% Simulink data dictionary LightCtrlParameter.sldd

P_AHBC_TURN_LAMP_ENABLE = Simulink.Parameter(1, DataType="boolean")
P_AHBC_FOG_ENABLE = Simulink.Parameter(1, DataType="boolean")
P_AHBC_ABS_ENABLE = Simulink.Parameter(1, DataType="boolean")
P_AHBC_ESP_ENABLE = Simulink.Parameter(1, DataType="boolean")
P_AHBC_WIPER_ENABLE = Simulink.Parameter(1, DataType="boolean")
P_AHBC_MAX_TAILLIGHT_DISTANCE_COUPLE2 = Simulink.Parameter(1000)
P_AHBC_MAX_ONCOMING_DISTANCE_COUPLE2 = Simulink.Parameter(1000)
P_AHBC_MAX_TAILLIGHT_DISTANCE_ONE2 = Simulink.Parameter(1000)
P_AHBC_MAX_ONCOMING_DISTANCE_ONE2 = Simulink.Parameter(1000)
P_AHBC_FOG_TIME = Simulink.Parameter(3, DataType="uint8")
P_AHBC_WIPER_TIME = Simulink.Parameter(3, DataType="uint8")
P_AHBC_HIGHBEAM_ACTIVE_GRACE = Simulink.Parameter(500, DataType="uint16")
P_AHBC_SPEED_SWITCH_HIGH_BEAM_ON2 = Simulink.Parameter(45, DataType="single")
P_AHBC_SPEED_SWITCH_HIGH_BEAM_OFF2 = Simulink.Parameter(5, DataType="single")
P_AHBC_LAT_ACC_EXIT = Simulink.Parameter(3, DataType="single")
P_AHBC_LAT_ACC_ENTER = Simulink.Parameter(5, DataType="single")
P_AHBC_YAW_RATE_ENTER = Simulink.Parameter(0.5, DataType="single")
P_AHBC_YAW_RATE_EXIT = Simulink.Parameter(0.3, DataType="single")
AHBC_LowPriorityTransformSuppression = Simulink.Signal(DataType="boolean")
AHBC_HighPriorityTransformSuppression = Simulink.Signal(DataType="boolean")
AHBC_LaserSuppression = Simulink.Signal(DataType="boolean")
P_AHBC_DRIVE_DIRECTION_ENABLE = Simulink.Parameter(1, DataType="boolean")
AHBC_HighBeamSuppression = Simulink.Signal(DataType="boolean")
AHBC_LSV_Distance1 = Simulink.Signal(DataType="uint16")
AHBC_LSV_Right_Angle1 = Simulink.Signal(DataType="single")
AHBC_LSV_Left_Angle1 = Simulink.Signal(DataType="single")
AHBC_LSV_Distance2 = Simulink.Signal(DataType="uint16")
AHBC_LSV_Right_Angle2 = Simulink.Signal(DataType="single")
AHBC_LSV_Left_Angle2 = Simulink.Signal(DataType="single")
AHBC_LSV_Distance3 = Simulink.Signal(DataType="uint16")
AHBC_LSV_Right_Angle3 = Simulink.Signal(DataType="single")
AHBC_LSV_Left_Angle3 = Simulink.Signal(DataType="single")
AHBC_LSV_Distance4 = Simulink.Signal(DataType="uint16")
AHBC_LSV_Right_Angle4 = Simulink.Signal(DataType="single")
AHBC_LSV_Left_Angle4 = Simulink.Signal(DataType="single")
AHBC_LSV_Distance5 = Simulink.Signal(DataType="uint16")
AHBC_LSV_Right_Angle5 = Simulink.Signal(DataType="single")
AHBC_LSV_Left_Angle5 = Simulink.Signal(DataType="single")
AHBC_LSV_Distance6 = Simulink.Signal(DataType="uint16")
AHBC_LSV_Right_Angle6 = Simulink.Signal(DataType="single")
AHBC_LSV_Left_Angle6 = Simulink.Signal(DataType="single")

UserDefined_LSV_ELEM_BUS = Simulink.Bus()
  LSV_ID_Out: uint8, Min=0, Max=255  % Light object ID. Range is 1-255, while 0 indicates that the field in unfilled.
  LSV_Is_New_Out: uint8, Min=0, Max=1  % Indicates whether the object was not first detected at the current frame. Due to a bug in the implementation.
  LSV_Confidence_Out: single, Min=0, Max=1  % DNN Confidence value
  LSV_Consecutive_Detection_Out: int8, Min=-5, Max=100  % The number of consecutive frames in which the light object was approved.
  LSV_Type_Out: uint8, Min=0, Max=6  % Describes the vehicle light type.
    % In case of a cluster it represents the type of the closest vehicle in the cluster.
    % Clearance = Truck cabin top lights.
  LSV_Sub_Type_Out: uint8, Min=0, Max=63  % Vehicle sub type.
  LSV_CL_Sub_Type_Out: uint8, Min=0, Max=6  % ENUM describes cluster sub type. If not cluster = 0
  LSV_Distance_Out: uint16, Min=0, Max=1000
  LSV_Right_Angle_Out: single, Min=-40, Max=40  % Angle to right of light rectangle
  LSV_Left_Angle_Out: single, Min=-40, Max=40  % Angle to left of light rectangle
  LSV_Top_Angle_Out: single, Min=-10, Max=10  % Angle to top of light rectangle
  LSV_Angular_Velocity_Right_Out: single, Min=-128, Max=127.875  % Angular velocity based on angle to right of light rectangle (can be couple)
  LSV_Angular_Velocity_Left_Out: single, Min=-128, Max=127.875  % Angular velocity based on angle to left of light rectangle (can be couple)

UserDefined_LSR_ELEM_BUS = Simulink.Bus()
  LSR_ID_Out: uint8, Min=0, Max=255  % Light object ID. Range is 1-255, while 0 indicates that the field in unfilled.
  LSR_Distance_Out: uint16, Min=0, Max=1000
  LSR_Right_Angle_Out: single, Min=-40, Max=40  % Angle to right of light rectangle
  LSR_Left_Angle_Out: single, Min=-40, Max=40  % Angle to left of light rectangle
  LSR_Top_Angle_Out: single, Min=-10, Max=10  % Angle to top of light rectangle

P_AHBC_TrafficStyle = Simulink.Parameter(1, DataType="uint8")