% Simulink data dictionary DMS_Parameter.sldd

P_DMS_tDSGoodUnbeliv2LowDistrctn = Simulink.Parameter(1, DataType="single", Unit="s")
P_DMS_tDSGoodUnbeliv2LowDrowsns = Simulink.Parameter(3, DataType="single", Unit="s")
P_DMS_tDSGoodUnbeliv2MidDistractn = Simulink.Parameter(2, DataType="single")
P_DMS_tDSGoodUnbeliv2MidDrowsns = Simulink.Parameter(3, DataType="single", Unit="s")
P_DMS_tDSLow2MidDistractn = Simulink.Parameter(2, DataType="single", Unit="s")
P_DMS_tDSLow2MidDrowsns = Simulink.Parameter(3, DataType="single", Unit="s")
P_DMS_tDSOther2Hi1Drowsns = Simulink.Parameter(0.5, DataType="single", Unit="s")
P_DMS_tDSOther2Hi1Distractn = Simulink.Parameter(2, DataType="single")
P_DMS_tDSOther2Hi2Distractn = Simulink.Parameter(5, DataType="single", Unit="s")
P_DMS_tDSOther2Hi2Drowsns = Simulink.Parameter(3, DataType="single", Unit="s")
DMS_DistractnSts = Simulink.Signal(StorageClass="ExportedGlobal")
DMS_DrowsnsSts = Simulink.Signal(StorageClass="ExportedGlobal")
DMS_DriverSts = Simulink.Signal(StorageClass="ExportedGlobal")