% Simulink data dictionary EHR_Data_Dictionary.sldd

CAMERA_STATE_INITIAL = Simulink.Parameter(1, DataType="uint8")
CAMERA_STATE_NORMAL = Simulink.Parameter(2, DataType="uint8")
CURVATURE_UNKNOWN = Simulink.Parameter(1, DataType="single")
DRIVING_ON_HIGHWAY_NO = Simulink.Parameter(2, DataType="uint8")
DRIVING_ON_HIGHWAY_UNKONWN = Simulink.Parameter(0, DataType="uint8")
DRIVING_ON_HIGHWAY_YES = Simulink.Parameter(1, DataType="uint8")
EHR_CYCLE = Simulink.Parameter(0.02, DataType="single")
ENTER_BRIDGE_INFO_NO = Simulink.Parameter(2, DataType="uint8")
ENTER_BRIDGE_INFO_UNKONWN = Simulink.Parameter(0, DataType="uint8")
ENTER_BRIDGE_INFO_YES = Simulink.Parameter(1, DataType="uint8")
ENTER_TUNNEL_INFO_NO = Simulink.Parameter(2, DataType="uint8")
ENTER_TUNNEL_INFO_UNKONWN = Simulink.Parameter(0, DataType="uint8")
ENTER_TUNNEL_INFO_YES = Simulink.Parameter(1, DataType="uint8")
FORM_OF_WAY_NO = Simulink.Parameter(2, DataType="uint8")
FORM_OF_WAY_RING_ROAD = Simulink.Parameter(3, DataType="uint8")
FORM_OF_WAY_UNKONWN = Simulink.Parameter(0, DataType="uint8")
FORM_OF_WAY_YES = Simulink.Parameter(1, DataType="uint8")
FORWARD_LOOKING_DISTANCE_LIMIT = Simulink.Parameter(3000, DataType="single")
IFC_HUT_INTERFACE_NO_RESPONSE = Simulink.Parameter(0, DataType="uint8")
IFC_HUT_INTERFACE_RESPONSE = Simulink.Parameter(1, DataType="uint8")
MAP_DATA_VALID_INVALID = Simulink.Parameter(2, DataType="uint8")
MAP_DATA_VALID_VALID = Simulink.Parameter(1, DataType="uint8")
MSG_TYPE_PROFILE_LONG = Simulink.Parameter(5, DataType="uint8")
MSG_TYPE_PROFILE_SHORT = Simulink.Parameter(4, DataType="uint8")
MSG_TYPE_SEGMENT = Simulink.Parameter(2, DataType="uint8")
MSG_TYPE_STUB = Simulink.Parameter(3, DataType="uint8")
NUM_OF_LANE_DRIVER_DIRECTION_UNKNOWN = Simulink.Parameter(7, DataType="uint8")
OFFSET_INVALID = Simulink.Parameter(8191, DataType="uint16")
OFFSET_MAX = Simulink.Parameter(8190, DataType="uint16")
OFFSET_MIN = Simulink.Parameter(0, DataType="uint16")
PROFILE_LONG_TYPE_TRAFFIC_SIGN = Simulink.Parameter(8, DataType="uint8")
PROFILE_LONG_VALUE_ELECTRONIC_EYE = Simulink.Parameter(250, DataType="uint8")
PROFILE_LONG_VALUE_LANE_MERGE_RIGHT = Simulink.Parameter(44, DataType="uint8")
PROFILE_SHORT_NO_OTHER_VALUE = Simulink.Parameter(0, DataType="uint8")
PROFILE_SHORT_TYPE_CURVATURE = Simulink.Parameter(1, DataType="uint8")
PROFILE_SHORT_TYPE_SLOPE = Simulink.Parameter(3, DataType="uint8")
REAR_LOOKING_DISTANCE_LIMIT = Simulink.Parameter(-2000, DataType="single")
SEGMENT_FORM_OF_WAY_HIGH_RING_ROAD = Simulink.Parameter(9, DataType="uint8")
SEGMENT_FORM_OF_WAY_MAIN_ROAD = Simulink.Parameter(2, DataType="uint8")
SEGMENT_FORM_OF_WAY_NORMAL_RING_ROAD = Simulink.Parameter(10, DataType="uint8")
SEGMENT_FUNC_ROAD_CLASS_EXPRESSWAY = Simulink.Parameter(1, DataType="uint8")
SEGMENT_IS_PART_OF_A_BRIDGE = Simulink.Parameter(1, DataType="uint8")
SEGMENT_IS_PART_OF_A_TUNNEL = Simulink.Parameter(1, DataType="uint8")
SEGMENT_SPEED_LIMIT_5KMH = Simulink.Parameter(1, DataType="uint8")
SEGMENT_SPEED_LIMIT_7KMH = Simulink.Parameter(2, DataType="uint8")
SEGMENT_SPEED_LIMIT_TYPE_ELECTRONIC_EYE = Simulink.Parameter(5, DataType="uint8")
SEGMENT_SPEED_LIMIT_UNKNOWN = Simulink.Parameter(0, DataType="uint8")
SEGMENT_SPEED_LIMIT_UNLIMITED = Simulink.Parameter(30, DataType="uint8")
SLOPE_UNKNOWN = Simulink.Parameter(60, DataType="single")
SPEED_LIMIT_UNKNOWN = Simulink.Parameter(0, DataType="uint8")
SPEED_LIMIT_UNLIMITED = Simulink.Parameter(255, DataType="uint8")
STUB_FORM_OF_WAY_HIGH_RING_ROAD = Simulink.Parameter(9, DataType="uint8")
STUB_FORM_OF_WAY_NORMAL_RING_ROAD = Simulink.Parameter(10, DataType="uint8")
TRAFFIC_SIGN_UNKNOWN = Simulink.Parameter(255, DataType="uint8")
PROFILE_LONG_TYPE_WEATHER_SIGN = Simulink.Parameter(20, DataType="uint8")
WEATHER_TYPE_UNKNOWN = Simulink.Parameter(127, DataType="uint8")
TEMPERATURE_UNKNOWN = Simulink.Parameter(127, DataType="int8")
PROFILE_LONG_TYPE_TRAFFIC_EVENT = Simulink.Parameter(19, DataType="uint8")
PROFILE_LONG_VALUE_TRAFFIC_JAM = Simulink.Parameter(4, DataType="uint8")
PROFILE_LONG_VALUE_REPAIR_ROAD_POINT = Simulink.Parameter(11, DataType="uint8")
FUNC_ROAD_CLASS_UNKNOWN = Simulink.Parameter(0, DataType="uint8")
BUILD_UP_AREA_UNKNOWN = Simulink.Parameter(2, DataType="uint8")
STUB_CMPLX_INSCT = Simulink.Parameter(1, DataType="uint8")
SPEED_LIMIT_TYPE_UNKNOWN = Simulink.Parameter(7, DataType="uint8")
DISTANCE_UNKONWN = Simulink.Parameter(1201, DataType="uint16")

ProfileShortStruct = Simulink.Bus()
  ProfShortOffset: uint16
  ProfShortMsgType: uint8
  ProfShortPathIdx: uint8
  ProfShortCycCnt: uint8
  ProfShortUpdate: boolean
  ProfShortRetr: boolean
  ProfShortCtrlPoint: boolean
  ProfShortProfType: uint8
  ProfShortDist1: uint16
  ProfShortAccurClass: uint8
  ProfShortValue0: uint16
  ProfShortValue1: uint16
  ProfShortRelativeOffset: int16

ProfileLongStruct = Simulink.Bus()
  ProfLongOffset: uint16
  ProfLongMsgType: uint8
  ProfLongPathIdx: uint8
  ProfLongCycCnt: uint8
  ProfLongUpdate: boolean
  ProfLongRetr: boolean
  ProfLongCtrlPoint: boolean
  ProfLongProfType: uint8
  ProfLongValue: uint32
  ProfLongRelativeOffset: int16

PositionStruct = Simulink.Bus()
  PosnOffset: uint16
  PosnMsgType: uint8
  PosnPathIdx: uint8
  PosnCycCnt: uint8
  PosnAge: uint16
  PosnPosProbb: single
  PosnIdx: uint8
  PosnSpd: single
  PosnCurLane: uint8
  PosnPosConfdc: uint8
  PosnRehead: single

SegmentStruct = Simulink.Bus()
  SegOffset: uint16
  SegMsgType: uint8
  SegPathIdx: uint8
  SegCycCnt: uint8
  SegUpdate: boolean
  SegRetr: boolean
  SegBuildUpArea: uint8
  SegBridge: uint8
  SegTunnel: uint8
  SegFuncRoadClass: uint8
  SegRelProbb: single
  SegFormOfWay: uint8
  SegCmplxInsct: uint8
  SegPartOfCalcRoute: uint8
  SegEffSpdLmtType: uint8
  SegEffSpdLmt: uint8
  SegNumOfLaneDrvDir: uint8
  SegNumOfLaneOppDir: uint8
  SegDivideRoad: uint8
  SegRelativeOffset: int16

StubStruct = Simulink.Bus()
  StubOffset: uint16
  StubMsgType: uint8
  StubPathIdx: uint8
  StubCycCnt: uint8
  StubUpdate: boolean
  StubRetr: boolean
  StubStubPathIdx: uint8
  StubFuncRoadClass: uint8
  StubRelProbb: single
  StubFormOfWay: uint8
  StubCmplxInsct: uint8
  StubPartOfCalcRoute: uint8
  StubTurnAngl: single
  StubNumOfLaneDrvDir: uint8
  StubNumOfLaneOppDir: uint8
  StubRtOfWay: uint8
  StubLastStub: boolean
  StubRelativeOffset: int16

MetaDataStruct = Simulink.Bus()
  MetaCountryCode: uint16
  MetaMapProvider: uint8
  MetaMsgType: uint8
  MetaHwVer: uint16
  MetaProtVerMinorSub: uint8
  MetaProtVerMajor: uint8
  MetaCycCnt: uint8
  MetaRegionCode: uint16
  MetaDrvSide: boolean
  MetaMapVerYear: uint8
  MetaMapVerQtr: uint8
  MetaProtVerMinor: uint8
  MetaSpdUnits: boolean