% Simulink data dictionary EHR_Parameter.sldd

EHRV2_DrivingOnHighWay = Simulink.Signal(StorageClass="ExportedGlobal")
EHRV2_FormOfWay = Simulink.Signal(StorageClass="ExportedGlobal")
EHRV2_TunnelDistance = Simulink.Signal(StorageClass="ExportedGlobal")
EHRV2_EnterTunnelInfo = Simulink.Signal(StorageClass="ExportedGlobal")
EHRV2_BridgeDistance = Simulink.Signal(StorageClass="ExportedGlobal")
EHRV2_EnterBridgeInfo = Simulink.Signal(StorageClass="ExportedGlobal")
EHRV2_RampDistance = Simulink.Signal(StorageClass="ExportedGlobal")
EHRV2_RampInDistance = Simulink.Signal(StorageClass="ExportedGlobal")
EHRV2_RampOutDistance = Simulink.Signal(StorageClass="ExportedGlobal")
EHRV2_NumOfLaneDrvDir = Simulink.Signal(StorageClass="ExportedGlobal")
EHRV2_TrafficSignDistance = Simulink.Signal(StorageClass="ExportedGlobal")
EHRV2_TrafficSignValue = Simulink.Signal(StorageClass="ExportedGlobal")
EHRV2_SpeedLimit = Simulink.Signal(StorageClass="ExportedGlobal")
EHRV2_SpeedUnit = Simulink.Signal(StorageClass="ExportedGlobal")
EHRV2_ElectronicEyeDistance = Simulink.Signal(StorageClass="ExportedGlobal")
EHRV2_ElectronicEyeSpeedLimit = Simulink.Signal(StorageClass="ExportedGlobal")
EHRV2_RoadCurvature = Simulink.Signal(StorageClass="ExportedGlobal")
EHRV2_RoadCurvatureFar = Simulink.Signal(StorageClass="ExportedGlobal")
EHRV2_RoadCurvatureFarDistance = Simulink.Signal(StorageClass="ExportedGlobal")
EHRV2_RoadSlope = Simulink.Signal(StorageClass="ExportedGlobal")
EHRV2_RoadSlopeFar = Simulink.Signal(StorageClass="ExportedGlobal")
EHRV2_RoadCurvatureValueMatrix = Simulink.Signal(StorageClass="ExportedGlobal")
EHRV2_RoadCurvatureDistanceMatrix = Simulink.Signal(StorageClass="ExportedGlobal")
EHRV2_RoadCurvatureMatrixSize = Simulink.Signal(StorageClass="ExportedGlobal")
EHRV2_RoadSlopeValueMatrix = Simulink.Signal(StorageClass="ExportedGlobal")
EHRV2_RoadSlopeDistanceMatrix = Simulink.Signal(StorageClass="ExportedGlobal")
EHRV2_RoadSlopeMatrixSize = Simulink.Signal(StorageClass="ExportedGlobal")
EHRV2_IFCHUTInterface = Simulink.Signal(StorageClass="ExportedGlobal")
EHRV2_MapDataValid = Simulink.Signal(StorageClass="ExportedGlobal")
EHRV2_ForecastTreeResetFlag = Simulink.Signal(StorageClass="ExportedGlobal")
EHRV2_StubIsUpdated = Simulink.Signal(StorageClass="ExportedGlobal")
EHRV2_StubIsInDataWindow = Simulink.Signal(StorageClass="ExportedGlobal")
EHRV2_StubVectorSize = Simulink.Signal(StorageClass="ExportedGlobal")
EHRV2_SegmentIsUpdated = Simulink.Signal(StorageClass="ExportedGlobal")
EHRV2_SegmentIsInDataWindow = Simulink.Signal(StorageClass="ExportedGlobal")
EHRV2_SegmentVectorSize = Simulink.Signal(StorageClass="ExportedGlobal")
EHRV2_PositionOffsetCycles = Simulink.Signal(StorageClass="ExportedGlobal")
EHRV2_PositionJumpOutOfRange = Simulink.Signal(StorageClass="ExportedGlobal")
EHRV2_PositionJumpOutOfRangeCycles = Simulink.Signal(StorageClass="ExportedGlobal")
EHRV2_PositionPathIdxInvalid = Simulink.Signal(StorageClass="ExportedGlobal")
EHRV2_PositionPathIdxInvalidCycles = Simulink.Signal(StorageClass="ExportedGlobal")
EHRV2_IFCHUTInterfaceCycles = Simulink.Signal(StorageClass="ExportedGlobal")
EHRV2_IFCHUTInterfaceNoResponseFlag1 = Simulink.Signal(StorageClass="ExportedGlobal")
EHRV2_IFCHUTInterfaceNoResponseFlag1Cycles = Simulink.Signal(StorageClass="ExportedGlobal")
EHRV2_IFCHUTInterfaceNoResponseFlag2 = Simulink.Signal(StorageClass="ExportedGlobal")
EHRV2_IFCHUTInterfaceNoResponseFlag2Cycles = Simulink.Signal(StorageClass="ExportedGlobal")
EHRV2_ProfileShortIsUpdated = Simulink.Signal(StorageClass="ExportedGlobal")
EHRV2_ProfileShortIsInDataWindow = Simulink.Signal(StorageClass="ExportedGlobal")
EHRV2_ProfileShortVectorSize = Simulink.Signal(StorageClass="ExportedGlobal")
EHRV2_ProfileLongIsUpdated = Simulink.Signal(StorageClass="ExportedGlobal")
EHRV2_ProfileLongIsInDataWindow = Simulink.Signal(StorageClass="ExportedGlobal")
EHRV2_ProfileLongVectorSize = Simulink.Signal(StorageClass="ExportedGlobal")
P_EHRV2_vVehSpeedHighForMapDataValid = Simulink.Parameter(55, StorageClass="ExportedGlobal", DataType="single")
P_EHRV2_tPositionOffsetNotUpdateForMapDataValid = Simulink.Parameter(3, StorageClass="ExportedGlobal", DataType="single")
P_EHRV2_tPositionOffsetInvalidForMapDataValid = Simulink.Parameter(0.5, StorageClass="ExportedGlobal", DataType="single")
P_EHRV2_tPositionJumpOutOfRangeForMapDataValid = Simulink.Parameter(30, StorageClass="ExportedGlobal", DataType="single")
P_EHRV2_tIFCHUTResponseTimeout = Simulink.Parameter(20, StorageClass="ExportedGlobal", DataType="single")
P_EHRV2_tIFCHUTNoResponseOfForecastTreeReset = Simulink.Parameter(1, StorageClass="ExportedGlobal", DataType="single")
P_EHRV2_tIFCHUTNoResponseOfTimeout = Simulink.Parameter(0.08, StorageClass="ExportedGlobal", DataType="single")
P_EHRV2_dVehRearLooking = Simulink.Parameter(-600, StorageClass="ExportedGlobal", DataType="single")
P_EHRV2_dVehForwardLooking = Simulink.Parameter(1200, StorageClass="ExportedGlobal", DataType="single")
P_EHRV2_dSlopeMatrix = Simulink.Parameter(300, StorageClass="ExportedGlobal", DataType="single")
P_EHRV2_dSlopeFar = Simulink.Parameter(60, StorageClass="ExportedGlobal", DataType="single")
P_EHRV2_dPositionJumpOutOfRangeForMapDataValid = Simulink.Parameter(50, StorageClass="ExportedGlobal", DataType="single")
P_EHRV2_dCurvatureMatrix = Simulink.Parameter(300, StorageClass="ExportedGlobal", DataType="single")
P_EHRV2_dCurvatureFar = Simulink.Parameter(300, StorageClass="ExportedGlobal", DataType="single")
P_EHRV2_tPositionPathIdxInvalidForMapDataValid = Simulink.Parameter(3, StorageClass="ExportedGlobal", DataType="single")