% Simulink data dictionary HMI_Parameter.sldd

HMI_Counter = Simulink.Signal(StorageClass="ExportedGlobal")
P_HMI_ObjectTypeFilter = Simulink.Parameter(1, StorageClass="ExportedGlobal", DataType="single")
P_HMI_LDW_LKAWarnTime = Simulink.Parameter(10, StorageClass="ExportedGlobal", DataType="single")
P_HMI_WarnFormLDWReq = Simulink.Parameter(1, DataType="uint8")
HMI_SubModel_VERSION = Simulink.Signal()
HMI_SubModel_Number = Simulink.Signal()