% Simulink data dictionary VLC.sldd

LongCtrl_axvClosedLoopControl = Simulink.Signal(StorageClass="ExportedGlobal")
LongCtrl_axvDiff = Simulink.Signal(StorageClass="ExportedGlobal")
LongCtrl_axvModelDiff = Simulink.Signal(StorageClass="ExportedGlobal")
LongCtrl_axvModelRef = Simulink.Signal(StorageClass="ExportedGlobal")
LongCtrl_axvModelResidual = Simulink.Signal(StorageClass="ExportedGlobal")
LongCtrl_axvTracActMean = Simulink.Signal(StorageClass="ExportedGlobal")
LongCtrl_axvTracMin = Simulink.Signal(StorageClass="ExportedGlobal")
LongCtrl_DCEnable = Simulink.Signal(StorageClass="ExportedGlobal")
LongCtrl_ECEnable = Simulink.Signal(StorageClass="ExportedGlobal")
LongCtrl_FF_NetEngTorq = Simulink.Signal(StorageClass="ExportedGlobal")
LongCtrl_FF_NetEngTorqInc = Simulink.Signal(StorageClass="ExportedGlobal")
LongCtrl_FF_NetEngTorqMax = Simulink.Signal(StorageClass="ExportedGlobal", Unit="%")
LongCtrl_Fz = Simulink.Signal(StorageClass="ExportedGlobal")
LongCtrl_OverrideToDC = Simulink.Signal(StorageClass="ExportedGlobal")
LongCtrl_PI_NetEngTorq = Simulink.Signal(StorageClass="ExportedGlobal")
LongCtrl_PI_NetEngTorqInc = Simulink.Signal(StorageClass="ExportedGlobal")
LongCtrl_Sw2DC = Simulink.Signal(StorageClass="ExportedGlobal")
LongCtrl_Sw2DC1 = Simulink.Signal(StorageClass="ExportedGlobal")
LongCtrl_Sw2DC2 = Simulink.Signal(StorageClass="ExportedGlobal")
LongCtrl_Sw2DC3 = Simulink.Signal(StorageClass="ExportedGlobal")
LongCtrl_Sw2DC4 = Simulink.Signal(StorageClass="ExportedGlobal")
LongCtrl_Sw2DC5 = Simulink.Signal(StorageClass="ExportedGlobal")
LongCtrl_Sw2DC6 = Simulink.Signal(StorageClass="ExportedGlobal")
LongCtrl_Sw2DC7 = Simulink.Signal(StorageClass="ExportedGlobal")
LongCtrl_Sw2EC = Simulink.Signal(StorageClass="ExportedGlobal")
LongCtrl_Sw2EC1 = Simulink.Signal(StorageClass="ExportedGlobal")
LongCtrl_Sw2EC2 = Simulink.Signal(StorageClass="ExportedGlobal")
LongCtrl_Sw2EC3 = Simulink.Signal(StorageClass="ExportedGlobal")
LongCtrl_Sw2EC4 = Simulink.Signal(StorageClass="ExportedGlobal")
LongCtrl_Sw2EC5 = Simulink.Signal(StorageClass="ExportedGlobal")
LongCtrl_Tr_Ratio = Simulink.Signal(StorageClass="ExportedGlobal")
LongCtrl_UpdateEnable_axvModeldiff = Simulink.Signal(StorageClass="ExportedGlobal")
LongCtrl_VlcInternalAcc = Simulink.Signal(StorageClass="ExportedGlobal")
LongCtrl_ACC_EngTrqReq = Simulink.Signal(StorageClass="ExportedGlobal")
LongCtrl_ACC_Decel_ReqValue = Simulink.Signal(StorageClass="ExportedGlobal")
P_LongCtrl_VLCaXCDeadZoneProp_Y = Simulink.Parameter([60 10 0 0 0 10 60], StorageClass="ExportedGlobal", DataType="single")
P_LongCtrl_VLCaxCtrlDevDeadZoneChar_Y = Simulink.Parameter([0.15 0.15 0.18 0.2 0.2], StorageClass="ExportedGlobal", DataType="single")
P_LongCtrl_VLCaxCtrlDevEC2DCMax = Simulink.Parameter(0.5, StorageClass="ExportedGlobal", DataType="single")
P_LongCtrl_VLCaxCtrlDevFastQuitDCMode = Simulink.Parameter(0.7, StorageClass="ExportedGlobal", DataType="single")
P_LongCtrl_VLCAxCtrlDevThresAddEC2DC_Y = Simulink.Parameter([0.1 0.1 0.15 0.2 0.2], StorageClass="ExportedGlobal", DataType="single")
P_LongCtrl_VLCdaxTarEC2DCMax = Simulink.Parameter(-0.2, StorageClass="ExportedGlobal", DataType="single")
P_LongCtrl_VLCdriveOffAxUpLimXAxix = Simulink.Parameter([0 0.5 1 1.5 3], StorageClass="ExportedGlobal", DataType="single")
LongCtrl_Counter = Simulink.Signal(StorageClass="ExportedGlobal")
P_LongCtrl_VLCAxTarDtThreEnableI = Simulink.Parameter(0.4, StorageClass="ExportedGlobal", DataType="single", Min=0, Max=5, Unit="m/s^3")
P_LongCtrl_VLCaxvRoadSlopeDC4CharXAxis = Simulink.Parameter([-0.5 -0.3 -0.2 -0.1 0], StorageClass="ExportedGlobal", DataType="single", Min=-4, Max=1, Unit="m/s^2")
P_LongCtrl_VLCaxvRoadSlopeDC4CharYAxis = Simulink.Parameter([0 0.2 0.4 0.8 1], StorageClass="ExportedGlobal", DataType="single", Min=0, Max=1)
P_LongCtrl_VLCAxvTracMinDC1FullFillXAxis = Simulink.Parameter([0 10 15 30], StorageClass="ExportedGlobal", DataType="single", Min=0, Max=60, Unit="m/s")
P_LongCtrl_VLCAxvTracMinDC1FullFillYAxis = Simulink.Parameter([0 0 0 0], StorageClass="ExportedGlobal", DataType="single", Min=-1, Max=1, Unit="m/s^2")
P_LongCtrl_VLCcoefFXAxis = Simulink.Parameter([0 20 40 60 80 100 120 140 160 180], StorageClass="ExportedGlobal", DataType="single", Min=0, Max=250, Unit="km/h")
P_LongCtrl_VLCcoefFYAxis = Simulink.Parameter([0.0111 0.0112 0.0114 0.0117 0.0122 0.0127 0.0136 0.0147 0.0162 0.0183], StorageClass="ExportedGlobal", DataType="single", Min=0, Max=1)
P_LongCtrl_VLCcoefIFadeOut1Calc = Simulink.Parameter(4, StorageClass="ExportedGlobal", DataType="single", Min=1, Max=10)
P_LongCtrl_VLCcoefIFadeOut1Condition = Simulink.Parameter(0.75, StorageClass="ExportedGlobal", DataType="single", Min=0, Max=1)
P_LongCtrl_VLCcoefIFadeOut2Calc = Simulink.Parameter(3, StorageClass="ExportedGlobal", DataType="single", Min=1, Max=10)
P_LongCtrl_VLCcoefIFadeOut2Condition = Simulink.Parameter(0.5, StorageClass="ExportedGlobal", DataType="single", Min=0, Max=1)
P_LongCtrl_VLCcoefIFadeOut3Calc = Simulink.Parameter(2, StorageClass="ExportedGlobal", DataType="single", Min=1, Max=10)
P_LongCtrl_VLCcoefIFadeOut3Condition = Simulink.Parameter(0.25, StorageClass="ExportedGlobal", DataType="single", Min=0, Max=1)
P_LongCtrl_VLCCounterAxvTracMinTimeout = Simulink.Parameter(40, StorageClass="ExportedGlobal", DataType="single", Min=0, Max=100)
P_LongCtrl_VLCCounterDC2ECTorqDelay = Simulink.Parameter(15, StorageClass="ExportedGlobal", DataType="single", Min=0, Max=100)
P_LongCtrl_VLCCounterDrvOff2EC = Simulink.Parameter(2, StorageClass="ExportedGlobal", DataType="single", Min=0, Max=100)
P_LongCtrl_VLCDtAxvRef2UpperBandDC5 = Simulink.Parameter(-0.5, StorageClass="ExportedGlobal", DataType="single", Min=-1, Max=1)
P_LongCtrl_VLCIACompensionNeg = Simulink.Parameter(-0.05, StorageClass="ExportedGlobal", DataType="single", Min=-3, Max=0, Unit="m/s^2")
P_LongCtrl_VLCIACompensionPos = Simulink.Parameter(0.05, StorageClass="ExportedGlobal", DataType="single", Min=0, Max=3, Unit="m/s^2")
P_LongCtrl_VLCki = Simulink.Parameter(0.05, StorageClass="ExportedGlobal", DataType="single")
P_LongCtrl_VLCkp = Simulink.Parameter(4, StorageClass="ExportedGlobal", DataType="single")
P_LongCtrl_VLCks = Simulink.Parameter(0.45, StorageClass="ExportedGlobal", DataType="single")
P_LongCtrl_VLCTorqDiffThreAxvTracMinTimeout = Simulink.Parameter(4, StorageClass="ExportedGlobal", DataType="single", Min=0, Max=20)
P_LongCtrl_VLCTrTatioMax = Simulink.Parameter(18, StorageClass="ExportedGlobal", DataType="single", Min=10, Max=30)
P_LongCtrl_VLCTrTatioMin = Simulink.Parameter(0.5, StorageClass="ExportedGlobal", DataType="single", Min=0.1, Max=1)
P_LongCtrl_VLCaccelMinHoldXAxis = Simulink.Parameter([1 3], StorageClass="ExportedGlobal", DataType="single", Min=0, Max=5, Unit="m/s^2")
P_LongCtrl_VLCaccelMinHoldYAxis = Simulink.Parameter([-2 -4], StorageClass="ExportedGlobal", DataType="single", Min=-6, Max=0, Unit="m/s^2")
P_LongCtrl_VLCjerkHoldXAxis = Simulink.Parameter([1 3], StorageClass="ExportedGlobal", DataType="single", Min=0, Max=4, Unit="m/s^2")
P_LongCtrl_VLCjerkHoldYAxis = Simulink.Parameter([-5 -30], StorageClass="ExportedGlobal", DataType="single", Min=-50, Max=0, Unit="m/s^3")
Longctrl_VIE_alpSideSlipAngle = Simulink.Signal(StorageClass="ExportedGlobal")
Longctrl_VIE_AxRefDt = Simulink.Signal(StorageClass="ExportedGlobal")
Longctrl_VIE_axRefMs2 = Simulink.Signal(StorageClass="ExportedGlobal")
P_LongCtrl_VLCdriveOffAxUpLimYAxix = Simulink.Parameter([1.5 1.5 1.6 1.8 2], StorageClass="ExportedGlobal", DataType="single")
P_LongCtrl_VLC_fRollCoef = Simulink.Parameter(0.395, StorageClass="ExportedGlobal")
P_LongCtrl_VLC_WindArea = Simulink.Parameter(2.4, StorageClass="ExportedGlobal", Unit="m^2")
P_LongCtrl_VLCTrRatioCharMaXAxis = Simulink.Parameter([3.38431 4.45086 5.42452 6.14307 6.90785 7.67253 8.43716 8.99323 9.82728 11.0319 12.0047 12.9774 13.8804 14.8066 15.6401 16.404 18 20], StorageClass="ExportedGlobal", DataType="single", Min=1, Max=30)
P_LongCtrl_VLCMaRatioCharMaYAxis = Simulink.Parameter([1.04928 1.05921 1.07148 1.0827 1.09735 1.1143 1.1324 1.14598 1.1675 1.20037 1.23103 1.26514 1.29928 1.33456 1.36872 1.40176 1.41 1.41], StorageClass="ExportedGlobal", DataType="single", Min=0, Max=3)
P_LongCtrl_VLCaDtThresUpdateTorq = Simulink.Parameter(5, StorageClass="ExportedGlobal", DataType="single", Min=0, Max=10, Unit="m/s^3")
P_LongCtrl_VLCaxCtrlDevTresAddDC2ECYAxis = Simulink.Parameter([0.15 0.15 0.12 0.1 0.1], StorageClass="ExportedGlobal", DataType="single")
P_LongCtrl_VLCaxCtrlDevThresAddEC2DCCharYAxis = Simulink.Parameter([0.1 0.1 0.15 0.2 0.2], StorageClass="ExportedGlobal", DataType="single")
P_LongCtrl_VLCcoefKiEnlargeADiffYAxis = Simulink.Parameter([1 1 0.9 0.85 0.7 0.6 0.7 0.85 0.9 1 1], StorageClass="ExportedGlobal", DataType="single")
P_LongCtrl_VLCLowerJerkCounterDrvOff2EC = Simulink.Parameter(0, StorageClass="ExportedGlobal", DataType="single", Min=-4, Max=4, Unit="m/s^3")
P_LongCtrl_VLCcoefKiDiffDtEnlargeYAxis = Simulink.Parameter([0.25 0.55 0.9 1.1 1.15 1.3], StorageClass="ExportedGlobal", DataType="single", Min=0, Max=3)
P_LongCtrl_VLCcoefKiEnableYAxis = Simulink.Parameter([0 0 1 1 0 0], StorageClass="ExportedGlobal", DataType="single", Min=0, Max=2)
P_LongCtrl_VLCcoefPIYAxis = Simulink.Parameter([0 0 1 1], StorageClass="ExportedGlobal", DataType="single", Min=0, Max=2)
P_LongCtrl_VLCdiffDtCharCoefKiEnlargeXAxis = Simulink.Parameter([-6 -1.3 -0.2 0.3 2.5 15], StorageClass="ExportedGlobal", DataType="single", Min=-10, Max=20, Unit="m/s^3")
P_LongCtrl_VLCengEfficientCharYAxis = Simulink.Parameter([1.1 1.1 1 0.9 0.9], StorageClass="ExportedGlobal", DataType="single", Min=0.5, Max=2)
P_LongCtrl_VLCengInverseEfficientYAxis = Simulink.Parameter([-100 -20 0 20 100], StorageClass="ExportedGlobal", DataType="single", Min=-120, Max=120, Unit="%")
P_LongCtrl_VLCtorqCharEngEfficientXAxis = Simulink.Parameter([-100 -20 0 20 100], StorageClass="ExportedGlobal", DataType="single", Min=-100, Max=100, Unit="%")
P_LongCtrl_VLCtorqCharEngInverseEfficientXAxis = Simulink.Parameter([-110 -22 0 18 90], StorageClass="ExportedGlobal", DataType="single", Min=-150, Max=110, Unit="%")
P_LongCtrl_VLCvelCharAxCtrlDevDeadZoneXAxis = Simulink.Parameter([0 36 72 108 120], StorageClass="ExportedGlobal", DataType="single", Min=0, Max=250, Unit="km/h")
P_LongCtrl_VLCvelCharCoefPIXAxis = Simulink.Parameter([0 1.08 4 10], StorageClass="ExportedGlobal", DataType="single", Min=0, Max=30, Unit="km/h")
P_LongCtrl_VLCvelThresUpdateTorq = Simulink.Parameter(18, StorageClass="ExportedGlobal", DataType="single", Min=0, Max=30, Unit="km/h")
P_LongCtrl_VLCVlcAccThresAxvTracMinTimeout = Simulink.Parameter(0, StorageClass="ExportedGlobal", DataType="single", Min=-5, Max=2, Unit="m/s^2")
P_LongCtrl_VLCaDiffCharCoefKiEnableXAxis = Simulink.Parameter([-2 -0.9 -0.5 1.5 7 10], StorageClass="ExportedGlobal", DataType="single", Min=-10, Max=20, Unit="m/s^2")
P_LongCtrl_VLCaDiffCharCoefKiXAxis = Simulink.Parameter([-2.5 -2 -0.4 -0.17 -0.1 0 0.15 0.25 0.6 3 3.5], StorageClass="ExportedGlobal", DataType="single", Min=-5, Max=5, Unit="m/s^2")
P_LongCtrl_VLCaxDtCharAxCtrlDevTresAddDC2ECXAxis = Simulink.Parameter([0 0.1 0.3 0.5 0.7], StorageClass="ExportedGlobal", Min=0, Max=2, Unit="m/s^3")
P_LongCtrl_VLCaxDtCharAxCtrlDevTresAddEC2DCXAxis = Simulink.Parameter([-0.7 -0.5 -0.3 -0.1 0], StorageClass="ExportedGlobal", DataType="single", Min=-2, Max=1, Unit="m/s^2")
LongCtrl_SubModel_VERSION = Simulink.Signal(StorageClass="ExportedGlobal")
LongCtrl_SubModel_Number = Simulink.Signal(StorageClass="ExportedGlobal")
LongCtrl_vxvRefMs = Simulink.Signal(StorageClass="ExportedGlobal")
P_LongCtrl_VLCUpperJerkCounterDrvOff2EC = Simulink.Parameter(0, StorageClass="ExportedGlobal", DataType="single", Min=-4, Max=4, Unit="m/s^3")
LongCtrl_axvRoadSlopeMs2 = Simulink.Signal(StorageClass="ExportedGlobal")
Longctrl_NoBrakeForce = Simulink.Signal(StorageClass="ExportedGlobal")
Longctrl_VehicleStandStill = Simulink.Signal(StorageClass="ExportedGlobal")
Longctrl_CurrentGear = Simulink.Signal(StorageClass="ExportedGlobal")
Longctrl_ShiftinProgress = Simulink.Signal(StorageClass="ExportedGlobal")
Longctrl_NetEngTrq = Simulink.Signal(StorageClass="ExportedGlobal")
Longctrl_NetEngTorqNorm = Simulink.Signal(StorageClass="ExportedGlobal")
Longctrl_EngTqMinAct = Simulink.Signal(StorageClass="ExportedGlobal")
Longctrl_EngTqMaxActSpd = Simulink.Signal(StorageClass="ExportedGlobal")
Longctrl_EngSpd = Simulink.Signal(StorageClass="ExportedGlobal")
Longctrl_ACCSts = Simulink.Signal(StorageClass="ExportedGlobal")
Longctrl_ACC_DrvOFF_Req = Simulink.Signal(StorageClass="ExportedGlobal")
Longctrl_ACC_axvCvAim = Simulink.Signal(StorageClass="ExportedGlobal")
Longctrl_ACC_axv_ComfortBandLowerValue = Simulink.Signal(StorageClass="ExportedGlobal")
Longctrl_ACC_axv_ComfortBandUpperValue = Simulink.Signal(StorageClass="ExportedGlobal")
Longctrl_ACC_DecelerateJerk = Simulink.Signal(StorageClass="ExportedGlobal")
Longctrl_ACC_AccelerateJerk = Simulink.Signal(StorageClass="ExportedGlobal")
Longctrl_ACC_BrakePrefer = Simulink.Signal(StorageClass="ExportedGlobal")
Longctrl_ACC_DecelToStopReq = Simulink.Signal(StorageClass="ExportedGlobal")
Longctrl_tCycleVLC = Simulink.Signal(StorageClass="ExportedGlobal")
LongCtrl_VLC_DriveOffConditonFulfilled = Simulink.Signal(StorageClass="ExportedGlobal")
LongCtrl_FLWheelDriveDirection = Simulink.Signal(StorageClass="ExportedGlobal")
LongCtrl_FRWheelDriveDirection = Simulink.Signal(StorageClass="ExportedGlobal")
LongCtrl_RLWheelDriveDirection = Simulink.Signal(StorageClass="ExportedGlobal")
LongCtrl_RRWheelDriveDirection = Simulink.Signal(StorageClass="ExportedGlobal")
LongCtrl_tEC = Simulink.Signal(StorageClass="ExportedGlobal")
LongCtrl_tECDC = Simulink.Signal(StorageClass="ExportedGlobal")
LongCtrl_VLCState = Simulink.Signal(StorageClass="ExportedGlobal")
LongCtrl_SlideFlag = Simulink.Signal(StorageClass="ExportedGlobal")
LongCtrl_ForwardFlagVxv = Simulink.Signal(StorageClass="ExportedGlobal")
LongCtrl_ForwardFlagTrq = Simulink.Signal(StorageClass="ExportedGlobal")
P_LongCtrl_AxvRoadSlopeThrd = Simulink.Parameter(0.1, StorageClass="ExportedGlobal", DataType="single")  % m/s^2
P_LongCtrl_SlideFlagEnable = Simulink.Parameter(0, StorageClass="ExportedGlobal", DataType="boolean")
P_LongCtrl_VxvRefThrd = Simulink.Parameter(0.1, StorageClass="ExportedGlobal", DataType="single")  % m/s
P_LongCtrl_TotWheelTrqRatio = Simulink.Parameter(1, StorageClass="ExportedGlobal", DataType="single")
P_LongCtrl_VLCaccelMinSlidHoldXAxis = Simulink.Parameter([0 0.5 1 1.5 2 2.5 3], StorageClass="ExportedGlobal", DataType="single")  % m/s^2
P_LongCtrl_VLCaccelMinSlidHoldYAxis = Simulink.Parameter(repmat(-1, 1, 7), StorageClass="ExportedGlobal", DataType="single")  % m/s^2
P_LongCtrl_VLCjerkSlidHoldXAxis = Simulink.Parameter([0 0.5 1 1.5 2 2.5 3], StorageClass="ExportedGlobal", DataType="single")  % m/s^2
P_LongCtrl_VLCjerkSlidHoldYAxis = Simulink.Parameter(repmat(-2, 1, 7), StorageClass="ExportedGlobal", DataType="single")  % m/s^3
LongCtrl_accelSlidHold = Simulink.Signal(StorageClass="ExportedGlobal")
LongCtrl_jerkSlidHold = Simulink.Signal(StorageClass="ExportedGlobal")
LongCtrl_accelHoldMin = Simulink.Signal(StorageClass="ExportedGlobal")
LongCtrl_jerkHold = Simulink.Signal(StorageClass="ExportedGlobal")
LongCtrl_UpdateUpperValue = Simulink.Signal(StorageClass="ExportedGlobal")
LongCtrl_UpdateLowerValue = Simulink.Signal(StorageClass="ExportedGlobal")
LongCtrl_ICEActWheelTrq = Simulink.Signal(StorageClass="ExportedGlobal")
LongCtrl_ICEFzNm = Simulink.Signal(StorageClass="ExportedGlobal")