% Simulink data dictionary LSM_Parameter.sldd

P_LSM_Pre_t = Simulink.Parameter(0, StorageClass="ExportedGlobal", DataType="single")
P_LSM_PilotTurnSwSts = Simulink.Parameter(0, StorageClass="ExportedGlobal")
P_LSM_LaneWidthLimit = Simulink.Parameter(4.2, StorageClass="ExportedGlobal", DataType="single")
P_LSM_PilotSts = Simulink.Parameter(0, StorageClass="ExportedGlobal")
P_LSM_PilotRoadSts = Simulink.Parameter(0, StorageClass="ExportedGlobal")
P_LSM_TJA2NOA_Switch = Simulink.Parameter(0, StorageClass="ExportedGlobal")
P_LSM_HWA2NOA_Switch = Simulink.Parameter(0, StorageClass="ExportedGlobal")
P_LSM_NOAMrege_Switch = Simulink.Parameter(0, StorageClass="ExportedGlobal")
P_LSM_TJALimitSpd = Simulink.Parameter(60, StorageClass="ExportedGlobal", DataType="single")
P_LSM_DOP_Switch = Simulink.Parameter(0, StorageClass="ExportedGlobal", DataType="boolean")
P_LSM_LineSTD_Limit = Simulink.Parameter(0.15, StorageClass="ExportedGlobal", DataType="single")
LSM_LCKLineValid = Simulink.Signal(StorageClass="ExportedGlobal")
LSM_HWALineValid = Simulink.Signal(StorageClass="ExportedGlobal")
LSM_SingleLineLost_b = Simulink.Signal(StorageClass="ExportedGlobal")
LSM_DoubleLineLost_b = Simulink.Signal(StorageClass="ExportedGlobal")
LSM_dyDiff = Simulink.Signal(StorageClass="ExportedGlobal")
LSM_ESSLineValid = Simulink.Signal(StorageClass="ExportedGlobal")
LSM_UpdateCnt = Simulink.Signal(StorageClass="ExportedGlobal")
LSM_TJALineC2 = Simulink.Signal(StorageClass="ExportedGlobal")
LSM_TJALineC0 = Simulink.Signal(StorageClass="ExportedGlobal")
LSM_TJARange = Simulink.Signal(StorageClass="ExportedGlobal")
LSM_LCKLineC3 = Simulink.Signal(StorageClass="ExportedGlobal")
LSM_LCKLineC2 = Simulink.Signal(StorageClass="ExportedGlobal")
LSM_LCKLineC1 = Simulink.Signal(StorageClass="ExportedGlobal")
LSM_LCKLineC0 = Simulink.Signal(StorageClass="ExportedGlobal")
LSM_LCKRange = Simulink.Signal(StorageClass="ExportedGlobal")
LSM_HWALineC3 = Simulink.Signal(StorageClass="ExportedGlobal")
LSM_HWALineC2 = Simulink.Signal(StorageClass="ExportedGlobal")
LSM_HWALineC1 = Simulink.Signal(StorageClass="ExportedGlobal")
LSM_HWALineC0 = Simulink.Signal(StorageClass="ExportedGlobal")
LSM_HWARange = Simulink.Signal(StorageClass="ExportedGlobal")
LSM_HWALeLineValid = Simulink.Signal(StorageClass="ExportedGlobal")
LSM_HWALeLineC3 = Simulink.Signal(StorageClass="ExportedGlobal")
LSM_HWALeLineC2 = Simulink.Signal(StorageClass="ExportedGlobal")
LSM_HWALeLineC1 = Simulink.Signal(StorageClass="ExportedGlobal")
LSM_HWALeLineC0 = Simulink.Signal(StorageClass="ExportedGlobal")
LSM_HWALeRange = Simulink.Signal(StorageClass="ExportedGlobal")
LSM_HWARiLineValid = Simulink.Signal(StorageClass="ExportedGlobal")
LSM_HWARiLineC3 = Simulink.Signal(StorageClass="ExportedGlobal")
LSM_HWARiLineC2 = Simulink.Signal(StorageClass="ExportedGlobal")
LSM_HWARiLineC1 = Simulink.Signal(StorageClass="ExportedGlobal")
LSM_HWARiLineC0 = Simulink.Signal(StorageClass="ExportedGlobal")
LSM_HWARiRange = Simulink.Signal(StorageClass="ExportedGlobal")
LSM_ESSLineC3 = Simulink.Signal(StorageClass="ExportedGlobal")
LSM_ESSLineC2 = Simulink.Signal(StorageClass="ExportedGlobal")
LSM_ESSLineC1 = Simulink.Signal(StorageClass="ExportedGlobal")
LSM_ESSLineC0 = Simulink.Signal(StorageClass="ExportedGlobal")
LSM_ESSRange = Simulink.Signal(StorageClass="ExportedGlobal")
LSM_ESSLeLineValid = Simulink.Signal(StorageClass="ExportedGlobal")
LSM_ESSLeLineC3 = Simulink.Signal(StorageClass="ExportedGlobal")
LSM_ESSLeLineC2 = Simulink.Signal(StorageClass="ExportedGlobal")
LSM_ESSLeLineC1 = Simulink.Signal(StorageClass="ExportedGlobal")
LSM_ESSLeLineC0 = Simulink.Signal(StorageClass="ExportedGlobal")
LSM_ESSLeRange = Simulink.Signal(StorageClass="ExportedGlobal")
LSM_ESSRiLineValid = Simulink.Signal(StorageClass="ExportedGlobal")
LSM_ESSRiLineC3 = Simulink.Signal(StorageClass="ExportedGlobal")
LSM_ESSRiLineC2 = Simulink.Signal(StorageClass="ExportedGlobal")
LSM_ESSRiLineC1 = Simulink.Signal(StorageClass="ExportedGlobal")
LSM_ESSRiLineC0 = Simulink.Signal(StorageClass="ExportedGlobal")
LSM_ESSRiRange = Simulink.Signal(StorageClass="ExportedGlobal")
LSM_TJALineC3 = Simulink.Signal(StorageClass="ExportedGlobal")
LSM_TJALineC1 = Simulink.Signal(StorageClass="ExportedGlobal")
LSM_OTLineValid = Simulink.Signal(StorageClass="ExportedGlobal")
LSM_OTL_A3 = Simulink.Signal(StorageClass="ExportedGlobal")
LSM_OTL_A2 = Simulink.Signal(StorageClass="ExportedGlobal")
LSM_OTL_A1 = Simulink.Signal(StorageClass="ExportedGlobal")
LSM_OTL_A0 = Simulink.Signal(StorageClass="ExportedGlobal")
LSM_OTL_Range = Simulink.Signal(StorageClass="ExportedGlobal")
LSM_OTL_Count = Simulink.Signal(StorageClass="ExportedGlobal")
LSM_HeadAngDiff = Simulink.Signal(StorageClass="ExportedGlobal")
LSM_MLeLane = Simulink.Signal(StorageClass="ExportedGlobal")
LSM_RoadWidth = Simulink.Signal(StorageClass="ExportedGlobal")
LSM_LeftLaneChange = Simulink.Signal(StorageClass="ExportedGlobal")
LSM_RightLaneChange = Simulink.Signal(StorageClass="ExportedGlobal")
LSM_PilotTurnSwSts = Simulink.Signal(StorageClass="ExportedGlobal")
LSM_PilotRoadSts = Simulink.Signal(StorageClass="ExportedGlobal")
LSM_PilotSts = Simulink.Signal(StorageClass="ExportedGlobal")
LSM_LeftMostLane = Simulink.Signal(StorageClass="ExportedGlobal")
LSM_RightMostLane = Simulink.Signal(StorageClass="ExportedGlobal")
P_LSM_Line_Wight = Simulink.Parameter(0.01, StorageClass="ExportedGlobal", DataType="single")
LSM_Lane_NUM = Simulink.Signal(StorageClass="ExportedGlobal")
LSM_Stub_Valid = Simulink.Signal(StorageClass="ExportedGlobal")
LSM_En_Type = Simulink.Signal(StorageClass="ExportedGlobal")
LSM_Road_Type = Simulink.Signal(StorageClass="ExportedGlobal")
LSM_RightLane_Type = Simulink.Signal(StorageClass="ExportedGlobal")
LSM_Stub_Direction = Simulink.Signal(StorageClass="ExportedGlobal")
LSM_Stub_Distance = Simulink.Signal(StorageClass="ExportedGlobal")
LSM_Turning_Angle = Simulink.Signal(StorageClass="ExportedGlobal")
LSM_CurLane_Type = Simulink.Signal(StorageClass="ExportedGlobal")
LSM_PioltLine_Level = Simulink.Signal(StorageClass="ExportedGlobal")
P_LSM_Exist_Dis_Limit = Simulink.Parameter(100, StorageClass="ExportedGlobal", DataType="single")
LSM_L1_Range = Simulink.Signal(StorageClass="ExportedGlobal")
LSM_L2_Range = Simulink.Signal(StorageClass="ExportedGlobal")
LSM_L3_Range = Simulink.Signal(StorageClass="ExportedGlobal")
LSM_L4_Range = Simulink.Signal(StorageClass="ExportedGlobal")
LSM_L1_Conf = Simulink.Signal(StorageClass="ExportedGlobal")
LSM_L2_Conf = Simulink.Signal(StorageClass="ExportedGlobal")
LSM_L3_Conf = Simulink.Signal(StorageClass="ExportedGlobal")
LSM_L4_Conf = Simulink.Signal(StorageClass="ExportedGlobal")
LSM_Exist_Distance = Simulink.Signal(StorageClass="ExportedGlobal")
LSM_PilotSPLDist = Simulink.Signal(StorageClass="ExportedGlobal")
LSM_PilotSPL = Simulink.Signal(StorageClass="ExportedGlobal")
LSM_TJALineValid = Simulink.Signal(StorageClass="ExportedGlobal")
LSM_RFM_LineCenter_Valid = Simulink.Signal(StorageClass="ExportedGlobal")
LSM_RFM_LineCenter_C0 = Simulink.Signal(StorageClass="ExportedGlobal")
LSM_RFM_LineCenter_C1 = Simulink.Signal(StorageClass="ExportedGlobal")
LSM_RFM_LineCenter_C2 = Simulink.Signal(StorageClass="ExportedGlobal")
LSM_RFM_LineCenter_C3 = Simulink.Signal(StorageClass="ExportedGlobal")
LSM_RFM_LineCenter_Start = Simulink.Signal(StorageClass="ExportedGlobal")
LSM_RFM_LineCenter_Front = Simulink.Signal(StorageClass="ExportedGlobal")
LSM_RFM_LineL1_Valid = Simulink.Signal(StorageClass="ExportedGlobal")
LSM_RFM_LineL1_C0 = Simulink.Signal(StorageClass="ExportedGlobal")
LSM_RFM_LineL1_C1 = Simulink.Signal(StorageClass="ExportedGlobal")
LSM_RFM_LineL1_C2 = Simulink.Signal(StorageClass="ExportedGlobal")
LSM_RFM_LineL1_C3 = Simulink.Signal(StorageClass="ExportedGlobal")
LSM_RFM_LineL1_Start = Simulink.Signal(StorageClass="ExportedGlobal")
LSM_RFM_LineL1_Front = Simulink.Signal(StorageClass="ExportedGlobal")
LSM_RFM_LineR1_Valid = Simulink.Signal(StorageClass="ExportedGlobal")
LSM_RFM_LineR1_C0 = Simulink.Signal(StorageClass="ExportedGlobal")
LSM_RFM_LineR1_C1 = Simulink.Signal(StorageClass="ExportedGlobal")
LSM_RFM_LineR1_C2 = Simulink.Signal(StorageClass="ExportedGlobal")
LSM_RFM_LineR1_C3 = Simulink.Signal(StorageClass="ExportedGlobal")
LSM_RFM_LineR1_Start = Simulink.Signal(StorageClass="ExportedGlobal")
LSM_RFM_LineR1_Front = Simulink.Signal(StorageClass="ExportedGlobal")
LSM_EN_Valid = Simulink.Signal(StorageClass="ExportedGlobal")
LSM_EN_C0 = Simulink.Signal(StorageClass="ExportedGlobal")
LSM_EN_C1 = Simulink.Signal(StorageClass="ExportedGlobal")
LSM_EN_C2 = Simulink.Signal(StorageClass="ExportedGlobal")
LSM_EN_C3 = Simulink.Signal(StorageClass="ExportedGlobal")
LSM_EN_Start = Simulink.Signal(StorageClass="ExportedGlobal")
LSM_EN_Front = Simulink.Signal(StorageClass="ExportedGlobal")
LSM_Exit_Valid = Simulink.Signal(StorageClass="ExportedGlobal")
LSM_Exit_C0 = Simulink.Signal(StorageClass="ExportedGlobal")
LSM_Exit_C1 = Simulink.Signal(StorageClass="ExportedGlobal")
LSM_Exit_C2 = Simulink.Signal(StorageClass="ExportedGlobal")
LSM_Exit_C3 = Simulink.Signal(StorageClass="ExportedGlobal")
LSM_Exit_Start = Simulink.Signal(StorageClass="ExportedGlobal")
LSM_Exit_Front = Simulink.Signal(StorageClass="ExportedGlobal")
P_LSM_SpdLim = Simulink.Parameter(200, StorageClass="ExportedGlobal", DataType="uint8")
P_LSM_AvaliTimeLimit = Simulink.Parameter(1, StorageClass="ExportedGlobal", DataType="single")
P_LSM_AvailDisLimit = Simulink.Parameter(5, StorageClass="ExportedGlobal", DataType="single")
LSM_L2_AvaliTime = Simulink.Signal(StorageClass="ExportedGlobal")
LSM_L3_AvaliTime = Simulink.Signal(StorageClass="ExportedGlobal")
LSM_L2_AvaliDis = Simulink.Signal(StorageClass="ExportedGlobal")
LSM_L3_AvaliDis = Simulink.Signal(StorageClass="ExportedGlobal")
LSM_L1_AvaliTime = Simulink.Signal(StorageClass="ExportedGlobal")
LSM_L4_AvaliTime = Simulink.Signal(StorageClass="ExportedGlobal")
LSM_L1_AvaliDis = Simulink.Signal(StorageClass="ExportedGlobal")
LSM_L4_AvaliDis = Simulink.Signal(StorageClass="ExportedGlobal")
LSM_L1_A0 = Simulink.Signal(StorageClass="ExportedGlobal")
LSM_L2_A0 = Simulink.Signal(StorageClass="ExportedGlobal")
LSM_L3_A0 = Simulink.Signal(StorageClass="ExportedGlobal")
LSM_L4_A0 = Simulink.Signal(StorageClass="ExportedGlobal")
LSM_MoveID = Simulink.Signal(StorageClass="ExportedGlobal")
LSM_LockID = Simulink.Signal(StorageClass="ExportedGlobal")
LSM_LockCounter = Simulink.Signal(StorageClass="ExportedGlobal")
P_LSM_DOPEnableSW = Simulink.Parameter(1, StorageClass="ExportedGlobal", DataType="boolean")
LSM_DOP_C0Enable = Simulink.Signal(StorageClass="ExportedGlobal")
LSM_DOP_dC0Enable = Simulink.Signal(StorageClass="ExportedGlobal")
LSM_DOP_C1Enable = Simulink.Signal(StorageClass="ExportedGlobal")
LSM_DOP_dC1Enable = Simulink.Signal(StorageClass="ExportedGlobal")
LSM_DOP_dC2Enable = Simulink.Signal(StorageClass="ExportedGlobal")
LSM_DOP_C2Enable = Simulink.Signal(StorageClass="ExportedGlobal")
LSM_DOP_RangeEnable = Simulink.Signal(StorageClass="ExportedGlobal")
LSM_DOP_C0Disable = Simulink.Signal(StorageClass="ExportedGlobal")
LSM_DOP_dC0Disable = Simulink.Signal(StorageClass="ExportedGlobal")
LSM_DOP_C1Disable = Simulink.Signal(StorageClass="ExportedGlobal")
LSM_DOP_dC1Disable = Simulink.Signal(StorageClass="ExportedGlobal")
LSM_DOP_C2Disable = Simulink.Signal(StorageClass="ExportedGlobal")
LSM_DOP_dC2Disable = Simulink.Signal(StorageClass="ExportedGlobal")
LSM_Line_source = Simulink.Signal(StorageClass="ExportedGlobal")
P_LSM_OTL_C2_Factor = Simulink.Parameter(0.5, StorageClass="ExportedGlobal")
P_LSM_OTL_C1_Factor = Simulink.Parameter(0.5, StorageClass="ExportedGlobal")
P_LSM_OTL_C0_Factor = Simulink.Parameter(1, StorageClass="ExportedGlobal")
P_LSM_Error_Limit = Simulink.Parameter(0.5, StorageClass="ExportedGlobal", DataType="single")
LSM_TJA_Line_State = Simulink.Signal(StorageClass="ExportedGlobal")
P_LSM_NOH_Switch = Simulink.Parameter(0, StorageClass="ExportedGlobal")
P_LSM_ALC_Enable = Simulink.Parameter(0, StorageClass="ExportedGlobal", DataType="uint8")
P_LSM_Line_Error = Simulink.Parameter(0.1, StorageClass="ExportedGlobal")
LSM_Edge_Offset = Simulink.Signal(StorageClass="ExportedGlobal")
P_LSM_Line2Edge_limit = Simulink.Parameter(0.5, StorageClass="ExportedGlobal", DataType="single")
P_LSM_AwayEdge_offset = Simulink.Parameter(0.1, StorageClass="ExportedGlobal", DataType="single")
P_LSM_IFV2RearAxis = Simulink.Parameter(0, StorageClass="ExportedGlobal", DataType="single")
P_LSM_IFV2CenterAxis = Simulink.Parameter(0, StorageClass="ExportedGlobal", DataType="single")
P_LSM_DOP2Line_Limit = Simulink.Parameter(1, StorageClass="ExportedGlobal")
P_LSM_DOP2Line_Reliable = Simulink.Parameter(0.8, StorageClass="ExportedGlobal")
LSM_SubModel_Number = Simulink.Signal()
LSM_SubModel_VERSION = Simulink.Signal()
P_LSM_RoadWidthFactor = Simulink.Parameter(0.41, StorageClass="ExportedGlobal", DataType="single")
P_LSM_Pre2OnlyLineDis = Simulink.Parameter(5, StorageClass="ExportedGlobal", DataType="single")
P_LSM_CentValidErr = Simulink.Parameter(1, StorageClass="ExportedGlobal", DataType="boolean")
P_LSM_DOP_C0_EN_Limit = Simulink.Parameter(0.8, StorageClass="ExportedGlobal")
P_LSM_DOP_C0_out_Limit = Simulink.Parameter(2, StorageClass="ExportedGlobal")
P_LSM_DOP_Out_Pre2Dop_Dis = Simulink.Parameter(2, StorageClass="ExportedGlobal", DataType="single")
P_LSM_DOPValid_CheckTime = Simulink.Parameter(0.06, StorageClass="ExportedGlobal", DataType="single")
P_LSM_DOP_In_Pre2Dop_Dis = Simulink.Parameter(1, StorageClass="ExportedGlobal", DataType="single")
P_LSM_DoubleLine_Pre2Cent_Dislimit = Simulink.Parameter(1, StorageClass="ExportedGlobal", DataType="single")
P_LSM_DoubleLine_Curr2Cent_Dislimit = Simulink.Parameter(0.5, StorageClass="ExportedGlobal", DataType="single")
P_LSM_DoubleLine_Dop2Cent_Dislimit = Simulink.Parameter(0.5, StorageClass="ExportedGlobal", DataType="single")
P_LSM_SingleLine_Cent2Edge_Dislimit = Simulink.Parameter(100, StorageClass="ExportedGlobal", DataType="single")

P_LSM_SingleLine_Pre2Cent_Dislimit = Simulink.Parameter(0.5, StorageClass="ExportedGlobal", DataType="single")
P_LSM_SingleLine_Curr2Cent_Dislimit = Simulink.Parameter(0.2, StorageClass="ExportedGlobal", DataType="single")
P_LSM_SingleLine_Dop2Cent_Dislimit = Simulink.Parameter(0.2, StorageClass="ExportedGlobal", DataType="single")
P_LSM_DOP_C1_EN_Limit = Simulink.Parameter([0.07 0.05 0.04 0.03 0.028 0.026 0.025], StorageClass="ExportedGlobal")
P_LSM_DOP_C1AndC2_Lim_X = Simulink.Parameter([0 10 20 30 40 50 60], StorageClass="ExportedGlobal", DataType="single")
P_LSM_DOP_C2_EN_Limit = Simulink.Parameter([0.01 0.008 0.007 0.005 0.004 0.004 0.004], StorageClass="ExportedGlobal")
P_LSM_DOP_C1_out_Limit = Simulink.Parameter([0.12 0.11 0.08 0.05 0.05 0.05 0.05], StorageClass="ExportedGlobal")
P_LSM_DOP_C2_out_Limit = Simulink.Parameter([0.015 0.012 0.01 0.008 0.006 0.006 0.006], StorageClass="ExportedGlobal")
P_LSM_DOP_PreDis_Y = Simulink.Parameter([2 3 5 8 8 8 8 8 8 8 8 8 8 8 8 8], StorageClass="ExportedGlobal", DataType="single")
P_LSM_DOP_PreDis_X = Simulink.Parameter([0 5 10 15 20 25 30 35 40 60 80 90 100 110 120 140], StorageClass="ExportedGlobal", DataType="single")
P_LSM_SingleLine_DOPOut_C1 = Simulink.Parameter([0.07 0.05 0.04 0.03 0.028 0.026 0.025], StorageClass="ExportedGlobal", DataType="single")
P_LSM_DoubleLine_DOPOut_C1 = Simulink.Parameter([0.1 0.08 0.06 0.05 0.05 0.05 0.05], StorageClass="ExportedGlobal", DataType="single")
LSM_DOP_EN = Simulink.Signal(StorageClass="ExportedGlobal")
LSM_DOP_Out = Simulink.Signal(StorageClass="ExportedGlobal")
LSM_LA_Adjacent_Count = Simulink.Signal(StorageClass="ExportedGlobal")
LSM_LA_ELEM_0_C0 = Simulink.Signal(StorageClass="ExportedGlobal")
LSM_LA_ELEM_0_C1 = Simulink.Signal(StorageClass="ExportedGlobal")
LSM_LA_ELEM_0_C2 = Simulink.Signal(StorageClass="ExportedGlobal")
LSM_LA_ELEM_0_C3 = Simulink.Signal(StorageClass="ExportedGlobal")
LSM_LA_ELEM_0_Range_Start = Simulink.Signal(StorageClass="ExportedGlobal")
LSM_LA_ELEM_0_Range_End = Simulink.Signal(StorageClass="ExportedGlobal")
LSM_LA_ELEM_0_Availability_State = Simulink.Signal(StorageClass="ExportedGlobal")
LSM_LA_ELEM_0_Lanemark_Type = Simulink.Signal(StorageClass="ExportedGlobal")
LSM_LA_ELEM_0_DLM_Type = Simulink.Signal(StorageClass="ExportedGlobal")
LSM_LA_ELEM_0_Line_Side = Simulink.Signal(StorageClass="ExportedGlobal")
LSM_LA_ELEM_0_Marker_Width = Simulink.Signal(StorageClass="ExportedGlobal")
LSM_LA_ELEM_1_C1 = Simulink.Signal(StorageClass="ExportedGlobal")
LSM_LA_ELEM_1_C2 = Simulink.Signal(StorageClass="ExportedGlobal")
LSM_LA_ELEM_1_C3 = Simulink.Signal(StorageClass="ExportedGlobal")
LSM_LA_ELEM_1_Range_Start = Simulink.Signal(StorageClass="ExportedGlobal")
LSM_LA_ELEM_1_Range_End = Simulink.Signal(StorageClass="ExportedGlobal")
LSM_LA_ELEM_1_Availability_State = Simulink.Signal(StorageClass="ExportedGlobal")
LSM_LA_ELEM_1_Lanemark_Type = Simulink.Signal(StorageClass="ExportedGlobal")
LSM_LA_ELEM_1_DLM_Type = Simulink.Signal(StorageClass="ExportedGlobal")
LSM_LA_ELEM_1_Line_Side = Simulink.Signal(StorageClass="ExportedGlobal")
LSM_LA_ELEM_1_Marker_Width = Simulink.Signal(StorageClass="ExportedGlobal")
LSM_LA_ELEM_1_Confidence = Simulink.Signal(StorageClass="ExportedGlobal")
LSM_LA_ELEM_1_C0 = Simulink.Signal(StorageClass="ExportedGlobal")
LSM_LA_ELEM_2_C0 = Simulink.Signal(StorageClass="ExportedGlobal")
LSM_LA_ELEM_2_C1 = Simulink.Signal(StorageClass="ExportedGlobal")
LSM_LA_ELEM_2_C2 = Simulink.Signal(StorageClass="ExportedGlobal")
LSM_LA_ELEM_2_C3 = Simulink.Signal(StorageClass="ExportedGlobal")
LSM_LA_ELEM_2_Range_Start = Simulink.Signal(StorageClass="ExportedGlobal")
LSM_LA_ELEM_2_Range_End = Simulink.Signal(StorageClass="ExportedGlobal")
LSM_LA_ELEM_2_Availability_State = Simulink.Signal(StorageClass="ExportedGlobal")
LSM_LA_ELEM_2_Lanemark_Type = Simulink.Signal(StorageClass="ExportedGlobal")
LSM_LA_ELEM_2_DLM_Type = Simulink.Signal(StorageClass="ExportedGlobal")
LSM_LA_ELEM_2_Line_Side = Simulink.Signal(StorageClass="ExportedGlobal")
LSM_LA_ELEM_2_Marker_Width = Simulink.Signal(StorageClass="ExportedGlobal")
LSM_LA_ELEM_2_Confidence = Simulink.Signal(StorageClass="ExportedGlobal")
LSM_LA_ELEM_3_C0 = Simulink.Signal(StorageClass="ExportedGlobal")
LSM_LA_ELEM_3_C1 = Simulink.Signal(StorageClass="ExportedGlobal")
LSM_LA_ELEM_3_C2 = Simulink.Signal(StorageClass="ExportedGlobal")
LSM_LA_ELEM_3_C3 = Simulink.Signal(StorageClass="ExportedGlobal")
LSM_LA_ELEM_3_Range_Start = Simulink.Signal(StorageClass="ExportedGlobal")
LSM_LA_ELEM_3_Range_End = Simulink.Signal(StorageClass="ExportedGlobal")
LSM_LA_ELEM_3_Availability_State = Simulink.Signal(StorageClass="ExportedGlobal")
LSM_LA_ELEM_3_Lanemark_Type = Simulink.Signal(StorageClass="ExportedGlobal")
LSM_LA_ELEM_3_DLM_Type = Simulink.Signal(StorageClass="ExportedGlobal")
LSM_LA_ELEM_3_Line_Side = Simulink.Signal(StorageClass="ExportedGlobal")
LSM_LA_ELEM_3_Marker_Width = Simulink.Signal(StorageClass="ExportedGlobal")
LSM_LA_ELEM_3_Confidence = Simulink.Signal(StorageClass="ExportedGlobal")
LSM_LH_Count = Simulink.Signal(StorageClass="ExportedGlobal")
LSM_LH_ELEM_0_C0 = Simulink.Signal(StorageClass="ExportedGlobal")
LSM_LH_ELEM_0_C1 = Simulink.Signal(StorageClass="ExportedGlobal")
LSM_LH_ELEM_0_C2 = Simulink.Signal(StorageClass="ExportedGlobal")
LSM_LH_ELEM_0_C3 = Simulink.Signal(StorageClass="ExportedGlobal")
LSM_LH_ELEM_0_VR_Start = Simulink.Signal(StorageClass="ExportedGlobal")
LSM_LH_ELEM_0_VR_End = Simulink.Signal(StorageClass="ExportedGlobal")
LSM_LH_ELEM_0_Availability_State = Simulink.Signal(StorageClass="ExportedGlobal")
LSM_LH_ELEM_0_Lanemark_Type = Simulink.Signal(StorageClass="ExportedGlobal")
LSM_LH_ELEM_0_DLM_Type = Simulink.Signal(StorageClass="ExportedGlobal")
LSM_LH_ELEM_0_Line_Side = Simulink.Signal(StorageClass="ExportedGlobal")
LSM_LH_ELEM_0_Marker_Width = Simulink.Signal(StorageClass="ExportedGlobal")
LSM_LH_ELEM_0_Crossing = Simulink.Signal(StorageClass="ExportedGlobal")
LSM_LH_ELEM_0_Confidence = Simulink.Signal(StorageClass="ExportedGlobal")
LSM_LH_ELEM_1_C0 = Simulink.Signal(StorageClass="ExportedGlobal")
LSM_LH_ELEM_1_C1 = Simulink.Signal(StorageClass="ExportedGlobal")
LSM_LH_ELEM_1_C2 = Simulink.Signal(StorageClass="ExportedGlobal")
LSM_LH_ELEM_1_C3 = Simulink.Signal(StorageClass="ExportedGlobal")
LSM_LH_ELEM_1_VR_Start = Simulink.Signal(StorageClass="ExportedGlobal")
LSM_LH_ELEM_1_VR_End = Simulink.Signal(StorageClass="ExportedGlobal")
LSM_LH_ELEM_1_Availability_State = Simulink.Signal(StorageClass="ExportedGlobal")
LSM_LH_ELEM_1_Lanemark_Type = Simulink.Signal(StorageClass="ExportedGlobal")
LSM_LH_ELEM_1_DLM_Type = Simulink.Signal(StorageClass="ExportedGlobal")
LSM_LH_ELEM_1_Line_Side = Simulink.Signal(StorageClass="ExportedGlobal")
LSM_LH_ELEM_1_Marker_Width = Simulink.Signal(StorageClass="ExportedGlobal")
LSM_LH_ELEM_1_Crossing = Simulink.Signal(StorageClass="ExportedGlobal")
LSM_LH_ELEM_1_Confidence = Simulink.Signal(StorageClass="ExportedGlobal")
LSM_LRE_Count = Simulink.Signal(StorageClass="ExportedGlobal")
LSM_LRE_ELEM_0_C0 = Simulink.Signal(StorageClass="ExportedGlobal")
LSM_LRE_ELEM_0_C1 = Simulink.Signal(StorageClass="ExportedGlobal")
LSM_LRE_ELEM_0_C2 = Simulink.Signal(StorageClass="ExportedGlobal")
LSM_LRE_ELEM_0_C3 = Simulink.Signal(StorageClass="ExportedGlobal")
LSM_LRE_ELEM_0_Range_Start = Simulink.Signal(StorageClass="ExportedGlobal")
LSM_LRE_ELEM_0_Range_End = Simulink.Signal(StorageClass="ExportedGlobal")
LSM_LRE_ELEM_0_Availability_State = Simulink.Signal(StorageClass="ExportedGlobal")
LSM_LRE_ELEM_0_Line_Side = Simulink.Signal(StorageClass="ExportedGlobal")
LSM_LRE_ELEM_0_Confidence = Simulink.Signal(StorageClass="ExportedGlobal")
LSM_LRE_ELEM_1_C0 = Simulink.Signal(StorageClass="ExportedGlobal")
LSM_LRE_ELEM_1_C1 = Simulink.Signal(StorageClass="ExportedGlobal")
LSM_LRE_ELEM_1_C2 = Simulink.Signal(StorageClass="ExportedGlobal")
LSM_LRE_ELEM_1_C3 = Simulink.Signal(StorageClass="ExportedGlobal")
LSM_LRE_ELEM_1_Range_Start = Simulink.Signal(StorageClass="ExportedGlobal")
LSM_LRE_ELEM_1_Range_End = Simulink.Signal(StorageClass="ExportedGlobal")
LSM_LRE_ELEM_1_Availability_State = Simulink.Signal(StorageClass="ExportedGlobal")
LSM_LRE_ELEM_1_Line_Side = Simulink.Signal(StorageClass="ExportedGlobal")
LSM_LRE_ELEM_1_Confidence = Simulink.Signal(StorageClass="ExportedGlobal")
LSM_LA_ELEM_0_Confidence = Simulink.Signal(StorageClass="ExportedGlobal")
P_LSM_LineWijCal_C14 = Simulink.Parameter(3, StorageClass="ExportedGlobal", DataType="single")
P_LSM_Pre2OnlyLineDis_Y = Simulink.Parameter([5 4.5 4.5 4 3.5 3 2], StorageClass="ExportedGlobal", DataType="single")
P_LSM_LineWijCal_C12 = Simulink.Parameter(5, StorageClass="ExportedGlobal", DataType="single")
P_LSM_LineWijCal_C13 = Simulink.Parameter(5, StorageClass="ExportedGlobal", DataType="single")
LSM_LH21 = Simulink.Signal(StorageClass="ExportedGlobal")
LSM_LH31 = Simulink.Signal(StorageClass="ExportedGlobal")
LSM_LH22 = Simulink.Signal(StorageClass="ExportedGlobal")
LSM_LH32 = Simulink.Signal(StorageClass="ExportedGlobal")
LSM_LH23 = Simulink.Signal(StorageClass="ExportedGlobal")
LSM_LH33 = Simulink.Signal(StorageClass="ExportedGlobal")
LSM_LH1Wij = Simulink.Signal(StorageClass="ExportedGlobal")
LSM_LH2Wij = Simulink.Signal(StorageClass="ExportedGlobal")
LSM_LH1Valid = Simulink.Signal(StorageClass="ExportedGlobal")
LSM_LH2Valid = Simulink.Signal(StorageClass="ExportedGlobal")
LSM_Line_State = Simulink.Signal(StorageClass="ExportedGlobal")
P_LSM_PosLineLcFac = Simulink.Parameter(0.8, StorageClass="ExportedGlobal", DataType="single")
LSM_Wij_State = Simulink.Signal(StorageClass="ExportedGlobal")
LSM_LeftOffset_b = Simulink.Signal(StorageClass="ExportedGlobal")
LSM_RightOffset_b = Simulink.Signal(StorageClass="ExportedGlobal")
LSM_PathLaneAvail = Simulink.Signal(StorageClass="ExportedGlobal")
LSM_LeftLineConf = Simulink.Signal(StorageClass="ExportedGlobal")
LSM_RightLineConf = Simulink.Signal(StorageClass="ExportedGlobal")
LSM_CurDis2 = Simulink.Signal(StorageClass="ExportedGlobal")
LSM_CurDis3 = Simulink.Signal(StorageClass="ExportedGlobal")
LSM_DeltaDis2 = Simulink.Signal(StorageClass="ExportedGlobal")
LSM_DeltaDis3 = Simulink.Signal(StorageClass="ExportedGlobal")
LSM_VRef = Simulink.Signal(StorageClass="ExportedGlobal")
LSM_CentLineValid = Simulink.Signal(StorageClass="ExportedGlobal")
LSM_CentLineA3 = Simulink.Signal(StorageClass="ExportedGlobal")
LSM_CentLineA2 = Simulink.Signal(StorageClass="ExportedGlobal")
LSM_CentLineA1 = Simulink.Signal(StorageClass="ExportedGlobal")
LSM_CentLineA0 = Simulink.Signal(StorageClass="ExportedGlobal")
LSM_CentLineRange = Simulink.Signal(StorageClass="ExportedGlobal")
LSM_CentQ = Simulink.Signal(StorageClass="ExportedGlobal")
LSM_RoadWidth1 = Simulink.Signal(StorageClass="ExportedGlobal")
LSM_VisLineUpdate = Simulink.Signal(StorageClass="ExportedGlobal")
LSM_dDeltaX = Simulink.Signal(StorageClass="ExportedGlobal")
LSM_dDeltaY = Simulink.Signal(StorageClass="ExportedGlobal")
LSM_CosOfPsi = Simulink.Signal(StorageClass="ExportedGlobal")
LSM_SinOfsi = Simulink.Signal(StorageClass="ExportedGlobal")
LSM_QualityK1 = Simulink.Signal(StorageClass="ExportedGlobal")
LSM_LineValidK1 = Simulink.Signal(StorageClass="ExportedGlobal")
LSM_A3K1 = Simulink.Signal(StorageClass="ExportedGlobal")
LSM_A2K1 = Simulink.Signal(StorageClass="ExportedGlobal")
LSM_A1K1 = Simulink.Signal(StorageClass="ExportedGlobal")
LSM_A0K1 = Simulink.Signal(StorageClass="ExportedGlobal")
LSM_RangeK1 = Simulink.Signal(StorageClass="ExportedGlobal")
LSM_tLostK1 = Simulink.Signal(StorageClass="ExportedGlobal")
LSM_HWALineC0K1 = Simulink.Signal(StorageClass="ExportedGlobal")
LSM_TJA_Line_State1 = Simulink.Signal(StorageClass="ExportedGlobal")
LSM_HWASts = Simulink.Signal(StorageClass="ExportedGlobal")
LSM_PathLaneAvail1 = Simulink.Signal(StorageClass="ExportedGlobal")
LSM_HWARiRangeCopy = Simulink.Signal(StorageClass="ExportedGlobal")
LSM_LeftLineTypeEN = Simulink.Signal(StorageClass="ExportedGlobal")
LSM_RightLineTypeEN = Simulink.Signal(StorageClass="ExportedGlobal")