% Simulink data dictionary LSM_Parameter.sldd

P_LSM_Pre_t = Simulink.Parameter(0, StorageClass="ExportedGlobal", DataType="single")
P_LSM_PilotTurnSwSts = Simulink.Parameter(0, StorageClass="ExportedGlobal")
P_LSM_LaneWidthLimit = Simulink.Parameter(4.2, StorageClass="ExportedGlobal", DataType="single")
P_LSM_PilotSts = Simulink.Parameter(0, StorageClass="ExportedGlobal")
P_LSM_PilotRoadSts = Simulink.Parameter(0, StorageClass="ExportedGlobal")
P_LSM_TJA2NOA_Switch = Simulink.Parameter(0, StorageClass="ExportedGlobal")
P_LSM_HWA2NOA_Switch = Simulink.Parameter(0, StorageClass="ExportedGlobal")
P_LSM_NOAMrege_Switch = Simulink.Parameter(0, StorageClass="ExportedGlobal")
P_LSM_TJALimitSpd = Simulink.Parameter(60, StorageClass="ExportedGlobal", DataType="single")
P_LSM_LineSTD_Limit = Simulink.Parameter(0.15, StorageClass="ExportedGlobal", DataType="single")
LSM_LCKLineValid = Simulink.Signal(StorageClass="ExportedGlobal")
LSM_HWALineValid = Simulink.Signal(StorageClass="ExportedGlobal")
LSM_SingleLineLost_b = Simulink.Signal(StorageClass="ExportedGlobal")
LSM_DoubleLineLost_b = Simulink.Signal(StorageClass="ExportedGlobal")
LSM_dyDiff = Simulink.Signal(StorageClass="ExportedGlobal")
LSM_ESSLineValid = Simulink.Signal(StorageClass="ExportedGlobal")
LSM_UpdateCnt = Simulink.Signal(StorageClass="ExportedGlobal")
LSM_TJALineC2 = Simulink.Signal(StorageClass="ExportedGlobal")
LSM_TJALineC0 = Simulink.Signal(StorageClass="ExportedGlobal")
LSM_TJARange = Simulink.Signal(StorageClass="ExportedGlobal")
LSM_LCKLineC3 = Simulink.Signal(StorageClass="ExportedGlobal")
LSM_LCKLineC2 = Simulink.Signal(StorageClass="ExportedGlobal")
LSM_LCKLineC1 = Simulink.Signal(StorageClass="ExportedGlobal")
LSM_LCKLineC0 = Simulink.Signal(StorageClass="ExportedGlobal")
LSM_LCKRange = Simulink.Signal(StorageClass="ExportedGlobal")
LSM_HWALineC3 = Simulink.Signal(StorageClass="ExportedGlobal")
LSM_HWALineC2 = Simulink.Signal(StorageClass="ExportedGlobal")
LSM_HWALineC1 = Simulink.Signal(StorageClass="ExportedGlobal")
LSM_HWALineC0 = Simulink.Signal(StorageClass="ExportedGlobal")
LSM_HWARange = Simulink.Signal(StorageClass="ExportedGlobal")
LSM_HWALeLineValid = Simulink.Signal(StorageClass="ExportedGlobal")
LSM_HWALeLineC3 = Simulink.Signal(StorageClass="ExportedGlobal")
LSM_HWALeLineC2 = Simulink.Signal(StorageClass="ExportedGlobal")
LSM_HWALeLineC1 = Simulink.Signal(StorageClass="ExportedGlobal")
LSM_HWALeLineC0 = Simulink.Signal(StorageClass="ExportedGlobal")
LSM_HWALeRange = Simulink.Signal(StorageClass="ExportedGlobal")
LSM_HWARiLineValid = Simulink.Signal(StorageClass="ExportedGlobal")
LSM_HWARiLineC3 = Simulink.Signal(StorageClass="ExportedGlobal")
LSM_HWARiLineC2 = Simulink.Signal(StorageClass="ExportedGlobal")
LSM_HWARiLineC1 = Simulink.Signal(StorageClass="ExportedGlobal")
LSM_HWARiLineC0 = Simulink.Signal(StorageClass="ExportedGlobal")
LSM_HWARiRange = Simulink.Signal(StorageClass="ExportedGlobal")
LSM_ESSLineC3 = Simulink.Signal(StorageClass="ExportedGlobal")
LSM_ESSLineC2 = Simulink.Signal(StorageClass="ExportedGlobal")
LSM_ESSLineC1 = Simulink.Signal(StorageClass="ExportedGlobal")
LSM_ESSLineC0 = Simulink.Signal(StorageClass="ExportedGlobal")
LSM_ESSRange = Simulink.Signal(StorageClass="ExportedGlobal")
LSM_ESSLeLineValid = Simulink.Signal(StorageClass="ExportedGlobal")
LSM_ESSLeLineC3 = Simulink.Signal(StorageClass="ExportedGlobal")
LSM_ESSLeLineC2 = Simulink.Signal(StorageClass="ExportedGlobal")
LSM_ESSLeLineC1 = Simulink.Signal(StorageClass="ExportedGlobal")
LSM_ESSLeLineC0 = Simulink.Signal(StorageClass="ExportedGlobal")
LSM_ESSLeRange = Simulink.Signal(StorageClass="ExportedGlobal")
LSM_ESSRiLineValid = Simulink.Signal(StorageClass="ExportedGlobal")
LSM_ESSRiLineC3 = Simulink.Signal(StorageClass="ExportedGlobal")
LSM_ESSRiLineC2 = Simulink.Signal(StorageClass="ExportedGlobal")
LSM_ESSRiLineC1 = Simulink.Signal(StorageClass="ExportedGlobal")
LSM_ESSRiLineC0 = Simulink.Signal(StorageClass="ExportedGlobal")
LSM_ESSRiRange = Simulink.Signal(StorageClass="ExportedGlobal")
LSM_TJALineC3 = Simulink.Signal(StorageClass="ExportedGlobal")
LSM_TJALineC1 = Simulink.Signal(StorageClass="ExportedGlobal")
LSM_OTLineValid = Simulink.Signal(StorageClass="ExportedGlobal")
LSM_OTL_A3 = Simulink.Signal(StorageClass="ExportedGlobal")
LSM_OTL_A2 = Simulink.Signal(StorageClass="ExportedGlobal")
LSM_OTL_A1 = Simulink.Signal(StorageClass="ExportedGlobal")
LSM_OTL_A0 = Simulink.Signal(StorageClass="ExportedGlobal")
LSM_OTL_Range = Simulink.Signal(StorageClass="ExportedGlobal")
LSM_OTL_Count = Simulink.Signal(StorageClass="ExportedGlobal")
LSM_HeadAngDiff = Simulink.Signal(StorageClass="ExportedGlobal")
LSM_MLeLane = Simulink.Signal(StorageClass="ExportedGlobal")
LSM_RoadWidth = Simulink.Signal(StorageClass="ExportedGlobal")
LSM_LeftLaneChange = Simulink.Signal(StorageClass="ExportedGlobal")
LSM_RightLaneChange = Simulink.Signal(StorageClass="ExportedGlobal")
LSM_PilotTurnSwSts = Simulink.Signal(StorageClass="ExportedGlobal")
LSM_PilotRoadSts = Simulink.Signal(StorageClass="ExportedGlobal")
LSM_PilotSts = Simulink.Signal(StorageClass="ExportedGlobal")
LSM_LeftMostLane = Simulink.Signal(StorageClass="ExportedGlobal")
LSM_RightMostLane = Simulink.Signal(StorageClass="ExportedGlobal")
P_LSM_Line_Wight = Simulink.Parameter(0.01, StorageClass="ExportedGlobal", DataType="single")
LSM_Lane_NUM = Simulink.Signal(StorageClass="ExportedGlobal")
LSM_Stub_Valid = Simulink.Signal(StorageClass="ExportedGlobal")
LSM_En_Type = Simulink.Signal(StorageClass="ExportedGlobal")
LSM_Road_Type = Simulink.Signal(StorageClass="ExportedGlobal")
LSM_RightLane_Type = Simulink.Signal(StorageClass="ExportedGlobal")
LSM_Stub_Direction = Simulink.Signal(StorageClass="ExportedGlobal")
LSM_Stub_Distance = Simulink.Signal(StorageClass="ExportedGlobal")
LSM_Turning_Angle = Simulink.Signal(StorageClass="ExportedGlobal")
LSM_CurLane_Type = Simulink.Signal(StorageClass="ExportedGlobal")
LSM_PioltLine_Level = Simulink.Signal(StorageClass="ExportedGlobal")
P_LSM_Exist_Dis_Limit = Simulink.Parameter(100, StorageClass="ExportedGlobal", DataType="single")
LSM_L1_Range = Simulink.Signal(StorageClass="ExportedGlobal")
LSM_L2_Range = Simulink.Signal(StorageClass="ExportedGlobal")
LSM_L3_Range = Simulink.Signal(StorageClass="ExportedGlobal")
LSM_L4_Range = Simulink.Signal(StorageClass="ExportedGlobal")
LSM_L1_Conf = Simulink.Signal(StorageClass="ExportedGlobal")
LSM_L2_Conf = Simulink.Signal(StorageClass="ExportedGlobal")
LSM_L3_Conf = Simulink.Signal(StorageClass="ExportedGlobal")
LSM_L4_Conf = Simulink.Signal(StorageClass="ExportedGlobal")
LSM_Exist_Distance = Simulink.Signal(StorageClass="ExportedGlobal")
LSM_PilotSPLDist = Simulink.Signal(StorageClass="ExportedGlobal")
LSM_PilotSPL = Simulink.Signal(StorageClass="ExportedGlobal")
LSM_TJALineValid = Simulink.Signal(StorageClass="ExportedGlobal")
LSM_RFM_LineCenter_Valid = Simulink.Signal(StorageClass="ExportedGlobal")
LSM_RFM_LineCenter_C0 = Simulink.Signal(StorageClass="ExportedGlobal")
LSM_RFM_LineCenter_C1 = Simulink.Signal(StorageClass="ExportedGlobal")
LSM_RFM_LineCenter_C2 = Simulink.Signal(StorageClass="ExportedGlobal")
LSM_RFM_LineCenter_C3 = Simulink.Signal(StorageClass="ExportedGlobal")
LSM_RFM_LineCenter_Start = Simulink.Signal(StorageClass="ExportedGlobal")
LSM_RFM_LineCenter_Front = Simulink.Signal(StorageClass="ExportedGlobal")
LSM_RFM_LineL1_Valid = Simulink.Signal(StorageClass="ExportedGlobal")
LSM_RFM_LineL1_C0 = Simulink.Signal(StorageClass="ExportedGlobal")
LSM_RFM_LineL1_C1 = Simulink.Signal(StorageClass="ExportedGlobal")
LSM_RFM_LineL1_C2 = Simulink.Signal(StorageClass="ExportedGlobal")
LSM_RFM_LineL1_C3 = Simulink.Signal(StorageClass="ExportedGlobal")
LSM_RFM_LineL1_Start = Simulink.Signal(StorageClass="ExportedGlobal")
LSM_RFM_LineL1_Front = Simulink.Signal(StorageClass="ExportedGlobal")
LSM_RFM_LineR1_Valid = Simulink.Signal(StorageClass="ExportedGlobal")
LSM_RFM_LineR1_C0 = Simulink.Signal(StorageClass="ExportedGlobal")
LSM_RFM_LineR1_C1 = Simulink.Signal(StorageClass="ExportedGlobal")
LSM_RFM_LineR1_C2 = Simulink.Signal(StorageClass="ExportedGlobal")
LSM_RFM_LineR1_C3 = Simulink.Signal(StorageClass="ExportedGlobal")
LSM_RFM_LineR1_Start = Simulink.Signal(StorageClass="ExportedGlobal")
LSM_RFM_LineR1_Front = Simulink.Signal(StorageClass="ExportedGlobal")
LSM_EN_Valid = Simulink.Signal(StorageClass="ExportedGlobal")
LSM_EN_C0 = Simulink.Signal(StorageClass="ExportedGlobal")
LSM_EN_C1 = Simulink.Signal(StorageClass="ExportedGlobal")
LSM_EN_C2 = Simulink.Signal(StorageClass="ExportedGlobal")
LSM_EN_C3 = Simulink.Signal(StorageClass="ExportedGlobal")
LSM_EN_Start = Simulink.Signal(StorageClass="ExportedGlobal")
LSM_EN_Front = Simulink.Signal(StorageClass="ExportedGlobal")
LSM_Exit_Valid = Simulink.Signal(StorageClass="ExportedGlobal")
LSM_Exit_C0 = Simulink.Signal(StorageClass="ExportedGlobal")
LSM_Exit_C1 = Simulink.Signal(StorageClass="ExportedGlobal")
LSM_Exit_C2 = Simulink.Signal(StorageClass="ExportedGlobal")
LSM_Exit_C3 = Simulink.Signal(StorageClass="ExportedGlobal")
LSM_Exit_Start = Simulink.Signal(StorageClass="ExportedGlobal")
LSM_Exit_Front = Simulink.Signal(StorageClass="ExportedGlobal")
P_LSM_SpdLim = Simulink.Parameter(200, StorageClass="ExportedGlobal", DataType="uint8")
P_LSM_AvaliTimeLimit = Simulink.Parameter(1, StorageClass="ExportedGlobal", DataType="single")
P_LSM_AvailDisLimit = Simulink.Parameter(5, StorageClass="ExportedGlobal", DataType="single")
LSM_L2_AvaliTime = Simulink.Signal(StorageClass="ExportedGlobal")
LSM_L3_AvaliTime = Simulink.Signal(StorageClass="ExportedGlobal")
LSM_L2_AvaliDis = Simulink.Signal(StorageClass="ExportedGlobal")
LSM_L3_AvaliDis = Simulink.Signal(StorageClass="ExportedGlobal")
LSM_Line_state = Simulink.Signal(StorageClass="ExportedGlobal")
LSM_L1_AvaliTime = Simulink.Signal(StorageClass="ExportedGlobal")
LSM_L4_AvaliTime = Simulink.Signal(StorageClass="ExportedGlobal")
LSM_L1_AvaliDis = Simulink.Signal(StorageClass="ExportedGlobal")
LSM_L4_AvaliDis = Simulink.Signal(StorageClass="ExportedGlobal")
LSM_L1_A0 = Simulink.Signal(StorageClass="ExportedGlobal")
LSM_L2_A0 = Simulink.Signal(StorageClass="ExportedGlobal")
LSM_L3_A0 = Simulink.Signal(StorageClass="ExportedGlobal")
LSM_L4_A0 = Simulink.Signal(StorageClass="ExportedGlobal")
LSM_MoveID = Simulink.Signal(StorageClass="ExportedGlobal")
LSM_LockID = Simulink.Signal(StorageClass="ExportedGlobal")
LSM_LockCounter = Simulink.Signal(StorageClass="ExportedGlobal")
P_LSM_DOPEnableSW = Simulink.Parameter(1, StorageClass="ExportedGlobal", DataType="boolean")
LA_Adjacent_Count = Simulink.Signal(StorageClass="ExportedGlobal")
LA_ELEM_1_C1 = Simulink.Signal(StorageClass="ExportedGlobal")
LA_ELEM_1_C2 = Simulink.Signal(StorageClass="ExportedGlobal")
LA_ELEM_1_C3 = Simulink.Signal(StorageClass="ExportedGlobal")
LA_ELEM_1_Range_Start = Simulink.Signal(StorageClass="ExportedGlobal")
LA_ELEM_1_Range_End = Simulink.Signal(StorageClass="ExportedGlobal")
LA_ELEM_1_Availability_State = Simulink.Signal(StorageClass="ExportedGlobal")
LA_ELEM_1_Lanemark_Type = Simulink.Signal(StorageClass="ExportedGlobal")
LA_ELEM_1_DLM_Type = Simulink.Signal(StorageClass="ExportedGlobal")
LA_ELEM_1_Line_Side = Simulink.Signal(StorageClass="ExportedGlobal")
LA_ELEM_1_Marker_Width = Simulink.Signal(StorageClass="ExportedGlobal")
LA_ELEM_1_Confidence = Simulink.Signal(StorageClass="ExportedGlobal")
LA_ELEM_2_C0 = Simulink.Signal(StorageClass="ExportedGlobal")
LA_ELEM_2_C1 = Simulink.Signal(StorageClass="ExportedGlobal")
LA_ELEM_2_C2 = Simulink.Signal(StorageClass="ExportedGlobal")
LA_ELEM_2_C3 = Simulink.Signal(StorageClass="ExportedGlobal")
LA_ELEM_2_Range_Start = Simulink.Signal(StorageClass="ExportedGlobal")
LA_ELEM_2_Range_End = Simulink.Signal(StorageClass="ExportedGlobal")
LA_ELEM_2_Availability_State = Simulink.Signal(StorageClass="ExportedGlobal")
LA_ELEM_2_Lanemark_Type = Simulink.Signal(StorageClass="ExportedGlobal")
LA_ELEM_2_DLM_Type = Simulink.Signal(StorageClass="ExportedGlobal")
LA_ELEM_2_Line_Side = Simulink.Signal(StorageClass="ExportedGlobal")
LA_ELEM_2_Marker_Width = Simulink.Signal(StorageClass="ExportedGlobal")
LA_ELEM_2_Confidence = Simulink.Signal(StorageClass="ExportedGlobal")
LA_ELEM_3_C0 = Simulink.Signal(StorageClass="ExportedGlobal")
LA_ELEM_3_C1 = Simulink.Signal(StorageClass="ExportedGlobal")
LA_ELEM_3_C2 = Simulink.Signal(StorageClass="ExportedGlobal")
LA_ELEM_3_C3 = Simulink.Signal(StorageClass="ExportedGlobal")
LA_ELEM_3_Range_Start = Simulink.Signal(StorageClass="ExportedGlobal")
LA_ELEM_3_Range_End = Simulink.Signal(StorageClass="ExportedGlobal")
LA_ELEM_3_Availability_State = Simulink.Signal(StorageClass="ExportedGlobal")
LA_ELEM_3_Lanemark_Type = Simulink.Signal(StorageClass="ExportedGlobal")
LA_ELEM_3_DLM_Type = Simulink.Signal(StorageClass="ExportedGlobal")
LA_ELEM_3_Line_Side = Simulink.Signal(StorageClass="ExportedGlobal")
LA_ELEM_3_Marker_Width = Simulink.Signal(StorageClass="ExportedGlobal")
LA_ELEM_3_Confidence = Simulink.Signal(StorageClass="ExportedGlobal")
LH_Count = Simulink.Signal(StorageClass="ExportedGlobal")
LH_ELEM_0_C0 = Simulink.Signal(StorageClass="ExportedGlobal")
LH_ELEM_0_C1 = Simulink.Signal(StorageClass="ExportedGlobal")
LH_ELEM_0_C2 = Simulink.Signal(StorageClass="ExportedGlobal")
LH_ELEM_0_C3 = Simulink.Signal(StorageClass="ExportedGlobal")
LH_ELEM_0_VR_Start = Simulink.Signal(StorageClass="ExportedGlobal")
LH_ELEM_0_VR_End = Simulink.Signal(StorageClass="ExportedGlobal")

LH_ELEM_0_Availability_State = Simulink.Signal(StorageClass="ExportedGlobal")
LH_ELEM_0_Lanemark_Type = Simulink.Signal(StorageClass="ExportedGlobal")
LH_ELEM_0_DLM_Type = Simulink.Signal(StorageClass="ExportedGlobal")
LH_ELEM_0_Line_Side = Simulink.Signal(StorageClass="ExportedGlobal")
LH_ELEM_0_Marker_Width = Simulink.Signal(StorageClass="ExportedGlobal")
LH_ELEM_0_Crossing = Simulink.Signal(StorageClass="ExportedGlobal")
LH_ELEM_0_Confidence = Simulink.Signal(StorageClass="ExportedGlobal")
LH_ELEM_1_C0 = Simulink.Signal(StorageClass="ExportedGlobal")
LH_ELEM_1_C1 = Simulink.Signal(StorageClass="ExportedGlobal")
LH_ELEM_1_C2 = Simulink.Signal(StorageClass="ExportedGlobal")
LH_ELEM_1_C3 = Simulink.Signal(StorageClass="ExportedGlobal")
LH_ELEM_1_VR_Start = Simulink.Signal(StorageClass="ExportedGlobal")
LH_ELEM_1_VR_End = Simulink.Signal(StorageClass="ExportedGlobal")
LH_ELEM_1_Availability_State = Simulink.Signal(StorageClass="ExportedGlobal")
LH_ELEM_1_Lanemark_Type = Simulink.Signal(StorageClass="ExportedGlobal")
LH_ELEM_1_DLM_Type = Simulink.Signal(StorageClass="ExportedGlobal")
LH_ELEM_1_Line_Side = Simulink.Signal(StorageClass="ExportedGlobal")
LH_ELEM_1_Marker_Width = Simulink.Signal(StorageClass="ExportedGlobal")
LH_ELEM_1_Crossing = Simulink.Signal(StorageClass="ExportedGlobal")
LH_ELEM_1_Confidence = Simulink.Signal(StorageClass="ExportedGlobal")
LRE_Count = Simulink.Signal(StorageClass="ExportedGlobal")
LRE_ELEM_0_C0 = Simulink.Signal(StorageClass="ExportedGlobal")
LRE_ELEM_0_C1 = Simulink.Signal(StorageClass="ExportedGlobal")
LRE_ELEM_0_C2 = Simulink.Signal(StorageClass="ExportedGlobal")
LRE_ELEM_0_C3 = Simulink.Signal(StorageClass="ExportedGlobal")
LRE_ELEM_0_Range_Start = Simulink.Signal(StorageClass="ExportedGlobal")
LRE_ELEM_0_Range_End = Simulink.Signal(StorageClass="ExportedGlobal")
LRE_ELEM_0_Availability_State = Simulink.Signal(StorageClass="ExportedGlobal")
LRE_ELEM_0_Line_Side = Simulink.Signal(StorageClass="ExportedGlobal")
LRE_ELEM_0_Confidence = Simulink.Signal(StorageClass="ExportedGlobal")
LRE_ELEM_1_C0 = Simulink.Signal(StorageClass="ExportedGlobal")
LRE_ELEM_1_C1 = Simulink.Signal(StorageClass="ExportedGlobal")
LRE_ELEM_1_C2 = Simulink.Signal(StorageClass="ExportedGlobal")
LRE_ELEM_1_C3 = Simulink.Signal(StorageClass="ExportedGlobal")
LRE_ELEM_1_Range_Start = Simulink.Signal(StorageClass="ExportedGlobal")
LRE_ELEM_1_Range_End = Simulink.Signal(StorageClass="ExportedGlobal")
LRE_ELEM_1_Availability_State = Simulink.Signal(StorageClass="ExportedGlobal")
LRE_ELEM_1_Line_Side = Simulink.Signal(StorageClass="ExportedGlobal")
LRE_ELEM_1_Confidence = Simulink.Signal(StorageClass="ExportedGlobal")
LSM_DOP_C0Enable = Simulink.Signal(StorageClass="ExportedGlobal")
LSM_DOP_dC0Enable = Simulink.Signal(StorageClass="ExportedGlobal")
LSM_DOP_C1Enable = Simulink.Signal(StorageClass="ExportedGlobal")
LSM_DOP_dC1Enable = Simulink.Signal(StorageClass="ExportedGlobal")
LSM_DOP_dC2Enable = Simulink.Signal(StorageClass="ExportedGlobal")
LSM_DOP_C2Enable = Simulink.Signal(StorageClass="ExportedGlobal")
LSM_DOP_RangeEnable = Simulink.Signal(StorageClass="ExportedGlobal")
LSM_DOP_C0Disable = Simulink.Signal(StorageClass="ExportedGlobal")
LSM_DOP_dC0Disable = Simulink.Signal(StorageClass="ExportedGlobal")
LSM_DOP_C1Disable = Simulink.Signal(StorageClass="ExportedGlobal")
LSM_DOP_dC1Disable = Simulink.Signal(StorageClass="ExportedGlobal")
LSM_DOP_C2Disable = Simulink.Signal(StorageClass="ExportedGlobal")
LSM_DOP_dC2Disable = Simulink.Signal(StorageClass="ExportedGlobal")
LA_ELEM_0_C0 = Simulink.Signal(StorageClass="ExportedGlobal")
LA_ELEM_0_C1 = Simulink.Signal(StorageClass="ExportedGlobal")
LA_ELEM_0_C2 = Simulink.Signal(StorageClass="ExportedGlobal")
LA_ELEM_0_C3 = Simulink.Signal(StorageClass="ExportedGlobal")
LA_ELEM_0_Range_Start = Simulink.Signal(StorageClass="ExportedGlobal")
LA_ELEM_0_Range_End = Simulink.Signal(StorageClass="ExportedGlobal")
LA_ELEM_0_Availability_State = Simulink.Signal(StorageClass="ExportedGlobal")
LA_ELEM_0_Lanemark_Type = Simulink.Signal(StorageClass="ExportedGlobal")
LA_ELEM_0_DLM_Type = Simulink.Signal(StorageClass="ExportedGlobal")
LA_ELEM_0_Line_Side = Simulink.Signal(StorageClass="ExportedGlobal")
LA_ELEM_0_Marker_Width = Simulink.Signal(StorageClass="ExportedGlobal")
LA_ELEM_0_Confidence = Simulink.Signal(StorageClass="ExportedGlobal")
LA_ELEM_1_C0 = Simulink.Signal(StorageClass="ExportedGlobal")
LSM_Line_source = Simulink.Signal(StorageClass="ExportedGlobal")
P_LSM_DOP_C1_EN_Limit = Simulink.Parameter(0.02, StorageClass="ExportedGlobal")
P_LSM_DOP_C2_EN_Limit = Simulink.Parameter(0.0005, StorageClass="ExportedGlobal")
P_LSM_DOP_C1_out_Limit = Simulink.Parameter(0.036, StorageClass="ExportedGlobal")
P_LSM_DOP_C2_out_Limit = Simulink.Parameter(0.001, StorageClass="ExportedGlobal")
P_LSM_OTL_C0_Factor = Simulink.Parameter(1, StorageClass="ExportedGlobal")
P_LSM_Error_Limit = Simulink.Parameter(0.5, StorageClass="ExportedGlobal", DataType="single")
LSM_TJA_Line_State = Simulink.Signal(StorageClass="ExportedGlobal")
P_LSM_NOH_Switch = Simulink.Parameter(0, StorageClass="ExportedGlobal")
P_LSM_ALC_Enable = Simulink.Parameter(0, StorageClass="ExportedGlobal", DataType="uint8")
P_LSM_Line_Error = Simulink.Parameter(0.1, StorageClass="ExportedGlobal")
LSM_Edge_Offset = Simulink.Signal(StorageClass="ExportedGlobal")
P_LSM_Line2Edge_limit = Simulink.Parameter(0.5, StorageClass="ExportedGlobal", DataType="single")
P_LSM_AwayEdge_offset = Simulink.Parameter(0.1, StorageClass="ExportedGlobal", DataType="single")
P_LSM_IFV2RearAxis = Simulink.Parameter(0, StorageClass="ExportedGlobal", DataType="single")
P_LSM_IFV2CenterAxis = Simulink.Parameter(0, StorageClass="ExportedGlobal", DataType="single")
P_LSM_DOP2Line_Limit = Simulink.Parameter(1, StorageClass="ExportedGlobal")
P_LSM_DOP2Line_Reliable = Simulink.Parameter(0.8, StorageClass="ExportedGlobal")
LSM_B_IS_Available = Simulink.Signal(StorageClass="ExportedGlobal")
LSM_B_StubValid = Simulink.Signal(StorageClass="ExportedGlobal")
LSM_CruiseLeft = Simulink.Signal(StorageClass="ExportedGlobal")
LSM_CruiseRight = Simulink.Signal(StorageClass="ExportedGlobal")
LSM_CruiseTurn = Simulink.Signal(StorageClass="ExportedGlobal")
LSM_CruiseValid = Simulink.Signal(StorageClass="ExportedGlobal")
LSM_EN_Direction = Simulink.Signal(StorageClass="ExportedGlobal")
LSM_EntryStub1 = Simulink.Signal(StorageClass="ExportedGlobal")
LSM_EntryStub2 = Simulink.Signal(StorageClass="ExportedGlobal")
LSM_EntryStub3 = Simulink.Signal(StorageClass="ExportedGlobal")
LSM_EntryStub4 = Simulink.Signal(StorageClass="ExportedGlobal")
LSM_EntryStub5 = Simulink.Signal(StorageClass="ExportedGlobal")
LSM_EntryStub6 = Simulink.Signal(StorageClass="ExportedGlobal")
LSM_IExitStub1 = Simulink.Signal(StorageClass="ExportedGlobal")
LSM_IExitStub2 = Simulink.Signal(StorageClass="ExportedGlobal")
LSM_IExitStub3 = Simulink.Signal(StorageClass="ExportedGlobal")
LSM_LeftStub = Simulink.Signal(StorageClass="ExportedGlobal")
LSM_OneLane = Simulink.Signal(StorageClass="ExportedGlobal")
LSM_RightStub = Simulink.Signal(StorageClass="ExportedGlobal")
LSM_StubValid = Simulink.Signal(StorageClass="ExportedGlobal")
LSM_TurnLeft = Simulink.Signal(StorageClass="ExportedGlobal")
LSM_TurnRight = Simulink.Signal(StorageClass="ExportedGlobal")
LSM_Vanish_turnleft = Simulink.Signal(StorageClass="ExportedGlobal")
LSM_rExitStub1 = Simulink.Signal(StorageClass="ExportedGlobal")
LSM_rExitStub2 = Simulink.Signal(StorageClass="ExportedGlobal")
LSM_rExitStub3 = Simulink.Signal(StorageClass="ExportedGlobal")
P_LSM_LinetLostTime = Simulink.Parameter(0.3, StorageClass="ExportedGlobal")
LSM_PilotNohExitDist = Simulink.Signal(StorageClass="ExportedGlobal")
LSM_HMI_Voice = Simulink.Signal(StorageClass="ExportedGlobal")
LSM_LH0_C0 = Simulink.Signal()
LSM_LH0_C1 = Simulink.Signal()
LSM_LH0_C2 = Simulink.Signal()
LSM_LH0_C3 = Simulink.Signal()
LSM_LH0_Min = Simulink.Signal()
LSM_LH0_Max = Simulink.Signal()
LSM_LH1_Max = Simulink.Signal()
LSM_LH1_Min = Simulink.Signal()
LSM_LH1_C3 = Simulink.Signal()
LSM_LH1_C2 = Simulink.Signal()
LSM_LH1_C1 = Simulink.Signal()
LSM_LH1_C0 = Simulink.Signal()
LSM_exitTakeOverValid = Simulink.Signal()
LSM_PilotNohExitDist_Set100 = Simulink.Signal()
LSM_nLaneNum = Simulink.Signal()
LSM_f_distance = Simulink.Signal()
LSM_nLaneID = Simulink.Signal()
LSM_en_direction_stub = Simulink.Signal()
P_LSM_SpdTurnAlarm = Simulink.Parameter([100 300 500 800 1000 1200])
LSM_SubModel_VERSION = Simulink.Signal(StorageClass="ExportedGlobal")
LSM_SubModel_Number = Simulink.Signal(StorageClass="ExportedGlobal")
P_LSM_SpdLim_StubLength = Simulink.Parameter([10 20 30 40 50 60 70 80])
P_LSM_SpdLim_Stub_Spd = Simulink.Parameter([30 30 30 40 40 60 60 60])
P_LSM_EntryVanishDis = Simulink.Parameter(50, StorageClass="ExportedGlobal", DataType="single")
P_LSM_MapValid_ErrorSwitch = Simulink.Parameter(1)
P_LSM_EntryLnChngEnSwitch = Simulink.Parameter(1, StorageClass="ExportedGlobal", DataType="single")
LSM_EnLaneChangeEnable = Simulink.Signal(StorageClass="ExportedGlobal")
P_LSM_EntryEdge_offset = Simulink.Parameter(1.5, StorageClass="ExportedGlobal", DataType="single")
LSM_EntryStub5_takeover = Simulink.Signal(StorageClass="ExportedGlobal")
P_LSM_Pre2OnlyLineDis = Simulink.Parameter(5, StorageClass="ExportedGlobal", DataType="single")
P_LSM_OTL_C2_Factor = Simulink.Parameter(1, StorageClass="ExportedGlobal")
P_LSM_OTL_C1_Factor = Simulink.Parameter(1, StorageClass="ExportedGlobal")
LSM_TurnHighSpdFlag = Simulink.Signal(StorageClass="ExportedGlobal")
LSW_VehRightmostLane = Simulink.Signal(StorageClass="ExportedGlobal")
LSW_MostLaneRight_HiFlag = Simulink.Signal(StorageClass="ExportedGlobal")
LSM_nLaneNum_HiFlag = Simulink.Signal()
LSM_VehSpd_HiFlag = Simulink.Signal(StorageClass="ExportedGlobal")
P_LSM_DOP_PreDis_X = Simulink.Parameter([0 5 10 15 20 25 30 35 40 60 80 90 100 110 120 140], StorageClass="ExportedGlobal", DataType="single")
P_LSM_DOP_PreDis_Y = Simulink.Parameter([8 9 10 11 12 13 14 15 16 19 25 28 33 38 42 49], StorageClass="ExportedGlobal", DataType="single")
P_LSM_DOP_In_Pre2Dop_Dis = Simulink.Parameter(1, StorageClass="ExportedGlobal", DataType="single")
P_LSM_DOP_C0_EN_Limit = Simulink.Parameter(0.7, StorageClass="ExportedGlobal")
P_LSM_DOP_C0_out_Limit = Simulink.Parameter(1, StorageClass="ExportedGlobal")
P_LSM_DoubleLine_Pre2Cent_Dislimit = Simulink.Parameter(1, StorageClass="ExportedGlobal", DataType="single")
P_LSM_DoubleLine_Curr2Cent_Dislimit = Simulink.Parameter(0.5, StorageClass="ExportedGlobal", DataType="single")
LSM_DOP_EN = Simulink.Signal(StorageClass="ExportedGlobal")
P_LSM_DoubleLine_Dop2Cent_Dislimit = Simulink.Parameter(0.5, StorageClass="ExportedGlobal", DataType="single")