% Simulink data dictionary AP.sldd

LongCtrl_accelTargAbsFilt = Simulink.Signal(StorageClass="ExportedGlobal")
LongCtrl_accelTargAbsEnable = Simulink.Signal(StorageClass="ExportedGlobal")
LongCtrl_velTargAbsPlanTerminate = Simulink.Signal(StorageClass="ExportedGlobal", Dimensions=[20 1])
LongCtrl_distDesPlanCorr = Simulink.Signal(StorageClass="ExportedGlobal", Dimensions=[20 1])
LongCtrl_distDesPlan = Simulink.Signal(StorageClass="ExportedGlobal", Unit="m", Dimensions=[20 1])
LongCtrl_distRelPlanTerminate = Simulink.Signal(StorageClass="ExportedGlobal", Unit="m", Dimensions=[1 20])
LongCtrl_distRelPlanOpt = Simulink.Signal(StorageClass="ExportedGlobal", Dimensions=[1 40])
LongCtrl_velPlanRelOpt = Simulink.Signal(StorageClass="ExportedGlobal", Dimensions=[1 40])
LongCtrl_velSubjPlanOpt = Simulink.Signal(StorageClass="ExportedGlobal", Dimensions=[1 40])
LongCtrl_accelSubjDesCorr = Simulink.Signal(StorageClass="ExportedGlobal")
LongCtrl_accelSubjPlanOpt = Simulink.Signal(StorageClass="ExportedGlobal", Dimensions=[1 40])
LongCtrl_accelSubjDesRaw = Simulink.Signal(StorageClass="ExportedGlobal")
LongCtrl_J = Simulink.Signal(StorageClass="ExportedGlobal", Dimensions=[20 1])
LongCtrl_JadtA = Simulink.Signal(StorageClass="ExportedGlobal", Dimensions=[20 1])
LongCtrl_JadtADist = Simulink.Signal(StorageClass="ExportedGlobal", Dimensions=[20 1])
LongCtrl_asum = Simulink.Signal(StorageClass="ExportedGlobal", Dimensions=[20 1])
LongCtrl_coefJEnlarge = Simulink.Signal(StorageClass="ExportedGlobal", Dimensions=[20 1])
LongCtrl_distRelPlanMin = Simulink.Signal(StorageClass="ExportedGlobal")
LongCtrl_distRelDesDistRelPlanNumMin = Simulink.Signal(StorageClass="ExportedGlobal")
LongCtrl_num = Simulink.Signal(StorageClass="ExportedGlobal")
LongCtrl_accelFollow = Simulink.Signal(StorageClass="ExportedGlobal")
LongCtrl_upperBandFollow = Simulink.Signal(StorageClass="ExportedGlobal")
LongCtrl_lowerBandFollow = Simulink.Signal(StorageClass="ExportedGlobal")
LongCtrl_upperJerkFollow = Simulink.Signal(StorageClass="ExportedGlobal")
LongCtrl_lowerJerkFollow = Simulink.Signal(StorageClass="ExportedGlobal")
LongCtrl_FollowAcceleStandstillOverride = Simulink.Signal(StorageClass="ExportedGlobal")
LongCtrl_accelCC = Simulink.Signal(StorageClass="ExportedGlobal")
LongCtrl_upperBandCC = Simulink.Signal(StorageClass="ExportedGlobal")
LongCtrl_lowerBandCC = Simulink.Signal(StorageClass="ExportedGlobal")
LongCtrl_upperJerkCC = Simulink.Signal(StorageClass="ExportedGlobal")
LongCtrl_lowerJerkCC = Simulink.Signal(StorageClass="ExportedGlobal")
LongCtrl_accelCCCtrlAfterJerk = Simulink.Signal(StorageClass="ExportedGlobal")
LongCtrl_accelArb = Simulink.Signal(StorageClass="ExportedGlobal")
LongCtrl_lowerBandArb = Simulink.Signal(StorageClass="ExportedGlobal")
LongCtrl_lowerJerkArb = Simulink.Signal(StorageClass="ExportedGlobal")
LongCtrl_upperBandArb = Simulink.Signal(StorageClass="ExportedGlobal")
LongCtrl_upperJerkArb = Simulink.Signal(StorageClass="ExportedGlobal")
LongCtrl_accelAL = Simulink.Signal(StorageClass="ExportedGlobal")
LongCtrl_upperBandAL = Simulink.Signal(StorageClass="ExportedGlobal")
LongCtrl_lowerBandAL = Simulink.Signal(StorageClass="ExportedGlobal")
LongCtrl_upperJerkAL = Simulink.Signal(StorageClass="ExportedGlobal")
LongCtrl_lowerJerkAL = Simulink.Signal(StorageClass="ExportedGlobal")
LongCtrl_DriveOffConditonFulfilled = Simulink.Signal(StorageClass="ExportedGlobal")
LongCtrl_DecleToStop = Simulink.Signal(StorageClass="ExportedGlobal")
LongCtrl_tor = Simulink.Signal(StorageClass="ExportedGlobal")
LongCtrl_BrakePrefer = Simulink.Signal(StorageClass="ExportedGlobal")
LongCtrl_axvFollow = Simulink.Signal(StorageClass="ExportedGlobal")
LongCtrl_distDesCur = Simulink.Signal(StorageClass="ExportedGlobal")
LongCtrl_TgtObjBarDisp = Simulink.Signal(StorageClass="ExportedGlobal")
P_LongCtrl_tCycle = Simulink.Parameter(0.02, StorageClass="ExportedGlobal", DataType="single", Min=0.02, Max=0.02, Unit="s")
P_LongCtrl_ALaLowerChar = Simulink.Parameter([-5 -5 -3.5 -3.5], StorageClass="ExportedGlobal", DataType="single", Unit="m/s^2")
LongCtrl_accelSupressionEnable = Simulink.Signal(StorageClass="ExportedGlobal")
LongCtrl_tStartDecel = Simulink.Signal(StorageClass="ExportedGlobal")
LongCtrl_accelFollowAfterLaneChangeSupress = Simulink.Signal(StorageClass="ExportedGlobal")
LongCtrl_curvatureForCurveDecelRaw = Simulink.Signal(StorageClass="ExportedGlobal")
LongCtrl_curvatureForCurveDecel = Simulink.Signal(StorageClass="ExportedGlobal")
LongCtrl_accelCurvature = Simulink.Signal(StorageClass="ExportedGlobal")
LongCtrl_kapFilt = Simulink.Signal(StorageClass="ExportedGlobal")
LongCtrl_accelKapStartupRaw = Simulink.Signal(StorageClass="ExportedGlobal")
LongCtrl_accelKapRun = Simulink.Signal(StorageClass="ExportedGlobal")
LongCtrl_accelKapStartup = Simulink.Signal(StorageClass="ExportedGlobal")
LongCtrl_accelKap = Simulink.Signal(StorageClass="ExportedGlobal")
LongCtrl_accelIC = Simulink.Signal(StorageClass="ExportedGlobal")
LongCtrl_upperBandIC = Simulink.Signal(StorageClass="ExportedGlobal")
LongCtrl_lowerBandIC = Simulink.Signal(StorageClass="ExportedGlobal")
LongCtrl_upperJerkIC = Simulink.Signal(StorageClass="ExportedGlobal")
LongCtrl_lowerJerkIC = Simulink.Signal(StorageClass="ExportedGlobal")
LongCtrl_curvatureNoC3 = Simulink.Signal(StorageClass="ExportedGlobal")
LongCtrl_curvatureWithC3 = Simulink.Signal(StorageClass="ExportedGlobal")
LongCtrl_coefCurvatureNoC3 = Simulink.Signal(StorageClass="ExportedGlobal")
LongCtrl_coefCurvatureWithC3 = Simulink.Signal(StorageClass="ExportedGlobal")
C_LongCtrl_0_Single = Simulink.Parameter(0, StorageClass="ExportedGlobal", DataType="single")
C_LongCtrl_0_Uint8 = Simulink.Parameter(0, StorageClass="ExportedGlobal", DataType="uint8")
C_LongCtrl_1_Single = Simulink.Parameter(1, StorageClass="ExportedGlobal", DataType="single")
C_LongCtrl_100_Single = Simulink.Parameter(100, StorageClass="ExportedGlobal", DataType="single")
C_LongCtrl_Mph2Kph = Simulink.Parameter(1.609, StorageClass="ExportedGlobal", DataType="single")
C_LongCtrl_Ms2Kph = Simulink.Parameter(3.6, StorageClass="ExportedGlobal", DataType="single")
LongCtrl_Follow_Counter = Simulink.Signal(StorageClass="ExportedGlobal")
LongCtrl_followAccel_Plau = Simulink.Signal(StorageClass="ExportedGlobal", Unit="m/s^2")
LongCtrl_standstillOverrideCondition = Simulink.Signal(StorageClass="ExportedGlobal")
LongCtrl_coefStandstillOverride = Simulink.Signal(StorageClass="ExportedGlobal")
LongCtrl_slopeStartupAssist = Simulink.Signal(StorageClass="ExportedGlobal")
LongCtrl_accelFollowSlopeAssist = Simulink.Signal(StorageClass="ExportedGlobal")
LongCtrl_accelFollowAfterDecelToStop = Simulink.Signal(StorageClass="ExportedGlobal")
LongCtrl_accelFollowFilt = Simulink.Signal(StorageClass="ExportedGlobal")
LongCtrl_accelFollowAfterJerk = Simulink.Signal(StorageClass="ExportedGlobal")
LongCtrl_VlcInternalAccK20 = Simulink.Signal(StorageClass="ExportedGlobal")
LongCtrl_accelORD = Simulink.Signal(StorageClass="ExportedGlobal")
LongCtrl_ALC_dangerLevel = Simulink.Signal(StorageClass="ExportedGlobal")
LongCtrl_ALC_laneChangeEnable = Simulink.Signal(StorageClass="ExportedGlobal")
LongCtrl_L1_Avail_time = Simulink.Signal(StorageClass="ExportedGlobal")
LongCtrl_R1_Avail_time = Simulink.Signal(StorageClass="ExportedGlobal")
LongCtrl_L1_Avail_dis = Simulink.Signal(StorageClass="ExportedGlobal")
LongCtrl_R1_Avail_dis = Simulink.Signal(StorageClass="ExportedGlobal")
P_LongCtrl_LaneAvailTime = Simulink.Parameter(1, StorageClass="ExportedGlobal", DataType="single", Min=0, Max=10)
P_LongCtrl_LaneAvailDis = Simulink.Parameter(10, StorageClass="ExportedGlobal", DataType="single", Min=0, Max=100)
LongCtrl_L1_Line_std = Simulink.Signal(StorageClass="ExportedGlobal")
LongCtrl_R1_Line_std = Simulink.Signal(StorageClass="ExportedGlobal")
P_LongCtrl_ORDvelDeltaEnableThres = Simulink.Parameter(1, StorageClass="ExportedGlobal", DataType="single", Min=0, Max=3, Unit="m/s")
P_LongCtrl_ORDtAcceleTimePos = Simulink.Parameter(5, StorageClass="ExportedGlobal", DataType="single", Min=1, Max=40, Unit="s")
P_LongCtrl_ORDtAcceleTimeNeg = Simulink.Parameter(20, StorageClass="ExportedGlobal", DataType="single", Min=5, Max=30, Unit="s")
P_LongCtrl_FollowttcCorrDecelJerkYAxis = Simulink.Parameter([1 0.8 0.5 0.1], StorageClass="ExportedGlobal", DataType="single", Min=0, Max=1)
P_LongCtrl_FollowttcCorrDecelJerkXAxis = Simulink.Parameter([1 10 20 100], StorageClass="ExportedGlobal", DataType="single", Min=0, Max=200, Unit="s")
P_LongCtrl_FollowjerkForceStopCharXAxis = Simulink.Parameter([0.3 1 2], StorageClass="ExportedGlobal", DataType="single", Min=0, Max=4, Unit="m/s^2")
P_LongCtrl_FollowaccelSupressionAccelThres = Simulink.Parameter(0.1, StorageClass="ExportedGlobal", DataType="single", Min=-0.5, Max=0.5, Unit="m/s^2")
P_LongCtrl_FollowaccelStopMax = Simulink.Parameter(-0.3, StorageClass="ExportedGlobal", DataType="single", Min=-1, Max=0, Unit="m/s^2")
P_LongCtrl_FollowaccelForceStopMinCharYAxis = Simulink.Parameter([-2 -4], StorageClass="ExportedGlobal", DataType="single", Min=-6, Max=-2, Unit="m/s^2")
P_LongCtrl_FollowaccelForceStopMinCharXAxis = Simulink.Parameter([1 3], StorageClass="ExportedGlobal", DataType="single", Min=0, Max=5, Unit="m/s^2")
P_LongCtrl_FollowaccelFollowDesThresEnableStopYAxis = Simulink.Parameter([0.35 0.18], StorageClass="ExportedGlobal", DataType="single", Min=0, Max=1, Unit="m/s^2")
P_LongCtrl_FollowaccelFollowDesThresEnableStopXAxis = Simulink.Parameter([3 4], StorageClass="ExportedGlobal", DataType="single", Min=0, Max=5.5, Unit="m")
P_LongCtrl_CCdecelCCJerkNegVLCInternalAcc = Simulink.Parameter(-1, StorageClass="ExportedGlobal", DataType="single", Min=-4, Max=0, Unit="m/s^3")
P_LongCtrl_CCdecelCCJerk = Simulink.Parameter(-2.5, StorageClass="ExportedGlobal", DataType="single", Min=-4, Max=0, Unit="m/s^3")
P_LongCtrl_CCaccelUpperCCSafeStop = Simulink.Parameter(-0.4, StorageClass="ExportedGlobal", DataType="single", Min=-2, Max=0, Unit="m/s^2")
P_LongCtrl_CCaccelUpperCC = Simulink.Parameter(2.5, StorageClass="ExportedGlobal", DataType="single", Min=1, Max=3, Unit="m/s^2")
P_LongCtrl_CCaccelMinNoFastDecel = Simulink.Parameter(-0.2, StorageClass="ExportedGlobal", DataType="single", Min=-2, Max=0, Unit="m/s^2")
P_LongCtrl_CCaccelMinFastDecel = Simulink.Parameter(-1.2, StorageClass="ExportedGlobal", DataType="single", Min=-5, Max=-1, Unit="m/s^2")
P_LongCtrl_CCaccelLowerIsLaneChange = Simulink.Parameter(0.3, StorageClass="ExportedGlobal", DataType="single", Min=0, Max=2, Unit="m/s^2")
P_LongCtrl_CCaccelCCPosJerk = Simulink.Parameter(1, StorageClass="ExportedGlobal", DataType="single", Min=0, Max=4, Unit="m/s^3")
P_LongCtrl_FollowgapThresActiveTOR = Simulink.Parameter(1.5, StorageClass="ExportedGlobal", DataType="single", Min=0, Max=10, Unit="s")
P_LongCtrl_numVlcInternalAccDelay = Simulink.Parameter(19, StorageClass="ExportedGlobal", DataType="double", Min=5, Max=40)
P_LongCtrl_FollowdistThresEnableStop = Simulink.Parameter(5, StorageClass="ExportedGlobal", DataType="single", Min=1, Max=10, Unit="m")
P_LongCtrl_FollowDrvOffvSetMinDriveOffConditions = Simulink.Parameter(1, StorageClass="ExportedGlobal", DataType="single", Min=0, Max=10, Unit="m/s")
P_LongCtrl_FollowDrvOffVelExitVelCorrOverride = Simulink.Parameter(0.3, StorageClass="ExportedGlobal", DataType="single", Min=0, Max=2, Unit="m/s")
P_LongCtrl_FollowDrvOffVelExitVelCorrNoOverride = Simulink.Parameter(0.2, StorageClass="ExportedGlobal", DataType="single", Min=0, Max=2, Unit="m/s")
P_LongCtrl_FollowDrvOffVelExitDistCorrOverride = Simulink.Parameter(0.8, StorageClass="ExportedGlobal", DataType="single", Min=0, Max=5, Unit="m")
P_LongCtrl_FollowDrvOffVelExitDistCorrNoOverride = Simulink.Parameter(0.5, StorageClass="ExportedGlobal", DataType="single", Min=0, Max=5, Unit="m")
P_LongCtrl_FollowDrvOffVelCorrVelFullFillOverride = Simulink.Parameter(0.2, StorageClass="ExportedGlobal", DataType="single", Min=0, Max=1, Unit="m/s")
P_LongCtrl_FollowDrvOffStandstillVelThres = Simulink.Parameter(1, StorageClass="ExportedGlobal", DataType="single", Min=0, Max=5, Unit="m/s")
P_LongCtrl_FollowDrvOffdistRelMinAutoDrvOff = Simulink.Parameter(3, StorageClass="ExportedGlobal", DataType="single", Min=2, Max=6, Unit="m")
P_LongCtrl_FollowDrvOffDistExitOverride = Simulink.Parameter(1.5, StorageClass="ExportedGlobal", DataType="single", Min=0, Max=5, Unit="m")
P_LongCtrl_FollowDrvOffDistExitNoOverride = Simulink.Parameter(0.5, StorageClass="ExportedGlobal", DataType="single", Min=0, Max=5, Unit="m")
P_LongCtrl_FollowDrvOffDistCorrVelFullFillOverride = Simulink.Parameter(0.5, StorageClass="ExportedGlobal", DataType="single", Min=0, Max=5, Unit="m")
P_LongCtrl_FollowDrvOffDistCorrDistFullFillOverride = Simulink.Parameter(1, StorageClass="ExportedGlobal", DataType="single", Min=0, Max=10, Unit="m")
P_LongCtrl_distThreDecToStopXAxis = Simulink.Parameter([0 0.2 0.5], StorageClass="ExportedGlobal", DataType="single", Min=0, Max=5, Unit="m/s^2")
P_LongCtrl_distThreDecToStopYAxis = Simulink.Parameter([20 1 0.1], StorageClass="ExportedGlobal", DataType="single", Min=0, Max=30, Unit="m")
P_LongCtrl_FollowaccelTargAbsEnableNegMax = Simulink.Parameter(-0.5, StorageClass="ExportedGlobal", DataType="single", Min=-1, Max=3, Unit="m/s^2")
P_LongCtrl_FollowaccelTargAbsEnableNegJerk = Simulink.Parameter(-4, StorageClass="ExportedGlobal", DataType="single", Min=-10, Max=0, Unit="m/s^3")
P_LongCtrl_FollowaccelTargAbsEnablePosJerk = Simulink.Parameter(3, StorageClass="ExportedGlobal", DataType="single", Min=0, Max=10, Unit="m/s^3")
P_LongCtrl_FollowaccelTargAbsEnableRangeMax = Simulink.Parameter(-0.4, StorageClass="ExportedGlobal", DataType="single", Min=-2, Max=2, Unit="m/s^2")
P_LongCtrl_CCtAcceleTimeNegCorrXAxis = Simulink.Parameter([-3 0], StorageClass="ExportedGlobal", DataType="single", Min=-5, Max=0, Unit="m/s")
P_LongCtrl_CCtAcceleTimeNegCorrYAxis = Simulink.Parameter([1 0.3], StorageClass="ExportedGlobal", DataType="single", Min=0, Max=1)
P_LongCtrl_CCtAcceleTimePosCorrXAxis = Simulink.Parameter([0 2], StorageClass="ExportedGlobal", DataType="single", Min=0, Max=5, Unit="m/s")
P_LongCtrl_CCtAcceleTimePosCorrYAxis = Simulink.Parameter([0.4 1], StorageClass="ExportedGlobal", DataType="single", Min=0, Max=1)
P_LongCtrl_FollowaccelTargThresEnableStop = Simulink.Parameter(0.5, StorageClass="ExportedGlobal", DataType="single", Min=0, Max=2, Unit="m/s^2")
P_LongCtrl_FollowaccelTargThresForceStop = Simulink.Parameter(0.1, StorageClass="ExportedGlobal", DataType="single", Min=0, Max=1, Unit="m/s^2")
P_LongCtrl_FollowaccelThresActiveTOR = Simulink.Parameter(-5.5, StorageClass="ExportedGlobal", DataType="single", Min=-10, Max=0, Unit="m/s^2")
P_LongCtrl_ICaccelThresEnableLine = Simulink.Parameter(-1, StorageClass="ExportedGlobal", DataType="single", Min=-2, Max=1, Unit="m/s^2")
P_LongCtrl_ICcoefCurvatureCharX1 = Simulink.Parameter([0 0.0025 0.0035 0.0045], StorageClass="ExportedGlobal", DataType="single", Min=0, Max=1, Unit="1/m")
P_LongCtrl_ICcoefCurvatureCharX2 = Simulink.Parameter([0.00015 0.0025 0.0035 0.0045], StorageClass="ExportedGlobal", DataType="single", Min=0, Max=1, Unit="1/m")
P_LongCtrl_ICcoefCurvatureCharY = Simulink.Parameter([0.1 0.1 0.1 0.1; 0.1 0.3 0.6 0.3; 0.15 0.6 0.8 0.6; 0.2 0.6 0.8 1], StorageClass="ExportedGlobal", DataType="single", Min=0, Max=1)
P_LongCtrl_ICCurveDecelEnable = Simulink.Parameter(1, StorageClass="ExportedGlobal", DataType="boolean", Min=0, Max=1)
P_LongCtrl_ICdeltaAccelLowerBand = Simulink.Parameter(0.2, StorageClass="ExportedGlobal", DataType="single", Min=0, Max=0.5, Unit="m/s^2")
P_LongCtrl_ICdeltaAccelUpperBand = Simulink.Parameter(0.2, StorageClass="ExportedGlobal", DataType="single", Min=0, Max=0.5, Unit="m/s^2")
P_LongCtrl_ICKapLimitAccelXAxis = Simulink.Parameter([0 0.0005 0.001 0.002 0.005 0.01 0.02 0.05 0.1 0.2], StorageClass="ExportedGlobal", DataType="single", Min=0, Max=1)
P_LongCtrl_ICKapLimitAccelYAxis = Simulink.Parameter([16 16 16 8 1.5 0.8 0.5 0.4 0.3 0.2], StorageClass="ExportedGlobal", DataType="single", Min=0, Max=16)
P_LongCtrl_ICKapLimitSpdXAxis = Simulink.Parameter([0 0.0005 0.001 0.002 0.005 0.01 0.02 0.05 0.1 0.2], StorageClass="ExportedGlobal", DataType="single", Min=0, Max=1)
P_LongCtrl_ICKapLimitSpdYAxis = Simulink.Parameter([150 150 150 150 150 100 60 40 20 10], StorageClass="ExportedGlobal", DataType="single", Min=0, Max=150)

P_LongCtrl_FollowdistDesYAxis = Simulink.Parameter([3.2 8.5 23 37 49 70
 3.3 9 26 42 56 75
 3.4 9.5 28 47 63 80
 3.5 10 34 54 71 85], StorageClass="ExportedGlobal", DataType="single", Min=2.5, Max=150)

P_LongCtrl_FollowRateJConditionStep = Simulink.Parameter(0.15, StorageClass="ExportedGlobal", DataType="single", Min=0, Max=1)
P_LongCtrl_FollowRateJDirStep = Simulink.Parameter(0.3, StorageClass="ExportedGlobal", DataType="single", Min=0, Max=1)
P_LongCtrl_FollowVelSubjNegToleranceAddX1Axis = Simulink.Parameter([0 9], StorageClass="ExportedGlobal", DataType="single", Min=0, Max=20, Unit="m")
P_LongCtrl_FollowVelSubjNegToleranceAddX2Axis = Simulink.Parameter([-4 -1.5], StorageClass="ExportedGlobal", DataType="single", Min=-10, Max=0, Unit="m/s")
P_LongCtrl_FollowVelSubjNegToleranceAddYAxis = Simulink.Parameter([-5 -5; 0 0], StorageClass="ExportedGlobal", DataType="single", Min=-10, Max=0, Unit="m/s")
P_LongCtrl_FollowvelSubjThresEnableStop = Simulink.Parameter(0.6, StorageClass="ExportedGlobal", DataType="single", Min=0.2, Max=2, Unit="m/s")
P_LongCtrl_FollowvelSubjThresEnableStopAddXAxis = Simulink.Parameter([0 1], StorageClass="ExportedGlobal", DataType="single", Min=0, Max=3.5, Unit="m")
P_LongCtrl_FollowvelSubjThresEnableStopAddYAxis = Simulink.Parameter([0 0.6], StorageClass="ExportedGlobal", DataType="single", Min=0, Max=3, Unit="m/s")
P_LongCtrl_FollowvelTarAbsThresForceStop = Simulink.Parameter(0.2, StorageClass="ExportedGlobal", DataType="single", Min=0.1, Max=1, Unit="m/s")
P_LongCtrl_FollowVelTargetAbsSmoothNum = Simulink.Parameter(0.2, StorageClass="ExportedGlobal", DataType="single", Min=0, Max=60, Unit="m/s")
P_LongCtrl_FollowvelTargRelThresActiveTOR = Simulink.Parameter(-1, StorageClass="ExportedGlobal", DataType="single", Min=-5, Max=0, Unit="m/s")
P_LongCtrl_FollowWdCoefXAxis = Simulink.Parameter([0.1 2 3], StorageClass="ExportedGlobal", DataType="single", Min=0, Max=20)
P_LongCtrl_FollowWdCoefYAxis = Simulink.Parameter([0.5 0.1 0.1], StorageClass="ExportedGlobal", DataType="single", Min=0, Max=5)
P_LongCtrl_FollowWvCoefXAxis = Simulink.Parameter([-5 -2 0 2], StorageClass="ExportedGlobal", DataType="single", Min=-20, Max=20)
P_LongCtrl_FollowWvCoefYAxis = Simulink.Parameter([1.2 0.2 0.1 0.1], StorageClass="ExportedGlobal", DataType="single", Min=0, Max=20)
P_LongCtrl_FollowcoefDistEnlargeDecToStop = Simulink.Parameter(5, StorageClass="ExportedGlobal", DataType="single", Min=1, Max=20)
P_LongCtrl_FollowcoefVelEnlargeDecToStop = Simulink.Parameter(5, StorageClass="ExportedGlobal", DataType="single", Min=1, Max=20)
P_LongCtrl_FollowDistDesCompensionVelRelThresMin = Simulink.Parameter(0, StorageClass="ExportedGlobal", DataType="single", Min=-5, Max=2, Unit="km/h")
P_LongCtrl_FollowdistDesCompensionXAxis = Simulink.Parameter([5 30], StorageClass="ExportedGlobal", DataType="single", Min=0, Max=70, Unit="m/s")
P_LongCtrl_FollowdistDesCompensionYAxis = Simulink.Parameter([3 15], StorageClass="ExportedGlobal", DataType="single", Min=0, Max=50, Unit="m")
P_LongCtrl_FollowdistDesStopMin = Simulink.Parameter(3.5, StorageClass="ExportedGlobal", DataType="single", Min=1.5, Max=5.5, Unit="m")
P_LongCtrl_FollowdistDesX2Axis = Simulink.Parameter([0 2.6 17 25 35 60], StorageClass="ExportedGlobal", DataType="single", Min=0, Max=70, Unit="m/s")
P_LongCtrl_FollowaccelTargAbsExitNegMin = Simulink.Parameter(-0.2, StorageClass="ExportedGlobal", DataType="single", Min=-3, Max=0, Unit="m/s^2")
P_LongCtrl_FollowDecelJerkForceSlopeXAxis = Simulink.Parameter([0.3 3], StorageClass="ExportedGlobal", DataType="single", Min=0, Max=4, Unit="m/s^2")
P_LongCtrl_FollowDecelJerkForceSlopeYAxis = Simulink.Parameter([-4 -30], StorageClass="ExportedGlobal", DataType="single", Min=-50, Max=0, Unit="m/s^3")
P_LongCtrl_FollowAccelAddSlopeAssistXAxis = Simulink.Parameter([0.8 1.5], StorageClass="ExportedGlobal", DataType="single", Min=0, Max=4, Unit="m/s^2")
P_LongCtrl_FollowAccelAddSlopeAssistYAxis = Simulink.Parameter([0.2 0.3], StorageClass="ExportedGlobal", DataType="single", Min=0, Max=1, Unit="m/s^2")
P_LongCtrl_FollowAccelSlopeAssistStep = Simulink.Parameter(0.02, StorageClass="ExportedGlobal", DataType="single", Min=0, Max=1, Unit="m/s^2")
P_LongCtrl_FollowdecelJerkCharXAxis = Simulink.Parameter([0.1 0.5 1 2 5 10], StorageClass="ExportedGlobal", DataType="single", Min=0, Max=20, Unit="s")
P_LongCtrl_FollowdecelJerkCharYAxis = Simulink.Parameter([-5 -4.5 -4 -3 -1.8 -1], StorageClass="ExportedGlobal", DataType="single", Min=-10, Max=0, Unit="m/s^3")
P_LongCtrl_IClowerJerkICCharXAxis = Simulink.Parameter([-2 -1 0], StorageClass="ExportedGlobal", DataType="single", Min=-5, Max=2, Unit="m/s^2")
P_LongCtrl_IClowerJerkICCharYAxis = Simulink.Parameter([-0.8 -0.4 -0.1], StorageClass="ExportedGlobal", DataType="single", Min=-5, Max=0, Unit="m/s^3")
P_LongCtrl_ICtDecel = Simulink.Parameter(5.5, StorageClass="ExportedGlobal", DataType="single", Min=2, Max=10, Unit="s")
LongCtrl_velSubjPlanArb = Simulink.Signal(StorageClass="ExportedGlobal")
LongCtrl_velSubjPlanCC = Simulink.Signal(StorageClass="ExportedGlobal", DataType="single")
LongCtrl_velSubjPlanFollow = Simulink.Signal(StorageClass="ExportedGlobal", DataType="single")
P_LongCtrl_ALvAcceleLowerChar = Simulink.Parameter([0 5 20 30], StorageClass="ExportedGlobal", DataType="single", Min=0, Max=70, Unit="m/s")
P_LongCtrl_ALvAcceleUpperCharEco = Simulink.Parameter([1 1.5 2 2.5 4 8 12 15 18 22 25 28 30 40 60], StorageClass="ExportedGlobal", DataType="single", Min=0, Max=70, Unit="m/s")
P_LongCtrl_ALvAcceleUpperCharNormal = Simulink.Parameter([1 1.5 2 2.5 4 8 12 15 18 22 25 28 30 40 60], StorageClass="ExportedGlobal", DataType="single", Min=0, Max=70, Unit="m/s")
P_LongCtrl_ALvAcceleUpperCharSport = Simulink.Parameter([1 1.5 2 2.5 4 8 12 15 18 22 25 28 30 40 60], StorageClass="ExportedGlobal", DataType="single", Min=0, Max=70, Unit="m/s")
P_LongCtrl_CCaDtLowerMax = Simulink.Parameter(-0.4, StorageClass="ExportedGlobal", DataType="single", Min=-5, Max=0, Unit="m/s^3")
P_LongCtrl_CCaDtLowerMin = Simulink.Parameter(-2, StorageClass="ExportedGlobal", DataType="single", Min=-5, Max=0, Unit="m/s^3")
P_LongCtrl_CCaDtUpperMax = Simulink.Parameter(1, StorageClass="ExportedGlobal", DataType="single", Min=0, Max=5, Unit="m/s^3")
P_LongCtrl_CCaDtUpperMin = Simulink.Parameter(0.5, StorageClass="ExportedGlobal", DataType="single", Min=0, Max=5, Unit="m/s^3")
P_LongCtrl_CCaMinNegAcceleLowerBand = Simulink.Parameter(-0.2, StorageClass="ExportedGlobal", DataType="single", Min=-2, Max=0, Unit="m/s^2")
P_LongCtrl_CCaMinNegAcceleUpperBand = Simulink.Parameter(0.2, StorageClass="ExportedGlobal", DataType="single", Min=0, Max=2, Unit="m/s^2")
P_LongCtrl_CCaMinPosAcceleLowerBand = Simulink.Parameter(-0.2, StorageClass="ExportedGlobal", DataType="single", Min=-2, Max=0, Unit="m/s^2")
P_LongCtrl_CCaMinPosAcceleUpperBand = Simulink.Parameter(0.2, StorageClass="ExportedGlobal", DataType="single", Min=0, Max=2, Unit="m/s^2")
P_LongCtrl_CCfacNegAcceleLowerBand = Simulink.Parameter(1.1, StorageClass="ExportedGlobal", DataType="single", Min=0, Max=2)
P_LongCtrl_CCfacNegAcceleUpperBand = Simulink.Parameter(0.9, StorageClass="ExportedGlobal", DataType="single", Min=0, Max=2)
P_LongCtrl_CCfacPosAcceleLowerBand = Simulink.Parameter(0.9, StorageClass="ExportedGlobal", DataType="single", Min=0, Max=2)
P_LongCtrl_CCfacPosAcceleUpperBand = Simulink.Parameter(1.1, StorageClass="ExportedGlobal", DataType="single", Min=0, Max=2)
P_LongCtrl_CCtAcceleTimeNeg = Simulink.Parameter(5.5, StorageClass="ExportedGlobal", DataType="single", Min=1, Max=10, Unit="s")
P_LongCtrl_CCtAcceleTimePos = Simulink.Parameter(5, StorageClass="ExportedGlobal", DataType="single", Min=1, Max=10, Unit="s")
P_LongCtrl_CCtJerkLow = Simulink.Parameter(1.2, StorageClass="ExportedGlobal", DataType="single", Min=0, Max=10, Unit="s")
P_LongCtrl_CCtJerkUpper = Simulink.Parameter(2, StorageClass="ExportedGlobal", DataType="single", Min=0, Max=10, Unit="s")
P_LongCtrl_distThreDecToStop = Simulink.Parameter(20, StorageClass="ExportedGlobal", DataType="single", Min=0, Max=50, Unit="m")
P_LongCtrl_FollowdistTargRelEnableAccelTargAbsThres = Simulink.Parameter(20, StorageClass="ExportedGlobal", DataType="single", Min=0, Max=50, Unit="m")
P_LongCtrl_velSubjThreDecToStop = Simulink.Parameter(3, StorageClass="ExportedGlobal", DataType="single", Min=0, Max=10, Unit="m/s")
P_LongCtrl_velTargetThreDecleToStop = Simulink.Parameter(1, StorageClass="ExportedGlobal", DataType="single", Min=0, Max=10, Unit="m/s")
P_LongCtrl_ORDdecelEnable = Simulink.Parameter(0, StorageClass="ExportedGlobal", DataType="boolean", Min=0, Max=1)
P_LongCtrl_IClowerJerkPosVLCInternalAccMin = Simulink.Parameter(-2, StorageClass="ExportedGlobal", DataType="single", Min=-5, Max=0, Unit="m/s^3")
P_LongCtrl_SJaccelFollowThresEnableBrkPrefer = Simulink.Parameter(0, StorageClass="ExportedGlobal", DataType="single", Min=-3, Max=1, Unit="m/s^2")
P_LongCtrl_SJaccelSubjPlanOptThresEnableBrkPrefer = Simulink.Parameter(-1.3, StorageClass="ExportedGlobal", DataType="single", Min=-5, Max=0, Unit="m/s^2")
P_LongCtrl_SJVlcInternalAccThresEnableBrkPrefer = Simulink.Parameter(0.3, StorageClass="ExportedGlobal", DataType="single", Min=-1, Max=2, Unit="m/s^2")
P_LongCtrl_SJaxvRoadSlopeThresEnableBrkPrefer = Simulink.Parameter(0.3, StorageClass="ExportedGlobal", DataType="single", Min=-3, Max=4, Unit="m/s^2")
P_LongCtrl_SJaccelSubjThresEnableBrkPrefer = Simulink.Parameter(-0.5, StorageClass="ExportedGlobal", DataType="single", Min=-2, Max=1, Unit="m/s^2")
P_LongCtrl_SJttcThresEnableBrkPrefer = Simulink.Parameter(10, StorageClass="ExportedGlobal", DataType="single", Min=0, Max=20, Unit="s")
P_LongCtrl_SJvelSubjThresEnableBrkPrefer = Simulink.Parameter(3.6, StorageClass="ExportedGlobal", DataType="single", Min=0, Max=30, Unit="m/s")
P_LongCtrl_SJdStop = Simulink.Parameter(4, StorageClass="ExportedGlobal", DataType="single", Min=4, Max=4)
P_LongCtrl_IClowerJerkPosVLCInternalAccMax = Simulink.Parameter(-0.1, StorageClass="ExportedGlobal", DataType="single", Min=-5, Max=0, Unit="m/s^3")
P_LongCtrl_FollowDistDesCompensionVelRelThresMax = Simulink.Parameter(single(5), StorageClass="ExportedGlobal", Min=0, Max=20, Unit="km/h")
P_LongCtrl_FollowjerkForceStopCharYAxis = Simulink.Parameter([-0.025 -0.25 -0.5], StorageClass="ExportedGlobal", DataType="single", Min=-5, Max=0, Unit="m/s^3")
LongCtrl_ForceStop = Simulink.Signal(StorageClass="ExportedGlobal")
LongCtrl_ArbFlag = Simulink.Signal(StorageClass="ExportedGlobal")
P_LongCtrl_CCaccelCCNeg2PosJerk = Simulink.Parameter(5, StorageClass="ExportedGlobal", DataType="single", Min=0, Max=5, Unit="m/s^3")
P_LongCtrl_FollowVelSubjThresForceStopXAxis = Simulink.Parameter([0.3 2], StorageClass="ExportedGlobal", DataType="single", Min=0, Max=4, Unit="m/s^2")
P_LongCtrl_FollowVelSubjThresForceStopYAxis = Simulink.Parameter([0.1 0.5], StorageClass="ExportedGlobal", DataType="single", Min=0, Max=3, Unit="m/s")
P_LongCtrl_FollowDistDiff2VelSubjThresEnableStop = Simulink.Parameter([-1 1], StorageClass="ExportedGlobal", DataType="single", Min=-5, Max=5, Unit="m")
LongCtrl_quickDecel = Simulink.Signal(StorageClass="ExportedGlobal")
P_LongCtrl_FollowQuickDecelVelTargRelThres = Simulink.Parameter(-1, StorageClass="ExportedGlobal", DataType="single", Min=-10, Max=0, Unit="m/s")
P_LongCtrl_FollowQuickDecelDiffDistRel2DesThres = Simulink.Parameter(0.5, StorageClass="ExportedGlobal", DataType="single", Min=-20, Max=5, Unit="m")
P_LongCtrl_FollowQuickDecelAccelDesMax = Simulink.Parameter(-0.6, StorageClass="ExportedGlobal", DataType="single", Min=-3, Max=0, Unit="m/s^2")
P_LongCtrl_FollowQuickDecelVelSubjThres = Simulink.Parameter(100, StorageClass="ExportedGlobal", DataType="single", Min=0, Max=100, Unit="m/s")
P_LongCtrl_FollowQuickAccelTargAbsEnableThres = Simulink.Parameter(-0.6, StorageClass="ExportedGlobal", DataType="single", Min=-3, Max=0, Unit="m/s^2")
P_LongCtrl_ICKapUpperJerkMin = Simulink.Parameter(1, StorageClass="ExportedGlobal", DataType="single")
P_LongCtrl_FollowTFiltP0XAxis = Simulink.Parameter(single([-1 0]), StorageClass="ExportedGlobal", Min=-2, Max=1, Unit="m/s^2")
P_LongCtrl_FollowTFiltP0YAxis = Simulink.Parameter(single([0.15 0.5]), StorageClass="ExportedGlobal", Min=0.01, Max=2, Unit="s")
P_LongCtrl_ICupperJerkICCharXAxis = Simulink.Parameter([-2 -1 0 1], StorageClass="ExportedGlobal", DataType="single", Min=-2, Max=2, Unit="m/s^2")
P_LongCtrl_ICupperJerkICCharYAxis = Simulink.Parameter([2 1 0.15 0.5], StorageClass="ExportedGlobal", DataType="single", Min=0, Max=3, Unit="m/s^3")
P_LongCtrl_CCResumeDelayDeltaVel = Simulink.Parameter(-2, StorageClass="ExportedGlobal", DataType="single")
P_LongCtrl_IC_PreDisLimitByCurXAxis = Simulink.Parameter([0 0.0005 0.001 0.002 0.005 0.01 0.02 0.05 0.1 0.2], StorageClass="ExportedGlobal", DataType="single", Min=0, Max=1)
P_LongCtrl_IC_PreDisLimitByCurYAxis = Simulink.Parameter([90 90 60 30 10 8 5 2 0 0], StorageClass="ExportedGlobal", DataType="single", Min=0, Max=150, Unit="m")
P_LongCtrl_IC_EHRV2Enable = Simulink.Parameter(0, StorageClass="ExportedGlobal", DataType="boolean", Min=0, Max=1)
LongCtrl_IC_EHRV2_Cur = Simulink.Signal(StorageClass="ExportedGlobal")
LongCtrl_IC_EHRV2_CurMatrix = Simulink.Signal(StorageClass="ExportedGlobal")
LongCtrl_IC_EHRV2_CurDisMatrix = Simulink.Signal(StorageClass="ExportedGlobal")
LongCtrl_IC_EHRV2_CurFar = Simulink.Signal(StorageClass="ExportedGlobal")
LongCtrl_IC_EHRV2_CurFarDis = Simulink.Signal(StorageClass="ExportedGlobal")
LongCtrl_IC_EHRV2_CurMatrixSize = Simulink.Signal(StorageClass="ExportedGlobal")
LongCtrl_CurvatureOfMap = Simulink.Signal(StorageClass="ExportedGlobal")
LongCtrl_CurvatureOfRoad = Simulink.Signal(StorageClass="ExportedGlobal")
P_LongCtrl_LaneAvailStd = Simulink.Parameter(0.3, StorageClass="ExportedGlobal", DataType="single", Min=0, Max=1)
P_LongCtrl_LaneAvailStdMax = Simulink.Parameter(0.4, StorageClass="ExportedGlobal", DataType="single", Min=0, Max=1)
P_LongCtrl_LaneAvailStdAverage = Simulink.Parameter(0.15, StorageClass="ExportedGlobal", DataType="single", Min=0, Max=1)
P_LongCtrl_KeepLaneTime = Simulink.Parameter(0.3, StorageClass="ExportedGlobal", DataType="single", Min=0, Max=5, Unit="s")
P_LongCtrl_KeepLaneSurDis = Simulink.Parameter(5, StorageClass="ExportedGlobal", DataType="single", Min=0, Max=100, Unit="m")
LongCtrl_L1_KeepLineSts = Simulink.Signal(StorageClass="ExportedGlobal")
LongCtrl_R1_KeepLineSts = Simulink.Signal(StorageClass="ExportedGlobal")
P_LongCtrl_FollowDecelJerkDiffTTC2GapCorrEnableVelSubjThres = Simulink.Parameter(5, StorageClass="ExportedGlobal", DataType="single", Min=1, Max=200, Unit="m/s")
LongCtrl_accelICCurvatureMapMatrix = Simulink.Signal(StorageClass="ExportedGlobal")
LongCtrl_distDesCurvatureMap = Simulink.Signal(StorageClass="ExportedGlobal")
LongCtrl_accelDesCurvatureMap = Simulink.Signal(StorageClass="ExportedGlobal")
P_LongCtrl_IC_EHRV2Pretime = Simulink.Parameter(3, StorageClass="ExportedGlobal", DataType="single", Min=0, Max=10, Unit="s")
P_LongCtrl_ICCurvatureMapLimitSpdXAxis = Simulink.Parameter([0 0.0005 0.001 0.002 0.005 0.01 0.02 0.05 0.1 0.2], StorageClass="ExportedGlobal", DataType="single", Min=0, Max=1, Unit="1/m")
P_LongCtrl_ICCurvatureMapLimitSpdYAxis = Simulink.Parameter([150 150 100 70 50 40 30 20 10 5], StorageClass="ExportedGlobal", DataType="single", Min=0, Max=210, Unit="km/h")
P_LongCtrl_ICtAcceleTimeNegCurvatureMap = Simulink.Parameter(10, StorageClass="ExportedGlobal", DataType="single", Min=1, Max=20, Unit="s")
P_LongCtrl_ICtAcceleTimePosCurvatureMap = Simulink.Parameter(5, StorageClass="ExportedGlobal", DataType="single", Min=1, Max=20, Unit="s")
P_LongCtrl_ICUpperJerkNegVLCInternalAcc = Simulink.Parameter(4, StorageClass="ExportedGlobal", DataType="single", Min=0, Max=10, Unit="m/s^3")
P_LongCtrl_FollowaccelMinAccelSupressionExit = Simulink.Parameter(-1.5, StorageClass="ExportedGlobal", DataType="single", Min=-3.5, Max=0, Unit="m/s^2")
P_LongCtrl_FollowaccelMinAccelSupressionEnter = Simulink.Parameter(-1.2, StorageClass="ExportedGlobal", DataType="single")
P_LongCtrl_ALCAccLimitByDangerYAxis = Simulink.Parameter([0 0 -1 -2 -5], StorageClass="ExportedGlobal", DataType="single", Min=-10, Max=10)
P_LongCtrl_ALCAccLimitByDangerXAxis = Simulink.Parameter([0 0.3 0.5 0.6 0.8], StorageClass="ExportedGlobal", DataType="single", Min=0, Max=1)
LongCtrl_distAccelSupressionEnter = Simulink.Signal(StorageClass="ExportedGlobal")
LongCtrl_distAccelSupressionExit = Simulink.Signal(StorageClass="ExportedGlobal")
P_LongCtrl_FollowCoefCharCoefEnlargeAccelJerkYAxis = Simulink.Parameter([4 1], StorageClass="ExportedGlobal", DataType="single", Min=0, Max=5)
P_LongCtrl_FollowAccelCharNegVlcAcc2CoefEnlargeAccelJerkXAxis = Simulink.Parameter([-0.5 0], StorageClass="ExportedGlobal", DataType="single", Min=-5, Max=3, Unit="m/s^2")
P_LongCtrl_FollowAccelJerkNegFollowAccel = Simulink.Parameter(0.95, StorageClass="ExportedGlobal", DataType="single", Min=0, Max=3, Unit="m/s^3")
P_LongCtrl_FollowJerkCharAccelJerkYAxis = Simulink.Parameter([1.5 1.4 1.3 1.2 1.1 1 1], StorageClass="ExportedGlobal", DataType="single", Min=0, Max=3, Unit="m/s^3")
P_LongCtrl_FollowVelCharAccelJerkXAxis = Simulink.Parameter([0 1 2 3 5 10 30], StorageClass="ExportedGlobal", DataType="single", Min=0, Max=60, Unit="m/s")
LongCtrl_coefVelDist2AccelStartUp = Simulink.Signal(StorageClass="ExportedGlobal")
P_LongCtrl_FollowtStartUpAssistEnableMax = Simulink.Parameter(15, StorageClass="ExportedGlobal", DataType="single", Min=0, Max=60)
P_LongCtrl_FollowAccelDesThresStartUpAssistEnable = Simulink.Parameter(0.2, StorageClass="ExportedGlobal", DataType="single", Min=0, Max=1, Unit="m/s^2")
P_LongCtrl_FollowVelTargAbsThresStartUpAssistEnable = Simulink.Parameter(0.5, StorageClass="ExportedGlobal", DataType="single", Min=0, Max=3, Unit="m/s")
P_LongCtrl_FollowVelSubjThresStartUpAssistEnable = Simulink.Parameter(8, StorageClass="ExportedGlobal", DataType="single", Min=0, Max=10, Unit="m/s")
P_LongCtrl_FollowVelCharCoefEnlargeAccelStartUpAssistXAxis = Simulink.Parameter([0 3], StorageClass="ExportedGlobal", DataType="single", Min=0, Max=10, Unit="m/s")
P_LongCtrl_FollowDistDiffCharCoefEnlargeAccelStartUpAssistXAxis = Simulink.Parameter([0 5], StorageClass="ExportedGlobal", DataType="single", Min=0, Max=5, Unit="m")
P_LongCtrl_FollowCoefStartUpAssistFadeOut = Simulink.Parameter(0.9, StorageClass="ExportedGlobal", DataType="single", Min=0, Max=0.99)
P_LongCtrl_FollowDecelJerkDiffTTC2GapCorrEnableTTCThres = Simulink.Parameter(2, StorageClass="ExportedGlobal", DataType="single", Min=2, Max=15, Unit="s")
P_LongCtrl_FollowDecelJerkDiffTTC2GapCorrXAxis = Simulink.Parameter(single([2 5]), StorageClass="ExportedGlobal", Min=0, Max=25, Unit="s")
P_LongCtrl_FollowVelSubjForceStopEnable = Simulink.Parameter(1, StorageClass="ExportedGlobal", DataType="boolean", Min=0, Max=1)
P_LongCtrl_FollowStartUpAssist = Simulink.Parameter(1, StorageClass="ExportedGlobal", DataType="boolean", Min=0, Max=1)
P_LongCtrl_FollowCoefCharDistCoefEnlargeAccelStartUpAssistYAxis = Simulink.Parameter([1 1.3], StorageClass="ExportedGlobal", DataType="single", Min=1, Max=3)
P_LongCtrl_FollowCoefCharVelCoefEnlargeAccelStartUpAssistYAxis = Simulink.Parameter([1 1.3], StorageClass="ExportedGlobal", DataType="single", Min=1, Max=3)
P_LongCtrl_ALaUpperCharEco = Simulink.Parameter([1.35 1.25 1.1 1.05 1 0.95 0.85 0.7 0.6 0.55 0.5 0.45 0.35 0.3 0.3], StorageClass="ExportedGlobal", DataType="single", Min=0, Max=3, Unit="m/s^2")
P_LongCtrl_ICCurvatureLimitSpdXAxis = Simulink.Parameter(single([0 0.0005 0.001 0.002 0.005 0.01 0.02 0.05 0.1 0.2]), StorageClass="ExportedGlobal", Min=0, Max=1)
P_LongCtrl_ICCurvatureLimitSpdYAxis = Simulink.Parameter(single([150 150 100 65 45 35 30 20 10 5]), StorageClass="ExportedGlobal", Min=0, Max=150, Unit="km/h")
P_LongCtrl_FollowDrvOffDistOffsetdDesiredAutoDrvOff = Simulink.Parameter(1.8, StorageClass="ExportedGlobal", DataType="single", Min=0, Max=4, Unit="m")
P_LongCtrl_FollowDrvOffVelRelMinAutoDrvOff = Simulink.Parameter(0.4, StorageClass="ExportedGlobal", DataType="single", Min=0, Max=2, Unit="m/s")
P_LongCtrl_FollowDistDesAddForceStop = Simulink.Parameter(0.5, StorageClass="ExportedGlobal", DataType="single", Min=-2, Max=3, Unit="m")
P_LongCtrl_FollowDecelJerkDiffTTC2GapCorrYAxis = Simulink.Parameter(single([1 0.25]), StorageClass="ExportedGlobal", Min=0.01, Max=1)
P_LongCtrl_ALaUpperCharNormal = Simulink.Parameter([1.489 1.399 1.309 1.264 1.218 1.083 0.993 0.903 0.767 0.679 0.632 0.55 0.45 0.35 0.3], StorageClass="ExportedGlobal", DataType="single", Min=0, Max=3, Unit="m/s^2")
P_LongCtrl_ALaUpperCharSport = Simulink.Parameter([1.625 1.534 1.444 1.399 1.309 1.218 1.083 0.993 0.903 0.808 0.76 0.65 0.55 0.45 0.35], StorageClass="ExportedGlobal", DataType="single", Min=0, Max=3, Unit="m/s^2")
P_LongCtrl_FollowcoefDistRelThresActiveTOR = Simulink.Parameter(0.3, StorageClass="ExportedGlobal", DataType="single", Min=0, Max=2)
LongCtrl_spdSetValueDurLCAccel = Simulink.Signal(StorageClass="ExportedGlobal")
P_LongCtrl_CCLCIncSetSpdAdd = Simulink.Parameter(5, StorageClass="ExportedGlobal", DataType="single", Min=0, Max=30, Unit="km/h")
P_LongCtrl_CCLCIncSetSpdAddCntStartValue = Simulink.Parameter(250, StorageClass="ExportedGlobal", DataType="single", Min=0, Max=1000)
PLAN_AP_SubModel_VERSION = Simulink.Signal(StorageClass="ExportedGlobal")
PLAN_AP_SubModel_Number = Simulink.Signal(StorageClass="ExportedGlobal")
P_LongCtrl_CCcoefESPSpd2IPSpd1 = Simulink.Parameter(1.03, StorageClass="ExportedGlobal", DataType="single", Min=0, Max=2)
P_LongCtrl_CCcoefESPSpd2IPSpd2 = Simulink.Parameter(1.3, StorageClass="ExportedGlobal", DataType="single", Min=0, Max=3)
P_LongCtrl_CCLCIncSetSpdEnable = Simulink.Parameter(0, StorageClass="ExportedGlobal", DataType="boolean", Min=0, Max=1)
P_LongCtrl_CCaccelMaxLCActive = Simulink.Parameter(0.3, StorageClass="ExportedGlobal", DataType="single", Min=0, Max=2, Unit="m/s^2")
P_LongCtrl_CCtTotVelPlan = Simulink.Parameter(4, StorageClass="ExportedGlobal", DataType="single", Min=0, Max=10, Unit="s")
P_LongCtrl_CCtStepVelPlan = Simulink.Parameter(0.5, StorageClass="ExportedGlobal", DataType="single", Min=0, Max=10, Unit="s")
P_LongCtrl_CCaccelMinECOAL = Simulink.Parameter(0.3, StorageClass="ExportedGlobal", DataType="single", Min=0, Max=2, Unit="m/s^2")
P_LongCtrl_CCaccelMinSportAL = Simulink.Parameter(0.65, StorageClass="ExportedGlobal", DataType="single", Min=0, Max=2, Unit="m/s^2")
P_LongCtrl_CCaccelMinNormAL = Simulink.Parameter(0.3, StorageClass="ExportedGlobal", DataType="single", Min=0, Max=2, Unit="m/s^2")
P_LongCtrl_CCbNorm = Simulink.Parameter(1.16939, StorageClass="ExportedGlobal", DataType="single", Min=-10, Max=10)
P_LongCtrl_CCkNorm = Simulink.Parameter(-0.02055, StorageClass="ExportedGlobal", DataType="single", Min=-10, Max=10)
P_LongCtrl_CCbECO = Simulink.Parameter(0.87382, StorageClass="ExportedGlobal", DataType="single", Min=-10, Max=10)
P_LongCtrl_CCkECO = Simulink.Parameter(-0.01521, StorageClass="ExportedGlobal", DataType="single", Min=-10, Max=10)
P_LongCtrl_CCbSport = Simulink.Parameter(1.31713, StorageClass="ExportedGlobal", DataType="single", Min=-10, Max=10)
P_LongCtrl_CCkSport = Simulink.Parameter(-0.01466, StorageClass="ExportedGlobal", DataType="single", Min=-10, Max=10)
P_LongCtrl_ORDaccelDevUpperBand = Simulink.Parameter(0.2, StorageClass="ExportedGlobal", DataType="single", Min=0, Max=1, Unit="m/s^2")
P_LongCtrl_ORDaccelDevLowerBand = Simulink.Parameter(0.2, StorageClass="ExportedGlobal", DataType="single", Min=0, Max=1, Unit="m/s^2")
P_LongCtrl_ORDupperJerk = Simulink.Parameter(2, StorageClass="ExportedGlobal", DataType="single", Min=0, Max=5, Unit="m/s^3")
P_LongCtrl_ORDlowerJerk = Simulink.Parameter(-2, StorageClass="ExportedGlobal", DataType="single", Min=-5, Max=0, Unit="m/s^3")
P_LongCtrl_FollowdistRelDevCalcDistConst = Simulink.Parameter(0.5, StorageClass="ExportedGlobal", DataType="single", Min=0, Max=10, Unit="m")
P_LongCtrl_FollowdistRelThresEnablePlauCheck = Simulink.Parameter(4, StorageClass="ExportedGlobal", DataType="single", Min=0, Max=20, Unit="m")
P_LongCtrl_FollowvelRelThresEnablePlauCheck = Simulink.Parameter(-1, StorageClass="ExportedGlobal", DataType="single", Min=-5, Max=1, Unit="m/s")
P_LongCtrl_FollowvelSubjMaxEnablePlauCheck = Simulink.Parameter(2.5, StorageClass="ExportedGlobal", DataType="single", Min=0, Max=20, Unit="m/s")
P_LongCtrl_FollowvelSubjThresEnablePlauCheck = Simulink.Parameter(0.5, StorageClass="ExportedGlobal", DataType="single", Min=0, Max=5, Unit="m/s")
P_LongCtrl_FollowvelTargAbsMaxJudgeStationaryTarget = Simulink.Parameter(0.2, StorageClass="ExportedGlobal", DataType="single", Min=0, Max=1, Unit="m/s")
P_LongCtrl_FollowdistRelMaxJudgeStationaryTarget = Simulink.Parameter(4, StorageClass="ExportedGlobal", DataType="single", Min=0, Max=10, Unit="m")
P_LongCtrl_FollowcoefAccelStandstillOverride = Simulink.Parameter(2.5, StorageClass="ExportedGlobal", DataType="single", Min=1, Max=5)
P_LongCtrl_FollowcoefAccelFadeOutPlauCheck = Simulink.Parameter(0.97, StorageClass="ExportedGlobal", DataType="single", Min=0, Max=1)