% Simulink data dictionary PLAN_Parameters.sldd

PLAN_ALC_sts = Simulink.Signal(StorageClass="ExportedGlobal")
PLAN_DPC_HWA_DangerPlaus_L = Simulink.Signal(StorageClass="ExportedGlobal")
PLAN_DPC_HWA_DangerPlaus_R = Simulink.Signal(StorageClass="ExportedGlobal")
PLAN_DPC_HWA_NearestObjValid_L = Simulink.Signal(StorageClass="ExportedGlobal")
PLAN_DPC_HWA_NearestObjValid_R = Simulink.Signal(StorageClass="ExportedGlobal")
PLAN_DPC_HWA_NearestObjSpeed_L = Simulink.Signal(StorageClass="ExportedGlobal")
PLAN_DPC_HWA_NearestObjSpeed_R = Simulink.Signal(StorageClass="ExportedGlobal")
PLAN_DPC_ESS_DangerPlaus_L = Simulink.Signal(StorageClass="ExportedGlobal")
PLAN_DPC_ESS_DangerPlaus_R = Simulink.Signal(StorageClass="ExportedGlobal")
PLAN_DPC_ESS_L_Oncoming_flag = Simulink.Signal(StorageClass="ExportedGlobal")
PLAN_DPC_ESS_R_Oncoming_flag = Simulink.Signal(StorageClass="ExportedGlobal")
PLAN_DPC_ESS_NearestObjValid_L = Simulink.Signal(StorageClass="ExportedGlobal")
PLAN_DPC_ESS_NearestObjValid_R = Simulink.Signal(StorageClass="ExportedGlobal")
PLAN_DPC_ESS_NearestObjSpeed_L = Simulink.Signal(StorageClass="ExportedGlobal")
PLAN_DPC_ESS_NearestObjSpeed_R = Simulink.Signal(StorageClass="ExportedGlobal")
PLAN_DPC_ESS_X_Factor_FL = Simulink.Signal(StorageClass="ExportedGlobal")
PLAN_DPC_ESS_X_Factor_FR = Simulink.Signal(StorageClass="ExportedGlobal")
PLAN_DPC_ESS_X_Factor_RL = Simulink.Signal(StorageClass="ExportedGlobal")
PLAN_DPC_ESS_X_Factor_RR = Simulink.Signal(StorageClass="ExportedGlobal")
PLAN_DPC_ESS_Y_Factor_L = Simulink.Signal(StorageClass="ExportedGlobal")
PLAN_DPC_ESS_Y_Factor_R = Simulink.Signal(StorageClass="ExportedGlobal")
PLAN_DPC_ESS_DangerPlaus_FL = Simulink.Signal(StorageClass="ExportedGlobal")
PLAN_DPC_ESS_DangerPlaus_FR = Simulink.Signal(StorageClass="ExportedGlobal")
PLAN_DPC_ESS_DangerPlaus_RL = Simulink.Signal(StorageClass="ExportedGlobal")
PLAN_DPC_ESS_DangerPlaus_RR = Simulink.Signal(StorageClass="ExportedGlobal")
PLAN_DPC_HWA_X_Factor_RR = Simulink.Signal(StorageClass="ExportedGlobal")
PLAN_UpdateCnt = Simulink.Signal(StorageClass="ExportedGlobal")
PLAN_ALC_tStartDecel = Simulink.Signal(StorageClass="ExportedGlobal")
PLAN_ALC_UpdateCnt = Simulink.Signal(StorageClass="ExportedGlobal")
PLAN_DPC_HWA_TTC_Factor_L = Simulink.Signal(StorageClass="ExportedGlobal")
PLAN_DPC_HWA_TTC_Factor_R = Simulink.Signal(StorageClass="ExportedGlobal")
PLAN_ALC_LcFinish = Simulink.Signal(StorageClass="ExportedGlobal")
PLAN_ALC_LcCancelRi_DrvCmpl = Simulink.Signal(StorageClass="ExportedGlobal")
PLAN_ALC_LcCancelRi_Drv = Simulink.Signal(StorageClass="ExportedGlobal")
PLAN_ALC_LcCancelRi_DPC = Simulink.Signal(StorageClass="ExportedGlobal")
PLAN_ALC_LcCancelRi_LineValid = Simulink.Signal(StorageClass="ExportedGlobal")
PLAN_ALC_LcCancelLe_DrvCmpl = Simulink.Signal(StorageClass="ExportedGlobal")
PLAN_ALC_LcCancelLe_Drv = Simulink.Signal(StorageClass="ExportedGlobal")
PLAN_ALC_LcCancelLe_DPC = Simulink.Signal(StorageClass="ExportedGlobal")
PLAN_ALC_LcCancelLe_LineValid = Simulink.Signal(StorageClass="ExportedGlobal")
PLAN_ALC_LcCancelLe = Simulink.Signal(StorageClass="ExportedGlobal")
PLAN_ALC_LcCancelRi = Simulink.Signal(StorageClass="ExportedGlobal")
P_PLAN_DPC_HWALineRearA3Factor = Simulink.Parameter(0.1, StorageClass="ExportedGlobal", DataType="single")
P_PLAN_DPC_HWALineRearA2Factor = Simulink.Parameter(0.25, StorageClass="ExportedGlobal", DataType="single")
PLAN_DPC_HWA_DPCMatrix_Le = Simulink.Signal(StorageClass="ExportedGlobal")
PLAN_DPC_HWA_DPCMatrix_Ri = Simulink.Signal(StorageClass="ExportedGlobal")
PLAN_DPC_HWA_X_Factor_Le = Simulink.Signal(StorageClass="ExportedGlobal")
PLAN_DPC_HWA_X_Factor_Ri = Simulink.Signal(StorageClass="ExportedGlobal")
PLAN_DPC_HWA_Y_Factor_Le = Simulink.Signal(StorageClass="ExportedGlobal")
PLAN_DPC_HWA_Y_Factor_Ri = Simulink.Signal(StorageClass="ExportedGlobal")
PLAN_DPC_HWA_TTC_Factor_Le = Simulink.Signal(StorageClass="ExportedGlobal")
PLAN_DPC_HWA_TTC_Factor_Ri = Simulink.Signal(StorageClass="ExportedGlobal")
PLAN_DPC_HWA_dPreDxRel_Le = Simulink.Signal(StorageClass="ExportedGlobal")
PLAN_DPC_HWA_dPreDxRel_Ri = Simulink.Signal(StorageClass="ExportedGlobal")
PLAN_DPC_HWA_dPreDyRel_Le = Simulink.Signal(StorageClass="ExportedGlobal")
PLAN_DPC_HWA_dPreDyRel_Ri = Simulink.Signal(StorageClass="ExportedGlobal")
PLAN_DPC_HWA_tTTC_Le = Simulink.Signal(StorageClass="ExportedGlobal")
PLAN_DPC_HWA_tTTC_Ri = Simulink.Signal(StorageClass="ExportedGlobal")
PLAN_ALC_SW_VERSION = Simulink.Signal(StorageClass="ExportedGlobal")
PLAN_SW_VERSION = Simulink.Signal(StorageClass="ExportedGlobal")
P_PLAN_ALC_vMinPreLC_OverTk = Simulink.Parameter(56, StorageClass="ExportedGlobal", DataType="single")
P_PLAN_ALC_tMinCC = Simulink.Parameter(150, StorageClass="ExportedGlobal", DataType="uint8")  % 请求换道最少要求巡航保持时间，实际执行时间为标定量*模型调用周期
PLAN_ALC_RoadWidth = Simulink.Signal(StorageClass="ExportedGlobal")
P_PLAN_ALC_LcEnterLane_factor = Simulink.Parameter(0.55, StorageClass="ExportedGlobal")
P_PLAN_ALC_LCDeltaTmeGap = Simulink.Parameter(4, StorageClass="ExportedGlobal", DataType="single")  % 超车换道不减速，提前时间
PLAN_DPC_ObjID = Simulink.Signal(StorageClass="ExportedGlobal")
PLAN_DPC_ObjTimeAlive = Simulink.Signal(StorageClass="ExportedGlobal")
PLAN_DPC_ObjDx = Simulink.Signal(StorageClass="ExportedGlobal")
PLAN_DPC_ObjDy = Simulink.Signal(StorageClass="ExportedGlobal")
PLAN_DPC_ObjVx = Simulink.Signal(StorageClass="ExportedGlobal")
P_PLAN_ALC_DynamicDPCthreshold = Simulink.Parameter(0.3, StorageClass="ExportedGlobal", DataType="single")
P_PLAN_DPC_MaxObjNum = Simulink.Parameter(11, StorageClass="ExportedGlobal", DataType="uint8", Min=1, Max=32)
P_PLAN_ALC_LciOverTkDeltaSpdLv3 = Simulink.Parameter(10, StorageClass="ExportedGlobal", DataType="single")  % 超车换道，前车与本车SetSpd最小差值
PLAN_ALC_LcReason = Simulink.Signal(StorageClass="ExportedGlobal", DataType="uint8")
P_PLAN_ALC_LciOverTkSpdSupTimeLv1 = Simulink.Parameter(10, StorageClass="ExportedGlobal", DataType="single")
P_PLAN_ALC_LciOverTkSpdSupTimeLv3 = Simulink.Parameter(3, StorageClass="ExportedGlobal", DataType="single")
P_PLAN_ALC_LciOverTkSpdSupTimeLv2 = Simulink.Parameter(5, StorageClass="ExportedGlobal", DataType="single")
PLAN_ALC_OveTkrSupDist = Simulink.Signal(StorageClass="ExportedGlobal")
P_PLAN_ALC_OveTkrSupDist = Simulink.Parameter(1000, StorageClass="ExportedGlobal")
P_PLAN_ALC_LcTouchLane_factor = Simulink.Parameter(0.91, StorageClass="ExportedGlobal")
PLAN_ALC_PreP0Dy = Simulink.Signal(StorageClass="ExportedGlobal")
P_PLAN_ALC_LciOverTkDeltaSpdLv1 = Simulink.Parameter(20, StorageClass="ExportedGlobal", DataType="single")  % 超车换道，前车与本车SetSpd最小差值
P_PLAN_ALC_LciOverTkDeltaSpdLv2 = Simulink.Parameter(15, StorageClass="ExportedGlobal", DataType="single")  % 超车换道，前车与本车SetSpd最小差值
P_PLAN_ALC_OverTkCutOutDyRWFactor = Simulink.Parameter(0.25, StorageClass="ExportedGlobal")
PLAN_ALC_LcOverTkLe = Simulink.Signal(StorageClass="ExportedGlobal")
PLAN_ALC_LcOverTkRi = Simulink.Signal(StorageClass="ExportedGlobal")
PLAN_ALC_LcDrvLe = Simulink.Signal(StorageClass="ExportedGlobal")
PLAN_ALC_LcDrvRi = Simulink.Signal(StorageClass="ExportedGlobal")
PLAN_ALC_LaneChangeReq = Simulink.Signal(StorageClass="ExportedGlobal")
PLAN_ALC_LcDrvLe_DPC = Simulink.Signal(StorageClass="ExportedGlobal")
PLAN_ALC_LcDrvLe_dyDiff = Simulink.Signal(StorageClass="ExportedGlobal")
PLAN_ALC_LcDrvLe_IPVehSpd = Simulink.Signal(StorageClass="ExportedGlobal")
PLAN_ALC_LcDrvLe_LciDrv = Simulink.Signal(StorageClass="ExportedGlobal")
PLAN_ALC_LcDrvLe_LineValid = Simulink.Signal(StorageClass="ExportedGlobal")
PLAN_ALC_LcDrvLe_NoLcCancelFlag = Simulink.Signal(StorageClass="ExportedGlobal")
PLAN_ALC_LcDrvLe_NoLcFinishFlag = Simulink.Signal(StorageClass="ExportedGlobal")
PLAN_ALC_LcDrvRi_DPC = Simulink.Signal(StorageClass="ExportedGlobal")
PLAN_ALC_LcDrvRi_dyDiff = Simulink.Signal(StorageClass="ExportedGlobal")
PLAN_ALC_LcDrvRi_IPVehSpd = Simulink.Signal(StorageClass="ExportedGlobal")
PLAN_ALC_LcDrvRi_LineValid = Simulink.Signal(StorageClass="ExportedGlobal")
PLAN_ALC_LcDrvRi_NoLcCancelFlag = Simulink.Signal(StorageClass="ExportedGlobal")
PLAN_ALC_LcDrvRi_NoLcFinishFlag = Simulink.Signal(StorageClass="ExportedGlobal")
PLAN_ALC_LcOverTkLe_DPC = Simulink.Signal(StorageClass="ExportedGlobal")
PLAN_ALC_LcOverTkLe_dyDiff = Simulink.Signal(StorageClass="ExportedGlobal")
PLAN_ALC_LcOverTkLe_IPVehSpd = Simulink.Signal(StorageClass="ExportedGlobal")
PLAN_ALC_LcOverTkLe_LineValid = Simulink.Signal(StorageClass="ExportedGlobal")
PLAN_ALC_LcOverTkLe_NoLcFinishFlag = Simulink.Signal(StorageClass="ExportedGlobal")
PLAN_ALC_LcOverTkLe_NoOnComing = Simulink.Signal(StorageClass="ExportedGlobal")
PLAN_ALC_LcOverTkLe_NoPilotReq = Simulink.Signal(StorageClass="ExportedGlobal")
PLAN_ALC_LcOverTkLe_NotInDrvCancelArea = Simulink.Signal(StorageClass="ExportedGlobal")
PLAN_ALC_LcOverTkLe_NoTurnLampReq = Simulink.Signal(StorageClass="ExportedGlobal")
PLAN_ALC_LcOverTkLe_OverTkTrigger = Simulink.Signal(StorageClass="ExportedGlobal")
PLAN_ALC_LcOverTkRi_DPC = Simulink.Signal(StorageClass="ExportedGlobal")
PLAN_ALC_LcOverTkRi_dyDiff = Simulink.Signal(StorageClass="ExportedGlobal")
PLAN_ALC_LcOverTkRi_IPVehSpd = Simulink.Signal(StorageClass="ExportedGlobal")
PLAN_ALC_LcOverTkRi_LineValid = Simulink.Signal(StorageClass="ExportedGlobal")
PLAN_ALC_LcOverTkRi_NoLcFinishFlag = Simulink.Signal(StorageClass="ExportedGlobal")
PLAN_ALC_LcOverTkRi_NoOnComing = Simulink.Signal(StorageClass="ExportedGlobal")
PLAN_ALC_LcOverTkRi_NoPilotReq = Simulink.Signal(StorageClass="ExportedGlobal")
PLAN_ALC_LcOverTkRi_NotInDrvCancelArea = Simulink.Signal(StorageClass="ExportedGlobal")
PLAN_ALC_LcOverTkRi_NoTurnLampReq = Simulink.Signal(StorageClass="ExportedGlobal")
PLAN_ALC_LcOverTkRi_OverTkTrigger = Simulink.Signal(StorageClass="ExportedGlobal")
PLAN_DPC_HWA_OncomingFlag_Le = Simulink.Signal(StorageClass="ExportedGlobal")
PLAN_DPC_HWA_OncomingFlag_Ri = Simulink.Signal(StorageClass="ExportedGlobal")
PLAN_ALC_LcDrvRi_NoOnComing = Simulink.Signal(StorageClass="ExportedGlobal")
PLAN_ALC_LcDrvLe_NoOnComing = Simulink.Signal(StorageClass="ExportedGlobal")
PLAN_ALC_LampReq = Simulink.Signal(StorageClass="ExportedGlobal")
PLAN_ALC_LcOverTkLe_ALCSwtOn = Simulink.Signal(StorageClass="ExportedGlobal")
PLAN_ALC_LcOverTkRi_ALCSwtOn = Simulink.Signal(StorageClass="ExportedGlobal")
P_PLAN_DPC_SafeDistBrkPoints = Simulink.Parameter([0 20 30 40 60 80 100 120], StorageClass="ExportedGlobal", DataType="single")
P_PLAN_DPC_PreEgoAccFactor = Simulink.Parameter(0.5, StorageClass="ExportedGlobal", DataType="single")
P_PLAN_DPC_BrkPointTTCFactor4 = Simulink.Parameter(15, StorageClass="ExportedGlobal", DataType="single")
PLAN_ALC_LcCancelLe_CancelOverTk = Simulink.Signal(StorageClass="ExportedGlobal")
PLAN_ALC_LcCancelLe_Oncoming = Simulink.Signal(StorageClass="ExportedGlobal")
PLAN_ALC_LcCancelRi_CancelOverTk = Simulink.Signal(StorageClass="ExportedGlobal")
PLAN_ALC_LcCancelRi_Oncoming = Simulink.Signal(StorageClass="ExportedGlobal")
PLAN_ALC_LcOverTkLe_LaneAvailable = Simulink.Signal(StorageClass="ExportedGlobal")
PLAN_ALC_LcOverTkRi_LaneAvailable = Simulink.Signal(StorageClass="ExportedGlobal")
PLAN_DPC_HWA_NearestObjDx_L = Simulink.Signal(StorageClass="ExportedGlobal")
PLAN_DPC_HWA_NearestObjDx_R = Simulink.Signal(StorageClass="ExportedGlobal")
PLAN_ALC_LcDrvRi_LciDrv = Simulink.Signal(StorageClass="ExportedGlobal")
P_PLAN_ALC_LcOverTkDPCthreshold = Simulink.Parameter(0.3, StorageClass="ExportedGlobal", DataType="single")
P_PLAN_ALC_LciDrvExistDefaultDisp = Simulink.Parameter(0, StorageClass="ExportedGlobal", DataType="uint8")
P_PLAN_DPC_BrkPointTTCFactor3 = Simulink.Parameter(10, StorageClass="ExportedGlobal", DataType="single")
PLAN_ALC_LaneChange = Simulink.Signal(StorageClass="ExportedGlobal")
PLAN_DPC_HWA_DangerPlaus_C = Simulink.Signal(StorageClass="ExportedGlobal")
P_PLAN_ALC_LcFinishDyDiffRwFactorForHMI = Simulink.Parameter(0.57, StorageClass="ExportedGlobal", DataType="single")
P_PLAN_ALC_tTimeLC = Simulink.Parameter(4, StorageClass="ExportedGlobal", DataType="single")
P_PLAN_DPC_SafeDistValue = Simulink.Parameter([5 7 9 10 10 13 16 18], StorageClass="ExportedGlobal", DataType="single")
PLAN_ALC_LcOverTkLe_P0NotCutOut = Simulink.Signal(StorageClass="ExportedGlobal")
PLAN_ALC_LcOverTkRi_P0NotCutOut = Simulink.Signal(StorageClass="ExportedGlobal")
P_PLAN_ALC_DPCConfirmTime = Simulink.Parameter(2, StorageClass="ExportedGlobal", DataType="single")
P_PLAN_ALC_LcDrvHMILineValidFtime = Simulink.Parameter(2, StorageClass="ExportedGlobal", DataType="single")
PLAN_ALC_LcOverTkRi_NoLcCancel = Simulink.Signal(StorageClass="ExportedGlobal")
PLAN_ALC_LcOverTkLe_NoLcCancel = Simulink.Signal(StorageClass="ExportedGlobal")
PLAN_ALC_LcNohLe_DPC = Simulink.Signal(StorageClass="ExportedGlobal")
PLAN_ALC_LcNohLe_IPVehSpd = Simulink.Signal(StorageClass="ExportedGlobal")
PLAN_ALC_LcNohLe_LciNoh = Simulink.Signal(StorageClass="ExportedGlobal")
PLAN_ALC_LcNohLe_LineValid = Simulink.Signal(StorageClass="ExportedGlobal")
PLAN_ALC_LcNohLe_NoLcFinishLeCnt = Simulink.Signal(StorageClass="ExportedGlobal")
PLAN_ALC_LcNohLe_NoTurnLamp = Simulink.Signal(StorageClass="ExportedGlobal")
PLAN_ALC_LcNohLe_dyDiff = Simulink.Signal(StorageClass="ExportedGlobal")
PLAN_ALC_LcNohRi_DPC = Simulink.Signal(StorageClass="ExportedGlobal")
PLAN_ALC_LcNohRi_IPVehSpd = Simulink.Signal(StorageClass="ExportedGlobal")
PLAN_ALC_LcNohRi_LciNoh = Simulink.Signal(StorageClass="ExportedGlobal")
PLAN_ALC_LcNohRi_LineValid = Simulink.Signal(StorageClass="ExportedGlobal")
PLAN_ALC_LcNohRi_NoLcFinishRiCnt = Simulink.Signal(StorageClass="ExportedGlobal")
PLAN_ALC_LcNohRi_NoTurnLamp = Simulink.Signal(StorageClass="ExportedGlobal")
PLAN_ALC_LcNohRi_dyDiff = Simulink.Signal(StorageClass="ExportedGlobal")
PLAN_ALC_LcOverTkLe_LineCurvatureValid = Simulink.Signal(StorageClass="ExportedGlobal")
PLAN_ALC_LcOverTkRi_LineCurvatureValid = Simulink.Signal(StorageClass="ExportedGlobal")
PLAN_ALC_PreCurvature = Simulink.Signal(StorageClass="SimulinkGlobal")
PLAN_DPC_ObjAx = Simulink.Signal(StorageClass="ExportedGlobal")
P_PLAN_ALC_LcCurvatureInhibitionValueBrkPoints = Simulink.Parameter([10 20 30 40 50 60 70 80 90 100 110 120 130 140], StorageClass="ExportedGlobal")
P_PLAN_ALC_LcCurvatureInhibitionValueTable = Simulink.Parameter([0.022 0.01 0.0059 0.0038 0.0025 0.0018 0.0012 0.0009 0.0006 0.0004 0.0003 0.0002 0.0001 0.0001], StorageClass="ExportedGlobal")
P_PLAN_ALC_LcFinishDyDiffBrkPoint = Simulink.Parameter([10 80 100 120], StorageClass="ExportedGlobal")
P_PLAN_ALC_LcMinVehSpd_OFF = Simulink.Parameter(39.5, StorageClass="ExportedGlobal")
P_PLAN_ALC_LcMinVehSpd_ON = Simulink.Parameter(40, StorageClass="ExportedGlobal")
P_PLAN_ALC_NotTouchLineCancelRWFactor = Simulink.Parameter(0.91, StorageClass="ExportedGlobal", DataType="single")
P_PLAN_ALC_PreCurvatureFactor = Simulink.Parameter(1, StorageClass="ExportedGlobal")
P_PLAN_ALC_PreCurvaturePreTime = Simulink.Parameter(3, StorageClass="ExportedGlobal")
P_PLAN_ALC_PreNotTouchLineCancelRWFactor = Simulink.Parameter(0.9, StorageClass="ExportedGlobal", DataType="single")
P_PLAN_DPC_BrkPointDxFactorF1 = Simulink.Parameter(0.4, StorageClass="ExportedGlobal", DataType="single", Min=0, Max=50)
P_PLAN_DPC_BrkPointDxFactorF2 = Simulink.Parameter(0.8, StorageClass="ExportedGlobal", DataType="single", Min=0, Max=50)
P_PLAN_DPC_BrkPointDxFactorF3 = Simulink.Parameter(1.2, StorageClass="ExportedGlobal", DataType="single", Min=0, Max=50)
P_PLAN_DPC_BrkPointDxFactorF4 = Simulink.Parameter(1.6, StorageClass="ExportedGlobal", DataType="single", Min=0, Max=50)
P_PLAN_DPC_BrkPointDxFactorR1 = Simulink.Parameter(-0.5, StorageClass="ExportedGlobal", DataType="single", Min=-50, Max=0)
P_PLAN_DPC_BrkPointDxFactorR2 = Simulink.Parameter(-1, StorageClass="ExportedGlobal", DataType="single", Min=-50, Max=0)
P_PLAN_DPC_BrkPointDxFactorR3 = Simulink.Parameter(-1.6, StorageClass="ExportedGlobal", DataType="single", Min=-50, Max=0)
P_PLAN_DPC_BrkPointDxFactorR4 = Simulink.Parameter(-2.2, StorageClass="ExportedGlobal", DataType="single", Min=-50, Max=0)
P_PLAN_DPC_BrkPointTTCFactor1 = Simulink.Parameter(3, StorageClass="ExportedGlobal", DataType="single")
P_PLAN_DPC_BrkPointTTCFactor2 = Simulink.Parameter(6, StorageClass="ExportedGlobal", DataType="single")
P_PLAN_DPC_ObjVxLPalpha = Simulink.Parameter(0.1, StorageClass="ExportedGlobal", DataType="single")
P_PLAN_ALC_DPCConfirmTimeHMI = Simulink.Parameter(0.5, StorageClass="ExportedGlobal", DataType="single")
P_PLAN_DPC_ObjDyLPalpha = Simulink.Parameter(0.1, StorageClass="ExportedGlobal", DataType="single")
P_PLAN_ALC_LcCancelLaneChangeReqDspTimeCnt = Simulink.Parameter(200, StorageClass="ExportedGlobal", DataType="uint16")
P_PLAN_ALC_LcOverTkCancelDy_factor = Simulink.Parameter(0.95, StorageClass="ExportedGlobal", DataType="single")
PLAN_DPC_HWA_DPCold_C = Simulink.Signal(StorageClass="ExportedGlobal")
PLAN_DPC_HWA_DPCold_R = Simulink.Signal(StorageClass="ExportedGlobal")
PLAN_DPC_HWA_DPCold_L = Simulink.Signal(StorageClass="ExportedGlobal")

P_PLAN_ALC_LcDelayCntSetNoh = Simulink.Parameter(75, StorageClass="ExportedGlobal", DataType="uint8")
P_PLAN_ALC_LcDelayCntSetOverTk = Simulink.Parameter(75, StorageClass="ExportedGlobal", DataType="uint8")
PLAN_ALC_LcOverTkLe_PilotLaneAvailable = Simulink.Signal(StorageClass="ExportedGlobal")
PLAN_ALC_LcOverTkRi_PilotLaneAvailable = Simulink.Signal(StorageClass="ExportedGlobal")
PLAN_ALC_LcOverTkRi_DPCLongConfirm = Simulink.Signal(StorageClass="ExportedGlobal")
PLAN_ALC_LcOverTkLe_DPCLongConfirm = Simulink.Signal(StorageClass="ExportedGlobal")
P_PLAN_DPC_SafeTG = Simulink.Parameter(1, StorageClass="ExportedGlobal", DataType="single")
P_PLAN_DPCswt = Simulink.Parameter(0, StorageClass="ExportedGlobal", DataType="boolean")
P_PLAN_DPC_CriticalTG = Simulink.Parameter(1, StorageClass="ExportedGlobal", DataType="single")
P_PLAN_ALC_vMinPreLC_Noh = Simulink.Parameter(15, StorageClass="ExportedGlobal", DataType="single")
P_PLAN_DPC_ObjDxLPalpha = Simulink.Parameter(1, StorageClass="ExportedGlobal", DataType="single")
PLAN_ALC_LcDrvRi_DPCHoldCnt = Simulink.Signal(StorageClass="ExportedGlobal")
PLAN_ALC_LcDrvLe_DPCHoldCnt = Simulink.Signal(StorageClass="ExportedGlobal")
PLAN_ALC_LcMrcRi_dyDiff = Simulink.Signal(StorageClass="ExportedGlobal")
PLAN_ALC_LcMrcRi_NoTurnLamp = Simulink.Signal(StorageClass="ExportedGlobal")
PLAN_ALC_LcMrcRi_LineValid = Simulink.Signal(StorageClass="ExportedGlobal")
PLAN_ALC_LcMrcRi_LciMrc = Simulink.Signal(StorageClass="ExportedGlobal")
PLAN_ALC_LcMrcRi_IPVehSpd = Simulink.Signal(StorageClass="ExportedGlobal")
PLAN_ALC_LcMrcRi_DPC = Simulink.Signal(StorageClass="ExportedGlobal")
PLAN_ALC_LaneChangeIncSetSpdReq = Simulink.Signal()
P_PLAN_ALC_DPCConfimrTimeTableLcMrc = Simulink.Parameter([0 0 2 6 15], StorageClass="ExportedGlobal", DataType="single")
P_PLAN_ALC_DPCthresholdLcDrvLv2 = Simulink.Parameter(0.3, StorageClass="ExportedGlobal", DataType="single")
P_PLAN_ALC_LcFinishDyDiffRwFactorForAP = Simulink.Parameter(0.4, StorageClass="ExportedGlobal", DataType="single")
P_PLAN_DPC_SafeAccR = Simulink.Parameter(0.15, StorageClass="ExportedGlobal", DataType="single")
P_PLAN_DPC_ObjAxLPalpha = Simulink.Parameter(0.05, StorageClass="ExportedGlobal", DataType="single")
P_PLAN_ALC_NOHTurnSts = Simulink.Parameter(0, StorageClass="ExportedGlobal", DataType="uint8")
P_PLAN_ALC_LcOverTkManualTriggerTimeCnt = Simulink.Parameter(50, StorageClass="ExportedGlobal")
P_PLAN_ALC_LcOverTkManualTrigger = Simulink.Parameter(0, StorageClass="ExportedGlobal", DataType="uint8")
P_PLAN_ALC_LcDrv_DyDiffThreshold = Simulink.Parameter(1.2, StorageClass="ExportedGlobal", DataType="single")
PLAN_ALC_LSMPilotTurnSts = Simulink.Signal(StorageClass="ExportedGlobal")
P_PLAN_ALC_DPCConfimrTimeTable = Simulink.Parameter([0 0 3 4 5], StorageClass="ExportedGlobal", DataType="single")
P_PLAN_ALC_DPCthresholdLcDrvLv1 = Simulink.Parameter(0.3, StorageClass="ExportedGlobal", DataType="single")
P_PLAN_ALC_DPCthresholdLcDrvLv3 = Simulink.Parameter(0.3, StorageClass="ExportedGlobal", DataType="single")
P_PLAN_ALC_DPCConfirmTimeOverTk = Simulink.Parameter(4, StorageClass="ExportedGlobal", DataType="single")
P_PLAN_ALC_NOHLcSwt = Simulink.Parameter(1, StorageClass="ExportedGlobal", DataType="uint8")
P_PLAN_ALC_LcCancelDPCThreshold = Simulink.Parameter(0.99, StorageClass="ExportedGlobal", DataType="single")
P_PLAN_ALC_vMinPreLC_Drv = Simulink.Parameter(40, StorageClass="ExportedGlobal", DataType="uint8")  % 换道请求时的最低速度阈值
P_PLAN_DPC_CriticalAccF = Simulink.Parameter(4, StorageClass="ExportedGlobal", DataType="single")
P_PLAN_DPC_CriticalAccR = Simulink.Parameter(2, StorageClass="ExportedGlobal", DataType="single")
P_PLAN_ALC_LcFinishDyDiffTableValue = Simulink.Parameter([0.3 0.3 0.8 0.8], StorageClass="ExportedGlobal")
P_PLAN_DPC_SafeAccF = Simulink.Parameter(0.3, StorageClass="ExportedGlobal", DataType="single")
PLAN_DPC_SubModel_VERSION = Simulink.Signal(StorageClass="ExportedGlobal", DataType="uint32")
PLAN_DPC_SubModel_Number = Simulink.Signal(StorageClass="ExportedGlobal", DataType="uint32")
PLAN_ALC_SubModel_Number = Simulink.Signal(StorageClass="ExportedGlobal", DataType="uint32")
PLAN_ALC_SubModel_VERSION = Simulink.Signal(StorageClass="ExportedGlobal", DataType="uint32")
P_PLAN_ALC_TurnLmpType = Simulink.Parameter(0, StorageClass="ExportedGlobal", DataType="uint8")