% Simulink data dictionary ACC.sldd

P_VSM_ACC_BOMEntry_AxvRefMs2 = Simulink.Parameter(-0.5, StorageClass="ExportedGlobal", DataType="single", Min=-2, Max=0)
P_VSM_ACC_BOMEntry_ACCDecReqValue = Simulink.Parameter(-0.5, StorageClass="ExportedGlobal", DataType="single", Min=-2, Max=0)
P_VSM_ACC_BOMExit_ACCDecReqValue = Simulink.Parameter(-0.3, StorageClass="ExportedGlobal", DataType="single", Min=-2, Max=0)
VSM_ACCSlowExitCons_EspActive400ms = Simulink.Signal(StorageClass="ExportedGlobal")
VSM_ACCSlowExitCons_MSRactive800ms = Simulink.Signal(StorageClass="ExportedGlobal")
VSM_ACCSlowExitCons_HDCactive40ms = Simulink.Signal(StorageClass="ExportedGlobal")
VSM_ACCSlowExitCons_ABSactive400ms = Simulink.Signal(StorageClass="ExportedGlobal")
VSM_ACCSlowExitCons_TCS1active3000ms = Simulink.Signal(StorageClass="ExportedGlobal")
VSM_ACCSlowExitCons_TCS2active3000ms = Simulink.Signal(StorageClass="ExportedGlobal")
VSM_ACCFastExitCons_Standstill3min = Simulink.Signal(StorageClass="ExportedGlobal")
VSM_ACCFastExitCons_StandstillNoBrakeForce = Simulink.Signal(StorageClass="ExportedGlobal")
VSM_ACCFastExitCons_RollingBack = Simulink.Signal(StorageClass="ExportedGlobal")
VSM_ACCFastExitCons_EngineOff = Simulink.Signal(StorageClass="ExportedGlobal")
VSM_ACCFastExitCons_BrakeDiskOverHeat = Simulink.Signal(StorageClass="ExportedGlobal")
VSM_ACCFastExitCons_Cancel = Simulink.Signal(StorageClass="ExportedGlobal")
VSM_ACCFastExitCons_EspOff = Simulink.Signal(StorageClass="ExportedGlobal")
VSM_ACCFastExitCons_NoForwardGear = Simulink.Signal(StorageClass="ExportedGlobal")
VSM_ACCFastExitCons_DriveBrakeExit = Simulink.Signal(StorageClass="ExportedGlobal")
VSM_ACCFastExitCons_EPBClosed = Simulink.Signal(StorageClass="ExportedGlobal")
VSM_ACCFastExitCons_DriverDoorOpen = Simulink.Signal(StorageClass="ExportedGlobal")
VSM_ACCFastExitCons_DriverSBR = Simulink.Signal(StorageClass="ExportedGlobal")
VSM_ACCFastExit = Simulink.Signal(StorageClass="ExportedGlobal")
VSM_ACCSlowExit = Simulink.Signal(StorageClass="ExportedGlobal")
VSM_ACCActCondF = Simulink.Signal(StorageClass="ExportedGlobal")
VSM_AccOverride = Simulink.Signal(StorageClass="ExportedGlobal")
VSM_ACCFastExitCons_AEBTrigger = Simulink.Signal(StorageClass="ExportedGlobal")
VSM_ACCFastExitCons_VehSpdExit = Simulink.Signal(StorageClass="ExportedGlobal")
VSM_ACCFastExitCons_DrivingModExit = Simulink.Signal(StorageClass="ExportedGlobal")
VSM_ACCFastExitCons_EngLimpHome = Simulink.Signal(StorageClass="ExportedGlobal")
VSM_ACCFastExitCons_APSGuidance = Simulink.Signal(StorageClass="ExportedGlobal")
VSM_ACCFastExitCons_ACCError_Inhibit = Simulink.Signal(StorageClass="ExportedGlobal")
VSM_Diagnostic_ACCError = Simulink.Signal(StorageClass="ExportedGlobal")
VSM_DriveBrake = Simulink.Signal(StorageClass="ExportedGlobal")
VSM_ActiveEnable = Simulink.Signal(StorageClass="ExportedGlobal")
VSM_VehicleStandStill = Simulink.Signal(StorageClass="ExportedGlobal")
VSM_TJASts = Simulink.Signal(StorageClass="ExportedGlobal")
VSM_ACC_DrvOffReq = Simulink.Signal(StorageClass="ExportedGlobal")
VSM_ACC_SpdSetValue = Simulink.Signal(StorageClass="ExportedGlobal")
VSM_ACC_TimeGapSet = Simulink.Signal(StorageClass="ExportedGlobal")
VSM_ACC_HazActv = Simulink.Signal(StorageClass="ExportedGlobal")
VSM_ACC_ModeDisp = Simulink.Signal(StorageClass="ExportedGlobal")
VSM_ACCTextDisp = Simulink.Signal(StorageClass="ExportedGlobal")
VSM_TJA_ModeDisp = Simulink.Signal(StorageClass="ExportedGlobal")
VSM_TJATextDisp = Simulink.Signal(StorageClass="ExportedGlobal")
VSM_ACC_ParkShiftReq = Simulink.Signal(StorageClass="ExportedGlobal")
VSM_ACC_VehCnfgACC = Simulink.Signal(StorageClass="ExportedGlobal")

ACC_DrvrOpr_Bus = Simulink.Bus()
  ACCon: boolean
  TJAOn: boolean
  User_ACCSet: boolean
  User_Res: boolean
  User_TJASet: boolean

ACC_AD_Bus = Simulink.Bus()
  AccelPedlPosnDiagc: single
  ESP_MasterCylBrkPress: single
  BrkPedalSts: uint8
  EPBSts: uint8
  EPB_SwtPosn: uint8
  VehStandstill: uint8
  RLWheelSpd: single
  RRWheelSpd: single
  RLWheelDriveDirection: uint8
  RRWheelDriveDirection: uint8
  TGS_LEVER: uint8
  EngState: uint8
  Start_StopSts: uint8
  ESPFuncOffSts: boolean
  BrkDskOvrheatd: boolean
  DrvDoorSts: boolean
  DrvSBR: boolean
  CC_ACC_CANCEL_OFFSwt: boolean
  VDCActv: boolean
  MSRActv: boolean
  HDCCtrl: uint8
  ABSActv: boolean
  PTCActv: boolean
  BTCActv: boolean
  AVHSts: uint8
  VehSpd: single
  AccPedalOverride: boolean
  DrivingModDis: uint8
  EngLimpHomeSts: boolean
  APS_WorkSts: uint8
  ECMACCInterface: boolean
  CDDAvailable: boolean
  SysPowerMod: uint8
  CDDActv: boolean

P_VSM_ACCExit_StandWaitTime = Simulink.Parameter(180, StorageClass="ExportedGlobal", DataType="uint16", Min=0, Max=1000, Unit="<S>")
VSM_ACC_VsetBelowMin = Simulink.Signal(StorageClass="ExportedGlobal")
P_VSM_ACC_BrakeOnlyNum = Simulink.Parameter(500, StorageClass="ExportedGlobal", DataType="uint16", Min=0, Max=600, Unit="num")
P_VSM_TJA_ActiveWaitNum = Simulink.Parameter(3000, StorageClass="ExportedGlobal", DataType="uint16", Min=0, Max=3000, Unit="num")
P_VSM_ACCExit_AccOverride = Simulink.Parameter(900, StorageClass="ExportedGlobal", DataType="uint16", Min=0, Max=1000, Unit="s")
VSM_ACC_Version = Simulink.Signal(StorageClass="ExportedGlobal")
VSM_ACC_BOMExit = Simulink.Signal(StorageClass="ExportedGlobal")
VSM_ACC_DecReqValue = Simulink.Signal(StorageClass="ExportedGlobal")

HAP_CAN = Simulink.Bus()
  USS_FrontSys_Status: uint8
  USS_FLCNear_Obj_Confidence: single
  USS_FLCNear_Obj_Pos_X: single
  USS_FLCNear_Obj_Pos_Y: single
  USS_FLMNear_Obj_Confidence: single
  USS_FLMNear_Obj_Pos_X: single
  USS_FLMNear_Obj_Pos_Y: single
  USS_FRMNear_Obj_Confidence: single
  USS_FRMNear_Obj_Pos_X: single
  USS_FRMNear_Obj_Pos_Y: single
  USS_FRCNear_Obj_Confidence: single
  USS_FRCNear_Obj_Pos_X: single
  USS_FRCNear_Obj_Pos_Y: single

VSM_ACCStandActive2Active_DrvrSts = Simulink.Signal(StorageClass="ExportedGlobal")
VSM_ACCStandActive2Wait_DrvrSts = Simulink.Signal(StorageClass="ExportedGlobal")
VSM_ACCStandActive2Wait_USS = Simulink.Signal(StorageClass="ExportedGlobal")
VSM_ACCStandActiveTime = Simulink.Signal(StorageClass="ExportedGlobal")
P_VSM_ACC_StandActiveNumACCMode = Simulink.Parameter(1500, StorageClass="ExportedGlobal", DataType="uint16", Min=0, Max=9000, Unit="num")
P_VSM_ACC_StandActiveNumHWAMode = Simulink.Parameter(1500, StorageClass="ExportedGlobal", DataType="uint16", Min=0, Max=9000, Unit="num")
VSM_ACCFastExitCons_ACCOverride = Simulink.Signal(StorageClass="ExportedGlobal")
VSM_ACC_SubModel_VERSION = Simulink.Signal(DataType="uint32")
VSM_ACC_SubModel_Number = Simulink.Signal(DataType="uint16")
P_VSM_ACC_AutoGoSW = Simulink.Parameter(1, StorageClass="ExportedGlobal", DataType="boolean")
P_VSM_HMI_Curve = Simulink.Parameter(0.003, StorageClass="ExportedGlobal")
P_VSM_HMI_CurveTime = Simulink.Parameter(0.1, StorageClass="ExportedGlobal")
VSM_ACC_DrvOfftoSM = Simulink.Signal(StorageClass="ExportedGlobal")
VSM_ACC_USSObjExist = Simulink.Signal(StorageClass="ExportedGlobal")
VSM_ACC_DrvrOff_Disp = Simulink.Signal(StorageClass="ExportedGlobal")
VSM_ACC_USSObjDxMin = Simulink.Signal(StorageClass="ExportedGlobal")
VSM_ACC_P0DxThrehod = Simulink.Signal(StorageClass="ExportedGlobal")
VSM_ACC_AccPedalTouch = Simulink.Signal(StorageClass="ExportedGlobal")
VSM_ACC_DriverBrake = Simulink.Signal(StorageClass="ExportedGlobal")
VSM_HMI_SubModel_VERSION = Simulink.Signal()
VSM_HMI_SubModel_Number = Simulink.Signal()
P_VSM_ACC_RadarOffset = Simulink.Parameter(0.5, StorageClass="ExportedGlobal", DataType="single")
P_VSM_PassSBRSpdIPLimt = Simulink.Parameter(31, StorageClass="ExportedGlobal", DataType="uint8")