% Simulink data dictionary ESS.sldd

ESS_VehicleSts_BUS = Simulink.Bus()
  AEB_PedTrig: boolean
  AEB_VehTrig: boolean
  Inter_FCW_Warn: uint8

P_VSM_ESS_SafeDistance_m = Simulink.Parameter(1.5, StorageClass="ExportedGlobal", DataType="single")
P_VSM_ESS_SpdPoint_kmh = Simulink.Parameter([50 60 70 80 90 100], StorageClass="ExportedGlobal", DataType="single")
P_VSM_ESS_SpdTime_s = Simulink.Parameter([0.2 0.25 0.35 0.4 0.45 0.5], StorageClass="ExportedGlobal", DataType="single")
P_VSM_ESS_DangerPlausLeft = Simulink.Parameter(0.3, StorageClass="ExportedGlobal", DataType="single")
P_VSM_ESS_DangerPlausRight = Simulink.Parameter(0.3, StorageClass="ExportedGlobal", DataType="single")
VSM_ESS_SteerWheelSpd_READY2ACTIVE = Simulink.Signal(StorageClass="ExportedGlobal", DataType="boolean")
VSM_ESS_AccelPed_READY2ACTIVE = Simulink.Signal(StorageClass="ExportedGlobal", DataType="boolean")
VSM_ESS_VehLgtAccel_READY2ACTIVE = Simulink.Signal(StorageClass="ExportedGlobal", DataType="boolean")
VSM_ESS_AEBVruFlag_Ready2Active = Simulink.Signal(StorageClass="ExportedGlobal", DataType="boolean")
VSM_ESS_AEBVehFlag_Ready2Active = Simulink.Signal(StorageClass="ExportedGlobal", DataType="boolean")
VSM_ESS_FcwDisFlag_Ready2Active = Simulink.Signal(StorageClass="ExportedGlobal", DataType="boolean")
VSM_ESS_FcwWarn_Ready2Active = Simulink.Signal(StorageClass="ExportedGlobal", DataType="boolean")
VSM_ESS_AEBTrigFlag_ACTIVE2IDLE = Simulink.Signal(StorageClass="ExportedGlobal", DataType="boolean")
VSM_ESS_DrvSBR_ACTIVE2IDLE = Simulink.Signal(StorageClass="ExportedGlobal", DataType="boolean")
VSM_ESS_DoorSts_ACTIVE2IDLE = Simulink.Signal(StorageClass="ExportedGlobal", DataType="boolean")
VSM_ESS_ESPFuncOffSts_ACTIVE2IDLE = Simulink.Signal(StorageClass="ExportedGlobal", DataType="boolean")
VSM_ESS_LateralAccel_ACTIVE2IDLE = Simulink.Signal(StorageClass="ExportedGlobal", DataType="boolean")
VSM_ESS_ESPActive_ACTIVE2IDLE = Simulink.Signal(StorageClass="ExportedGlobal", DataType="boolean")
VSM_ESS_PedSwtReq = Simulink.Signal(StorageClass="ExportedGlobal", DataType="boolean")
VSM_ESS_VehSwtReq = Simulink.Signal(StorageClass="ExportedGlobal", DataType="boolean")
VSM_ESS_Sensor_idle2error = Simulink.Signal(StorageClass="ExportedGlobal", DataType="boolean")
VSM_ESS_IDLE2READY = Simulink.Signal(StorageClass="ExportedGlobal", DataType="boolean")
VSM_ESS_READY2IDLE = Simulink.Signal(StorageClass="ExportedGlobal", DataType="boolean")
VSM_ESS_READY2ACTIVE = Simulink.Signal(StorageClass="ExportedGlobal", DataType="boolean")
VSM_ESS_ACTIVE2IDLE = Simulink.Signal(StorageClass="ExportedGlobal", DataType="boolean")
VSM_ESS_L_ACTIVE2READY = Simulink.Signal(StorageClass="ExportedGlobal", DataType="boolean")
VSM_ESS_R_ACTIVE2READY = Simulink.Signal(StorageClass="ExportedGlobal", DataType="boolean")
VSM_ESS_Left_READY2ACTIVE = Simulink.Signal(StorageClass="ExportedGlobal", DataType="boolean")
VSM_ESS_Right_READY2ACTIVE = Simulink.Signal(StorageClass="ExportedGlobal", DataType="boolean")
VSM_ESSState = Simulink.Signal(StorageClass="ExportedGlobal", DataType="uint8")
VSM_ESS_LastPoint = Simulink.Signal(StorageClass="ExportedGlobal", DataType="single")
VSM_ESS_DPC_L_Active2Ready = Simulink.Signal(StorageClass="ExportedGlobal", DataType="boolean")
VSM_ESS_L_Oncoming_Active2Ready = Simulink.Signal(StorageClass="ExportedGlobal", DataType="boolean")
VSM_ESS_L_Active2Ready = Simulink.Signal(StorageClass="ExportedGlobal", DataType="boolean")
VSM_ESS_LValid_Active2Ready = Simulink.Signal(StorageClass="ExportedGlobal", DataType="boolean")
VSM_ESS_DPC_R_Active2Ready = Simulink.Signal(StorageClass="ExportedGlobal", DataType="boolean")
VSM_ESS_R_Oncoming_Active2Ready = Simulink.Signal(StorageClass="ExportedGlobal", DataType="boolean")
VSM_ESS_R_Active2Ready = Simulink.Signal(StorageClass="ExportedGlobal", DataType="boolean")
VSM_ESS_RValid_Active2Ready = Simulink.Signal(StorageClass="ExportedGlobal", DataType="boolean")
VSM_ESS_Obj_Active2Ready = Simulink.Signal(StorageClass="ExportedGlobal", DataType="boolean")
VSM_ESS_LineRValid_Ready2Active = Simulink.Signal(StorageClass="ExportedGlobal", DataType="boolean")
VSM_ESS_R_SteerWheelSpdSign_Ready2Active = Simulink.Signal(StorageClass="ExportedGlobal", DataType="boolean")
VSM_ESS_LineLValid_Ready2Active = Simulink.Signal(StorageClass="ExportedGlobal", DataType="boolean")
VSM_ESS_L_SteerWheelSpdSign_Ready2Active = Simulink.Signal(StorageClass="ExportedGlobal", DataType="boolean")
VSM_ESS_VehicleSpd_IDLE2READY = Simulink.Signal(StorageClass="ExportedGlobal", DataType="boolean")
VSM_ESS_ESPFuncOffSts_IDLE2READY = Simulink.Signal(StorageClass="ExportedGlobal", DataType="boolean")
VSM_ESS_DoorSts_IDLE2READY = Simulink.Signal(StorageClass="ExportedGlobal", DataType="boolean")
VSM_ESS_DrvSBR_IDLE2READY = Simulink.Signal(StorageClass="ExportedGlobal", DataType="boolean")
VSM_ESS_TrailerSts_IDLE2READY = Simulink.Signal(StorageClass="ExportedGlobal", DataType="boolean")
VSM_ESS_WiprReq_IDLE2READY = Simulink.Signal(StorageClass="ExportedGlobal", DataType="boolean")
VSM_ESS_HiLoBeam_IDLE2READY = Simulink.Signal(StorageClass="ExportedGlobal", DataType="boolean")
VSM_ESS_ESPActive_IDLE2READY = Simulink.Signal(StorageClass="ExportedGlobal", DataType="boolean")
VSM_ESS_LateralAccel_IDLE2READY = Simulink.Signal(StorageClass="ExportedGlobal", DataType="boolean")
VSM_ESS_VehicleSpd_READY2IDLE = Simulink.Signal(StorageClass="ExportedGlobal", DataType="boolean")
VSM_ESS_ESPFuncOffSts_READY2IDLE = Simulink.Signal(StorageClass="ExportedGlobal", DataType="boolean")
VSM_ESS_DoorSts_READY2IDLE = Simulink.Signal(StorageClass="ExportedGlobal", DataType="boolean")
VSM_ESS_DrvSBR_READY2IDLE = Simulink.Signal(StorageClass="ExportedGlobal", DataType="boolean")
VSM_ESS_TrailerSts_READY2IDLE = Simulink.Signal(StorageClass="ExportedGlobal", DataType="boolean")
VSM_ESS_WiprReq_READY2IDLE = Simulink.Signal(StorageClass="ExportedGlobal", DataType="boolean")
VSM_ESS_HiLoBeam_READY2IDLE = Simulink.Signal(StorageClass="ExportedGlobal", DataType="boolean")
VSM_ESS_ESPActive_READY2IDLE = Simulink.Signal(StorageClass="ExportedGlobal", DataType="boolean")
VSM_ESS_LateralAccel_READY2IDLE = Simulink.Signal(StorageClass="ExportedGlobal", DataType="boolean")
VSM_ESS_FcwFlag_READY2ACTIVE = Simulink.Signal(StorageClass="ExportedGlobal", DataType="boolean")
VSM_ESS_AEBFlag_READY2ACTIVE = Simulink.Signal(StorageClass="ExportedGlobal", DataType="boolean")
VSM_ESS_DrvOver_Active2Ready = Simulink.Signal(StorageClass="ExportedGlobal", DataType="boolean")
VSM_ESS_LeftOncoming_Ready2Active = Simulink.Signal(StorageClass="ExportedGlobal", DataType="boolean")
VSM_ESS_DangerPlausLeft_Ready2Active = Simulink.Signal(StorageClass="ExportedGlobal", DataType="boolean")
VSM_ESS_RightOncoming_Ready2Active = Simulink.Signal(StorageClass="ExportedGlobal", DataType="boolean")
VSM_ESS_DangerPlausRight_Ready2Active = Simulink.Signal(StorageClass="ExportedGlobal", DataType="boolean")
P_VSM_ESS_Vehspeed_enable = Simulink.Parameter(1, StorageClass="ExportedGlobal", DataType="boolean")
P_VSM_ESS_ESPFuncOffSts_enable = Simulink.Parameter(1, StorageClass="ExportedGlobal", DataType="boolean")
P_VSM_ESS_DoorSts_enable = Simulink.Parameter(1, StorageClass="ExportedGlobal", DataType="boolean")
P_VSM_ESS_DrvSBR_enable = Simulink.Parameter(1, StorageClass="ExportedGlobal", DataType="boolean")
P_VSM_ESS_TrailerSts_enable = Simulink.Parameter(1, StorageClass="ExportedGlobal", DataType="boolean")
P_VSM_ESS_WiprReq_enable = Simulink.Parameter(1, StorageClass="ExportedGlobal", DataType="boolean")
P_VSM_ESS_HiLoBeam_enable = Simulink.Parameter(1, StorageClass="ExportedGlobal", DataType="boolean")
P_VSM_ESS_ESPActive_enable = Simulink.Parameter(1, StorageClass="ExportedGlobal", DataType="boolean")
P_VSM_ESS_LateralAccel_enable = Simulink.Parameter(1, StorageClass="ExportedGlobal", DataType="boolean")
P_VSM_ESS_SteerWheelSpd_enable = Simulink.Parameter(1, StorageClass="ExportedGlobal", DataType="boolean")
P_VSM_ESS_AccelPed_enable = Simulink.Parameter(1, StorageClass="ExportedGlobal", DataType="boolean")
P_VSM_ESS_VehLgtAccel_enable = Simulink.Parameter(1, StorageClass="ExportedGlobal", DataType="boolean")
P_VSM_ESS_FcwSw_enable = Simulink.Parameter(1, StorageClass="ExportedGlobal", DataType="boolean")
P_VSM_ESS_FcwDisFlag_enable = Simulink.Parameter(1, StorageClass="ExportedGlobal", DataType="boolean")
P_VSM_ESS_AEBFlag_enable = Simulink.Parameter(1, StorageClass="ExportedGlobal", DataType="boolean")
P_VSM_ESS_MaxLateral_mss = Simulink.Parameter([10 9 8 7 6 5], StorageClass="ExportedGlobal", DataType="single")
P_VSM_ESS_IPSpeed_kmh = Simulink.Parameter([50 60 70 80 90 100], StorageClass="ExportedGlobal", DataType="single")
VSM_ESS_LineA0_Active2Ready = Simulink.Signal(StorageClass="ExportedGlobal", DataType="boolean")
VSM_ESS_LineA1_Active2Ready = Simulink.Signal(StorageClass="ExportedGlobal", DataType="boolean")
VSM_ESS_VehCnfgESS = Simulink.Signal(StorageClass="ExportedGlobal", DataType="uint8")
P_VSM_ESS_AccPedlPosn_Param = Simulink.Parameter(60, StorageClass="ExportedGlobal", DataType="single")
P_VSM_ESS_StopA0_Param = Simulink.Parameter(0.2, StorageClass="ExportedGlobal", DataType="single")
P_VSM_ESS_StopA1Time_Param = Simulink.Parameter(2, StorageClass="ExportedGlobal", DataType="single")
P_VSM_ESS_AngleSpdTable_deg = Simulink.Parameter([65 60 55 45 35 25], StorageClass="ExportedGlobal", DataType="single")
P_VSM_ESS_ACtiveTime = Simulink.Parameter(5, StorageClass="ExportedGlobal", DataType="single")
P_VSM_ESS_MasterCylindBrake = Simulink.Parameter(5, StorageClass="ExportedGlobal", DataType="single")
VSM_ESS_MasterCylindBrakePress_ACTIVE2IDLE = Simulink.Signal(StorageClass="ExportedGlobal", DataType="boolean")
VSM_ESS_VehicleSpd_ACTIVE2IDLE = Simulink.Signal(StorageClass="ExportedGlobal", DataType="boolean")
P_VSM_ESS_LgtAccelUpper_Param = Simulink.Parameter(3, StorageClass="ExportedGlobal", DataType="single")
P_VSM_ESS_LgtAccelLower_Param = Simulink.Parameter(-8, StorageClass="ExportedGlobal", DataType="single")
P_VSM_ESS_StopA1_Param = Simulink.Parameter(0.02, StorageClass="ExportedGlobal", DataType="single")
VSM_ESS_SubModel_VERSION = Simulink.Signal(StorageClass="ExportedGlobal", DataType="uint32")
VSM_ESS_SubModel_Number = Simulink.Signal(StorageClass="ExportedGlobal", DataType="uint16")
P_VSM_ESS_Ready2ACtiveTime = Simulink.Parameter(5, StorageClass="ExportedGlobal", DataType="single")
VSM_ESScnt = Simulink.Signal(StorageClass="ExportedGlobal")
VSM_ESSLtime = Simulink.Signal(StorageClass="ExportedGlobal")
VSM_ESSRtime = Simulink.Signal(StorageClass="ExportedGlobal")
VSM_cnt = Simulink.Signal(StorageClass="ExportedGlobal")
VSM_ESS_Statecnt = Simulink.Signal(StorageClass="ExportedGlobal", DataType="uint16")
VSM_ESS_StateR = Simulink.Signal(StorageClass="ExportedGlobal", DataType="single")
VSM_ESS_StateL = Simulink.Signal(StorageClass="ExportedGlobal", DataType="single")
P_VSM_ESS_DelayTime = Simulink.Parameter(3, StorageClass="ExportedGlobal", DataType="single")
P_VSM_ESS_SteerWheelSpd_Param = Simulink.Parameter(repmat(100, 1, 6), StorageClass="ExportedGlobal", DataType="single")
P_VSM_ESS_SteerWheelSpd_BP = Simulink.Parameter([60 80 90 100 110 120], StorageClass="ExportedGlobal")
VSM_ESS_DelayReady = Simulink.Signal(StorageClass="ExportedGlobal")

ESS_AD_CAN_BUS = Simulink.Bus()
  SteerWheelAngSign: boolean
  VehSpd: single
  VDCActv: boolean
  PTCActv: boolean
  BTCActv: boolean
  ABSActv: boolean
  EPS_DrvInpTrqVal_HighReslolution: single
  SteerWheelSpd: single
  AccelPedlPosnDiagc: single
  VehLatAccel: single
  EPS_LKATorqOvrlDlvd: single
  SteerWheelSpdSign: boolean
  FrntWiprSwtSts: uint8
  HighBeamSts: boolean
  LowBeamSts: boolean
  ESPFuncOffSts: boolean
  DrvDoorSts: boolean
  PassengerDoorSts: boolean
  DrvSBR: boolean
  VehLgtAccel: single
  MSRActv: boolean
  ESS_PedSwtReq: boolean
  ESS_VehSwtReq: boolean
  EPS_LKATrqOvlDlvdSts: uint8
  ESP_MasterCylBrkPress: single

P_VSM_ESS_OVERRIDE_SW = Simulink.Parameter(0, StorageClass="ExportedGlobal", DataType="boolean")
P_VSM_ESS_DriveIn = Simulink.Parameter(repmat(1.2, 1, 6), StorageClass="ExportedGlobal", DataType="single")
P_VSM_ESS_DriveIn_BP = Simulink.Parameter([50 60 70 80 90 100], StorageClass="ExportedGlobal", DataType="single")
P_VSM_ESS_DriverInputdSameDire_delaytime = Simulink.Parameter(1, StorageClass="ExportedGlobal", DataType="single")
P_VSM_ESS_DrvOverTime_Paramsame = Simulink.Parameter(0.2, StorageClass="ExportedGlobal", DataType="single")
P_VSM_ESS_DrvOverTime_Param = Simulink.Parameter(0.2, StorageClass="ExportedGlobal", DataType="single")
VSM_ESS_DrvOver_Active2Ready_DiffDirc = Simulink.Signal(StorageClass="ExportedGlobal", DataType="boolean")
VSM_ESS_DrvOver_Active2Ready_SamDirc = Simulink.Signal(StorageClass="ExportedGlobal", DataType="boolean")
P_VSM_ESS_DriverInputTrq_Param = Simulink.Parameter(repmat(0.8, 1, 6), StorageClass="ExportedGlobal", DataType="single")