% Simulink data dictionary HOD.sldd

VSM_HandsOffWarningLevel = Simulink.Signal(StorageClass="ExportedGlobal")
VSM_HandsOffDetd = Simulink.Signal(StorageClass="ExportedGlobal")
P_VSM_HOD_HandsOn_Tr = Simulink.Parameter(0.35, StorageClass="ExportedGlobal", DataType="single")
P_VSM_HOD_HWA_HandsOffLev1TimeCnt = Simulink.Parameter(6000, StorageClass="ExportedGlobal", DataType="single")
P_VSM_HOD_HWA_HandsOffLev2TimeCnt = Simulink.Parameter(6150, StorageClass="ExportedGlobal", DataType="single")
P_VSM_HOD_HWA_HandsOffLev3TimeCnt = Simulink.Parameter(6350, StorageClass="ExportedGlobal", DataType="single")
P_VSM_HOD_HWA_HandsOffLev4TimeCnt = Simulink.Parameter(6600, StorageClass="ExportedGlobal", DataType="single")
P_VSM_HOD_HandsOff_Tr = Simulink.Parameter(0.23, StorageClass="ExportedGlobal", DataType="single")
P_VSM_HOD_Handson_TrqInsertPoint = Simulink.Parameter([0.26 0.5 0.9 1.1 1.5], StorageClass="ExportedGlobal", DataType="single")
VSM_HOD_DrvTrqFilted = Simulink.Signal(StorageClass="ExportedGlobal")
P_VSM_HOD_Handson_TimeInsertPoint = Simulink.Parameter([0.1 0.08 0.05 0.02 0], StorageClass="ExportedGlobal", DataType="single")
P_VSM_HOD_DrvTrqFlterTIme = Simulink.Parameter(0.5, StorageClass="ExportedGlobal")
P_VSM_HOD_LCKTJA_HandsOffLev1TimeCnt = Simulink.Parameter(6000, StorageClass="ExportedGlobal", DataType="single")
P_VSM_HOD_LCKTJA_HandsOffLev2TimeCnt = Simulink.Parameter(6150, StorageClass="ExportedGlobal", DataType="single")
P_VSM_HOD_LCKTJA_HandsOffLev3TimeCnt = Simulink.Parameter(6350, StorageClass="ExportedGlobal", DataType="single")
P_VSM_HOD_LCKTJA_HandsOffLev4TimeCnt = Simulink.Parameter(6600, StorageClass="ExportedGlobal", DataType="single")
VSM_HOD_SubModel_VERSION = Simulink.Signal(DataType="uint32")
VSM_HOD_SubModel_Number = Simulink.Signal(DataType="uint16")