% Simulink data dictionary HWA.sldd

VSM_HWASlowExitCons_HighSpdIn3s = Simulink.Signal(StorageClass="ExportedGlobal")
VSM_HWASlowExitCons_DMSInvalid = Simulink.Signal(StorageClass="ExportedGlobal")
VSM_HWASlowExitCons_MapDataInvalid = Simulink.Signal(StorageClass="ExportedGlobal")
VSM_HWASlowExitCons_SingleLineLost = Simulink.Signal(StorageClass="ExportedGlobal")
VSM_HWASlowExitCons_NotHighWayArterialRoad5s = Simulink.Signal(StorageClass="ExportedGlobal")
VSM_HWASlowExitCons_LCKIdleWithoutTurnLight = Simulink.Signal(StorageClass="ExportedGlobal")
VSM_HWASlowExitConditions_b = Simulink.Signal(StorageClass="ExportedGlobal")
VSM_SomeHWASafeStop2ExitConditions_b = Simulink.Signal(StorageClass="ExportedGlobal")
VSM_HWAFastExitConditions_b = Simulink.Signal(StorageClass="ExportedGlobal")
VSM_HWAActivationConditions_b = Simulink.Signal(StorageClass="ExportedGlobal")
VSM_HWAActivationCons_TJAActive = Simulink.Signal(StorageClass="ExportedGlobal")
VSM_HWAActivationCons_LCKActive = Simulink.Signal(StorageClass="ExportedGlobal")
VSM_HWAActivationCons_HandsOn5s = Simulink.Signal(StorageClass="ExportedGlobal")
VSM_HWAActivationCons_DriverStsGood10s = Simulink.Signal(StorageClass="ExportedGlobal")
VSM_HWAActivationCons_AEBSwitchOn = Simulink.Signal(StorageClass="ExportedGlobal")
VSM_HWAActivationCons_HWALineValid = Simulink.Signal(StorageClass="ExportedGlobal")
VSM_HWAActivationCons_NoSingleLineLost = Simulink.Signal(StorageClass="ExportedGlobal")
VSM_HWAActivationCons_NoDoubleLineLost = Simulink.Signal(StorageClass="ExportedGlobal")
VSM_HWAActivationCons_HighWayArterialRoad = Simulink.Signal(StorageClass="ExportedGlobal")
VSM_HWAActivationCons_NoTunnel300m = Simulink.Signal(StorageClass="ExportedGlobal")
VSM_HWAActivationCons_NoForkRoad300m = Simulink.Signal(StorageClass="ExportedGlobal")
VSM_HWAActivationCons_MapDataValid = Simulink.Signal(StorageClass="ExportedGlobal")
VSM_HWAActivationCons_DVRNoError = Simulink.Signal(StorageClass="ExportedGlobal")
VSM_HWAActivationCons_NoHWANoError = Simulink.Signal(StorageClass="ExportedGlobal")
VSM_HWAActivationCons_NoHWASafeStopHappened_b = Simulink.Signal(StorageClass="ExportedGlobal")
VSM_HWAActivationCons_VehicleSpdNormal3s = Simulink.Signal(StorageClass="ExportedGlobal")
VSM_HWAWarningLevel = Simulink.Signal(StorageClass="ExportedGlobal")
VSM_HWASafeStopEn = Simulink.Signal(StorageClass="ExportedGlobal")
VSM_HWAFastExit_b = Simulink.Signal(StorageClass="ExportedGlobal")
VSM_HWASlowExit_b = Simulink.Signal(StorageClass="ExportedGlobal")
VSM_Diagnostic_HWAError = Simulink.Signal(StorageClass="ExportedGlobal")
P_VSM_HWA_EHR_Enable = Simulink.Parameter(0, StorageClass="ExportedGlobal", DataType="boolean")  % EHR使能开关
P_VSM_HWA_DMS_Enable = Simulink.Parameter(0, DataType="boolean")  % 驾驶员状态使能开关
VSM_HWAActivationCons_NoHWAFastExitConditions_b = Simulink.Signal()
VSM_HWAFastExitCons_ACCNotActive = Simulink.Signal()
VSM_HWAFastExitCons_HWAErrorFastExit = Simulink.Signal()
VSM_HWASlowExitCons_TCS2Active3000ms = Simulink.Signal()
VSM_HWAFastExitCons_OverrideTimeout = Simulink.Signal()
VSM_HWAFastExitCons_ParkGearOrEPBActive = Simulink.Signal()
VSM_HWAFastExitCons_SpeedTooHighWithOverride = Simulink.Signal()
VSM_HWASlowExitCons_ABSActive400ms = Simulink.Signal()
VSM_HWASlowExitCons_AEBOff = Simulink.Signal()
VSM_HWASlowExitCons_AEBTrigger = Simulink.Signal()
VSM_HWASlowExitCons_EPBClosed = Simulink.Signal()
VSM_HWASlowExitCons_ESPOff = Simulink.Signal()
VSM_HWASlowExitCons_EspActive400ms = Simulink.Signal()
VSM_HWASlowExitCons_HDCActive40ms = Simulink.Signal()
VSM_HWASlowExitCons_DriverBrakeExit = Simulink.Signal()
VSM_HWASlowExitCons_NoForwardGear = Simulink.Signal()
VSM_HWASlowExitCons_DriverDoorOpen = Simulink.Signal()
VSM_HWASlowExitCons_HandsoffOverride = Simulink.Signal()
VSM_HWASlowExitCons_MSRActive400ms = Simulink.Signal()
VSM_HWASlowExitCons_TCS1Active3000ms = Simulink.Signal()
VSM_HWAFastExitCons_StandstillTimeout = Simulink.Signal()
VSM_HWASlowExitCons_MSRActive800ms = Simulink.Signal()
VSM_HWASlowExitCons_HWAError_Inhibit = Simulink.Signal()
VSM_HWASlowExitCons_HWAError_Error = Simulink.Signal()
VSM_HWASlowExitCons_HWAError_ErrorBlindness = Simulink.Signal()
VSM_HandsOn = Simulink.Signal(StorageClass="ExportedGlobal")
VSM_HandsOff = Simulink.Signal(StorageClass="ExportedGlobal")
VSM_HandsOffOverride = Simulink.Signal(StorageClass="ExportedGlobal")
VSM_HWADriveOffCondF_b = Simulink.Signal(StorageClass="ExportedGlobal")
P_VSM_HWA_AutoLC_Spd_low_kph = Simulink.Parameter(56, StorageClass="ExportedGlobal", DataType="single")  % HWA auto lanechane vehSpeed
VSM_HWA_ModeDisp = Simulink.Signal(StorageClass="ExportedGlobal")
VSM_HWATextDisp = Simulink.Signal(StorageClass="ExportedGlobal")
VSM_HWA_LaneChangeReq = Simulink.Signal(StorageClass="ExportedGlobal")
VSM_HWA_Warning = Simulink.Signal(StorageClass="ExportedGlobal")
VSM_HWAActive = Simulink.Signal(StorageClass="ExportedGlobal")
VSM_HWASts = Simulink.Signal(StorageClass="ExportedGlobal")
VSM_HWAAccControlSts = Simulink.Signal(StorageClass="ExportedGlobal")
VSM_HWA_ParkShiftReq = Simulink.Signal()
VSM_HWANOA_Mode = Simulink.Signal(StorageClass="ExportedGlobal")

EHR_Bus = Simulink.Bus()
  DrivingOnHighWay: uint8
  FormOfWay: uint8
  TunnelDistance: uint16
  RampDistance: uint16
  MapDataValid: uint8

HWA_AD_Bus = Simulink.Bus()
  DVRWorkSts: uint8
  VDCActv: boolean
  MSRActv: boolean
  HDCCtrl: uint8
  ABSActv: boolean
  PTCActv: boolean
  BTCActv: boolean
  LTurnLmpSwtSts: boolean
  RTurnLmpSwtSts: boolean
  HazardLmpSwtSts: boolean
  EPBSts: uint8
  EPB_SwtPosn: uint8
  VehStandstill: uint8
  TGS_LEVER: uint8
  ESPFuncOffSts: boolean
  DrvDoorSts: boolean
  DrvSBR: boolean
  VehSpd: single
  ESP_MasterCylBrkPress: single
  BrkPedalSts: uint8

P_VSM_HWAActivation_Spd_Up = Simulink.Parameter(120, StorageClass="ExportedGlobal", DataType="single")
VSM_HWA_Version = Simulink.Signal(StorageClass="ExportedGlobal")
P_VSM_ALC_vMinPreLC_Drv = Simulink.Parameter(40, StorageClass="ExportedGlobal", DataType="single")
VSM_HWA_StopExit = Simulink.Signal(StorageClass="ExportedGlobal")
VSM_HWASlowExitCons_ACCError = Simulink.Signal(StorageClass="ExportedGlobal")
P_VSM_HWA_ALCStsSW = Simulink.Parameter(true, StorageClass="ExportedGlobal", DataType="boolean")
P_VSM_HWASlowExit_SingleLineLostDuring = Simulink.Parameter(3, StorageClass="ExportedGlobal", DataType="uint8")
P_VSM_HWAActivation_NOAMOd_Spd = Simulink.Parameter(5, StorageClass="ExportedGlobal", DataType="single")
P_VSM_HWAActivation_Spd_Low = Simulink.Parameter(5, StorageClass="ExportedGlobal", DataType="single")
VSM_HWAFastExitCons_DriverSBR = Simulink.Signal()
VSM_HWAFastExitCons_DVRError = Simulink.Signal(StorageClass="ExportedGlobal")
VSM_Diagnostic_TJAError = Simulink.Signal(StorageClass="ExportedGlobal")
P_VSM_NOH_Swt_Req_SW = Simulink.Parameter(0, StorageClass="ExportedGlobal")
P_VSM_NOH_PilotSelc_SW = Simulink.Parameter(0, StorageClass="ExportedGlobal", DataType="uint8")
VSM_HWA_TJA_SubModel_VERSION = Simulink.Signal(DataType="uint32")
VSM_HWA_TJA_SubModel_Number = Simulink.Signal(DataType="uint16")
P_VSM_TimeGapHMI_SW = Simulink.Parameter(0, StorageClass="ExportedGlobal", DataType="boolean")
P_VSM_SOSSpdLimit = Simulink.Parameter(0, StorageClass="ExportedGlobal")
P_VSM_SOSContinueTime = Simulink.Parameter(3000, StorageClass="ExportedGlobal")
P_VSM_TJA_PassSBRSpdExistSlow = Simulink.Parameter(30, StorageClass="ExportedGlobal", DataType="uint8")