% Simulink data dictionary ISL.sldd

P_VSM_ISL_TimeTakeOver = Simulink.Parameter(30, StorageClass="ExportedGlobal", DataType="uint8", Unit="s")
P_VSM_ISL_SLW_Warning_Time = Simulink.Parameter(10, DataType="uint8")
P_VSM_ISL_AutoSpPpercentage = Simulink.Parameter(0.1)  % 0-1表示0-100%
P_VSM_ISL_SpdDOWNmaxDiff = Simulink.Parameter(50)  % 减小setspd最大减小量
P_VSM_ISL_SpdUPmaxDiff = Simulink.Parameter(25)  % 增加Spd最大增量
P_VSM_ISL_SpdUPminDiff = Simulink.Parameter(10)  % 增加setspd 最小限速增加量
VSM_ISL_SLWSPLvalue = Simulink.Signal()
P_VSM_ISL_TimeInformDis = Simulink.Parameter(6, StorageClass="ExportedGlobal", DataType="uint8", Min=1, Max=255, Unit="s")
VSM_ISL_SubModel_VERSION = Simulink.Signal(DataType="uint32")
VSM_ISL_SubModel_Number = Simulink.Signal(DataType="uint16")