% Simulink data dictionary ELK.sldd

VSM_ELK_Con_VehicleSpeed_Idle2ReadyELK = Simulink.Signal(StorageClass="ExportedGlobal", DataType="boolean")
VSM_ELK_Con_YawRate_Idle2Ready = Simulink.Signal(StorageClass="ExportedGlobal", DataType="boolean")
VSM_ELK_Con_AbsEsp_Idle2Ready = Simulink.Signal(StorageClass="ExportedGlobal", DataType="boolean")
VSM_ELK_Con_Lane_Idle2Ready = Simulink.Signal(StorageClass="ExportedGlobal", DataType="boolean")
VSM_ELK_Con_Headingangel_Idle2Ready = Simulink.Signal(StorageClass="ExportedGlobal", DataType="boolean")
VSM_ELK_Con_LaneCurve_Idle2Ready = Simulink.Signal(StorageClass="ExportedGlobal", DataType="boolean")
VSM_ELK_Con_Failsafe_Idle2Ready = Simulink.Signal(StorageClass="ExportedGlobal", DataType="boolean")
VSM_ELK_Con_Handson_Idle2Ready = Simulink.Signal(StorageClass="ExportedGlobal", DataType="boolean")
VSM_ELK_Con_SteerWheelAngle_Ready2Active = Simulink.Signal(StorageClass="ExportedGlobal", DataType="boolean")
VSM_ELK_Con_DriverInput_Ready2Active = Simulink.Signal(StorageClass="ExportedGlobal", DataType="boolean")
VSM_ELK_Con_SteerWheelSpd_Ready2Active = Simulink.Signal(StorageClass="ExportedGlobal", DataType="boolean")
VSM_ELK_Con_LateralAcc_Ready2Active = Simulink.Signal(StorageClass="ExportedGlobal", DataType="boolean")
VSM_ELK_Con_LongitudeAcc_Ready2Active = Simulink.Signal(StorageClass="ExportedGlobal", DataType="boolean")
VSM_ELK_Con_BrakePressure_Ready2Active = Simulink.Signal(StorageClass="ExportedGlobal", DataType="boolean")
VSM_ELK_Con_AccPedalRate_Ready2Active = Simulink.Signal(StorageClass="ExportedGlobal", DataType="boolean")
VSM_ELK_Con_EpsSta_Ready2Active = Simulink.Signal(StorageClass="ExportedGlobal", DataType="boolean")
VSM_ELK_Con_CURRENT_GEAR_Ready2Active = Simulink.Signal(StorageClass="ExportedGlobal", DataType="boolean")
VSM_ELK_Con_TurnLight_Ready2Active = Simulink.Signal(StorageClass="ExportedGlobal", DataType="boolean")
VSM_ELK_Con_SteerWheelAngle_Active2Ready = Simulink.Signal(StorageClass="ExportedGlobal", DataType="boolean")
VSM_ELK_Con_DriverInput_Active2Ready = Simulink.Signal(StorageClass="ExportedGlobal", DataType="boolean")
VSM_ELK_Con_SteerWheelSpd_Active2Ready = Simulink.Signal(StorageClass="ExportedGlobal", DataType="boolean")
VSM_ELK_Con_LateralAcc_Active2Ready = Simulink.Signal(StorageClass="ExportedGlobal", DataType="boolean")
VSM_ELK_Con_LongitudeAcc_Active2Ready = Simulink.Signal(StorageClass="ExportedGlobal", DataType="boolean")
VSM_ELK_Con_BrakePressure_Active2Ready = Simulink.Signal(StorageClass="ExportedGlobal", DataType="boolean")
VSM_ELK_Con_AccPedalRate_Active2Ready = Simulink.Signal(StorageClass="ExportedGlobal", DataType="boolean")
VSM_ELK_Con_EpsSta_Active2Ready = Simulink.Signal(StorageClass="ExportedGlobal", DataType="boolean")
VSM_ELK_Con_CURRENT_GEAR_Active2Ready = Simulink.Signal(StorageClass="ExportedGlobal", DataType="boolean")
VSM_ELK_Con_TurnLight_Active2Ready = Simulink.Signal(StorageClass="ExportedGlobal", DataType="boolean")
VSM_ELK_Con_OverRide_Active2Ready = Simulink.Signal(StorageClass="ExportedGlobal", DataType="boolean")
VSM_ELK_Con_VehicleSpeed_Ready2Idle = Simulink.Signal(StorageClass="ExportedGlobal", DataType="boolean")
VSM_ELK_Con_YawRate_Ready2Idle = Simulink.Signal(StorageClass="ExportedGlobal", DataType="boolean")
VSM_ELK_Con_AbsEsp_Ready2Idle = Simulink.Signal(StorageClass="ExportedGlobal", DataType="boolean")
VSM_ELK_Con_Lane_Ready2Idle = Simulink.Signal(StorageClass="ExportedGlobal", DataType="boolean")
VSM_ELK_Con_Failsafe_Ready2Idle = Simulink.Signal(StorageClass="ExportedGlobal", DataType="boolean")
VSM_ELK_Con_LaneCurve_Ready2Idle = Simulink.Signal(StorageClass="ExportedGlobal", DataType="boolean")
VSM_ELK_Con_Headingangle_Ready2Idle = Simulink.Signal(StorageClass="ExportedGlobal", DataType="boolean")
VSM_ELK_Con_HandOff_Ready2Idle = Simulink.Signal(StorageClass="ExportedGlobal", DataType="boolean")
VSM_ELK_Idle2Ready = Simulink.Signal(StorageClass="ExportedGlobal", DataType="boolean")
VSM_ELK_Ready2Active = Simulink.Signal(StorageClass="ExportedGlobal", DataType="boolean")
VSM_ELK_Active2Ready = Simulink.Signal(StorageClass="ExportedGlobal", DataType="boolean")
VSM_ELK_Other2Idle = Simulink.Signal(StorageClass="ExportedGlobal", DataType="boolean")
VSM_ELK_OnComing_LetfCondition = Simulink.Signal(StorageClass="ExportedGlobal", DataType="boolean")
VSM_ELK_OnComing_RightCondition = Simulink.Signal(StorageClass="ExportedGlobal", DataType="boolean")
VSM_ELK_OnComing_LOut = Simulink.Signal(StorageClass="ExportedGlobal", DataType="boolean")
VSM_ELK_OnComing_ROut = Simulink.Signal(StorageClass="ExportedGlobal", DataType="boolean")
VSM_ELK_OnComing_LOnComing = Simulink.Signal(StorageClass="ExportedGlobal", DataType="boolean")
VSM_ELK_OnComing_Lttc = Simulink.Signal(StorageClass="ExportedGlobal", DataType="boolean")
VSM_ELK_OnComing_ROnComing = Simulink.Signal(StorageClass="ExportedGlobal", DataType="boolean")
VSM_ELK_OnComing_Rttc = Simulink.Signal(StorageClass="ExportedGlobal", DataType="boolean")
VSM_ELK_OverTaking_LeftCondition = Simulink.Signal(StorageClass="ExportedGlobal", DataType="boolean")
VSM_ELK_OverTaking_RightCondition = Simulink.Signal(StorageClass="ExportedGlobal", DataType="boolean")
VSM_ELK_OverTaking_LOut = Simulink.Signal(StorageClass="ExportedGlobal", DataType="boolean")
VSM_ELK_OverTaking_ROut = Simulink.Signal(StorageClass="ExportedGlobal", DataType="boolean")
VSM_ELK_OverTaking_LLateral = Simulink.Signal(StorageClass="ExportedGlobal", DataType="boolean")
VSM_ELK_OverTaking_leftcar = Simulink.Signal(StorageClass="ExportedGlobal", DataType="boolean")
VSM_ELK_OverTaking_RLateral = Simulink.Signal(StorageClass="ExportedGlobal", DataType="boolean")
VSM_ELK_OverTaking_rightcar = Simulink.Signal(StorageClass="ExportedGlobal", DataType="boolean")
VSM_ELK_Con_Override_Ready2Active = Simulink.Signal(StorageClass="ExportedGlobal", DataType="boolean")
P_VSM_ELK_State_Vehspeed_enable = Simulink.Parameter(1, StorageClass="ExportedGlobal", DataType="single")
P_VSM_ELK_State_Yawsup_enable = Simulink.Parameter(1, StorageClass="ExportedGlobal", DataType="single")
P_VSM_ELK_State_Absesp_enable = Simulink.Parameter(1, StorageClass="ExportedGlobal", DataType="single")
P_VSM_ELK_State_Lane_enable = Simulink.Parameter(1, StorageClass="ExportedGlobal", DataType="single")
P_VSM_ELK_State_Headingangle_enable = Simulink.Parameter(1, StorageClass="ExportedGlobal", DataType="single")
P_VSM_ELK_State_Lanecurve_enable = Simulink.Parameter(1, StorageClass="ExportedGlobal", DataType="single")
P_VSM_ELK_State_Failsafe_enable = Simulink.Parameter(1, StorageClass="ExportedGlobal", DataType="single")
P_VSM_ELK_State_Handson_enable = Simulink.Parameter(1, StorageClass="ExportedGlobal", DataType="single")
P_VSM_ELK_State_SteerWheelAngle_enable = Simulink.Parameter(1, StorageClass="ExportedGlobal", DataType="single")
P_VSM_ELK_State_DriverInputTrqValue_enable = Simulink.Parameter(1, StorageClass="ExportedGlobal", DataType="single")
P_VSM_ELK_State_SteerWheelSpd_enable = Simulink.Parameter(1, StorageClass="ExportedGlobal", DataType="single")
P_VSM_ELK_State_LateralAcce_enable = Simulink.Parameter(1, StorageClass="ExportedGlobal", DataType="single")
P_VSM_ELK_State_LongitudeAcc_enable = Simulink.Parameter(1, StorageClass="ExportedGlobal", DataType="single")
P_VSM_ELK_State_Breakpressure_enable = Simulink.Parameter(1, StorageClass="ExportedGlobal", DataType="single")
P_VSM_ELK_State_Accpedalrate_enable = Simulink.Parameter(1, StorageClass="ExportedGlobal", DataType="single")
P_VSM_ELK_State_Eps_enable = Simulink.Parameter(1, StorageClass="ExportedGlobal", DataType="single")
P_VSM_ELK_State_GEAR_enable = Simulink.Parameter(1, StorageClass="ExportedGlobal", DataType="single")
P_VSM_ELK_State_TurnLight_enable = Simulink.Parameter(1, StorageClass="ExportedGlobal", DataType="single")
P_VSM_ELK_State_Overide_enable = Simulink.Parameter(1, StorageClass="ExportedGlobal", DataType="single")
P_VSM_ELK_State_Param_Lane = Simulink.Parameter(0.45, StorageClass="ExportedGlobal", DataType="single")
P_VSM_ELK_State_Param_Re = Simulink.Parameter(0.55, StorageClass="ExportedGlobal", DataType="single")
P_VSM_ELK_State_Param_LaneDeac = Simulink.Parameter(0.75, StorageClass="ExportedGlobal", DataType="single")
P_VSM_ELK_State_Param_Oncoming = Simulink.Parameter(0.55, StorageClass="ExportedGlobal", DataType="single")
P_VSM_ELK_State_Param_OnDeac = Simulink.Parameter(0.75, StorageClass="ExportedGlobal", DataType="single")
P_VSM_ELK_State_Param_Over = Simulink.Parameter(0.55, StorageClass="ExportedGlobal", DataType="single")
P_VSM_ELK_State_Param_OverDeac = Simulink.Parameter(0.75, StorageClass="ExportedGlobal", DataType="single")
P_VSM_ELK_State_Param_LaneTime = Simulink.Parameter(repmat(0.7, 1, 16), StorageClass="ExportedGlobal", DataType="single")
P_VSM_ELK_State_Param_OutOffset = Simulink.Parameter(0.15, StorageClass="ExportedGlobal", DataType="single")
P_VSM_ELK_State_Param_AngleOffset = Simulink.Parameter(0.05, StorageClass="ExportedGlobal", DataType="single")
P_VSM_ELK_State_Param_OnTime = Simulink.Parameter(repmat(0.7, 1, 16), StorageClass="ExportedGlobal", DataType="single")
P_VSM_ELK_State_Param_OvTime = Simulink.Parameter(repmat(0.7, 1, 16), StorageClass="ExportedGlobal", DataType="single")
P_VSM_ELK_OnComing_TTC = Simulink.Parameter(3, StorageClass="ExportedGlobal", DataType="single")
P_VSM_ELK_OverTaking_Lateral = Simulink.Parameter(2, StorageClass="ExportedGlobal", DataType="single")
P_VSM_ELK_Lateral_Speed_Table = Simulink.Parameter([0.1 0.2 0.3 0.4 0.5 0.6 0.7 0.8 0.9 1 1.1 1.2], StorageClass="ExportedGlobal", DataType="single")
P_VSM_ELK_Lateral_Speed_Table_Calibration = Simulink.Parameter(repmat(1, 1, 12), StorageClass="ExportedGlobal", DataType="single")
P_VSM_ELK_Lane_Width_Table = Simulink.Parameter([2.5 3 3.5 4 4.5 5 5.5], StorageClass="ExportedGlobal", DataType="single")
P_VSM_ELK_Curvature_R_Table = Simulink.Parameter([150 500 1000 1500 2000 3000 4000 5000 5500], StorageClass="ExportedGlobal", DataType="single")
P_VSM_ELK_Curvature_R_Table_Calibration = Simulink.Parameter(repmat(1, 1, 9), StorageClass="ExportedGlobal", DataType="single")
P_VSM_ELK_Sensitive_Table = Simulink.Parameter([1 2 3], StorageClass="ExportedGlobal", DataType="single")
P_VSM_ELK_OverTaking_TTC = Simulink.Parameter(5, StorageClass="ExportedGlobal", DataType="single")
P_VSM_ELK_State_Param_Speed = Simulink.Parameter([0 5 10 15 20 25 30 35 40 60 80 90 100 110 120 140], StorageClass="ExportedGlobal", DataType="single")
P_VSM_ELK_OnComing_Lateral = Simulink.Parameter(2.8, StorageClass="ExportedGlobal", DataType="single")
VSM_ELK_LWidth = Simulink.Signal(StorageClass="ExportedGlobal", DataType="single")
VSM_ELK_OnComing_Lv_re = Simulink.Signal(StorageClass="ExportedGlobal", DataType="single")
VSM_ELK_OnComing_Llateral = Simulink.Signal(StorageClass="ExportedGlobal", DataType="single")
VSM_ELK_OnComing_Rv_re = Simulink.Signal(StorageClass="ExportedGlobal", DataType="single")
VSM_ELK_OnComing_Rlateral = Simulink.Signal(StorageClass="ExportedGlobal", DataType="single")
P_VSM_ELK_Lane_Width_Table_Calibration = Simulink.Parameter(repmat(0, 1, 7), StorageClass="ExportedGlobal", DataType="single")
P_VSM_ELK_Sensitive_Table_Calibration = Simulink.Parameter([0 0.1 -0.1], StorageClass="ExportedGlobal", DataType="single")
VSM_ELKState = Simulink.Signal(StorageClass="ExportedGlobal", DataType="uint8")
VSM_ELK_Warning = Simulink.Signal(StorageClass="ExportedGlobal", DataType="single")
VSM_ELK_Counter = Simulink.Signal(StorageClass="ExportedGlobal", DataType="uint8")
VSM_ELK_Con_ESSSts_Ready2Idle = Simulink.Signal(StorageClass="ExportedGlobal", DataType="boolean")
VSM_ELK_Con_ESSSts_Idle2Ready = Simulink.Signal(StorageClass="ExportedGlobal", DataType="boolean")
P_VSM_ELK_State_ESSSts_enable = Simulink.Parameter(1, StorageClass="ExportedGlobal", DataType="single")
P_VSM_ELK_State_LaneChange_enable = Simulink.Parameter(1, StorageClass="ExportedGlobal", DataType="single")
VSM_ELK_Con_LaneChange_Ready2Active = Simulink.Signal(StorageClass="ExportedGlobal", DataType="boolean")
VSM_ELK_Con_LaneChange_Active2Ready = Simulink.Signal(StorageClass="ExportedGlobal", DataType="boolean")
VSM_ELK_VehConfigELK = Simulink.Signal(StorageClass="ExportedGlobal", DataType="uint8")
VSM_ELK_Lane_valid = Simulink.Signal(StorageClass="ExportedGlobal", DataType="boolean")
VSM_ELK_Lwidth_Valid = Simulink.Signal(StorageClass="ExportedGlobal", DataType="boolean")

LaneARe_SP = Simulink.Bus()
  Left_Valid: boolean
  Left_A3: single
  Left_A2: single
  Left_A1: single
  Left_A0: single
  Left_Range: single
  Left_Type: uint8
  Right_Valid: boolean
  Right_A3: single
  Right_A2: single
  Right_A1: single
  Right_A0: single
  Right_Range: single
  Right_Type: uint8
  LeftRE_Valid: boolean
  LeftRE_A3: single
  LeftRE_A2: single
  LeftRE_A1: single
  LeftRE_A0: single
  LeftRE_Range: single
  RightRE_Valid: boolean
  RightRE_A3: single
  RightRE_A2: single
  RightRE_A1: single
  RightRE_A0: single
  RightRE_Range: single
  LeftValid_A0: single
  LeftValid_A1: single
  LeftValid_A2: single
  LeftValid_A3: single
  LeftValid_Range: single
  LeftValid_Valid: boolean
  LeftValid_Type: uint8
  RightValid_A0: single
  RightValid_A1: single
  RightValid_A2: single
  RightValid_A3: single
  RightValid_Range: single
  RightValid_Valid: boolean
  RightValid_Type: uint8
  DeltaY: single
  T_A0: single
  T_A1: single
  T_A2: single
  T_A3: single
  T_Range: single
  T_Valid: boolean
  C_Lanewidth: single
  LeftChange: boolean
  RightChange: boolean
  Host_LRE: boolean
  Host_RRE: boolean
  LaneCurve: single
  HeadingAngle_In: boolean
  HeadingAngle_Out: boolean
  Left_LaneRe30: single
  Right_LaneRe30: single
  Scene_LaneValid: single
  LDWLKAELK_LWidth: single
  laneCenterA0: single
  laneCenterA1: single
  laneCenterA2: single
  laneCenterA3: single
  laneCenterValid: boolean
  Left_LaneValid: boolean
  Right_LaneValid: boolean
  Left_ReValid: boolean
  Right_ReValid: boolean
  Left_LaneOp_A0: single
  Right_LaneOp_A0: single
  Left_ReOp_A0: single
  Right_ReOp_A0: single
  Signal_Lane1: single
  Signal_Lane2: single
  Signal_Lane3: single
  Left_Lane_A1: single
  Right_Lane_A1: single
  Left_Re_A1: single
  Right_Re_A1: single

VSM_ELK_SubModel_VERSION = Simulink.Signal()
VSM_ELK_SubModel_Number = Simulink.Signal()