% Simulink data dictionary LCKIE.sldd

LCKIE_Diagno = Simulink.Bus()
  IFVFail: boolean
  VehConfig: boolean

CenterLane = Simulink.Bus()
  LCKLane_A0: single
  LCKLane_A1: single
  LCKLane_A2: single
  LCKLane_A3: single
  LCKLane_Valid: boolean

LCKIE_AD = Simulink.Bus()
  IntelligentEvaSwtReq: boolean
  canABSVehicleSpd: single
  canBCMWiperSwitchSts: uint8
  canBCMHighBeamSts: boolean
  canBCMLowBeamSts: boolean
  canBCMRearFogLmpSts: boolean
  canBCMFrontFogLmpSts: boolean
  canEPS_DriverInputTrqValue: single
  HWASts: uint8

VSM_LCKIE_State_IFVReady = Simulink.Signal(StorageClass="ExportedGlobal", DataType="boolean")
VSM_LCKIE_State_IFVFail = Simulink.Signal(StorageClass="ExportedGlobal", DataType="boolean")
VSM_LCKIE_State_Vehspeed_Idel2Ready = Simulink.Signal(StorageClass="ExportedGlobal", DataType="boolean")
VSM_LCKIE_State_Vehspeed_Ready2Idel = Simulink.Signal(StorageClass="ExportedGlobal", DataType="boolean")
VSM_LCKIE_State_Lanecurve_Idel2Ready = Simulink.Signal(StorageClass="ExportedGlobal", DataType="boolean")
VSM_LCKIE_State_LaneWidth_Idel2Ready = Simulink.Signal(StorageClass="ExportedGlobal", DataType="boolean")
VSM_LCKIE_State_wiper_Idel2Ready = Simulink.Signal(StorageClass="ExportedGlobal", DataType="boolean")
VSM_LCKIE_State_lamb_Idel2Ready = Simulink.Signal(StorageClass="ExportedGlobal", DataType="boolean")
VSM_LCKIE_State_detaspd_Idel2Ready = Simulink.Signal(StorageClass="ExportedGlobal", DataType="boolean")
VSM_LCKIE_State_Idel2Ready = Simulink.Signal(StorageClass="ExportedGlobal", DataType="boolean")
VSM_LCKIE_State_Ready2Idel = Simulink.Signal(StorageClass="ExportedGlobal", DataType="boolean")
VSM_LCKIE_State_DrvInputTrqValue_Ready2Active = Simulink.Signal(StorageClass="ExportedGlobal", DataType="boolean")
VSM_LCKIE_State_DrvInputTrqValue_Active2Ready = Simulink.Signal(StorageClass="ExportedGlobal", DataType="boolean")
VSM_LCKIE_State_ELKObj_Ready2Active = Simulink.Signal(StorageClass="ExportedGlobal", DataType="boolean")
VSM_LCKIE_State_ELKObj_Active2Ready = Simulink.Signal(StorageClass="ExportedGlobal", DataType="boolean")
VSM_LCKIE_State_OppFrontObj_Ready2Active = Simulink.Signal(StorageClass="ExportedGlobal", DataType="boolean")
VSM_LCKIE_State_OppFrontObj_Active2Ready = Simulink.Signal(StorageClass="ExportedGlobal", DataType="boolean")
VSM_LCKIE_State_IEObj_Ready2Active = Simulink.Signal(StorageClass="ExportedGlobal", DataType="boolean")
VSM_LCKIE_State_IEObj_Active2Ready = Simulink.Signal(StorageClass="ExportedGlobal", DataType="boolean")
VSM_LCKIE_State_Ready2Active = Simulink.Signal(StorageClass="ExportedGlobal", DataType="boolean")
VSM_LCKIE_State_Active2Ready = Simulink.Signal(StorageClass="ExportedGlobal", DataType="boolean")
VSM_LCKIE_State_LCToff = Simulink.Signal(StorageClass="ExportedGlobal", DataType="single")
VSM_LCKIE_State_LCflg = Simulink.Signal(StorageClass="ExportedGlobal", DataType="uint8")
VSM_LCKIE_State_LCCounter = Simulink.Signal(StorageClass="ExportedGlobal", DataType="uint8")
P_VSM_LCKIE_State_Vehspeed_enable = Simulink.Parameter(1, StorageClass="ExportedGlobal", DataType="single")
P_VSM_LCKIE_State_LaneWidth_enable = Simulink.Parameter(1, StorageClass="ExportedGlobal", DataType="single")
P_VSM_LCKIE_State_wiper_enable = Simulink.Parameter(1, StorageClass="ExportedGlobal", DataType="single")
P_VSM_LCKIE_State_lamb_enable = Simulink.Parameter(1, StorageClass="ExportedGlobal", DataType="single")
P_VSM_LCKIE_State_detaspd_enable = Simulink.Parameter(1, StorageClass="ExportedGlobal", DataType="single")
P_VSM_LCKIE_State_HWASts_disable = Simulink.Parameter(1, StorageClass="ExportedGlobal", DataType="single")
P_VSM_LCKIE_State_DriverInputTrqValue_enable = Simulink.Parameter(1, StorageClass="ExportedGlobal", DataType="single")
P_VSM_LCKIE_State_IFVReady = Simulink.Parameter(1, StorageClass="ExportedGlobal", DataType="single")
P_VSM_LCKIE_State_ELKObjClc = Simulink.Parameter(1, StorageClass="ExportedGlobal", DataType="single")
P_VSM_LCKIE_State_OppObjClc = Simulink.Parameter(1, StorageClass="ExportedGlobal", DataType="single")
P_VSM_LCKIE_State_IEObjClc = Simulink.Parameter(1, StorageClass="ExportedGlobal", DataType="single")
P_VSM_LCKIE_LongC_FleetOff = Simulink.Parameter(80, StorageClass="ExportedGlobal", DataType="single")
P_VSM_LCKIE_LongC_DirecChangeDis = Simulink.Parameter(20, StorageClass="ExportedGlobal", DataType="single")
P_VSM_LCKIE_LongC_maxDis = Simulink.Parameter(80, StorageClass="ExportedGlobal", DataType="single")
P_VSM_LCKIE_LongC_minDis = Simulink.Parameter(50, StorageClass="ExportedGlobal", DataType="single")
P_VSM_LCKIE_LongC_toff = Simulink.Parameter(10, StorageClass="ExportedGlobal", DataType="single")
P_VSM_LCKIE_ORC_LimitDis1 = Simulink.Parameter(-30, StorageClass="ExportedGlobal", DataType="single")
P_VSM_LCKIE_POC_LimitDis = Simulink.Parameter(-15, StorageClass="ExportedGlobal", DataType="single")
P_VSM_LCKIE_POC_detaSpd = Simulink.Parameter([-2 0 2 5 8 10], StorageClass="ExportedGlobal", DataType="single")
P_VSM_LCKIE_State_Lanecurve_enable = Simulink.Parameter(1, StorageClass="ExportedGlobal", DataType="single")
P_VSM_LCKIE_ORC_LimitTTC = Simulink.Parameter(10, StorageClass="ExportedGlobal", DataType="single")
P_VSM_LCKIE_POC_Delaytime = Simulink.Parameter([2 6 6 5 4 3], StorageClass="ExportedGlobal", DataType="single")
P_VSM_LCKIE_OFC_SafDis = Simulink.Parameter(10, StorageClass="ExportedGlobal", DataType="single")
P_VSM_LCKIE_OFC_ActDis = Simulink.Parameter(10, StorageClass="ExportedGlobal", DataType="single")
P_VSM_LCKIE_OFC_Toff = Simulink.Parameter(3, StorageClass="ExportedGlobal", DataType="single")
P_VSM_LCKIE_POC_LimitTTC = Simulink.Parameter(2, StorageClass="ExportedGlobal", DataType="single")
P_VSM_LCKIE_tcycle = Simulink.Parameter(0.02, StorageClass="ExportedGlobal", DataType="single")
P_VSM_LCKIE_State_Off2on = Simulink.Parameter(3, StorageClass="ExportedGlobal", DataType="single")
P_VSM_LCKIE_State_detaspd = Simulink.Parameter(1.39, StorageClass="ExportedGlobal", DataType="single")
P_VSM_LCKIE_LongC_ShutDownTTC = Simulink.Parameter(-4, StorageClass="ExportedGlobal", DataType="single")
P_VSM_LCKIE_LongC_ShutDownLongDis = Simulink.Parameter(-25, StorageClass="ExportedGlobal", DataType="single")
P_VSM_LCKIE_LongC_MidSpdTTC = Simulink.Parameter(repmat(5.5, 1, 6), StorageClass="ExportedGlobal", DataType="single")
P_VSM_LCKIE_LongC_Spd = Simulink.Parameter([60 80 100 110 120 130], StorageClass="ExportedGlobal")
P_VSM_LCKIE_State_LCDetaSpd = Simulink.Parameter([0.5 2.5 5 8 10 15], StorageClass="ExportedGlobal", DataType="single")
P_VSM_LCKIE_State_LCtoffset = Simulink.Parameter([6 3.5 2 1.5 1.5 1.5], StorageClass="ExportedGlobal", DataType="single")
P_VSM_LCKIE_LongC_DetaSpd = Simulink.Parameter([1 3 16], StorageClass="ExportedGlobal")
P_VSM_LCKIE_LatC_SafeDisofLanWidth = Simulink.Parameter([0.5 0.5 0.5 0.5], StorageClass="ExportedGlobal", DataType="single")
P_VSM_LCKIE_LatC_LanWidth = Simulink.Parameter([2.6 2.8 3 3.5], StorageClass="ExportedGlobal", DataType="single")
P_VSM_LCKIE_LatC_DisOffofLanWidth = Simulink.Parameter([3 3 3 3], StorageClass="ExportedGlobal", DataType="single")
P_VSM_LCKIE_LatC_DisOffofSpd = Simulink.Parameter(repmat(3, 1, 6), StorageClass="ExportedGlobal", DataType="single")
P_VSM_LCKIE_LatC_Spd = Simulink.Parameter([60 80 100 110 120 130], StorageClass="ExportedGlobal", DataType="single")
P_VSM_LCKIE_LatC_minLimitDisREToLane = Simulink.Parameter(1.2, StorageClass="ExportedGlobal", DataType="single")
P_VSM_LCKIE_LatC_maxLimitDisREToLane = Simulink.Parameter(2.5, StorageClass="ExportedGlobal", DataType="single")
P_VSM_LCKIE_LatC_LimitDisEgoToObjSelt = Simulink.Parameter(1.5, StorageClass="ExportedGlobal", DataType="single")
P_VSM_LCKIE_LatC_LimitEgoToOppLane = Simulink.Parameter(0.3, StorageClass="ExportedGlobal", DataType="single")
P_VSM_LCKIE_LatC_MoveEnableDis = Simulink.Parameter(0, StorageClass="ExportedGlobal", DataType="single")
VSM_LCKIE_OS_RoadWidth = Simulink.Signal(StorageClass="ExportedGlobal", DataType="single")
VSM_LCKIE_LatC_SafeDisToLaneEdge = Simulink.Signal(StorageClass="ExportedGlobal", DataType="single")
VSM_LCKIE_LongC_LongDis = Simulink.Signal(StorageClass="ExportedGlobal", DataType="single")
VSM_LCKIE_LongC_LongDisfinal = Simulink.Signal(StorageClass="ExportedGlobal", DataType="single")
VSM_LCKIE_LongC_ObjLong = Simulink.Signal(StorageClass="ExportedGlobal", DataType="single")
VSM_LCKIE_OFC_Long = Simulink.Signal(StorageClass="ExportedGlobal", DataType="single")
VSM_LCKIE_OFC_OppObjDetaSpd = Simulink.Signal(StorageClass="ExportedGlobal", DataType="single")
VSM_LCKIE_ORC_ObjTTC = Simulink.Signal(StorageClass="ExportedGlobal", DataType="single")
VSM_LCKIE_ORC_ObjLong = Simulink.Signal(StorageClass="ExportedGlobal", DataType="single")
VSM_LCKIE_ORC_ObjDetaSpd = Simulink.Signal(StorageClass="ExportedGlobal", DataType="single")
VSM_LCKIE_ORC_ObjLatPos = Simulink.Signal(StorageClass="ExportedGlobal", DataType="single")
VSM_LCKIE_Laneoffset = Simulink.Signal(StorageClass="ExportedGlobal", DataType="single")
VSM_LCKIE_OS_OppFObjID = Simulink.Signal(StorageClass="ExportedGlobal", DataType="uint8")
VSM_LCKIE_LatC_MovDirct = Simulink.Signal(StorageClass="ExportedGlobal", DataType="uint8")
VSM_LCKIE_LongC_IEReady = Simulink.Signal(StorageClass="ExportedGlobal", DataType="uint8")
VSM_LCKIE_LongC_LongFlg = Simulink.Signal(StorageClass="ExportedGlobal", DataType="uint8")
VSM_LCKIE_OFC_OppObjReady = Simulink.Signal(StorageClass="ExportedGlobal", DataType="uint8")
VSM_LCKIE_OFC_Counter = Simulink.Signal(StorageClass="ExportedGlobal", DataType="uint8")
VSM_LCKIE_ORC_OppREARObjReady = Simulink.Signal(StorageClass="ExportedGlobal", DataType="uint8")
VSM_LCKIE_ORC_Counter = Simulink.Signal(StorageClass="ExportedGlobal", DataType="uint8")
VSM_LCKIE_POC_Counter = Simulink.Signal(StorageClass="ExportedGlobal", DataType="uint8")
VSM_LCKIE_POC_delay_time = Simulink.Signal(StorageClass="ExportedGlobal", DataType="single")
VSM_LCKIE_POC_LongDown = Simulink.Signal(StorageClass="ExportedGlobal", DataType="uint8")
VSM_LCKIE_POC_OvertakeFlg = Simulink.Signal(StorageClass="ExportedGlobal", DataType="uint8")
VSM_LCKIE_POC_OvertakeSpd = Simulink.Signal(StorageClass="ExportedGlobal", DataType="single")
VSM_LCKIE_POC_POSID = Simulink.Signal(StorageClass="ExportedGlobal", DataType="uint8")
VSM_LCKIE_LongC_PocFlg = Simulink.Signal(StorageClass="ExportedGlobal", DataType="uint8")
VSM_LCKIE_LongC_CouterOff = Simulink.Signal(StorageClass="ExportedGlobal", DataType="uint16")
VSM_LCKIE_LongC_Counter = Simulink.Signal(StorageClass="ExportedGlobal", DataType="uint8")
VSM_LCKIE_LongC_Couter1 = Simulink.Signal(StorageClass="ExportedGlobal", DataType="uint16")
VSM_LCKIE_LongC_Couter2 = Simulink.Signal(StorageClass="ExportedGlobal", DataType="uint16")
VSM_LCKIE_OFC_OppObjFail = Simulink.Signal(StorageClass="ExportedGlobal", DataType="uint8")
VSM_LCKIE_OFC_Tset = Simulink.Signal(StorageClass="ExportedGlobal", DataType="single")
VSM_LCKIE_POC_Couter1 = Simulink.Signal(StorageClass="ExportedGlobal", DataType="uint16")
VSM_LCKIE_DelayTime = Simulink.Signal(StorageClass="ExportedGlobal", DataType="single")
VSM_LCKIE_LongC_d1 = Simulink.Signal(StorageClass="ExportedGlobal", DataType="single")
VSM_LCKIE_LongC_d2 = Simulink.Signal(StorageClass="ExportedGlobal")
VSM_LCKIE_OS_OppRObjID = Simulink.Signal(StorageClass="ExportedGlobal", DataType="uint8")
VSM_LCKIE_OS_POSRObjID = Simulink.Signal(StorageClass="ExportedGlobal", DataType="uint8")
VSM_LCKIE_OS_ObjLane = Simulink.Signal(StorageClass="ExportedGlobal", DataType="uint8")
VSM_LCKIE_OS_DisEgo2ObjSelect = Simulink.Signal(StorageClass="ExportedGlobal", DataType="single")
VSM_LCKIE_OS_DetaSpdSelect = Simulink.Signal(StorageClass="ExportedGlobal", DataType="single")
VSM_LCKIE_OS_DisEgo2OppLane = Simulink.Signal(StorageClass="ExportedGlobal", DataType="single")
VSM_LCKIE_OS_DetaSpd = Simulink.Signal(StorageClass="ExportedGlobal", DataType="single")
VSM_LCKIE_OS_TTC = Simulink.Signal(StorageClass="ExportedGlobal", DataType="single")
VSM_LCKIE_OS_ObjSelectID = Simulink.Signal(StorageClass="ExportedGlobal", DataType="uint8")
VSM_LCKIE_OS_ObjIDSelect = Simulink.Signal(StorageClass="ExportedGlobal", DataType="uint8")
VSM_LCKIE_OS_Couter1 = Simulink.Signal(StorageClass="ExportedGlobal", DataType="uint8")
VSM_LCKIE_OS_Couter = Simulink.Signal(StorageClass="ExportedGlobal", DataType="uint8")
VSM_LCKIE_LatC_MovDirct1 = Simulink.Signal(StorageClass="ExportedGlobal", DataType="uint8")
VSM_LCKIE_LatC_MoveDis = Simulink.Signal(StorageClass="ExportedGlobal", DataType="single")
VSM_LCKIE_LatC_DirectChange = Simulink.Signal(StorageClass="ExportedGlobal", DataType="uint8")
VSM_LCKIE_LatC_LatFLg = Simulink.Signal(StorageClass="ExportedGlobal", DataType="uint8")
VSM_LCKIE_LatC_Counter5 = Simulink.Signal(StorageClass="ExportedGlobal", DataType="uint8")
VSM_LCKIE_LatC_Counter4 = Simulink.Signal(StorageClass="ExportedGlobal", DataType="uint8")
VSM_LCKIE_LatC_Counter3 = Simulink.Signal(StorageClass="ExportedGlobal", DataType="uint8")
VSM_LCKIE_LatC_Counter2 = Simulink.Signal(StorageClass="ExportedGlobal", DataType="uint8")
VSM_LCKIE_LatC_Counter1 = Simulink.Signal(StorageClass="ExportedGlobal", DataType="uint8")
VSM_LCKIE_LatC_Counter = Simulink.Signal(StorageClass="ExportedGlobal", DataType="uint8")
VSM_LCKIE_LongC_Couter3 = Simulink.Signal(StorageClass="ExportedGlobal", DataType="uint16")
VSM_LCKIE_POC_ObjLong = Simulink.Signal(StorageClass="ExportedGlobal", DataType="single")
VSM_LCKIE_POC_ObjTTC = Simulink.Signal(StorageClass="ExportedGlobal", DataType="single")
VSM_LCKIE_POC_Counter2 = Simulink.Signal(StorageClass="ExportedGlobal", DataType="uint8")
VSM_LCKIE_POC_POSObjID = Simulink.Signal(StorageClass="ExportedGlobal", DataType="uint8")
VSM_LCKIE_OFC_Counter1 = Simulink.Signal(StorageClass="ExportedGlobal", DataType="uint8")
VSM_LCKIE_OFC_ObjTTC = Simulink.Signal(StorageClass="ExportedGlobal", DataType="single")
VSM_LCKIE_LaneCurve = Simulink.Signal(StorageClass="ExportedGlobal", DataType="single")
VSM_LCKIE_LatC_LatWarning = Simulink.Signal(StorageClass="ExportedGlobal", DataType="uint8")
VSM_LCKIE_LatC_ObjLatFailFlg = Simulink.Signal(StorageClass="ExportedGlobal", DataType="uint8")
VSM_LCKIE_LatC_DisEgo2ObjOff = Simulink.Signal(StorageClass="ExportedGlobal", DataType="single")
VSM_LCKIE_LatC_DisREToLane = Simulink.Signal(StorageClass="ExportedGlobal", DataType="single")
VSM_LCKIE_LatC_SafDis = Simulink.Signal(StorageClass="ExportedGlobal", DataType="single")
VSM_LCKIE_POC_POCObjLong = Simulink.Signal(StorageClass="ExportedGlobal", DataType="single")
VSM_LCKIE_POC_POCObjTTC = Simulink.Signal(StorageClass="ExportedGlobal", DataType="single")
VSM_LCKIE_POC_Couter2 = Simulink.Signal(StorageClass="ExportedGlobal", DataType="uint8")
VSM_LCKIE_LatC_LatMovDis = Simulink.Signal(StorageClass="ExportedGlobal", DataType="single")
VSM_LCKIE_State = Simulink.Signal(StorageClass="ExportedGlobal", DataType="uint8")
VSM_LCKIE_State_Lanecurve_Ready2Idel = Simulink.Signal(StorageClass="ExportedGlobal", DataType="boolean")
VSM_LCKIE_State_LaneWidth_Ready2Idel = Simulink.Signal(StorageClass="ExportedGlobal", DataType="boolean")
VSM_LCKIE_State_wiper_Ready2Idel = Simulink.Signal(StorageClass="ExportedGlobal", DataType="boolean")
VSM_LCKIE_State_lamb_Ready2Idel = Simulink.Signal(StorageClass="ExportedGlobal", DataType="boolean")
VSM_LCKIE_State_detaspd_Ready2Idel = Simulink.Signal(StorageClass="ExportedGlobal", DataType="boolean")
VSM_LCKIE_State_HWASts_Ready2Active = Simulink.Signal(StorageClass="ExportedGlobal", DataType="boolean")
VSM_LCKIE_DelayReady = Simulink.Signal(StorageClass="ExportedGlobal", DataType="uint8")

LCKIE_Lane = Simulink.Bus()
  Left_A0: single
  Left_A1: single
  Left_A2: single
  Left_A3: single
  Left_Valid: boolean
  Right_A0: single
  Right_A1: single
  Right_A2: single
  Right_A3: single
  Right_Valid: boolean
  LeftRE_A0: single
  LeftRE_A1: single
  LeftRE_A2: single
  LeftRE_A3: single
  LeftRE_Valid: boolean
  RightRE_A0: single
  RightRE_A1: single
  RightRE_A2: single
  RightRE_A3: single
  RightRE_Valid: boolean
  LaneCurve: single
  LeftChange: boolean
  RightChange: boolean

VSM_LCKIE_SubModel_VERSION = Simulink.Signal(StorageClass="ExportedGlobal", DataType="uint32")
VSM_LCKIE_SubModel_Number = Simulink.Signal(StorageClass="ExportedGlobal", DataType="uint16")
VSM_LCKIE_OS_DisEgo2Obj = Simulink.Signal(StorageClass="ExportedGlobal", DataType="single")
P_VSM_LCKIE_ORC_LatDis = Simulink.Parameter(1.8, StorageClass="ExportedGlobal", DataType="single")
P_VSM_LCKIE_ORC_LowSpd = Simulink.Parameter(-5, StorageClass="ExportedGlobal", DataType="single")
P_VSM_LCKIE_OFC_DownTTC = Simulink.Parameter(5, StorageClass="ExportedGlobal", DataType="single")
P_VSM_LCKIE_OFC_DownDis = Simulink.Parameter(10, StorageClass="ExportedGlobal", DataType="single")
P_VSM_LCKIE_ORC_LimitDis2 = Simulink.Parameter(-10, StorageClass="ExportedGlobal", DataType="single")
P_VSM_LCKIE_Laneoffset_BP = Simulink.Parameter([60 80 100 110 120], StorageClass="ExportedGlobal", DataType="single")
P_VSM_LCKIE_State_CurveMax = Simulink.Parameter(0.005, StorageClass="ExportedGlobal", DataType="single")
P_VSM_LCKIE_LATC_LimitDis_BP = Simulink.Parameter([0 0.1 0.2 0.3 0.4], StorageClass="ExportedGlobal", DataType="single")
VSM_LCKIE_LatC_latmovori = Simulink.Signal(StorageClass="ExportedGlobal", DataType="single")
VSM_LCKIE_LatC_DetaDis = Simulink.Signal(StorageClass="ExportedGlobal", DataType="single")
VSM_LCKIE_LatC_Flg = Simulink.Signal(StorageClass="ExportedGlobal", DataType="uint8")
P_VSM_LCKIE_LATC_LimitDis = Simulink.Parameter([0.2 0.2 0.2 0.1 0.1], StorageClass="ExportedGlobal", DataType="single")
P_VSM_LCKIE_LongC_d1 = Simulink.Parameter(repmat(10, 1, 6), StorageClass="ExportedGlobal", DataType="single")
P_VSM_LCKIE_LongC_d2 = Simulink.Parameter([30 30 60], StorageClass="ExportedGlobal")
P_VSM_LCKIE_Laneoffset = Simulink.Parameter(repmat(0.3, 1, 5), StorageClass="ExportedGlobal", DataType="single")
VSM_LCKIE_LatC_tdisOR = Simulink.Signal(StorageClass="ExportedGlobal", DataType="single")
VSM_LCKIE_LatC_tdis = Simulink.Signal(StorageClass="ExportedGlobal", DataType="single")
VSM_LCKIE_LatC_ts = Simulink.Signal(StorageClass="ExportedGlobal", DataType="single")
P_VSM_LCKIE_State_CurveMin = Simulink.Parameter(0.005555556, StorageClass="ExportedGlobal", DataType="single")
P_VSM_LCKIE_ClassInput = Simulink.Parameter(0, StorageClass="ExportedGlobal", DataType="single")
P_VSM_LCKIE_STATE_ORCObjenable = Simulink.Parameter(0, StorageClass="ExportedGlobal", DataType="single")
P_VSM_LCKIE_LatC_DisSW = Simulink.Parameter(0, StorageClass="ExportedGlobal", DataType="single")
P_VSM_LCKIE_LatC_RESafDis = Simulink.Parameter(0.8, StorageClass="ExportedGlobal", DataType="single")