% Simulink data dictionary LCK.sldd

P_VSM_LCK_State_ESSSts_enable = Simulink.Parameter(1, StorageClass="ExportedGlobal")
VSM_LCK_Con_ESSSts_Idle2Ready = Simulink.Signal(StorageClass="ExportedGlobal")
VSM_LCK_Con_Lane_Idle2Ready = Simulink.Signal(StorageClass="ExportedGlobal", DataType="boolean")
VSM_LCK_Con_BrakePress_Active2Ready = Simulink.Signal(StorageClass="ExportedGlobal", DataType="boolean")
VSM_LCK_Con_OverRide_Active2Ready = Simulink.Signal(StorageClass="ExportedGlobal", DataType="boolean")
VSM_LCK_Con_AccPedalRate_Active2Ready = Simulink.Signal(StorageClass="ExportedGlobal", DataType="boolean")
VSM_LCK_Con_SteerWheelAngle_Active2Ready = Simulink.Signal(StorageClass="ExportedGlobal", DataType="boolean")
VSM_LCK_Con_DriverInput_Active2Ready = Simulink.Signal(StorageClass="ExportedGlobal", DataType="boolean")
VSM_LCK_Con_EpsSta_Active2Ready = Simulink.Signal(StorageClass="ExportedGlobal", DataType="boolean")
VSM_LCK_Con_LateralAcc_Active2Ready = Simulink.Signal(StorageClass="ExportedGlobal", DataType="boolean")
VSM_LCK_Con_LongitudeAcc_Active2Ready = Simulink.Signal(StorageClass="ExportedGlobal", DataType="boolean")
VSM_LCK_Con_CURRENT_GEAR_Active2Ready = Simulink.Signal(StorageClass="ExportedGlobal", DataType="boolean")
VSM_LCK_Con_YawRate_Ready2Idle = Simulink.Signal(StorageClass="ExportedGlobal", DataType="boolean")
VSM_LCK_Con_AbsEsp_Ready2Idle = Simulink.Signal(StorageClass="ExportedGlobal", DataType="boolean")
VSM_LCK_Con_HandsOff_Ready2Idle = Simulink.Signal(StorageClass="ExportedGlobal", DataType="boolean")
VSM_LCK_Con_Lane_Ready2Idle = Simulink.Signal(StorageClass="ExportedGlobal", DataType="boolean")
VSM_LCK_Con_VehicleSpd_Ready2Idle = Simulink.Signal(StorageClass="ExportedGlobal", DataType="boolean")
VSM_LCK_Idle2Ready = Simulink.Signal(StorageClass="ExportedGlobal", DataType="boolean")
VSM_LCK_Ready2Active = Simulink.Signal(StorageClass="ExportedGlobal", DataType="boolean")
VSM_LCK_Active2Ready = Simulink.Signal(StorageClass="ExportedGlobal", DataType="boolean")
VSM_LCK_Ready2Idle = Simulink.Signal(StorageClass="ExportedGlobal", DataType="boolean")
VSM_LCK_Active2Idle = Simulink.Signal(StorageClass="ExportedGlobal", DataType="boolean")
VSM_LCK_Con_AbsEsp_Idle2Ready = Simulink.Signal(StorageClass="ExportedGlobal", DataType="boolean")
VSM_LCK_Con_LaneChange_Active2Ready = Simulink.Signal(StorageClass="ExportedGlobal", DataType="boolean")
VSM_LCK_Con_LaneChange_Ready2Active = Simulink.Signal(StorageClass="ExportedGlobal", DataType="boolean")
VSM_LCK_Con_ESSSts_Ready2Idle = Simulink.Signal(StorageClass="ExportedGlobal", DataType="boolean")
P_VSM_LCK_State_Yawsup_enable = Simulink.Parameter(1, StorageClass="ExportedGlobal", DataType="single")
P_VSM_LCK_State_Handson_enable = Simulink.Parameter(1, StorageClass="ExportedGlobal", DataType="single")
P_VSM_LCK_State_Absesp_enable = Simulink.Parameter(1, StorageClass="ExportedGlobal", DataType="single")
P_VSM_LCK_State_Lane_enable = Simulink.Parameter(1, StorageClass="ExportedGlobal", DataType="single")
P_VSM_LCK_State_Vehspeed_enable = Simulink.Parameter(1, StorageClass="ExportedGlobal", DataType="single")
P_VSM_LCK_State_TurnLight_enable = Simulink.Parameter(1, StorageClass="ExportedGlobal", DataType="single")
P_VSM_LCK_State_SteerWheelSpd_enable = Simulink.Parameter(1, StorageClass="ExportedGlobal", DataType="single")
P_VSM_LCK_State_Breakpressure_enable = Simulink.Parameter(1, StorageClass="ExportedGlobal", DataType="single")
P_VSM_LCK_State_SteerWheelAngle_enable = Simulink.Parameter(1, StorageClass="ExportedGlobal", DataType="single")
P_VSM_LCK_State_DriverInputTrqValue_enable = Simulink.Parameter(1, StorageClass="ExportedGlobal", DataType="single")
P_VSM_LCK_State_LateralAcce_enable = Simulink.Parameter(1, StorageClass="ExportedGlobal", DataType="single")
P_VSM_LCK_State_LongitudeAcc_enable = Simulink.Parameter(1, StorageClass="ExportedGlobal", DataType="single")
P_VSM_LCK_State_GEAR_enable = Simulink.Parameter(1, StorageClass="ExportedGlobal", DataType="single")
P_VSM_LCK_State_Overide_enable = Simulink.Parameter(1, StorageClass="ExportedGlobal", DataType="single")
VSM_LCK_Con_LaneCurve_Ready2Idle = Simulink.Signal(StorageClass="ExportedGlobal", DataType="boolean")
VSM_LCK_Con_LaneCurve_Idle2Ready = Simulink.Signal(StorageClass="ExportedGlobal", DataType="boolean")
VSM_LCK_Warning = Simulink.Signal(StorageClass="ExportedGlobal")
VSM_LCK_Con_YawRate_Idle2Ready = Simulink.Signal(StorageClass="ExportedGlobal", DataType="boolean")
VSM_LCK_Con_Handson_Idle2Ready = Simulink.Signal(StorageClass="ExportedGlobal", DataType="boolean")
VSM_LCK_Con_Headingangle_Idle2Ready = Simulink.Signal(StorageClass="ExportedGlobal", DataType="boolean")
VSM_LCK_Con_VehicleSpd_Idle2Ready = Simulink.Signal(StorageClass="ExportedGlobal", DataType="boolean")
VSM_LCK_Con_TurnLight_Ready2Active = Simulink.Signal(StorageClass="ExportedGlobal", DataType="boolean")
VSM_LCK_Con_SteerAngleSpd_Ready2Active = Simulink.Signal(StorageClass="ExportedGlobal", DataType="boolean")
VSM_LCK_Con_BrakePress_Ready2Active = Simulink.Signal(StorageClass="ExportedGlobal", DataType="boolean")
VSM_LCK_Con_AccPedalRate_Ready2Active = Simulink.Signal(StorageClass="ExportedGlobal", DataType="boolean")
VSM_LCK_Con_SteerWheelAngle_Ready2Active = Simulink.Signal(StorageClass="ExportedGlobal", DataType="boolean")
VSM_LCK_Con_DrvInputTrqValue_Ready2Active = Simulink.Signal(StorageClass="ExportedGlobal", DataType="boolean")
VSM_LCK_Con_LateralAcc_Ready2Active = Simulink.Signal(StorageClass="ExportedGlobal", DataType="boolean")
VSM_LCK_Con_LongitudeAcc_Ready2Active = Simulink.Signal(StorageClass="ExportedGlobal", DataType="boolean")
VSM_LCK_Con_CURRENT_GEAR_Ready2Active = Simulink.Signal(StorageClass="ExportedGlobal", DataType="boolean")
VSM_LCK_Con_OverRide_Ready2Active = Simulink.Signal(StorageClass="ExportedGlobal", DataType="boolean")
VSM_LCK_Con_EpsSts_Ready2Active = Simulink.Signal(StorageClass="ExportedGlobal", DataType="boolean")
VSM_LCK_Con_TurnLight_Active2Ready = Simulink.Signal(StorageClass="ExportedGlobal", DataType="boolean")
VSM_LCK_Con_SteerAngleSpd_Active2Ready = Simulink.Signal(StorageClass="ExportedGlobal", DataType="boolean")
VSM_LCKState = Simulink.Signal(StorageClass="ExportedGlobal", DataType="uint8")
P_VSM_LCK_LaneDouble = Simulink.Parameter(1, StorageClass="ExportedGlobal", DataType="single")

LCK_STATE = enum(DefaultValue="LCK_Off", StorageType="uint8", AddClassNameToEnumNames=true)
  LCK_Off = 0
  LCK_Idle = 1
  LCK_Ready = 2
  LCK_Active = 3
  LCK_Error = 7

VSM_LCK_Con_TJALane_Idle2Ready = Simulink.Signal(StorageClass="ExportedGlobal")
VSM_LCK_Con_TJALane_Ready2Idle = Simulink.Signal(StorageClass="ExportedGlobal")
VSM_LCK_Counter = Simulink.Signal(StorageClass="ExportedGlobal", DataType="uint8")
VSM_LCK_Con_TargetLaneIn_Idle2Ready = Simulink.Signal(StorageClass="ExportedGlobal", DataType="boolean")
VSM_LCK_VERSION = Simulink.Signal(StorageClass="ExportedGlobal", DataType="uint32")
P_VSM_LCK_State_TargetLaneIn_enable = Simulink.Parameter(1, StorageClass="ExportedGlobal", DataType="single")
VSM_LCK_Con_LSMLine_Idle2Ready = Simulink.Signal(StorageClass="ExportedGlobal", DataType="boolean")
VSM_LCK_Con_LSMLine_Ready2Idle = Simulink.Signal(StorageClass="ExportedGlobal", DataType="boolean")
P_VSM_LCK_State_LSMLine_enable = Simulink.Parameter(1, StorageClass="ExportedGlobal", DataType="single")
VSM_LCK_TJAActive2Ready = Simulink.Signal(StorageClass="ExportedGlobal", DataType="boolean")
VSM_LCK_TJAReady2Active = Simulink.Signal(StorageClass="ExportedGlobal", DataType="boolean")
P_VSM_LCK_State_ReadyInTime_enable = Simulink.Parameter(1, StorageClass="ExportedGlobal", DataType="single")
VSM_LCK_Con_InTime_Idle2Ready = Simulink.Signal(StorageClass="ExportedGlobal", DataType="boolean")
VSM_LCK_Con_InTime_Ready2Active = Simulink.Signal(StorageClass="ExportedGlobal", DataType="boolean")
P_VSM_LCK_IdleInTime = Simulink.Parameter(2, StorageClass="ExportedGlobal", DataType="single")
P_VSM_LCK_State_IdleInTime_enable = Simulink.Parameter(0, StorageClass="ExportedGlobal", DataType="single")
P_VSM_LCK_AccrPelRateOut = Simulink.Parameter(0, StorageClass="ExportedGlobal")
P_VSM_LCK_LCOverrideValue = Simulink.Parameter(1.5, StorageClass="ExportedGlobal")
P_VSM_LCK_LCOverrideTime = Simulink.Parameter(0.6, StorageClass="ExportedGlobal")
VSM_TJALCKState = Simulink.Signal(StorageClass="ExportedGlobal")
VSM_LCK_Con_TJAVehicleSpd_Idle2Ready = Simulink.Signal(StorageClass="ExportedGlobal", DataType="boolean")
VSM_LCK_TJAIdle2Ready = Simulink.Signal(StorageClass="ExportedGlobal", DataType="boolean")
P_VSM_LCK_State_LaneCurve_enable = Simulink.Parameter(0, StorageClass="ExportedGlobal", DataType="single")
P_VSM_LCK_AccRateIn = Simulink.Parameter(30, StorageClass="ExportedGlobal")
P_VSM_LCK_AccRateOut = Simulink.Parameter(80, StorageClass="ExportedGlobal")
P_VSM_LCK_YawRateIn = Simulink.Parameter(0.2, StorageClass="ExportedGlobal")
P_VSM_LCK_YawRateOut = Simulink.Parameter(0.25, StorageClass="ExportedGlobal")
P_VSM_LCK_YawRateInTime = Simulink.Parameter(1, StorageClass="ExportedGlobal")
P_VSM_LCK_AbsEspInTime = Simulink.Parameter(3, StorageClass="ExportedGlobal")
P_VSM_LCK_SteerAngleSpdIn = Simulink.Parameter(150, StorageClass="ExportedGlobal")
P_VSM_LCK_SteerAngleSpdInTime = Simulink.Parameter(3, StorageClass="ExportedGlobal")
P_VSM_LCK_BrakePressIn = Simulink.Parameter(3, StorageClass="ExportedGlobal")
P_VSM_LCK_BrakePressInTime = Simulink.Parameter(1.5, StorageClass="ExportedGlobal")
P_VSM_LCK_AccRateInTime = Simulink.Parameter(1.5, StorageClass="ExportedGlobal")
P_VSM_LCK_SteerWheelAngleIn = Simulink.Parameter(70, StorageClass="ExportedGlobal")
P_VSM_LCK_SteerWheelAngleInTime = Simulink.Parameter(3, StorageClass="ExportedGlobal")
P_VSM_LCK_DrvInputTrqValueIn = Simulink.Parameter(2, StorageClass="ExportedGlobal")
P_VSM_LCK_DrvInputTrqValueInTime = Simulink.Parameter(3, StorageClass="ExportedGlobal")
P_VSM_LCK_LateralAcceInTime = Simulink.Parameter(3, StorageClass="ExportedGlobal")
P_VSM_LCK_LongitudeAccIn = Simulink.Parameter(3, StorageClass="ExportedGlobal")
P_VSM_LCK_LongitudeAccInTime = Simulink.Parameter(3, StorageClass="ExportedGlobal")
P_VSM_LCK_absLongitudeAccIn = Simulink.Parameter(2.5, StorageClass="ExportedGlobal")
P_VSM_LCK_OverrideInTime = Simulink.Parameter(3, StorageClass="ExportedGlobal")
P_VSM_LCK_SteerAngleSpdOut = Simulink.Parameter(200, StorageClass="ExportedGlobal")
P_VSM_LCK_BrakePressOut = Simulink.Parameter(5, StorageClass="ExportedGlobal")
P_VSM_LCK_OverrideValue = Simulink.Parameter(1.2, StorageClass="ExportedGlobal")
P_VSM_LCK_OverrideTime = Simulink.Parameter(0.3, StorageClass="ExportedGlobal")
P_VSM_LCK_SteerWheelAngleOut = Simulink.Parameter(90, StorageClass="ExportedGlobal")
P_VSM_LCK_DrvInputTrqValueOut = Simulink.Parameter(2.3, StorageClass="ExportedGlobal")
P_VSM_LCK_LongitudeAccOut = Simulink.Parameter(3.5, StorageClass="ExportedGlobal")
P_VSM_LCK_absLongitudeAccOut = Simulink.Parameter(3, StorageClass="ExportedGlobal")
P_VSM_LCK_Warnarea1 = Simulink.Parameter(-0.55, StorageClass="ExportedGlobal")
P_VSM_LCK_Warnarea2 = Simulink.Parameter(-0.35, StorageClass="ExportedGlobal")
P_VSM_LCK_WarnInTime = Simulink.Parameter(2, StorageClass="ExportedGlobal")
P_VSM_LCK_AccrPelOut = Simulink.Parameter(30, StorageClass="ExportedGlobal")
P_VSM_LCK_LCDrvInputTrqValueOut = Simulink.Parameter(3, StorageClass="ExportedGlobal")
VSM_LCK_Con_TJA_Active2Ready = Simulink.Signal(StorageClass="ExportedGlobal")
VSM_LCK_Con_TJA_Ready2Active = Simulink.Signal(StorageClass="ExportedGlobal", DataType="boolean")
VSM_LCK_TJAReady2Idle = Simulink.Signal(StorageClass="ExportedGlobal", DataType="boolean")
VSM_LCK_Con_TJAVehicleSpd_Ready2Idle = Simulink.Signal(StorageClass="ExportedGlobal", DataType="boolean")
VSM_LCK_Con_TJAHandson_Idle2Ready = Simulink.Signal(StorageClass="ExportedGlobal", DataType="boolean")
VSM_LCK_TargetLaneIn_A1 = Simulink.Signal(DataType="boolean")
VSM_LCK_TargetLaneIn_A0 = Simulink.Signal(StorageClass="ExportedGlobal", DataType="boolean")

LaneARe_SP_LCK = Simulink.Bus()
  Left_Valid: boolean
  Left_A3: single
  Left_A2: single
  Left_A1: single
  Left_A0: single
  Left_Range: single
  Left_Type: uint8
  Right_Valid: boolean
  Right_A3: single
  Right_A2: single
  Right_A1: single
  Right_A0: single
  Right_Range: single
  Right_Type: uint8
  LeftRE_Valid: boolean
  LeftRE_A3: single
  LeftRE_A2: single
  LeftRE_A1: single
  LeftRE_A0: single
  LeftRE_Range: single
  RightRE_Valid: boolean
  RightRE_A3: single
  RightRE_A2: single
  RightRE_A1: single
  RightRE_A0: single
  RightRE_Range: single
  LeftValid_A0: single
  LeftValid_A1: single
  LeftValid_A2: single
  LeftValid_A3: single
  LeftValid_Range: single
  LeftValid_Valid: boolean
  LeftValid_Type: uint8
  RightValid_A0: single
  RightValid_A1: single
  RightValid_A2: single
  RightValid_A3: single
  RightValid_Range: single
  RightValid_Valid: boolean
  RightValid_Type: uint8
  DeltaY: single
  T_A0: single
  T_A1: single
  T_A2: single
  T_A3: single
  T_Range: single
  T_Valid: boolean
  C_Lanewidth: single
  LeftChange: boolean
  RightChange: boolean
  Host_LRE: boolean
  Host_RRE: boolean
  LaneCurve: single
  HeadingAngle_In: boolean
  HeadingAngle_Out: boolean
  Left_LaneRe30: single
  Right_LaneRe30: single
  Scene_LaneValid: single
  LDWLKAELK_LWidth: single
  laneCenterA0: single
  laneCenterA1: single
  laneCenterA2: single
  laneCenterA3: single
  laneCenterValid: boolean
  Left_LaneValid: boolean
  Right_LaneValid: boolean
  Left_ReValid: boolean
  Right_ReValid: boolean
  Left_LaneOp_A0: single
  Right_LaneOp_A0: single
  Left_ReOp_A0: single
  Right_ReOp_A0: single
  Signal_Lane1: single
  Signal_Lane2: single
  Signal_Lane3: single
  Left_Lane_A1: single
  Right_Lane_A1: single
  Left_Re_A1: single
  Right_Re_A1: single

P_VSM_LCK_State_Accpedalrate_enable = Simulink.Parameter(0, StorageClass="ExportedGlobal", DataType="single")
P_VSM_LCK_PreTime = Simulink.Parameter(0.2, StorageClass="ExportedGlobal")
P_VSM_LCK_T1 = Simulink.Parameter(15, StorageClass="ExportedGlobal")
P_VSM_LCK_T0 = Simulink.Parameter(0.75, StorageClass="ExportedGlobal")
P_VSM_LCK_State_Eps_enable = Simulink.Parameter(1, StorageClass="ExportedGlobal", DataType="single")
P_VSM_LCK_LateralAcceIn = Simulink.Parameter(3, StorageClass="ExportedGlobal")
P_VSM_LCK_LateralAcceOut = Simulink.Parameter(3.5, StorageClass="ExportedGlobal")
VSM_LCK_SubModel_VERSION = Simulink.Signal()
VSM_LCK_SubModel_Number = Simulink.Signal()
VSM_SteerAngOffsetInit = Simulink.Signal(StorageClass="ExportedGlobal")
VSM_SteerAngleOffset_deg = Simulink.Signal(StorageClass="ExportedGlobal")
P_VSM_LCK_State_LaneChange_enable = Simulink.Parameter(1, StorageClass="ExportedGlobal")
VSM_LCK_preDis = Simulink.Signal(StorageClass="ExportedGlobal")
VSM_LCK_dypre = Simulink.Signal(StorageClass="ExportedGlobal")
P_VSM_LCK_dypreFactor = Simulink.Parameter(1, StorageClass="ExportedGlobal")
VSM_LCK_dypreoffset = Simulink.Signal(StorageClass="ExportedGlobal")
P_VSM_LCK_LanechangeSwitch = Simulink.Parameter(0, StorageClass="ExportedGlobal")
VSM_LCK_TargetLaneIn = Simulink.Signal(StorageClass="ExportedGlobal")
VSM_LCK_dy0 = Simulink.Signal(StorageClass="ExportedGlobal")
P_VSM_LCK_C0 = Simulink.Parameter(0.4, StorageClass="ExportedGlobal")
P_VSM_LCK_State_Param_LaneCurve_Offset = Simulink.Parameter([0 0.1 0.2 0.3], StorageClass="ExportedGlobal")
P_VSM_LCK_State_Param_LaneCurve = Simulink.Parameter([0.001 0.00125 0.00167 0.05], StorageClass="ExportedGlobal")
P_VSM_LCK_TargetInSwitch = Simulink.Parameter(0, StorageClass="ExportedGlobal")
VSM_LCK_TargetLaneIn2 = Simulink.Signal(StorageClass="ExportedGlobal")
P_VSM_LCK_State_Param_LaneWidth_Offset = Simulink.Parameter([-0.27 -0.16 -0.05 0.07 0.17 0.28 0.4], StorageClass="ExportedGlobal")
P_VSM_LCK_State_Param_LaneWidth = Simulink.Parameter([2.5 3 3.5 4 4.5 5 5.5], StorageClass="ExportedGlobal")
VSM_LCK_Lanewidth = Simulink.Signal(StorageClass="ExportedGlobal")
P_VSM_LCK_Lanewidthswitch = Simulink.Parameter(1, StorageClass="ExportedGlobal")
P_VSM_LCK_ParamA1 = Simulink.Parameter([0 0 0 0])
P_VSM_LCK_A1 = Simulink.Parameter(15, StorageClass="ExportedGlobal")