% Simulink data dictionary LDW.sldd

P_VSM_LDW_State_ESSSts_enable = Simulink.Parameter(1, StorageClass="ExportedGlobal")
VSM_LDW_Idle2Ready = Simulink.Signal(StorageClass="ExportedGlobal", DataType="boolean")
VSM_LDW_Con_YawRate_Idle2Ready = Simulink.Signal(StorageClass="ExportedGlobal", DataType="boolean")
VSM_LDW_Con_AbsEsp_Idle2Ready = Simulink.Signal(StorageClass="ExportedGlobal", DataType="boolean")
VSM_LDW_Con_Headingangle_Idle2Ready = Simulink.Signal(StorageClass="ExportedGlobal", DataType="boolean")
VSM_LDW_Con_Failsafe_Idle2Ready = Simulink.Signal(StorageClass="ExportedGlobal", DataType="boolean")
VSM_LDW_Con_LaneCurve_Idle2Ready = Simulink.Signal(StorageClass="ExportedGlobal", DataType="boolean")
VSM_LDW_Con_Lane_Idle2Ready = Simulink.Signal(StorageClass="ExportedGlobal", DataType="boolean")
VSM_LDW_Con_VehicleSpeed_Idle2Ready = Simulink.Signal(StorageClass="ExportedGlobal", DataType="boolean")
VSM_LDW_Con_SteerWheelAngle_Ready2Active = Simulink.Signal(StorageClass="ExportedGlobal", DataType="boolean")
VSM_LDW_Con_SteerWheelSpd_Ready2Active = Simulink.Signal(StorageClass="ExportedGlobal", DataType="boolean")
VSM_LDW_Con_LateralAcc_Ready2Active = Simulink.Signal(StorageClass="ExportedGlobal", DataType="boolean")
VSM_LDW_Con_LongitudeAcc_Ready2Active = Simulink.Signal(StorageClass="ExportedGlobal", DataType="boolean")
VSM_LDW_Con_AccPedalRate_Ready2Active = Simulink.Signal(StorageClass="ExportedGlobal", DataType="boolean")
VSM_LDW_Con_CURRENT_GEAR_Ready2Active = Simulink.Signal(StorageClass="ExportedGlobal", DataType="boolean")
VSM_LDW_Con_TurnLight_Ready2Active = Simulink.Signal(StorageClass="ExportedGlobal", DataType="boolean")
VSM_LDW_Con_LaneChange_Ready2Active = Simulink.Signal(StorageClass="ExportedGlobal", DataType="boolean")
VSM_LDW_Con_SteerWheelAngle_Active2Ready = Simulink.Signal(StorageClass="ExportedGlobal", DataType="boolean")
VSM_LDW_Con_SteerWheelSpd_Active2Ready = Simulink.Signal(StorageClass="ExportedGlobal", DataType="boolean")
VSM_LDW_Con_LateralAcc_Active2Ready = Simulink.Signal(StorageClass="ExportedGlobal", DataType="boolean")
VSM_LDW_Con_LongitudeAcc_Active2Ready = Simulink.Signal(StorageClass="ExportedGlobal", DataType="boolean")
VSM_LDW_Con_BrakePressure_Active2Ready = Simulink.Signal(StorageClass="ExportedGlobal", DataType="boolean")
VSM_LDW_Con_AccPedalRate_Active2Ready = Simulink.Signal(StorageClass="ExportedGlobal", DataType="boolean")
VSM_LDW_Con_CURRENT_GEAR_Active2Ready = Simulink.Signal(StorageClass="ExportedGlobal", DataType="boolean")
VSM_LDW_Con_TurnLight_Active2Ready = Simulink.Signal(StorageClass="ExportedGlobal", DataType="boolean")
VSM_LDW_Con_LaneChange_Active2Ready = Simulink.Signal(StorageClass="ExportedGlobal", DataType="boolean")
VSM_LDW_Other2Idle = Simulink.Signal(StorageClass="ExportedGlobal", DataType="boolean")
VSM_LDW_Active2Ready = Simulink.Signal(StorageClass="ExportedGlobal", DataType="boolean")
VSM_LDW_Ready2Active = Simulink.Signal(StorageClass="ExportedGlobal", DataType="boolean")
VSM_LDW_Con_Lane_Ready2Idle = Simulink.Signal(StorageClass="ExportedGlobal", DataType="boolean")
VSM_LDW_Con_VehicleSpeed_Ready2Idle = Simulink.Signal(StorageClass="ExportedGlobal", DataType="boolean")
VSM_LDW_Con_YawRate_Ready2Idle = Simulink.Signal(StorageClass="ExportedGlobal", DataType="boolean")
VSM_LDW_Con_AbsEsp_Ready2Idle = Simulink.Signal(StorageClass="ExportedGlobal", DataType="boolean")
VSM_LDW_Con_Failsafe_Ready2Idle = Simulink.Signal(StorageClass="ExportedGlobal", DataType="boolean")
VSM_LDW_Con_LaneCurve_Ready2Idle = Simulink.Signal(StorageClass="ExportedGlobal", DataType="boolean")
VSM_LDW_Con_Headingangle_Ready2Idle = Simulink.Signal(StorageClass="ExportedGlobal", DataType="boolean")
VSM_LDW_Con_BrakePressure_Ready2Active = Simulink.Signal(StorageClass="ExportedGlobal", DataType="boolean")
VSM_LDW_Con_ESSSts_Idle2Ready = Simulink.Signal(StorageClass="ExportedGlobal", DataType="boolean")
VSM_LDW_Con_ESSSts_Ready2Idle = Simulink.Signal(StorageClass="ExportedGlobal", DataType="boolean")
P_VSM_LDW_State_Yawsup_enable = Simulink.Parameter(1, StorageClass="ExportedGlobal", DataType="single")
P_VSM_LDW_State_Absesp_enable = Simulink.Parameter(1, StorageClass="ExportedGlobal", DataType="single")
P_VSM_LDW_State_Headingangle_enable = Simulink.Parameter(1, StorageClass="ExportedGlobal", DataType="single")
P_VSM_LDW_State_Failsafe_enable = Simulink.Parameter(1, StorageClass="ExportedGlobal", DataType="single")
P_VSM_LDW_State_Lanecurve_enable = Simulink.Parameter(1, StorageClass="ExportedGlobal", DataType="single")
P_VSM_LDW_State_Lane_enable = Simulink.Parameter(1, StorageClass="ExportedGlobal", DataType="single")
P_VSM_LDW_State_Vehspeed_enable = Simulink.Parameter(1, StorageClass="ExportedGlobal", DataType="single")
P_VSM_LDW_State_SteerWheelAngle_enable = Simulink.Parameter(1, StorageClass="ExportedGlobal", DataType="single")
P_VSM_LDW_State_DriverInputTrqValue_enable = Simulink.Parameter(1, StorageClass="ExportedGlobal", DataType="single")
P_VSM_LDW_State_SteerWheelSpd_enable = Simulink.Parameter(1, StorageClass="ExportedGlobal", DataType="single")
P_VSM_LDW_State_LateralAcce_enable = Simulink.Parameter(1, StorageClass="ExportedGlobal", DataType="single")
P_VSM_LDW_State_LongitudeAcc_enable = Simulink.Parameter(1, StorageClass="ExportedGlobal", DataType="single")
P_VSM_LDW_State_Breakpressure_enable = Simulink.Parameter(1, StorageClass="ExportedGlobal", DataType="single")
P_VSM_LDW_State_GEAR_enable = Simulink.Parameter(1, StorageClass="ExportedGlobal", DataType="single")
P_VSM_LDW_State_TurnLight_enable = Simulink.Parameter(1, StorageClass="ExportedGlobal", DataType="single")
P_VSM_LDW_State_LaneChange_enable = Simulink.Parameter(1, StorageClass="ExportedGlobal", DataType="single")
P_VSM_LDW_State_Param_WarningZoneIn = Simulink.Parameter(0.2, StorageClass="ExportedGlobal", DataType="single")
P_VSM_LDW_State_Param_WarningZoneOut = Simulink.Parameter(-0.65, StorageClass="ExportedGlobal", DataType="single")
P_VSM_LDW_State_Param_LaneWidth_Offset = Simulink.Parameter([-0.2 -0.1 0 0.1 0.2 0.3 0.4], StorageClass="ExportedGlobal", DataType="single")
P_VSM_LDW_State_Param_Sensitive_Offset = Simulink.Parameter([0 0.2 -0.2], StorageClass="ExportedGlobal", DataType="single")
P_VSM_LDW_State_Param_REWarningZoneIn = Simulink.Parameter(0.35, StorageClass="ExportedGlobal", DataType="single")
VSM_LDW_Leftwarnflag = Simulink.Signal(StorageClass="ExportedGlobal", DataType="single")
VSM_LDW_wCount = Simulink.Signal(StorageClass="ExportedGlobal", DataType="single")
VSM_LDW_Count = Simulink.Signal(StorageClass="ExportedGlobal", DataType="single")
VSM_LDW_Rightwarnflag = Simulink.Signal(StorageClass="ExportedGlobal", DataType="single")
P_VSM_LDW_State_Param_LaneTime = Simulink.Parameter(repmat(0.7, 1, 16), StorageClass="ExportedGlobal", DataType="single")
P_VSM_LDW_State_Param_Speed = Simulink.Parameter([0 5 10 15 20 25 30 35 40 60 70 80 90 100 120 140], StorageClass="ExportedGlobal", DataType="single")
VSM_LDWSts = Simulink.Signal(StorageClass="ExportedGlobal", DataType="uint8")
VSM_LDW_Counter = Simulink.Signal(StorageClass="ExportedGlobal", DataType="uint8")
VSM_LDW_VERSION = Simulink.Signal(StorageClass="ExportedGlobal", DataType="uint32")
P_VSM_LDW_AccRateOutTime = Simulink.Parameter(0, StorageClass="SimulinkGlobal")
P_VSM_LDW_AccPedalOut = Simulink.Parameter(30, StorageClass="ExportedGlobal")
P_VSM_LDW_LaneCurveOut = Simulink.Parameter(0.006, StorageClass="ExportedGlobal")
P_VSM_LDW_YawRateOut = Simulink.Parameter(0.25, StorageClass="ExportedGlobal")
P_VSM_LDW_BrakePressOut = Simulink.Parameter(5, StorageClass="ExportedGlobal")
P_VSM_LDW_absLongitudeAccOut = Simulink.Parameter(3, StorageClass="ExportedGlobal")
P_VSM_LDW_LongitudeAccOut = Simulink.Parameter(3.5, StorageClass="ExportedGlobal")
P_VSM_LDW_LateralAcceOut = Simulink.Parameter(3.5, StorageClass="ExportedGlobal")
P_VSM_LDW_SteerWheelSpdOut = Simulink.Parameter(200, StorageClass="ExportedGlobal")
P_VSM_LDW_SteerWheelAngleOut = Simulink.Parameter(90, StorageClass="ExportedGlobal")
P_VSM_LDW_WhelDy = Simulink.Parameter(2, StorageClass="ExportedGlobal")
P_VSM_LDW_TurnLightInTime = Simulink.Parameter(3, StorageClass="ExportedGlobal")
P_VSM_LDW_BrakePressInTime = Simulink.Parameter(1.5, StorageClass="ExportedGlobal")
P_VSM_LDW_BrakePressIn = Simulink.Parameter(3, StorageClass="ExportedGlobal")
P_VSM_LDW_LongitudeAccInTime = Simulink.Parameter(3, StorageClass="ExportedGlobal")
P_VSM_LDW_absLongitudeAccIn = Simulink.Parameter(2.5, StorageClass="ExportedGlobal")
P_VSM_LDW_LongitudeAccIn = Simulink.Parameter(3, StorageClass="ExportedGlobal")
P_VSM_LDW_LateralAcceInTime = Simulink.Parameter(3, StorageClass="ExportedGlobal")
P_VSM_LDW_LateralAcceIn = Simulink.Parameter(3, StorageClass="ExportedGlobal")
P_VSM_LDW_SteerWheelSpdInTime = Simulink.Parameter(3, StorageClass="ExportedGlobal")
P_VSM_LDW_SteerWheelSpdIn = Simulink.Parameter(150, StorageClass="ExportedGlobal")
P_VSM_LDW_SteerWheelAngleInTime = Simulink.Parameter(3, StorageClass="ExportedGlobal")
P_VSM_LDW_SteerWheelAngleIn = Simulink.Parameter(70, StorageClass="ExportedGlobal")
P_VSM_LDW_LaneCurveIn = Simulink.Parameter(0.005, StorageClass="ExportedGlobal")
P_VSM_LDW_AbsEspInTime = Simulink.Parameter(3, StorageClass="ExportedGlobal")
P_VSM_LDW_YawRateInTime = Simulink.Parameter(1, StorageClass="ExportedGlobal")
P_VSM_LDW_YawRateIn = Simulink.Parameter(0.2, StorageClass="ExportedGlobal")
P_VSM_LDW_AccRateInTime = Simulink.Parameter(1.5, StorageClass="ExportedGlobal")
P_VSM_LDW_AccRateIn = Simulink.Parameter(30, StorageClass="ExportedGlobal")
P_VSM_LDW_AccRateOut = Simulink.Parameter(80, StorageClass="ExportedGlobal")

LaneARe_SP_LDW = Simulink.Bus()
  Left_Valid: boolean
  Left_A3: single
  Left_A2: single
  Left_A1: single
  Left_A0: single
  Left_Range: single
  Left_Type: uint8
  Right_Valid: boolean
  Right_A3: single
  Right_A2: single
  Right_A1: single
  Right_A0: single
  Right_Range: single
  Right_Type: uint8
  LeftRE_Valid: boolean
  LeftRE_A3: single
  LeftRE_A2: single
  LeftRE_A1: single
  LeftRE_A0: single
  LeftRE_Range: single
  RightRE_Valid: boolean
  RightRE_A3: single
  RightRE_A2: single
  RightRE_A1: single
  RightRE_A0: single
  RightRE_Range: single
  LeftValid_A0: single
  LeftValid_A1: single
  LeftValid_A2: single
  LeftValid_A3: single
  LeftValid_Range: single
  LeftValid_Valid: boolean
  LeftValid_Type: uint8
  RightValid_A0: single
  RightValid_A1: single
  RightValid_A2: single
  RightValid_A3: single
  RightValid_Range: single
  RightValid_Valid: boolean
  RightValid_Type: uint8
  DeltaY: single
  T_A0: single
  T_A1: single
  T_A2: single
  T_A3: single
  T_Range: single
  T_Valid: boolean
  C_Lanewidth: single
  LeftChange: boolean
  RightChange: boolean
  Host_LRE: boolean
  Host_RRE: boolean
  LaneCurve: single
  HeadingAngle_In: boolean
  HeadingAngle_Out: boolean
  Left_LaneRe30: single
  Right_LaneRe30: single
  Scene_LaneValid: single
  LDWLKAELK_LWidth: single
  laneCenterA0: single
  laneCenterA1: single
  laneCenterA2: single
  laneCenterA3: single
  laneCenterValid: boolean
  Left_LaneValid: boolean
  Right_LaneValid: boolean
  Left_ReValid: boolean
  Right_ReValid: boolean
  Left_LaneOp_A0: single
  Right_LaneOp_A0: single
  Left_ReOp_A0: single
  Right_ReOp_A0: single
  Signal_Lane1: single
  Signal_Lane2: single
  Signal_Lane3: single
  Left_Lane_A1: single
  Right_Lane_A1: single
  Left_Re_A1: single
  Right_Re_A1: single

P_VSM_LDW_State_Accpedalrate_enable = Simulink.Parameter(1, StorageClass="ExportedGlobal", DataType="single")
P_VSM_LDW_LaneChangeOffset = Simulink.Parameter(0.11, StorageClass="ExportedGlobal")
VSM_LDW_Error = Simulink.Signal(StorageClass="ExportedGlobal")
VSM_LDW_SubModel_VERSION = Simulink.Signal()
VSM_LDW_SubModel_Number = Simulink.Signal()