% Simulink data dictionary LKA.sldd

P_VSM_LKA_State_ESSSts_enable = Simulink.Parameter(1, StorageClass="ExportedGlobal")
VSM_LKA_Idle2Ready = Simulink.Signal(StorageClass="ExportedGlobal", DataType="boolean")
VSM_LKA_Ready2Active = Simulink.Signal(StorageClass="ExportedGlobal", DataType="boolean")
VSM_LKA_Active2Ready = Simulink.Signal(StorageClass="ExportedGlobal", DataType="boolean")
VSM_LKA_Other2Idle = Simulink.Signal(StorageClass="ExportedGlobal", DataType="boolean")
VSM_LKA_Con_VehicleSpeed_Idle2Ready = Simulink.Signal(StorageClass="ExportedGlobal", DataType="boolean")
VSM_LKA_Con_YawRate_Idle2Ready = Simulink.Signal(StorageClass="ExportedGlobal", DataType="boolean")
VSM_LKA_Con_AbsEsp_Idle2Ready = Simulink.Signal(StorageClass="ExportedGlobal", DataType="boolean")
VSM_LKA_Con_Lane_Idle2Ready = Simulink.Signal(StorageClass="ExportedGlobal", DataType="boolean")
VSM_LKA_Con_Headingangle_Idle2Ready = Simulink.Signal(StorageClass="ExportedGlobal", DataType="boolean")
VSM_LKA_Con_LaneCurve_Idle2Ready = Simulink.Signal(StorageClass="ExportedGlobal", DataType="boolean")
VSM_LKA_Con_Failsafe_Idle2Ready = Simulink.Signal(StorageClass="ExportedGlobal", DataType="boolean")
VSM_LKA_Con_Handson_Idle2Ready = Simulink.Signal(StorageClass="ExportedGlobal", DataType="boolean")
VSM_LKA_Con_TurnLight_Ready2Active = Simulink.Signal(StorageClass="ExportedGlobal", DataType="boolean")
VSM_LKA_Con_SteerWheelAngle_Ready2Active = Simulink.Signal(StorageClass="ExportedGlobal", DataType="boolean")
VSM_LKA_Con_DriverInput_Ready2Active = Simulink.Signal(StorageClass="ExportedGlobal", DataType="boolean")
VSM_LKA_Con_SteerWheelSpd_Ready2Active = Simulink.Signal(StorageClass="ExportedGlobal", DataType="boolean")
VSM_LKA_Con_LateralAcc_Ready2Active = Simulink.Signal(StorageClass="ExportedGlobal", DataType="boolean")
VSM_LKA_Con_LongitudeAcc_Ready2Active = Simulink.Signal(StorageClass="ExportedGlobal", DataType="boolean")
VSM_LKA_Con_BrakePressure_Ready2Active = Simulink.Signal(StorageClass="ExportedGlobal", DataType="boolean")
VSM_LKA_Con_AccPedalRate_Ready2Active = Simulink.Signal(StorageClass="ExportedGlobal", DataType="boolean")
VSM_LKA_Con_EpsSta_Ready2Active = Simulink.Signal(StorageClass="ExportedGlobal", DataType="boolean")
VSM_LKA_Con_CURRENT_GEAR_Ready2Active = Simulink.Signal(StorageClass="ExportedGlobal", DataType="boolean")
VSM_LKA_Con_Override_Ready2Active = Simulink.Signal(StorageClass="ExportedGlobal", DataType="boolean")
VSM_LKA_Con_LaneChange_Ready2Active = Simulink.Signal(StorageClass="ExportedGlobal", DataType="boolean")
VSM_LKA_Con_TurnLight_Active2Ready = Simulink.Signal(StorageClass="ExportedGlobal", DataType="boolean")
VSM_LKA_Con_SteerWheelAngle_Active2Ready = Simulink.Signal(StorageClass="ExportedGlobal", DataType="boolean")
VSM_LKA_Con_DriverInput_Active2Ready = Simulink.Signal(StorageClass="ExportedGlobal", DataType="boolean")
VSM_LKA_Con_SteerWheelSpd_Active2Ready = Simulink.Signal(StorageClass="ExportedGlobal", DataType="boolean")
VSM_LKA_Con_LateralAcc_Active2Ready = Simulink.Signal(StorageClass="ExportedGlobal", DataType="boolean")
VSM_LKA_Con_LongitudeAcc_Active2Ready = Simulink.Signal(StorageClass="ExportedGlobal", DataType="boolean")
VSM_LKA_Con_BrakePressure_Active2Ready = Simulink.Signal(StorageClass="ExportedGlobal", DataType="boolean")
VSM_LKA_Con_AccPedalRate_Active2Ready = Simulink.Signal(StorageClass="ExportedGlobal", DataType="boolean")
VSM_LKA_Con_EpsSta_Active2Ready = Simulink.Signal(StorageClass="ExportedGlobal", DataType="boolean")
VSM_LKA_Con_CURRENT_GEAR_Active2Ready = Simulink.Signal(StorageClass="ExportedGlobal", DataType="boolean")
VSM_LKA_Con_OverRide_Active2Ready = Simulink.Signal(StorageClass="ExportedGlobal", DataType="boolean")
VSM_LKA_Con_LaneChange_Active2Ready = Simulink.Signal(StorageClass="ExportedGlobal", DataType="boolean")
VSM_LKA_Con_Lane_Ready2Idle = Simulink.Signal(StorageClass="ExportedGlobal", DataType="boolean")
VSM_LKA_Con_VehicleSpeed_Ready2Idle = Simulink.Signal(StorageClass="ExportedGlobal", DataType="boolean")
VSM_LKA_Con_YawRate_Ready2Idle = Simulink.Signal(StorageClass="ExportedGlobal", DataType="boolean")
VSM_LKA_Con_AbsEsp_Ready2Idle = Simulink.Signal(StorageClass="ExportedGlobal", DataType="boolean")
VSM_LKA_Con_Failsafe_Ready2Idle = Simulink.Signal(StorageClass="ExportedGlobal", DataType="boolean")
VSM_LKA_Con_LaneCurve_Ready2Idle = Simulink.Signal(StorageClass="ExportedGlobal", DataType="boolean")
VSM_LKA_Con_Headingangle_Ready2Idle = Simulink.Signal(StorageClass="ExportedGlobal", DataType="boolean")
VSM_LKA_Con_HandsOff_Ready2Idle = Simulink.Signal(StorageClass="ExportedGlobal", DataType="boolean")
VSM_LKA_LeftWarning = Simulink.Signal(StorageClass="ExportedGlobal", DataType="boolean")
VSM_LKA_RightWarning = Simulink.Signal(StorageClass="ExportedGlobal", DataType="boolean")
VSM_LKA_End = Simulink.Signal(StorageClass="ExportedGlobal", DataType="boolean")
VSM_LKA_Con_ESSSts_Idle2Ready = Simulink.Signal(StorageClass="ExportedGlobal", DataType="boolean")
VSM_LKA_Con_ESSSts_Ready2Idle = Simulink.Signal(StorageClass="ExportedGlobal", DataType="boolean")
P_VSM_LKA_State_Vehspeed_enable = Simulink.Parameter(1, StorageClass="ExportedGlobal", DataType="single")
P_VSM_LKA_State_Yawsup_enable = Simulink.Parameter(1, StorageClass="ExportedGlobal", DataType="single")
P_VSM_LKA_State_Absesp_enable = Simulink.Parameter(1, StorageClass="ExportedGlobal", DataType="single")
P_VSM_LKA_State_Lane_enable = Simulink.Parameter(1, StorageClass="ExportedGlobal", DataType="single")
P_VSM_LKA_State_Headingangle_enable = Simulink.Parameter(1, StorageClass="ExportedGlobal", DataType="single")
P_VSM_LKA_State_Lanecurve_enable = Simulink.Parameter(1, StorageClass="ExportedGlobal", DataType="single")
P_VSM_LKA_State_Failsafe_enable = Simulink.Parameter(1, StorageClass="ExportedGlobal", DataType="single")
P_VSM_LKA_State_Handson_enable = Simulink.Parameter(1, StorageClass="ExportedGlobal", DataType="single")
P_VSM_LKA_State_TurnLight_enable = Simulink.Parameter(1, StorageClass="ExportedGlobal", DataType="single")
P_VSM_LKA_State_SteerWheelAngle_enable = Simulink.Parameter(1, StorageClass="ExportedGlobal", DataType="single")
P_VSM_LKA_State_DriverInputTrqValue_enable = Simulink.Parameter(1, StorageClass="ExportedGlobal", DataType="single")
P_VSM_LKA_State_SteerWheelSpd_enable = Simulink.Parameter(1, StorageClass="ExportedGlobal", DataType="single")
P_VSM_LKA_State_LateralAcce_enable = Simulink.Parameter(1, StorageClass="ExportedGlobal", DataType="single")
P_VSM_LKA_State_Breakpressure_enable = Simulink.Parameter(1, StorageClass="ExportedGlobal", DataType="single")
P_VSM_LKA_State_Eps_enable = Simulink.Parameter(1, StorageClass="ExportedGlobal", DataType="single")
P_VSM_LKA_State_GEAR_enable = Simulink.Parameter(1, StorageClass="ExportedGlobal", DataType="single")
P_VSM_LKA_State_Overide_enable = Simulink.Parameter(1, StorageClass="ExportedGlobal", DataType="single")
P_VSM_LKA_State_LaneChange_enable = Simulink.Parameter(1, StorageClass="ExportedGlobal", DataType="single")
P_VSM_LKA_State_HandsOff_enable = Simulink.Parameter(1, StorageClass="ExportedGlobal", DataType="single")
P_VSM_LKA_State_Param_OutTime = Simulink.Parameter(2, StorageClass="ExportedGlobal", DataType="single")
P_VSM_LKA_State_LongitudeAcc_enable = Simulink.Parameter(1, StorageClass="ExportedGlobal", DataType="single")
P_VSM_LKA_State_Param_InterventionZoneIn = Simulink.Parameter(0.4, StorageClass="ExportedGlobal", DataType="single")
P_VSM_LKA_State_Param_OutOffset = Simulink.Parameter(0.2, StorageClass="ExportedGlobal", DataType="single")
P_VSM_LKA_State_Param_InterventionZoneOut = Simulink.Parameter(-0.65, StorageClass="ExportedGlobal", DataType="single")
P_VSM_LKA_State_Param_REInterventionZoneIn = Simulink.Parameter(0.55, StorageClass="ExportedGlobal", DataType="single")
P_VSM_LKA_State_Param_AngleOffset = Simulink.Parameter(0.15, StorageClass="ExportedGlobal", DataType="single")
P_VSM_LKA_State_Param_LaneWidth_Offset = Simulink.Parameter([-0.27 -0.16 -0.05 0.07 0.17 0.28 0.4], StorageClass="ExportedGlobal", DataType="single")
P_VSM_LKA_State_Param_Sensitive_Offset = Simulink.Parameter([0 0.2 -0.2], StorageClass="ExportedGlobal", DataType="single")
VSM_LKA_InterventionEnd = Simulink.Signal(StorageClass="ExportedGlobal", DataType="single")
VSM_LKA_State = Simulink.Signal(StorageClass="ExportedGlobal", DataType="uint8")
VSM_LKA_Warning = Simulink.Signal(StorageClass="ExportedGlobal", DataType="uint8")
VSM_LKAState = Simulink.Signal(StorageClass="ExportedGlobal", DataType="uint8")
VSM_LKAWarnflag = Simulink.Signal(StorageClass="ExportedGlobal")
P_VSM_LKA_State_Param_Offset = Simulink.Parameter(1.5, StorageClass="ExportedGlobal", DataType="single")
VSM_LKA_AccrPedlPosnDiagc = Simulink.Signal(StorageClass="ExportedGlobal")
VSM_LKA_Con_TJASts_Active2Ready = Simulink.Signal(StorageClass="ExportedGlobal", DataType="boolean")
VSM_LKA_Con_TJASts_Ready2Active = Simulink.Signal(StorageClass="ExportedGlobal", DataType="boolean")
P_VSM_LKA_State_TJASts_enable = Simulink.Parameter(1, StorageClass="ExportedGlobal", DataType="single")
VSM_LKA_Counter = Simulink.Signal(StorageClass="ExportedGlobal", DataType="uint8")
VSM_LKA_Con_ESSSts_Active2Ready = Simulink.Signal(StorageClass="ExportedGlobal", DataType="boolean")
VSM_LKA_VERSION = Simulink.Signal(StorageClass="ExportedGlobal", DataType="uint32")
P_VSM_LKA_AccPedalRateOutTime = Simulink.Parameter(0, StorageClass="ExportedGlobal")
P_VSM_LKA_AccPedalPosnOut = Simulink.Parameter(30, StorageClass="ExportedGlobal")
P_VSM_LKA_TurnLightInTime = Simulink.Parameter(3, StorageClass="ExportedGlobal")
P_VSM_LKA_LaneCurveOut = Simulink.Parameter(0.006, StorageClass="ExportedGlobal")
P_VSM_LKA_Warnarea2 = Simulink.Parameter(-0.35, StorageClass="ExportedGlobal")
P_VSM_LKA_Warnarea1 = Simulink.Parameter(-0.55, StorageClass="ExportedGlobal")
P_VSM_LKA_WarnInTime = Simulink.Parameter(2, StorageClass="ExportedGlobal")
P_VSM_LKA_AbsEspInTime = Simulink.Parameter(3, StorageClass="ExportedGlobal")
P_VSM_LKA_YawRateInTime = Simulink.Parameter(1, StorageClass="ExportedGlobal")
P_VSM_LKA_YawRateIn = Simulink.Parameter(0.2, StorageClass="ExportedGlobal")
P_VSM_LKA_YawRateOut = Simulink.Parameter(0.25, StorageClass="ExportedGlobal")
P_VSM_LKA_OverrideTime = Simulink.Parameter(0.3, StorageClass="ExportedGlobal")
P_VSM_LKA_OverrideValue = Simulink.Parameter(1.2, StorageClass="ExportedGlobal")
P_VSM_LKA_BrakePressOut = Simulink.Parameter(5, StorageClass="ExportedGlobal")
P_VSM_LKA_absLongitudeAcceOut = Simulink.Parameter(3, StorageClass="ExportedGlobal")
P_VSM_LKA_LongitudeAcceOut = Simulink.Parameter(3.5, StorageClass="ExportedGlobal")
P_VSM_LKA_LateralAcceOut = Simulink.Parameter(3.5, StorageClass="ExportedGlobal")
P_VSM_LKA_SteerWheelSpdOut = Simulink.Parameter(200, StorageClass="ExportedGlobal")
P_VSM_LKA_SteerWheelAngleOut = Simulink.Parameter(90, StorageClass="ExportedGlobal")
P_VSM_LKA_WhelDy = Simulink.Parameter(2, StorageClass="ExportedGlobal")
P_VSM_LKA_OverrideInTime = Simulink.Parameter(1.5, StorageClass="ExportedGlobal")
P_VSM_LKA_BrakePressInTime = Simulink.Parameter(1.5, StorageClass="ExportedGlobal")
P_VSM_LKA_BrakePressIn = Simulink.Parameter(3, StorageClass="ExportedGlobal")
P_VSM_LKA_absLongitudeAcceInTime = Simulink.Parameter(3, StorageClass="ExportedGlobal")
P_VSM_LKA_absLongitudeAcceIn = Simulink.Parameter(2.5, StorageClass="ExportedGlobal")
P_VSM_LKA_LongitudeAcceIn = Simulink.Parameter(3, StorageClass="ExportedGlobal")
P_VSM_LKA_LateralAcceInTime = Simulink.Parameter(3, StorageClass="ExportedGlobal")
P_VSM_LKA_LateralAcceIn = Simulink.Parameter(3, StorageClass="ExportedGlobal")
P_VSM_LKA_SteerWheelSpdInTime = Simulink.Parameter(3, StorageClass="ExportedGlobal")
P_VSM_LKA_SteerWheelSpdIn = Simulink.Parameter(150, StorageClass="ExportedGlobal")
P_VSM_LKA_DriverInputTrqValueInTime = Simulink.Parameter(3, StorageClass="ExportedGlobal")
P_VSM_LKA_SteerWheelAngleInTime = Simulink.Parameter(3, StorageClass="ExportedGlobal")
P_VSM_LKA_SteerWheelAngleIn = Simulink.Parameter(70, StorageClass="ExportedGlobal")
P_VSM_LKA_LaneCurveIn = Simulink.Parameter(0.005, StorageClass="ExportedGlobal")
P_VSM_LKA_AccRateInTime = Simulink.Parameter(1.5, StorageClass="ExportedGlobal")
P_VSM_LKA_AccRateOut = Simulink.Parameter(70, StorageClass="ExportedGlobal")
P_VSM_LKA_AccRateIn = Simulink.Parameter(30, StorageClass="ExportedGlobal")
P_VSM_LKA_DriverInputTrqValueOut = Simulink.Parameter(2.3, StorageClass="ExportedGlobal")
P_VSM_LKA_DriverInputTrqValueIn = Simulink.Parameter(2, StorageClass="ExportedGlobal")
P_VSM_LKA_State_Param_LaneCurve_Offset = Simulink.Parameter([0 0.1 0.2 0.3], StorageClass="ExportedGlobal")
P_VSM_LKA_State_Param_LaneCurve = Simulink.Parameter([0.001 0.00125 0.00167 0.05], StorageClass="ExportedGlobal")

LaneARe_SP_LKA = Simulink.Bus()
  Left_Valid: boolean
  Left_A3: single
  Left_A2: single
  Left_A1: single
  Left_A0: single
  Left_Range: single
  Left_Type: uint8
  Right_Valid: boolean
  Right_A3: single
  Right_A2: single
  Right_A1: single
  Right_A0: single
  Right_Range: single
  Right_Type: uint8
  LeftRE_Valid: boolean
  LeftRE_A3: single
  LeftRE_A2: single
  LeftRE_A1: single
  LeftRE_A0: single
  LeftRE_Range: single
  RightRE_Valid: boolean
  RightRE_A3: single
  RightRE_A2: single
  RightRE_A1: single
  RightRE_A0: single
  RightRE_Range: single
  LeftValid_A0: single
  LeftValid_A1: single
  LeftValid_A2: single
  LeftValid_A3: single
  LeftValid_Range: single
  LeftValid_Valid: boolean
  LeftValid_Type: uint8
  RightValid_A0: single
  RightValid_A1: single
  RightValid_A2: single
  RightValid_A3: single
  RightValid_Range: single
  RightValid_Valid: boolean
  RightValid_Type: uint8
  DeltaY: single
  T_A0: single
  T_A1: single
  T_A2: single
  T_A3: single
  T_Range: single
  T_Valid: boolean
  C_Lanewidth: single
  LeftChange: boolean
  RightChange: boolean
  Host_LRE: boolean
  Host_RRE: boolean
  LaneCurve: single
  HeadingAngle_In: boolean
  HeadingAngle_Out: boolean
  Left_LaneRe30: single
  Right_LaneRe30: single
  Scene_LaneValid: single
  LDWLKAELK_LWidth: single
  laneCenterA0: single
  laneCenterA1: single
  laneCenterA2: single
  laneCenterA3: single
  laneCenterValid: boolean
  Left_LaneValid: boolean
  Right_LaneValid: boolean
  Left_ReValid: boolean
  Right_ReValid: boolean
  Left_LaneOp_A0: single
  Right_LaneOp_A0: single
  Left_ReOp_A0: single
  Right_ReOp_A0: single
  Signal_Lane1: single
  Signal_Lane2: single
  Signal_Lane3: single
  Left_Lane_A1: single
  Right_Lane_A1: single
  Left_Re_A1: single
  Right_Re_A1: single

VSM_LKA_LKAactive = Simulink.Signal(StorageClass="ExportedGlobal", DataType="single")
VSM_LKA_LKAout = Simulink.Signal(StorageClass="ExportedGlobal", DataType="single")
P_VSM_LKA_State_Accpedalrate_enable = Simulink.Parameter(1, StorageClass="ExportedGlobal", DataType="single")
P_VSM_LKA_LaneChangeOffset = Simulink.Parameter(0.11, StorageClass="ExportedGlobal")
VSM_LKA_Error = Simulink.Signal(StorageClass="ExportedGlobal")
VSM_LKA_SubModel_VERSION = Simulink.Signal()
VSM_LKA_SubModel_Number = Simulink.Signal()
VSM_LKA_leftactive = Simulink.Signal()
VSM_LKA_rightactive = Simulink.Signal()
P_VSM_LKA_CurveFactor = Simulink.Parameter(1, StorageClass="ExportedGlobal")
P_VSM_LKA_EndSwitch = Simulink.Parameter(1, StorageClass="ExportedGlobal")