% Simulink data dictionary TLS.sldd

VSM_TarLineValid = Simulink.Signal(DataType="boolean")
VSM_TarLineC3 = Simulink.Signal(DataType="single")
VSM_TarLineC2 = Simulink.Signal(DataType="single")
VSM_TarLineC1 = Simulink.Signal(DataType="single")
VSM_TarLineC0 = Simulink.Signal(DataType="single")
VSM_TarLineRange = Simulink.Signal(DataType="single")
VSM_ELKLaneA3 = Simulink.Signal(DataType="single")
VSM_ELKLaneA2 = Simulink.Signal(DataType="single")
VSM_ELKLaneA1 = Simulink.Signal(DataType="single")
VSM_ELKLaneA0 = Simulink.Signal(DataType="single")
VSM_ELKLaneRange = Simulink.Signal(DataType="single")
VSM_LKALaneA3 = Simulink.Signal(DataType="single")
VSM_LKALaneA2 = Simulink.Signal(DataType="single")
VSM_LKALaneA1 = Simulink.Signal(DataType="single")
VSM_LKALaneA0 = Simulink.Signal(DataType="single")
VSM_LKALaneRange = Simulink.Signal(DataType="single")
VSM_ELKLaneValid = Simulink.Signal(DataType="boolean")
VSM_LKALaneValid = Simulink.Signal(DataType="boolean")
VSM_TarDangerLevel = Simulink.Signal(StorageClass="ExportedGlobal", DataType="uint8")

TLS_ELKLane = Simulink.Bus()
  ELK_LaneValid: boolean
  ELK_LaneA3: single
  ELK_LaneA2: single
  ELK_LaneA1: single
  ELK_LaneA0: single
  ELK_LaneRange: single

TLS_LKALane = Simulink.Bus()
  LKA_LaneValid: boolean
  LKA_LaneA3: single
  LKA_LaneA2: single
  LKA_LaneA1: single
  LKA_LaneA0: single
  LKA_LaneRange: single

TLS_DesLane = Simulink.Bus()
  TarLineValid: boolean
  TarLineC3: single
  TarLineC2: single
  TarLineC1: single
  TarLineC0: single
  TarLineRange: single
  TarDangerLevel: uint8

VSM_TLS_SubModel_VERSION = Simulink.Signal()
VSM_TLS_SubModel_Number = Simulink.Signal()