% Simulink data dictionary TSR.sldd

P_VSM_TSR_Dis_keep_SPL_Table = Simulink.Parameter([150 150 200 350 400 700 700 900 2200 2200 2200 2200 2200 2200 2200 2200], DataType="uint16")
P_VSM_TSR_Dis_keep_SPLend = Simulink.Parameter(50, DataType="uint16")
P_VSM_TSR_Dis_keep_TS_Table = Simulink.Parameter(repmat(200, 1, 48), DataType="uint16")
P_VSM_TSR_Ena_SPLSupp_Table = Simulink.Parameter(repmat(1, 1, 23), DataType="uint8")
P_VSM_TSR_Ena_TS_Table = Simulink.Parameter(repmat(1, 1, 48), DataType="uint8")
P_VSM_TSR_SLIF_Speed_High = Simulink.Parameter(150, DataType="uint8")
P_VSM_TSR_SLIF_Speed_Low = Simulink.Parameter(0, DataType="uint8")
P_VSM_TSR_SLW_SnvtySwitch = Simulink.Parameter(0, DataType="boolean")
P_VSM_TSR_SLW_Speed_Delta_disable = Simulink.Parameter(1, DataType="uint8")
P_VSM_TSR_SLW_Speed_Delta_enable = Simulink.Parameter(0, DataType="uint8")
P_VSM_TSR_SLW_Speed_High = Simulink.Parameter(150, DataType="uint8")
P_VSM_TSR_SLW_Speed_Low = Simulink.Parameter(30, DataType="uint8")
P_VSM_TSR_SLW_TrafEyeAvtiveDist = Simulink.Parameter(100, DataType="uint16")
P_VSM_TSR_SLW_Warning_Time = Simulink.Parameter(10, DataType="uint8")
P_VSM_TSR_SteerWheelAngle = Simulink.Parameter(360, DataType="single")
P_VSM_TSR_SWS_speed_withDir = Simulink.Parameter(9, DataType="uint8")
P_VSM_TSR_SWS_speed_woDir = Simulink.Parameter(24, DataType="uint8")

VSM_TSR_TSR_Measurements = Simulink.Bus()
  VSM_TSR_SLIF_Suppress: boolean
  VSM_TSR_SLW_Suppress: boolean
  VSM_TSR_SPL_Constancy_Req: uint8
  VSM_TSR_SPL_EndDist_Req: single
  VSM_TSR_SPL_End_Req: boolean
  SuppName_Value_Remain: uint8
  VSM_TSR_SPL_noSupp_Dist_Req: single
  VSM_TSR_SPL_noSupp_EnableReq: boolean
  VSM_TSR_SPL_noSupp_Value_Req: uint8
  whSupp_Dist_Remain: single
  SPL_whSupp_Dist_Req: single
  SPL_whSupp_EnableReq: boolean
  whSupp_Value_Remain: uint8
  SPL_whSupp_Value_Req: uint8
  VSM_TSR_SnvtySet: int8
  VSM_TSR_TS_Suppress: boolean

TSR_BUS = Simulink.Bus()
  TSRSts: uint8  % TSR模式
  TSRResp: boolean  % TSR开关状态
  TSRWarnResp: boolean  % TSR限速警告开关状态
  TSR_Snvty: int8  % TSR超速警告补偿（现行项目为偏移量）
  TSRSpdLimUnit: uint8  % HMI显示限速单位
  TSRSpdLimSts: uint8  % TSR限速状态
  TSRSpdLim: uint8  % TSR限速值显示
  TSRSpdLimCfdc: uint8  % 置信度
  TSRSpdLimWarn: boolean  % TSR超速警告状态
  TSRConSpdLim: uint8  % TSR条件限速值显示
  TSRConSpdLimWarn: boolean  % TSR条件限速超速警告状态
  TSRTrfcSignVal: uint8  % TSR交通标志类型
  TSRTrfcSignValCfdc: uint8  % 置信度
  SLW_Enable: boolean
  SLW_SpeedLimitValueWhSnvty: uint8
  SPL_noSupp_Dist_Remain: single, Min=0
  SPL_whSupp_Dist_Remain: single, Min=0
  TS_SignName_Dist_Remain: single, Min=0
  SPL_noSupp_Value_Remain: uint8, Min=0
  SPL_whSupp_Value_Remain: uint8, Min=0
  TS_SignName_Value_Remain: uint8, Min=0
  SPL_SuppName_Value_Remain: uint8, Min=0
  SPLnoSuppDistKeep: single
  SPLwhSuppDistKeep: single
  TSDistKeep: single

AD_TSR_CAN = Simulink.Bus()
  TSRSwtReq: boolean
  TSRWarnSwtReq: boolean
  TSR_SnvtySet: int8
  SteerWheelAng: single
  SteerWheelAngSign: boolean
  VehSpd: single
  IP_VehSpdUnit: boolean
  RTurnLmpSwtSts: boolean
  LTurnLmpSwtSts: boolean
  VehYawRate: single
  FFogLmpSts_F_Pbox: boolean
  RFogLmpSts_R_Pbox: boolean
  WindshldWiprActvSts: boolean
  ACAmbTemp: single

VSM_TSR_TS_Suppress = Simulink.Signal(StorageClass="ExportedGlobal", DataType="boolean")
VSM_TSR_SPL_whSupp_Value_Req = Simulink.Signal(StorageClass="ExportedGlobal", DataType="uint8")
VSM_TSR_SPL_whSupp_Value = Simulink.Signal(StorageClass="ExportedGlobal", DataType="uint8")
VSM_TSR_SPL_whSupp_EnableReq = Simulink.Signal(StorageClass="ExportedGlobal", DataType="boolean")
VSM_TSR_SPL_whSupp_Dist_Req = Simulink.Signal(StorageClass="ExportedGlobal", DataType="single")
VSM_TSR_SPL_noSupp_Value_Req = Simulink.Signal(StorageClass="ExportedGlobal", DataType="uint8")
VSM_TSR_SPL_noSupp_Value = Simulink.Signal(StorageClass="ExportedGlobal", DataType="uint8")
VSM_TSR_SPL_noSupp_EnableReq = Simulink.Signal(StorageClass="ExportedGlobal", DataType="boolean")
VSM_TSR_SPL_noSupp_Dist_Req = Simulink.Signal(StorageClass="ExportedGlobal", DataType="single")
VSM_TSR_SPL_EndDist_Req = Simulink.Signal(StorageClass="ExportedGlobal", DataType="single")
VSM_TSR_SPL_End_Req = Simulink.Signal(StorageClass="ExportedGlobal", DataType="boolean")
VSM_TSR_SPL_Constancy_Req = Simulink.Signal(StorageClass="ExportedGlobal", DataType="uint8")
VSM_TSR_SLW_Suppress = Simulink.Signal(StorageClass="ExportedGlobal", DataType="boolean")
VSM_TSR_SLIF_Suppress = Simulink.Signal(StorageClass="ExportedGlobal", DataType="boolean")
VSM_TSR_SLIF_LaneChange = Simulink.Signal(StorageClass="ExportedGlobal", DataType="boolean")
VSM_TSR_SubModel_VERSION = Simulink.Signal(StorageClass="ExportedGlobal", DataType="uint32")
VSM_TSR_SubModel_Number = Simulink.Signal(StorageClass="ExportedGlobal", DataType="uint16")