% Simulink data dictionary UOM.sldd

P_VSM_CruiseFunUserInputMappingWays = Simulink.Parameter(0, StorageClass="ExportedGlobal", DataType="uint8")
VSM_TJA_ACC_SelSts = Simulink.Signal(StorageClass="ExportedGlobal")
VSM_ACC_SWCruise = Simulink.Signal(StorageClass="ExportedGlobal")
VSM_ACC_SWEngState = Simulink.Signal(StorageClass="ExportedGlobal")
VSM_ACC_SWSet = Simulink.Signal(StorageClass="ExportedGlobal")
VSM_ACC_SWRes = Simulink.Signal(StorageClass="ExportedGlobal")
VSM_UOM_SubModel_VERSION = Simulink.Signal(DataType="uint32")
VSM_UOM_SubModel_Number = Simulink.Signal(DataType="uint16")