% Simulink data dictionary VSM.sldd

HWAError_NoError = Simulink.Parameter(0)
HWAError_ErrorBlindness = Simulink.Parameter(4)
HWAError_ErrorFast = Simulink.Parameter(2)
HWAError_Error = Simulink.Parameter(1)
HWAError_Inhibit = Simulink.Parameter(3)
P_VSM_LSMC_SampleTime = Simulink.Parameter(0.02, StorageClass="ExportedGlobal", DataType="single")
VSM_Counter = Simulink.Signal(StorageClass="ExportedGlobal")
P_VSM_LSSWarnFormSwtReq = Simulink.Parameter(false, StorageClass="ExportedGlobal", DataType="boolean")
P_VSM_LKASwtReq = Simulink.Parameter(false, StorageClass="ExportedGlobal", DataType="boolean")
P_VSM_LCKSwtReq = Simulink.Parameter(false, StorageClass="ExportedGlobal", DataType="boolean")
P_VSM_ELKSwtReq = Simulink.Parameter(false, StorageClass="ExportedGlobal", DataType="boolean")
P_VSM_ISLSwtReq = Simulink.Parameter(false, StorageClass="ExportedGlobal", DataType="boolean")
P_VSM_LSSSwtReq = Simulink.Parameter(false, StorageClass="ExportedGlobal", DataType="boolean")
P_VSM_AESSwtReq = Simulink.Parameter(false, StorageClass="ExportedGlobal", DataType="boolean")
P_VSM_HWASwtReq = Simulink.Parameter(false, StorageClass="ExportedGlobal", DataType="boolean")
P_VSM_ALCSwtReq = Simulink.Parameter(false, StorageClass="ExportedGlobal", DataType="boolean")
P_VSM_LDWSwtReq = Simulink.Parameter(false, StorageClass="ExportedGlobal", DataType="boolean")
P_VSM_TSRSwtReq = Simulink.Parameter(false, StorageClass="ExportedGlobal", DataType="boolean")
P_VSM_TSRWarnSwtReq = Simulink.Parameter(false, StorageClass="ExportedGlobal", DataType="boolean")
P_VSM_ICA_HandsOffSwtReq = Simulink.Parameter(false, StorageClass="ExportedGlobal", DataType="boolean")
P_VSM_ESSPedSwtReq = Simulink.Parameter(false, StorageClass="ExportedGlobal", DataType="boolean")
P_VSM_ESS_VehSwtReq = Simulink.Parameter(false, StorageClass="ExportedGlobal", DataType="boolean")
VSM_ACCSts = Simulink.Signal(StorageClass="ExportedGlobal")

BusLKA_lr = Simulink.Bus()
  left: boolean
  right: boolean

ACC_STATE = enum(DefaultValue="ACC_Off", AddClassNameToEnumNames=true)
  ACC_Off = 0
  ACC_Reject = 1
  ACC_Standby = 2
  ACC_ActiveControl = 3
  ACC_BrakeOnly = 4
  ACC_Override = 5
  ACC_StandWait = 6
  ACC_Failure = 7
  ACC_StandActive = 9

ISLActive = enum(DefaultValue="Inactive", StorageType="uint8", AddClassNameToEnumNames=true)
  Inactive = 0
  Active = 1
  ISL_Take_Over_Warning = 2

ISL_InterSysInfoDisp = enum(DefaultValue="No_display", StorageType="uint8", AddClassNameToEnumNames=true)
  No_display = 0
  Speed_Limit_Confirm_Request = 1
  Speed_Limit_Take_Over_Request = 2

STATE = enum(DefaultValue="OFF", StorageType="uint8", AddClassNameToEnumNames=true)
  OFF = 0
  IDLE = 1
  READY = 2
  ACTIVE = 3
  ACTIVE_LEFT = 4
  ACTIVE_RIGHT = 5
  ERROR = 6
  DEFAULT = 7

ELKSTATE = enum(DefaultValue="ELK_OFF", StorageType="uint8", AddClassNameToEnumNames=true)
  ELK_OFF = 0
  ELK_IDLE = 1
  ELK_READY = 2
  ELK_ACTIVE_LEFT = 3
  ELK_ACTIVE_RIGHT = 4
  ELK_ONCOMING_LEFT = 5
  ELK_ONCOMING_RIGHT = 6
  ELK_OVERTAKING_LEFT = 7
  ELK_OVERTAKING_RIGHT = 8
  ELK_ERROR = 9
  ELK_DEFAULT = 10

ACCExitConds = Simulink.Bus()
  VSM_ACCFastExitCons_Standstill3min: boolean
  VSM_ACCFastExitCons_StandstillNoBrakeForce: boolean
  VSM_ACCFastExitCons_RollingBack: boolean
  VSM_ACCFastExitCons_EngineOff: boolean
  VSM_ACCFastExitCons_BrakeDiskOverHeat: boolean
  VSM_ACCFastExitCons_Cancel: boolean
  VSM_ACCFastExitCons_EspOff: boolean
  VSM_ACCFastExitCons_NoForwardGear: boolean
  VSM_ACCFastExitCons_DriveBrakeExit: boolean
  VSM_ACCFastExitCons_EPBClosed: boolean
  VSM_ACCFastExitCons_DriverDoorOpen: boolean
  VSM_ACCSlowExitCons_EspActive400ms: boolean
  VSM_ACCSlowExitCons_MSRactive800ms: boolean
  VSM_ACCSlowExitCons_HDCactive40ms: boolean
  VSM_ACCSlowExitCons_ABSactive400ms: boolean
  VSM_ACCSlowExitCons_TCS1active3000ms: boolean
  VSM_ACCSlowExitCons_TCS2active3000ms: boolean
  VSM_ACCFastExitCons_DriverSBR: boolean

HWAExitConds = Simulink.Bus()
  AEB_Trigger: boolean
  AEB_Off: boolean
  VSM_HandsOffOverride: boolean
  VSM_HWASlowExitCons_HighSpdIn3s: boolean
  VSM_HWASlowExitCons_DMSInvalid: boolean
  VSM_HWASlowExitCons_MapDataInvalid: boolean
  VSM_HWASlowExitCons_DVRError: boolean
  VSM_HWASlowExitCons_SingleLineLost: boolean
  VSM_ACCSlowExitCons_EspActive400ms: boolean
  VSM_ACCSlowExitCons_MSRactive800ms: boolean
  VSM_ACCSlowExitCons_HDCactive40ms: boolean
  VSM_ACCSlowExitCons_ABSactive400ms: boolean
  VSM_ACCSlowExitCons_TCS1active3000ms: boolean
  VSM_ACCSlowExitCons_TCS2active3000ms: boolean
  VSM_ACCFastExitCons_DriverSBR: boolean
  VSM_HWASlowExitCons_NotHighWayArterialRoad5s: boolean
  VSM_HWASlowExitCons_LCKIdleWithoutTurnLight: boolean
  HWAError_Inhibit: boolean
  HWAError_Error: boolean
  HWAError_ErrorBlindness: boolean
  ACCNotActive: boolean
  HWAErrorFastExit: boolean
  ParkGearOrEPBActive: boolean
  StandstillTimeout: boolean
  OverrideTimeout: boolean
  SpeedTooHighWithOverride: boolean
  VSM_HWAActivationCons_VehicleSpdNormal3s: boolean
  VSM_HWAActivationCons_TJAActive: boolean
  VSM_HWAActivationCons_LCKActive: boolean
  VSM_HWAActivationCons_HandsOn5s: boolean
  VSM_HWAActivationCons_DriverStsGood10s: boolean
  VSM_HWAActivationCons_AEBSwitchOn: boolean
  VSM_HWAActivationCons_HWALineValid: boolean
  VSM_HWAActivationCons_NoSingleLineLost: boolean
  VSM_HWAActivationCons_NoDoubleLineLost: boolean
  VSM_HWAActivationCons_HighWayArterialRoad: boolean
  VSM_HWAActivationCons_NoTunnel300m: boolean
  VSM_HWAActivationCons_NoForkRoad300m: boolean
  VSM_HWAActivationCons_MapDataValid: boolean
  VSM_HWAActivationCons_DVRNoError: boolean
  VSM_HWAActivationCons_NoHWANoError: boolean
  VSM_HWAActivationCons_NoHWASafeStopHappened_b: boolean
  NoHWAFastExitConditions_b: boolean
  DoubleLineNotLostOrP0TargetExist: boolean
  DrivingOnHighWay: boolean
  FormOfWay: boolean
  MapDataValid: boolean
  HWANoError: boolean
  LTurnLightSwOff: boolean
  RTurnLightSwOff: boolean
  HazardLmpSwtStsOff: boolean
  DriverStsGood: boolean
  AEBSwitchOn: boolean

VSM_LANE_BUS = Simulink.Bus()
  Valid: boolean
  C3: single
  C2: single
  C1: single
  C0: single
  Range: single

HWA_STATE = enum(DefaultValue="HWA_Off", StorageType="uint8", AddClassNameToEnumNames=true)
  HWA_Off = 0
  HWA_Idle = 1
  HWA_Ready = 2
  HWA_CCAct = 3
  HWA_Pause = 4
  HWA_LeftTurn = 5
  HWA_RightTurn = 6
  HWA_Error = 7
  HWA_SafeStop = 9
  HWA_SlowRetreat = 10
  HWA_LeftTurnPrepare = 11
  HWA_RightTurnPrepare = 12

VSM_ERROR_RIGHT = Simulink.Signal(StorageClass="ExportedGlobal", DataType="single")
VSM_ERROR_LEFT = Simulink.Signal(StorageClass="ExportedGlobal", DataType="single")
VSM_LeftChange_old = Simulink.Signal(StorageClass="ExportedGlobal", DataType="boolean")
VSM_RightChange_old = Simulink.Signal(StorageClass="ExportedGlobal", DataType="boolean")
VSM_LeftChange_new = Simulink.Signal(StorageClass="ExportedGlobal", DataType="boolean")
VSM_RightChange_new = Simulink.Signal(StorageClass="ExportedGlobal", DataType="boolean")
VSM_FLWhelDy = Simulink.Signal(StorageClass="ExportedGlobal", DataType="single")
VSM_FRWhelDy = Simulink.Signal(StorageClass="ExportedGlobal", DataType="single")
VSM_preFLWhelDy = Simulink.Signal(StorageClass="ExportedGlobal", DataType="single")
VSM_preFRWhelDy = Simulink.Signal(StorageClass="ExportedGlobal", DataType="single")
P_VSM_IntelligentEvaSwtReq = Simulink.Parameter(false, StorageClass="ExportedGlobal", DataType="boolean")

TJA_STATE = enum(DefaultValue="TJA_Off", StorageType="uint8", AddClassNameToEnumNames=true)
  TJA_Off = 0
  TJA_Idle = 1
  TJA_Ready = 2
  TJA_Active = 3
  TJA_Error = 7
  TJA_SafeStop = 9
  TJA_Wait = 6
  TJA_SlowRetreat = 10

P_VSM_ACCSOS_SW = Simulink.Parameter(1, StorageClass="ExportedGlobal", DataType="boolean")