% Simulink data dictionary HWA_DDs.sldd
% references enumsss.sldd
% references LCS_New.sldd

QuickStart_50021_1_23_22_33_55606 = Simulink.ConfigSet(StartTime="0", StopTime="Inf", FixedStep="0.02", Solver="FixedStepAuto", ProdHWDeviceType="Custom Processor->Custom", SystemTargetFile="ert.tlc", TargetLang="C")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
VSM_EUR_B1latacc = Simulink.Signal(StorageClass="ExportedGlobal")
VSM_EUR_ACSFlatacc = Simulink.Signal(StorageClass="ExportedGlobal")
Object_Type = Simulink.Signal(StorageClass="ExportedGlobal", Dimensions=9)
EQ4_Type = Simulink.Signal(StorageClass="ExportedGlobal")