% Simulink data dictionary LCS_New.sldd

P_LCS_LATC_CurOffsetVehicleSpdLimitValue_degs = Simulink.Parameter(7, StorageClass="ExportedGlobal", DataType="single")
LCS_LATC_CurrentSteerAngleOffset_deg = Simulink.Signal(StorageClass="ExportedGlobal")
LCS_LATC_SteerAngleCmd_deg = Simulink.Signal(StorageClass="ExportedGlobal")
LCS_LATC_Feedforward_deg = Simulink.Signal(StorageClass="ExportedGlobal")
LCS_LATC_Feedback_deg = Simulink.Signal(StorageClass="ExportedGlobal")
LCS_LATC_SteerAngleLimit_deg = Simulink.Signal(StorageClass="ExportedGlobal")
LCS_LATC_TarAngle_deg = Simulink.Signal(StorageClass="ExportedGlobal")
LCS_LATC_TarAngleFilter_deg = Simulink.Signal(StorageClass="ExportedGlobal")
P_LCS_LATC_CurOffsetCurve_TabX_m = Simulink.Parameter(single([0 0.0002 0.0003 0.0007 0.0013 0.0025 0.0033 0.005 0.01 0.02]), StorageClass="ExportedGlobal")
P_LCS_LATC_CurOffsetCurveFliterTime_Tab_s = Simulink.Parameter(repmat(2, 1, 10), StorageClass="ExportedGlobal")
P_LCS_VehicleSpd_TabX_Kph = Simulink.Parameter(single([0 5 10 15 20 25 30 35 40 60 80 90 100 110 120 140]), StorageClass="ExportedGlobal")
P_LCS_LATC_MatrixQ1_st = Simulink.Parameter([1.2e-5 1.2e-5 1.2e-5 1.2e-5 1.2e-5 1.2e-5 1.2e-5 1.2e-5 1.2e-5 1.6e-5 2.0e-5 2.0e-5 2.0e-5 2.0e-5 2.0e-5 2.0e-5], StorageClass="ExportedGlobal")
P_LCS_LATC_MatrixQ3_st = Simulink.Parameter(repmat(0.01, 1, 16), StorageClass="ExportedGlobal")
P_LCS_LATC_TarAngleFliterWindowSize = Simulink.Parameter(5, StorageClass="ExportedGlobal")
LCS_LATC_MaxAy_ms2 = Simulink.Signal(StorageClass="ExportedGlobal")
LCS_LATC_StateActAngleSlope_degs = Simulink.Signal(StorageClass="ExportedGlobal")
LCS_LATC_StateAngleSlope_degs = Simulink.Signal(StorageClass="ExportedGlobal")
P_LCS_LATC_StateHoldTime_st = Simulink.Parameter(250, StorageClass="ExportedGlobal")
P_LCS_LATC_LCKMaxLatAcc_ms2 = Simulink.Parameter(repmat(10, 1, 16), StorageClass="ExportedGlobal")
P_LCS_LATC_LCKIEMaxLatAcc_ms2 = Simulink.Parameter(repmat(10, 1, 16), StorageClass="ExportedGlobal")
P_LCS_LATC_LCNormalMaxLatAcc_ms2 = Simulink.Parameter(repmat(10, 1, 16), StorageClass="ExportedGlobal")
P_LCS_LATC_LKAMaxLatAcc_ms2 = Simulink.Parameter(repmat(10, 1, 16), StorageClass="ExportedGlobal")
P_LCS_LATC_ELKMaxLatAcc_ms2 = Simulink.Parameter(repmat(10, 1, 16), StorageClass="ExportedGlobal")
P_LCS_LATC_ESSMaxLatAcc_ms2 = Simulink.Parameter(repmat(10, 1, 16), StorageClass="ExportedGlobal")
P_LCS_LATC_LCEcoMaxLatAcc_ms2 = Simulink.Parameter(repmat(10, 1, 16), StorageClass="ExportedGlobal")
P_LCS_LATC_LCSportMaxLatAcc_ms2 = Simulink.Parameter(repmat(10, 1, 16), StorageClass="ExportedGlobal")
P_LCS_LATC_LCCancleMaxLatAcc_ms2 = Simulink.Parameter(repmat(10, 1, 16), StorageClass="ExportedGlobal")
P_LCS_LATC_LCKAngleSlope_ratio = Simulink.Parameter([0.4 0.4 0.4 0.4 0.4 0.4 0.4 0.4 0.4 0.5 0.6 0.6 0.6 0.6 0.6 0.6], StorageClass="ExportedGlobal")
P_LCS_LATC_LCKIEAngleSlope_ratio = Simulink.Parameter([0.4 0.4 0.4 0.4 0.4 0.4 0.4 0.4 0.4 0.5 0.6 0.6 0.6 0.6 0.6 0.6], StorageClass="ExportedGlobal")
P_LCS_LATC_LCNormalAngleSlope_ratio = Simulink.Parameter(repmat(1.6, 1, 16), StorageClass="ExportedGlobal")
P_LCS_LATC_LKAAngleSlope_ratio = Simulink.Parameter(repmat(1.6, 1, 16), StorageClass="ExportedGlobal")
P_LCS_LATC_ELKAngleSlope_ratio = Simulink.Parameter(repmat(1.6, 1, 16), StorageClass="ExportedGlobal")
P_LCS_LATC_ESSAngleSlope_ratio = Simulink.Parameter(repmat(1.6, 1, 16), StorageClass="ExportedGlobal")
P_LCS_LATC_LCEcoAngleSlope_ratio = Simulink.Parameter(repmat(1.6, 1, 16), StorageClass="ExportedGlobal")
P_LCS_LATC_LCSportAngleSlope_ratio = Simulink.Parameter(repmat(1.6, 1, 16), StorageClass="ExportedGlobal")
P_LCS_LATC_LCAngleSlope_ratio = Simulink.Parameter(repmat(1.6, 1, 16), StorageClass="ExportedGlobal")
P_LCS_LATC_StateActiveFlg_TabX_st = Simulink.Parameter([1 2 3 4 5], StorageClass="ExportedGlobal")
P_LCS_LATC_StateActiveHoldTime_TabY_st = Simulink.Parameter([0 0.2 0.4 0.6 0.8 1 1.2 1.4 1.6 1.8 2 4 6 8 10], StorageClass="ExportedGlobal")

P_LCS_LATC_StateActivAngleSlopeLimit_ratio = Simulink.Parameter([0.01 0.01 0.1 0.2 0.4 0.8 1 1.2 1.4 1.6 1.8 2 2 2 2
 0.15 0.15 0.15 0.15 0.15 0.15 0.15 0.15 1.4 1.6 1.8 2 2 2 2
 0.1 0.15 0.2 0.25 0.28 0.8 1 1.2 1.4 1.6 1.8 2 2 2 2
 0.5 0.7 1 1 1 1 1 1.2 1.4 1.6 1.8 2 2 2 2
 1.6 1.6 1.6 1.6 1.6 1.6 1.6 1.6 1.6 1.6 1.6 1.6 2 2 2], StorageClass="ExportedGlobal")

LCS_PLAN_TrajectoryX = Simulink.Signal(StorageClass="ExportedGlobal")
LCS_PLAN_Trajectory_PlanY = Simulink.Signal(StorageClass="ExportedGlobal")
LCS_PLAN_Trajectory_PlanTheta = Simulink.Signal(StorageClass="ExportedGlobal")
LCS_PLAN_Trajectory_PlanIdex = Simulink.Signal(StorageClass="ExportedGlobal")
LCS_PLAN_Trajectory_PreviewX = Simulink.Signal(StorageClass="ExportedGlobal")
LCS_PLAN_Trajectory_PreviewY = Simulink.Signal(StorageClass="ExportedGlobal")
LCS_PLAN_Trajectory_PreviewTheta = Simulink.Signal(StorageClass="ExportedGlobal")
LCS_PLAN_Trajectory_NumTraj = Simulink.Signal(StorageClass="ExportedGlobal")
LCS_PLAN_PreviewPointRefCurve = Simulink.Signal(StorageClass="ExportedGlobal")
LCS_PLAN_PreviewPointLaterErr = Simulink.Signal(StorageClass="ExportedGlobal")
LCS_PLAN_PreviewPointLaterErrRate = Simulink.Signal(StorageClass="ExportedGlobal")
LCS_PLAN_PreviewPointHeadingErr = Simulink.Signal(StorageClass="ExportedGlobal")
LCS_PLAN_PreviewPointHeadingErrRate = Simulink.Signal(StorageClass="ExportedGlobal")
P_LCS_PLAN_StateActiv_PreviewT_s = Simulink.Parameter(repmat(10, 5, 15), StorageClass="ExportedGlobal")
P_LCS_PLAN_StateActiv_AyDtLimit_ms3 = Simulink.Parameter(repmat(15, 5, 15), StorageClass="ExportedGlobal")
P_LCS_PLAN_CurvePreView_s = Simulink.Parameter(0.3, StorageClass="ExportedGlobal")
LCS_PLAN_PreviewCurve = Simulink.Signal(StorageClass="ExportedGlobal")
P_LCS_PLAN_CurvePreview_TabX_m = Simulink.Parameter(single([0 0.0002 0.0003 0.0007 0.0013 0.0025 0.0033 0.005 0.01 0.02]), StorageClass="ExportedGlobal")
P_LCS_PLAN_CurvePreview_Tab_ratio = Simulink.Parameter(repmat(1, 1, 10), StorageClass="ExportedGlobal")
LCS_PLAN_FinalPreviewT_s = Simulink.Signal(StorageClass="ExportedGlobal")
P_LCS_PLAN_VehicleSpd_TabX_kph = Simulink.Parameter(single([0 5 10 15 20 25 30 35 40 60 80 90 100 110 120 140]), StorageClass="ExportedGlobal")
P_LCS_PLAN_PreViewT_Tab_s = Simulink.Parameter([0.6 0.6 0.6 0.6 0.5 0.4 0.4 0.4 0.4 0.4 0.4 0.4 0.4 0.4 0.4 0.4], StorageClass="ExportedGlobal")
P_LCS_PLAN_A0Distance_TabX_m = Simulink.Parameter([-0.6 -0.4 -0.2 0 0.2 0.4 0.6], StorageClass="ExportedGlobal")
P_LCS_PLAN_A0PreViewFac_ratio = Simulink.Parameter(repmat(0, 7, 16), StorageClass="ExportedGlobal")
LCS_PLAN_A0PreviewFac = Simulink.Signal(StorageClass="ExportedGlobal")
LCS_PLAN_AyDtLimit = Simulink.Signal(StorageClass="ExportedGlobal")
P_LCS_PLAN_MinPlanDis_m = Simulink.Parameter([30 30 30 30 30 30 30 30 30 35 40 45 45 45 45 45], StorageClass="ExportedGlobal")
P_LCS_PLAN_PreCurMinDisFac_ratio = Simulink.Parameter([1 1 1 1 1 1 0.6 0.6 0.6 0.6], StorageClass="ExportedGlobal")
P_LCS_PLAN_CurvePreViewFilterTime_s = Simulink.Parameter(0.02, StorageClass="ExportedGlobal", DataType="single")
P_LCS_OverRideDetect_b = Simulink.Parameter(1, StorageClass="ExportedGlobal")
LCS_OverRideDetect_b = Simulink.Signal(StorageClass="ExportedGlobal")
LCS_IN_Spd_ms = Simulink.Signal(StorageClass="ExportedGlobal")
LCS_Plan_PreDisCurveFac_ratio = Simulink.Signal()
LCS_PreDisCurve_m = Simulink.Signal(StorageClass="ExportedGlobal")
P_LCS_Plan_LCKIEayDtLimit_Tab_ms3 = Simulink.Parameter(repmat(3, 13, 16), StorageClass="ExportedGlobal")
P_LCS_Plan_LCKNomalayDtLimit_Tab_ms3 = Simulink.Parameter(repmat(1.2, 13, 16), StorageClass="ExportedGlobal", DataType="single")
P_LCS_Plan_LKAayDtLimit_Tab_ms3 = Simulink.Parameter(repmat(3, 13, 16), StorageClass="ExportedGlobal", DataType="single")
P_LCS_Plan_ELKayDtLimit_Tab_ms3 = Simulink.Parameter(repmat(3, 13, 16), StorageClass="ExportedGlobal")
P_LCS_Plan_ESSAESayDtLimit_Tab_ms3 = Simulink.Parameter(repmat(3, 13, 16), StorageClass="ExportedGlobal", DataType="single")
P_LCS_Plan_LCKEcoayDtLimit_Tab_ms3 = Simulink.Parameter(repmat(0.8, 13, 16), StorageClass="ExportedGlobal", DataType="single")
P_LCS_Plan_LCKSportayDtLimit_Tab_ms3 = Simulink.Parameter(repmat(2.8, 13, 16), StorageClass="ExportedGlobal", DataType="single")
P_LCS_Plan_LCayDtLimit_Tab_ms3 = Simulink.Parameter(repmat(4, 13, 16), StorageClass="ExportedGlobal", DataType="single")
LCS_Plan_AyDtlimit = Simulink.Signal(StorageClass="ExportedGlobal")

P_LCS_Plan_PreDisCurveFac_Tab_ratio = Simulink.Parameter(single([1 1 1 1 1 1 1
 1 1 1 1 1 1 1
 0.7 0.7 0.7 0.7 0.7 1 1]), StorageClass="ExportedGlobal")

P_LCS_desLane_A0 = Simulink.Parameter(single([0 0.2 0.4 0.6 0.8 1 1.5]), StorageClass="ExportedGlobal")
P_LCS_Plan_A2Pretime_s = Simulink.Parameter(0.075, StorageClass="ExportedGlobal", DataType="single")
P_LCS_PLAN_StateActiveFlg_TabX_st = Simulink.Parameter([1 2 3 4 5], StorageClass="ExportedGlobal")
P_LCS_PLAN_StateActiveHoldTime_TabY_s = Simulink.Parameter([0 0.2 0.4 0.6 0.8 1 1.2 1.4 1.6 1.8 2 4 6 8 10], StorageClass="ExportedGlobal")
LCS_Plan_FinalpreDis = Simulink.Signal(StorageClass="ExportedGlobal")
P_LCS_PLAN_DisFac_Tab_ratio = Simulink.Parameter(0.4, StorageClass="ExportedGlobal")
P_LCS_PLAN_MinDis_m = Simulink.Parameter(20, StorageClass="ExportedGlobal")
P_LCS_PLAN_StateHoldTime_st = Simulink.Parameter(250, StorageClass="ExportedGlobal")

P_LCS_PLAN_StateActivAngleSlope_Tab_ratio = Simulink.Parameter([0.01 0.01 0.1 0.2 0.4 0.8 1 1.2 1.4 1.6 1.8 2 2 2 2
 0.1 0.1 0.2 0.3 0.4 0.4 0.4 0.4 0.4 0.4 0.4 2 2 2 2
 0.1 0.15 0.2 0.25 0.28 0.8 1 1.2 1.4 1.6 1.8 2 2 2 2
 0.1 0.25 0.5 0.7 0.9 1 1 1.2 1.4 1.6 1.8 2 2 2 2
 1.6 1.6 1.6 1.6 1.6 1.6 1.6 1.6 1.6 1.6 1.6 1.6 2 2 2], StorageClass="ExportedGlobal")

P_LCS_PLAN_StateCompleteAngleSlope_Tab_ratio = Simulink.Parameter([1.5 1.6 1.6 1.6 1.6 1.6 1.6 1.6 1.6 1.6 1.5 1.5 1.2 0.8 0.4
 1.5 1.6 1.6 1.6 1.6 1.6 1.6 1.6 1.6 1.6 1.5 1.5 1.2 0.8 0.4
 1.5 1.6 1.6 1.6 1.6 1.6 1.6 1.6 1.6 1.6 1.5 1.5 1.2 0.8 0.4], StorageClass="ExportedGlobal")

P_LCS_PLAN_StateCompleteFlg_TabX_st = Simulink.Parameter([6 7 8], StorageClass="ExportedGlobal")

P_LCS_PLAN_LCCompletePreDisFac_Tab_ratio = Simulink.Parameter([0.8 0.8 0.8 0.8 0.8 0.8 0.8 0.8 0.8 0.8 0.8 0.9 1 1 1
 0.8 0.8 0.8 0.8 0.8 0.8 0.8 0.8 0.8 0.8 0.8 0.9 1 1 1
 0.8 0.8 0.8 0.8 0.8 0.8 0.8 0.8 0.8 0.8 0.8 0.9 1 1 1], StorageClass="ExportedGlobal")

P_LCS_PLAN_DesLineA0_TabX_m = Simulink.Parameter(single([0 0.2 0.4 0.6 0.8 1 1.5]), StorageClass="ExportedGlobal")
P_LCS_PLAN_PreDisCurve_TabY_m = Simulink.Parameter(single([0 0.0001 0.0003 0.0007 0.0013 0.002 0.0025 0.0033 0.004 0.005 0.007 0.01 0.02]))

P_LCS_PlLAN_PreDisFac_Tab_ratio = Simulink.Parameter(single([1 0.9 0.7 0.6 0.55 0.4 0.3 0.3 0.3 0.3 0.3 0.3 0.25
 1 0.9 0.7 0.6 0.55 0.4 0.3 0.3 0.3 0.3 0.3 0.3 0.25
 1 0.8 0.65 0.55 0.5 0.4 0.3 0.3 0.3 0.3 0.3 0.3 0.25
 1 0.7 0.6 0.5 0.4 0.3 0.3 0.3 0.3 0.3 0.3 0.3 0.25
 1 0.6 0.55 0.5 0.4 0.3 0.3 0.3 0.3 0.3 0.3 0.3 0.25
 1 0.6 0.5 0.45 0.4 0.3 0.3 0.3 0.3 0.3 0.3 0.3 0.25
 1 0.6 0.5 0.4 0.35 0.3 0.3 0.3 0.3 0.3 0.3 0.3 0.25]), StorageClass="ExportedGlobal")

P_LCS_PLAN_LCPreDisFac_ratio = Simulink.Parameter(single([1 1 1 1 1 1 1
 1 1 1 1 1 1 1
 0.7 0.7 0.7 0.7 0.7 1 1]), StorageClass="ExportedGlobal")

P_LCS_PLAN_TarDangerlLevel_Tabx_st = Simulink.Parameter(single([4 5 9]), StorageClass="ExportedGlobal")
P_LCS_PLAN_DesLineA0_TabY_m = Simulink.Parameter(single([0 0.2 0.4 0.6 0.8 1 1.5]), StorageClass="ExportedGlobal")
P_LCS_PLAN_PreDis_Tab_m = Simulink.Parameter([8 9 10 11 12 13 14 15 17 22 25 30 31 32 32 32], StorageClass="ExportedGlobal", DataType="single")
P_LCS_PLAN_VehicleSpd_TabX_Kph = Simulink.Parameter(single([0 5 10 15 20 25 30 35 40 60 80 90 100 110 120 140]))
P_LCS_PLAN_A2FliterTime_s = Simulink.Parameter(0.1, StorageClass="ExportedGlobal", DataType="single")
P_LCS_PLAN_VehicleSpd_TabY_Kph = Simulink.Parameter(single([0 5 10 15 20 25 30 35 40 60 80 90 100 110 120 140]), StorageClass="ExportedGlobal")
P_LCS_PLAN_PreDisCurve_TabX_m = Simulink.Parameter(single([0 0.0001 0.0003 0.0007 0.0013 0.002 0.0025 0.0033 0.004 0.005 0.007 0.01 0.02]), StorageClass="ExportedGlobal")
LCS_PLAN_planT = Simulink.Signal(StorageClass="ExportedGlobal")
LCS_PLAN_PlanX = Simulink.Signal(StorageClass="ExportedGlobal")
LCS_PLAN_PlanY = Simulink.Signal(StorageClass="ExportedGlobal")
LCS_PLAN_Valid = Simulink.Signal(StorageClass="ExportedGlobal")
LCS_PLAN_LoopNum = Simulink.Signal(StorageClass="ExportedGlobal")
LCS_PLAN_Length = Simulink.Signal(StorageClass="ExportedGlobal")
LCS_PLAN_AyDt = Simulink.Signal(StorageClass="ExportedGlobal")
LCS_Line_PlanAyDt = Simulink.Signal(StorageClass="ExportedGlobal")
P_LCS_LATC_LCKAngleSlope_Tab_degs = Simulink.Parameter(repmat(0.4, 1, 12), StorageClass="ExportedGlobal")
P_LCS_LATC_VehicleSpd_TabX_Kph = Simulink.Parameter([0 10 20 30 40 60 80 90 100 110 120 140], StorageClass="ExportedGlobal")
P_LCS_LATC_LCKIEAngleSlope_Tab_degs = Simulink.Parameter(repmat(0.4, 1, 12), StorageClass="ExportedGlobal")
P_LCS_LATC_LCNormalAngleSlope_Tab_degs = Simulink.Parameter(repmat(0.5, 1, 12), StorageClass="ExportedGlobal")
P_LCS_PLAN_ELKAngleSlope_Tab_degs = Simulink.Parameter(repmat(0.4, 1, 12), StorageClass="ExportedGlobal")
P_LCS_LATC_ESSAESAngleSlope_Tab_degs = Simulink.Parameter(repmat(0.4, 1, 12), StorageClass="ExportedGlobal")
P_LCS_LATC_LCAngleSlope_Tab_degs = Simulink.Parameter(repmat(0.8, 1, 12), StorageClass="ExportedGlobal")
P_LCS_LATC_LCEcoAngleSlope_Tab_degs = Simulink.Parameter(repmat(0.4, 1, 12), StorageClass="ExportedGlobal")
P_LCS_LATC_LCSportAngleSlope_Tab_degs = Simulink.Parameter(repmat(1.5, 1, 12), StorageClass="ExportedGlobal")
P_LCS_LATC_LKAAngleSlope_Tab_degs = Simulink.Parameter(repmat(0.4, 1, 12), StorageClass="ExportedGlobal")
LCS_LATC_EqA0 = Simulink.Signal(StorageClass="ExportedGlobal")
P_LCS_LATC_DeltaEps_Tab_s = Simulink.Parameter([0.5 0.5 0.5 0.5 0.5 0.5 0.5 0.5 0.5 0.5 0.4 0.4 0.4 0.4 0.4 0.4], StorageClass="ExportedGlobal")
LCS_PLAN_AngleSlope = Simulink.Signal(StorageClass="ExportedGlobal")
P_LCS_LATC_DxOffset_Sw = Simulink.Parameter(1, StorageClass="ExportedGlobal")
P_LCS_LATC_PreWeight = Simulink.Parameter(repmat(1, 1, 7), StorageClass="ExportedGlobal")
P_LCS_LATC_Preindex = Simulink.Parameter([5 10 15 17 18 19 20], StorageClass="ExportedGlobal")
LCS_LATC_TarSteerAngle = Simulink.Signal(StorageClass="ExportedGlobal")
LCS_LATC_TarSteerAngleFilter = Simulink.Signal(StorageClass="ExportedGlobal")
LCS_LATC_TarSteerAngleEnd = Simulink.Signal(StorageClass="ExportedGlobal")
LCS_LATC_DeltaAngle = Simulink.Signal(StorageClass="ExportedGlobal")

P_LCS_LATC_ESSAddAngleSlope_Tab_degs = Simulink.Parameter([1 1 1 1 1 1 1 1 1 1 1 1
 1 1 1 1 1 1 1 1 1 1 1 1
 1 1 1 1 1 1 1 1 1 1 1 1
 1 1 1 1 1 1 1 1 1 1 1 1
 2 2 2 2 7.5 7.5 7.5 7.5 7.5 7.5 7.5 7.5
 2 2 2 2 7.5 7.5 7.5 7.5 7.5 7.5 7.5 7.5
 2 2 2 2 7.5 7.5 7.5 7.5 7.5 7.5 7.5 7.5
 7 7 7 7 7.5 7.5 7.5 7.5 7.5 7.5 7.5 7.5
 7 7 7 7 7.5 7.5 7.5 7.5 7.5 7.5 7.5 7.5
 7 7 7 7 7.5 7.5 7.5 7.5 7.5 7.5 7.5 7.5
 7 7 7 7 7.5 7.5 7.5 7.5 7.5 7.5 7.5 7.5
 7 7 7 7 7.5 7.5 7.5 7.5 7.5 7.5 7.5 7.5
 7 7 7 7 7.5 7.5 7.5 7.5 7.5 7.5 7.5 7.5
 7 7 7 7 7.5 7.5 7.5 7.5 7.5 7.5 7.5 7.5
 7 7 7 7 7.5 7.5 7.5 7.5 7.5 7.5 7.5 7.5
 7 7 7 7 8 8 8 8 8 8 8 8
 7 7 7 7 8 8 8 8 8 8 8 8
 7 7 7 7 8 8 8 8 8 8 8 8
 7 7 7 7 8 8 8 8 8 8 8 8], StorageClass="ExportedGlobal")

P_LCS_LATC_ESSA0Dis_TabX_m = Simulink.Parameter([0 0.2 0.4 0.6 0.8 1 1.2 1.4 1.6 1.8 2 2.2 2.4 2.6 2.8 3 3.2 3.4 3.6], StorageClass="ExportedGlobal")
LCS_LATC_ESS_TarAngle2 = Simulink.Signal(StorageClass="ExportedGlobal")
LCS_LATC_ReqEPSTrgAngle = Simulink.Signal(StorageClass="ExportedGlobal")
P_LCS_LATC_CurrentOffsetFliterTime_Tab_s = Simulink.Parameter(single(repmat(2, 1, 10)), StorageClass="ExportedGlobal")
LCS_IN_vxvRefMs = Simulink.Signal(StorageClass="ExportedGlobal")
LCS_IN_axvRefMs2 = Simulink.Signal(StorageClass="ExportedGlobal")
LCS_IN_ayvRefMs2 = Simulink.Signal(StorageClass="ExportedGlobal")
LCS_IN_kapTraj = Simulink.Signal(StorageClass="ExportedGlobal")
LCS_IN_alpSideSlipAngle = Simulink.Signal(StorageClass="ExportedGlobal")
LCS_IN_psiDtOpt = Simulink.Signal(StorageClass="ExportedGlobal")
LCS_IN_SteerAngOffset_deg = Simulink.Signal(StorageClass="ExportedGlobal")
LCS_IN_EPS_DrvInpTrqVal = Simulink.Signal(StorageClass="ExportedGlobal")
LCS_IN_EPS_LKATorqOvrlDlvd = Simulink.Signal(StorageClass="ExportedGlobal")
LCS_IN_EPS_LKATorqOvrlDlvdVld = Simulink.Signal(StorageClass="ExportedGlobal")
LCS_IN_EPS_LKAAngDlvdSts = Simulink.Signal(StorageClass="ExportedGlobal")
LCS_IN_EPS_LKATrqOvlDlvdSts = Simulink.Signal(StorageClass="ExportedGlobal")
LCS_IN_EPS_FailSts = Simulink.Signal(StorageClass="ExportedGlobal")
LCS_IN_SteerWheelSpd = Simulink.Signal(StorageClass="ExportedGlobal")
LCS_IN_SteerWheelAng = Simulink.Signal(StorageClass="ExportedGlobal")
LCS_IN_SteerWheelSpdSign = Simulink.Signal(StorageClass="ExportedGlobal")
LCS_IN_SteerWheelAngleSign = Simulink.Signal(StorageClass="ExportedGlobal")
LCS_IN_CurrentLaneWidth = Simulink.Signal(StorageClass="ExportedGlobal")
LCS_OUT_AngCmdReqValVld = Simulink.Signal(StorageClass="ExportedGlobal")
LCS_CurSteerAngle_deg = Simulink.Signal(StorageClass="ExportedGlobal")
LCS_IN_CurSteerAngle_deg = Simulink.Signal(StorageClass="ExportedGlobal")
LCS_IN_SteerAngleSpd_degs = Simulink.Signal(StorageClass="ExportedGlobal")
LCS_IN_Spd_Kph = Simulink.Signal(StorageClass="ExportedGlobal")
LCS_EqA0 = Simulink.Signal(StorageClass="ExportedGlobal")
LCS_IN_desLaneA0 = Simulink.Signal(StorageClass="ExportedGlobal")
LCS_IN_desLaneValid = Simulink.Signal(StorageClass="ExportedGlobal")
LCS_IN_TarDangerlLevel = Simulink.Signal(StorageClass="ExportedGlobal")
LCS_IN_TarDangerlLevel_Delay2Frame = Simulink.Signal(StorageClass="ExportedGlobal")
LCS_ESS_NotActiveFlg = Simulink.Signal(StorageClass="ExportedGlobal")
LCS_ESS_NotActiveFlg1 = Simulink.Signal(StorageClass="ExportedGlobal")
LCS_ESS_NotActiveFlg2 = Simulink.Signal(StorageClass="ExportedGlobal")
LCS_ESS_NotActiveFlg3 = Simulink.Signal(StorageClass="ExportedGlobal")
LCS_ESS_NotActiveFlgOriginal = Simulink.Signal(StorageClass="ExportedGlobal")
LCS_ESS_SteerWheelAngleSpd = Simulink.Signal(StorageClass="ExportedGlobal")
LCS_ESS_SteerWheelAngleSpdFilter = Simulink.Signal(StorageClass="ExportedGlobal")
LCS_ESS_TarAngle = Simulink.Signal(StorageClass="ExportedGlobal")
LCS_ESS_TarAngle2 = Simulink.Signal(StorageClass="ExportedGlobal")
LCS_ESS_TarAngleSpd = Simulink.Signal(StorageClass="ExportedGlobal")
LCS_ESS_TarAngleSpdFilter = Simulink.Signal(StorageClass="ExportedGlobal")
LCS_ESS_TarTorq = Simulink.Signal(StorageClass="ExportedGlobal")
P_LCS_ESSAngSlope_SW = Simulink.Parameter(0, StorageClass="ExportedGlobal")
P_LCS_ESSAngleSW = Simulink.Parameter(1, StorageClass="ExportedGlobal")
P_LCS_ESSAngleSW2 = Simulink.Parameter(0, StorageClass="ExportedGlobal")
P_LCS_ESSOverrideTime1 = Simulink.Parameter(0.06, StorageClass="ExportedGlobal")
P_LCS_ESSOverrideTime2 = Simulink.Parameter(0.06, StorageClass="ExportedGlobal")
P_LCS_ESSOverrideTime3 = Simulink.Parameter(0.06, StorageClass="ExportedGlobal")
P_LCS_ESSOverrideValue1 = Simulink.Parameter(20, StorageClass="ExportedGlobal")
P_LCS_ESSOverrideValue2 = Simulink.Parameter(20, StorageClass="ExportedGlobal")
P_LCS_ESS_AngleSlopeNormal_Spd = Simulink.Parameter([0.4 0.4 0.4 0.4 0.4 0.4 1.2 1.2 1.2 1.2 1.2 1 1 0.25 0.25 0.25], StorageClass="ExportedGlobal")
P_LCS_ESS_AngleSlope_Limit = Simulink.Parameter(2.9, StorageClass="ExportedGlobal")
P_LCS_ESS_EqA0_SW = Simulink.Parameter(1, StorageClass="ExportedGlobal", DataType="uint8")
P_LCS_ESS_LogicTest_Enable = Simulink.Parameter(1, StorageClass="ExportedGlobal", DataType="boolean")
P_LCS_ESS_MaxTorqSlope = AUTOSAR4.Parameter(1.5, SwCalibrationAccess="ReadWrite", StorageClass="Global", MemorySection="CAL", DataType="single")
P_LCS_ESS_NotActiveFlgDelayTime = Simulink.Parameter(0, StorageClass="ExportedGlobal")
P_LCS_ESS_NotActiveFlgDelayTimeSW = Simulink.Parameter(0, StorageClass="ExportedGlobal")
P_LCS_ESS_SteerAngleFilterTime = Simulink.Parameter(0.2, StorageClass="ExportedGlobal", DataType="single")
P_LCS_ESS_TarAngleFilterTime = Simulink.Parameter(0.2, StorageClass="ExportedGlobal", DataType="single")
P_LCS_ESS_Test_SW = Simulink.Parameter(0, StorageClass="ExportedGlobal")
P_LCS_ESS_preDis_Nomal = Simulink.Parameter([8 9 10 10 11 11 11 11 11 12 15 18 22 24 27 33], StorageClass="ExportedGlobal")
P_LCS_ESS_preDis_Nomal_Add = Simulink.Parameter(repmat(0, 1, 8), StorageClass="ExportedGlobal")
P_LCS_ESS_preDis_TmaxFac = Simulink.Parameter([0.4 0.4 0.4 0.4 0.4 0.4 -0.1 -0.1 -0.1 0.1 0.1 0 0 0.9 0.9 0.9], StorageClass="ExportedGlobal")
P_LCS_OverRideTime_TH_s = Simulink.Parameter(0.5, StorageClass="ExportedGlobal")
P_LCS_NoOverRideTime_TH_s = Simulink.Parameter(0.5, StorageClass="ExportedGlobal")
P_LCS_DetOverRide_DrvTrq_TH = Simulink.Parameter(1.5, StorageClass="ExportedGlobal")
P_LCS_DetNoOverRide_DrvTrq_TH = Simulink.Parameter(1.5, StorageClass="ExportedGlobal")
P_LCS_Trq_Switch = Simulink.Parameter(0, StorageClass="ExportedGlobal")
LCS_SubModel_VERSION = Simulink.Signal(StorageClass="ExportedGlobal")
LCS_SubModel_Number = Simulink.Signal(StorageClass="ExportedGlobal")
LCS_Trq_Switch = Simulink.Signal(StorageClass="ExportedGlobal")
LCS_Counter = Simulink.Signal(StorageClass="ExportedGlobal")
P_LCS_IN_Offset_Test_SW = Simulink.Parameter(0, StorageClass="ExportedGlobal")
P_LCS_IN_Offset_Test_Value = Simulink.Parameter(0, StorageClass="ExportedGlobal")
LCS_EPSFault = Simulink.Signal(StorageClass="ExportedGlobal")
P_LCS_ESS_SteerAngleErr = Simulink.Parameter(repmat(30, 1, 12), StorageClass="ExportedGlobal")
LCS_ESS_NotActiveDelayFlg = Simulink.Signal(StorageClass="ExportedGlobal")
LCS_IN_desLaneA3 = Simulink.Signal(StorageClass="ExportedGlobal")
LCS_IN_desLaneA2 = Simulink.Signal(StorageClass="ExportedGlobal")
LCS_IN_desLaneA1 = Simulink.Signal(StorageClass="ExportedGlobal")
LCS_LATC_ReqEPSTrgAngle_deg = Simulink.Signal(StorageClass="ExportedGlobal")
P_LCS_LATC_AngleFilterTime_s = Simulink.Parameter(0.1, StorageClass="ExportedGlobal")
LCS_LATC_PreIndex = Simulink.Signal(StorageClass="ExportedGlobal")
LCS_LATC_AngleSlopeFlg_st = Simulink.Signal(StorageClass="ExportedGlobal")
LCS_LATC_HoldTime_s = Simulink.Signal(StorageClass="ExportedGlobal")

P_LCS_PLAN_LCKAyDtLimit_Tab_ms3 = Simulink.Parameter([2 2 2 2 2 2 2 2 2 2 2 2 2 2 2 2
 2 2 2 2 2 2 2 2 2 2 2 2 2 2 2 2
 2 2 2 2 2 2 2 2 2 2 2 2 2 2 2 2
 2 2 2 2 2 2 2 2 2 2 2 2 2 2 2 2
 2 2 2 2 2 2 2 2 2 2 2 2 2 2 2 2
 2 2 2 2 2 2 2 2 2 2 2 2 2 2 2 2
 3 3 3 3 3 3 3 3 3 3 3 3 3 3 3 3
 3 3 3 3 3 3 3 3 3 3 3 3 3 3 3 3
 3 3 3 3 3 3 3 3 3 3 3 3 3 3 3 3
 4 4 4 4 4 4 4 4 4 4 4 4 4 4 4 4
 4 4 4 4 4 4 4 4 4 4 4 4 4 4 4 4
 5 5 5 5 5 5 5 5 5 5 5 5 5 5 5 5
 5 5 5 5 5 5 5 5 5 5 5 5 5 5 5 5], StorageClass="ExportedGlobal")

P_LCS_PLAN_LCKIEAyDtLimit_Tab_ms3 = Simulink.Parameter(repmat(3, 13, 16), StorageClass="ExportedGlobal")
P_LCS_PLAN_LCNormalAyDtLimit_Tab_ms3 = Simulink.Parameter(repmat(1.2, 13, 16), StorageClass="ExportedGlobal")
P_LCS_PLAN_LKAAyDtLimit_Tab_ms3 = Simulink.Parameter(repmat(3, 13, 16), StorageClass="ExportedGlobal")
P_LCS_PLAN_ELKAyDtLimit_Tab_ms3 = Simulink.Parameter(repmat(3, 13, 16), StorageClass="ExportedGlobal")
P_LCS_PLAN_ESSAyDtLimit_Tab_ms3 = Simulink.Parameter(repmat(3, 13, 16), StorageClass="ExportedGlobal")
P_LCS_PLAN_LCEcoAyDtLimit_Tab_ms3 = Simulink.Parameter(repmat(0.8, 13, 16), StorageClass="ExportedGlobal")
P_LCS_PLAN_LCSportAyDtLimit_Tab_ms3 = Simulink.Parameter(repmat(2.8, 13, 16), StorageClass="ExportedGlobal")
P_LCS_PLAN_LCCancleAyDtLimit_Tab_ms3 = Simulink.Parameter(repmat(4, 13, 16), StorageClass="ExportedGlobal")
P_LCS_LATC_MatrixR_st = Simulink.Parameter(repmat(1, 1, 16), StorageClass="ExportedGlobal", DataType="single")
LCS_PLAN_PreviewPointRefTheta = Simulink.Signal(StorageClass="ExportedGlobal")
P_LCS_LATC_MPCMatrixR_st = Simulink.Parameter(repmat(1, 1, 16), StorageClass="ExportedGlobal")
P_LCS_LATC_MPCMaxSterAngle_deg = Simulink.Parameter(90, StorageClass="ExportedGlobal")
P_LCS_LATC_MPCMaxSterAngleSpd_degs = Simulink.Parameter(0.4, StorageClass="ExportedGlobal")
P_LCS_LATC_MPCDeltaT_s = Simulink.Parameter(0.04, StorageClass="ExportedGlobal")
P_LCS_LATC_MPCMatrixQ1_st = Simulink.Parameter(repmat(0.1, 1, 16), StorageClass="ExportedGlobal")
P_LCS_LATC_MPCMatrixQ2_st = Simulink.Parameter(repmat(2, 1, 16), StorageClass="ExportedGlobal")
LCS_OffSetUpdate_Flg = Simulink.Signal(StorageClass="ExportedGlobal")
LCS_PreTraj_X = Simulink.Signal(StorageClass="ExportedGlobal")
LCS_PreTraj_Y = Simulink.Signal(StorageClass="ExportedGlobal")
LCS_LATC_OutTrgSteerAngle = Simulink.Signal(StorageClass="ExportedGlobal")
LCS_LATC_PlanT = Simulink.Signal(StorageClass="ExportedGlobal")
LCS_LATC_PlanLoopNum = Simulink.Signal(StorageClass="ExportedGlobal")
LCS_LATC_PlanLength = Simulink.Signal(StorageClass="ExportedGlobal")
LCS_LATC_PlanAyDt = Simulink.Signal(StorageClass="ExportedGlobal")

P_LCS_PLAN_LCKayDtLimit_Tab_ms3 = Simulink.Parameter([2 2 2 2 2 2 2 2 2 2 2 2 2 2 2 2
 2 2 2 2 2 2 2 2 2 2 2 2 2 2 2 2
 2 2 2 2 2 2 2 2 2 2 2 2 2 2 2 2
 2 2 2 2 2 2 2 2 2 2 2 2 2 2 2 2
 2 2 2 2 2 2 2 2 2 2 2 2 2 2 2 2
 2 2 2 2 2 2 2 2 2 2 2 2 2 2 2 2
 3 3 3 3 3 3 3 3 3 3 3 3 3 3 3 3
 3 3 3 3 3 3 3 3 3 3 3 3 3 3 3 3
 3 3 3 3 3 3 3 3 3 3 3 3 3 3 3 3
 4 4 4 4 4 4 4 4 4 4 4 4 4 4 4 4
 4 4 4 4 4 4 4 4 4 4 4 4 4 4 4 4
 5 5 5 5 5 5 5 5 5 5 5 5 5 5 5 5
 5 5 5 5 5 5 5 5 5 5 5 5 5 5 5 5], StorageClass="ExportedGlobal")

P_LCS_Plan_LCKIEAyDtLimit_Tab_ms3 = Simulink.Parameter(repmat(3, 13, 16), StorageClass="ExportedGlobal")
P_LCS_Plan_LCNomalAyDtLimit_Tab_ms3 = Simulink.Parameter(repmat(1.2, 13, 16), StorageClass="ExportedGlobal")
P_LCS_Plan_LKAAyDtLimit_Tab_ms3 = Simulink.Parameter(repmat(3, 13, 16), StorageClass="ExportedGlobal")
P_LCS_Plan_ELKAyDtLimit_Tab_ms3 = Simulink.Parameter(repmat(3, 13, 16), StorageClass="ExportedGlobal")
P_LCS_Plan_ESSAyDtLimit_Tab_ms3 = Simulink.Parameter(repmat(3, 13, 16))
P_LCS_Plan_LCEcoAyDtLimit_Tab_ms3 = Simulink.Parameter(repmat(0.8, 13, 16))
P_LCS_Plan_LCSportAyDtLimit_Tab_ms3 = Simulink.Parameter(repmat(2.8, 13, 16), StorageClass="ExportedGlobal")
P_LCS_Plan_LCAyDtLimit_Tab_ms3 = Simulink.Parameter(repmat(4, 13, 16), StorageClass="ExportedGlobal")
LCS_PLAN_PreViewIdxSW_b = Simulink.Parameter(0, StorageClass="ExportedGlobal", DataType="single")
LCS_PLAN_PreViewIdxNum = Simulink.Parameter(4, StorageClass="ExportedGlobal", DataType="single")
LCS_LATC_FinalpreDis = Simulink.Signal(StorageClass="ExportedGlobal")
LCS_LATC_MatrixResult_deg = Simulink.Signal(StorageClass="ExportedGlobal")
LCS_LATC_MPCDeltaT_s = Simulink.Signal(StorageClass="ExportedGlobal")
P_LCS_LATC_CurOffsetA2FliterT_s = Simulink.Parameter(0.2, StorageClass="ExportedGlobal")
LCS_TarSteerAngleCalc_Num = Simulink.Signal(StorageClass="ExportedGlobal")
LCS_PLAN_PreViewDt_cur = Simulink.Parameter(0.0005, StorageClass="ExportedGlobal")
LCS_IN_SteerAngleOffset_deg = Simulink.Signal(StorageClass="ExportedGlobal")
LCS_LATC_CorrectSteerAngle_deg = Simulink.Signal(StorageClass="ExportedGlobal")
P_LCS_LCC_ref_curve = Simulink.Parameter(0.02, StorageClass="ExportedGlobal", DataType="single")
P_LCS_LCC_Later_error = Simulink.Parameter(0.02, StorageClass="ExportedGlobal")
P_LCS_LCC_Later_error_rate = Simulink.Parameter(0.02, StorageClass="ExportedGlobal")
P_LCS_LCC_heading_error = Simulink.Parameter(0.02, StorageClass="ExportedGlobal")
P_LCS_LCC_LaterErrTime_s = Simulink.Parameter(0.02, StorageClass="ExportedGlobal")
P_LCS_LCC_RefcurveTime_s = Simulink.Parameter(0.02, StorageClass="ExportedGlobal")
P_LCS_LCC_LaterErrRateTime_s = Simulink.Parameter(0.02, StorageClass="ExportedGlobal")
P_LCS_LCC_HeadingErrTime_s = Simulink.Parameter(0.02, StorageClass="ExportedGlobal")
P_LCS_LCC_HeadingErRrateTime_s = Simulink.Parameter(0.02, StorageClass="ExportedGlobal")
P_LCS_LCC_RefThetaTime_s = Simulink.Parameter(0.02, StorageClass="ExportedGlobal")