% Simulink data dictionary IfDecisionLM.sldd
% references PubIfDecisionLM_RTE.sldd
% references PubIfFusionRFM_RTE.sldd

LM_C0InfoBefFilt = Simulink.Signal(DataType="Bus:LM_FusC0InfoBus")
LM_C0InfoFilt = Simulink.Signal(DataType="Bus:LM_FusC0InfoBus")
LM_ComAllLineLost_flg = Simulink.Signal(DataType="boolean")
LM_ComEVOffsetAng = Simulink.Signal(DataType="single")
LM_ComEVOffsetX = Simulink.Signal(DataType="single")
LM_ComEVOffsetY = Simulink.Signal(DataType="single")
LM_ComLineLostNum = Simulink.Signal(DataType="uint8")
LM_DIREgoVehOnLineValid = Simulink.Signal(DataType="boolean")
LM_DIRLeftTurnLampOnTime = Simulink.Signal(DataType="single")
LM_DIRRightTurnLampOnTime = Simulink.Signal(DataType="single")
LM_DIRTurnLeftProb = Simulink.Signal(DataType="single")
LM_DIRTurnLeftProbByKapTraj = Simulink.Signal(DataType="single")
LM_DIRTurnLeftProbByPsiDtopt = Simulink.Signal(DataType="single")
LM_DIRTurnLeftProbBySteerWheelAng = Simulink.Signal(DataType="single")
LM_DIRTurnLeftProbByTurnLampSts = Simulink.Signal(DataType="single")
LM_DIRTurnLeftProbByVehSpd = Simulink.Signal(DataType="single")
LM_DIRTurnLeftProbBytTurnLamp = Simulink.Signal(DataType="single")
LM_DIRTurnLeftValid = Simulink.Signal(DataType="boolean")
LM_DIRTurnRightProb = Simulink.Signal(DataType="single")
LM_DIRTurnRightProbByKapTraj = Simulink.Signal(DataType="single")
LM_DIRTurnRightProbByPsiDtopt = Simulink.Signal(DataType="single")
LM_DIRTurnRightProbBySteerWheelAng = Simulink.Signal(DataType="single")
LM_DIRTurnRightProbByTurnLampSts = Simulink.Signal(DataType="single")
LM_DIRTurnRightProbByVehSpd = Simulink.Signal(DataType="single")
LM_DIRTurnRightProbBytTurnLamp = Simulink.Signal(DataType="single")
LM_DIRTurnRightValid = Simulink.Signal(DataType="boolean")
LM_DrivInWLType = Simulink.Signal(DataType="uint8")
LM_EMLFntPath1Quality = Simulink.Signal(DataType="single")
LM_EMLFntPath2Quality = Simulink.Signal(DataType="single")
LM_EMLFntPath3Quality = Simulink.Signal(DataType="single")
LM_EMLFntPath_C2 = Simulink.Signal(DataType="single")
LM_EMLKap = Simulink.Signal(DataType="single")
LM_EMLKapCorr = Simulink.Signal(DataType="single")
LM_EMLLLC0 = Simulink.Signal(DataType="single")
LM_EMLLRC0 = Simulink.Signal(DataType="single")
LM_EMLMinKap = Simulink.Signal(DataType="single")
LM_EMLRLC0 = Simulink.Signal(DataType="single")
LM_EMLRRC0 = Simulink.Signal(DataType="single")
LM_EMLRearPath1P = Simulink.Signal(DataType="single", Dimensions=[1 4])
LM_EMLRearPath1Qulity = Simulink.Signal(DataType="single")
LM_EMLRearPath2P = Simulink.Signal(DataType="single", Dimensions=[1 4])
LM_EMLRearPath2Qulity = Simulink.Signal(DataType="single")
LM_EMLRearPath3P = Simulink.Signal(DataType="single", Dimensions=[1 4])
LM_EMLRearPath3Qulity = Simulink.Signal(DataType="single")
LM_FntPath1Dis = Simulink.Signal(DataType="single")
LM_FntPath2Dis = Simulink.Signal(DataType="single")
LM_FntPath3Dis = Simulink.Signal(DataType="single")
LM_FusBLInfoAdju = Simulink.Signal(DataType="Bus:LM_FusBLInfoBus")
LM_FusBLInfoBefFilt = Simulink.Signal(DataType="Bus:LM_FusBLInfoBus")
LM_FusBLInfoFilt = Simulink.Signal(DataType="Bus:LM_FusBLInfoBus")
LM_FusCase = Simulink.Signal(DataType="uint8")
LM_FusEVdiffValid = Simulink.Signal(DataType="boolean")
LM_FusOTLValid = Simulink.Signal(DataType="boolean")
LM_FusRatioInfo = Simulink.Signal(DataType="Bus:LM_FusRatioInfoBus")
LM_FusVSLValid = Simulink.Signal(DataType="boolean")
LM_LINE_LL = Simulink.Signal(DataType="Bus:LM_LINE_BUS")
LM_LINE_LR = Simulink.Signal(DataType="Bus:LM_LINE_BUS")
LM_LINE_RL = Simulink.Signal(DataType="Bus:LM_LINE_BUS")
LM_LINE_RR = Simulink.Signal(DataType="Bus:LM_LINE_BUS")
LM_OTLBufE1Flg = Simulink.Signal(DataType="uint8", Dimensions=3)
LM_OTLBufE1LastFlg = Simulink.Signal(DataType="uint8", Dimensions=3)
LM_OTLBufE1LastValid = Simulink.Signal(DataType="uint8", Dimensions=3)
LM_OTLBufE1Valid = Simulink.Signal(DataType="uint8", Dimensions=3)
LM_OTLBufE2Flg = Simulink.Signal(DataType="uint8", Dimensions=3)
LM_OTLBufE2LastFlg = Simulink.Signal(DataType="uint8", Dimensions=3)
LM_OTLBufE2LastValid = Simulink.Signal(DataType="uint8", Dimensions=3)
LM_OTLBufE2Valid = Simulink.Signal(DataType="uint8", Dimensions=3)
LM_OTLBufL1Flg = Simulink.Signal(DataType="uint8", Dimensions=3)
LM_OTLBufL1LastFlg = Simulink.Signal(DataType="uint8", Dimensions=3)
LM_OTLBufL1LastValid = Simulink.Signal(DataType="uint8", Dimensions=3)
LM_OTLBufL1Valid = Simulink.Signal(DataType="uint8", Dimensions=3)
LM_OTLBufL2Flg = Simulink.Signal(DataType="uint8", Dimensions=3)
LM_OTLBufL2LastFlg = Simulink.Signal(DataType="uint8", Dimensions=3)
LM_OTLBufL2LastValid = Simulink.Signal(DataType="uint8", Dimensions=3)
LM_OTLBufL2Valid = Simulink.Signal(DataType="uint8", Dimensions=3)
LM_OTLBufR1Flg = Simulink.Signal(DataType="uint8", Dimensions=3)
LM_OTLBufR1LastFlg = Simulink.Signal(DataType="uint8", Dimensions=3)
LM_OTLBufR1LastValid = Simulink.Signal(DataType="uint8", Dimensions=3)
LM_OTLBufR1Valid = Simulink.Signal(DataType="uint8", Dimensions=3)
LM_OTLBufR2Flg = Simulink.Signal(DataType="uint8", Dimensions=3)
LM_OTLBufR2LastFlg = Simulink.Signal(DataType="uint8", Dimensions=3)
LM_OTLBufR2LastValid = Simulink.Signal(DataType="uint8", Dimensions=3)
LM_OTLBufR2Valid = Simulink.Signal(DataType="uint8", Dimensions=3)
LM_OTLCurEgoLaObj1Index = Simulink.Signal(DataType="uint8")
LM_OTLCurEgoLaObj2Index = Simulink.Signal(DataType="uint8")
LM_OTLCurLeLaObj1Index = Simulink.Signal(DataType="uint8")
LM_OTLCurLeLaObj2Index = Simulink.Signal(DataType="uint8")
LM_OTLCurRigLaObj1Index = Simulink.Signal(DataType="uint8")
LM_OTLCurRigLaObj2Index = Simulink.Signal(DataType="uint8")
LM_OTLFntPath1P = Simulink.Signal(DataType="single", Dimensions=[1 4])
LM_OTLFntPath1Qulity = Simulink.Signal(DataType="single")
LM_OTLFntPath2P = Simulink.Signal(DataType="single", Dimensions=[1 4])
LM_OTLFntPath2Qulity = Simulink.Signal(DataType="single")
LM_OTLFntPath3P = Simulink.Signal(DataType="single", Dimensions=[1 4])
LM_OTLFntPath3Qulity = Simulink.Signal(DataType="single")
LM_OTL_MovObjValid = Simulink.Signal(DataType="boolean", Dimensions=80)
LM_RFM_LINE_CL = Simulink.Signal(DataType="Bus:RFM_LINE_BUS")
LM_RFM_LINE_L2 = Simulink.Signal(DataType="Bus:RFM_LINE_BUS")
LM_RFM_LINE_LB = Simulink.Signal(DataType="Bus:RFM_LINE_BUS")
LM_RFM_LINE_R2 = Simulink.Signal(DataType="Bus:RFM_LINE_BUS")
LM_RFM_LINE_RB = Simulink.Signal(DataType="Bus:RFM_LINE_BUS")
LM_RearPath1Dis = Simulink.Signal(DataType="single")
LM_RearPath2Dis = Simulink.Signal(DataType="single")
LM_RearPath3Dis = Simulink.Signal(DataType="single")
LM_RoadNumChgType = Simulink.Signal(DataType="uint8")
LM_SpecialRoadType = Simulink.Signal(DataType="uint8")
LM_SteerAngleOffset_deg = Simulink.Signal(DataType="single")
LM_VCAN_CSA = Simulink.Signal(DataType="Bus:LM_VCAN_CSA_BUS")
LM_VCAN_ESP = Simulink.Signal(DataType="Bus:LM_VCAN_ESP_BUS")
LM_VSLBLFntDis = Simulink.Signal(DataType="single")
LM_VSLBLIndex = Simulink.Signal(DataType="uint8")
LM_VSLBaseC1 = Simulink.Signal(DataType="single")
LM_VSLBaseC1Filt = Simulink.Signal(DataType="single")
LM_VSLBaseC2 = Simulink.Signal(DataType="single")
LM_VSLBaseC2Filt = Simulink.Signal(DataType="single")
LM_VSLBaseC3 = Simulink.Signal(DataType="single")
LM_VSLBaseC3Filt = Simulink.Signal(DataType="single")
LM_VSLBaseQuality = Simulink.Signal(DataType="single")
LM_VSLBaseQualityFilt = Simulink.Signal(DataType="single")
LM_VSLDiffValid = Simulink.Signal(DataType="boolean", Dimensions=4)
LM_VSLDiffValue = Simulink.Signal(DataType="single", Dimensions=4)
LM_VSLFntPath1Quality = Simulink.Signal(DataType="single")
LM_VSLFntPath2Quality = Simulink.Signal(DataType="single")
LM_VSLFntPath3Quality = Simulink.Signal(DataType="single")
LM_VSLHistLineInfoRcdFlg = Simulink.Signal(DataType="boolean")
LM_VSLHistPEndPos = Simulink.Signal(DataType="uint8")
LM_VSLHistPFristPos = Simulink.Signal(DataType="uint8")
LM_VSLHistPNum = Simulink.Signal(DataType="uint8")
LM_VSLL1C0 = Simulink.Signal(DataType="single")
LM_VSLL1C1 = Simulink.Signal(DataType="single")
LM_VSLL1C2 = Simulink.Signal(DataType="single")
LM_VSLL1C3 = Simulink.Signal(DataType="single")
LM_VSLL1bIsLineExist = Simulink.Signal(DataType="uint8")
LM_VSLL1dDisFront = Simulink.Signal(DataType="single")
LM_VSLL1dDisStart = Simulink.Signal(DataType="single")
LM_VSLL1dQuality = Simulink.Signal(DataType="single")
LM_VSLL2C0 = Simulink.Signal(DataType="single")
LM_VSLL2C1 = Simulink.Signal(DataType="single")
LM_VSLL2C2 = Simulink.Signal(DataType="single")
LM_VSLL2C3 = Simulink.Signal(DataType="single")
LM_VSLL2bIsLineExist = Simulink.Signal(DataType="uint8")
LM_VSLL2dDisFront = Simulink.Signal(DataType="single")
LM_VSLL2dDisStart = Simulink.Signal(DataType="single")
LM_VSLL2dQuality = Simulink.Signal(DataType="single")
LM_VSLLLC0 = Simulink.Signal(DataType="single")
LM_VSLLRC0 = Simulink.Signal(DataType="single")
LM_VSLLaChgC0JumpFlg = Simulink.Signal(DataType="int8")
LM_VSLLineDiffnum = Simulink.Signal(DataType="single")
LM_VSLLineMaxDis = Simulink.Signal(DataType="single")
LM_VSLLineMaxQualityIndex = Simulink.Signal(DataType="uint8")
LM_VSLLineMinQualityIndex = Simulink.Signal(DataType="uint8")
LM_VSLLineMinQualityLineValid = Simulink.Signal(DataType="boolean")
LM_VSLR1C0 = Simulink.Signal(DataType="single")
LM_VSLR1C1 = Simulink.Signal(DataType="single")
LM_VSLR1C2 = Simulink.Signal(DataType="single")
LM_VSLR1C3 = Simulink.Signal(DataType="single")
LM_VSLR1bIsLineExist = Simulink.Signal(DataType="uint8")
LM_VSLR1dDisFront = Simulink.Signal(DataType="single")
LM_VSLR1dDisStart = Simulink.Signal(DataType="single")
LM_VSLR1dQuality = Simulink.Signal(DataType="single")
LM_VSLR2C0 = Simulink.Signal(DataType="single")
LM_VSLR2C1 = Simulink.Signal(DataType="single")
LM_VSLR2C2 = Simulink.Signal(DataType="single")
LM_VSLR2C3 = Simulink.Signal(DataType="single")
LM_VSLR2bIsLineExist = Simulink.Signal(DataType="uint8")
LM_VSLR2dDisFront = Simulink.Signal(DataType="single")
LM_VSLR2dDisStart = Simulink.Signal(DataType="single")
LM_VSLR2dQuality = Simulink.Signal(DataType="single")
LM_VSLRLC0 = Simulink.Signal(DataType="single")
LM_VSLRRC0 = Simulink.Signal(DataType="single")
LM_VSLRearPath1P = Simulink.Signal(DataType="single", Dimensions=[1 4])
LM_VSLRearPath1Qulity = Simulink.Signal(DataType="single")
LM_VSLRearPath2P = Simulink.Signal(DataType="single", Dimensions=[1 4])
LM_VSLRearPath2Qulity = Simulink.Signal(DataType="single")
LM_VSLRearPath3P = Simulink.Signal(DataType="single", Dimensions=[1 4])
LM_VSLRearPath3Qulity = Simulink.Signal(DataType="single")
LM_VSL_RearLRC0 = Simulink.Signal(DataType="single")
LM_VSL_RearRLC0 = Simulink.Signal(DataType="single")
LM_alpSideSlipAngle = Simulink.Signal(DataType="single")
LM_axRefDt = Simulink.Signal(DataType="single")
LM_axRefMs2 = Simulink.Signal(DataType="single")
LM_axvRefMs2 = Simulink.Signal(DataType="single")
LM_axvRoadSlopeMs2 = Simulink.Signal(DataType="single")
LM_ayvRefMs2 = Simulink.Signal(DataType="single")
LM_kapTraj = Simulink.Signal(DataType="single")
LM_psiDtOpt = Simulink.Signal(DataType="single")
LM_vxvRefMs = Simulink.Signal(DataType="single")
P_LM_Cyc = Simulink.Parameter(0.05, DataType="single")
P_LM_EMLHistKapRcdBufSize = Simulink.Parameter(25, DataType="uint8")
P_LM_EMLHistTrajBaseDis = Simulink.Parameter(1.5, DataType="single")
P_LM_EMLHistTrajPNum = Simulink.Parameter(80, DataType="uint8")
P_LM_EMLKapCorrMaxThre = Simulink.Parameter(0.002, DataType="single")
P_LM_EMLMinKapThre = Simulink.Parameter(0.002, DataType="single")
P_LM_EMLPathDisDiffThre = Simulink.Parameter(15, DataType="single")
P_LM_EMLQuaFiltPar = Simulink.Parameter(0.35, DataType="single")
P_LM_EMLTurnActKapThre = Simulink.Parameter(0.03, DataType="single")
P_LM_EMLValidQuaThre = Simulink.Parameter(0.1, DataType="single")
P_LM_FntPath1Disgap = Simulink.Parameter(35, DataType="single")
P_LM_FntPath1MinDis = Simulink.Parameter(70, DataType="single")
P_LM_FntPath1Timegap = Simulink.Parameter(2, DataType="single")

P_LM_FntPath2Disgap = Simulink.Parameter(30, DataType="single")
P_LM_FntPath2MinDis = Simulink.Parameter(120, DataType="single")
P_LM_FntPath2Timegap = Simulink.Parameter(1.5, DataType="single")
P_LM_FntPath3Disgap = Simulink.Parameter(30, DataType="single")
P_LM_FntPath3MinDis = Simulink.Parameter(150, DataType="single")
P_LM_FntPath3Timegap = Simulink.Parameter(1.5, DataType="single")
P_LM_FusBLParFiltP = Simulink.Parameter(0.25, DataType="single")
P_LM_FusEVDifC2Thre = Simulink.Parameter(0.005, DataType="single")
P_LM_FusEVOPath1AllVSLDisThre = Simulink.Parameter(8, DataType="single")
P_LM_FusEVOPath1AllVSLLostNumThre = Simulink.Parameter(1, DataType="uint8")
P_LM_FusEVOPath1AllVSLQuaThre = Simulink.Parameter(0.65, DataType="single")
P_LM_FusEVOPath1OTLFacNLC = Simulink.Parameter(0.65, DataType="single")
P_LM_FusOTLQuaThre = Simulink.Parameter(0.3, DataType="single")
P_LM_FusOTLSW = Simulink.Parameter(1, DataType="uint8")
P_LM_FusParC0Index = Simulink.Parameter(4, DataType="uint8")
P_LM_FusParC1Index = Simulink.Parameter(3, DataType="uint8")
P_LM_FusParC2Index = Simulink.Parameter(2, DataType="uint8")
P_LM_FusParC3Index = Simulink.Parameter(1, DataType="uint8")
P_LM_FusStraLineC2Thre = Simulink.Parameter(0.0001, DataType="single")
P_LM_FusStraLineC3Thre = Simulink.Parameter(1.0e-6, DataType="single")
P_LM_FusVSLQuaThre = Simulink.Parameter(0.1, DataType="single")
P_LM_FusVSLSW = Simulink.Parameter(1, DataType="uint8")
P_LM_FusVSLValidSteerWheerAngThre = Simulink.Parameter(100, DataType="single")
P_LM_FusVSLValidVxvThre = Simulink.Parameter(2, DataType="single")
P_LM_FusVehChgLaC1Thre = Simulink.Parameter(0.3, DataType="single")
P_LM_FusVehChgLaC2Thre = Simulink.Parameter(0.002, DataType="single")
P_LM_LaneWidth = Simulink.Parameter(3.5, DataType="single")
P_LM_OTLBufTPInfoEvaFactor = Simulink.Parameter(0.1, DataType="single")
P_LM_OTLBufTPMinPntNum = Simulink.Parameter(10, DataType="uint8")
P_LM_OTLBufTPSPosMinDis = Simulink.Parameter(5, DataType="single")
P_LM_OTLObjNum = Simulink.Parameter(80, DataType="uint8")
P_LM_OTLObjSelectAgeThre = Simulink.Parameter(5, DataType="uint16")
P_LM_OTLObjSelectDxAssessVx = Simulink.Parameter([0 2.7 5.775 8.85 11.925 15 40], DataType="single")
P_LM_OTLObjSelectDxThre = Simulink.Parameter([120 120 135 150 165 180 180], DataType="single")
P_LM_OTLObjSelectVxThre = Simulink.Parameter(6, DataType="single")
P_LM_OTLObjSelectVyAssessDx = Simulink.Parameter([10 40 70 100 130], DataType="single")
P_LM_OTLObjSelectVyThre = Simulink.Parameter([2 3 4 5 6], DataType="single")
P_LM_OTLRearMaxDis = Simulink.Parameter(-80, DataType="single")
P_LM_OTLTPNum = Simulink.Parameter(80, DataType="uint8")
P_LM_OTLTrajPntBaseDis = Simulink.Parameter(2, DataType="single")
P_LM_OTLTrajStdThre = Simulink.Parameter(0.5, DataType="single")
P_LM_RearPath1Disgap = Simulink.Parameter(30, DataType="single")
P_LM_RearPath1MinDis = Simulink.Parameter(35, DataType="single")
P_LM_RearPath1Timegap = Simulink.Parameter(2, DataType="single")
P_LM_RearPath2Disgap = Simulink.Parameter(25, DataType="single")
P_LM_RearPath2MinDis = Simulink.Parameter(65, DataType="single")
P_LM_RearPath2Timegap = Simulink.Parameter(1.5, DataType="single")
P_LM_RearPath3Disgap = Simulink.Parameter(25, DataType="single")
P_LM_RearPath3MinDis = Simulink.Parameter(85, DataType="single")
P_LM_RearPath3Timegap = Simulink.Parameter(1.5, DataType="single")
P_LM_VSLBLSDiffThre = Simulink.Parameter(1, DataType="single")
P_LM_VSLBLSDisRatio = Simulink.Parameter(0.6, DataType="single")
P_LM_VSLBLSQualityRatio = Simulink.Parameter(0.75, DataType="single")
P_LM_VSLFusBLParFiltP_C1 = Simulink.Parameter(0.5, DataType="single")
P_LM_VSLFusBLParFiltP_C2 = Simulink.Parameter(0.25, DataType="single")
P_LM_VSLFusBLParFiltP_C3 = Simulink.Parameter(0.25, DataType="single")
P_LM_VSLFusBLParFiltP_Quality = Simulink.Parameter(0.25, DataType="single")
P_LM_VSLHistTrajBaseDis = Simulink.Parameter(1.5, DataType="single")
P_LM_VSLHistTrajPNum = Simulink.Parameter(60, DataType="single")
P_LM_VSLLCC0diff = Simulink.Parameter(2.9, DataType="single")
P_LM_VSLLCFntPathC1 = Simulink.Parameter(0.03, DataType="single")
P_LM_VSLLCMaxC0 = Simulink.Parameter(3, DataType="single")
P_LM_VSLLCMinC0 = Simulink.Parameter(0.9, DataType="single")
P_LM_VSLLineMinQualityThre = Simulink.Parameter(0.15, DataType="single")
P_LM_VSLLinePdiffThre = Simulink.Parameter(0.5, DataType="single")
P_LM_VSLLineQualitydiffThre = Simulink.Parameter(0.3, DataType="single")
P_LM_VSLMaxLINEL1 = Simulink.Parameter(3.5, DataType="single")
P_LM_VSLMaxLINEL2 = Simulink.Parameter(7, DataType="single")
P_LM_VSLMaxLINER1 = Simulink.Parameter(0.8, DataType="single")
P_LM_VSLMaxLINER2 = Simulink.Parameter(-2.8, DataType="single")
P_LM_VSLMinLINEL1 = Simulink.Parameter(-0.8, DataType="single")
P_LM_VSLMinLINEL2 = Simulink.Parameter(2.8, DataType="single")
P_LM_VSLMinLINER1 = Simulink.Parameter(-3.5, DataType="single")
P_LM_VSLMinLINER2 = Simulink.Parameter(-7, DataType="single")
P_LM_VSLPath1DisDiffThre = Simulink.Parameter(5, DataType="single")
P_LM_VSLPath2DisDiffThre = Simulink.Parameter(15, DataType="single")
P_LM_VSLRearLanePolyfitQualityRatio = Simulink.Parameter(5, DataType="single")
P_LM_VSLRearLaneQualityRatio = Simulink.Parameter(0.3, DataType="single")
P_LM_VSLAvailLineNum = Simulink.Parameter(single([1 2 3 4]))
P_LM_VSLLineBaseQualityRatio = Simulink.Parameter(single([0.3 0.8 1 1]))
LM_RFM_LINE_R1 = Simulink.Signal(DataType="Bus: RFM_LINE_BUS")
LM_RFM_LINE_L1 = Simulink.Signal(DataType="Bus: RFM_LINE_BUS")

LM_FusBLInfoBus = Simulink.Bus()
  LM_FusBLFntPath1Info: Bus:LM_FusBLPathInfoBus
  LM_FusBLFntPath2Info: Bus:LM_FusBLPathInfoBus
  LM_FusBLFntPath3Info: Bus:LM_FusBLPathInfoBus
  LM_FusBLRearPath1Info: Bus:LM_FusBLPathInfoBus
  LM_FusBLRearPath2Info: Bus:LM_FusBLPathInfoBus
  LM_FusBLRearPath3Info: Bus:LM_FusBLPathInfoBus

LM_FusBLPathInfoBus = Simulink.Bus()
  LM_FusBLPathC0: single
  LM_FusBLPathC1: single
  LM_FusBLPathC2: single
  LM_FusBLPathC3: single
  LM_FusBLPathQuality: single

LM_FusC0InfoBus = Simulink.Bus()
  LM_LLC0: single
  LM_LRC0: single
  LM_RLC0: single
  LM_RRC0: single

LM_FusFntPathKInfoBus = Simulink.Bus()
  LM_FusFntPath1EMLK: single
  LM_FusFntPath1VSLK: single
  LM_FusFntPath1OTLK: single
  LM_FusFntPath1RELK: single
  LM_FusFntPath1MALK: single
  LM_FusFntPath2EMLK: single
  LM_FusFntPath2VSLK: single
  LM_FusFntPath2OTLK: single
  LM_FusFntPath2RELK: single
  LM_FusFntPath2MALK: single
  LM_FusFntPath3EMLK: single
  LM_FusFntPath3VSLK: single
  LM_FusFntPath3OTLK: single
  LM_FusFntPath3RELK: single
  LM_FusFntPath3MALK: single

LM_FusRatioInfoBus = Simulink.Bus()
  LM_FusFntPathK: Bus:LM_FusFntPathKInfoBus
  LM_FusRearPathK: Bus:LM_FusRearPathKInfoBus

LM_FusRearPathKInfoBus = Simulink.Bus()
  LM_FusRearPath1VSLK: single
  LM_FusRearPath2VSLK: single
  LM_FusRearPath3VSLK: single
  LM_FusFntPath1EMLK: single
  LM_FusFntPath2EMLK: single
  LM_FusFntPath3EMLK: single