% Simulink data dictionary PvtIfTOS.sldd

C_TOS_AEBLongTargetInEgoFront_Flag = Simulink.Parameter(1, DataType="boolean")  % 目标是否位于本车道内标志位
C_TOS_DxDefaultValue_m = Simulink.Parameter(255, DataType="single")  % 目标选择，dx纵向距离默认值 255
C_TOS_ACCTargetInEgoFront_Flag = Simulink.Parameter(1, DataType="boolean")  % ACC本车道内目标，标志位
C_TOS_AEBLatCarDyThre_Val = Simulink.Parameter(12, DataType="single")
C_TOS_AEBLatObjDxThre_Val = Simulink.Parameter(40, DataType="single")
C_TOS_AEBLatPedDyThre_Val = Simulink.Parameter(8, DataType="single")
C_TOS_CameraInvolvedObjFusionType = Simulink.Parameter(1, DataType="int8")  % 摄像头参与融合的目标，dx、dy 距离约束有效
C_TOS_CameraNOTInvolvedObjFusionType = Simulink.Parameter(0, DataType="int8")  % 摄像头参与融合的目标，dx、dy 距离约束无效
C_TOS_CoreAreaOfCurrentLaneInvalid = Simulink.Parameter(255, DataType="single")
C_TOS_CurrentLaneCoreMinWidth_Val = Simulink.Parameter(0, DataType="single")
C_TOS_CutOutProb_Val_Zero = Simulink.Parameter(0, DataType="single")  % 目标切出可能性为 0
C_TOS_DefaultValueObjectToCenterLine_dy = Simulink.Parameter(255, DataType="single")  % 目标dx范围dx>150m 或 dx<-80m时，默认目标到车道中心线距离 dis=dy-255
C_TOS_EffectiveTargetFilteringInvalid = Simulink.Parameter(255, DataType="single")  % 初步筛选目标无效，横向距离赋值255（摄像头参与：dx、dy距离约束; 雷达目标（无摄像头参与目标）：var方差约束）
C_TOS_HalfWidthVehicle_Con = Simulink.Parameter(0.5, DataType="single")  % 车辆宽度一半；参数 0.5
C_TOS_LaneLineCourseErrorFront = Simulink.Parameter(0.00014, DataType="single")
C_TOS_LaneLineCourseErrorRear = Simulink.Parameter(0.00014, DataType="single")  % 自车后方道路曲率偏差 0.00014
C_TOS_NumberOfEffectiveTargets = Simulink.Parameter(80, DataType="uint8")
C_TOS_ObjID_InvalidPIL_Val = Simulink.Parameter(0, DataType="single")  % 目标无效时；PIL值默认0
C_TOS_ObjID_Invalid_Val = Simulink.Parameter(0, DataType="uint8")  % 目标无效时，ID默认值0
C_TOS_ObjInCurrentLane_Val = Simulink.Parameter(1, DataType="single")  % 目标位于本车道核心区域内
C_TOS_ObjLifeCycle_ms = Simulink.Parameter(2, DataType="uint16")  % 目标存在的生命周期数 >=2  // ObjectToCenterLine_dy 滤波系数
C_TOS_ObjNotInCurrentLane_Val = Simulink.Parameter(0, DataType="single")
C_TOS_ObjPredictDis_dy_ConstantVal_Zeros = Simulink.Parameter(0, DataType="single")  % 根据ObjectToCenterLine_dy 、 目标预测距离判断；车辆过中心线预测距离置0
C_TOS_ObjToCenterLine_ConstantVal_Zeros = Simulink.Parameter(0, DataType="single")  % 目标到中心线之间距离；判断目标在左侧OR右侧 ；常量0
C_TOS_Obj_Age_Val = Simulink.Parameter(1, DataType="uint16")
C_TOS_Obj_InitializationVariableDeclaration = Simulink.Parameter(repmat(0, 80, 1), DataType="single")
C_TOS_Objdx_Constraint_Val = Simulink.Parameter(0, DataType="single")  % Obj dx 大于常数 0
C_TOS_ObjectDefaultValueIDInvalid = Simulink.Parameter(0, DataType="single")
C_TOS_PIL_LatDisCons_Val_zero = Simulink.Parameter(0, DataType="single")  % 计算PIL考虑车辆宽度后，dyc ± objwdth 约束值 0

C_TOS_RadarInvolvedObjFusionType_VarNOSatisfy = Simulink.Parameter(0, DataType="int8")  % 只有雷达参与融合目标，且方差不满足条件
  % // TOS_20200903/TOS/PIL1/EffectiveTargetFiltering/Subsystem

C_TOS_RadarInvolvedObjFusionType_VarSatisfy = Simulink.Parameter(1, DataType="int8")  % 只有雷达参与融合目标，且方差满足条件
  % // TOS_20200903/TOS/PIL1/EffectiveTargetFiltering/Subsystem

C_TOS_SpeedUnitConversionTO_km_h = Simulink.Parameter(3.6, DataType="single")  % 车速单位转换；m/s转换为km/h
C_TOS_axAbsGround_Parameter = Simulink.Parameter(0, DataType="single")
C_TOS_dyEdgeWidthLeftInvalid = Simulink.Parameter(0, DataType="single")
C_TOS_AEBJATargetSize_Val = Simulink.Parameter(32, DataType="uint8")
C_TOS_AEBLatTargetSize_Val = Simulink.Parameter(10, DataType="uint8")
C_TOS_CutInProb_Val_Zero = Simulink.Parameter(0, DataType="single")  % 目标不满足cut in条件时，cutin概率值置为0
C_TOS_ObjInLaneValid = Simulink.Parameter(1, DataType="boolean")  % 目标所在车道有效
C_TOS_ObjInCurrentLaneValid = Simulink.Parameter(1, DataType="uint8")  % 目标在本车道
C_TOS_ObjInLeftLaneValid = Simulink.Parameter(2, DataType="uint8")  % 目标在左车道
C_TOS_ObjInRightLaneValid = Simulink.Parameter(3, DataType="uint8")  % 目标在右车道
C_TOS_ObjInLaneInvalid = Simulink.Parameter(0, DataType="uint8")  % 目标所在车道无效
C_TOS_EgoCarWidth_Val = Simulink.Parameter(1.88, DataType="single")  % 自车宽度
C_TOS_EgoCar_LeftLaneDefaultProb_Val = Simulink.Parameter(0, DataType="single")  % 自车在左车道概率默认值 0
C_TOS_EgoCar_RightLaneDefaultProb_Val = Simulink.Parameter(0, DataType="single")  % 自车在右车道概率默认值 0
C_TOS_EgoCar_CurrentLaneProb_Val = Simulink.Parameter(1, DataType="single")  % 自车位于本车道内
C_TOS_EgoCar_CurrentLaneDefaultProb_Val = Simulink.Parameter(1, DataType="single")  % 自车在中间车道概率默认值 0
C_TOS_ACCTargetInLeftLaneFront_Flag = Simulink.Parameter(1, DataType="boolean")  % 目标在左车道内
C_TOS_ACCTargetInRightLaneFront_Flag = Simulink.Parameter(1, DataType="boolean")  % 目标在右车道内
C_TOS_OFMObjIDInvilad_Val = Simulink.Parameter(0, DataType="uint8")
C_TOS_D2R_Val = Simulink.Parameter(360, DataType="single")
C_TOS_AEBLatOtherTypeDyThre_Val = Simulink.Parameter(8, DataType="single")
C_TOS_EgoDxRefPoint_m = Simulink.Parameter(0, DataType="single")  % 车体系下dx参考点原点
C_TOS_ACCTargetFront_Flag = Simulink.Parameter(1, DataType="boolean")
C_TOS_EgoCarDisThreshold_m = Simulink.Parameter(8.5, DataType="single")  % 自车前保向前4.5m距离
C_TOS_HWA_LeftLaneFlag = Simulink.Parameter(1, DataType="boolean")
C_TOS_HWA_RightLaneFlag = Simulink.Parameter(1, DataType="boolean")
C_TOS_HWA_CurrentLaneFlag = Simulink.Parameter(1, DataType="boolean")
C_TOS_PP_ObjFusType_FC_FR_Confirm_b = Simulink.Parameter(1, DataType="boolean")
C_TOS_PP_ObjFusType_FR_Confirm_b = Simulink.Parameter(1, DataType="boolean")
C_TOS_PP_ObjFusType_FC_Confirm_b = Simulink.Parameter(1, DataType="boolean")
C_TOS_CNsubjWidth = Simulink.Parameter(1.8, DataType="single")
C_TOS_CameraConfirmedFlag = Simulink.Parameter(1, DataType="boolean")
C_TOS_PIL_ObjLaneProb_al_Val = Simulink.Parameter(0.2, DataType="single")  % 目标在三个车道内总的概率值
C_TOS_MotorbikeDefaultWidth_m = Simulink.Parameter(1, DataType="single")  % cut in 摩托车宽度 1m
C_TOS_ObjectDefaultWidth_m = Simulink.Parameter(0.5, DataType="single")  % 行人、自行车、摩托车；未知类型目标 默认宽度0.5
C_TOS_PIL_ObjectCutInFlag_b = Simulink.Parameter(1, DataType="boolean")  % TLJ 目标切入判断
C_TOS_PIL_ObjectCutOutFlag_b = Simulink.Parameter(1, DataType="boolean")  % TLJ 目标切出判断
C_TOS_StepTime_Val = Simulink.Parameter(0.05, DataType="single")
C_TOS_AEBJuncPedTargetSize_Val = Simulink.Parameter(16, DataType="uint8")
C_TOS_AEBJAPedObjDxThre_Val = Simulink.Parameter(25, DataType="single")
C_TOS_AEBJAVehObjDxThre_Val = Simulink.Parameter(50, DataType="single")
C_TOS_AEBJAVehObjDyThre_Val = Simulink.Parameter(10, DataType="single")
C_TOS_AEBJAPedObjDyThre_Val = Simulink.Parameter(10, DataType="single")
C_TOS_EgoRAxletoFbumplength_m = Simulink.Parameter(0, DataType="single")
C_TOS_ACCEgoRAxletoFbumplength_m = Simulink.Parameter(3.93, DataType="single")
C_TOS_HWA_MovingDir_Vaild = Simulink.Parameter(1, DataType="boolean")
C_TOS_HWA_MovState_Vaild = Simulink.Parameter(1, DataType="boolean")
C_TOS_ObjNotREElementType = Simulink.Parameter(0, DataType="uint8")
C_TOS_RE_D2R = Simulink.Parameter(57.29578, DataType="single")
C_TOS_RE_D_180_Val = Simulink.Parameter(180, DataType="single")
C_TOS_RE_InvalidFlag_bool = Simulink.Parameter(0, DataType="boolean")
C_TOS_RE_ObjectNum_Val = Simulink.Parameter(80, DataType="uint8")
C_TOS_RE_InvalidObjectID_Val = Simulink.Parameter(0, DataType="uint8")
C_TOS_StillObjSortInvalidIndex_Val = Simulink.Parameter(0, DataType="uint8")
C_TOS_RE_ThretaDefault_Val = Simulink.Parameter(181, DataType="single")
C_TOS_RE_InvalidTargetChainDir_Val = Simulink.Parameter(0, DataType="uint8")
C_TOS_RE_ObjectNumDefault_Val = Simulink.Parameter(80, DataType="single")
C_TOS_RE_80Single181Default_Val = Simulink.Parameter(repmat(181, 80, 1), DataType="single")
C_TOS_RE_80Uint8Default_Val = Simulink.Parameter(repmat(0, 80, 1), DataType="uint8")
C_TOS_RE_80BoolDefault_Val = Simulink.Parameter(repmat(0, 80, 1), DataType="boolean")
C_TOS_RE_80Single255Default_Val = Simulink.Parameter(repmat(255, 80, 1), DataType="single")
P_TOS_P0_Trajectory_TrackRecord_Num = Simulink.Parameter(80, DataType="single")

OFM_OBJ_FUSTYPE = enum(DefaultValue="FC_FR", AddClassNameToEnumNames=true)
  FC_FR = 3  % FC代表摄像头；FR代表前雷达；
  FC_FR_CL = 7  % CL代表左角雷达；CR代表右角雷达；
  FC_FR_CR = 11  % BL代表左盲点雷达；BR代表右盲点雷达；
  FC_FR_CL_CR = 15
  FC_FR_BL = 19
  FC_FR_CL_BL = 23
  FC_FR_CR_BL = 27
  FC_FR_CL_CR_BL = 31
  FC_FR_BR = 35
  FC_FR_CL_BR = 39
  FC_FR_CR_BR = 43
  FC_FR_CL_CR_BR = 47
  FC_FR_BL_BR = 51
  FC_FR_CL_BL_BR = 55
  FC_FR_CR_BL_BR = 59
  FC_FR_CL_CR_BL_BR = 63
  INVALID = 0
  FC = 1
  FR = 2
  CL = 4
  FC_CL = 5
  FR_CL = 6
  CR = 8
  FC_CR = 9
  FR_CR = 10
  CL_CR = 12
  FC_CL_CR = 13
  FR_CL_CR = 14
  BL = 16
  FC_BL = 17
  FR_BL = 18
  CL_BL = 20
  FC_CL_BL = 21
  FR_CL_BL = 22
  CR_BL = 24
  FC_CR_BL = 25
  FR_CR_BL = 26
  CL_CR_BL = 28
  FC_CL_CR_BL = 29
  FR_CL_CR_BL = 30
  BR = 32
  FC_BR = 33
  FR_BR = 34
  CL_BR = 36
  FC_CL_BR = 37
  FR_CL_BR = 38
  CR_BR = 40
  FC_CR_BR = 41
  FR_CR_BR = 42
  CL_CR_BR = 44
  FC_CL_CR_BR = 45
  FR_CL_CR_BR = 46
  BL_BR = 48
  FC_BL_BR = 49
  FR_BL_BR = 50
  CL_BL_BR = 52
  FC_CL_BL_BR = 53
  FR_CL_BL_BR = 54
  CR_BL_BR = 56
  FC_CR_BL_BR = 57
  FR_CR_BL_BR = 58
  CL_CR_BL_BR = 60
  FC_CL_CR_BL_BR = 61
  FR_CL_CR_BL_BR = 62

ObjectMovingOrientation_E = enum(DefaultValue="UnknownDir", AddClassNameToEnumNames=true)
  UnknownDir = 0  % 目标运动方向：未知
  SameDir = 1  % 目标运动方向：同向
  OnComingDir = 2  % 目标运动方向：对向
  Crossing = 3  % 目标运动方向：横穿

LM_SpecialRoadType_E = enum(DefaultValue="enum1", AddClassNameToEnumNames=true)
  enum1 = 0

LM_RoadNumChg_E = enum(DefaultValue="NotChange", AddClassNameToEnumNames=true)
  NotChange = 0
  LeftAdd = 1
  RightAdd = 2
  LeftDes = 3
  RightDes = 4

LM_DrivInWLFlag_E = enum(DefaultValue="INVALID", AddClassNameToEnumNames=true)
  INVALID = 0
  EgoCarInLeftLane = 1
  EgoCarInMidLane = 2
  EgoCarInRightLane = 3

EgoVehicleProCalcu_BUS = Simulink.Bus()
  EgoCar_LeftLaneProb: single
  EgoCar_CurrentLaneProb: single
  EgoCar_RightLaneProb: single

PIL_ProbInLaneCalculat_BUS = Simulink.Bus()
  PIL_CurrentLaneProb: single[80]
  PIL_LeftLaneProb: single[80]
  PIL_RightLaneProb: single[80]
  PIL_ObjLaneProb_all: single[80]
  TOS_PIL_EgoVehiclePro: Bus: EgoVehicleProCalcu_BUS
  PIL_CutinProb: single[80]
  PIL_CutinFlag: boolean[80]
  PIL_CutoutProb: single[80]
  PIL_CutoutFlag: boolean[80]
  PIL_OverlapRatio: single[80]

ObjectMovingState_E = enum(DefaultValue="invalid", AddClassNameToEnumNames=true)
  invalid = 0  % TOS输出，目标运动状态：未知
  UnknownState = 1  % TOS输出，目标运动状态：未知
  Moving = 2  % TOS输出，目标运动状态：运动的
  Still = 3  % TOS输出，目标运动状态：一直静止
  Stopped = 4  % 运动到停

ObjectMovingState_AEB_E = enum(DefaultValue="UnknownState", AddClassNameToEnumNames=true)
  UnknownState = 0
  Still = 1
  Moving = 2
  Stopped = 3

TOS_LM_LL_Line_bus = Simulink.Bus()
  LM_LL_Line01: Bus: TOS_LM_Line_bus
  LM_LL_Line02: Bus: TOS_LM_Line_bus
  LM_LL_Line03: Bus: TOS_LM_Line_bus
  LM_LL_Line04: Bus: TOS_LM_Line_bus
  LM_LL_Line05: Bus: TOS_LM_Line_bus
  LM_LL_Line06: Bus: TOS_LM_Line_bus
  LM_LL_Line07: Bus: TOS_LM_Line_bus
  LM_LL_Line08: Bus: TOS_LM_Line_bus

TOS_LM_Line_bus = Simulink.Bus()
  pC0: single
  pC1: single
  pC2: single
  pC3: single
  dDisStart: single
  dDisEnd: single
  dQuality: single
  fCamValid: uint8

TOS_LM_LR_Line_bus = Simulink.Bus()
  LM_LR_Line01: Bus: TOS_LM_Line_bus
  LM_LR_Line02: Bus: TOS_LM_Line_bus
  LM_LR_Line03: Bus: TOS_LM_Line_bus
  LM_LR_Line04: Bus: TOS_LM_Line_bus
  LM_LR_Line05: Bus: TOS_LM_Line_bus
  LM_LR_Line06: Bus: TOS_LM_Line_bus
  LM_LR_Line07: Bus: TOS_LM_Line_bus
  LM_LR_Line08: Bus: TOS_LM_Line_bus

TOS_LM_RL_Line_bus = Simulink.Bus()
  LM_RL_Line01: Bus: TOS_LM_Line_bus
  LM_RL_Line02: Bus: TOS_LM_Line_bus
  LM_RL_Line03: Bus: TOS_LM_Line_bus
  LM_RL_Line04: Bus: TOS_LM_Line_bus
  LM_RL_Line05: Bus: TOS_LM_Line_bus
  LM_RL_Line06: Bus: TOS_LM_Line_bus
  LM_RL_Line07: Bus: TOS_LM_Line_bus
  LM_RL_Line08: Bus: TOS_LM_Line_bus

TOS_LM_RR_Line_bus = Simulink.Bus()
  LM_RR_Line01: Bus: TOS_LM_Line_bus
  LM_RR_Line02: Bus: TOS_LM_Line_bus
  LM_RR_Line03: Bus: TOS_LM_Line_bus
  LM_RR_Line04: Bus: TOS_LM_Line_bus
  LM_RR_Line05: Bus: TOS_LM_Line_bus
  LM_RR_Line06: Bus: TOS_LM_Line_bus
  LM_RR_Line07: Bus: TOS_LM_Line_bus
  LM_RR_Line08: Bus: TOS_LM_Line_bus

TOS_AddAttributes_BUS = Simulink.Bus()
  PP_MovingStateSignalProcessing: uint8[80]
  PP_MovingState_AEB_SignalProcessing: uint8[80]
  PP_ObjMovingDirSignalProcessing: uint8[80]
  PP_axAbsGround: single[80]
  PP_CamareConfirmSignalProcessing: boolean[80]
  PP_ObjToEgoCarFrontbump: single[80]
  PP_ObjFusType_FC_FR_Confirm: boolean[80]
  PP_ObjFusType_FR_Confirm: boolean[80]
  PP_ObjFusType_FC_Confirm: boolean[80]
  PP_EgoVehCenterLine_dy: single
  PP_ObjectToCenterLine_dy: single[80]
  PP_ObjectToCenterLine_vyc: single[80]
  PP_ObjFirstDetect_Dx: single[80]
  PP_ObjFirstDetect_Dy: single[80]

TOS_P0_Traject_Line_BUS = Simulink.Bus()
  OTL_Valid: boolean
  OTL_C3: single
  OTL_C2: single
  OTL_C1: single
  OTL_C0: single
  OTL_Range: single
  OTL_Cnt: uint8