% Simulink data dictionary PvtParsTOS.sldd

P_TOS_ACC_P0_ObstacleProbThre_Valu = AUTOSAR4.Parameter(0.4, SwCalibrationAccess="ReadWrite", StorageClass="Global", MemorySection="CAL", DataType="single")
P_TOS_ACC_P0_P1_MovingObjDxThreshold_m = AUTOSAR4.Parameter(120, SwCalibrationAccess="ReadWrite", StorageClass="Global", MemorySection="CAL", DataType="single")
P_TOS_ACC_P0_P1_ObstacleProbThre_Valu = AUTOSAR4.Parameter(0.4, SwCalibrationAccess="ReadWrite", StorageClass="Global", MemorySection="CAL", DataType="single")
P_TOS_ACC_P0_P1_StaticObjDxThreshold_m = AUTOSAR4.Parameter(90, SwCalibrationAccess="ReadWrite", StorageClass="Global", MemorySection="CAL", DataType="single")
P_TOS_ACC_P0_P1_TargetInFrontEgoVehicle_OverlapThre_Val = AUTOSAR4.Parameter(0.1, SwCalibrationAccess="ReadWrite", StorageClass="Global", MemorySection="CAL", DataType="single")
P_TOS_ACC_P0_P1_TargetPre_OverlapThre_Val = AUTOSAR4.Parameter(0.05, SwCalibrationAccess="ReadWrite", StorageClass="Global", MemorySection="CAL", DataType="single")
P_TOS_ACC_P1_ObstacleProbThre_Valu = AUTOSAR4.Parameter(0.4, SwCalibrationAccess="ReadWrite", StorageClass="Global", MemorySection="CAL", DataType="single")
P_TOS_ACC_P1_TargetOverlapThre_Val = AUTOSAR4.Parameter(0.1, SwCalibrationAccess="ReadWrite", StorageClass="Global", MemorySection="CAL", DataType="single")
P_TOS_ACC_P2_P4_ObstacleProbThre_Valu = AUTOSAR4.Parameter(0.4, SwCalibrationAccess="ReadWrite", StorageClass="Global", MemorySection="CAL", DataType="single")
P_TOS_ACC_P3_P5_ObstacleProbThre_Valu = AUTOSAR4.Parameter(0.4, SwCalibrationAccess="ReadWrite", StorageClass="Global", MemorySection="CAL", DataType="single")
P_TOS_ACC_TargetOverlapThre_Val = AUTOSAR4.Parameter(0.15, SwCalibrationAccess="ReadWrite", StorageClass="Global", MemorySection="CAL", DataType="single")
P_TOS_AEBJuncTargetEgoYawRateThre_val = AUTOSAR4.Parameter(0.01, SwCalibrationAccess="ReadWrite", StorageClass="Global", MemorySection="CAL", DataType="single")
P_TOS_AEBJuncTargetObstacleProbThre_Valu = AUTOSAR4.Parameter(0.4, SwCalibrationAccess="ReadWrite", StorageClass="Global", MemorySection="CAL", DataType="single")
P_TOS_AEBJuncTargetVyvThre_val = AUTOSAR4.Parameter(0.4, SwCalibrationAccess="ReadWrite", StorageClass="Global", MemorySection="CAL", DataType="single")
P_TOS_AEBLatTargetEgoYawRateThre_val = AUTOSAR4.Parameter(0.01, SwCalibrationAccess="ReadWrite", StorageClass="Global", MemorySection="CAL", DataType="single")
P_TOS_AEBLatTargetObstacleProbThre_Valu = AUTOSAR4.Parameter(0.4, SwCalibrationAccess="ReadWrite", StorageClass="Global", MemorySection="CAL", DataType="single")
P_TOS_AEBLong_TargetOverlapThre_Val = AUTOSAR4.Parameter(0.15, SwCalibrationAccess="ReadWrite", StorageClass="Global", MemorySection="CAL", DataType="single")
P_TOS_AEBLongObjSelectCondition_LatSpd_Val = AUTOSAR4.Parameter(30, SwCalibrationAccess="ReadWrite", StorageClass="Global", MemorySection="CAL", DataType="single")  % 标定量；速度低于 30km/h 时；输出目标距离(标定量<50m)
P_TOS_AEBLongObjSelectMaxDis_Val = AUTOSAR4.Parameter(80, SwCalibrationAccess="ReadWrite", StorageClass="Global", MemorySection="CAL", DataType="single")  % AEBLong 选择目标的最远距离 (标定量 80m)
P_TOS_AEBLongObjSelectMinDis_Val = AUTOSAR4.Parameter(0, SwCalibrationAccess="ReadWrite", StorageClass="Global", MemorySection="CAL", DataType="single")  % AEBLong选择目标的最近距离（标定量 50m）
P_TOS_AEBLongTargetExistProbThre_Valu = AUTOSAR4.Parameter(0.6, SwCalibrationAccess="ReadWrite", StorageClass="Global", MemorySection="CAL", DataType="single")  % AEBLong选择目标 目标存在的可能行（标定量 0.6）
P_TOS_AEBLongTargetObstacleProbThre_Valu = AUTOSAR4.Parameter(0.4, SwCalibrationAccess="ReadWrite", StorageClass="Global", MemorySection="CAL", DataType="single")  % AEBLong选择目标 成为障碍物的可能性约束（标定量 0.6）
P_TOS_BasicLaneWidth_Bicycle_MinVal = AUTOSAR4.Parameter(2.2, SwCalibrationAccess="ReadWrite", StorageClass="Global", MemorySection="CAL", DataType="single")  % 自行车目标基础道路宽度 // 2.2
P_TOS_BasicLaneWidth_CAR_MinVal = AUTOSAR4.Parameter(2.5, SwCalibrationAccess="ReadWrite", StorageClass="Global", MemorySection="CAL", DataType="single")  % 车辆目标基础道路宽度 // 2.5m
P_TOS_BasicLaneWidth_OthertType_MinVal = AUTOSAR4.Parameter(2, SwCalibrationAccess="ReadWrite", StorageClass="Global", MemorySection="CAL", DataType="single")  % 其他类型目标基础道路宽度 // 2.4 m
P_TOS_BasicLaneWidth_Pedestrian_MinVal = AUTOSAR4.Parameter(2, SwCalibrationAccess="ReadWrite", StorageClass="Global", MemorySection="CAL", DataType="single")  % 行人目标基础道路宽度 // 2
P_TOS_BasicLaneWidth_StillObj_MinVal = AUTOSAR4.Parameter(1.9, SwCalibrationAccess="ReadWrite", StorageClass="Global", MemorySection="CAL", DataType="single")  % 静态物体目标基础道路宽度 // 1.9 m
P_TOS_CrossingTargetVyvThre_val = AUTOSAR4.Parameter(0.4, SwCalibrationAccess="ReadWrite", StorageClass="Global", MemorySection="CAL", DataType="single")
P_TOS_CrossingVyThre_Val = AUTOSAR4.Parameter(0.2, SwCalibrationAccess="ReadWrite", StorageClass="Global", MemorySection="CAL", DataType="single")
P_TOS_CurrentLane_BicycleProb_Val = AUTOSAR4.Parameter(0.4, SwCalibrationAccess="ReadWrite", StorageClass="Global", MemorySection="CAL", DataType="single")  % 本车道自行车 可能性
P_TOS_CurrentLane_CARProb_Val = AUTOSAR4.Parameter(0.4, SwCalibrationAccess="ReadWrite", StorageClass="Global", MemorySection="CAL", DataType="single")  % 本车道车辆可能性
P_TOS_CurrentLane_OthertTypeProb_Val = AUTOSAR4.Parameter(0.4, SwCalibrationAccess="ReadWrite", StorageClass="Global", MemorySection="CAL", DataType="single")  % 本车道其他物体可能性
P_TOS_CurrentLane_PedestrianProb_Val = AUTOSAR4.Parameter(0.65, SwCalibrationAccess="ReadWrite", StorageClass="Global", MemorySection="CAL", DataType="single")  % 本车道行人可能性
P_TOS_CurrentLane_StillObjProb_Val = AUTOSAR4.Parameter(0.75, SwCalibrationAccess="ReadWrite", StorageClass="Global", MemorySection="CAL", DataType="single")  % 本车道静态目标可能性 0.75
P_TOS_CurrentLaneLeftBasicProb_Val = AUTOSAR4.Parameter(0.5, SwCalibrationAccess="ReadWrite", StorageClass="Global", MemorySection="CAL", DataType="single")  % 本车道内，目标位于左边线时；概率值0.5
P_TOS_CurrentLaneProbThre_Value = AUTOSAR4.Parameter(0.4, SwCalibrationAccess="ReadWrite", StorageClass="Global", MemorySection="CAL", DataType="single")  % 目标存在于本车道时，概率阈值
P_TOS_CurrentLaneRightBasicProb_Val = AUTOSAR4.Parameter(0.5, SwCalibrationAccess="ReadWrite", StorageClass="Global", MemorySection="CAL", DataType="single")  % 本车道内，目标位于右边线时；概率值0.5
P_TOS_CurveLaneC2Thre_Val = AUTOSAR4.Parameter(0.01, SwCalibrationAccess="ReadWrite", StorageClass="Global", MemorySection="CAL", DataType="single")
P_TOS_CutIn_ObjectToCenterLine_Leftdy_Con = AUTOSAR4.Parameter(0.1, SwCalibrationAccess="ReadWrite", StorageClass="Global", MemorySection="CAL", DataType="single")  % 滤波后 ObjectToCenterLine_dy_Filt 与 ObjectToCenterLine_dy差值 > 0.2
P_TOS_CutIn_ObjectToCenterLine_Rightdy_Con = AUTOSAR4.Parameter(-0.1, SwCalibrationAccess="ReadWrite", StorageClass="Global", MemorySection="CAL", DataType="single")  % 滤波后 ObjectToCenterLine_dy_Filt 与 ObjectToCenterLine_dy差值 < -0.2
P_TOS_CutInAngleFilt_Val = AUTOSAR4.Parameter(1, SwCalibrationAccess="ReadWrite", StorageClass="Global", MemorySection="CAL", DataType="single")
P_TOS_CutinCLDyThre_Val = AUTOSAR4.Parameter(0.8, SwCalibrationAccess="ReadWrite", StorageClass="Global", MemorySection="CAL", DataType="single")  % 目标cut in 距离中心线之间距离阈值
P_TOS_CutInMaxPredict_dy_Val = AUTOSAR4.Parameter(1.2, SwCalibrationAccess="ReadWrite", StorageClass="Global", MemorySection="CAL", DataType="single")  % cut in 横向 dy 最大预测距离 0.7 m
P_TOS_CutInMaxPredictDis_Val = AUTOSAR4.Parameter(110, SwCalibrationAccess="ReadWrite", StorageClass="Global", MemorySection="CAL", DataType="single")  % 目标与本车之间最大 dx距离 ；判断cut in 区间
P_TOS_CutInMaxPredictTime_CarTruck_Val = AUTOSAR4.Parameter(1.6, SwCalibrationAccess="ReadWrite", StorageClass="Global", MemorySection="CAL", DataType="single")  % 车辆切入最大预测时间
P_TOS_CutInMaxPredictTime_Val = AUTOSAR4.Parameter(1.6, SwCalibrationAccess="ReadWrite", StorageClass="Global", MemorySection="CAL", DataType="single")  % cut in 预测时间 最长 1.6 s
P_TOS_CutInMinPredict_dy_Val = AUTOSAR4.Parameter(0, SwCalibrationAccess="ReadWrite", StorageClass="Global", MemorySection="CAL", DataType="single")  % cut in 横向 dy 最小预测距离 0
P_TOS_CutInMinPredictDis_Val = AUTOSAR4.Parameter(3.93, SwCalibrationAccess="ReadWrite", StorageClass="Global", MemorySection="CAL", DataType="single")  % 目标与本车之间最小 dx距离 ；判断cut in 区间
P_TOS_CutInMinPredictTime_Val = AUTOSAR4.Parameter(0, SwCalibrationAccess="ReadWrite", StorageClass="Global", MemorySection="CAL", DataType="single")  % 目标非 cut in 时；预测时间 0
P_TOS_CutinObjectToCenterLine_dy_Val = AUTOSAR4.Parameter(0.1, SwCalibrationAccess="ReadWrite", StorageClass="Global", MemorySection="CAL", DataType="single")  % cut in 本车道目标与车道中心线之间距离
P_TOS_CutinObjvyThre_CarTruck_Val = AUTOSAR4.Parameter(0.1, SwCalibrationAccess="ReadWrite", StorageClass="Global", MemorySection="CAL", DataType="single")  % 车辆横向切入最小速度阈值 0.1 m/s
P_TOS_CutinObjvyThre_Val = AUTOSAR4.Parameter(0.1, SwCalibrationAccess="ReadWrite", StorageClass="Global", MemorySection="CAL", DataType="single")  % 目标沿道路经向，横向切入速度阈值
P_TOS_CutInPluseDecreaseRate_Val = AUTOSAR4.Parameter(0.2, SwCalibrationAccess="ReadWrite", StorageClass="Global", MemorySection="CAL", DataType="single")  % cunin 本车都目标概率下降 速率约束
P_TOS_CutInPluseUpperRate_Val = AUTOSAR4.Parameter(0.7, SwCalibrationAccess="ReadWrite", StorageClass="Global", MemorySection="CAL", DataType="single")  % 判断 cut in 可能性时，概率值上升累加速率约束
P_TOS_CutOut_ObjectToCenterLine_Leftdy_Con = AUTOSAR4.Parameter(0.1, SwCalibrationAccess="ReadWrite", StorageClass="Global", MemorySection="CAL", DataType="single")  % 滤波后 ObjectToCenterLine_dy_Filt 与 ObjectToCenterLine_dy差值 > 0.2
P_TOS_CutOut_ObjectToCenterLine_Rightdy_Con = AUTOSAR4.Parameter(-0.1, SwCalibrationAccess="ReadWrite", StorageClass="Global", MemorySection="CAL", DataType="single")  % 滤波后 ObjectToCenterLine_dy_Filt 与 ObjectToCenterLine_dy差值 < -0.2
P_TOS_CutoutBoundaryToCenterLine_Val = AUTOSAR4.Parameter(0.1, SwCalibrationAccess="ReadWrite", StorageClass="Global", MemorySection="CAL", DataType="single")  % 目标cut out时，目标边界与车道中心线之间 横向距离阈值（0.1 m）
P_TOS_CutOutMaxPredict_dy_Val = AUTOSAR4.Parameter(2.8, SwCalibrationAccess="ReadWrite", StorageClass="Global", MemorySection="CAL", DataType="single")  % cut out 横向 dy 最大预测距离 2.8 m(1.5~2.8范围内预测cut out)
P_TOS_CutOutMaxPredict_LatDis_Val = AUTOSAR4.Parameter(2.8, SwCalibrationAccess="ReadWrite", StorageClass="Global", MemorySection="CAL", DataType="single")  % cut  out 目标最大横向预测距离2.8m
P_TOS_CutOutMaxPredictDis_Val = AUTOSAR4.Parameter(110, SwCalibrationAccess="ReadWrite", StorageClass="Global", MemorySection="CAL", DataType="single")  % 判断目标 cut out 最远距离 110 m
P_TOS_CutOutMaxPredictTime_Val = AUTOSAR4.Parameter(1, SwCalibrationAccess="ReadWrite", StorageClass="Global", MemorySection="CAL", DataType="single")  % 目标 cut out预测最长时间 1s
P_TOS_CutOutMinPredict_dy_Val = AUTOSAR4.Parameter(1.5, SwCalibrationAccess="ReadWrite", StorageClass="Global", MemorySection="CAL", DataType="single")  % cut out 横向 dy 最小预测距离 1.5 m
P_TOS_CutOutMinPredictDis_Val = AUTOSAR4.Parameter(3.93, SwCalibrationAccess="ReadWrite", StorageClass="Global", MemorySection="CAL", DataType="single")  % 目标与本车之间最小 dx距离 ；判断cut out 区间
P_TOS_CutOutMinPredictTime_Val = AUTOSAR4.Parameter(0, SwCalibrationAccess="ReadWrite", StorageClass="Global", MemorySection="CAL", DataType="single")  % 目标 cut out预测最短时间 0s
P_TOS_CutoutObjvyThre = AUTOSAR4.Parameter(0.3, SwCalibrationAccess="ReadWrite", StorageClass="Global", MemorySection="CAL", DataType="single")  % cut out 目标横向速度均值
P_TOS_CutoutObjvyThre_NegativeVal = AUTOSAR4.Parameter(-0.1, SwCalibrationAccess="ReadWrite", StorageClass="Global", MemorySection="CAL", DataType="single")
P_TOS_CutoutObjvyThre_Val = AUTOSAR4.Parameter(0.1, SwCalibrationAccess="ReadWrite", StorageClass="Global", MemorySection="CAL", DataType="single")
P_TOS_CutOutPluseDecreaseRate_Val = AUTOSAR4.Parameter(0.1, SwCalibrationAccess="ReadWrite", StorageClass="Global", MemorySection="CAL", DataType="single")  % 判断 cut out可能性时，概率值累加下降速率约束
P_TOS_CutOutPluseUpperRate_Val = AUTOSAR4.Parameter(0.1, SwCalibrationAccess="ReadWrite", StorageClass="Global", MemorySection="CAL", DataType="single")  % 判断 cut out可能性时，概率值累加上升速率约束
P_TOS_DetectionTarget_maxistance = AUTOSAR4.Parameter(150, SwCalibrationAccess="ReadWrite", StorageClass="Global", MemorySection="CAL", DataType="single")
P_TOS_DetectionTarget_minDistance = AUTOSAR4.Parameter(-80, SwCalibrationAccess="ReadWrite", StorageClass="Global", MemorySection="CAL", DataType="single")
P_TOS_EgoFrontDxThre_50_Val = AUTOSAR4.Parameter(50, SwCalibrationAccess="ReadWrite", StorageClass="Global", MemorySection="CAL", DataType="single")
P_TOS_EgoFrontDxThre_70_Val = AUTOSAR4.Parameter(70, SwCalibrationAccess="ReadWrite", StorageClass="Global", MemorySection="CAL", DataType="single")
P_TOS_EgoFrontDxThre_90_Val = AUTOSAR4.Parameter(90, SwCalibrationAccess="ReadWrite", StorageClass="Global", MemorySection="CAL", DataType="single")
P_TOS_EgoFrontDxThre_120_Val = AUTOSAR4.Parameter(120, SwCalibrationAccess="ReadWrite", StorageClass="Global", MemorySection="CAL", DataType="single")
P_TOS_EgoFrontDxThre_Val = AUTOSAR4.Parameter(120, SwCalibrationAccess="ReadWrite", StorageClass="Global", MemorySection="CAL", DataType="single")  % 自车前方最远 120m
P_TOS_EgoRearDxThre_Val = AUTOSAR4.Parameter(-80, SwCalibrationAccess="ReadWrite", StorageClass="Global", MemorySection="CAL", DataType="single")  % 自车后方最远 80 m
P_TOS_ELK_TargetOverlapThre_Val = AUTOSAR4.Parameter(0.15, SwCalibrationAccess="ReadWrite", StorageClass="Global", MemorySection="CAL", DataType="single")
P_TOS_ELKTargetNum_Val = AUTOSAR4.Parameter(8, SwCalibrationAccess="ReadWrite", StorageClass="Global", MemorySection="CAL", DataType="uint8")  % TOS发送ELK目标个数
P_TOS_HWA_TargetOverlapThre_Val = AUTOSAR4.Parameter(0.15, SwCalibrationAccess="ReadWrite", StorageClass="Global", MemorySection="CAL", DataType="single")
P_TOS_HWA_TargetPre_OverlapThre_Val = AUTOSAR4.Parameter(0.05, SwCalibrationAccess="ReadWrite", StorageClass="Global", MemorySection="CAL", DataType="single")
P_TOS_LaneWidthFiltFactor_Switch = AUTOSAR4.Parameter(1, SwCalibrationAccess="ReadWrite", StorageClass="Global", MemorySection="CAL", DataType="boolean")  % 本车道，道路宽度，滤波系数 开关 ==1 打开滤波
P_TOS_LaneWidthFiltFactor_Val = AUTOSAR4.Parameter(0.2, SwCalibrationAccess="ReadWrite", StorageClass="Global", MemorySection="CAL", DataType="single")  % 本车道，道路宽度，滤波系数
P_TOS_LCKie_TargetOverlapThre_Val = AUTOSAR4.Parameter(0.15, SwCalibrationAccess="ReadWrite", StorageClass="Global", MemorySection="CAL", DataType="single")
P_TOS_LCKieTargetNum_Val = AUTOSAR4.Parameter(9, SwCalibrationAccess="ReadWrite", StorageClass="Global", MemorySection="CAL", DataType="uint8")  % TOS 发送 LCKie目标个数
P_TOS_LCTargetNum_Val = AUTOSAR4.Parameter(11, SwCalibrationAccess="ReadWrite", StorageClass="Global", MemorySection="CAL", DataType="uint8")  % TOS输出 LC目标个数
P_TOS_LeftLaneProbThre_Value = AUTOSAR4.Parameter(0.7, SwCalibrationAccess="ReadWrite", StorageClass="Global", MemorySection="CAL", DataType="single")  % 目标存在于左车道时，概率阈值
P_TOS_LineCourseErrorLeftExtend_BasicLaneWidth = AUTOSAR4.Parameter(0, SwCalibrationAccess="ReadWrite", StorageClass="Global", MemorySection="CAL", DataType="single")
P_TOS_LineCourseErrorRightExtend_BasicLaneWidth = AUTOSAR4.Parameter(0, SwCalibrationAccess="ReadWrite", StorageClass="Global", MemorySection="CAL", DataType="single")
P_TOS_LM_FiltdelayNum_Val = AUTOSAR4.Parameter(15, SwCalibrationAccess="ReadWrite", StorageClass="Global", MemorySection="CAL", DataType="double")
P_TOS_LongVyThre_Val = AUTOSAR4.Parameter(2, SwCalibrationAccess="ReadWrite", StorageClass="Global", MemorySection="CAL", DataType="single")
P_TOS_MovingDirJudge_C1Default_Val = AUTOSAR4.Parameter(0, SwCalibrationAccess="ReadWrite", StorageClass="Global", MemorySection="CAL", DataType="single")
P_TOS_MovingDirJudge_C2Default_Val = AUTOSAR4.Parameter(0, SwCalibrationAccess="ReadWrite", StorageClass="Global", MemorySection="CAL", DataType="single")
P_TOS_ObjCutInObject_DY_Val = AUTOSAR4.Parameter(2.4, SwCalibrationAccess="ReadWrite", StorageClass="Global", MemorySection="CAL", DataType="single")  % 判断目标切入横向 dy 最远距离（调节cutin 范围）
P_TOS_ObjCutOutProb_Val = AUTOSAR4.Parameter(0.7, SwCalibrationAccess="ReadWrite", StorageClass="Global", MemorySection="CAL", DataType="single")  % 目标切出 可能性概率值 0.7
P_TOS_Object_Var_AX_maxVal = AUTOSAR4.Parameter(255, SwCalibrationAccess="ReadWrite", StorageClass="Global", MemorySection="CAL", DataType="single")
P_TOS_Object_Var_AX_minVal = AUTOSAR4.Parameter(0, SwCalibrationAccess="ReadWrite", StorageClass="Global", MemorySection="CAL", DataType="single")
P_TOS_Object_Var_AY_maxVal = AUTOSAR4.Parameter(255, SwCalibrationAccess="ReadWrite", StorageClass="Global", MemorySection="CAL", DataType="single")  % 无摄像头参与融合，雷达（融合）目标，Ay方差最大值
P_TOS_Object_Var_AY_minVal = AUTOSAR4.Parameter(0, SwCalibrationAccess="ReadWrite", StorageClass="Global", MemorySection="CAL", DataType="single")  % 无摄像头参与融合，雷达（融合）目标，Ay方差最小值
P_TOS_Object_Var_DX_maxVal = AUTOSAR4.Parameter(255, SwCalibrationAccess="ReadWrite", StorageClass="Global", MemorySection="CAL", DataType="single")  % 无摄像头参与融合，雷达（融合）目标，dx方差最大值
P_TOS_Object_Var_DX_minVal = AUTOSAR4.Parameter(0, SwCalibrationAccess="ReadWrite", StorageClass="Global", MemorySection="CAL", DataType="single")  % 无摄像头参与融合，雷达（融合）目标，dx方差最小值
P_TOS_Object_Var_DY_maxVal = AUTOSAR4.Parameter(255, SwCalibrationAccess="ReadWrite", StorageClass="Global", MemorySection="CAL", DataType="single")  % 无摄像头参与融合，雷达（融合）目标，dy方差最大值
P_TOS_Object_Var_DY_minVal = AUTOSAR4.Parameter(0, SwCalibrationAccess="ReadWrite", StorageClass="Global", MemorySection="CAL", DataType="single")  % 无摄像头参与融合，雷达（融合）目标，dy方差最小值
P_TOS_Object_Var_VX_maxVal = AUTOSAR4.Parameter(255, SwCalibrationAccess="ReadWrite", StorageClass="Global", MemorySection="CAL", DataType="single")  % 无摄像头参与融合，雷达（融合）目标，vx方差最大值
P_TOS_Object_Var_VX_minVal = AUTOSAR4.Parameter(0, SwCalibrationAccess="ReadWrite", StorageClass="Global", MemorySection="CAL", DataType="single")  % 无摄像头参与融合，雷达（融合）目标，Vx方差最小值
P_TOS_Object_Var_VY_maxVal = AUTOSAR4.Parameter(255, SwCalibrationAccess="ReadWrite", StorageClass="Global", MemorySection="CAL", DataType="single")  % 无摄像头参与融合，雷达（融合）目标，vy方差最大值
P_TOS_Object_Var_VY_minVal = AUTOSAR4.Parameter(0, SwCalibrationAccess="ReadWrite", StorageClass="Global", MemorySection="CAL", DataType="single")  % 无摄像头参与融合，雷达（融合）目标，vy方差最小值
P_TOS_ObjectExistProbThre_Value = AUTOSAR4.Parameter(0.3, SwCalibrationAccess="ReadWrite", StorageClass="Global", MemorySection="CAL", DataType="single")  % 目标成为障碍物的概率值，阈值约束
P_TOS_ObjectToCenterLine_dy_FiltCon = AUTOSAR4.Parameter(0.028, SwCalibrationAccess="ReadWrite", StorageClass="Global", MemorySection="CAL", DataType="single")  % ObjectToCenterLine_dy 滤波系数// cut in 判断
P_TOS_ObjectVXDefault_Val = AUTOSAR4.Parameter(0, SwCalibrationAccess="ReadWrite", StorageClass="Global", MemorySection="CAL", DataType="single")
P_TOS_ObjectVYDefault_Val = AUTOSAR4.Parameter(0, SwCalibrationAccess="ReadWrite", StorageClass="Global", MemorySection="CAL", DataType="single")
P_TOS_ObjinEgoLaneProb_Val = AUTOSAR4.Parameter(0.4, SwCalibrationAccess="ReadWrite", StorageClass="Global", MemorySection="CAL", DataType="single")
P_TOS_ObjinLeftLaneProb_Val = AUTOSAR4.Parameter(0.5, SwCalibrationAccess="ReadWrite", StorageClass="Global", MemorySection="CAL", DataType="single")
P_TOS_ObjinRightLaneProb_Val = AUTOSAR4.Parameter(0.5, SwCalibrationAccess="ReadWrite", StorageClass="Global", MemorySection="CAL", DataType="single")
P_TOS_ObjInSameDirYawAngMaxThre_Val = AUTOSAR4.Parameter(45, SwCalibrationAccess="ReadWrite", StorageClass="Global", MemorySection="CAL", DataType="single")
P_TOS_ObjInSameDirYawAngMinThre_Val = AUTOSAR4.Parameter(0, SwCalibrationAccess="ReadWrite", StorageClass="Global", MemorySection="CAL", DataType="single")
P_TOS_ObjLatCroYawAngMaxThre_Val = AUTOSAR4.Parameter(135, SwCalibrationAccess="ReadWrite", StorageClass="Global", MemorySection="CAL", DataType="single")
P_TOS_ObjLatCroYawAngMinThre_Val = AUTOSAR4.Parameter(45, SwCalibrationAccess="ReadWrite", StorageClass="Global", MemorySection="CAL", DataType="single")
P_TOS_ObjOncomingYawAngMaxThre_Val = AUTOSAR4.Parameter(180, SwCalibrationAccess="ReadWrite", StorageClass="Global", MemorySection="CAL", DataType="single")
P_TOS_ObjWidthThreshold_Overlap_Val = AUTOSAR4.Parameter(0.4, SwCalibrationAccess="ReadWrite", StorageClass="Global", MemorySection="CAL", DataType="single")
P_TOS_OncomingDirVxvOffset_Val = AUTOSAR4.Parameter(0.2, SwCalibrationAccess="ReadWrite", StorageClass="Global", MemorySection="CAL", DataType="single")
P_TOS_OncomingPedDxChangeOffset_Val = AUTOSAR4.Parameter(0.1, SwCalibrationAccess="ReadWrite", StorageClass="Global", MemorySection="CAL", DataType="single")
P_TOS_OncomingTarget_VxabsOffset_val = AUTOSAR4.Parameter(-0.7, SwCalibrationAccess="ReadWrite", StorageClass="Global", MemorySection="CAL", DataType="single")
P_TOS_OncomingVehDxChangeOffset_Val = AUTOSAR4.Parameter(0.4, SwCalibrationAccess="ReadWrite", StorageClass="Global", MemorySection="CAL", DataType="single")
P_TOS_OverlapEgoWidthMO = AUTOSAR4.Parameter(1, SwCalibrationAccess="ReadWrite", StorageClass="Global", MemorySection="CAL", DataType="single")
P_TOS_OverlapEgoWidthSO = AUTOSAR4.Parameter(0.5, SwCalibrationAccess="ReadWrite", StorageClass="Global", MemorySection="CAL", DataType="single")
P_TOS_PIL_EgoInLeftlaneProb_Val = AUTOSAR4.Parameter(0.3, SwCalibrationAccess="ReadWrite", StorageClass="Global", MemorySection="CAL", DataType="single")  % 自车在左车道概率 0.3
P_TOS_PIL_EgoInMiddlelaneProb_Val = AUTOSAR4.Parameter(0.3, SwCalibrationAccess="ReadWrite", StorageClass="Global", MemorySection="CAL", DataType="single")  % 自车在本车道概率 0.3
P_TOS_PIL_EgoInRightlaneProb_Val = AUTOSAR4.Parameter(0.3, SwCalibrationAccess="ReadWrite", StorageClass="Global", MemorySection="CAL", DataType="single")  % 自车在右车道概率 0.3
P_TOS_PIL_FiltingParmet_CurrentLaneProbDeclineLimit = AUTOSAR4.Parameter(0.1, SwCalibrationAccess="ReadWrite", StorageClass="Global", MemorySection="CAL", DataType="single")  % 本车道目标概率值滤波，下降速率 0.1
P_TOS_PIL_FiltingParmet_CurrentLaneProbUpperLimit = AUTOSAR4.Parameter(0.5, SwCalibrationAccess="ReadWrite", StorageClass="Global", MemorySection="CAL", DataType="single")  % 本车道目标概率值滤波，上升速率 0.25
P_TOS_PIL_FiltingParmet_LeftLaneProbDeclineLimit = AUTOSAR4.Parameter(0.25, SwCalibrationAccess="ReadWrite", StorageClass="Global", MemorySection="CAL", DataType="single")  % 左车道目标概率值滤波，下降速率 0.1
P_TOS_PIL_FiltingParmet_LeftLaneProbUpperLimit = AUTOSAR4.Parameter(0.5, SwCalibrationAccess="ReadWrite", StorageClass="Global", MemorySection="CAL", DataType="single")  % 左车道目标概率值滤波，上升速率 0.25
P_TOS_PIL_FiltingParmet_RightLaneProbDeclineLimit = AUTOSAR4.Parameter(0.25, SwCalibrationAccess="ReadWrite", StorageClass="Global", MemorySection="CAL", DataType="single")  % 右车道目标概率值滤波，下降速率 0.1
P_TOS_PIL_FiltingParmet_RightLaneProbUpperLimit = AUTOSAR4.Parameter(0.5, SwCalibrationAccess="ReadWrite", StorageClass="Global", MemorySection="CAL", DataType="single")  % 右车道目标概率值滤波，上升速率 0.25
P_TOS_PIL_FiltingParmet_SameLaneProbUpperLimit = AUTOSAR4.Parameter(0.5, SwCalibrationAccess="ReadWrite", StorageClass="Global", MemorySection="CAL", DataType="single")
P_TOS_PIL_FiltingParmet_SametLaneProbDeclineLimit = AUTOSAR4.Parameter(0.25, SwCalibrationAccess="ReadWrite", StorageClass="Global", MemorySection="CAL", DataType="single")
P_TOS_PIL_ObjectToCenterLine_dy_CutInDeclineLimit = AUTOSAR4.Parameter(0.1, SwCalibrationAccess="ReadWrite", StorageClass="Global", MemorySection="CAL", DataType="single")  % 目标到本车道中心线距离，滤波 DeclineRate
P_TOS_PIL_ObjectToCenterLine_dy_CutInUpperLimit = AUTOSAR4.Parameter(0.5, SwCalibrationAccess="ReadWrite", StorageClass="Global", MemorySection="CAL", DataType="single")  % 目标到本车道中心线距离，滤波 UpperRate
P_TOS_PIL_ObjinEgoLaneProb_Val = AUTOSAR4.Parameter(0.3, SwCalibrationAccess="ReadWrite", StorageClass="Global", MemorySection="CAL", DataType="single")  % 目标在自车道概率 0.3
P_TOS_PIL_ObjInLeftlaneProb_Val = AUTOSAR4.Parameter(0.3, SwCalibrationAccess="ReadWrite", StorageClass="Global", MemorySection="CAL", DataType="single")  % 目标在左车道概率 0.3
P_TOS_PIL_ObjInRightlaneProb_Val = AUTOSAR4.Parameter(0.3, SwCalibrationAccess="ReadWrite", StorageClass="Global", MemorySection="CAL", DataType="single")  % 目标在右车道概率 0.3
P_TOS_ProbOfWithInSameLane_Vyc_Val_1 = AUTOSAR4.Parameter(0, SwCalibrationAccess="ReadWrite", StorageClass="Global", MemorySection="CAL", DataType="single")  % 目标与本车在相同车道内，滤波依据Vyc大小，
P_TOS_ProbOfWithInSameLane_Vyc_Val_2 = AUTOSAR4.Parameter(0.5, SwCalibrationAccess="ReadWrite", StorageClass="Global", MemorySection="CAL", DataType="single")  % 目标与本车在相同车道内，滤波依据Vyc大小，
P_TOS_ProbOfWithInSameLane_Vyc_Val_3 = AUTOSAR4.Parameter(1, SwCalibrationAccess="ReadWrite", StorageClass="Global", MemorySection="CAL", DataType="single")  % 目标与本车在相同车道内，滤波依据Vyc大小，
P_TOS_ProbOfWithInSameLane_Vyc_Val_4 = AUTOSAR4.Parameter(1.5, SwCalibrationAccess="ReadWrite", StorageClass="Global", MemorySection="CAL", DataType="single")  % 目标与本车在相同车道内，滤波依据Vyc大小，
P_TOS_ProbOfWithInSameLane_Vyc_Val_5 = AUTOSAR4.Parameter(2, SwCalibrationAccess="ReadWrite", StorageClass="Global", MemorySection="CAL", DataType="single")  % 目标与本车在相同车道内，滤波依据Vyc大小，
P_TOS_RefPoint_dx_m = AUTOSAR4.Parameter(0, SwCalibrationAccess="ReadWrite", StorageClass="Global", MemorySection="CAL", DataType="single")
P_TOS_RefPoint_FixDis_dx1_m = AUTOSAR4.Parameter(-3, SwCalibrationAccess="ReadWrite", StorageClass="Global", MemorySection="CAL", DataType="single")
P_TOS_RefPoint_FixDis_dx2_m = AUTOSAR4.Parameter(3, SwCalibrationAccess="ReadWrite", StorageClass="Global", MemorySection="CAL", DataType="single")
P_TOS_RightLaneProbThre_Value = AUTOSAR4.Parameter(0.7, SwCalibrationAccess="ReadWrite", StorageClass="Global", MemorySection="CAL", DataType="single")  % 目标存在于右车道时，概率阈值
P_TOS_SameDirVxvOffset_Val = AUTOSAR4.Parameter(1, SwCalibrationAccess="ReadWrite", StorageClass="Global", MemorySection="CAL", DataType="single")
P_TOS_SameDirVyOffset_Val = AUTOSAR4.Parameter(2, SwCalibrationAccess="ReadWrite", StorageClass="Global", MemorySection="CAL", DataType="single")
P_TOS_SteerWheelAngMax_Val = AUTOSAR4.Parameter(100, SwCalibrationAccess="ReadWrite", StorageClass="Global", MemorySection="CAL", DataType="single")
P_TOS_SteerWheelAngMin_Val = AUTOSAR4.Parameter(5, SwCalibrationAccess="ReadWrite", StorageClass="Global", MemorySection="CAL", DataType="single")
P_TOS_SteerWheelSpdMax_Val = AUTOSAR4.Parameter(100, SwCalibrationAccess="ReadWrite", StorageClass="Global", MemorySection="CAL", DataType="single")
P_TOS_SysCycTime_Val = AUTOSAR4.Parameter(0.05, SwCalibrationAccess="ReadWrite", StorageClass="Global", MemorySection="CAL", DataType="single")
P_TOS_TAP_ExistProbThre_Valu = AUTOSAR4.Parameter(0.5, SwCalibrationAccess="ReadWrite", StorageClass="Global", MemorySection="CAL", DataType="single")
P_TOS_TAP_ObstacleProbThre_Valu = AUTOSAR4.Parameter(0.43, SwCalibrationAccess="ReadWrite", StorageClass="Global", MemorySection="CAL", DataType="single")
P_TOS_VYVXAngleMax_Val = AUTOSAR4.Parameter(3.14, SwCalibrationAccess="ReadWrite", StorageClass="Global", MemorySection="CAL", DataType="single")
P_TOS_VYVXAngleMin_Val = AUTOSAR4.Parameter(-3.14, SwCalibrationAccess="ReadWrite", StorageClass="Global", MemorySection="CAL", DataType="single")
P_TOS_RE_Ts = AUTOSAR4.Parameter(0.05, SwCalibrationAccess="ReadWrite", StorageClass="Global", MemorySection="CAL", DataType="single")
P_TOS_RE_TargetDyStdMaxVal = AUTOSAR4.Parameter(12.5, SwCalibrationAccess="ReadWrite", StorageClass="Global", MemorySection="CAL", DataType="single")
P_TOS_RE_TargetDyMinVal_m = AUTOSAR4.Parameter(0.5, SwCalibrationAccess="ReadWrite", StorageClass="Global", MemorySection="CAL", DataType="single")
P_TOS_RE_TargetDyMaxVal_m = AUTOSAR4.Parameter(20, SwCalibrationAccess="ReadWrite", StorageClass="Global", MemorySection="CAL", DataType="single")
P_TOS_RE_TargetDxStdMaxVal = AUTOSAR4.Parameter(12.5, SwCalibrationAccess="ReadWrite", StorageClass="Global", MemorySection="CAL", DataType="single")
P_TOS_RE_TargetDxMinVal_m = AUTOSAR4.Parameter(0, SwCalibrationAccess="ReadWrite", StorageClass="Global", MemorySection="CAL", DataType="single")
P_TOS_RE_TargetDxMaxVal_m = AUTOSAR4.Parameter(200, SwCalibrationAccess="ReadWrite", StorageClass="Global", MemorySection="CAL", DataType="single")
P_TOS_RE_StrightDirThetaMin_val = AUTOSAR4.Parameter(-1.8, SwCalibrationAccess="ReadWrite", StorageClass="Global", MemorySection="CAL", DataType="single")
P_TOS_RE_StrightDirThetaMax_val = AUTOSAR4.Parameter(1.8, SwCalibrationAccess="ReadWrite", StorageClass="Global", MemorySection="CAL", DataType="single")
P_TOS_RE_stateProlongationTime = AUTOSAR4.Parameter(0.2, SwCalibrationAccess="ReadWrite", StorageClass="Global", MemorySection="CAL", DataType="single")
P_TOS_RE_SameDirTargetChainDyThre_Val = AUTOSAR4.Parameter(3, SwCalibrationAccess="ReadWrite", StorageClass="Global", MemorySection="CAL", DataType="single")
P_TOS_RE_SameDirTargetChainDxThre_Val = AUTOSAR4.Parameter(40, SwCalibrationAccess="ReadWrite", StorageClass="Global", MemorySection="CAL", DataType="single")
P_TOS_RE_RoadEdgeGroupEgoVxvThre_Val = AUTOSAR4.Parameter(16, SwCalibrationAccess="ReadWrite", StorageClass="Global", MemorySection="CAL", DataType="single")
P_TOS_RE_RoadEdgeGroupDy_LowSpeedThre_Val = AUTOSAR4.Parameter(6, SwCalibrationAccess="ReadWrite", StorageClass="Global", MemorySection="CAL", DataType="single")
P_TOS_RE_RoadEdgeGroupDy_HighSpeedThre_Val = AUTOSAR4.Parameter(10, SwCalibrationAccess="ReadWrite", StorageClass="Global", MemorySection="CAL", DataType="single")
P_TOS_RE_RoadEdgeGroupDxThre_Val = AUTOSAR4.Parameter(35, SwCalibrationAccess="ReadWrite", StorageClass="Global", MemorySection="CAL", DataType="single")
P_TOS_RE_REE3TargetThetaMin_Val = AUTOSAR4.Parameter(-22, SwCalibrationAccess="ReadWrite", StorageClass="Global", MemorySection="CAL", DataType="single")
P_TOS_RE_REE3TargetThetaMax_Val = AUTOSAR4.Parameter(22, SwCalibrationAccess="ReadWrite", StorageClass="Global", MemorySection="CAL", DataType="single")
P_TOS_RE_NebrNearTargetDyThre_Val = AUTOSAR4.Parameter(0.5, SwCalibrationAccess="ReadWrite", StorageClass="Global", MemorySection="CAL", DataType="single")
P_TOS_RE_NebrNearTargetDxThre_Val = AUTOSAR4.Parameter(5, SwCalibrationAccess="ReadWrite", StorageClass="Global", MemorySection="CAL", DataType="single")
P_TOS_RE_LowSpeedREE4TargetThetaMinOut_Val = AUTOSAR4.Parameter(-12, SwCalibrationAccess="ReadWrite", StorageClass="Global", MemorySection="CAL", DataType="single")
P_TOS_RE_LowSpeedREE4TargetThetaMin_Val = AUTOSAR4.Parameter(-11, SwCalibrationAccess="ReadWrite", StorageClass="Global", MemorySection="CAL", DataType="single")
P_TOS_RE_LowSpeedREE4TargetThetaMaxOut_Val = AUTOSAR4.Parameter(12, SwCalibrationAccess="ReadWrite", StorageClass="Global", MemorySection="CAL", DataType="single")
P_TOS_RE_LowSpeedREE4TargetThetaMax_Val = AUTOSAR4.Parameter(11, SwCalibrationAccess="ReadWrite", StorageClass="Global", MemorySection="CAL", DataType="single")
P_TOS_RE_HighSpeedREE4TargetThetaMinOut_Val = AUTOSAR4.Parameter(-10, SwCalibrationAccess="ReadWrite", StorageClass="Global", MemorySection="CAL", DataType="single")
P_TOS_RE_HighSpeedREE4TargetThetaMin_Val = AUTOSAR4.Parameter(-8, SwCalibrationAccess="ReadWrite", StorageClass="Global", MemorySection="CAL", DataType="single")
P_TOS_RE_HighSpeedREE4TargetThetaMaxOut_Val = AUTOSAR4.Parameter(10, SwCalibrationAccess="ReadWrite", StorageClass="Global", MemorySection="CAL", DataType="single")
P_TOS_RE_HighSpeedREE4TargetThetaMax_Val = AUTOSAR4.Parameter(8, SwCalibrationAccess="ReadWrite", StorageClass="Global", MemorySection="CAL", DataType="single")
P_TOS_RE_ExistProbThre_val = AUTOSAR4.Parameter(0.4, SwCalibrationAccess="ReadWrite", StorageClass="Global", MemorySection="CAL", DataType="single")
P_TOS_RE_DiffDirTargetChainDyThre_Val = AUTOSAR4.Parameter(1, SwCalibrationAccess="ReadWrite", StorageClass="Global", MemorySection="CAL", DataType="single")
P_TOS_RE_DiffDirTargetChainDxThre_Val = AUTOSAR4.Parameter(40, SwCalibrationAccess="ReadWrite", StorageClass="Global", MemorySection="CAL", DataType="single")
P_TOS_RE_ApartNearTargetDyThre_Val = AUTOSAR4.Parameter(0.5, SwCalibrationAccess="ReadWrite", StorageClass="Global", MemorySection="CAL", DataType="single")
P_TOS_RE_ApartNearTargetDxThre_Val = AUTOSAR4.Parameter(8, SwCalibrationAccess="ReadWrite", StorageClass="Global", MemorySection="CAL", DataType="single")
P_TOS_ACC_P0_TargetOverlapThre_Val = AUTOSAR4.Parameter(0.3, SwCalibrationAccess="ReadWrite", StorageClass="Global", MemorySection="CAL", DataType="single")
P_TOS_CrossingTarget_VxabsOffset_val = AUTOSAR4.Parameter(2, SwCalibrationAccess="ReadWrite", StorageClass="Global", MemorySection="CAL", DataType="single")
TOS_PP_TPA_OFMObjValid_Flag = AUTOSAR4.Signal(SwCalibrationAccess="ReadOnly", StorageClass="Global", MemorySection="VAR", DataType="boolean")  % 目标预处理，目标是否有效标志位
TOS_PP_AddAttributes_bus = AUTOSAR4.Signal(SwCalibrationAccess="ReadOnly", StorageClass="Global", MemorySection="VAR")
TOS_PIL_SameLanePro_Filt = AUTOSAR4.Signal(SwCalibrationAccess="ReadOnly", StorageClass="Global", MemorySection="VAR", DataType="single")
TOS_TLJ_SameLaneConfirm_Flag = AUTOSAR4.Signal(SwCalibrationAccess="ReadOnly", StorageClass="Global", MemorySection="VAR", DataType="boolean")

TOS_TLJ_LeftLaneConfirm_Flag = AUTOSAR4.Signal(SwCalibrationAccess="ReadOnly", StorageClass="Global", MemorySection="VAR", DataType="boolean")
TOS_TLJ_RightLaneConfirm_Flag = AUTOSAR4.Signal(SwCalibrationAccess="ReadOnly", StorageClass="Global", MemorySection="VAR", DataType="boolean")
TOS_AEBLong_Index = AUTOSAR4.Signal(SwCalibrationAccess="ReadOnly", StorageClass="Global", MemorySection="VAR", DataType="uint8")
TOS_AEBLong_TargetIndex = AUTOSAR4.Signal(SwCalibrationAccess="ReadOnly", StorageClass="Global", MemorySection="VAR", DataType="uint8")
TOS_PP_LM_RoadNumChg = AUTOSAR4.Signal(SwCalibrationAccess="ReadOnly", StorageClass="Global", MemorySection="VAR", DataType="uint8")
TOS_PP_LM_DrivInWLflg = AUTOSAR4.Signal(SwCalibrationAccess="ReadOnly", StorageClass="Global", MemorySection="VAR", DataType="uint8")
TOS_PP_LM_SpecialRoadType = AUTOSAR4.Signal(SwCalibrationAccess="ReadOnly", StorageClass="Global", MemorySection="VAR", DataType="uint8")
TOS_PIL_ObjectToCenterLine_dy_Filt = AUTOSAR4.Signal(SwCalibrationAccess="ReadOnly", StorageClass="Global", MemorySection="VAR", DataType="single")
TOS_PIL_CutInPredictTime_ObserVale = AUTOSAR4.Signal(SwCalibrationAccess="ReadOnly", StorageClass="Global", MemorySection="VAR", DataType="single")
TOS_PIL_CutInPredictTime_dxConstraint_ObserVale = AUTOSAR4.Signal(SwCalibrationAccess="ReadOnly", StorageClass="Global", MemorySection="VAR", DataType="single")
TOS_PIL_CutInPredictDis_dy_ObjWidthConstraint_ObserVale = AUTOSAR4.Signal(SwCalibrationAccess="ReadOnly", StorageClass="Global", MemorySection="VAR", DataType="single")
TOS_PIL_CutinMindFlg_ObserVale = AUTOSAR4.Signal(SwCalibrationAccess="ReadOnly", StorageClass="Global", MemorySection="VAR", DataType="boolean")
TOS_PIL_ObjectCutInPro_Filt = AUTOSAR4.Signal(SwCalibrationAccess="ReadOnly", StorageClass="Global", MemorySection="VAR", DataType="single")
TOS_PIL_ObjectCutIn_Flag = AUTOSAR4.Signal(SwCalibrationAccess="ReadOnly", StorageClass="Global", MemorySection="VAR", DataType="boolean")
TOS_PIL_CutOutPredictTime_ObserVale = AUTOSAR4.Signal(SwCalibrationAccess="ReadOnly", StorageClass="Global", MemorySection="VAR", DataType="single")
TOS_PIL_CutOutPredictTime_dxConstraint_ObserVale = AUTOSAR4.Signal(SwCalibrationAccess="ReadOnly", StorageClass="Global", MemorySection="VAR", DataType="single")
TOS_CutOutPredictDis_dy_ObjWidthConstraint_ObserVale = AUTOSAR4.Signal(SwCalibrationAccess="ReadOnly", StorageClass="Global", MemorySection="VAR", DataType="single")
TOS_PIL_ObjectCutOutMindFlg_ObserVale = AUTOSAR4.Signal(SwCalibrationAccess="ReadOnly", StorageClass="Global", MemorySection="VAR", DataType="boolean")
TOS_PIL_ObjectCutOutPro_Filt = AUTOSAR4.Signal(SwCalibrationAccess="ReadOnly", StorageClass="Global", MemorySection="VAR", DataType="single")
TOS_PIL_ObjectCutOut_Flag = AUTOSAR4.Signal(SwCalibrationAccess="ReadOnly", StorageClass="Global", MemorySection="VAR", DataType="boolean")
TOS_PIL_RightLaneProb_Filt = AUTOSAR4.Signal(SwCalibrationAccess="ReadOnly", StorageClass="Global", MemorySection="VAR", DataType="single")
TOS_PIL_LeftLaneProb_Filt = AUTOSAR4.Signal(SwCalibrationAccess="ReadOnly", StorageClass="Global", MemorySection="VAR", DataType="single")
TOS_PIL_EgoVehiclePro_bus = AUTOSAR4.Signal(SwCalibrationAccess="ReadOnly", StorageClass="Global", MemorySection="VAR")
TOS_AEBLong_TargetDis_ObserVale = AUTOSAR4.Signal(SwCalibrationAccess="ReadOnly", StorageClass="Global", MemorySection="VAR", DataType="boolean")
TOS_AEBLong_ObstacleProb_ObserVale = AUTOSAR4.Signal(SwCalibrationAccess="ReadOnly", StorageClass="Global", MemorySection="VAR", DataType="boolean")
TOS_AEBLong_TargetExistProb_ObserVale = AUTOSAR4.Signal(SwCalibrationAccess="ReadOnly", StorageClass="Global", MemorySection="VAR", DataType="boolean")
TOS_AEBLong_ObjFusType_ObserVale = AUTOSAR4.Signal(SwCalibrationAccess="ReadOnly", StorageClass="Global", MemorySection="VAR", DataType="boolean")
TOS_AEBLong_TargetInEgoFront_ObserVale = AUTOSAR4.Signal(SwCalibrationAccess="ReadOnly", StorageClass="Global", MemorySection="VAR", DataType="boolean")
TOS_AEBLong_TargetMovingDir_ObserVale = AUTOSAR4.Signal(SwCalibrationAccess="ReadOnly", StorageClass="Global", MemorySection="VAR", DataType="boolean")
TOS_AEB_Stockade_ObserVale = AUTOSAR4.Signal(SwCalibrationAccess="ReadOnly", StorageClass="Global", MemorySection="VAR", DataType="boolean")
TOS_AEBLong_TargetDy_ObserVale = AUTOSAR4.Signal(SwCalibrationAccess="ReadOnly", StorageClass="Global", MemorySection="VAR", DataType="boolean")
TOS_AEBLong_SteerWheelAngConfirm_ObserVale = AUTOSAR4.Signal(SwCalibrationAccess="ReadOnly", StorageClass="Global", MemorySection="VAR", DataType="boolean")
TOS_AEBJunc_Index = AUTOSAR4.Signal(SwCalibrationAccess="ReadOnly", StorageClass="Global", MemorySection="VAR", DataType="uint8")
TOS_AEBJunc_TargetIndex = AUTOSAR4.Signal(SwCalibrationAccess="ReadOnly", StorageClass="Global", MemorySection="VAR", DataType="uint8")
TOS_AEBJunc_TargetDx_ObserVale = AUTOSAR4.Signal(SwCalibrationAccess="ReadOnly", StorageClass="Global", MemorySection="VAR", DataType="boolean")
TOS_AEBJunc_TargetDy_ObserVale = AUTOSAR4.Signal(SwCalibrationAccess="ReadOnly", StorageClass="Global", MemorySection="VAR", DataType="boolean")
TOS_AEBJunc_ObjFusType_ObserVale = AUTOSAR4.Signal(SwCalibrationAccess="ReadOnly", StorageClass="Global", MemorySection="VAR", DataType="boolean")
TOS_AEBJunc_TargetMoveDir_ObserVale = AUTOSAR4.Signal(SwCalibrationAccess="ReadOnly", StorageClass="Global", MemorySection="VAR", DataType="boolean")
TOS_AEBJunc_ObstacleProb_ObserVale = AUTOSAR4.Signal(SwCalibrationAccess="ReadOnly", StorageClass="Global", MemorySection="VAR", DataType="boolean")
TOS_AEBLat_Index = AUTOSAR4.Signal(SwCalibrationAccess="ReadOnly", StorageClass="Global", MemorySection="VAR", DataType="uint8")
TOS_AEBLat_TargetIndex = AUTOSAR4.Signal(SwCalibrationAccess="ReadOnly", StorageClass="Global", MemorySection="VAR", DataType="uint8")
TOS_AEBLat_TargetDx_ObserVale = AUTOSAR4.Signal(SwCalibrationAccess="ReadOnly", StorageClass="Global", MemorySection="VAR", DataType="boolean")
TOS_AEBLat_TargetDy_ObserVale = AUTOSAR4.Signal(SwCalibrationAccess="ReadOnly", StorageClass="Global", MemorySection="VAR", DataType="boolean")
TOS_AEBLat_ObjFusType_ObserVale = AUTOSAR4.Signal(SwCalibrationAccess="ReadOnly", StorageClass="Global", MemorySection="VAR", DataType="boolean")
TOS_AEBLat_TargetMoveDir_ObserVale = AUTOSAR4.Signal(SwCalibrationAccess="ReadOnly", StorageClass="Global", MemorySection="VAR", DataType="boolean")
TOS_AEBLat_ObstacleProb_ObserVale = AUTOSAR4.Signal(SwCalibrationAccess="ReadOnly", StorageClass="Global", MemorySection="VAR", DataType="boolean")
TOS_ACC_P2_P4_Index = AUTOSAR4.Signal(SwCalibrationAccess="ReadOnly", StorageClass="Global", MemorySection="VAR", DataType="uint8")
TOS_ACC_P2_P4_TargetIndex = AUTOSAR4.Signal(SwCalibrationAccess="ReadOnly", StorageClass="Global", MemorySection="VAR", DataType="uint8")
TOS_ACC_P2_P4_FusionType_ObserVale = AUTOSAR4.Signal(SwCalibrationAccess="ReadOnly", StorageClass="Global", MemorySection="VAR", DataType="boolean")
TOS_ACC_P2_P4_TrgMovDir_ObserVale = AUTOSAR4.Signal(SwCalibrationAccess="ReadOnly", StorageClass="Global", MemorySection="VAR", DataType="boolean")
TOS_ACC_P2_P4_TrgInLeftLane_ObserVale = AUTOSAR4.Signal(SwCalibrationAccess="ReadOnly", StorageClass="Global", MemorySection="VAR", DataType="boolean")
TOS_ACC_P2_P4_ObjType_ObserVale = AUTOSAR4.Signal(SwCalibrationAccess="ReadOnly", StorageClass="Global", MemorySection="VAR", DataType="boolean")
TOS_ACC_P2_P4_ObstacleProb_ObserVale = AUTOSAR4.Signal(SwCalibrationAccess="ReadOnly", StorageClass="Global", MemorySection="VAR", DataType="boolean")
TOS_ACC_P2_P4_DyConfirm_ObserVale = AUTOSAR4.Signal(SwCalibrationAccess="ReadOnly", StorageClass="Global", MemorySection="VAR", DataType="boolean")
TOS_ACC_P3_P5_Index = AUTOSAR4.Signal(SwCalibrationAccess="ReadOnly", StorageClass="Global", MemorySection="VAR", DataType="uint8")
TOS_ACC_P3_P5_TargetIndex = AUTOSAR4.Signal(SwCalibrationAccess="ReadOnly", StorageClass="Global", MemorySection="VAR", DataType="uint8")
TOS_ACC_P3_P5_FusionType_ObserVale = AUTOSAR4.Signal(SwCalibrationAccess="ReadOnly", StorageClass="Global", MemorySection="VAR", DataType="boolean")
TOS_ACC_P3_P5_TrgMovDir_ObserVale = AUTOSAR4.Signal(SwCalibrationAccess="ReadOnly", StorageClass="Global", MemorySection="VAR", DataType="boolean")
TOS_ACC_P3_P5_TrgInRightLane_ObserVale = AUTOSAR4.Signal(SwCalibrationAccess="ReadOnly", StorageClass="Global", MemorySection="VAR", DataType="boolean")
TOS_ACC_P3_P5_ObjType_ObserVale = AUTOSAR4.Signal(SwCalibrationAccess="ReadOnly", StorageClass="Global", MemorySection="VAR", DataType="boolean")
TOS_ACC_P3_P5_ObstacleProb_ObserVale = AUTOSAR4.Signal(SwCalibrationAccess="ReadOnly", StorageClass="Global", MemorySection="VAR", DataType="boolean")
TOS_ACC_P3_P5_DyConfirm_ObserVale = AUTOSAR4.Signal(SwCalibrationAccess="ReadOnly", StorageClass="Global", MemorySection="VAR", DataType="boolean")
TOS_HWA_LeftLane_ObjIndex = AUTOSAR4.Signal(SwCalibrationAccess="ReadOnly", StorageClass="Global", MemorySection="VAR", DataType="uint8")
TOS_HWA_RightLane_ObjIndex = AUTOSAR4.Signal(SwCalibrationAccess="ReadOnly", StorageClass="Global", MemorySection="VAR", DataType="uint8")
TOS_HWA_CurrentLane_ObjIndex = AUTOSAR4.Signal(SwCalibrationAccess="ReadOnly", StorageClass="Global", MemorySection="VAR", DataType="uint8")
TOS_LCKie_LeftLane_ObjIndex = AUTOSAR4.Signal(SwCalibrationAccess="ReadOnly", StorageClass="Global", MemorySection="VAR", DataType="uint8")
TOS_LCKie_RightLane_ObjIndex = AUTOSAR4.Signal(SwCalibrationAccess="ReadOnly", StorageClass="Global", MemorySection="VAR", DataType="uint8")
TOS_ELK_CurrentLane_ObjIndex = AUTOSAR4.Signal(SwCalibrationAccess="ReadOnly", StorageClass="Global", MemorySection="VAR", DataType="uint8")
TOS_ELK_RightLane_ObjIndex = AUTOSAR4.Signal(SwCalibrationAccess="ReadOnly", StorageClass="Global", MemorySection="VAR", DataType="uint8")
TOS_ELK_LeftLane_ObjIndex = AUTOSAR4.Signal(SwCalibrationAccess="ReadOnly", StorageClass="Global", MemorySection="VAR", DataType="uint8")
TOS_LCKie_CurrentLane_ObjIndex = AUTOSAR4.Signal(SwCalibrationAccess="ReadOnly", StorageClass="Global", MemorySection="VAR", DataType="uint8")
TOS_AEBLong_OverlapRatio_ObserVale = AUTOSAR4.Signal(SwCalibrationAccess="ReadOnly", StorageClass="Global", MemorySection="VAR", DataType="boolean")
TOS_ACC_P0_P1_TargetPre_FusionTypeFlag_ObserVale = AUTOSAR4.Signal(SwCalibrationAccess="ReadOnly", StorageClass="Global", MemorySection="VAR", DataType="boolean")
TOS_ACC_P0_P1_TargetPre_PassedbyTarget_Flag_ObserVale = AUTOSAR4.Signal(SwCalibrationAccess="ReadOnly", StorageClass="Global", MemorySection="VAR", DataType="boolean")
TOS_ACC_P0_P1_TargetPre_FenceFlag_ObserVale = AUTOSAR4.Signal(SwCalibrationAccess="ReadOnly", StorageClass="Global", MemorySection="VAR", DataType="boolean")
TOS_ACC_P0_P1_TargetPreFiltFlag = AUTOSAR4.Signal(SwCalibrationAccess="ReadOnly", StorageClass="Global", MemorySection="VAR", DataType="boolean")
TOS_LM_LINE_LL = AUTOSAR4.Signal(SwCalibrationAccess="ReadOnly", StorageClass="Global", MemorySection="VAR")
TOS_PP_LeftLaneWidth = AUTOSAR4.Signal(SwCalibrationAccess="ReadOnly", StorageClass="Global", MemorySection="VAR", DataType="single")
TOS_PP_CurrentLaneWidth = AUTOSAR4.Signal(SwCalibrationAccess="ReadOnly", StorageClass="Global", MemorySection="VAR", DataType="single")
TOS_PP_RightLaneWidth = AUTOSAR4.Signal(SwCalibrationAccess="ReadOnly", StorageClass="Global", MemorySection="VAR", DataType="single")
TOS_TLJ_ObjinLeftLaneProb_ObserVale = AUTOSAR4.Signal(SwCalibrationAccess="ReadOnly", StorageClass="Global", MemorySection="VAR", DataType="single")
TOS_TLJ_ObjinEgoLaneProb_ObserVale = AUTOSAR4.Signal(SwCalibrationAccess="ReadOnly", StorageClass="Global", MemorySection="VAR", DataType="single")
TOS_TLJ_ObjinRightLaneProb_ObserVale = AUTOSAR4.Signal(SwCalibrationAccess="ReadOnly", StorageClass="Global", MemorySection="VAR", DataType="single")
TOS_TLJ_ObjInLaneCondition_Flag_ObserVale = AUTOSAR4.Signal(SwCalibrationAccess="ReadOnly", StorageClass="Global", MemorySection="VAR", DataType="uint8")
TOS_ACC_P0_P1_TrgInEgoFront_ObserVale_ObserVale = AUTOSAR4.Signal(SwCalibrationAccess="ReadOnly", StorageClass="Global", MemorySection="VAR", DataType="boolean")
TOS_HWA_TargetPreConfirm = AUTOSAR4.Signal(SwCalibrationAccess="ReadOnly", StorageClass="Global", MemorySection="VAR", DataType="boolean")
TOS_ACC_P0_P1_Index = AUTOSAR4.Signal(SwCalibrationAccess="ReadOnly", StorageClass="Global", MemorySection="VAR", DataType="uint8")
TOS_LM_LL_Bus = AUTOSAR4.Signal(SwCalibrationAccess="ReadOnly", StorageClass="Global", MemorySection="VAR")
TOS_LM_LR_Bus = AUTOSAR4.Signal(SwCalibrationAccess="ReadOnly", StorageClass="Global", MemorySection="VAR")
TOS_LM_RL_Bus = AUTOSAR4.Signal(SwCalibrationAccess="ReadOnly", StorageClass="Global", MemorySection="VAR")
TOS_LM_RR_Bus = AUTOSAR4.Signal(SwCalibrationAccess="ReadOnly", StorageClass="Global", MemorySection="VAR")
TOS_ACC_P0_P1_TargetPre_SameLaneFlag = AUTOSAR4.Signal(SwCalibrationAccess="ReadOnly", StorageClass="Global", MemorySection="VAR", DataType="boolean")
TOS_ACC_P0_P1_TargetPre_2_OverlapThre_ObserVale = AUTOSAR4.Signal(SwCalibrationAccess="ReadOnly", StorageClass="Global", MemorySection="VAR", DataType="boolean")
TOS_ACC_P0_P1_TargetPre_ObjType_ObserVale = AUTOSAR4.Signal(SwCalibrationAccess="ReadOnly", StorageClass="Global", MemorySection="VAR", DataType="boolean")
TOS_ACC_P0_TragetIndex = AUTOSAR4.Signal(SwCalibrationAccess="ReadOnly", StorageClass="Global", MemorySection="VAR", DataType="uint8")
TOS_ACC_P0_FusionType_ObserVale = AUTOSAR4.Signal(SwCalibrationAccess="ReadOnly", StorageClass="Global", MemorySection="VAR", DataType="boolean")
TOS_ACC_P0_TrgMovDir_ObserVale = AUTOSAR4.Signal(SwCalibrationAccess="ReadOnly", StorageClass="Global", MemorySection="VAR", DataType="boolean")
TOS_ACC_P0_TargetDxConfirm_ObserVale = AUTOSAR4.Signal(SwCalibrationAccess="ReadOnly", StorageClass="Global", MemorySection="VAR", DataType="boolean")
TOS_ACC_P0_ObjType_ObserVale = AUTOSAR4.Signal(SwCalibrationAccess="ReadOnly", StorageClass="Global", MemorySection="VAR", DataType="boolean")
TOS_ACC_P0_ObstacleProb_ObserVale = AUTOSAR4.Signal(SwCalibrationAccess="ReadOnly", StorageClass="Global", MemorySection="VAR", DataType="boolean")
TOS_ACC_P0_DyConfirm_ObserVale = AUTOSAR4.Signal(SwCalibrationAccess="ReadOnly", StorageClass="Global", MemorySection="VAR", DataType="boolean")
TOS_ACC_P0_TrgMovDirFlag_1_ObserVale = AUTOSAR4.Signal(SwCalibrationAccess="ReadOnly", StorageClass="Global", MemorySection="VAR", DataType="boolean")
TOS_ACC_P0_TrgMovDirFlag_2_ObserVale = AUTOSAR4.Signal(SwCalibrationAccess="ReadOnly", StorageClass="Global", MemorySection="VAR", DataType="boolean")
TOS_ACC_P0_TrgMovDirFlag_3_ObserVale = AUTOSAR4.Signal(SwCalibrationAccess="ReadOnly", StorageClass="Global", MemorySection="VAR", DataType="boolean")
TOS_ACC_P0_TrgMovDirFlag_4_ObserVale = AUTOSAR4.Signal(SwCalibrationAccess="ReadOnly", StorageClass="Global", MemorySection="VAR", DataType="boolean")
TOS_ACC_P0_TrgMovDirFlag_5_ObserVale = AUTOSAR4.Signal(SwCalibrationAccess="ReadOnly", StorageClass="Global", MemorySection="VAR", DataType="boolean")
TOS_ACC_P0_DyConfirm_1_ObserVale = AUTOSAR4.Signal(SwCalibrationAccess="ReadOnly", StorageClass="Global", MemorySection="VAR", DataType="boolean")
TOS_ACC_P0_DyConfirm_2_ObserVale = AUTOSAR4.Signal(SwCalibrationAccess="ReadOnly", StorageClass="Global", MemorySection="VAR", DataType="boolean")
TOS_ACC_P0_DyConfirm_3_ObserVale = AUTOSAR4.Signal(SwCalibrationAccess="ReadOnly", StorageClass="Global", MemorySection="VAR", DataType="boolean")
TOS_ACC_P1_TragetIndex = AUTOSAR4.Signal(SwCalibrationAccess="ReadOnly", StorageClass="Global", MemorySection="VAR", DataType="uint8")
TOS_ACC_P1_FusionType_ObserVale = AUTOSAR4.Signal(SwCalibrationAccess="ReadOnly", StorageClass="Global", MemorySection="VAR", DataType="boolean")
TOS_ACC_P1_TrgMovDir_ObserVale = AUTOSAR4.Signal(SwCalibrationAccess="ReadOnly", StorageClass="Global", MemorySection="VAR", DataType="boolean")
TOS_ACC_P1_TargetDxConfirm_ObserVale = AUTOSAR4.Signal(SwCalibrationAccess="ReadOnly", StorageClass="Global", MemorySection="VAR", DataType="boolean")
TOS_ACC_P1_ObjType_ObserVale = AUTOSAR4.Signal(SwCalibrationAccess="ReadOnly", StorageClass="Global", MemorySection="VAR", DataType="boolean")
TOS_ACC_P1_ObstacleProb_ObserVale = AUTOSAR4.Signal(SwCalibrationAccess="ReadOnly", StorageClass="Global", MemorySection="VAR", DataType="boolean")
TOS_HWA_LeftFront_FusType_ObserVale = AUTOSAR4.Signal(SwCalibrationAccess="ReadOnly", StorageClass="Global", MemorySection="VAR", DataType="boolean")
TOS_HWA_InLeftLane_Front_Flag_ObserVale = AUTOSAR4.Signal(SwCalibrationAccess="ReadOnly", StorageClass="Global", MemorySection="VAR", DataType="boolean")
TOS_HWA_LeftFront_TargMovDir_ObserVale = AUTOSAR4.Signal(SwCalibrationAccess="ReadOnly", StorageClass="Global", MemorySection="VAR", DataType="boolean")
TOS_HWA_LeftRear_MovState_ObserVale = AUTOSAR4.Signal(SwCalibrationAccess="ReadOnly", StorageClass="Global", MemorySection="VAR", DataType="boolean")
TOS_HWA_LeftRear_FusionType_ObserVale = AUTOSAR4.Signal(SwCalibrationAccess="ReadOnly", StorageClass="Global", MemorySection="VAR", DataType="boolean")
TOS_HWA_InLeftLane_Rear_Flag_ObserVale = AUTOSAR4.Signal(SwCalibrationAccess="ReadOnly", StorageClass="Global", MemorySection="VAR", DataType="boolean")
TOS_HWA_LeftRear_TargetMovingDir_ObserVale = AUTOSAR4.Signal(SwCalibrationAccess="ReadOnly", StorageClass="Global", MemorySection="VAR", DataType="boolean")
TOS_HWA_LeftRear_DyConfirm_ObserVale = AUTOSAR4.Signal(SwCalibrationAccess="ReadOnly", StorageClass="Global", MemorySection="VAR", DataType="boolean")
TOS_HWA_RightFront_FusType_ObserVale = AUTOSAR4.Signal(SwCalibrationAccess="ReadOnly", StorageClass="Global", MemorySection="VAR", DataType="boolean")
TOS_HWA_InRightLane_Front_Flag_ObserVale = AUTOSAR4.Signal(SwCalibrationAccess="ReadOnly", StorageClass="Global", MemorySection="VAR", DataType="boolean")
TOS_HWA_RightFront_TargMovDir_ObserVale = AUTOSAR4.Signal(SwCalibrationAccess="ReadOnly", StorageClass="Global", MemorySection="VAR", DataType="boolean")
TOS_HWA_RightRear_MovState_ObserVale = AUTOSAR4.Signal(SwCalibrationAccess="ReadOnly", StorageClass="Global", MemorySection="VAR", DataType="boolean")
TOS_HWA_RightRear_FusionType_ObserVale = AUTOSAR4.Signal(SwCalibrationAccess="ReadOnly", StorageClass="Global", MemorySection="VAR", DataType="boolean")
TOS_HWA_InRightLane_Rear_Flag_ObserVale = AUTOSAR4.Signal(SwCalibrationAccess="ReadOnly", StorageClass="Global", MemorySection="VAR", DataType="boolean")
TOS_HWA_RightRear_TargetMovingDir_ObserVale = AUTOSAR4.Signal(SwCalibrationAccess="ReadOnly", StorageClass="Global", MemorySection="VAR", DataType="boolean")
TOS_HWA_RightRear_DyConfirm_ObserVale = AUTOSAR4.Signal(SwCalibrationAccess="ReadOnly", StorageClass="Global", MemorySection="VAR", DataType="boolean")
TOS_HWA_CurrentFront_FusType_ObserVale = AUTOSAR4.Signal(SwCalibrationAccess="ReadOnly", StorageClass="Global", MemorySection="VAR", DataType="boolean")
TOS_HWA_InCurrentLane_Front_Flag_ObserVale = AUTOSAR4.Signal(SwCalibrationAccess="ReadOnly", StorageClass="Global", MemorySection="VAR", DataType="boolean")
TOS_HWA_CurrentFront_TargMovDir_ObserVale = AUTOSAR4.Signal(SwCalibrationAccess="ReadOnly", StorageClass="Global", MemorySection="VAR", DataType="boolean")
TOS_HWA_CurrentRear_MovState_ObserVale = AUTOSAR4.Signal(SwCalibrationAccess="ReadOnly", StorageClass="Global", MemorySection="VAR", DataType="boolean")
TOS_HWA_CurrentFront_ObjType_ObserVale = AUTOSAR4.Signal(SwCalibrationAccess="ReadOnly", StorageClass="Global", MemorySection="VAR", DataType="boolean")
TOS_HWA_CurrentRear_FusionType_ObserVale = AUTOSAR4.Signal(SwCalibrationAccess="ReadOnly", StorageClass="Global", MemorySection="VAR", DataType="boolean")
TOS_HWA_InCurrentLane_Rear_Flag_ObserVale = AUTOSAR4.Signal(SwCalibrationAccess="ReadOnly", StorageClass="Global", MemorySection="VAR", DataType="boolean")
TOS_HWA_CurrentRear_TargetMovingDir_ObserVale = AUTOSAR4.Signal(SwCalibrationAccess="ReadOnly", StorageClass="Global", MemorySection="VAR", DataType="boolean")
TOS_HWA_CurrentRear_DyConfirm_ObserVale = AUTOSAR4.Signal(SwCalibrationAccess="ReadOnly", StorageClass="Global", MemorySection="VAR", DataType="boolean")
TOS_PIL_OverlapRatio = AUTOSAR4.Signal(SwCalibrationAccess="ReadOnly", StorageClass="Global", MemorySection="VAR", DataType="single")
TOS_ACC_P0_TrgMovDirFlag_6_ObserVale = AUTOSAR4.Signal(SwCalibrationAccess="ReadOnly", StorageClass="Global", MemorySection="VAR", DataType="boolean")
TOS_ACC_P0_DyConfirm_4_OverlapRatio_ObserVale = AUTOSAR4.Signal(SwCalibrationAccess="ReadOnly", StorageClass="Global", MemorySection="VAR", DataType="boolean")
TOS_ACC_P0_DyConfirm_5_OverlapConfirm_ObserVale = AUTOSAR4.Signal(SwCalibrationAccess="ReadOnly", StorageClass="Global", MemorySection="VAR", DataType="boolean")
TOS_ACC_P0_DyConfirm_ALL_6_ObserVale = AUTOSAR4.Signal(SwCalibrationAccess="ReadOnly", StorageClass="Global", MemorySection="VAR", DataType="boolean")
TOS_ACC_P0_P1_TargetPre_1_ConditionFlag_ObserVale = AUTOSAR4.Signal(SwCalibrationAccess="ReadOnly", StorageClass="Global", MemorySection="VAR", DataType="boolean")
TOS_ACC_P0_P1_TargetPre_OverlapThre_Val_ObserVale = AUTOSAR4.Signal(SwCalibrationAccess="ReadOnly", StorageClass="Global", MemorySection="VAR", DataType="boolean")
TOS_HWA_LeftFront_Target_1 = AUTOSAR4.Signal(SwCalibrationAccess="ReadOnly", StorageClass="Global", MemorySection="VAR", DataType="uint8")
TOS_HWA_LeftFront_Target_2 = AUTOSAR4.Signal(SwCalibrationAccess="ReadOnly", StorageClass="Global", MemorySection="VAR", DataType="uint8")
TOS_HWA_LeftRear_Target_3 = AUTOSAR4.Signal(SwCalibrationAccess="ReadOnly", StorageClass="Global", MemorySection="VAR", DataType="uint8")
TOS_HWA_LeftRear_Target_4 = AUTOSAR4.Signal(SwCalibrationAccess="ReadOnly", StorageClass="Global", MemorySection="VAR", DataType="uint8")
TOS_HWA_CurrentFront_Target_1 = AUTOSAR4.Signal(SwCalibrationAccess="ReadOnly", StorageClass="Global", MemorySection="VAR", DataType="uint8")
TOS_HWA_CurrentFront_Target_2 = AUTOSAR4.Signal(SwCalibrationAccess="ReadOnly", StorageClass="Global", MemorySection="VAR", DataType="uint8")
TOS_HWA_CurrenRear_Target_1 = AUTOSAR4.Signal(SwCalibrationAccess="ReadOnly", StorageClass="Global", MemorySection="VAR", DataType="uint8")
TOS_HWA_RightFront_Target_1 = AUTOSAR4.Signal(SwCalibrationAccess="ReadOnly", StorageClass="Global", MemorySection="VAR", DataType="uint8")
TOS_HWA_RightFront_Target_2 = AUTOSAR4.Signal(SwCalibrationAccess="ReadOnly", StorageClass="Global", MemorySection="VAR", DataType="uint8")
TOS_HWA_RightRear_Target_3 = AUTOSAR4.Signal(SwCalibrationAccess="ReadOnly", StorageClass="Global", MemorySection="VAR", DataType="uint8")
TOS_HWA_RighRear_Target_4 = AUTOSAR4.Signal(SwCalibrationAccess="ReadOnly", StorageClass="Global", MemorySection="VAR", DataType="uint8")
TOS_ACC_P0_P1_TargetPre_REElementType_ObserVale = AUTOSAR4.Signal(SwCalibrationAccess="ReadOnly", StorageClass="Global", MemorySection="VAR", DataType="boolean")
TOS_P0_TARGET_TrgValidConfirm_ObserVale = AUTOSAR4.Signal(SwCalibrationAccess="ReadOnly", StorageClass="Global", MemorySection="VAR", DataType="boolean")
TOS_P0_TARGET_TrgValidConfirm_P0_Counter_ObserVale = AUTOSAR4.Signal(SwCalibrationAccess="ReadOnly", StorageClass="Global", MemorySection="VAR", DataType="uint32")
TOS_P0_LINE_d_Start = AUTOSAR4.Signal(SwCalibrationAccess="ReadOnly", StorageClass="Global", MemorySection="VAR", DataType="single")
TOS_P0_LINE_d_End = AUTOSAR4.Signal(SwCalibrationAccess="ReadOnly", StorageClass="Global", MemorySection="VAR", DataType="single")
TOS_P0_LINE_bus = AUTOSAR4.Signal(SwCalibrationAccess="ReadOnly", StorageClass="Global", MemorySection="VAR")
TOS_AEBLongObjInfo = AUTOSAR4.Signal(SwCalibrationAccess="ReadOnly", StorageClass="Global", MemorySection="VAR")
TOS_AEBJuncObjInfo = AUTOSAR4.Signal(SwCalibrationAccess="ReadOnly", StorageClass="Global", MemorySection="VAR")
TOS_AEBLatObjInfo = AUTOSAR4.Signal(SwCalibrationAccess="ReadOnly", StorageClass="Global", MemorySection="VAR")
TOS_ACCP1 = AUTOSAR4.Signal(SwCalibrationAccess="ReadOnly", StorageClass="Global", MemorySection="VAR")
TOS_ACCP2 = AUTOSAR4.Signal(SwCalibrationAccess="ReadOnly", StorageClass="Global", MemorySection="VAR")
TOS_ACCP3 = AUTOSAR4.Signal(SwCalibrationAccess="ReadOnly", StorageClass="Global", MemorySection="VAR")
TOS_ACCP4 = AUTOSAR4.Signal(SwCalibrationAccess="ReadOnly", StorageClass="Global", MemorySection="VAR")
TOS_ACCP5 = AUTOSAR4.Signal(SwCalibrationAccess="ReadOnly", StorageClass="Global", MemorySection="VAR")
TOS_LC = AUTOSAR4.Signal(SwCalibrationAccess="ReadOnly", StorageClass="Global", MemorySection="VAR")
TOS_LCKIE = AUTOSAR4.Signal(SwCalibrationAccess="ReadOnly", StorageClass="Global", MemorySection="VAR")
TOS_ELK = AUTOSAR4.Signal(SwCalibrationAccess="ReadOnly", StorageClass="Global", MemorySection="VAR")
TOS_PIL_ObjectCutoutMindFlg1_ObserVale = AUTOSAR4.Signal(SwCalibrationAccess="ReadOnly", StorageClass="Global", MemorySection="VAR", DataType="boolean")
TOS_PIL_ObjectCutoutMindFlg2_ObserVale = AUTOSAR4.Signal(SwCalibrationAccess="ReadOnly", StorageClass="Global", MemorySection="VAR", DataType="boolean")
TOS_PIL_ObjectCutoutMindFlg3_ObserVale = AUTOSAR4.Signal(SwCalibrationAccess="ReadOnly", StorageClass="Global", MemorySection="VAR", DataType="boolean")
TOS_PP_EgoVehCenterLine_dy = AUTOSAR4.Signal(SwCalibrationAccess="ReadOnly", StorageClass="Global", MemorySection="VAR", DataType="single")
TOS_PP_ObjectToCenterLine_dy = AUTOSAR4.Signal(SwCalibrationAccess="ReadOnly", StorageClass="Global", MemorySection="VAR", DataType="single")
TOS_TEM_P0_TARGET_LINE = AUTOSAR4.Signal(SwCalibrationAccess="ReadOnly", StorageClass="Global", MemorySection="VAR")
TOS_AEBJunc_PedTargetDXDY_observal = AUTOSAR4.Signal(SwCalibrationAccess="ReadOnly", StorageClass="Global", MemorySection="VAR", DataType="boolean")
TOS_AEBJunc_PedTargetFusionType_observal = AUTOSAR4.Signal(SwCalibrationAccess="ReadOnly", StorageClass="Global", MemorySection="VAR", DataType="boolean")
TOS_AEBJunc_PedTargetMovDir_observal = AUTOSAR4.Signal(SwCalibrationAccess="ReadOnly", StorageClass="Global", MemorySection="VAR", DataType="boolean")
TOS_AEBJunc_PedTargetObjectType_observal = AUTOSAR4.Signal(SwCalibrationAccess="ReadOnly", StorageClass="Global", MemorySection="VAR", DataType="boolean")
TOS_AEBJunc_VehTargetDXDY_observal = AUTOSAR4.Signal(SwCalibrationAccess="ReadOnly", StorageClass="Global", MemorySection="VAR", DataType="boolean")
TOS_AEBJunc_VehTargetFusionType_observal = AUTOSAR4.Signal(SwCalibrationAccess="ReadOnly", StorageClass="Global", MemorySection="VAR", DataType="boolean")
TOS_AEBJunc_VehTargetMovDir_observal = AUTOSAR4.Signal(SwCalibrationAccess="ReadOnly", StorageClass="Global", MemorySection="VAR", DataType="boolean")
TOS_AEBJunc_VehTargetMovState_observal = AUTOSAR4.Signal(SwCalibrationAccess="ReadOnly", StorageClass="Global", MemorySection="VAR", DataType="boolean")
TOS_AEBJunc_VehTargetObjectType_observal = AUTOSAR4.Signal(SwCalibrationAccess="ReadOnly", StorageClass="Global", MemorySection="VAR", DataType="boolean")
TOS_AEBLat_TargetDXDY_observal = AUTOSAR4.Signal(SwCalibrationAccess="ReadOnly", StorageClass="Global", MemorySection="VAR", DataType="boolean")
TOS_AEBLat_TargetFusionType_observal = AUTOSAR4.Signal(SwCalibrationAccess="ReadOnly", StorageClass="Global", MemorySection="VAR", DataType="boolean")
TOS_AEBLat_TargetMovDir_observal = AUTOSAR4.Signal(SwCalibrationAccess="ReadOnly", StorageClass="Global", MemorySection="VAR", DataType="boolean")
TOS_AEBLat_TargetObjectType_observal = AUTOSAR4.Signal(SwCalibrationAccess="ReadOnly", StorageClass="Global", MemorySection="VAR", DataType="boolean")
TOS_ACCP0 = AUTOSAR4.Signal(SwCalibrationAccess="ReadOnly", StorageClass="ExportedGlobal")