% Simulink data dictionary mcuSPI.sldd

SPI2SOC_VISIONS_BUS = Simulink.Bus(DataScope="Imported", HeaderFile="mcuEQ4.h")
  EQ4_APP: Bus: SPI_EQ4_APP_BUS
  EQ4_COM: Bus: SPI_EQ4_COM_BUS
  EQ4_FS: Bus: SPI_EQ4_FS_BUS
  EQ4_SD: Bus: SPI_EQ4_SD_BUS
  EQ4_FSPX: Bus: SPI_EQ4_FSPX_BUS
  EQ4_LA: Bus: SPI_EQ4_LA_BUS
  EQ4_LAP: Bus: SPI_EQ4_LAP_BUS
  EQ4_LH: Bus: SPI_EQ4_LH_BUS
  EQ4_LRE: Bus: SPI_EQ4_LRE_BUS
  EQ4_OBJ: Bus: SPI_EQ4_OBJ_BUS
  EQ4_TFL_SPOTS: Bus: SPI_EQ4_TFL_SPOTS_BUS
  EQ4_TFL_STRUCT: Bus: SPI_EQ4_TFL_STRUCT_BUS
  EQ4_TSR: Bus: SPI_EQ4_TSR_BUS

SPI_EQ4_APPINFO_BUS = Simulink.Bus(DataScope="Imported", HeaderFile="mcuEQ4.h")
  H: uint32
  L: uint32
  APP_SyncTsValid: uint8
  APP_E2EStatus: uint8

SPI_EQ4_APP_BUS = Simulink.Bus(DataScope="Imported", HeaderFile="mcuEQ4.h")
  EQ4_APPINFO: Bus: SPI_EQ4_APPINFO_BUS
  EQ4_APP_HDR: Bus: SPI_EQ4_APP_HDR_BUS

SPI_EQ4_APP_HDR_BUS = Simulink.Bus(DataScope="Imported", HeaderFile="mcuEQ4.h")
  APP_Zero_Byte: uint8
  Application_Message_Version: uint8
  APP_Main_State: uint8
  APP_Sub_State: uint8
  APP_EyeQ_Process_Index: uint32
  APP_EyeQ_Timestamp: uint32
  APP_EyeQ_Current_Timestamp: uint32
  APP_Diagnostics_part_1: uint16
  APP_Diagnostics_part_2: uint16
  APP_Fatal_Error: uint8
  App_RSRV_1: uint8
  APP_Minor_Error: uint16
  APP_EyeQTemperature1: int16
  APP_EyeQTemperature2: int16
  APP_Temperature_DDR: int8
  App_RSRV_2: uint8
  App_RSRV_3: uint16
  App_RSRV_4: uint8
  APP_spiErrors: uint8
  APP_Valid_second_cam_temp_info: uint8
  APP_Valid_cameras_information: uint8
  APP_Camera1_temperature_1: int16
  APP_Camera2_temperature_1: int16
  APP_Camera3_temperature_1: int16
  APP_Camera1_temperature_2: int16
  APP_Camera2_temperature_2: int16
  APP_Camera3_temperature_2: int16
  App_RSRV_5: int16
  App_RSRV_6: int16
  APP_Camera1_VideoErrorRange: uint8
  APP_Camera2_VideoErrorRange: uint8
  APP_Camera3_VideoErrorRange: uint8
  App_RSRV_7: uint8
  App_RSRV_8: uint8
  App_RSRV_9: uint8
  App_RSRV_10: uint8
  App_RSRV_11: uint8
  APP_Camera1_VideoErrorFlags_pt1: uint32
  APP_Camera2_VideoErrorFlags_pt1: uint32
  APP_Camera3_VideoErrorFlags_pt1: uint32
  APP_Brain_drops_counter: uint32
  APP_appMode: uint32
  APP_Application_ver: uint32
  App_RSRV_12: uint32
  App_RSRV_13: uint32
  APP_Camera1_VideoErrorFlags_pt2: uint32
  APP_Camera2_VideoErrorFlags_pt2: uint32
  APP_Camera3_VideoErrorFlags_pt2: uint32
  APP_SPI_Bus_Load_Tx: uint32
  APP_SPI_Bus_Load_Rx: uint32
  APP_SPI_Retransmit_Tx: uint32
  App_RSRV_14: uint32
  App_CRC32: uint32

SPI_EQ4_COM_BUS = Simulink.Bus(DataScope="Imported", HeaderFile="mcuEQ4.h")
  EQ4_APPINFO: Bus: SPI_EQ4_APPINFO_BUS
  EQ4_COM_HDR: Bus: SPI_EQ4_COM_HDR_BUS

SPI_EQ4_COM_HDR_BUS = Simulink.Bus(DataScope="Imported", HeaderFile="mcuEQ4.h")
  COM_Zero_byte: uint8
  Reserved_1: uint8
  COM_CRC: uint32
  COM_Protocol_Version: uint8
  COM_Sync_Frame_ID: uint8
  Reserved_2: uint8
  COM_Frame_MCU_TS_Start: uint32
  L: uint32
  COM_Last_MCU_Sync_TS: uint32
  L2: uint32
  COM_Last_Clock_Sync_Skew: int32
  COM_Last_Clock_Sync_Error: uint8
  Reserved_3: uint8
  COM_EyeQ_Frame_ID: uint32
  COM_Cam_Frame_ID: uint32
  COM_DayTime_Indicator: uint8
  COM_HIL_Mode_Status: uint8
  COM_Exposure_Type: uint8
  COM_Region_Code_V: uint8
  COM_Region_Code: uint8
  COM_Driving_Side_V: uint8
  COM_Driving_Side: uint8
  COM_Is_HighSpeed_Road_V: uint8
  COM_Is_HighSpeed_Road: uint8
  COM_Buffer_C1: uint8
  COM_Buffer_C2: single

SPI_EQ4_FSPX_BUS = Simulink.Bus(DataScope="Imported", HeaderFile="mcuEQ4.h")
  EQ4_APPINFO: Bus: SPI_EQ4_APPINFO_BUS
  EQ4_FSPX_HDR: Bus: SPI_EQ4_FSPX_HDR_BUS
  EQ4_FSPX_ELEM: Bus: SPI_EQ4_FSPX_ELEM_BUS[72]

SPI_EQ4_FSPX_ELEM_BUS = Simulink.Bus(DataScope="Imported", HeaderFile="mcuEQ4.h")
  FSPX_Is_Valid: uint8
  FSPX_Existence_Prob_B0: single
  FSPX_Mobility_Status_B0: uint8
  FSPX_Classification_Conf_B0: single
  FSPX_Classification_Type_B0: uint8
  FSPX_Lane_Assginment_B0: uint8
  Reserved_1: uint8
  FSPX_Obsticle_ID_B0: uint8
  FSPX_Elevation_Angle_B0: single
  FSPX_Range_STD_B0: single
  Reserved_2: uint8
  FSPX_Height_B0: single
  FSPX_Height_STD_B0: single
  FSPX_Azimuth_Angle_B0: single
  FSPX_Azimuth_Angle_STD_B0: single
  FSPX_Range_B0: single
  Reserved_3: uint8

SPI_EQ4_FSPX_HDR_BUS = Simulink.Bus(DataScope="Imported", HeaderFile="mcuEQ4.h")
  FSPX_Zero_byte: uint8
  FSPX_Protocol_Version: uint8
  FSPX_Sync_ID: uint8
  FSPX_Header_Buffer: uint8

SPI_EQ4_FS_BUS = Simulink.Bus(DataScope="Imported", HeaderFile="mcuEQ4.h")
  EQ4_APPINFO: Bus: SPI_EQ4_APPINFO_BUS
  EQ4_FS_HDR: Bus: SPI_EQ4_FS_HDR_BUS
  EQ4_FS_ELEM: Bus: SPI_EQ4_FS_ELEM_BUS[15]

SPI_EQ4_FS_ELEM_BUS = Simulink.Bus(DataScope="Imported", HeaderFile="mcuEQ4.h")
  FS_CRC: uint32
  FS_Camera_ID: uint8
  FS_Free_Sight: uint8
  FS_Splashes: uint8
  FS_Sun_Ray: uint8
  FS_Low_Sun: uint8
  FS_Blur_Image: uint8
  FS_Partial_Blockage: uint8
  FS_Full_Blockage: uint8
  FS_Frozen_Windshield_Lens: uint8
  FS_Out_Of_Focus: uint8
  FS_C2C_Out_Of_Calib: uint8

SPI_EQ4_FS_HDR_BUS = Simulink.Bus(DataScope="Imported", HeaderFile="mcuEQ4.h")
  FSP_Zero_byte: uint8
  Reserved_1: uint8
  FS_Header_CRC: uint32
  FS_Protocol_Version: uint8
  FS_Sync_ID: uint8
  FS_Cameras_Number: uint8
  FS_TSR_Out_OF_Calib: uint8
  FS_Out_Of_Calib: uint8
  Reserved_2: uint8
  FS_Impacted_Technologies: uint16
  FS_Rain: uint8
  FS_Fog: uint8
  FS_Calibration_Misalignment: uint8
  FS_C2W_OOR: uint8
  Reserved_3: uint8

SPI_EQ4_LAP_BUS = Simulink.Bus(DataScope="Imported", HeaderFile="mcuEQ4.h")
  EQ4_APPINFO: Bus: SPI_EQ4_APPINFO_BUS
  EQ4_LAP_HDR: Bus: SPI_EQ4_LAP_HDR_BUS
  EQ4_LAP_ELEM: Bus: SPI_EQ4_LAP_ELEM_BUS[8]

SPI_EQ4_LAP_ELEM_BUS = Simulink.Bus(DataScope="Imported", HeaderFile="mcuEQ4.h")
  LAP_INTP_ID: uint8
  LAP_INTP_Distance_Age: uint8
  LAP_INTP_Confidence: single
  LAP_INTP_Is_Valid: uint8
  LAP_INTP_Type: uint8
  LAP_INTP_Is_Start: uint8
  Reserved_4: uint8
  LAP_INTP_Lat_Distance: single
  LAP_INTP_Long_Distance: single
  Reserved_5: uint8
  LAP_Buffer_C1: uint8
  LAP_Buffer_C2: uint8
  Reserved_6: uint8
  Reserved_7: uint16

SPI_EQ4_LAP_HDR_BUS = Simulink.Bus(DataScope="Imported", HeaderFile="mcuEQ4.h")
  LAP_Zero_byte: uint8
  LAP_Protocol_Version: uint8
  LAP_Sync_ID: uint8
  LAP_Is_Construction_Area: uint8
  LAP_Buffer_C0: uint8
  LAP_INTP_Available: uint8
  LAP_INTP_Count: uint8
  LAP_Exit_Merge_Available: uint8
  LAP_Is_Highway_Merge_Left: uint8
  LAP_Is_Highway_Merge_Right: uint8
  LAP_Is_Highway_Exit_Left: uint8
  LAP_Is_Highway_Exit_Right: uint8
  LAP_Vertical_Surface_Available: uint8
  LAP_Vertical_Surface_VR_End: single
  Reserved_1: uint8
  LAP_Vertical_Surface_C0: single
  LAP_Vertical_Surface_C1: single
  LAP_Vertical_Surface_C2: single
  LAP_Vertical_Surface_C3: single
  LAP_Path_Pred_CRC: uint32
  LAP_Path_Pred_Available: uint8
  LAP_Path_Pred_First_Valid: uint8
  LAP_Path_Pred_Second_Valid: uint8
  LAP_Path_Pred_Half_Width: single
  LAP_Path_Pred_Conf: single
  LAP_Is_Triggered_SDM_Model: uint8
  Reserved_2: uint8
  LAP_Path_Pred_First_VR_End: single
  LAP_Path_Pred_second_VR_End: single
  Reserved_3: uint8
  LAP_Path_Pred_First_C0: single
  LAP_Path_Pred_First_C1: single
  LAP_Path_Pred_First_C2: single
  LAP_Path_Pred_First_C3: single
  LAP_Path_Pred_Second_C0: single
  LAP_Path_Pred_Second_C1: single
  LAP_Path_Pred_Second_C2: single
  LAP_Path_Pred_Second_C3: single

SPI_EQ4_LA_BUS = Simulink.Bus(DataScope="Imported", HeaderFile="mcuEQ4.h")
  EQ4_APPINFO: Bus: SPI_EQ4_APPINFO_BUS
  EQ4_LA_HDR: Bus: SPI_EQ4_LA_HDR_BUS
  EQ4_LA_ELEM: Bus: SPI_EQ4_LA_ELEM_BUS[4]

SPI_EQ4_LA_ELEM_BUS = Simulink.Bus(DataScope="Imported", HeaderFile="mcuEQ4.h")
  LA_Lane_Track_ID: uint8
  LA_Age: uint8
  LA_Confidence: single
  LA_Color: uint8
  LA_Color_Conf: single
  LA_Prediction_Reason: uint8
  LA_Availability_State: uint8
  LA_View_Range_Start: single
  Reserved_2: uint8
  LA_View_Range_End: single
  LA_Measured_VR_End: single
  Reserved_3: uint8
  LA_Lanemark_Type: uint8
  LA_DLM_Type: uint8
  LA_Lanemark_Type_Conf: single
  LA_Line_Side: uint8
  LA_Marker_Width: single
  Reserved_4: uint8
  LA_Marker_Width_STD: single
  Reserved_5: uint8
  LA_Line_C3: single
  LA_Line_C2: single
  LA_Line_C1: single
  LA_Line_C0: single
  LH_Buffer_C1: uint8
  Reserved_6: uint8

SPI_EQ4_LA_HDR_BUS = Simulink.Bus(DataScope="Imported", HeaderFile="mcuEQ4.h")
  LA_Zero_byte: uint8
  LA_Protocol_Version: uint8
  LA_Sync_ID: uint8
  LA_Adjacent_Count: uint8
  Reserved_1: uint8
  Reserved_2: uint8
  Reserved_3: uint16

SPI_EQ4_LH_BUS = Simulink.Bus(DataScope="Imported", HeaderFile="mcuEQ4.h")
  EQ4_APPINFO: Bus: SPI_EQ4_APPINFO_BUS
  EQ4_LH_HDR: Bus: SPI_EQ4_LH_HDR_BUS
  EQ4_LH_ELEM: Bus: SPI_EQ4_LH_ELEM_BUS[2]

SPI_EQ4_LH_ELEM_BUS = Simulink.Bus(DataScope="Imported", HeaderFile="mcuEQ4.h")
  LH_CRC: uint32
  LH_Is_Triggered_SDM_Type: uint8
  LH_Is_Triggered_SDM_Model: uint8
  LH_Track_ID: uint8
  LH_Age: uint8
  LH_Confidence: single
  Reserved_3: uint8
  LH_Prediction_Reason: uint8
  LH_Availability_State: uint8
  LH_Color: uint8
  LH_Color_Confidence: single
  LH_Lanemark_Type: uint8
  LH_DLM_Type: uint8
  LH_DECEL_Type: uint8
  Reserved_4: uint8
  LH_Lanemark_Type_Conf: single
  LH_Side: uint8
  LH_Crossing: uint8
  LH_Marker_Width: single
  LH_Marker_Width_STD: single
  Reserved_5: uint8
  LH_Dash_Average_Length: single
  LH_Dash_Average_Gap: single
  LH_Is_Multi_Clothoid: uint8
  Reserved_6: uint8
  LH_Line_First_C0: single
  LH_Line_First_C1: single
  LH_Line_First_C2: single
  LH_Line_First_C3: single
  LH_First_VR_Start: single
  LH_First_VR_End: single
  Reserved_7: uint8
  LH_First_Measured_VR_End: single
  LH_Second_Measured_VR_End: single
  Reserved_8: uint8
  LH_Line_Second_C0: single
  LH_Line_Second_C1: single
  LH_Line_Second_C2: single
  LH_Line_Second_C3: single
  LH_Second_VR_Start: single
  LH_Second_VR_End: single
  LH_Buffer_C3: uint8

SPI_EQ4_LH_HDR_BUS = Simulink.Bus(DataScope="Imported", HeaderFile="mcuEQ4.h")
  LH_Zero_byte: uint8
  LH_Protocol_Version: uint8
  LH_Sync_ID: uint8
  LH_Lanes_Count: uint8
  Reserved_1: uint8
  LH_Estimated_Width: single
  Reserved_2: uint8

SPI_EQ4_LRE_BUS = Simulink.Bus(DataScope="Imported", HeaderFile="mcuEQ4.h")
  EQ4_APPINFO: Bus: SPI_EQ4_APPINFO_BUS
  EQ4_LRE_HDR: Bus: SPI_EQ4_LRE_HDR_BUS
  EQ4_LRE_ELEM: Bus: SPI_EQ4_LRE_ELEM_BUS[2]

SPI_EQ4_LRE_ELEM_BUS = Simulink.Bus(DataScope="Imported", HeaderFile="mcuEQ4.h")
  LRE_ID: uint8
  LRE_Age: uint8
  LRE_Confidence: single
  LRE_Type: uint8
  Reserved_2: uint8
  LRE_Prediction_Reason: uint8
  LRE_Availability_State: uint8
  LRE_Height: single
  LRE_Height_STD: single
  Reserved_3: uint8
  LRE_View_Range_Start: single
  LRE_View_Range_End: single
  Reserved_4: uint8
  LRE_Measured_VR_End: single
  LRE_Side: uint8
  LRE_Is_Triggered_SDM_Model: uint8
  Reserved_5: uint8
  LRE_Line_C3: single
  LRE_Line_C2: single
  LRE_Line_C1: single
  LRE_Line_C0: single
  LRE_Detection_Source: uint8
  Reserved_6: uint8

SPI_EQ4_LRE_HDR_BUS = Simulink.Bus(DataScope="Imported", HeaderFile="mcuEQ4.h")
  LRE_Zero_byte: uint8
  Reserved_1: uint8
  LRE_CRC: uint32
  LRE_Protocol_Version: uint8
  LRE_Sync_ID: uint8
  LRE_Count: uint8
  LRE_Header_Buffer: uint8
  Reserved_2: uint16

SPI_EQ4_OBJ_BUS = Simulink.Bus(DataScope="Imported", HeaderFile="mcuEQ4.h")
  EQ4_APPINFO: Bus: SPI_EQ4_APPINFO_BUS
  EQ4_OBJ_HDR: Bus: SPI_EQ4_OBJ_HDR_BUS
  EQ4_OBJ_ELEM: Bus: SPI_EQ4_OBJ_ELEM_BUS[20]

SPI_EQ4_OBJ_ELEM_BUS = Simulink.Bus(DataScope="Imported", HeaderFile="mcuEQ4.h")
  OBJ_CRC: uint32
  OBJ_ID: uint8
  OBJ_Existence_Probability: single
  OBJ_Fusion_Source: uint16
  OBJ_Triggered_SDM: uint8
  OBJ_Motion_Category: uint8
  OBJ_Buffer_C0: single
  OBJ_Object_Age: uint16
  OBJ_Measuring_Status: uint8
  OBJ_Object_Class: uint8
  Reserved_4: uint8
  OBJ_Class_Probability: single
  OBJ_Buffer_C1: single
  OBJ_Buffer_C2: single
  OBJ_Buffer_C3: single
  OBJ_Camera_Source: uint8
  OBJ_Motion_Status: uint8
  OBJ_Motion_Orientation: uint8
  OBJ_Has_Cut_Lane: uint8
  OBJ_Has_Cut_Path: uint8
  OBJ_Brake_Light: uint8
  OBJ_Turn_Indicator_Right: uint8
  OBJ_Turn_Indicator_Left: uint8
  OBJ_Light_Indicator_Validity: uint8
  OBJ_Right_Out_Of_Image: uint8
  OBJ_Left_Out_Of_Image: uint8
  OBJ_Right_Out_Of_Image_V: uint8
  OBJ_Left_Out_Of_Image_V: uint8
  OBJ_Top_Out_Of_Image: uint8
  OBJ_Bottom_Out_Of_Image: uint8
  OBJ_Top_Out_Of_Image_V: uint8
  OBJ_Bottom_Out_Of_Image_V: uint8
  OBJ_Lane_Assignment: uint8
  OBJ_Lane_Assignment_V: uint8
  OBJ_Age_Seconds: uint8
  OBJ_Age_Seconds_V: uint8
  OBJ_Width: single
  OBJ_Width_V: uint8
  OBJ_Width_STD: single
  OBJ_Width_STD_V: uint8
  OBJ_Length: single
  OBJ_Length_V: uint8
  OBJ_Length_STD: single
  OBJ_Length_STD_V: uint8
  OBJ_Radar_ID: uint8
  OBJ_Height: single
  OBJ_Height_V: uint8
  Reserved_5: uint8
  OBJ_Height_STD: single
  OBJ_Height_STD_V: uint8
  OBJ_Abs_Long_Velocity: single
  OBJ_Abs_Long_Velocity_V: uint8
  Reserved_6: uint8
  OBJ_Abs_Long_Velocity_STD: single
  OBJ_Abs_Long_Vel_STD_V: uint8
  OBJ_Abs_Lat_Velocity: single
  OBJ_Abs_Lat_Velocity_V: uint8
  Reserved_7: uint8
  OBJ_Abs_Lat_Velocity_STD: single
  OBJ_Abs_Lat_Vel_STD_V: uint8
  OBJ_Abs_Long_Acc: single
  OBJ_Abs_Long_Acc_V: uint8
  Reserved_8: uint8
  OBJ_Abs_Long_Acc_STD: single
  OBJ_Abs_Long_Acc_STD_V: uint8
  OBJ_Abs_Lat_Acc: single
  OBJ_Abs_Lat_Acc_V: uint8
  OBJ_Abs_Lat_Acc_STD: single
  OBJ_Abs_Lat_Acc_STD_V: uint8
  OBJ_Abs_Acceleration: single
  OBJ_Abs_Acceleration_V: uint8
  OBJ_Abs_Acc_STD: single
  OBJ_Abs_Acc_STD_V: uint8
  OBJ_Inv_TTC: single
  OBJ_Inv_TTC_V: uint8
  OBJ_Inv_TTC_STD: single
  OBJ_Inv_TTC_STD_V: uint8
  OBJ_Relative_Long_Acc: single
  OBJ_Relative_Long_Acc_V: uint8
  Reserved_9: uint8
  OBJ_Relative_Long_Acc_STD: single
  OBJ_Rel_Long_Acc_STD_V: uint8
  OBJ_Relative_Long_Velocity: single
  OBJ_Relative_Long_Velocity_V: uint8
  Reserved_10: uint8
  OBJ_Relative_Long_Vel_STD: single
  OBJ_Rel_Long_Vel_STD_V: uint8
  OBJ_Relative_Lat_Velocity: single
  OBJ_Relative_Lat_Velocity_V: uint8
  Reserved_11: uint8
  OBJ_Relative_Lat_Velocity_STD: single
  OBJ_Rel_Lat_Vel_STD_V: uint8
  OBJ_Long_Distance: single
  OBJ_Long_Distance_V: uint8
  Reserved_12: uint8
  OBJ_Long_Distance_STD: single
  OBJ_Long_Distance_STD_V: uint8
  OBJ_Lat_Distance: single
  OBJ_Lat_Distance_V: uint8
  Reserved_13: uint8
  OBJ_Lat_Distance_STD: single
  OBJ_Lat_Distance_STD_V: uint8
  OBJ_Absolute_Speed: single
  OBJ_Absolute_Speed_V: uint8
  Reserved_14: uint8
  OBJ_Absolute_Speed_STD: single
  OBJ_Absolute_Speed_STD_V: uint8
  OBJ_Heading: single
  OBJ_Heading_V: uint8
  Reserved_15: uint8
  OBJ_Heading_STD: single
  OBJ_Heading_STD_V: uint8
  OBJ_Angle_Rate_STD: single
  OBJ_Angle_Rate_STD_V: uint8
  OBJ_Angle_Rate: single
  OBJ_Angle_Rate_V: uint8
  OBJ_Angle_Right: single
  OBJ_Angle_Right_V: uint8
  Reserved_16: uint8
  OBJ_Angle_Right_STD: single
  OBJ_Angle_Right_STD_V: uint8
  OBJ_Angle_Left: single
  OBJ_Angle_Left_V: uint8
  Reserved_17: uint8
  OBJ_Angle_Left_STD: single
  OBJ_Angle_Left_STD_V: uint8
  OBJ_Angle_Side: single
  OBJ_Angle_Side_V: uint8
  Reserved_18: uint8
  OBJ_Angle_Side_STD: single
  OBJ_Angle_Side_STD_V: uint8
  OBJ_Angle_Mid_V: uint8
  OBJ_Angle_Mid: single
  Reserved_19: uint8
  OBJ_Angle_Mid_STD: single
  OBJ_Angle_Mid_STD_V: uint8
  OBJ_Angle_Bottom_V: uint8
  OBJ_Angle_Bottom: single
  Reserved_20: uint8
  OBJ_Angle_Bottom_STD: single
  OBJ_Angle_Bottom_STD_V: uint8
  OBJ_Visibility_Side_V: uint8
  OBJ_Visibility_Side: uint8
  OBJ_Is_In_Drivable_Area: uint8
  OBJ_Is_In_Drivable_Area_V: uint8
  OBJ_Is_VeryClose_V: uint8
  OBJ_Is_VeryClose: uint8
  OBJ_Buffer_C4: uint8
  OBJ_Buffer_C5: uint8
  OBJ_Buffer_C6: uint8
  OBJ_Buffer_C7: uint8
  Reserved_21: uint8
  OBJ_Buffer_C8: single
  OBJ_Buffer_C9: single
  OBJ_Is_EMERGENCY_VCL: uint8
  OBJ_EMERGENCY_LIGHT_COLOR: uint8
  OBJ_EMERGENCY_V: uint8
  Reserved_22: uint8

SPI_EQ4_OBJ_HDR_BUS = Simulink.Bus(DataScope="Imported", HeaderFile="mcuEQ4.h")
  OBJ_Zero_byte: uint8
  Reserved_1: uint8
  OBJ_Header_CRC: uint32
  OBJ_Protocol_Version: uint8
  OBJ_Sync_ID: uint8
  OBJ_VRU_Count: uint8
  OBJ_VD_Count: uint8
  OBJ_General_OBJ_Count: uint8
  Reserved_2: uint8
  OBJ_Animal_Count: uint8
  OBJ_VD_NIV_Left: uint8
  OBJ_VD_NIV_Right: uint8
  OBJ_VD_CIPV_ID: uint8
  OBJ_VD_CIPV_Lost: uint8
  OBJ_VD_Allow_Acc: uint8
  OBJ_Is_Blocked_Left: uint8
  OBJ_Is_Blocked_Right: uint8
  Reserved_3: uint8
  Reserved_4: uint16

SPI_EQ4_SD_BUS = Simulink.Bus(DataScope="Imported", HeaderFile="mcuEQ4.h")
  EQ4_APPINFO: Bus: SPI_EQ4_APPINFO_BUS
  EQ4_SD_HDR: Bus: SPI_EQ4_SD_HDR_BUS
  EQ4_SD_ELEM: Bus: SPI_EQ4_SD_ELEM_BUS[64]

SPI_EQ4_SD_ELEM_BUS = Simulink.Bus(DataScope="Imported", HeaderFile="mcuEQ4.h")
  SD_Bit: uint8

SPI_EQ4_SD_HDR_BUS = Simulink.Bus(DataScope="Imported", HeaderFile="mcuEQ4.h")
  SD_Zero_byte: uint8
  Reserved_1: uint8
  SD_CRC: uint32
  SD_Protocol_Version: uint8
  SD_Sync_ID: uint8
  SD_Challenge_Response1: uint8
  SD_Challenge_Response2: uint8
  SD_Challenge_Response3: uint8
  SD_Challenge_Response4: uint8
  SD_Challenge_Identifier: uint8
  Reserved_2: uint8
  Reserved_3: uint16

SPI_EQ4_TFL_SPOTS_BUS = Simulink.Bus(DataScope="Imported", HeaderFile="mcuEQ4.h")
  EQ4_APPINFO: Bus: SPI_EQ4_APPINFO_BUS
  EQ4_TFL_SPOTS_HDR: Bus: SPI_EQ4_TFL_SPOTS_HDR_BUS
  EQ4_TFL_SPOTS_ELEM: Bus: SPI_EQ4_TFL_SPOTS_ELEM_BUS[50]

SPI_EQ4_TFL_SPOTS_ELEM_BUS = Simulink.Bus(DataScope="Imported", HeaderFile="mcuEQ4.h")
  TFL_Spot_Spot_ID: uint8
  TFL_Spot_Structure_ID: uint8
  TFL_Spot_Color: uint8
  TFL_Spot_Red_Probability: single
  TFL_Spot_Orange_Probability: single
  TFL_Spot_Green_Probability: single
  TFL_Spot_Mode: uint8
  TFL_Spot_Shape: uint8
  TFL_Spot_Shape_Probability: single
  TFL_Spot_Relevancy: single
  TFL_Spot_Buffer_C0: uint8
  Reserved_2: uint8
  TFL_Spot_Buffer_C1: single
  TFL_Spot_Buffer_C2: uint8
  Reserved_3: uint8
  Reserved_4: uint16

SPI_EQ4_TFL_SPOTS_HDR_BUS = Simulink.Bus(DataScope="Imported", HeaderFile="mcuEQ4.h")
  TFL_Spot_Zero_byte: uint8
  TFL_Spot_Protocol_Version: uint8
  TFL_Spot_Sync_ID: uint8
  TFL_Spot_Number_Of_Objects: uint8
  Reserved_1: uint8
  Reserved_2: uint8
  Reserved_3: uint16

SPI_EQ4_TFL_STRUCT_BUS = Simulink.Bus(DataScope="Imported", HeaderFile="mcuEQ4.h")
  EQ4_APPINFO: Bus: SPI_EQ4_APPINFO_BUS
  EQ4_TFL_STRUCT_HDR: Bus: SPI_EQ4_TFL_STRUCT_HDR_BUS
  EQ4_TFL_STRUCT_ELEM: Bus: SPI_EQ4_TFL_STRUCT_ELEM_BUS[20]

SPI_EQ4_TFL_STRUCT_ELEM_BUS = Simulink.Bus(DataScope="Imported", HeaderFile="mcuEQ4.h")
  TFL_Struct_ID: uint8
  TFL_Struct_Age: uint8
  TFL_Struct_State: uint8
  TFL_Struct_State_Age: uint8
  TFL_Struct_State_Confidence: uint8
  TFL_Struct_Relevancy_Score: single
  TFL_Struct_Detection_Camera: uint8
  TFL_Struct_Type: uint16
  Reserved_2: uint8
  TFL_Struct_Type_Conf: single
  TFL_Struct_Lat_Distance: single
  TFL_Struct_Lat_Distance_STD: single
  Reserved_3: uint8
  TFL_Struct_Rel_Height: single
  TFL_Struct_Rel_Height_STD: single
  TFL_Struct_Long_Distance: single
  Reserved_4: uint8
  TFL_Struct_Long_Distance_STD: single
  TFL_Struct_Buffer_C0: single
  Reserved_5: uint8
  TFL_Struct_Buffer_C1: single
  TFL_Struct_Image_Status: uint8
  TFL_Struct_Buffer_C2: uint8
  TFL_Struct_Buffer_C3: single
  TFL_Struct_Buffer_C4: single
  Reserved_6: uint8
  TFL_Struct_Buffer_C5: single
  TFL_Struct_Buffer_C6: single
  TFL_Struct_Buffer_C7: single
  TFL_Struct_Buffer_C8: uint8
  Reserved_7: uint8

SPI_EQ4_TFL_STRUCT_HDR_BUS = Simulink.Bus(DataScope="Imported", HeaderFile="mcuEQ4.h")
  TFL_Struct_Zero_byte: uint8
  TFL_Struct_Protocol_Version: uint8
  TFL_Struct_Sync_ID: uint8
  TFL_Struct_Count: uint8
  TFL_Struct_Buffer_C9: uint8
  Reserved_1: uint8
  Reserved_2: uint16

SPI_EQ4_TSR_BUS = Simulink.Bus(DataScope="Imported", HeaderFile="mcuEQ4.h")
  EQ4_APPINFO: Bus: SPI_EQ4_APPINFO_BUS
  EQ4_TSR_HDR: Bus: SPI_EQ4_TSR_HDR_BUS
  EQ4_TSR_ELEM: Bus: SPI_EQ4_TSR_ELEM_BUS[10]

SPI_EQ4_TSR_ELEM_BUS = Simulink.Bus(DataScope="Imported", HeaderFile="mcuEQ4.h")
  TSR_ID: uint8
  TSR_Camera_Source: uint8
  TSR_Sign_Name: uint16
  TSR_Relevancy: uint8
  Reserved_2: uint8
  TSR_Filter_Type: uint8
  TSR_Sup1_SignName: uint8
  TSR_Sup1_Confidence: single
  TSR_Sup1_Position: uint8
  TSR_Sup2_SignName: uint8
  Reserved_3: uint8
  TSR_Sup2_Confidence: single
  TSR_Sup2_Position: uint8
  TSR_Confidence: single
  TSR_Sign_Shape: uint8
  TSR_Sign_Structure: uint8
  Reserved_4: uint8
  TSR_Tracking_Age: uint16
  TSR_Sign_Long_Distance: single
  Reserved_5: uint8
  TSR_Sign_Long_Distance_STD: single
  TSR_Sign_Lateral_Distance: single
  Reserved_6: uint8
  TSR_Sign_Lat_Distance_STD: single
  TSR_Sign_Height: single
  Reserved_7: uint8
  TSR_Sign_Panel_Height_STD: single
  TSR_Sign_Height_STD: single
  Reserved_8: uint8
  TSR_Sign_Panel_Width: single
  TSR_Sign_Panel_Height: single
  TSR_Sign_Panel_Width_STD: single
  Reserved_9: uint8
  TSR_Measurement_Status: uint8
  TSR_AngleZ: single
  TSR_Relevancy_Confidence: single
  Reserved_10: uint8

SPI_EQ4_TSR_HDR_BUS = Simulink.Bus(DataScope="Imported", HeaderFile="mcuEQ4.h")
  TSR_Zero_byte: uint8
  TSR_Protocol_Version: uint8
  TSR_Sync_ID: uint8
  TSR_Approved_Sign_Count: uint8
  TSR_Filtered_Sign_Count: uint8
  TSR_UnderTracking_Sign_Count: uint8
  Reserved_1: uint8

struct_UDP_HEADER = Simulink.Bus(DataScope="Imported", HeaderFile="mcuEQ4.h")
  frame_counter: uint32
  total_pack_count: uint16
  pack_counter: uint16
  data_id: uint16
  reserved: uint16

mcuEQ4_LAP = Simulink.Signal(StorageClass="ExportedGlobal")
mcuEQ4_LA = Simulink.Signal(StorageClass="ExportedGlobal")
mcuEQ4_LH = Simulink.Signal(StorageClass="ExportedGlobal")
mcuEQ4_LRE = Simulink.Signal(StorageClass="ExportedGlobal")