% Simulink data dictionary IfLibrarySL_Wrapper.sldd

CAN_FD_MESSAGE_BUS = Simulink.Bus(HeaderFile="Rte_Type.h")
  ProtocolMode: uint8
  Extended: uint8
  Length: uint8
  Remote: uint8
  Error: uint8
  BRS: uint8
  ESI: uint8
  DLC: uint8
  ID: uint32
  Reserved: uint32
  Timestamp: double
  Data: uint8[64]

CAN_MESSAGE_BUS = Simulink.Bus(HeaderFile="Rte_Type.h")
  Extended: uint8
  Length: uint8
  Remote: uint8
  Error: uint8
  ID: uint32
  Timestamp: double
  Data: uint8[8]

HM_CAN_MESSAGE_BUS = Simulink.Bus(HeaderFile="Rte_Type.h")
  Extended: uint8
  Length: uint8
  Remote: uint8
  Error: uint8
  ID: uint32
  Timestamp: double
  Data: uint8[8]

HM_CAN_FD_MESSAGE_BUS = Simulink.Bus(HeaderFile="Rte_Type.h")
  ProtocolMode: uint8
  Extended: uint8
  Length: uint8
  Remote: uint8
  Error: uint8
  BRS: uint8
  ESI: uint8
  DLC: uint8
  ID: uint32
  Reserved: uint32
  Timestamp: double
  Data: uint8[64]