% Simulink data dictionary PubIfBswStbM.sldd

Std_ReturnType = Simulink.AliasType(BaseType="uint8", HeaderFile="Rte_Type.h")
StbM_TimeBaseStatusType = Simulink.AliasType(BaseType="uint8", HeaderFile="Rte_Type.h")
P_Std_ReturnType = Simulink.Parameter(0, DataType="Std_ReturnType")
P_StbM_UserDataType = Simulink.Parameter(struct(userDataLength=uint8(0), userByte0=uint8(0), userByte1=uint8(0), userByte2=uint8(0)), DataType="Bus: StbM_UserDataType")
P_StbM_TimeStampExtendedType = Simulink.Parameter(struct(timeBaseStatus=uint8(0), nanoseconds=uint32(0), seconds=fi(0, 0, 64, 0)), DataType="Bus: StbM_TimeStampExtendedType")

StbM_UserDataType = Simulink.Bus(HeaderFile="Rte_Type.h")
  userDataLength: uint8
  userByte0: uint8
  userByte1: uint8
  userByte2: uint8

StbM_TimeStampType = Simulink.Bus(HeaderFile="Rte_Type.h")
  timeBaseStatus: StbM_TimeBaseStatusType
  nanoseconds: uint32
  seconds: uint32
  secondsHi: uint16

StbM_TimeStampExtendedType = Simulink.Bus(HeaderFile="Rte_Type.h")
  timeBaseStatus: StbM_TimeBaseStatusType
  nanoseconds: uint32
  seconds: uint64

Dem_UdsStatusByteType = Simulink.AliasType(BaseType="uint8", HeaderFile="Rte_Type.h")
Dem_DTCFormatType = Simulink.AliasType(BaseType="uint8", HeaderFile="Rte_Type.h")
Dem_DebouncingStateType = Simulink.AliasType(BaseType="uint8", HeaderFile="Rte_Type.h")
Dem_MaxDataValueType = Simulink.AliasType(BaseType="uint8", HeaderFile="Rte_Type.h")
P_Dem_UdsStatusByteType = Simulink.Parameter(0, DataType="Dem_UdsStatusByteType")
P_Dem_DTCFormatType = Simulink.Parameter(0, DataType="Dem_DTCFormatType")
P_Dem_DebouncingStateType = Simulink.Parameter(0, DataType="Dem_DebouncingStateType")
P_Dem_MaxDataValueType = Simulink.Parameter([0 0 0 0], DataType="Dem_MaxDataValueType")
Dem_EventIdType = Simulink.AliasType(BaseType="uint16", HeaderFile="Rte_Type.h")
P_Dem_EventIdType = Simulink.Parameter(0, DataType="Dem_EventIdType")