% Simulink data dictionary PubIfCanfdRSDS_V06_RTE.sldd

RSDS_L_AD1_MSG_BUS = Simulink.Bus(HeaderFile="Rte_Type.h")
  Checksum1: uint8
  RSDS_L_ObjID_1: uint8
  RSDS_L_ObjExistProb_1: single
  RSDS_L_ObjObstacleProb_1: single
  RSDS_L_ObjDistX_1: single
  RSDS_L_ObjDistY_1: single
  RollingCounter1: uint8
  RSDS_L_ObjRelAccelX_1: single
  Checksum2: uint8
  RSDS_L_ObjRelVelX_1: single
  RSDS_L_ObjDistXStd_1: single
  RSDS_L_ObjRelVelY_1: single
  RSDS_L_ObjDistYStd_1: single
  RSDS_L_ObjRelVelXStd_1: single
  RollingCounter2: uint8
  RSDS_L_ObjRelVelYStd_1: single
  Checksum3: uint8
  RSDS_L_ObjRAccelXStd_1: single
  RSDS_L_ObjRelAccelY_1: single
  RSDS_L_ObjRAccelYStd_1: single
  RSDS_L_VFC_ObjWidth_1: single
  RSDS_L_BLIND: uint8
  RSDS_L_hdr_ErrorStatus: uint8
  RSDS_L_VFC_ObjLength_1: single
  RollingCounter3: uint8
  Checksum4: uint8
  RSDS_L_hdr_TimeStamp: single
  BlockCounter1: uint8
  RSDS_L_hdr_TimerStempStatus: uint8
  RollingCounter4: uint8
  RSDS_L_hdr_AutoSarTimeStamp: uint32
  Checksum5: uint8
  RSDS_L_ObjID_2: uint8
  RSDS_L_ObjExistProb_2: single
  RSDS_L_ObjObstacleProb_2: single
  RSDS_L_ObjDistX_2: single
  RSDS_L_ObjDistY_2: single
  RollingCounter5: uint8
  RSDS_L_ObjRelAccelX_2: single
  Checksum6: uint8
  RSDS_L_ObjRelVelX_2: single
  RSDS_L_ObjDistXStd_2: single
  RSDS_L_ObjRelVelY_2: single
  RSDS_L_ObjDistYStd_2: single
  RSDS_L_ObjRelVelXStd_2: single
  RollingCounter6: uint8
  RSDS_L_ObjRelVelYStd_2: single
  Checksum7: uint8
  RSDS_L_ObjRAccelXStd_2: single
  RSDS_L_ObjRelAccelY_2: single
  RSDS_L_ObjRAccelYStd_2: single
  RSDS_L_VFC_ObjWidth_2: single
  RSDS_L_ObjMeasured_1: uint8
  RSDS_L_ObjMeasured_2: uint8
  RSDS_L_VFC_ObjLength_2: single
  RollingCounter7: uint8

RSDS_L_AD1_RAW_BUS = Simulink.Bus(HeaderFile="Rte_Type.h")
  Checksum1: uint8  % 1|0|0|255|uint8
  RSDS_L_ObjID_1: uint8  % 1|0|0|255|uint8
  RSDS_L_ObjExistProb_1: uint8  % 0.032258|0|0|1|single
  RSDS_L_ObjObstacleProb_1: uint8  % 0.032258|0|0|1|single
  RSDS_L_ObjDistX_1: uint16  % 0.0625|-128|-128|126.9375|single
  RSDS_L_ObjDistY_1: uint16  % 0.125|-128|-128|127.875|single
  RollingCounter1: uint8  % 1|0|0|15|uint8
  RSDS_L_ObjRelAccelX_1: uint16  % 0.03125|-16|-16|15.9688|single
  Checksum2: uint8  % 1|0|0|255|uint8
  RSDS_L_ObjRelVelX_1: uint16  % 0.0312|-128|-128|126.9976|single
  RSDS_L_ObjDistXStd_1: uint8  % 0.1|0|0|6|single
  RSDS_L_ObjRelVelY_1: uint16  % 0.0312|-128|-128|126.9976|single
  RSDS_L_ObjDistYStd_1: uint8  % 0.1|0|0|6|single
  RSDS_L_ObjRelVelXStd_1: uint8  % 0.0625|0|0|3.9375|single
  RollingCounter2: uint8  % 1|0|0|15|uint8
  RSDS_L_ObjRelVelYStd_1: uint8  % 0.0625|0|0|3.9375|single
  Checksum3: uint8  % 1|0|0|255|uint8
  RSDS_L_ObjRAccelXStd_1: uint8  % 0.0625|0|0|3.9375|single
  RSDS_L_ObjRelAccelY_1: uint16  % 0.03125|-16|-16|15.9688|single
  RSDS_L_ObjRAccelYStd_1: uint8  % 0.0625|0|0|3.9375|single
  RSDS_L_VFC_ObjWidth_1: uint16  % 0.01|0|0|5|single
  RSDS_L_BLIND: uint8  % 1|0|0|3|uint8
  RSDS_L_hdr_ErrorStatus: uint8  % 1|0|0|15|uint8
  RSDS_L_VFC_ObjLength_1: uint16  % 0.05|0|0|20|single
  RollingCounter3: uint8  % 1|0|0|15|uint8
  Checksum4: uint8  % 1|0|0|255|uint8
  RSDS_L_hdr_TimeStamp: uint32  % 0.00097|0|0|65536|single
  BlockCounter1: uint8  % 1|0|0|15|uint8
  RSDS_L_hdr_TimerStempStatus: uint8  % 1|0|0|255|uint8
  RollingCounter4: uint8  % 1|0|0|15|uint8
  RSDS_L_hdr_AutoSarTimeStamp: uint32  % 1|0|0|67108863|uint32
  Checksum5: uint8  % 1|0|0|255|uint8
  RSDS_L_ObjID_2: uint8  % 1|0|0|255|uint8
  RSDS_L_ObjExistProb_2: uint8  % 0.032258|0|0|1|single
  RSDS_L_ObjObstacleProb_2: uint8  % 0.032258|0|0|1|single
  RSDS_L_ObjDistX_2: uint16  % 0.0625|-128|-128|126.9375|single
  RSDS_L_ObjDistY_2: uint16  % 0.125|-128|-128|127.875|single
  RollingCounter5: uint8  % 1|0|0|15|uint8
  RSDS_L_ObjRelAccelX_2: uint16  % 0.03125|-16|-16|15.9688|single
  Checksum6: uint8  % 1|0|0|255|uint8
  RSDS_L_ObjRelVelX_2: uint16  % 0.0312|-128|-128|126.9976|single
  RSDS_L_ObjDistXStd_2: uint8  % 0.1|0|0|6|single
  RSDS_L_ObjRelVelY_2: uint16  % 0.0312|-128|-128|126.9976|single
  RSDS_L_ObjDistYStd_2: uint8  % 0.1|0|0|6|single
  RSDS_L_ObjRelVelXStd_2: uint8  % 0.0625|0|0|3.9375|single
  RollingCounter6: uint8  % 1|0|0|15|uint8
  RSDS_L_ObjRelVelYStd_2: uint8  % 0.0625|0|0|3.9375|single
  Checksum7: uint8  % 1|0|0|255|uint8
  RSDS_L_ObjRAccelXStd_2: uint8  % 0.0625|0|0|3.9375|single
  RSDS_L_ObjRelAccelY_2: uint16  % 0.03125|-16|-16|15.9688|single
  RSDS_L_ObjRAccelYStd_2: uint8  % 0.0625|0|0|3.9375|single
  RSDS_L_VFC_ObjWidth_2: uint16  % 0.01|0|0|5|single
  RSDS_L_ObjMeasured_1: uint8  % 1|0|0|3|uint8
  RSDS_L_ObjMeasured_2: uint8  % 1|0|0|3|uint8
  RSDS_L_VFC_ObjLength_2: uint16  % 0.05|0|0|20|single
  RollingCounter7: uint8  % 1|0|0|15|uint8

RSDS_L_AD2_MSG_BUS = Simulink.Bus(HeaderFile="Rte_Type.h")
  Checksum8: uint8
  RSDS_L_ObjID_3: uint8
  RSDS_L_ObjExistProb_3: single
  RSDS_L_ObjObstacleProb_3: single
  RSDS_L_ObjDistX_3: single
  RSDS_L_ObjDistY_3: single
  RollingCounter8: uint8
  RSDS_L_ObjRelAccelX_3: single
  Checksum9: uint8
  RSDS_L_ObjRelVelX_3: single
  RSDS_L_ObjDistXStd_3: single
  RSDS_L_ObjRelVelY_3: single
  RSDS_L_ObjDistYStd_3: single
  RSDS_L_ObjRelVelXStd_3: single
  RollingCounter9: uint8
  RSDS_L_ObjRelVelYStd_3: single
  Checksum10: uint8
  RSDS_L_ObjRAccelXStd_3: single
  RSDS_L_ObjRelAccelY_3: single
  RSDS_L_ObjRAccelYStd_3: single
  RSDS_L_VFC_ObjWidth_3: single
  RSDS_L_VFC_ObjLength_3: single
  RollingCounter10: uint8
  Checksum11: uint8
  BlockCounter2: uint8
  Rollingcounter11: uint8
  Checksum12: uint8
  RSDS_L_ObjID_4: uint8
  RSDS_L_ObjExistProb_4: single
  RSDS_L_ObjObstacleProb_4: single
  RSDS_L_ObjDistX_4: single
  RSDS_L_ObjDistY_4: single
  RollingCounter12: uint8
  RSDS_L_ObjRelAccelX_4: single
  Checksum13: uint8
  RSDS_L_ObjRelVelX_4: single
  RSDS_L_ObjDistXStd_4: single
  RSDS_L_ObjRelVelY_4: single
  RSDS_L_ObjDistYStd_4: single
  RSDS_L_ObjRelVelXStd_4: single
  RollingCounter13: uint8
  RSDS_L_ObjRelVelYStd_4: single
  Checksum14: uint8
  RSDS_L_ObjRAccelXStd_4: single
  RSDS_L_ObjRelAccelY_4: single
  RSDS_L_ObjRAccelYStd_4: single
  RSDS_L_VFC_ObjWidth_4: single
  RSDS_L_ObjMeasured_3: uint8
  RSDS_L_ObjMeasured_4: uint8
  RSDS_L_VFC_ObjLength_4: single
  RollingCounter14: uint8

RSDS_L_AD2_RAW_BUS = Simulink.Bus(HeaderFile="Rte_Type.h")
  Checksum8: uint8  % 1|0|0|255|uint8
  RSDS_L_ObjID_3: uint8  % 1|0|0|255|uint8
  RSDS_L_ObjExistProb_3: uint8  % 0.032258|0|0|1|single
  RSDS_L_ObjObstacleProb_3: uint8  % 0.032258|0|0|1|single
  RSDS_L_ObjDistX_3: uint16  % 0.0625|-128|-128|126.9375|single
  RSDS_L_ObjDistY_3: uint16  % 0.125|-128|-128|127.875|single
  RollingCounter8: uint8  % 1|0|0|15|uint8
  RSDS_L_ObjRelAccelX_3: uint16  % 0.03125|-16|-16|15.9688|single
  Checksum9: uint8  % 1|0|0|255|uint8
  RSDS_L_ObjRelVelX_3: uint16  % 0.0312|-128|-128|126.9976|single
  RSDS_L_ObjDistXStd_3: uint8  % 0.1|0|0|6|single
  RSDS_L_ObjRelVelY_3: uint16  % 0.0312|-128|-128|126.9976|single
  RSDS_L_ObjDistYStd_3: uint8  % 0.1|0|0|6|single
  RSDS_L_ObjRelVelXStd_3: uint8  % 0.0625|0|0|3.9375|single
  RollingCounter9: uint8  % 1|0|0|15|uint8
  RSDS_L_ObjRelVelYStd_3: uint8  % 0.0625|0|0|3.9375|single
  Checksum10: uint8  % 1|0|0|255|uint8
  RSDS_L_ObjRAccelXStd_3: uint8  % 0.0625|0|0|3.9375|single
  RSDS_L_ObjRelAccelY_3: uint16  % 0.03125|-16|-16|15.9688|single
  RSDS_L_ObjRAccelYStd_3: uint8  % 0.0625|0|0|3.9375|single
  RSDS_L_VFC_ObjWidth_3: uint16  % 0.01|0|0|5|single
  RSDS_L_VFC_ObjLength_3: uint16  % 0.05|0|0|20|single
  RollingCounter10: uint8  % 1|0|0|15|uint8
  Checksum11: uint8  % 1|0|0|255|uint8
  BlockCounter2: uint8  % 1|0|0|15|uint8
  Rollingcounter11: uint8  % 1|0|0|15|uint8
  Checksum12: uint8  % 1|0|0|255|uint8
  RSDS_L_ObjID_4: uint8  % 1|0|0|255|uint8
  RSDS_L_ObjExistProb_4: uint8  % 0.032258|0|0|1|single
  RSDS_L_ObjObstacleProb_4: uint8  % 0.032258|0|0|1|single
  RSDS_L_ObjDistX_4: uint16  % 0.0625|-128|-128|126.9375|single
  RSDS_L_ObjDistY_4: uint16  % 0.125|-128|-128|127.875|single
  RollingCounter12: uint8  % 1|0|0|15|uint8
  RSDS_L_ObjRelAccelX_4: uint16  % 0.03125|-16|-16|15.9688|single
  Checksum13: uint8  % 1|0|0|255|uint8
  RSDS_L_ObjRelVelX_4: uint16  % 0.0312|-128|-128|126.9976|single
  RSDS_L_ObjDistXStd_4: uint8  % 0.1|0|0|6|single
  RSDS_L_ObjRelVelY_4: uint16  % 0.0312|-128|-128|126.9976|single
  RSDS_L_ObjDistYStd_4: uint8  % 0.1|0|0|6|single
  RSDS_L_ObjRelVelXStd_4: uint8  % 0.0625|0|0|3.9375|single
  RollingCounter13: uint8  % 1|0|0|15|uint8
  RSDS_L_ObjRelVelYStd_4: uint8  % 0.0625|0|0|3.9375|single
  Checksum14: uint8  % 1|0|0|255|uint8
  RSDS_L_ObjRAccelXStd_4: uint8  % 0.0625|0|0|3.9375|single
  RSDS_L_ObjRelAccelY_4: uint16  % 0.03125|-16|-16|15.9688|single
  RSDS_L_ObjRAccelYStd_4: uint8  % 0.0625|0|0|3.9375|single
  RSDS_L_VFC_ObjWidth_4: uint16  % 0.01|0|0|5|single
  RSDS_L_ObjMeasured_3: uint8  % 1|0|0|3|uint8
  RSDS_L_ObjMeasured_4: uint8  % 1|0|0|3|uint8
  RSDS_L_VFC_ObjLength_4: uint16  % 0.05|0|0|20|single
  RollingCounter14: uint8  % 1|0|0|15|uint8

RSDS_L_AD3_MSG_BUS = Simulink.Bus(HeaderFile="Rte_Type.h")
  Checksum15: uint8
  RSDS_L_ObjID_5: uint8
  RSDS_L_ObjExistProb_5: single
  RSDS_L_ObjObstacleProb_5: single
  RSDS_L_ObjDistX_5: single
  RSDS_L_ObjDistY_5: single
  RollingCounter15: uint8
  RSDS_L_ObjRelAccelX_5: single
  Checksum16: uint8
  RSDS_L_ObjRelVelX_5: single
  RSDS_L_ObjDistXStd_5: single
  RSDS_L_ObjRelVelY_5: single
  RSDS_L_ObjDistYStd_5: single
  RSDS_L_ObjRelVelXStd_5: single
  RollingCounter16: uint8
  RSDS_L_ObjRelVelYStd_5: single
  Checksum17: uint8
  RSDS_L_ObjRAccelXStd_5: single
  RSDS_L_ObjRelAccelY_5: single
  RSDS_L_ObjRAccelYStd_5: single
  RSDS_L_VFC_ObjWidth_5: single
  RSDS_L_VFC_ObjLength_5: single
  RollingCounter17: uint8
  Checksum18: uint8
  BlockCounter3: uint8
  Rollingcounter18: uint8
  Checksum19: uint8
  RSDS_L_ObjID_6: uint8
  RSDS_L_ObjExistProb_6: single
  RSDS_L_ObjObstacleProb_6: single
  RSDS_L_ObjDistX_6: single
  RSDS_L_ObjDistY_6: single
  RollingCounter19: uint8
  RSDS_L_ObjRelAccelX_6: single
  Checksum20: uint8
  RSDS_L_ObjRelVelX_6: single
  RSDS_L_ObjDistXStd_6: single
  RSDS_L_ObjRelVelY_6: single
  RSDS_L_ObjDistYStd_6: single
  RSDS_L_ObjRelVelXStd_6: single
  RollingCounter20: uint8
  RSDS_L_ObjRelVelYStd_6: single
  Checksum21: uint8
  RSDS_L_ObjRAccelXStd_6: single
  RSDS_L_ObjRelAccelY_6: single
  RSDS_L_ObjRAccelYStd_6: single
  RSDS_L_VFC_ObjWidth_6: single
  RSDS_L_ObjMeasured_5: uint8
  RSDS_L_ObjMeasured_6: uint8
  RSDS_L_VFC_ObjLength_6: single
  RollingCounter21: uint8

RSDS_L_AD3_RAW_BUS = Simulink.Bus(HeaderFile="Rte_Type.h")
  Checksum15: uint8  % 1|0|0|255|uint8
  RSDS_L_ObjID_5: uint8  % 1|0|0|255|uint8
  RSDS_L_ObjExistProb_5: uint8  % 0.032258|0|0|1|single
  RSDS_L_ObjObstacleProb_5: uint8  % 0.032258|0|0|1|single
  RSDS_L_ObjDistX_5: uint16  % 0.0625|-128|-128|126.9375|single
  RSDS_L_ObjDistY_5: uint16  % 0.125|-128|-128|127.875|single
  RollingCounter15: uint8  % 1|0|0|15|uint8
  RSDS_L_ObjRelAccelX_5: uint16  % 0.03125|-16|-16|15.9688|single
  Checksum16: uint8  % 1|0|0|255|uint8
  RSDS_L_ObjRelVelX_5: uint16  % 0.0312|-128|-128|126.9976|single
  RSDS_L_ObjDistXStd_5: uint8  % 0.1|0|0|6|single
  RSDS_L_ObjRelVelY_5: uint16  % 0.0312|-128|-128|126.9976|single
  RSDS_L_ObjDistYStd_5: uint8  % 0.1|0|0|6|single
  RSDS_L_ObjRelVelXStd_5: uint8  % 0.0625|0|0|3.9375|single
  RollingCounter16: uint8  % 1|0|0|15|uint8
  RSDS_L_ObjRelVelYStd_5: uint8  % 0.0625|0|0|3.9375|single
  Checksum17: uint8  % 1|0|0|255|uint8
  RSDS_L_ObjRAccelXStd_5: uint8  % 0.0625|0|0|3.9375|single
  RSDS_L_ObjRelAccelY_5: uint16  % 0.03125|-16|-16|15.9688|single
  RSDS_L_ObjRAccelYStd_5: uint8  % 0.0625|0|0|3.9375|single
  RSDS_L_VFC_ObjWidth_5: uint16  % 0.01|0|0|5|single
  RSDS_L_VFC_ObjLength_5: uint16  % 0.05|0|0|20|single
  RollingCounter17: uint8  % 1|0|0|15|uint8
  Checksum18: uint8  % 1|0|0|255|uint8
  BlockCounter3: uint8  % 1|0|0|15|uint8
  Rollingcounter18: uint8  % 1|0|0|15|uint8
  Checksum19: uint8  % 1|0|0|255|uint8
  RSDS_L_ObjID_6: uint8  % 1|0|0|255|uint8
  RSDS_L_ObjExistProb_6: uint8  % 0.032258|0|0|1|single
  RSDS_L_ObjObstacleProb_6: uint8  % 0.032258|0|0|1|single
  RSDS_L_ObjDistX_6: uint16  % 0.0625|-128|-128|126.9375|single
  RSDS_L_ObjDistY_6: uint16  % 0.125|-128|-128|127.875|single
  RollingCounter19: uint8  % 1|0|0|15|uint8
  RSDS_L_ObjRelAccelX_6: uint16  % 0.03125|-16|-16|15.9688|single
  Checksum20: uint8  % 1|0|0|255|uint8
  RSDS_L_ObjRelVelX_6: uint16  % 0.0312|-128|-128|126.9976|single
  RSDS_L_ObjDistXStd_6: uint8  % 0.1|0|0|6|single
  RSDS_L_ObjRelVelY_6: uint16  % 0.0312|-128|-128|126.9976|single
  RSDS_L_ObjDistYStd_6: uint8  % 0.1|0|0|6|single
  RSDS_L_ObjRelVelXStd_6: uint8  % 0.0625|0|0|3.9375|single
  RollingCounter20: uint8  % 1|0|0|15|uint8
  RSDS_L_ObjRelVelYStd_6: uint8  % 0.0625|0|0|3.9375|single
  Checksum21: uint8  % 1|0|0|255|uint8
  RSDS_L_ObjRAccelXStd_6: uint8  % 0.0625|0|0|3.9375|single
  RSDS_L_ObjRelAccelY_6: uint16  % 0.03125|-16|-16|15.9688|single
  RSDS_L_ObjRAccelYStd_6: uint8  % 0.0625|0|0|3.9375|single
  RSDS_L_VFC_ObjWidth_6: uint16  % 0.01|0|0|5|single
  RSDS_L_ObjMeasured_5: uint8  % 1|0|0|3|uint8
  RSDS_L_ObjMeasured_6: uint8  % 1|0|0|3|uint8
  RSDS_L_VFC_ObjLength_6: uint16  % 0.05|0|0|20|single
  RollingCounter21: uint8  % 1|0|0|15|uint8

RSDS_R_AD1_MSG_BUS = Simulink.Bus(HeaderFile="Rte_Type.h")
  Checksum22: uint8
  RSDS_R_ObjID_1: uint8
  RSDS_R_ObjExistProb_1: single
  RSDS_R_ObjObstacleProb_1: single
  RSDS_R_ObjDistX_1: single
  RSDS_R_ObjDistY_1: single
  RollingCounter22: uint8
  RSDS_R_ObjRelAccelX_1: single
  Checksum23: uint8
  RSDS_R_ObjRelVelX_1: single
  RSDS_R_ObjDistXStd_1: single
  RSDS_R_ObjRelVelY_1: single
  RSDS_R_ObjDistYStd_1: single
  RSDS_R_ObjRelVelXStd_1: single
  RollingCounter23: uint8
  RSDS_R_ObjRelVelYStd_1: single
  Checksum24: uint8
  RSDS_R_ObjRAccelXStd_1: single
  RSDS_R_ObjRelAccelY_1: single
  RSDS_R_ObjRAccelYStd_1: single
  RSDS_R_VFC_ObjWidth_1: single
  RSDS_R_BLIND: uint8
  RSDS_R_hdr_ErrorStatus: uint8
  RSDS_R_VFC_ObjLength_1: single
  RollingCounter24: uint8
  Checksum25: uint8
  RSDS_R_hdr_TimeStamp: single
  BlockCounter4: uint8
  RSDS_R_hdr_TimerStempStatus: uint8
  Rollingcounter25: uint8
  RSDS_R_hdr_AutoSarTimeStamp: uint32
  Checksum26: uint8
  RSDS_R_ObjID_2: uint8
  RSDS_R_ObjExistProb_2: single
  RSDS_R_ObjObstacleProb_2: single
  RSDS_R_ObjDistX_2: single
  RSDS_R_ObjDistY_2: single
  RollingCounter26: uint8
  RSDS_R_ObjRelAccelX_2: single
  Checksum27: uint8
  RSDS_R_ObjRelVelX_2: single
  RSDS_R_ObjDistXStd_2: single
  RSDS_R_ObjRelVelY_2: single
  RSDS_R_ObjDistYStd_2: single
  RSDS_R_ObjRelVelXStd_2: single
  RollingCounter27: uint8
  RSDS_R_ObjRelVelYStd_2: single
  Checksum28: uint8
  RSDS_R_ObjRAccelXStd_2: single
  RSDS_R_ObjRelAccelY_2: single
  RSDS_R_ObjRAccelYStd_2: single
  RSDS_R_VFC_ObjWidth_2: single
  RSDS_R_ObjMeasured_1: uint8
  RSDS_R_ObjMeasured_2: uint8
  RSDS_R_VFC_ObjLength_2: single
  RollingCounter28: uint8

RSDS_R_AD1_RAW_BUS = Simulink.Bus(HeaderFile="Rte_Type.h")
  Checksum22: uint8  % 1|0|0|255|uint8
  RSDS_R_ObjID_1: uint8  % 1|0|0|255|uint8
  RSDS_R_ObjExistProb_1: uint8  % 0.032258|0|0|1|single
  RSDS_R_ObjObstacleProb_1: uint8  % 0.032258|0|0|1|single
  RSDS_R_ObjDistX_1: uint16  % 0.0625|-128|-128|126.9375|single
  RSDS_R_ObjDistY_1: uint16  % 0.125|-128|-128|127.875|single
  RollingCounter22: uint8  % 1|0|0|15|uint8
  RSDS_R_ObjRelAccelX_1: uint16  % 0.03125|-16|-16|15.9688|single
  Checksum23: uint8  % 1|0|0|255|uint8
  RSDS_R_ObjRelVelX_1: uint16  % 0.0312|-128|-128|126.9976|single
  RSDS_R_ObjDistXStd_1: uint8  % 0.1|0|0|6|single
  RSDS_R_ObjRelVelY_1: uint16  % 0.0312|-128|-128|126.9976|single
  RSDS_R_ObjDistYStd_1: uint8  % 0.1|0|0|6|single
  RSDS_R_ObjRelVelXStd_1: uint8  % 0.0625|0|0|3.9375|single
  RollingCounter23: uint8  % 1|0|0|15|uint8
  RSDS_R_ObjRelVelYStd_1: uint8  % 0.0625|0|0|3.9375|single
  Checksum24: uint8  % 1|0|0|255|uint8
  RSDS_R_ObjRAccelXStd_1: uint8  % 0.0625|0|0|3.9375|single
  RSDS_R_ObjRelAccelY_1: uint16  % 0.03125|-16|-16|15.9688|single
  RSDS_R_ObjRAccelYStd_1: uint8  % 0.0625|0|0|3.9375|single
  RSDS_R_VFC_ObjWidth_1: uint16  % 0.01|0|0|5|single
  RSDS_R_BLIND: uint8  % 1|0|0|3|uint8
  RSDS_R_hdr_ErrorStatus: uint8  % 1|0|0|15|uint8
  RSDS_R_VFC_ObjLength_1: uint16  % 0.05|0|0|20|single
  RollingCounter24: uint8  % 1|0|0|15|uint8
  Checksum25: uint8  % 1|0|0|255|uint8
  RSDS_R_hdr_TimeStamp: uint32  % 0.00097|0|0|65536|single
  BlockCounter4: uint8  % 1|0|0|15|uint8
  RSDS_R_hdr_TimerStempStatus: uint8  % 1|0|0|255|uint8
  Rollingcounter25: uint8  % 1|0|0|15|uint8
  RSDS_R_hdr_AutoSarTimeStamp: uint32  % 1|0|0|67108863|uint32
  Checksum26: uint8  % 1|0|0|255|uint8
  RSDS_R_ObjID_2: uint8  % 1|0|0|255|uint8
  RSDS_R_ObjExistProb_2: uint8  % 0.032258|0|0|1|single
  RSDS_R_ObjObstacleProb_2: uint8  % 0.032258|0|0|1|single
  RSDS_R_ObjDistX_2: uint16  % 0.0625|-128|-128|126.9375|single
  RSDS_R_ObjDistY_2: uint16  % 0.125|-128|-128|127.875|single
  RollingCounter26: uint8  % 1|0|0|15|uint8
  RSDS_R_ObjRelAccelX_2: uint16  % 0.03125|-16|-16|15.9688|single
  Checksum27: uint8  % 1|0|0|255|uint8
  RSDS_R_ObjRelVelX_2: uint16  % 0.0312|-128|-128|126.9976|single
  RSDS_R_ObjDistXStd_2: uint8  % 0.1|0|0|6|single
  RSDS_R_ObjRelVelY_2: uint16  % 0.0312|-128|-128|126.9976|single
  RSDS_R_ObjDistYStd_2: uint8  % 0.1|0|0|6|single
  RSDS_R_ObjRelVelXStd_2: uint8  % 0.0625|0|0|3.9375|single
  RollingCounter27: uint8  % 1|0|0|15|uint8
  RSDS_R_ObjRelVelYStd_2: uint8  % 0.0625|0|0|3.9375|single
  Checksum28: uint8  % 1|0|0|255|uint8
  RSDS_R_ObjRAccelXStd_2: uint8  % 0.0625|0|0|3.9375|single
  RSDS_R_ObjRelAccelY_2: uint16  % 0.03125|-16|-16|15.9688|single
  RSDS_R_ObjRAccelYStd_2: uint8  % 0.0625|0|0|3.9375|single
  RSDS_R_VFC_ObjWidth_2: uint16  % 0.01|0|0|5|single
  RSDS_R_ObjMeasured_1: uint8  % 1|0|0|3|uint8
  RSDS_R_ObjMeasured_2: uint8  % 1|0|0|3|uint8
  RSDS_R_VFC_ObjLength_2: uint16  % 0.05|0|0|20|single
  RollingCounter28: uint8  % 1|0|0|15|uint8

RSDS_R_AD2_MSG_BUS = Simulink.Bus(HeaderFile="Rte_Type.h")
  Checksum29: uint8
  RSDS_R_ObjID_3: uint8
  RSDS_R_ObjExistProb_3: single
  RSDS_R_ObjObstacleProb_3: single
  RSDS_R_ObjDistX_3: single
  RSDS_R_ObjDistY_3: single
  RollingCounter29: uint8
  RSDS_R_ObjRelAccelX_3: single
  Checksum30: uint8
  RSDS_R_ObjRelVelX_3: single
  RSDS_R_ObjDistXStd_3: single
  RSDS_R_ObjRelVelY_3: single
  RSDS_R_ObjDistYStd_3: single
  RSDS_R_ObjRelVelXStd_3: single
  RollingCounter30: uint8
  RSDS_R_ObjRelVelYStd_3: single
  Checksum31: uint8
  RSDS_R_ObjRAccelXStd_3: single
  RSDS_R_ObjRelAccelY_3: single
  RSDS_R_ObjRAccelYStd_3: single
  RSDS_R_VFC_ObjWidth_3: single
  RSDS_R_VFC_ObjLength_3: single
  RollingCounter31: uint8
  Checksum32: uint8
  BlockCounter5: uint8
  Rollingcounter32: uint8
  Checksum33: uint8
  RSDS_R_ObjID_4: uint8
  RSDS_R_ObjExistProb_4: single
  RSDS_R_ObjObstacleProb_4: single
  RSDS_R_ObjDistX_4: single
  RSDS_R_ObjDistY_4: single
  RollingCounter33: uint8
  RSDS_R_ObjRelAccelX_4: single
  Checksum34: uint8
  RSDS_R_ObjRelVelX_4: single
  RSDS_R_ObjDistXStd_4: single
  RSDS_R_ObjRelVelY_4: single
  RSDS_R_ObjDistYStd_4: single
  RSDS_R_ObjRelVelXStd_4: single
  RollingCounter34: uint8
  RSDS_R_ObjRelVelYStd_4: single
  Checksum35: uint8
  RSDS_R_ObjRAccelXStd_4: single
  RSDS_R_ObjRelAccelY_4: single
  RSDS_R_ObjRAccelYStd_4: single
  RSDS_R_VFC_ObjWidth_4: single
  RSDS_R_ObjMeasured_3: uint8
  RSDS_R_ObjMeasured_4: uint8
  RSDS_R_VFC_ObjLength_4: single
  RollingCounter35: uint8

RSDS_R_AD2_RAW_BUS = Simulink.Bus(HeaderFile="Rte_Type.h")
  Checksum29: uint8  % 1|0|0|255|uint8
  RSDS_R_ObjID_3: uint8  % 1|0|0|255|uint8
  RSDS_R_ObjExistProb_3: uint8  % 0.032258|0|0|1|single
  RSDS_R_ObjObstacleProb_3: uint8  % 0.032258|0|0|1|single
  RSDS_R_ObjDistX_3: uint16  % 0.0625|-128|-128|126.9375|single
  RSDS_R_ObjDistY_3: uint16  % 0.125|-128|-128|127.875|single
  RollingCounter29: uint8  % 1|0|0|15|uint8
  RSDS_R_ObjRelAccelX_3: uint16  % 0.03125|-16|-16|15.9688|single
  Checksum30: uint8  % 1|0|0|255|uint8
  RSDS_R_ObjRelVelX_3: uint16  % 0.0312|-128|-128|126.9976|single
  RSDS_R_ObjDistXStd_3: uint8  % 0.1|0|0|6|single
  RSDS_R_ObjRelVelY_3: uint16  % 0.0312|-128|-128|126.9976|single
  RSDS_R_ObjDistYStd_3: uint8  % 0.1|0|0|6|single
  RSDS_R_ObjRelVelXStd_3: uint8  % 0.0625|0|0|3.9375|single
  RollingCounter30: uint8  % 1|0|0|15|uint8
  RSDS_R_ObjRelVelYStd_3: uint8  % 0.0625|0|0|3.9375|single
  Checksum31: uint8  % 1|0|0|255|uint8
  RSDS_R_ObjRAccelXStd_3: uint8  % 0.0625|0|0|3.9375|single
  RSDS_R_ObjRelAccelY_3: uint16  % 0.03125|-16|-16|15.9688|single
  RSDS_R_ObjRAccelYStd_3: uint8  % 0.0625|0|0|3.9375|single
  RSDS_R_VFC_ObjWidth_3: uint16  % 0.01|0|0|5|single
  RSDS_R_VFC_ObjLength_3: uint16  % 0.05|0|0|20|single
  RollingCounter31: uint8  % 1|0|0|15|uint8
  Checksum32: uint8  % 1|0|0|255|uint8
  BlockCounter5: uint8  % 1|0|0|15|uint8
  Rollingcounter32: uint8  % 1|0|0|15|uint8
  Checksum33: uint8  % 1|0|0|255|uint8
  RSDS_R_ObjID_4: uint8  % 1|0|0|255|uint8
  RSDS_R_ObjExistProb_4: uint8  % 0.032258|0|0|1|single
  RSDS_R_ObjObstacleProb_4: uint8  % 0.032258|0|0|1|single
  RSDS_R_ObjDistX_4: uint16  % 0.0625|-128|-128|126.9375|single
  RSDS_R_ObjDistY_4: uint16  % 0.125|-128|-128|127.875|single
  RollingCounter33: uint8  % 1|0|0|15|uint8
  RSDS_R_ObjRelAccelX_4: uint16  % 0.03125|-16|-16|15.9688|single
  Checksum34: uint8  % 1|0|0|255|uint8
  RSDS_R_ObjRelVelX_4: uint16  % 0.0312|-128|-128|126.9976|single
  RSDS_R_ObjDistXStd_4: uint8  % 0.1|0|0|6|single
  RSDS_R_ObjRelVelY_4: uint16  % 0.0312|-128|-128|126.9976|single
  RSDS_R_ObjDistYStd_4: uint8  % 0.1|0|0|6|single
  RSDS_R_ObjRelVelXStd_4: uint8  % 0.0625|0|0|3.9375|single
  RollingCounter34: uint8  % 1|0|0|15|uint8
  RSDS_R_ObjRelVelYStd_4: uint8  % 0.0625|0|0|3.9375|single
  Checksum35: uint8  % 1|0|0|255|uint8
  RSDS_R_ObjRAccelXStd_4: uint8  % 0.0625|0|0|3.9375|single
  RSDS_R_ObjRelAccelY_4: uint16  % 0.03125|-16|-16|15.9688|single
  RSDS_R_ObjRAccelYStd_4: uint8  % 0.0625|0|0|3.9375|single
  RSDS_R_VFC_ObjWidth_4: uint16  % 0.01|0|0|5|single
  RSDS_R_ObjMeasured_3: uint8  % 1|0|0|3|uint8
  RSDS_R_ObjMeasured_4: uint8  % 1|0|0|3|uint8
  RSDS_R_VFC_ObjLength_4: uint16  % 0.05|0|0|20|single
  RollingCounter35: uint8  % 1|0|0|15|uint8

RSDS_R_AD3_MSG_BUS = Simulink.Bus(HeaderFile="Rte_Type.h")
  Checksum36: uint8
  RSDS_R_ObjID_5: uint8
  RSDS_R_ObjExistProb_5: single
  RSDS_R_ObjObstacleProb_5: single
  RSDS_R_ObjDistX_5: single
  RSDS_R_ObjDistY_5: single
  RollingCounter36: uint8
  RSDS_R_ObjRelAccelX_5: single
  Checksum37: uint8
  RSDS_R_ObjRelVelX_5: single
  RSDS_R_ObjDistXStd_5: single
  RSDS_R_ObjRelVelY_5: single
  RSDS_R_ObjDistYStd_5: single
  RSDS_R_ObjRelVelXStd_5: single
  RollingCounter37: uint8
  RSDS_R_ObjRelVelYStd_5: single
  Checksum38: uint8
  RSDS_R_ObjRAccelXStd_5: single
  RSDS_R_ObjRelAccelY_5: single
  RSDS_R_ObjRAccelYStd_5: single
  RSDS_R_VFC_ObjWidth_5: single
  RSDS_R_VFC_ObjLength_5: single
  RollingCounter38: uint8
  Checksum39: uint8
  BlockCounter6: uint8
  Rollingcounter39: uint8
  Checksum40: uint8
  RSDS_R_ObjID_6: uint8
  RSDS_R_ObjExistProb_6: single
  RSDS_R_ObjObstacleProb_6: single
  RSDS_R_ObjDistX_6: single
  RSDS_R_ObjDistY_6: single
  RollingCounter40: uint8
  RSDS_R_ObjRelAccelX_6: single
  Checksum41: uint8
  RSDS_R_ObjRelVelX_6: single
  RSDS_R_ObjDistXStd_6: single
  RSDS_R_ObjRelVelY_6: single
  RSDS_R_ObjDistYStd_6: single
  RSDS_R_ObjRelVelXStd_6: single
  RollingCounter41: uint8
  RSDS_R_ObjRelVelYStd_6: single
  Checksum42: uint8
  RSDS_R_ObjRAccelXStd_6: single
  RSDS_R_ObjRelAccelY_6: single
  RSDS_R_ObjRAccelYStd_6: single
  RSDS_R_VFC_ObjWidth_6: single
  RSDS_R_ObjMeasured_5: uint8
  RSDS_R_ObjMeasured_6: uint8
  RSDS_R_VFC_ObjLength_6: single
  RollingCounter42: uint8

RSDS_R_AD3_RAW_BUS = Simulink.Bus(HeaderFile="Rte_Type.h")
  Checksum36: uint8  % 1|0|0|255|uint8
  RSDS_R_ObjID_5: uint8  % 1|0|0|255|uint8
  RSDS_R_ObjExistProb_5: uint8  % 0.032258|0|0|1|single
  RSDS_R_ObjObstacleProb_5: uint8  % 0.032258|0|0|1|single
  RSDS_R_ObjDistX_5: uint16  % 0.0625|-128|-128|126.9375|single
  RSDS_R_ObjDistY_5: uint16  % 0.125|-128|-128|127.875|single
  RollingCounter36: uint8  % 1|0|0|15|uint8
  RSDS_R_ObjRelAccelX_5: uint16  % 0.03125|-16|-16|15.9688|single
  Checksum37: uint8  % 1|0|0|255|uint8
  RSDS_R_ObjRelVelX_5: uint16  % 0.0312|-128|-128|126.9976|single
  RSDS_R_ObjDistXStd_5: uint8  % 0.1|0|0|6|single
  RSDS_R_ObjRelVelY_5: uint16  % 0.0312|-128|-128|126.9976|single
  RSDS_R_ObjDistYStd_5: uint8  % 0.1|0|0|6|single
  RSDS_R_ObjRelVelXStd_5: uint8  % 0.0625|0|0|3.9375|single
  RollingCounter37: uint8  % 1|0|0|15|uint8
  RSDS_R_ObjRelVelYStd_5: uint8  % 0.0625|0|0|3.9375|single
  Checksum38: uint8  % 1|0|0|255|uint8
  RSDS_R_ObjRAccelXStd_5: uint8  % 0.0625|0|0|3.9375|single
  RSDS_R_ObjRelAccelY_5: uint16  % 0.03125|-16|-16|15.9688|single
  RSDS_R_ObjRAccelYStd_5: uint8  % 0.0625|0|0|3.9375|single
  RSDS_R_VFC_ObjWidth_5: uint16  % 0.01|0|0|5|single
  RSDS_R_VFC_ObjLength_5: uint16  % 0.05|0|0|20|single
  RollingCounter38: uint8  % 1|0|0|15|uint8
  Checksum39: uint8  % 1|0|0|255|uint8
  BlockCounter6: uint8  % 1|0|0|15|uint8
  Rollingcounter39: uint8  % 1|0|0|15|uint8
  Checksum40: uint8  % 1|0|0|255|uint8
  RSDS_R_ObjID_6: uint8  % 1|0|0|255|uint8
  RSDS_R_ObjExistProb_6: uint8  % 0.032258|0|0|1|single
  RSDS_R_ObjObstacleProb_6: uint8  % 0.032258|0|0|1|single
  RSDS_R_ObjDistX_6: uint16  % 0.0625|-128|-128|126.9375|single
  RSDS_R_ObjDistY_6: uint16  % 0.125|-128|-128|127.875|single
  RollingCounter40: uint8  % 1|0|0|15|uint8
  RSDS_R_ObjRelAccelX_6: uint16  % 0.03125|-16|-16|15.9688|single
  Checksum41: uint8  % 1|0|0|255|uint8
  RSDS_R_ObjRelVelX_6: uint16  % 0.0312|-128|-128|126.9976|single
  RSDS_R_ObjDistXStd_6: uint8  % 0.1|0|0|6|single
  RSDS_R_ObjRelVelY_6: uint16  % 0.0312|-128|-128|126.9976|single
  RSDS_R_ObjDistYStd_6: uint8  % 0.1|0|0|6|single
  RSDS_R_ObjRelVelXStd_6: uint8  % 0.0625|0|0|3.9375|single
  RollingCounter41: uint8  % 1|0|0|15|uint8
  RSDS_R_ObjRelVelYStd_6: uint8  % 0.0625|0|0|3.9375|single
  Checksum42: uint8  % 1|0|0|255|uint8
  RSDS_R_ObjRAccelXStd_6: uint8  % 0.0625|0|0|3.9375|single
  RSDS_R_ObjRelAccelY_6: uint16  % 0.03125|-16|-16|15.9688|single
  RSDS_R_ObjRAccelYStd_6: uint8  % 0.0625|0|0|3.9375|single
  RSDS_R_VFC_ObjWidth_6: uint16  % 0.01|0|0|5|single
  RSDS_R_ObjMeasured_5: uint8  % 1|0|0|3|uint8
  RSDS_R_ObjMeasured_6: uint8  % 1|0|0|3|uint8
  RSDS_R_VFC_ObjLength_6: uint16  % 0.05|0|0|20|single
  RollingCounter42: uint8  % 1|0|0|15|uint8