% Simulink data dictionary PubIfChassisAHBC_RTE.sldd

AHBC_VCAN_ESP_BUS = Simulink.Bus(HeaderFile="Rte_Type.h")
  VehSpd: single
  FLWheelDriveDirection: uint8
  FRWheelDriveDirection: uint8
  RLWheelDriveDirection: uint8
  RRWheelDriveDirection: uint8
  ABSActv: boolean
  VDCActv: boolean
  BTCActv: boolean
  PTCActv: boolean
  MSRActv: boolean

AHBC_VCAN_GW_BUS = Simulink.Bus(HeaderFile="Rte_Type.h")
  CURRENT_GEAR: uint8
  FrntWiprSwtSts: uint8
  WiprReq_F_PBOX: uint8
  FFogLmpSts_F_Pbox: boolean
  LTurnLmpSwtSts: boolean
  RTurnLmpSwtSts: boolean
  VehYawRate: single
  VehLatAccel: single
  RFogLmpSts_R_Pbox: boolean

AHBC_HMA_BUS = Simulink.Bus(HeaderFile="Rte_Type.h")
  HMA_Sts: uint8, Min=0, Max=3
  HMA_HibeamReq: uint8, Min=0, Max=4

AHBC_ADB_BUS = Simulink.Bus(HeaderFile="Rte_Type.h")
  CameraSts: uint8, Min=0, Max=3
  AmbLight: boolean, Min=0, Max=1
  RoadIllumDetd: boolean, Min=0, Max=1
  Trafficstyle: uint8, Min=0, Max=3
  Spots1Valid: boolean, Min=0, Max=1
  Spots1Typ: uint8, Min=0, Max=3
  Spots1HozlPosnRiAng: single, Min=-40, Max=40
  Spots1HozlPosnLeAng: single, Min=-40, Max=40
  Spots1Distance: uint16, Min=0, Max=510
  Spots1HozLeAngSpd: single, Min=-16, Max=15.875
  Spot1VertAng: single, Min=-5, Max=26.875
  Spots1TrackingInfo: boolean, Min=0, Max=1
  Spots1VehObjClassn: uint8, Min=0, Max=7
  Spots2Valid: boolean, Min=0, Max=1
  Spots2Typ: uint8, Min=0, Max=3
  Spots2HozlPosnRiAng: single, Min=-40, Max=40
  Spots2HozlPosnLeAng: single, Min=-40, Max=40
  Spots2Distance: uint16, Min=0, Max=510
  Spots2HozLeAngSpd: single, Min=-16, Max=15.875
  Spot2VertAng: single, Min=-5, Max=26.875
  Spots2TrackingInfo: boolean, Min=0, Max=1
  Spots2VehObjClassn: uint8, Min=0, Max=7
  Spots3Valid: boolean, Min=0, Max=1
  Spots3Typ: uint8, Min=0, Max=3
  Spots3HozlPosnRiAng: single, Min=-40, Max=40
  Spots3HozlPosnLeAng: single, Min=-40, Max=40
  Spots3Distance: uint16, Min=0, Max=510
  Spots3HozLeAngSpd: single, Min=-16, Max=15.875
  Spot3VertAng: single, Min=-5, Max=26.875
  Spots3TrackingInfo: boolean, Min=0, Max=1
  Spots3VehObjClassn: uint8, Min=0, Max=7
  Spots4Valid: boolean, Min=0, Max=1
  Spots4Typ: uint8, Min=0, Max=3
  Spots4HozlPosnRiAng: single, Min=-40, Max=40
  Spots4HozlPosnLeAng: single, Min=-40, Max=40
  Spots4Distance: uint16, Min=0, Max=510
  Spots4HozLeAngSpd: single, Min=-16, Max=15.875
  Spot4VertAng: single, Min=-5, Max=26.875
  Spots4TrackingInfo: boolean, Min=0, Max=1
  Spots4VehObjClassn: uint8, Min=0, Max=7
  Spots5Valid: boolean, Min=0, Max=1
  Spots5Typ: uint8, Min=0, Max=3
  Spots5HozlPosnRiAng: single, Min=-40, Max=40
  Spots5HozlPosnLeAng: single, Min=-40, Max=40
  Spots5Distance: uint16, Min=0, Max=510
  Spots5HozLeAngSpd: single, Min=-16, Max=15.875
  Spot5VertAng: single, Min=-5, Max=26.875
  Spots5TrackingInfo: boolean, Min=0, Max=1
  Spots5VehObjClassn: uint8, Min=0, Max=7
  Spots6Valid: boolean, Min=0, Max=1
  Spots6Typ: uint8, Min=0, Max=3
  Spots6HozlPosnRiAng: single, Min=-40, Max=40
  Spots6HozlPosnLeAng: single, Min=-40, Max=40
  Spots6Distance: uint16, Min=0, Max=510
  Spots6HozLeAngSpd: single, Min=-16, Max=15.875
  Spot6VertAng: single, Min=-5, Max=26.875
  Spots6TrackingInfo: boolean, Min=0, Max=1
  Spots6VehObjClassn: uint8, Min=0, Max=7
  Spots7Valid: boolean, Min=0, Max=1
  Spots7Typ: uint8, Min=0, Max=3
  Spots7HozlPosnRiAng: single, Min=-40, Max=40
  Spots7HozlPosnLeAng: single, Min=-40, Max=40
  Spots7Distance: uint16, Min=0, Max=510
  Spots7HozLeAngSpd: single, Min=-16, Max=15.875
  Spot7VertAng: single, Min=-5, Max=26.875
  Spots7TrackingInfo: boolean, Min=0, Max=1
  Spots7VehObjClassn: uint8, Min=0, Max=7
  Spots8Valid: boolean, Min=0, Max=1
  Spots8Typ: uint8, Min=0, Max=3
  Spots8HozlPosnRiAng: single, Min=-40, Max=40
  Spots8HozlPosnLeAng: single, Min=-40, Max=40
  Spots8Distance: uint16, Min=0, Max=510
  Spots8HozLeAngSpd: single, Min=-16, Max=15.875
  Spot8VertAng: single, Min=-5, Max=26.875
  Spots8TrackingInfo: boolean, Min=0, Max=1
  Spots8VehObjClassn: uint8, Min=0, Max=7