% Simulink data dictionary PubIfChassisEDR_RTE.sldd

EDR_AEB_LONOBJ_INFO_REC_BUS = Simulink.Bus(HeaderFile="Rte_Type.h")
  FusionType: uint8  % 目标是否是融合,传感器类型
  ObjectID: uint8  % 融合追踪处理后，目标的ID
  ObjectType: uint8  % 目标的类型（行人、小汽车、卡车...）
  ObjectTypeCameraConfirmed: boolean  % 目标类型经过摄像头确认标志位
  ObjectLength: single  % 目标的长度
  ObjectWidth: single  % 目标的宽度
  ObjectHight: single  % 目标的高度
  ObjectYawAngle: single  % 车体系下, 目标的航向角
  ObjectMovingState: uint8  % 目标的运动状态(静止、运动...)
  ObjectMovingOrientation: uint8  % 目标的运动方向(同向、对向、横穿...)
  dx: single  % 车体坐标系下，自车和目标纵向相对距离
  dy: single  % 车体坐标系下，自车和目标横向相对距离
  dz: single  % 自车和目标垂向相对距离
  vx: single  % 自车和目标的纵向的相对速度
  vy: single  % 自车和目标的横向的相对速度
  ax: single  % 自车和目标  纵向  相对距离的方差
  ay: single  % 自车和目标  横向  相对距离的方差
  dxVariance: single  % 自车和目标的纵向的相对加速度
  dyVariance: single  % 自车和目标的横向的相对加速度
  ObjectExistProb: single  % 目标存在的概率值
  ObjectIsObstacleProb: single  % 目标成为障碍物的概率值
  ObjectMeasurementStatus: single  % 目标的测量状态
  dyObject2Center: single  % 目标中心线距中间车道中心线距离
  dyEgo2Center: single  % 自车中心线距中间车道中心线距离

EDR_AEB_LATPED_INFO_REC_BUS = Simulink.Bus(HeaderFile="Rte_Type.h")
  FusionType: uint8  % 目标是否是融合,传感器类型
  ObjectID: uint8  % 融合追踪处理后，目标的ID
  ObjectType: uint8  % 目标的类型（行人、小汽车、卡车...）
  ObjectTypeCameraConfirmed: boolean  % 目标类型经过摄像头确认标志位
  ObjectLength: single  % 目标的长度
  ObjectWidth: single  % 目标的宽度
  ObjectHight: single  % 目标的高度
  ObjectYawAngle: single  % 车体系下, 目标的航向角
  ObjectMovingState: uint8  % 目标的运动状态(静止、运动...)
  ObjectMovingOrientation: uint8  % 目标的运动方向(同向、对向、横穿...)
  dxFisrtDetection: single  % 首次探测到目标时自车和目标纵向相对距离
  dyFisrtDetection: single  % 首次探测到目标时自车和目标横向相对距离
  dx: single  % 车体坐标系下，自车和目标纵向相对距离
  dy: single  % 车体坐标系下，自车和目标横向相对距离
  dz: single  % 自车和目标垂向相对距离
  vx: single  % 自车和目标的纵向的相对速度
  vy: single  % 自车和目标的横向的相对速度
  ax: single  % 自车和目标的纵向的相对加速度
  ay: single  % 自车和目标的横向的相对加速度
  dxVariance: single  % 自车和目标纵向相对距离的方差
  dyVariance: single  % 自车和目标横向相对距离的方差
  ObjectExistProb: single  % 目标存在的概率值
  ObjectIsObstacleProb: single  % 目标成为障碍物的概率值
  ObjectMeasurementStatus: single  % 目标的测量状态
  ObjectLifeCycle: single  % 目标存在生命周期

EDR_AEB_LATCYC_INFO_REC_BUS = Simulink.Bus(HeaderFile="Rte_Type.h")
  FusionType: uint8  % 目标是否是融合,传感器类型
  ObjectID: uint8  % 融合追踪处理后，目标的ID
  ObjectType: uint8  % 目标的类型（行人、小汽车、卡车...）
  ObjectTypeCameraConfirmed: boolean  % 目标类型经过摄像头确认标志位
  ObjectLength: single  % 目标的长度
  ObjectWidth: single  % 目标的宽度
  ObjectHight: single  % 目标的高度
  ObjectYawAngle: single  % 车体系下, 目标的航向角
  ObjectMovingState: uint8  % 目标的运动状态(静止、运动...)
  ObjectMovingOrientation: uint8  % 目标的运动方向(同向、对向、横穿...)
  dxFisrtDetection: single  % 首次探测到目标时自车和目标纵向相对距离
  dyFisrtDetection: single  % 首次探测到目标时自车和目标横向相对距离
  dx: single  % 车体坐标系下，自车和目标纵向相对距离
  dy: single  % 车体坐标系下，自车和目标横向相对距离
  dz: single  % 自车和目标垂向相对距离
  vx: single  % 自车和目标的纵向的相对速度
  vy: single  % 自车和目标的横向的相对速度
  ax: single  % 自车和目标的纵向的相对加速度
  ay: single  % 自车和目标的横向的相对加速度
  dxVariance: single  % 自车和目标纵向相对距离的方差
  dyVariance: single  % 自车和目标横向相对距离的方差
  ObjectExistProb: single  % 目标存在的概率值
  ObjectIsObstacleProb: single  % 目标成为障碍物的概率值
  ObjectMeasurementStatus: single  % 目标的测量状态
  ObjectLifeCycle: single  % 目标存在生命周期

EDR_AEB_JAPED_INFO_REC_BUS = Simulink.Bus(HeaderFile="Rte_Type.h")
  FusionType: uint8  % 目标是否是融合,传感器类型
  ObjectID: uint8  % 融合追踪处理后，目标的ID
  ObjectType: uint8  % 目标的类型（行人、小汽车、卡车...）
  ObjectTypeCameraConfirmed: boolean  % 目标类型经过摄像头确认标志位
  ObjectLength: single  % 目标的长度
  ObjectWidth: single  % 目标的宽度
  ObjectHight: single  % 目标的高度
  ObjectYawAngle: single  % 车体系下, 目标的航向角
  ObjectMovingState: uint8  % 目标的运动状态(静止、运动...)
  ObjectMovingOrientation: uint8  % 目标的运动方向(同向、对向、横穿...)
  dxFisrtDetection: single  % 首次探测到目标时自车和目标纵向相对距离
  dyFisrtDetection: single  % 首次探测到目标时自车和目标横向相对距离
  dx: single  % 车体坐标系下，自车和目标纵向相对距离
  dy: single  % 车体坐标系下，自车和目标横向相对距离
  dz: single  % 自车和目标垂向相对距离
  vx: single  % 自车和目标的纵向的相对速度
  vy: single  % 自车和目标的横向的相对速度
  ax: single  % 自车和目标的纵向的相对加速度
  ay: single  % 自车和目标的横向的相对加速度
  dxVariance: single  % 自车和目标纵向相对距离的方差
  dyVariance: single  % 自车和目标横向相对距离的方差
  ObjectExistProb: single  % 目标存在的概率值
  ObjectIsObstacleProb: single  % 目标成为障碍物的概率值
  ObjectMeasurementStatus: single  % 目标的测量状态
  ObjectLifeCycle: single  % 目标存在生命周期

EDR_AEB_JAVEH_INFO_REC_BUS = Simulink.Bus(HeaderFile="Rte_Type.h")
  FusionType: uint8  % 目标是否是融合,传感器类型
  ObjectID: uint8  % 融合追踪处理后，目标的ID
  ObjectType: uint8  % 目标的类型（行人、小汽车、卡车...）
  ObjectTypeCameraConfirmed: boolean  % 目标类型经过摄像头确认标志位
  ObjectLength: single  % 目标的长度
  ObjectWidth: single  % 目标的宽度
  ObjectHight: single  % 目标的高度
  ObjectYawAngle: single  % 车体系下, 目标的航向角
  ObjectMovingState: uint8  % 目标的运动状态(静止、运动...)
  ObjectMovingOrientation: uint8  % 目标的运动方向(同向、对向、横穿...)
  dxFisrtDetection: single  % 首次探测到目标时自车和目标纵向相对距离
  dyFisrtDetection: single  % 首次探测到目标时自车和目标横向相对距离
  dx: single  % 车体坐标系下，自车和目标纵向相对距离
  dy: single  % 车体坐标系下，自车和目标横向相对距离
  dz: single  % 自车和目标垂向相对距离
  vx: single  % 自车和目标的纵向的相对速度
  vy: single  % 自车和目标的横向的相对速度
  ax: single  % 自车和目标的纵向的相对加速度
  ay: single  % 自车和目标的横向的相对加速度
  dxVariance: single  % 自车和目标纵向相对距离的方差
  dyVariance: single  % 自车和目标横向相对距离的方差
  ObjectExistProb: single  % 目标存在的概率值
  ObjectIsObstacleProb: single  % 目标成为障碍物的概率值
  ObjectMeasurementStatus: single  % 目标的测量状态
  ObjectLifeCycle: single  % 目标存在生命周期

EDR_AEB_BRK_INFO_REC_BUS = Simulink.Bus(HeaderFile="Rte_Type.h")
  AEB_ABP_Req: boolean  % <undefined>
  AEB_ABA_Req: boolean  % <undefined>
  AEB_ABA_Level: uint8  % <undefined>
  AEB_AWB_Req: boolean  % <undefined>
  AEB_AWB_Level: uint8  % <undefined>
  AEB_TgtDecel_Req: boolean  % <undefined>
  AEB_TgtDecel_ReqValue: single  % <undefined>
  AEB_BrkReqFunc: uint8  % <undefined>
  EBA_TgtDecel_Req: boolean  % <undefined>
  AEB_VehHldReq: boolean  % <undefined>