% Simulink data dictionary PubIfCommonCAL_RTE.sldd

CAL_AHBC_CONFIG_BUS = Simulink.Bus(HeaderFile="Rte_Type.h")
  VehConfigADB: uint8
  VehConfigHMA: uint8
  VehConfigHMA_laser: uint8

CAL_AEB_CONFIG_BUS = Simulink.Bus(HeaderFile="Rte_Type.h")
  VehConfigFCW: uint8
  VehConfigAEB: uint8
  VehConfigAEBPed: uint8
  VehConfigAEBCyc: uint8
  VehConfigAEBJA: uint8
  VehConfigIbooster: uint8

CAL_NETWORKCFG_BUS = Simulink.Bus(HeaderFile="Rte_Type.h")
  ProjectCode: uint8
  TrafficSignWarning: uint8
  AutoParkingSystem: uint8
  PowerTrainType: uint8
  Transmission: uint8
  DriverHandleType: uint8
  HeadLampLighting: uint8
  Country: uint8
  Navigation: uint8
  ElectrMotorPosition: uint8
  Tire: uint8
  Cruise_Control: uint8
  LDW_LKA: uint8
  Warning_Auto: uint8
  HeadLampBeamSystem: uint8
  IDC_L2: uint8
  TransferCase: uint8
  LaneSupportSystem: uint8
  TrailingHook: uint8
  WarningKreak: uint8
  Support: uint8
  AEBJunctionAssist: uint8
  AutoEvasiveSteering: uint8
  HihgwayAssist: uint8
  HighWayPilot: uint8
  Pump: uint8
  E_AXLE: uint8
  SALESAREA: uint8
  REGIONAL: uint8
  NOH: uint8

CAL_VSM_CONFIG_BUS = Simulink.Bus(HeaderFile="Rte_Type.h")
  VehConfigHWA: uint8
  VehConfigTJA: uint8
  VehConfigLCK: uint8
  VehConfigELK: uint8
  VehConfigACC: uint8
  VehConfigESS: uint8
  VehConfigCC: uint8
  VehConfigLKA: uint8
  VehConfigLDW: uint8
  VehConfigLCKIE: uint8
  VehConfigiACC: uint8
  VehConfigTSR: uint8
  VehConfigAES: uint8
  VehConfigNOH: uint8
  VehConfigHWP: uint8