% Simulink data dictionary PubIfCommonEHRV3_RTE.sldd

EHRV3_TUNNEL_BUS = Simulink.Bus(HeaderFile="Rte_Type.h")
  b_is_available: uint8  % 是否可用
  f_start_offset: single  % 起始offset，单位cm
  f_end_offset: single  % 终止offset，单位cm
  f_length: single  % 隧道长度，单位m

EHRV3_REC_LANES_BUS = Simulink.Bus(HeaderFile="Rte_Type.h")
  i_rec_lanes_num: uint8, Min=0, Max=255  % 推荐车道数量
  i_rec_lanes: uint8[8], Min=0, Max=255  % 推荐车道数组，从左往右编号增大

EHRV3_POSTION_BUS = Simulink.Bus(HeaderFile="Rte_Type.h")
  i_ts: uint64  % 时间戳
  i_position_age: uint64  % 定位时间
  i_path_id: uint32  % 所在pathid
  i_offset: uint32  % 所在位置offset
  i_accuracy: uint32
  i_deviation: int32
  f_speed: single
  f_relative_heading: single
  f_probability: single
  i_current_Lane: uint8  % 当前所在车道编号，从左往右
  i_prefer_path: uint32  % MPP信息

EHRV3_GEOFENCE_BUS = Simulink.Bus(HeaderFile="Rte_Type.h")
  i_is_in_geofence: uint8  % 百度地理围栏信息：参考：\\10.255.33.160\znjs-l3\013_Data Fusion\01_projHwpFunsion\21_refDoc\ADASISV3\百度输出信号列表0414.xlsx
  i_geofence_notice: uint8  % 百度地理围栏信息：参考：\\10.255.33.160\znjs-l3\013_Data Fusion\01_projHwpFunsion\21_refDoc\ADASISV3\百度输出信号列表0415.xlsx
  i_geofence_status: uint8  % 百度地理围栏信息：参考：\\10.255.33.160\znjs-l3\013_Data Fusion\01_projHwpFunsion\21_refDoc\ADASISV3\百度输出信号列表0416.xlsx
  i_type: uint32  % 高德地理围栏信息，含义待定
  i_action: uint32  % 高德地理围栏信息，含义待定
  i_reason: uint64  % 高德地理围栏信息，含义待定

EHRV3_TUNNEL_VAL = struct(b_is_available=uint8(0), f_start_offset=single(0), f_end_offset=single(0), f_length=single(0))
EHRV3_TUNNEL_PAR = AUTOSAR4.Parameter(struct(b_is_available=uint8(0), f_start_offset=single(0), f_end_offset=single(0), f_length=single(0)), SwCalibrationAccess="ReadWrite", StorageClass="Global", DataType="Bus:EHRV3_TUNNEL_BUS")
EHRV3_REC_LANES_VAL = struct(i_rec_lanes_num=uint8(0), i_rec_lanes=uint8(repmat(0, 1, 8)))
EHRV3_REC_LANES_PAR = AUTOSAR4.Parameter(struct(i_rec_lanes_num=uint8(0), i_rec_lanes=uint8(repmat(0, 1, 8))), SwCalibrationAccess="ReadWrite", StorageClass="Global", DataType="Bus:EHRV3_REC_LANES_BUS")

EHRV3_POSTION_VAL = struct(
  i_ts=uint64(0),
  i_position_age=uint64(0),
  i_path_id=uint32(0),
  i_offset=uint32(0),
  i_accuracy=uint32(0),
  i_deviation=int32(0),
  f_speed=single(0),
  f_relative_heading=single(0),
  f_probability=single(0),
  i_current_Lane=uint8(0),
  i_prefer_path=uint32(0))

EHRV3_POSTION_PAR = AUTOSAR4.Parameter(struct(
  i_ts=uint64(0),
  i_position_age=uint64(0),
  i_path_id=uint32(0),
  i_offset=uint32(0),
  i_accuracy=uint32(0),
  i_deviation=int32(0),
  f_speed=single(0),
  f_relative_heading=single(0),
  f_probability=single(0),
  i_current_Lane=uint8(0),
  i_prefer_path=uint32(0)), SwCalibrationAccess="ReadWrite", StorageClass="Global", DataType="Bus:EHRV3_POSTION_BUS")

EHRV3_GEOFENCE_VAL = struct(
  i_is_in_geofence=uint8(0),
  i_geofence_notice=uint8(0),
  i_geofence_status=uint8(0),
  i_type=uint32(0),
  i_action=uint32(0),
  i_reason=uint64(0))

EHRV3_GEOFENCE_PAR = AUTOSAR4.Parameter(struct(
  i_is_in_geofence=uint8(0),
  i_geofence_notice=uint8(0),
  i_geofence_status=uint8(0),
  i_type=uint32(0),
  i_action=uint32(0),
  i_reason=uint64(0)), SwCalibrationAccess="ReadWrite", StorageClass="Global", DataType="Bus:EHRV3_GEOFENCE_BUS")

en_line_type_PAR = Simulink.Parameter(0, DataType="uint8")
en_color_PAR = Simulink.Parameter(0, DataType="uint8")
i_line_frontpoint_cnt_PAR = Simulink.Parameter(0, DataType="uint8")
i_line_frontpoint_cnt_before_PAR = Simulink.Parameter(0, DataType="uint8")
i_line_rearpoint_cnt_PAR = Simulink.Parameter(0, DataType="uint8")
i_line_rearpoint_cnt_before_PAR = Simulink.Parameter(0, DataType="uint8")

EHRV3_POSITION_OUT_BUS = Simulink.Bus(HeaderFile="Rte_Type.h")
  st_rela_position: Bus: EHRV3_RELA_POSITION_BUS  % 自定位信息
  st_abs_position: Bus: EHRV3_ABS_POSITION_BUS  % 绝对定位信息
  st_geofence: Bus: EHRV3_GEOFENCE_BUS  % 地理围栏（ODD）信息
  st_postion: Bus: EHRV3_POSTION_BUS  % V3定位信息

EHRV3_RELA_POSITION_BUS = Simulink.Bus(HeaderFile="Rte_Type.h")
  f_dis_left: single
  f_dis_right: single
  f_head_left: single
  f_head_right: single
  i_con_loc_lat: uint8
  i_con_loc_lon: uint8
  i_con_heading_left: uint8
  i_con_heading_right: uint8
  i_con_loc_lane: uint8

EHRV3_WGS84_VAL = struct(f_point_x=single(0), f_point_y=single(0))
EHRV3_WGS84_PAR = AUTOSAR4.Parameter(struct(f_point_x=single(0), f_point_y=single(0)), SwCalibrationAccess="ReadWrite", StorageClass="Global", DataType="Bus:EHRV3_WGS84_BUS")

EHRV3_WGS84_BUS = Simulink.Bus(HeaderFile="Rte_Type.h")
  f_point_x: single  % x坐标
  f_point_y: single  % y坐标

EHRV3_LANES_INFO_BUS = Simulink.Bus(HeaderFile="Rte_Type.h")
  en_road_class: uint8  % 道路等级
  en_road_type: uint8  % 道路类型
  i_ego_lane_number: uint8  % 本车所在车道编号，从左往右
  i_total_lane_number: uint8  % 当前路段车道总数
  b_tunnel: uint8  % 当前是否在隧道
  st_lane_info: Bus: EHRV3_LANE_INFO_BUS[3]  % 左中右车道属性信息
  i_spd_limit_change: uint8
  f_spd_limit_change_dis: single
  b_has_emergency: uint8

EHRV3_LANE_INFO_BUS = Simulink.Bus(HeaderFile="Rte_Type.h")
  en_lane_direction: uint8  % 车道方向
  en_transition_type: uint8  % 车道过度类型（未知、正常、消失、分裂、其他）
  en_lane_type: uint32  % 车道类型
  b_lane_valid: uint8  % 车道是否有效
  f_lane_width_start: single  % 车道起点宽度
  f_lane_width_end: single  % 车道终点宽度
  i_spd_limit: uint8  % 车道限速（高德始终为默认值0）
  vanish_valid: uint8
  vanish_pt_dis: single

EHRV3_LANE_INFO_PAR = AUTOSAR4.Parameter(struct(
  en_lane_direction=uint8(0),
  en_transition_type=uint8(0),
  en_lane_type=uint32(0),
  b_lane_valid=uint8(0),
  f_lane_width_start=single(0),
  f_lane_width_end=single(0),
  i_spd_limit=uint8(0),
  vanish_valid=uint8(0),
  vanish_pt_dis=single(0)), SwCalibrationAccess="ReadWrite", StorageClass="Global", DataType="Bus:EHRV3_LANE_INFO_BUS")

EHRV3_LANE_INFO_VAL = struct(
  en_lane_direction=uint8(0),
  en_transition_type=uint8(0),
  en_lane_type=uint32(0),
  b_lane_valid=uint8(0),
  f_lane_width_start=single(0),
  f_lane_width_end=single(0),
  i_spd_limit=uint8(0),
  vanish_valid=uint8(0),
  vanish_pt_dis=single(0))

EHRV3_RELA_POSITION_PAR = AUTOSAR4.Parameter(struct(
  f_dis_left=single(0),
  f_dis_right=single(0),
  f_head_left=single(0),
  f_head_right=single(0),
  i_con_loc_lat=uint8(0),
  i_con_loc_lon=uint8(0),
  i_con_heading_left=uint8(0),
  i_con_heading_right=uint8(0),
  i_con_loc_lane=uint8(0)), SwCalibrationAccess="ReadWrite", StorageClass="Global", DataType="Bus:EHRV3_RELA_POSITION_BUS")

EHRV3_RELA_POSITION_VAL = struct(
  f_dis_left=single(0),
  f_dis_right=single(0),
  f_head_left=single(0),
  f_head_right=single(0),
  i_con_loc_lat=uint8(0),
  i_con_loc_lon=uint8(0),
  i_con_heading_left=uint8(0),
  i_con_heading_right=uint8(0),
  i_con_loc_lane=uint8(0))

i_spd_limit_change_PAR = Simulink.Parameter(0, DataType="uint8")
f_spd_limit_change_dis_PAR = Simulink.Parameter(0, DataType="single")
b_has_emergency_PAR = Simulink.Parameter(0, DataType="single")
en_road_class_PAR = Simulink.Parameter(0, DataType="uint8")
en_road_type_PAR = Simulink.Parameter(0, DataType="uint8")
i_ego_lane_number_PAR = Simulink.Parameter(0, DataType="uint8")
i_total_lane_number_PAR = Simulink.Parameter(0, DataType="uint8")
b_tunnel_PAR = Simulink.Parameter(0, DataType="uint8")
b_is_available_PAR = Simulink.Parameter(0, DataType="uint8")
i_direct_PAR = Simulink.Parameter(0, DataType="uint8")
f_start_dashed_distance_PAR = Simulink.Parameter(0, DataType="single")
f_end_dashed_distance_PAR = Simulink.Parameter(0, DataType="single")
P_EHRV3_OC_SWT = Simulink.Parameter(0, DataType="uint8")

EHRV3_GLOBAL_DATA_BUS = Simulink.Bus(HeaderFile="Rte_Type.h")
  i_prot_0: uint8  % 类型编号
  b_proa_0: uint8  % 可用性
  i_driv_side: uint8  % 行驶习惯
  i_prot_1: uint8
  b_proa_1: uint8
  i_country_code: uint32  % 国家代码，中国156
  i_prot_2: uint8
  b_proa_2: uint8
  i_unit_system: uint8  % 单位系统
  i_prot_3: uint8
  b_proa_3: uint8
  i_ver_protocol: uint32  % 协议版本
  i_prot_4: uint8
  b_proa_4: uint8
  i_version_hw: uint32  % 硬件版本
  i_prot_5: uint8
  b_proa_5: uint8
  i_version_map: uint32  % 地图版本
  i_prot_6: uint8
  b_proa_6: uint8
  i_map_age: uint32  % 地图时间
  i_prot_7: uint8
  b_proa_7: uint8
  i_map_provider: uint32  % 地图供应商，默认为2
  i_prot_8: uint8
  b_proa8: uint8
  i_guidance: uint8  % 含义待定（仅百度可用）
  b_simulating: uint8  % 无用信号
  i_prot_9: uint8
  b_proa9: uint8
  i_region_code: uint8[4]  % 子区域编码（仅高德可用）
  i_prot_10: uint8
  b_proa10: uint8
  i_map_status: uint8  % 地图是否可用（仅高德可用）
  i_prot_11: uint8
  b_proa11: uint8
  i_time_zone_offset: int32  % 时区差异，目前为默认值（仅高德可用）

EHRV3_CURVATURE_BUS = Simulink.Bus(HeaderFile="Rte_Type.h")
  i_curvature_num: uint16  % 曲率点数量
  ai_curvature_offset: single[301]  % 曲率点距离本车的offset，前正后负，单位为m
  af_curvature_radius: single[301]  % 曲率半径，单位为m

EHRV3_CURVATURE_VAL = struct(
  i_curvature_num=uint16(0),
  ai_curvature_offset=single(repmat(0, 1, 301)),
  af_curvature_radius=single(repmat(0, 1, 301)))

EHRV3_CURVATURE_PAR = AUTOSAR4.Parameter(struct(
  i_curvature_num=uint16(0),
  ai_curvature_offset=single(repmat(0, 1, 301)),
  af_curvature_radius=single(repmat(0, 1, 301))), SwCalibrationAccess="ReadWrite", StorageClass="Global", DataType="Bus:EHRV3_CURVATURE_BUS")

EHRV3_GLOBAL_DATA_VAL = struct(
  i_prot_0=uint8(0),
  b_proa_0=uint8(0),
  i_driv_side=uint8(0),
  i_prot_1=uint8(0),
  b_proa_1=uint8(0),
  i_country_code=uint32(0),
  i_prot_2=uint8(0),
  b_proa_2=uint8(0),
  i_unit_system=uint8(0),
  i_prot_3=uint8(0),
  b_proa_3=uint8(0),
  i_ver_protocol=uint32(0),
  i_prot_4=uint8(0),
  b_proa_4=uint8(0),
  i_version_hw=uint32(0),
  i_prot_5=uint8(0),
  b_proa_5=uint8(0),
  i_version_map=uint32(0),
  i_prot_6=uint8(0),
  b_proa_6=uint8(0),
  i_map_age=uint32(0),
  i_prot_7=uint8(0),
  b_proa_7=uint8(0),
  i_map_provider=uint32(0),
  i_prot_8=uint8(0),
  b_proa8=uint8(0),
  i_guidance=uint8(0),
  b_simulating=uint8(0),
  i_prot_9=uint8(0),
  b_proa9=uint8(0),
  i_region_code=uint8([0 0 0 0]),
  i_prot_10=uint8(0),
  b_proa10=uint8(0),
  i_map_status=uint8(0),
  i_prot_11=uint8(0),
  b_proa11=uint8(0),
  i_time_zone_offset=int32(0))

EHRV3_GLOBAL_DATA_PAR = AUTOSAR4.Parameter(struct(
  i_prot_0=uint8(0),
  b_proa_0=uint8(0),
  i_driv_side=uint8(0),
  i_prot_1=uint8(0),
  b_proa_1=uint8(0),
  i_country_code=uint32(0),
  i_prot_2=uint8(0),
  b_proa_2=uint8(0),
  i_unit_system=uint8(0),
  i_prot_3=uint8(0),
  b_proa_3=uint8(0),
  i_ver_protocol=uint32(0),
  i_prot_4=uint8(0),
  b_proa_4=uint8(0),
  i_version_hw=uint32(0),
  i_prot_5=uint8(0),
  b_proa_5=uint8(0),
  i_version_map=uint32(0),
  i_prot_6=uint8(0),
  b_proa_6=uint8(0),
  i_map_age=uint32(0),
  i_prot_7=uint8(0),
  b_proa_7=uint8(0),
  i_map_provider=uint32(0),
  i_prot_8=uint8(0),
  b_proa8=uint8(0),
  i_guidance=uint8(0),
  b_simulating=uint8(0),
  i_prot_9=uint8(0),
  b_proa9=uint8(0),
  i_region_code=uint8([0 0 0 0]),
  i_prot_10=uint8(0),
  b_proa10=uint8(0),
  i_map_status=uint8(0),
  i_prot_11=uint8(0),
  b_proa11=uint8(0),
  i_time_zone_offset=int32(0)), SwCalibrationAccess="ReadWrite", StorageClass="Global", DataType="Bus:EHRV3_GLOBAL_DATA_BUS")

EHRV3_ABS_POSITION_BUS = Simulink.Bus(HeaderFile="Rte_Type.h")
  f_point_x: single  % 转换后点坐标
  f_point_y: single  % 转换后点坐标
  f_heading: single  % 车辆朝向角（高德该值具体含义待定）
  i_loc_status_lon: uint8
  i_loc_status_lat: uint8
  i_loc_status_heading: uint8
  f_vx: single  % x向速度（目前仅百度可用)
  f_vy: single  % y向速度
  f_vz: single  % z向速度
  f_x_acc: single  % x向加速度
  f_y_acc: single  % y向加速度
  f_z_acc: single  % z向加速度
  f_angular_velocity_x: single  % x向角速度
  f_angular_velocity_y: single  % y向角速度
  f_angular_velocity_z: single  % z向角速度
  i_std_lateral_pos: int32
  i_std_longitudinal_pos: int32

EHRV3_ABS_POSITION_PAR = AUTOSAR4.Parameter(struct(
  f_point_x=single(0),
  f_point_y=single(0),
  f_heading=single(0),
  i_loc_status_lon=uint8(0),
  i_loc_status_lat=uint8(0),
  i_loc_status_heading=uint8(0),
  f_vx=single(0),
  f_vy=single(0),
  f_vz=single(0),
  f_x_acc=single(0),
  f_y_acc=single(0),
  f_z_acc=single(0),
  f_angular_velocity_x=single(0),
  f_angular_velocity_y=single(0),
  f_angular_velocity_z=single(0),
  i_std_lateral_pos=int32(0),
  i_std_longitudinal_pos=int32(0)), SwCalibrationAccess="ReadWrite", StorageClass="Global", DataType="Bus:EHRV3_ABS_POSITION_BUS")

EHRV3_ABS_POSITION_VAL = struct(
  f_point_x=single(0),
  f_point_y=single(0),
  f_heading=single(0),
  i_loc_status_lon=uint8(0),
  i_loc_status_lat=uint8(0),
  i_loc_status_heading=uint8(0),
  f_vx=single(0),
  f_vy=single(0),
  f_vz=single(0),
  f_x_acc=single(0),
  f_y_acc=single(0),
  f_z_acc=single(0),
  f_angular_velocity_x=single(0),
  f_angular_velocity_y=single(0),
  f_angular_velocity_z=single(0),
  i_std_lateral_pos=int32(0),
  i_std_longitudinal_pos=int32(0))

i_guide_line_point_cnt_PAR = Simulink.Parameter(0, DataType="uint16")

EHRV3_NOT_ODD_BUS = Simulink.Bus(HeaderFile="Rte_Type.h")
  f_start_dis: single
  f_end_dis: single
  i_type: uint64

EHRV3_NOT_ODD_ALL_BUS = Simulink.Bus(HeaderFile="Rte_Type.h")
  b_is_in_notODD: uint8
  i_type: uint64
  i_count: uint8
  st_not_odd_vec: Bus: EHRV3_NOT_ODD_BUS[5]

EHRV3_NOT_ODD_VAL = struct(f_start_dis=single(0), f_end_dis=single(0), i_type=uint64(0))
EHRV3_NOT_ODD_PAR = AUTOSAR4.Parameter(struct(f_start_dis=single(0), f_end_dis=single(0), i_type=uint64(0)), SwCalibrationAccess="ReadWrite", StorageClass="Global", DataType="Bus:EHRV3_NOT_ODD_BUS")
b_is_in_notODD_PAR = Simulink.Parameter(0, DataType="uint8")
i_type_PAR = Simulink.Parameter(0, DataType="uint8")
ODD_i_type_PAR = Simulink.Parameter(0, DataType="uint64")
i_count_PAR = Simulink.Parameter(0, DataType="uint8")
Bus = Simulink.Bus()

EHRV3_LINES_BUS = Simulink.Bus(HeaderFile="Rte_Type.h")
  st_lines: Bus: EHRV3_LINE_BUS[11]

EHRV3_LINE_VAL = struct(
  bIsLineExist=uint8(0),
  dQuality=single(0),
  first_C0V=single(0),
  first_C1V=single(0),
  first_C2V=single(0),
  first_C3V=single(0),
  first_DisStart=single(0),
  first_DisEnd=single(0),
  enLineType=uint8(0),
  enColour=uint8(0),
  is_Multi_Clothoid=uint8(0),
  second_C0V=single(0),
  second_C1V=single(0),
  second_C2V=single(0),
  second_C3V=single(0),
  second_DisStart=single(0),
  second_DisEnd=single(0))

EHRV3_LINE_PAR = AUTOSAR4.Parameter(struct(
  bIsLineExist=uint8(0),
  dQuality=single(0),
  first_C0V=single(0),
  first_C1V=single(0),
  first_C2V=single(0),
  first_C3V=single(0),
  first_DisStart=single(0),
  first_DisEnd=single(0),
  enLineType=uint8(0),
  enColour=uint8(0),
  is_Multi_Clothoid=uint8(0),
  second_C0V=single(0),
  second_C1V=single(0),
  second_C2V=single(0),
  second_C3V=single(0),
  second_DisStart=single(0),
  second_DisEnd=single(0)), SwCalibrationAccess="ReadWrite", StorageClass="Global", DataType="Bus:EHRV3_LINE_BUS")

EHRV3_GUIDE_LINE_BUS = Simulink.Bus(HeaderFile="Rte_Type.h")
  b_is_available: uint8  % 是否可用
  i_type: uint8  % 引导线类型
  i_direct: uint8  % 引导线换道方向
  f_start_dashed_distance: single  % 距离虚线起点的距离，单位m，正数代表车辆前方，负数表示在车辆后方
  f_end_dashed_distance: single  % 距离虚线终点的距离，单位m，正数代表车辆前方，负数表示在车辆后方
  i_guide_line_point_cnt: uint16  % 引导线点数
  st_guideline: Bus: EHRV3_LINE_BUS  % 引导线点数组

EHRV3_LINE_BUS = Simulink.Bus(HeaderFile="Rte_Type.h")
  bIsLineExist: uint8
  dQuality: single
  first_C0V: single
  first_C1V: single
  first_C2V: single
  first_C3V: single
  first_DisStart: single
  first_DisEnd: single
  enLineType: uint8
  enColour: uint8
  is_Multi_Clothoid: uint8
  second_C0V: single
  second_C1V: single
  second_C2V: single
  second_C3V: single
  second_DisStart: single
  second_DisEnd: single

EHRV3_INTERSEC_BUS = Simulink.Bus(HeaderFile="Rte_Type.h")
  en_intersec_type: uint8  % 路口类型：未知、分裂、合并
  f_start_distance: single  % 到路口距离
  f_end_distance: single
  i_right_of_way: uint8  % 路权，枚举待定
  b_is_complex: uint8  % 是否为复杂路口，含义待定
  b_is_available: uint8  % 是否可用

EHRV3_HDR_BUS = Simulink.Bus(HeaderFile="Rte_Type.h")
  i_map_data_valid: uint8, Min=0, Max=2  % 地图数据是否有效
  i_timestamp_ms: uint64  % 地图全局信息
  b_on_nav_path: uint8
  i_update_cnt: uint8
  en_sys_status: uint16

EHRV3_HDR_PAR = AUTOSAR4.Parameter(struct(
  i_map_data_valid=uint8(0),
  i_timestamp_ms=uint64(0),
  b_on_nav_path=uint8(0),
  i_update_cnt=uint8(0),
  en_sys_status=uint16(0)), SwCalibrationAccess="ReadWrite", StorageClass="Global", DataType="Bus:EHRV3_HDR_BUS")

EHRV3_HDR_VAL = struct(
  i_map_data_valid=uint8(0),
  i_timestamp_ms=uint64(0),
  b_on_nav_path=uint8(0),
  i_update_cnt=uint8(0),
  en_sys_status=uint16(0))

EHRV3_INTERSEC_PAR = AUTOSAR4.Parameter(struct(
  en_intersec_type=uint8(0),
  f_start_distance=single(0),
  f_end_distance=single(0),
  i_right_of_way=uint8(0),
  b_is_complex=uint8(0),
  b_is_available=uint8(0)), SwCalibrationAccess="ReadWrite", StorageClass="Global", DataType="Bus:EHRV3_INTERSEC_BUS")

EHRV3_INTERSEC_VAL = struct(
  en_intersec_type=uint8(0),
  f_start_distance=single(0),
  f_end_distance=single(0),
  i_right_of_way=uint8(0),
  b_is_complex=uint8(0),
  b_is_available=uint8(0))