% Simulink data dictionary PubIfCommonVIE_RTE.sldd

VIE_VCAN_ESP_BUS = Simulink.Bus(HeaderFile="Rte_Type.h")
  FLWheelSpd: single  % 左前轮速
  FRWheelSpd: single  % 右前轮速
  RLWheelSpd: single  % 左后轮速
  RRWheelSpd: single  % 右后轮速
  FLWheelDriveDirection: uint8  % 左前轮速方向
  FRWheelDriveDirection: uint8  % 右前轮速方向
  RLWheelDriveDirection: uint8  % 左后轮速方向
  RRWheelDriveDirection: uint8  % 右后轮速方向
  VehStandstill: uint8  % 车辆静止

VIE_VCAN_CSA_BUS = Simulink.Bus(HeaderFile="Rte_Type.h")
  SteerWheelAngSign: boolean  % 方向盘转角
  SteerWheelAng: single  % 方向盘转角方向
  SteerWheelSpd: single  % 方向盘转速
  SAS_Sts: uint8  % SAS状态

VIE_VCAN_ABM_BUS = Simulink.Bus(HeaderFile="Rte_Type.h")
  VehLgtAccel: single  % 车辆纵向加速度
  VehYawRate: single  % 车辆横摆角速度