% Simulink data dictionary PubIfControlLATC_RTE.sldd

LATC_VCAN_EPS_BUS = Simulink.Bus(HeaderFile="Rte_Type.h")
  EPS_SteerMod: uint8
  EPS_DrvInpTrqVal_HighReslolution: single
  EPS_LKATorqOvrlDlvd: single  % eps执行扭矩
  EPS_LKATorqOvrlDlvdVld: boolean

LATC_VCAN_CSA_BUS = Simulink.Bus(HeaderFile="Rte_Type.h")
  SteerWheelAng: single
  SteerWheelAngSign: boolean
  SteerWheelSpd: single
  SteerWheelSpdSign: boolean

LATC_L3_BUS = Simulink.Bus(HeaderFile="Rte_Type.h")
  HWP_AngCmdReqVal: single, Min=-780, Max=780
  HWP_AngCmdReqValVld: boolean, Min=0, Max=1
  HWP_ReqCtrlEPS: boolean, Min=0, Max=1
  HWP_ReqCtrlEPSVld: boolean, Min=0, Max=1
  HWP_WorkReq: uint8, Min=0, Max=7
  HWP_WorkReqVld: boolean, Min=0, Max=1
  HWP_FuncTrqCmdReqFlag: uint8, Min=0, Max=7
  HWP_TrqOvlCmdReqValue: single, Min=-10.23, Max=10.24