% Simulink data dictionary PubIfControlLONC_RTE.sldd

LONC_VCAN_ESP_BUS = Simulink.Bus(HeaderFile="Rte_Type.h")
  NoBrkForce: boolean
  VehStandstill: uint8

LONC_VCAN_DCT_BUS = Simulink.Bus(HeaderFile="Rte_Type.h")
  CURRENT_GEAR: uint8
  SHIFT_IN_PROGRESS: boolean

LONC_VCAN_ECM_BUS = Simulink.Bus(HeaderFile="Rte_Type.h")
  NetEngTrq: single
  MaxEngTrqNorm: uint16
  EngTrqMinAct: single
  EngTrqMaxActSpd: single
  EngSpd: single

LONC_CTRL_OUT_BUS = Simulink.Bus(HeaderFile="Rte_Type.h")
  Longctrl_EngTrqReq: single, Min=-100, Max=100  % 扭矩请求值
  Longctrl_EngTrqReqActive: boolean, Min=0, Max=1  % 扭矩请求标志位
  Longctrl_Decel_Req: boolean, Min=0, Max=1  % 减速请求标志位
  Longctrl_Decel_ReqValue: single, Min=-7, Max=5.75  % 减速度请求值

LONC_VCAN_HCU_BUS = Simulink.Bus(HeaderFile="Rte_Type.h")
  HCU_DrvMod: uint8, Min=0, Max=15  % 0x0:Auto/Normal Mode started
    % 0x1:EV Mode started
    % 0x2:Save Mode started
    % 0x3:SPORT Mode started
    % 0x4:AWD Normal Mode started
    % 0x5:Snow Mode started
    % 0x6:Muddy Mode started
    % 0x7:Sand Mode started
    % 0x8:ECO
    % 0x9-0xF:Reserved
  HCU_PTDrvMod: uint8, Min=0, Max=7  % 0x0:No propel torque
    % 0x1:H-FWD (发动机+P2，或发动机)
    % 0x2:E-FWD（纯电即P2）
    % 0x3:RWD （纯电即P4）
    % 0x4:H-AWD（混动四驱即发动机+P4，或P2+发动机+P4）
    % 0x5:E-AWD（纯电四驱，即P2+P4）
    % 0x6-0x7:Reserved
  ActWheelTrqDmd: int16, Min=-6000, Max=14475  % 0x000~0xFFF:Valid values
  MaxPsblWheelTrq: int16, Min=-6000, Max=14460  % 0x000~0x3FF:Vaild value
  TotWheelTrq: int16, Min=-6000, Max=14475  % 0x000~0xFFF:Vaild value
  MinPsblWheelTrq: int16, Min=-6000, Max=14460  % 0x000~0x3FF:Vaild value
  ACU_ShiftInProgress: uint8, Min=0, Max=3  % 0x0:Not in progress
    % 0x1:In progress
    % 0x2:Reserved
    % 0x3:Invalid

LONC_Hybrid_CTRL_OUT_BUS = Simulink.Bus(HeaderFile="Rte_Type.h")
  Longctrl_HCUTrqReq: single, Min=-16384, Max=16383.5  % 0x0000-0xFFFF:Valid value
  Longctrl_HCUTrqReqActive: boolean, Min=0, Max=1  % 0x0:Not active
    % 0x1:Active