% Simulink data dictionary PubIfDecisionLM_RTE.sldd

LM_VCAN_ESP_BUS = Simulink.Bus(HeaderFile="Rte_Type.h")
  FLWheelSpd: single  % 左前轮速
  FRWheelSpd: single  % 右前轮速
  RLWheelSpd: single  % 左后轮速
  RRWheelSpd: single  % 右后轮速
  FLWheelDriveDirection: uint8  % 左前轮速方向
  FRWheelDriveDirection: uint8  % 右前轮速方向
  RLWheelDriveDirection: uint8  % 左后轮速方向
  RRWheelDriveDirection: uint8  % 右后轮速方向
  VehStandstill: uint8  % 车辆静止

LM_VCAN_CSA_BUS = Simulink.Bus(HeaderFile="Rte_Type.h")
  SteerWheelAngSign: boolean  % 方向盘转角
  SteerWheelAng: single  % 方向盘转角方向
  SteerWheelSpd: single  % 方向盘转速
  SAS_Sts: uint8  % SAS状态
  LTurnLmpSwtSts: boolean  % 左转向灯开关状态
  RTurnLmpSwtSts: boolean  % 右转向灯开关状态

LM_LINE_BUS = Simulink.Bus(HeaderFile="Rte_Type.h")
  LM_Line01: Bus:LM_TRAJINFO_BUS
  LM_Line02: Bus:LM_TRAJINFO_BUS
  LM_Line03: Bus:LM_TRAJINFO_BUS
  LM_Line04: Bus:LM_TRAJINFO_BUS
  LM_Line05: Bus:LM_TRAJINFO_BUS
  LM_Line06: Bus:LM_TRAJINFO_BUS
  LM_Line07: Bus:LM_TRAJINFO_BUS
  LM_Line08: Bus:LM_TRAJINFO_BUS

LM_TRAJINFO_BUS = Simulink.Bus(HeaderFile="Rte_Type.h")
  pC0: single  % 轨迹参数C0
  pC1: single  % 轨迹参数C1
  pC2: single  % 轨迹参数C2
  pC3: single  % 轨迹参数C3
  dDisStart: single  % 轨迹起始点距离
  dDisEnd: single  % 轨迹终点距离
  dQuality: single  % 轨迹质量
  fCamValid: uint8  % 摄像头是否可用

LM_FUS_RATIO_BUS = Simulink.Bus(HeaderFile="Rte_Type.h")
  LM_VSL_01_Fus_Ratio: single
  LM_VSL_02_Fus_Ratio: single
  LM_VSL_03_Fus_Ratio: single
  LM_EML_01_Fus_Ratio: single
  LM_EML_02_Fus_Ratio: single
  LM_EML_03_Fus_Ratio: single
  LM_OTL_01_Fus_Ratio: single
  LM_OTL_02_Fus_Ratio: single
  LM_OTL_03_Fus_Ratio: single
  LM_MAL_01_Fus_Ratio: single
  LM_MAL_02_Fus_Ratio: single
  LM_MAL_03_Fus_Ratio: single
  LM_REL_01_Fus_Ratio: single
  LM_REL_02_Fus_Ratio: single
  LM_REL_03_Fus_Ratio: single