% Simulink data dictionary PubIfDecisionPLAN_RTE.sldd

PLAN_VCAN_ESP_BUS = Simulink.Bus(HeaderFile="Rte_Type.h")
  VehSpd: single  % 车速
  DrivingModDis: uint8  % 驾驶模式

PLAN_DPC_ESS_BUS = Simulink.Bus(HeaderFile="Rte_Type.h")
  PLAN_DPC_ESS_DangerPlaus_L: single
  PLAN_DPC_ESS_DangerPlaus_R: single
  PLAN_DPC_ESS_L_Oncoming_flag: boolean  % 0x0 Left Oncoming Not Exist
    % 0x1 Left Oncoming Exist
  PLAN_DPC_ESS_R_Oncoming_flag: boolean  % 0x0 Right Oncoming Not Exist
    % 0x1 Right Oncoming Exist

PLAN_HMI_BUS = Simulink.Bus(HeaderFile="Rte_Type.h")
  tor: boolean
  ACC_TgtObjBarDisp: uint8
  ACC_LeTgtObjBarDisp: uint8
  ACC_RiTgtObjBarDisp: uint8
  IntelligentCurveActive: boolean, Min=0, Max=1  % 0x0:Not active
    % 0x1:Active

PLAN_ACCPLAN_BUS = Simulink.Bus(HeaderFile="Rte_Type.h")
  ACC_axvCvAim: single
  ACC_axv_ComfortBandLowerValue: single
  ACC_axv_ComfortBandUpperValue: single
  ACC_DecelerateJerk: single
  ACC_AccelerateJerk: single
  ACC_BrakePrefer: boolean

PLAN_ALC_DECS_BUS = Simulink.Bus(HeaderFile="Rte_Type.h")
  PLAN_ALC_sts: uint8
  PLAN_ALC_LcDecsLe: uint8
  PLAN_ALC_LcDecsRi: uint8
  PLAN_ALC_TurnLightReq: uint8
  PLAN_ALC_stsReason: uint8
  PLAN_ALC_LcReason: uint8
  PLAN_ALC_LcFeReason: uint16
  PLAN_ALC_LcCancelReason: uint16
  PLAN_ALC_DangerObjIndex: uint32