% Simulink data dictionary PubIfDiagnosticDFIM_RTE.sldd

DFIM_AHBC_STS_BUS = Simulink.Bus(HeaderFile="Rte_Type.h")
  HMA_error: uint8, Min=0, Max=255
  ADB_error: uint8, Min=0, Max=255

DFIM_AEB_STS_BUS = Simulink.Bus(HeaderFile="Rte_Type.h")
  AEB_Error: uint8, Min=0, Max=255
  AEB_Ped_Error: uint8, Min=0, Max=255
  AEB_JA_Error: uint8, Min=0, Max=255

DFIM_VSM_STS_BUS = Simulink.Bus(HeaderFile="Rte_Type.h")
  TJA_ICA_Error: uint8, Min=0, Max=255
  ACC_Error: uint8, Min=0, Max=255
  HWA_Error: uint8, Min=0, Max=255
  LKA_LCK_Error: uint8, Min=0, Max=255
  LDW_Error: uint8, Min=0, Max=255
  ELK_Error: uint8, Min=0, Max=255
  ESS_Error: uint8, Min=0, Max=255
  TSR_Error: uint8, Min=0, Max=255
  ALC_Error: uint8, Min=0, Max=255
  NOA_Error: uint8, Min=0, Max=255
  ID_Error: uint8, Min=0, Max=255