% Simulink data dictionary PubIfDiagnosticDMON_RTE.sldd

DMON_VCAN_ECM_BUS = Simulink.Bus(HeaderFile="Rte_Type.h")
  NetEngTrq: single
  TrqLossVldty: boolean
  DrvEngTrqReqVld: boolean
  EngSpdVldty: uint8
  BrkPedalSts: uint8
  Start_StopSts: uint8
  AccelPedalPosnVldty: uint8
  EngState: uint8
  ECMACCInterface: boolean

DMON_VCAN_DCT_BUS = Simulink.Bus(HeaderFile="Rte_Type.h")
  RatAct: single
  CurrentGearValid: boolean
  TargetGearValid: boolean
  ShiftInPrgValid: boolean
  CURRENT_GEAR: uint8
  TGS_LEVER: uint8
  DrvFaiMsg: uint8

DMON_VCAN_EPS_BUS = Simulink.Bus(HeaderFile="Rte_Type.h")
  EPS_TrqSnsrSts: boolean
  EPS_FailSts: uint8
  EPS_SteerMod: uint8
  EPS_LKATrqOvlDlvdSts: uint8

DMON_VCAN_CSA_BUS = Simulink.Bus(HeaderFile="Rte_Type.h")
  FrntWiprSwtSts: uint8
  SteerWheelAng: single
  SteerWheelSpd: single
  SAS_Sts: uint8
  CC_ACCSwtErr: boolean

DMON_VCAN_ABM_BUS = Simulink.Bus(HeaderFile="Rte_Type.h")
  VehYawRate: single
  VehDynYawRateVld: boolean
  VehLgtAccel: single
  VehLatAccel: single
  VehLatAccelVld: boolean
  VehLgtAccelVld: boolean

DMON_VCAN_HUT_BUS = Simulink.Bus(HeaderFile="Rte_Type.h")
  IFC_SnvtySet: uint8
  LSSWarnFormSwtReq: uint8
  FCW_SnvtySet: uint8
  TSR_SnvtySet: int8
  NavSpdLimValue: uint8
  NavSpdLimUnit_HUT: uint8

DMON_VCAN_IP_BUS = Simulink.Bus(HeaderFile="Rte_Type.h")
  IP_Err: boolean
  IP_ACCErr: boolean

DMON_VCAN_CR_BUS = Simulink.Bus(HeaderFile="Rte_Type.h")
  CR_BrkgReqVal: single
  CR_ErrSts: boolean
  CR_ObjSts_Le: uint8
  CR_ObjMotionType_Le: uint8
  CR_ObjSts_Ri: uint8
  CR_ObjMotionType_Ri: uint8

DMON_VCAN_HC_BUS = Simulink.Bus(HeaderFile="Rte_Type.h")
  LeftLowBeamFailSts: boolean
  RightLowBeamFailSts: boolean
  LeftHighBeamFailSts: boolean
  RightHighBeamFailSts: boolean
  ALS_FailSts: boolean

DMON_VCAN_RSDS_BUS = Simulink.Bus(HeaderFile="Rte_Type.h")
  LeTarSts: uint8
  RiTarSts: uint8

DMON_VCAN_ESP_BUS = Simulink.Bus(HeaderFile="Rte_Type.h")
  FLWheelDriveDirection: uint8
  FRWheelDriveDirection: uint8
  RLWheelDriveDirection: uint8
  RRWheelDriveDirection: uint8
  FLWheelSpdVld: boolean
  FRWheelSpdVld: boolean
  RLWheelSpdVld: boolean
  RRWheelSpdVld: boolean
  VehSpdVld: boolean
  VehSpd: single
  VehStandstill: uint8
  EPBErrSts: uint8
  EPB_SwtPosnVld: boolean
  EPB_SwtPosn: uint8
  EPBSts: uint8
  ESP_MasterCylBrkPressVld: boolean
  ESP_MasterCylBrkPress: single
  HDCCtrl: uint8
  DrivingModDis: uint8
  ABSFailSts: boolean
  ESPFailSts: boolean
  AEBAvailable: boolean
  ABPAvailable: boolean
  ABAavailable: boolean
  AWBAvailable: boolean
  CDDAvailable: boolean
  ESP_DiagActv: uint8

DMON_VCAN_MIX_BUS = Simulink.Bus(HeaderFile="Rte_Type.h")
  APS_WorkSts: uint8
  DMSSts: uint8
  WiprReq_F_PBOX: uint8
  ACAmbTemp: single

DMON_SENS_ERR_BUS = Simulink.Bus(HeaderFile="Rte_Type.h")
  FCam_CalibrationSts: uint8
  FCam_BlockageSts: uint8

DMON_EHR_ERR_BUS = Simulink.Bus(HeaderFile="Rte_Type.h")
  EHR_PosiCycCntFailure: uint8, Min=0, Max=1
  EHR_PosiTimOutFailure: uint8, Min=0, Max=1
  EHR_MetaCycCntFailure: uint8, Min=0, Max=1
  EHR_MetaTimOutFailure: uint8, Min=0, Max=1