% Simulink data dictionary PubIfFusionOFM_RTE.sldd

OFM_OBJ_TYPE_E = enum(DefaultValue="INVALID", AddClassNameToEnumNames=true)
  INVALID = 0  % 目标的类型（行人、小汽车、卡车...）
  UNKNOWN_TYPE = 1  % 目标的类型（行人、小汽车、卡车...）
  CAR = 2  % 目标的类型（行人、小汽车、卡车...）
  TRUCK = 3  % 目标的类型（行人、小汽车、卡车...）
  MOTORBIKE = 4  % 目标的类型（行人、小汽车、卡车...）
  BICYCLE = 5  % 目标的类型（行人、小汽车、卡车...）
  PEDESTRIAN = 6  % 目标的类型（行人、小汽车、卡车...）
  GENERAL_OBJECT = 7  % 目标的类型（行人、小汽车、卡车...）
  ANIMAL = 8  % 目标的类型（行人、小汽车、卡车...）

OFM_OBJ_FUSIONTYPE_E = enum(DefaultValue="INVALID", AddClassNameToEnumNames=true)
  INVALID = 0  % 目标是否是融合,传感器类型，FC代表摄像头；FR代表前雷达；CL代表左角雷达；CR代表右角雷达；BL代表左盲点雷达；BR代表右盲点雷达；
  FC = 1  % 目标是否是融合,传感器类型，FC代表摄像头；FR代表前雷达；CL代表左角雷达；CR代表右角雷达；BL代表左盲点雷达；BR代表右盲点雷达；
  FR = 2  % 目标是否是融合,传感器类型，FC代表摄像头；FR代表前雷达；CL代表左角雷达；CR代表右角雷达；BL代表左盲点雷达；BR代表右盲点雷达；
  FC_FR = 3  % 目标是否是融合,传感器类型，FC代表摄像头；FR代表前雷达；CL代表左角雷达；CR代表右角雷达；BL代表左盲点雷达；BR代表右盲点雷达；
  CL = 4  % 目标是否是融合,传感器类型，FC代表摄像头；FR代表前雷达；CL代表左角雷达；CR代表右角雷达；BL代表左盲点雷达；BR代表右盲点雷达；
  FC_CL = 5  % 目标是否是融合,传感器类型，FC代表摄像头；FR代表前雷达；CL代表左角雷达；CR代表右角雷达；BL代表左盲点雷达；BR代表右盲点雷达；
  FR_CL = 6  % 目标是否是融合,传感器类型，FC代表摄像头；FR代表前雷达；CL代表左角雷达；CR代表右角雷达；BL代表左盲点雷达；BR代表右盲点雷达；
  FC_FR_CL = 7  % 目标是否是融合,传感器类型，FC代表摄像头；FR代表前雷达；CL代表左角雷达；CR代表右角雷达；BL代表左盲点雷达；BR代表右盲点雷达；
  CR = 8  % 目标是否是融合,传感器类型，FC代表摄像头；FR代表前雷达；CL代表左角雷达；CR代表右角雷达；BL代表左盲点雷达；BR代表右盲点雷达；
  FC_CR = 9  % 目标是否是融合,传感器类型，FC代表摄像头；FR代表前雷达；CL代表左角雷达；CR代表右角雷达；BL代表左盲点雷达；BR代表右盲点雷达；
  FR_CR = 10  % 目标是否是融合,传感器类型，FC代表摄像头；FR代表前雷达；CL代表左角雷达；CR代表右角雷达；BL代表左盲点雷达；BR代表右盲点雷达；
  FC_FR_CR = 11  % 目标是否是融合,传感器类型，FC代表摄像头；FR代表前雷达；CL代表左角雷达；CR代表右角雷达；BL代表左盲点雷达；BR代表右盲点雷达；
  CL_CR = 12  % 目标是否是融合,传感器类型，FC代表摄像头；FR代表前雷达；CL代表左角雷达；CR代表右角雷达；BL代表左盲点雷达；BR代表右盲点雷达；
  FC_CL_CR = 13  % 目标是否是融合,传感器类型，FC代表摄像头；FR代表前雷达；CL代表左角雷达；CR代表右角雷达；BL代表左盲点雷达；BR代表右盲点雷达；
  FR_CL_CR = 14  % 目标是否是融合,传感器类型，FC代表摄像头；FR代表前雷达；CL代表左角雷达；CR代表右角雷达；BL代表左盲点雷达；BR代表右盲点雷达；
  FC_FR_CL_CR = 15  % 目标是否是融合,传感器类型，FC代表摄像头；FR代表前雷达；CL代表左角雷达；CR代表右角雷达；BL代表左盲点雷达；BR代表右盲点雷达；
  BL = 16  % 目标是否是融合,传感器类型，FC代表摄像头；FR代表前雷达；CL代表左角雷达；CR代表右角雷达；BL代表左盲点雷达；BR代表右盲点雷达；
  FC_BL = 17  % 目标是否是融合,传感器类型，FC代表摄像头；FR代表前雷达；CL代表左角雷达；CR代表右角雷达；BL代表左盲点雷达；BR代表右盲点雷达；
  FR_BL = 18  % 目标是否是融合,传感器类型，FC代表摄像头；FR代表前雷达；CL代表左角雷达；CR代表右角雷达；BL代表左盲点雷达；BR代表右盲点雷达；
  FC_FR_BL = 19  % 目标是否是融合,传感器类型，FC代表摄像头；FR代表前雷达；CL代表左角雷达；CR代表右角雷达；BL代表左盲点雷达；BR代表右盲点雷达；
  CL_BL = 20  % 目标是否是融合,传感器类型，FC代表摄像头；FR代表前雷达；CL代表左角雷达；CR代表右角雷达；BL代表左盲点雷达；BR代表右盲点雷达；
  FC_CL_BL = 21  % 目标是否是融合,传感器类型，FC代表摄像头；FR代表前雷达；CL代表左角雷达；CR代表右角雷达；BL代表左盲点雷达；BR代表右盲点雷达；
  FR_CL_BL = 22  % 目标是否是融合,传感器类型，FC代表摄像头；FR代表前雷达；CL代表左角雷达；CR代表右角雷达；BL代表左盲点雷达；BR代表右盲点雷达；
  FC_FR_CL_BL = 23  % 目标是否是融合,传感器类型，FC代表摄像头；FR代表前雷达；CL代表左角雷达；CR代表右角雷达；BL代表左盲点雷达；BR代表右盲点雷达；
  CR_BL = 24  % 目标是否是融合,传感器类型，FC代表摄像头；FR代表前雷达；CL代表左角雷达；CR代表右角雷达；BL代表左盲点雷达；BR代表右盲点雷达；
  FC_CR_BL = 25  % 目标是否是融合,传感器类型，FC代表摄像头；FR代表前雷达；CL代表左角雷达；CR代表右角雷达；BL代表左盲点雷达；BR代表右盲点雷达；
  FR_CR_BL = 26  % 目标是否是融合,传感器类型，FC代表摄像头；FR代表前雷达；CL代表左角雷达；CR代表右角雷达；BL代表左盲点雷达；BR代表右盲点雷达；
  FC_FR_CR_BL = 27  % 目标是否是融合,传感器类型，FC代表摄像头；FR代表前雷达；CL代表左角雷达；CR代表右角雷达；BL代表左盲点雷达；BR代表右盲点雷达；
  CL_CR_BL = 28  % 目标是否是融合,传感器类型，FC代表摄像头；FR代表前雷达；CL代表左角雷达；CR代表右角雷达；BL代表左盲点雷达；BR代表右盲点雷达；
  FC_CL_CR_BL = 29  % 目标是否是融合,传感器类型，FC代表摄像头；FR代表前雷达；CL代表左角雷达；CR代表右角雷达；BL代表左盲点雷达；BR代表右盲点雷达；
  FR_CL_CR_BL = 30  % 目标是否是融合,传感器类型，FC代表摄像头；FR代表前雷达；CL代表左角雷达；CR代表右角雷达；BL代表左盲点雷达；BR代表右盲点雷达；
  FC_FR_CL_CR_BL = 31  % 目标是否是融合,传感器类型，FC代表摄像头；FR代表前雷达；CL代表左角雷达；CR代表右角雷达；BL代表左盲点雷达；BR代表右盲点雷达；
  BR = 32  % 目标是否是融合,传感器类型，FC代表摄像头；FR代表前雷达；CL代表左角雷达；CR代表右角雷达；BL代表左盲点雷达；BR代表右盲点雷达；
  FC_BR = 33  % 目标是否是融合,传感器类型，FC代表摄像头；FR代表前雷达；CL代表左角雷达；CR代表右角雷达；BL代表左盲点雷达；BR代表右盲点雷达；
  FR_BR = 34  % 目标是否是融合,传感器类型，FC代表摄像头；FR代表前雷达；CL代表左角雷达；CR代表右角雷达；BL代表左盲点雷达；BR代表右盲点雷达；
  FC_FR_BR = 35  % 目标是否是融合,传感器类型，FC代表摄像头；FR代表前雷达；CL代表左角雷达；CR代表右角雷达；BL代表左盲点雷达；BR代表右盲点雷达；
  CL_BR = 36  % 目标是否是融合,传感器类型，FC代表摄像头；FR代表前雷达；CL代表左角雷达；CR代表右角雷达；BL代表左盲点雷达；BR代表右盲点雷达；
  FC_CL_BR = 37  % 目标是否是融合,传感器类型，FC代表摄像头；FR代表前雷达；CL代表左角雷达；CR代表右角雷达；BL代表左盲点雷达；BR代表右盲点雷达；
  FR_CL_BR = 38  % 目标是否是融合,传感器类型，FC代表摄像头；FR代表前雷达；CL代表左角雷达；CR代表右角雷达；BL代表左盲点雷达；BR代表右盲点雷达；
  FC_FR_CL_BR = 39  % 目标是否是融合,传感器类型，FC代表摄像头；FR代表前雷达；CL代表左角雷达；CR代表右角雷达；BL代表左盲点雷达；BR代表右盲点雷达；
  CR_BR = 40  % 目标是否是融合,传感器类型，FC代表摄像头；FR代表前雷达；CL代表左角雷达；CR代表右角雷达；BL代表左盲点雷达；BR代表右盲点雷达；
  FC_CR_BR = 41  % 目标是否是融合,传感器类型，FC代表摄像头；FR代表前雷达；CL代表左角雷达；CR代表右角雷达；BL代表左盲点雷达；BR代表右盲点雷达；
  FR_CR_BR = 42  % 目标是否是融合,传感器类型，FC代表摄像头；FR代表前雷达；CL代表左角雷达；CR代表右角雷达；BL代表左盲点雷达；BR代表右盲点雷达；
  FC_FR_CR_BR = 43  % 目标是否是融合,传感器类型，FC代表摄像头；FR代表前雷达；CL代表左角雷达；CR代表右角雷达；BL代表左盲点雷达；BR代表右盲点雷达；
  CL_CR_BR = 44  % 目标是否是融合,传感器类型，FC代表摄像头；FR代表前雷达；CL代表左角雷达；CR代表右角雷达；BL代表左盲点雷达；BR代表右盲点雷达；
  FC_CL_CR_BR = 45  % 目标是否是融合,传感器类型，FC代表摄像头；FR代表前雷达；CL代表左角雷达；CR代表右角雷达；BL代表左盲点雷达；BR代表右盲点雷达；
  FR_CL_CR_BR = 46  % 目标是否是融合,传感器类型，FC代表摄像头；FR代表前雷达；CL代表左角雷达；CR代表右角雷达；BL代表左盲点雷达；BR代表右盲点雷达；
  FC_FR_CL_CR_BR = 47  % 目标是否是融合,传感器类型，FC代表摄像头；FR代表前雷达；CL代表左角雷达；CR代表右角雷达；BL代表左盲点雷达；BR代表右盲点雷达；
  BL_BR = 48  % 目标是否是融合,传感器类型，FC代表摄像头；FR代表前雷达；CL代表左角雷达；CR代表右角雷达；BL代表左盲点雷达；BR代表右盲点雷达；
  FC_BL_BR = 49  % 目标是否是融合,传感器类型，FC代表摄像头；FR代表前雷达；CL代表左角雷达；CR代表右角雷达；BL代表左盲点雷达；BR代表右盲点雷达；
  FR_BL_BR = 50  % 目标是否是融合,传感器类型，FC代表摄像头；FR代表前雷达；CL代表左角雷达；CR代表右角雷达；BL代表左盲点雷达；BR代表右盲点雷达；
  FC_FR_BL_BR = 51  % 目标是否是融合,传感器类型，FC代表摄像头；FR代表前雷达；CL代表左角雷达；CR代表右角雷达；BL代表左盲点雷达；BR代表右盲点雷达；
  CL_BL_BR = 52  % 目标是否是融合,传感器类型，FC代表摄像头；FR代表前雷达；CL代表左角雷达；CR代表右角雷达；BL代表左盲点雷达；BR代表右盲点雷达；
  FC_CL_BL_BR = 53  % 目标是否是融合,传感器类型，FC代表摄像头；FR代表前雷达；CL代表左角雷达；CR代表右角雷达；BL代表左盲点雷达；BR代表右盲点雷达；
  FR_CL_BL_BR = 54  % 目标是否是融合,传感器类型，FC代表摄像头；FR代表前雷达；CL代表左角雷达；CR代表右角雷达；BL代表左盲点雷达；BR代表右盲点雷达；
  FC_FR_CL_BL_BR = 55  % 目标是否是融合,传感器类型，FC代表摄像头；FR代表前雷达；CL代表左角雷达；CR代表右角雷达；BL代表左盲点雷达；BR代表右盲点雷达；
  CR_BL_BR = 56  % 目标是否是融合,传感器类型，FC代表摄像头；FR代表前雷达；CL代表左角雷达；CR代表右角雷达；BL代表左盲点雷达；BR代表右盲点雷达；
  FC_CR_BL_BR = 57  % 目标是否是融合,传感器类型，FC代表摄像头；FR代表前雷达；CL代表左角雷达；CR代表右角雷达；BL代表左盲点雷达；BR代表右盲点雷达；
  FR_CR_BL_BR = 58  % 目标是否是融合,传感器类型，FC代表摄像头；FR代表前雷达；CL代表左角雷达；CR代表右角雷达；BL代表左盲点雷达；BR代表右盲点雷达；
  FC_FR_CR_BL_BR = 59  % 目标是否是融合,传感器类型，FC代表摄像头；FR代表前雷达；CL代表左角雷达；CR代表右角雷达；BL代表左盲点雷达；BR代表右盲点雷达；
  CL_CR_BL_BR = 60  % 目标是否是融合,传感器类型，FC代表摄像头；FR代表前雷达；CL代表左角雷达；CR代表右角雷达；BL代表左盲点雷达；BR代表右盲点雷达；
  FC_CL_CR_BL_BR = 61  % 目标是否是融合,传感器类型，FC代表摄像头；FR代表前雷达；CL代表左角雷达；CR代表右角雷达；BL代表左盲点雷达；BR代表右盲点雷达；
  FR_CL_CR_BL_BR = 62  % 目标是否是融合,传感器类型，FC代表摄像头；FR代表前雷达；CL代表左角雷达；CR代表右角雷达；BL代表左盲点雷达；BR代表右盲点雷达；
  FC_FR_CL_CR_BL_BR = 63  % 目标是否是融合,传感器类型，FC代表摄像头；FR代表前雷达；CL代表左角雷达；CR代表右角雷达；BL代表左盲点雷达；BR代表右盲点雷达；

OFM_OBJ_MOVINGSTATE_E = enum(DefaultValue="INVALID", AddClassNameToEnumNames=true)
  INVALID = 0  % 目标的运动状态(静止、运动...)
  UNKNOWN = 1  % 目标的运动状态(静止、运动...)
  MOVING = 2  % 目标的运动状态(静止、运动...)
  STATIONARY = 3  % 目标的运动状态(静止、运动...)
  STOPPED = 4  % 目标的运动状态(静止、运动...)
  MOVING_SLOWLY = 5  % 目标的运动状态(静止、运动...)

OFM_OBJ_ORIENTATION_E = enum(DefaultValue="INVALID", AddClassNameToEnumNames=true)
  INVALID = 0  % 目标的运动方向(同向、对向、横穿...)
  UNKNOWN = 1  % 目标的运动方向(同向、对向、横穿...)
  NORTH_EAST = 2  % 目标的运动方向(同向、对向、横穿...)
  EAST = 3  % 目标的运动方向(同向、对向、横穿...)
  SOUTH_EAST = 4  % 目标的运动方向(同向、对向、横穿...)
  SOUTH = 5  % 目标的运动方向(同向、对向、横穿...)
  SOUTH_WEST = 6  % 目标的运动方向(同向、对向、横穿...)
  WEST = 7  % 目标的运动方向(同向、对向、横穿...)
  NORTH_WEST = 8  % 目标的运动方向(同向、对向、横穿...)
  NORTH = 9  % 目标的运动方向(同向、对向、横穿...)
  CROSS = 16  % 目标的运动方向(同向、对向、横穿...)

OFM_UpdateCnt_PAR = Simulink.Parameter(0, DataType="uint32")

OFM_OBJ_BUS = Simulink.Bus(HeaderFile="Rte_Type.h")
  Object_Fus_Type: uint8[80]  % 目标是否是融合,传感器类型，FC代表摄像头；FR代表前雷达；CL代表左角雷达；CR代表右角雷达；BL代表左盲点雷达；BR代表右盲点雷达；
  Object_ID: uint8[80], Min=1, Max=80  % 融合追踪处理后，目标的ID
  Object_Type: uint8[80]  % 目标的类型（行人、小汽车、卡车...）
  Object_Length: single[80], Min=1.2, Max=21, Unit="m"  % 目标的长度
  Object_Width: single[80], Min=0.04, Max=2.98, Unit="m"  % 目标的宽度
  Object_Hight: single[80], Min=0.01, Max=2.95, Unit="m"  % 目标的高度
  Object_HeadingAngle: single[80], Min=-180, Max=180, Unit="deg"  % 车体系下, 目标航向角
  Object_YawAngle: single[80], Min=-180, Max=180, Unit="deg"  % 车体系下, 目标的方位角
  Object_MovingState: uint8[80]  % 目标的运动状态(静止、运动...)
  Object_Orientation: uint8[80]  % 目标的运动方向(同向、对向、横穿...)
  Object_DX: single[80], Min=-80, Max=200, Unit="m"  % 车体坐标系下，自车和目标纵向相对距离
  Object_DY: single[80], Min=-100, Max=100, Unit="m"  % 车体坐标系下，自车和目标横向相对距离
  Object_VX: single[80], Min=-120, Max=130, Unit="m/s"  % 目标的  纵向的  速度
  Object_VY: single[80], Min=-50, Max=50, Unit="m/s"  % 目标的  横向的  速度
  Object_Std_AX: single[80], Min=0, Max=7.3  % 目标的  纵向的  加速度的方差
  Object_Std_AY: single[80], Min=0, Max=7.3  % 目标的  横向的  加速度的方差
  Object_Std_DX: single[80], Min=0, Max=250  % 目标的  纵向的  距离的方差
  Object_Std_DY: single[80], Min=0, Max=100  % 目标的  横向的  距离的方差
  Object_Std_VX: single[80], Min=0, Max=130  % 目标的  纵向的  速度的方差
  Object_Std_VY: single[80], Min=0, Max=50  % 目标的  横向的  速度的方差
  Object_AX: single[80], Min=-10.3, Max=7.3, Unit="m/s^2"  % 目标的  纵向的  加速度
  Object_AY: single[80], Min=-10.3, Max=7.3, Unit="m/s^2"  % 目标的  横向的  加速度
  Object_Std_Length: single[80], Min=0, Max=10  % 目标长度的方差
  Object_Std_Width: single[80], Min=0, Max=2  % 目标宽度的方差
  Object_Std_HeadingAngle: single[80], Min=0, Max=3.14  % 目标的航向角的方差
  Object_Type_Prob: single[80], Min=0, Max=1  % 目标对应类型的概率值
  Object_ExistProb: single[80], Min=0, Max=1  % 目标存在的概率值
  Object_ObstacleProb: single[80], Min=0, Max=1  % 目标成为障碍物的概率值
  Object_Age: uint16[80], Min=0, Max=65535  % 目标存在生命周期
  Object_State: uint8[80]  % 前摄像头传感目标ID
  FR_ObjectID: uint8[80], Min=0, Max=255  % 前摄像头传感目标类型
  FR_ObjectType: uint8[80], Min=0, Max=15  % 前摄像头传感目标运动状态
  FR_ObjectMovingState: uint8[80], Min=0, Max=7  % 前摄像头传感目标运动朝向
  FR_ObjectMovingOrientation: uint8[80], Min=0, Max=7  % 前摄像头传感目标纵向距离
  FR_Dx: single[80], Min=0, Max=254.9375, Unit="m"  % 前摄像头传感目标横向距离
  FR_Dy: single[80], Min=-128, Max=127.875, Unit="m"  % 前摄像头传感目标纵向速度
  FR_Vx: single[80], Min=-128, Max=126.9976, Unit="m/s"  % 前摄像头传感目标横向速度
  FR_Vy: single[80], Min=-128, Max=126.9976, Unit="m/s"  % 前雷达传感目标ID
  FC_ObjectID: uint8[80], Min=0, Max=255  % 前雷达传感目标类型
  FC_ObjectType: uint8[80], Min=0, Max=8  % 前雷达传感目标运动状态
  FC_ObjectMovingState: uint8[80], Min=0, Max=5  % 前雷达传感目标运动朝向
  FC_ObjectMovingOrientation: uint8[80], Min=0, Max=13  % 前雷达传感目标纵向距离
  FC_Dx: single[80], Min=-200, Max=250, Unit="m"  % 前雷达传感目标横向距离
  FC_Dy: single[80], Min=-100, Max=100, Unit="m"  % 前雷达传感目标纵向速度
  FC_Vx: single[80], Min=-120, Max=130, Unit="m/s"  % 前雷达传感目标横向速度
  FC_Vy: single[80], Min=-50, Max=50, Unit="m/s"

OFM_OBJS_VAL = struct(
  Object_Fus_Type=uint8(repmat(0, 1, 80)),
  Object_ID=uint8(repmat(1, 1, 80)),
  Object_Type=uint8(repmat(0, 1, 80)),
  Object_Length=single(repmat(1.2, 1, 80)),
  Object_Width=single(repmat(0.04, 1, 80)),
  Object_Hight=single(repmat(0.01, 1, 80)),
  Object_HeadingAngle=single(repmat(-180, 1, 80)),
  Object_YawAngle=single(repmat(-180, 1, 80)),
  Object_MovingState=uint8(repmat(0, 1, 80)),
  Object_Orientation=uint8(repmat(0, 1, 80)),
  Object_DX=single(repmat(-80, 1, 80)),
  Object_DY=single(repmat(-100, 1, 80)),
  Object_VX=single(repmat(-120, 1, 80)),
  Object_VY=single(repmat(-50, 1, 80)),
  Object_Std_AX=single(repmat(0, 1, 80)),
  Object_Std_AY=single(repmat(0, 1, 80)),
  Object_Std_DX=single(repmat(0, 1, 80)),
  Object_Std_DY=single(repmat(0, 1, 80)),
  Object_Std_VX=single(repmat(0, 1, 80)),
  Object_Std_VY=single(repmat(0, 1, 80)),
  Object_AX=single(repmat(-10.3, 1, 80)),
  Object_AY=single(repmat(-10.3, 1, 80)),
  Object_Std_Length=single(repmat(0, 1, 80)),
  Object_Std_Width=single(repmat(0, 1, 80)),
  Object_Std_HeadingAngle=single(repmat(0, 1, 80)),
  Object_Type_Prob=single(repmat(0, 1, 80)),
  Object_ExistProb=single(repmat(0, 1, 80)),
  Object_ObstacleProb=single(repmat(0, 1, 80)),
  Object_Age=uint16(repmat(0, 1, 80)),
  Object_State=uint8(repmat(0, 1, 80)),
  FR_ObjectID=uint8(repmat(0, 1, 80)),
  FR_ObjectType=uint8(repmat(0, 1, 80)),
  FR_ObjectMovingState=uint8(repmat(0, 1, 80)),
  FR_ObjectMovingOrientation=uint8(repmat(0, 1, 80)),
  FR_Dx=single(repmat(0, 1, 80)),
  FR_Dy=single(repmat(-128, 1, 80)),
  FR_Vx=single(repmat(-128, 1, 80)),
  FR_Vy=single(repmat(-128, 1, 80)),
  FC_ObjectID=uint8(repmat(0, 1, 80)),
  FC_ObjectType=uint8(repmat(0, 1, 80)),
  FC_ObjectMovingState=uint8(repmat(0, 1, 80)),
  FC_ObjectMovingOrientation=uint8(repmat(0, 1, 80)),
  FC_Dx=single(repmat(-200, 1, 80)),
  FC_Dy=single(repmat(-100, 1, 80)),
  FC_Vx=single(repmat(-120, 1, 80)),
  FC_Vy=single(repmat(-50, 1, 80)))

OFM_OBJS_PAR = AUTOSAR4.Parameter(struct(
  Object_Fus_Type=uint8(repmat(0, 1, 80)),
  Object_ID=uint8(repmat(1, 1, 80)),
  Object_Type=uint8(repmat(0, 1, 80)),
  Object_Length=single(repmat(1.2, 1, 80)),
  Object_Width=single(repmat(0.04, 1, 80)),
  Object_Hight=single(repmat(0.01, 1, 80)),
  Object_HeadingAngle=single(repmat(-180, 1, 80)),
  Object_YawAngle=single(repmat(-180, 1, 80)),
  Object_MovingState=uint8(repmat(0, 1, 80)),
  Object_Orientation=uint8(repmat(0, 1, 80)),
  Object_DX=single(repmat(-80, 1, 80)),
  Object_DY=single(repmat(-100, 1, 80)),
  Object_VX=single(repmat(-120, 1, 80)),
  Object_VY=single(repmat(-50, 1, 80)),
  Object_Std_AX=single(repmat(0, 1, 80)),
  Object_Std_AY=single(repmat(0, 1, 80)),
  Object_Std_DX=single(repmat(0, 1, 80)),
  Object_Std_DY=single(repmat(0, 1, 80)),
  Object_Std_VX=single(repmat(0, 1, 80)),
  Object_Std_VY=single(repmat(0, 1, 80)),
  Object_AX=single(repmat(-10.3, 1, 80)),
  Object_AY=single(repmat(-10.3, 1, 80)),
  Object_Std_Length=single(repmat(0, 1, 80)),
  Object_Std_Width=single(repmat(0, 1, 80)),
  Object_Std_HeadingAngle=single(repmat(0, 1, 80)),
  Object_Type_Prob=single(repmat(0, 1, 80)),
  Object_ExistProb=single(repmat(0, 1, 80)),
  Object_ObstacleProb=single(repmat(0, 1, 80)),
  Object_Age=uint16(repmat(0, 1, 80)),
  Object_State=uint8(repmat(0, 1, 80)),
  FR_ObjectID=uint8(repmat(0, 1, 80)),
  FR_ObjectType=uint8(repmat(0, 1, 80)),
  FR_ObjectMovingState=uint8(repmat(0, 1, 80)),
  FR_ObjectMovingOrientation=uint8(repmat(0, 1, 80)),
  FR_Dx=single(repmat(0, 1, 80)),
  FR_Dy=single(repmat(-128, 1, 80)),
  FR_Vx=single(repmat(-128, 1, 80)),
  FR_Vy=single(repmat(-128, 1, 80)),
  FC_ObjectID=uint8(repmat(0, 1, 80)),
  FC_ObjectType=uint8(repmat(0, 1, 80)),
  FC_ObjectMovingState=uint8(repmat(0, 1, 80)),
  FC_ObjectMovingOrientation=uint8(repmat(0, 1, 80)),
  FC_Dx=single(repmat(-200, 1, 80)),
  FC_Dy=single(repmat(-100, 1, 80)),
  FC_Vx=single(repmat(-120, 1, 80)),
  FC_Vy=single(repmat(-50, 1, 80))), SwCalibrationAccess="ReadWrite", StorageClass="Global", DataType="Bus:OFM_OBJ_BUS")