% Simulink data dictionary PubIfFusionRFM_RTE.sldd

RFM_TSR_FUSIONSTS_E = enum(HeaderFile="Rte_Type.h", AddClassNameToEnumNames=true)
  UNKNOWN = 0  % 融合状态（故障，融合，仅视觉，仅导航）
  FUSION = 1  % 融合状态（故障，融合，仅视觉，仅导航）
  VISION = 2  % 融合状态（故障，融合，仅视觉，仅导航）
  HUT = 3  % 融合状态（故障，融合，仅视觉，仅导航）
  FAILURE = 4  % 融合状态（故障，融合，仅视觉，仅导航）

RFM_NAV_ROADTYPE_E = enum(HeaderFile="Rte_Type.h", AddClassNameToEnumNames=true)
  UNKNOWN = 0  % 指示导航检测到的车辆当前行驶位置的行驶类型(HUT)
  EXPRESSWAY = 1  % 指示导航检测到的车辆当前行驶位置的行驶类型(HUT)
  CITY_EXPRESSWAY = 2  % 指示导航检测到的车辆当前行驶位置的行驶类型(HUT)
  NATIONAL_ROAD = 3  % 指示导航检测到的车辆当前行驶位置的行驶类型(HUT)
  PROVINCIAL_ROAD = 4  % 指示导航检测到的车辆当前行驶位置的行驶类型(HUT)
  COUNTRY_ROAD = 5  % 指示导航检测到的车辆当前行驶位置的行驶类型(HUT)
  CITY_OR_VILLAGE_ROAD = 6  % 指示导航检测到的车辆当前行驶位置的行驶类型(HUT)
  RAMP = 7  % 指示导航检测到的车辆当前行驶位置的行驶类型(HUT)
  TUNNEL = 8  % 指示导航检测到的车辆当前行驶位置的行驶类型(HUT)
  SIDE_ROAD = 9  % 指示导航检测到的车辆当前行驶位置的行驶类型(HUT)
  CHANNEL = 10  % 指示导航检测到的车辆当前行驶位置的行驶类型(HUT)
  RESERVED = 0  % 指示导航检测到的车辆当前行驶位置的行驶类型(HUT)

RFM_NAV_SPLTYPE_E = enum(HeaderFile="Rte_Type.h", AddClassNameToEnumNames=true)
  UNKNOWN = 0  % 限速类型
  TRAFFIC_SIGN = 1  % 限速类型
  ELECTRONIC_EYE = 2  % 限速类型
  ROAD_DEFAULT = 3  % 限速类型

RFM_NAV_SPLUNIT_E = enum(HeaderFile="Rte_Type.h", AddClassNameToEnumNames=true)
  KMH = 0  % 指示当前限速单位
  MPH = 1  % 指示当前限速单位
  UNKNOWN = 2  % 指示当前限速单位
  RESERVED = 3  % 指示当前限速单位

RFM_LANECHANGE_DIR_E = enum(HeaderFile="Rte_Type.h", AddClassNameToEnumNames=true)
  INVALID = 0  % 指示是否发生变道以及变道向哪个方向
  LEFT = 1  % 指示是否发生变道以及变道向哪个方向
  RIGHT = 2  % 指示是否发生变道以及变道向哪个方向

RFM_LANE_BUS = Simulink.Bus(HeaderFile="Rte_Type.h")
  b_is_avalible: uint8, Min=0, Max=1  % 车道是否可用
    % 0：不可用
    % 1：可用
    % （与b_free相同，后续或删除）
  en_lane_type: uint8, Min=0, Max=14  % 车道类型（目前只有0、1、2、3、5）：
    % 0：Unknown
    % 1：Normal
    % 2：Exit
    % 3：Entry :
    % 4： Auxiliary
    % 5： Emergency
    % 6：RestrictedForbidden
    % 7： RestrictedUsable
    % 8：HOV
    % 9：Express
    % 10：Reversible
    % 11：Slow
    % 12： DrivableShoulder
    % 13：TurnOrSuicide
  i_speed_max: uint8, Min=0, Max=255  % 当前限速(KMPH)
  f_spd_change_dis: single, Min=0, Max=2000  % 前方限速变化距离
  i_change_spd_max: uint8, Min=0, Max=255  % 限速变化后的值
  f_width: single, Min=0  % 车道宽度
  b_vanish_valid: uint8  % 是否为消失车道
    % 0：不是
    % 1：是
  f_vanish_pt_dis: single  % 到消失点的距离

RFM_BRANCH_BUS = Simulink.Bus(HeaderFile="Rte_Type.h")
  b_available: uint8  % 距离路口一定距离（暂定200m）时给出true
  f_turning_angle: single  % 道路分支相比主路的夹角，（暂不确定能否给出）
  en_RoadClass: uint8

RFM_REC_LANES_BUS = Simulink.Bus(HeaderFile="Rte_Type.h")
  i_rec_lanes_num: uint8, Min=0, Max=255  % 推荐行驶车道处车道总数
  i_rec_lanes: uint8[8], Min=0, Max=255  % 推荐行驶车道数组（最多8个元素）

RFM_LINE_TYPE_E = enum(HeaderFile="Rte_Type.h", AddClassNameToEnumNames=true)
  UNDECIDED = 0  % 车道线线型 （普通、实线、虚线、路牙...）
  SOLID = 1  % 车道线线型 （普通、实线、虚线、路牙...）
  DASHED = 2  % 车道线线型 （普通、实线、虚线、路牙...）
  DOUBLE_SOLID_DASHED = 3  % 车道线线型 （普通、实线、虚线、路牙...）
  DOUBLE_DASHED_SOLID = 4  % 车道线线型 （普通、实线、虚线、路牙...）
  DOUBLE_SOLID_SOLID = 5  % 车道线线型 （普通、实线、虚线、路牙...）
  DOUBLE_DASHED_DASHED = 6  % 车道线线型 （普通、实线、虚线、路牙...）
  BOTTS = 7  % 车道线线型 （普通、实线、虚线、路牙...）
  DECELERATION = 8  % 车道线线型 （普通、实线、虚线、路牙...）
  HOV_LANE = 9  % 车道线线型 （普通、实线、虚线、路牙...）
  ROAD_EDGE = 10  % 车道线线型 （普通、实线、虚线、路牙...）
  ELEVATED_STRUCTURE = 11  % 车道线线型 （普通、实线、虚线、路牙...）
  LCURB = 12  % 车道线线型 （普通、实线、虚线、路牙...）
  CONES_POLES = 13  % 车道线线型 （普通、实线、虚线、路牙...）
  PARKED_CARS = 14  % 车道线线型 （普通、实线、虚线、路牙...）

RFM_LINE_COLOR_E = enum(HeaderFile="Rte_Type.h", AddClassNameToEnumNames=true)
  NONE = 0  % 车道线颜色
  YELLOW = 1  % 车道线颜色
  WHITE = 2  % 车道线颜色
  BLUE = 3  % 车道线颜色
  ORANGE = 4  % 车道线颜色

RFM_LINE_BUS = Simulink.Bus(HeaderFile="Rte_Type.h")
  bIsLineExist: uint8  % 表示车道线有无，2为有，1为无
  dC0V: single, Min=-30, Max=30  % 车辆坐标系下，车道线参数C0
  dC1V: single, Min=-2, Max=2  % 车辆坐标系下，车道线参数C1
  dC2V: single, Min=-0.125, Max=0.125  % 车辆坐标系下，车道线参数C2
  dC3V: single, Min=-0.004, Max=0.004  % 车辆坐标系下，车道线参数C3
  dLaneWidth: single, Min=0, Max=0.7  % 车道线宽度
  eLineType: uint8  % 车道线线型 （普通、实线、虚线、路牙...）
  dDisStart: single, Min=0, Max=200  % 车道线前方，起点长度
  dDisFront: single, Min=0, Max=200  % 车道线前方，有效长度
  dQuality: single  % 车道线质量信息
  eColour: uint8  % 车道线颜色
  eFuType: uint8, Min=0, Max=4  % 车道线融合状态（无、摄像头、地图、摄像头融合地图、预留）
  nTrackAge: uint8, Min=0, Max=255  % 车道线预测周期数（未预测时为0）

RFM_TSR_VAL = struct(
  FUSSts=uint8(0),
  RFframe_count=uint32(0),
  CtryType=uint8(0),
  RoadType=uint8(0),
  SPL_TypeCurRoad=uint8(0),
  SPL_ValueCurRoad=uint8(0),
  VehToTrafEyeDist=uint16(0),
  SPL_Unit=uint8(0),
  SPL_End=uint8(0),
  SPL_noSupp_Value=uint8(0),
  SPL_whSupp_Value=uint8(0),
  SPL_Sup1_SignName=uint8(0),
  SPL_Sup1_Confidence=single(0),
  SPL_Sup2_SignName=uint8(0),
  SPL_Sup2_Confidence=single(0),
  SPL_noSupp_LongDistance=uint8(0),
  SPL_whSupp_LongDistance=uint8(0),
  SPL_LeftLaneValue=uint8(0),
  SPL_RightLaneValue=uint8(0),
  TSR_ID=uint8(0),
  TS_SignName=uint8(0),
  TS_Confidence=single(0),
  TS_LongDistance=uint8(0),
  VehInLeftmostLane=uint8(0),
  VehInRightmostLane=uint8(0),
  SPL_LaneChanged=uint8(0),
  TSR_Sign_Long_Distance=uint32(0),
  TSR_Sign_Lateral_Distance=single(-32))

RFM_REC_LANES_VAL = struct(i_rec_lanes_num=uint8(0), i_rec_lanes=uint8(repmat(0, 1, 8)))

RFM_LINE_VAL = struct(
  bIsLineExist=uint8(0),
  dC0V=single(-30),
  dC1V=single(-2),
  dC2V=single(-0.125),
  dC3V=single(-0.004),
  dLaneWidth=single(0),
  eLineType=uint8(0),
  dDisStart=single(0),
  dDisFront=single(0),
  dQuality=single(0),
  eColour=uint8(0),
  eFuType=uint8(0),
  nTrackAge=uint8(0))

RFM_LANE_VAL = struct(
  b_is_avalible=uint8(0),
  en_lane_type=uint8(0),
  i_speed_max=uint8(0),
  f_spd_change_dis=single(0),
  i_change_spd_max=uint8(0),
  f_width=single(0),
  b_vanish_valid=uint8(0),
  f_vanish_pt_dis=single(0))

RFM_BRANCH_VAL = struct(b_available=uint8(0), f_turning_angle=single(0), en_RoadClass=uint8(0))
RFM_UpdateCnt_PAR = Simulink.Parameter(0, DataType="uint32")
RFM_BRANCH_PAR = AUTOSAR4.Parameter(struct(b_available=uint8(0), f_turning_angle=single(0), en_RoadClass=uint8(0)), SwCalibrationAccess="ReadWrite", DataType="Bus:RFM_BRANCH_BUS")

RFM_LANE_PAR = AUTOSAR4.Parameter(struct(
  b_is_avalible=uint8(0),
  en_lane_type=uint8(0),
  i_speed_max=uint8(0),
  f_spd_change_dis=single(0),
  i_change_spd_max=uint8(0),
  f_width=single(0),
  b_vanish_valid=uint8(0),
  f_vanish_pt_dis=single(0)), SwCalibrationAccess="ReadWrite", DataType="Bus:RFM_LANE_BUS")

RFM_LINE_PAR = AUTOSAR4.Parameter(struct(
  bIsLineExist=uint8(0),
  dC0V=single(-30),
  dC1V=single(-2),
  dC2V=single(-0.125),
  dC3V=single(-0.004),
  dLaneWidth=single(0),
  eLineType=uint8(0),
  dDisStart=single(0),
  dDisFront=single(0),
  dQuality=single(0),
  eColour=uint8(0),
  eFuType=uint8(0),
  nTrackAge=uint8(0)), SwCalibrationAccess="ReadWrite", DataType="Bus:RFM_LINE_BUS")

RFM_REC_LANES_PAR = AUTOSAR4.Parameter(struct(i_rec_lanes_num=uint8(0), i_rec_lanes=uint8(repmat(0, 1, 8))), SwCalibrationAccess="ReadWrite", DataType="Bus:RFM_REC_LANES_BUS")

RFM_ROAD_VAL = struct(
  nLaneID=uint8(0),
  nLaneNum=uint8(0),
  dCurrentLaneWidth=single(0),
  dLeftLaneWidth=single(0),
  dRightLaneWidth=single(0),
  bCurrentLaneFree=uint8(0),
  fCurrentLaneFreeDis=single(0),
  bLeftLaneFree=uint8(0),
  fLeftLaneFreeDis=single(0),
  bRightLaneFree=uint8(0),
  fRighLaneFreeDis=single(0),
  b_toll=uint8(0),
  f_toll_distance=single(0),
  b_tunnel=uint8(0),
  f_tunnel_distance=single(0),
  b_bridge=uint8(0),
  f_bridge_distance=single(0),
  b_traffic_jam=uint8(0),
  f_distance_to_jam=single(0),
  b_traffic_accident=uint8(0),
  f_distance_to_accident=single(0),
  en_weather=uint8(0),
  i_mapvalid=uint8(0),
  i_on_nav_path=uint8(0),
  i_road_curvature=single(-1),
  i_road_curvature_far=single(-1),
  i_road_curvature_far_distance=uint16(0),
  i_road_curvature_value_matrix=single(repmat(0, 1, 10)),
  i_road_curvature_distance_matrix=single(repmat(0, 1, 10)),
  i_road_curvature_matrix_size=uint8(0))

RFM_TSR_BUS = Simulink.Bus(HeaderFile="Rte_Type.h")
  FUSSts: uint8, Min=0, Max=4  % 融合状态（故障，融合，仅视觉，仅导航）
  RFframe_count: uint32, Min=0  % 程序运行帧数
  CtryType: uint16, Min=0, Max=255  % 指示车辆当前行驶位置的国家/地区类型（HUT）
  RoadType: uint8, Min=0, Max=15  % 指示导航检测到的车辆当前行驶位置的行驶类型(HUT)
  SPL_TypeCurRoad: uint8, Min=0, Max=3  % 限速类型
  SPL_ValueCurRoad: uint8, Min=0, Max=255  % 限速值
  VehToTrafEyeDist: uint16, Min=0, Max=1000  % 到电子眼限速的距离
  SPL_Unit: uint8, Min=0, Max=3  % 指示当前限速单位
  SPL_End: uint8, Min=0, Max=3  % 结束限速标志
  SPL_noSupp_Value: uint8, Min=0, Max=150  % 指示当前车道的限速值，或者无法区分车道的无补充标志的限速值。
  SPL_whSupp_Value: uint8, Min=0, Max=150  % 条件限速标志的值
  SPL_Sup1_SignName: uint8, Min=0, Max=255  % 条件限速的第一个补充标识类型
  SPL_Sup1_Confidence: single, Min=0, Max=1  % 条件限速的第一个补充标识的可信度
  SPL_Sup2_SignName: uint8, Min=0, Max=255  % 条件限速的第二个补充标识类型
  SPL_Sup2_Confidence: single, Min=0, Max=1  % 条件限速的第二个补充标识的可信度
  SPL_noSupp_LongDistance: uint8, Min=0, Max=255  % 暂不使用
  SPL_whSupp_LongDistance: uint8, Min=0, Max=255  % 暂不使用
  SPL_LeftLaneValue: uint8, Min=0, Max=255  % 指示左侧车道限速值
  SPL_RightLaneValue: uint8, Min=0, Max=255  % 指示右侧车道限速值
  TSR_ID: uint8, Min=0, Max=255  % 暂不使用
  TS_SignName: uint8, Min=0, Max=255  % 识别到的与本车相关的交通标志类型
  TS_Confidence: single, Min=0, Max=1  % 检测到的交通标志的可信度
  TS_LongDistance: uint8, Min=0, Max=255  % 暂不使用
  VehInLeftmostLane: uint8, Min=0, Max=1  % 指示是否在最左侧车道
  VehInRightmostLane: uint8, Min=0, Max=1  % 指示是否在最右侧车道
  SPL_LaneChanged: uint8, Min=0, Max=2  % 指示是否发生变道以及变道向哪个方向
  TSR_Sign_Long_Distance: uint32, Min=0, Max=63  % 限速交通标志距摄像头纵向距离
  TSR_Sign_Lateral_Distance: single, Min=-32, Max=31  % 限速交通标志距摄像头横向距离

RFM_ROAD_BUS = Simulink.Bus(HeaderFile="Rte_Type.h")
  nLaneID: uint8, Min=0  % 自动驾驶车辆所在车道ID（从左往右）
  nLaneNum: uint8, Min=0  % 当前总车道数
  dCurrentLaneWidth: single, Min=0  % 本车道宽度
  dLeftLaneWidth: single, Min=0  % 左侧相邻，车道宽度
  dRightLaneWidth: single, Min=0  % 右侧相邻，车道宽度
  bCurrentLaneFree: uint8, Min=0, Max=1  % 当前车道是否可行驶（freespace 可用）
  fCurrentLaneFreeDis: single, Min=0  % 当前可行驶距离
  bLeftLaneFree: uint8, Min=0, Max=1  % 左侧车道是否可行驶（freespace 可用）
  fLeftLaneFreeDis: single, Min=0  % 左侧可行驶距离
  bRightLaneFree: uint8, Min=0, Max=1  % 右侧车道是否可行驶（freespace 可用）
  fRighLaneFreeDis: single, Min=0  % 右侧可行驶距离
  b_toll: uint8, Min=0, Max=1  % 前方是否有收费站：
    % Unknown：0x0
    % Yes：0x1
    % No：0x2
  f_toll_distance: single, Min=0, Max=2000  % 到收费站距离
  b_tunnel: uint8, Min=0, Max=1  % 车辆是否在隧道：
    % Unknown：0x0
    % Yes：0x1
    % No：0x2
  f_tunnel_distance: single, Min=0, Max=2000  % 到隧道的距离
  b_bridge: uint8, Min=0, Max=1  % 车辆是否在桥梁上：
    % Unknown：0x0
    % Yes：0x1
    % No：0x2
  f_bridge_distance: single, Min=0, Max=2000  % 到桥梁的距离
  b_traffic_jam: uint8, Min=0, Max=1  % 前方是否有交通拥堵：
    % Unknown：0x0
    % Yes：0x1
    % No：0x2
  f_distance_to_jam: single, Min=0, Max=2000  % 到交通拥堵点的距离
  b_traffic_accident: uint8, Min=0, Max=1  % 前方是否发生交通事故：
    % Unknown：0x0
    % Yes：0x1
    % No：0x2
  f_distance_to_accident: single, Min=0, Max=2000  % 到交通事故发生点的距离
  en_weather: uint8, Min=0, Max=127  % 天气情况
  i_mapvalid: uint8, Min=0, Max=3
  i_on_nav_path: uint8, Min=0, Max=2
  i_road_curvature: single, Min=-1, Max=1
  i_road_curvature_far: single, Min=-1, Max=1
  i_road_curvature_far_distance: uint16, Min=0, Max=2001
  i_road_curvature_value_matrix: single[10], Min=0, Max=2001
  i_road_curvature_distance_matrix: uint16[10], Min=0, Max=2001
  i_road_curvature_matrix_size: uint8, Min=0, Max=10

RFM_TSR_PAR = AUTOSAR4.Parameter(struct(
  FUSSts=uint8(0),
  RFframe_count=uint32(0),
  CtryType=uint16(0),
  RoadType=uint8(0),
  SPL_TypeCurRoad=uint8(0),
  SPL_ValueCurRoad=uint8(0),
  VehToTrafEyeDist=uint16(0),
  SPL_Unit=uint8(0),
  SPL_End=uint8(0),
  SPL_noSupp_Value=uint8(0),
  SPL_whSupp_Value=uint8(0),
  SPL_Sup1_SignName=uint8(0),
  SPL_Sup1_Confidence=single(0),
  SPL_Sup2_SignName=uint8(0),
  SPL_Sup2_Confidence=single(0),
  SPL_noSupp_LongDistance=uint8(0),
  SPL_whSupp_LongDistance=uint8(0),
  SPL_LeftLaneValue=uint8(0),
  SPL_RightLaneValue=uint8(0),
  TSR_ID=uint8(0),
  TS_SignName=uint8(0),
  TS_Confidence=single(0),
  TS_LongDistance=uint8(0),
  VehInLeftmostLane=uint8(0),
  VehInRightmostLane=uint8(0),
  SPL_LaneChanged=uint8(0),
  TSR_Sign_Long_Distance=uint32(0),
  TSR_Sign_Lateral_Distance=single(-32)), SwCalibrationAccess="ReadWrite", StorageClass="Global", DataType="Bus:RFM_TSR_BUS")

RFM_ROAD_PAR = AUTOSAR4.Parameter(struct(
  nLaneID=uint8(0),
  nLaneNum=uint8(0),
  dCurrentLaneWidth=single(0),
  dLeftLaneWidth=single(0),
  dRightLaneWidth=single(0),
  bCurrentLaneFree=uint8(0),
  fCurrentLaneFreeDis=single(0),
  bLeftLaneFree=uint8(0),
  fLeftLaneFreeDis=single(0),
  bRightLaneFree=uint8(0),
  fRighLaneFreeDis=single(0),
  b_toll=uint8(0),
  f_toll_distance=single(0),
  b_tunnel=uint8(0),
  f_tunnel_distance=single(0),
  b_bridge=uint8(0),
  f_bridge_distance=single(0),
  b_traffic_jam=uint8(0),
  f_distance_to_jam=single(0),
  b_traffic_accident=uint8(0),
  f_distance_to_accident=single(0),
  en_weather=uint8(0),
  i_mapvalid=uint8(0),
  i_on_nav_path=uint8(0),
  i_road_curvature=single(-1),
  i_road_curvature_far=single(-1),
  i_road_curvature_far_distance=uint16(0),
  i_road_curvature_value_matrix=single(repmat(0, 1, 10)),
  i_road_curvature_distance_matrix=uint16(repmat(0, 1, 10)),
  i_road_curvature_matrix_size=uint8(0)), SwCalibrationAccess="ReadWrite", StorageClass="Global", DataType="Bus:RFM_ROAD_BUS")

RFM_ODD_BUS = Simulink.Bus(HeaderFile="Rte_Type.h")
  b_is_in_notODD: uint8
  i_type: uint64
  i_count: uint8
  st_not_odd_vec: Bus: RFM_NOT_ODD_BUS[5]

RFM_NOT_ODD_VAL = struct(f_start_dis=single(0), f_end_dis=single(0), i_type=uint64(0))
RFM_NOT_ODD_PAR = AUTOSAR4.Parameter(struct(f_start_dis=single(0), f_end_dis=single(0), i_type=uint64(0)), SwCalibrationAccess="ReadWrite", StorageClass="Global", DataType="Bus:RFM_NOT_ODD_BUS")

RFM_NOT_ODD_BUS = Simulink.Bus(HeaderFile="Rte_Type.h")
  f_start_dis: single
  f_end_dis: single
  i_type: uint64

RFM_INTERSEC_ALERT_BUS = Simulink.Bus(HeaderFile="Rte_Type.h")
  b_is_available: uint8, Min=0, Max=1  % 是否可用：
    % 0：否
    % 1：是
    % 前方1000m有路口时给出true
  f_start_distance: single, Min=0, Max=2000  % 到最近路口距离
  f_end_distance: single
  en_direction: uint8, Min=0, Max=1  % 前方最近路口主车通行方向（合流默认为左）：
    % Unknown：0X0
    % 驶出：0x1
    % 驶入：0x2
    % 前方2000m内驶出，当前路口直行：0x3
    % （行驶方向
    % 0x01：右侧，0x02左侧，0x00无效）
    % （方向信息待确认，保持与EHRV2一致）
  en_type: uint8, Min=0, Max=1  % 路口类型：合流分流：
    % 0: STUB_MERGE
    % 1:  STUB_SPLIT,

RFM_INTERSEC_ALERT_VAL = struct(
  b_is_available=uint8(0),
  f_start_distance=single(0),
  f_end_distance=single(0),
  en_direction=uint8(0),
  en_type=uint8(0))

RFM_INTERSEC_ALERT_PAR = AUTOSAR4.Parameter(struct(
  b_is_available=uint8(0),
  f_start_distance=single(0),
  f_end_distance=single(0),
  en_direction=uint8(0),
  en_type=uint8(0)), SwCalibrationAccess="ReadWrite", DataType="Bus:RFM_INTERSEC_ALERT_BUS")