% Simulink data dictionary PubIfSensorCR_V06_RTE.sldd

CR_L_AD1_BUS = Simulink.Bus(HeaderFile="Rte_Type.h")
  Checksum1: uint8, Min=0, Max=255  % Use the checksum strategy from document “End-to-End Communication Protection Specification-V1.8”
  Checksum2: uint8, Min=0, Max=255  % Use the checksum strategy from document “End-to-End Communication Protection Specification-V1.8”
  Checksum3: uint8, Min=0, Max=255  % Use the checksum strategy from document “End-to-End Communication Protection Specification-V1.8”
  Checksum4: uint8, Min=0, Max=255  % Use the checksum strategy from document “End-to-End Communication Protection Specification-V1.8”
  Checksum5: uint8, Min=0, Max=255  % Use the checksum strategy from document “End-to-End Communication Protection Specification-V1.8”
  Checksum6: uint8, Min=0, Max=255  % Use the checksum strategy from document “End-to-End Communication Protection Specification-V1.8”
  Checksum7: uint8, Min=0, Max=255  % Use the checksum strategy from document “End-to-End Communication Protection Specification-V1.8”
  RollingCounter1: uint8, Min=0, Max=15
  RollingCounter2: uint8, Min=0, Max=15
  RollingCounter3: uint8, Min=0, Max=15
  RollingCounter4: uint8, Min=0, Max=15
  RollingCounter5: uint8, Min=0, Max=15
  RollingCounter6: uint8, Min=0, Max=15
  RollingCounter7: uint8, Min=0, Max=15

CR_L_AD2_BUS = Simulink.Bus(HeaderFile="Rte_Type.h")
  Checksum8: uint8, Min=0, Max=255  % Use the checksum strategy from document “End-to-End Communication Protection Specification-V1.8”
  Checksum9: uint8, Min=0, Max=255  % Use the checksum strategy from document “End-to-End Communication Protection Specification-V1.8”
  Checksum10: uint8, Min=0, Max=255  % Use the checksum strategy from document “End-to-End Communication Protection Specification-V1.8”
  Checksum11: uint8, Min=0, Max=255
  Checksum12: uint8, Min=0, Max=255  % Use the checksum strategy from document “End-to-End Communication Protection Specification-V1.8”
  Checksum13: uint8, Min=0, Max=255  % Use the checksum strategy from document “End-to-End Communication Protection Specification-V1.8”
  Checksum14: uint8, Min=0, Max=255  % Use the checksum strategy from document “End-to-End Communication Protection Specification-V1.8”
  RollingCounter8: uint8, Min=0, Max=15
  RollingCounter9: uint8, Min=0, Max=15
  RollingCounter10: uint8, Min=0, Max=15
  RollingCounter11: uint8, Min=0, Max=15
  RollingCounter12: uint8, Min=0, Max=15
  RollingCounter13: uint8, Min=0, Max=15
  RollingCounter14: uint8, Min=0, Max=15

CR_L_AD3_BUS = Simulink.Bus(HeaderFile="Rte_Type.h")
  Checksum15: uint8, Min=0, Max=255  % Use the checksum strategy from document “End-to-End Communication Protection Specification-V1.8”
  Checksum16: uint8, Min=0, Max=255  % Use the checksum strategy from document “End-to-End Communication Protection Specification-V1.8”
  Checksum17: uint8, Min=0, Max=255  % Use the checksum strategy from document “End-to-End Communication Protection Specification-V1.8”
  Checksum18: uint8, Min=0, Max=255
  Checksum19: uint8, Min=0, Max=255  % Use the checksum strategy from document “End-to-End Communication Protection Specification-V1.8”
  Checksum20: uint8, Min=0, Max=255  % Use the checksum strategy from document “End-to-End Communication Protection Specification-V1.8”
  Checksum21: uint8, Min=0, Max=255  % Use the checksum strategy from document “End-to-End Communication Protection Specification-V1.8”
  RollingCounter15: uint8, Min=0, Max=15
  RollingCounter16: uint8, Min=0, Max=15
  RollingCounter17: uint8, Min=0, Max=15
  RollingCounter18: uint8, Min=0, Max=15
  RollingCounter19: uint8, Min=0, Max=15
  RollingCounter20: uint8, Min=0, Max=15
  RollingCounter21: uint8, Min=0, Max=15

CR_DIAG_BUS = Simulink.Bus(HeaderFile="Rte_Type.h")
  MsgErrSts1: uint32
  MsgErrSts2: uint32
  MsgErrSts3: uint32

CR_R_AD1_BUS = Simulink.Bus(HeaderFile="Rte_Type.h")
  Checksum22: uint8, Min=0, Max=255  % Use the checksum strategy from document “End-to-End Communication Protection Specification-V1.8”
  Checksum23: uint8, Min=0, Max=255  % Use the checksum strategy from document “End-to-End Communication Protection Specification-V1.8”
  Checksum24: uint8, Min=0, Max=255  % Use the checksum strategy from document “End-to-End Communication Protection Specification-V1.8”
  Checksum25: uint8, Min=0, Max=255
  Checksum26: uint8, Min=0, Max=255  % Use the checksum strategy from document “End-to-End Communication Protection Specification-V1.8”
  Checksum27: uint8, Min=0, Max=255  % Use the checksum strategy from document “End-to-End Communication Protection Specification-V1.8”
  Checksum28: uint8, Min=0, Max=255  % Use the checksum strategy from document “End-to-End Communication Protection Specification-V1.8”
  RollingCounter22: uint8, Min=0, Max=15
  RollingCounter23: uint8, Min=0, Max=15
  RollingCounter24: uint8, Min=0, Max=15
  RollingCounter25: uint8, Min=0, Max=15
  RollingCounter26: uint8, Min=0, Max=15
  RollingCounter27: uint8, Min=0, Max=15
  RollingCounter28: uint8, Min=0, Max=15

CR_R_AD2_BUS = Simulink.Bus(HeaderFile="Rte_Type.h")
  Checksum29: uint8, Min=0, Max=255  % Use the checksum strategy from document “End-to-End Communication Protection Specification-V1.8”
  Checksum30: uint8, Min=0, Max=255  % Use the checksum strategy from document “End-to-End Communication Protection Specification-V1.8”
  Checksum31: uint8, Min=0, Max=255  % Use the checksum strategy from document “End-to-End Communication Protection Specification-V1.8”
  Checksum32: uint8, Min=0, Max=255
  Checksum33: uint8, Min=0, Max=255  % Use the checksum strategy from document “End-to-End Communication Protection Specification-V1.8”
  Checksum34: uint8, Min=0, Max=255  % Use the checksum strategy from document “End-to-End Communication Protection Specification-V1.8”
  Checksum35: uint8, Min=0, Max=255  % Use the checksum strategy from document “End-to-End Communication Protection Specification-V1.8”
  RollingCounter29: uint8, Min=0, Max=15
  RollingCounter30: uint8, Min=0, Max=15
  RollingCounter31: uint8, Min=0, Max=15
  RollingCounter32: uint8, Min=0, Max=15
  RollingCounter33: uint8, Min=0, Max=15
  RollingCounter34: uint8, Min=0, Max=15
  RollingCounter35: uint8, Min=0, Max=15

CR_R_AD3_BUS = Simulink.Bus(HeaderFile="Rte_Type.h")
  Checksum36: uint8, Min=0, Max=255  % Use the checksum strategy from document “End-to-End Communication Protection Specification-V1.8”
  Checksum37: uint8, Min=0, Max=255  % Use the checksum strategy from document “End-to-End Communication Protection Specification-V1.8”
  Checksum38: uint8, Min=0, Max=255  % Use the checksum strategy from document “End-to-End Communication Protection Specification-V1.8”
  Checksum39: uint8, Min=0, Max=255
  Checksum40: uint8, Min=0, Max=255  % Use the checksum strategy from document “End-to-End Communication Protection Specification-V1.8”
  Checksum41: uint8, Min=0, Max=255  % Use the checksum strategy from document “End-to-End Communication Protection Specification-V1.8”
  Checksum42: uint8, Min=0, Max=255  % Use the checksum strategy from document “End-to-End Communication Protection Specification-V1.8”
  RollingCounter36: uint8, Min=0, Max=15  % Use the checksum strategy from document “End-to-End Communication Protection Specification-V1.8”
  RollingCounter37: uint8, Min=0, Max=15
  RollingCounter38: uint8, Min=0, Max=15
  RollingCounter39: uint8, Min=0, Max=15
  RollingCounter40: uint8, Min=0, Max=15
  RollingCounter41: uint8, Min=0, Max=15
  RollingCounter42: uint8, Min=0, Max=15

CR_DIAG_UPDATE_BUS = Simulink.Bus(HeaderFile="Rte_Type.h")
  CR_BSW_CR_L_AD1_IsUpdated: boolean
  CR_BSW_CR_L_AD2_IsUpdated: boolean
  CR_BSW_CR_L_AD3_IsUpdated: boolean
  CR_BSW_CR_R_AD1_IsUpdated: boolean
  CR_BSW_CR_R_AD2_IsUpdated: boolean
  CR_BSW_CR_R_AD3_IsUpdated: boolean

CR_HDR_BUS = Simulink.Bus(HeaderFile="Rte_Type.h")
  CR_BLIND: uint8, Min=0, Max=3
  CR_hdr_ErrorStatus: uint8, Min=0, Max=15  % Error status of radar
  CR_hdr_TimeStamp: single, Min=0, Max=65536  % Time taken for the object data to be processed (difference between receiving radar reflections, and sending objects on CAN).
  CR_hdr_TimeStampStatus: uint8, Min=0, Max=255
  CR_hdr_AutosarTimeStamp: uint32, Min=0, Max=67108863, Unit="ms"

CR_OBJ_BUS = Simulink.Bus(HeaderFile="Rte_Type.h")
  CR_ObjID: uint8, Min=0, Max=255  % ID is an identifier number that allows for tracking of persistent objects over time.
  CR_ObjExistProb: single, Min=0, Max=1  % The probability of an object to exist in reality.
  CR_ObjObstacleProb: single, Min=0, Max=1  % The probability of an object being an obstacle.
  CR_ObjDistX: single, Min=-128, Max=126.9375, Unit="m"  % Position of target vehicle in x-direction.
  CR_ObjDistY: single, Min=-128, Max=127.875  % Position of target vehicle in y-direction.
  CR_ObjRelVelX: single, Min=-128, Max=126.9976  % Relative target object velocity in x-direction.
  CR_ObjRelVelY: single, Min=-128, Max=126.9976  % Relative target object velocity in y-direction.
  CR_ObjRelAccelX: single, Min=-16, Max=15.96875  % Relative target object acceleration in x-direction.
  CR_ObjRelAccelY: single, Min=-16, Max=15.96875  % Relative target object acceleration in y-direction.
  CR_ObjDistXStd: single, Min=0, Max=6  % Standard deviation of distance X
  CR_ObjDistYStd: single, Min=0, Max=6  % Standard deviation of distance Y
  CR_ObjRelVelXStd: single, Min=0, Max=3.9375  % Standard deviation of Relative velocity X
  CR_ObjRelVelYStd: single, Min=0, Max=3.9375  % Standard deviation of Relative velocity Y
  CR_ObjRAccelXStd: single, Min=0, Max=3.9375  % Standard deviation of Relative Acceleration X
  CR_ObjRAccelYStd: single, Min=0, Max=3.9375  % Standard deviation of Relative Acceleration Y
  CR_VFC_ObjWidth: single, Min=0, Max=5  % Width of the object
  CR_VFC_ObjLength: single, Min=0, Max=20  % Length of the object
  CR_ObjMeasured: uint8, Min=0, Max=3