% Simulink data dictionary PubIfSensorMRR_V06_RTE.sldd

MRR_DIAG_BUS = Simulink.Bus(HeaderFile="Rte_Type.h")
  MsgErrSts1: uint32
  MsgErrSts2: uint32
  MsgErrSts3: uint32
  MsgErrSts4: uint32
  MsgErrSts5: uint32
  MsgErrSts6: uint32
  MsgErrSts7: uint32
  MsgErrSts8: uint32
  MsgErrSts9: uint32
  MsgErrSts10: uint32
  MsgErrSts11: uint32
  MsgErrSts12: uint32
  MsgErrSts13: uint32
  MsgErrSts14: uint32
  MsgErrSts15: uint32
  MsgErrSts16: uint32

MRRAD1_BUS = Simulink.Bus(HeaderFile="Rte_Type.h")
  Checksum1: uint8, Min=0, Max=255  % Use the checksum strategy from document “End-to-End Communication Protection Specification-V1.7”
  Checksum2: uint8, Min=0, Max=255  % Use the checksum strategy from document “End-to-End Communication Protection Specification-V1.8”
  Checksum3: uint8, Min=0, Max=255  % Use the checksum strategy from document “End-to-End Communication Protection Specification-V1.9”
  Checksum4: uint8, Min=0, Max=255  % Use the checksum strategy from document “End-to-End Communication Protection Specification-V1.10”
  Checksum5: uint8, Min=0, Max=255  % Use the checksum strategy from document “End-to-End Communication Protection Specification-V1.11”
  Checksum6: uint8, Min=0, Max=255  % Use the checksum strategy from document “End-to-End Communication Protection Specification-V1.12”
  Checksum7: uint8, Min=0, Max=255  % Use the checksum strategy from document “End-to-End Communication Protection Specification-V1.13”
  Checksum8: uint8, Min=0, Max=255  % Use the checksum strategy from document “End-to-End Communication Protection Specification-V1.14”
  RollingCounter1: uint8, Min=0, Max=255
  RollingCounter2: uint8, Min=0, Max=255
  RollingCounter3: uint8, Min=0, Max=255
  RollingCounter4: uint8, Min=0, Max=255
  RollingCounter5: uint8, Min=0, Max=255
  RollingCounter6: uint8, Min=0, Max=255
  RollingCounter7: uint8, Min=0, Max=255
  RollingCounter8: uint8, Min=0, Max=255

MRRAD2_BUS = Simulink.Bus(HeaderFile="Rte_Type.h")
  Checksum9: uint8, Min=0, Max=255  % Use the checksum strategy from document “End-to-End Communication Protection Specification-V1.7”
  Checksum10: uint8, Min=0, Max=255  % Use the checksum strategy from document “End-to-End Communication Protection Specification-V1.8”
  Checksum11: uint8, Min=0, Max=255  % Use the checksum strategy from document “End-to-End Communication Protection Specification-V1.9”
  Checksum12: uint8, Min=0, Max=255  % Use the checksum strategy from document “End-to-End Communication Protection Specification-V1.10”
  Checksum13: uint8, Min=0, Max=255  % Use the checksum strategy from document “End-to-End Communication Protection Specification-V1.11”
  Checksum14: uint8, Min=0, Max=255  % Use the checksum strategy from document “End-to-End Communication Protection Specification-V1.12”
  Checksum15: uint8, Min=0, Max=255  % Use the checksum strategy from document “End-to-End Communication Protection Specification-V1.13”
  Checksum16: uint8, Min=0, Max=255  % Use the checksum strategy from document “End-to-End Communication Protection Specification-V1.14”
  RollingCounter9: uint8, Min=0, Max=255
  RollingCounter10: uint8, Min=0, Max=255
  RollingCounter11: uint8, Min=0, Max=255
  RollingCounter12: uint8, Min=0, Max=255
  RollingCounter13: uint8, Min=0, Max=255
  RollingCounter14: uint8, Min=0, Max=255
  RollingCounter15: uint8, Min=0, Max=255
  RollingCounter16: uint8, Min=0, Max=255

MRRAD3_BUS = Simulink.Bus(HeaderFile="Rte_Type.h")
  Checksum17: uint8, Min=0, Max=255  % Use the checksum strategy from document “End-to-End Communication Protection Specification-V1.7”
  Checksum18: uint8, Min=0, Max=255  % Use the checksum strategy from document “End-to-End Communication Protection Specification-V1.8”
  Checksum19: uint8, Min=0, Max=255  % Use the checksum strategy from document “End-to-End Communication Protection Specification-V1.9”
  Checksum20: uint8, Min=0, Max=255  % Use the checksum strategy from document “End-to-End Communication Protection Specification-V1.10”
  Checksum21: uint8, Min=0, Max=255  % Use the checksum strategy from document “End-to-End Communication Protection Specification-V1.11”
  Checksum22: uint8, Min=0, Max=255  % Use the checksum strategy from document “End-to-End Communication Protection Specification-V1.12”
  Checksum23: uint8, Min=0, Max=255  % Use the checksum strategy from document “End-to-End Communication Protection Specification-V1.13”
  Checksum24: uint8, Min=0, Max=255
  RollingCounter17: uint8, Min=0, Max=255
  RollingCounter18: uint8, Min=0, Max=255
  RollingCounter19: uint8, Min=0, Max=255
  RollingCounter20: uint8, Min=0, Max=255
  RollingCounter21: uint8, Min=0, Max=255
  RollingCounter22: uint8, Min=0, Max=255
  RollingCounter23: uint8, Min=0, Max=255
  RollingCounter24: uint8, Min=0, Max=255

MRRAD4_BUS = Simulink.Bus(HeaderFile="Rte_Type.h")
  Checksum25: uint8, Min=0, Max=255  % Use the checksum strategy from document “End-to-End Communication Protection Specification-V1.7”
  Checksum26: uint8, Min=0, Max=255  % Use the checksum strategy from document “End-to-End Communication Protection Specification-V1.8”
  Checksum27: uint8, Min=0, Max=255  % Use the checksum strategy from document “End-to-End Communication Protection Specification-V1.9”
  Checksum28: uint8, Min=0, Max=255  % Use the checksum strategy from document “End-to-End Communication Protection Specification-V1.10”
  Checksum29: uint8, Min=0, Max=255  % Use the checksum strategy from document “End-to-End Communication Protection Specification-V1.11”
  Checksum30: uint8, Min=0, Max=255  % Use the checksum strategy from document “End-to-End Communication Protection Specification-V1.12”
  Checksum31: uint8, Min=0, Max=255  % Use the checksum strategy from document “End-to-End Communication Protection Specification-V1.13”
  Checksum32: uint8, Min=0, Max=255
  RollingCounter25: uint8, Min=0, Max=255
  RollingCounter26: uint8, Min=0, Max=255
  RollingCounter27: uint8, Min=0, Max=255
  RollingCounter28: uint8, Min=0, Max=255
  RollingCounter29: uint8, Min=0, Max=255
  RollingCounter30: uint8, Min=0, Max=255
  RollingCounter31: uint8, Min=0, Max=255
  RollingCounter32: uint8, Min=0, Max=255

MRRAD5_BUS = Simulink.Bus(HeaderFile="Rte_Type.h")
  Checksum33: uint8, Min=0, Max=255  % Use the checksum strategy from document “End-to-End Communication Protection Specification-V1.7”
  Checksum34: uint8, Min=0, Max=255  % Use the checksum strategy from document “End-to-End Communication Protection Specification-V1.8”
  Checksum35: uint8, Min=0, Max=255  % Use the checksum strategy from document “End-to-End Communication Protection Specification-V1.9”
  Checksum36: uint8, Min=0, Max=255  % Use the checksum strategy from document “End-to-End Communication Protection Specification-V1.10”
  Checksum37: uint8, Min=0, Max=255  % Use the checksum strategy from document “End-to-End Communication Protection Specification-V1.11”
  Checksum38: uint8, Min=0, Max=255  % Use the checksum strategy from document “End-to-End Communication Protection Specification-V1.12”
  Checksum39: uint8, Min=0, Max=255  % Use the checksum strategy from document “End-to-End Communication Protection Specification-V1.13”
  Checksum40: uint8, Min=0, Max=255  % Use the checksum strategy from document “End-to-End Communication Protection Specification-V1.14”
  RollingCounter33: uint8, Min=0, Max=255
  RollingCounter34: uint8, Min=0, Max=255
  RollingCounter35: uint8, Min=0, Max=255
  RollingCounter36: uint8, Min=0, Max=255
  RollingCounter37: uint8, Min=0, Max=255
  RollingCounter38: uint8, Min=0, Max=255
  RollingCounter39: uint8, Min=0, Max=255
  RollingCounter40: uint8, Min=0, Max=255

MRRAD6_BUS = Simulink.Bus(HeaderFile="Rte_Type.h")
  Checksum41: uint8, Min=0, Max=255  % Use the checksum strategy from document “End-to-End Communication Protection Specification-V1.7”
  Checksum42: uint8, Min=0, Max=255  % Use the checksum strategy from document “End-to-End Communication Protection Specification-V1.8”
  Checksum43: uint8, Min=0, Max=255  % Use the checksum strategy from document “End-to-End Communication Protection Specification-V1.9”
  Checksum44: uint8, Min=0, Max=255  % Use the checksum strategy from document “End-to-End Communication Protection Specification-V1.10”
  Checksum45: uint8, Min=0, Max=255  % Use the checksum strategy from document “End-to-End Communication Protection Specification-V1.11”
  Checksum46: uint8, Min=0, Max=255  % Use the checksum strategy from document “End-to-End Communication Protection Specification-V1.12”
  Checksum47: uint8, Min=0, Max=255  % Use the checksum strategy from document “End-to-End Communication Protection Specification-V1.13”
  Checksum48: uint8, Min=0, Max=255  % Use the checksum strategy from document “End-to-End Communication Protection Specification-V1.14”
  RollingCounter41: uint8, Min=0, Max=255
  RollingCounter42: uint8, Min=0, Max=255
  RollingCounter43: uint8, Min=0, Max=255
  RollingCounter44: uint8, Min=0, Max=255
  RollingCounter45: uint8, Min=0, Max=255
  RollingCounter46: uint8, Min=0, Max=255
  RollingCounter47: uint8, Min=0, Max=255
  RollingCounter48: uint8, Min=0, Max=255

MRRAD7_BUS = Simulink.Bus(HeaderFile="Rte_Type.h")
  Checksum49: uint8, Min=0, Max=255  % Use the checksum strategy from document “End-to-End Communication Protection Specification-V1.7”
  Checksum50: uint8, Min=0, Max=255  % Use the checksum strategy from document “End-to-End Communication Protection Specification-V1.8”
  Checksum51: uint8, Min=0, Max=255  % Use the checksum strategy from document “End-to-End Communication Protection Specification-V1.9”
  Checksum52: uint8, Min=0, Max=255  % Use the checksum strategy from document “End-to-End Communication Protection Specification-V1.10”
  Checksum53: uint8, Min=0, Max=255  % Use the checksum strategy from document “End-to-End Communication Protection Specification-V1.11”
  Checksum54: uint8, Min=0, Max=255  % Use the checksum strategy from document “End-to-End Communication Protection Specification-V1.12”
  Checksum55: uint8, Min=0, Max=255  % Use the checksum strategy from document “End-to-End Communication Protection Specification-V1.13”
  Checksum56: uint8, Min=0, Max=255  % Use the checksum strategy from document “End-to-End Communication Protection Specification-V1.14”
  RollingCounter49: uint8, Min=0, Max=255
  RollingCounter50: uint8, Min=0, Max=255
  RollingCounter51: uint8, Min=0, Max=255
  RollingCounter52: uint8, Min=0, Max=255
  RollingCounter53: uint8, Min=0, Max=255
  RollingCounter54: uint8, Min=0, Max=255
  RollingCounter55: uint8, Min=0, Max=255
  RollingCounter56: uint8, Min=0, Max=255

MRRAD8_BUS = Simulink.Bus(HeaderFile="Rte_Type.h")
  Checksum57: uint8, Min=0, Max=255  % Use the checksum strategy from document “End-to-End Communication Protection Specification-V1.7”
  Checksum58: uint8, Min=0, Max=255  % Use the checksum strategy from document “End-to-End Communication Protection Specification-V1.8”
  Checksum59: uint8, Min=0, Max=255  % Use the checksum strategy from document “End-to-End Communication Protection Specification-V1.9”
  Checksum60: uint8, Min=0, Max=255  % Use the checksum strategy from document “End-to-End Communication Protection Specification-V1.10”
  Checksum61: uint8, Min=0, Max=255  % Use the checksum strategy from document “End-to-End Communication Protection Specification-V1.11”
  Checksum62: uint8, Min=0, Max=255  % Use the checksum strategy from document “End-to-End Communication Protection Specification-V1.12”
  Checksum63: uint8, Min=0, Max=255  % Use the checksum strategy from document “End-to-End Communication Protection Specification-V1.13”
  Checksum64: uint8, Min=0, Max=255  % Use the checksum strategy from document “End-to-End Communication Protection Specification-V1.14”
  RollingCounter57: uint8, Min=0, Max=255
  RollingCounter58: uint8, Min=0, Max=255
  RollingCounter59: uint8, Min=0, Max=255
  RollingCounter60: uint8, Min=0, Max=255
  RollingCounter61: uint8, Min=0, Max=255
  RollingCounter62: uint8, Min=0, Max=255
  RollingCounter63: uint8, Min=0, Max=255
  RollingCounter64: uint8, Min=0, Max=255

MRRAD9_BUS = Simulink.Bus(HeaderFile="Rte_Type.h")
  Checksum65: uint8, Min=0, Max=255  % Use the checksum strategy from document “End-to-End Communication Protection Specification-V1.7”
  Checksum66: uint8, Min=0, Max=255  % Use the checksum strategy from document “End-to-End Communication Protection Specification-V1.8”
  Checksum67: uint8, Min=0, Max=255  % Use the checksum strategy from document “End-to-End Communication Protection Specification-V1.9”
  Checksum68: uint8, Min=0, Max=255  % Use the checksum strategy from document “End-to-End Communication Protection Specification-V1.10”
  Checksum69: uint8, Min=0, Max=255  % Use the checksum strategy from document “End-to-End Communication Protection Specification-V1.11”
  Checksum70: uint8, Min=0, Max=255  % Use the checksum strategy from document “End-to-End Communication Protection Specification-V1.12”
  Checksum71: uint8, Min=0, Max=255  % Use the checksum strategy from document “End-to-End Communication Protection Specification-V1.13”
  Checksum72: uint8, Min=0, Max=255  % Use the checksum strategy from document “End-to-End Communication Protection Specification-V1.14”
  RollingCounter65: uint8, Min=0, Max=255
  RollingCounter66: uint8, Min=0, Max=255
  RollingCounter67: uint8, Min=0, Max=255
  RollingCounter68: uint8, Min=0, Max=255
  RollingCounter69: uint8, Min=0, Max=255
  RollingCounter70: uint8, Min=0, Max=255
  RollingCounter71: uint8, Min=0, Max=255
  RollingCounter72: uint8, Min=0, Max=255

MRRAD10_BUS = Simulink.Bus(HeaderFile="Rte_Type.h")
  Checksum73: uint8, Min=0, Max=255  % Use the checksum strategy from document “End-to-End Communication Protection Specification-V1.7”
  Checksum74: uint8, Min=0, Max=255  % Use the checksum strategy from document “End-to-End Communication Protection Specification-V1.8”
  Checksum75: uint8, Min=0, Max=255  % Use the checksum strategy from document “End-to-End Communication Protection Specification-V1.9”
  Checksum76: uint8, Min=0, Max=255  % Use the checksum strategy from document “End-to-End Communication Protection Specification-V1.10”
  Checksum77: uint8, Min=0, Max=255  % Use the checksum strategy from document “End-to-End Communication Protection Specification-V1.11”
  Checksum78: uint8, Min=0, Max=255  % Use the checksum strategy from document “End-to-End Communication Protection Specification-V1.12”
  Checksum79: uint8, Min=0, Max=255  % Use the checksum strategy from document “End-to-End Communication Protection Specification-V1.13”
  Checksum80: uint8, Min=0, Max=255  % Use the checksum strategy from document “End-to-End Communication Protection Specification-V1.14”
  RollingCounter73: uint8, Min=0, Max=255
  RollingCounter74: uint8, Min=0, Max=255
  RollingCounter75: uint8, Min=0, Max=255
  RollingCounter76: uint8, Min=0, Max=255
  RollingCounter77: uint8, Min=0, Max=255
  RollingCounter78: uint8, Min=0, Max=255
  RollingCounter79: uint8, Min=0, Max=255
  RollingCounter80: uint8, Min=0, Max=255

MRRAD11_BUS = Simulink.Bus(HeaderFile="Rte_Type.h")
  Checksum81: uint8, Min=0, Max=255  % Use the checksum strategy from document “End-to-End Communication Protection Specification-V1.7”
  Checksum82: uint8, Min=0, Max=255  % Use the checksum strategy from document “End-to-End Communication Protection Specification-V1.8”
  Checksum83: uint8, Min=0, Max=255  % Use the checksum strategy from document “End-to-End Communication Protection Specification-V1.9”
  Checksum84: uint8, Min=0, Max=255  % Use the checksum strategy from document “End-to-End Communication Protection Specification-V1.10”
  Checksum85: uint8, Min=0, Max=255  % Use the checksum strategy from document “End-to-End Communication Protection Specification-V1.11”
  Checksum86: uint8, Min=0, Max=255  % Use the checksum strategy from document “End-to-End Communication Protection Specification-V1.12”
  Checksum87: uint8, Min=0, Max=255  % Use the checksum strategy from document “End-to-End Communication Protection Specification-V1.13”
  Checksum88: uint8, Min=0, Max=255  % Use the checksum strategy from document “End-to-End Communication Protection Specification-V1.14”
  RollingCounter81: uint8, Min=0, Max=255
  RollingCounter82: uint8, Min=0, Max=255
  RollingCounter83: uint8, Min=0, Max=255
  RollingCounter84: uint8, Min=0, Max=255
  RollingCounter85: uint8, Min=0, Max=255
  RollingCounter86: uint8, Min=0, Max=255
  RollingCounter87: uint8, Min=0, Max=255
  RollingCounter88: uint8, Min=0, Max=255

MRRAD12_BUS = Simulink.Bus(HeaderFile="Rte_Type.h")
  Checksum89: uint8, Min=0, Max=255  % Use the checksum strategy from document “End-to-End Communication Protection Specification-V1.7”
  Checksum90: uint8, Min=0, Max=255  % Use the checksum strategy from document “End-to-End Communication Protection Specification-V1.8”
  Checksum91: uint8, Min=0, Max=255  % Use the checksum strategy from document “End-to-End Communication Protection Specification-V1.9”
  Checksum92: uint8, Min=0, Max=255  % Use the checksum strategy from document “End-to-End Communication Protection Specification-V1.10”
  Checksum93: uint8, Min=0, Max=255  % Use the checksum strategy from document “End-to-End Communication Protection Specification-V1.11”
  Checksum94: uint8, Min=0, Max=255  % Use the checksum strategy from document “End-to-End Communication Protection Specification-V1.12”
  Checksum95: uint8, Min=0, Max=255  % Use the checksum strategy from document “End-to-End Communication Protection Specification-V1.13”
  Checksum96: uint8, Min=0, Max=255  % Use the checksum strategy from document “End-to-End Communication Protection Specification-V1.14”
  RollingCounter89: uint8, Min=0, Max=255
  RollingCounter90: uint8, Min=0, Max=255
  RollingCounter91: uint8, Min=0, Max=255
  RollingCounter92: uint8, Min=0, Max=255
  RollingCounter93: uint8, Min=0, Max=255
  RollingCounter94: uint8, Min=0, Max=255
  RollingCounter95: uint8, Min=0, Max=255
  RollingCounter96: uint8, Min=0, Max=255

MRRAD13_BUS = Simulink.Bus(HeaderFile="Rte_Type.h")
  Checksum97: uint8, Min=0, Max=255  % Use the checksum strategy from document “End-to-End Communication Protection Specification-V1.7”
  Checksum98: uint8, Min=0, Max=255  % Use the checksum strategy from document “End-to-End Communication Protection Specification-V1.8”
  Checksum99: uint8, Min=0, Max=255  % Use the checksum strategy from document “End-to-End Communication Protection Specification-V1.9”
  Checksum100: uint8, Min=0, Max=255  % Use the checksum strategy from document “End-to-End Communication Protection Specification-V1.10”
  Checksum101: uint8, Min=0, Max=255  % Use the checksum strategy from document “End-to-End Communication Protection Specification-V1.11”
  Checksum102: uint8, Min=0, Max=255  % Use the checksum strategy from document “End-to-End Communication Protection Specification-V1.12”
  Checksum103: uint8, Min=0, Max=255  % Use the checksum strategy from document “End-to-End Communication Protection Specification-V1.13”
  Checksum104: uint8, Min=0, Max=255  % Use the checksum strategy from document “End-to-End Communication Protection Specification-V1.14”
  RollingCounter97: uint8, Min=0, Max=255
  RollingCounter98: uint8, Min=0, Max=255
  RollingCounter99: uint8, Min=0, Max=255
  RollingCounter100: uint8, Min=0, Max=255
  RollingCounter101: uint8, Min=0, Max=255
  RollingCounter102: uint8, Min=0, Max=255
  RollingCounter103: uint8, Min=0, Max=255
  RollingCounter104: uint8, Min=0, Max=255

MRRAD14_BUS = Simulink.Bus(HeaderFile="Rte_Type.h")
  Checksum105: uint8, Min=0, Max=255  % Use the checksum strategy from document “End-to-End Communication Protection Specification-V1.7”
  Checksum106: uint8, Min=0, Max=255  % Use the checksum strategy from document “End-to-End Communication Protection Specification-V1.8”
  Checksum107: uint8, Min=0, Max=255  % Use the checksum strategy from document “End-to-End Communication Protection Specification-V1.9”
  Checksum108: uint8, Min=0, Max=255  % Use the checksum strategy from document “End-to-End Communication Protection Specification-V1.10”
  Checksum109: uint8, Min=0, Max=255  % Use the checksum strategy from document “End-to-End Communication Protection Specification-V1.11”
  Checksum110: uint8, Min=0, Max=255  % Use the checksum strategy from document “End-to-End Communication Protection Specification-V1.12”
  Checksum111: uint8, Min=0, Max=255  % Use the checksum strategy from document “End-to-End Communication Protection Specification-V1.13”
  Checksum112: uint8, Min=0, Max=255  % Use the checksum strategy from document “End-to-End Communication Protection Specification-V1.14”
  RollingCounter105: uint8, Min=0, Max=255
  RollingCounter106: uint8, Min=0, Max=255
  RollingCounter107: uint8, Min=0, Max=255
  RollingCounter108: uint8, Min=0, Max=255
  RollingCounter109: uint8, Min=0, Max=255
  RollingCounter110: uint8, Min=0, Max=255
  RollingCounter111: uint8, Min=0, Max=255
  RollingCounter112: uint8, Min=0, Max=255

MRRAD15_BUS = Simulink.Bus(HeaderFile="Rte_Type.h")
  Checksum113: uint8, Min=0, Max=255  % Use the checksum strategy from document “End-to-End Communication Protection Specification-V1.7”
  Checksum114: uint8, Min=0, Max=255  % Use the checksum strategy from document “End-to-End Communication Protection Specification-V1.8”
  Checksum115: uint8, Min=0, Max=255  % Use the checksum strategy from document “End-to-End Communication Protection Specification-V1.9”
  Checksum116: uint8, Min=0, Max=255  % Use the checksum strategy from document “End-to-End Communication Protection Specification-V1.10”
  Checksum117: uint8, Min=0, Max=255  % Use the checksum strategy from document “End-to-End Communication Protection Specification-V1.11”
  Checksum118: uint8, Min=0, Max=255  % Use the checksum strategy from document “End-to-End Communication Protection Specification-V1.12”
  Checksum119: uint8, Min=0, Max=255  % Use the checksum strategy from document “End-to-End Communication Protection Specification-V1.13”
  Checksum120: uint8, Min=0, Max=255  % Use the checksum strategy from document “End-to-End Communication Protection Specification-V1.14”
  RollingCounter113: uint8, Min=0, Max=255
  RollingCounter114: uint8, Min=0, Max=255
  RollingCounter115: uint8, Min=0, Max=255
  RollingCounter116: uint8, Min=0, Max=255
  RollingCounter117: uint8, Min=0, Max=255
  RollingCounter118: uint8, Min=0, Max=255
  RollingCounter119: uint8, Min=0, Max=255
  RollingCounter120: uint8, Min=0, Max=255

MRRAD16_BUS = Simulink.Bus(HeaderFile="Rte_Type.h")
  Checksum121: uint8, Min=0, Max=255  % RollingCounter
  Checksum122: uint8, Min=0, Max=255  % Use the checksum strategy from document “End-to-End Communication Protection Specification-V1.7”
  Checksum123: uint8, Min=0, Max=255  % Use the checksum strategy from document “End-to-End Communication Protection Specification-V1.8”
  Checksum124: uint8, Min=0, Max=255  % Use the checksum strategy from document “End-to-End Communication Protection Specification-V1.9”
  Checksum125: uint8, Min=0, Max=255  % Use the checksum strategy from document “End-to-End Communication Protection Specification-V1.10”
  Checksum126: uint8, Min=0, Max=255  % Use the checksum strategy from document “End-to-End Communication Protection Specification-V1.11”
  Checksum127: uint8, Min=0, Max=255  % Use the checksum strategy from document “End-to-End Communication Protection Specification-V1.12”
  Checksum128: uint8, Min=0, Max=255  % Use the checksum strategy from document “End-to-End Communication Protection Specification-V1.13”
  RollingCounter121: uint8, Min=0, Max=255
  RollingCounter122: uint8, Min=0, Max=255
  RollingCounter123: uint8, Min=0, Max=255
  RollingCounter124: uint8, Min=0, Max=255
  RollingCounter125: uint8, Min=0, Max=255
  RollingCounter126: uint8, Min=0, Max=255
  RollingCounter127: uint8, Min=0, Max=255
  RollingCounter128: uint8, Min=0, Max=255

MRR_HDR_BUS = Simulink.Bus(HeaderFile="Rte_Type.h")
  MRR_hdr_ErrorStatus: uint8, Min=0, Max=15  % Error status of radar
  MRR_hdr_TimeStamp: single, Min=0, Max=65536  % Time taken for the object data to be processed (difference between receiving radar reflections, and sending objects on CAN).
  MRR_hdr_TimeStampStatus: uint8, Min=0, Max=255
  MRR_BLIND: uint8, Min=0, Max=3
  MRR_hdr_AutosarTimeStamp: uint32, Min=0, Max=67108863

MRR_DIAG_UPDATE_BUS = Simulink.Bus(HeaderFile="Rte_Type.h")
  MRR_BSW_MRRAD1_IsUpdated: boolean
  MRR_BSW_MRRAD2_IsUpdated: boolean
  MRR_BSW_MRRAD3_IsUpdated: boolean
  MRR_BSW_MRRAD4_IsUpdated: boolean
  MRR_BSW_MRRAD5_IsUpdated: boolean
  MRR_BSW_MRRAD6_IsUpdated: boolean
  MRR_BSW_MRRAD7_IsUpdated: boolean
  MRR_BSW_MRRAD8_IsUpdated: boolean
  MRR_BSW_MRRAD9_IsUpdated: boolean
  MRR_BSW_MRRAD10_IsUpdated: boolean
  MRR_BSW_MRRAD11_IsUpdated: boolean
  MRR_BSW_MRRAD12_IsUpdated: boolean
  MRR_BSW_MRRAD13_IsUpdated: boolean
  MRR_BSW_MRRAD14_IsUpdated: boolean
  MRR_BSW_MRRAD15_IsUpdated: boolean
  MRR_BSW_MRRAD16_IsUpdated: boolean

MRR_OBJ_BUS = Simulink.Bus(HeaderFile="Rte_Type.h")
  MRR_ObjID: uint8, Min=0, Max=255  % ID is an identifier number that allows for tracking of persistent objects over time.
  MRR_ObjExistProb: single, Min=0, Max=0.96875  % The probability of an object to exist in reality.
  MRR_ObjObstacleProb: single, Min=0, Max=0.96875  % The probability of an object being an obstacle.
  MRR_ObjDistX: single, Min=0, Max=254.9375  % Position of target vehicle in x-direction.
  MRR_ObjDistY: single, Min=-128, Max=127.875  % Position of target vehicle in y-direction.
  MRR_ObjRelVelX: single, Min=-128, Max=126.9976  % Relative target object velocity in x-direction.
  MRR_ObjRelVelY: single, Min=-128, Max=126.9976  % Relative target object velocity in y-direction.
  MRR_ObjRelAccelX: single, Min=-16, Max=15.96875  % Relative target object acceleration in x-direction.
  MRR_ObjRelAccelY: single, Min=-16, Max=15.96875  % Relative target object acceleration in y-direction.
  MRR_ObjDistXStd: single, Min=0, Max=6  % Standard deviation of distance X
  MRR_ObjDistYStd: single, Min=0, Max=6  % Standard deviation of distance Y
  MRR_ObjRelVelXStd: single, Min=0, Max=3.9375  % Standard deviation of Relative velocity X
  MRR_ObjRelVelYStd: single, Min=0, Max=3.9375  % Standard deviation of Relative velocity Y
  MRR_ObjRAccelXStd: single, Min=0, Max=3.9375  % Standard deviation of Relative Acceleration X
  MRR_ObjRAccelYStd: single, Min=0, Max=3.9375  % Standard deviation of Relative Acceleration Y
  MRR_ObjType: uint8, Min=0, Max=15  % Class of object type.
  MRR_ObjMotionType: uint8, Min=0, Max=7  % Motion type of object
  VFC_ObjWidth: single, Min=0, Max=5  % Width of the object
  VFC_ObjLength: single, Min=0, Max=20  % Length of the object
  VFC_ObjHeight: single, Min=0, Max=6  % Height of the object
  VFC_ObjMotionDirection: uint8, Min=0, Max=7  % Motion direction of object
  MRR_ObjMeasured: uint8, Min=0, Max=3