% Simulink data dictionary PubIfStateAEB_RTE.sldd

AEB_VCAN_ABM_BUS = Simulink.Bus(HeaderFile="Rte_Type.h")
  DrvSBR: boolean  % 驾驶员安全带状态
  PassSBR: boolean  % 副驾驶安全带状态
  VehLgtAccel: single  % 车辆纵向加速度
  VehLgtAccelVld: boolean  % 纵向加速度有效标志位

AEB_VCAN_ESP_BUS = Simulink.Bus(HeaderFile="Rte_Type.h")
  FLWheelDriveDirection: uint8  % 左前轮速方向
  FLWheelSpdVld: boolean  % 左前轮速有效标志位
  FLWheelSpd: single  % 左前轮速
  FRWheelDriveDirection: uint8  % 右前轮速方向
  FRWheelSpdVld: boolean  % 右前轮速有效标志位
  FRWheelSpd: single  % 右前轮速
  RLWheelDriveDirection: uint8  % 左后前轮速方向
  RLWheelSpdVld: boolean  % 左后轮速有效标志位
  RLWheelSpd: single  % 左后轮速
  RRWheelDriveDirection: uint8  % 右后轮速方向
  RRWheelSpdVld: boolean  % 右后轮速有效标志位
  RRWheelSpd: single  % 右后轮速
  BTCActv: boolean  % BTC功能是否激活
  PTCActv: boolean  % PTC功能是否激活
  VDCActv: boolean  % VDC功能是否激活
  ESP_MasterCylBrkPressVld: boolean  % 主缸压力有效标志位
  ESP_MasterCylBrkPress: single  % 主缸压力
  VehStandstill: uint8  % 整车是否静止标志位
  ABAactv: boolean  % ABA是否激活
  ABAavailable: boolean  % ABA功能是否可用
  ABPActv: boolean  % ABP功能是否激活
  ABPAvailable: boolean  % ABP功能是否可用
  AEBAvailable: boolean  % AEB功能是否可用
  AEBBAActv: boolean  % AEBBA功能是否激活
  AEBIBActv: boolean  % AEBIA功能是否激活
  AWBActv: boolean  % AWB功能是否激活
  AWBAvailable: boolean  % AWB功能是否可用
  AVHSts: uint8  % AVH状态信号
  DrivingModDis: uint8  % 驾驶模式
  ESPFuncOffSts: boolean
  VehSpd: single  % 车速

AEB_VCAN_BCM_BUS = Simulink.Bus(HeaderFile="Rte_Type.h")
  DrvDoorSts: boolean  % 驾驶侧车门状态
  PassengerDoorSts: boolean  % 副驾驶侧车门状态

AEB_VCAN_CSA_BUS = Simulink.Bus(HeaderFile="Rte_Type.h")
  LTurnLmpSwtSts: boolean  % 左转向灯状态
  RTurnLmpSwtSts: boolean  % 右转向灯状态
  SteerWheelAng: single  % 方向盘转角
  SteerWheelAngSign: boolean  % 方向盘转角有效标志位
  SteerWheelSpd: single  % 方向盘转角速度
  SteerWheelSpdSign: boolean  % 方向盘转角速度有效标志位

AEB_VCAN_DCT_BUS = Simulink.Bus(HeaderFile="Rte_Type.h")
  CurrentGearValid: boolean  % 当前档位有效标志位
  CURRENT_GEAR: uint8  % 当前档位

AEB_VCAN_HUT_BUS = Simulink.Bus(HeaderFile="Rte_Type.h")
  AEB_PedSwtReq: boolean  % AEB行人开关信号
  AEB_VehSwtReq: boolean  % AEB车辆开关信号
  AEB_JASwtReq: boolean  % AEB自行车开关信号
  FCW_SnvtySet: uint8  % FCW功能灵敏度

AEB_VCAN_HCU_BUS = Simulink.Bus(HeaderFile="Rte_Type.h")
  HCU_PowertrainSts: uint8
  HCU_AccelPedalPosn_Diag: single
  HCU_AccelPedalPosn_DiagValid: boolean
  HCU_DrvMod: uint8

AEB_BRK_INFO_BUS = Simulink.Bus(HeaderFile="Rte_Type.h")
  AEB_ABP_Req: boolean
  AEB_ABA_Req: boolean
  AEB_ABA_Level: uint8
  AEB_AWB_Req: boolean
  AEB_AWB_Level: uint8
  AEB_TgtDecel_Req: boolean
  AEB_TgtDecel_ReqValue: single
  AEB_BrkReqFunc: uint8
  EBA_TgtDecel_Req: boolean
  AEB_VehHldReq: boolean

AEB_DVR_INFO_BUS = Simulink.Bus(HeaderFile="Rte_Type.h")
  AEBObjID: uint8
  AEBObjVideoCfmd: boolean
  AEBObjState: uint8
  AEBObjDx: single
  AEBObjDy: single
  AEBObjVx: single
  AEBObjVy: single
  AEBObjAx: single
  AEBObjAy: single
  AEBObjExist: single
  AEBObjObstcl: single
  AEBObjCntAlive: uint16
  AEBObjOverlap: uint8
  AEBObjDrvby: uint8
  PedObjID: uint8
  PedObjVideoCfmd: boolean
  PedObjState: uint8
  PedObjDx: single
  PedObjDy: single
  PedObjVx: single
  PedObjVy: single
  PedObjAx: single
  PedObjAy: single
  PedObjExist: single
  PedObjObstcl: single
  PedObjCntAlive: uint16
  CyclistObjID: uint8
  CyclistObjVideoCfmd: boolean
  CyclistObjState: uint8
  CyclistObjDx: single
  CyclistObjDy: single
  CyclistObjVx: single
  CyclistObjVy: single
  CyclistObjAx: single
  CyclistObjAy: single
  CyclistObjExist: single
  CyclistObjObstcl: single
  CyclistObjCntAlive: uint16
  AEBJAObjID: uint8
  AEBJAObjVideoCfmd: boolean
  AEBJAObjState: uint8
  AEBJAObjDx: single
  AEBJAObjDy: single
  AEBJAObjVx: single
  AEBJAObjVy: single
  AEBJAObjAx: single
  AEBJAObjAy: single
  AEBJAObjExist: single
  AEBJAObjObstcl: single
  AEBJAObjCntAlive: uint16
  JAPedObjID: uint8
  JAPedObjVideoCfmd: boolean
  JAPedObjState: uint8
  JAPedObjDx: single
  JAPedObjDy: single
  JAPedObjVx: single
  JAPedObjVy: single
  JAPedObjAx: single
  JAPedObjAy: single
  JAPedObjExist: single
  JAPedObjObstcl: single
  JAPedObjCntAlive: uint16

AEB_EDR_LONOBJ_INFO_BUS = Simulink.Bus(HeaderFile="Rte_Type.h")
  FusionType: uint8  % 目标是否是融合,传感器类型
  ObjectID: uint8  % 融合追踪处理后，目标的ID
  ObjectType: uint8  % 目标的类型（行人、小汽车、卡车...）
  ObjectTypeCameraConfirmed: boolean  % 目标类型经过摄像头确认标志位
  ObjectLength: single  % 目标的长度
  ObjectWidth: single  % 目标的宽度
  ObjectHight: single  % 目标的高度
  ObjectYawAngle: single  % 车体系下, 目标的航向角
  ObjectMovingState: uint8  % 目标的运动状态(静止、运动...)
  ObjectMovingOrientation: uint8  % 目标的运动方向(同向、对向、横穿...)
  dx: single  % 车体坐标系下，自车和目标纵向相对距离
  dy: single  % 车体坐标系下，自车和目标横向相对距离
  dz: single  % 自车和目标垂向相对距离
  vx: single  % 自车和目标的纵向的相对速度
  vy: single  % 自车和目标的横向的相对速度
  ax: single  % 自车和目标  纵向  相对距离的方差
  ay: single  % 自车和目标  横向  相对距离的方差
  dxVariance: single  % 自车和目标的纵向的相对加速度
  dyVariance: single  % 自车和目标的横向的相对加速度
  ObjectExistProb: single  % 目标存在的概率值
  ObjectIsObstacleProb: single  % 目标成为障碍物的概率值
  ObjectMeasurementStatus: single  % 目标的测量状态
  dyObject2Center: single  % 目标中心线距中间车道中心线距离
  dyEgo2Center: single  % 自车中心线距中间车道中心线距离

AEB_EDR_LATPED_INFO_BUS = Simulink.Bus(HeaderFile="Rte_Type.h")
  FusionType: uint8  % 目标是否是融合,传感器类型
  ObjectID: uint8  % 融合追踪处理后，目标的ID
  ObjectType: uint8  % 目标的类型（行人、小汽车、卡车...）
  ObjectTypeCameraConfirmed: boolean  % 目标类型经过摄像头确认标志位
  ObjectLength: single  % 目标的长度
  ObjectWidth: single  % 目标的宽度
  ObjectHight: single  % 目标的高度
  ObjectYawAngle: single  % 车体系下, 目标的航向角
  ObjectMovingState: uint8  % 目标的运动状态(静止、运动...)
  ObjectMovingOrientation: uint8  % 目标的运动方向(同向、对向、横穿...)
  dxFisrtDetection: single  % 首次探测到目标时自车和目标纵向相对距离
  dyFisrtDetection: single  % 首次探测到目标时自车和目标横向相对距离
  dx: single  % 车体坐标系下，自车和目标纵向相对距离
  dy: single  % 车体坐标系下，自车和目标横向相对距离
  dz: single  % 自车和目标垂向相对距离
  vx: single  % 自车和目标的纵向的相对速度
  vy: single  % 自车和目标的横向的相对速度
  ax: single  % 自车和目标的纵向的相对加速度
  ay: single  % 自车和目标的横向的相对加速度
  dxVariance: single  % 自车和目标纵向相对距离的方差
  dyVariance: single  % 自车和目标横向相对距离的方差
  ObjectExistProb: single  % 目标存在的概率值
  ObjectIsObstacleProb: single  % 目标成为障碍物的概率值
  ObjectMeasurementStatus: single  % 目标的测量状态
  ObjectLifeCycle: single  % 目标存在生命周期

AEB_EDR_LATCYC_INFO_BUS = Simulink.Bus(HeaderFile="Rte_Type.h")
  FusionType: uint8  % 目标是否是融合,传感器类型
  ObjectID: uint8  % 融合追踪处理后，目标的ID
  ObjectType: uint8  % 目标的类型（行人、小汽车、卡车...）
  ObjectTypeCameraConfirmed: boolean  % 目标类型经过摄像头确认标志位
  ObjectLength: single  % 目标的长度
  ObjectWidth: single  % 目标的宽度
  ObjectHight: single  % 目标的高度
  ObjectYawAngle: single  % 车体系下, 目标的航向角
  ObjectMovingState: uint8  % 目标的运动状态(静止、运动...)
  ObjectMovingOrientation: uint8  % 目标的运动方向(同向、对向、横穿...)
  dxFisrtDetection: single  % 首次探测到目标时自车和目标纵向相对距离
  dyFisrtDetection: single  % 首次探测到目标时自车和目标横向相对距离
  dx: single  % 车体坐标系下，自车和目标纵向相对距离
  dy: single  % 车体坐标系下，自车和目标横向相对距离
  dz: single  % 自车和目标垂向相对距离
  vx: single  % 自车和目标的纵向的相对速度
  vy: single  % 自车和目标的横向的相对速度
  ax: single  % 自车和目标的纵向的相对加速度
  ay: single  % 自车和目标的横向的相对加速度
  dxVariance: single  % 自车和目标纵向相对距离的方差
  dyVariance: single  % 自车和目标横向相对距离的方差
  ObjectExistProb: single  % 目标存在的概率值
  ObjectIsObstacleProb: single  % 目标成为障碍物的概率值
  ObjectMeasurementStatus: single  % 目标的测量状态
  ObjectLifeCycle: single  % 目标存在生命周期

AEB_EDR_JAPED_INFO_BUS = Simulink.Bus(HeaderFile="Rte_Type.h")
  FusionType: uint8  % 目标是否是融合,传感器类型
  ObjectID: uint8  % 融合追踪处理后，目标的ID
  ObjectType: uint8  % 目标的类型（行人、小汽车、卡车...）
  ObjectTypeCameraConfirmed: boolean  % 目标类型经过摄像头确认标志位
  ObjectLength: single  % 目标的长度
  ObjectWidth: single  % 目标的宽度
  ObjectHight: single  % 目标的高度
  ObjectYawAngle: single  % 车体系下, 目标的航向角
  ObjectMovingState: uint8  % 目标的运动状态(静止、运动...)
  ObjectMovingOrientation: uint8  % 目标的运动方向(同向、对向、横穿...)
  dxFisrtDetection: single  % 首次探测到目标时自车和目标纵向相对距离
  dyFisrtDetection: single  % 首次探测到目标时自车和目标横向相对距离
  dx: single  % 车体坐标系下，自车和目标纵向相对距离
  dy: single  % 车体坐标系下，自车和目标横向相对距离
  dz: single  % 自车和目标垂向相对距离
  vx: single  % 自车和目标的纵向的相对速度
  vy: single  % 自车和目标的横向的相对速度
  ax: single  % 自车和目标的纵向的相对加速度
  ay: single  % 自车和目标的横向的相对加速度
  dxVariance: single  % 自车和目标纵向相对距离的方差
  dyVariance: single  % 自车和目标横向相对距离的方差
  ObjectExistProb: single  % 目标存在的概率值
  ObjectIsObstacleProb: single  % 目标成为障碍物的概率值
  ObjectMeasurementStatus: single  % 目标的测量状态
  ObjectLifeCycle: single  % 目标存在生命周期

AEB_EDR_JAVEH_INFO_BUS = Simulink.Bus(HeaderFile="Rte_Type.h")
  FusionType: uint8  % 目标是否是融合,传感器类型
  ObjectID: uint8  % 融合追踪处理后，目标的ID
  ObjectType: uint8  % 目标的类型（行人、小汽车、卡车...）
  ObjectTypeCameraConfirmed: boolean  % 目标类型经过摄像头确认标志位
  ObjectLength: single  % 目标的长度
  ObjectWidth: single  % 目标的宽度
  ObjectHight: single  % 目标的高度
  ObjectYawAngle: single  % 车体系下, 目标的航向角
  ObjectMovingState: uint8  % 目标的运动状态(静止、运动...)
  ObjectMovingOrientation: uint8  % 目标的运动方向(同向、对向、横穿...)
  dxFisrtDetection: single  % 首次探测到目标时自车和目标纵向相对距离
  dyFisrtDetection: single  % 首次探测到目标时自车和目标横向相对距离
  dx: single  % 车体坐标系下，自车和目标纵向相对距离
  dy: single  % 车体坐标系下，自车和目标横向相对距离
  dz: single  % 自车和目标垂向相对距离
  vx: single  % 自车和目标的纵向的相对速度
  vy: single  % 自车和目标的横向的相对速度
  ax: single  % 自车和目标的纵向的相对加速度
  ay: single  % 自车和目标的横向的相对加速度
  dxVariance: single  % 自车和目标纵向相对距离的方差
  dyVariance: single  % 自车和目标横向相对距离的方差
  ObjectExistProb: single  % 目标存在的概率值
  ObjectIsObstacleProb: single  % 目标成为障碍物的概率值
  ObjectMeasurementStatus: single  % 目标的测量状态
  ObjectLifeCycle: single  % 目标存在生命周期

AEB_FUNC_STS_INFO_BUS = Simulink.Bus(HeaderFile="Rte_Type.h")
  LatentWarningFuncSts: uint8  % LatentWarning功能状态
  PreWarningFuncSts: uint8  % 纵向PreWarning功能状态
  AcuteWarningFuncSts: uint8  % AcuteWarning功能状态
  PedPreWarningFuncSts: uint8  % 横穿行人Prewarning功能状态
  PrefillFuncSts: uint8  % 纵向Prefill功能状态
  ABAFuncFuncSts: uint8  % 纵向ABA功能状态
  PedPrefillFuncSts: uint8  % 横穿行人Prefill功能状态
  PedABAFuncSts: uint8  % 横穿行人ABA功能状态
  CycPrefillFuncSts: uint8  % 横穿自行车Prefill功能状态
  JA_VehPrefillFuncSts: uint8  % JA车辆Prefill功能状态
  JA_PTW_PrefillFuncSts: uint8  % JA两轮车Prefill功能状态
  JA_CycPrefillFuncSts: uint8  % JA自行车Prefill功能状态
  JA_PedPrefillFuncSts: uint8  % JA行人Prefill功能状态
  FCTB_PrefillFuncSts: uint8  % FCTB Prefill功能状态
  FCTB_ABAFuncSts: uint8  % FCTB ABA功能状态
  AEBpartFuncSts: uint8  % 纵向AEBPart功能状态
  CycAEBpartFuncSts: uint8  % 横向自行车AEBPart功能状态
  AEBfullFuncSts: uint8  % 纵向AEB功能状态
  JA_AEBfullFuncSts: uint8  % JA车辆AEB功能状态
  CycAEBfullFuncSts: uint8  % 横向自行车AEB功能状态
  PedAEBfullFuncSts: uint8  % 横向行人AEB功能状态
  EBAFuncSts: uint8  % 纵向EBA功能状态
  FCTBFuncSts: uint8  % FCTB功能状态
  JA_PTW_AEBFuncSts: uint8  % JA两轮车AEB功能状态
  JA_CycAEBFuncSts: uint8  % JA自行车AEB功能状态
  JA_PedAEBFuncSts: uint8  % JA行人AEB功能状态

AEB_IPHUT_INFO_BUS = Simulink.Bus(HeaderFile="Rte_Type.h")
  AEB_VehResp: boolean
  AEB_PedResp: boolean
  AEB_JA_Resp: boolean
  FCW_Snvty: uint8
  FCW_AEB_VehFctSts: uint8
  FCW_AEB_PedFctSts: uint8
  AEB_JAFuncSts: uint8
  AEB_VehTrig: boolean
  AEB_PedTrig: boolean
  AEB_JABrkTrig: uint8
  FCW_Warn: uint8
  AEB_JA_Warn: uint8
  AEB_ObjSty: uint8
  AEB_LePedDetn: uint8
  AEB_LePedTyp: uint8
  AEB_LePedHeading: single
  AEB_LePedDx: single
  AEB_LePedDy: single
  AEB_LePed_collisionprob: boolean
  AEB_RiPedDetn: uint8
  AEB_RiPedTyp: uint8
  AEB_RiPedHeading: single
  AEB_RiPedDx: single
  AEB_RiPedDy: single
  AEB_RiPed_collisionprob: boolean
  AEB_LeCyclistDetn: uint8
  AEB_LeCyclistTyp: uint8
  AEB_LeCyclistHeading: single
  AEB_LeCyclistDx: single
  AEB_LeCyclistDy: single
  AEB_LeCyclist_collisionprob: boolean
  AEB_RiCyclistDetn: uint8
  AEB_RiCyclistTyp: uint8
  AEB_RiCyclistHeading: single
  AEB_RiCyclistDx: single
  AEB_RiCyclistDy: single
  AEB_RiCyclist_collisionprob: boolean
  FCWAEB_longTTC: single
  FCWAEB_crossingTTC: single
  FCWAEB_JATTC: single

AEB_VCAN_ECM_BUS = Simulink.Bus(HeaderFile="Rte_Type.h")
  BrkPedalSts: uint8  % 制动踏板状态
  HCU_Start_StopSts: uint8
  EngState: uint8  % 发动机状态
  AccelPedalPosnVldty: uint8  % 加速踏板有效标志位
  AccPedalOverride: boolean  % 驾驶员是否override标志位
  AccelPedlPosnDiagc: single  % 加速踏板油门开度

AEB_VCAN_CR_BUS = Simulink.Bus(HeaderFile="Rte_Type.h")
  FCTB_ABA_Level: uint8
  FCTB_ABA_Req: boolean
  FCTB_ABP_Req: boolean
  CR_BrkgReq: boolean
  CR_BrkgReqVal: single