% Simulink data dictionary PubIfStateVSM_RTE.sldd

VSM_VCAN_ECM_BUS = Simulink.Bus(HeaderFile="Rte_Type.h")
  BrkPedalSts: uint8
  EngSpd: single
  Start_StopSts: uint8
  AccPedalOverride: boolean
  AccelPedlPosnDiagc: single
  ECMRespACC: boolean
  ECMACCInterface: boolean
  AccelPedalPosn: single
  AccelPedalPosnVldty: uint8
  EngState: uint8
  EngLimpHomeSts: boolean
  EngState_PHEV: uint8

VSM_VCAN_DCT_BUS = Simulink.Bus(HeaderFile="Rte_Type.h")
  CurrentGearValid: boolean
  SHIFT_IN_PROGRESS: boolean
  TargetGearValid: boolean
  TARGET_GEAR: uint8
  ShiftInPrgValid: boolean
  CURRENT_GEAR: uint8
  TGS_LEVER: uint8

VSM_VCAN_HCU_BUS = Simulink.Bus(HeaderFile="Rte_Type.h")
  HCU_BrkPedalSts: uint8
  HCU_AccelPedalPosn_Diag: single
  HCU_ACCInterface: boolean
  HCU_PowertrainSts: uint8
  ACU_ShiftInProgress: boolean
  HCU_DrvMod: uint8
  HCU_PTDrvMod: uint8
  DrvTrqReqOvld: boolean
  HCU_GearSts: uint8

VSM_VCAN_ESP_BUS = Simulink.Bus(HeaderFile="Rte_Type.h")
  BrkDskOvrheatd: boolean
  NoBrkForce: boolean
  VehStandstill: uint8
  HDCCtrl: uint8
  CDDActv: boolean
  CDDAvailable: boolean
  AVHSts: uint8
  DrivingModDis: uint8
  ESPFuncOffSts: boolean
  ESPBrkLmpCtrl: boolean
  ESPFailSts: boolean
  ESP_MasterCylBrkPressVld: boolean
  MSRActv: boolean
  VDCActv: boolean
  PTCActv: boolean
  BTCActv: boolean
  ESP_MasterCylBrkPress: single
  MSRActv_RA: boolean
  PTCActv_RA: boolean
  BTCActv_RA: boolean
  ABSFailSts: boolean
  EBDFailSts: boolean
  VehSpd: single
  ABSActv: boolean
  EPBSts: uint8
  EPB_SwtPosn: uint8
  RLWheelDriveDirection: uint8
  RLWheelSpd: single
  RRWheelDriveDirection: uint8
  RRWheelSpd: single
  EPS_FailSts: uint8
  EPS_TrqSnsrSts: boolean
  EPS_SteerMod: uint8
  EPS_LKATorqOvrlDlvd: single
  EPS_LKATorqOvrlDlvdVld: boolean
  EPS_LKATrqOvlDlvdSts: uint8
  EPS_DrvInpTrqVal_HighReslolution: single
  SysPowerMod: uint8

VSM_VCAN_BCM_BUS = Simulink.Bus(HeaderFile="Rte_Type.h")
  WiprReq_F_PBOX: uint8
  DrvDoorSts: boolean
  PassengerDoorSts: boolean
  WindshldWiprActvSts: boolean
  HazardLmpSwtSts: boolean
  KL30BRelaySts: boolean

VSM_VCAN_PBOX_BUS = Simulink.Bus(HeaderFile="Rte_Type.h")
  HoodSts_F_Pbox: boolean
  FFogLmpSts_F_Pbox: boolean
  RFogLmpSts_R_Pbox: boolean
  LowBeamSts_F_Pbox: boolean

VSM_VCAN_CSA_BUS = Simulink.Bus(HeaderFile="Rte_Type.h")
  FrntWshrSwtSts: uint8
  FrntWiprSwtSts: uint8
  LTurnLmpSwtSts: boolean
  RTurnLmpSwtSts: boolean
  SteerWheelAng: single
  SteerWheelAngSign: boolean
  SteerWheelSpd: single
  SteerWheelSpdSign: boolean
  SAS_Sts: uint8
  ACC_TimeGap_IncSetSwt: boolean
  ACC_TimeGap_DecSetSwt: boolean
  CC_ACC_CRUISE_OFFSwt: boolean
  CC_ACC_CANCEL_OFFSwt: boolean
  CC_ACC_IncSetSpd_ResuSwt: boolean
  CC_ACC_DecSetSpd_SetSwt: boolean
  CC_ACCSwtErr: boolean
  HWA_OK_OFFSwt: boolean

VSM_VCAN_ABM_BUS = Simulink.Bus(HeaderFile="Rte_Type.h")
  DrvSBR: boolean
  PassSBR: boolean
  VehLgtAccel: single
  VehLatAccel: single
  VehYawRate: single

VSM_VCAN_HUT_BUS = Simulink.Bus(HeaderFile="Rte_Type.h")
  IFC_SnvtySet: uint8
  LKASwtReq: boolean
  LCKSwtReq: boolean
  ELKSwtReq: boolean
  ESS_PedSwtReq: boolean
  ESS_VehSwtReq: boolean
  LDWSwtReq: boolean
  TSRSwtReq: boolean
  TSRWarnSwtReq: boolean
  ICA_HandsOffSwtReq: boolean
  ISLSwtReq: boolean
  TSR_SnvtySet: int8
  LSSWarnFormSwtReq: uint8
  LSSSwtReq: boolean
  IntelligentEvaSwtReq: boolean
  AESSwtReq: boolean
  HWA_SwtReq: boolean
  HWA_SnvtySet: uint8
  ALC_SwtReq: boolean
  CR_BrkgReq: boolean

VSM_VCAN_HAP_BUS = Simulink.Bus(HeaderFile="Rte_Type.h")
  USS_FrontSys_Status: uint8
  USS_FLCNear_Obj_Confidence: single
  USS_FLCNear_Obj_Pos_X: single
  USS_FLCNear_Obj_Pos_Y: single
  USS_FLMNear_Obj_Confidence: single
  USS_FLMNear_Obj_Pos_X: single
  USS_FLMNear_Obj_Pos_Y: single
  USS_FRMNear_Obj_Confidence: single
  USS_FRMNear_Obj_Pos_X: single
  USS_FRMNear_Obj_Pos_Y: single
  USS_FRCNear_Obj_Confidence: single
  USS_FRCNear_Obj_Pos_X: single
  USS_FRCNear_Obj_Pos_Y: single
  APS_WorkSts: uint8
  DVRWorkSts: uint8

VSM_TSR_INIT_BUS = Simulink.Bus(HeaderFile="Rte_Type.h")
  SPL_noSupp_Dist_Init: single
  SPL_whSupp_Dist_Init: single
  TS_SignName_Dist_Init: single
  SPL_noSupp_Value_Init: uint8
  SPL_whSupp_Value_Init: uint8
  TS_SignName_Value_Init: uint8
  SPL_SuppName_Value_Init: uint8

VSM_LAT_CTRL_BUS = Simulink.Bus(HeaderFile="Rte_Type.h")
  TarLineValid: boolean  % 横向控制线状态
  TarLineC3: single  % 控制线    y = C3*x^3 + C2*x^2 + C1*x + C0
  TarLineC2: single  % 控制线    y = C3*x^3 + C2*x^2 + C1*x + C0
  TarLineC1: single  % 控制线    y = C3*x^3 + C2*x^2 + C1*x + C0
  TarLineC0: single  % 控制线    y = C3*x^3 + C2*x^2 + C1*x + C0
  TarLineRange: single  % 控制线长度
  TarDangerLevel: uint8  % ESS激活时，属于危险

VSM_CTRL_LINE_BUS = Simulink.Bus(HeaderFile="Rte_Type.h")
  LKALineValid: boolean  % LKA控制线状态
  LKALineC3: single  % LKA控制线    y = C3*x^3 + C2*x^2 + C1*x + C0
  LKALineC2: single  % LKA控制线    y = C3*x^3 + C2*x^2 + C1*x + C0
  LKALineC1: single  % LKA控制线    y = C3*x^3 + C2*x^2 + C1*x + C0
  LKALineC0: single  % LKA控制线    y = C3*x^3 + C2*x^2 + C1*x + C0
  LKALineRange: single  % LKA控制线长度
  ELKLineValid: boolean  % ELK控制线状态
  ELKLineC3: single  % ELK控制线    y = C3*x^3 + C2*x^2 + C1*x + C0
  ELKLineC2: single  % ELK控制线    y = C3*x^3 + C2*x^2 + C1*x + C0
  ELKLineC1: single  % ELK控制线    y = C3*x^3 + C2*x^2 + C1*x + C0
  ELKLineC0: single  % ELK控制线    y = C3*x^3 + C2*x^2 + C1*x + C0
  ELKLineRange: single  % ELK控制线长度

VSM_TSR_BUS = Simulink.Bus(HeaderFile="Rte_Type.h")
  TSRSts: uint8  % TSR模式
  TSRResp: boolean  % TSR开关状态
  TSRWarnResp: boolean  % TSR限速警告开关状态
  TSR_Snvty: int8  % TSR超速警告补偿（现行项目为偏移量）
  TSRSpdLimUnit: uint8  % HMI显示限速单位
  TSRSpdLimSts: uint8  % TSR限速状态
  TSRSpdLim: uint8  % TSR限速值显示
  TSRSpdLimCfdc: uint8  % 置信度
  TSRSpdLimWarn: boolean  % TSR超速警告状态
  TSRConSpdLim: uint8  % TSR条件限速值显示
  TSRConSpdLimWarn: boolean  % TSR条件限速超速警告状态
  TSRTrfcSignVal: uint8  % TSR交通标志类型
  TSRTrfcSignValCfdc: uint8  % 置信度

VSM_TSR_REMAIN_BUS = Simulink.Bus(HeaderFile="Rte_Type.h")
  SPL_noSupp_Dist_Remain: single, Min=0
  SPL_whSupp_Dist_Remain: single, Min=0
  TS_SignName_Dist_Remain: single, Min=0
  SPL_noSupp_Value_Remain: uint8, Min=0
  SPL_whSupp_Value_Remain: uint8, Min=0
  TS_SignName_Value_Remain: uint8, Min=0
  SPL_SuppName_Value_Remain: uint8, Min=0

VSM_DATACLCT_INFO_BUS = Simulink.Bus(HeaderFile="Rte_Type.h")
  ACCDataClct_ConNotStsf: uint32
  TJADataClct_ConNotStsf: uint32
  HWADataClct_OverrideHWAExit: boolean
  HWADataClct_DriverBrakeHWAExit: boolean
  HWADataClct_DriverSteerHWAExit: boolean
  ACCDataClct_OverrideACCExit: boolean
  ACCDataClct_DriverBrakeACCExit: boolean
  ACCDataClct_DriverSteerACCExit: boolean
  LDW_Con_AccPedalRate_LDWExit: boolean
  LDW_Con_BrakePressure_LDWExit: boolean
  LDW_Con_SteerWheelAngle_LDWExit: boolean
  LDW_Con_DriverInput_LDWExit: boolean
  LDW_Con_SteerWheelSpd_LDWExit: boolean
  LKA_Con_AccPedalRate_LKAExit: boolean
  LKA_Con_BrakePressure_LKAExit: boolean
  LKA_Con_SteerWheelAngle_LKAExit: boolean
  LKA_Con_DriverInput_LKAExit: boolean
  LKA_Con_SteerWheelSpd_LKAExit: boolean
  LKA_Con_OverRide_LKAExit: boolean
  ELK_Con_AccPedalRate_ELKExit: boolean
  ELK_Con_BrakePressure_ELKExit: boolean
  ELK_Con_SteerWheelAngle_ELKExit: boolean
  ELK_Con_SteerWheelSpd_ELKExit: boolean
  LCK_Con_AccPedalRate_LCKExit: boolean
  LCK_Con_BrakePress_LCKExit: boolean
  LCK_Con_SteerAngleSpd_LCKExit: boolean
  LCK_Con_OverRide_LCKExit: boolean
  LCK_Con_SteerWheelAngle_LCKExit: boolean
  LCK_Con_DriverInput_LCKExit: boolean
  ESSDataClct_OverrideESSExit: boolean
  ESSDataClct_DriverSteerESSExit: boolean

VSM_UOM_LC_BUS = Simulink.Bus(HeaderFile="Rte_Type.h")
  User_LeTurnLmpOn: boolean
  User_RiTurnLmpOn: boolean
  User_LC_LeTurnNextLineReq: boolean
  User_LC_RiTurnNextLineReq: boolean
  User_LC_TurnMostLeLineReq: boolean
  User_LC_TurnMostRiLineReq: boolean
  User_LC_ALCswt: uint8
  User_LC_DrvConfirm: boolean
  User_LC_DrvOverride: uint8
  User_LC_DrvLCswt: uint8

VSM_LON_CTRL_BUS = Simulink.Bus(HeaderFile="Rte_Type.h")
  ACCSts: uint8  % ACC系统状态
  ACC_SpdSetValue: uint8  % ACC设定速度
  ACC_SpdSetValueKmh: single  % ACC设定速度，kmh单位
  ACC_TimeGapSet: uint8  % TimeGap设定值
  vSetBelowMin: boolean
  HWAAccControlSts: uint8  % HWA速度控制状态
  ACC_DrvOffReq: boolean  % ACC请求起步
  ACC_TimeGapSet_HMI: uint8

VSM_HMI_BUS = Simulink.Bus(HeaderFile="Rte_Type.h")
  TJASts: uint8  % TJA系统状态
  HWASts: uint8  % HWA系统状态
  HWAActive: boolean  % HWA激活
  ACC_HazActv: uint8  % 危险报警灯请求点亮标志
  ACC_ModeDisp: uint8  % ACC仪表显示状态
  ACC_ParkShiftReq: boolean  % P档请求
  TJA_ModeDisp: uint8  % TJA仪表显示状态
  HWA_ModeDisp: uint8  % HWA仪表显示状态
  HWASlowRetreat_b: boolean  % HWA缓慢退出状态
  CruiseChauffeur_ModeDisp: uint8  % CruiseChauffeur仪表显示状态
  ACCTextDisp: uint8  % ACC仪表文字提示
  TJATextDisp: uint8  % TJA仪表文字提示
  CCTextDisp: uint8  % CruiseChauffeur仪表文字提示
  HWATextDisp: uint8  % HWA仪表文字提示
  LCKSts: uint8  % LCK系统状态
  HandsOffWarningLevel: uint8  % HandOff报警
  LDWSts: uint8  % LDW系统状态
  LKASts: uint8  % LKA系统状态
  LKAWarning: uint8
  ELKSts: uint8  % ELK系统状态
  LCKIEDist: single
  ACC_ISLResp: boolean  % 智能限速开关反馈信号
  ISL_InterSysInfoDisp: uint8  % 智能限速仪表提示信号
  ISLActive: uint8  % 智能限速状态
  EPBTakeOver_Req: boolean
  ALC_Resp: boolean
  HWA_SnvtySet_Resp: uint8
  HWA_Resp: boolean
  ICA_HandsOffSwtResp: boolean
  TJA_ACC_SelSts: uint8
  HWA_LaneChangeReq: uint8
  HWA_Warning: uint8
  HandsOffDetd: boolean
  LSS_WarnFormSwtResp: uint8
  DriverInloop_Monitor: uint8
  ACC_SOS_Req: boolean
  LaneAvailability: uint8
  TJA_FollowSts: uint8
  ESSSts: uint8
  AESSts: uint8
  LCKIESts: uint8
  HWA_TurnLightReq: uint8
  ACC_DrvrOffDisp: uint8
  NOH_Sts: uint8
  NOH_Swt_Resp: boolean
  NOH_Act_Resp: boolean
  NOH_SysInfoDisplay: uint8
  NOH_DistToExit: uint16
  HiPilotModeSelect: uint8
  HWA_LaneChange: uint8
  HWA_InhibitWarn: uint8
  HWA_WarnInfoDisp: uint8
  NOH_WarnInfoDisplay: uint8