% Simulink data dictionary PubIfVCanP01_V40_RTE.sldd

ABM1_MSG_BUS = Simulink.Bus(HeaderFile="Rte_Type.h")
  CheckSum_ABM1: uint8
  PassSBR: boolean
  DrvSBR: boolean
  RollingCounter_ABM1: uint8
  FreshnessValue_ABM1: uint16
  MAC_Check_ABM1: uint64

ABM1_RAW_BUS = Simulink.Bus(HeaderFile="Rte_Type.h")
  CheckSum_ABM1: uint8  % 1|0|0|255|uint8
  PassSBR: boolean  % 1|0|0|1|boolean
  DrvSBR: boolean  % 1|0|0|1|boolean
  RollingCounter_ABM1: uint8  % 1|0|0|15|uint8
  FreshnessValue_ABM1: uint16  % 1|0|0|65535|uint16
  MAC_Check_ABM1: uint64  % 1|0|0|281474976710655|uint64

ABM2_MSG_BUS = Simulink.Bus(HeaderFile="Rte_Type.h")
  CheckSum_ABM2: uint8
  VehLgtAccel: single
  VehLatAccel: single
  VehYawRate: single
  RollingCounter_ABM2: uint8
  VehDynYawRateVld: boolean
  VehLatAccelVld: boolean
  VehLgtAccelVld: boolean

ABM2_RAW_BUS = Simulink.Bus(HeaderFile="Rte_Type.h")
  CheckSum_ABM2: uint8  % 1|0|0|255|uint8
  VehLgtAccel: uint16  % 0.00098|-21.592|-21.592|21.592|single
  VehLatAccel: uint16  % 0.00098|-21.592|-21.592|21.592|single
  VehYawRate: uint16  % 0.00024|-2.093|-2.093|2.093|single
  RollingCounter_ABM2: uint8  % 1|0|0|15|uint8
  VehDynYawRateVld: boolean  % 1|0|0|1|boolean
  VehLatAccelVld: boolean  % 1|0|0|1|boolean
  VehLgtAccelVld: boolean  % 1|0|0|1|boolean

ABS1_MSG_BUS = Simulink.Bus(HeaderFile="Rte_Type.h")
  CheckSum_ABS1: uint8
  FLWheelSpdVld: boolean
  FLWheelDriveDirection: uint8
  FLWheelSpd: single
  FRWheelSpdVld: boolean
  FRWheelDriveDirection: uint8
  FRWheelSpd: single
  WssFLEdgesSum: uint8
  WssFREdgesSum: uint8
  RollingCounter_ABS1: uint8
  WssFREdgesSumVld: boolean
  WssFLEdgesSumVld: boolean

ABS1_RAW_BUS = Simulink.Bus(HeaderFile="Rte_Type.h")
  CheckSum_ABS1: uint8  % 1|0|0|255|uint8
  FLWheelSpdVld: boolean  % 1|0|0|1|boolean
  FLWheelDriveDirection: uint8  % 1|0|0|3|uint8
  FLWheelSpd: uint16  % 0.05625|0|0|299.9812|single
  FRWheelSpdVld: boolean  % 1|0|0|1|boolean
  FRWheelDriveDirection: uint8  % 1|0|0|3|uint8
  FRWheelSpd: uint16  % 0.05625|0|0|299.9812|single
  WssFLEdgesSum: uint8  % 1|0|0|255|uint8
  WssFREdgesSum: uint8  % 1|0|0|255|uint8
  RollingCounter_ABS1: uint8  % 1|0|0|15|uint8
  WssFREdgesSumVld: boolean  % 1|0|0|1|boolean
  WssFLEdgesSumVld: boolean  % 1|0|0|1|boolean

ABS2_MSG_BUS = Simulink.Bus(HeaderFile="Rte_Type.h")
  CheckSum_ABS2: uint8
  RLWheelSpdVld: boolean
  RLWheelDriveDirection: uint8
  RLWheelSpd: single
  RRWheelSpdVld: boolean
  RRWheelDriveDirection: uint8
  RRWheelSpd: single
  WssRREdgesSum: uint8
  WssRLEdgesSum: uint8
  RollingCounter_ABS2: uint8
  WssRREdgesSumVld: boolean
  WssRLEdgesSumVld: boolean

ABS2_RAW_BUS = Simulink.Bus(HeaderFile="Rte_Type.h")
  CheckSum_ABS2: uint8  % 1|0|0|255|uint8
  RLWheelSpdVld: boolean  % 1|0|0|1|boolean
  RLWheelDriveDirection: uint8  % 1|0|0|3|uint8
  RLWheelSpd: uint16  % 0.05625|0|0|299.9812|single
  RRWheelSpdVld: boolean  % 1|0|0|1|boolean
  RRWheelDriveDirection: uint8  % 1|0|0|3|uint8
  RRWheelSpd: uint16  % 0.05625|0|0|299.9812|single
  WssRREdgesSum: uint8  % 1|0|0|255|uint8
  WssRLEdgesSum: uint8  % 1|0|0|255|uint8
  RollingCounter_ABS2: uint8  % 1|0|0|15|uint8
  WssRREdgesSumVld: boolean  % 1|0|0|1|boolean
  WssRLEdgesSumVld: boolean  % 1|0|0|1|boolean

ABS3_MSG_BUS = Simulink.Bus(HeaderFile="Rte_Type.h")
  CheckSum_ABS3: uint8
  VehSpdVld: boolean
  EBDFailSts: boolean
  ABSFailSts: boolean
  VehSpd: single
  ABSActv: boolean
  EBDActv: boolean
  RollingCounter_ABS3: uint8

ABS3_RAW_BUS = Simulink.Bus(HeaderFile="Rte_Type.h")
  CheckSum_ABS3: uint8  % 1|0|0|255|uint8
  VehSpdVld: boolean  % 1|0|0|1|boolean
  EBDFailSts: boolean  % 1|0|0|1|boolean
  ABSFailSts: boolean  % 1|0|0|1|boolean
  VehSpd: uint16  % 0.05625|0|0|299.9812|single
  ABSActv: boolean  % 1|0|0|1|boolean
  EBDActv: boolean  % 1|0|0|1|boolean
  RollingCounter_ABS3: uint8  % 1|0|0|15|uint8

AC2_MSG_BUS = Simulink.Bus(HeaderFile="Rte_Type.h")
  ACAmbTemp: single

AC2_RAW_BUS = Simulink.Bus(HeaderFile="Rte_Type.h")
  ACAmbTemp: uint8  % 0.5|-40|-40|86.5|single

ACC_FD1_MSG_BUS = Simulink.Bus(HeaderFile="Rte_Type.h")
  Checksum_ACC1: uint8
  Longctrl_Decel_Req: boolean
  Longctrl_ModSts: uint8
  Longctrl_DrvOFF_Req: boolean
  Longctrl_VehHldReq: boolean
  Longctrl_EngTrqReq: single
  Longctrl_ParkShiftReq: uint8
  Longctrl_EPBTakeover_Req: boolean
  Longctrl_DecelToStopReq: boolean
  Longctrl_FuelCutOffPrevn: boolean
  Longctrl_EngTrqReqActive: boolean
  Longctrl_Decel_ReqValue: single
  ActualTargetSpeed: uint8
  RollingCounter_ACC1: uint8
  Checksum_ACC2: uint8
  RollingCounter_ACC2: uint8
  ACC_CRInterface: boolean

ACC_FD1_RAW_BUS = Simulink.Bus(HeaderFile="Rte_Type.h")
  Checksum_ACC1: uint8  % 1|0|0|255|uint8
  Longctrl_Decel_Req: boolean  % 1|0|0|1|boolean
  Longctrl_ModSts: uint8  % 1|0|0|15|uint8
  Longctrl_DrvOFF_Req: boolean  % 1|0|0|1|boolean
  Longctrl_VehHldReq: boolean  % 1|0|0|1|boolean
  Longctrl_EngTrqReq: uint16  % 0.0030518|-100|-100|99.9997|single
  Longctrl_ParkShiftReq: uint8  % 1|0|0|3|uint8
  Longctrl_EPBTakeover_Req: boolean  % 1|0|0|1|boolean
  Longctrl_DecelToStopReq: boolean  % 1|0|0|1|boolean
  Longctrl_FuelCutOffPrevn: boolean  % 1|0|0|1|boolean
  Longctrl_EngTrqReqActive: boolean  % 1|0|0|1|boolean
  Longctrl_Decel_ReqValue: uint8  % 0.05|-7|-7|5.75|single
  ActualTargetSpeed: uint8  % 1|0|0|254|uint8
  RollingCounter_ACC1: uint8  % 1|0|0|15|uint8
  Checksum_ACC2: uint8  % 1|0|0|255|uint8
  RollingCounter_ACC2: uint8  % 1|0|0|15|uint8
  ACC_CRInterface: boolean  % 1|0|0|1|boolean

ACC_FD2_MSG_BUS = Simulink.Bus(HeaderFile="Rte_Type.h")
  ACC_LeTgt_02_Dy: single
  ACC_LeTgt_02_Dx: single
  ACC_RiTargrt_02_Detn: uint8
  ACC_LeTargrt_02_Detn: uint8
  ACC_LeTgt_02_Typ: uint8
  ACC_RiTgt_02_Dx: single
  ACC_RiTgtObjBarDisp: uint8
  ACC_LeTgtObjBarDisp: uint8
  ACC_RiTgt_02_Dy: single
  ACC_RiTgt_02_Typ: uint8
  Checksum_ACC3: uint8
  ALC_Resp: boolean
  HWA_SnvtySet_Resp: uint8
  HWA_Resp: boolean
  ICA_HandsOffResp: boolean
  ISL_Resp: boolean
  Longctrl_EngTrqReqActive_DVR: boolean
  Longctrl_Decel_Req_DVR: boolean
  Longctrl_ModSts_DVR: uint8
  Longctrl_DrvOFF_Req_DVR: boolean
  Longctrl_VehHldReq_DVR: boolean
  Longctrl_EngTrqReq_DVR: single
  Longctrl_Decel_ReqValue_DVR: single
  Longctrl_ParkShiftReq_DVR: uint8
  Longctrl_DecelToStopReq_DVR: boolean
  RollingCounter_ACC3: uint8
  ALC_InterSysInfoDisp: uint8
  Checksum_ACC4: uint8
  ACC_InterSysInfoDisp: uint8
  ACC_TakeOverReq: boolean
  ACC_ObjDetecte: boolean
  ACC_FctSts: uint8
  ACC_ModDisp: uint8
  TJA_ACC_SelSts: uint8
  Longctrl_HazActv: uint8
  ACC_TgtObjBarDisp: uint8
  TJA_ICA_InterSysInfoDisp: uint8
  CruCha_ModDisp: uint8
  ACC_TimeGapSet: uint8
  ISL_InterSysInfoDisp: uint8
  TJA_ICA_ModDisp: uint8
  ACC_SpdSetValue: uint8
  RollingCounter_ACC4: uint8
  CruChar_InterSysInfoDisp: uint8
  Checksum_ACC8: uint8
  HWA_InterSysInfoDisp: uint8
  HWA_ModDisp: uint8
  ADAS_DriverInloop_Monitor: uint8
  HWA_LaneChange: uint8
  HWA_warning: uint8
  HWA_LaneChangeReq: uint8
  RollingCounter_ACC8: uint8
  Checksum_ACC6: uint8
  ACC_PotentialTgtDy: single
  ACC_RlvTgtTyp: uint8
  ACC_EgoStatus: uint8
  ACC_RlvTgtDetn: uint8
  ACC_PotentialTgtDx: single
  ACC_RlvTgtDy: single
  ACC_PotentialTgtTyp: uint8
  ACC_PotentialTgtDetn: uint8
  ACC_RlvTgtDx: single
  RollingCounter_ACC6: uint8
  IntelligentCurveAct: boolean
  Checksum_ACC7: uint8
  ACC_LeTgtDy: single
  ACC_RiTargrtDetn: uint8
  ACC_LeTargrtDection: uint8
  ACC_LeTgtTyp: uint8
  ACC_LeTgtDx: single
  ACC_RiTgtDy: single
  ACC_RiTgtTyp: uint8
  ACC_RiTgtDx: single
  RollingCounter_ACC7: uint8
  Request_driveoff: uint8
  ACC_LeTgtfusion: boolean
  ACC_RlvTgtHeading: single
  ACC_RlvTgtfusion: boolean
  ACC_PotentialTgtfusion: boolean
  ACC_RiTgtfusion: boolean
  ACC_LeTgtHeading: single
  ACC_RiTgtHeading: single
  ACC_PotentialTgtHeading: single
  TargetCutoutPro: single
  TargetCutinPro: single
  FreshnessValue_ACC_FD2: uint16
  MAC_Check_ACC_FD2: uint64

ACC_FD2_RAW_BUS = Simulink.Bus(HeaderFile="Rte_Type.h")
  ACC_LeTgt_02_Dy: uint8  % 0.1|0|0|8|single
  ACC_LeTgt_02_Dx: uint16  % 0.5|0|0|150|single
  ACC_RiTargrt_02_Detn: uint8  % 1|0|0|3|uint8
  ACC_LeTargrt_02_Detn: uint8  % 1|0|0|3|uint8
  ACC_LeTgt_02_Typ: uint8  % 1|0|0|7|uint8
  ACC_RiTgt_02_Dx: uint16  % 0.5|0|0|150|single
  ACC_RiTgtObjBarDisp: uint8  % 1|0|0|7|uint8
  ACC_LeTgtObjBarDisp: uint8  % 1|0|0|7|uint8
  ACC_RiTgt_02_Dy: uint8  % 0.1|-8|-8|0|single
  ACC_RiTgt_02_Typ: uint8  % 1|0|0|7|uint8
  Checksum_ACC3: uint8  % 1|0|0|255|uint8
  ALC_Resp: boolean  % 1|0|0|1|boolean
  HWA_SnvtySet_Resp: uint8  % 1|0|0|3|uint8
  HWA_Resp: boolean  % 1|0|0|1|boolean
  ICA_HandsOffResp: boolean  % 1|0|0|1|boolean
  ISL_Resp: boolean  % 1|0|0|1|boolean
  Longctrl_EngTrqReqActive_DVR: boolean  % 1|0|0|1|boolean
  Longctrl_Decel_Req_DVR: boolean  % 1|0|0|1|boolean
  Longctrl_ModSts_DVR: uint8  % 1|0|0|15|uint8
  Longctrl_DrvOFF_Req_DVR: boolean  % 1|0|0|1|boolean
  Longctrl_VehHldReq_DVR: boolean  % 1|0|0|1|boolean
  Longctrl_EngTrqReq_DVR: uint16  % 0.0030518|-100|-100|99.9997|single
  Longctrl_Decel_ReqValue_DVR: uint8  % 0.05|-7|-7|5.75|single
  Longctrl_ParkShiftReq_DVR: uint8  % 1|0|0|3|uint8
  Longctrl_DecelToStopReq_DVR: boolean  % 1|0|0|1|boolean
  RollingCounter_ACC3: uint8  % 1|0|0|15|uint8
  ALC_InterSysInfoDisp: uint8  % 1|0|0|3|uint8
  Checksum_ACC4: uint8  % 1|0|0|255|uint8
  ACC_InterSysInfoDisp: uint8  % 1|0|0|31|uint8
  ACC_TakeOverReq: boolean  % 1|0|0|1|boolean
  ACC_ObjDetecte: boolean  % 1|0|0|1|boolean
  ACC_FctSts: uint8  % 1|0|0|3|uint8
  ACC_ModDisp: uint8  % 1|0|0|31|uint8
  TJA_ACC_SelSts: uint8  % 1|0|0|7|uint8
  Longctrl_HazActv: uint8  % 1|0|0|3|uint8
  ACC_TgtObjBarDisp: uint8  % 1|0|0|7|uint8
  TJA_ICA_InterSysInfoDisp: uint8  % 1|0|0|7|uint8
  CruCha_ModDisp: uint8  % 1|0|0|15|uint8
  ACC_TimeGapSet: uint8  % 1|0|0|7|uint8
  ISL_InterSysInfoDisp: uint8  % 1|0|0|3|uint8
  TJA_ICA_ModDisp: uint8  % 1|0|0|7|uint8
  ACC_SpdSetValue: uint8  % 1|0|0|255|uint8
  RollingCounter_ACC4: uint8  % 1|0|0|15|uint8
  CruChar_InterSysInfoDisp: uint8  % 1|0|0|15|uint8
  Checksum_ACC8: uint8  % 1|0|0|255|uint8
  HWA_InterSysInfoDisp: uint8  % 1|0|0|15|uint8
  HWA_ModDisp: uint8  % 1|0|0|15|uint8
  ADAS_DriverInloop_Monitor: uint8  % 1|7|7|7|uint8
  HWA_LaneChange: uint8  % 1|0|0|3|uint8
  HWA_warning: uint8  % 1|0|0|3|uint8
  HWA_LaneChangeReq: uint8  % 1|0|0|7|uint8
  RollingCounter_ACC8: uint8  % 1|0|0|15|uint8
  Checksum_ACC6: uint8  % 1|0|0|255|uint8
  ACC_PotentialTgtDy: uint8  % 0.1|-8|-8|8|single
  ACC_RlvTgtTyp: uint8  % 1|0|0|7|uint8
  ACC_EgoStatus: uint8  % 1|0|0|3|uint8
  ACC_RlvTgtDetn: uint8  % 1|0|0|3|uint8
  ACC_PotentialTgtDx: uint16  % 0.5|0|0|150|single
  ACC_RlvTgtDy: uint8  % 0.1|-8|-8|8|single
  ACC_PotentialTgtTyp: uint8  % 1|0|0|7|uint8
  ACC_PotentialTgtDetn: uint8  % 1|0|0|3|uint8
  ACC_RlvTgtDx: uint16  % 0.5|0|0|150|single
  RollingCounter_ACC6: uint8  % 1|0|0|15|uint8
  IntelligentCurveAct: boolean  % 1|0|0|1|boolean
  Checksum_ACC7: uint8  % 1|0|0|255|uint8
  ACC_LeTgtDy: uint8  % 0.1|-8|-8|8|single
  ACC_RiTargrtDetn: uint8  % 1|0|0|3|uint8
  ACC_LeTargrtDection: uint8  % 1|0|0|3|uint8
  ACC_LeTgtTyp: uint8  % 1|0|0|7|uint8
  ACC_LeTgtDx: uint16  % 0.5|0|0|150|single
  ACC_RiTgtDy: uint8  % 0.1|-8|-8|8|single
  ACC_RiTgtTyp: uint8  % 1|0|0|7|uint8
  ACC_RiTgtDx: uint16  % 0.5|0|0|150|single
  RollingCounter_ACC7: uint8  % 1|0|0|15|uint8
  Request_driveoff: uint8  % 1|0|0|7|uint8
  ACC_LeTgtfusion: boolean  % 1|0|0|1|boolean
  ACC_RlvTgtHeading: uint8  % 0.05|-1.5|-1.5|1.5|single
  ACC_RlvTgtfusion: boolean  % 1|0|0|1|boolean
  ACC_PotentialTgtfusion: boolean  % 1|0|0|1|boolean
  ACC_RiTgtfusion: boolean  % 1|0|0|1|boolean
  ACC_LeTgtHeading: uint8  % 0.05|-1.5|-1.5|1.5|single
  ACC_RiTgtHeading: uint8  % 0.05|-1.5|-1.5|1.5|single
  ACC_PotentialTgtHeading: uint8  % 0.05|-1.5|-1.5|1.5|single
  TargetCutoutPro: uint8  % 0.02|0|0|1|single
  TargetCutinPro: uint8  % 0.02|0|0|1|single
  FreshnessValue_ACC_FD2: uint16  % 1|0|0|65535|uint16
  MAC_Check_ACC_FD2: uint64  % 1|0|0|281474976710655|uint64

ACC_FD3_MSG_BUS = Simulink.Bus(HeaderFile="Rte_Type.h")
  AEB_LePedDy: single
  AEB_RiPedDy: single
  AEB_LeCyclistDy: single
  AEB_RiCyclistDy: single
  AEB_LePedDetn: uint8
  JAPedObjExist: single
  AEB_RiPedDetn: uint8
  AEB_RiPedTyp: uint8
  AEB_LePedTyp: uint8
  AEB_RiCyclist_collisionprob: boolean
  AEB_LeCyclist_collisionprob: boolean
  AEB_RiPed_collisionprob: boolean
  AEB_LePed_collisionprob: boolean
  AEBJAObjID: uint8
  JAPedObjVideoCfmd: boolean
  AEBJAObjVideoCfmd: boolean
  AEBJAObjExist: single
  AEBJAObjVx: single
  AEBJAObjDx: single
  JAPedObjID: uint8
  AEBJAObjState: uint8
  AEBJAObjCntAlive: uint16
  AEBJAObjDy: single
  AEBJAObjObstcl: single
  AEBJAObjVy: single
  AEBJAObjAx: single
  JAPedObjState: uint8
  JAPedObjObstcl: single
  AEBJAObjAy: single
  JAPedObjDy: single
  JAPedObjDx: single
  FCWAEB_JATTC: single
  JAPedObjVx: single
  JAPedObjCntAlive: uint16
  JAPedObjVy: single
  JAPedObjAy: single
  AEB_LePedHeading: single
  JAPedObjAx: single
  AEB_RiPedHeading: single
  AEB_LeCyclistHeading: single
  FCWAEB_longTTC: single
  AEB_RiCyclistHeading: single
  FCWAEB_crossingTTC: single
  AEB_LePedDx: single
  AEB_LeCyclistTyp: uint8
  AEB_LeCyclistDetn: uint8
  AEB_RiPedDx: single
  AEB_RiCyclistDetn: uint8
  AEB_LeCyclistDx: single
  AEB_RiCyclistTyp: uint8
  AEB_RiCyclistDx: single

ACC_FD3_RAW_BUS = Simulink.Bus(HeaderFile="Rte_Type.h")
  AEB_LePedDy: uint8  % 0.1|-8|-8|8|single
  AEB_RiPedDy: uint8  % 0.1|-8|-8|8|single
  AEB_LeCyclistDy: uint8  % 0.1|-8|-8|8|single
  AEB_RiCyclistDy: uint8  % 0.1|-8|-8|8|single
  AEB_LePedDetn: uint8  % 1|0|0|3|uint8
  JAPedObjExist: uint8  % 0.015625|0|0|0.98438|single
  AEB_RiPedDetn: uint8  % 1|0|0|3|uint8
  AEB_RiPedTyp: uint8  % 1|0|0|7|uint8
  AEB_LePedTyp: uint8  % 1|0|0|7|uint8
  AEB_RiCyclist_collisionprob: boolean  % 1|0|0|1|boolean
  AEB_LeCyclist_collisionprob: boolean  % 1|0|0|1|boolean
  AEB_RiPed_collisionprob: boolean  % 1|0|0|1|boolean
  AEB_LePed_collisionprob: boolean  % 1|0|0|1|boolean
  AEBJAObjID: uint8  % 1|0|0|255|uint8
  JAPedObjVideoCfmd: boolean  % 1|0|0|1|boolean
  AEBJAObjVideoCfmd: boolean  % 1|0|0|1|boolean
  AEBJAObjExist: uint8  % 0.015625|0|0|0.98438|single
  AEBJAObjVx: uint16  % 0.0625|-128|-128|127|single
  AEBJAObjDx: uint16  % 0.0625|0|0|255.9375|single
  JAPedObjID: uint8  % 1|0|0|255|uint8
  AEBJAObjState: uint8  % 1|0|0|7|uint8
  AEBJAObjCntAlive: uint16  % 17|0|0|65535|uint16
  AEBJAObjDy: uint16  % 0.125|-128|-128|127.875|single
  AEBJAObjObstcl: uint8  % 0.03125|0|0|0.96875|single
  AEBJAObjVy: uint16  % 0.125|-64|-64|63.875|single
  AEBJAObjAx: uint16  % 0.03125|-16|-16|15.9688|single
  JAPedObjState: uint8  % 1|0|0|7|uint8
  JAPedObjObstcl: uint8  % 0.03125|0|0|0.96875|single
  AEBJAObjAy: uint16  % 0.03125|-16|-16|15.9688|single
  JAPedObjDy: uint16  % 0.125|-128|-128|127.875|single
  JAPedObjDx: uint16  % 0.0625|0|0|255.9375|single
  FCWAEB_JATTC: uint8  % 0.1|0|0|6.3|single
  JAPedObjVx: uint16  % 0.0625|-128|-128|127|single
  JAPedObjCntAlive: uint16  % 17|0|0|65535|uint16
  JAPedObjVy: uint16  % 0.125|-64|-64|63.875|single
  JAPedObjAy: uint16  % 0.03125|-16|-16|15.9688|single
  AEB_LePedHeading: uint8  % 0.05|-3|-3|0|single
  JAPedObjAx: uint16  % 0.03125|-16|-16|15.9688|single
  AEB_RiPedHeading: uint8  % 0.05|0|0|3|single
  AEB_LeCyclistHeading: uint8  % 0.05|-3|-3|0|single
  FCWAEB_longTTC: uint8  % 0.1|0|0|6.3|single
  AEB_RiCyclistHeading: uint8  % 0.05|0|0|3|single
  FCWAEB_crossingTTC: uint8  % 0.1|0|0|6.3|single
  AEB_LePedDx: uint16  % 0.5|0|0|150|single
  AEB_LeCyclistTyp: uint8  % 1|0|0|7|uint8
  AEB_LeCyclistDetn: uint8  % 1|0|0|3|uint8
  AEB_RiPedDx: uint16  % 0.5|0|0|150|single
  AEB_RiCyclistDetn: uint8  % 1|0|0|3|uint8
  AEB_LeCyclistDx: uint16  % 0.5|0|0|150|single
  AEB_RiCyclistTyp: uint8  % 1|0|0|7|uint8
  AEB_RiCyclistDx: uint16  % 0.5|0|0|150|single

ACC_FD4_MSG_BUS = Simulink.Bus(HeaderFile="Rte_Type.h")
  AEBObjID: uint8
  AEBObjVideoCfmd: boolean
  AEBObjExist: single
  AEBObjVx: single
  AEBObjDx: single
  AEBObjCntAlive: uint16
  AEBObjDy: single
  AEBObjObstcl: single
  AEBObjState: uint8
  CyclistObjExist: single
  AEBObjVy: single
  AEBObjAx: single
  AEBObjAy: single
  CyclistObjDx: single
  CyclistObjID: uint8
  CyclistObjObstcl: single
  CyclistObjDy: single
  CyclistObjVx: single
  CyclistObjCntAlive: uint16
  CyclistObjVideoCfmd: boolean
  CyclistObjState: uint8
  CyclistObjVy: single
  CyclistObjAx: single
  PedObjExist: single
  CyclistObjAy: single
  PedObjID: uint8
  PedObjObstcl: single
  PedObjDy: single
  PedObjDx: single
  PedObjVx: single
  PedObjVideoCfmd: boolean
  PedObjVy: single
  ACCTgtObjDx: single
  PedObjAy: single
  PedObjCntAlive: uint16
  PedObjAx: single
  ACCTgtObjID: uint8
  ACCTgtObjObstcl: single
  ACCTgtObjDy: single
  ACCTgtObjExist: single
  ACCTgtObjVy: single
  ACCTgtObjVx: single
  ACCTgtObjAx: single
  ACCTgtObjAy: single
  ACCTgtObjVideoCfmd: boolean
  ACCTgtObjState: uint8
  ACCTgtObjCntAlive: uint16
  DrvgOnHiWay: uint8
  HandsoffDetd: uint8
  RadarHorMisalign: single
  SpdLimitDst: uint16
  RoadCrvt: single
  RampDst: uint16
  RoadCrvtFar: single
  SpdLimit: uint8
  NavSpdLimUnit: uint8
  CurveDst: uint16
  DrvgOnRiLane: uint8
  TunnelDst: uint16
  RadarDrvrAttentive: boolean
  BrdgDst: uint16
  PedObjState: uint8
  ACC_SOSReq: uint8
  ACC_DataRecReq: uint8
  DrvrSts: uint8
  MapDataValid: boolean
  AEBObjDrvby: uint8
  AEBObjOverlap: uint8

ACC_FD4_RAW_BUS = Simulink.Bus(HeaderFile="Rte_Type.h")
  AEBObjID: uint8  % 1|0|0|255|uint8
  AEBObjVideoCfmd: boolean  % 1|0|0|1|boolean
  AEBObjExist: uint8  % 0.015625|0|0|0.98438|single
  AEBObjVx: uint16  % 0.0625|-128|-128|127|single
  AEBObjDx: uint16  % 0.0625|0|0|255.9375|single
  AEBObjCntAlive: uint16  % 1|0|0|3855|uint16
  AEBObjDy: uint16  % 0.125|-128|-128|127.875|single
  AEBObjObstcl: uint8  % 0.03125|0|0|0.96875|single
  AEBObjState: uint8  % 1|0|0|7|uint8
  CyclistObjExist: uint8  % 0.015625|0|0|0.98438|single
  AEBObjVy: uint16  % 0.125|-64|-64|63.875|single
  AEBObjAx: uint16  % 0.03125|-16|-16|15.9688|single
  AEBObjAy: uint16  % 0.03125|-16|-16|15.9688|single
  CyclistObjDx: uint16  % 0.0625|0|0|255.9375|single
  CyclistObjID: uint8  % 1|0|0|255|uint8
  CyclistObjObstcl: uint8  % 0.03125|0|0|0.96875|single
  CyclistObjDy: uint16  % 0.125|-128|-128|127.875|single
  CyclistObjVx: uint16  % 0.0625|-128|-128|127|single
  CyclistObjCntAlive: uint16  % 1|0|0|3855|uint16
  CyclistObjVideoCfmd: boolean  % 1|0|0|1|boolean
  CyclistObjState: uint8  % 1|0|0|7|uint8
  CyclistObjVy: uint16  % 0.125|-64|-64|63.875|single
  CyclistObjAx: uint16  % 0.03125|-16|-16|15.9688|single
  PedObjExist: uint8  % 0.015625|0|0|0.98438|single
  CyclistObjAy: uint16  % 0.03125|-16|-16|15.9688|single
  PedObjID: uint8  % 1|0|0|255|uint8
  PedObjObstcl: uint8  % 0.03125|0|0|0.96875|single
  PedObjDy: uint16  % 0.125|-128|-128|127.875|single
  PedObjDx: uint16  % 0.0625|0|0|255.9375|single
  PedObjVx: uint16  % 0.0625|-128|-128|127|single
  PedObjVideoCfmd: boolean  % 1|0|0|1|boolean
  PedObjVy: uint16  % 0.125|-64|-64|63.875|single
  ACCTgtObjDx: uint16  % 0.0625|0|0|255.9375|single
  PedObjAy: uint16  % 0.03125|-16|-16|15.9688|single
  PedObjCntAlive: uint16  % 1|0|0|3855|uint16
  PedObjAx: uint16  % 0.03125|-16|-16|15.9688|single
  ACCTgtObjID: uint8  % 1|0|0|255|uint8
  ACCTgtObjObstcl: uint8  % 0.03125|0|0|0.96875|single
  ACCTgtObjDy: uint16  % 0.125|-128|-128|127.875|single
  ACCTgtObjExist: uint8  % 0.015625|0|0|0.98438|single
  ACCTgtObjVy: uint16  % 0.125|-64|-64|63.875|single
  ACCTgtObjVx: uint16  % 0.0625|-128|-128|127|single
  ACCTgtObjAx: uint16  % 0.03125|-16|-16|15.9688|single
  ACCTgtObjAy: uint16  % 0.03125|-16|-16|15.9688|single
  ACCTgtObjVideoCfmd: boolean  % 1|0|0|1|boolean
  ACCTgtObjState: uint8  % 1|0|0|7|uint8
  ACCTgtObjCntAlive: uint16  % 1|0|0|3855|uint16
  DrvgOnHiWay: uint8  % 1|0|0|3|uint8
  HandsoffDetd: uint8  % 1|0|0|3|uint8
  RadarHorMisalign: uint16  % 0.0001|-0.2048|-0.2048|0.2047|single
  SpdLimitDst: uint8  % 10|0|0|600|uint16
  RoadCrvt: uint16  % 0.00032|-0.16352|-0.16352|0.16352|single
  RampDst: uint8  % 10|0|0|600|uint16
  RoadCrvtFar: uint16  % 0.00032|-0.16352|-0.16352|0.16352|single
  SpdLimit: uint8  % 1|0|0|255|uint8
  NavSpdLimUnit: uint8  % 1|0|0|3|uint8
  CurveDst: uint8  % 10|0|0|600|uint16
  DrvgOnRiLane: uint8  % 1|0|0|3|uint8
  TunnelDst: uint8  % 10|0|0|600|uint16
  RadarDrvrAttentive: boolean  % 1|0|0|1|boolean
  BrdgDst: uint8  % 10|0|0|600|uint16
  PedObjState: uint8  % 1|0|0|7|uint8
  ACC_SOSReq: uint8  % 1|0|0|3|uint8
  ACC_DataRecReq: uint8  % 1|0|0|7|uint8
  DrvrSts: uint8  % 1|0|0|7|uint8
  MapDataValid: boolean  % 1|0|0|1|boolean
  AEBObjDrvby: uint8  % 1|0|0|31|uint8
  AEBObjOverlap: uint8  % 1|0|0|31|uint8

AEB_FD1_MSG_BUS = Simulink.Bus(HeaderFile="Rte_Type.h")
  Checksum_AEB1: uint8
  AEB_ABP_Req: boolean
  AEB_AWB_Req: boolean
  AEB_TgtDecel_Req: boolean
  AEB_VehHldReq: boolean
  EBA_TgtDecel_Req: boolean
  AEB_ABA_Req: boolean
  AEB_ABA_Level: uint8
  AEB_TgtDecel_ReqValue: single
  AEB_BrkReqFunc: uint8
  AEB_AWB_Level: uint8
  AEB_ObjSty: uint8
  RollingCounter_AEB1: uint8

AEB_FD1_RAW_BUS = Simulink.Bus(HeaderFile="Rte_Type.h")
  Checksum_AEB1: uint8  % 1|0|0|255|uint8
  AEB_ABP_Req: boolean  % 1|0|0|1|boolean
  AEB_AWB_Req: boolean  % 1|0|0|1|boolean
  AEB_TgtDecel_Req: boolean  % 1|0|0|1|boolean
  AEB_VehHldReq: boolean  % 1|0|0|1|boolean
  EBA_TgtDecel_Req: boolean  % 1|0|0|1|boolean
  AEB_ABA_Req: boolean  % 1|0|0|1|boolean
  AEB_ABA_Level: uint8  % 1|0|0|3|uint8
  AEB_TgtDecel_ReqValue: uint16  % 0.000488|-16|-16|16|single
  AEB_BrkReqFunc: uint8  % 1|0|0|7|uint8
  AEB_AWB_Level: uint8  % 1|0|0|15|uint8
  AEB_ObjSty: uint8  % 1|0|0|7|uint8
  RollingCounter_AEB1: uint8  % 1|0|0|15|uint8

AEB_FD2_MSG_BUS = Simulink.Bus(HeaderFile="Rte_Type.h")
  Checksum_AEB2: uint8
  AEB_JA_Resp: boolean
  FCW_Snvty: uint8
  AEB_VehResp: boolean
  AEB_PedResp: boolean
  RollingCounter_AEB2: uint8
  Checksum_AEB3: uint8
  FCW_AEB_VehFctSts: uint8
  AEB_PedTrig: boolean
  AEB_VehTrig: boolean
  AEB_JA_Warn: uint8
  AEB_JAFuncSts: uint8
  FCW_Warn: uint8
  FCW_AEB_PedFctSts: uint8
  AEB_JABrkTrig: uint8
  RollingCounter_AEB3: uint8
  FreshnessValue_AEB_FD2: uint16
  MAC_Check_AEB_FD2: uint64

AEB_FD2_RAW_BUS = Simulink.Bus(HeaderFile="Rte_Type.h")
  Checksum_AEB2: uint8  % 1|0|0|255|uint8
  AEB_JA_Resp: boolean  % 1|0|0|1|boolean
  FCW_Snvty: uint8  % 1|0|0|3|uint8
  AEB_VehResp: boolean  % 1|0|0|1|boolean
  AEB_PedResp: boolean  % 1|0|0|1|boolean
  RollingCounter_AEB2: uint8  % 1|0|0|15|uint8
  Checksum_AEB3: uint8  % 1|0|0|255|uint8
  FCW_AEB_VehFctSts: uint8  % 1|0|0|3|uint8
  AEB_PedTrig: boolean  % 1|0|0|1|boolean
  AEB_VehTrig: boolean  % 1|0|0|1|boolean
  AEB_JA_Warn: uint8  % 1|0|0|3|uint8
  AEB_JAFuncSts: uint8  % 1|0|0|3|uint8
  FCW_Warn: uint8  % 1|0|0|3|uint8
  FCW_AEB_PedFctSts: uint8  % 1|0|0|3|uint8
  AEB_JABrkTrig: uint8  % 1|0|0|3|uint8
  RollingCounter_AEB3: uint8  % 1|0|0|15|uint8
  FreshnessValue_AEB_FD2: uint16  % 1|0|0|65535|uint16
  MAC_Check_AEB_FD2: uint64  % 1|0|0|281474976710655|uint64

BCM1_MSG_BUS = Simulink.Bus(HeaderFile="Rte_Type.h")
  WindshldWiprActvSts: boolean
  RRDoorSts: boolean
  PassengerDoorSts: boolean
  LRDoorSts: boolean
  DrvDoorSts: boolean
  TrunkSts: boolean
  FreshnessValue_BCM1: uint16
  MAC_Check_BCM1: uint64

BCM1_RAW_BUS = Simulink.Bus(HeaderFile="Rte_Type.h")
  WindshldWiprActvSts: boolean  % 1|0|0|1|boolean
  RRDoorSts: boolean  % 1|0|0|1|boolean
  PassengerDoorSts: boolean  % 1|0|0|1|boolean
  LRDoorSts: boolean  % 1|0|0|1|boolean
  DrvDoorSts: boolean  % 1|0|0|1|boolean
  TrunkSts: boolean  % 1|0|0|1|boolean
  FreshnessValue_BCM1: uint16  % 1|0|0|65535|uint16
  MAC_Check_BCM1: uint64  % 1|0|0|281474976710655|uint64

BCM3_MSG_BUS = Simulink.Bus(HeaderFile="Rte_Type.h")
  HazardLmpSwtSts: boolean
  FreshnessValue_BCM3: uint16
  MAC_Check_BCM3: uint64

BCM3_RAW_BUS = Simulink.Bus(HeaderFile="Rte_Type.h")
  HazardLmpSwtSts: boolean  % 1|0|0|1|boolean
  FreshnessValue_BCM3: uint16  % 1|0|0|65535|uint16
  MAC_Check_BCM3: uint64  % 1|0|0|281474976710655|uint64

BCM8_MSG_BUS = Simulink.Bus(HeaderFile="Rte_Type.h")
  Checksum_BCM8: uint8
  PASWorkCmd: boolean
  RViewMirrorSts: boolean
  RSDS_RLEDSts: boolean
  RSDS_LLEDSts: boolean
  WiprReq_F_Pbox: uint8
  Rollingcounter_BCM8: uint8
  KL30BRelaySts: boolean

BCM8_RAW_BUS = Simulink.Bus(HeaderFile="Rte_Type.h")
  Checksum_BCM8: uint8  % 1|0|0|255|uint8
  PASWorkCmd: boolean  % 1|0|0|1|boolean
  RViewMirrorSts: boolean  % 1|0|0|1|boolean
  RSDS_RLEDSts: boolean  % 1|0|0|1|boolean
  RSDS_LLEDSts: boolean  % 1|0|0|1|boolean
  WiprReq_F_Pbox: uint8  % 1|0|0|7|uint8
  Rollingcounter_BCM8: uint8  % 1|0|0|15|uint8
  KL30BRelaySts: boolean  % 1|0|0|1|boolean

BLE1_MSG_BUS = Simulink.Bus(HeaderFile="Rte_Type.h")
  Checksum_BLE1: uint8
  BLESecuritySts: uint8
  BLEConnSts: uint8
  PrkOutModSel_Rmt: uint8
  ParkAbortReq_Rmt: boolean
  PrkOutVehStrtReq_Rmt: boolean
  PrkgslidReq_Rmt: boolean
  PrkOutTypeReq_Rmt: uint8
  PrkOutVehStrtReq_Rmt_Valid: boolean
  PrkgSyncStrtReq_Rmt: boolean
  RollingCounter_BLE1: uint8

BLE1_RAW_BUS = Simulink.Bus(HeaderFile="Rte_Type.h")
  Checksum_BLE1: uint8  % 1|0|0|255|uint8
  BLESecuritySts: uint8  % 1|0|0|3|uint8
  BLEConnSts: uint8  % 1|0|0|3|uint8
  PrkOutModSel_Rmt: uint8  % 1|0|0|7|uint8
  ParkAbortReq_Rmt: boolean  % 1|0|0|1|boolean
  PrkOutVehStrtReq_Rmt: boolean  % 1|0|0|1|boolean
  PrkgslidReq_Rmt: boolean  % 1|0|0|1|boolean
  PrkOutTypeReq_Rmt: uint8  % 1|0|0|3|uint8
  PrkOutVehStrtReq_Rmt_Valid: boolean  % 1|0|0|1|boolean
  PrkgSyncStrtReq_Rmt: boolean  % 1|0|0|1|boolean
  RollingCounter_BLE1: uint8  % 1|0|0|15|uint8

CR_FD1_MSG_BUS = Simulink.Bus(HeaderFile="Rte_Type.h")
  Checksum_CR_R_1: uint8
  FCTA_Warn: boolean
  FCTA_B_FuncSts: uint8
  CR_FCTB_Resp: boolean
  CR_FCTA_Resp: boolean
  FCTB_ABA_Req: boolean
  FCTB_ABA_Level: uint8
  FCTBTrig: boolean
  CR_BrkgReq: boolean
  CR_BliSts: boolean
  CR_ErrSts: boolean
  CR_BrkgReqVal: single
  FCTA_B_TTC: single
  FCTB_ABP_Req: boolean
  RollingCounter_CR_R_1: uint8
  Checksum_CR_R_2: uint8
  CR_ObjDistY_Le: single
  CR_ObjID_Le: uint8
  CR_ObjDistX_Le: single
  CR_ObjRelVelX_Le: single
  CR_ObjSts_Le: uint8
  CR_ObjRelAccelX_Le: single
  RollingCounter_CR_R_2: uint8
  CR_ObjMotionType_Le: uint8
  Checksum_CR_R_3: uint8
  CR_ObjDistY_Ri: single
  CR_ObjID_Ri: uint8
  CR_ObjDistX_Ri: single
  CR_ObjRelVelX_Ri: single
  CR_ObjSts_Ri: uint8
  CR_ObjRelAccelX_Ri: single
  RollingCounter_CR_R_3: uint8
  CR_ObjMotionType_Ri: uint8
  Checksum_CR_R_4: uint8
  CR_ObjRelAccelY_Ri: single
  CR_ObjRelAccelY_Le: single
  CR_ObjRelVelY_Ri: single
  CR_ObjRelVelY_Le: single
  RollingCounter_CR_R_4: uint8
  CR_ObjDistXStd_Le: single
  CR_ObjRelVelXStd_Le: single
  CR_ObjDistYStd_Le: single
  CR_ObjRelVelYStd_Le: single
  CR_ObjRAccelYStd_Le: single
  CR_ObjRAccelXStd_Le: single
  CR_ObjDistYStd_Ri: single
  CR_ObjDistXStd_Ri: single
  CR_ObjRelVelXStd_Ri: single
  CR_ObjRelVelYStd_Ri: single
  CR_ObjRAccelYStd_Ri: single
  CR_ObjRAccelXStd_Ri: single

CR_FD1_RAW_BUS = Simulink.Bus(HeaderFile="Rte_Type.h")
  Checksum_CR_R_1: uint8  % 1|0|0|255|uint8
  FCTA_Warn: boolean  % 1|0|0|1|boolean
  FCTA_B_FuncSts: uint8  % 1|0|0|3|uint8
  CR_FCTB_Resp: boolean  % 1|0|0|1|boolean
  CR_FCTA_Resp: boolean  % 1|0|0|1|boolean
  FCTB_ABA_Req: boolean  % 1|0|0|1|boolean
  FCTB_ABA_Level: uint8  % 1|0|0|3|uint8
  FCTBTrig: boolean  % 1|0|0|1|boolean
  CR_BrkgReq: boolean  % 1|0|0|1|boolean
  CR_BliSts: boolean  % 1|0|0|1|boolean
  CR_ErrSts: boolean  % 1|0|0|1|boolean
  CR_BrkgReqVal: uint16  % 0.000488|-16|-16|16|single
  FCTA_B_TTC: uint8  % 0.1|0|0|6.3|single
  FCTB_ABP_Req: boolean  % 1|0|0|1|boolean
  RollingCounter_CR_R_1: uint8  % 1|0|0|15|uint8
  Checksum_CR_R_2: uint8  % 1|0|0|255|uint8
  CR_ObjDistY_Le: uint8  % 0.1|-12.8|-12.8|12.7|single
  CR_ObjID_Le: uint8  % 1|0|0|63|uint8
  CR_ObjDistX_Le: uint16  % 0.1|-10|-10|92.3|single
  CR_ObjRelVelX_Le: uint16  % 0.1|-60|-60|42.3|single
  CR_ObjSts_Le: uint8  % 1|0|0|3|uint8
  CR_ObjRelAccelX_Le: uint16  % 0.03125|-16|-16|15.9688|single
  RollingCounter_CR_R_2: uint8  % 1|0|0|15|uint8
  CR_ObjMotionType_Le: uint8  % 1|0|0|7|uint8
  Checksum_CR_R_3: uint8  % 1|0|0|255|uint8
  CR_ObjDistY_Ri: uint8  % 0.1|-12.8|-12.8|12.7|single
  CR_ObjID_Ri: uint8  % 1|0|0|63|uint8
  CR_ObjDistX_Ri: uint16  % 0.1|-10|-10|92.3|single
  CR_ObjRelVelX_Ri: uint16  % 0.1|-60|-60|42.3|single
  CR_ObjSts_Ri: uint8  % 1|0|0|3|uint8
  CR_ObjRelAccelX_Ri: uint16  % 0.03125|-16|-16|15.9688|single
  RollingCounter_CR_R_3: uint8  % 1|0|0|15|uint8
  CR_ObjMotionType_Ri: uint8  % 1|0|0|7|uint8
  Checksum_CR_R_4: uint8  % 1|0|0|255|uint8
  CR_ObjRelAccelY_Ri: uint16  % 0.03125|-16|-16|15.9688|single
  CR_ObjRelAccelY_Le: uint16  % 0.03125|-16|-16|15.9688|single
  CR_ObjRelVelY_Ri: uint8  % 0.1|-6.4|-6.4|6.3|single
  CR_ObjRelVelY_Le: uint8  % 0.1|-6.4|-6.4|6.3|single
  RollingCounter_CR_R_4: uint8  % 1|0|0|15|uint8
  CR_ObjDistXStd_Le: uint8  % 0.375|0|0|11.625|single
  CR_ObjRelVelXStd_Le: uint8  % 0.375|0|0|11.625|single
  CR_ObjDistYStd_Le: uint8  % 0.375|0|0|11.625|single
  CR_ObjRelVelYStd_Le: uint8  % 0.375|0|0|11.625|single
  CR_ObjRAccelYStd_Le: uint8  % 0.375|0|0|11.625|single
  CR_ObjRAccelXStd_Le: uint8  % 0.375|0|0|11.625|single
  CR_ObjDistYStd_Ri: uint8  % 0.375|0|0|11.625|single
  CR_ObjDistXStd_Ri: uint8  % 0.375|0|0|11.625|single
  CR_ObjRelVelXStd_Ri: uint8  % 0.375|0|0|11.625|single
  CR_ObjRelVelYStd_Ri: uint8  % 0.375|0|0|11.625|single
  CR_ObjRAccelYStd_Ri: uint8  % 0.375|0|0|11.625|single
  CR_ObjRAccelXStd_Ri: uint8  % 0.375|0|0|11.625|single

CR_L_PHY_REQ_MSG_BUS = Simulink.Bus(HeaderFile="Rte_Type.h")
  CR_L_Phy_Req: uint64

CR_L_PHY_REQ_RAW_BUS = Simulink.Bus(HeaderFile="Rte_Type.h")
  CR_L_Phy_Req: uint64  % 1|0|0|1.84467440737096e+19|uint64

CR_L_PHY_RESP_MSG_BUS = Simulink.Bus(HeaderFile="Rte_Type.h")
  CR_L_Phy_Resp: uint64

CR_L_PHY_RESP_RAW_BUS = Simulink.Bus(HeaderFile="Rte_Type.h")
  CR_L_Phy_Resp: uint64  % 1|0|0|1.84467440737096e+19|uint64

CR_R_PHY_REQ_MSG_BUS = Simulink.Bus(HeaderFile="Rte_Type.h")
  CR_R_Phy_Req: uint64

CR_R_PHY_REQ_RAW_BUS = Simulink.Bus(HeaderFile="Rte_Type.h")
  CR_R_Phy_Req: uint64  % 1|0|0|1.84467440737096e+19|uint64

CR_R_PHY_RESP_MSG_BUS = Simulink.Bus(HeaderFile="Rte_Type.h")
  CR_R_Phy_Resp: uint64

CR_R_PHY_RESP_RAW_BUS = Simulink.Bus(HeaderFile="Rte_Type.h")
  CR_R_Phy_Resp: uint64  % 1|0|0|1.84467440737096e+19|uint64

CSA1_MSG_BUS = Simulink.Bus(HeaderFile="Rte_Type.h")
  FrntWiprSwtSts: uint8
  FrntWshrSwtSts: uint8
  LTurnLmpSwtSts: boolean
  RTurnLmpSwtSts: boolean
  FrntFogLmpSwtSts: boolean
  LowBeamSwtSts: boolean
  HiBeamSwtSts: boolean
  OverVehBeamSwtSts: boolean
  AutoLmpSwtSts: boolean

CSA1_RAW_BUS = Simulink.Bus(HeaderFile="Rte_Type.h")
  FrntWiprSwtSts: uint8  % 1|0|0|7|uint8
  FrntWshrSwtSts: uint8  % 1|0|0|3|uint8
  LTurnLmpSwtSts: boolean  % 1|0|0|1|boolean
  RTurnLmpSwtSts: boolean  % 1|0|0|1|boolean
  FrntFogLmpSwtSts: boolean  % 1|0|0|1|boolean
  LowBeamSwtSts: boolean  % 1|0|0|1|boolean
  HiBeamSwtSts: boolean  % 1|0|0|1|boolean
  OverVehBeamSwtSts: boolean  % 1|0|0|1|boolean
  AutoLmpSwtSts: boolean  % 1|0|0|1|boolean

CSA2_MSG_BUS = Simulink.Bus(HeaderFile="Rte_Type.h")
  Checksum_CSA2: uint8
  SteerWheelAngSign: boolean
  SteerWheelAng: single
  SteerWheelSpdSign: boolean
  SteerWheelSpd: single
  ACC_TimeGap_DecSetSwt: boolean
  ACC_TimeGap_IncSetSwt: boolean
  CC_ACC_CANCEL_OFFSwt: boolean
  CC_ACC_CRUISE_OFFSwt: boolean
  CC_ACCSwtErr: boolean
  CC_ACC_DecSetSpd_SetSwt: boolean
  CC_ACC_IncSetSpd_ResuSwt: boolean
  SAS_Sts: uint8
  Rollingcounter_CSA2: uint8
  HWA_OK_OFFSwt: boolean

CSA2_RAW_BUS = Simulink.Bus(HeaderFile="Rte_Type.h")
  Checksum_CSA2: uint8  % 1|0|0|255|uint8
  SteerWheelAngSign: boolean  % 1|0|0|1|boolean
  SteerWheelAng: uint16  % 0.1|0|0|780|single
  SteerWheelSpdSign: boolean  % 1|0|0|1|boolean
  SteerWheelSpd: uint16  % 0.1|0|0|1016|single
  ACC_TimeGap_DecSetSwt: boolean  % 1|0|0|1|boolean
  ACC_TimeGap_IncSetSwt: boolean  % 1|0|0|1|boolean
  CC_ACC_CANCEL_OFFSwt: boolean  % 1|0|0|1|boolean
  CC_ACC_CRUISE_OFFSwt: boolean  % 1|0|0|1|boolean
  CC_ACCSwtErr: boolean  % 1|0|0|1|boolean
  CC_ACC_DecSetSpd_SetSwt: boolean  % 1|0|0|1|boolean
  CC_ACC_IncSetSpd_ResuSwt: boolean  % 1|0|0|1|boolean
  SAS_Sts: uint8  % 1|0|0|3|uint8
  Rollingcounter_CSA2: uint8  % 1|0|0|15|uint8
  HWA_OK_OFFSwt: boolean  % 1|0|0|1|boolean

DCT2_MSG_BUS = Simulink.Bus(HeaderFile="Rte_Type.h")
  TC_SLIP_STATE: uint8

DCT2_RAW_BUS = Simulink.Bus(HeaderFile="Rte_Type.h")
  TC_SLIP_STATE: uint8  % 1|0|0|7|uint8

DCT5_MSG_BUS = Simulink.Bus(HeaderFile="Rte_Type.h")
  CheckSum_DCT5: uint8
  TargetGearValid: boolean
  SHIFT_IN_PROGRESS: boolean
  CurrentGearValid: boolean
  TARGET_GEAR: uint8
  TCU_APS_Available: boolean
  TCUFailure: uint8
  ShiftInPrgValid: boolean
  TGS_LEVER: uint8
  CURRENT_GEAR: uint8
  RollingCounter_DCT5: uint8

DCT5_RAW_BUS = Simulink.Bus(HeaderFile="Rte_Type.h")
  CheckSum_DCT5: uint8  % 1|0|0|255|uint8
  TargetGearValid: boolean  % 1|0|0|1|boolean
  SHIFT_IN_PROGRESS: boolean  % 1|0|0|1|boolean
  CurrentGearValid: boolean  % 1|0|0|1|boolean
  TARGET_GEAR: uint8  % 1|0|0|15|uint8
  TCU_APS_Available: boolean  % 1|0|0|1|boolean
  TCUFailure: uint8  % 1|0|0|3|uint8
  ShiftInPrgValid: boolean  % 1|0|0|1|boolean
  TGS_LEVER: uint8  % 1|0|0|15|uint8
  CURRENT_GEAR: uint8  % 1|0|0|15|uint8
  RollingCounter_DCT5: uint8  % 1|0|0|15|uint8

DCT9_MSG_BUS = Simulink.Bus(HeaderFile="Rte_Type.h")
  TorqueRatio: single

DCT9_RAW_BUS = Simulink.Bus(HeaderFile="Rte_Type.h")
  TorqueRatio: uint8  % 0.1|0|0|25.4|single

DMS_FD1_MSG_BUS = Simulink.Bus(HeaderFile="Rte_Type.h")
  DistrctnLvlQlty_ACC: uint8
  DrowsnsLvlQlty_ACC: uint8
  DrowsnsLvl_ACC: uint8
  DistrctnLvl_ACC: uint8
  HeadPosnX: int16
  HeadPosnY: int16
  HeadPosQlty: uint8
  HeadPosnZ: int16
  GazePosnX: int16
  GazePosnY: int16
  GazePosnZ: int16
  HeadYawAng: int8
  HeadPitchAng: int8
  HeadRollAng: int8
  HeadDetn: boolean
  HeadRotAngQlty: uint8
  DMSSts: uint8
  RobustGazeYawAng: int8
  RobustGazePitchAng: int8
  LEyeOpenStsQlty: uint8
  REyeOpenStsQlty: uint8
  RobustGazeAngQlty: uint8
  REyeOpenSts: uint8
  LEyeOpenSts: uint8

DMS_FD1_RAW_BUS = Simulink.Bus(HeaderFile="Rte_Type.h")
  DistrctnLvlQlty_ACC: uint8  % 1|0|0|100|uint8
  DrowsnsLvlQlty_ACC: uint8  % 1|0|0|100|uint8
  DrowsnsLvl_ACC: uint8  % 1|0|0|7|uint8
  DistrctnLvl_ACC: uint8  % 1|0|0|7|uint8
  HeadPosnX: uint16  % 1|-500|-500|1000|int16
  HeadPosnY: uint16  % 1|-500|-500|500|int16
  HeadPosQlty: uint8  % 1|0|0|100|uint8
  HeadPosnZ: uint16  % 1|-500|-500|500|int16
  GazePosnX: uint16  % 1|-500|-500|1000|int16
  GazePosnY: uint16  % 1|-500|-500|500|int16
  GazePosnZ: uint16  % 1|-500|-500|500|int16
  HeadYawAng: uint8  % 1|-75|-75|75|int8
  HeadPitchAng: uint8  % 1|-25|-25|45|int8
  HeadRollAng: uint8  % 1|-45|-45|45|int8
  HeadDetn: boolean  % 1|0|0|1|boolean
  HeadRotAngQlty: uint8  % 1|0|0|100|uint8
  DMSSts: uint8  % 1|0|0|7|uint8
  RobustGazeYawAng: uint8  % 1|-90|-90|90|int8
  RobustGazePitchAng: uint8  % 1|-90|-90|90|int8
  LEyeOpenStsQlty: uint8  % 1|0|0|100|uint8
  REyeOpenStsQlty: uint8  % 1|0|0|100|uint8
  RobustGazeAngQlty: uint8  % 1|0|0|100|uint8
  REyeOpenSts: uint8  % 1|0|0|3|uint8
  LEyeOpenSts: uint8  % 1|0|0|3|uint8

DVR_FD1_MSG_BUS = Simulink.Bus(HeaderFile="Rte_Type.h")
  DVR_360VideoCaptureReq: boolean

DVR_FD1_RAW_BUS = Simulink.Bus(HeaderFile="Rte_Type.h")
  DVR_360VideoCaptureReq: boolean  % 1|0|0|1|boolean

DIAGFUNCREQ_MSG_BUS = Simulink.Bus(HeaderFile="Rte_Type.h")
  DiagFuncReq: uint64

DIAGFUNCREQ_RAW_BUS = Simulink.Bus(HeaderFile="Rte_Type.h")
  DiagFuncReq: uint64  % 1|0|0|1.84467440737096e+19|uint64

ECM1_MSG_BUS = Simulink.Bus(HeaderFile="Rte_Type.h")
  Checksum_ECM1: uint8
  BrkPedalSts: uint8
  Start_StopSts: uint8
  EngSpd: single
  RollingCounter_ECM1: uint8
  EngSpdVldty: uint8

ECM1_RAW_BUS = Simulink.Bus(HeaderFile="Rte_Type.h")
  Checksum_ECM1: uint8  % 1|0|0|255|uint8
  BrkPedalSts: uint8  % 1|0|0|3|uint8
  Start_StopSts: uint8  % 1|0|0|7|uint8
  EngSpd: uint16  % 0.125|0|0|8191.875|single
  RollingCounter_ECM1: uint8  % 1|0|0|15|uint8
  EngSpdVldty: uint8  % 1|0|0|2|uint8

ECM2_MSG_BUS = Simulink.Bus(HeaderFile="Rte_Type.h")
  Checksum_ECM2: uint8
  AccelPedalPosn: single
  AccelPedalPosnVldty: uint8
  RollingCounter_ECM2: uint8
  EngState: uint8

ECM2_RAW_BUS = Simulink.Bus(HeaderFile="Rte_Type.h")
  Checksum_ECM2: uint8  % 1|0|0|255|uint8
  AccelPedalPosn: uint8  % 0.3937|0|0|100.3935|single
  AccelPedalPosnVldty: uint8  % 1|0|0|2|uint8
  RollingCounter_ECM2: uint8  % 1|0|0|15|uint8
  EngState: uint8  % 1|0|0|3|uint8

ECM3_MSG_BUS = Simulink.Bus(HeaderFile="Rte_Type.h")
  MaxEngTrqNorm: uint16
  EngLimpHomeSts: boolean

ECM3_RAW_BUS = Simulink.Bus(HeaderFile="Rte_Type.h")
  MaxEngTrqNorm: uint8  % 5|0|0|510|uint16
  EngLimpHomeSts: boolean  % 1|0|0|1|boolean

ECM4_MSG_BUS = Simulink.Bus(HeaderFile="Rte_Type.h")
  Checksum_ECM4: uint8
  NetEngTrq: single
  DrvEngTrqReq: single
  RollingCounter_ECM4: uint8
  DrvEngTrqReqVld: boolean

ECM4_RAW_BUS = Simulink.Bus(HeaderFile="Rte_Type.h")
  Checksum_ECM4: uint8  % 1|0|0|255|uint8
  NetEngTrq: uint16  % 0.0030518|-100|-100|99.9967|single
  DrvEngTrqReq: uint16  % 0.0030518|-100|-100|99.9997|single
  RollingCounter_ECM4: uint8  % 1|0|0|15|uint8
  DrvEngTrqReqVld: boolean  % 1|0|0|1|boolean

ECM7_MSG_BUS = Simulink.Bus(HeaderFile="Rte_Type.h")
  EngTrqRedLimFast: single

ECM7_RAW_BUS = Simulink.Bus(HeaderFile="Rte_Type.h")
  EngTrqRedLimFast: uint16  % 0.0030518|-100|-100|99.9997|single

ECM8_MSG_BUS = Simulink.Bus(HeaderFile="Rte_Type.h")
  EngTrqMinAct: single
  EngTrqMaxActSpd: single
  TrqLoss: single
  TrqLossVldty: boolean

ECM8_RAW_BUS = Simulink.Bus(HeaderFile="Rte_Type.h")
  EngTrqMinAct: uint16  % 0.0030518|-100|-100|99.9997|single
  EngTrqMaxActSpd: uint16  % 0.0030518|-100|-100|99.9997|single
  TrqLoss: uint16  % 0.0030518|-100|-100|99.9997|single
  TrqLossVldty: boolean  % 1|0|0|1|boolean

ECM9_MSG_BUS = Simulink.Bus(HeaderFile="Rte_Type.h")
  Checksum_ECM9: uint8
  ECM_interfaceAPS: boolean
  AccPedalOverride: boolean
  AccelPedlPosnDiagc: single
  ECMACCInterface: boolean
  ECMRespACC: boolean
  RollingCounter_ECM9: uint8

ECM9_RAW_BUS = Simulink.Bus(HeaderFile="Rte_Type.h")
  Checksum_ECM9: uint8  % 1|0|0|255|uint8
  ECM_interfaceAPS: boolean  % 1|0|0|1|boolean
  AccPedalOverride: boolean  % 1|0|0|1|boolean
  AccelPedlPosnDiagc: uint8  % 0.3937|0|0|100.3935|single
  ECMACCInterface: boolean  % 1|0|0|1|boolean
  ECMRespACC: boolean  % 1|0|0|1|boolean
  RollingCounter_ECM9: uint8  % 1|0|0|15|uint8

EEM1_MSG_BUS = Simulink.Bus(HeaderFile="Rte_Type.h")
  Stat_PwrSv_Lvl: uint8
  TranPMode_Sts: boolean

EEM1_RAW_BUS = Simulink.Bus(HeaderFile="Rte_Type.h")
  Stat_PwrSv_Lvl: uint8  % 1|0|0|7|uint8
  TranPMode_Sts: boolean  % 1|0|0|1|boolean

EPB1_MSG_BUS = Simulink.Bus(HeaderFile="Rte_Type.h")
  CheckSum_EPB1: uint8
  EPB_SwtPosnVld: boolean
  EPBErrSts: uint8
  EPBSts: uint8
  EPB_SwtPosn: uint8
  RollingCounter_EPB1: uint8

EPB1_RAW_BUS = Simulink.Bus(HeaderFile="Rte_Type.h")
  CheckSum_EPB1: uint8  % 1|0|0|255|uint8
  EPB_SwtPosnVld: boolean  % 1|0|0|1|boolean
  EPBErrSts: uint8  % 1|0|0|3|uint8
  EPBSts: uint8  % 1|0|0|3|uint8
  EPB_SwtPosn: uint8  % 1|0|0|3|uint8
  RollingCounter_EPB1: uint8  % 1|0|0|15|uint8

EPS1_MSG_BUS = Simulink.Bus(HeaderFile="Rte_Type.h")
  CheckSum_EPS1: uint8
  EPS_FailSts: uint8
  EPS_TrqSnsrSts: boolean
  EPS_AvailSts: uint8
  EPS_InterferDetdVld: boolean
  EPS_InterferDetd: boolean
  EPS_SteerMod: uint8
  RollingCounter_EPS1: uint8

EPS1_RAW_BUS = Simulink.Bus(HeaderFile="Rte_Type.h")
  CheckSum_EPS1: uint8  % 1|0|0|255|uint8
  EPS_FailSts: uint8  % 1|0|0|3|uint8
  EPS_TrqSnsrSts: boolean  % 1|0|0|1|boolean
  EPS_AvailSts: uint8  % 1|0|0|3|uint8
  EPS_InterferDetdVld: boolean  % 1|0|0|1|boolean
  EPS_InterferDetd: boolean  % 1|0|0|1|boolean
  EPS_SteerMod: uint8  % 1|0|0|7|uint8
  RollingCounter_EPS1: uint8  % 1|0|0|15|uint8

EPS2_MSG_BUS = Simulink.Bus(HeaderFile="Rte_Type.h")
  CheckSum_EPS2: uint8
  EPS_DrvInpTrqVal_HighReslolution: single
  EPS_LKATorqOvrlDlvd: single
  RollingCounter_EPS2: uint8
  EPS_LKATrqOvlDlvdSts: uint8
  EPS_LKATorqOvrlDlvdVld: boolean

EPS2_RAW_BUS = Simulink.Bus(HeaderFile="Rte_Type.h")
  CheckSum_EPS2: uint8  % 1|0|0|255|uint8
  EPS_DrvInpTrqVal_HighReslolution: uint16  % 0.015625|-31.9844|-31.9844|32|single
  EPS_LKATorqOvrlDlvd: uint16  % 0.01|-15|-15|15|single
  RollingCounter_EPS2: uint8  % 1|0|0|15|uint8
  EPS_LKATrqOvlDlvdSts: uint8  % 1|0|0|3|uint8
  EPS_LKATorqOvrlDlvdVld: boolean  % 1|0|0|1|boolean

ESP1_MSG_BUS = Simulink.Bus(HeaderFile="Rte_Type.h")
  CheckSum_ESP1: uint8
  ESPFuncOffSts: boolean
  ESPBrkLmpCtrl: boolean
  ESPFailSts: boolean
  ESP_MasterCylBrkPressVld: boolean
  VDCActv: boolean
  MSRActv: boolean
  PTCActv: boolean
  BTCActv: boolean
  ESP_MasterCylBrkPress: single
  RollingCounter_ESP1: uint8

ESP1_RAW_BUS = Simulink.Bus(HeaderFile="Rte_Type.h")
  CheckSum_ESP1: uint8  % 1|0|0|255|uint8
  ESPFuncOffSts: boolean  % 1|0|0|1|boolean
  ESPBrkLmpCtrl: boolean  % 1|0|0|1|boolean
  ESPFailSts: boolean  % 1|0|0|1|boolean
  ESP_MasterCylBrkPressVld: boolean  % 1|0|0|1|boolean
  VDCActv: boolean  % 1|0|0|1|boolean
  MSRActv: boolean  % 1|0|0|1|boolean
  PTCActv: boolean  % 1|0|0|1|boolean
  BTCActv: boolean  % 1|0|0|1|boolean
  ESP_MasterCylBrkPress: uint16  % 0.03125|-42.5|-42.5|425|single
  RollingCounter_ESP1: uint8  % 1|0|0|15|uint8

ESP2_MSG_BUS = Simulink.Bus(HeaderFile="Rte_Type.h")
  CheckSum_ESP2: uint8
  ESP_DiagActv: boolean
  CTABrkAvailable: boolean
  BrkDskOvrheatd: boolean
  NoBrkForce: boolean
  VehStandstill: uint8
  AEBIBActv: boolean
  AEBBAActv: boolean
  AEBAvailable: boolean
  ABPAvailable: boolean
  ABPActv: boolean
  ABAavailable: boolean
  ABAactv: boolean
  HDCCtrl: uint8
  CDDActv: boolean
  CDDAvailable: boolean
  AWBAvailable: boolean
  AWBActv: boolean
  AVHErrSts: uint8
  AVHSts: uint8
  DrivingModReq_ESP: uint8
  DrivingModDis: uint8
  RollingCounter_ESP2: uint8

ESP2_RAW_BUS = Simulink.Bus(HeaderFile="Rte_Type.h")
  CheckSum_ESP2: uint8  % 1|0|0|255|uint8
  ESP_DiagActv: boolean  % 1|0|0|1|boolean
  CTABrkAvailable: boolean  % 1|0|0|1|boolean
  BrkDskOvrheatd: boolean  % 1|0|0|1|boolean
  NoBrkForce: boolean  % 1|0|0|1|boolean
  VehStandstill: uint8  % 1|0|0|3|uint8
  AEBIBActv: boolean  % 1|0|0|1|boolean
  AEBBAActv: boolean  % 1|0|0|1|boolean
  AEBAvailable: boolean  % 1|0|0|1|boolean
  ABPAvailable: boolean  % 1|0|0|1|boolean
  ABPActv: boolean  % 1|0|0|1|boolean
  ABAavailable: boolean  % 1|0|0|1|boolean
  ABAactv: boolean  % 1|0|0|1|boolean
  HDCCtrl: uint8  % 1|0|0|2|uint8
  CDDActv: boolean  % 1|0|0|1|boolean
  CDDAvailable: boolean  % 1|0|0|1|boolean
  AWBAvailable: boolean  % 1|0|0|1|boolean
  AWBActv: boolean  % 1|0|0|1|boolean
  AVHErrSts: uint8  % 1|0|0|3|uint8
  AVHSts: uint8  % 1|0|0|2|uint8
  DrivingModReq_ESP: uint8  % 1|0|0|31|uint8
  DrivingModDis: uint8  % 1|0|0|31|uint8
  RollingCounter_ESP2: uint8  % 1|0|0|15|uint8

ESP7_MSG_BUS = Simulink.Bus(HeaderFile="Rte_Type.h")
  CheckSum_ESP7: uint8
  ESP_MEBBrkAvail: boolean
  FourWhlsBrkTrq: uint16
  LgtCtrlrFailr: uint8
  LgtCtrlrSts: uint8
  RollingCounter_ESP7: uint8
  LgtCtrlrAvail: uint8

ESP7_RAW_BUS = Simulink.Bus(HeaderFile="Rte_Type.h")
  CheckSum_ESP7: uint8  % 1|0|0|255|uint8
  ESP_MEBBrkAvail: boolean  % 1|0|0|1|boolean
  FourWhlsBrkTrq: uint16  % 1|0|0|16383|uint16
  LgtCtrlrFailr: uint8  % 1|0|0|7|uint8
  LgtCtrlrSts: uint8  % 1|0|0|7|uint8
  RollingCounter_ESP7: uint8  % 1|0|0|15|uint8
  LgtCtrlrAvail: uint8  % 1|0|0|1|uint8

ESP8_MSG_BUS = Simulink.Bus(HeaderFile="Rte_Type.h")
  CCO_Active: uint8

ESP8_RAW_BUS = Simulink.Bus(HeaderFile="Rte_Type.h")
  CCO_Active: uint8  % 1|0|0|3|uint8

FR_PHY_REQ_MSG_BUS = Simulink.Bus(HeaderFile="Rte_Type.h")
  FR_Phy_Req: uint64

FR_PHY_REQ_RAW_BUS = Simulink.Bus(HeaderFile="Rte_Type.h")
  FR_Phy_Req: uint64  % 1|0|0|1.84467440737096e+19|uint64

FR_PHY_RESP_MSG_BUS = Simulink.Bus(HeaderFile="Rte_Type.h")
  FR_Phy_Resp: uint64

FR_PHY_RESP_RAW_BUS = Simulink.Bus(HeaderFile="Rte_Type.h")
  FR_Phy_Resp: uint64  % 1|0|0|1.84467440737096e+19|uint64

F_PBOX1_MSG_BUS = Simulink.Bus(HeaderFile="Rte_Type.h")
  FFogLmpSts_F_Pbox: boolean
  LowBeamSts_F_Pbox: boolean
  HiBeamSts_F_Pbox: boolean
  HoodSts_F_Pbox: boolean

F_PBOX1_RAW_BUS = Simulink.Bus(HeaderFile="Rte_Type.h")
  FFogLmpSts_F_Pbox: boolean  % 1|0|0|1|boolean
  LowBeamSts_F_Pbox: boolean  % 1|0|0|1|boolean
  HiBeamSts_F_Pbox: boolean  % 1|0|0|1|boolean
  HoodSts_F_Pbox: boolean  % 1|0|0|1|boolean

GW_PHY_REQ_MSG_BUS = Simulink.Bus(HeaderFile="Rte_Type.h")
  GW_Phy_Req: uint64

GW_PHY_REQ_RAW_BUS = Simulink.Bus(HeaderFile="Rte_Type.h")
  GW_Phy_Req: uint64  % 1|0|0|1.84467440737096e+19|uint64

GW_PHY_RESP_MSG_BUS = Simulink.Bus(HeaderFile="Rte_Type.h")
  GW_Phy_Resp: uint64

GW_PHY_RESP_RAW_BUS = Simulink.Bus(HeaderFile="Rte_Type.h")
  GW_Phy_Resp: uint64  % 1|0|0|1.84467440737096e+19|uint64

HAP_FD1_MSG_BUS = Simulink.Bus(HeaderFile="Rte_Type.h")
  Checksum_APS1: uint8
  APS_ReqCtrlEPS: boolean
  APS_ReqEPSTgtAngValid: boolean
  APS_SlotDisp: uint8
  APS_SysSoundIndcn: uint8
  APS_ReqEPSTgtAng: single
  APS_TextDisp: uint8
  APS_SwtSts: boolean
  APS_ProcBar: uint8
  TurnLightsCmd: uint8
  APS_PrkgMod: uint8
  APS_PrkgTyp: uint8
  RollingCounter_APS1: uint8
  Checksum_APS4: uint8
  APS_BrkCategory: uint8
  APS_ESP_TgtGearReq: uint8
  APS_BrkFctnMod: uint8
  APS_WorkSts: uint8
  MEB_BrkgReq: boolean
  MEBErrSts: boolean
  APS_BrkModSts: uint8
  APS_ESP_SpdLimn: single
  MEB_AVHReq: boolean
  APS_ESP_BrkDistance: uint16
  MEB_BrkgReqValue: single
  RollingCounter_APS4: uint8
  P2P_PahDelSts: uint8
  HAP_PrkgModCurrSts: uint8
  APS_PASSwtReq: uint8
  P2P_Pah1Avail: boolean
  P2P_SelfDetErrCode: uint8
  HAP_SwtDispCtrlCmd: uint8
  TailVertPrkgOutVald: boolean
  HeadVertPrkgOutVald: boolean
  RParaPrkgOutVald: boolean
  LParaPrkgOutVald: boolean
  RmtPrkgReq: boolean
  P2P_Pah2Avail: boolean
  P2P_SelfDetSts: uint8
  APS_MovgDirc: uint8

HAP_FD1_RAW_BUS = Simulink.Bus(HeaderFile="Rte_Type.h")
  Checksum_APS1: uint8  % 1|0|0|255|uint8
  APS_ReqCtrlEPS: boolean  % 1|0|0|1|boolean
  APS_ReqEPSTgtAngValid: boolean  % 1|0|0|1|boolean
  APS_SlotDisp: uint8  % 1|0|0|7|uint8
  APS_SysSoundIndcn: uint8  % 1|0|0|7|uint8
  APS_ReqEPSTgtAng: uint16  % 0.1|0|-1638.3|1638.3|single
  APS_TextDisp: uint8  % 1|0|0|63|uint8
  APS_SwtSts: boolean  % 1|0|0|1|boolean
  APS_ProcBar: uint8  % 1|0|0|127|uint8
  TurnLightsCmd: uint8  % 1|0|0|3|uint8
  APS_PrkgMod: uint8  % 1|0|0|3|uint8
  APS_PrkgTyp: uint8  % 1|0|0|3|uint8
  RollingCounter_APS1: uint8  % 1|0|0|15|uint8
  Checksum_APS4: uint8  % 1|0|0|255|uint8
  APS_BrkCategory: uint8  % 1|0|0|3|uint8
  APS_ESP_TgtGearReq: uint8  % 1|0|0|7|uint8
  APS_BrkFctnMod: uint8  % 1|0|0|7|uint8
  APS_WorkSts: uint8  % 1|0|0|7|uint8
  MEB_BrkgReq: boolean  % 1|0|0|1|boolean
  MEBErrSts: boolean  % 1|0|0|1|boolean
  APS_BrkModSts: uint8  % 1|0|0|7|uint8
  APS_ESP_SpdLimn: uint8  % 0.1|0|0|25.5|single
  MEB_AVHReq: boolean  % 1|0|0|1|boolean
  APS_ESP_BrkDistance: uint16  % 1|0|0|4095|uint16
  MEB_BrkgReqValue: uint8  % 0.05|-10|-10|0|single
  RollingCounter_APS4: uint8  % 1|0|0|15|uint8
  P2P_PahDelSts: uint8  % 1|0|0|3|uint8
  HAP_PrkgModCurrSts: uint8  % 1|0|0|15|uint8
  APS_PASSwtReq: uint8  % 1|0|0|3|uint8
  P2P_Pah1Avail: boolean  % 1|0|0|1|boolean
  P2P_SelfDetErrCode: uint8  % 1|0|0|15|uint8
  HAP_SwtDispCtrlCmd: uint8  % 1|0|0|7|uint8
  TailVertPrkgOutVald: boolean  % 1|0|0|1|boolean
  HeadVertPrkgOutVald: boolean  % 1|0|0|1|boolean
  RParaPrkgOutVald: boolean  % 1|0|0|1|boolean
  LParaPrkgOutVald: boolean  % 1|0|0|1|boolean
  RmtPrkgReq: boolean  % 1|0|0|1|boolean
  P2P_Pah2Avail: boolean  % 1|0|0|1|boolean
  P2P_SelfDetSts: uint8  % 1|0|0|3|uint8
  APS_MovgDirc: uint8  % 1|0|0|3|uint8

HAP_FD2_MSG_BUS = Simulink.Bus(HeaderFile="Rte_Type.h")
  SigViewIndcn: uint8
  AVM_CurrSts: uint8
  HAP_Hmi_Index: uint8
  AutoAVMSwtSet_Sts: boolean
  AutoViewChgFuncSts: boolean
  CarMdlDispSts: boolean
  MOD_AlarmSts: boolean
  MOD_WorkSts: boolean
  MdlColrSts: uint8
  RadarDispSts: uint8
  GuidOvlSts: uint8
  CurrCalResultSts: boolean
  LaneCalFltSts: uint8
  LaneCalSts: uint8
  CarMdlTrsprcySts: uint8
  OvlOpFailSts: boolean
  EolNotCmpltd: boolean
  FrntCamInpFailSts: boolean
  RearCamInpFailSts: boolean
  LeCamInpFailSts: boolean
  RiCamInpFailSts: boolean
  AVM_3DAngSts: uint16
  DVRWorkSts: uint8
  HAP_DispCmd: boolean

HAP_FD2_RAW_BUS = Simulink.Bus(HeaderFile="Rte_Type.h")
  SigViewIndcn: uint8  % 1|0|0|63|uint8
  AVM_CurrSts: uint8  % 1|0|0|3|uint8
  HAP_Hmi_Index: uint8  % 1|0|0|7|uint8
  AutoAVMSwtSet_Sts: boolean  % 1|0|0|1|boolean
  AutoViewChgFuncSts: boolean  % 1|0|0|1|boolean
  CarMdlDispSts: boolean  % 1|0|0|1|boolean
  MOD_AlarmSts: boolean  % 1|0|0|1|boolean
  MOD_WorkSts: boolean  % 1|0|0|1|boolean
  MdlColrSts: uint8  % 1|0|0|15|uint8
  RadarDispSts: uint8  % 1|0|0|3|uint8
  GuidOvlSts: uint8  % 1|0|0|3|uint8
  CurrCalResultSts: boolean  % 1|0|0|1|boolean
  LaneCalFltSts: uint8  % 1|0|0|7|uint8
  LaneCalSts: uint8  % 1|0|0|3|uint8
  CarMdlTrsprcySts: uint8  % 1|0|0|3|uint8
  OvlOpFailSts: boolean  % 1|0|0|1|boolean
  EolNotCmpltd: boolean  % 1|0|0|1|boolean
  FrntCamInpFailSts: boolean  % 1|0|0|1|boolean
  RearCamInpFailSts: boolean  % 1|0|0|1|boolean
  LeCamInpFailSts: boolean  % 1|0|0|1|boolean
  RiCamInpFailSts: boolean  % 1|0|0|1|boolean
  AVM_3DAngSts: uint16  % 1|0|0|360|uint16
  DVRWorkSts: uint8  % 1|0|0|3|uint8
  HAP_DispCmd: boolean  % 1|0|0|1|boolean

HAP_FD3_MSG_BUS = Simulink.Bus(HeaderFile="Rte_Type.h")
  RPAS_NearBrrdstn: uint8
  APS_ObjRiSideAr2: uint8
  APS_ObjRiSideAr1: uint8
  APS_ObjRiSideAr4: uint8
  APS_ObjRiSideAr3: uint8
  APS_ObjLeSideAr1: uint8
  APS_ObjRiSideAr5: uint8
  APS_ObjLeSideAr3: uint8
  APS_ObjLeSideAr2: uint8
  APS_ObjLeSideAr5: uint8
  APS_ObjLeSideAr4: uint8
  SDWActiveSts: boolean
  SDW_SoundIndcn: uint8
  APS_RLSideSnsrFailSts: boolean
  APS_RRSideSnsrFailSts: boolean
  APS_FLSideSnsrFailSts: boolean
  APS_FRSideSnsrFailSts: boolean
  RPAS_ObjRRCornrAr2: uint8
  RPAS_ObjRRCornrAr1: uint8
  RPAS_ObjRRMidlAr2: uint8
  RPAS_ObjRRMidlAr1: uint8
  RPAS_ObjRLMidlAr2: uint8
  RPAS_ObjRLMidlAr1: uint8
  RPAS_ObjRLCornrAr2: uint8
  RPAS_ObjRLCornrAr1: uint8
  RPAS_WorkSts: uint8
  RPAS_RRCornrSnsrFailSts: boolean
  RPAS_RRMiddlSnsrFailSts: boolean
  RPAS_RLMiddlSnsrFailSts: boolean
  RPAS_RLCornrSnsrFailSts: boolean
  MEB_EnableSts: boolean
  MEBWorkSts: uint8
  RPAS_SoundIndcn: uint8
  FPAS_ObjFLCornrAr2: uint8
  FPAS_ObjFLCornrAr1: uint8
  FPAS_ObjFLMidlAr2: uint8
  FPAS_ObjFLMidlAr1: uint8
  FPAS_ObjFRMidlAr2: uint8
  FPAS_ObjFRMidlAr1: uint8
  FPAS_ObjFRCornrAr2: uint8
  FPAS_ObjFRCornrAr1: uint8
  FPAS_AutoModSts: boolean
  FPAS_DispCmd: boolean
  FPAS_WorkSts: uint8
  FPAS_FRCornrSnsrFailSts: boolean
  FPAS_FRMiddlSnsrFailSts: boolean
  FPAS_FLMiddlSnsrFailSts: boolean
  FPAS_FLCornrSnsrFailSts: boolean
  FPAS_SoundIndcn: uint8
  FPAS_NearBrrdstn: uint8
  FADS_FuncSts: uint8
  RADS_FuncSts: uint8
  P2P_FuncSts: uint8
  APA_FuncSts: uint8
  OrvmCtrlCmd: uint8
  HAP_TextIconDispCtrl: uint8
  APA_MenuDispCtrlCmd: uint8
  RmtPrkgSts: boolean
  RmtPrkgFinishReq: uint8
  APS_Coordinate_Angle: uint16
  APS_Coordinate_X: int16
  APS_Coordinate_Y: int16

HAP_FD3_RAW_BUS = Simulink.Bus(HeaderFile="Rte_Type.h")
  RPAS_NearBrrdstn: uint8  % 1|0|0|150|uint8
  APS_ObjRiSideAr2: uint8  % 1|0|0|15|uint8
  APS_ObjRiSideAr1: uint8  % 1|0|0|15|uint8
  APS_ObjRiSideAr4: uint8  % 1|0|0|15|uint8
  APS_ObjRiSideAr3: uint8  % 1|0|0|15|uint8
  APS_ObjLeSideAr1: uint8  % 1|0|0|15|uint8
  APS_ObjRiSideAr5: uint8  % 1|0|0|15|uint8
  APS_ObjLeSideAr3: uint8  % 1|0|0|15|uint8
  APS_ObjLeSideAr2: uint8  % 1|0|0|15|uint8
  APS_ObjLeSideAr5: uint8  % 1|0|0|15|uint8
  APS_ObjLeSideAr4: uint8  % 1|0|0|15|uint8
  SDWActiveSts: boolean  % 1|0|0|1|boolean
  SDW_SoundIndcn: uint8  % 1|0|0|3|uint8
  APS_RLSideSnsrFailSts: boolean  % 1|0|0|1|boolean
  APS_RRSideSnsrFailSts: boolean  % 1|0|0|1|boolean
  APS_FLSideSnsrFailSts: boolean  % 1|0|0|1|boolean
  APS_FRSideSnsrFailSts: boolean  % 1|0|0|1|boolean
  RPAS_ObjRRCornrAr2: uint8  % 1|0|0|15|uint8
  RPAS_ObjRRCornrAr1: uint8  % 1|0|0|15|uint8
  RPAS_ObjRRMidlAr2: uint8  % 1|0|0|15|uint8
  RPAS_ObjRRMidlAr1: uint8  % 1|0|0|15|uint8
  RPAS_ObjRLMidlAr2: uint8  % 1|0|0|15|uint8
  RPAS_ObjRLMidlAr1: uint8  % 1|0|0|15|uint8
  RPAS_ObjRLCornrAr2: uint8  % 1|0|0|15|uint8
  RPAS_ObjRLCornrAr1: uint8  % 1|0|0|15|uint8
  RPAS_WorkSts: uint8  % 1|0|0|3|uint8
  RPAS_RRCornrSnsrFailSts: boolean  % 1|0|0|1|boolean
  RPAS_RRMiddlSnsrFailSts: boolean  % 1|0|0|1|boolean
  RPAS_RLMiddlSnsrFailSts: boolean  % 1|0|0|1|boolean
  RPAS_RLCornrSnsrFailSts: boolean  % 1|0|0|1|boolean
  MEB_EnableSts: boolean  % 1|0|0|1|boolean
  MEBWorkSts: uint8  % 1|0|0|3|uint8
  RPAS_SoundIndcn: uint8  % 1|0|0|3|uint8
  FPAS_ObjFLCornrAr2: uint8  % 1|0|0|15|uint8
  FPAS_ObjFLCornrAr1: uint8  % 1|0|0|15|uint8
  FPAS_ObjFLMidlAr2: uint8  % 1|0|0|15|uint8
  FPAS_ObjFLMidlAr1: uint8  % 1|0|0|15|uint8
  FPAS_ObjFRMidlAr2: uint8  % 1|0|0|15|uint8
  FPAS_ObjFRMidlAr1: uint8  % 1|0|0|15|uint8
  FPAS_ObjFRCornrAr2: uint8  % 1|0|0|15|uint8
  FPAS_ObjFRCornrAr1: uint8  % 1|0|0|15|uint8
  FPAS_AutoModSts: boolean  % 1|0|0|1|boolean
  FPAS_DispCmd: boolean  % 1|0|0|1|boolean
  FPAS_WorkSts: uint8  % 1|0|0|3|uint8
  FPAS_FRCornrSnsrFailSts: boolean  % 1|0|0|1|boolean
  FPAS_FRMiddlSnsrFailSts: boolean  % 1|0|0|1|boolean
  FPAS_FLMiddlSnsrFailSts: boolean  % 1|0|0|1|boolean
  FPAS_FLCornrSnsrFailSts: boolean  % 1|0|0|1|boolean
  FPAS_SoundIndcn: uint8  % 1|0|0|3|uint8
  FPAS_NearBrrdstn: uint8  % 1|0|0|100|uint8
  FADS_FuncSts: uint8  % 1|0|0|3|uint8
  RADS_FuncSts: uint8  % 1|0|0|3|uint8
  P2P_FuncSts: uint8  % 1|0|0|3|uint8
  APA_FuncSts: uint8  % 1|0|0|3|uint8
  OrvmCtrlCmd: uint8  % 1|0|0|3|uint8
  HAP_TextIconDispCtrl: uint8  % 1|0|0|3|uint8
  APA_MenuDispCtrlCmd: uint8  % 1|0|0|15|uint8
  RmtPrkgSts: boolean  % 1|0|0|1|boolean
  RmtPrkgFinishReq: uint8  % 1|0|0|3|uint8
  APS_Coordinate_Angle: uint16  % 1|0|0|359|uint16
  APS_Coordinate_X: uint16  % 2|-500|-500|500|int16
  APS_Coordinate_Y: uint16  % 2|-2000|-2000|2000|int16

HAP_FD6_MSG_BUS = Simulink.Bus(HeaderFile="Rte_Type.h")
  USS_FLCNear_Obj_Pos_X: single
  USS_FLCNear_Obj_Confidence: single
  USS_FLCNear_Obj_Pos_Y: single
  USS_FLMNear_Obj_Pos_X: single
  USS_FLMNear_Obj_Confidence: single
  USS_FLMNear_Obj_Pos_Y: single
  USS_FRMNear_Obj_Pos_X: single
  USS_FRMNear_Obj_Confidence: single
  USS_FRMNear_Obj_Pos_Y: single
  USS_FrontSys_Status: uint8
  USS_FRCNear_Obj_Pos_X: single
  USS_FRCNear_Obj_Confidence: single
  USS_FRCNear_Obj_Pos_Y: single

HAP_FD6_RAW_BUS = Simulink.Bus(HeaderFile="Rte_Type.h")
  USS_FLCNear_Obj_Pos_X: uint8  % 0.1|0|0|6.2|single
  USS_FLCNear_Obj_Confidence: uint8  % 0.1|0|0|1|single
  USS_FLCNear_Obj_Pos_Y: uint8  % 0.1|-3.1|-3.1|3.1|single
  USS_FLMNear_Obj_Pos_X: uint8  % 0.1|0|0|6.2|single
  USS_FLMNear_Obj_Confidence: uint8  % 0.1|0|0|1|single
  USS_FLMNear_Obj_Pos_Y: uint8  % 0.1|-3.1|-3.1|3.1|single
  USS_FRMNear_Obj_Pos_X: uint8  % 0.1|0|0|6.2|single
  USS_FRMNear_Obj_Confidence: uint8  % 0.1|0|0|1|single
  USS_FRMNear_Obj_Pos_Y: uint8  % 0.1|-3.1|-3.1|3.1|single
  USS_FrontSys_Status: uint8  % 1|0|0|3|uint8
  USS_FRCNear_Obj_Pos_X: uint8  % 0.1|0|0|6.2|single
  USS_FRCNear_Obj_Confidence: uint8  % 0.1|0|0|1|single
  USS_FRCNear_Obj_Pos_Y: uint8  % 0.1|-3.1|-3.1|3.1|single

HAP_IPAS_PHY_REQ_MSG_BUS = Simulink.Bus(HeaderFile="Rte_Type.h")
  HAP_IPAS_Phy_Req: uint64

HAP_IPAS_PHY_REQ_RAW_BUS = Simulink.Bus(HeaderFile="Rte_Type.h")
  HAP_IPAS_Phy_Req: uint64  % 1|0|0|1.84467440737096e+19|uint64

HAP_IPAS_PHY_RESP_MSG_BUS = Simulink.Bus(HeaderFile="Rte_Type.h")
  HAP_IPAS_Phy_Resp: uint64

HAP_IPAS_PHY_RESP_RAW_BUS = Simulink.Bus(HeaderFile="Rte_Type.h")
  HAP_IPAS_Phy_Resp: uint64  % 1|0|0|1.84467440737096e+19|uint64

HUT15_MSG_BUS = Simulink.Bus(HeaderFile="Rte_Type.h")
  APSPrkgTypSeln: uint8
  SDWSwtSet: boolean
  APSSwtReq_VR: uint8

HUT15_RAW_BUS = Simulink.Bus(HeaderFile="Rte_Type.h")
  APSPrkgTypSeln: uint8  % 1|0|0|3|uint8
  SDWSwtSet: boolean  % 1|0|0|1|boolean
  APSSwtReq_VR: uint8  % 1|0|0|3|uint8

HUT19_MSG_BUS = Simulink.Bus(HeaderFile="Rte_Type.h")
  ADAS_Meta_MapProvider: uint8
  ADAS_Meta_MsgTyp: uint8
  ADAS_Meta_CountryCode: uint16
  ADAS_Meta_ProtVer_MinorSub: uint8
  ADAS_Meta_ProtVer_Major: uint8
  ADAS_Meta_CycCnt: uint8
  ADAS_Meta_HwVer: uint16
  ADAS_Meta_DrvSide: boolean
  ADAS_Meta_RegionCode: uint16
  ADAS_Meta_MapVerYear: uint8
  ADAS_Meta_MapVerQtr: uint8
  ADAS_Meta_ProtVer_Minor: uint8
  ADAS_Meta_SpdUnits: boolean

HUT19_RAW_BUS = Simulink.Bus(HeaderFile="Rte_Type.h")
  ADAS_Meta_MapProvider: uint8  % 1|0|0|7|uint8
  ADAS_Meta_MsgTyp: uint8  % 1|0|0|7|uint8
  ADAS_Meta_CountryCode: uint16  % 1|0|0|1023|uint16
  ADAS_Meta_ProtVer_MinorSub: uint8  % 1|0|0|7|uint8
  ADAS_Meta_ProtVer_Major: uint8  % 1|0|0|3|uint8
  ADAS_Meta_CycCnt: uint8  % 1|0|0|3|uint8
  ADAS_Meta_HwVer: uint16  % 1|0|0|511|uint16
  ADAS_Meta_DrvSide: boolean  % 1|0|0|1|boolean
  ADAS_Meta_RegionCode: uint16  % 1|0|0|32767|uint16
  ADAS_Meta_MapVerYear: uint8  % 1|0|0|63|uint8
  ADAS_Meta_MapVerQtr: uint8  % 1|0|0|3|uint8
  ADAS_Meta_ProtVer_Minor: uint8  % 1|0|0|15|uint8
  ADAS_Meta_SpdUnits: boolean  % 1|0|0|1|boolean

HUT20_MSG_BUS = Simulink.Bus(HeaderFile="Rte_Type.h")
  ADAS_ProfLong_MsgTyp: uint8
  ADAS_ProfLong_Offset: uint16
  ADAS_ProfLong_PathIdx: uint8
  ADAS_ProfLong_CycCnt: uint8
  ADAS_ProfLong_Update: boolean
  ADAS_ProfLong_Retr: boolean
  ADAS_ProfLong_CtrlPoint: boolean
  ADAS_ProfLong_ProfTyp: uint8
  ADAS_ProfLong_Value: uint32

HUT20_RAW_BUS = Simulink.Bus(HeaderFile="Rte_Type.h")
  ADAS_ProfLong_MsgTyp: uint8  % 1|0|0|7|uint8
  ADAS_ProfLong_Offset: uint16  % 1|0|0|8190|uint16
  ADAS_ProfLong_PathIdx: uint8  % 1|0|0|63|uint8
  ADAS_ProfLong_CycCnt: uint8  % 1|0|0|3|uint8
  ADAS_ProfLong_Update: boolean  % 1|0|0|1|boolean
  ADAS_ProfLong_Retr: boolean  % 1|0|0|1|boolean
  ADAS_ProfLong_CtrlPoint: boolean  % 1|0|0|1|boolean
  ADAS_ProfLong_ProfTyp: uint8  % 1|0|0|31|uint8
  ADAS_ProfLong_Value: uint32  % 1|0|0|4294967295|uint32

HUT21_MSG_BUS = Simulink.Bus(HeaderFile="Rte_Type.h")
  ADAS_ProfShort_MsgTyp: uint8
  ADAS_ProfShort_Offset: uint16
  ADAS_ProfShort_PathIdx: uint8
  ADAS_ProfShort_CycCnt: uint8
  ADAS_ProfShort_Update: boolean
  ADAS_ProfShort_Retr: boolean
  ADAS_ProfShort_CtrlPoint: boolean
  ADAS_ProfShort_ProfTyp: uint8
  ADAS_ProfShort_AccurClass: uint8
  ADAS_ProfShort_Dist1: uint16
  ADAS_ProfShort_Value0: uint16
  ADAS_ProfShort_Value1: uint16

HUT21_RAW_BUS = Simulink.Bus(HeaderFile="Rte_Type.h")
  ADAS_ProfShort_MsgTyp: uint8  % 1|0|0|7|uint8
  ADAS_ProfShort_Offset: uint16  % 1|0|0|8190|uint16
  ADAS_ProfShort_PathIdx: uint8  % 1|0|0|63|uint8
  ADAS_ProfShort_CycCnt: uint8  % 1|0|0|3|uint8
  ADAS_ProfShort_Update: boolean  % 1|0|0|1|boolean
  ADAS_ProfShort_Retr: boolean  % 1|0|0|1|boolean
  ADAS_ProfShort_CtrlPoint: boolean  % 1|0|0|1|boolean
  ADAS_ProfShort_ProfTyp: uint8  % 1|0|0|31|uint8
  ADAS_ProfShort_AccurClass: uint8  % 1|0|0|3|uint8
  ADAS_ProfShort_Dist1: uint16  % 1|0|0|1022|uint16
  ADAS_ProfShort_Value0: uint16  % 1|0|0|1022|uint16
  ADAS_ProfShort_Value1: uint16  % 1|0|0|1022|uint16

HUT22_MSG_BUS = Simulink.Bus(HeaderFile="Rte_Type.h")
  ADAS_Seg_MsgTyp: uint8
  ADAS_Seg_Offset: uint16
  ADAS_Seg_PathIdx: uint8
  ADAS_Seg_CycCnt: uint8
  ADAS_Seg_Update: boolean
  ADAS_Seg_Retr: boolean
  ADAS_Seg_BuildUpArea: uint8
  ADAS_Seg_Brdg: uint8
  ADAS_Seg_Tunnel: uint8
  ADAS_Seg_FuncRoadClass: uint8
  ADAS_Seg_RelProbb: single
  ADAS_Seg_FormOfWay: uint8
  ADAS_Seg_CmplxInsct: uint8
  ADAS_Seg_PartOfCalcRoute: uint8
  ADAS_Seg_EffSpdLmtTyp: uint8
  ADAS_Seg_EffSpdLmt: uint8
  ADAS_Seg_NumOfLaneDrvDir: uint8
  ADAS_Seg_NumOfLaneOppDir: uint8
  ADAS_Seg_DivideRoad: uint8

HUT22_RAW_BUS = Simulink.Bus(HeaderFile="Rte_Type.h")
  ADAS_Seg_MsgTyp: uint8  % 1|0|0|7|uint8
  ADAS_Seg_Offset: uint16  % 1|0|0|8190|uint16
  ADAS_Seg_PathIdx: uint8  % 1|0|0|63|uint8
  ADAS_Seg_CycCnt: uint8  % 1|0|0|3|uint8
  ADAS_Seg_Update: boolean  % 1|0|0|1|boolean
  ADAS_Seg_Retr: boolean  % 1|0|0|1|boolean
  ADAS_Seg_BuildUpArea: uint8  % 1|0|0|3|uint8
  ADAS_Seg_Brdg: uint8  % 1|0|0|3|uint8
  ADAS_Seg_Tunnel: uint8  % 1|0|0|3|uint8
  ADAS_Seg_FuncRoadClass: uint8  % 1|0|0|7|uint8
  ADAS_Seg_RelProbb: uint8  % 3.333|0|0|100|single
  ADAS_Seg_FormOfWay: uint8  % 1|0|0|15|uint8
  ADAS_Seg_CmplxInsct: uint8  % 1|0|0|3|uint8
  ADAS_Seg_PartOfCalcRoute: uint8  % 1|0|0|3|uint8
  ADAS_Seg_EffSpdLmtTyp: uint8  % 1|0|0|7|uint8
  ADAS_Seg_EffSpdLmt: uint8  % 1|0|0|31|uint8
  ADAS_Seg_NumOfLaneDrvDir: uint8  % 1|0|0|7|uint8
  ADAS_Seg_NumOfLaneOppDir: uint8  % 1|0|0|3|uint8
  ADAS_Seg_DivideRoad: uint8  % 1|0|0|3|uint8

HUT23_MSG_BUS = Simulink.Bus(HeaderFile="Rte_Type.h")
  ADAS_Stub_MsgTyp: uint8
  ADAS_Stub_Offset: uint16
  ADAS_Stub_PathIdx: uint8
  ADAS_Stub_CycCnt: uint8
  ADAS_Stub_Update: boolean
  ADAS_Stub_Retr: boolean
  ADAS_Stub_StubPathIdx: uint8
  ADAS_Stub_FuncRoadClass: uint8
  ADAS_Stub_RelProbb: single
  ADAS_Stub_FormOfWay: uint8
  ADAS_Stub_CmplxInsct: uint8
  ADAS_Stub_PartOfCalcRoute: uint8
  ADAS_Stub_TurnAngl: single
  ADAS_Stub_NumOfLaneDrvDir: uint8
  ADAS_Stub_NumOfLaneOppDir: uint8
  ADAS_Stub_RtOfWay: uint8
  ADAS_Stub_LastStub: boolean

HUT23_RAW_BUS = Simulink.Bus(HeaderFile="Rte_Type.h")
  ADAS_Stub_MsgTyp: uint8  % 1|0|0|7|uint8
  ADAS_Stub_Offset: uint16  % 1|0|0|8190|uint16
  ADAS_Stub_PathIdx: uint8  % 1|0|0|63|uint8
  ADAS_Stub_CycCnt: uint8  % 1|0|0|3|uint8
  ADAS_Stub_Update: boolean  % 1|0|0|1|boolean
  ADAS_Stub_Retr: boolean  % 1|0|0|1|boolean
  ADAS_Stub_StubPathIdx: uint8  % 1|0|0|63|uint8
  ADAS_Stub_FuncRoadClass: uint8  % 1|0|0|7|uint8
  ADAS_Stub_RelProbb: uint8  % 3.333|0|0|100|single
  ADAS_Stub_FormOfWay: uint8  % 1|0|0|15|uint8
  ADAS_Stub_CmplxInsct: uint8  % 1|0|0|3|uint8
  ADAS_Stub_PartOfCalcRoute: uint8  % 1|0|0|3|uint8
  ADAS_Stub_TurnAngl: uint8  % 1.417|0|0|358.583|single
  ADAS_Stub_NumOfLaneDrvDir: uint8  % 1|0|0|7|uint8
  ADAS_Stub_NumOfLaneOppDir: uint8  % 1|0|0|3|uint8
  ADAS_Stub_RtOfWay: uint8  % 1|0|0|3|uint8
  ADAS_Stub_LastStub: boolean  % 1|0|0|1|boolean

HUT32_MSG_BUS = Simulink.Bus(HeaderFile="Rte_Type.h")
  CheckSum_HUT32: uint8
  ContnPrkgReqValid: boolean
  DetVideoLost: boolean
  PrkgCtrlModReqValid: boolean
  PrkgCtrlModReq: uint8
  ContnPrkgReq: uint8
  XLvl: uint16
  YLvl: uint16
  ScrnOpSts: uint8
  RollingCounter_HUT32: uint8

HUT32_RAW_BUS = Simulink.Bus(HeaderFile="Rte_Type.h")
  CheckSum_HUT32: uint8  % 1|0|0|255|uint8
  ContnPrkgReqValid: boolean  % 1|0|0|1|boolean
  DetVideoLost: boolean  % 1|0|0|1|boolean
  PrkgCtrlModReqValid: boolean  % 1|0|0|1|boolean
  PrkgCtrlModReq: uint8  % 1|0|0|3|uint8
  ContnPrkgReq: uint8  % 1|0|0|3|uint8
  XLvl: uint16  % 1|0|0|2047|uint16
  YLvl: uint16  % 1|0|0|2047|uint16
  ScrnOpSts: uint8  % 1|0|0|3|uint8
  RollingCounter_HUT32: uint8  % 1|0|0|15|uint8

HUT33_MSG_BUS = Simulink.Bus(HeaderFile="Rte_Type.h")
  PrkInDirChoice: uint8
  PathLrngFinshCmd: boolean
  PathLrngStartCmd: boolean
  ParkMdlCmd: boolean
  BackReq_APS: boolean
  SelPrkOutDirReq: uint8
  StartPrkgPath2Cmd: boolean
  DeletePath2Cmd: boolean
  StartPrkgPath1Cmd: boolean
  DeletePath1Cmd: boolean
  SelPrkgFctnCmd: uint8

HUT33_RAW_BUS = Simulink.Bus(HeaderFile="Rte_Type.h")
  PrkInDirChoice: uint8  % 1|0|0|3|uint8
  PathLrngFinshCmd: boolean  % 1|0|0|1|boolean
  PathLrngStartCmd: boolean  % 1|0|0|1|boolean
  ParkMdlCmd: boolean  % 1|0|0|1|boolean
  BackReq_APS: boolean  % 1|0|0|1|boolean
  SelPrkOutDirReq: uint8  % 1|0|0|7|uint8
  StartPrkgPath2Cmd: boolean  % 1|0|0|1|boolean
  DeletePath2Cmd: boolean  % 1|0|0|1|boolean
  StartPrkgPath1Cmd: boolean  % 1|0|0|1|boolean
  DeletePath1Cmd: boolean  % 1|0|0|1|boolean
  SelPrkgFctnCmd: uint8  % 1|0|0|7|uint8

HUT34_MSG_BUS = Simulink.Bus(HeaderFile="Rte_Type.h")
  Time_Hour: uint8
  TimeMod: boolean
  TimeIndcn: boolean
  Time_Minutes: uint8
  Time_Second: uint8
  Time_Year_Right: uint8
  Time_Year_Left: uint8
  Time_Month: uint8
  Time_Day: uint8

HUT34_RAW_BUS = Simulink.Bus(HeaderFile="Rte_Type.h")
  Time_Hour: uint8  % 1|0|0|31|uint8
  TimeMod: boolean  % 1|0|0|1|boolean
  TimeIndcn: boolean  % 1|0|0|1|boolean
  Time_Minutes: uint8  % 1|0|0|63|uint8
  Time_Second: uint8  % 1|0|0|63|uint8
  Time_Year_Right: uint8  % 1|0|0|15|uint8
  Time_Year_Left: uint8  % 1|0|0|15|uint8
  Time_Month: uint8  % 1|0|0|15|uint8
  Time_Day: uint8  % 1|0|0|31|uint8

HUT6_MSG_BUS = Simulink.Bus(HeaderFile="Rte_Type.h")
  Guid_Ovl_Display_Cmd: boolean
  Sgl_View_Sel: uint8
  Radar_DispCmd: boolean
  LaneCalActvtCmd: boolean
  CarMdlTrsprcySwtCmd: boolean
  MdlColrChgCmd: boolean
  AutoViewChgCmd: boolean
  WshSoftSwt: boolean
  AutoAVMSwSet_Cmd: boolean
  SwToFieldCalRstCmd: boolean
  View_SoftswitchCmd: boolean
  FPAS_AutoModSwt: boolean
  MEBSwtSet: boolean
  MODChgReq: boolean
  CarMdlDispCmd: boolean

HUT6_RAW_BUS = Simulink.Bus(HeaderFile="Rte_Type.h")
  Guid_Ovl_Display_Cmd: boolean  % 1|0|0|1|boolean
  Sgl_View_Sel: uint8  % 1|0|0|15|uint8
  Radar_DispCmd: boolean  % 1|0|0|1|boolean
  LaneCalActvtCmd: boolean  % 1|0|0|1|boolean
  CarMdlTrsprcySwtCmd: boolean  % 1|0|0|1|boolean
  MdlColrChgCmd: boolean  % 1|0|0|1|boolean
  AutoViewChgCmd: boolean  % 1|0|0|1|boolean
  WshSoftSwt: boolean  % 1|0|0|1|boolean
  AutoAVMSwSet_Cmd: boolean  % 1|0|0|1|boolean
  SwToFieldCalRstCmd: boolean  % 1|0|0|1|boolean
  View_SoftswitchCmd: boolean  % 1|0|0|1|boolean
  FPAS_AutoModSwt: boolean  % 1|0|0|1|boolean
  MEBSwtSet: boolean  % 1|0|0|1|boolean
  MODChgReq: boolean  % 1|0|0|1|boolean
  CarMdlDispCmd: boolean  % 1|0|0|1|boolean

HUT_FD1_MSG_BUS = Simulink.Bus(HeaderFile="Rte_Type.h")
  IFC_SnvtySet: uint8
  FCW_SnvtySet: uint8
  RCWSwtReq: boolean
  RCTABrkSwtReq: boolean
  RCTASwtReq: boolean
  LCASwtReq: boolean
  LDWSwtReq: boolean
  ESS_VehSwtReq: boolean
  ESS_PedSwtReq: boolean
  ELKSwtReq: boolean
  LCKSwtReq: boolean
  LKASwtReq: boolean
  AEB_VehSwtReq: boolean
  LSSWarnFormSwtReq: uint8
  TSRWarnSwtReq: boolean
  TSRSwtReq: boolean
  DOWSwtReq: boolean
  AEB_PedSwtReq: boolean
  LSSSwtReq: boolean
  IntelligentEvaSwtReq: boolean
  TSR_SnvtySet: int8
  ISLSwtReq: boolean
  ICA_HandsOffSwtReq: boolean
  NavVehToTrafEyeDist: uint16
  NavSpdLimUnit_HUT: uint8
  NavSpdLimValue: uint8
  HWA_SwtReq: boolean
  NavSpdLimSignSts: uint8
  NavCtryType: uint16
  NavTSRTrafSign: uint8
  ALC_SwtReq: boolean
  AESSwtReq: boolean
  AEB_JASwtReq: boolean
  FCTABrkSwtReq: boolean
  FCTASwtReq: boolean
  HWA_SnvtySet: uint8
  NavSpdLimType: uint8
  NavRoadType: uint8
  ADAS_Posn_MsgTye: uint8
  ADAS_Posn_Offset: uint16
  ADAS_Posn_Pathldx: uint8
  ADAS_Posn_CycCnt: uint8
  ADAS_Posn_PosProbb: single
  ADAS_Posn_Idx: uint8
  ADAS_Posn_Age: uint16
  ADAS_Posn_CurLane: uint8
  ADAS_Posn_PosConfdc: uint8
  ADAS_Posn_Spd: single
  ADAS_Posn_Rehead: single
  FreshnessValue_HUT_FD1: uint16
  MAC_Check_HUT_FD1: uint64

HUT_FD1_RAW_BUS = Simulink.Bus(HeaderFile="Rte_Type.h")
  IFC_SnvtySet: uint8  % 1|0|0|3|uint8
  FCW_SnvtySet: uint8  % 1|0|0|3|uint8
  RCWSwtReq: boolean  % 1|0|0|1|boolean
  RCTABrkSwtReq: boolean  % 1|0|0|1|boolean
  RCTASwtReq: boolean  % 1|0|0|1|boolean
  LCASwtReq: boolean  % 1|0|0|1|boolean
  LDWSwtReq: boolean  % 1|0|0|1|boolean
  ESS_VehSwtReq: boolean  % 1|0|0|1|boolean
  ESS_PedSwtReq: boolean  % 1|0|0|1|boolean
  ELKSwtReq: boolean  % 1|0|0|1|boolean
  LCKSwtReq: boolean  % 1|0|0|1|boolean
  LKASwtReq: boolean  % 1|0|0|1|boolean
  AEB_VehSwtReq: boolean  % 1|0|0|1|boolean
  LSSWarnFormSwtReq: uint8  % 1|0|0|3|uint8
  TSRWarnSwtReq: boolean  % 1|0|0|1|boolean
  TSRSwtReq: boolean  % 1|0|0|1|boolean
  DOWSwtReq: boolean  % 1|0|0|1|boolean
  AEB_PedSwtReq: boolean  % 1|0|0|1|boolean
  LSSSwtReq: boolean  % 1|0|0|1|boolean
  IntelligentEvaSwtReq: boolean  % 1|0|0|1|boolean
  TSR_SnvtySet: uint8  % 1|-15|-15|15|int8
  ISLSwtReq: boolean  % 1|0|0|1|boolean
  ICA_HandsOffSwtReq: boolean  % 1|0|0|1|boolean
  NavVehToTrafEyeDist: uint16  % 1|0|0|1023|uint16
  NavSpdLimUnit_HUT: uint8  % 1|0|0|3|uint8
  NavSpdLimValue: uint8  % 1|0|0|63|uint8
  HWA_SwtReq: boolean  % 1|0|0|1|boolean
  NavSpdLimSignSts: uint8  % 1|0|0|7|uint8
  NavCtryType: uint16  % 1|0|0|1023|uint16
  NavTSRTrafSign: uint8  % 1|0|0|255|uint8
  ALC_SwtReq: boolean  % 1|0|0|1|boolean
  AESSwtReq: boolean  % 1|0|0|1|boolean
  AEB_JASwtReq: boolean  % 1|0|0|1|boolean
  FCTABrkSwtReq: boolean  % 1|0|0|1|boolean
  FCTASwtReq: boolean  % 1|0|0|1|boolean
  HWA_SnvtySet: uint8  % 1|0|0|3|uint8
  NavSpdLimType: uint8  % 1|0|0|3|uint8
  NavRoadType: uint8  % 1|0|0|15|uint8
  ADAS_Posn_MsgTye: uint8  % 1|0|0|7|uint8
  ADAS_Posn_Offset: uint16  % 1|0|0|8190|uint16
  ADAS_Posn_Pathldx: uint8  % 1|0|0|63|uint8
  ADAS_Posn_CycCnt: uint8  % 1|0|0|3|uint8
  ADAS_Posn_PosProbb: uint8  % 3.33|0|0|100|single
  ADAS_Posn_Idx: uint8  % 1|0|0|3|uint8
  ADAS_Posn_Age: uint16  % 5|0|0|2545|uint16
  ADAS_Posn_CurLane: uint8  % 1|0|0|7|uint8
  ADAS_Posn_PosConfdc: uint8  % 1|0|0|7|uint8
  ADAS_Posn_Spd: uint16  % 0.2|-12.8|-12.8|89.2|single
  ADAS_Posn_Rehead: uint8  % 1.417|0|0|358.583|single
  FreshnessValue_HUT_FD1: uint16  % 1|0|0|65535|uint16
  MAC_Check_HUT_FD1: uint64  % 1|0|0|281474976710655|uint64

HUT_IP2_MSG_BUS = Simulink.Bus(HeaderFile="Rte_Type.h")
  IP_VehTotDistance: single
  IP_VehTotDistanceValid: boolean
  IP_ACCErr: boolean
  IP_Err: boolean
  IP_VehSpdUnit: boolean
  FreshnessValue_IP2: uint16
  MAC_Check_IP2: uint64

HUT_IP2_RAW_BUS = Simulink.Bus(HeaderFile="Rte_Type.h")
  IP_VehTotDistance: uint32  % 0.1|0|0|999999.9|single
  IP_VehTotDistanceValid: boolean  % 1|0|0|1|boolean
  IP_ACCErr: boolean  % 1|0|0|1|boolean
  IP_Err: boolean  % 1|0|0|1|boolean
  IP_VehSpdUnit: boolean  % 1|0|0|1|boolean
  FreshnessValue_IP2: uint16  % 1|0|0|65535|uint16
  MAC_Check_IP2: uint64  % 1|0|0|281474976710655|uint64

IDC_L2_PHY_REQ_MSG_BUS = Simulink.Bus(HeaderFile="Rte_Type.h")
  IDC_L2_Phy_Req: uint64

IDC_L2_PHY_REQ_RAW_BUS = Simulink.Bus(HeaderFile="Rte_Type.h")
  IDC_L2_Phy_Req: uint64  % 1|0|0|1.84467440737096e+19|uint64

IDC_L2_PHY_RESP_MSG_BUS = Simulink.Bus(HeaderFile="Rte_Type.h")
  IDC_L2_Phy_Resp: uint64

IDC_L2_PHY_RESP_RAW_BUS = Simulink.Bus(HeaderFile="Rte_Type.h")
  IDC_L2_Phy_Resp: uint64  % 1|0|0|1.84467440737096e+19|uint64

IFC_FD1_MSG_BUS = Simulink.Bus(HeaderFile="Rte_Type.h")
  Checksum_IFC1: uint8
  IFCTrqOvlCmdProtnValue: uint16
  IFCVibrationWarning: uint8
  IFCTrqOvlCmdReqValue: single
  RollingCounter_IFC1: uint8
  IFCFuncTrqCmdReqFlag: uint8
  Checksum_IFC2: uint8
  IFCAngCmdReqValue: single
  IFCAngCmdReqProtnValue: uint16
  RollingCounter_IFC2: uint8

IFC_FD1_RAW_BUS = Simulink.Bus(HeaderFile="Rte_Type.h")
  Checksum_IFC1: uint8  % 1|0|0|255|uint8
  IFCTrqOvlCmdProtnValue: uint16  % 1|0|0|16383|uint16
  IFCVibrationWarning: uint8  % 1|0|0|3|uint8
  IFCTrqOvlCmdReqValue: uint16  % 0.01|-10.23|-10.23|10.24|single
  RollingCounter_IFC1: uint8  % 1|0|0|15|uint8
  IFCFuncTrqCmdReqFlag: uint8  % 1|0|0|7|uint8
  Checksum_IFC2: uint8  % 1|0|0|255|uint8
  IFCAngCmdReqValue: uint16  % 0.1|-780|-780|780|single
  IFCAngCmdReqProtnValue: uint16  % 1|0|0|16383|uint16
  RollingCounter_IFC2: uint8  % 1|0|0|15|uint8

IFC_FD2_MSG_BUS = Simulink.Bus(HeaderFile="Rte_Type.h")
  Checksum_IFC3: uint8
  IFCHUTInterface: boolean
  LDW_LKA_Snvty: uint8
  AESResp: boolean
  ELKResp: boolean
  LCKResp: boolean
  LKAResp: boolean
  LDWResp: boolean
  AESSts: uint8
  IntelligentEvaResp: boolean
  LSSResp: boolean
  LSSWarnFormResp: uint8
  ESS_VehResp: boolean
  ESS_PedResp: boolean
  ESSErrSts: boolean
  AESErrSts: boolean
  ESSSts: uint8
  RollingCounter_IFC3: uint8
  Checksum_IFC4: uint8
  LSSFuncSts: uint8
  LSSIntervention: uint8
  LDW_LKAWarn: uint8
  TJA_FollowSts: uint8
  LaneAvailability: uint8
  ELKMainState: uint8
  CameraBlockageSts: boolean
  IFCCalibrationSts: uint8
  IFC_Handsoffwarn: uint8
  LSSErrSts: uint8
  IntelligentEvaActSts: boolean
  ELKActSts: boolean
  RollingCounter_IFC4: uint8
  ESSintervention: uint8
  AESintervention: uint8
  Checksum_IFC5: uint8
  IFC_LeLaneTyp: uint8
  IFC_LaneCurve: single
  IFC_NextRiLaneTyp: uint8
  IFC_NextLeLaneTyp: uint8
  IFC_RiLaneTyp: uint8
  IFC_LeLane_dy: single
  IFC_RiLane_dy: single
  RollingCounter_IFC5: uint8
  Checksum_IFC6: uint8
  IFC_NextLeLane_dy: single
  IFC_NextRiLane_dy: single
  RollingCounter_IFC6: uint8

IFC_FD2_RAW_BUS = Simulink.Bus(HeaderFile="Rte_Type.h")
  Checksum_IFC3: uint8  % 1|0|0|255|uint8
  IFCHUTInterface: boolean  % 1|0|0|1|boolean
  LDW_LKA_Snvty: uint8  % 1|0|0|3|uint8
  AESResp: boolean  % 1|0|0|1|boolean
  ELKResp: boolean  % 1|0|0|1|boolean
  LCKResp: boolean  % 1|0|0|1|boolean
  LKAResp: boolean  % 1|0|0|1|boolean
  LDWResp: boolean  % 1|0|0|1|boolean
  AESSts: uint8  % 1|0|0|3|uint8
  IntelligentEvaResp: boolean  % 1|0|0|1|boolean
  LSSResp: boolean  % 1|0|0|1|boolean
  LSSWarnFormResp: uint8  % 1|0|0|3|uint8
  ESS_VehResp: boolean  % 1|0|0|1|boolean
  ESS_PedResp: boolean  % 1|0|0|1|boolean
  ESSErrSts: boolean  % 1|0|0|1|boolean
  AESErrSts: boolean  % 1|0|0|1|boolean
  ESSSts: uint8  % 1|0|0|3|uint8
  RollingCounter_IFC3: uint8  % 1|0|0|15|uint8
  Checksum_IFC4: uint8  % 1|0|0|255|uint8
  LSSFuncSts: uint8  % 1|0|0|7|uint8
  LSSIntervention: uint8  % 1|0|0|7|uint8
  LDW_LKAWarn: uint8  % 1|0|0|3|uint8
  TJA_FollowSts: uint8  % 1|0|0|3|uint8
  LaneAvailability: uint8  % 1|0|0|3|uint8
  ELKMainState: uint8  % 1|0|0|7|uint8
  CameraBlockageSts: boolean  % 1|0|0|1|boolean
  IFCCalibrationSts: uint8  % 1|0|0|3|uint8
  IFC_Handsoffwarn: uint8  % 1|0|0|7|uint8
  LSSErrSts: uint8  % 1|0|0|7|uint8
  IntelligentEvaActSts: boolean  % 1|0|0|1|boolean
  ELKActSts: boolean  % 1|0|0|1|boolean
  RollingCounter_IFC4: uint8  % 1|0|0|15|uint8
  ESSintervention: uint8  % 1|0|0|3|uint8
  AESintervention: uint8  % 1|0|0|3|uint8
  Checksum_IFC5: uint8  % 1|0|0|255|uint8
  IFC_LeLaneTyp: uint8  % 1|0|0|7|uint8
  IFC_LaneCurve: uint16  % 1.5e-05|-0.030705|-0.030705|0.030705|single
  IFC_NextRiLaneTyp: uint8  % 1|0|0|7|uint8
  IFC_NextLeLaneTyp: uint8  % 1|0|0|7|uint8
  IFC_RiLaneTyp: uint8  % 1|0|0|7|uint8
  IFC_LeLane_dy: uint16  % 0.0039063|-8|-8|7.9922|single
  IFC_RiLane_dy: uint16  % 0.0039063|-8|-8|7.9922|single
  RollingCounter_IFC5: uint8  % 1|0|0|15|uint8
  Checksum_IFC6: uint8  % 1|0|0|255|uint8
  IFC_NextLeLane_dy: uint16  % 0.0039063|-8|-8|7.9922|single
  IFC_NextRiLane_dy: uint16  % 0.0039063|-8|-8|7.9922|single
  RollingCounter_IFC6: uint8  % 1|0|0|15|uint8

IFC_FD3_MSG_BUS = Simulink.Bus(HeaderFile="Rte_Type.h")
  Checksum_IFC7: uint8
  TSRSts: uint8
  TSRSpdLimCfdc: uint8
  TSRSpdLimUnit: uint8
  TSRResp: boolean
  TSRSpdLimSts: uint8
  TSRSpdLim: uint8
  TSRTrfcSignValCfdc: uint8
  TSR_Snvty: int8
  TSRSpdLimWarn: boolean
  TSRTrfcSignVal: uint8
  TSRWarnResp: boolean
  HMA_HibeamReq: uint8
  RollingCounter_IFC7: uint8
  HMA_Sts: uint8

IFC_FD3_RAW_BUS = Simulink.Bus(HeaderFile="Rte_Type.h")
  Checksum_IFC7: uint8  % 1|0|0|255|uint8
  TSRSts: uint8  % 1|0|0|7|uint8
  TSRSpdLimCfdc: uint8  % 1|0|0|3|uint8
  TSRSpdLimUnit: uint8  % 1|0|0|3|uint8
  TSRResp: boolean  % 1|0|0|1|boolean
  TSRSpdLimSts: uint8  % 1|0|0|3|uint8
  TSRSpdLim: uint8  % 1|0|0|63|uint8
  TSRTrfcSignValCfdc: uint8  % 1|0|0|3|uint8
  TSR_Snvty: uint8  % 1|-15|-15|15|int8
  TSRSpdLimWarn: boolean  % 1|0|0|1|boolean
  TSRTrfcSignVal: uint8  % 1|0|0|255|uint8
  TSRWarnResp: boolean  % 1|0|0|1|boolean
  HMA_HibeamReq: uint8  % 1|0|0|3|uint8
  RollingCounter_IFC7: uint8  % 1|0|0|15|uint8
  HMA_Sts: uint8  % 1|0|0|7|uint8

IFC_FD5_MSG_BUS = Simulink.Bus(HeaderFile="Rte_Type.h")
  IFC_Line01_Dy: single
  IFC_Line01_Curv: single
  IFC_Line01_CurvChange: single
  IFC_Line01_Type: uint8
  IFC_Line02_Dy: single
  IFC_Line02_Curv: single
  IFC_Line02_CurvChange: single
  IFC_Line02_Type: uint8
  IFC_Line03_Dy: single
  IFC_Line03_Curv: single
  IFC_Line03_CurvChange: single
  IFC_Line03_Type: uint8
  IFC_Line04_Dy: single
  IFC_Line04_Curv: single
  IFC_Line04_CurvChange: single
  IFC_Line04_Type: uint8
  IFC_Roadedge01_Dy: single
  IFC_Roadedge01_Curv: single
  IFC_Roadedge01_CurvChange: single
  IFC_Roadedge01_Type: uint8
  IFC_Roadedge02_Dy: single
  IFC_Roadedge02_Curv: single
  IFC_Roadedge02_CurvChange: single
  IFC_Roadedge02_Type: uint8

IFC_FD5_RAW_BUS = Simulink.Bus(HeaderFile="Rte_Type.h")
  IFC_Line01_Dy: uint16  % 0.01|-30|-30|30|single
  IFC_Line01_Curv: uint16  % 1.6e-05|-0.25|-0.25|0.25|single
  IFC_Line01_CurvChange: uint32  % 5e-08|-0.024|-0.024|0.024|single
  IFC_Line01_Type: uint8  % 1|0|0|15|uint8
  IFC_Line02_Dy: uint16  % 0.01|-30|-30|30|single
  IFC_Line02_Curv: uint16  % 1.6e-05|-0.25|-0.25|0.25|single
  IFC_Line02_CurvChange: uint32  % 5e-08|-0.024|-0.024|0.024|single
  IFC_Line02_Type: uint8  % 1|0|0|15|uint8
  IFC_Line03_Dy: uint16  % 0.01|-30|-30|30|single
  IFC_Line03_Curv: uint16  % 1.6e-05|-0.25|-0.25|0.25|single
  IFC_Line03_CurvChange: uint32  % 5e-08|-0.024|-0.024|0.024|single
  IFC_Line03_Type: uint8  % 1|0|0|15|uint8
  IFC_Line04_Dy: uint16  % 0.01|-30|-30|30|single
  IFC_Line04_Curv: uint16  % 1.6e-05|-0.25|-0.25|0.25|single
  IFC_Line04_CurvChange: uint32  % 5e-08|-0.024|-0.024|0.024|single
  IFC_Line04_Type: uint8  % 1|0|0|15|uint8
  IFC_Roadedge01_Dy: uint16  % 0.01|-30|-30|30|single
  IFC_Roadedge01_Curv: uint16  % 1.6e-05|-0.25|-0.25|0.25|single
  IFC_Roadedge01_CurvChange: uint32  % 5e-08|-0.024|-0.024|0.024|single
  IFC_Roadedge01_Type: uint8  % 1|0|0|15|uint8
  IFC_Roadedge02_Dy: uint16  % 0.01|-30|-30|30|single
  IFC_Roadedge02_Curv: uint16  % 1.6e-05|-0.25|-0.25|0.25|single
  IFC_Roadedge02_CurvChange: uint32  % 5e-08|-0.024|-0.024|0.024|single
  IFC_Roadedge02_Type: uint8  % 1|0|0|15|uint8

IFC_FD6_MSG_BUS = Simulink.Bus(HeaderFile="Rte_Type.h")
  IFC_Line01_DxStart: single
  IFC_Line01_DxEnd: single
  IFC_Line01_HeadingAngle: single
  IFC_Line02_HeadingAngle: single
  IFC_Line02_DxStart: single
  IFC_Line02_DxEnd: single
  IFC_Line03_DxStart: single
  IFC_Line03_DxEnd: single
  IFC_Line03_HeadingAngle: single
  IFC_Line04_DxStart: single
  IFC_Line04_HeadingAngle: single
  IFC_Line04_DxEnd: single
  IFC_Roadedge01_DxStart: single
  IFC_Roadedge01_DxEnd: single
  IFC_Roadedge01_HeadingAngle: single
  IFC_Roadedge02_DxStart: single
  IFC_Roadedge02_DxEnd: single
  IFC_Roadedge02_HeadingAngle: single

IFC_FD6_RAW_BUS = Simulink.Bus(HeaderFile="Rte_Type.h")
  IFC_Line01_DxStart: uint16  % 0.01|0|0|200|single
  IFC_Line01_DxEnd: uint16  % 0.01|0|0|200|single
  IFC_Line01_HeadingAngle: uint16  % 0.01|-2|-2|2|single
  IFC_Line02_HeadingAngle: uint16  % 0.01|-2|-2|2|single
  IFC_Line02_DxStart: uint16  % 0.01|0|0|200|single
  IFC_Line02_DxEnd: uint16  % 0.01|0|0|200|single
  IFC_Line03_DxStart: uint16  % 0.01|0|0|200|single
  IFC_Line03_DxEnd: uint16  % 0.01|0|0|200|single
  IFC_Line03_HeadingAngle: uint16  % 0.01|-2|-2|2|single
  IFC_Line04_DxStart: uint16  % 0.01|0|0|200|single
  IFC_Line04_HeadingAngle: uint16  % 0.01|-2|-2|2|single
  IFC_Line04_DxEnd: uint16  % 0.01|0|0|200|single
  IFC_Roadedge01_DxStart: uint16  % 0.01|0|0|200|single
  IFC_Roadedge01_DxEnd: uint16  % 0.01|0|0|200|single
  IFC_Roadedge01_HeadingAngle: uint16  % 0.01|-2|-2|2|single
  IFC_Roadedge02_DxStart: uint16  % 0.01|0|0|200|single
  IFC_Roadedge02_DxEnd: uint16  % 0.01|0|0|200|single
  IFC_Roadedge02_HeadingAngle: uint16  % 0.01|-2|-2|2|single

IFC_PHY_REQ_MSG_BUS = Simulink.Bus(HeaderFile="Rte_Type.h")
  IFC_Phy_Req: uint64

IFC_PHY_REQ_RAW_BUS = Simulink.Bus(HeaderFile="Rte_Type.h")
  IFC_Phy_Req: uint64  % 1|0|0|1.84467440737096e+19|uint64

IFC_PHY_RESP_MSG_BUS = Simulink.Bus(HeaderFile="Rte_Type.h")
  IFC_Phy_Resp: uint64

IFC_PHY_RESP_RAW_BUS = Simulink.Bus(HeaderFile="Rte_Type.h")
  IFC_Phy_Resp: uint64  % 1|0|0|1.84467440737096e+19|uint64

PEPS2_MSG_BUS = Simulink.Bus(HeaderFile="Rte_Type.h")
  SysPowerModVld: boolean
  SysPowerMod: uint8

PEPS2_RAW_BUS = Simulink.Bus(HeaderFile="Rte_Type.h")
  SysPowerModVld: boolean  % 1|0|0|1|boolean
  SysPowerMod: uint8  % 1|0|0|3|uint8

RSDS_FD1_MSG_BUS = Simulink.Bus(HeaderFile="Rte_Type.h")
  RSDS_ObjRelAccelY_Le: single
  Checksum_RSDS_R_2: uint8
  RSDS_BrkgReq: boolean
  RSDS_Brk_ErrSts: boolean
  RSDS_IPSoundReq: uint8
  RSDS_LEDLightReqRight: uint8
  RSDS_LEDLightReqLeft: uint8
  RSDS_BrkgReqVal: single
  DOW_warningReqleft: uint8
  DOW_warningReqRight: uint8
  BSD_LCA_warningReqleft: uint8
  BSD_LCA_warningReqRight: uint8
  RSDS_RCW_Trigger: uint8
  RSDS_RCTAResp: boolean
  RSDS_RCWResp: boolean
  RSDS_DOWResp: boolean
  RSDS_LCAResp: boolean
  RSDS_TrailerSts: boolean
  RSDS_BliSts: boolean
  RSDS_BrkgTrig: boolean
  RSDS_ErrSts: boolean
  RollingCounter_RSDS_R_2: uint8
  RCTA_warningReqLeft: boolean
  RCTA_warningReqRight: boolean
  RSDS_CTA_Actv: boolean
  RSDS_RCTABrkResp: boolean
  Checksum_RSDS_R_3: uint8
  ObjIDLe: uint8
  LeTarSts: uint8
  ObjLgtPosnCurvLe: single
  ObjLatPosnCurvLe: single
  ObjLgtSpdCurvLe: single
  ObjLatSpdCurvLe: single
  RollingCounter_RSDS_R_3: uint8
  ObjTTCLe: single
  Checksum_RSDS_R_4: uint8
  ObjStatyLe: boolean
  ObjWidthLe: single
  ObjLenLe: uint8
  ObjRinRi: uint8
  ObjStsLe: uint8
  ZoneIndLe: uint8
  ObjStsRi: uint8
  ZoneIndRi: uint8
  ObjStatyRi: boolean
  ObjWidthRi: single
  RollingCounter_RSDS_R_4: uint8
  Checksum_RSDS_R_5: uint8
  ObjIDRi: uint8
  RiTarSts: uint8
  ObjLgtPosnCurvRi: single
  ObjLatPosnCurvRi: single
  ObjLgtSpdCurvRi: single
  ObjLatSpdCurvRi: single
  RollingCounter_RSDS_R_5: uint8
  ObjTTCRi: single
  RSDS_ObjDistXStd_Le: single
  RSDS_ObjRelVelXStd_Le: single
  RSDS_ObjDistYStd_Le: single
  RSDS_ObjRelVelYStd_Le: single
  RSDS_ObjRAccelYStd_Le: single
  RSDS_ObjRAccelXStd_Le: single
  RSDS_ObjDistYStd_Ri: single
  RSDS_ObjDistXStd_Ri: single
  RSDS_ObjRelVelXStd_Ri: single
  RSDS_ObjRelVelYStd_Ri: single
  RSDS_ObjRAccelYStd_Ri: single
  RSDS_ObjRAccelXStd_Ri: single
  RSDS_ObjRelAccelX_Le: single
  RSDS_ObjRelAccelX_Ri: single
  RSDS_ObjRelAccelY_Ri: single

RSDS_FD1_RAW_BUS = Simulink.Bus(HeaderFile="Rte_Type.h")
  RSDS_ObjRelAccelY_Le: uint16  % 0.03125|-16|-16|15.9688|single
  Checksum_RSDS_R_2: uint8  % 1|0|0|255|uint8
  RSDS_BrkgReq: boolean  % 1|0|0|1|boolean
  RSDS_Brk_ErrSts: boolean  % 1|0|0|1|boolean
  RSDS_IPSoundReq: uint8  % 1|0|0|3|uint8
  RSDS_LEDLightReqRight: uint8  % 1|0|0|3|uint8
  RSDS_LEDLightReqLeft: uint8  % 1|0|0|3|uint8
  RSDS_BrkgReqVal: uint8  % 0.05|-10|-10|2.75|single
  DOW_warningReqleft: uint8  % 1|0|0|3|uint8
  DOW_warningReqRight: uint8  % 1|0|0|3|uint8
  BSD_LCA_warningReqleft: uint8  % 1|0|0|3|uint8
  BSD_LCA_warningReqRight: uint8  % 1|0|0|3|uint8
  RSDS_RCW_Trigger: uint8  % 1|0|0|3|uint8
  RSDS_RCTAResp: boolean  % 1|0|0|1|boolean
  RSDS_RCWResp: boolean  % 1|0|0|1|boolean
  RSDS_DOWResp: boolean  % 1|0|0|1|boolean
  RSDS_LCAResp: boolean  % 1|0|0|1|boolean
  RSDS_TrailerSts: boolean  % 1|0|0|1|boolean
  RSDS_BliSts: boolean  % 1|0|0|1|boolean
  RSDS_BrkgTrig: boolean  % 1|0|0|1|boolean
  RSDS_ErrSts: boolean  % 1|0|0|1|boolean
  RollingCounter_RSDS_R_2: uint8  % 1|0|0|15|uint8
  RCTA_warningReqLeft: boolean  % 1|0|0|1|boolean
  RCTA_warningReqRight: boolean  % 1|0|0|1|boolean
  RSDS_CTA_Actv: boolean  % 1|0|0|1|boolean
  RSDS_RCTABrkResp: boolean  % 1|0|0|1|boolean
  Checksum_RSDS_R_3: uint8  % 1|0|0|255|uint8
  ObjIDLe: uint8  % 1|0|0|63|uint8
  LeTarSts: uint8  % 1|0|0|3|uint8
  ObjLgtPosnCurvLe: uint16  % 0.1|-92.3|-92.3|10|single
  ObjLatPosnCurvLe: uint8  % 0.1|-12.8|-12.8|12.7|single
  ObjLgtSpdCurvLe: uint16  % 0.1|-10|-10|92.3|single
  ObjLatSpdCurvLe: uint8  % 0.1|-6.4|-6.4|6.3|single
  RollingCounter_RSDS_R_3: uint8  % 1|0|0|15|uint8
  ObjTTCLe: uint8  % 0.1|0|0|12.7|single
  Checksum_RSDS_R_4: uint8  % 1|0|0|255|uint8
  ObjStatyLe: boolean  % 1|0|0|1|boolean
  ObjWidthLe: uint8  % 0.5|0|0|3.5|single
  ObjLenLe: uint8  % 1|0|0|15|uint8
  ObjRinRi: uint8  % 1|0|0|15|uint8
  ObjStsLe: uint8  % 1|0|0|3|uint8
  ZoneIndLe: uint8  % 1|0|0|3|uint8
  ObjStsRi: uint8  % 1|0|0|3|uint8
  ZoneIndRi: uint8  % 1|0|0|3|uint8
  ObjStatyRi: boolean  % 1|0|0|1|boolean
  ObjWidthRi: uint8  % 0.5|0|0|3.5|single
  RollingCounter_RSDS_R_4: uint8  % 1|0|0|15|uint8
  Checksum_RSDS_R_5: uint8  % 1|0|0|255|uint8
  ObjIDRi: uint8  % 1|0|0|63|uint8
  RiTarSts: uint8  % 1|0|0|3|uint8
  ObjLgtPosnCurvRi: uint16  % 0.1|-92.3|-92.3|10|single
  ObjLatPosnCurvRi: uint8  % 0.1|-12.8|-12.8|12.7|single
  ObjLgtSpdCurvRi: uint16  % 0.1|-10|-10|92.3|single
  ObjLatSpdCurvRi: uint8  % 0.1|-6.4|-6.4|6.3|single
  RollingCounter_RSDS_R_5: uint8  % 1|0|0|15|uint8
  ObjTTCRi: uint8  % 0.1|0|0|12.7|single
  RSDS_ObjDistXStd_Le: uint8  % 0.375|0|0|11.625|single
  RSDS_ObjRelVelXStd_Le: uint8  % 0.375|0|0|11.625|single
  RSDS_ObjDistYStd_Le: uint8  % 0.375|0|0|11.625|single
  RSDS_ObjRelVelYStd_Le: uint8  % 0.375|0|0|11.625|single
  RSDS_ObjRAccelYStd_Le: uint8  % 0.375|0|0|11.625|single
  RSDS_ObjRAccelXStd_Le: uint8  % 0.375|0|0|11.625|single
  RSDS_ObjDistYStd_Ri: uint8  % 0.375|0|0|11.625|single
  RSDS_ObjDistXStd_Ri: uint8  % 0.375|0|0|11.625|single
  RSDS_ObjRelVelXStd_Ri: uint8  % 0.375|0|0|11.625|single
  RSDS_ObjRelVelYStd_Ri: uint8  % 0.375|0|0|11.625|single
  RSDS_ObjRAccelYStd_Ri: uint8  % 0.375|0|0|11.625|single
  RSDS_ObjRAccelXStd_Ri: uint8  % 0.375|0|0|11.625|single
  RSDS_ObjRelAccelX_Le: uint16  % 0.03125|-16|-16|15.9688|single
  RSDS_ObjRelAccelX_Ri: uint16  % 0.03125|-16|-16|15.9688|single
  RSDS_ObjRelAccelY_Ri: uint16  % 0.03125|-16|-16|15.9688|single

RSDS_FD2_MSG_BUS = Simulink.Bus(HeaderFile="Rte_Type.h")
  RCTA_B_TTC: single
  BSD_LCA_Left_TTC: single
  RCW_TTC: single
  BSD_LCA_Right_TTC: single
  RSDS_LeTgt_01_dy: single
  RSDS_LeTgt_01: boolean
  RSDS_LeTgt_02: boolean
  RSDS_LeTgt_01_dx: single
  RSDS_LeTgt_02_dx: single
  RSDS_RiTgt_01: boolean
  RSDS_LeTgt_02_dy: single
  RSDS_RiTgt_01_dx: single
  RSDS_RiTgt_02: boolean
  RSDS_RiTgt_01_dy: single
  RSDS_RiTgt_02_dx: single
  RSDS_MidTgt_01: boolean
  RSDS_RiTgt_02_dy: single
  RSDS_MidTgt_01_dx: single
  RSDS_MidTgt_02: boolean
  RSDS_MidTgt_01_dy: single
  RSDS_MidTgt_02_dx: single
  RSDS_MidTgt_02_dy: single

RSDS_FD2_RAW_BUS = Simulink.Bus(HeaderFile="Rte_Type.h")
  RCTA_B_TTC: uint8  % 0.1|0|0|6.3|single
  BSD_LCA_Left_TTC: uint8  % 0.1|0|0|6.3|single
  RCW_TTC: uint8  % 0.1|0|0|6.3|single
  BSD_LCA_Right_TTC: uint8  % 0.1|0|0|6.3|single
  RSDS_LeTgt_01_dy: uint8  % 0.1|0|0|8|single
  RSDS_LeTgt_01: boolean  % 1|0|0|1|boolean
  RSDS_LeTgt_02: boolean  % 1|0|0|1|boolean
  RSDS_LeTgt_01_dx: uint16  % 0.1|-90|-90|5|single
  RSDS_LeTgt_02_dx: uint16  % 0.1|-90|-90|5|single
  RSDS_RiTgt_01: boolean  % 1|0|0|1|boolean
  RSDS_LeTgt_02_dy: uint8  % 0.1|0|0|8|single
  RSDS_RiTgt_01_dx: uint16  % 0.1|-90|-90|5|single
  RSDS_RiTgt_02: boolean  % 1|0|0|1|boolean
  RSDS_RiTgt_01_dy: uint8  % 0.1|-8|-8|0|single
  RSDS_RiTgt_02_dx: uint16  % 0.1|-90|-90|5|single
  RSDS_MidTgt_01: boolean  % 1|0|0|1|boolean
  RSDS_RiTgt_02_dy: uint8  % 0.1|-8|-8|0|single
  RSDS_MidTgt_01_dx: uint16  % 0.1|-90|-90|5|single
  RSDS_MidTgt_02: boolean  % 1|0|0|1|boolean
  RSDS_MidTgt_01_dy: uint8  % 0.1|-4|-4|4|single
  RSDS_MidTgt_02_dx: uint16  % 0.1|-90|-90|5|single
  RSDS_MidTgt_02_dy: uint8  % 0.1|-4|-4|4|single

RSDS_L_PHY_REQ_MSG_BUS = Simulink.Bus(HeaderFile="Rte_Type.h")
  RSDS_L_Phy_Req: uint64

RSDS_L_PHY_REQ_RAW_BUS = Simulink.Bus(HeaderFile="Rte_Type.h")
  RSDS_L_Phy_Req: uint64  % 1|0|0|1.84467440737096e+19|uint64

RSDS_L_PHY_RESP_MSG_BUS = Simulink.Bus(HeaderFile="Rte_Type.h")
  RSDS_L_Phy_Resp: uint64

RSDS_L_PHY_RESP_RAW_BUS = Simulink.Bus(HeaderFile="Rte_Type.h")
  RSDS_L_Phy_Resp: uint64  % 1|0|0|1.84467440737096e+19|uint64

RSDS_R_PHY_REQ_MSG_BUS = Simulink.Bus(HeaderFile="Rte_Type.h")
  RSDS_R_Phy_Req: uint64

RSDS_R_PHY_REQ_RAW_BUS = Simulink.Bus(HeaderFile="Rte_Type.h")
  RSDS_R_Phy_Req: uint64  % 1|0|0|1.84467440737096e+19|uint64

RSDS_R_PHY_RESP_MSG_BUS = Simulink.Bus(HeaderFile="Rte_Type.h")
  RSDS_R_Phy_Resp: uint64

RSDS_R_PHY_RESP_RAW_BUS = Simulink.Bus(HeaderFile="Rte_Type.h")
  RSDS_R_Phy_Resp: uint64  % 1|0|0|1.84467440737096e+19|uint64

R_PBOX1_MSG_BUS = Simulink.Bus(HeaderFile="Rte_Type.h")
  PosnLmpOutpSts_R_Pbox: boolean
  RBrkLmpFailSts: boolean
  LBrkLmpFailSts: boolean
  HiPosnBrkLmpFailSts: boolean
  RFogLmpSts_R_Pbox: boolean
  RFogLmpFailSts_R_Pbox: boolean
  RTurnLmpSts_R_Pbox: boolean
  LTurnLmpSts_R_Pbox: boolean
  FreshnessValue_R_PBox1: uint16
  MAC_Check_R_PBox1: uint64

R_PBOX1_RAW_BUS = Simulink.Bus(HeaderFile="Rte_Type.h")
  PosnLmpOutpSts_R_Pbox: boolean  % 1|0|0|1|boolean
  RBrkLmpFailSts: boolean  % 1|0|0|1|boolean
  LBrkLmpFailSts: boolean  % 1|0|0|1|boolean
  HiPosnBrkLmpFailSts: boolean  % 1|0|0|1|boolean
  RFogLmpSts_R_Pbox: boolean  % 1|0|0|1|boolean
  RFogLmpFailSts_R_Pbox: boolean  % 1|0|0|1|boolean
  RTurnLmpSts_R_Pbox: boolean  % 1|0|0|1|boolean
  LTurnLmpSts_R_Pbox: boolean  % 1|0|0|1|boolean
  FreshnessValue_R_PBox1: uint16  % 1|0|0|65535|uint16
  MAC_Check_R_PBox1: uint64  % 1|0|0|281474976710655|uint64

T_BOX_FD3_MSG_BUS = Simulink.Bus(HeaderFile="Rte_Type.h")
  T_Box_SysErrSts: uint8
  FreshnessValue_T_Box_FD3: uint16
  MAC_Check_T_Box_FD3: uint64

T_BOX_FD3_RAW_BUS = Simulink.Bus(HeaderFile="Rte_Type.h")
  T_Box_SysErrSts: uint8  % 1|0|0|31|uint8
  FreshnessValue_T_Box_FD3: uint16  % 1|0|0|65535|uint16
  MAC_Check_T_Box_FD3: uint64  % 1|0|0|281474976710655|uint64

TRAILER1_MSG_BUS = Simulink.Bus(HeaderFile="Rte_Type.h")
  TrailerSts: boolean

TRAILER1_RAW_BUS = Simulink.Bus(HeaderFile="Rte_Type.h")
  TrailerSts: boolean  % 1|0|0|1|boolean