% Simulink data dictionary PubIfVCanV71.sldd

PAS_PHY_REQ_MSG_BUS = Simulink.Bus()
  PAS_Phy_Req: uint64

PAS_PHY_RESP_MSG_BUS = Simulink.Bus()
  PAS_Phy_Resp: uint64

ABM_NODE_BUS = Simulink.Bus(HeaderFile="Rte_Type.h")
  ABM1_MSG: ABM1_MSG_BUS
  ABM2_MSG: ABM2_MSG_BUS

AC_NEDE_BUS = Simulink.Bus(HeaderFile="Rte_Type.h")
  AC2_MSG: Bus: AC2_MSG_BUS

BCM_NODE_BUS = Simulink.Bus(HeaderFile="Rte_Type.h")
  BCM1_MSG: BCM1_MSG_BUS
  BCM10_MSG: BCM10_MSG_BUS
  BCM3_MSG: BCM3_MSG_BUS
  BCM8_MSG: BCM8_MSG_BUS

CR_NODE_BUS = Simulink.Bus(HeaderFile="Rte_Type.h")
  CR_FD1_MSG: CR_FD1_MSG_BUS
  CR_L_PHY_REQ_MSG: CR_L_PHY_REQ_MSG_BUS
  CR_L_PHY_RESP_MSG: CR_L_PHY_RESP_MSG_BUS
  CR_R_PHY_REQ_MSG: CR_R_PHY_REQ_MSG_BUS
  CR_R_PHY_RESP_MSG: CR_R_PHY_RESP_MSG_BUS

CSA_NODE_BUS = Simulink.Bus(HeaderFile="Rte_Type.h")
  CSA1_MSG: CSA1_MSG_BUS
  CSA2_MSG: CSA2_MSG_BUS
  CSA4_MSG: CSA4_MSG_BUS

DCT_NODE_BUS = Simulink.Bus(HeaderFile="Rte_Type.h")
  DCT5_MSG: DCT5_MSG_BUS
  DCT_FD1_MSG: DCT_FD1_MSG_BUS
  DCT_FD4_MSG: DCT_FD4_MSG_BUS

DMS_NODE_BUS = Simulink.Bus(HeaderFile="Rte_Type.h")
  DMS_FD1_MSG: DMS_FD1_MSG_BUS

ECM_NODE_BUS = Simulink.Bus(HeaderFile="Rte_Type.h")
  ECM1_MSG: ECM1_MSG_BUS
  ECM_FD1_MSG: ECM_FD1_MSG_BUS
  ECM_FD2_MSG: ECM_FD2_MSG_BUS
  ECM_FD3_MSG: ECM_FD3_MSG_BUS

EPS_NODE_BUS = Simulink.Bus(HeaderFile="Rte_Type.h")
  EPS_FD1_MSG: EPS_FD1_MSG_BUS

ESP_NODE_BUS = Simulink.Bus(HeaderFile="Rte_Type.h")
  ESP_FD2_MSG: ESP_FD2_MSG_BUS
  ESP_FD3_MSG: ESP_FD3_MSG_BUS

HAP_NODE_BUS = Simulink.Bus(HeaderFile="Rte_Type.h")
  HAP_FD1_MSG: HAP_FD1_MSG_BUS
  HAP_FD2_MSG: HAP_FD2_MSG_BUS
  HAP_FD3_MSG: HAP_FD3_MSG_BUS
  HAP_FD4_MSG: HAP_FD4_MSG_BUS
  HAP_FD5_MSG: HAP_FD5_MSG_BUS
  HAP_FD6_MSG: HAP_FD6_MSG_BUS
  HAP_PHY_REQ_MSG: HAP_PHY_REQ_MSG_BUS
  HAP_PHY_RESP_MSG: HAP_PHY_RESP_MSG_BUS

HC_NODE_BUS = Simulink.Bus(HeaderFile="Rte_Type.h")
  HC1_MSG: Bus: HC1_MSG_BUS
  HC_NM_MSG: Bus: HC_NM_MSG_BUS

HCU_NODE_BUS = Simulink.Bus(HeaderFile="Rte_Type.h")
  HCU_FD1_MSG: HCU_FD1_MSG_BUS
  HCU_FD3_MSG: HCU_FD3_MSG_BUS
  HCU_HP8_MSG: HCU_HP8_MSG_BUS
  HCU_PT4_MSG: HCU_PT4_MSG_BUS

HUT_NODE_BUS = Simulink.Bus(HeaderFile="Rte_Type.h")
  HUT15_MSG: HUT15_MSG_BUS
  HUT19_MSG: HUT19_MSG_BUS
  HUT20_MSG: HUT20_MSG_BUS
  HUT21_MSG: HUT21_MSG_BUS
  HUT22_MSG: HUT22_MSG_BUS
  HUT23_MSG: HUT23_MSG_BUS
  HUT32_MSG: HUT32_MSG_BUS
  HUT33_MSG: HUT33_MSG_BUS
  HUT34_MSG: HUT34_MSG_BUS
  HUT6_MSG: HUT6_MSG_BUS
  HUT_FD1_MSG: HUT_FD1_MSG_BUS
  HUT_FD2_MSG: HUT_FD2_MSG_BUS
  HUT_FD3_MSG: HUT_FD3_MSG_BUS

IBOOSTER_NODE_BUS = Simulink.Bus(HeaderFile="Rte_Type.h")
  IBOOSTER_FD2_MSG: IBOOSTER_FD2_MSG_BUS

IDC_L3_NODE_BUS = Simulink.Bus(HeaderFile="Rte_Type.h")
  IDC_L3_FD1_MSG: IDC_L3_FD1_MSG_BUS
  IDC_L3_FD2_MSG: IDC_L3_FD2_MSG_BUS
  IDC_L3_FD3_MSG: IDC_L3_FD3_MSG_BUS
  IDC_L3_NM_MSG: IDC_L3_NM_MSG_BUS
  IDC_L3_PHY_REQ_MSG: IDC_L3_PHY_REQ_MSG_BUS
  IDC_L3_PHY_RESP_MSG: IDC_L3_PHY_RESP_MSG_BUS

IP_NODE_BUS = Simulink.Bus(HeaderFile="Rte_Type.h")
  IP2_MSG: IP2_MSG_BUS

PBOX_NODE_BUS = Simulink.Bus(HeaderFile="Rte_Type.h")
  R_PBOX1_MSG: Bus: R_PBOX1_MSG_BUS
  F_PBOX1_MSG: Bus: F_PBOX1_MSG_BUS

PEPS_NODE_BUS = Simulink.Bus(HeaderFile="Rte_Type.h")
  PEPS2_MSG: PEPS2_MSG_BUS

RSDS_NODE_BUS = Simulink.Bus(HeaderFile="Rte_Type.h")
  RSDS_FD1_MSG: RSDS_FD1_MSG_BUS
  RSDS_FD2_MSG: RSDS_FD2_MSG_BUS
  RSDS_L_PHY_REQ_MSG: RSDS_L_PHY_REQ_MSG_BUS
  RSDS_L_PHY_RESP_MSG: RSDS_L_PHY_RESP_MSG_BUS
  RSDS_R_PHY_REQ_MSG: RSDS_R_PHY_REQ_MSG_BUS
  RSDS_R_PHY_RESP_MSG: RSDS_R_PHY_RESP_MSG_BUS

ABM1_MSG_BUS = Simulink.Bus(HeaderFile="Rte_Type.h")
  CheckSum_ABM1: uint8
  PassSBR: boolean
  SecRowRSBR: boolean
  DrvSBR: boolean
  SecRowMidSBR: boolean
  AirbFailLmpCmd: boolean
  SecRowLSBR: boolean
  PABSwtSts: boolean
  CrashOutputSts: uint8
  DrvSBR_Visual: uint8
  PassSBR_Visual: uint8
  SecRowLSBR_Visual: uint8
  SecRowMidSBR_Visual: uint8
  SecRowRSBR_Visual: uint8
  RollingCounter_ABM1: uint8
  FreshnessValue_ABM1: uint16
  MAC_Check_ABM1: uint64

ABM2_MSG_BUS = Simulink.Bus(HeaderFile="Rte_Type.h")
  CheckSum_ABM2: uint8
  VehLgtAccel: single
  VehLatAccel: single
  VehYawRate: single
  RollingCounter_ABM2: uint8
  VehDynYawRateVld: boolean
  VehLatAccelVld: boolean
  VehLgtAccelVld: boolean

AC2_MSG_BUS = Simulink.Bus(HeaderFile="Rte_Type.h")
  ACFrntBlwrSpd: uint8
  ACAmbTemp: single

ACC_FD1_MSG_BUS = Simulink.Bus(HeaderFile="Rte_Type.h")
  HWP_TgtAccel_L2: int8
  HWP_UpperLimit_L2: single
  HWP_LowerLimit_L2: single
  HWP_TgtAccelCmftUpprLimVal_L2: single
  HWP_TgtAccelCmftLwrLimVal_L2: single
  HWP_ShutdownReq_L2: boolean
  HWP_MotTypeReqLong_L2: uint8
  HWP_MotTypeReqMode_L2: uint8
  HWP_ACCAvail: boolean
  HWP_AEBAvail: boolean
  HWP_SecureReq_L2: boolean
  HWP_UseTgtAccelCmftUpprLimVal_L2: boolean
  Checksum_ACC1: uint8
  Longctrl_Decel_Req: boolean
  Longctrl_ModSts: uint8
  Longctrl_DrvOFF_Req: boolean
  Longctrl_VehHldReq: boolean
  Longctrl_EngTrqReq: single
  Longctrl_ParkShiftReq: uint8
  Longctrl_DecelToStopReq: boolean
  Longctrl_FuelCutOffPrevn: boolean
  Longctrl_EngTrqReqActive: boolean
  Longctrl_Decel_ReqValue: single
  ActualTargetSpeed: uint8
  RollingCounter_ACC1: uint8
  Checksum_ACC2: uint8
  RollingCounter_ACC2: uint8
  ACC_CRInterface: boolean
  Checksum_ACC10: uint8
  Longctrl_HCUTrqReq: single
  Longctrl_HCUTrqReqActive: boolean
  RollingCounter_ACC10: uint8
  FreshnessValue_ACC_FD1: uint16

ACC_FD2_MSG_BUS = Simulink.Bus(HeaderFile="Rte_Type.h")
  ACC_LeTgt_02_Dy: single
  ACC_LeTgt_02_Dx: single
  ACC_RiTargrt_02_Detn: uint8
  ACC_LeTargrt_02_Detn: uint8
  ACC_LeTgt_02_Typ: uint8
  ACC_RiTgt_02_Dx: single
  ACC_RiTgtObjBarDisp: uint8
  ACC_LeTgtObjBarDisp: uint8
  ACC_RiTgt_02_Dy: single
  ACC_RiTgt_02_Typ: uint8
  Checksum_ACC3: uint8
  ALC_Resp: boolean
  HWA_SnvtySet_Resp: uint8
  HWA_Resp: boolean
  ICA_HandsOffResp: boolean
  ISL_Resp: boolean
  Longctrl_EngTrqReqActive_DVR: boolean
  Longctrl_Decel_Req_DVR: boolean
  Longctrl_ModSts_DVR: uint8
  Longctrl_DrvOFF_Req_DVR: boolean
  Longctrl_VehHldReq_DVR: boolean
  Longctrl_EngTrqReq_DVR: single
  Longctrl_Decel_ReqValue_DVR: single
  Longctrl_HCUTrqReqActive_DVR: boolean
  Longctrl_ParkShiftReq_DVR: uint8
  Longctrl_DecelToStopReq_DVR: boolean
  RollingCounter_ACC3: uint8
  ALC_InterSysInfoDisp: uint8
  Checksum_ACC4: uint8
  ACC_InterSysInfoDisp: uint8
  ACC_TakeOverReq: boolean
  ACC_ObjDetecte: boolean
  ACC_FctSts: uint8
  ACC_ModDisp: uint8
  TJA_ACC_SelSts: uint8
  Longctrl_HazActv: uint8
  ACC_TgtObjBarDisp: uint8
  TJA_ICA_InterSysInfoDisp: uint8
  CruCha_ModDisp: uint8
  ACC_TimeGapSet: uint8
  ISL_InterSysInfoDisp: uint8
  TJA_ICA_ModDisp: uint8
  ACC_SpdSetValue: uint8
  RollingCounter_ACC4: uint8
  CruChar_InterSysInfoDisp: uint8
  Checksum_ACC8: uint8
  HWA_InterSysInfoDisp: uint8
  HWA_ModDisp: uint8
  ADAS_DriverInloop_Monitor: uint8
  HWA_LaneChange: uint8
  HWA_warning: uint8
  HWA_LaneChangeReq: uint8
  Longctrl_HCUTrqReq_DVR: single
  RollingCounter_ACC8: uint8
  Checksum_ACC6: uint8
  ACC_PotentialTgtDy: single
  ACC_RlvTgtTyp: uint8
  ACC_EgoStatus: uint8
  ACC_RlvTgtDetn: uint8
  ACC_PotentialTgtDx: single
  ACC_RlvTgtDy: single
  ACC_PotentialTgtTyp: uint8
  ACC_PotentialTgtDetn: uint8
  ACC_RlvTgtDx: single
  RollingCounter_ACC6: uint8
  IntelligentCurveAct: boolean
  Checksum_ACC7: uint8
  ACC_LeTgtDy: single
  ACC_RiTargrtDetn: uint8
  ACC_LeTargrtDection: uint8
  ACC_LeTgtTyp: uint8
  ACC_LeTgtDx: single
  ACC_RiTgtDy: single
  ACC_RiTgtTyp: uint8
  ACC_RiTgtDx: single
  RollingCounter_ACC7: uint8
  Request_driveoff: uint8
  ACC_LeTgtfusion: boolean
  ACC_RlvTgtHeading: single
  ACC_RlvTgtfusion: boolean
  ACC_PotentialTgtfusion: boolean
  ACC_RiTgtfusion: boolean
  ACC_LeTgtHeading: single
  ACC_RiTgtHeading: single
  ACC_PotentialTgtHeading: single
  TargetCutoutPro: single
  TargetCutinPro: single
  FreshnessValue_ACC_FD2: uint16

ACC_FD3_MSG_BUS = Simulink.Bus(HeaderFile="Rte_Type.h")
  AEB_LePedDy: single
  AEB_RiPedDy: single
  AEB_LeCyclistDy: single
  AEB_RiCyclistDy: single
  AEB_LePedDetn: uint8
  JAPedObjExist: single
  AEB_RiPedDetn: uint8
  AEB_RiPedTyp: uint8
  AEB_LePedTyp: uint8
  AEB_RiCyclist_collisionprob: boolean
  AEB_LeCyclist_collisionprob: boolean
  AEB_RiPed_collisionprob: boolean
  AEB_LePed_collisionprob: boolean
  AEBJAObjID: uint8
  JAPedObjVideoCfmd: boolean
  AEBJAObjVideoCfmd: boolean
  AEBJAObjExist: single
  AEBJAObjVx: single
  AEBJAObjDx: single
  JAPedObjID: uint8
  AEBJAObjState: uint8
  AEBJAObjCntAlive: uint16
  AEBJAObjDy: single
  AEBJAObjObstcl: single
  AEBJAObjVy: single
  AEBJAObjAx: single
  JAPedObjState: uint8
  JAPedObjObstcl: single
  AEBJAObjAy: single
  JAPedObjDy: single
  JAPedObjDx: single
  FCWAEB_JATTC: single
  JAPedObjVx: single
  JAPedObjCntAlive: uint16
  JAPedObjVy: single
  JAPedObjAy: single
  AEB_LePedHeading: single
  JAPedObjAx: single
  AEB_RiPedHeading: single
  AEB_LeCyclistHeading: single
  FCWAEB_longTTC: single
  AEB_RiCyclistHeading: single
  FCWAEB_crossingTTC: single
  AEB_LePedDx: single
  AEB_LeCyclistTyp: uint8
  AEB_LeCyclistDetn: uint8
  AEB_RiPedDx: single
  AEB_RiCyclistDetn: uint8
  AEB_LeCyclistDx: single
  AEB_RiCyclistTyp: uint8
  AEB_RiCyclistDx: single

ACC_FD4_MSG_BUS = Simulink.Bus(HeaderFile="Rte_Type.h")
  AEBObjID: uint8
  AEBObjVideoCfmd: boolean
  AEBObjExist: single
  AEBObjVx: single
  AEBObjDx: single
  AEBObjCntAlive: uint16
  AEBObjDy: single
  AEBObjObstcl: single
  AEBObjState: uint8
  CyclistObjExist: single
  AEBObjVy: single
  AEBObjAx: single
  AEBObjAy: single
  CyclistObjDx: single
  CyclistObjID: uint8
  CyclistObjObstcl: single
  CyclistObjDy: single
  CyclistObjVx: single
  CyclistObjCntAlive: uint16
  CyclistObjVideoCfmd: boolean
  CyclistObjState: uint8
  CyclistObjVy: single
  CyclistObjAx: single
  PedObjExist: single
  CyclistObjAy: single
  PedObjID: uint8
  PedObjObstcl: single
  PedObjDy: single
  PedObjDx: single
  PedObjVx: single
  PedObjVideoCfmd: boolean
  PedObjVy: single
  ACCTgtObjDx: single
  PedObjAy: single
  PedObjCntAlive: uint16
  PedObjAx: single
  ACCTgtObjID: uint8
  ACCTgtObjObstcl: single
  ACCTgtObjDy: single
  ACCTgtObjExist: single
  ACCTgtObjVy: single
  ACCTgtObjVx: single
  ACCTgtObjAx: single
  ACCTgtObjAy: single
  ACCTgtObjVideoCfmd: boolean
  ACCTgtObjState: uint8
  ACCTgtObjCntAlive: uint32
  DrvgOnHiWay: uint8
  HandsoffDetd: uint8
  RadarHorMisalign: single
  SpdLimitDst: uint16
  RoadCrvt: single
  RampDst: uint16
  RoadCrvtFar: single
  SpdLimit: uint8
  NavSpdLimUnit: uint8
  CurveDst: uint16
  DrvgOnRiLane: uint8
  TunnelDst: uint16
  RadarDrvrAttentive: boolean
  BrdgDst: uint16
  PedObjState: uint8
  ACC_SOSReq: uint8
  ACC_DataRecReq: uint8
  DrvrSts: uint8
  MapDataValid: boolean
  AEBObjDrvby: uint8
  AEBObjOverlap: uint8

ACC_FD5_MSG_BUS = Simulink.Bus(HeaderFile="Rte_Type.h")
  Sync_Type: uint8
  Sync_CRC: uint8
  Sync_Counter: uint8
  Sync_TimeDomain: uint8
  Sync_OVS: uint8
  Sync_SGW: boolean
  Sync_Resd: uint8
  Sync_SyncTime: uint32

AEB_FD1_MSG_BUS = Simulink.Bus(HeaderFile="Rte_Type.h")
  Checksum_AEB1: uint8
  AEB_ABP_Req: boolean
  AEB_AWB_Req: boolean
  AEB_TgtDecel_Req: boolean
  AEB_VehHldReq: boolean
  EBA_TgtDecel_Req: boolean
  AEB_ABA_Req: boolean
  AEB_ABA_Level: uint8
  AEB_TgtDecel_ReqValue: single
  AEB_BrkReqFunc: uint8
  AEB_AWB_Level: uint8
  AEB_ObjSty: uint8
  RollingCounter_AEB1: uint8

AEB_FD2_MSG_BUS = Simulink.Bus(HeaderFile="Rte_Type.h")
  Checksum_AEB2: uint8
  AEB_JA_Resp: boolean
  FCW_Snvty: uint8
  AEB_VehResp: boolean
  AEB_PedResp: boolean
  RollingCounter_AEB2: uint8
  Checksum_AEB3: uint8
  FCW_AEB_VehFctSts: uint8
  AEB_PedTrig: boolean
  AEB_VehTrig: boolean
  AEB_JA_Warn: uint8
  AEB_JAFuncSts: uint8
  FCW_Warn: uint8
  FCW_AEB_PedFctSts: uint8
  AEB_JABrkTrig: uint8
  RollingCounter_AEB3: uint8
  FreshnessValue_AEB_FD2: uint16

BCM1_MSG_BUS = Simulink.Bus(HeaderFile="Rte_Type.h")
  BrkPedalSts_BCM: boolean
  WindshldWiprActvSts: boolean
  RRDoorSts: boolean
  PassengerDoorSts: boolean
  LRDoorSts: boolean
  DrvDoorSts: boolean
  TrunkSts: boolean
  BrkPedalFailSts: boolean
  ReversGearSts: uint8
  ParkBrkSts: uint8
  PosnLightReq: boolean
  RLSFailSts: boolean
  FreshnessValue_BCM1: uint16
  MAC_Check_BCM1: uint64

BCM3_MSG_BUS = Simulink.Bus(HeaderFile="Rte_Type.h")
  HazardLmpSwtSts: boolean
  BCM_HWPWorkSts: uint8
  FreshnessValue_BCM3: uint16
  MAC_Check_BCM3: uint64

BCM8_MSG_BUS = Simulink.Bus(HeaderFile="Rte_Type.h")
  Checksum_BCM8: uint8
  PASWorkCmd: boolean
  RViewMirrorSts: boolean
  WiprReq_F_PBOX: uint8
  Rollingcounter_BCM8: uint8
  KL30BRelaySts: boolean

BCM10_MSG_BUS = Simulink.Bus(HeaderFile="Rte_Type.h")
  Checksum_BCM10: uint8
  LTurnLampWorkCmd: boolean
  RTurnLmpWorkCmd: boolean
  LowBeamWorkCmd: boolean
  HiBeamWorkCmd: boolean
  LFFogLmpWorkCmd: boolean
  RFFogLmpWorkCmd: boolean
  LDayRunngLmpWorkCmd: boolean
  RDayRunngLmpWorkCmd: boolean
  HornWorkCmd: boolean
  FFogLmpAsstSts: boolean
  RFogLmpWorkCmd: boolean
  BrkLmpWorkCmd: boolean
  ReversLampWorkCmd: boolean
  LicPlateLmpWorkCmd: boolean
  ChildLockProtWorkCmd: uint8
  AsstPosnLmpSts: boolean
  TrunkLmpWorkCmd: boolean
  LHorseRaceLmpWorkCmd: boolean
  RHorseRaceLmpWorkCmd: boolean
  RCornrLmpWorkCmd: boolean
  LCornrLmpWorkCmd: boolean
  LasHdLmpWorkCmd: boolean
  Rollingcounter_BCM10: uint8
  FreshnessValue_BCM10: uint16
  MAC_Check_BCM10: uint64

BLE1_MSG_BUS = Simulink.Bus(HeaderFile="Rte_Type.h")
  Checksum_BLE1: uint8
  BLESecuritySts: uint8
  BLEConnSts: uint8
  PrkOutModSel_Rmt: uint8
  ParkAbortReq_Rmt: boolean
  PrkOutVehStrtReq_Rmt: boolean
  PrkgslidReq_Rmt: boolean
  PrkOutTypeReq_Rmt: uint8
  PrkOutVehStrtReq_Rmt_Valid: boolean
  PrkgSyncStrtReq_Rmt: boolean
  RollingCounter_BLE1: uint8

CR_FD1_MSG_BUS = Simulink.Bus(HeaderFile="Rte_Type.h")
  Checksum_CR_R_1: uint8
  FCTA_Warn: boolean
  FCTA_B_FuncSts: uint8
  CR_FCTB_Resp: boolean
  CR_FCTA_Resp: boolean
  FCTB_ABA_Req: boolean
  FCTB_ABA_Level: uint8
  FCTBTrig: boolean
  CR_BrkgReq: boolean
  CR_BliSts: boolean
  CR_ErrSts: boolean
  CR_BrkgReqVal: single
  FCTA_B_TTC: single
  FCTB_ABP_Req: boolean
  RollingCounter_CR_R_1: uint8
  Checksum_CR_R_2: uint8
  CR_ObjDistY_Le: single
  CR_ObjID_Le: uint8
  CR_ObjDistX_Le: single
  CR_ObjRelVelX_Le: single
  CR_ObjSts_Le: uint8
  CR_ObjRelAccelX_Le: single
  RollingCounter_CR_R_2: uint8
  CR_ObjMotionType_Le: uint8
  Checksum_CR_R_3: uint8
  CR_ObjDistY_Ri: single
  CR_ObjID_Ri: uint8
  CR_ObjDistX_Ri: single
  CR_ObjRelVelX_Ri: single
  CR_ObjSts_Ri: uint8
  CR_ObjRelAccelX_Ri: single
  RollingCounter_CR_R_3: uint8
  CR_ObjMotionType_Ri: uint8
  Checksum_CR_R_4: uint8
  CR_ObjRelAccelY_Ri: single
  CR_ObjRelAccelY_Le: single
  CR_ObjRelVelY_Ri: single
  CR_ObjRelVelY_Le: single
  RollingCounter_CR_R_4: uint8
  CR_ObjDistXStd_Le: single
  CR_ObjRelVelXStd_Le: single
  CR_ObjDistYStd_Le: single
  CR_ObjRelVelYStd_Le: single
  CR_ObjRAccelYStd_Le: single
  CR_ObjRAccelXStd_Le: single
  CR_ObjDistYStd_Ri: single
  CR_ObjDistXStd_Ri: single
  CR_ObjRelVelXStd_Ri: single
  CR_ObjRelVelYStd_Ri: single
  CR_ObjRAccelYStd_Ri: single
  CR_ObjRAccelXStd_Ri: single

CR_L_PHY_REQ_MSG_BUS = Simulink.Bus(HeaderFile="Rte_Type.h")
  CR_L_Phy_Req: uint64

CR_L_PHY_RESP_MSG_BUS = Simulink.Bus(HeaderFile="Rte_Type.h")
  CR_L_Phy_Resp: uint64

CR_R_PHY_REQ_MSG_BUS = Simulink.Bus(HeaderFile="Rte_Type.h")
  CR_R_Phy_Req: uint64

CR_R_PHY_RESP_MSG_BUS = Simulink.Bus(HeaderFile="Rte_Type.h")
  CR_R_Phy_Resp: uint64

CSA1_MSG_BUS = Simulink.Bus(HeaderFile="Rte_Type.h")
  FrntWiprSwtSts: uint8
  FrntWshrSwtSts: uint8
  LTurnLmpSwtSts: boolean
  RTurnLmpSwtSts: boolean
  FrntFogLmpSwtSts: boolean
  LowBeamSwtSts: boolean
  HiBeamSwtSts: boolean
  OverVehBeamSwtSts: boolean
  AutoHiLowBeamSwtSts: boolean
  AutoLmpSwtSts: boolean

CSA2_MSG_BUS = Simulink.Bus(HeaderFile="Rte_Type.h")
  Checksum_CSA2: uint8
  SteerWheelAngSign: boolean
  SteerWheelAng: single
  SteerWheelSpdSign: boolean
  SteerWheelSpd: single
  ACC_TimeGap_DecSetSwt: boolean
  ACC_TimeGap_IncSetSwt: boolean
  CC_ACC_CANCEL_OFFSwt: boolean
  CC_ACC_CRUISE_OFFSwt: boolean
  CC_ACCSwtErr: boolean
  CC_ACC_DecSetSpd_SetSwt: boolean
  CC_ACC_IncSetSpd_ResuSwt: boolean
  SAS_Sts: uint8
  Rollingcounter_CSA2: uint8
  HWA_OK_OFFSwt: boolean
  ManualShiftReq: uint8

CSA4_MSG_BUS = Simulink.Bus(HeaderFile="Rte_Type.h")
  CheckSum_CSA4: uint8
  HOD_ErrInfo: uint8
  HOD_HandOffSts: uint8
  RollingCounter_CSA4: uint8

DCT_FD1_MSG_BUS = Simulink.Bus(HeaderFile="Rte_Type.h")
  TCUResponseHWP: boolean
  TmLimpHomeValid: boolean
  RatAct: single
  FreshnessValue_DCT_FD1: uint16
  MAC_Check_DCT_FD1: uint64

DCT_FD4_MSG_BUS = Simulink.Bus(HeaderFile="Rte_Type.h")
  DrvFaiMsg: uint8
  FreshnessValue_DCT_FD4: uint16
  MAC_Check_DCT_FD4: uint64

DCT5_MSG_BUS = Simulink.Bus(HeaderFile="Rte_Type.h")
  CheckSum_DCT5: uint8
  TargetGearValid: boolean
  SHIFT_IN_PROGRESS: boolean
  CurrentGearValid: boolean
  TARGET_GEAR: uint8
  TCU_APS_Available: boolean
  ShiftInPrgValid: boolean
  TGS_LEVER: uint8
  CURRENT_GEAR: uint8
  RollingCounter_DCT5: uint8

DDCM1_MSG_BUS = Simulink.Bus(HeaderFile="Rte_Type.h")
  RSDS_Driver_LED_Sts: boolean
  DrvMirrFold_UnfoldSts: boolean

DIAGFUNCREQ_MSG_BUS = Simulink.Bus(HeaderFile="Rte_Type.h")
  DiagFuncReq: uint64

DMS_FD1_MSG_BUS = Simulink.Bus(HeaderFile="Rte_Type.h")
  DistrctnLvlQlty_ACC: uint8
  DrowsnsLvlQlty_ACC: uint8
  DrowsnsLvl_ACC: uint8
  DistrctnLvl_ACC: uint8
  HeadPosnX: int16
  HeadPosnY: int16
  HeadPosQlty: uint8
  HeadPosnZ: int16
  GazePosnX: int16
  GazePosnY: int16
  GazePosnZ: int16
  HeadYawAng: int8
  HeadPitchAng: int8
  HeadRollAng: int8
  HeadDetn: boolean
  HeadRotAngQlty: uint8
  DMSSts: uint8
  RobustGazeYawAng: int8
  RobustGazePitchAng: int8
  LEyeOpenStsQlty: uint8
  REyeOpenStsQlty: uint8
  RobustGazeAngQlty: uint8
  REyeOpenSts: uint8
  LEyeOpenSts: uint8

DVR_FD1_MSG_BUS = Simulink.Bus(HeaderFile="Rte_Type.h")
  DVR_360VideoCaptureReq: boolean

ECM_FD1_MSG_BUS = Simulink.Bus(HeaderFile="Rte_Type.h")
  Checksum_ECM4: uint8
  NetEngTrq: single
  DrvEngTrqReq: single
  RollingCounter_ECM4: uint8
  DrvEngTrqReqVld: boolean
  HCU_Start_StopSts: uint8
  HCU_PowertrainSts_P0: uint8
  EngTrqMinAct: single
  EngTrqMaxActSpd: single
  TrqLoss: single
  TrqLossVldty: boolean
  Checksum_ECM1: uint8
  BrkPedalSts: uint8
  Start_StopSts: uint8
  EngSpd: single
  RollingCounter_ECM1: uint8
  EngSpdVldty: uint8
  FreshnessValue_ECM_FD1: uint16
  MAC_Check_ECM_FD1: uint64

ECM_FD2_MSG_BUS = Simulink.Bus(HeaderFile="Rte_Type.h")
  Checksum_ECM9: uint8
  ECM_interfaceAPS: boolean
  AccPedalOverride: boolean
  AccelPedlPosnDiagc: single
  ECMACCInterface: boolean
  ECMRespACC: boolean
  RollingCounter_ECM9: uint8
  Checksum_ECM10: uint8
  AccPedalOverride_HWP: boolean
  EngFail: uint8
  ECMHWPinterface: boolean
  RollingCounter_ECM10: uint8
  Checksum_ECM2: uint8
  AccelPedalPosn: single
  AccelPedalPosnVldty: uint8
  RollingCounter_ECM2: uint8
  EngState: uint8
  EngState_PHEV: uint8
  FreshnessValue_ECM_FD2: uint16
  MAC_Check_ECM_FD2: uint64

ECM_FD3_MSG_BUS = Simulink.Bus(HeaderFile="Rte_Type.h")
  MaxEngTrqNorm: uint16
  EngLimpHomeSts: boolean

ECM1_MSG_BUS = Simulink.Bus(HeaderFile="Rte_Type.h")
  EngSpd: single
  EngSpdVldty: uint8

EEM1_MSG_BUS = Simulink.Bus(HeaderFile="Rte_Type.h")
  Stat_PwrSv_Lvl: uint8
  TranPMode_Sts: boolean

EPS_FD1_MSG_BUS = Simulink.Bus(HeaderFile="Rte_Type.h")
  CheckSum_EPS1: uint8
  EPS_FailSts: uint8
  EPS_TrqSnsrSts: boolean
  EPS_AvailSts: uint8
  EPS_InterferDetdVld: boolean
  EPS_InterferDetd: boolean
  EPS_SteerMod: uint8
  RollingCounter_EPS1: uint8
  CheckSum_EPS2: uint8
  EPS_DrvInpTrqVal_HighReslolution: single
  EPS_LKATorqOvrlDlvd: single
  RollingCounter_EPS2: uint8
  EPS_LKATrqOvlDlvdSts: uint8
  EPS_LKATorqOvrlDlvdVld: boolean
  CheckSum_EPS3: uint8
  EPS_HWPHndShkResp: boolean
  ElecPwrSteerCpby: uint8
  EPS_SteerWheelAngSign: boolean
  EPS_SteerWheelAng: single
  EPS_SteerWheelSpdSign: boolean
  EPS_SteerWheelSpd: single
  RollingCounter_EPS3: uint8
  FreshnessValue_EPS_FD1: uint16
  MAC_Check_EPS_FD1: uint64

ESP_FD2_MSG_BUS = Simulink.Bus(HeaderFile="Rte_Type.h")
  CheckSum_ESP_FD2_1: uint8
  RollingCounter_ESP_FD2_1: uint8
  L12mainVMCavailiable: boolean
  L12VLCADactive: boolean
  CheckSum_ESP2: uint8
  CTABrkAvailable: boolean
  BrkDskOvrheatd: boolean
  NoBrkForce: boolean
  VehStandstill: uint8
  AEBIBActv: boolean
  AEBBAActv: boolean
  AEBAvailable: boolean
  ABPAvailable: boolean
  ABPActv: boolean
  ABAavailable: boolean
  ABAactv: boolean
  HDCCtrl: uint8
  CDDActv: boolean
  CDDAvailable: boolean
  AWBAvailable: boolean
  AWBActv: boolean
  AVHErrSts: uint8
  AVHSts: uint8
  DrivingModReq_ESP: uint8
  DrivingModDis: uint8
  RollingCounter_ESP2: uint8
  CheckSum_ESP1: uint8
  PTCActv_RA: boolean
  BTCActv_RA: boolean
  ESPFuncOffSts: boolean
  ESPBrkLmpCtrl: boolean
  ESPFailSts: boolean
  ESP_MasterCylBrkPressVld: boolean
  VDCActv: boolean
  MSRActv: boolean
  PTCActv: boolean
  BTCActv: boolean
  ESP_MasterCylBrkPress: single
  MSRActv_RA: boolean
  RollingCounter_ESP1: uint8
  CheckSum_ESP7: uint8
  ESP_MEBBrkAvail: boolean
  FourWhlsBrkTrq: uint16
  LgtCtrlrFailr: uint8
  LgtCtrlrSts: uint8
  EngTrqReq: single
  APS_EngTrqReqEna: boolean
  RollingCounter_ESP7: uint8
  LgtCtrlrAvail: uint8
  CheckSum_ABS3: uint8
  VehSpdVld: boolean
  EBDFailSts: boolean
  ABSFailSts: boolean
  VehSpd: single
  ABSActv: boolean
  EBDActv: boolean
  RollingCounter_ABS3: uint8
  FreshnessValue_ESP_FD2: uint16
  MAC_Check_ESP_FD2: uint64

ESP_FD3_MSG_BUS = Simulink.Bus(HeaderFile="Rte_Type.h")
  CheckSum_ABS1: uint8
  FLWheelSpdVld: boolean
  FLWheelDriveDirection: uint8
  FLWheelSpd: single
  FRWheelSpdVld: boolean
  FRWheelDriveDirection: uint8
  FRWheelSpd: single
  WssFLEdgesSum: uint8
  WssFREdgesSum: uint8
  RollingCounter_ABS1: uint8
  WssFREdgesSumVld: boolean
  WssFLEdgesSumVld: boolean
  CheckSum_EPB1: uint8
  EPB_SwtPosnVld: boolean
  EPBErrSts: uint8
  EPBSts: uint8
  EPB_SwtPosn: uint8
  RollingCounter_EPB1: uint8
  CheckSum_ABS2: uint8
  RLWheelSpdVld: boolean
  RLWheelDriveDirection: uint8
  RLWheelSpd: single
  RRWheelSpdVld: boolean
  RRWheelDriveDirection: uint8
  RRWheelSpd: single
  WssRREdgesSum: uint8
  WssRLEdgesSum: uint8
  RollingCounter_ABS2: uint8
  WssRREdgesSumVld: boolean
  WssRLEdgesSumVld: boolean
  CheckSum_ESP_FD3_7: uint8
  LSMSubMTReqAvailable: boolean
  LSMSubMTReqEcho: uint8
  LSMSubMTLongEcho: uint8
  LSMSubMTLevelEcho: uint8
  LSMPosLongACapbl: uint8
  LSMGearRequest: uint8
  Lsm23Avl: uint8
  Lsm12EmergencyAvl: uint8
  Lsm12ComfortAvl: uint8
  VLC_ESP_State: uint8
  VLC_ESP_FuelCutOffPrevention: boolean
  L3mainVMCavailiable: uint8
  L3VLCADactive: boolean
  ParkPawlRequest: boolean
  RollingCounter_ESP_FD3_7: uint8
  FreshnessValue_ESP_FD3: uint16
  MAC_Check_ESP_FD3: uint64

F_PBOX1_MSG_BUS = Simulink.Bus(HeaderFile="Rte_Type.h")
  FFogLmpSts_F_Pbox: boolean
  LowBeamSts_F_Pbox: boolean
  HiBeamSts_F_Pbox: boolean
  HoodSts_F_Pbox: boolean
  RHeadLmpFailSts: boolean
  LHeadLmpFailSts: boolean

FR_PHY_REQ_MSG_BUS = Simulink.Bus(HeaderFile="Rte_Type.h")
  FR_Phy_Req: uint64

FR_PHY_RESP_MSG_BUS = Simulink.Bus(HeaderFile="Rte_Type.h")
  FR_Phy_Resp: uint64

GW_NM_MSG_BUS = Simulink.Bus(HeaderFile="Rte_Type.h")
  Destination_GW_NM: uint8
  OpCode_GW_NM: uint8

GW_PHY_REQ_MSG_BUS = Simulink.Bus(HeaderFile="Rte_Type.h")
  GW_Phy_Req: uint64

GW_PHY_RESP_MSG_BUS = Simulink.Bus(HeaderFile="Rte_Type.h")
  GW_Phy_Resp: uint64

HAP_FD1_MSG_BUS = Simulink.Bus(HeaderFile="Rte_Type.h")
  Checksum_APS1: uint8
  APS_ReqCtrlEPS: boolean
  APS_ReqEPSTgtAngValid: boolean
  APS_SlotDisp: uint8
  APS_SysSoundIndcn: uint8
  APS_ReqEPSTgtAng: single
  APS_TextDisp: uint8
  APS_SwtSts: boolean
  APS_ProcBar: uint8
  TurnLightsCmd: uint8
  APS_PrkgMod: uint8
  APS_PrkgTyp: uint8
  RollingCounter_APS1: uint8
  Checksum_APS4: uint8
  APS_BrkCategory: uint8
  APS_ESP_TgtGearReq: uint8
  APS_BrkFctnMod: uint8
  APS_WorkSts: uint8
  MEB_BrkgReq: boolean
  MEBErrSts: boolean
  APS_BrkModSts: uint8
  APS_ESP_SpdLimn: single
  MEB_AVHReq: boolean
  APS_ESP_BrkDistance: uint16
  MEB_BrkgReqValue: single
  RollingCounter_APS4: uint8
  HAP_ESP_LSMSubMTReq: uint8
  HAP_ESP_DriverPresenceExternal: boolean
  HAP_ESP_LSMDistToStop: uint16
  HAP_ESP_LSMPrefill: boolean
  HAP_ESP_LSMSubMTLevel: uint8
  HAP_ESP_SafeDrvrHandoverReq: boolean
  HAP_ESP_LSMvMaxRq: single
  HAP_ESP_LSMNudgeReq: boolean
  HAP_ESP_LSMVehSecReq: boolean
  HAP_ESP_LSMComfBrakeReq: uint8
  HAP_ESP_LSMVehDirRq: uint8
  HAP_ESP_LSMSubMTLong: uint8
  P2P_PahDelSts: uint8
  HAP_PrkgModCurrSts: uint8
  APS_PASSwtReq: uint8
  P2P_Pah1Avail: boolean
  P2P_SelfDetErrCode: uint8
  HAP_SwtDispCtrlCmd: uint8
  TailVertPrkgOutVald: boolean
  HeadVertPrkgOutVald: boolean
  RParaPrkgOutVald: boolean
  LParaPrkgOutVald: boolean
  RmtPrkgReq: boolean
  P2P_Pah2Avail: boolean
  P2P_SelfDetSts: uint8
  APS_MovgDirc: uint8
  FreshnessValue_HAP_FD1: uint16
  MAC_Check_HAP_FD1: uint64

HAP_FD2_MSG_BUS = Simulink.Bus(HeaderFile="Rte_Type.h")
  SigViewIndcn: uint8
  AVM_CurrSts: uint8
  HAP_Hmi_Index: uint8
  AutoAVMSwtSet_Sts: boolean
  AutoViewChgFuncSts: boolean
  CarMdlDispSts: boolean
  MOD_AlarmSts: boolean
  MOD_WorkSts: boolean
  MdlColrSts: uint8
  RadarDispSts: uint8
  GuidOvlSts: uint8
  CurrCalResultSts: boolean
  LaneCalFltSts: uint8
  LaneCalSts: uint8
  CarMdlTrsprcySts: uint8
  OvlOpFailSts: boolean
  EolNotCmpltd: boolean
  FrntCamInpFailSts: boolean
  RearCamInpFailSts: boolean
  LeCamInpFailSts: boolean
  RiCamInpFailSts: boolean
  AVM_3DAngSts: uint16
  DVRWorkSts: uint8
  HAP_DispCmd: boolean

HAP_FD3_MSG_BUS = Simulink.Bus(HeaderFile="Rte_Type.h")
  RPAS_NearBrrdstn: uint8
  APS_ObjRiSideAr2: uint8
  APS_ObjRiSideAr1: uint8
  APS_ObjRiSideAr4: uint8
  APS_ObjRiSideAr3: uint8
  APS_ObjLeSideAr1: uint8
  APS_ObjRiSideAr5: uint8
  APS_ObjLeSideAr3: uint8
  APS_ObjLeSideAr2: uint8
  APS_ObjLeSideAr5: uint8
  APS_ObjLeSideAr4: uint8
  SDWActiveSts: boolean
  SDW_SoundIndcn: uint8
  APS_RLSideSnsrFailSts: boolean
  APS_RRSideSnsrFailSts: boolean
  APS_FLSideSnsrFailSts: boolean
  APS_FRSideSnsrFailSts: boolean
  RPAS_ObjRRCornrAr2: uint8
  RPAS_ObjRRCornrAr1: uint8
  RPAS_ObjRRMidlAr2: uint8
  RPAS_ObjRRMidlAr1: uint8
  RPAS_ObjRLMidlAr2: uint8
  RPAS_ObjRLMidlAr1: uint8
  RPAS_ObjRLCornrAr2: uint8
  RPAS_ObjRLCornrAr1: uint8
  RPAS_WorkSts: uint8
  RPAS_RRCornrSnsrFailSts: boolean
  RPAS_RRMiddlSnsrFailSts: boolean
  RPAS_RLMiddlSnsrFailSts: boolean
  RPAS_RLCornrSnsrFailSts: boolean
  MEB_EnableSts: boolean
  MEBWorkSts: uint8
  RPAS_SoundIndcn: uint8
  FPAS_ObjFLCornrAr2: uint8
  FPAS_ObjFLCornrAr1: uint8
  FPAS_ObjFLMidlAr2: uint8
  FPAS_ObjFLMidlAr1: uint8
  FPAS_ObjFRMidlAr2: uint8
  FPAS_ObjFRMidlAr1: uint8
  FPAS_ObjFRCornrAr2: uint8
  FPAS_ObjFRCornrAr1: uint8
  FPAS_AutoModSts: boolean
  FPAS_DispCmd: boolean
  FPAS_WorkSts: uint8
  FPAS_FRCornrSnsrFailSts: boolean
  FPAS_FRMiddlSnsrFailSts: boolean
  FPAS_FLMiddlSnsrFailSts: boolean
  FPAS_FLCornrSnsrFailSts: boolean
  FPAS_SoundIndcn: uint8
  FPAS_NearBrrdstn: uint8
  FADS_FuncSts: uint8
  RADS_FuncSts: uint8
  P2P_FuncSts: uint8
  APA_FuncSts: uint8
  OrvmCtrlCmd: uint8
  HAP_TextIconDispCtrl: uint8
  APA_MenuDispCtrlCmd: uint8
  RmtPrkgSts: boolean
  RmtPrkgFinishReq: uint8
  APS_Coordinate_Angle: uint16
  APS_Coordinate_X: int16
  APS_Coordinate_Y: int16
  HAPob_WorkSts: uint8
  LtSlope: single
  LtCurVtur: single
  Ltlntcep: single
  LtCobfi: single
  RtSlope: single
  RtCurVtur: single
  Rtlntcep: single
  RtCobfi: single
  FreshnessValue_HAP_FD3: uint16
  MAC_Check_HAP_FD3: uint64

HAP_FD4_MSG_BUS = Simulink.Bus(HeaderFile="Rte_Type.h")
  OD_Obj1_width: single
  OD_Obj1_type: uint8
  OD_Obj1_Confidence: single
  OD_Obj1_height: single
  OD_Obj1_length: single
  OD_Obj1_Ground_Pos_X: single
  OD_Obj1_Ground_Pos_Y: single
  OD_Obj1_ID: uint8
  OD_Obj2_width: single
  OD_Obj2_type: uint8
  OD_Obj2_Confidence: single
  OD_Obj2_height: single
  OD_Obj2_length: single
  OD_Obj2_Ground_Pos_X: single
  OD_Obj2_Ground_Pos_Y: single
  OD_Obj2_ID: uint8
  OD_Obj3_width: single
  OD_Obj3_type: uint8
  OD_Obj3_Confidence: single
  OD_Obj3_height: single
  OD_Obj3_length: single
  OD_Obj3_Ground_Pos_X: single
  OD_Obj3_Ground_Pos_Y: single
  OD_Obj3_ID: uint8
  OD_Obj4_width: single
  OD_Obj4_type: uint8
  OD_Obj4_Confidence: single
  OD_Obj4_height: single
  OD_Obj4_length: single
  OD_Obj4_Ground_Pos_X: single
  OD_Obj4_Ground_Pos_Y: single
  OD_Obj4_ID: uint8
  OD_Obj5_width: single
  OD_Obj5_type: uint8
  OD_Obj5_Confidence: single
  OD_Obj5_height: single
  OD_Obj5_length: single
  OD_Obj5_Ground_Pos_X: single
  OD_Obj5_Ground_Pos_Y: single
  OD_Obj5_ID: uint8
  OD_Obj6_width: single
  OD_Obj6_type: uint8
  OD_Obj6_Confidence: single
  OD_Obj6_height: single
  OD_Obj6_length: single
  OD_Obj6_Ground_Pos_X: single
  OD_Obj6_Ground_Pos_Y: single
  OD_Obj6_ID: uint8
  OD_Obj7_width: single
  OD_Obj7_type: uint8
  OD_Obj7_Confidence: single
  OD_Obj7_height: single
  OD_Obj7_length: single
  OD_Obj7_Ground_Pos_X: single
  OD_Obj7_Ground_Pos_Y: single
  OD_Obj7_ID: uint8

HAP_FD5_MSG_BUS = Simulink.Bus(HeaderFile="Rte_Type.h")
  Freespace_1_distance: single
  Freespace_2_distance: single
  Freespace_4_distance: single
  Freespace_3_distance: single
  Freespace_5_distance: single
  Freespace_6_distance: single
  Freespace_8_distance: single
  Freespace_7_distance: single
  Freespace_9_distance: single
  Freespace_10_distance: single
  Freespace_12_distance: single
  Freespace_11_distance: single
  Freespace_13_distance: single
  Freespace_14_distance: single
  Freespace_16_distance: single
  Freespace_15_distance: single
  Freespace_17_distance: single
  Freespace_18_distance: single
  Freespace_20_distance: single
  Freespace_19_distance: single
  Freespace_21_distance: single
  Freespace_22_distance: single
  Freespace_24_distance: single
  Freespace_23_distance: single
  Freespace_25_distance: single
  Freespace_26_distance: single
  Freespace_28_distance: single
  Freespace_27_distance: single
  Freespace_29_distance: single
  Freespace_30_distance: single
  Freespace_32_distance: single
  Freespace_31_distance: single
  Freespace_33_distance: single
  Freespace_34_distance: single
  Freespace_36_distance: single
  Freespace_35_distance: single
  Freespace_37_distance: single
  Freespace_38_distance: single
  Freespace_40_distance: single
  Freespace_39_distance: single
  Freespace_41_distance: single
  Freespace_42_distance: single
  Freespace_44_distance: single
  Freespace_43_distance: single
  Freespace_45_distance: single
  Freespace_46_distance: single
  Freespace_48_distance: single
  Freespace_47_distance: single

HAP_FD6_MSG_BUS = Simulink.Bus(HeaderFile="Rte_Type.h")
  HAP_RtSide_Obj1_type: uint8
  HAP_RtSide_Obj1_ID: uint8
  HAP_RtSide_Obj1_Confidence: single
  HAP_RtSide_Obj1_Ground_Pos_X: single
  HAP_RtSide_Obj1_Ground_Pos_Y: single
  HAP_RtCam_WorkSts: uint8
  HAP_RtSide_Obj2_type: uint8
  HAP_RtSide_Obj2_ID: uint8
  HAP_RtSide_Obj2_Confidence: single
  HAP_RtSide_Obj2_Ground_Pos_X: single
  HAP_RtSide_Obj2_Ground_Pos_Y: single
  HAP_RtSide_Obj3_type: uint8
  HAP_RtSide_Obj3_ID: uint8
  HAP_RtSide_Obj3_Confidence: single
  HAP_RtSide_Obj3_Ground_Pos_X: single
  HAP_RtSide_Obj3_Ground_Pos_Y: single
  HAP_RtSide_Obj4_type: uint8
  HAP_RtSide_Obj4_ID: uint8
  HAP_RtSide_Obj4_Confidence: single
  HAP_RtSide_Obj4_Ground_Pos_X: single
  HAP_RtSide_Obj4_Ground_Pos_Y: single
  USS_RRSide2_Status: uint8
  USS_FRSide1_Status: uint8
  USS_RLSide2_Status: uint8
  USS_FLSide1_Status: uint8
  USS_FLSide1_Dist: single
  USS_RLSide2_Dist: single
  USS_FRSide1_Dist: single
  USS_RRSide2_Dist: single
  USS_FLCNear_Obj_Pos_X: single
  USS_FLCNear_Obj_Confidence: single
  USS_FLCNear_Obj_Pos_Y: single
  USS_FLMNear_Obj_Pos_X: single
  USS_FLMNear_Obj_Confidence: single
  USS_FLMNear_Obj_Pos_Y: single
  USS_FRMNear_Obj_Pos_X: single
  USS_FRMNear_Obj_Confidence: single
  USS_FRMNear_Obj_Pos_Y: single
  USS_FrontSys_Status: uint8
  USS_FRCNear_Obj_Pos_X: single
  USS_FRCNear_Obj_Confidence: single
  USS_FRCNear_Obj_Pos_Y: single

HAP_PHY_REQ_MSG_BUS = Simulink.Bus(HeaderFile="Rte_Type.h")
  HAP_Phy_Req: uint64

HAP_PHY_RESP_MSG_BUS = Simulink.Bus(HeaderFile="Rte_Type.h")
  HAP_Phy_Resp: uint64

HC_NM_MSG_BUS = Simulink.Bus(HeaderFile="Rte_Type.h")
  Destination_HC_NM: uint8
  OpCode_HC_NM: uint8

HC1_MSG_BUS = Simulink.Bus(HeaderFile="Rte_Type.h")
  CheckSum_HC1: uint8
  ALS_FailSts: boolean
  RightHighBeamFailSts: boolean
  LeftHighBeamFailSts: boolean
  RightLowBeamFailSts: boolean
  LeftLowBeamFailSts: boolean
  ADBstatus: uint8
  HighBeamSts_HC: boolean
  HBStatusSegment3: uint8
  HBStatusSegment2: uint8
  HBStatusSegment1: uint8
  HBStatusSegment0: uint8
  HBStatusSegment7: uint8
  HBStatusSegment6: uint8
  HBStatusSegment5: uint8
  HBStatusSegment4: uint8
  ALSDrvSide_FB: boolean
  RollingCounter_HC1: uint8

HCU_FD1_MSG_BUS = Simulink.Bus(HeaderFile="Rte_Type.h")
  Checksum_HCU_PT1: uint8
  HCU_AccelPedalPosn_Diag: single
  HCU_BrkPedalStsValid: boolean
  HCU_AccelPedalPosn_DiagValid: boolean
  HCU_BrkPedalSts: uint8
  ActWheelTrqDmd: int16
  RollingCounter_HCU_PT1: uint8
  Checksum_HCU_PT9: uint8
  MaxPsblWheelTrq: int16
  TotWheelTrq: int16
  HCU_ACCInterface: boolean
  MinPsblWheelTrq: int16
  RollingCounter_HCU_PT9: uint8
  HCU_PowertrainSts: uint8
  HCU_RespHWP: boolean
  HCU_HWPInterface: boolean
  ACU_ShiftInProgress: uint8
  FreshnessValue_HCU_FD1: uint16
  MAC_Check_HCU_FD1: uint64

HCU_FD3_MSG_BUS = Simulink.Bus(HeaderFile="Rte_Type.h")
  Checksum_HCU_PT5: uint8
  HCU_PTDrvMod: uint8
  HCU_DrvMod: uint8
  DrvTrqReqOvld: uint8
  RollingCounter_HCU_PT5: uint8
  HCU_GearSts: uint8
  HCU_APS_Available: boolean
  HCU_VehSpdLimit: uint16
  FreshnessValue_HCU_FD3: uint16
  MAC_Check_HCU_FD3: uint64

HCU_HP8_MSG_BUS = Simulink.Bus(HeaderFile="Rte_Type.h")
  HCU_TrqLimMax_Norm: uint16

HCU_PT4_MSG_BUS = Simulink.Bus(HeaderFile="Rte_Type.h")
  HCU_RdyLmpSts: boolean

HUT_FD1_MSG_BUS = Simulink.Bus(HeaderFile="Rte_Type.h")
  IFC_SnvtySet: uint8
  FCW_SnvtySet: uint8
  RCWSwtReq: boolean
  RCTABrkSwtReq: boolean
  RCTASwtReq: boolean
  LCASwtReq: boolean
  LDWSwtReq: boolean
  ESS_VehSwtReq: boolean
  ESS_PedSwtReq: boolean
  ELKSwtReq: boolean
  LCKSwtReq: boolean
  LKASwtReq: boolean
  AEB_VehSwtReq: boolean
  LSSWarnFormSwtReq: uint8
  TSRWarnSwtReq: boolean
  TSRSwtReq: boolean
  DOWSwtReq: boolean
  AEB_PedSwtReq: boolean
  LSSSwtReq: boolean
  IntelligentEvaSwtReq: boolean
  TSR_SnvtySet: int8
  ISLSwtReq: boolean
  ICA_HandsOffSwtReq: boolean
  NavVehToTrafEyeDist: uint16
  NavSpdLimUnit_HUT: uint8
  NavSpdLimValue: uint8
  HWA_SwtReq: boolean
  NavSpdLimSignSts: uint8
  NavCtryType: uint16
  NavTSRTrafSign: uint8
  ALC_SwtReq: boolean
  AESSwtReq: boolean
  AEB_JASwtReq: boolean
  FCTABrkSwtReq: boolean
  FCTASwtReq: boolean
  HWA_SnvtySet: uint8
  NavSpdLimType: uint8
  NavRoadType: uint8
  ADAS_Posn_MsgTye: uint8
  ADAS_Posn_Offset: uint16
  ADAS_Posn_Pathldx: uint8
  ADAS_Posn_CycCnt: uint8
  ADAS_Posn_PosProbb: single
  ADAS_Posn_Idx: uint8
  ADAS_Posn_Age: uint16
  ADAS_Posn_CurLane: uint8
  ADAS_Posn_PosConfdc: uint8
  ADAS_Posn_Spd: single
  ADAS_Posn_Rehead: single
  FreshnessValue_HUT_FD1: uint16
  MAC_Check_HUT_FD1: uint64

HUT_FD2_MSG_BUS = Simulink.Bus(HeaderFile="Rte_Type.h")
  HUT_OD_Obj0_Confidence: single
  HUT_OD_Obj0_ID: uint8
  HUT_OD_Obj0_type: uint8
  HUT_OD_Obj0_width: single
  HUT_OD_Obj0_Ground_Pos_X: single
  HUT_OD_Obj0_Ground_Pos_Y: single
  HUT_OD_Obj1_Confidence: single
  HTU_OD_Obj1_ID: uint8
  HUT_OD_Obj1_type: uint8
  HUT_OD_Obj1_width: single
  HUT_OD_Obj1_Ground_Pos_X: single
  HUT_OD_Obj1_Ground_Pos_Y: single
  HUT_OD_Obj2_Confidence: single
  HUT_OD_Obj2_ID: uint8
  HUT_OD_Obj2_type: uint8
  HUT_OD_Obj2_width: single
  HUT_OD_Obj2_Ground_Pos_X: single
  HUT_OD_Obj2_Ground_Pos_Y: single
  HUT_OD_Obj3_Confidence: single
  HUT_OD_Obj3_ID: uint8
  HUT_OD_Obj3_type: uint8
  HUT_OD_Obj3_width: single
  HUT_OD_Obj3_Ground_Pos_X: single
  HUT_OD_Obj3_Ground_Pos_Y: single
  HUT_OD_Obj4_Confidence: single
  HUT_OD_Obj4_ID: uint8
  HUT_OD_Obj4_type: uint8
  HUT_OD_Obj4_width: single
  HUT_OD_Obj4_Ground_Pos_X: single
  HUT_OD_Obj4_Ground_Pos_Y: single
  HUT_OD_Obj5_Confidence: single
  HUT_OD_Obj5_ID: uint8
  HUT_OD_Obj5_type: uint8
  HUT_OD_Obj5_width: single
  HUT_OD_Obj5_Ground_Pos_X: single
  HUT_OD_Obj5_Ground_Pos_Y: single
  HUT_OD_Obj6_Confidence: single
  HUT_OD_Obj6_ID: uint8
  HUT_OD_Obj6_type: uint8
  HUT_OD_Obj6_width: single
  HUT_OD_Obj6_Ground_Pos_X: single
  HUT_OD_Obj6_Ground_Pos_Y: single

HUT_FD3_MSG_BUS = Simulink.Bus(HeaderFile="Rte_Type.h")
  HUT_OD_Obj7_Confidence: single
  HUT_OD_Obj7_ID: uint8
  HUT_OD_Obj7_type: uint8
  HUT_OD_Obj7_width: single
  HUT_OD_Obj7_Ground_Pos_X: single
  HUT_OD_Obj7_Ground_Pos_Y: single
  HUT_OD_Obj_Timestamp: uint16
  HUT_FSD1_distance: single
  HUT_FSD2_distance: single
  HUT_FSD4_distance: single
  HUT_FSD3_distance: single
  HUT_OD_WorkSts: uint8
  HUT_FSD5_distance: single
  HUT_FSD6_distance: single
  HUT_FSD7_distance: single
  HUT_FSD9_distance: single
  HUT_FSD8_distance: single
  HUT_FSD10_distance: single
  HUT_FSD11_distance: single
  HUT_FSD13_distance: single
  HUT_FSD12_distance: single
  HUT_FSD14_distance: single
  HUT_FSD15_distance: single
  HUT_FSD17_distance: single
  HUT_FSD16_distance: single
  HUT_FSD18_distance: single

HUT6_MSG_BUS = Simulink.Bus(HeaderFile="Rte_Type.h")
  Guid_Ovl_Display_Cmd: boolean
  Sgl_View_Sel: uint8
  Radar_DispCmd: boolean
  LaneCalActvtCmd: boolean
  CarMdlTrsprcySwtCmd: boolean
  MdlColrChgCmd: boolean
  AutoViewChgCmd: boolean
  WshSoftSwt: boolean
  AutoAVMSwSet_Cmd: boolean
  SwToFieldCalRstCmd: boolean
  View_SoftswitchCmd: boolean
  FPAS_AutoModSwt: boolean
  MEBSwtSet: boolean
  MODChgReq: boolean
  CarMdlDispCmd: boolean

HUT15_MSG_BUS = Simulink.Bus(HeaderFile="Rte_Type.h")
  APSPrkgTypSeln: uint8
  SDWSwtSet: boolean
  APSSwtReq_VR: uint8

HUT19_MSG_BUS = Simulink.Bus(HeaderFile="Rte_Type.h")
  ADAS_Meta_MapProvider: uint8
  ADAS_Meta_MsgTyp: uint8
  ADAS_Meta_CountryCode: uint16
  ADAS_Meta_ProtVer_MinorSub: uint8
  ADAS_Meta_ProtVer_Major: uint8
  ADAS_Meta_CycCnt: uint8
  ADAS_Meta_HwVer: uint16
  ADAS_Meta_DrvSide: boolean
  ADAS_Meta_RegionCode: uint16
  ADAS_Meta_MapVerYear: uint8
  ADAS_Meta_MapVerQtr: uint8
  ADAS_Meta_ProtVer_Minor: uint8
  ADAS_Meta_SpdUnits: boolean

HUT20_MSG_BUS = Simulink.Bus(HeaderFile="Rte_Type.h")
  ADAS_ProfLong_MsgTyp: uint8
  ADAS_ProfLong_Offset: uint16
  ADAS_ProfLong_PathIdx: uint8
  ADAS_ProfLong_CycCnt: uint8
  ADAS_ProfLong_Update: boolean
  ADAS_ProfLong_Retr: boolean
  ADAS_ProfLong_CtrlPoint: boolean
  ADAS_ProfLong_ProfTyp: uint8
  ADAS_ProfLong_Value: uint32

HUT21_MSG_BUS = Simulink.Bus(HeaderFile="Rte_Type.h")
  ADAS_ProfShort_MsgTyp: uint8
  ADAS_ProfShort_Offset: uint16
  ADAS_ProfShort_PathIdx: uint8
  ADAS_ProfShort_CycCnt: uint8
  ADAS_ProfShort_Update: boolean
  ADAS_ProfShort_Retr: boolean
  ADAS_ProfShort_CtrlPoint: boolean
  ADAS_ProfShort_ProfTyp: uint8
  ADAS_ProfShort_AccurClass: uint8
  ADAS_ProfShort_Dist1: uint16
  ADAS_ProfShort_Value0: uint16
  ADAS_ProfShort_Value1: uint16

HUT22_MSG_BUS = Simulink.Bus(HeaderFile="Rte_Type.h")
  ADAS_Seg_MsgTyp: uint8
  ADAS_Seg_Offset: uint16
  ADAS_Seg_PathIdx: uint8
  ADAS_Seg_CycCnt: uint8
  ADAS_Seg_Update: boolean
  ADAS_Seg_Retr: boolean
  ADAS_Seg_BuildUpArea: uint8
  ADAS_Seg_Brdg: uint8
  ADAS_Seg_Tunnel: uint8
  ADAS_Seg_FuncRoadClass: uint8
  ADAS_Seg_RelProbb: single
  ADAS_Seg_FormOfWay: uint8
  ADAS_Seg_CmplxInsct: uint8
  ADAS_Seg_PartOfCalcRoute: uint8
  ADAS_Seg_EffSpdLmtTyp: uint8
  ADAS_Seg_EffSpdLmt: uint8
  ADAS_Seg_NumOfLaneDrvDir: uint8
  ADAS_Seg_NumOfLaneOppDir: uint8
  ADAS_Seg_DivideRoad: uint8

HUT23_MSG_BUS = Simulink.Bus(HeaderFile="Rte_Type.h")
  ADAS_Stub_MsgTyp: uint8
  ADAS_Stub_Offset: uint16
  ADAS_Stub_PathIdx: uint8
  ADAS_Stub_CycCnt: uint8
  ADAS_Stub_Update: boolean
  ADAS_Stub_Retr: boolean
  ADAS_Stub_StubPathIdx: uint8
  ADAS_Stub_FuncRoadClass: uint8
  ADAS_Stub_RelProbb: single
  ADAS_Stub_FormOfWay: uint8
  ADAS_Stub_CmplxInsct: uint8
  ADAS_Stub_PartOfCalcRoute: uint8
  ADAS_Stub_TurnAngl: single
  ADAS_Stub_NumOfLaneDrvDir: uint8
  ADAS_Stub_NumOfLaneOppDir: uint8
  ADAS_Stub_RtOfWay: uint8
  ADAS_Stub_LastStub: boolean

HUT32_MSG_BUS = Simulink.Bus(HeaderFile="Rte_Type.h")
  CheckSum_HUT32: uint8
  ContnPrkgReqValid: boolean
  DetVideoLost: boolean
  PrkgCtrlModReqValid: boolean
  PrkStraightSwtReq_HUT: boolean
  PrkgCtrlModReq: uint8
  ContnPrkgReq: uint8
  PrkStraightSuspendOrFinishReq_HUT: uint8
  XLvl: uint16
  YLvl: uint16
  PrkStraightVehStrtReq_HUT_Valid: boolean
  PrkStraightStrtReq_HUT: boolean
  ScrnOpSts: uint8
  PrkStraightContinueReq_HUT: boolean
  RollingCounter_HUT32: uint8
  PrkStraightSts_HUT: boolean
  PrkStraightModSel_HUT: uint8

HUT33_MSG_BUS = Simulink.Bus(HeaderFile="Rte_Type.h")
  PrkInDirChoice: uint8
  PathLrngFinshCmd: boolean
  PathLrngStartCmd: boolean
  ParkMdlCmd: boolean
  BackReq_APS: boolean
  SelPrkOutDirReq: uint8
  StartPrkgPath2Cmd: boolean
  DeletePath2Cmd: boolean
  StartPrkgPath1Cmd: boolean
  DeletePath1Cmd: boolean
  SelPrkgFctnCmd: uint8

HUT34_MSG_BUS = Simulink.Bus(HeaderFile="Rte_Type.h")
  Time_Hour: uint8
  TimeMod: boolean
  TimeIndcn: boolean
  Time_Minutes: uint8
  Time_Second: uint8
  Time_Year_Right: uint8
  Time_Year_Left: uint8
  Time_Month: uint8
  Time_Day: uint8

IBOOSTER_FD2_MSG_BUS = Simulink.Bus(HeaderFile="Rte_Type.h")
  IB_BrkPedalAppldVld: uint8
  IB_BrkPedalAppld: boolean
  CheckSum_EPB1: uint8
  EPBSts: uint8
  RollingCounter_EPB1: uint8
  CheckSum_ABS1: uint8
  FLWheelSpdVld: boolean
  FLWheelDriveDirection: uint8
  FLWheelSpd: single
  FRWheelSpdVld: boolean
  FRWheelDriveDirection: uint8
  FRWheelSpd: single
  WssFLEdgesSum: uint8
  WssFREdgesSum: uint8
  RollingCounter_ABS1: uint8
  WssFREdgesSumVld: boolean
  WssFLEdgesSumVld: boolean
  CheckSum_ABS3: uint8
  VehSpdVld: boolean
  EBDFailSts: boolean
  ABSFailSts: boolean
  VehSpd: single
  ABSActv: boolean
  EBDActv: boolean
  RollingCounter_ABS3: uint8
  CheckSum_IBooster_FD2_5: uint8
  L3mainVMCavailiable: uint8
  L3VLCADactive: boolean
  RollingCounter_Booster_FD2_5: uint8
  CheckSum_ABS2: uint8
  RLWheelSpdVld: boolean
  RLWheelDriveDirection: uint8
  RLWheelSpd: single
  RRWheelSpdVld: boolean
  RRWheelDriveDirection: uint8
  RRWheelSpd: single
  WssRREdgesSum: uint8
  WssRLEdgesSum: uint8
  RollingCounter_ABS2: uint8
  WssRREdgesSumVld: boolean
  WssRLEdgesSumVld: boolean

IDC_L3_FD2_MSG_BUS = Simulink.Bus(HeaderFile="Rte_Type.h")
  HWP_RFogLightReq: boolean
  HWP_FFogLightReq: boolean
  HWP_HiBeamtReq: boolean
  HWP_DippedBeamReq: boolean
  HWP_HornReq: boolean
  HWP_TurnlLightReq: uint8
  HWP_EmgyLightReq: boolean
  HWP_RWshrReq: boolean
  HWP_FWshrReq: uint8
  HWP_RWiperReq: uint8
  HWP_FWiperReq: uint8
  HWP_AC_Req: boolean
  HWP_TrkReq: uint8
  HWP_CenCtrllockReq: uint8
  HWP_BackupReq: boolean
  HWP_BrkLmpReq: boolean
  HWP_KBCM_Req: boolean
  HWP_WorkReqVld_KBCM: boolean
  HWP_TarTemp: uint8
  HWP_TarWind: uint8
  HWP_TextWarn_AC: uint8
  HWP_WorkReq_KBCM: uint8
  FreshnessValue_IDC_L3_FD2: uint16
  MAC_Check_IDC_L3_FD2: uint64

IDC_L3_FD3_MSG_BUS = Simulink.Bus(HeaderFile="Rte_Type.h")
  Checksum_IDC_L3_2: uint8
  HWP_CrsSpdSetVal: uint8
  EgoVehSpd: single
  HWP_SpdMaxLim: single
  HWP_OperStsDecision: uint8
  HWP_OperSts: uint8
  HWP_VehSpdUnit: boolean
  HWP_ChimeWarn: uint8
  HWP_TextWarn: uint8
  RollingCounter_IDC_L3_2: uint8
  HWP_HAP_Cmd: uint8
  FreshnessValue_IDC_L3_FD3: uint16
  MAC_Check_IDC_L3_FD3: uint64

IDC_L3_NM_MSG_BUS = Simulink.Bus(HeaderFile="Rte_Type.h")
  Destination_IDC_L3_NM: uint8
  OpCode_IDC_L3_NM: uint8

IFC_FD1_MSG_BUS = Simulink.Bus(HeaderFile="Rte_Type.h")
  Checksum_IFC1: uint8
  IFCTrqOvlCmdProtnValue: uint16
  IFCVibrationWarning: uint8
  IFCTrqOvlCmdReqValue: single
  RollingCounter_IFC1: uint8
  IFCFuncTrqCmdReqFlag: uint8
  Checksum_IFC2: uint8
  IFCAngCmdReqValue: single
  IFCAngCmdReqProtnValue: uint16
  RollingCounter_IFC2: uint8

IFC_FD2_MSG_BUS = Simulink.Bus(HeaderFile="Rte_Type.h")
  Checksum_IFC3: uint8
  IFCHUTInterface: boolean
  LDW_LKA_Snvty: uint8
  AESResp: boolean
  ELKResp: boolean
  LCKResp: boolean
  LKAResp: boolean
  LDWResp: boolean
  AESSts: uint8
  IntelligentEvaResp: boolean
  LSSResp: boolean
  LSSWarnFormResp: uint8
  ESS_VehResp: boolean
  ESS_PedResp: boolean
  ESSErrSts: boolean
  AESErrSts: boolean
  ESSSts: uint8
  RollingCounter_IFC3: uint8
  Checksum_IFC4: uint8
  LSSFuncSts: uint8
  LSSIntervention: uint8
  LDW_LKAWarn: uint8
  TJA_FollowSts: uint8
  LaneAvailability: uint8
  ELKMainState: uint8
  CameraBlockageSts: boolean
  IFCCalibrationSts: uint8
  IFC_Handsoffwarn: uint8
  LSSErrSts: uint8
  IntelligentEvaActSts: boolean
  ELKActSts: boolean
  RollingCounter_IFC4: uint8
  ESSintervention: uint8
  AESintervention: uint8
  Checksum_IFC5: uint8
  IFC_LeLaneTyp: uint8
  IFC_LaneCurve: single
  IFC_NextRiLaneTyp: uint8
  IFC_NextLeLaneTyp: uint8
  IFC_RiLaneTyp: uint8
  IFC_LeLane_dy: single
  IFC_RiLane_dy: single
  RollingCounter_IFC5: uint8
  Checksum_IFC6: uint8
  IFC_NextLeLane_dy: single
  IFC_NextRiLane_dy: single
  RollingCounter_IFC6: uint8

IFC_FD3_MSG_BUS = Simulink.Bus(HeaderFile="Rte_Type.h")
  Checksum_IFC7: uint8
  TSRSts: uint8
  TSRSpdLimCfdc: uint8
  TSRSpdLimUnit: uint8
  TSRResp: boolean
  TSRSpdLimSts: uint8
  TSRSpdLim: uint8
  TSRTrfcSignValCfdc: uint8
  TSR_Snvty: int8
  TSRSpdLimWarn: boolean
  TSRTrfcSignVal: uint8
  TSRWarnResp: boolean
  HMA_HibeamReq: uint8
  RollingCounter_IFC7: uint8
  HMA_Sts: uint8

IFC_FD4_MSG_BUS = Simulink.Bus(HeaderFile="Rte_Type.h")
  CheckSum1: uint8
  TrafficStyle: uint8
  RoadIllumDetd: boolean
  AmbLight: boolean
  CameraSts: uint8
  Spots1HozlPosnRiAng: single
  Spots1Typ: uint8
  Spots1Valid: boolean
  Spots1HozlPosnLeAng: single
  Spots1Distance: uint16
  Spots2HozlPosnRiAng: single
  RollingCounter1: uint8
  Spots2Valid: boolean
  Spots2Typ: uint8
  CheckSum2: uint8
  Spots2HozlPosnLeAng: single
  Spots2Distance: uint16
  Spots3HozlPosnRiAng: single
  Spots3HozlPosnLeAng: single
  Spots3Distance: uint16
  RollingCounter2: uint8
  Spots3Typ: uint8
  Spots3Valid: boolean
  CheckSum3: uint8
  Spots4HozlPosnRiAng: single
  Spots4HozlPosnLeAng: single
  Spots4Distance: uint16
  Spots5HozlPosnRiAng: single
  Spots5Distance: uint16
  RollingCounter3: uint8
  Spots4Typ: uint8
  Spots4Valid: boolean
  CheckSum4: uint8
  Spots6Valid: boolean
  Spots6Typ: uint8
  Spots5Valid: boolean
  Spots5Typ: uint8
  Spots5HozlPosnLeAng: single
  Spots6HozlPosnRiAng: single
  Spots6HozlPosnLeAng: single
  Spots6Distance: uint16
  RollingCounter4: uint8
  CheckSum5: uint8
  Spots7Valid: boolean
  Spots7Typ: uint8
  Spots7HozlPosnRiAng: single
  Spots7HozlPosnLeAng: single
  Spots7Distance: uint16
  RollingCounter5: uint8
  CheckSum6: uint8
  Spots8Typ: uint8
  Spots8Valid: boolean
  Spots8HozlPosnRiAng: single
  Spots8HozlPosnLeAng: single
  Spots8Distance: uint16
  RollingCounter6: uint8

IFC_FD5_MSG_BUS = Simulink.Bus(HeaderFile="Rte_Type.h")
  IFC_Line01_Dy: single
  IFC_Line01_Curv: single
  IFC_Line01_CurvChange: single
  IFC_Line01_Type: uint8
  IFC_Line02_Dy: single
  IFC_Line02_Curv: single
  IFC_Line02_CurvChange: single
  IFC_Line02_Type: uint8
  IFC_Line03_Dy: single
  IFC_Line03_Curv: single
  IFC_Line03_CurvChange: single
  IFC_Line03_Type: uint8
  IFC_Line04_Dy: single
  IFC_Line04_Curv: single
  IFC_Line04_CurvChange: single
  IFC_Line04_Type: uint8
  IFC_Roadedge01_Dy: single
  IFC_Roadedge01_Curv: single
  IFC_Roadedge01_CurvChange: single
  IFC_Roadedge01_Type: uint8
  IFC_Roadedge02_Dy: single
  IFC_Roadedge02_Curv: single
  IFC_Roadedge02_CurvChange: single
  IFC_Roadedge02_Type: uint8

IFC_FD6_MSG_BUS = Simulink.Bus(HeaderFile="Rte_Type.h")
  IFC_Line01_DxStart: single
  IFC_Line01_DxEnd: single
  IFC_Line01_HeadingAngle: single
  IFC_Line02_HeadingAngle: single
  IFC_Line02_DxStart: single
  IFC_Line02_DxEnd: single
  IFC_Line03_DxStart: single
  IFC_Line03_DxEnd: single
  IFC_Line03_HeadingAngle: single
  IFC_Line04_DxStart: single
  IFC_Line04_HeadingAngle: single
  IFC_Line04_DxEnd: single
  IFC_Roadedge01_DxStart: single
  IFC_Roadedge01_DxEnd: single
  IFC_Roadedge01_HeadingAngle: single
  IFC_Roadedge02_DxStart: single
  IFC_Roadedge02_DxEnd: single
  IFC_Roadedge02_HeadingAngle: single

IP2_MSG_BUS = Simulink.Bus(HeaderFile="Rte_Type.h")
  IP_VehTotDistance: single
  IP_VehTotDistanceValid: boolean
  IP_ACCErr: boolean
  IP_Err: boolean
  IP_VehSpdUnit: boolean
  FreshnessValue_IP2: uint16
  MAC_Check_IP2: uint64

PDCM1_MSG_BUS = Simulink.Bus(HeaderFile="Rte_Type.h")
  RSDS_Pass_LED_Sts: boolean
  PassMirrFold_UnfoldSts: boolean

PEPS2_MSG_BUS = Simulink.Bus(HeaderFile="Rte_Type.h")
  SysPowerModVld: boolean
  SysPowerMod: uint8

R_PBOX1_MSG_BUS = Simulink.Bus(HeaderFile="Rte_Type.h")
  PosnLmpOutpSts_R_Pbox: boolean
  RBrkLmpFailSts: boolean
  LBrkLmpFailSts: boolean
  HiPosnBrkLmpFailSts: boolean
  RFogLmpSts_R_Pbox: boolean
  RFogLmpFailSts_R_Pbox: boolean
  RTurnLmpSts_R_Pbox: boolean
  LTurnLmpSts_R_Pbox: boolean
  FreshnessValue_R_PBox1: uint16
  MAC_Check_R_PBox1: uint64

RRR_NM_MSG_BUS = Simulink.Bus(HeaderFile="Rte_Type.h")
  Destination_RRR_NM: uint8
  OpCode_RRR_NM: uint8

RSDS_FD1_MSG_BUS = Simulink.Bus(HeaderFile="Rte_Type.h")
  RSDS_ObjRelAccelY_Le: single
  Checksum_RSDS_R_2: uint8
  RSDS_BrkgReq: boolean
  RSDS_Brk_ErrSts: boolean
  RSDS_IPSoundReq: uint8
  RSDS_LEDLightReqRight: uint8
  RSDS_LEDLightReqLeft: uint8
  RSDS_BrkgReqVal: single
  DOW_warningReqleft: uint8
  DOW_warningReqRight: uint8
  BSD_LCA_warningReqleft: uint8
  BSD_LCA_warningReqRight: uint8
  RSDS_RCW_Trigger: uint8
  RSDS_RCTAResp: boolean
  RSDS_RCWResp: boolean
  RSDS_DOWResp: boolean
  RSDS_LCAResp: boolean
  RSDS_TrailerSts: boolean
  RSDS_BliSts: boolean
  RSDS_BrkgTrig: boolean
  RSDS_ErrSts: boolean
  RollingCounter_RSDS_R_2: uint8
  RCTA_warningReqLeft: boolean
  RCTA_warningReqRight: boolean
  RSDS_CTA_Actv: boolean
  RSDS_RCTABrkResp: boolean
  Checksum_RSDS_R_3: uint8
  ObjIDLe: uint8
  LeTarSts: uint8
  ObjLgtPosnCurvLe: single
  ObjLatPosnCurvLe: single
  ObjLgtSpdCurvLe: single
  ObjLatSpdCurvLe: single
  RollingCounter_RSDS_R_3: uint8
  ObjTTCLe: single
  Checksum_RSDS_R_4: uint8
  ObjStatyLe: boolean
  ObjWidthLe: single
  ObjLenLe: uint8
  ObjRinRi: uint8
  ObjStsLe: uint8
  ZoneIndLe: uint8
  ObjStsRi: uint8
  ZoneIndRi: uint8
  ObjStatyRi: boolean
  ObjWidthRi: single
  RollingCounter_RSDS_R_4: uint8
  Checksum_RSDS_R_5: uint8
  ObjIDRi: uint8
  RiTarSts: uint8
  ObjLgtPosnCurvRi: single
  ObjLatPosnCurvRi: single
  ObjLgtSpdCurvRi: single
  ObjLatSpdCurvRi: single
  RollingCounter_RSDS_R_5: uint8
  ObjTTCRi: single
  RSDS_ObjDistXStd_Le: single
  RSDS_ObjRelVelXStd_Le: single
  RSDS_ObjDistYStd_Le: single
  RSDS_ObjRelVelYStd_Le: single
  RSDS_ObjRAccelYStd_Le: single
  RSDS_ObjRAccelXStd_Le: single
  RSDS_ObjDistYStd_Ri: single
  RSDS_ObjDistXStd_Ri: single
  RSDS_ObjRelVelXStd_Ri: single
  RSDS_ObjRelVelYStd_Ri: single
  RSDS_ObjRAccelYStd_Ri: single
  RSDS_ObjRAccelXStd_Ri: single
  RSDS_ObjRelAccelX_Le: single
  RSDS_ObjRelAccelX_Ri: single
  RSDS_ObjRelAccelY_Ri: single

RSDS_FD2_MSG_BUS = Simulink.Bus(HeaderFile="Rte_Type.h")
  RCTA_B_TTC: single
  BSD_LCA_Left_TTC: single
  RCW_TTC: single
  BSD_LCA_Right_TTC: single
  RSDS_LeTgt_01_dy: single
  RSDS_LeTgt_01: boolean
  RSDS_LeTgt_02: boolean
  RSDS_LeTgt_01_dx: single
  RSDS_LeTgt_02_dx: single
  RSDS_RiTgt_01: boolean
  RSDS_LeTgt_02_dy: single
  RSDS_RiTgt_01_dx: single
  RSDS_RiTgt_02: boolean
  RSDS_RiTgt_01_dy: single
  RSDS_RiTgt_02_dx: single
  RSDS_MidTgt_01: boolean
  RSDS_RiTgt_02_dy: single
  RSDS_MidTgt_01_dx: single
  RSDS_MidTgt_02: boolean
  RSDS_MidTgt_01_dy: single
  RSDS_MidTgt_02_dx: single
  RSDS_MidTgt_02_dy: single

SRR_L_NM_MSG_BUS = Simulink.Bus(HeaderFile="Rte_Type.h")
  Destination_SRR_L_NM: uint8
  OpCode_SRR_L_NM: uint8

SRR_R_NM_MSG_BUS = Simulink.Bus(HeaderFile="Rte_Type.h")
  Destination_SRR_R_NM: uint8
  OpCode_SRR_R_NM: uint8

T_BOX_FD3_MSG_BUS = Simulink.Bus(HeaderFile="Rte_Type.h")
  T_Box_SysErrSts: uint8
  FreshnessValue_T_Box_FD3: uint16
  MAC_Check_T_Box_FD3: uint64

TPMS1_MSG_BUS = Simulink.Bus(HeaderFile="Rte_Type.h")
  TirePressSysFailrIndcn: uint8
  FRTirePressIndSts: uint8
  FLTirePressIndSts: uint8
  RRTirePressIndSts: uint8
  RLTirePressIndSts: uint8
  RRTireTempSts: uint8
  RLTireTempSts: uint8
  FRTireTempSts: uint8
  FLTireTempSts: uint8
  TPMS_AutoLoctSts: uint8
  FreshnessValue_TPMS1: uint16
  MAC_Check_TPMS1: uint64

TRAILER1_MSG_BUS = Simulink.Bus(HeaderFile="Rte_Type.h")
  TrailerSts: boolean

IDC_L3_PHY_REQ_MSG_BUS = Simulink.Bus(HeaderFile="Rte_Type.h")
  IDC_L3_Phy_Req: uint64

IDC_L3_PHY_RESP_MSG_BUS = Simulink.Bus(HeaderFile="Rte_Type.h")
  IDC_L3_Phy_Resp: uint64

RSDS_L_PHY_REQ_MSG_BUS = Simulink.Bus(HeaderFile="Rte_Type.h")
  RSDS_L_Phy_Req: uint64

RSDS_L_PHY_RESP_MSG_BUS = Simulink.Bus(HeaderFile="Rte_Type.h")
  RSDS_L_Phy_Resp: uint64

RSDS_R_PHY_RESP_MSG_BUS = Simulink.Bus(HeaderFile="Rte_Type.h")
  RSDS_R_Phy_Resp: uint64

RSDS_R_PHY_REQ_MSG_BUS = Simulink.Bus(HeaderFile="Rte_Type.h")
  RSDS_R_Phy_Req: uint64

HC_PHY_RESP_MSG_BUS = Simulink.Bus(HeaderFile="Rte_Type.h")
  HC_Phy_Resp: uint64

HC_PHY_REQ_MSG_BUS = Simulink.Bus(HeaderFile="Rte_Type.h")
  HC_Phy_Req: uint64

IDC_L2_PHY_REQ_MSG_BUS = Simulink.Bus(HeaderFile="Rte_Type.h")
  IDC_L2_Phy_Req: uint64

IDC_L2_PHY_RESP_MSG_BUS = Simulink.Bus(HeaderFile="Rte_Type.h")
  IDC_L2_Phy_Resp: uint64

IFC_PHY_REQ_MSG_BUS = Simulink.Bus(HeaderFile="Rte_Type.h")
  IFC_Phy_Req: uint64

IFC_PHY_RESP_MSG_BUS = Simulink.Bus(HeaderFile="Rte_Type.h")
  IFC_Phy_Resp: uint64

RRR_PHY_REQ_MSG_BUS = Simulink.Bus(HeaderFile="Rte_Type.h")
  RRR_Phy_Req: uint64

RRR_PHY_RESP_MSG_BUS = Simulink.Bus(HeaderFile="Rte_Type.h")
  RRR_Phy_Resp: uint64

SRR_L_PHY_REQ_MSG_BUS = Simulink.Bus(HeaderFile="Rte_Type.h")
  SRR_L_Phy_Req: uint64

SRR_L_PHY_RESP_MSG_BUS = Simulink.Bus(HeaderFile="Rte_Type.h")
  SRR_L_Phy_Resp: uint64

SRR_R_PHY_REQ_MSG_BUS = Simulink.Bus(HeaderFile="Rte_Type.h")
  SRR_R_Phy_Req: uint64

SRR_R_PHY_RESP_MSG_BUS = Simulink.Bus(HeaderFile="Rte_Type.h")
  SRR_R_Phy_Resp: uint64

CAN_FD_MESSAGE_BUS_HM = Simulink.Bus(HeaderFile="Rte_Type.h")
  ProtocolMode: uint8
  Extended: uint8
  Length: uint8
  Remote: uint8
  Error: uint8
  BRS: uint8
  ESI: uint8
  DLC: uint8
  ID: uint32
  Reserved: uint32
  Timestamp: double
  Data: uint8[64]

IDC_L3_FD1_MSG_BUS = Simulink.Bus(HeaderFile="Rte_Type.h")
  Checksum_IDC_L3_1: uint8
  HWP_AngCmdReqVal: single
  HWP_TrqOvlCmdProtnValue: uint16
  HWP_TrqOvlCmdReqValue: single
  HWP_FuncTrqCmdReqFlag: uint8
  HWP_HapcWarnReq: uint8
  HWP_AngCmdReqValVld: boolean
  HWP_ReqCtrlEPSVld: boolean
  HWP_ReqCtrlEPS: boolean
  RollingCounter_IDC_L3_1: uint8
  Checksum_IDC_L3_3: uint8
  HWP_Lgtctrl_EngTrqReq: single
  HWP_EngTrqReqActvVld: boolean
  HWP_ECMOvrdReq: boolean
  HWP_Lgtctrl_FuelCutOffReq: boolean
  HWP_Lgtctrl_EngTrqReqActv: boolean
  HWP_TgtGearReqVld: boolean
  HWP_TgtGearReq: uint8
  HWP_WorkReq: uint8
  HWP_lgt_ModSts: uint8
  HWP_Lgtctrl_EngTrqReqVld: boolean
  HWP_WorkReqVld: boolean
  RollingCounter_IDC_L3_3: uint8
  Checksum_IDC_L3_5: uint8
  HWP_lgt_Decel_ReqValue: single
  HWP_AEB_DecelCtrlReqVal: single
  HWP_EBA_DecelCtrlReq: boolean
  HWP_AEB_ABAReq: boolean
  HWP_AEB_ABALvl: uint8
  HWP_lgt_DecelToStopReq: boolean
  HWP_lgt_Decel_Req: boolean
  HWP_lgt_DrvOFF_Req: boolean
  HWP_lgt_VehHldReq: boolean
  HWP_AEB_ABP_Req: boolean
  HWP_AEB_AWB_Lvl: uint8
  HWP_AEB_AWB_Req: boolean
  HWP_AEB_DecelCtrlReq: boolean
  HWP_AEB_VehHldReq: boolean
  HWP_EPBCtrlReqVld: boolean
  HWP_EPBCtrlReq: boolean
  RollingCounter_IDC_L3_5: uint8
  Checksum_IDC_L3_4: uint8
  HWP_Lgt_HCUTrqReq: single
  HWP_HCUOvrdReq: boolean
  HWP_Lgt_HCUTrqReqActvVld: boolean
  HWP_Lgt_HCUTrqReqActv: boolean
  HWP_Lgt_HCUTrqReqVld: boolean
  RollingCounter_IDC_L3_4: uint8
  HWP_TgtAccel: single
  HWP_UpperLimit: single
  HWP_LowerLimit: single
  HWP_TgtAccelCmftUpprLimVal: single
  HWP_TgtAccelCmftLwrLimVal: single
  HWP_SuprAvail: boolean
  HWP_SecureReq: boolean
  HWP_UseTgtAccelCmftUpprLimVal: boolean
  HWP_ShutdownReq: boolean
  HWP_MotTypeReqLong: uint8
  HWP_MotTypeReqMode: uint8
  FreshnessValue_IDC_L3_FD1: uint16
  MAC_Check_IDC_L3_FD1: uint64

VCAN_BUS = Simulink.Bus(HeaderFile="Rte_Type.h")
  PBOX_NODE: Bus: PBOX_NODE_BUS
  HC_NODE: Bus: HC_NODE_BUS
  AC_NEDE: Bus: AC_NEDE_BUS
  ABM_NODE: ABM_NODE_BUS
  BCM_NODE: BCM_NODE_BUS
  CSA_NODE: CSA_NODE_BUS
  DCT_NODE: DCT_NODE_BUS
  DMS_NODE: DMS_NODE_BUS
  ECM_NODE: ECM_NODE_BUS
  ESP_NODE: ESP_NODE_BUS
  EPS_NODE: EPS_NODE_BUS
  HCU_NODE: HCU_NODE_BUS
  HUT_NODE: HUT_NODE_BUS
  IDC_L3_NODE: IDC_L3_NODE_BUS
  IP_NODE: IP_NODE_BUS
  CR_NODE: CR_NODE_BUS
  RSDS_NODE: RSDS_NODE_BUS
  IBOOSTER_NODE: IBOOSTER_NODE_BUS
  PEPS_NODE: PEPS_NODE_BUS
  HAP_NODE: HAP_NODE_BUS