% Simulink data dictionary PubIfVCanV71_V411_RTE.sldd

ABM1_MSG_BUS = Simulink.Bus(HeaderFile="Rte_Type.h")
  CheckSum_ABM1: uint8
  PassSBR: boolean
  SecRowRSBR: boolean
  DrvSBR: boolean
  SecRowMidSBR: boolean
  AirbFailLmpCmd: boolean
  SecRowLSBR: boolean
  PABSwtSts: boolean
  CrashOutputSts: uint8
  DrvSBR_Visual: uint8
  PassSBR_Visual: uint8
  SecRowLSBR_Visual: uint8
  SecRowMidSBR_Visual: uint8
  SecRowRSBR_Visual: uint8
  RollingCounter_ABM1: uint8
  FreshnessValue_ABM1: uint16
  MAC_Check_ABM1: uint64

ABM1_RAW_BUS = Simulink.Bus(HeaderFile="Rte_Type.h")
  CheckSum_ABM1: uint8  % 1|0|0|255|uint8
  PassSBR: boolean  % 1|0|0|1|boolean
  SecRowRSBR: boolean  % 1|0|0|1|boolean
  DrvSBR: boolean  % 1|0|0|1|boolean
  SecRowMidSBR: boolean  % 1|0|0|1|boolean
  AirbFailLmpCmd: boolean  % 1|0|0|1|boolean
  SecRowLSBR: boolean  % 1|0|0|1|boolean
  PABSwtSts: boolean  % 1|0|0|1|boolean
  CrashOutputSts: uint8  % 1|0|0|18|uint8
  DrvSBR_Visual: uint8  % 1|0|0|3|uint8
  PassSBR_Visual: uint8  % 1|0|0|3|uint8
  SecRowLSBR_Visual: uint8  % 1|0|0|3|uint8
  SecRowMidSBR_Visual: uint8  % 1|0|0|3|uint8
  SecRowRSBR_Visual: uint8  % 1|0|0|3|uint8
  RollingCounter_ABM1: uint8  % 1|0|0|15|uint8
  FreshnessValue_ABM1: uint16  % 1|0|0|65535|uint16
  MAC_Check_ABM1: uint64  % 1|0|0|281474976710655|uint64

ABM2_MSG_BUS = Simulink.Bus(HeaderFile="Rte_Type.h")
  CheckSum_ABM2: uint8
  VehLgtAccel: single
  VehLatAccel: single
  VehYawRate: single
  RollingCounter_ABM2: uint8
  VehDynYawRateVld: boolean
  VehLatAccelVld: boolean
  VehLgtAccelVld: boolean

ABM2_RAW_BUS = Simulink.Bus(HeaderFile="Rte_Type.h")
  CheckSum_ABM2: uint8  % 1|0|0|255|uint8
  VehLgtAccel: uint16  % 0.00098|-21.592|-21.592|21.592|single
  VehLatAccel: uint16  % 0.00098|-21.592|-21.592|21.592|single
  VehYawRate: uint16  % 0.00024|-2.093|-2.093|2.093|single
  RollingCounter_ABM2: uint8  % 1|0|0|15|uint8
  VehDynYawRateVld: boolean  % 1|0|0|1|boolean
  VehLatAccelVld: boolean  % 1|0|0|1|boolean
  VehLgtAccelVld: boolean  % 1|0|0|1|boolean

AC2_MSG_BUS = Simulink.Bus(HeaderFile="Rte_Type.h")
  ACFrntBlwrSpd: uint8
  ACAmbTemp: single

AC2_RAW_BUS = Simulink.Bus(HeaderFile="Rte_Type.h")
  ACFrntBlwrSpd: uint8  % 1|0|0|15|uint8
  ACAmbTemp: uint8  % 0.5|-40|-40|86.5|single

ACC_FD1_MSG_BUS = Simulink.Bus(HeaderFile="Rte_Type.h")
  Checksum_ACC11: uint8
  HWP_UpperLimit_L2: single
  HWP_LowerLimit_L2: single
  HWP_TgtAccelCmftUpprLimVal_L2: single
  HWP_TgtAccelCmftLwrLimVal_L2: single
  HWP_AccelOvrdActnReq_L2: boolean
  HWP_SuprAvail_L2: boolean
  HWP_ShutdownReq_L2: boolean
  HWP_MotTypeReqLong_L2: uint8
  HWP_MotTypeReqMode_L2: uint8
  RollingCounter_ACC11: uint8
  HWP_ACCAvail: boolean
  HWP_AEBAvail: boolean
  HWP_SecureReq_L2: boolean
  HWP_UseTgtAccelCmftUpprLimVal_L2: boolean
  Checksum_ACC1: uint8
  Longctrl_Decel_Req: boolean
  Longctrl_ModSts: uint8
  Longctrl_DrvOFF_Req: boolean
  Longctrl_VehHldReq: boolean
  Longctrl_EngTrqReq: single
  Longctrl_ParkShiftReq: uint8
  Longctrl_DecelToStopReq: boolean
  Longctrl_FuelCutOffPrevn: boolean
  Longctrl_EngTrqReqActive: boolean
  Longctrl_Decel_ReqValue: single
  ActualTargetSpeed: uint8
  RollingCounter_ACC1: uint8
  Checksum_ACC2: uint8
  HWP_AngCmdReqValVld_L2: boolean
  IDC_L2_HADFuncCmdReqFlag: uint8
  HWP_TgtAccel_L2: single
  HWP_AngCmdReqVal_L2: single
  RollingCounter_ACC2: uint8
  ACC_CRInterface: boolean
  Checksum_ACC10: uint8
  Longctrl_HCUTrqReq: single
  Longctrl_HCUTrqReqActive: boolean
  RollingCounter_ACC10: uint8
  FreshnessValue_ACC_FD1: uint16
  MAC_Check_ACC_FD1: uint64

ACC_FD1_RAW_BUS = Simulink.Bus(HeaderFile="Rte_Type.h")
  Checksum_ACC11: uint8  % 1|0|0|255|uint8
  HWP_UpperLimit_L2: uint8  % 0.1|0|0|12.7|single
  HWP_LowerLimit_L2: uint8  % 0.1|-12.7|-12.7|0|single
  HWP_TgtAccelCmftUpprLimVal_L2: uint8  % 0.0125|0|0|3.125|single
  HWP_TgtAccelCmftLwrLimVal_L2: uint8  % 0.0125|0|0|3.125|single
  HWP_AccelOvrdActnReq_L2: boolean  % 1|0|0|1|boolean
  HWP_SuprAvail_L2: boolean  % 1|0|0|1|boolean
  HWP_ShutdownReq_L2: boolean  % 1|0|0|1|boolean
  HWP_MotTypeReqLong_L2: uint8  % 1|0|0|4|uint8
  HWP_MotTypeReqMode_L2: uint8  % 1|0|0|3|uint8
  RollingCounter_ACC11: uint8  % 1|0|0|15|uint8
  HWP_ACCAvail: boolean  % 1|0|0|1|boolean
  HWP_AEBAvail: boolean  % 1|0|0|1|boolean
  HWP_SecureReq_L2: boolean  % 1|0|0|1|boolean
  HWP_UseTgtAccelCmftUpprLimVal_L2: boolean  % 1|0|0|1|boolean
  Checksum_ACC1: uint8  % 1|0|0|255|uint8
  Longctrl_Decel_Req: boolean  % 1|0|0|1|boolean
  Longctrl_ModSts: uint8  % 1|0|0|15|uint8
  Longctrl_DrvOFF_Req: boolean  % 1|0|0|1|boolean
  Longctrl_VehHldReq: boolean  % 1|0|0|1|boolean
  Longctrl_EngTrqReq: uint16  % 0.0030518|-100|-100|99.9997|single
  Longctrl_ParkShiftReq: uint8  % 1|0|0|3|uint8
  Longctrl_DecelToStopReq: boolean  % 1|0|0|1|boolean
  Longctrl_FuelCutOffPrevn: boolean  % 1|0|0|1|boolean
  Longctrl_EngTrqReqActive: boolean  % 1|0|0|1|boolean
  Longctrl_Decel_ReqValue: uint8  % 0.05|-7|-7|5.75|single
  ActualTargetSpeed: uint8  % 1|0|0|254|uint8
  RollingCounter_ACC1: uint8  % 1|0|0|15|uint8
  Checksum_ACC2: uint8  % 1|0|0|255|uint8
  HWP_AngCmdReqValVld_L2: boolean  % 1|0|0|1|boolean
  IDC_L2_HADFuncCmdReqFlag: uint8  % 1|0|0|7|uint8
  HWP_TgtAccel_L2: uint16  % 0.0125|-16|-16|16|single
  HWP_AngCmdReqVal_L2: uint16  % 0.1|-780|-780|780|single
  RollingCounter_ACC2: uint8  % 1|0|0|15|uint8
  ACC_CRInterface: boolean  % 1|0|0|1|boolean
  Checksum_ACC10: uint8  % 1|0|0|255|uint8
  Longctrl_HCUTrqReq: uint16  % 0.5|-16384|-16384|16383.5|single
  Longctrl_HCUTrqReqActive: boolean  % 1|0|0|1|boolean
  RollingCounter_ACC10: uint8  % 1|0|0|15|uint8
  FreshnessValue_ACC_FD1: uint16  % 1|0|0|65535|uint16
  MAC_Check_ACC_FD1: uint64  % 1|0|0|281474976710655|uint64

ACC_FD2_MSG_BUS = Simulink.Bus(HeaderFile="Rte_Type.h")
  ACC_LeTgt_02_Dy: single
  ACC_LeTgt_02_Dx: single
  ACC_RiTargrt_02_Detn: uint8
  ACC_LeTargrt_02_Detn: uint8
  ACC_LeTgt_02_Typ: uint8
  ACC_RiTgt_02_Dx: single
  ACC_RiTgtObjBarDisp: uint8
  ACC_LeTgtObjBarDisp: uint8
  ACC_RiTgt_02_Dy: single
  ACC_RiTgt_02_Typ: uint8
  Checksum_ACC3: uint8
  ALC_Resp: boolean
  HWA_SnvtySet_Resp: uint8
  HWA_Resp: boolean
  ICA_HandsOffResp: boolean
  ISL_Resp: boolean
  Longctrl_EngTrqReqActive_DVR: boolean
  Longctrl_Decel_Req_DVR: boolean
  Longctrl_ModSts_DVR: uint8
  Longctrl_DrvOFF_Req_DVR: boolean
  Longctrl_VehHldReq_DVR: boolean
  Longctrl_EngTrqReq_DVR: single
  Longctrl_Decel_ReqValue_DVR: single
  Longctrl_HCUTrqReqActive_DVR: boolean
  Longctrl_ParkShiftReq_DVR: uint8
  Longctrl_DecelToStopReq_DVR: boolean
  RollingCounter_ACC3: uint8
  ALC_InterSysInfoDisp: uint8
  Checksum_ACC4: uint8
  ACC_InterSysInfoDisp: uint8
  ACC_TakeOverReq: boolean
  ACC_ObjDetecte: boolean
  ACCReqAVM: boolean
  ACC_FctSts: uint8
  ACC_ModDisp: uint8
  TJA_ACC_SelSts: uint8
  Longctrl_HazActv: uint8
  ACC_TgtObjBarDisp: uint8
  TJA_ICA_InterSysInfoDisp: uint8
  CruCha_ModDisp: uint8
  ACC_TimeGapSet: uint8
  ISL_InterSysInfoDisp: uint8
  TJA_ICA_ModDisp: uint8
  ACC_SpdSetValue: uint8
  RollingCounter_ACC4: uint8
  CruChar_InterSysInfoDisp: uint8
  Checksum_ACC8: uint8
  HWA_InterSysInfoDisp: uint8
  HWA_ModDisp: uint8
  ADAS_DriverInloop_Monitor: uint8
  HWA_LaneChange: uint8
  HWA_warning: uint8
  HWA_LaneChangeReq: uint8
  Longctrl_HCUTrqReq_DVR: single
  RollingCounter_ACC8: uint8
  Checksum_ACC6: uint8
  ACC_PotentialTgtDy: single
  ACC_RlvTgtTyp: uint8
  ACC_EgoStatus: uint8
  ACC_RlvTgtDetn: uint8
  ACC_PotentialTgtDx: single
  ACC_RlvTgtDy: single
  ACC_PotentialTgtTyp: uint8
  ACC_PotentialTgtDetn: uint8
  ACC_RlvTgtDx: single
  RollingCounter_ACC6: uint8
  IntelligentCurveAct: boolean
  Checksum_ACC7: uint8
  ACC_LeTgtDy: single
  ACC_RiTargrtDetn: uint8
  ACC_LeTargrtDection: uint8
  ACC_LeTgtTyp: uint8
  ACC_LeTgtDx: single
  ACC_RiTgtDy: single
  ACC_RiTgtTyp: uint8
  ACC_RiTgtDx: single
  RollingCounter_ACC7: uint8
  Request_driveoff: uint8
  ACC_LeTgtfusion: boolean
  ACC_RlvTgtHeading: single
  ACC_RlvTgtfusion: boolean
  ACC_PotentialTgtfusion: boolean
  ACC_RiTgtfusion: boolean
  ACC_LeTgtHeading: single
  ACC_RiTgtHeading: single
  ACC_PotentialTgtHeading: single
  TargetCutoutPro: single
  TargetCutinPro: single
  FreshnessValue_ACC_FD2: uint16
  MAC_Check_ACC_FD2: uint64

ACC_FD2_RAW_BUS = Simulink.Bus(HeaderFile="Rte_Type.h")
  ACC_LeTgt_02_Dy: uint8  % 0.1|-8|-8|0|single
  ACC_LeTgt_02_Dx: uint16  % 0.5|0|0|150|single
  ACC_RiTargrt_02_Detn: uint8  % 1|0|0|3|uint8
  ACC_LeTargrt_02_Detn: uint8  % 1|0|0|3|uint8
  ACC_LeTgt_02_Typ: uint8  % 1|0|0|7|uint8
  ACC_RiTgt_02_Dx: uint16  % 0.5|0|0|150|single
  ACC_RiTgtObjBarDisp: uint8  % 1|0|0|7|uint8
  ACC_LeTgtObjBarDisp: uint8  % 1|0|0|7|uint8
  ACC_RiTgt_02_Dy: uint8  % 0.1|0|0|8|single
  ACC_RiTgt_02_Typ: uint8  % 1|0|0|7|uint8
  Checksum_ACC3: uint8  % 1|0|0|255|uint8
  ALC_Resp: boolean  % 1|0|0|1|boolean
  HWA_SnvtySet_Resp: uint8  % 1|0|0|3|uint8
  HWA_Resp: boolean  % 1|0|0|1|boolean
  ICA_HandsOffResp: boolean  % 1|0|0|1|boolean
  ISL_Resp: boolean  % 1|0|0|1|boolean
  Longctrl_EngTrqReqActive_DVR: boolean  % 1|0|0|1|boolean
  Longctrl_Decel_Req_DVR: boolean  % 1|0|0|1|boolean
  Longctrl_ModSts_DVR: uint8  % 1|0|0|15|uint8
  Longctrl_DrvOFF_Req_DVR: boolean  % 1|0|0|1|boolean
  Longctrl_VehHldReq_DVR: boolean  % 1|0|0|1|boolean
  Longctrl_EngTrqReq_DVR: uint16  % 0.0030518|-100|-100|99.9997|single
  Longctrl_Decel_ReqValue_DVR: uint8  % 0.05|-7|-7|5.75|single
  Longctrl_HCUTrqReqActive_DVR: boolean  % 1|0|0|1|boolean
  Longctrl_ParkShiftReq_DVR: uint8  % 1|0|0|3|uint8
  Longctrl_DecelToStopReq_DVR: boolean  % 1|0|0|1|boolean
  RollingCounter_ACC3: uint8  % 1|0|0|15|uint8
  ALC_InterSysInfoDisp: uint8  % 1|0|0|3|uint8
  Checksum_ACC4: uint8  % 1|0|0|255|uint8
  ACC_InterSysInfoDisp: uint8  % 1|0|0|31|uint8
  ACC_TakeOverReq: boolean  % 1|0|0|1|boolean
  ACC_ObjDetecte: boolean  % 1|0|0|1|boolean
  ACCReqAVM: boolean  % 1|0|0|1|boolean
  ACC_FctSts: uint8  % 1|0|0|3|uint8
  ACC_ModDisp: uint8  % 1|0|0|31|uint8
  TJA_ACC_SelSts: uint8  % 1|0|0|7|uint8
  Longctrl_HazActv: uint8  % 1|0|0|3|uint8
  ACC_TgtObjBarDisp: uint8  % 1|0|0|7|uint8
  TJA_ICA_InterSysInfoDisp: uint8  % 1|0|0|7|uint8
  CruCha_ModDisp: uint8  % 1|0|0|15|uint8
  ACC_TimeGapSet: uint8  % 1|0|0|7|uint8
  ISL_InterSysInfoDisp: uint8  % 1|0|0|3|uint8
  TJA_ICA_ModDisp: uint8  % 1|0|0|7|uint8
  ACC_SpdSetValue: uint8  % 1|0|0|255|uint8
  RollingCounter_ACC4: uint8  % 1|0|0|15|uint8
  CruChar_InterSysInfoDisp: uint8  % 1|0|0|15|uint8
  Checksum_ACC8: uint8  % 1|0|0|255|uint8
  HWA_InterSysInfoDisp: uint8  % 1|0|0|15|uint8
  HWA_ModDisp: uint8  % 1|0|0|15|uint8
  ADAS_DriverInloop_Monitor: uint8  % 1|7|7|7|uint8
  HWA_LaneChange: uint8  % 1|0|0|3|uint8
  HWA_warning: uint8  % 1|0|0|3|uint8
  HWA_LaneChangeReq: uint8  % 1|0|0|7|uint8
  Longctrl_HCUTrqReq_DVR: uint16  % 0.5|-16384|-16384|16383.5|single
  RollingCounter_ACC8: uint8  % 1|0|0|15|uint8
  Checksum_ACC6: uint8  % 1|0|0|255|uint8
  ACC_PotentialTgtDy: uint8  % 0.1|-8|-8|8|single
  ACC_RlvTgtTyp: uint8  % 1|0|0|7|uint8
  ACC_EgoStatus: uint8  % 1|0|0|3|uint8
  ACC_RlvTgtDetn: uint8  % 1|0|0|3|uint8
  ACC_PotentialTgtDx: uint16  % 0.5|0|0|150|single
  ACC_RlvTgtDy: uint8  % 0.1|-8|-8|8|single
  ACC_PotentialTgtTyp: uint8  % 1|0|0|7|uint8
  ACC_PotentialTgtDetn: uint8  % 1|0|0|3|uint8
  ACC_RlvTgtDx: uint16  % 0.5|0|0|150|single
  RollingCounter_ACC6: uint8  % 1|0|0|15|uint8
  IntelligentCurveAct: boolean  % 1|0|0|1|boolean
  Checksum_ACC7: uint8  % 1|0|0|255|uint8
  ACC_LeTgtDy: uint8  % 0.1|-8|-8|8|single
  ACC_RiTargrtDetn: uint8  % 1|0|0|3|uint8
  ACC_LeTargrtDection: uint8  % 1|0|0|3|uint8
  ACC_LeTgtTyp: uint8  % 1|0|0|7|uint8
  ACC_LeTgtDx: uint16  % 0.5|0|0|150|single
  ACC_RiTgtDy: uint8  % 0.1|-8|-8|8|single
  ACC_RiTgtTyp: uint8  % 1|0|0|7|uint8
  ACC_RiTgtDx: uint16  % 0.5|0|0|150|single
  RollingCounter_ACC7: uint8  % 1|0|0|15|uint8
  Request_driveoff: uint8  % 1|0|0|7|uint8
  ACC_LeTgtfusion: boolean  % 1|0|0|1|boolean
  ACC_RlvTgtHeading: uint8  % 0.05|-1.5|-1.5|1.5|single
  ACC_RlvTgtfusion: boolean  % 1|0|0|1|boolean
  ACC_PotentialTgtfusion: boolean  % 1|0|0|1|boolean
  ACC_RiTgtfusion: boolean  % 1|0|0|1|boolean
  ACC_LeTgtHeading: uint8  % 0.05|-1.5|-1.5|1.5|single
  ACC_RiTgtHeading: uint8  % 0.05|-1.5|-1.5|1.5|single
  ACC_PotentialTgtHeading: uint8  % 0.05|-1.5|-1.5|1.5|single
  TargetCutoutPro: uint8  % 0.02|0|0|1|single
  TargetCutinPro: uint8  % 0.02|0|0|1|single
  FreshnessValue_ACC_FD2: uint16  % 1|0|0|65535|uint16
  MAC_Check_ACC_FD2: uint64  % 1|0|0|281474976710655|uint64

ACC_FD3_MSG_BUS = Simulink.Bus(HeaderFile="Rte_Type.h")
  AEB_LePedDy: single
  AEB_RiPedDy: single
  AEB_LeCyclistDy: single
  AEB_RiCyclistDy: single
  AEB_LePedDetn: uint8
  JAPedObjExist: single
  AEB_RiPedDetn: uint8
  AEB_RiPedTyp: uint8
  AEB_LePedTyp: uint8
  AEB_RiCyclist_collisionprob: boolean
  AEB_LeCyclist_collisionprob: boolean
  AEB_RiPed_collisionprob: boolean
  AEB_LePed_collisionprob: boolean
  AEBJAObjID: uint8
  JAPedObjVideoCfmd: boolean
  AEBJAObjVideoCfmd: boolean
  AEBJAObjExist: single
  AEBJAObjVx: single
  AEBJAObjDx: single
  JAPedObjID: uint8
  AEBJAObjState: uint8
  AEBJAObjCntAlive: uint16
  AEBJAObjDy: single
  AEBJAObjObstcl: single
  AEBJAObjVy: single
  AEBJAObjAx: single
  JAPedObjState: uint8
  JAPedObjObstcl: single
  AEBJAObjAy: single
  JAPedObjDy: single
  JAPedObjDx: single
  FCWAEB_JATTC: single
  JAPedObjVx: single
  JAPedObjCntAlive: uint16
  JAPedObjVy: single
  JAPedObjAy: single
  JAPedObjAx: single
  NOH_Sts: uint8
  NOH_DistToExit: uint16
  FCWAEB_longTTC: single
  NOH_Swt_Resp: boolean
  NOH_Act_Resp: boolean
  FCWAEB_crossingTTC: single
  NOH_SysInfoDisplay: uint8
  AEB_LePedDx: single
  AEB_LeCyclistTyp: uint8
  AEB_LeCyclistDetn: uint8
  AEB_RiPedDx: single
  AEB_RiCyclistDetn: uint8
  AEB_LeCyclistDx: single
  AEB_RiCyclistTyp: uint8
  AEB_RiCyclistDx: single

ACC_FD3_RAW_BUS = Simulink.Bus(HeaderFile="Rte_Type.h")
  AEB_LePedDy: uint8  % 0.1|-8|-8|8|single
  AEB_RiPedDy: uint8  % 0.1|-8|-8|8|single
  AEB_LeCyclistDy: uint8  % 0.1|-8|-8|8|single
  AEB_RiCyclistDy: uint8  % 0.1|-8|-8|8|single
  AEB_LePedDetn: uint8  % 1|0|0|3|uint8
  JAPedObjExist: uint8  % 0.015625|0|0|0.98438|single
  AEB_RiPedDetn: uint8  % 1|0|0|3|uint8
  AEB_RiPedTyp: uint8  % 1|0|0|7|uint8
  AEB_LePedTyp: uint8  % 1|0|0|7|uint8
  AEB_RiCyclist_collisionprob: boolean  % 1|0|0|1|boolean
  AEB_LeCyclist_collisionprob: boolean  % 1|0|0|1|boolean
  AEB_RiPed_collisionprob: boolean  % 1|0|0|1|boolean
  AEB_LePed_collisionprob: boolean  % 1|0|0|1|boolean
  AEBJAObjID: uint8  % 1|0|0|255|uint8
  JAPedObjVideoCfmd: boolean  % 1|0|0|1|boolean
  AEBJAObjVideoCfmd: boolean  % 1|0|0|1|boolean
  AEBJAObjExist: uint8  % 0.015625|0|0|0.98438|single
  AEBJAObjVx: uint16  % 0.0625|-128|-128|127|single
  AEBJAObjDx: uint16  % 0.0625|0|0|255.9375|single
  JAPedObjID: uint8  % 1|0|0|255|uint8
  AEBJAObjState: uint8  % 1|0|0|7|uint8
  AEBJAObjCntAlive: uint16  % 17|0|0|65535|uint16
  AEBJAObjDy: uint16  % 0.125|-128|-128|127.875|single
  AEBJAObjObstcl: uint8  % 0.03125|0|0|0.96875|single
  AEBJAObjVy: uint16  % 0.125|-64|-64|63.875|single
  AEBJAObjAx: uint16  % 0.03125|-16|-16|15.9688|single
  JAPedObjState: uint8  % 1|0|0|7|uint8
  JAPedObjObstcl: uint8  % 0.03125|0|0|0.96875|single
  AEBJAObjAy: uint16  % 0.03125|-16|-16|15.9688|single
  JAPedObjDy: uint16  % 0.125|-128|-128|127.875|single
  JAPedObjDx: uint16  % 0.0625|0|0|255.9375|single
  FCWAEB_JATTC: uint8  % 0.1|0|0|6.3|single
  JAPedObjVx: uint16  % 0.0625|-128|-128|127|single
  JAPedObjCntAlive: uint16  % 17|0|0|65535|uint16
  JAPedObjVy: uint16  % 0.125|-64|-64|63.875|single
  JAPedObjAy: uint16  % 0.03125|-16|-16|15.9688|single
  JAPedObjAx: uint16  % 0.03125|-16|-16|15.9688|single
  NOH_Sts: uint8  % 1|0|0|15|uint8
  NOH_DistToExit: uint16  % 1|0|0|4095|uint16
  FCWAEB_longTTC: uint8  % 0.1|0|0|6.3|single
  NOH_Swt_Resp: boolean  % 1|0|0|1|boolean
  NOH_Act_Resp: boolean  % 1|0|0|1|boolean
  FCWAEB_crossingTTC: uint8  % 0.1|0|0|6.3|single
  NOH_SysInfoDisplay: uint8  % 1|0|0|15|uint8
  AEB_LePedDx: uint16  % 0.5|0|0|150|single
  AEB_LeCyclistTyp: uint8  % 1|0|0|7|uint8
  AEB_LeCyclistDetn: uint8  % 1|0|0|3|uint8
  AEB_RiPedDx: uint16  % 0.5|0|0|150|single
  AEB_RiCyclistDetn: uint8  % 1|0|0|3|uint8
  AEB_LeCyclistDx: uint16  % 0.5|0|0|150|single
  AEB_RiCyclistTyp: uint8  % 1|0|0|7|uint8
  AEB_RiCyclistDx: uint16  % 0.5|0|0|150|single

ACC_FD4_MSG_BUS = Simulink.Bus(HeaderFile="Rte_Type.h")
  AEBObjID: uint8
  AEBObjVideoCfmd: boolean
  AEBObjExist: single
  AEBObjVx: single
  AEBObjDx: single
  AEBObjCntAlive: uint16
  AEBObjDy: single
  AEBObjObstcl: single
  AEBObjState: uint8
  CyclistObjExist: single
  AEBObjVy: single
  AEBObjAx: single
  AEBObjAy: single
  CyclistObjDx: single
  CyclistObjID: uint8
  CyclistObjObstcl: single
  CyclistObjDy: single
  CyclistObjVx: single
  CyclistObjCntAlive: uint16
  CyclistObjVideoCfmd: boolean
  CyclistObjState: uint8
  CyclistObjVy: single
  CyclistObjAx: single
  PedObjExist: single
  CyclistObjAy: single
  PedObjID: uint8
  PedObjObstcl: single
  PedObjDy: single
  PedObjDx: single
  PedObjVx: single
  PedObjVideoCfmd: boolean
  PedObjVy: single
  ACCTgtObjDx: single
  PedObjAy: single
  PedObjCntAlive: uint16
  PedObjAx: single
  ACCTgtObjID: uint8
  ACCTgtObjObstcl: single
  ACCTgtObjDy: single
  ACCTgtObjExist: single
  ACCTgtObjVy: single
  ACCTgtObjVx: single
  ACCTgtObjAx: single
  ACCTgtObjAy: single
  ACCTgtObjVideoCfmd: boolean
  ACCTgtObjState: uint8
  ACCTgtObjCntAlive: uint16
  DrvgOnHiWay: uint8
  HandsoffDetd: uint8
  RadarHorMisalign: single
  SpdLimitDst: uint16
  RoadCrvt: single
  RampDst: uint16
  RoadCrvtFar: single
  SpdLimit: uint8
  NavSpdLimUnit: uint8
  CurveDst: uint16
  DrvgOnRiLane: uint8
  TunnelDst: uint16
  RadarDrvrAttentive: boolean
  BrdgDst: uint16
  PedObjState: uint8
  ACC_SOSReq: uint8
  DrvrSts: uint8
  MapDataValid: boolean
  AEBObjDrvby: uint8
  AEBObjOverlap: uint8
  ACC_DataRecReq: uint8

ACC_FD4_RAW_BUS = Simulink.Bus(HeaderFile="Rte_Type.h")
  AEBObjID: uint8  % 1|0|0|255|uint8
  AEBObjVideoCfmd: boolean  % 1|0|0|1|boolean
  AEBObjExist: uint8  % 0.015625|0|0|0.98438|single
  AEBObjVx: uint16  % 0.0625|-128|-128|127|single
  AEBObjDx: uint16  % 0.0625|0|0|255.9375|single
  AEBObjCntAlive: uint16  % 1|0|0|3855|uint16
  AEBObjDy: uint16  % 0.125|-128|-128|127.875|single
  AEBObjObstcl: uint8  % 0.03125|0|0|0.96875|single
  AEBObjState: uint8  % 1|0|0|7|uint8
  CyclistObjExist: uint8  % 0.015625|0|0|0.98438|single
  AEBObjVy: uint16  % 0.125|-64|-64|63.875|single
  AEBObjAx: uint16  % 0.03125|-16|-16|15.9688|single
  AEBObjAy: uint16  % 0.03125|-16|-16|15.9688|single
  CyclistObjDx: uint16  % 0.0625|0|0|255.9375|single
  CyclistObjID: uint8  % 1|0|0|255|uint8
  CyclistObjObstcl: uint8  % 0.03125|0|0|0.96875|single
  CyclistObjDy: uint16  % 0.125|-128|-128|127.875|single
  CyclistObjVx: uint16  % 0.0625|-128|-128|127|single
  CyclistObjCntAlive: uint16  % 1|0|0|3855|uint16
  CyclistObjVideoCfmd: boolean  % 1|0|0|1|boolean
  CyclistObjState: uint8  % 1|0|0|7|uint8
  CyclistObjVy: uint16  % 0.125|-64|-64|63.875|single
  CyclistObjAx: uint16  % 0.03125|-16|-16|15.9688|single
  PedObjExist: uint8  % 0.015625|0|0|0.98438|single
  CyclistObjAy: uint16  % 0.03125|-16|-16|15.9688|single
  PedObjID: uint8  % 1|0|0|255|uint8
  PedObjObstcl: uint8  % 0.03125|0|0|0.96875|single
  PedObjDy: uint16  % 0.125|-128|-128|127.875|single
  PedObjDx: uint16  % 0.0625|0|0|255.9375|single
  PedObjVx: uint16  % 0.0625|-128|-128|127|single
  PedObjVideoCfmd: boolean  % 1|0|0|1|boolean
  PedObjVy: uint16  % 0.125|-64|-64|63.875|single
  ACCTgtObjDx: uint16  % 0.0625|0|0|255.9375|single
  PedObjAy: uint16  % 0.03125|-16|-16|15.9688|single
  PedObjCntAlive: uint16  % 1|0|0|3855|uint16
  PedObjAx: uint16  % 0.03125|-16|-16|15.9688|single
  ACCTgtObjID: uint8  % 1|0|0|255|uint8
  ACCTgtObjObstcl: uint8  % 0.03125|0|0|0.96875|single
  ACCTgtObjDy: uint16  % 0.125|-128|-128|127.875|single
  ACCTgtObjExist: uint8  % 0.015625|0|0|0.98438|single
  ACCTgtObjVy: uint16  % 0.125|-64|-64|63.875|single
  ACCTgtObjVx: uint16  % 0.0625|-128|-128|127|single
  ACCTgtObjAx: uint16  % 0.03125|-16|-16|15.9688|single
  ACCTgtObjAy: uint16  % 0.03125|-16|-16|15.9688|single
  ACCTgtObjVideoCfmd: boolean  % 1|0|0|1|boolean
  ACCTgtObjState: uint8  % 1|0|0|7|uint8
  ACCTgtObjCntAlive: uint16  % 1|0|0|3855|uint16
  DrvgOnHiWay: uint8  % 1|0|0|3|uint8
  HandsoffDetd: uint8  % 1|0|0|3|uint8
  RadarHorMisalign: uint16  % 0.0001|-0.2048|-0.2048|0.2047|single
  SpdLimitDst: uint8  % 10|0|0|600|uint16
  RoadCrvt: uint16  % 0.00032|-0.16352|-0.16352|0.16352|single
  RampDst: uint8  % 10|0|0|600|uint16
  RoadCrvtFar: uint16  % 0.00032|-0.16352|-0.16352|0.16352|single
  SpdLimit: uint8  % 1|0|0|255|uint8
  NavSpdLimUnit: uint8  % 1|0|0|3|uint8
  CurveDst: uint8  % 10|0|0|600|uint16
  DrvgOnRiLane: uint8  % 1|0|0|3|uint8
  TunnelDst: uint8  % 10|0|0|600|uint16
  RadarDrvrAttentive: boolean  % 1|0|0|1|boolean
  BrdgDst: uint8  % 10|0|0|600|uint16
  PedObjState: uint8  % 1|0|0|7|uint8
  ACC_SOSReq: uint8  % 1|0|0|3|uint8
  DrvrSts: uint8  % 1|0|0|7|uint8
  MapDataValid: boolean  % 1|0|0|1|boolean
  AEBObjDrvby: uint8  % 1|0|0|31|uint8
  AEBObjOverlap: uint8  % 1|0|0|31|uint8
  ACC_DataRecReq: uint8  % 1|0|0|255|uint8

ACC_FD5_MSG_BUS = Simulink.Bus(HeaderFile="Rte_Type.h")
  Sync_Type: uint8
  Sync_CRC: uint8
  Sync_Counter: uint8
  Sync_TimeDomain: uint8
  Sync_OVS: uint8
  Sync_SGW: boolean
  Sync_Resd: uint8
  Sync_SyncTime: uint32

ACC_FD5_RAW_BUS = Simulink.Bus(HeaderFile="Rte_Type.h")
  Sync_Type: uint8  % 1|0|0|255|uint8
  Sync_CRC: uint8  % 1|0|0|255|uint8
  Sync_Counter: uint8  % 1|0|0|15|uint8
  Sync_TimeDomain: uint8  % 1|0|0|15|uint8
  Sync_OVS: uint8  % 1|0|0|3|uint8
  Sync_SGW: boolean  % 1|0|0|1|boolean
  Sync_Resd: uint8  % 1|0|0|31|uint8
  Sync_SyncTime: uint32  % 1|0|0|4294967295|uint32

AEB_FD1_MSG_BUS = Simulink.Bus(HeaderFile="Rte_Type.h")
  Checksum_AEB1: uint8
  AEB_ABP_Req: boolean
  AEB_AWB_Req: boolean
  AEB_TgtDecel_Req: boolean
  AEB_VehHldReq: boolean
  EBA_TgtDecel_Req: boolean
  AEB_ABA_Req: boolean
  AEB_ABA_Level: uint8
  AEB_TgtDecel_ReqValue: single
  AEB_BrkReqFunc: uint8
  AEB_AWB_Level: uint8
  AEB_ObjSty: uint8
  RollingCounter_AEB1: uint8

AEB_FD1_RAW_BUS = Simulink.Bus(HeaderFile="Rte_Type.h")
  Checksum_AEB1: uint8  % 1|0|0|255|uint8
  AEB_ABP_Req: boolean  % 1|0|0|1|boolean
  AEB_AWB_Req: boolean  % 1|0|0|1|boolean
  AEB_TgtDecel_Req: boolean  % 1|0|0|1|boolean
  AEB_VehHldReq: boolean  % 1|0|0|1|boolean
  EBA_TgtDecel_Req: boolean  % 1|0|0|1|boolean
  AEB_ABA_Req: boolean  % 1|0|0|1|boolean
  AEB_ABA_Level: uint8  % 1|0|0|3|uint8
  AEB_TgtDecel_ReqValue: uint16  % 0.000488|-16|-16|16|single
  AEB_BrkReqFunc: uint8  % 1|0|0|7|uint8
  AEB_AWB_Level: uint8  % 1|0|0|15|uint8
  AEB_ObjSty: uint8  % 1|0|0|7|uint8
  RollingCounter_AEB1: uint8  % 1|0|0|15|uint8

AEB_FD2_MSG_BUS = Simulink.Bus(HeaderFile="Rte_Type.h")
  Checksum_AEB2: uint8
  AEB_JA_Resp: boolean
  FCW_Snvty: uint8
  AEB_VehResp: boolean
  AEB_PedResp: boolean
  RollingCounter_AEB2: uint8
  Checksum_AEB3: uint8
  FCW_AEB_VehFctSts: uint8
  AEB_PedTrig: boolean
  AEB_VehTrig: boolean
  AEB_JA_Warn: uint8
  AEB_JAFuncSts: uint8
  FCW_Warn: uint8
  FCW_AEB_PedFctSts: uint8
  AEB_JABrkTrig: uint8
  RollingCounter_AEB3: uint8
  FreshnessValue_AEB_FD2: uint16
  MAC_Check_AEB_FD2: uint64

AEB_FD2_RAW_BUS = Simulink.Bus(HeaderFile="Rte_Type.h")
  Checksum_AEB2: uint8  % 1|0|0|255|uint8
  AEB_JA_Resp: boolean  % 1|0|0|1|boolean
  FCW_Snvty: uint8  % 1|0|0|3|uint8
  AEB_VehResp: boolean  % 1|0|0|1|boolean
  AEB_PedResp: boolean  % 1|0|0|1|boolean
  RollingCounter_AEB2: uint8  % 1|0|0|15|uint8
  Checksum_AEB3: uint8  % 1|0|0|255|uint8
  FCW_AEB_VehFctSts: uint8  % 1|0|0|3|uint8
  AEB_PedTrig: boolean  % 1|0|0|1|boolean
  AEB_VehTrig: boolean  % 1|0|0|1|boolean
  AEB_JA_Warn: uint8  % 1|0|0|3|uint8
  AEB_JAFuncSts: uint8  % 1|0|0|3|uint8
  FCW_Warn: uint8  % 1|0|0|3|uint8
  FCW_AEB_PedFctSts: uint8  % 1|0|0|3|uint8
  AEB_JABrkTrig: uint8  % 1|0|0|3|uint8
  RollingCounter_AEB3: uint8  % 1|0|0|15|uint8
  FreshnessValue_AEB_FD2: uint16  % 1|0|0|65535|uint16
  MAC_Check_AEB_FD2: uint64  % 1|0|0|281474976710655|uint64

AVP_HAP_PAS_PHY_REQ_MSG_BUS = Simulink.Bus(HeaderFile="Rte_Type.h")
  AVP_HAP_PAS_Phy_Req: uint64

AVP_HAP_PAS_PHY_REQ_RAW_BUS = Simulink.Bus(HeaderFile="Rte_Type.h")
  AVP_HAP_PAS_Phy_Req: uint64  % 1|0|0|1.84467440737096e+19|uint64

AVP_HAP_PAS_PHY_RESP_MSG_BUS = Simulink.Bus(HeaderFile="Rte_Type.h")
  AVP_HAP_PAS_Phy_Resp: uint64

AVP_HAP_PAS_PHY_RESP_RAW_BUS = Simulink.Bus(HeaderFile="Rte_Type.h")
  AVP_HAP_PAS_Phy_Resp: uint64  % 1|0|0|1.84467440737096e+19|uint64

AVP_NM_MSG_BUS = Simulink.Bus(HeaderFile="Rte_Type.h")
  Destination_AVP_NM: uint8
  OpCode_AVP_NM: uint8

AVP_NM_RAW_BUS = Simulink.Bus(HeaderFile="Rte_Type.h")
  Destination_AVP_NM: uint8  % 1|0|0|63|uint8
  OpCode_AVP_NM: uint8  % 1|0|0|63|uint8

BCM1_MSG_BUS = Simulink.Bus(HeaderFile="Rte_Type.h")
  WindshldWiprActvSts: boolean
  RRDoorSts: boolean
  PassengerDoorSts: boolean
  LRDoorSts: boolean
  DrvDoorSts: boolean
  TrunkSts: boolean
  RLSFailSts: boolean
  FreshnessValue_BCM1: uint16
  MAC_Check_BCM1: uint64

BCM1_RAW_BUS = Simulink.Bus(HeaderFile="Rte_Type.h")
  WindshldWiprActvSts: boolean  % 1|0|0|1|boolean
  RRDoorSts: boolean  % 1|0|0|1|boolean
  PassengerDoorSts: boolean  % 1|0|0|1|boolean
  LRDoorSts: boolean  % 1|0|0|1|boolean
  DrvDoorSts: boolean  % 1|0|0|1|boolean
  TrunkSts: boolean  % 1|0|0|1|boolean
  RLSFailSts: boolean  % 1|0|0|1|boolean
  FreshnessValue_BCM1: uint16  % 1|0|0|65535|uint16
  MAC_Check_BCM1: uint64  % 1|0|0|281474976710655|uint64

BCM12_MSG_BUS = Simulink.Bus(HeaderFile="Rte_Type.h")
  SrPosn_VR_APP: uint8

BCM12_RAW_BUS = Simulink.Bus(HeaderFile="Rte_Type.h")
  SrPosn_VR_APP: uint8  % 1|0|0|127|uint8

BCM3_MSG_BUS = Simulink.Bus(HeaderFile="Rte_Type.h")
  HazardLmpSwtSts: boolean
  DrvDoorLockSts: boolean
  FreshnessValue_BCM3: uint16
  MAC_Check_BCM3: uint64

BCM3_RAW_BUS = Simulink.Bus(HeaderFile="Rte_Type.h")
  HazardLmpSwtSts: boolean  % 1|0|0|1|boolean
  DrvDoorLockSts: boolean  % 1|0|0|1|boolean
  FreshnessValue_BCM3: uint16  % 1|0|0|65535|uint16
  MAC_Check_BCM3: uint64  % 1|0|0|281474976710655|uint64

BCM8_MSG_BUS = Simulink.Bus(HeaderFile="Rte_Type.h")
  Checksum_BCM8: uint8
  PASWorkCmd: boolean
  RemoteModSts: boolean
  RViewMirrorSts: boolean
  WiprReq_F_PBOX: uint8
  Rollingcounter_BCM8: uint8
  KL30BRelaySts: boolean

BCM8_RAW_BUS = Simulink.Bus(HeaderFile="Rte_Type.h")
  Checksum_BCM8: uint8  % 1|0|0|255|uint8
  PASWorkCmd: boolean  % 1|0|0|1|boolean
  RemoteModSts: boolean  % 1|0|0|1|boolean
  RViewMirrorSts: boolean  % 1|0|0|1|boolean
  WiprReq_F_PBOX: uint8  % 1|0|0|7|uint8
  Rollingcounter_BCM8: uint8  % 1|0|0|15|uint8
  KL30BRelaySts: boolean  % 1|0|0|1|boolean

BLE1_MSG_BUS = Simulink.Bus(HeaderFile="Rte_Type.h")
  Checksum_BLE1: uint8
  BLESecuritySts: uint8
  BLEConnSts: uint8
  PrkOutModSel_Rmt: uint8
  ParkAbortReq_Rmt: boolean
  PrkOutVehStrtReq_Rmt: boolean
  PrkgslidReq_Rmt: boolean
  PrkOutTypeReq_Rmt: uint8
  PrkOutVehStrtReq_Rmt_Valid: boolean
  PrkgSyncStrtReq_Rmt: boolean
  RollingCounter_BLE1: uint8

BLE1_RAW_BUS = Simulink.Bus(HeaderFile="Rte_Type.h")
  Checksum_BLE1: uint8  % 1|0|0|255|uint8
  BLESecuritySts: uint8  % 1|0|0|3|uint8
  BLEConnSts: uint8  % 1|0|0|3|uint8
  PrkOutModSel_Rmt: uint8  % 1|0|0|7|uint8
  ParkAbortReq_Rmt: boolean  % 1|0|0|1|boolean
  PrkOutVehStrtReq_Rmt: boolean  % 1|0|0|1|boolean
  PrkgslidReq_Rmt: boolean  % 1|0|0|1|boolean
  PrkOutTypeReq_Rmt: uint8  % 1|0|0|3|uint8
  PrkOutVehStrtReq_Rmt_Valid: boolean  % 1|0|0|1|boolean
  PrkgSyncStrtReq_Rmt: boolean  % 1|0|0|1|boolean
  RollingCounter_BLE1: uint8  % 1|0|0|15|uint8

CR_FD1_MSG_BUS = Simulink.Bus(HeaderFile="Rte_Type.h")
  Checksum_CR_R_1: uint8
  FCTA_Warn: boolean
  FCTA_B_FuncSts: uint8
  CR_FCTB_Resp: boolean
  CR_FCTA_Resp: boolean
  FCTB_ABA_Req: boolean
  FCTB_ABA_Level: uint8
  FCTBTrig: boolean
  CR_BrkgReq: boolean
  CR_BliSts: boolean
  CR_ErrSts: boolean
  CR_BrkgReqVal: single
  FCTA_B_TTC: single
  FCTB_ABP_Req: boolean
  RollingCounter_CR_R_1: uint8
  Checksum_CR_R_2: uint8
  CR_ObjDistY_Le: single
  CR_ObjID_Le: uint8
  CR_ObjDistX_Le: single
  CR_ObjRelVelX_Le: single
  CR_ObjSts_Le: uint8
  CR_ObjRelAccelX_Le: single
  RollingCounter_CR_R_2: uint8
  CR_ObjMotionType_Le: uint8
  Checksum_CR_R_3: uint8
  CR_ObjDistY_Ri: single
  CR_ObjID_Ri: uint8
  CR_ObjDistX_Ri: single
  CR_ObjRelVelX_Ri: single
  CR_ObjSts_Ri: uint8
  CR_ObjRelAccelX_Ri: single
  RollingCounter_CR_R_3: uint8
  CR_ObjMotionType_Ri: uint8
  Checksum_CR_R_4: uint8
  CR_ObjRelAccelY_Ri: single
  CR_ObjRelAccelY_Le: single
  CR_ObjRelVelY_Ri: single
  CR_ObjRelVelY_Le: single
  RollingCounter_CR_R_4: uint8
  CR_ObjDistXStd_Le: single
  CR_ObjRelVelXStd_Le: single
  CR_ObjDistYStd_Le: single
  CR_ObjRelVelYStd_Le: single
  CR_ObjRAccelYStd_Le: single
  CR_ObjRAccelXStd_Le: single
  CR_ObjDistYStd_Ri: single
  CR_ObjDistXStd_Ri: single
  CR_ObjRelVelXStd_Ri: single
  CR_ObjRelVelYStd_Ri: single
  CR_ObjRAccelYStd_Ri: single
  CR_ObjRAccelXStd_Ri: single

CR_FD1_RAW_BUS = Simulink.Bus(HeaderFile="Rte_Type.h")
  Checksum_CR_R_1: uint8  % 1|0|0|255|uint8
  FCTA_Warn: boolean  % 1|0|0|1|boolean
  FCTA_B_FuncSts: uint8  % 1|0|0|3|uint8
  CR_FCTB_Resp: boolean  % 1|0|0|1|boolean
  CR_FCTA_Resp: boolean  % 1|0|0|1|boolean
  FCTB_ABA_Req: boolean  % 1|0|0|1|boolean
  FCTB_ABA_Level: uint8  % 1|0|0|3|uint8
  FCTBTrig: boolean  % 1|0|0|1|boolean
  CR_BrkgReq: boolean  % 1|0|0|1|boolean
  CR_BliSts: boolean  % 1|0|0|1|boolean
  CR_ErrSts: boolean  % 1|0|0|1|boolean
  CR_BrkgReqVal: uint16  % 0.000488|-16|-16|16|single
  FCTA_B_TTC: uint8  % 0.1|0|0|6.3|single
  FCTB_ABP_Req: boolean  % 1|0|0|1|boolean
  RollingCounter_CR_R_1: uint8  % 1|0|0|15|uint8
  Checksum_CR_R_2: uint8  % 1|0|0|255|uint8
  CR_ObjDistY_Le: uint8  % 0.1|-12.8|-12.8|12.7|single
  CR_ObjID_Le: uint8  % 1|0|0|63|uint8
  CR_ObjDistX_Le: uint16  % 0.1|-10|-10|92.3|single
  CR_ObjRelVelX_Le: uint16  % 0.1|-60|-60|42.3|single
  CR_ObjSts_Le: uint8  % 1|0|0|3|uint8
  CR_ObjRelAccelX_Le: uint16  % 0.03125|-16|-16|15.9688|single
  RollingCounter_CR_R_2: uint8  % 1|0|0|15|uint8
  CR_ObjMotionType_Le: uint8  % 1|0|0|7|uint8
  Checksum_CR_R_3: uint8  % 1|0|0|255|uint8
  CR_ObjDistY_Ri: uint8  % 0.1|-12.8|-12.8|12.7|single
  CR_ObjID_Ri: uint8  % 1|0|0|63|uint8
  CR_ObjDistX_Ri: uint16  % 0.1|-10|-10|92.3|single
  CR_ObjRelVelX_Ri: uint16  % 0.1|-60|-60|42.3|single
  CR_ObjSts_Ri: uint8  % 1|0|0|3|uint8
  CR_ObjRelAccelX_Ri: uint16  % 0.03125|-16|-16|15.9688|single
  RollingCounter_CR_R_3: uint8  % 1|0|0|15|uint8
  CR_ObjMotionType_Ri: uint8  % 1|0|0|7|uint8
  Checksum_CR_R_4: uint8  % 1|0|0|255|uint8
  CR_ObjRelAccelY_Ri: uint16  % 0.03125|-16|-16|15.9688|single
  CR_ObjRelAccelY_Le: uint16  % 0.03125|-16|-16|15.9688|single
  CR_ObjRelVelY_Ri: uint8  % 0.1|-6.4|-6.4|6.3|single
  CR_ObjRelVelY_Le: uint8  % 0.1|-6.4|-6.4|6.3|single
  RollingCounter_CR_R_4: uint8  % 1|0|0|15|uint8
  CR_ObjDistXStd_Le: uint8  % 0.375|0|0|11.625|single
  CR_ObjRelVelXStd_Le: uint8  % 0.375|0|0|11.625|single
  CR_ObjDistYStd_Le: uint8  % 0.375|0|0|11.625|single
  CR_ObjRelVelYStd_Le: uint8  % 0.375|0|0|11.625|single
  CR_ObjRAccelYStd_Le: uint8  % 0.375|0|0|11.625|single
  CR_ObjRAccelXStd_Le: uint8  % 0.375|0|0|11.625|single
  CR_ObjDistYStd_Ri: uint8  % 0.375|0|0|11.625|single
  CR_ObjDistXStd_Ri: uint8  % 0.375|0|0|11.625|single
  CR_ObjRelVelXStd_Ri: uint8  % 0.375|0|0|11.625|single
  CR_ObjRelVelYStd_Ri: uint8  % 0.375|0|0|11.625|single
  CR_ObjRAccelYStd_Ri: uint8  % 0.375|0|0|11.625|single
  CR_ObjRAccelXStd_Ri: uint8  % 0.375|0|0|11.625|single

CR_L_PHY_REQ_MSG_BUS = Simulink.Bus(HeaderFile="Rte_Type.h")
  CR_L_Phy_Req: uint64

CR_L_PHY_REQ_RAW_BUS = Simulink.Bus(HeaderFile="Rte_Type.h")
  CR_L_Phy_Req: uint64  % 1|0|0|1.84467440737096e+19|uint64

CR_L_PHY_RESP_MSG_BUS = Simulink.Bus(HeaderFile="Rte_Type.h")
  CR_L_Phy_Resp: uint64

CR_L_PHY_RESP_RAW_BUS = Simulink.Bus(HeaderFile="Rte_Type.h")
  CR_L_Phy_Resp: uint64  % 1|0|0|1.84467440737096e+19|uint64

CR_R_PHY_REQ_MSG_BUS = Simulink.Bus(HeaderFile="Rte_Type.h")
  CR_R_Phy_Req: uint64

CR_R_PHY_REQ_RAW_BUS = Simulink.Bus(HeaderFile="Rte_Type.h")
  CR_R_Phy_Req: uint64  % 1|0|0|1.84467440737096e+19|uint64

CR_R_PHY_RESP_MSG_BUS = Simulink.Bus(HeaderFile="Rte_Type.h")
  CR_R_Phy_Resp: uint64

CR_R_PHY_RESP_RAW_BUS = Simulink.Bus(HeaderFile="Rte_Type.h")
  CR_R_Phy_Resp: uint64  % 1|0|0|1.84467440737096e+19|uint64

CSA1_MSG_BUS = Simulink.Bus(HeaderFile="Rte_Type.h")
  FrntWiprSwtSts: uint8
  FrntWshrSwtSts: uint8
  LTurnLmpSwtSts: boolean
  RTurnLmpSwtSts: boolean
  FrntFogLmpSwtSts: boolean
  LowBeamSwtSts: boolean
  HiBeamSwtSts: boolean
  OverVehBeamSwtSts: boolean
  AutoHiLowBeamSwtSts: boolean
  AutoLmpSwtSts: boolean

CSA1_RAW_BUS = Simulink.Bus(HeaderFile="Rte_Type.h")
  FrntWiprSwtSts: uint8  % 1|0|0|7|uint8
  FrntWshrSwtSts: uint8  % 1|0|0|3|uint8
  LTurnLmpSwtSts: boolean  % 1|0|0|1|boolean
  RTurnLmpSwtSts: boolean  % 1|0|0|1|boolean
  FrntFogLmpSwtSts: boolean  % 1|0|0|1|boolean
  LowBeamSwtSts: boolean  % 1|0|0|1|boolean
  HiBeamSwtSts: boolean  % 1|0|0|1|boolean
  OverVehBeamSwtSts: boolean  % 1|0|0|1|boolean
  AutoHiLowBeamSwtSts: boolean  % 1|0|0|1|boolean
  AutoLmpSwtSts: boolean  % 1|0|0|1|boolean

CSA2_MSG_BUS = Simulink.Bus(HeaderFile="Rte_Type.h")
  Checksum_CSA2: uint8
  SteerWheelAngSign: boolean
  SteerWheelAng: single
  SteerWheelSpdSign: boolean
  SteerWheelSpd: single
  ACC_TimeGap_DecSetSwt: boolean
  ACC_TimeGap_IncSetSwt: boolean
  CC_ACC_CANCEL_OFFSwt: boolean
  CC_ACC_CRUISE_OFFSwt: boolean
  CC_ACCSwtErr: boolean
  CC_ACC_DecSetSpd_SetSwt: boolean
  CC_ACC_IncSetSpd_ResuSwt: boolean
  SAS_Sts: uint8
  Rollingcounter_CSA2: uint8
  HWA_OK_OFFSwt: boolean
  ManualShiftReq: uint8

CSA2_RAW_BUS = Simulink.Bus(HeaderFile="Rte_Type.h")
  Checksum_CSA2: uint8  % 1|0|0|255|uint8
  SteerWheelAngSign: boolean  % 1|0|0|1|boolean
  SteerWheelAng: uint16  % 0.1|0|0|780|single
  SteerWheelSpdSign: boolean  % 1|0|0|1|boolean
  SteerWheelSpd: uint16  % 0.1|0|0|1016|single
  ACC_TimeGap_DecSetSwt: boolean  % 1|0|0|1|boolean
  ACC_TimeGap_IncSetSwt: boolean  % 1|0|0|1|boolean
  CC_ACC_CANCEL_OFFSwt: boolean  % 1|0|0|1|boolean
  CC_ACC_CRUISE_OFFSwt: boolean  % 1|0|0|1|boolean
  CC_ACCSwtErr: boolean  % 1|0|0|1|boolean
  CC_ACC_DecSetSpd_SetSwt: boolean  % 1|0|0|1|boolean
  CC_ACC_IncSetSpd_ResuSwt: boolean  % 1|0|0|1|boolean
  SAS_Sts: uint8  % 1|0|0|3|uint8
  Rollingcounter_CSA2: uint8  % 1|0|0|15|uint8
  HWA_OK_OFFSwt: boolean  % 1|0|0|1|boolean
  ManualShiftReq: uint8  % 1|0|0|7|uint8

CSA4_MSG_BUS = Simulink.Bus(HeaderFile="Rte_Type.h")
  CheckSum_HOD_1: uint8
  HOD_ErrInfo: uint8
  RollingCounter_HOD_1: uint8
  HOD_HandOffSts: uint8

CSA4_RAW_BUS = Simulink.Bus(HeaderFile="Rte_Type.h")
  CheckSum_HOD_1: uint8  % 1|0|0|255|uint8
  HOD_ErrInfo: uint8  % 1|0|0|15|uint8
  RollingCounter_HOD_1: uint8  % 1|0|0|15|uint8
  HOD_HandOffSts: uint8  % 1|0|0|15|uint8

DCT5_MSG_BUS = Simulink.Bus(HeaderFile="Rte_Type.h")
  CheckSum_DCT5: uint8
  TargetGearValid: boolean
  SHIFT_IN_PROGRESS: boolean
  CurrentGearValid: boolean
  TARGET_GEAR: uint8
  TCU_APS_Available: boolean
  ShiftInPrgValid: boolean
  TGS_LEVER: uint8
  CURRENT_GEAR: uint8
  RollingCounter_DCT5: uint8

DCT5_RAW_BUS = Simulink.Bus(HeaderFile="Rte_Type.h")
  CheckSum_DCT5: uint8  % 1|0|0|255|uint8
  TargetGearValid: boolean  % 1|0|0|1|boolean
  SHIFT_IN_PROGRESS: boolean  % 1|0|0|1|boolean
  CurrentGearValid: boolean  % 1|0|0|1|boolean
  TARGET_GEAR: uint8  % 1|0|0|15|uint8
  TCU_APS_Available: boolean  % 1|0|0|1|boolean
  ShiftInPrgValid: boolean  % 1|0|0|1|boolean
  TGS_LEVER: uint8  % 1|0|0|15|uint8
  CURRENT_GEAR: uint8  % 1|0|0|15|uint8
  RollingCounter_DCT5: uint8  % 1|0|0|15|uint8

DCT_FD1_MSG_BUS = Simulink.Bus(HeaderFile="Rte_Type.h")
  TCUResponseHWP: boolean
  TmLimpHomeValid: boolean
  RatAct: single
  FreshnessValue_DCT_FD1: uint16
  MAC_Check_DCT_FD1: uint64

DCT_FD1_RAW_BUS = Simulink.Bus(HeaderFile="Rte_Type.h")
  TCUResponseHWP: boolean  % 1|0|0|1|boolean
  TmLimpHomeValid: boolean  % 1|0|0|1|boolean
  RatAct: uint8  % 0.1|0|0|25.5|single
  FreshnessValue_DCT_FD1: uint16  % 1|0|0|65535|uint16
  MAC_Check_DCT_FD1: uint64  % 1|0|0|281474976710655|uint64

DCT_FD4_MSG_BUS = Simulink.Bus(HeaderFile="Rte_Type.h")
  DrvFaiMsg: uint8
  FreshnessValue_DCT_FD4: uint16
  MAC_Check_DCT_FD4: uint64

DCT_FD4_RAW_BUS = Simulink.Bus(HeaderFile="Rte_Type.h")
  DrvFaiMsg: uint8  % 1|0|0|15|uint8
  FreshnessValue_DCT_FD4: uint16  % 1|0|0|65535|uint16
  MAC_Check_DCT_FD4: uint64  % 1|0|0|281474976710655|uint64

DDCM1_MSG_BUS = Simulink.Bus(HeaderFile="Rte_Type.h")
  RSDS_Driver_LED_Sts: boolean
  DrvMirrFold_UnfoldSts: boolean
  DrvWinPosnSts: uint8
  DrvSideRearWinPosnSts: uint8

DDCM1_RAW_BUS = Simulink.Bus(HeaderFile="Rte_Type.h")
  RSDS_Driver_LED_Sts: boolean  % 1|0|0|1|boolean
  DrvMirrFold_UnfoldSts: boolean  % 1|0|0|1|boolean
  DrvWinPosnSts: uint8  % 1|0|0|3|uint8
  DrvSideRearWinPosnSts: uint8  % 1|0|0|3|uint8

DMS_FD1_MSG_BUS = Simulink.Bus(HeaderFile="Rte_Type.h")
  Checksum_DMS2: uint8
  DistrctnLvlQlty_ACC: uint8
  DrowsnsLvl_ACC: uint8
  DistrctnLvl_ACC: uint8
  RollingCounter_DMS2: uint8
  Checksum_DMS3: uint8
  HeadPosnX: int16
  HeadPosnY: int16
  HeadPosnZ: int16
  RollingCounter_DMS3: uint8
  Checksum_DMS5: uint8
  HeadYawAng: int8
  HeadPitchAng: int8
  HeadRollAng: int8
  HeadDetn: boolean
  DMSSts: uint8
  RollingCounter_DMS5: uint8
  Checksum_DMS6: uint8
  RobustGazeYawAng: int8
  RobustGazePitchAng: int8
  LEyeOpenStsQlty: uint8
  REyeOpenStsQlty: uint8
  REyeOpenSts: uint8
  LEyeOpenSts: uint8
  RollingCounter_DMS6: uint8

DMS_FD1_RAW_BUS = Simulink.Bus(HeaderFile="Rte_Type.h")
  Checksum_DMS2: uint8  % 1|0|0|255|uint8
  DistrctnLvlQlty_ACC: uint8  % 1|0|0|100|uint8
  DrowsnsLvl_ACC: uint8  % 1|0|0|7|uint8
  DistrctnLvl_ACC: uint8  % 1|0|0|7|uint8
  RollingCounter_DMS2: uint8  % 1|0|0|15|uint8
  Checksum_DMS3: uint8  % 1|0|0|255|uint8
  HeadPosnX: uint16  % 1|-500|-500|1000|int16
  HeadPosnY: uint16  % 1|-500|-500|500|int16
  HeadPosnZ: uint16  % 1|-500|-500|500|int16
  RollingCounter_DMS3: uint8  % 1|0|0|15|uint8
  Checksum_DMS5: uint8  % 1|0|0|255|uint8
  HeadYawAng: uint8  % 1|-75|-75|75|int8
  HeadPitchAng: uint8  % 1|-25|-25|45|int8
  HeadRollAng: uint8  % 1|-45|-45|45|int8
  HeadDetn: boolean  % 1|0|0|1|boolean
  DMSSts: uint8  % 1|0|0|7|uint8
  RollingCounter_DMS5: uint8  % 1|0|0|15|uint8
  Checksum_DMS6: uint8  % 1|0|0|255|uint8
  RobustGazeYawAng: uint8  % 1|-90|-90|90|int8
  RobustGazePitchAng: uint8  % 1|-90|-90|90|int8
  LEyeOpenStsQlty: uint8  % 1|0|0|100|uint8
  REyeOpenStsQlty: uint8  % 1|0|0|100|uint8
  REyeOpenSts: uint8  % 1|0|0|3|uint8
  LEyeOpenSts: uint8  % 1|0|0|3|uint8
  RollingCounter_DMS6: uint8  % 1|0|0|15|uint8

DVR_FD1_MSG_BUS = Simulink.Bus(HeaderFile="Rte_Type.h")
  DVR_360VideoCaptureReq: boolean
  DVRSts: uint8

DVR_FD1_RAW_BUS = Simulink.Bus(HeaderFile="Rte_Type.h")
  DVR_360VideoCaptureReq: boolean  % 1|0|0|1|boolean
  DVRSts: uint8  % 1|0|0|15|uint8

DIAGFUNCREQ_MSG_BUS = Simulink.Bus(HeaderFile="Rte_Type.h")
  DiagFuncReq: uint64

DIAGFUNCREQ_RAW_BUS = Simulink.Bus(HeaderFile="Rte_Type.h")
  DiagFuncReq: uint64  % 1|0|0|1.84467440737096e+19|uint64

ECM1_MSG_BUS = Simulink.Bus(HeaderFile="Rte_Type.h")
  EngSpd: single
  EngSpdVldty: uint8

ECM1_RAW_BUS = Simulink.Bus(HeaderFile="Rte_Type.h")
  EngSpd: uint16  % 0.125|0|0|8191.875|single
  EngSpdVldty: uint8  % 1|0|0|2|uint8

ECM_FD1_MSG_BUS = Simulink.Bus(HeaderFile="Rte_Type.h")
  Checksum_ECM4: uint8
  NetEngTrq: single
  DrvEngTrqReq: single
  RollingCounter_ECM4: uint8
  DrvEngTrqReqVld: boolean
  HCU_Start_StopSts: uint8
  HCU_PowertrainSts_P0: uint8
  EngTrqMinAct: single
  EngTrqMaxActSpd: single
  TrqLoss: single
  TrqLossVldty: boolean
  Checksum_ECM1: uint8
  BrkPedalSts: uint8
  Start_StopSts: uint8
  EngSpd: single
  RollingCounter_ECM1: uint8
  EngSpdVldty: uint8
  FreshnessValue_ECM_FD1: uint16
  MAC_Check_ECM_FD1: uint64

ECM_FD1_RAW_BUS = Simulink.Bus(HeaderFile="Rte_Type.h")
  Checksum_ECM4: uint8  % 1|0|0|255|uint8
  NetEngTrq: uint16  % 0.0030518|-100|-100|99.9967|single
  DrvEngTrqReq: uint16  % 0.0030518|-100|-100|99.9997|single
  RollingCounter_ECM4: uint8  % 1|0|0|15|uint8
  DrvEngTrqReqVld: boolean  % 1|0|0|1|boolean
  HCU_Start_StopSts: uint8  % 1|0|0|9|uint8
  HCU_PowertrainSts_P0: uint8  % 1|0|0|15|uint8
  EngTrqMinAct: uint16  % 0.0030518|-100|-100|99.9997|single
  EngTrqMaxActSpd: uint16  % 0.0030518|-100|-100|99.9997|single
  TrqLoss: uint16  % 0.0030518|-100|-100|99.9997|single
  TrqLossVldty: boolean  % 1|0|0|1|boolean
  Checksum_ECM1: uint8  % 1|0|0|255|uint8
  BrkPedalSts: uint8  % 1|0|0|3|uint8
  Start_StopSts: uint8  % 1|0|0|7|uint8
  EngSpd: uint16  % 0.125|0|0|8191.875|single
  RollingCounter_ECM1: uint8  % 1|0|0|15|uint8
  EngSpdVldty: uint8  % 1|0|0|2|uint8
  FreshnessValue_ECM_FD1: uint16  % 1|0|0|65535|uint16
  MAC_Check_ECM_FD1: uint64  % 1|0|0|281474976710655|uint64

ECM_FD2_MSG_BUS = Simulink.Bus(HeaderFile="Rte_Type.h")
  Checksum_ECM9: uint8
  ECM_interfaceAPS: boolean
  AccPedalOverride: boolean
  AccelPedlPosnDiagc: single
  ECMACCInterface: boolean
  ECMRespACC: boolean
  RollingCounter_ECM9: uint8
  Checksum_ECM10: uint8
  AccPedalOverride_HWP: boolean
  EngFail: uint8
  ECMHWPinterface: boolean
  RollingCounter_ECM10: uint8
  Checksum_ECM2: uint8
  AccelPedalPosn: single
  AccelPedalPosnVldty: uint8
  RollingCounter_ECM2: uint8
  EngState: uint8
  EngState_PHEV: uint8
  FreshnessValue_ECM_FD2: uint16
  MAC_Check_ECM_FD2: uint64

ECM_FD2_RAW_BUS = Simulink.Bus(HeaderFile="Rte_Type.h")
  Checksum_ECM9: uint8  % 1|0|0|255|uint8
  ECM_interfaceAPS: boolean  % 1|0|0|1|boolean
  AccPedalOverride: boolean  % 1|0|0|1|boolean
  AccelPedlPosnDiagc: uint8  % 0.3937|0|0|100.3935|single
  ECMACCInterface: boolean  % 1|0|0|1|boolean
  ECMRespACC: boolean  % 1|0|0|1|boolean
  RollingCounter_ECM9: uint8  % 1|0|0|15|uint8
  Checksum_ECM10: uint8  % 1|0|0|255|uint8
  AccPedalOverride_HWP: boolean  % 1|0|0|1|boolean
  EngFail: uint8  % 1|0|0|7|uint8
  ECMHWPinterface: boolean  % 1|0|0|1|boolean
  RollingCounter_ECM10: uint8  % 1|0|0|15|uint8
  Checksum_ECM2: uint8  % 1|0|0|255|uint8
  AccelPedalPosn: uint8  % 0.3937|0|0|100.3935|single
  AccelPedalPosnVldty: uint8  % 1|0|0|2|uint8
  RollingCounter_ECM2: uint8  % 1|0|0|15|uint8
  EngState: uint8  % 1|0|0|3|uint8
  EngState_PHEV: uint8  % 1|0|0|7|uint8
  FreshnessValue_ECM_FD2: uint16  % 1|0|0|65535|uint16
  MAC_Check_ECM_FD2: uint64  % 1|0|0|281474976710655|uint64

ECM_FD3_MSG_BUS = Simulink.Bus(HeaderFile="Rte_Type.h")
  MaxEngTrqNorm: uint16
  EngLimpHomeSts: boolean

ECM_FD3_RAW_BUS = Simulink.Bus(HeaderFile="Rte_Type.h")
  MaxEngTrqNorm: uint8  % 5|0|0|510|uint16
  EngLimpHomeSts: boolean  % 1|0|0|1|boolean

EEM1_MSG_BUS = Simulink.Bus(HeaderFile="Rte_Type.h")
  Stat_PwrSv_Lvl: uint8
  TranPMode_Sts: boolean

EEM1_RAW_BUS = Simulink.Bus(HeaderFile="Rte_Type.h")
  Stat_PwrSv_Lvl: uint8  % 1|0|0|7|uint8
  TranPMode_Sts: boolean  % 1|0|0|1|boolean

EPS_FD1_MSG_BUS = Simulink.Bus(HeaderFile="Rte_Type.h")
  CheckSum_EPS1: uint8
  EPS_DSTCtrlSts: uint8
  EPS_FailSts: uint8
  EPS_TrqSnsrSts: boolean
  EPS_AvailSts: uint8
  EPS_InterferDetdVld: boolean
  EPS_InterferDetd: boolean
  EPS_SteerMod: uint8
  RollingCounter_EPS1: uint8
  CheckSum_EPS2: uint8
  EPS_DrvInpTrqVal_HighReslolution: single
  EPS_LKATorqOvrlDlvd: single
  RollingCounter_EPS2: uint8
  EPS_LKATrqOvlDlvdSts: uint8
  EPS_DrvInpTrqVal_HighResVld: boolean
  EPS_LKATorqOvrlDlvdVld: boolean
  CheckSum_EPS3: uint8
  EPS_HWPHndShkResp: boolean
  ElecPwrSteerCpby: uint8
  EPS_SteerWheelAngSign: boolean
  EPS_SteerWheelAng: single
  EPS_SteerWheelSpdSign: boolean
  EPS_SteerWheelSpd: single
  EPS_AvailStsforHAD: uint8
  EPS_SteerWheelAngVld: boolean
  EPS_HADerror_Reason: uint8
  RollingCounter_EPS3: uint8
  EPS_HADHndShkRespSt: uint8
  EPS_AngCmdOverRange: boolean
  FreshnessValue_EPS_FD1: uint16
  MAC_Check_EPS_FD1: uint64

EPS_FD1_RAW_BUS = Simulink.Bus(HeaderFile="Rte_Type.h")
  CheckSum_EPS1: uint8  % 1|0|0|255|uint8
  EPS_DSTCtrlSts: uint8  % 1|0|0|7|uint8
  EPS_FailSts: uint8  % 1|0|0|3|uint8
  EPS_TrqSnsrSts: boolean  % 1|0|0|1|boolean
  EPS_AvailSts: uint8  % 1|0|0|3|uint8
  EPS_InterferDetdVld: boolean  % 1|0|0|1|boolean
  EPS_InterferDetd: boolean  % 1|0|0|1|boolean
  EPS_SteerMod: uint8  % 1|0|0|7|uint8
  RollingCounter_EPS1: uint8  % 1|0|0|15|uint8
  CheckSum_EPS2: uint8  % 1|0|0|255|uint8
  EPS_DrvInpTrqVal_HighReslolution: uint16  % 0.015625|-31.9844|-31.9844|32|single
  EPS_LKATorqOvrlDlvd: uint16  % 0.01|-15|-15|15|single
  RollingCounter_EPS2: uint8  % 1|0|0|15|uint8
  EPS_LKATrqOvlDlvdSts: uint8  % 1|0|0|3|uint8
  EPS_DrvInpTrqVal_HighResVld: boolean  % 1|0|0|1|boolean
  EPS_LKATorqOvrlDlvdVld: boolean  % 1|0|0|1|boolean
  CheckSum_EPS3: uint8  % 1|0|0|255|uint8
  EPS_HWPHndShkResp: boolean  % 1|0|0|1|boolean
  ElecPwrSteerCpby: uint8  % 1|0|0|2|uint8
  EPS_SteerWheelAngSign: boolean  % 1|0|0|1|boolean
  EPS_SteerWheelAng: uint16  % 0.1|0|0|780|single
  EPS_SteerWheelSpdSign: boolean  % 1|0|0|1|boolean
  EPS_SteerWheelSpd: uint16  % 0.1|0|0|1016|single
  EPS_AvailStsforHAD: uint8  % 1|0|0|3|uint8
  EPS_SteerWheelAngVld: boolean  % 1|0|0|1|boolean
  EPS_HADerror_Reason: uint8  % 1|0|0|15|uint8
  RollingCounter_EPS3: uint8  % 1|0|0|15|uint8
  EPS_HADHndShkRespSt: uint8  % 1|0|0|7|uint8
  EPS_AngCmdOverRange: boolean  % 1|0|0|1|boolean
  FreshnessValue_EPS_FD1: uint16  % 1|0|0|65535|uint16
  MAC_Check_EPS_FD1: uint64  % 1|0|0|281474976710655|uint64

ESP14_MSG_BUS = Simulink.Bus(HeaderFile="Rte_Type.h")
  CheckSum_ESP14: uint8
  IsDrvReqFxBrakeDom: boolean
  DrvReqFxBrkDomAvail: uint8
  IsDrvPressBrkPedal: boolean
  DrvPressBrkPedalAvl: uint8
  RollingCounter_ESP14: uint8

ESP14_RAW_BUS = Simulink.Bus(HeaderFile="Rte_Type.h")
  CheckSum_ESP14: uint8  % 1|0|0|255|uint8
  IsDrvReqFxBrakeDom: boolean  % 1|0|0|1|boolean
  DrvReqFxBrkDomAvail: uint8  % 1|0|0|2|uint8
  IsDrvPressBrkPedal: boolean  % 1|0|0|1|boolean
  DrvPressBrkPedalAvl: uint8  % 1|0|0|2|uint8
  RollingCounter_ESP14: uint8  % 1|0|0|15|uint8