% Simulink data dictionary PubParsConfig_bak.sldd

P_AEB_PowerTrainConfig = AUTOSAR4.Parameter(0, SwCalibrationAccess="ReadWrite", StorageClass="Global", MemorySection="CAL", DataType="uint8")
P_VSM_PowerTrainConfig = AUTOSAR4.Parameter(0, SwCalibrationAccess="ReadWrite", StorageClass="Global", MemorySection="CAL", DataType="uint8")