% Simulink data dictionary PubParsGlobal.sldd

P_Global_DxvFrontBumper_m = AUTOSAR4.Parameter(3.872, SwCalibrationAccess="ReadWrite", StorageClass="ImportedExtern", DataType="single", Unit="m")  % 后轴到前杠前边缘的X向位置
P_Global_FrontAxleToCenter_m = AUTOSAR4.Parameter(1.2721, SwCalibrationAccess="ReadWrite", StorageClass="ImportedExtern", DataType="single", Unit="m")  % 前轴距到车辆质心距离
P_Global_Height_m = AUTOSAR4.Parameter(1.69, SwCalibrationAccess="ReadWrite", StorageClass="ImportedExtern", DataType="single", Unit="m")  % 地面到车顶高度Z向位置
P_Global_RearAxleToCenter_m = AUTOSAR4.Parameter(1.6429, SwCalibrationAccess="ReadWrite", StorageClass="ImportedExtern", DataType="single", Unit="m")  % 后轴到车辆质心的X向位置
P_Global_SideSlipAnglefactor = AUTOSAR4.Parameter(0.002, SwCalibrationAccess="ReadWrite", StorageClass="ImportedExtern", DataType="single")  % 侧滑角系数
P_Global_SteeringAngleRatio = AUTOSAR4.Parameter(15.5, SwCalibrationAccess="ReadWrite", StorageClass="ImportedExtern", DataType="single")  % 方向盘与前轮转角传动比
P_Global_TireRadius_m = AUTOSAR4.Parameter(0.393, SwCalibrationAccess="ReadWrite", StorageClass="ImportedExtern", DataType="single", Unit="m")  % 轮胎半径
P_Global_VehicleWidthMax_m = AUTOSAR4.Parameter(2.188, SwCalibrationAccess="ReadWrite", StorageClass="ImportedExtern", DataType="single", Unit="m")  % 最大车宽
P_Global_VehicleWidthMin_m = AUTOSAR4.Parameter(1.96, SwCalibrationAccess="ReadWrite", StorageClass="ImportedExtern", DataType="single", Unit="m")  % 最小车宽
P_Global_Weight_N = AUTOSAR4.Parameter(17934, SwCalibrationAccess="ReadWrite", StorageClass="ImportedExtern", DataType="single", Unit="N")  % 车重
P_Global_WheelBase_m = AUTOSAR4.Parameter(2.915, SwCalibrationAccess="ReadWrite", StorageClass="ImportedExtern", DataType="single", Unit="m")  % 轴距
P_Global_WheelTrack_m = AUTOSAR4.Parameter(1.671, SwCalibrationAccess="ReadWrite", StorageClass="ImportedExtern", DataType="single", Unit="m")  % 轮距
P_Global_DxvRearBumper_m = AUTOSAR4.Parameter(-0.944, SwCalibrationAccess="ReadWrite", StorageClass="ImportedExtern", DataType="single", Unit="m")  % 后轴中心到后杠后边缘中心的X向位置
P_Global_Vehicle_Length_m = AUTOSAR4.Parameter(4.875, SwCalibrationAccess="ReadWrite", StorageClass="ImportedExtern", DataType="single", Unit="m")  % 车长
P_Global_EQ2RearAxisX_m = AUTOSAR4.Parameter(1.919, SwCalibrationAccess="ReadWrite", StorageClass="ImportedExtern", DataType="single", Unit="m")  % 后轴中心点到摄像头光心的X向位置
P_Global_EQ2RearAxisY_m = AUTOSAR4.Parameter(-0.0955, SwCalibrationAccess="ReadWrite", StorageClass="ImportedExtern", DataType="single", Unit="m")  % 摄像头光心到后轴中心点的Y向位置
P_Global_RadarToRearAxleCenterX_m = AUTOSAR4.Parameter(3.846, SwCalibrationAccess="ReadWrite", StorageClass="ImportedExtern", DataType="single", Unit="m")  % 前雷达安装位置到后轴中心点的X向位置
P_Global_RadarToRearAxleCenterY_m = AUTOSAR4.Parameter(0, SwCalibrationAccess="ReadWrite", StorageClass="ImportedExtern", DataType="single", Unit="m")  % 前雷达安装位置到后轴中心点的Y向位置
P_Global_IEnvironment_WheelWidth = AUTOSAR4.Parameter(0.235, SwCalibrationAccess="ReadWrite", StorageClass="ImportedExtern", DataType="single", Unit="m")  % 车轮宽度
P_Global_IEnvironment_RefPX_Front_Bumper = AUTOSAR4.Parameter(1.933, SwCalibrationAccess="ReadWrite", StorageClass="ImportedExtern", DataType="single", Unit="m")  % 摄像头到前保险杠的X向距离偏移量
P_Global_TAC_Camera_Height = AUTOSAR4.Parameter(1.53, SwCalibrationAccess="ReadWrite", StorageClass="ImportedExtern", DataType="single", Unit="m")  % 摄像头距地面的高度Hc
P_Global_TAC_Targets_Num = AUTOSAR4.Parameter(2, SwCalibrationAccess="ReadWrite", StorageClass="ImportedExtern", DataType="uint8", Unit="个")  % 目标数量
P_Global_IEnvironment_CamToFrontAxle = AUTOSAR4.Parameter(0.996, SwCalibrationAccess="ReadWrite", StorageClass="ImportedExtern", DataType="single", Unit="m")  % 摄像头光心到前轴中心点的X向距离
P_Global_TAC_Bottom = AUTOSAR4.Parameter(-90, SwCalibrationAccess="ReadWrite", StorageClass="ImportedExtern", DataType="int8", Unit="pixel")  % 底部剪切值（默认值-90）
P_Global_IEnviroment_Top_Crop = AUTOSAR4.Parameter(120, SwCalibrationAccess="ReadWrite", StorageClass="ImportedExtern", DataType="uint16", Unit="pixel")  % 顶部剪切范围（默认120）
P_Global_IEnviroment_Bottom_Crop = AUTOSAR4.Parameter(-90, SwCalibrationAccess="ReadWrite", StorageClass="ImportedExtern", DataType="int16", Unit="pixel")  % 底部剪切范围（默认-90）
P_Global_EQ2LeftWheel_m = AUTOSAR4.Parameter(1.061, SwCalibrationAccess="ReadWrite", StorageClass="ImportedExtern", DataType="single", Unit="m")  % 摄像头光心到左轮的Y向距离
P_Global_EQ2RightWheel_m = AUTOSAR4.Parameter(0.87, SwCalibrationAccess="ReadWrite", StorageClass="ImportedExtern", DataType="single", Unit="m")  % 摄像头光心到右轮的Y向距离
P_Global_EHRV3CALIBRA_DIS_DX = AUTOSAR4.Parameter(0, SwCalibrationAccess="ReadWrite", StorageClass="ImportedExtern", DataType="single", Unit="m")  % 地图盒子坐标轴到后轴中心点的X向位置
P_Global_EHRV3CALIBRA_DIS_DY = AUTOSAR4.Parameter(0, SwCalibrationAccess="ReadWrite", StorageClass="ImportedExtern", DataType="single", Unit="m")  % 地图盒子坐标轴到后轴中心点的Y向位置
P_Global_Empty_mass_kg = AUTOSAR4.Parameter(1830, SwCalibrationAccess="ReadWrite", StorageClass="ImportedExtern", DataType="single", Unit="kg")  % 空载
P_Global_GVW_kg = AUTOSAR4.Parameter(2252, SwCalibrationAccess="ReadWrite", StorageClass="ImportedExtern", DataType="single", Unit="kg")  % 满载
P_Global_CURB_kg = AUTOSAR4.Parameter(1830, SwCalibrationAccess="ReadWrite", StorageClass="ImportedExtern", DataType="single", Unit="kg")  % 整备质量
P_Global_CharSpd_ms = AUTOSAR4.Parameter(23.5, SwCalibrationAccess="ReadWrite", StorageClass="ImportedExtern", DataType="single", Unit="m/s")  % 车辆特征车速（过渡转向和转向不足的临界车速，ESP提供）
P_Global_VehiclePowerType = AUTOSAR4.Parameter(0, SwCalibrationAccess="ReadWrite", StorageClass="ImportedExtern", DataType="uint8")  % 动力形式，0-V71混动；1-V61混动；