% Simulink data dictionary VIE_P.sldd

Switch_OSM_visionOnly_on = Simulink.Parameter(0, StorageClass="ExportedGlobal")
WheelBase_m = Simulink.Parameter(2.68, StorageClass="ExportedGlobal", DataType="single", Unit="m")
FrontAxleToCenter_m = Simulink.Parameter(1.2, StorageClass="ExportedGlobal", DataType="single", Unit="m")
RearAxleToCenter_m = Simulink.Parameter(1.48, StorageClass="ExportedGlobal", DataType="single", Unit="m")
SteeringAngleRatio = Simulink.Parameter(17.79, StorageClass="ExportedGlobal", DataType="single")
CharSpd_ms = Simulink.Parameter(23, DataType="single", Unit="m/s")  % Vehicle Characteristic Speed
SideSlipAnglefactor = Simulink.Parameter(0.002, DataType="single")
WheelTrack_m = Simulink.Parameter(1.586, DataType="single", Unit="m")