% Simulink data dictionary HWA_DDsbackups.sldd
% references PubIfAutosarDDs.sldd
% references PubParsAutosarDDs.sldd
% references LightCtrlParameter.sldd
% references DMS_Parameter.sldd
% references EHR_all.sldd
% references HMI_Parameter.sldd
% references LCS_v05.sldd
% references LSM_Parameter.sldd
% references AP.sldd
% references PLAN_Parameters.sldd
% references LM_TOS_all.sldd
% references mcuSPI.sldd
% references VIE_P.sldd
% references VSM_All.sldd
% references VLC.sldd

QuickStart_50021_1_23_22_33_55606 = Simulink.ConfigSet(StartTime="0", StopTime="Inf", FixedStep="0.02", Solver="FixedStepAuto", ProdHWDeviceType="Custom Processor->Custom", SystemTargetFile="ert.tlc", TargetLang="C")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
RFM_L1_bIsLineExist = Simulink.Signal(StorageClass="ExportedGlobal")
RFM_L1_dC0V = Simulink.Signal(StorageClass="ExportedGlobal")
RFM_L1_dC1V = Simulink.Signal(StorageClass="ExportedGlobal")
RFM_L1_dC2V = Simulink.Signal()
RFM_L1_dC3V = Simulink.Signal(StorageClass="ExportedGlobal")
RFM_L1_dDisStart = Simulink.Signal(StorageClass="ExportedGlobal")
RFM_L1_dDisFront = Simulink.Signal(StorageClass="ExportedGlobal")
RFM_R1_bIsLineExist = Simulink.Signal(StorageClass="ExportedGlobal")
RFM_R1_dC0V = Simulink.Signal(StorageClass="ExportedGlobal")
RFM_R1_dC1V = Simulink.Signal(StorageClass="ExportedGlobal")
RFM_R1_dC2V = Simulink.Signal(StorageClass="ExportedGlobal")
RFM_R1_dC3V = Simulink.Signal(StorageClass="ExportedGlobal")
RFM_R1_dDisStart = Simulink.Signal(StorageClass="ExportedGlobal")
RFM_R1_dDisFront = Simulink.Signal(StorageClass="ExportedGlobal")
RFM_L1_eLineType = Simulink.Signal(StorageClass="ExportedGlobal")
RFM_R1_eLineType = Simulink.Signal(StorageClass="ExportedGlobal")
Param = Simulink.Parameter([])
P_TOSS_DxOffset = Simulink.Parameter(-3, StorageClass="ExportedGlobal")
DspaceConfig = Simulink.ConfigSet(StartTime="0", StopTime="Inf", Solver="FixedStepAuto", ProdHWDeviceType="Custom Processor->Custom", SystemTargetFile="dsrt.tlc", TargetLang="C")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