% Simulink data dictionary PubIfChassisHMI_RTE.sldd

HMI_VCAN_HUT_BUS = Simulink.Bus(HeaderFile="Rte_Type.h")
  LSSSwtReq: boolean
  ESS_PedSwtReq: boolean
  ESS_VehSwtReq: boolean
  AESSwtReq: boolean
  IFC_SnvtySet: uint8
  ADAS_Posn_CurLane: uint8
  NavSpdLimValue: uint8
  NavSpdLimUnit_HUT: uint8

HMI_IFC_FD2_BUS = Simulink.Bus(HeaderFile="Rte_Type.h")
  LSSIntervention: uint8
  LSSWarnFormResp: uint8
  ELKResp: boolean
  LCKResp: boolean
  LKAResp: boolean
  LDWResp: boolean
  IntelligentEvaResp: boolean
  LSSFuncSts: uint8
  LSSErrSts: uint8
  LSSResp: boolean
  ELKMainState: uint8
  LDW_LKAWarn: uint8
  ESS_PedResp: boolean
  ESS_VehResp: boolean
  AESResp: boolean
  LaneAvailability: uint8
  LDW_LKA_Snvty: uint8
  IFCCalibrationSts: uint8
  IFCHUTInterface: boolean
  CameraBlockageSts: boolean
  TJA_FollowSts: uint8
  IFC_LeLaneTyp: uint8
  IFC_RiLaneTyp: uint8
  IFC_NextLeLaneTyp: uint8
  IFC_NextRiLaneTyp: uint8
  IFC_LaneCurve: single
  IFC_LeLane_dy: single
  IFC_RiLane_dy: single
  IFC_NextLeLane_dy: single
  IFC_NextRiLane_dy: single
  AESintervention: uint8
  ESSintervention: uint8
  ELKActSts: boolean
  IntelligentEvaActSts: boolean
  IFC_Handsoffwarn: uint8
  AESSts: uint8
  ESSSts: uint8

HMI_ACC_FD4_BUS = Simulink.Bus(HeaderFile="Rte_Type.h")
  ACCTgtObjDx: single
  ACCTgtObjDy: single
  ACCTgtObjObstcl: single
  ACCTgtObjExist: single
  ACCTgtObjVy: single
  ACCTgtObjVx: single
  ACCTgtObjAx: single
  ACCTgtObjAy: single
  ACCTgtObjState: uint8
  ACCTgtObjVideoCfmd: boolean
  ACCTgtObjCntAlive: uint32
  HandsoffDetd: uint8
  DrvgOnHiWay: uint8
  RoadCrvt: single
  SpdLimitDst: uint16
  RoadCrvtFar: single
  RampDst: uint16
  SpdLimit: uint8
  CurveDst: uint16
  NavSpdLimUnit: uint8
  TunnelDst: uint16
  DrvgOnRiLane: uint8
  BrdgDst: uint16
  ACC_SOSReq: uint8
  MapDataValid: boolean
  DrvrSts: uint8
  ACCTgtObjID: uint8

HMI_ACC_FD1_BUS = Simulink.Bus(HeaderFile="Rte_Type.h")
  Longctrl_DrvOFF_Req: boolean
  Longctrl_ModSts: uint8
  Longctrl_ParkShiftReq: uint8
  ActualTargetSpeed: uint8
  Longctrl_VehHldReq: boolean
  ACC_CRInterface: boolean
  Longctrl_FuelCutOffPrevn: boolean

HMI_IFC_FD5_BUS = Simulink.Bus(HeaderFile="Rte_Type.h")
  IFC_Line01_Dy: single
  IFC_Line01_Curv: single
  IFC_Line01_CurvChange: single
  IFC_Line01_Type: uint8
  IFC_Line02_Dy: single
  IFC_Line02_Curv: single
  IFC_Line02_CurvChange: single
  IFC_Line02_Type: uint8
  IFC_Line03_Dy: single
  IFC_Line03_Curv: single
  IFC_Line03_CurvChange: single
  IFC_Line03_Type: uint8
  IFC_Line04_Dy: single
  IFC_Line04_Curv: single
  IFC_Line04_CurvChange: single
  IFC_Line04_Type: uint8
  IFC_Roadedge01_Dy: single
  IFC_Roadedge01_Curv: single
  IFC_Roadedge01_CurvChange: single
  IFC_Roadedge01_Type: uint8
  IFC_Roadedge02_Dy: single
  IFC_Roadedge02_Curv: single
  IFC_Roadedge02_CurvChange: single
  IFC_Roadedge02_Type: uint8

HMI_ACC_FD2_BUS = Simulink.Bus(HeaderFile="Rte_Type.h")
  ACC_ModDisp: uint8
  TJA_ICA_ModDisp: uint8
  HWA_ModDisp: uint8
  ACC_InterSysInfoDisp: uint8
  TJA_ICA_InterSysInfoDisp: uint8
  HWA_InterSysInfoDisp: uint8
  CruCha_ModDisp: uint8
  CruChar_InterSysInfoDisp: uint8
  ALC_Resp: boolean
  HWA_Resp: boolean
  ISL_Resp: boolean
  ICA_HandsOffResp: boolean
  HWA_warning: uint8
  ACC_TimeGapSet: uint8
  ACC_SpdSetValue: uint8
  TJA_ACC_SelSts: uint8
  ACC_TakeOverReq: boolean
  ACC_FctSts: uint8
  ACC_EgoStatus: uint8
  Longctrl_HazActv: uint8
  ADAS_DriverInloop_Monitor: uint8
  HWA_SnvtySet_Resp: uint8
  HWA_LaneChangeReq: uint8
  HWA_LaneChange: uint8
  ACC_ObjDetecte: boolean
  ACC_RlvTgtDetn: uint8
  ACC_PotentialTgtDetn: uint8
  ACC_PotentialTgtTyp: uint8
  ACC_PotentialTgtDx: single
  ACC_PotentialTgtDy: single
  ACC_LeTargrtDection: uint8
  ACC_LeTgtTyp: uint8
  ACC_LeTgtDx: single
  ACC_LeTgtDy: single
  ACC_RiTargrtDetn: uint8
  ACC_RiTgtTyp: uint8
  ACC_RiTgtDx: single
  ACC_RiTgtDy: single
  ISL_InterSysInfoDisp: uint8
  Longctrl_DrvOFF_Req_DVR: boolean
  Longctrl_ModSts_DVR: uint8
  Longctrl_ParkShiftReq_DVR: uint8
  ACC_RlvTgtTyp: uint8
  ACC_RlvTgtDx: single
  ACC_RlvTgtDy: single
  Longctrl_HCUTrqReq_DVR: single
  ALC_InterSysInfoDisp: uint8
  Request_driveoff: uint8
  Longctrl_VehHldReq_DVR: boolean
  Longctrl_HCUTrqReqActive_DVR: boolean
  IntelligentCurveAct: boolean
  ACC_RlvTgtfusion: boolean
  ACC_RlvTgtHeading: single
  ACC_LeTgtfusion: boolean
  ACC_LeTgtHeading: single
  ACC_RiTgtfusion: boolean
  ACC_RiTgtHeading: single
  ACC_PotentialTgtfusion: boolean
  ACC_PotentialTgtHeading: single
  ACC_LeTgt_02_Dy: single
  ACC_LeTgt_02_Dx: single
  ACC_LeTgt_02_Typ: uint8
  ACC_LeTargrt_02_Detn: uint8
  ACC_RiTargrt_02_Detn: uint8
  ACC_RiTgt_02_Dy: single
  ACC_RiTgt_02_Dx: single
  ACC_RiTgt_02_Typ: uint8
  ACC_TgtObjBarDisp: uint8
  ACC_LeTgtObjBarDisp: uint8
  ACC_RiTgtObjBarDisp: uint8

HMI_IFC_FD6_BUS = Simulink.Bus(HeaderFile="Rte_Type.h")
  IFC_Line01_HeadingAngle: single
  IFC_Line02_HeadingAngle: single
  IFC_Line03_HeadingAngle: single
  IFC_Line04_HeadingAngle: single
  IFC_Roadedge01_HeadingAngle: single
  IFC_Roadedge02_HeadingAngle: single
  IFC_Line01_DxStart: single
  IFC_Line01_DxEnd: single
  IFC_Line02_DxStart: single
  IFC_Line02_DxEnd: single
  IFC_Line03_DxStart: single
  IFC_Line03_DxEnd: single
  IFC_Line04_DxStart: single
  IFC_Line04_DxEnd: single
  IFC_Roadedge01_DxStart: single
  IFC_Roadedge01_DxEnd: single
  IFC_Roadedge02_DxStart: single
  IFC_Roadedge02_DxEnd: single

HMI_ACC_FD3_BUS = Simulink.Bus(HeaderFile="Rte_Type.h")
  NOH_Sts: uint8
  NOH_DistToExit: uint16
  NOH_Swt_Resp: boolean
  NOH_Act_Resp: boolean
  NOH_SysInfoDisplay: uint8

HMI_IFC_FD3_BUS = Simulink.Bus(HeaderFile="Rte_Type.h")
  IDC_L2_EmgyLightReq: boolean
  IDC_L2_TurnLightReq: uint8
  IDC_L2_FWiperReq: uint8
  HWA_InhibitWarn: uint8
  HWA_WarnInfoDisp: uint8
  NOH_WarnInfoDisplay: uint8