% Simulink data dictionary PubIfDCanV71_V13_RTE.sldd

IDC_L2_GW1_MSG_BUS = Simulink.Bus(HeaderFile="Rte_Type.h")
  TOS_LCP7_ObjIn_Lane: uint8
  TOS_LCP7_RightLane_Prob: single
  TOS_LCP7_CurrLane_Prob: single
  TOS_LCP7_LeftLane_Prob: single
  TOS_LCP7_Obj_Age: uint16
  TOS_LCP7_Obj_ObstclProb: single
  TOS_LCP7_Obj_ExistProb: single
  TOS_LCP7_Obj_Typ_Prob: single
  TOS_LCP7_Obj_Std_HdgAng: single
  TOS_LCP7_Obj_Std_Width: single
  TOS_LCP7_Obj_Std_Len: single
  TOS_LCP7_Obj_AY: single
  TOS_LCP7_Obj_AX: single
  TOS_LCP7_Obj_Std_VY: single
  TOS_LCP7_Obj_Std_VX: single
  TOS_LCP7_Obj_Std_DY: single
  TOS_LCP7_Obj_Std_DX: single
  TOS_LCP7_Obj_Std_AY: single
  TOS_LCP7_Obj_Std_AX: single
  TOS_LCP7_Obj_VY: single
  TOS_LCP7_Obj_VX: single
  TOS_LCP7_Obj_DY: single
  TOS_LCP7_Obj_DX: single
  TOS_LCP7_Obj_MovgSt: uint8
  TOS_LCP7_Obj_Orntn: uint8
  TOS_LCP7_Obj_YawAng: single
  TOS_LCP7_Obj_HdgAng: single
  TOS_LCP7_Obj_Hei: single
  TOS_LCP7_Obj_Width: single
  TOS_LCP7_Obj_Len: single
  TOS_LCP7_Obj_Typ: uint8
  TOS_LCP7_Obj_ID: uint8
  TOS_LCP7_Obj_Fusn_Typ: uint8
  AEB_JAVEH_dyFisrtDetn: single
  AEB_JAVEH_dxFisrtDetn: single
  AEB_JAVEH_ObjMeasSts: boolean
  AEB_JAVEH_ObjLifeCycle: uint16
  AEB_JAVEH_ObjExistProb: single
  AEB_JAVEH_ObjIsObstclProb: single
  AEB_JAVEH_dyVari: single
  AEB_JAVEH_dxVari: single
  AEB_JAVEH_ay: single
  AEB_JAVEH_ax: single
  AEB_JAVEH_vy: single
  AEB_JAVEH_vx: single
  AEB_JAVEH_dz: single
  AEB_JAVEH_dy: single
  AEB_JAVEH_ObjMovgOrntn: uint8
  AEB_JAVEH_dx: single
  AEB_JAVEH_ObjMovgSt: uint8
  AEB_JAVEH_ObjYawAng: single
  AEB_JAVEH_ObjHei: single
  AEB_JAVEH_ObjWidth: single
  AEB_JAVEH_ObjTypCamCfmd: boolean
  AEB_JAVEH_ObjLen: single
  AEB_JAVEH_ObjTyp: uint8
  AEB_JAVEH_FusnTyp: uint8
  AEB_JAVEH_ObjID: uint8

IDC_L2_GW1_RAW_BUS = Simulink.Bus(HeaderFile="Rte_Type.h")
  TOS_LCP7_ObjIn_Lane: uint8  % IDC_L2_GW1|1|0|0|3|uint8
  TOS_LCP7_RightLane_Prob: uint8  % IDC_L2_GW1|0.01|0|0|1|single
  TOS_LCP7_CurrLane_Prob: uint8  % IDC_L2_GW1|0.01|0|0|1|single
  TOS_LCP7_LeftLane_Prob: uint8  % IDC_L2_GW1|0.01|0|0|1|single
  TOS_LCP7_Obj_Age: uint16  % IDC_L2_GW1|1|0|0|65535|uint16
  TOS_LCP7_Obj_ObstclProb: uint8  % IDC_L2_GW1|0.03125|0|0|1|single
  TOS_LCP7_Obj_ExistProb: uint8  % IDC_L2_GW1|0.01|0|0|1|single
  TOS_LCP7_Obj_Typ_Prob: uint8  % IDC_L2_GW1|0.01|0|0|1|single
  TOS_LCP7_Obj_Std_HdgAng: uint16  % IDC_L2_GW1|0.01|0|0|3.14|single
  TOS_LCP7_Obj_Std_Width: uint8  % IDC_L2_GW1|0.01|0|0|2|single
  TOS_LCP7_Obj_Std_Len: uint8  % IDC_L2_GW1|0.05|0|0|10|single
  TOS_LCP7_Obj_AY: uint16  % IDC_L2_GW1|0.05|-10.3|-10.3|7.3|single
  TOS_LCP7_Obj_AX: uint16  % IDC_L2_GW1|0.05|-10.3|-10.3|7.3|single
  TOS_LCP7_Obj_Std_VY: uint16  % IDC_L2_GW1|0.05|0|0|50|single
  TOS_LCP7_Obj_Std_VX: uint16  % IDC_L2_GW1|0.05|0|0|130|single
  TOS_LCP7_Obj_Std_DY: uint16  % IDC_L2_GW1|0.05|0|0|100|single
  TOS_LCP7_Obj_Std_DX: uint16  % IDC_L2_GW1|0.05|0|0|250|single
  TOS_LCP7_Obj_Std_AY: uint8  % IDC_L2_GW1|0.05|0|0|7.3|single
  TOS_LCP7_Obj_Std_AX: uint8  % IDC_L2_GW1|0.05|0|0|7.3|single
  TOS_LCP7_Obj_VY: uint16  % IDC_L2_GW1|0.05|-50|-50|50|single
  TOS_LCP7_Obj_VX: uint16  % IDC_L2_GW1|0.05|-120|-120|130|single
  TOS_LCP7_Obj_DY: uint16  % IDC_L2_GW1|0.05|-100|-100|100|single
  TOS_LCP7_Obj_DX: uint16  % IDC_L2_GW1|0.05|-80|-80|200|single
  TOS_LCP7_Obj_MovgSt: uint8  % IDC_L2_GW1|1|0|0|5|uint8
  TOS_LCP7_Obj_Orntn: uint8  % IDC_L2_GW1|1|0|0|10|uint8
  TOS_LCP7_Obj_YawAng: uint16  % IDC_L2_GW1|0.01|-180|-180|180|single
  TOS_LCP7_Obj_HdgAng: uint16  % IDC_L2_GW1|0.01|-180|-180|180|single
  TOS_LCP7_Obj_Hei: uint16  % IDC_L2_GW1|0.01|0.01|0.01|2.95|single
  TOS_LCP7_Obj_Width: uint16  % IDC_L2_GW1|0.01|0.04|0.04|2.98|single
  TOS_LCP7_Obj_Len: uint16  % IDC_L2_GW1|0.05|1.2|1.2|21|single
  TOS_LCP7_Obj_Typ: uint8  % IDC_L2_GW1|1|0|0|8|uint8
  TOS_LCP7_Obj_ID: uint8  % IDC_L2_GW1|1|0|0|80|uint8
  TOS_LCP7_Obj_Fusn_Typ: uint8  % IDC_L2_GW1|1|0|0|63|uint8
  AEB_JAVEH_dyFisrtDetn: uint16  % IDC_L2_GW1|0.125|-128|-128|127.875|single
  AEB_JAVEH_dxFisrtDetn: uint16  % IDC_L2_GW1|0.125|0|0|254.9375|single
  AEB_JAVEH_ObjMeasSts: boolean  % IDC_L2_GW1|1|0|0|1|boolean
  AEB_JAVEH_ObjLifeCycle: uint16  % IDC_L2_GW1|17|0|0|65535|uint16
  AEB_JAVEH_ObjExistProb: uint8  % IDC_L2_GW1|0.015625|0|0|0.98438|single
  AEB_JAVEH_ObjIsObstclProb: uint8  % IDC_L2_GW1|0.03125|0|0|0.96875|single
  AEB_JAVEH_dyVari: uint8  % IDC_L2_GW1|0.0625|0|0|15.5|single
  AEB_JAVEH_dxVari: uint8  % IDC_L2_GW1|0.0625|0|0|15.5|single
  AEB_JAVEH_ay: uint16  % IDC_L2_GW1|0.03125|-16|-16|15.9688|single
  AEB_JAVEH_ax: uint16  % IDC_L2_GW1|0.03125|-16|-16|15.9688|single
  AEB_JAVEH_vy: uint16  % IDC_L2_GW1|0.125|-64|-64|63.875|single
  AEB_JAVEH_vx: uint16  % IDC_L2_GW1|0.0625|-128|-128|127|single
  AEB_JAVEH_dz: uint16  % IDC_L2_GW1|0.05|-102.4|-102.4|102.3|single
  AEB_JAVEH_dy: uint16  % IDC_L2_GW1|0.125|-128|-128|127.875|single
  AEB_JAVEH_ObjMovgOrntn: uint8  % IDC_L2_GW1|1|0|0|3|uint8
  AEB_JAVEH_dx: uint16  % IDC_L2_GW1|0.0625|0|0|255.9375|single
  AEB_JAVEH_ObjMovgSt: uint8  % IDC_L2_GW1|1|0|0|5|uint8
  AEB_JAVEH_ObjYawAng: uint16  % IDC_L2_GW1|0.01|-180|-180|180|single
  AEB_JAVEH_ObjHei: uint16  % IDC_L2_GW1|0.01|0|0|6|single
  AEB_JAVEH_ObjWidth: uint16  % IDC_L2_GW1|0.01|0|0|5|single
  AEB_JAVEH_ObjTypCamCfmd: boolean  % IDC_L2_GW1|1|0|0|1|boolean
  AEB_JAVEH_ObjLen: uint16  % IDC_L2_GW1|0.05|0|0|20|single
  AEB_JAVEH_ObjTyp: uint8  % IDC_L2_GW1|1|0|0|8|uint8
  AEB_JAVEH_FusnTyp: uint8  % IDC_L2_GW1|1|0|0|63|uint8
  AEB_JAVEH_ObjID: uint8  % IDC_L2_GW1|1|0|0|255|uint8

IDC_L2_GW10_MSG_BUS = Simulink.Bus(HeaderFile="Rte_Type.h")
  TOS_LCP0_ObjIn_Lane: uint8
  TOS_LCP0_RightLane_Prob: single
  TOS_LCP0_CurrLane_Prob: single
  TOS_LCP0_LeftLane_Prob: single
  TOS_LCP0_Obj_Age: uint16
  TOS_LCP0_Obj_ObstclProb: single
  TOS_LCP0_Obj_ExistProb: single
  TOS_LCP0_Obj_Typ_Prob: single
  TOS_LCP0_Obj_Std_HdgAng: single
  TOS_LCP0_Obj_Std_Width: single
  TOS_LCP0_Obj_Std_Len: single
  TOS_LCP0_Obj_AY: single
  TOS_LCP0_Obj_AX: single
  TOS_LCP0_Obj_Std_VY: single
  TOS_LCP0_Obj_Std_VX: single
  TOS_LCP0_Obj_Std_DY: single
  TOS_LCP0_Obj_Std_DX: single
  TOS_LCP0_Obj_Std_AY: single
  TOS_LCP0_Obj_Std_AX: single
  TOS_LCP0_Obj_VY: single
  TOS_LCP0_Obj_VX: single
  TOS_LCP0_Obj_DY: single
  TOS_LCP0_Obj_DX: single
  TOS_LCP0_Obj_MovgSt: uint8
  TOS_LCP0_Obj_Orntn: uint8
  TOS_LCP0_Obj_YawAng: single
  TOS_LCP0_Obj_HdgAng: single
  TOS_LCP0_Obj_Hei: single
  TOS_LCP0_Obj_Width: single
  TOS_LCP0_Obj_Len: single
  TOS_LCP0_Obj_Typ: uint8
  TOS_LCP0_Obj_ID: uint8
  VehLgtAccelVld: boolean
  VehLatAccelVld: boolean
  TOS_LCP0_Obj_Fusn_Typ: uint8
  VehYawRate: single
  VehLatAccel: single
  HWA_OK_OFFSwt: boolean
  DrvSBR: boolean
  VehLgtAccel: single
  ObjLatSpdCurvRi: single
  ObjLgtSpdCurvRi: single
  ObjLatPosnCurvRi: single
  ObjLgtPosnCurvRi: single
  RiTarSts: uint8
  ObjIDRi: uint8
  ObjWidthRi: single
  ObjStatyRi: boolean
  ZoneIndRi: uint8
  ObjStsRi: uint8
  ZoneIndLe: uint8
  ObjStsLe: uint8
  ObjRinRi: uint8
  ObjLenLe: uint8
  ObjWidthLe: single
  ObjStatyLe: boolean
  ObjTTCLe: single
  ObjLatSpdCurvLe: single
  ObjLgtSpdCurvLe: single
  ObjLatPosnCurvLe: single
  ObjIDLe: uint8
  ObjLgtPosnCurvLe: single
  RSDS_TrailerSts: boolean
  RSDS_LCAResp: boolean
  RSDS_DOWResp: boolean
  RSDS_RCWResp: boolean
  RSDS_RCTAResp: boolean
  RSDS_RCTABrkResp: boolean
  LeTarSts: uint8
  RSDS_IPSoundReq: uint8
  RSDS_RCW_Trigger: uint8
  RSDS_ErrSts: boolean
  RSDS_BrkgTrig: boolean
  RSDS_BliSts: boolean
  RSDS_LEDLightReqLeft: uint8
  RSDS_LEDLightReqRight: uint8
  APS_WorkSts: uint8
  RSDS_Brk_ErrSts: boolean
  RSDS_BrkgReq: boolean
  RSDS_BrkgReqVal: single

IDC_L2_GW10_RAW_BUS = Simulink.Bus(HeaderFile="Rte_Type.h")
  TOS_LCP0_ObjIn_Lane: uint8  % IDC_L2_GW10|1|0|0|3|uint8
  TOS_LCP0_RightLane_Prob: uint8  % IDC_L2_GW10|0.01|0|0|1|single
  TOS_LCP0_CurrLane_Prob: uint8  % IDC_L2_GW10|0.01|0|0|1|single
  TOS_LCP0_LeftLane_Prob: uint8  % IDC_L2_GW10|0.01|0|0|1|single
  TOS_LCP0_Obj_Age: uint16  % IDC_L2_GW10|1|0|0|65535|uint16
  TOS_LCP0_Obj_ObstclProb: uint8  % IDC_L2_GW10|0.03125|0|0|1|single
  TOS_LCP0_Obj_ExistProb: uint8  % IDC_L2_GW10|0.01|0|0|1|single
  TOS_LCP0_Obj_Typ_Prob: uint8  % IDC_L2_GW10|0.01|0|0|1|single
  TOS_LCP0_Obj_Std_HdgAng: uint16  % IDC_L2_GW10|0.01|0|0|3.14|single
  TOS_LCP0_Obj_Std_Width: uint8  % IDC_L2_GW10|0.01|0|0|2|single
  TOS_LCP0_Obj_Std_Len: uint8  % IDC_L2_GW10|0.05|0|0|10|single
  TOS_LCP0_Obj_AY: uint16  % IDC_L2_GW10|0.05|-10.3|-10.3|7.3|single
  TOS_LCP0_Obj_AX: uint16  % IDC_L2_GW10|0.05|-10.3|-10.3|7.3|single
  TOS_LCP0_Obj_Std_VY: uint16  % IDC_L2_GW10|0.05|0|0|50|single
  TOS_LCP0_Obj_Std_VX: uint16  % IDC_L2_GW10|0.05|0|0|130|single
  TOS_LCP0_Obj_Std_DY: uint16  % IDC_L2_GW10|0.05|0|0|100|single
  TOS_LCP0_Obj_Std_DX: uint16  % IDC_L2_GW10|0.05|0|0|250|single
  TOS_LCP0_Obj_Std_AY: uint8  % IDC_L2_GW10|0.05|0|0|7.3|single
  TOS_LCP0_Obj_Std_AX: uint8  % IDC_L2_GW10|0.05|0|0|7.3|single
  TOS_LCP0_Obj_VY: uint16  % IDC_L2_GW10|0.05|-50|-50|50|single
  TOS_LCP0_Obj_VX: uint16  % IDC_L2_GW10|0.05|-120|-120|130|single
  TOS_LCP0_Obj_DY: uint16  % IDC_L2_GW10|0.05|-100|-100|100|single
  TOS_LCP0_Obj_DX: uint16  % IDC_L2_GW10|0.05|-80|-80|200|single
  TOS_LCP0_Obj_MovgSt: uint8  % IDC_L2_GW10|1|0|0|5|uint8
  TOS_LCP0_Obj_Orntn: uint8  % IDC_L2_GW10|1|0|0|10|uint8
  TOS_LCP0_Obj_YawAng: uint16  % IDC_L2_GW10|0.01|-180|-180|180|single
  TOS_LCP0_Obj_HdgAng: uint16  % IDC_L2_GW10|0.01|-180|-180|180|single
  TOS_LCP0_Obj_Hei: uint16  % IDC_L2_GW10|0.01|0.01|0.01|2.95|single
  TOS_LCP0_Obj_Width: uint16  % IDC_L2_GW10|0.01|0.04|0.04|2.98|single
  TOS_LCP0_Obj_Len: uint16  % IDC_L2_GW10|0.05|1.2|1.2|21|single
  TOS_LCP0_Obj_Typ: uint8  % IDC_L2_GW10|1|0|0|8|uint8
  TOS_LCP0_Obj_ID: uint8  % IDC_L2_GW10|1|0|0|80|uint8
  VehLgtAccelVld: boolean  % IDC_L2_GW10|1|0|0|1|boolean
  VehLatAccelVld: boolean  % IDC_L2_GW10|1|0|0|1|boolean
  TOS_LCP0_Obj_Fusn_Typ: uint8  % IDC_L2_GW10|1|0|0|63|uint8
  VehYawRate: uint16  % IDC_L2_GW10|0.00024|-2.093|-2.093|2.093|single
  VehLatAccel: uint16  % IDC_L2_GW10|0.00098|-21.592|-21.592|21.592|single
  HWA_OK_OFFSwt: boolean  % IDC_L2_GW10|1|0|0|1|boolean
  DrvSBR: boolean  % IDC_L2_GW10|1|0|0|1|boolean
  VehLgtAccel: uint16  % IDC_L2_GW10|0.00098|-21.592|-21.592|21.592|single
  ObjLatSpdCurvRi: uint8  % IDC_L2_GW10|0.1|-6.4|-6.4|6.3|single
  ObjLgtSpdCurvRi: uint16  % IDC_L2_GW10|0.1|-10|-10|92.3|single
  ObjLatPosnCurvRi: uint8  % IDC_L2_GW10|0.1|-12.8|-12.8|12.7|single
  ObjLgtPosnCurvRi: uint16  % IDC_L2_GW10|0.1|-92.3|-92.3|10|single
  RiTarSts: uint8  % IDC_L2_GW10|1|0|0|3|uint8
  ObjIDRi: uint8  % IDC_L2_GW10|1|0|0|63|uint8
  ObjWidthRi: uint8  % IDC_L2_GW10|0.5|0|0|3.5|single
  ObjStatyRi: boolean  % IDC_L2_GW10|1|0|0|1|boolean
  ZoneIndRi: uint8  % IDC_L2_GW10|1|0|0|3|uint8
  ObjStsRi: uint8  % IDC_L2_GW10|1|0|0|3|uint8
  ZoneIndLe: uint8  % IDC_L2_GW10|1|0|0|3|uint8
  ObjStsLe: uint8  % IDC_L2_GW10|1|0|0|3|uint8
  ObjRinRi: uint8  % IDC_L2_GW10|1|0|0|15|uint8
  ObjLenLe: uint8  % IDC_L2_GW10|1|0|0|15|uint8
  ObjWidthLe: uint8  % IDC_L2_GW10|0.5|0|0|3.5|single
  ObjStatyLe: boolean  % IDC_L2_GW10|1|0|0|1|boolean
  ObjTTCLe: uint8  % IDC_L2_GW10|0.1|0|0|12.7|single
  ObjLatSpdCurvLe: uint8  % IDC_L2_GW10|0.1|-6.4|-6.4|6.3|single
  ObjLgtSpdCurvLe: uint16  % IDC_L2_GW10|0.1|-10|-10|92.3|single
  ObjLatPosnCurvLe: uint8  % IDC_L2_GW10|0.1|-12.8|-12.8|12.7|single
  ObjIDLe: uint8  % IDC_L2_GW10|1|0|0|63|uint8
  ObjLgtPosnCurvLe: uint16  % IDC_L2_GW10|0.1|-92.3|-92.3|10|single
  RSDS_TrailerSts: boolean  % IDC_L2_GW10|1|0|0|1|boolean
  RSDS_LCAResp: boolean  % IDC_L2_GW10|1|0|0|1|boolean
  RSDS_DOWResp: boolean  % IDC_L2_GW10|1|0|0|1|boolean
  RSDS_RCWResp: boolean  % IDC_L2_GW10|1|0|0|1|boolean
  RSDS_RCTAResp: boolean  % IDC_L2_GW10|1|0|0|1|boolean
  RSDS_RCTABrkResp: boolean  % IDC_L2_GW10|1|0|0|1|boolean
  LeTarSts: uint8  % IDC_L2_GW10|1|0|0|3|uint8
  RSDS_IPSoundReq: uint8  % IDC_L2_GW10|1|0|0|3|uint8
  RSDS_RCW_Trigger: uint8  % IDC_L2_GW10|1|0|0|3|uint8
  RSDS_ErrSts: boolean  % IDC_L2_GW10|1|0|0|1|boolean
  RSDS_BrkgTrig: boolean  % IDC_L2_GW10|1|0|0|1|boolean
  RSDS_BliSts: boolean  % IDC_L2_GW10|1|0|0|1|boolean
  RSDS_LEDLightReqLeft: uint8  % IDC_L2_GW10|1|0|0|3|uint8
  RSDS_LEDLightReqRight: uint8  % IDC_L2_GW10|1|0|0|3|uint8
  APS_WorkSts: uint8  % IDC_L2_GW10|1|0|0|7|uint8
  RSDS_Brk_ErrSts: boolean  % IDC_L2_GW10|1|0|0|1|boolean
  RSDS_BrkgReq: boolean  % IDC_L2_GW10|1|0|0|1|boolean
  RSDS_BrkgReqVal: uint8  % IDC_L2_GW10|0.05|-10|-10|2.75|single

IDC_L2_GW11_MSG_BUS = Simulink.Bus(HeaderFile="Rte_Type.h")
  WiprReq_F_PBOX: uint8
  HeadDetn: boolean
  Time_Day: uint8
  DrowsnsLvl_ACC: uint8
  DMSSts: uint8
  DistrctnLvl_ACC: uint8
  DistrctnLvlQlty_ACC: uint8
  EPS_LKATorqOvrlDlvdVld: boolean
  EPS_LKATrqOvlDlvdSts: uint8
  DVRSts: uint8
  EPS_SteerMod: uint8
  EPS_LKATorqOvrlDlvd: single
  EPS_FailSts: uint8
  EPS_TrqSnsrSts: boolean
  EPS_InterferDetd: boolean
  EPS_InterferDetdVld: boolean
  EPS_AvailSts: uint8
  BTCActv_RA: boolean
  ABSFailSts: boolean
  EBDFailSts: boolean
  EBDActv: boolean
  ABSActv: boolean
  EPBErrSts: uint8
  EPBSts: uint8
  MSRActv_RA: boolean
  PTCActv_RA: boolean
  ESPFailSts: boolean
  ESP_MasterCylBrkPressVld: boolean
  MSRActv: boolean
  VDCActv: boolean
  PTCActv: boolean
  BTCActv: boolean
  ESP_MasterCylBrkPress: single
  DrivingModDis: uint8
  ESPFuncOffSts: boolean
  ESPBrkLmpCtrl: boolean
  CDDActv: boolean
  CDDAvailable: boolean
  AWBAvailable: boolean
  AWBActv: boolean
  DrivingModReq_ESP: uint8
  AEBBAActv: boolean
  AEBAvailable: boolean
  ABPAvailable: boolean
  ABPActv: boolean
  ABAavailable: boolean
  ABAactv: boolean
  HDCCtrl: uint8
  RRWheelSpdVld: boolean
  DrvFaiMsg: uint8
  BrkDskOvrheatd: boolean
  NoBrkForce: boolean
  AEBIBActv: boolean
  RRWheelDriveDirection: uint8
  RLWheelSpdVld: boolean
  RLWheelSpd: single
  RLWheelDriveDirection: uint8
  FRWheelSpdVld: boolean
  FRWheelSpd: single
  FRWheelDriveDirection: uint8
  FLWheelSpdVld: boolean
  FLWheelSpd: single
  FLWheelDriveDirection: uint8
  VehSpdVld: boolean
  VehSpd: single
  TOS_LCP2_ObjIn_Lane: uint8
  VehStandstill: uint8
  TOS_LCP2_RightLane_Prob: single
  TOS_LCP2_LeftLane_Prob: single
  TOS_LCP2_CurrLane_Prob: single
  TOS_LCP2_Obj_ObstclProb: single
  TOS_LCP2_Obj_Age: uint16
  TOS_LCP2_Obj_ExistProb: single
  TOS_LCP2_Obj_Typ_Prob: single
  TOS_LCP2_Obj_Std_HdgAng: single
  TOS_LCP2_Obj_Std_Width: single
  TOS_LCP2_Obj_Std_Len: single
  TOS_LCP2_Obj_AY: single
  TOS_LCP2_Obj_AX: single
  TOS_LCP2_Obj_Std_VY: single
  TOS_LCP2_Obj_Std_VX: single
  TOS_LCP2_Obj_Std_DY: single
  TOS_LCP2_Obj_Std_DX: single
  TOS_LCP2_Obj_Std_AY: single
  TOS_LCP2_Obj_Std_AX: single
  TOS_LCP2_Obj_VY: single
  TOS_LCP2_Obj_VX: single
  TOS_LCP2_Obj_DY: single
  TOS_LCP2_Obj_DX: single
  TOS_LCP2_Obj_MovgSt: uint8
  TOS_LCP2_Obj_Orntn: uint8
  TOS_LCP2_Obj_YawAng: single
  TOS_LCP2_Obj_HdgAng: single
  TOS_LCP2_Obj_Hei: single
  TOS_LCP2_Obj_Width: single
  TOS_LCP2_Obj_Typ: uint8
  TOS_LCP2_Obj_Len: single
  TOS_LCP2_Obj_ID: uint8
  DrvDoorSts: boolean
  HazardLmpSwtSts: boolean
  TOS_LCP2_Obj_Fusn_Typ: uint8
  EPS_DrvInpTrqVal_HighReslolution: single

IDC_L2_GW11_RAW_BUS = Simulink.Bus(HeaderFile="Rte_Type.h")
  WiprReq_F_PBOX: uint8  % IDC_L2_GW11|1|0|0|7|uint8
  HeadDetn: boolean  % IDC_L2_GW11|1|0|0|1|boolean
  Time_Day: uint8  % IDC_L2_GW11|1|0|0|31|uint8
  DrowsnsLvl_ACC: uint8  % IDC_L2_GW11|1|0|0|7|uint8
  DMSSts: uint8  % IDC_L2_GW11|1|0|0|7|uint8
  DistrctnLvl_ACC: uint8  % IDC_L2_GW11|1|0|0|7|uint8
  DistrctnLvlQlty_ACC: uint8  % IDC_L2_GW11|1|0|0|100|uint8
  EPS_LKATorqOvrlDlvdVld: boolean  % IDC_L2_GW11|1|0|0|1|boolean
  EPS_LKATrqOvlDlvdSts: uint8  % IDC_L2_GW11|1|0|0|3|uint8
  DVRSts: uint8  % IDC_L2_GW11|1|0|0|15|uint8
  EPS_SteerMod: uint8  % IDC_L2_GW11|1|0|0|7|uint8
  EPS_LKATorqOvrlDlvd: uint16  % IDC_L2_GW11|0.01|-15|-15|15|single
  EPS_FailSts: uint8  % IDC_L2_GW11|1|0|0|3|uint8
  EPS_TrqSnsrSts: boolean  % IDC_L2_GW11|1|0|0|1|boolean
  EPS_InterferDetd: boolean  % IDC_L2_GW11|1|0|0|1|boolean
  EPS_InterferDetdVld: boolean  % IDC_L2_GW11|1|0|0|1|boolean
  EPS_AvailSts: uint8  % IDC_L2_GW11|1|0|0|3|uint8
  BTCActv_RA: boolean  % IDC_L2_GW11|1|0|0|1|boolean
  ABSFailSts: boolean  % IDC_L2_GW11|1|0|0|1|boolean
  EBDFailSts: boolean  % IDC_L2_GW11|1|0|0|1|boolean
  EBDActv: boolean  % IDC_L2_GW11|1|0|0|1|boolean
  ABSActv: boolean  % IDC_L2_GW11|1|0|0|1|boolean
  EPBErrSts: uint8  % IDC_L2_GW11|1|0|0|3|uint8
  EPBSts: uint8  % IDC_L2_GW11|1|0|0|3|uint8
  MSRActv_RA: boolean  % IDC_L2_GW11|1|0|0|1|boolean
  PTCActv_RA: boolean  % IDC_L2_GW11|1|0|0|1|boolean
  ESPFailSts: boolean  % IDC_L2_GW11|1|0|0|1|boolean
  ESP_MasterCylBrkPressVld: boolean  % IDC_L2_GW11|1|0|0|1|boolean
  MSRActv: boolean  % IDC_L2_GW11|1|0|0|1|boolean
  VDCActv: boolean  % IDC_L2_GW11|1|0|0|1|boolean
  PTCActv: boolean  % IDC_L2_GW11|1|0|0|1|boolean
  BTCActv: boolean  % IDC_L2_GW11|1|0|0|1|boolean
  ESP_MasterCylBrkPress: uint16  % IDC_L2_GW11|0.03125|-42.5|-42.5|425|single
  DrivingModDis: uint8  % IDC_L2_GW11|1|0|0|31|uint8
  ESPFuncOffSts: boolean  % IDC_L2_GW11|1|0|0|1|boolean
  ESPBrkLmpCtrl: boolean  % IDC_L2_GW11|1|0|0|1|boolean
  CDDActv: boolean  % IDC_L2_GW11|1|0|0|1|boolean
  CDDAvailable: boolean  % IDC_L2_GW11|1|0|0|1|boolean
  AWBAvailable: boolean  % IDC_L2_GW11|1|0|0|1|boolean
  AWBActv: boolean  % IDC_L2_GW11|1|0|0|1|boolean
  DrivingModReq_ESP: uint8  % IDC_L2_GW11|1|0|0|31|uint8
  AEBBAActv: boolean  % IDC_L2_GW11|1|0|0|1|boolean
  AEBAvailable: boolean  % IDC_L2_GW11|1|0|0|1|boolean
  ABPAvailable: boolean  % IDC_L2_GW11|1|0|0|1|boolean
  ABPActv: boolean  % IDC_L2_GW11|1|0|0|1|boolean
  ABAavailable: boolean  % IDC_L2_GW11|1|0|0|1|boolean
  ABAactv: boolean  % IDC_L2_GW11|1|0|0|1|boolean
  HDCCtrl: uint8  % IDC_L2_GW11|1|0|0|2|uint8
  RRWheelSpdVld: boolean  % IDC_L2_GW11|1|0|0|1|boolean
  DrvFaiMsg: uint8  % IDC_L2_GW11|1|0|0|15|uint8
  BrkDskOvrheatd: boolean  % IDC_L2_GW11|1|0|0|1|boolean
  NoBrkForce: boolean  % IDC_L2_GW11|1|0|0|1|boolean
  AEBIBActv: boolean  % IDC_L2_GW11|1|0|0|1|boolean
  RRWheelDriveDirection: uint8  % IDC_L2_GW11|1|0|0|3|uint8
  RLWheelSpdVld: boolean  % IDC_L2_GW11|1|0|0|1|boolean
  RLWheelSpd: uint16  % IDC_L2_GW11|0.05625|0|0|299.9812|single
  RLWheelDriveDirection: uint8  % IDC_L2_GW11|1|0|0|3|uint8
  FRWheelSpdVld: boolean  % IDC_L2_GW11|1|0|0|1|boolean
  FRWheelSpd: uint16  % IDC_L2_GW11|0.05625|0|0|299.9812|single
  FRWheelDriveDirection: uint8  % IDC_L2_GW11|1|0|0|3|uint8
  FLWheelSpdVld: boolean  % IDC_L2_GW11|1|0|0|1|boolean
  FLWheelSpd: uint16  % IDC_L2_GW11|0.05625|0|0|299.9812|single
  FLWheelDriveDirection: uint8  % IDC_L2_GW11|1|0|0|3|uint8
  VehSpdVld: boolean  % IDC_L2_GW11|1|0|0|1|boolean
  VehSpd: uint16  % IDC_L2_GW11|0.05625|0|0|299.9812|single
  TOS_LCP2_ObjIn_Lane: uint8  % IDC_L2_GW11|1|0|0|3|uint8
  VehStandstill: uint8  % IDC_L2_GW11|1|0|0|3|uint8
  TOS_LCP2_RightLane_Prob: uint8  % IDC_L2_GW11|0.01|0|0|1|single
  TOS_LCP2_LeftLane_Prob: uint8  % IDC_L2_GW11|0.01|0|0|1|single
  TOS_LCP2_CurrLane_Prob: uint8  % IDC_L2_GW11|0.01|0|0|1|single
  TOS_LCP2_Obj_ObstclProb: uint8  % IDC_L2_GW11|0.03125|0|0|1|single
  TOS_LCP2_Obj_Age: uint16  % IDC_L2_GW11|1|0|0|65535|uint16
  TOS_LCP2_Obj_ExistProb: uint8  % IDC_L2_GW11|0.01|0|0|1|single
  TOS_LCP2_Obj_Typ_Prob: uint8  % IDC_L2_GW11|0.01|0|0|1|single
  TOS_LCP2_Obj_Std_HdgAng: uint16  % IDC_L2_GW11|0.01|0|0|3.14|single
  TOS_LCP2_Obj_Std_Width: uint8  % IDC_L2_GW11|0.01|0|0|2|single
  TOS_LCP2_Obj_Std_Len: uint8  % IDC_L2_GW11|0.05|0|0|10|single
  TOS_LCP2_Obj_AY: uint16  % IDC_L2_GW11|0.05|-10.3|-10.3|7.3|single
  TOS_LCP2_Obj_AX: uint16  % IDC_L2_GW11|0.05|-10.3|-10.3|7.3|single
  TOS_LCP2_Obj_Std_VY: uint16  % IDC_L2_GW11|0.05|0|0|50|single
  TOS_LCP2_Obj_Std_VX: uint16  % IDC_L2_GW11|0.05|0|0|130|single
  TOS_LCP2_Obj_Std_DY: uint16  % IDC_L2_GW11|0.05|0|0|100|single
  TOS_LCP2_Obj_Std_DX: uint16  % IDC_L2_GW11|0.05|0|0|250|single
  TOS_LCP2_Obj_Std_AY: uint8  % IDC_L2_GW11|0.05|0|0|7.3|single
  TOS_LCP2_Obj_Std_AX: uint8  % IDC_L2_GW11|0.05|0|0|7.3|single
  TOS_LCP2_Obj_VY: uint16  % IDC_L2_GW11|0.05|-50|-50|50|single
  TOS_LCP2_Obj_VX: uint16  % IDC_L2_GW11|0.05|-120|-120|130|single
  TOS_LCP2_Obj_DY: uint16  % IDC_L2_GW11|0.05|-100|-100|100|single
  TOS_LCP2_Obj_DX: uint16  % IDC_L2_GW11|0.05|-80|-80|200|single
  TOS_LCP2_Obj_MovgSt: uint8  % IDC_L2_GW11|1|0|0|5|uint8
  TOS_LCP2_Obj_Orntn: uint8  % IDC_L2_GW11|1|0|0|10|uint8
  TOS_LCP2_Obj_YawAng: uint16  % IDC_L2_GW11|0.01|-180|-180|180|single
  TOS_LCP2_Obj_HdgAng: uint16  % IDC_L2_GW11|0.01|-180|-180|180|single
  TOS_LCP2_Obj_Hei: uint16  % IDC_L2_GW11|0.01|0.01|0.01|2.95|single
  TOS_LCP2_Obj_Width: uint16  % IDC_L2_GW11|0.01|0.04|0.04|2.98|single
  TOS_LCP2_Obj_Typ: uint8  % IDC_L2_GW11|1|0|0|8|uint8
  TOS_LCP2_Obj_Len: uint16  % IDC_L2_GW11|0.05|1.2|1.2|21|single
  TOS_LCP2_Obj_ID: uint8  % IDC_L2_GW11|1|0|0|80|uint8
  DrvDoorSts: boolean  % IDC_L2_GW11|1|0|0|1|boolean
  HazardLmpSwtSts: boolean  % IDC_L2_GW11|1|0|0|1|boolean
  TOS_LCP2_Obj_Fusn_Typ: uint8  % IDC_L2_GW11|1|0|0|63|uint8
  EPS_DrvInpTrqVal_HighReslolution: uint16  % IDC_L2_GW11|0.015625|-31.9844|-31.9844|32|single

IDC_L2_GW12_MSG_BUS = Simulink.Bus(HeaderFile="Rte_Type.h")
  LCKSwtReq: boolean
  NavRoadType: uint8
  HWA_SwtReq: boolean
  AEB_JASwtReq: boolean
  TGS_LEVER: uint8
  IP_Err: boolean
  AEB_PedSwtReq: boolean
  AEB_VehSwtReq: boolean
  LKASwtReq: boolean
  TARGET_GEAR: uint8
  CURRENT_GEAR: uint8
  EngState_PHEV: uint8
  CurrentGearValid: boolean
  SHIFT_IN_PROGRESS: boolean
  TargetGearValid: boolean
  VehDynYawRateVld: boolean
  IP_VehTotDistance: single
  SteerWheelSpdSign: boolean
  SAS_Sts: uint8
  SteerWheelAngSign: boolean
  SteerWheelSpd: single
  AEB_JAFuncSts: uint8
  AEB_JA_Warn: uint8
  HoodSts_F_Pbox: boolean
  LTurnLmpSwtSts: boolean
  RTurnLmpSwtSts: boolean
  SteerWheelAng: single
  AEB_VehTrig: boolean
  AEB_PedTrig: boolean
  FCW_AEB_VehFctSts: uint8
  FCW_AEB_PedFctSts: uint8
  FCW_Warn: uint8
  AEB_ObjSty: uint8
  AEB_PedResp: boolean
  AEB_VehResp: boolean
  FCW_Snvty: uint8
  AEB_JA_Resp: boolean
  AEB_AWB_Level: uint8
  AEB_ABP_Req: boolean
  AEB_BrkReqFunc: uint8
  AEB_AWB_Req: boolean
  AEB_ABA_Level: uint8
  AEB_ABA_Req: boolean
  EBA_TgtDecel_Req: boolean
  AEB_VehHldReq: boolean
  AEB_TgtDecel_Req: boolean
  AEB_TgtDecel_ReqValue: single
  ECMRespACC: boolean
  ECMACCInterface: boolean
  EngState: uint8
  AEBObjDrvby: uint8
  AccelPedlPosnDiagc: single
  EngSpdVldty: uint8
  AccPedalOverride: boolean
  DrvEngTrqReqVld: boolean
  BrkPedalSts: uint8
  EngSpd: single
  DrvEngTrqReq: single
  AEB_JABrkTrig: uint8
  NetEngTrq: single
  TOS_LCP1_ObjIn_Lane: uint8
  TOS_LCP1_LeftLane_Prob: single
  TOS_LCP1_RightLane_Prob: single
  TOS_LCP1_CurrLane_Prob: single
  TOS_LCP1_Obj_Age: uint16
  TOS_LCP1_Obj_ObstclProb: single
  TOS_LCP1_Obj_ExistProb: single
  TOS_LCP1_Obj_Typ_Prob: single
  TOS_LCP1_Obj_Std_HdgAng: single
  TOS_LCP1_Obj_Std_Width: single
  TOS_LCP1_Obj_Std_Len: single
  TOS_LCP1_Obj_AY: single
  TOS_LCP1_Obj_AX: single
  TOS_LCP1_Obj_Std_VY: single
  TOS_LCP1_Obj_Std_VX: single
  TOS_LCP1_Obj_Std_DY: single
  TOS_LCP1_Obj_Std_DX: single
  TOS_LCP1_Obj_Std_AY: single
  TOS_LCP1_Obj_Std_AX: single
  TOS_LCP1_Obj_VY: single
  TOS_LCP1_Obj_VX: single
  TOS_LCP1_Obj_DY: single
  TOS_LCP1_Obj_DX: single
  TOS_LCP1_Obj_MovgSt: uint8
  TOS_LCP1_Obj_Orntn: uint8
  TOS_LCP1_Obj_YawAng: single
  TOS_LCP1_Obj_HdgAng: single
  TOS_LCP1_Obj_Hei: single
  TOS_LCP1_Obj_Width: single
  TOS_LCP1_Obj_Len: single
  TOS_LCP1_Obj_Typ: uint8
  TOS_LCP1_Obj_Fusn_Typ: uint8
  TOS_LCP1_Obj_ID: uint8

IDC_L2_GW12_RAW_BUS = Simulink.Bus(HeaderFile="Rte_Type.h")
  LCKSwtReq: boolean  % IDC_L2_GW12|1|0|0|1|boolean
  NavRoadType: uint8  % IDC_L2_GW12|1|0|0|15|uint8
  HWA_SwtReq: boolean  % IDC_L2_GW12|1|0|0|1|boolean
  AEB_JASwtReq: boolean  % IDC_L2_GW12|1|0|0|1|boolean
  TGS_LEVER: uint8  % IDC_L2_GW12|1|0|0|15|uint8
  IP_Err: boolean  % IDC_L2_GW12|1|0|0|1|boolean
  AEB_PedSwtReq: boolean  % IDC_L2_GW12|1|0|0|1|boolean
  AEB_VehSwtReq: boolean  % IDC_L2_GW12|1|0|0|1|boolean
  LKASwtReq: boolean  % IDC_L2_GW12|1|0|0|1|boolean
  TARGET_GEAR: uint8  % IDC_L2_GW12|1|0|0|15|uint8
  CURRENT_GEAR: uint8  % IDC_L2_GW12|1|0|0|15|uint8
  EngState_PHEV: uint8  % IDC_L2_GW12|1|0|0|7|uint8
  CurrentGearValid: boolean  % IDC_L2_GW12|1|0|0|1|boolean
  SHIFT_IN_PROGRESS: boolean  % IDC_L2_GW12|1|0|0|1|boolean
  TargetGearValid: boolean  % IDC_L2_GW12|1|0|0|1|boolean
  VehDynYawRateVld: boolean  % IDC_L2_GW12|1|0|0|1|boolean
  IP_VehTotDistance: uint32  % IDC_L2_GW12|0.1|0|0|999999.9|single
  SteerWheelSpdSign: boolean  % IDC_L2_GW12|1|0|0|1|boolean
  SAS_Sts: uint8  % IDC_L2_GW12|1|0|0|3|uint8
  SteerWheelAngSign: boolean  % IDC_L2_GW12|1|0|0|1|boolean
  SteerWheelSpd: uint16  % IDC_L2_GW12|0.1|0|0|1016|single
  AEB_JAFuncSts: uint8  % IDC_L2_GW12|1|0|0|3|uint8
  AEB_JA_Warn: uint8  % IDC_L2_GW12|1|0|0|3|uint8
  HoodSts_F_Pbox: boolean  % IDC_L2_GW12|1|0|0|1|boolean
  LTurnLmpSwtSts: boolean  % IDC_L2_GW12|1|0|0|1|boolean
  RTurnLmpSwtSts: boolean  % IDC_L2_GW12|1|0|0|1|boolean
  SteerWheelAng: uint16  % IDC_L2_GW12|0.1|0|0|780|single
  AEB_VehTrig: boolean  % IDC_L2_GW12|1|0|0|1|boolean
  AEB_PedTrig: boolean  % IDC_L2_GW12|1|0|0|1|boolean
  FCW_AEB_VehFctSts: uint8  % IDC_L2_GW12|1|0|0|3|uint8
  FCW_AEB_PedFctSts: uint8  % IDC_L2_GW12|1|0|0|3|uint8
  FCW_Warn: uint8  % IDC_L2_GW12|1|0|0|3|uint8
  AEB_ObjSty: uint8  % IDC_L2_GW12|1|0|0|7|uint8
  AEB_PedResp: boolean  % IDC_L2_GW12|1|0|0|1|boolean
  AEB_VehResp: boolean  % IDC_L2_GW12|1|0|0|1|boolean
  FCW_Snvty: uint8  % IDC_L2_GW12|1|0|0|3|uint8
  AEB_JA_Resp: boolean  % IDC_L2_GW12|1|0|0|1|boolean
  AEB_AWB_Level: uint8  % IDC_L2_GW12|1|0|0|15|uint8
  AEB_ABP_Req: boolean  % IDC_L2_GW12|1|0|0|1|boolean
  AEB_BrkReqFunc: uint8  % IDC_L2_GW12|1|0|0|7|uint8
  AEB_AWB_Req: boolean  % IDC_L2_GW12|1|0|0|1|boolean
  AEB_ABA_Level: uint8  % IDC_L2_GW12|1|0|0|3|uint8
  AEB_ABA_Req: boolean  % IDC_L2_GW12|1|0|0|1|boolean
  EBA_TgtDecel_Req: boolean  % IDC_L2_GW12|1|0|0|1|boolean
  AEB_VehHldReq: boolean  % IDC_L2_GW12|1|0|0|1|boolean
  AEB_TgtDecel_Req: boolean  % IDC_L2_GW12|1|0|0|1|boolean
  AEB_TgtDecel_ReqValue: uint16  % IDC_L2_GW12|0.000488|-16|-16|16|single
  ECMRespACC: boolean  % IDC_L2_GW12|1|0|0|1|boolean
  ECMACCInterface: boolean  % IDC_L2_GW12|1|0|0|1|boolean
  EngState: uint8  % IDC_L2_GW12|1|0|0|3|uint8
  AEBObjDrvby: uint8  % IDC_L2_GW12|1|0|0|31|uint8
  AccelPedlPosnDiagc: uint8  % IDC_L2_GW12|0.3937|0|0|100.3935|single
  EngSpdVldty: uint8  % IDC_L2_GW12|1|0|0|2|uint8
  AccPedalOverride: boolean  % IDC_L2_GW12|1|0|0|1|boolean
  DrvEngTrqReqVld: boolean  % IDC_L2_GW12|1|0|0|1|boolean
  BrkPedalSts: uint8  % IDC_L2_GW12|1|0|0|3|uint8
  EngSpd: uint16  % IDC_L2_GW12|0.125|0|0|8191.875|single
  DrvEngTrqReq: uint16  % IDC_L2_GW12|0.0030518|-100|-100|99.9997|single
  AEB_JABrkTrig: uint8  % IDC_L2_GW12|1|0|0|3|uint8
  NetEngTrq: uint16  % IDC_L2_GW12|0.0030518|-100|-100|99.9967|single
  TOS_LCP1_ObjIn_Lane: uint8  % IDC_L2_GW12|1|0|0|3|uint8
  TOS_LCP1_LeftLane_Prob: uint8  % IDC_L2_GW12|0.01|0|0|1|single
  TOS_LCP1_RightLane_Prob: uint8  % IDC_L2_GW12|0.01|0|0|1|single
  TOS_LCP1_CurrLane_Prob: uint8  % IDC_L2_GW12|0.01|0|0|1|single
  TOS_LCP1_Obj_Age: uint16  % IDC_L2_GW12|1|0|0|65535|uint16
  TOS_LCP1_Obj_ObstclProb: uint8  % IDC_L2_GW12|0.03125|0|0|1|single
  TOS_LCP1_Obj_ExistProb: uint8  % IDC_L2_GW12|0.01|0|0|1|single
  TOS_LCP1_Obj_Typ_Prob: uint8  % IDC_L2_GW12|0.01|0|0|1|single
  TOS_LCP1_Obj_Std_HdgAng: uint16  % IDC_L2_GW12|0.01|0|0|3.14|single
  TOS_LCP1_Obj_Std_Width: uint8  % IDC_L2_GW12|0.01|0|0|2|single
  TOS_LCP1_Obj_Std_Len: uint8  % IDC_L2_GW12|0.05|0|0|10|single
  TOS_LCP1_Obj_AY: uint16  % IDC_L2_GW12|0.05|-10.3|-10.3|7.3|single
  TOS_LCP1_Obj_AX: uint16  % IDC_L2_GW12|0.05|-10.3|-10.3|7.3|single
  TOS_LCP1_Obj_Std_VY: uint16  % IDC_L2_GW12|0.05|0|0|50|single
  TOS_LCP1_Obj_Std_VX: uint16  % IDC_L2_GW12|0.05|0|0|130|single
  TOS_LCP1_Obj_Std_DY: uint16  % IDC_L2_GW12|0.05|0|0|100|single
  TOS_LCP1_Obj_Std_DX: uint16  % IDC_L2_GW12|0.05|0|0|250|single
  TOS_LCP1_Obj_Std_AY: uint8  % IDC_L2_GW12|0.05|0|0|7.3|single
  TOS_LCP1_Obj_Std_AX: uint8  % IDC_L2_GW12|0.05|0|0|7.3|single
  TOS_LCP1_Obj_VY: uint16  % IDC_L2_GW12|0.05|-50|-50|50|single
  TOS_LCP1_Obj_VX: uint16  % IDC_L2_GW12|0.05|-120|-120|130|single
  TOS_LCP1_Obj_DY: uint16  % IDC_L2_GW12|0.05|-100|-100|100|single
  TOS_LCP1_Obj_DX: uint16  % IDC_L2_GW12|0.05|-80|-80|200|single
  TOS_LCP1_Obj_MovgSt: uint8  % IDC_L2_GW12|1|0|0|5|uint8
  TOS_LCP1_Obj_Orntn: uint8  % IDC_L2_GW12|1|0|0|10|uint8
  TOS_LCP1_Obj_YawAng: uint16  % IDC_L2_GW12|0.01|-180|-180|180|single
  TOS_LCP1_Obj_HdgAng: uint16  % IDC_L2_GW12|0.01|-180|-180|180|single
  TOS_LCP1_Obj_Hei: uint16  % IDC_L2_GW12|0.01|0.01|0.01|2.95|single
  TOS_LCP1_Obj_Width: uint16  % IDC_L2_GW12|0.01|0.04|0.04|2.98|single
  TOS_LCP1_Obj_Len: uint16  % IDC_L2_GW12|0.05|1.2|1.2|21|single
  TOS_LCP1_Obj_Typ: uint8  % IDC_L2_GW12|1|0|0|8|uint8
  TOS_LCP1_Obj_Fusn_Typ: uint8  % IDC_L2_GW12|1|0|0|63|uint8
  TOS_LCP1_Obj_ID: uint8  % IDC_L2_GW12|1|0|0|80|uint8

IDC_L2_GW13_MSG_BUS = Simulink.Bus(HeaderFile="Rte_Type.h")
  PLAN_ALC_sts: uint8
  NOH_Act_Resp: boolean
  NOH_Sts: uint8
  LongCtrl_ArbFlag: uint8
  PLAN_ALC_LcReason: uint8
  PLAN_ALC_LcCancelReason: uint8
  RRWheelDriveDirection: uint8
  RRWheelSpdVld: boolean
  RLWheelDriveDirection: uint8
  RLWheelSpdVld: boolean
  RLWheelSpd: single
  FRWheelDriveDirection: uint8
  FRWheelSpdVld: boolean
  FRWheelSpd: single
  VehStandstill: uint8
  FLWheelDriveDirection: uint8
  FLWheelSpdVld: boolean
  FLWheelSpd: single
  VehSpdVld: boolean
  VehSpd: single
  AEBObjOverlap: uint8
  RRWheelSpd: single
  PedObjState: uint8
  MapDataValid: boolean
  DrvrSts: uint8
  ACC_SOSReq: uint8
  BrdgDst: uint16
  RadarDrvrAttentive: boolean
  HWARecReq: uint8
  TunnelDst: uint16
  DrvgOnRiLane: uint8
  CurveDst: uint16
  NavSpdLimUnit: uint8
  SpdLimit: uint8
  RampDst: uint16
  RoadCrvtFar: single
  SpdLimitDst: uint16
  RoadCrvt: single
  HandsoffDetd: uint8
  DrvgOnHiWay: uint8
  RadarHorMisalign: single
  TOS_LCP8_ObjIn_Lane: uint8
  TOS_LCP8_LeftLane_Prob: single
  TOS_LCP8_RightLane_Prob: single
  TOS_LCP8_CurrLane_Prob: single
  TOS_LCP8_Obj_Age: uint16
  TOS_LCP8_Obj_ObstclProb: single
  TOS_LCP8_Obj_ExistProb: single
  TOS_LCP8_Obj_Typ_Prob: single
  TOS_LCP8_Obj_Std_HdgAng: single
  TOS_LCP8_Obj_Std_Width: single
  TOS_LCP8_Obj_Std_Len: single
  TOS_LCP8_Obj_AY: single
  TOS_LCP8_Obj_AX: single
  TOS_LCP8_Obj_Std_VY: single
  TOS_LCP8_Obj_Std_VX: single
  TOS_LCP8_Obj_Std_DY: single
  TOS_LCP8_Obj_Std_DX: single
  TOS_LCP8_Obj_Std_AY: single
  TOS_LCP8_Obj_Std_AX: single
  TOS_LCP8_Obj_VY: single
  TOS_LCP8_Obj_VX: single
  TOS_LCP8_Obj_DY: single
  TOS_LCP8_Obj_DX: single
  TOS_LCP8_Obj_MovgSt: uint8
  TOS_LCP8_Obj_Orntn: uint8
  TOS_LCP8_Obj_YawAng: single
  TOS_LCP8_Obj_HdgAng: single
  TOS_LCP8_Obj_Hei: single
  TOS_LCP8_Obj_Width: single
  TOS_LCP8_Obj_Len: single
  TOS_LCP8_Obj_Typ: uint8
  TOS_LCP8_Obj_Fusn_Typ: uint8
  TOS_LCP8_Obj_ID: uint8

IDC_L2_GW13_RAW_BUS = Simulink.Bus(HeaderFile="Rte_Type.h")
  PLAN_ALC_sts: uint8  % IDC_L2_GW13|1|0|0|3|uint8
  NOH_Act_Resp: boolean  % IDC_L2_GW13|1|0|0|1|boolean
  NOH_Sts: uint8  % IDC_L2_GW13|1|0|0|15|uint8
  LongCtrl_ArbFlag: uint8  % IDC_L2_GW13|1|0|0|31|uint8
  PLAN_ALC_LcReason: uint8  % IDC_L2_GW13|1|0|0|4|uint8
  PLAN_ALC_LcCancelReason: uint8  % IDC_L2_GW13|1|0|0|64|uint8
  RRWheelDriveDirection: uint8  % IDC_L2_GW13|1|0|0|3|uint8
  RRWheelSpdVld: boolean  % IDC_L2_GW13|1|0|0|1|boolean
  RLWheelDriveDirection: uint8  % IDC_L2_GW13|1|0|0|3|uint8
  RLWheelSpdVld: boolean  % IDC_L2_GW13|1|0|0|1|boolean
  RLWheelSpd: uint16  % IDC_L2_GW13|0.05625|0|0|299.9812|single
  FRWheelDriveDirection: uint8  % IDC_L2_GW13|1|0|0|3|uint8
  FRWheelSpdVld: boolean  % IDC_L2_GW13|1|0|0|1|boolean
  FRWheelSpd: uint16  % IDC_L2_GW13|0.05625|0|0|299.9812|single
  VehStandstill: uint8  % IDC_L2_GW13|1|0|0|3|uint8
  FLWheelDriveDirection: uint8  % IDC_L2_GW13|1|0|0|3|uint8
  FLWheelSpdVld: boolean  % IDC_L2_GW13|1|0|0|1|boolean
  FLWheelSpd: uint16  % IDC_L2_GW13|0.05625|0|0|299.9812|single
  VehSpdVld: boolean  % IDC_L2_GW13|1|0|0|1|boolean
  VehSpd: uint16  % IDC_L2_GW13|0.05625|0|0|299.9812|single
  AEBObjOverlap: uint8  % IDC_L2_GW13|1|0|0|31|uint8
  RRWheelSpd: uint16  % IDC_L2_GW13|0.05625|0|0|299.9812|single
  PedObjState: uint8  % IDC_L2_GW13|1|0|0|7|uint8
  MapDataValid: boolean  % IDC_L2_GW13|1|0|0|1|boolean
  DrvrSts: uint8  % IDC_L2_GW13|1|0|0|7|uint8
  ACC_SOSReq: uint8  % IDC_L2_GW13|1|0|0|3|uint8
  BrdgDst: uint8  % IDC_L2_GW13|10|0|0|600|uint16
  RadarDrvrAttentive: boolean  % IDC_L2_GW13|1|0|0|1|boolean
  HWARecReq: uint8  % IDC_L2_GW13|1|0|0|255|uint8
  TunnelDst: uint8  % IDC_L2_GW13|10|0|0|600|uint16
  DrvgOnRiLane: uint8  % IDC_L2_GW13|1|0|0|3|uint8
  CurveDst: uint8  % IDC_L2_GW13|10|0|0|600|uint16
  NavSpdLimUnit: uint8  % IDC_L2_GW13|1|0|0|3|uint8
  SpdLimit: uint8  % IDC_L2_GW13|1|0|0|255|uint8
  RampDst: uint8  % IDC_L2_GW13|10|0|0|600|uint16
  RoadCrvtFar: uint16  % IDC_L2_GW13|0.00032|-0.1635|-0.1635|0.16352|single
  SpdLimitDst: uint8  % IDC_L2_GW13|10|0|0|600|uint16
  RoadCrvt: uint16  % IDC_L2_GW13|0.00032|-0.1635|-0.1635|0.16352|single
  HandsoffDetd: uint8  % IDC_L2_GW13|1|0|0|3|uint8
  DrvgOnHiWay: uint8  % IDC_L2_GW13|1|0|0|3|uint8
  RadarHorMisalign: uint16  % IDC_L2_GW13|0.0001|-0.2048|-0.2048|0.2047|single
  TOS_LCP8_ObjIn_Lane: uint8  % IDC_L2_GW13|1|0|0|3|uint8
  TOS_LCP8_LeftLane_Prob: uint8  % IDC_L2_GW13|0.01|0|0|1|single
  TOS_LCP8_RightLane_Prob: uint8  % IDC_L2_GW13|0.01|0|0|1|single
  TOS_LCP8_CurrLane_Prob: uint8  % IDC_L2_GW13|0.01|0|0|1|single
  TOS_LCP8_Obj_Age: uint16  % IDC_L2_GW13|1|0|0|65535|uint16
  TOS_LCP8_Obj_ObstclProb: uint8  % IDC_L2_GW13|0.03125|0|0|1|single
  TOS_LCP8_Obj_ExistProb: uint8  % IDC_L2_GW13|0.01|0|0|1|single
  TOS_LCP8_Obj_Typ_Prob: uint8  % IDC_L2_GW13|0.01|0|0|1|single
  TOS_LCP8_Obj_Std_HdgAng: uint16  % IDC_L2_GW13|0.01|0|0|3.14|single
  TOS_LCP8_Obj_Std_Width: uint8  % IDC_L2_GW13|0.01|0|0|2|single
  TOS_LCP8_Obj_Std_Len: uint8  % IDC_L2_GW13|0.05|0|0|10|single
  TOS_LCP8_Obj_AY: uint16  % IDC_L2_GW13|0.05|-10.3|-10.3|7.3|single
  TOS_LCP8_Obj_AX: uint16  % IDC_L2_GW13|0.05|-10.3|-10.3|7.3|single
  TOS_LCP8_Obj_Std_VY: uint16  % IDC_L2_GW13|0.05|0|0|50|single
  TOS_LCP8_Obj_Std_VX: uint16  % IDC_L2_GW13|0.05|0|0|130|single
  TOS_LCP8_Obj_Std_DY: uint16  % IDC_L2_GW13|0.05|0|0|100|single
  TOS_LCP8_Obj_Std_DX: uint16  % IDC_L2_GW13|0.05|0|0|250|single
  TOS_LCP8_Obj_Std_AY: uint8  % IDC_L2_GW13|0.05|0|0|7.3|single
  TOS_LCP8_Obj_Std_AX: uint8  % IDC_L2_GW13|0.05|0|0|7.3|single
  TOS_LCP8_Obj_VY: uint16  % IDC_L2_GW13|0.05|-50|-50|50|single
  TOS_LCP8_Obj_VX: uint16  % IDC_L2_GW13|0.05|-120|-120|130|single
  TOS_LCP8_Obj_DY: uint16  % IDC_L2_GW13|0.05|-100|-100|100|single
  TOS_LCP8_Obj_DX: uint16  % IDC_L2_GW13|0.05|-80|-80|200|single
  TOS_LCP8_Obj_MovgSt: uint8  % IDC_L2_GW13|1|0|0|5|uint8
  TOS_LCP8_Obj_Orntn: uint8  % IDC_L2_GW13|1|0|0|10|uint8
  TOS_LCP8_Obj_YawAng: uint16  % IDC_L2_GW13|0.01|-180|-180|180|single
  TOS_LCP8_Obj_HdgAng: uint16  % IDC_L2_GW13|0.01|-180|-180|180|single
  TOS_LCP8_Obj_Hei: uint16  % IDC_L2_GW13|0.01|0.01|0.01|2.95|single
  TOS_LCP8_Obj_Width: uint16  % IDC_L2_GW13|0.01|0.04|0.04|2.98|single
  TOS_LCP8_Obj_Len: uint16  % IDC_L2_GW13|0.05|1.2|1.2|21|single
  TOS_LCP8_Obj_Typ: uint8  % IDC_L2_GW13|1|0|0|8|uint8
  TOS_LCP8_Obj_Fusn_Typ: uint8  % IDC_L2_GW13|1|0|0|63|uint8
  TOS_LCP8_Obj_ID: uint8  % IDC_L2_GW13|1|0|0|80|uint8

IDC_L2_GW14_MSG_BUS = Simulink.Bus(HeaderFile="Rte_Type.h")
  CR_L_ObjRelVelY_1: single
  CR_L_ObjRelVelX_1: single
  CR_L_ObjDistY_1: single
  CR_L_ObjObstacleProb_1: single
  CR_L_ObjDistX_1: single
  CR_L_ObjExistProb_1: single
  CR_L_ObjID_1: uint8
  EQ_Obj_Elm4_OBJ_Height: single
  EQ_Obj_Elm4_OBJ_Rel_Lat_Vel: single
  EQ_Obj_Elm4_OBJ_Rel_Long_Vel: single
  EQ_Obj_Elm4_OBJ_Heading: single
  EQ_Obj_Elm4_OBJ_Lat_Distance: single
  EQ_Obj_Elm4_OBJ_Long_Distance: single
  EQ_Obj_Elm4_OBJ_Length: single
  EQ_Obj_Elm4_OBJ_Width: single
  EQ_Obj_Elm4_OBJ_Obj_Class: uint8
  EQ_Obj_Elm4_OBJ_Exist_Problty: single
  EQ_Obj_Elm4_OBJ_Motion_Sts: uint8
  EQ_Obj_Elm4_OBJ_ID: uint8
  EQ_Obj_Elm3_OBJ_Height: single
  EQ_Obj_Elm3_OBJ_Rel_Lat_Vel: single
  EQ_Obj_Elm3_OBJ_Rel_Long_Vel: single
  EQ_Obj_Elm3_OBJ_Heading: single
  EQ_Obj_Elm3_OBJ_Lat_Distance: single
  EQ_Obj_Elm3_OBJ_Long_Distance: single
  EQ_Obj_Elm3_OBJ_Length: single
  EQ_Obj_Elm3_OBJ_Width: single
  EQ_Obj_Elm3_OBJ_Exist_Problty: single
  EQ_Obj_Elm3_OBJ_Motion_Sts: uint8
  EQ_Obj_Elm3_OBJ_Obj_Class: uint8
  EQ_Obj_Elm3_OBJ_ID: uint8
  EQ_Obj_Elm2_OBJ_Height: single
  EQ_Obj_Elm2_OBJ_Rel_Lat_Vel: single
  EQ_Obj_Elm2_OBJ_Rel_Long_Vel: single
  EQ_Obj_Elm2_OBJ_Heading: single
  EQ_Obj_Elm2_OBJ_Lat_Distance: single
  EQ_Obj_Elm2_OBJ_Long_Distance: single
  EQ_Obj_Elm2_OBJ_Length: single
  EQ_Obj_Elm2_OBJ_Width: single
  EQ_Obj_Elm2_OBJ_Obj_Class: uint8
  EQ_Obj_Elm2_OBJ_Exist_Problty: single
  EQ_Obj_Elm2_OBJ_Motion_Sts: uint8
  EQ_Obj_Elm2_OBJ_ID: uint8
  EQ_Obj_Elm1_OBJ_Height: single
  EQ_Obj_Elm1_OBJ_Rel_Lat_Vel: single
  EQ_Obj_Elm1_OBJ_Rel_Long_Vel: single
  EQ_Obj_Elm1_OBJ_Heading: single
  EQ_Obj_Elm1_OBJ_Lat_Distance: single
  EQ_Obj_Elm1_OBJ_Long_Distance: single
  EQ_Obj_Elm1_OBJ_Length: single
  EQ_Obj_Elm1_OBJ_Width: single
  EQ_Obj_Elm1_OBJ_Motion_Sts: uint8
  EQ_Obj_Elm1_OBJ_Obj_Class: uint8
  EQ_Obj_Elm1_OBJ_Exist_Problty: single
  EQ_Obj_Elm1_OBJ_ID: uint8

IDC_L2_GW14_RAW_BUS = Simulink.Bus(HeaderFile="Rte_Type.h")
  CR_L_ObjRelVelY_1: uint16  % IDC_L2_GW14|0.0312|-128|-128|126.9976|single
  CR_L_ObjRelVelX_1: uint16  % IDC_L2_GW14|0.0312|-128|-128|126.9976|single
  CR_L_ObjDistY_1: uint16  % IDC_L2_GW14|0.125|-128|-128|127.875|single
  CR_L_ObjObstacleProb_1: uint8  % IDC_L2_GW14|0.032258|0|0|1|single
  CR_L_ObjDistX_1: uint16  % IDC_L2_GW14|0.0625|-128|-128|126.9375|single
  CR_L_ObjExistProb_1: uint8  % IDC_L2_GW14|0.032258|0|0|1|single
  CR_L_ObjID_1: uint8  % IDC_L2_GW14|1|0|0|255|uint8
  EQ_Obj_Elm4_OBJ_Height: uint16  % IDC_L2_GW14|0.01|0|0|2.95|single
  EQ_Obj_Elm4_OBJ_Rel_Lat_Vel: uint16  % IDC_L2_GW14|0.05|-50|-50|50|single
  EQ_Obj_Elm4_OBJ_Rel_Long_Vel: uint16  % IDC_L2_GW14|0.05|-120|-120|130|single
  EQ_Obj_Elm4_OBJ_Heading: uint16  % IDC_L2_GW14|0.01|-3.14|-3.14|3.14|single
  EQ_Obj_Elm4_OBJ_Lat_Distance: uint16  % IDC_L2_GW14|0.05|-100|-100|100|single
  EQ_Obj_Elm4_OBJ_Long_Distance: uint16  % IDC_L2_GW14|0.05|-200|-200|500|single
  EQ_Obj_Elm4_OBJ_Length: uint16  % IDC_L2_GW14|0.05|0|1.2|21|single
  EQ_Obj_Elm4_OBJ_Width: uint16  % IDC_L2_GW14|0.01|0|0.4|2.95|single
  EQ_Obj_Elm4_OBJ_Obj_Class: uint8  % IDC_L2_GW14|1|0|0|8|uint8
  EQ_Obj_Elm4_OBJ_Exist_Problty: uint8  % IDC_L2_GW14|0.01|0|0|1|single
  EQ_Obj_Elm4_OBJ_Motion_Sts: uint8  % IDC_L2_GW14|1|0|0|5|uint8
  EQ_Obj_Elm4_OBJ_ID: uint8  % IDC_L2_GW14|1|0|0|255|uint8
  EQ_Obj_Elm3_OBJ_Height: uint16  % IDC_L2_GW14|0.01|0|0|2.95|single
  EQ_Obj_Elm3_OBJ_Rel_Lat_Vel: uint16  % IDC_L2_GW14|0.05|-50|-50|50|single
  EQ_Obj_Elm3_OBJ_Rel_Long_Vel: uint16  % IDC_L2_GW14|0.05|-120|-120|130|single
  EQ_Obj_Elm3_OBJ_Heading: uint16  % IDC_L2_GW14|0.01|-3.14|-3.14|3.14|single
  EQ_Obj_Elm3_OBJ_Lat_Distance: uint16  % IDC_L2_GW14|0.05|-100|-100|100|single
  EQ_Obj_Elm3_OBJ_Long_Distance: uint16  % IDC_L2_GW14|0.05|-200|-200|500|single
  EQ_Obj_Elm3_OBJ_Length: uint16  % IDC_L2_GW14|0.05|0|1.2|21|single
  EQ_Obj_Elm3_OBJ_Width: uint16  % IDC_L2_GW14|0.01|0|0.4|2.95|single
  EQ_Obj_Elm3_OBJ_Exist_Problty: uint8  % IDC_L2_GW14|0.01|0|0|1|single
  EQ_Obj_Elm3_OBJ_Motion_Sts: uint8  % IDC_L2_GW14|1|0|0|5|uint8
  EQ_Obj_Elm3_OBJ_Obj_Class: uint8  % IDC_L2_GW14|1|0|0|8|uint8
  EQ_Obj_Elm3_OBJ_ID: uint8  % IDC_L2_GW14|1|0|0|255|uint8
  EQ_Obj_Elm2_OBJ_Height: uint16  % IDC_L2_GW14|0.01|0|0|2.95|single
  EQ_Obj_Elm2_OBJ_Rel_Lat_Vel: uint16  % IDC_L2_GW14|0.05|-50|-50|50|single
  EQ_Obj_Elm2_OBJ_Rel_Long_Vel: uint16  % IDC_L2_GW14|0.05|-120|-120|130|single
  EQ_Obj_Elm2_OBJ_Heading: uint16  % IDC_L2_GW14|0.01|-3.14|-3.14|3.14|single
  EQ_Obj_Elm2_OBJ_Lat_Distance: uint16  % IDC_L2_GW14|0.05|-100|-100|100|single
  EQ_Obj_Elm2_OBJ_Long_Distance: uint16  % IDC_L2_GW14|0.05|-200|-200|500|single
  EQ_Obj_Elm2_OBJ_Length: uint16  % IDC_L2_GW14|0.05|0|1.2|21|single
  EQ_Obj_Elm2_OBJ_Width: uint16  % IDC_L2_GW14|0.01|0|0.4|2.95|single
  EQ_Obj_Elm2_OBJ_Obj_Class: uint8  % IDC_L2_GW14|1|0|0|8|uint8
  EQ_Obj_Elm2_OBJ_Exist_Problty: uint8  % IDC_L2_GW14|0.01|0|0|1|single
  EQ_Obj_Elm2_OBJ_Motion_Sts: uint8  % IDC_L2_GW14|1|0|0|5|uint8
  EQ_Obj_Elm2_OBJ_ID: uint8  % IDC_L2_GW14|1|0|0|255|uint8
  EQ_Obj_Elm1_OBJ_Height: uint16  % IDC_L2_GW14|0.01|0|0|2.95|single
  EQ_Obj_Elm1_OBJ_Rel_Lat_Vel: uint16  % IDC_L2_GW14|0.05|-50|-50|50|single
  EQ_Obj_Elm1_OBJ_Rel_Long_Vel: uint16  % IDC_L2_GW14|0.05|-120|-120|130|single
  EQ_Obj_Elm1_OBJ_Heading: uint16  % IDC_L2_GW14|0.01|-3.14|-3.14|3.14|single
  EQ_Obj_Elm1_OBJ_Lat_Distance: uint16  % IDC_L2_GW14|0.05|-100|-100|100|single
  EQ_Obj_Elm1_OBJ_Long_Distance: uint16  % IDC_L2_GW14|0.05|-200|-200|500|single
  EQ_Obj_Elm1_OBJ_Length: uint16  % IDC_L2_GW14|0.05|0|1.2|21|single
  EQ_Obj_Elm1_OBJ_Width: uint16  % IDC_L2_GW14|0.01|0|0.4|2.95|single
  EQ_Obj_Elm1_OBJ_Motion_Sts: uint8  % IDC_L2_GW14|1|0|0|5|uint8
  EQ_Obj_Elm1_OBJ_Obj_Class: uint8  % IDC_L2_GW14|1|0|0|8|uint8
  EQ_Obj_Elm1_OBJ_Exist_Problty: uint8  % IDC_L2_GW14|0.01|0|0|1|single
  EQ_Obj_Elm1_OBJ_ID: uint8  % IDC_L2_GW14|1|0|0|255|uint8

IDC_L2_GW15_MSG_BUS = Simulink.Bus(HeaderFile="Rte_Type.h")
  EQ_Obj_Elm8_OBJ_Height: single
  EQ_Obj_Elm8_OBJ_Rel_Lat_Vel: single
  EQ_Obj_Elm8_OBJ_Rel_Long_Vel: single
  EQ_Obj_Elm8_OBJ_Heading: single
  EQ_Obj_Elm8_OBJ_Lat_Distance: single
  EQ_Obj_Elm8_OBJ_Long_Distance: single
  EQ_Obj_Elm8_OBJ_Length: single
  EQ_Obj_Elm8_OBJ_Width: single
  EQ_Obj_Elm8_OBJ_Exist_Problty: single
  EQ_Obj_Elm8_OBJ_Motion_Sts: uint8
  EQ_Obj_Elm8_OBJ_Obj_Class: uint8
  EQ_Obj_Elm8_OBJ_ID: uint8
  EQ_Obj_Elm7_OBJ_Height: single
  EQ_Obj_Elm7_OBJ_Rel_Lat_Vel: single
  EQ_Obj_Elm7_OBJ_Rel_Long_Vel: single
  EQ_Obj_Elm7_OBJ_Heading: single
  EQ_Obj_Elm7_OBJ_Lat_Distance: single
  EQ_Obj_Elm7_OBJ_Long_Distance: single
  EQ_Obj_Elm7_OBJ_Length: single
  EQ_Obj_Elm7_OBJ_Width: single
  EQ_Obj_Elm7_OBJ_Obj_Class: uint8
  EQ_Obj_Elm7_OBJ_Exist_Problty: single
  EQ_Obj_Elm7_OBJ_Motion_Sts: uint8
  EQ_Obj_Elm7_OBJ_ID: uint8
  EQ_Obj_Elm6_OBJ_Height: single
  EQ_Obj_Elm6_OBJ_Rel_Lat_Vel: single
  EQ_Obj_Elm6_OBJ_Rel_Long_Vel: single
  EQ_Obj_Elm6_OBJ_Heading: single
  EQ_Obj_Elm6_OBJ_Lat_Distance: single
  EQ_Obj_Elm6_OBJ_Long_Distance: single
  EQ_Obj_Elm6_OBJ_Length: single
  EQ_Obj_Elm6_OBJ_Width: single
  EQ_Obj_Elm6_OBJ_Motion_Sts: uint8
  EQ_Obj_Elm6_OBJ_Obj_Class: uint8
  EQ_Obj_Elm6_OBJ_Exist_Problty: single
  EQ_Obj_Elm6_OBJ_ID: uint8
  EQ_Obj_Elm5_OBJ_Height: single
  EQ_Obj_Elm5_OBJ_Rel_Lat_Vel: single
  EQ_Obj_Elm5_OBJ_Rel_Long_Vel: single
  EQ_Obj_Elm5_OBJ_Heading: single
  EQ_Obj_Elm5_OBJ_Lat_Distance: single
  EQ_Obj_Elm5_OBJ_Long_Distance: single
  EQ_Obj_Elm5_OBJ_Length: single
  EQ_Obj_Elm5_OBJ_Width: single
  EQ_Obj_Elm5_OBJ_Exist_Problty: single
  EQ_Obj_Elm5_OBJ_Motion_Sts: uint8
  EQ_Obj_Elm5_OBJ_Obj_Class: uint8
  EQ_Obj_Elm5_OBJ_ID: uint8
  CR_L_ObjRelVelY_2: single
  CR_L_ObjRelVelX_2: single
  CR_L_ObjDistY_2: single
  CR_L_ObjDistX_2: single
  CR_L_ObjExistProb_2: single
  CR_L_ObjObstacleProb_2: single
  CR_L_ObjID_2: uint8

IDC_L2_GW15_RAW_BUS = Simulink.Bus(HeaderFile="Rte_Type.h")
  EQ_Obj_Elm8_OBJ_Height: uint16  % IDC_L2_GW15|0.01|0|0|2.95|single
  EQ_Obj_Elm8_OBJ_Rel_Lat_Vel: uint16  % IDC_L2_GW15|0.05|-50|-50|50|single
  EQ_Obj_Elm8_OBJ_Rel_Long_Vel: uint16  % IDC_L2_GW15|0.05|-120|-120|130|single
  EQ_Obj_Elm8_OBJ_Heading: uint16  % IDC_L2_GW15|0.01|-3.14|-3.14|3.14|single
  EQ_Obj_Elm8_OBJ_Lat_Distance: uint16  % IDC_L2_GW15|0.05|-100|-100|100|single
  EQ_Obj_Elm8_OBJ_Long_Distance: uint16  % IDC_L2_GW15|0.05|-200|-200|500|single
  EQ_Obj_Elm8_OBJ_Length: uint16  % IDC_L2_GW15|0.05|0|1.2|21|single
  EQ_Obj_Elm8_OBJ_Width: uint16  % IDC_L2_GW15|0.01|0|0.4|2.95|single
  EQ_Obj_Elm8_OBJ_Exist_Problty: uint8  % IDC_L2_GW15|0.01|0|0|1|single
  EQ_Obj_Elm8_OBJ_Motion_Sts: uint8  % IDC_L2_GW15|1|0|0|5|uint8
  EQ_Obj_Elm8_OBJ_Obj_Class: uint8  % IDC_L2_GW15|1|0|0|8|uint8
  EQ_Obj_Elm8_OBJ_ID: uint8  % IDC_L2_GW15|1|0|0|255|uint8
  EQ_Obj_Elm7_OBJ_Height: uint16  % IDC_L2_GW15|0.01|0|0|2.95|single
  EQ_Obj_Elm7_OBJ_Rel_Lat_Vel: uint16  % IDC_L2_GW15|0.05|-50|-50|50|single
  EQ_Obj_Elm7_OBJ_Rel_Long_Vel: uint16  % IDC_L2_GW15|0.05|-120|-120|130|single
  EQ_Obj_Elm7_OBJ_Heading: uint16  % IDC_L2_GW15|0.01|-3.14|-3.14|3.14|single
  EQ_Obj_Elm7_OBJ_Lat_Distance: uint16  % IDC_L2_GW15|0.05|-100|-100|100|single
  EQ_Obj_Elm7_OBJ_Long_Distance: uint16  % IDC_L2_GW15|0.05|-200|-200|500|single
  EQ_Obj_Elm7_OBJ_Length: uint16  % IDC_L2_GW15|0.05|0|1.2|21|single
  EQ_Obj_Elm7_OBJ_Width: uint16  % IDC_L2_GW15|0.01|0|0.4|2.95|single
  EQ_Obj_Elm7_OBJ_Obj_Class: uint8  % IDC_L2_GW15|1|0|0|8|uint8
  EQ_Obj_Elm7_OBJ_Exist_Problty: uint8  % IDC_L2_GW15|0.01|0|0|1|single
  EQ_Obj_Elm7_OBJ_Motion_Sts: uint8  % IDC_L2_GW15|1|0|0|5|uint8
  EQ_Obj_Elm7_OBJ_ID: uint8  % IDC_L2_GW15|1|0|0|255|uint8
  EQ_Obj_Elm6_OBJ_Height: uint16  % IDC_L2_GW15|0.01|0|0|2.95|single
  EQ_Obj_Elm6_OBJ_Rel_Lat_Vel: uint16  % IDC_L2_GW15|0.05|-50|-50|50|single
  EQ_Obj_Elm6_OBJ_Rel_Long_Vel: uint16  % IDC_L2_GW15|0.05|-120|-120|130|single
  EQ_Obj_Elm6_OBJ_Heading: uint16  % IDC_L2_GW15|0.01|-3.14|-3.14|3.14|single
  EQ_Obj_Elm6_OBJ_Lat_Distance: uint16  % IDC_L2_GW15|0.05|-100|-100|100|single
  EQ_Obj_Elm6_OBJ_Long_Distance: uint16  % IDC_L2_GW15|0.05|-200|-200|500|single
  EQ_Obj_Elm6_OBJ_Length: uint16  % IDC_L2_GW15|0.05|0|1.2|21|single
  EQ_Obj_Elm6_OBJ_Width: uint16  % IDC_L2_GW15|0.01|0|0.4|2.95|single
  EQ_Obj_Elm6_OBJ_Motion_Sts: uint8  % IDC_L2_GW15|1|0|0|5|uint8
  EQ_Obj_Elm6_OBJ_Obj_Class: uint8  % IDC_L2_GW15|1|0|0|8|uint8
  EQ_Obj_Elm6_OBJ_Exist_Problty: uint8  % IDC_L2_GW15|0.01|0|0|1|single
  EQ_Obj_Elm6_OBJ_ID: uint8  % IDC_L2_GW15|1|0|0|255|uint8
  EQ_Obj_Elm5_OBJ_Height: uint16  % IDC_L2_GW15|0.01|0|0|2.95|single
  EQ_Obj_Elm5_OBJ_Rel_Lat_Vel: uint16  % IDC_L2_GW15|0.05|-50|-50|50|single
  EQ_Obj_Elm5_OBJ_Rel_Long_Vel: uint16  % IDC_L2_GW15|0.05|-120|-120|130|single
  EQ_Obj_Elm5_OBJ_Heading: uint16  % IDC_L2_GW15|0.01|-3.14|-3.14|3.14|single
  EQ_Obj_Elm5_OBJ_Lat_Distance: uint16  % IDC_L2_GW15|0.05|-100|-100|100|single
  EQ_Obj_Elm5_OBJ_Long_Distance: uint16  % IDC_L2_GW15|0.05|-200|-200|500|single
  EQ_Obj_Elm5_OBJ_Length: uint16  % IDC_L2_GW15|0.05|0|1.2|21|single
  EQ_Obj_Elm5_OBJ_Width: uint16  % IDC_L2_GW15|0.01|0|0.4|2.95|single
  EQ_Obj_Elm5_OBJ_Exist_Problty: uint8  % IDC_L2_GW15|0.01|0|0|1|single
  EQ_Obj_Elm5_OBJ_Motion_Sts: uint8  % IDC_L2_GW15|1|0|0|5|uint8
  EQ_Obj_Elm5_OBJ_Obj_Class: uint8  % IDC_L2_GW15|1|0|0|8|uint8
  EQ_Obj_Elm5_OBJ_ID: uint8  % IDC_L2_GW15|1|0|0|255|uint8
  CR_L_ObjRelVelY_2: uint16  % IDC_L2_GW15|0.0312|-128|-128|126.9976|single
  CR_L_ObjRelVelX_2: uint16  % IDC_L2_GW15|0.0312|-128|-128|126.9976|single
  CR_L_ObjDistY_2: uint16  % IDC_L2_GW15|0.125|-128|-128|127.875|single
  CR_L_ObjDistX_2: uint16  % IDC_L2_GW15|0.0625|-128|-128|126.9375|single
  CR_L_ObjExistProb_2: uint8  % IDC_L2_GW15|0.032258|0|0|1|single
  CR_L_ObjObstacleProb_2: uint8  % IDC_L2_GW15|0.032258|0|0|1|single
  CR_L_ObjID_2: uint8  % IDC_L2_GW15|1|0|0|255|uint8

IDC_L2_GW16_MSG_BUS = Simulink.Bus(HeaderFile="Rte_Type.h")
  CR_L_ObjRelVelY_3: single
  CR_L_ObjRelVelX_3: single
  CR_L_ObjDistY_3: single
  CR_L_ObjObstacleProb_3: single
  CR_L_ObjDistX_3: single
  CR_L_ObjExistProb_3: single
  CR_L_ObjID_3: uint8
  EQ_Obj_Elm12_OBJ_Height: single
  EQ_Obj_Elm12_OBJ_Rel_Lat_Vel: single
  EQ_Obj_Elm12_OBJ_Rel_Long_Vel: single
  EQ_Obj_Elm12_OBJ_Heading: single
  EQ_Obj_Elm12_OBJ_Lat_Distance: single
  EQ_Obj_Elm12_OBJ_Long_Distance: single
  EQ_Obj_Elm12_OBJ_Length: single
  EQ_Obj_Elm12_OBJ_Width: single
  EQ_Obj_Elm12_OBJ_Obj_Class: uint8
  EQ_Obj_Elm12_OBJ_Exist_Problty: single
  EQ_Obj_Elm12_OBJ_Motion_Sts: uint8
  EQ_Obj_Elm12_OBJ_ID: uint8
  EQ_Obj_Elm11_OBJ_Height: uint8
  EQ_Obj_Elm11_OBJ_Rel_Lat_Vel: single
  EQ_Obj_Elm11_OBJ_Rel_Long_Vel: single
  EQ_Obj_Elm11_OBJ_Heading: single
  EQ_Obj_Elm11_OBJ_Lat_Distance: single
  EQ_Obj_Elm11_OBJ_Long_Distance: single
  EQ_Obj_Elm11_OBJ_Length: single
  EQ_Obj_Elm11_OBJ_Width: single
  EQ_Obj_Elm11_OBJ_Exist_Problty: single
  EQ_Obj_Elm11_OBJ_Motion_Sts: uint8
  EQ_Obj_Elm11_OBJ_Obj_Class: uint8
  EQ_Obj_Elm11_OBJ_ID: uint8
  EQ_Obj_Elm10_OBJ_Height: single
  EQ_Obj_Elm10_OBJ_Rel_Lat_Vel: single
  EQ_Obj_Elm10_OBJ_Rel_Long_Vel: single
  EQ_Obj_Elm10_OBJ_Heading: single
  EQ_Obj_Elm10_OBJ_Lat_Distance: single
  EQ_Obj_Elm10_OBJ_Long_Distance: single
  EQ_Obj_Elm10_OBJ_Length: single
  EQ_Obj_Elm10_OBJ_Width: single
  EQ_Obj_Elm10_OBJ_Obj_Class: uint8
  EQ_Obj_Elm10_OBJ_Exist_Problty: single
  EQ_Obj_Elm10_OBJ_Motion_Sts: uint8
  EQ_Obj_Elm10_OBJ_ID: uint8
  EQ_Obj_Elm9_OBJ_Height: single
  EQ_Obj_Elm9_OBJ_Rel_Lat_Vel: single
  EQ_Obj_Elm9_OBJ_Rel_Long_Vel: single
  EQ_Obj_Elm9_OBJ_Heading: single
  EQ_Obj_Elm9_OBJ_Lat_Distance: single
  EQ_Obj_Elm9_OBJ_Long_Distance: single
  EQ_Obj_Elm9_OBJ_Length: single
  EQ_Obj_Elm9_OBJ_Width: single
  EQ_Obj_Elm9_OBJ_Motion_Sts: uint8
  EQ_Obj_Elm9_OBJ_Obj_Class: uint8
  EQ_Obj_Elm9_OBJ_Exist_Problty: single
  EQ_Obj_Elm9_OBJ_ID: uint8

IDC_L2_GW16_RAW_BUS = Simulink.Bus(HeaderFile="Rte_Type.h")
  CR_L_ObjRelVelY_3: uint16  % IDC_L2_GW16|0.0312|-128|-128|126.9976|single
  CR_L_ObjRelVelX_3: uint16  % IDC_L2_GW16|0.0312|-128|-128|126.9976|single
  CR_L_ObjDistY_3: uint16  % IDC_L2_GW16|0.125|-128|-128|127.875|single
  CR_L_ObjObstacleProb_3: uint8  % IDC_L2_GW16|0.032258|0|0|1|single
  CR_L_ObjDistX_3: uint16  % IDC_L2_GW16|0.0625|-128|-128|126.9375|single
  CR_L_ObjExistProb_3: uint8  % IDC_L2_GW16|0.032258|0|0|1|single
  CR_L_ObjID_3: uint8  % IDC_L2_GW16|1|0|0|255|uint8
  EQ_Obj_Elm12_OBJ_Height: uint16  % IDC_L2_GW16|0.01|0|0|2.95|single
  EQ_Obj_Elm12_OBJ_Rel_Lat_Vel: uint16  % IDC_L2_GW16|0.05|-50|-50|50|single
  EQ_Obj_Elm12_OBJ_Rel_Long_Vel: uint16  % IDC_L2_GW16|0.05|-120|-120|130|single
  EQ_Obj_Elm12_OBJ_Heading: uint16  % IDC_L2_GW16|0.01|-3.14|-3.14|3.14|single
  EQ_Obj_Elm12_OBJ_Lat_Distance: uint16  % IDC_L2_GW16|0.05|-100|-100|100|single
  EQ_Obj_Elm12_OBJ_Long_Distance: uint16  % IDC_L2_GW16|0.05|-200|-200|500|single
  EQ_Obj_Elm12_OBJ_Length: uint16  % IDC_L2_GW16|0.05|0|1.2|21|single
  EQ_Obj_Elm12_OBJ_Width: uint16  % IDC_L2_GW16|0.01|0|0.4|2.95|single
  EQ_Obj_Elm12_OBJ_Obj_Class: uint8  % IDC_L2_GW16|1|0|0|8|uint8
  EQ_Obj_Elm12_OBJ_Exist_Problty: uint8  % IDC_L2_GW16|0.01|0|0|1|single
  EQ_Obj_Elm12_OBJ_Motion_Sts: uint8  % IDC_L2_GW16|1|0|0|5|uint8
  EQ_Obj_Elm12_OBJ_ID: uint8  % IDC_L2_GW16|1|0|0|255|uint8
  EQ_Obj_Elm11_OBJ_Height: uint16  % IDC_L2_GW16|1|0|0|2.95|uint8
  EQ_Obj_Elm11_OBJ_Rel_Lat_Vel: uint16  % IDC_L2_GW16|0.05|-50|-50|50|single
  EQ_Obj_Elm11_OBJ_Rel_Long_Vel: uint16  % IDC_L2_GW16|0.05|-120|-120|130|single
  EQ_Obj_Elm11_OBJ_Heading: uint16  % IDC_L2_GW16|0.01|-3.14|-3.14|3.14|single
  EQ_Obj_Elm11_OBJ_Lat_Distance: uint16  % IDC_L2_GW16|0.05|-100|-100|100|single
  EQ_Obj_Elm11_OBJ_Long_Distance: uint16  % IDC_L2_GW16|0.05|-200|-200|500|single
  EQ_Obj_Elm11_OBJ_Length: uint16  % IDC_L2_GW16|0.05|0|1.2|21|single
  EQ_Obj_Elm11_OBJ_Width: uint16  % IDC_L2_GW16|0.01|0|0.4|2.95|single
  EQ_Obj_Elm11_OBJ_Exist_Problty: uint8  % IDC_L2_GW16|0.01|0|0|1|single
  EQ_Obj_Elm11_OBJ_Motion_Sts: uint8  % IDC_L2_GW16|1|0|0|5|uint8
  EQ_Obj_Elm11_OBJ_Obj_Class: uint8  % IDC_L2_GW16|1|0|0|8|uint8
  EQ_Obj_Elm11_OBJ_ID: uint8  % IDC_L2_GW16|1|0|0|255|uint8
  EQ_Obj_Elm10_OBJ_Height: uint16  % IDC_L2_GW16|0.01|0|0|2.95|single
  EQ_Obj_Elm10_OBJ_Rel_Lat_Vel: uint16  % IDC_L2_GW16|0.05|-50|-50|50|single
  EQ_Obj_Elm10_OBJ_Rel_Long_Vel: uint16  % IDC_L2_GW16|0.05|-120|-120|130|single
  EQ_Obj_Elm10_OBJ_Heading: uint16  % IDC_L2_GW16|0.01|-3.14|-3.14|3.14|single
  EQ_Obj_Elm10_OBJ_Lat_Distance: uint16  % IDC_L2_GW16|0.05|-100|-100|100|single
  EQ_Obj_Elm10_OBJ_Long_Distance: uint16  % IDC_L2_GW16|0.05|-200|-200|500|single
  EQ_Obj_Elm10_OBJ_Length: uint16  % IDC_L2_GW16|0.05|0|1.2|21|single
  EQ_Obj_Elm10_OBJ_Width: uint16  % IDC_L2_GW16|0.01|0|0.4|2.95|single
  EQ_Obj_Elm10_OBJ_Obj_Class: uint8  % IDC_L2_GW16|1|0|0|8|uint8
  EQ_Obj_Elm10_OBJ_Exist_Problty: uint8  % IDC_L2_GW16|0.01|0|0|1|single
  EQ_Obj_Elm10_OBJ_Motion_Sts: uint8  % IDC_L2_GW16|1|0|0|5|uint8
  EQ_Obj_Elm10_OBJ_ID: uint8  % IDC_L2_GW16|1|0|0|255|uint8
  EQ_Obj_Elm9_OBJ_Height: uint16  % IDC_L2_GW16|0.01|0|0|2.95|single
  EQ_Obj_Elm9_OBJ_Rel_Lat_Vel: uint16  % IDC_L2_GW16|0.05|-50|-50|50|single
  EQ_Obj_Elm9_OBJ_Rel_Long_Vel: uint16  % IDC_L2_GW16|0.05|-120|-120|130|single
  EQ_Obj_Elm9_OBJ_Heading: uint16  % IDC_L2_GW16|0.01|-3.14|-3.14|3.14|single
  EQ_Obj_Elm9_OBJ_Lat_Distance: uint16  % IDC_L2_GW16|0.05|-100|-100|100|single
  EQ_Obj_Elm9_OBJ_Long_Distance: uint16  % IDC_L2_GW16|0.05|-200|-200|500|single
  EQ_Obj_Elm9_OBJ_Length: uint16  % IDC_L2_GW16|0.05|0|1.2|21|single
  EQ_Obj_Elm9_OBJ_Width: uint16  % IDC_L2_GW16|0.01|0|0.4|2.95|single
  EQ_Obj_Elm9_OBJ_Motion_Sts: uint8  % IDC_L2_GW16|1|0|0|5|uint8
  EQ_Obj_Elm9_OBJ_Obj_Class: uint8  % IDC_L2_GW16|1|0|0|8|uint8
  EQ_Obj_Elm9_OBJ_Exist_Problty: uint8  % IDC_L2_GW16|0.01|0|0|1|single
  EQ_Obj_Elm9_OBJ_ID: uint8  % IDC_L2_GW16|1|0|0|255|uint8

IDC_L2_GW17_MSG_BUS = Simulink.Bus(HeaderFile="Rte_Type.h")
  EQ_Obj_Elm16_OBJ_Height: single
  EQ_Obj_Elm16_OBJ_Rel_Lat_Vel: single
  EQ_Obj_Elm16_OBJ_Rel_Long_Vel: single
  EQ_Obj_Elm16_OBJ_Heading: single
  EQ_Obj_Elm16_OBJ_Lat_Distance: single
  EQ_Obj_Elm16_OBJ_Long_Distance: single
  EQ_Obj_Elm16_OBJ_Length: single
  EQ_Obj_Elm16_OBJ_Width: single
  EQ_Obj_Elm16_OBJ_Exist_Problty: single
  EQ_Obj_Elm16_OBJ_Motion_Sts: uint8
  EQ_Obj_Elm16_OBJ_Obj_Class: uint8
  EQ_Obj_Elm16_OBJ_ID: uint8
  EQ_Obj_Elm15_OBJ_Height: single
  EQ_Obj_Elm15_OBJ_Rel_Lat_Vel: single
  EQ_Obj_Elm15_OBJ_Rel_Long_Vel: single
  EQ_Obj_Elm15_OBJ_Heading: single
  EQ_Obj_Elm15_OBJ_Lat_Distance: single
  EQ_Obj_Elm15_OBJ_Long_Distance: single
  EQ_Obj_Elm15_OBJ_Length: single
  EQ_Obj_Elm15_OBJ_Width: single
  EQ_Obj_Elm15_OBJ_Obj_Class: uint8
  EQ_Obj_Elm15_OBJ_Exist_Problty: single
  EQ_Obj_Elm15_OBJ_Motion_Sts: uint8
  EQ_Obj_Elm15_OBJ_ID: uint8
  EQ_Obj_Elm14_OBJ_Height: single
  EQ_Obj_Elm14_OBJ_Rel_Lat_Vel: single
  EQ_Obj_Elm14_OBJ_Rel_Long_Vel: single
  EQ_Obj_Elm14_OBJ_Heading: single
  EQ_Obj_Elm14_OBJ_Lat_Distance: single
  EQ_Obj_Elm14_OBJ_Long_Distance: single
  EQ_Obj_Elm14_OBJ_Length: single
  EQ_Obj_Elm14_OBJ_Width: single
  EQ_Obj_Elm14_OBJ_Motion_Sts: uint8
  EQ_Obj_Elm14_OBJ_Obj_Class: uint8
  EQ_Obj_Elm14_OBJ_Exist_Problty: single
  EQ_Obj_Elm14_OBJ_ID: uint8
  EQ_Obj_Elm13_OBJ_Height: single
  EQ_Obj_Elm13_OBJ_Rel_Lat_Vel: single
  EQ_Obj_Elm13_OBJ_Rel_Long_Vel: single
  EQ_Obj_Elm13_OBJ_Heading: single
  EQ_Obj_Elm13_OBJ_Lat_Distance: single
  EQ_Obj_Elm13_OBJ_Long_Distance: single
  EQ_Obj_Elm13_OBJ_Length: single
  EQ_Obj_Elm13_OBJ_Width: single
  EQ_Obj_Elm13_OBJ_Exist_Problty: single
  EQ_Obj_Elm13_OBJ_Motion_Sts: uint8
  EQ_Obj_Elm13_OBJ_Obj_Class: uint8
  EQ_Obj_Elm13_OBJ_ID: uint8
  CR_L_ObjRelVelY_4: single
  CR_L_ObjRelVelX_4: single
  CR_L_ObjDistY_4: single
  CR_L_ObjDistX_4: single
  CR_L_ObjExistProb_4: single
  CR_L_ObjObstacleProb_4: single
  CR_L_ObjID_4: uint8

IDC_L2_GW17_RAW_BUS = Simulink.Bus(HeaderFile="Rte_Type.h")
  EQ_Obj_Elm16_OBJ_Height: uint16  % IDC_L2_GW17|0.01|0|0|2.95|single
  EQ_Obj_Elm16_OBJ_Rel_Lat_Vel: uint16  % IDC_L2_GW17|0.05|-50|-50|50|single
  EQ_Obj_Elm16_OBJ_Rel_Long_Vel: uint16  % IDC_L2_GW17|0.05|-120|-120|130|single
  EQ_Obj_Elm16_OBJ_Heading: uint16  % IDC_L2_GW17|0.01|-3.14|-3.14|3.14|single
  EQ_Obj_Elm16_OBJ_Lat_Distance: uint16  % IDC_L2_GW17|0.05|-100|-100|100|single
  EQ_Obj_Elm16_OBJ_Long_Distance: uint16  % IDC_L2_GW17|0.05|-200|-200|500|single
  EQ_Obj_Elm16_OBJ_Length: uint16  % IDC_L2_GW17|0.05|0|1.2|21|single
  EQ_Obj_Elm16_OBJ_Width: uint16  % IDC_L2_GW17|0.01|0|0.4|2.95|single
  EQ_Obj_Elm16_OBJ_Exist_Problty: uint8  % IDC_L2_GW17|0.01|0|0|1|single
  EQ_Obj_Elm16_OBJ_Motion_Sts: uint8  % IDC_L2_GW17|1|0|0|5|uint8
  EQ_Obj_Elm16_OBJ_Obj_Class: uint8  % IDC_L2_GW17|1|0|0|8|uint8
  EQ_Obj_Elm16_OBJ_ID: uint8  % IDC_L2_GW17|1|0|0|255|uint8
  EQ_Obj_Elm15_OBJ_Height: uint16  % IDC_L2_GW17|0.01|0|0|2.95|single
  EQ_Obj_Elm15_OBJ_Rel_Lat_Vel: uint16  % IDC_L2_GW17|0.05|-50|-50|50|single
  EQ_Obj_Elm15_OBJ_Rel_Long_Vel: uint16  % IDC_L2_GW17|0.05|-120|-120|130|single
  EQ_Obj_Elm15_OBJ_Heading: uint16  % IDC_L2_GW17|0.01|-3.14|-3.14|3.14|single
  EQ_Obj_Elm15_OBJ_Lat_Distance: uint16  % IDC_L2_GW17|0.05|-100|-100|100|single
  EQ_Obj_Elm15_OBJ_Long_Distance: uint16  % IDC_L2_GW17|0.05|-200|-200|500|single
  EQ_Obj_Elm15_OBJ_Length: uint16  % IDC_L2_GW17|0.05|0|1.2|21|single
  EQ_Obj_Elm15_OBJ_Width: uint16  % IDC_L2_GW17|0.01|0|0.4|2.95|single
  EQ_Obj_Elm15_OBJ_Obj_Class: uint8  % IDC_L2_GW17|1|0|0|8|uint8
  EQ_Obj_Elm15_OBJ_Exist_Problty: uint8  % IDC_L2_GW17|0.01|0|0|1|single
  EQ_Obj_Elm15_OBJ_Motion_Sts: uint8  % IDC_L2_GW17|1|0|0|5|uint8
  EQ_Obj_Elm15_OBJ_ID: uint8  % IDC_L2_GW17|1|0|0|255|uint8
  EQ_Obj_Elm14_OBJ_Height: uint16  % IDC_L2_GW17|0.01|0|0|2.95|single
  EQ_Obj_Elm14_OBJ_Rel_Lat_Vel: uint16  % IDC_L2_GW17|0.05|-50|-50|50|single
  EQ_Obj_Elm14_OBJ_Rel_Long_Vel: uint16  % IDC_L2_GW17|0.05|-120|-120|130|single
  EQ_Obj_Elm14_OBJ_Heading: uint16  % IDC_L2_GW17|0.01|-3.14|-3.14|3.14|single
  EQ_Obj_Elm14_OBJ_Lat_Distance: uint16  % IDC_L2_GW17|0.05|-100|-100|100|single
  EQ_Obj_Elm14_OBJ_Long_Distance: uint16  % IDC_L2_GW17|0.05|-200|-200|500|single
  EQ_Obj_Elm14_OBJ_Length: uint16  % IDC_L2_GW17|0.05|0|1.2|21|single
  EQ_Obj_Elm14_OBJ_Width: uint16  % IDC_L2_GW17|0.01|0|0.4|2.95|single
  EQ_Obj_Elm14_OBJ_Motion_Sts: uint8  % IDC_L2_GW17|1|0|0|5|uint8
  EQ_Obj_Elm14_OBJ_Obj_Class: uint8  % IDC_L2_GW17|1|0|0|8|uint8
  EQ_Obj_Elm14_OBJ_Exist_Problty: uint8  % IDC_L2_GW17|0.01|0|0|1|single
  EQ_Obj_Elm14_OBJ_ID: uint8  % IDC_L2_GW17|1|0|0|255|uint8
  EQ_Obj_Elm13_OBJ_Height: uint16  % IDC_L2_GW17|0.01|0|0|2.95|single
  EQ_Obj_Elm13_OBJ_Rel_Lat_Vel: uint16  % IDC_L2_GW17|0.05|-50|-50|50|single
  EQ_Obj_Elm13_OBJ_Rel_Long_Vel: uint16  % IDC_L2_GW17|0.05|-120|-120|130|single
  EQ_Obj_Elm13_OBJ_Heading: uint16  % IDC_L2_GW17|0.01|-3.14|-3.14|3.14|single
  EQ_Obj_Elm13_OBJ_Lat_Distance: uint16  % IDC_L2_GW17|0.05|-100|-100|100|single
  EQ_Obj_Elm13_OBJ_Long_Distance: uint16  % IDC_L2_GW17|0.05|-200|-200|500|single
  EQ_Obj_Elm13_OBJ_Length: uint16  % IDC_L2_GW17|0.05|0|1.2|21|single
  EQ_Obj_Elm13_OBJ_Width: uint16  % IDC_L2_GW17|0.01|0|0.4|2.95|single
  EQ_Obj_Elm13_OBJ_Exist_Problty: uint8  % IDC_L2_GW17|0.01|0|0|1|single
  EQ_Obj_Elm13_OBJ_Motion_Sts: uint8  % IDC_L2_GW17|1|0|0|5|uint8
  EQ_Obj_Elm13_OBJ_Obj_Class: uint8  % IDC_L2_GW17|1|0|0|8|uint8
  EQ_Obj_Elm13_OBJ_ID: uint8  % IDC_L2_GW17|1|0|0|255|uint8
  CR_L_ObjRelVelY_4: uint16  % IDC_L2_GW17|0.0312|-128|-128|126.9976|single
  CR_L_ObjRelVelX_4: uint16  % IDC_L2_GW17|0.0312|-128|-128|126.9976|single
  CR_L_ObjDistY_4: uint16  % IDC_L2_GW17|0.125|-128|-128|127.875|single
  CR_L_ObjDistX_4: uint16  % IDC_L2_GW17|0.0625|-128|-128|126.9375|single
  CR_L_ObjExistProb_4: uint8  % IDC_L2_GW17|0.032258|0|0|1|single
  CR_L_ObjObstacleProb_4: uint8  % IDC_L2_GW17|0.032258|0|0|1|single
  CR_L_ObjID_4: uint8  % IDC_L2_GW17|1|0|0|255|uint8

IDC_L2_GW18_MSG_BUS = Simulink.Bus(HeaderFile="Rte_Type.h")
  CR_L_ObjRelVelY_5: single
  CR_L_ObjRelVelX_5: single
  CR_L_ObjDistY_5: single
  CR_L_ObjObstacleProb_5: single
  CR_L_ObjDistX_5: single
  CR_L_ObjExistProb_5: single
  CR_L_ObjID_5: uint8
  EQ_Obj_Elm20_OBJ_Height: single
  EQ_Obj_Elm20_OBJ_Rel_Lat_Vel: single
  EQ_Obj_Elm20_OBJ_Rel_Long_Vel: single
  EQ_Obj_Elm20_OBJ_Heading: single
  EQ_Obj_Elm20_OBJ_Lat_Distance: single
  EQ_Obj_Elm20_OBJ_Long_Distance: single
  EQ_Obj_Elm20_OBJ_Length: single
  EQ_Obj_Elm20_OBJ_Width: single
  EQ_Obj_Elm20_OBJ_Obj_Class: uint8
  EQ_Obj_Elm20_OBJ_Exist_Problty: single
  EQ_Obj_Elm20_OBJ_Motion_Sts: uint8
  EQ_Obj_Elm20_OBJ_ID: uint8
  EQ_Obj_Elm19_OBJ_Height: single
  EQ_Obj_Elm19_OBJ_Rel_Lat_Vel: single
  EQ_Obj_Elm19_OBJ_Rel_Long_Vel: single
  EQ_Obj_Elm19_OBJ_Heading: single
  EQ_Obj_Elm19_OBJ_Lat_Distance: single
  EQ_Obj_Elm19_OBJ_Long_Distance: single
  EQ_Obj_Elm19_OBJ_Length: single
  EQ_Obj_Elm19_OBJ_Width: single
  EQ_Obj_Elm19_OBJ_Exist_Problty: single
  EQ_Obj_Elm19_OBJ_Motion_Sts: uint8
  EQ_Obj_Elm19_OBJ_Obj_Class: uint8
  EQ_Obj_Elm19_OBJ_ID: uint8
  EQ_Obj_Elm18_OBJ_Height: single
  EQ_Obj_Elm18_OBJ_Rel_Lat_Vel: single
  EQ_Obj_Elm18_OBJ_Rel_Long_Vel: single
  EQ_Obj_Elm18_OBJ_Heading: single
  EQ_Obj_Elm18_OBJ_Lat_Distance: single
  EQ_Obj_Elm18_OBJ_Long_Distance: single
  EQ_Obj_Elm18_OBJ_Length: single
  EQ_Obj_Elm18_OBJ_Width: single
  EQ_Obj_Elm18_OBJ_Obj_Class: uint8
  EQ_Obj_Elm18_OBJ_Exist_Problty: single
  EQ_Obj_Elm18_OBJ_Motion_Sts: uint8
  EQ_Obj_Elm18_OBJ_ID: uint8
  EQ_Obj_Elm17_OBJ_Height: single
  EQ_Obj_Elm17_OBJ_Rel_Lat_Vel: single
  EQ_Obj_Elm17_OBJ_Rel_Long_Vel: single
  EQ_Obj_Elm17_OBJ_Heading: single
  EQ_Obj_Elm17_OBJ_Lat_Distance: single
  EQ_Obj_Elm17_OBJ_Long_Distance: single
  EQ_Obj_Elm17_OBJ_Length: single
  EQ_Obj_Elm17_OBJ_Width: single
  EQ_Obj_Elm17_OBJ_Motion_Sts: uint8
  EQ_Obj_Elm17_OBJ_Obj_Class: uint8
  EQ_Obj_Elm17_OBJ_Exist_Problty: single
  EQ_Obj_Elm17_OBJ_ID: uint8

IDC_L2_GW18_RAW_BUS = Simulink.Bus(HeaderFile="Rte_Type.h")
  CR_L_ObjRelVelY_5: uint16  % IDC_L2_GW18|0.0312|-128|-128|126.9976|single
  CR_L_ObjRelVelX_5: uint16  % IDC_L2_GW18|0.0312|-128|-128|126.9976|single
  CR_L_ObjDistY_5: uint16  % IDC_L2_GW18|0.125|-128|-128|127.875|single
  CR_L_ObjObstacleProb_5: uint8  % IDC_L2_GW18|0.032258|0|0|1|single
  CR_L_ObjDistX_5: uint16  % IDC_L2_GW18|0.0625|-128|-128|126.9375|single
  CR_L_ObjExistProb_5: uint8  % IDC_L2_GW18|0.032258|0|0|1|single
  CR_L_ObjID_5: uint8  % IDC_L2_GW18|1|0|0|255|uint8
  EQ_Obj_Elm20_OBJ_Height: uint16  % IDC_L2_GW18|0.01|0|0|2.95|single
  EQ_Obj_Elm20_OBJ_Rel_Lat_Vel: uint16  % IDC_L2_GW18|0.05|-50|-50|50|single
  EQ_Obj_Elm20_OBJ_Rel_Long_Vel: uint16  % IDC_L2_GW18|0.05|-120|-120|130|single
  EQ_Obj_Elm20_OBJ_Heading: uint16  % IDC_L2_GW18|0.01|-3.14|-3.14|3.14|single
  EQ_Obj_Elm20_OBJ_Lat_Distance: uint16  % IDC_L2_GW18|0.05|-100|-100|100|single
  EQ_Obj_Elm20_OBJ_Long_Distance: uint16  % IDC_L2_GW18|0.05|-200|-200|500|single
  EQ_Obj_Elm20_OBJ_Length: uint16  % IDC_L2_GW18|0.05|0|1.2|21|single
  EQ_Obj_Elm20_OBJ_Width: uint16  % IDC_L2_GW18|0.01|0|0.4|2.95|single
  EQ_Obj_Elm20_OBJ_Obj_Class: uint8  % IDC_L2_GW18|1|0|0|8|uint8
  EQ_Obj_Elm20_OBJ_Exist_Problty: uint8  % IDC_L2_GW18|0.01|0|0|1|single
  EQ_Obj_Elm20_OBJ_Motion_Sts: uint8  % IDC_L2_GW18|1|0|0|5|uint8
  EQ_Obj_Elm20_OBJ_ID: uint8  % IDC_L2_GW18|1|0|0|255|uint8
  EQ_Obj_Elm19_OBJ_Height: uint16  % IDC_L2_GW18|0.01|0|0|2.95|single
  EQ_Obj_Elm19_OBJ_Rel_Lat_Vel: uint16  % IDC_L2_GW18|0.05|-50|-50|50|single
  EQ_Obj_Elm19_OBJ_Rel_Long_Vel: uint16  % IDC_L2_GW18|0.05|-120|-120|130|single
  EQ_Obj_Elm19_OBJ_Heading: uint16  % IDC_L2_GW18|0.01|-3.14|-3.14|3.14|single
  EQ_Obj_Elm19_OBJ_Lat_Distance: uint16  % IDC_L2_GW18|0.05|-100|-100|100|single
  EQ_Obj_Elm19_OBJ_Long_Distance: uint16  % IDC_L2_GW18|0.05|-200|-200|500|single
  EQ_Obj_Elm19_OBJ_Length: uint16  % IDC_L2_GW18|0.05|0|1.2|21|single
  EQ_Obj_Elm19_OBJ_Width: uint16  % IDC_L2_GW18|0.01|0|0.4|2.95|single
  EQ_Obj_Elm19_OBJ_Exist_Problty: uint8  % IDC_L2_GW18|0.01|0|0|1|single
  EQ_Obj_Elm19_OBJ_Motion_Sts: uint8  % IDC_L2_GW18|1|0|0|5|uint8
  EQ_Obj_Elm19_OBJ_Obj_Class: uint8  % IDC_L2_GW18|1|0|0|8|uint8
  EQ_Obj_Elm19_OBJ_ID: uint8  % IDC_L2_GW18|1|0|0|255|uint8
  EQ_Obj_Elm18_OBJ_Height: uint16  % IDC_L2_GW18|0.01|0|0|2.95|single
  EQ_Obj_Elm18_OBJ_Rel_Lat_Vel: uint16  % IDC_L2_GW18|0.05|-50|-50|50|single
  EQ_Obj_Elm18_OBJ_Rel_Long_Vel: uint16  % IDC_L2_GW18|0.05|-120|-120|130|single
  EQ_Obj_Elm18_OBJ_Heading: uint16  % IDC_L2_GW18|0.01|-3.14|-3.14|3.14|single
  EQ_Obj_Elm18_OBJ_Lat_Distance: uint16  % IDC_L2_GW18|0.05|-100|-100|100|single
  EQ_Obj_Elm18_OBJ_Long_Distance: uint16  % IDC_L2_GW18|0.05|-200|-200|500|single
  EQ_Obj_Elm18_OBJ_Length: uint16  % IDC_L2_GW18|0.05|0|1.2|21|single
  EQ_Obj_Elm18_OBJ_Width: uint16  % IDC_L2_GW18|0.01|0|0.4|2.95|single
  EQ_Obj_Elm18_OBJ_Obj_Class: uint8  % IDC_L2_GW18|1|0|0|8|uint8
  EQ_Obj_Elm18_OBJ_Exist_Problty: uint8  % IDC_L2_GW18|0.01|0|0|1|single
  EQ_Obj_Elm18_OBJ_Motion_Sts: uint8  % IDC_L2_GW18|1|0|0|5|uint8
  EQ_Obj_Elm18_OBJ_ID: uint8  % IDC_L2_GW18|1|0|0|255|uint8
  EQ_Obj_Elm17_OBJ_Height: uint16  % IDC_L2_GW18|0.01|0|0|2.95|single
  EQ_Obj_Elm17_OBJ_Rel_Lat_Vel: uint16  % IDC_L2_GW18|0.05|-50|-50|50|single
  EQ_Obj_Elm17_OBJ_Rel_Long_Vel: uint16  % IDC_L2_GW18|0.05|-120|-120|130|single
  EQ_Obj_Elm17_OBJ_Heading: uint16  % IDC_L2_GW18|0.01|-3.14|-3.14|3.14|single
  EQ_Obj_Elm17_OBJ_Lat_Distance: uint16  % IDC_L2_GW18|0.05|-100|-100|100|single
  EQ_Obj_Elm17_OBJ_Long_Distance: uint16  % IDC_L2_GW18|0.05|-200|-200|500|single
  EQ_Obj_Elm17_OBJ_Length: uint16  % IDC_L2_GW18|0.05|0|1.2|21|single
  EQ_Obj_Elm17_OBJ_Width: uint16  % IDC_L2_GW18|0.01|0|0.4|2.95|single
  EQ_Obj_Elm17_OBJ_Motion_Sts: uint8  % IDC_L2_GW18|1|0|0|5|uint8
  EQ_Obj_Elm17_OBJ_Obj_Class: uint8  % IDC_L2_GW18|1|0|0|8|uint8
  EQ_Obj_Elm17_OBJ_Exist_Problty: uint8  % IDC_L2_GW18|0.01|0|0|1|single
  EQ_Obj_Elm17_OBJ_ID: uint8  % IDC_L2_GW18|1|0|0|255|uint8

IDC_L2_GW19_MSG_BUS = Simulink.Bus(HeaderFile="Rte_Type.h")
  VFC_ObjMotionDirection_2: uint8
  VFC_ObjMotionDirection_1: uint8
  VFC_ObjMotionDirection_3: uint8
  VFC_ObjMotionDirection_4: uint8
  MRR_ObjMotionType_4: uint8
  MRR_ObjType_4: uint8
  MRR_ObjRelVelY_4: single
  MRR_ObjRelVelX_4: single
  MRR_ObjDistY_4: single
  MRR_ObjDistX_4: single
  MRR_ObjObstacleProb_4: single
  MRR_ObjExistProb_4: single
  MRR_ObjMotionType_3: uint8
  MRR_ObjType_3: uint8
  MRR_ObjID_4: uint8
  MRR_ObjRelVelY_3: single
  MRR_ObjRelVelX_3: single
  MRR_ObjDistY_3: single
  MRR_ObjObstacleProb_3: single
  MRR_ObjDistX_3: single
  MRR_ObjExistProb_3: single
  MRR_ObjType_2: uint8
  MRR_ObjID_3: uint8
  MRR_ObjMotionType_2: uint8
  MRR_ObjRelVelY_2: single
  MRR_ObjRelVelX_2: single
  MRR_ObjDistY_2: single
  MRR_ObjObstacleProb_2: single
  MRR_ObjDistX_2: single
  MRR_ObjExistProb_2: single
  MRR_ObjID_2: uint8
  MRR_ObjMotionType_1: uint8
  MRR_ObjType_1: uint8
  MRR_ObjRelVelY_1: single
  MRR_ObjRelVelX_1: single
  MRR_ObjDistY_1: single
  MRR_ObjDistX_1: single
  MRR_ObjExistProb_1: single
  MRR_ObjObstacleProb_1: single
  MRR_ObjID_1: uint8
  CR_R_ObjRelVelY_2: single
  CR_R_ObjRelVelX_2: single
  CR_R_ObjDistY_2: single
  CR_R_ObjDistX_2: single
  CR_R_ObjObstacleProb_2: single
  CR_R_ObjExistProb_2: single
  CR_R_ObjID_2: uint8
  CR_R_ObjRelVelY_1: single
  CR_R_ObjRelVelX_1: single
  CR_R_ObjDistY_1: single
  CR_R_ObjObstacleProb_1: single
  CR_R_ObjDistX_1: single
  CR_R_ObjExistProb_1: single
  CR_R_ObjID_1: uint8
  CR_L_ObjRelVelY_6: single
  CR_L_ObjRelVelX_6: single
  CR_L_ObjDistY_6: single
  CR_L_ObjDistX_6: single
  CR_L_ObjExistProb_6: single
  CR_L_ObjObstacleProb_6: single
  CR_L_ObjID_6: uint8

IDC_L2_GW19_RAW_BUS = Simulink.Bus(HeaderFile="Rte_Type.h")
  VFC_ObjMotionDirection_2: uint8  % IDC_L2_GW19|1|0|0|7|uint8
  VFC_ObjMotionDirection_1: uint8  % IDC_L2_GW19|1|0|0|7|uint8
  VFC_ObjMotionDirection_3: uint8  % IDC_L2_GW19|1|0|0|7|uint8
  VFC_ObjMotionDirection_4: uint8  % IDC_L2_GW19|1|0|0|7|uint8
  MRR_ObjMotionType_4: uint8  % IDC_L2_GW19|1|0|0|7|uint8
  MRR_ObjType_4: uint8  % IDC_L2_GW19|1|0|0|15|uint8
  MRR_ObjRelVelY_4: uint16  % IDC_L2_GW19|0.0312|-128|-128|126.9976|single
  MRR_ObjRelVelX_4: uint16  % IDC_L2_GW19|0.0312|-128|-128|126.9976|single
  MRR_ObjDistY_4: uint16  % IDC_L2_GW19|0.125|-128|-128|127.875|single
  MRR_ObjDistX_4: uint16  % IDC_L2_GW19|0.0625|0|0|254.9375|single
  MRR_ObjObstacleProb_4: uint8  % IDC_L2_GW19|0.03125|0|0|0.96875|single
  MRR_ObjExistProb_4: uint8  % IDC_L2_GW19|0.03125|0|0|0.96875|single
  MRR_ObjMotionType_3: uint8  % IDC_L2_GW19|1|0|0|7|uint8
  MRR_ObjType_3: uint8  % IDC_L2_GW19|1|0|0|15|uint8
  MRR_ObjID_4: uint8  % IDC_L2_GW19|1|0|0|255|uint8
  MRR_ObjRelVelY_3: uint16  % IDC_L2_GW19|0.0312|-128|-128|126.9976|single
  MRR_ObjRelVelX_3: uint16  % IDC_L2_GW19|0.0312|-128|-128|126.9976|single
  MRR_ObjDistY_3: uint16  % IDC_L2_GW19|0.125|-128|-128|127.875|single
  MRR_ObjObstacleProb_3: uint8  % IDC_L2_GW19|0.03125|0|0|0.96875|single
  MRR_ObjDistX_3: uint16  % IDC_L2_GW19|0.0625|0|0|254.9375|single
  MRR_ObjExistProb_3: uint8  % IDC_L2_GW19|0.03125|0|0|0.96875|single
  MRR_ObjType_2: uint8  % IDC_L2_GW19|1|0|0|15|uint8
  MRR_ObjID_3: uint8  % IDC_L2_GW19|1|0|0|255|uint8
  MRR_ObjMotionType_2: uint8  % IDC_L2_GW19|1|0|0|7|uint8
  MRR_ObjRelVelY_2: uint16  % IDC_L2_GW19|0.0312|-128|-128|126.9976|single
  MRR_ObjRelVelX_2: uint16  % IDC_L2_GW19|0.0312|-128|-128|126.9976|single
  MRR_ObjDistY_2: uint16  % IDC_L2_GW19|0.125|-128|-128|127.875|single
  MRR_ObjObstacleProb_2: uint8  % IDC_L2_GW19|0.03125|0|0|0.96875|single
  MRR_ObjDistX_2: uint16  % IDC_L2_GW19|0.0625|0|0|254.9375|single
  MRR_ObjExistProb_2: uint8  % IDC_L2_GW19|0.03125|0|0|0.96875|single
  MRR_ObjID_2: uint8  % IDC_L2_GW19|1|0|0|255|uint8
  MRR_ObjMotionType_1: uint8  % IDC_L2_GW19|1|0|0|7|uint8
  MRR_ObjType_1: uint8  % IDC_L2_GW19|1|0|0|15|uint8
  MRR_ObjRelVelY_1: uint16  % IDC_L2_GW19|0.0312|-128|-128|126.9976|single
  MRR_ObjRelVelX_1: uint16  % IDC_L2_GW19|0.0312|-128|-128|126.9976|single
  MRR_ObjDistY_1: uint16  % IDC_L2_GW19|0.125|-128|-128|127.875|single
  MRR_ObjDistX_1: uint16  % IDC_L2_GW19|0.0625|0|0|254.9375|single
  MRR_ObjExistProb_1: uint8  % IDC_L2_GW19|0.03125|0|0|0.96875|single
  MRR_ObjObstacleProb_1: uint8  % IDC_L2_GW19|0.03125|0|0|0.96875|single
  MRR_ObjID_1: uint8  % IDC_L2_GW19|1|0|0|255|uint8
  CR_R_ObjRelVelY_2: uint16  % IDC_L2_GW19|0.0312|-128|-128|126.9976|single
  CR_R_ObjRelVelX_2: uint16  % IDC_L2_GW19|0.0312|-128|-128|126.9976|single
  CR_R_ObjDistY_2: uint16  % IDC_L2_GW19|0.125|-128|-128|127.875|single
  CR_R_ObjDistX_2: uint16  % IDC_L2_GW19|0.0625|-128|-128|126.9375|single
  CR_R_ObjObstacleProb_2: uint8  % IDC_L2_GW19|0.032258|0|0|1|single
  CR_R_ObjExistProb_2: uint8  % IDC_L2_GW19|0.032258|0|0|1|single
  CR_R_ObjID_2: uint8  % IDC_L2_GW19|1|0|0|255|uint8
  CR_R_ObjRelVelY_1: uint16  % IDC_L2_GW19|0.0312|-128|-128|126.9976|single
  CR_R_ObjRelVelX_1: uint16  % IDC_L2_GW19|0.0312|-128|-128|126.9976|single
  CR_R_ObjDistY_1: uint16  % IDC_L2_GW19|0.125|-128|-128|127.875|single
  CR_R_ObjObstacleProb_1: uint8  % IDC_L2_GW19|0.032258|0|0|1|single
  CR_R_ObjDistX_1: uint16  % IDC_L2_GW19|0.0625|-128|-128|126.9375|single
  CR_R_ObjExistProb_1: uint8  % IDC_L2_GW19|0.032258|0|0|1|single
  CR_R_ObjID_1: uint8  % IDC_L2_GW19|1|0|0|255|uint8
  CR_L_ObjRelVelY_6: uint16  % IDC_L2_GW19|0.0312|-128|-128|126.9976|single
  CR_L_ObjRelVelX_6: uint16  % IDC_L2_GW19|0.0312|-128|-128|126.9976|single
  CR_L_ObjDistY_6: uint16  % IDC_L2_GW19|0.125|-128|-128|127.875|single
  CR_L_ObjDistX_6: uint16  % IDC_L2_GW19|0.0625|-128|-128|126.9375|single
  CR_L_ObjExistProb_6: uint8  % IDC_L2_GW19|0.032258|0|0|1|single
  CR_L_ObjObstacleProb_6: uint8  % IDC_L2_GW19|0.032258|0|0|1|single
  CR_L_ObjID_6: uint8  % IDC_L2_GW19|1|0|0|255|uint8

IDC_L2_GW2_MSG_BUS = Simulink.Bus(HeaderFile="Rte_Type.h")
  TOS_LCP6_ObjIn_Lane: uint8
  TOS_LCP6_RightLane_Prob: single
  TOS_LCP6_CurrLane_Prob: single
  TOS_LCP6_LeftLane_Prob: single
  TOS_LCP6_Obj_Age: uint16
  TOS_LCP6_Obj_ObstclProb: single
  TOS_LCP6_Obj_ExistProb: single
  TOS_LCP6_Obj_Typ_Prob: single
  TOS_LCP6_Obj_Std_HdgAng: single
  TOS_LCP6_Obj_Std_Width: single
  TOS_LCP6_Obj_Std_Len: single
  TOS_LCP6_Obj_AY: single
  TOS_LCP6_Obj_AX: single
  TOS_LCP6_Obj_Std_VY: single
  TOS_LCP6_Obj_Std_VX: single
  TOS_LCP6_Obj_Std_DY: single
  TOS_LCP6_Obj_Std_DX: single
  TOS_LCP6_Obj_Std_AY: single
  TOS_LCP6_Obj_Std_AX: single
  TOS_LCP6_Obj_VY: single
  TOS_LCP6_Obj_VX: single
  TOS_LCP6_Obj_DY: single
  TOS_LCP6_Obj_DX: single
  TOS_LCP6_Obj_MovgSt: uint8
  TOS_LCP6_Obj_Orntn: uint8
  TOS_LCP6_Obj_YawAng: single
  TOS_LCP6_Obj_HdgAng: single
  TOS_LCP6_Obj_Hei: single
  TOS_LCP6_Obj_Width: single
  TOS_LCP6_Obj_Len: single
  TOS_LCP6_Obj_Typ: uint8
  TOS_LCP6_Obj_ID: uint8
  TOS_LCP6_Obj_Fusn_Typ: uint8
  AEB_LONOBJ_dyEgo2Center: single
  AEB_LONOBJ_dyObj2Center: single
  AEB_LONOBJ_ObjMeasSts: boolean
  AEB_LONOBJ_ObjLifeCycle: uint16
  AEB_LONOBJ_ObjIsObstclProb: single
  AEB_LONOBJ_FusnTyp: uint8
  AEB_LONOBJ_ObjExistProb: single
  AEB_LONOBJ_dyVari: single
  AEB_LONOBJ_dxVari: single
  AEB_LONOBJ_ay: single
  AEB_LONOBJ_ax: single
  AEB_LONOBJ_vy: single
  AEB_LONOBJ_vx: single
  AEB_LONOBJ_dz: single
  AEB_LONOBJ_dy: single
  AEB_LONOBJ_ObjMovgSt: uint8
  AEB_LONOBJ_ObjMovgOrntn: uint8
  AEB_LONOBJ_dx: single
  AEB_LONOBJ_ObjYawAng: single
  AEB_LONOBJ_ObjHei: single
  AEB_LONOBJ_ObjWidth: single
  AEB_LONOBJ_ObjTyp: uint8
  AEB_LONOBJ_ObjTypCamCfmd: boolean
  AEB_LONOBJ_ObjLen: single
  AEB_LONOBJ_ObjID: uint8

IDC_L2_GW2_RAW_BUS = Simulink.Bus(HeaderFile="Rte_Type.h")
  TOS_LCP6_ObjIn_Lane: uint8  % IDC_L2_GW2|1|0|0|3|uint8
  TOS_LCP6_RightLane_Prob: uint8  % IDC_L2_GW2|0.01|0|0|1|single
  TOS_LCP6_CurrLane_Prob: uint8  % IDC_L2_GW2|0.01|0|0|1|single
  TOS_LCP6_LeftLane_Prob: uint8  % IDC_L2_GW2|0.01|0|0|1|single
  TOS_LCP6_Obj_Age: uint16  % IDC_L2_GW2|1|0|0|65535|uint16
  TOS_LCP6_Obj_ObstclProb: uint8  % IDC_L2_GW2|0.03125|0|0|1|single
  TOS_LCP6_Obj_ExistProb: uint8  % IDC_L2_GW2|0.01|0|0|1|single
  TOS_LCP6_Obj_Typ_Prob: uint8  % IDC_L2_GW2|0.01|0|0|1|single
  TOS_LCP6_Obj_Std_HdgAng: uint16  % IDC_L2_GW2|0.01|0|0|3.14|single
  TOS_LCP6_Obj_Std_Width: uint8  % IDC_L2_GW2|0.01|0|0|2|single
  TOS_LCP6_Obj_Std_Len: uint8  % IDC_L2_GW2|0.05|0|0|10|single
  TOS_LCP6_Obj_AY: uint16  % IDC_L2_GW2|0.05|-10.3|-10.3|7.3|single
  TOS_LCP6_Obj_AX: uint16  % IDC_L2_GW2|0.05|-10.3|-10.3|7.3|single
  TOS_LCP6_Obj_Std_VY: uint16  % IDC_L2_GW2|0.05|0|0|50|single
  TOS_LCP6_Obj_Std_VX: uint16  % IDC_L2_GW2|0.05|0|0|130|single
  TOS_LCP6_Obj_Std_DY: uint16  % IDC_L2_GW2|0.05|0|0|100|single
  TOS_LCP6_Obj_Std_DX: uint16  % IDC_L2_GW2|0.05|0|0|250|single
  TOS_LCP6_Obj_Std_AY: uint8  % IDC_L2_GW2|0.05|0|0|7.3|single
  TOS_LCP6_Obj_Std_AX: uint8  % IDC_L2_GW2|0.05|0|0|7.3|single
  TOS_LCP6_Obj_VY: uint16  % IDC_L2_GW2|0.05|-50|-50|50|single
  TOS_LCP6_Obj_VX: uint16  % IDC_L2_GW2|0.05|-120|-120|130|single
  TOS_LCP6_Obj_DY: uint16  % IDC_L2_GW2|0.05|-100|-100|100|single
  TOS_LCP6_Obj_DX: uint16  % IDC_L2_GW2|0.05|-80|-80|200|single
  TOS_LCP6_Obj_MovgSt: uint8  % IDC_L2_GW2|1|0|0|5|uint8
  TOS_LCP6_Obj_Orntn: uint8  % IDC_L2_GW2|1|0|0|10|uint8
  TOS_LCP6_Obj_YawAng: uint16  % IDC_L2_GW2|0.01|-180|-180|180|single
  TOS_LCP6_Obj_HdgAng: uint16  % IDC_L2_GW2|0.01|-180|-180|180|single
  TOS_LCP6_Obj_Hei: uint16  % IDC_L2_GW2|0.01|0.01|0.01|2.95|single
  TOS_LCP6_Obj_Width: uint16  % IDC_L2_GW2|0.01|0.04|0.04|2.98|single
  TOS_LCP6_Obj_Len: uint16  % IDC_L2_GW2|0.05|1.2|1.2|21|single
  TOS_LCP6_Obj_Typ: uint8  % IDC_L2_GW2|1|0|0|8|uint8
  TOS_LCP6_Obj_ID: uint8  % IDC_L2_GW2|1|0|0|80|uint8
  TOS_LCP6_Obj_Fusn_Typ: uint8  % IDC_L2_GW2|1|0|0|63|uint8
  AEB_LONOBJ_dyEgo2Center: uint16  % IDC_L2_GW2|0.125|-128|-128|127.875|single
  AEB_LONOBJ_dyObj2Center: uint16  % IDC_L2_GW2|0.125|-128|-128|127.875|single
  AEB_LONOBJ_ObjMeasSts: boolean  % IDC_L2_GW2|1|0|0|1|boolean
  AEB_LONOBJ_ObjLifeCycle: uint16  % IDC_L2_GW2|17|0|0|65535|uint16
  AEB_LONOBJ_ObjIsObstclProb: uint8  % IDC_L2_GW2|0.03125|0|0|0.96875|single
  AEB_LONOBJ_FusnTyp: uint8  % IDC_L2_GW2|1|0|0|63|uint8
  AEB_LONOBJ_ObjExistProb: uint8  % IDC_L2_GW2|0.015625|0|0|0.98438|single
  AEB_LONOBJ_dyVari: uint8  % IDC_L2_GW2|0.0625|0|0|15.5|single
  AEB_LONOBJ_dxVari: uint8  % IDC_L2_GW2|0.0625|0|0|15.5|single
  AEB_LONOBJ_ay: uint16  % IDC_L2_GW2|0.03125|-16|-16|15.9688|single
  AEB_LONOBJ_ax: uint16  % IDC_L2_GW2|0.03125|-16|-16|15.9688|single
  AEB_LONOBJ_vy: uint16  % IDC_L2_GW2|0.125|-64|-64|63.875|single
  AEB_LONOBJ_vx: uint16  % IDC_L2_GW2|0.0625|-128|-128|127|single
  AEB_LONOBJ_dz: uint16  % IDC_L2_GW2|0.05|-102.4|-102.4|102.3|single
  AEB_LONOBJ_dy: uint16  % IDC_L2_GW2|0.125|-128|-128|127.875|single
  AEB_LONOBJ_ObjMovgSt: uint8  % IDC_L2_GW2|1|0|0|4|uint8
  AEB_LONOBJ_ObjMovgOrntn: uint8  % IDC_L2_GW2|1|0|0|3|uint8
  AEB_LONOBJ_dx: uint16  % IDC_L2_GW2|0.0625|0|0|255.9375|single
  AEB_LONOBJ_ObjYawAng: uint16  % IDC_L2_GW2|0.01|-180|-180|180|single
  AEB_LONOBJ_ObjHei: uint16  % IDC_L2_GW2|0.01|0|0|6|single
  AEB_LONOBJ_ObjWidth: uint16  % IDC_L2_GW2|0.01|0|0|5|single
  AEB_LONOBJ_ObjTyp: uint8  % IDC_L2_GW2|1|0|0|8|uint8
  AEB_LONOBJ_ObjTypCamCfmd: boolean  % IDC_L2_GW2|1|0|0|1|boolean
  AEB_LONOBJ_ObjLen: uint16  % IDC_L2_GW2|0.05|0|0|20|single
  AEB_LONOBJ_ObjID: uint8  % IDC_L2_GW2|1|0|0|255|uint8

IDC_L2_GW20_MSG_BUS = Simulink.Bus(HeaderFile="Rte_Type.h")
  VFC_ObjMotionDirection_8: uint8
  VFC_ObjMotionDirection_7: uint8
  VFC_ObjMotionDirection_5: uint8
  VFC_ObjMotionDirection_6: uint8
  CR_R_ObjRelVelY_5: single
  CR_R_ObjRelVelX_5: single
  CR_R_ObjDistY_5: single
  CR_R_ObjDistX_5: single
  CR_R_ObjObstacleProb_5: single
  CR_R_ObjExistProb_5: single
  CR_R_ObjID_5: uint8
  CR_R_ObjRelVelY_4: single
  CR_R_ObjRelVelX_4: single
  CR_R_ObjDistY_4: single
  CR_R_ObjObstacleProb_4: single
  CR_R_ObjDistX_4: single
  CR_R_ObjExistProb_4: single
  CR_R_ObjID_4: uint8
  CR_R_ObjRelVelY_3: single
  CR_R_ObjRelVelX_3: single
  CR_R_ObjDistY_3: single
  CR_R_ObjDistX_3: single
  CR_R_ObjExistProb_3: single
  CR_R_ObjObstacleProb_3: single
  CR_R_ObjID_3: uint8
  MRR_ObjMotionType_8: uint8
  MRR_ObjType_8: uint8
  MRR_ObjRelVelY_8: single
  MRR_ObjRelVelX_8: single
  MRR_ObjDistY_8: single
  MRR_ObjDistX_8: single
  MRR_ObjObstacleProb_8: single
  MRR_ObjExistProb_8: single
  MRR_ObjType_7: uint8
  MRR_ObjID_8: uint8
  MRR_ObjMotionType_7: uint8
  MRR_ObjRelVelY_7: single
  MRR_ObjRelVelX_7: single
  MRR_ObjDistY_7: single
  MRR_ObjObstacleProb_7: single
  MRR_ObjDistX_7: single
  MRR_ObjExistProb_7: single
  MRR_ObjType_6: uint8
  MRR_ObjID_7: uint8
  MRR_ObjMotionType_6: uint8
  MRR_ObjRelVelY_6: single
  MRR_ObjRelVelX_6: single
  MRR_ObjDistY_6: single
  MRR_ObjDistX_6: single
  MRR_ObjExistProb_6: single
  MRR_ObjObstacleProb_6: single
  MRR_ObjID_6: uint8
  MRR_ObjMotionType_5: uint8
  MRR_ObjType_5: uint8
  MRR_ObjRelVelY_5: single
  MRR_ObjRelVelX_5: single
  MRR_ObjDistY_5: single
  MRR_ObjDistX_5: single
  MRR_ObjExistProb_5: single
  MRR_ObjObstacleProb_5: single
  MRR_ObjID_5: uint8

IDC_L2_GW20_RAW_BUS = Simulink.Bus(HeaderFile="Rte_Type.h")
  VFC_ObjMotionDirection_8: uint8  % IDC_L2_GW20|1|0|0|7|uint8
  VFC_ObjMotionDirection_7: uint8  % IDC_L2_GW20|1|0|0|7|uint8
  VFC_ObjMotionDirection_5: uint8  % IDC_L2_GW20|1|0|0|7|uint8
  VFC_ObjMotionDirection_6: uint8  % IDC_L2_GW20|1|0|0|7|uint8
  CR_R_ObjRelVelY_5: uint16  % IDC_L2_GW20|0.0312|-128|-128|126.9976|single
  CR_R_ObjRelVelX_5: uint16  % IDC_L2_GW20|0.0312|-128|-128|126.9976|single
  CR_R_ObjDistY_5: uint16  % IDC_L2_GW20|0.125|-128|-128|127.875|single
  CR_R_ObjDistX_5: uint16  % IDC_L2_GW20|0.0625|-128|-128|126.9375|single
  CR_R_ObjObstacleProb_5: uint8  % IDC_L2_GW20|0.032258|0|0|1|single
  CR_R_ObjExistProb_5: uint8  % IDC_L2_GW20|0.032258|0|0|1|single
  CR_R_ObjID_5: uint8  % IDC_L2_GW20|1|0|0|255|uint8
  CR_R_ObjRelVelY_4: uint16  % IDC_L2_GW20|0.0312|-128|-128|126.9976|single
  CR_R_ObjRelVelX_4: uint16  % IDC_L2_GW20|0.0312|-128|-128|126.9976|single
  CR_R_ObjDistY_4: uint16  % IDC_L2_GW20|0.125|-128|-128|127.875|single
  CR_R_ObjObstacleProb_4: uint8  % IDC_L2_GW20|0.032258|0|0|1|single
  CR_R_ObjDistX_4: uint16  % IDC_L2_GW20|0.0625|-128|-128|126.9375|single
  CR_R_ObjExistProb_4: uint8  % IDC_L2_GW20|0.032258|0|0|1|single
  CR_R_ObjID_4: uint8  % IDC_L2_GW20|1|0|0|255|uint8
  CR_R_ObjRelVelY_3: uint16  % IDC_L2_GW20|0.0312|-128|-128|126.9976|single
  CR_R_ObjRelVelX_3: uint16  % IDC_L2_GW20|0.0312|-128|-128|126.9976|single
  CR_R_ObjDistY_3: uint16  % IDC_L2_GW20|0.125|-128|-128|127.875|single
  CR_R_ObjDistX_3: uint16  % IDC_L2_GW20|0.0625|-128|-128|126.9375|single
  CR_R_ObjExistProb_3: uint8  % IDC_L2_GW20|0.032258|0|0|1|single
  CR_R_ObjObstacleProb_3: uint8  % IDC_L2_GW20|0.032258|0|0|1|single
  CR_R_ObjID_3: uint8  % IDC_L2_GW20|1|0|0|255|uint8
  MRR_ObjMotionType_8: uint8  % IDC_L2_GW20|1|0|0|7|uint8
  MRR_ObjType_8: uint8  % IDC_L2_GW20|1|0|0|15|uint8
  MRR_ObjRelVelY_8: uint16  % IDC_L2_GW20|0.0312|-128|-128|126.9976|single
  MRR_ObjRelVelX_8: uint16  % IDC_L2_GW20|0.0312|-128|-128|126.9976|single
  MRR_ObjDistY_8: uint16  % IDC_L2_GW20|0.125|-128|-128|127.875|single
  MRR_ObjDistX_8: uint16  % IDC_L2_GW20|0.0625|0|0|254.9375|single
  MRR_ObjObstacleProb_8: uint8  % IDC_L2_GW20|0.03125|0|0|0.96875|single
  MRR_ObjExistProb_8: uint8  % IDC_L2_GW20|0.03125|0|0|0.96875|single
  MRR_ObjType_7: uint8  % IDC_L2_GW20|1|0|0|15|uint8
  MRR_ObjID_8: uint8  % IDC_L2_GW20|1|0|0|255|uint8
  MRR_ObjMotionType_7: uint8  % IDC_L2_GW20|1|0|0|7|uint8
  MRR_ObjRelVelY_7: uint16  % IDC_L2_GW20|0.0312|-128|-128|126.9976|single
  MRR_ObjRelVelX_7: uint16  % IDC_L2_GW20|0.0312|-128|-128|126.9976|single
  MRR_ObjDistY_7: uint16  % IDC_L2_GW20|0.125|-128|-128|127.875|single
  MRR_ObjObstacleProb_7: uint8  % IDC_L2_GW20|0.03125|0|0|0.96875|single
  MRR_ObjDistX_7: uint16  % IDC_L2_GW20|0.0625|0|0|254.9375|single
  MRR_ObjExistProb_7: uint8  % IDC_L2_GW20|0.03125|0|0|0.96875|single
  MRR_ObjType_6: uint8  % IDC_L2_GW20|1|0|0|15|uint8
  MRR_ObjID_7: uint8  % IDC_L2_GW20|1|0|0|255|uint8
  MRR_ObjMotionType_6: uint8  % IDC_L2_GW20|1|0|0|7|uint8
  MRR_ObjRelVelY_6: uint16  % IDC_L2_GW20|0.0312|-128|-128|126.9976|single
  MRR_ObjRelVelX_6: uint16  % IDC_L2_GW20|0.0312|-128|-128|126.9976|single
  MRR_ObjDistY_6: uint16  % IDC_L2_GW20|0.125|-128|-128|127.875|single
  MRR_ObjDistX_6: uint16  % IDC_L2_GW20|0.0625|0|0|254.9375|single
  MRR_ObjExistProb_6: uint8  % IDC_L2_GW20|0.03125|0|0|0.96875|single
  MRR_ObjObstacleProb_6: uint8  % IDC_L2_GW20|0.03125|0|0|0.96875|single
  MRR_ObjID_6: uint8  % IDC_L2_GW20|1|0|0|255|uint8
  MRR_ObjMotionType_5: uint8  % IDC_L2_GW20|1|0|0|7|uint8
  MRR_ObjType_5: uint8  % IDC_L2_GW20|1|0|0|15|uint8
  MRR_ObjRelVelY_5: uint16  % IDC_L2_GW20|0.0312|-128|-128|126.9976|single
  MRR_ObjRelVelX_5: uint16  % IDC_L2_GW20|0.0312|-128|-128|126.9976|single
  MRR_ObjDistY_5: uint16  % IDC_L2_GW20|0.125|-128|-128|127.875|single
  MRR_ObjDistX_5: uint16  % IDC_L2_GW20|0.0625|0|0|254.9375|single
  MRR_ObjExistProb_5: uint8  % IDC_L2_GW20|0.03125|0|0|0.96875|single
  MRR_ObjObstacleProb_5: uint8  % IDC_L2_GW20|0.03125|0|0|0.96875|single
  MRR_ObjID_5: uint8  % IDC_L2_GW20|1|0|0|255|uint8

IDC_L2_GW21_MSG_BUS = Simulink.Bus(HeaderFile="Rte_Type.h")
  VFC_ObjMotionDirection_12: uint8
  VFC_ObjMotionDirection_11: uint8
  VFC_ObjMotionDirection_9: uint8
  VFC_ObjMotionDirection_10: uint8
  MRR_ObjMotionType_12: uint8
  MRR_ObjType_12: uint8
  MRR_ObjRelVelY_12: single
  MRR_ObjRelVelX_12: single
  MRR_ObjDistY_12: single
  MRR_ObjDistX_12: single
  MRR_ObjObstacleProb_12: single
  MRR_ObjExistProb_12: single
  MRR_ObjMotionType_11: uint8
  MRR_ObjType_11: uint8
  MRR_ObjID_12: uint8
  MRR_ObjRelVelY_11: single
  MRR_ObjRelVelX_11: single
  MRR_ObjDistY_11: single
  MRR_ObjObstacleProb_11: single
  MRR_ObjDistX_11: single
  MRR_ObjExistProb_11: single
  MRR_ObjType_10: uint8
  MRR_ObjID_11: uint8
  MRR_ObjMotionType_10: uint8
  MRR_ObjRelVelY_10: single
  MRR_ObjRelVelX_10: single
  MRR_ObjDistY_10: single
  MRR_ObjObstacleProb_10: single
  MRR_ObjDistX_10: single
  MRR_ObjExistProb_10: single
  MRR_ObjID_10: uint8
  MRR_ObjMotionType_9: uint8
  MRR_ObjType_9: uint8
  MRR_ObjRelVelY_9: single
  MRR_ObjRelVelX_9: single
  MRR_ObjDistY_9: single
  MRR_ObjDistX_9: single
  MRR_ObjExistProb_9: single
  MRR_ObjObstacleProb_9: single
  MRR_ObjID_9: uint8
  RSDS_L_ObjRelVelY_2: single
  RSDS_L_ObjRelVelX_2: single
  RSDS_L_ObjDistY_2: single
  RSDS_L_ObjDistX_2: single
  RSDS_L_ObjObstacleProb_2: single
  RSDS_L_ObjExistProb_2: single
  RSDS_L_ObjID_2: uint8
  RSDS_L_ObjRelVelY_1: single
  RSDS_L_ObjRelVelX_1: single
  RSDS_L_ObjDistY_1: single
  RSDS_L_ObjObstacleProb_1: single
  RSDS_L_ObjDistX_1: single
  RSDS_L_ObjExistProb_1: single
  RSDS_L_ObjID_1: uint8
  CR_R_ObjRelVelY_6: single
  CR_R_ObjRelVelX_6: single
  CR_R_ObjDistY_6: single
  CR_R_ObjDistX_6: single
  CR_R_ObjExistProb_6: single
  CR_R_ObjObstacleProb_6: single
  CR_R_ObjID_6: uint8

IDC_L2_GW21_RAW_BUS = Simulink.Bus(HeaderFile="Rte_Type.h")
  VFC_ObjMotionDirection_12: uint8  % IDC_L2_GW21|1|0|0|7|uint8
  VFC_ObjMotionDirection_11: uint8  % IDC_L2_GW21|1|0|0|7|uint8
  VFC_ObjMotionDirection_9: uint8  % IDC_L2_GW21|1|0|0|7|uint8
  VFC_ObjMotionDirection_10: uint8  % IDC_L2_GW21|1|0|0|7|uint8
  MRR_ObjMotionType_12: uint8  % IDC_L2_GW21|1|0|0|7|uint8
  MRR_ObjType_12: uint8  % IDC_L2_GW21|1|0|0|15|uint8
  MRR_ObjRelVelY_12: uint16  % IDC_L2_GW21|0.0312|-128|-128|126.9976|single
  MRR_ObjRelVelX_12: uint16  % IDC_L2_GW21|0.0312|-128|-128|126.9976|single
  MRR_ObjDistY_12: uint16  % IDC_L2_GW21|0.125|-128|-128|127.875|single
  MRR_ObjDistX_12: uint16  % IDC_L2_GW21|0.0625|0|0|254.9375|single
  MRR_ObjObstacleProb_12: uint8  % IDC_L2_GW21|0.03125|0|0|0.96875|single
  MRR_ObjExistProb_12: uint8  % IDC_L2_GW21|0.03125|0|0|0.96875|single
  MRR_ObjMotionType_11: uint8  % IDC_L2_GW21|1|0|0|7|uint8
  MRR_ObjType_11: uint8  % IDC_L2_GW21|1|0|0|15|uint8
  MRR_ObjID_12: uint8  % IDC_L2_GW21|1|0|0|255|uint8
  MRR_ObjRelVelY_11: uint16  % IDC_L2_GW21|0.0312|-128|-128|126.9976|single
  MRR_ObjRelVelX_11: uint16  % IDC_L2_GW21|0.0312|-128|-128|126.9976|single
  MRR_ObjDistY_11: uint16  % IDC_L2_GW21|0.125|-128|-128|127.875|single
  MRR_ObjObstacleProb_11: uint8  % IDC_L2_GW21|0.03125|0|0|0.96875|single
  MRR_ObjDistX_11: uint16  % IDC_L2_GW21|0.0625|0|0|254.9375|single
  MRR_ObjExistProb_11: uint8  % IDC_L2_GW21|0.03125|0|0|0.96875|single
  MRR_ObjType_10: uint8  % IDC_L2_GW21|1|0|0|15|uint8
  MRR_ObjID_11: uint8  % IDC_L2_GW21|1|0|0|255|uint8
  MRR_ObjMotionType_10: uint8  % IDC_L2_GW21|1|0|0|7|uint8
  MRR_ObjRelVelY_10: uint16  % IDC_L2_GW21|0.0312|-128|-128|126.9976|single
  MRR_ObjRelVelX_10: uint16  % IDC_L2_GW21|0.0312|-128|-128|126.9976|single
  MRR_ObjDistY_10: uint16  % IDC_L2_GW21|0.125|-128|-128|127.875|single
  MRR_ObjObstacleProb_10: uint8  % IDC_L2_GW21|0.03125|0|0|0.96875|single
  MRR_ObjDistX_10: uint16  % IDC_L2_GW21|0.0625|0|0|254.9375|single
  MRR_ObjExistProb_10: uint8  % IDC_L2_GW21|0.03125|0|0|0.96875|single
  MRR_ObjID_10: uint8  % IDC_L2_GW21|1|0|0|255|uint8
  MRR_ObjMotionType_9: uint8  % IDC_L2_GW21|1|0|0|7|uint8
  MRR_ObjType_9: uint8  % IDC_L2_GW21|1|0|0|15|uint8
  MRR_ObjRelVelY_9: uint16  % IDC_L2_GW21|0.0312|-128|-128|126.9976|single
  MRR_ObjRelVelX_9: uint16  % IDC_L2_GW21|0.0312|-128|-128|126.9976|single
  MRR_ObjDistY_9: uint16  % IDC_L2_GW21|0.125|-128|-128|127.875|single
  MRR_ObjDistX_9: uint16  % IDC_L2_GW21|0.0625|0|0|254.9375|single
  MRR_ObjExistProb_9: uint8  % IDC_L2_GW21|0.03125|0|0|0.96875|single
  MRR_ObjObstacleProb_9: uint8  % IDC_L2_GW21|0.03125|0|0|0.96875|single
  MRR_ObjID_9: uint8  % IDC_L2_GW21|1|0|0|255|uint8
  RSDS_L_ObjRelVelY_2: uint16  % IDC_L2_GW21|0.0312|-128|-128|126.9976|single
  RSDS_L_ObjRelVelX_2: uint16  % IDC_L2_GW21|0.0312|-128|-128|126.9976|single
  RSDS_L_ObjDistY_2: uint16  % IDC_L2_GW21|0.125|-128|-128|127.875|single
  RSDS_L_ObjDistX_2: uint16  % IDC_L2_GW21|0.0625|-128|0|126.9375|single
  RSDS_L_ObjObstacleProb_2: uint8  % IDC_L2_GW21|0.032258|0|0|1|single
  RSDS_L_ObjExistProb_2: uint8  % IDC_L2_GW21|0.032258|0|0|1|single
  RSDS_L_ObjID_2: uint8  % IDC_L2_GW21|1|0|0|255|uint8
  RSDS_L_ObjRelVelY_1: uint16  % IDC_L2_GW21|0.0312|-128|-128|126.9976|single
  RSDS_L_ObjRelVelX_1: uint16  % IDC_L2_GW21|0.0312|-128|-128|126.9976|single
  RSDS_L_ObjDistY_1: uint16  % IDC_L2_GW21|0.125|-128|-128|127.875|single
  RSDS_L_ObjObstacleProb_1: uint8  % IDC_L2_GW21|0.032258|0|0|1|single
  RSDS_L_ObjDistX_1: uint16  % IDC_L2_GW21|0.0625|-128|0|126.9375|single
  RSDS_L_ObjExistProb_1: uint8  % IDC_L2_GW21|0.032258|0|0|1|single
  RSDS_L_ObjID_1: uint8  % IDC_L2_GW21|1|0|0|255|uint8
  CR_R_ObjRelVelY_6: uint16  % IDC_L2_GW21|0.0312|-128|-128|126.9976|single
  CR_R_ObjRelVelX_6: uint16  % IDC_L2_GW21|0.0312|-128|-128|126.9976|single
  CR_R_ObjDistY_6: uint16  % IDC_L2_GW21|0.125|-128|-128|127.875|single
  CR_R_ObjDistX_6: uint16  % IDC_L2_GW21|0.0625|-128|-128|126.9375|single
  CR_R_ObjExistProb_6: uint8  % IDC_L2_GW21|0.032258|0|0|1|single
  CR_R_ObjObstacleProb_6: uint8  % IDC_L2_GW21|0.032258|0|0|1|single
  CR_R_ObjID_6: uint8  % IDC_L2_GW21|1|0|0|255|uint8

IDC_L2_GW22_MSG_BUS = Simulink.Bus(HeaderFile="Rte_Type.h")
  RSDS_L_ObjRelVelY_5: single
  RSDS_L_ObjRelVelX_5: single
  RSDS_L_ObjDistY_5: single
  RSDS_L_ObjDistX_5: single
  RSDS_L_ObjExistProb_5: single
  RSDS_L_ObjObstacleProb_5: single
  RSDS_L_ObjID_5: uint8
  RSDS_L_ObjRelVelY_4: single
  RSDS_L_ObjRelVelX_4: single
  RSDS_L_ObjDistY_4: single
  RSDS_L_ObjDistX_4: single
  RSDS_L_ObjObstacleProb_4: single
  RSDS_L_ObjExistProb_4: single
  RSDS_L_ObjID_4: uint8
  RSDS_L_ObjRelVelY_3: single
  RSDS_L_ObjRelVelX_3: single
  RSDS_L_ObjDistY_3: single
  RSDS_L_ObjObstacleProb_3: single
  RSDS_L_ObjDistX_3: single
  RSDS_L_ObjExistProb_3: single
  MRR_ObjType_16: uint8
  RSDS_L_ObjID_3: uint8
  MRR_ObjMotionType_16: uint8
  VFC_ObjMotionDirection_16: uint8
  MRR_ObjRelVelY_16: single
  MRR_ObjRelVelX_16: single
  MRR_ObjDistY_16: single
  MRR_ObjDistX_16: single
  MRR_ObjObstacleProb_16: single
  MRR_ObjExistProb_16: single
  VFC_ObjMotionDirection_15: uint8
  MRR_ObjType_15: uint8
  MRR_ObjID_16: uint8
  MRR_ObjMotionType_15: uint8
  MRR_ObjRelVelY_15: single
  MRR_ObjRelVelX_15: single
  MRR_ObjDistY_15: single
  MRR_ObjDistX_15: single
  MRR_ObjExistProb_15: single
  MRR_ObjObstacleProb_15: single
  MRR_ObjID_15: uint8
  MRR_ObjMotionType_14: uint8
  VFC_ObjMotionDirection_14: uint8
  MRR_ObjType_14: uint8
  MRR_ObjRelVelY_14: single
  MRR_ObjRelVelX_14: single
  MRR_ObjDistY_14: single
  MRR_ObjObstacleProb_14: single
  MRR_ObjDistX_14: single
  MRR_ObjExistProb_14: single
  MRR_ObjType_13: uint8
  MRR_ObjID_14: uint8
  MRR_ObjMotionType_13: uint8
  VFC_ObjMotionDirection_13: uint8
  MRR_ObjRelVelY_13: single
  MRR_ObjRelVelX_13: single
  MRR_ObjDistY_13: single
  MRR_ObjDistX_13: single
  MRR_ObjExistProb_13: single
  MRR_ObjObstacleProb_13: single
  MRR_ObjID_13: uint8

IDC_L2_GW22_RAW_BUS = Simulink.Bus(HeaderFile="Rte_Type.h")
  RSDS_L_ObjRelVelY_5: uint16  % IDC_L2_GW22|0.0312|-128|-128|126.9976|single
  RSDS_L_ObjRelVelX_5: uint16  % IDC_L2_GW22|0.0312|-128|-128|126.9976|single
  RSDS_L_ObjDistY_5: uint16  % IDC_L2_GW22|0.125|-128|-128|127.875|single
  RSDS_L_ObjDistX_5: uint16  % IDC_L2_GW22|0.0625|-128|0|126.9375|single
  RSDS_L_ObjExistProb_5: uint8  % IDC_L2_GW22|0.032258|0|0|1|single
  RSDS_L_ObjObstacleProb_5: uint8  % IDC_L2_GW22|0.032258|0|0|1|single
  RSDS_L_ObjID_5: uint8  % IDC_L2_GW22|1|0|0|255|uint8
  RSDS_L_ObjRelVelY_4: uint16  % IDC_L2_GW22|0.0312|-128|-128|126.9976|single
  RSDS_L_ObjRelVelX_4: uint16  % IDC_L2_GW22|0.0312|-128|-128|126.9976|single
  RSDS_L_ObjDistY_4: uint16  % IDC_L2_GW22|0.125|-128|-128|127.875|single
  RSDS_L_ObjDistX_4: uint16  % IDC_L2_GW22|0.0625|-128|0|126.9375|single
  RSDS_L_ObjObstacleProb_4: uint8  % IDC_L2_GW22|0.032258|0|0|1|single
  RSDS_L_ObjExistProb_4: uint8  % IDC_L2_GW22|0.032258|0|0|1|single
  RSDS_L_ObjID_4: uint8  % IDC_L2_GW22|1|0|0|255|uint8
  RSDS_L_ObjRelVelY_3: uint16  % IDC_L2_GW22|0.0312|-128|-128|126.9976|single
  RSDS_L_ObjRelVelX_3: uint16  % IDC_L2_GW22|0.0312|-128|-128|126.9976|single
  RSDS_L_ObjDistY_3: uint16  % IDC_L2_GW22|0.125|-128|-128|127.875|single
  RSDS_L_ObjObstacleProb_3: uint8  % IDC_L2_GW22|0.032258|0|0|1|single
  RSDS_L_ObjDistX_3: uint16  % IDC_L2_GW22|0.0625|-128|0|126.9375|single
  RSDS_L_ObjExistProb_3: uint8  % IDC_L2_GW22|0.032258|0|0|1|single
  MRR_ObjType_16: uint8  % IDC_L2_GW22|1|0|0|15|uint8
  RSDS_L_ObjID_3: uint8  % IDC_L2_GW22|1|0|0|255|uint8
  MRR_ObjMotionType_16: uint8  % IDC_L2_GW22|1|0|0|7|uint8
  VFC_ObjMotionDirection_16: uint8  % IDC_L2_GW22|1|0|0|7|uint8
  MRR_ObjRelVelY_16: uint16  % IDC_L2_GW22|0.0312|-128|-128|126.9976|single
  MRR_ObjRelVelX_16: uint16  % IDC_L2_GW22|0.0312|-128|-128|126.9976|single
  MRR_ObjDistY_16: uint16  % IDC_L2_GW22|0.125|-128|-128|127.875|single
  MRR_ObjDistX_16: uint16  % IDC_L2_GW22|0.0625|0|0|254.9375|single
  MRR_ObjObstacleProb_16: uint8  % IDC_L2_GW22|0.03125|0|0|0.96875|single
  MRR_ObjExistProb_16: uint8  % IDC_L2_GW22|0.03125|0|0|0.96875|single
  VFC_ObjMotionDirection_15: uint8  % IDC_L2_GW22|1|0|0|7|uint8
  MRR_ObjType_15: uint8  % IDC_L2_GW22|1|0|0|15|uint8
  MRR_ObjID_16: uint8  % IDC_L2_GW22|1|0|0|255|uint8
  MRR_ObjMotionType_15: uint8  % IDC_L2_GW22|1|0|0|7|uint8
  MRR_ObjRelVelY_15: uint16  % IDC_L2_GW22|0.0312|-128|-128|126.9976|single
  MRR_ObjRelVelX_15: uint16  % IDC_L2_GW22|0.0312|-128|-128|126.9976|single
  MRR_ObjDistY_15: uint16  % IDC_L2_GW22|0.125|-128|-128|127.875|single
  MRR_ObjDistX_15: uint16  % IDC_L2_GW22|0.0625|0|0|254.9375|single
  MRR_ObjExistProb_15: uint8  % IDC_L2_GW22|0.03125|0|0|0.96875|single
  MRR_ObjObstacleProb_15: uint8  % IDC_L2_GW22|0.03125|0|0|0.96875|single
  MRR_ObjID_15: uint8  % IDC_L2_GW22|1|0|0|255|uint8
  MRR_ObjMotionType_14: uint8  % IDC_L2_GW22|1|0|0|7|uint8
  VFC_ObjMotionDirection_14: uint8  % IDC_L2_GW22|1|0|0|7|uint8
  MRR_ObjType_14: uint8  % IDC_L2_GW22|1|0|0|15|uint8
  MRR_ObjRelVelY_14: uint16  % IDC_L2_GW22|0.0312|-128|-128|126.9976|single
  MRR_ObjRelVelX_14: uint16  % IDC_L2_GW22|0.0312|-128|-128|126.9976|single
  MRR_ObjDistY_14: uint16  % IDC_L2_GW22|0.125|-128|-128|127.875|single
  MRR_ObjObstacleProb_14: uint8  % IDC_L2_GW22|0.03125|0|0|0.96875|single
  MRR_ObjDistX_14: uint16  % IDC_L2_GW22|0.0625|0|0|254.9375|single
  MRR_ObjExistProb_14: uint8  % IDC_L2_GW22|0.03125|0|0|0.96875|single
  MRR_ObjType_13: uint8  % IDC_L2_GW22|1|0|0|15|uint8
  MRR_ObjID_14: uint8  % IDC_L2_GW22|1|0|0|255|uint8
  MRR_ObjMotionType_13: uint8  % IDC_L2_GW22|1|0|0|7|uint8
  VFC_ObjMotionDirection_13: uint8  % IDC_L2_GW22|1|0|0|7|uint8
  MRR_ObjRelVelY_13: uint16  % IDC_L2_GW22|0.0312|-128|-128|126.9976|single
  MRR_ObjRelVelX_13: uint16  % IDC_L2_GW22|0.0312|-128|-128|126.9976|single
  MRR_ObjDistY_13: uint16  % IDC_L2_GW22|0.125|-128|-128|127.875|single
  MRR_ObjDistX_13: uint16  % IDC_L2_GW22|0.0625|0|0|254.9375|single
  MRR_ObjExistProb_13: uint8  % IDC_L2_GW22|0.03125|0|0|0.96875|single
  MRR_ObjObstacleProb_13: uint8  % IDC_L2_GW22|0.03125|0|0|0.96875|single
  MRR_ObjID_13: uint8  % IDC_L2_GW22|1|0|0|255|uint8

IDC_L2_GW23_MSG_BUS = Simulink.Bus(HeaderFile="Rte_Type.h")
  MRR_ObjType_20: uint8
  MRR_ObjMotionType_20: uint8
  VFC_ObjMotionDirection_20: uint8
  MRR_ObjRelVelY_20: single
  MRR_ObjRelVelX_20: single
  MRR_ObjDistY_20: single
  MRR_ObjDistX_20: single
  MRR_ObjExistProb_20: single
  MRR_ObjObstacleProb_20: single
  MRR_ObjID_20: uint8
  VFC_ObjMotionDirection_19: uint8
  MRR_ObjType_19: uint8
  MRR_ObjMotionType_19: uint8
  MRR_ObjRelVelY_19: single
  MRR_ObjRelVelX_19: single
  MRR_ObjDistY_19: single
  MRR_ObjObstacleProb_19: single
  MRR_ObjDistX_19: single
  MRR_ObjExistProb_19: single
  MRR_ObjID_19: uint8
  MRR_ObjMotionType_18: uint8
  VFC_ObjMotionDirection_18: uint8
  MRR_ObjType_18: uint8
  MRR_ObjRelVelY_18: single
  MRR_ObjRelVelX_18: single
  MRR_ObjDistY_18: single
  MRR_ObjDistX_18: single
  MRR_ObjObstacleProb_18: single
  MRR_ObjExistProb_18: single
  MRR_ObjType_17: uint8
  MRR_ObjID_18: uint8
  MRR_ObjMotionType_17: uint8
  VFC_ObjMotionDirection_17: uint8
  MRR_ObjRelVelY_17: single
  MRR_ObjRelVelX_17: single
  MRR_ObjDistY_17: single
  MRR_ObjDistX_17: single
  MRR_ObjExistProb_17: single
  MRR_ObjObstacleProb_17: single
  MRR_ObjID_17: uint8
  RSDS_R_ObjRelVelY_2: single
  RSDS_R_ObjRelVelX_2: single
  RSDS_R_ObjDistY_2: single
  RSDS_R_ObjDistX_2: single
  RSDS_R_ObjObstacleProb_2: single
  RSDS_R_ObjExistProb_2: single
  RSDS_R_ObjID_2: uint8
  RSDS_R_ObjRelVelY_1: single
  RSDS_R_ObjRelVelX_1: single
  RSDS_R_ObjDistY_1: single
  RSDS_R_ObjObstacleProb_1: single
  RSDS_R_ObjDistX_1: single
  RSDS_R_ObjExistProb_1: single
  RSDS_R_ObjID_1: uint8
  RSDS_L_ObjRelVelY_6: single
  RSDS_L_ObjRelVelX_6: single
  RSDS_L_ObjDistY_6: single
  RSDS_L_ObjDistX_6: single
  RSDS_L_ObjExistProb_6: single
  RSDS_L_ObjObstacleProb_6: single
  RSDS_L_ObjID_6: uint8

IDC_L2_GW23_RAW_BUS = Simulink.Bus(HeaderFile="Rte_Type.h")
  MRR_ObjType_20: uint8  % IDC_L2_GW23|1|0|0|15|uint8
  MRR_ObjMotionType_20: uint8  % IDC_L2_GW23|1|0|0|7|uint8
  VFC_ObjMotionDirection_20: uint8  % IDC_L2_GW23|1|0|0|7|uint8
  MRR_ObjRelVelY_20: uint16  % IDC_L2_GW23|0.0312|-128|-128|126.9976|single
  MRR_ObjRelVelX_20: uint16  % IDC_L2_GW23|0.0312|-128|-128|126.9976|single
  MRR_ObjDistY_20: uint16  % IDC_L2_GW23|0.125|-128|-128|127.875|single
  MRR_ObjDistX_20: uint16  % IDC_L2_GW23|0.0625|0|0|254.9375|single
  MRR_ObjExistProb_20: uint8  % IDC_L2_GW23|0.03125|0|0|0.96875|single
  MRR_ObjObstacleProb_20: uint8  % IDC_L2_GW23|0.03125|0|0|0.96875|single
  MRR_ObjID_20: uint8  % IDC_L2_GW23|1|0|0|255|uint8
  VFC_ObjMotionDirection_19: uint8  % IDC_L2_GW23|1|0|0|7|uint8
  MRR_ObjType_19: uint8  % IDC_L2_GW23|1|0|0|15|uint8
  MRR_ObjMotionType_19: uint8  % IDC_L2_GW23|1|0|0|7|uint8
  MRR_ObjRelVelY_19: uint16  % IDC_L2_GW23|0.0312|-128|-128|126.9976|single
  MRR_ObjRelVelX_19: uint16  % IDC_L2_GW23|0.0312|-128|-128|126.9976|single
  MRR_ObjDistY_19: uint16  % IDC_L2_GW23|0.125|-128|-128|127.875|single
  MRR_ObjObstacleProb_19: uint8  % IDC_L2_GW23|0.03125|0|0|0.96875|single
  MRR_ObjDistX_19: uint16  % IDC_L2_GW23|0.0625|0|0|254.9375|single
  MRR_ObjExistProb_19: uint8  % IDC_L2_GW23|0.03125|0|0|0.96875|single
  MRR_ObjID_19: uint8  % IDC_L2_GW23|1|0|0|255|uint8
  MRR_ObjMotionType_18: uint8  % IDC_L2_GW23|1|0|0|7|uint8
  VFC_ObjMotionDirection_18: uint8  % IDC_L2_GW23|1|0|0|7|uint8
  MRR_ObjType_18: uint8  % IDC_L2_GW23|1|0|0|15|uint8
  MRR_ObjRelVelY_18: uint16  % IDC_L2_GW23|0.0312|-128|-128|126.9976|single
  MRR_ObjRelVelX_18: uint16  % IDC_L2_GW23|0.0312|-128|-128|126.9976|single
  MRR_ObjDistY_18: uint16  % IDC_L2_GW23|0.125|-128|-128|127.875|single
  MRR_ObjDistX_18: uint16  % IDC_L2_GW23|0.0625|0|0|254.9375|single
  MRR_ObjObstacleProb_18: uint8  % IDC_L2_GW23|0.03125|0|0|0.96875|single
  MRR_ObjExistProb_18: uint8  % IDC_L2_GW23|0.03125|0|0|0.96875|single
  MRR_ObjType_17: uint8  % IDC_L2_GW23|1|0|0|15|uint8
  MRR_ObjID_18: uint8  % IDC_L2_GW23|1|0|0|255|uint8
  MRR_ObjMotionType_17: uint8  % IDC_L2_GW23|1|0|0|7|uint8
  VFC_ObjMotionDirection_17: uint8  % IDC_L2_GW23|1|0|0|7|uint8
  MRR_ObjRelVelY_17: uint16  % IDC_L2_GW23|0.0312|-128|-128|126.9976|single
  MRR_ObjRelVelX_17: uint16  % IDC_L2_GW23|0.0312|-128|-128|126.9976|single
  MRR_ObjDistY_17: uint16  % IDC_L2_GW23|0.125|-128|-128|127.875|single
  MRR_ObjDistX_17: uint16  % IDC_L2_GW23|0.0625|0|0|254.9375|single
  MRR_ObjExistProb_17: uint8  % IDC_L2_GW23|0.03125|0|0|0.96875|single
  MRR_ObjObstacleProb_17: uint8  % IDC_L2_GW23|0.03125|0|0|0.96875|single
  MRR_ObjID_17: uint8  % IDC_L2_GW23|1|0|0|255|uint8
  RSDS_R_ObjRelVelY_2: uint16  % IDC_L2_GW23|0.0312|-128|-128|126.9976|single
  RSDS_R_ObjRelVelX_2: uint16  % IDC_L2_GW23|0.0312|-128|-128|126.9976|single
  RSDS_R_ObjDistY_2: uint16  % IDC_L2_GW23|0.125|-128|-128|127.875|single
  RSDS_R_ObjDistX_2: uint16  % IDC_L2_GW23|0.0625|-128|0|126.9375|single
  RSDS_R_ObjObstacleProb_2: uint8  % IDC_L2_GW23|0.032258|0|0|1|single
  RSDS_R_ObjExistProb_2: uint8  % IDC_L2_GW23|0.032258|0|0|1|single
  RSDS_R_ObjID_2: uint8  % IDC_L2_GW23|1|0|0|255|uint8
  RSDS_R_ObjRelVelY_1: uint16  % IDC_L2_GW23|0.0312|-128|-128|126.9976|single
  RSDS_R_ObjRelVelX_1: uint16  % IDC_L2_GW23|0.0312|-128|-128|126.9976|single
  RSDS_R_ObjDistY_1: uint16  % IDC_L2_GW23|0.125|-128|-128|127.875|single
  RSDS_R_ObjObstacleProb_1: uint8  % IDC_L2_GW23|0.032258|0|0|1|single
  RSDS_R_ObjDistX_1: uint16  % IDC_L2_GW23|0.0625|-128|0|126.9375|single
  RSDS_R_ObjExistProb_1: uint8  % IDC_L2_GW23|0.032258|0|0|1|single
  RSDS_R_ObjID_1: uint8  % IDC_L2_GW23|1|0|0|255|uint8
  RSDS_L_ObjRelVelY_6: uint16  % IDC_L2_GW23|0.0312|-128|-128|126.9976|single
  RSDS_L_ObjRelVelX_6: uint16  % IDC_L2_GW23|0.0312|-128|-128|126.9976|single
  RSDS_L_ObjDistY_6: uint16  % IDC_L2_GW23|0.125|-128|-128|127.875|single
  RSDS_L_ObjDistX_6: uint16  % IDC_L2_GW23|0.0625|-128|0|126.9375|single
  RSDS_L_ObjExistProb_6: uint8  % IDC_L2_GW23|0.032258|0|0|1|single
  RSDS_L_ObjObstacleProb_6: uint8  % IDC_L2_GW23|0.032258|0|0|1|single
  RSDS_L_ObjID_6: uint8  % IDC_L2_GW23|1|0|0|255|uint8

IDC_L2_GW24_MSG_BUS = Simulink.Bus(HeaderFile="Rte_Type.h")
  RSDS_R_ObjRelVelY_5: single
  RSDS_R_ObjRelVelX_5: single
  RSDS_R_ObjDistY_5: single
  RSDS_R_ObjDistX_5: single
  RSDS_R_ObjExistProb_5: single
  RSDS_R_ObjObstacleProb_5: single
  RSDS_R_ObjID_5: uint8
  RSDS_R_ObjRelVelY_4: single
  RSDS_R_ObjRelVelX_4: single
  RSDS_R_ObjDistY_4: single
  RSDS_R_ObjDistX_4: single
  RSDS_R_ObjObstacleProb_4: single
  RSDS_R_ObjExistProb_4: single
  RSDS_R_ObjID_4: uint8
  RSDS_R_ObjRelVelY_3: single
  RSDS_R_ObjRelVelX_3: single
  RSDS_R_ObjDistY_3: single
  RSDS_R_ObjObstacleProb_3: single
  RSDS_R_ObjDistX_3: single
  RSDS_R_ObjExistProb_3: single
  MRR_ObjType_24: uint8
  RSDS_R_ObjID_3: uint8
  MRR_ObjMotionType_24: uint8
  VFC_ObjMotionDirection_24: uint8
  MRR_ObjRelVelY_24: single
  MRR_ObjRelVelX_24: single
  MRR_ObjDistY_24: single
  MRR_ObjDistX_24: single
  MRR_ObjObstacleProb_24: single
  MRR_ObjExistProb_24: single
  VFC_ObjMotionDirection_23: uint8
  MRR_ObjType_23: uint8
  MRR_ObjID_24: uint8
  MRR_ObjMotionType_23: uint8
  MRR_ObjRelVelY_23: single
  MRR_ObjRelVelX_23: single
  MRR_ObjDistY_23: single
  MRR_ObjDistX_23: single
  MRR_ObjExistProb_23: single
  MRR_ObjObstacleProb_23: single
  MRR_ObjID_23: uint8
  MRR_ObjMotionType_22: uint8
  VFC_ObjMotionDirection_22: uint8
  MRR_ObjType_22: uint8
  MRR_ObjRelVelY_22: single
  MRR_ObjRelVelX_22: single
  MRR_ObjDistY_22: single
  MRR_ObjObstacleProb_22: single
  MRR_ObjDistX_22: single
  MRR_ObjExistProb_22: single
  MRR_ObjType_21: uint8
  MRR_ObjID_22: uint8
  MRR_ObjMotionType_21: uint8
  VFC_ObjMotionDirection_21: uint8
  MRR_ObjRelVelY_21: single
  MRR_ObjRelVelX_21: single
  MRR_ObjDistY_21: single
  MRR_ObjDistX_21: single
  MRR_ObjExistProb_21: single
  MRR_ObjObstacleProb_21: single
  MRR_ObjID_21: uint8

IDC_L2_GW24_RAW_BUS = Simulink.Bus(HeaderFile="Rte_Type.h")
  RSDS_R_ObjRelVelY_5: uint16  % IDC_L2_GW24|0.0312|-128|-128|126.9976|single
  RSDS_R_ObjRelVelX_5: uint16  % IDC_L2_GW24|0.0312|-128|-128|126.9976|single
  RSDS_R_ObjDistY_5: uint16  % IDC_L2_GW24|0.125|-128|-128|127.875|single
  RSDS_R_ObjDistX_5: uint16  % IDC_L2_GW24|0.0625|-128|0|126.9375|single
  RSDS_R_ObjExistProb_5: uint8  % IDC_L2_GW24|0.032258|0|0|1|single
  RSDS_R_ObjObstacleProb_5: uint8  % IDC_L2_GW24|0.032258|0|0|1|single
  RSDS_R_ObjID_5: uint8  % IDC_L2_GW24|1|0|0|255|uint8
  RSDS_R_ObjRelVelY_4: uint16  % IDC_L2_GW24|0.0312|-128|-128|126.9976|single
  RSDS_R_ObjRelVelX_4: uint16  % IDC_L2_GW24|0.0312|-128|-128|126.9976|single
  RSDS_R_ObjDistY_4: uint16  % IDC_L2_GW24|0.125|-128|-128|127.875|single
  RSDS_R_ObjDistX_4: uint16  % IDC_L2_GW24|0.0625|-128|0|126.9375|single
  RSDS_R_ObjObstacleProb_4: uint8  % IDC_L2_GW24|0.032258|0|0|1|single
  RSDS_R_ObjExistProb_4: uint8  % IDC_L2_GW24|0.032258|0|0|1|single
  RSDS_R_ObjID_4: uint8  % IDC_L2_GW24|1|0|0|255|uint8
  RSDS_R_ObjRelVelY_3: uint16  % IDC_L2_GW24|0.0312|-128|-128|126.9976|single
  RSDS_R_ObjRelVelX_3: uint16  % IDC_L2_GW24|0.0312|-128|-128|126.9976|single
  RSDS_R_ObjDistY_3: uint16  % IDC_L2_GW24|0.125|-128|-128|127.875|single
  RSDS_R_ObjObstacleProb_3: uint8  % IDC_L2_GW24|0.032258|0|0|1|single
  RSDS_R_ObjDistX_3: uint16  % IDC_L2_GW24|0.0625|-128|0|126.9375|single
  RSDS_R_ObjExistProb_3: uint8  % IDC_L2_GW24|0.032258|0|0|1|single
  MRR_ObjType_24: uint8  % IDC_L2_GW24|1|0|0|15|uint8
  RSDS_R_ObjID_3: uint8  % IDC_L2_GW24|1|0|0|255|uint8
  MRR_ObjMotionType_24: uint8  % IDC_L2_GW24|1|0|0|7|uint8
  VFC_ObjMotionDirection_24: uint8  % IDC_L2_GW24|1|0|0|7|uint8
  MRR_ObjRelVelY_24: uint16  % IDC_L2_GW24|0.0312|-128|-128|126.9976|single
  MRR_ObjRelVelX_24: uint16  % IDC_L2_GW24|0.0312|-128|-128|126.9976|single
  MRR_ObjDistY_24: uint16  % IDC_L2_GW24|0.125|-128|-128|127.875|single
  MRR_ObjDistX_24: uint16  % IDC_L2_GW24|0.0625|0|0|254.9375|single
  MRR_ObjObstacleProb_24: uint8  % IDC_L2_GW24|0.03125|0|0|0.96875|single
  MRR_ObjExistProb_24: uint8  % IDC_L2_GW24|0.03125|0|0|0.96875|single
  VFC_ObjMotionDirection_23: uint8  % IDC_L2_GW24|1|0|0|7|uint8
  MRR_ObjType_23: uint8  % IDC_L2_GW24|1|0|0|15|uint8
  MRR_ObjID_24: uint8  % IDC_L2_GW24|1|0|0|255|uint8
  MRR_ObjMotionType_23: uint8  % IDC_L2_GW24|1|0|0|7|uint8
  MRR_ObjRelVelY_23: uint16  % IDC_L2_GW24|0.0312|-128|-128|126.9976|single
  MRR_ObjRelVelX_23: uint16  % IDC_L2_GW24|0.0312|-128|-128|126.9976|single
  MRR_ObjDistY_23: uint16  % IDC_L2_GW24|0.125|-128|-128|127.875|single
  MRR_ObjDistX_23: uint16  % IDC_L2_GW24|0.0625|0|0|254.9375|single
  MRR_ObjExistProb_23: uint8  % IDC_L2_GW24|0.03125|0|0|0.96875|single
  MRR_ObjObstacleProb_23: uint8  % IDC_L2_GW24|0.03125|0|0|0.96875|single
  MRR_ObjID_23: uint8  % IDC_L2_GW24|1|0|0|255|uint8
  MRR_ObjMotionType_22: uint8  % IDC_L2_GW24|1|0|0|7|uint8
  VFC_ObjMotionDirection_22: uint8  % IDC_L2_GW24|1|0|0|7|uint8
  MRR_ObjType_22: uint8  % IDC_L2_GW24|1|0|0|15|uint8
  MRR_ObjRelVelY_22: uint16  % IDC_L2_GW24|0.0312|-128|-128|126.9976|single
  MRR_ObjRelVelX_22: uint16  % IDC_L2_GW24|0.0312|-128|-128|126.9976|single
  MRR_ObjDistY_22: uint16  % IDC_L2_GW24|0.125|-128|-128|127.875|single
  MRR_ObjObstacleProb_22: uint8  % IDC_L2_GW24|0.03125|0|0|0.96875|single
  MRR_ObjDistX_22: uint16  % IDC_L2_GW24|0.0625|0|0|254.9375|single
  MRR_ObjExistProb_22: uint8  % IDC_L2_GW24|0.03125|0|0|0.96875|single
  MRR_ObjType_21: uint8  % IDC_L2_GW24|1|0|0|15|uint8
  MRR_ObjID_22: uint8  % IDC_L2_GW24|1|0|0|255|uint8
  MRR_ObjMotionType_21: uint8  % IDC_L2_GW24|1|0|0|7|uint8
  VFC_ObjMotionDirection_21: uint8  % IDC_L2_GW24|1|0|0|7|uint8
  MRR_ObjRelVelY_21: uint16  % IDC_L2_GW24|0.0312|-128|-128|126.9976|single
  MRR_ObjRelVelX_21: uint16  % IDC_L2_GW24|0.0312|-128|-128|126.9976|single
  MRR_ObjDistY_21: uint16  % IDC_L2_GW24|0.125|-128|-128|127.875|single
  MRR_ObjDistX_21: uint16  % IDC_L2_GW24|0.0625|0|0|254.9375|single
  MRR_ObjExistProb_21: uint8  % IDC_L2_GW24|0.03125|0|0|0.96875|single
  MRR_ObjObstacleProb_21: uint8  % IDC_L2_GW24|0.03125|0|0|0.96875|single
  MRR_ObjID_21: uint8  % IDC_L2_GW24|1|0|0|255|uint8

IDC_L2_GW25_MSG_BUS = Simulink.Bus(HeaderFile="Rte_Type.h")
  MRR_ObjType_29: uint8
  MRR_ObjMotionType_29: uint8
  VFC_ObjMotionDirection_29: uint8
  MRR_ObjRelVelY_29: single
  MRR_ObjRelVelX_29: single
  MRR_ObjDistY_29: single
  MRR_ObjDistX_29: single
  MRR_ObjObstacleProb_29: single
  MRR_ObjExistProb_29: single
  VFC_ObjMotionDirection_28: uint8
  MRR_ObjType_28: uint8
  MRR_ObjID_29: uint8
  MRR_ObjMotionType_28: uint8
  MRR_ObjRelVelY_28: single
  MRR_ObjRelVelX_28: single
  MRR_ObjDistY_28: single
  MRR_ObjDistX_28: single
  MRR_ObjExistProb_28: single
  MRR_ObjObstacleProb_28: single
  MRR_ObjID_28: uint8
  MRR_ObjMotionType_27: uint8
  VFC_ObjMotionDirection_27: uint8
  MRR_ObjType_27: uint8
  MRR_ObjRelVelY_27: single
  MRR_ObjRelVelX_27: single
  MRR_ObjDistY_27: single
  MRR_ObjObstacleProb_27: single
  MRR_ObjDistX_27: single
  MRR_ObjExistProb_27: single
  MRR_ObjType_26: uint8
  MRR_ObjID_27: uint8
  MRR_ObjMotionType_26: uint8
  VFC_ObjMotionDirection_26: uint8
  MRR_ObjRelVelY_26: single
  MRR_ObjRelVelX_26: single
  MRR_ObjDistY_26: single
  MRR_ObjDistX_26: single
  MRR_ObjExistProb_26: single
  MRR_ObjObstacleProb_26: single
  MRR_ObjID_26: uint8
  VFC_ObjMotionDirection_25: uint8
  MRR_ObjType_25: uint8
  MRR_ObjMotionType_25: uint8
  MRR_ObjRelVelY_25: single
  MRR_ObjRelVelX_25: single
  MRR_ObjDistY_25: single
  MRR_ObjObstacleProb_25: single
  MRR_ObjDistX_25: single
  MRR_ObjExistProb_25: single
  MRR_ObjID_25: uint8
  RSDS_R_ObjRelVelY_6: single
  RSDS_R_ObjRelVelX_6: single
  RSDS_R_ObjDistY_6: single
  RSDS_R_ObjDistX_6: single
  RSDS_R_ObjExistProb_6: single
  RSDS_R_ObjObstacleProb_6: single
  RSDS_R_ObjID_6: uint8

IDC_L2_GW25_RAW_BUS = Simulink.Bus(HeaderFile="Rte_Type.h")
  MRR_ObjType_29: uint8  % IDC_L2_GW25|1|0|0|15|uint8
  MRR_ObjMotionType_29: uint8  % IDC_L2_GW25|1|0|0|7|uint8
  VFC_ObjMotionDirection_29: uint8  % IDC_L2_GW25|1|0|0|7|uint8
  MRR_ObjRelVelY_29: uint16  % IDC_L2_GW25|0.0312|-128|-128|126.9976|single
  MRR_ObjRelVelX_29: uint16  % IDC_L2_GW25|0.0312|-128|-128|126.9976|single
  MRR_ObjDistY_29: uint16  % IDC_L2_GW25|0.125|-128|-128|127.875|single
  MRR_ObjDistX_29: uint16  % IDC_L2_GW25|0.0625|0|0|254.9375|single
  MRR_ObjObstacleProb_29: uint8  % IDC_L2_GW25|0.03125|0|0|0.96875|single
  MRR_ObjExistProb_29: uint8  % IDC_L2_GW25|0.03125|0|0|0.96875|single
  VFC_ObjMotionDirection_28: uint8  % IDC_L2_GW25|1|0|0|7|uint8
  MRR_ObjType_28: uint8  % IDC_L2_GW25|1|0|0|15|uint8
  MRR_ObjID_29: uint8  % IDC_L2_GW25|1|0|0|255|uint8
  MRR_ObjMotionType_28: uint8  % IDC_L2_GW25|1|0|0|7|uint8
  MRR_ObjRelVelY_28: uint16  % IDC_L2_GW25|0.0312|-128|-128|126.9976|single
  MRR_ObjRelVelX_28: uint16  % IDC_L2_GW25|0.0312|-128|-128|126.9976|single
  MRR_ObjDistY_28: uint16  % IDC_L2_GW25|0.125|-128|-128|127.875|single
  MRR_ObjDistX_28: uint16  % IDC_L2_GW25|0.0625|0|0|254.9375|single
  MRR_ObjExistProb_28: uint8  % IDC_L2_GW25|0.03125|0|0|0.96875|single
  MRR_ObjObstacleProb_28: uint8  % IDC_L2_GW25|0.03125|0|0|0.96875|single
  MRR_ObjID_28: uint8  % IDC_L2_GW25|1|0|0|255|uint8
  MRR_ObjMotionType_27: uint8  % IDC_L2_GW25|1|0|0|7|uint8
  VFC_ObjMotionDirection_27: uint8  % IDC_L2_GW25|1|0|0|7|uint8
  MRR_ObjType_27: uint8  % IDC_L2_GW25|1|0|0|15|uint8
  MRR_ObjRelVelY_27: uint16  % IDC_L2_GW25|0.0312|-128|-128|126.9976|single
  MRR_ObjRelVelX_27: uint16  % IDC_L2_GW25|0.0312|-128|-128|126.9976|single
  MRR_ObjDistY_27: uint16  % IDC_L2_GW25|0.125|-128|-128|127.875|single
  MRR_ObjObstacleProb_27: uint8  % IDC_L2_GW25|0.03125|0|0|0.96875|single
  MRR_ObjDistX_27: uint16  % IDC_L2_GW25|0.0625|0|0|254.9375|single
  MRR_ObjExistProb_27: uint8  % IDC_L2_GW25|0.03125|0|0|0.96875|single
  MRR_ObjType_26: uint8  % IDC_L2_GW25|1|0|0|15|uint8
  MRR_ObjID_27: uint8  % IDC_L2_GW25|1|0|0|255|uint8
  MRR_ObjMotionType_26: uint8  % IDC_L2_GW25|1|0|0|7|uint8
  VFC_ObjMotionDirection_26: uint8  % IDC_L2_GW25|1|0|0|7|uint8
  MRR_ObjRelVelY_26: uint16  % IDC_L2_GW25|0.0312|-128|-128|126.9976|single
  MRR_ObjRelVelX_26: uint16  % IDC_L2_GW25|0.0312|-128|-128|126.9976|single
  MRR_ObjDistY_26: uint16  % IDC_L2_GW25|0.125|-128|-128|127.875|single
  MRR_ObjDistX_26: uint16  % IDC_L2_GW25|0.0625|0|0|254.9375|single
  MRR_ObjExistProb_26: uint8  % IDC_L2_GW25|0.03125|0|0|0.96875|single
  MRR_ObjObstacleProb_26: uint8  % IDC_L2_GW25|0.03125|0|0|0.96875|single
  MRR_ObjID_26: uint8  % IDC_L2_GW25|1|0|0|255|uint8
  VFC_ObjMotionDirection_25: uint8  % IDC_L2_GW25|1|0|0|7|uint8
  MRR_ObjType_25: uint8  % IDC_L2_GW25|1|0|0|15|uint8
  MRR_ObjMotionType_25: uint8  % IDC_L2_GW25|1|0|0|7|uint8
  MRR_ObjRelVelY_25: uint16  % IDC_L2_GW25|0.0312|-128|-128|126.9976|single
  MRR_ObjRelVelX_25: uint16  % IDC_L2_GW25|0.0312|-128|-128|126.9976|single
  MRR_ObjDistY_25: uint16  % IDC_L2_GW25|0.125|-128|-128|127.875|single
  MRR_ObjObstacleProb_25: uint8  % IDC_L2_GW25|0.03125|0|0|0.96875|single
  MRR_ObjDistX_25: uint16  % IDC_L2_GW25|0.0625|0|0|254.9375|single
  MRR_ObjExistProb_25: uint8  % IDC_L2_GW25|0.03125|0|0|0.96875|single
  MRR_ObjID_25: uint8  % IDC_L2_GW25|1|0|0|255|uint8
  RSDS_R_ObjRelVelY_6: uint16  % IDC_L2_GW25|0.0312|-128|-128|126.9976|single
  RSDS_R_ObjRelVelX_6: uint16  % IDC_L2_GW25|0.0312|-128|-128|126.9976|single
  RSDS_R_ObjDistY_6: uint16  % IDC_L2_GW25|0.125|-128|-128|127.875|single
  RSDS_R_ObjDistX_6: uint16  % IDC_L2_GW25|0.0625|-128|0|126.9375|single
  RSDS_R_ObjExistProb_6: uint8  % IDC_L2_GW25|0.032258|0|0|1|single
  RSDS_R_ObjObstacleProb_6: uint8  % IDC_L2_GW25|0.032258|0|0|1|single
  RSDS_R_ObjID_6: uint8  % IDC_L2_GW25|1|0|0|255|uint8

IDC_L2_GW26_MSG_BUS = Simulink.Bus(HeaderFile="Rte_Type.h")
  VFC_ObjMotionDirection_32: uint8
  MRR_ObjType_32: uint8
  MRR_ObjMotionType_32: uint8
  MRR_ObjRelVelY_32: single
  MRR_ObjRelVelX_32: single
  MRR_ObjDistY_32: single
  MRR_ObjDistX_32: single
  MRR_ObjExistProb_32: single
  MRR_ObjObstacleProb_32: single
  MRR_ObjID_32: uint8
  MRR_ObjMotionType_31: uint8
  VFC_ObjMotionDirection_31: uint8
  MRR_ObjType_31: uint8
  MRR_ObjRelVelY_31: single
  MRR_ObjRelVelX_31: single
  MRR_ObjDistY_31: single
  MRR_ObjObstacleProb_31: single
  MRR_ObjDistX_31: single
  MRR_ObjExistProb_31: single
  MRR_ObjType_30: uint8
  MRR_ObjID_31: uint8
  MRR_ObjMotionType_30: uint8
  VFC_ObjMotionDirection_30: uint8
  MRR_ObjRelVelY_30: single
  MRR_ObjRelVelX_30: single
  MRR_ObjDistY_30: single
  MRR_ObjDistX_30: single
  MRR_ObjExistProb_30: single
  MRR_ObjObstacleProb_30: single
  MRR_ObjID_30: uint8

IDC_L2_GW26_RAW_BUS = Simulink.Bus(HeaderFile="Rte_Type.h")
  VFC_ObjMotionDirection_32: uint8  % IDC_L2_GW26|1|0|0|7|uint8
  MRR_ObjType_32: uint8  % IDC_L2_GW26|1|0|0|15|uint8
  MRR_ObjMotionType_32: uint8  % IDC_L2_GW26|1|0|0|7|uint8
  MRR_ObjRelVelY_32: uint16  % IDC_L2_GW26|0.0312|-128|-128|126.9976|single
  MRR_ObjRelVelX_32: uint16  % IDC_L2_GW26|0.0312|-128|-128|126.9976|single
  MRR_ObjDistY_32: uint16  % IDC_L2_GW26|0.125|-128|-128|127.875|single
  MRR_ObjDistX_32: uint16  % IDC_L2_GW26|0.0625|0|0|254.9375|single
  MRR_ObjExistProb_32: uint8  % IDC_L2_GW26|0.03125|0|0|0.96875|single
  MRR_ObjObstacleProb_32: uint8  % IDC_L2_GW26|0.03125|0|0|0.96875|single
  MRR_ObjID_32: uint8  % IDC_L2_GW26|1|0|0|255|uint8
  MRR_ObjMotionType_31: uint8  % IDC_L2_GW26|1|0|0|7|uint8
  VFC_ObjMotionDirection_31: uint8  % IDC_L2_GW26|1|0|0|7|uint8
  MRR_ObjType_31: uint8  % IDC_L2_GW26|1|0|0|15|uint8
  MRR_ObjRelVelY_31: uint16  % IDC_L2_GW26|0.0312|-128|-128|126.9976|single
  MRR_ObjRelVelX_31: uint16  % IDC_L2_GW26|0.0312|-128|-128|126.9976|single
  MRR_ObjDistY_31: uint16  % IDC_L2_GW26|0.125|-128|-128|127.875|single
  MRR_ObjObstacleProb_31: uint8  % IDC_L2_GW26|0.03125|0|0|0.96875|single
  MRR_ObjDistX_31: uint16  % IDC_L2_GW26|0.0625|0|0|254.9375|single
  MRR_ObjExistProb_31: uint8  % IDC_L2_GW26|0.03125|0|0|0.96875|single
  MRR_ObjType_30: uint8  % IDC_L2_GW26|1|0|0|15|uint8
  MRR_ObjID_31: uint8  % IDC_L2_GW26|1|0|0|255|uint8
  MRR_ObjMotionType_30: uint8  % IDC_L2_GW26|1|0|0|7|uint8
  VFC_ObjMotionDirection_30: uint8  % IDC_L2_GW26|1|0|0|7|uint8
  MRR_ObjRelVelY_30: uint16  % IDC_L2_GW26|0.0312|-128|-128|126.9976|single
  MRR_ObjRelVelX_30: uint16  % IDC_L2_GW26|0.0312|-128|-128|126.9976|single
  MRR_ObjDistY_30: uint16  % IDC_L2_GW26|0.125|-128|-128|127.875|single
  MRR_ObjDistX_30: uint16  % IDC_L2_GW26|0.0625|0|0|254.9375|single
  MRR_ObjExistProb_30: uint8  % IDC_L2_GW26|0.03125|0|0|0.96875|single
  MRR_ObjObstacleProb_30: uint8  % IDC_L2_GW26|0.03125|0|0|0.96875|single
  MRR_ObjID_30: uint8  % IDC_L2_GW26|1|0|0|255|uint8

IDC_L2_GW27_MSG_BUS = Simulink.Bus(HeaderFile="Rte_Type.h")
  SysSupplierMESWVersNumber: uint16
  SupplierECUCalSWVersNumber: uint16
  SysSupplierECUSWVersNumber: uint16
  RFM_LINE_RB_eColour: uint8
  RFM_LINE_RB_dQuality: single
  RFM_LINE_RB_dDisFront: single
  RFM_LINE_RB_dDisStart: single
  RFM_LINE_RB_dLaneWidth: single
  RFM_LINE_RB_eLineTyp: uint8
  RFM_LINE_RB_dC3V: single
  RFM_LINE_RB_dC2V: single
  RFM_LINE_RB_dC1V: single
  RFM_LINE_RB_bIsLineExist: uint8
  RFM_LINE_RB_dC0V: single
  RFM_LINE_LB_eColour: uint8
  RFM_LINE_LB_dQuality: single
  RFM_LINE_LB_dDisFront: single
  RFM_LINE_LB_dDisStart: single
  RFM_LINE_LB_dLaneWidth: single
  RFM_LINE_LB_eLineTyp: uint8
  RFM_LINE_LB_dC3V: single
  RFM_LINE_LB_dC2V: single
  RFM_LINE_LB_dC1V: single
  RFM_LINE_LB_bIsLineExist: uint8
  RFM_LINE_LB_dC0V: single
  RFM_LINE_R3_eColour: uint8
  RFM_LINE_R3_dQuality: single
  RFM_LINE_R3_dDisFront: single
  RFM_LINE_R3_dDisStart: single
  RFM_LINE_R3_dLaneWidth: single
  RFM_LINE_R3_eLineTyp: uint8
  RFM_LINE_R3_dC3V: single
  RFM_LINE_R3_dC2V: single
  RFM_LINE_R3_dC1V: single
  RFM_LINE_R3_bIsLineExist: uint8
  RFM_LINE_R3_dC0V: single
  RFM_LINE_L3_eColour: uint8
  RFM_LINE_L3_dQuality: single
  RFM_LINE_L3_dDisFront: single
  RFM_LINE_L3_dDisStart: single
  RFM_LINE_L3_dLaneWidth: single
  RFM_LINE_L3_eLineTyp: uint8
  RFM_LINE_L3_dC3V: single
  RFM_LINE_L3_dC2V: single
  RFM_LINE_L3_dC1V: single
  RFM_LINE_L3_bIsLineExist: uint8
  RFM_LINE_L3_dC0V: single

IDC_L2_GW27_RAW_BUS = Simulink.Bus(HeaderFile="Rte_Type.h")
  SysSupplierMESWVersNumber: uint16  % IDC_L2_GW27|1|0|0|1023|uint16
  SupplierECUCalSWVersNumber: uint16  % IDC_L2_GW27|1|0|0|1023|uint16
  SysSupplierECUSWVersNumber: uint16  % IDC_L2_GW27|1|0|0|1023|uint16
  RFM_LINE_RB_eColour: uint8  % IDC_L2_GW27|1|0|0|4|uint8
  RFM_LINE_RB_dQuality: uint8  % IDC_L2_GW27|0.01|0|0|1|single
  RFM_LINE_RB_dDisFront: uint16  % IDC_L2_GW27|0.01|0|0|200|single
  RFM_LINE_RB_dDisStart: uint16  % IDC_L2_GW27|0.01|0|0|200|single
  RFM_LINE_RB_dLaneWidth: uint8  % IDC_L2_GW27|0.1|0|0|0.7|single
  RFM_LINE_RB_eLineTyp: uint8  % IDC_L2_GW27|1|0|0|14|uint8
  RFM_LINE_RB_dC3V: uint32  % IDC_L2_GW27|1e-08|-0.004|-0.004|0.004|single
  RFM_LINE_RB_dC2V: uint16  % IDC_L2_GW27|5e-06|-0.125|-0.125|0.125|single
  RFM_LINE_RB_dC1V: uint16  % IDC_L2_GW27|0.0009|-2|-2|2|single
  RFM_LINE_RB_bIsLineExist: uint8  % IDC_L2_GW27|1|0|0|3|uint8
  RFM_LINE_RB_dC0V: uint16  % IDC_L2_GW27|0.01|-30|-30|30|single
  RFM_LINE_LB_eColour: uint8  % IDC_L2_GW27|1|0|0|4|uint8
  RFM_LINE_LB_dQuality: uint8  % IDC_L2_GW27|0.01|0|0|1|single
  RFM_LINE_LB_dDisFront: uint16  % IDC_L2_GW27|0.01|0|0|200|single
  RFM_LINE_LB_dDisStart: uint16  % IDC_L2_GW27|0.01|0|0|200|single
  RFM_LINE_LB_dLaneWidth: uint8  % IDC_L2_GW27|0.1|0|0|0.7|single
  RFM_LINE_LB_eLineTyp: uint8  % IDC_L2_GW27|1|0|0|14|uint8
  RFM_LINE_LB_dC3V: uint32  % IDC_L2_GW27|1e-08|-0.004|-0.004|0.004|single
  RFM_LINE_LB_dC2V: uint16  % IDC_L2_GW27|5e-06|-0.125|-0.125|0.125|single
  RFM_LINE_LB_dC1V: uint16  % IDC_L2_GW27|0.0009|-2|-2|2|single
  RFM_LINE_LB_bIsLineExist: uint8  % IDC_L2_GW27|1|0|0|3|uint8
  RFM_LINE_LB_dC0V: uint16  % IDC_L2_GW27|0.01|-30|-30|30|single
  RFM_LINE_R3_eColour: uint8  % IDC_L2_GW27|1|0|0|4|uint8
  RFM_LINE_R3_dQuality: uint8  % IDC_L2_GW27|0.01|0|0|1|single
  RFM_LINE_R3_dDisFront: uint16  % IDC_L2_GW27|0.01|0|0|200|single
  RFM_LINE_R3_dDisStart: uint16  % IDC_L2_GW27|0.01|0|0|200|single
  RFM_LINE_R3_dLaneWidth: uint8  % IDC_L2_GW27|0.1|0|0|0.7|single
  RFM_LINE_R3_eLineTyp: uint8  % IDC_L2_GW27|1|0|0|14|uint8
  RFM_LINE_R3_dC3V: uint32  % IDC_L2_GW27|1e-08|-0.004|-0.004|0.004|single
  RFM_LINE_R3_dC2V: uint16  % IDC_L2_GW27|5e-06|-0.125|-0.125|0.125|single
  RFM_LINE_R3_dC1V: uint16  % IDC_L2_GW27|0.0009|-2|-2|2|single
  RFM_LINE_R3_bIsLineExist: uint8  % IDC_L2_GW27|1|0|0|3|uint8
  RFM_LINE_R3_dC0V: uint16  % IDC_L2_GW27|0.01|-30|-30|30|single
  RFM_LINE_L3_eColour: uint8  % IDC_L2_GW27|1|0|0|4|uint8
  RFM_LINE_L3_dQuality: uint8  % IDC_L2_GW27|0.01|0|0|1|single
  RFM_LINE_L3_dDisFront: uint16  % IDC_L2_GW27|0.01|0|0|200|single
  RFM_LINE_L3_dDisStart: uint16  % IDC_L2_GW27|0.01|0|0|200|single
  RFM_LINE_L3_dLaneWidth: uint8  % IDC_L2_GW27|0.1|0|0|0.7|single
  RFM_LINE_L3_eLineTyp: uint8  % IDC_L2_GW27|1|0|0|14|uint8
  RFM_LINE_L3_dC3V: uint32  % IDC_L2_GW27|1e-08|-0.004|-0.004|0.004|single
  RFM_LINE_L3_dC2V: uint16  % IDC_L2_GW27|5e-06|-0.125|-0.125|0.125|single
  RFM_LINE_L3_dC1V: uint16  % IDC_L2_GW27|0.0009|-2|-2|2|single
  RFM_LINE_L3_bIsLineExist: uint8  % IDC_L2_GW27|1|0|0|3|uint8
  RFM_LINE_L3_dC0V: uint16  % IDC_L2_GW27|0.01|-30|-30|30|single

IDC_L2_GW28_MSG_BUS = Simulink.Bus(HeaderFile="Rte_Type.h")
  RFM_LINE_R2_eColour: uint8
  RFM_LINE_R2_dQuality: single
  RFM_LINE_R2_dDisFront: single
  RFM_LINE_R2_dDisStart: single
  RFM_LINE_R2_dLaneWidth: single
  RFM_LINE_R2_eLineTyp: uint8
  RFM_LINE_R2_dC3V: single
  RFM_LINE_R2_dC2V: single
  RFM_LINE_R2_dC1V: single
  RFM_LINE_R2_bIsLineExist: uint8
  RFM_LINE_R2_dC0V: single
  RFM_LINE_L2_eColour: uint8
  RFM_LINE_L2_dQuality: single
  RFM_LINE_L2_dDisFront: single
  RFM_LINE_L2_dDisStart: single
  RFM_LINE_L2_dLaneWidth: single
  RFM_LINE_L2_eLineTyp: uint8
  RFM_LINE_L2_dC3V: single
  RFM_LINE_L2_dC2V: single
  RFM_LINE_L2_dC1V: single
  RFM_LINE_L2_bIsLineExist: uint8
  RFM_LINE_L2_dC0V: single
  RFM_LINE_R1_eColour: uint8
  RFM_LINE_R1_dQuality: single
  RFM_LINE_R1_dDisFront: single
  RFM_LINE_R1_dDisStart: single
  RFM_LINE_R1_dLaneWidth: single
  RFM_LINE_R1_eLineTyp: uint8
  RFM_LINE_R1_dC3V: single
  RFM_LINE_R1_dC2V: single
  RFM_LINE_R1_dC1V: single
  RFM_LINE_R1_bIsLineExist: uint8
  RFM_LINE_R1_dC0V: single
  RFM_LINE_L1_eColour: uint8
  RFM_LINE_L1_dQuality: single
  RFM_LINE_L1_dDisFront: single
  RFM_LINE_L1_dDisStart: single
  RFM_LINE_L1_dLaneWidth: single
  RFM_LINE_L1_eLineTyp: uint8
  RFM_LINE_L1_dC3V: single
  RFM_LINE_L1_dC2V: single
  RFM_LINE_L1_dC1V: single
  RFM_LINE_L1_bIsLineExist: uint8
  RFM_LINE_L1_dC0V: single
  Time_Year_Right: uint8
  Time_Month: uint8
  Time_Year_Left: uint8
  Time_Minutes: uint8
  Time_Second: uint8
  ALC_SwtReq: boolean
  TimeMod: boolean
  TimeIndcn: boolean
  Time_Hour: uint8

IDC_L2_GW28_RAW_BUS = Simulink.Bus(HeaderFile="Rte_Type.h")
  RFM_LINE_R2_eColour: uint8  % IDC_L2_GW28|1|0|0|4|uint8
  RFM_LINE_R2_dQuality: uint8  % IDC_L2_GW28|0.01|0|0|1|single
  RFM_LINE_R2_dDisFront: uint16  % IDC_L2_GW28|0.01|0|0|200|single
  RFM_LINE_R2_dDisStart: uint16  % IDC_L2_GW28|0.01|0|0|200|single
  RFM_LINE_R2_dLaneWidth: uint8  % IDC_L2_GW28|0.1|0|0|0.7|single
  RFM_LINE_R2_eLineTyp: uint8  % IDC_L2_GW28|1|0|0|14|uint8
  RFM_LINE_R2_dC3V: uint32  % IDC_L2_GW28|1e-08|-0.004|-0.004|0.004|single
  RFM_LINE_R2_dC2V: uint16  % IDC_L2_GW28|5e-06|-0.125|-0.125|0.125|single
  RFM_LINE_R2_dC1V: uint16  % IDC_L2_GW28|0.0009|-2|-2|2|single
  RFM_LINE_R2_bIsLineExist: uint8  % IDC_L2_GW28|1|0|0|3|uint8
  RFM_LINE_R2_dC0V: uint16  % IDC_L2_GW28|0.01|-30|-30|30|single
  RFM_LINE_L2_eColour: uint8  % IDC_L2_GW28|1|0|0|4|uint8
  RFM_LINE_L2_dQuality: uint8  % IDC_L2_GW28|0.01|0|0|1|single
  RFM_LINE_L2_dDisFront: uint16  % IDC_L2_GW28|0.01|0|0|200|single
  RFM_LINE_L2_dDisStart: uint16  % IDC_L2_GW28|0.01|0|0|200|single
  RFM_LINE_L2_dLaneWidth: uint8  % IDC_L2_GW28|0.1|0|0|0.7|single
  RFM_LINE_L2_eLineTyp: uint8  % IDC_L2_GW28|1|0|0|14|uint8
  RFM_LINE_L2_dC3V: uint32  % IDC_L2_GW28|1e-08|-0.004|-0.004|0.004|single
  RFM_LINE_L2_dC2V: uint16  % IDC_L2_GW28|5e-06|-0.125|-0.125|0.125|single
  RFM_LINE_L2_dC1V: uint16  % IDC_L2_GW28|0.0009|-2|-2|2|single
  RFM_LINE_L2_bIsLineExist: uint8  % IDC_L2_GW28|1|0|0|3|uint8
  RFM_LINE_L2_dC0V: uint16  % IDC_L2_GW28|0.01|-30|-30|30|single
  RFM_LINE_R1_eColour: uint8  % IDC_L2_GW28|1|0|0|4|uint8
  RFM_LINE_R1_dQuality: uint8  % IDC_L2_GW28|0.01|0|0|1|single
  RFM_LINE_R1_dDisFront: uint16  % IDC_L2_GW28|0.01|0|0|200|single
  RFM_LINE_R1_dDisStart: uint16  % IDC_L2_GW28|0.01|0|0|200|single
  RFM_LINE_R1_dLaneWidth: uint8  % IDC_L2_GW28|0.1|0|0|0.7|single
  RFM_LINE_R1_eLineTyp: uint8  % IDC_L2_GW28|1|0|0|14|uint8
  RFM_LINE_R1_dC3V: uint32  % IDC_L2_GW28|1e-08|-0.004|-0.004|0.004|single
  RFM_LINE_R1_dC2V: uint16  % IDC_L2_GW28|5e-06|-0.125|-0.125|0.125|single
  RFM_LINE_R1_dC1V: uint16  % IDC_L2_GW28|0.0009|-2|-2|2|single
  RFM_LINE_R1_bIsLineExist: uint8  % IDC_L2_GW28|1|0|0|3|uint8
  RFM_LINE_R1_dC0V: uint16  % IDC_L2_GW28|0.01|-30|-30|30|single
  RFM_LINE_L1_eColour: uint8  % IDC_L2_GW28|1|0|0|4|uint8
  RFM_LINE_L1_dQuality: uint8  % IDC_L2_GW28|0.01|0|0|1|single
  RFM_LINE_L1_dDisFront: uint16  % IDC_L2_GW28|0.01|0|0|200|single
  RFM_LINE_L1_dDisStart: uint16  % IDC_L2_GW28|0.01|0|0|200|single
  RFM_LINE_L1_dLaneWidth: uint8  % IDC_L2_GW28|0.1|0|0|0.7|single
  RFM_LINE_L1_eLineTyp: uint8  % IDC_L2_GW28|1|0|0|14|uint8
  RFM_LINE_L1_dC3V: uint32  % IDC_L2_GW28|1e-08|-0.004|-0.004|0.004|single
  RFM_LINE_L1_dC2V: uint16  % IDC_L2_GW28|5e-06|-0.125|-0.125|0.125|single
  RFM_LINE_L1_dC1V: uint16  % IDC_L2_GW28|0.0009|-2|-2|2|single
  RFM_LINE_L1_bIsLineExist: uint8  % IDC_L2_GW28|1|0|0|3|uint8
  RFM_LINE_L1_dC0V: uint16  % IDC_L2_GW28|0.01|-30|-30|30|single
  Time_Year_Right: uint8  % IDC_L2_GW28|1|0|0|15|uint8
  Time_Month: uint8  % IDC_L2_GW28|1|0|0|15|uint8
  Time_Year_Left: uint8  % IDC_L2_GW28|1|0|0|15|uint8
  Time_Minutes: uint8  % IDC_L2_GW28|1|0|0|63|uint8
  Time_Second: uint8  % IDC_L2_GW28|1|0|0|63|uint8
  ALC_SwtReq: boolean  % IDC_L2_GW28|1|0|0|1|boolean
  TimeMod: boolean  % IDC_L2_GW28|1|0|0|1|boolean
  TimeIndcn: boolean  % IDC_L2_GW28|1|0|0|1|boolean
  Time_Hour: uint8  % IDC_L2_GW28|1|0|0|31|uint8

IDC_L2_GW29_MSG_BUS = Simulink.Bus(HeaderFile="Rte_Type.h")
  TOS_ACCP2_targetExistP2: boolean
  TOS_ACCP2_P2HdgAng: single
  TOS_ACCP2_ObjDYP2: single
  TOS_ACCP2_ObjMovgStP2: uint8
  TOS_ACCP2_ObjTypP2: uint8
  TOS_ACCP2_fu_TypP2: uint8
  TOS_ACCP2_P2CutinProb: single
  TOS_ACCP2_rangeP2: single
  TOS_ACCP2_axAbsGroundP2: single
  TOS_ACCP2_vxRelP2: single
  TOS_ACCP2_dxP2: single
  TOS_ACCP2_IDP2: uint8
  TOS_ACCP3_targetExistP3: boolean
  TOS_ACCP3_P3HdgAng: single
  TOS_ACCP3_ObjTypP3: uint8
  TOS_ACCP3_ObjDYP3: single
  TOS_ACCP3_fu_TypP3: uint8
  TOS_ACCP3_ObjMovgStP3: uint8
  TOS_ACCP3_P3CutinProb: single
  TOS_ACCP3_rangeP3: single
  TOS_ACCP3_axAbsGroundP3: single
  TOS_ACCP3_vxRelP3: single
  TOS_ACCP3_dxP3: single
  TOS_ACCP3_IDP3: uint8
  TOS_ACCP0_Obj_Orntn: uint8
  TOS_ACCP0_P0CutInflg: boolean
  TOS_ACCP0_ACCTgtObjVy: single
  TOS_ACCP0_ACCTgtObjExist: single
  TOS_ACCP0_ACCTgtObjCntAlive: uint32
  TOS_ACCP0_ACCTgtObjObstcl: single
  TOS_ACCP0_ACCTgtObjAy: single
  TOS_ACCP0_P0HdgAng: single
  TOS_ACCP0_ObjTypP0: uint8
  TOS_ACCP0_ObjDYP0: single
  TOS_ACCP0_fu_TypP0: uint8
  TOS_ACCP0_ObjMovgStP0: uint8
  TOS_ACCP0_targetExistP0: uint8
  TOS_ACCP0_rangeP0: single
  TOS_ACCP0_axAbsGroundP0: single
  TOS_ACCP0_vxRelP0: single
  TOS_ACCP0_IDP0: uint8
  TOS_ACCP0_dxP0: single
  RFM_LINE_PRED_eColour: uint8
  RFM_LINE_PRED_dQuality: single
  RFM_LINE_PRED_dDisFront: single
  RFM_LINE_PRED_dDisStart: single
  RFM_LINE_PRED_dLaneWidth: single
  RFM_LINE_PRED_eLineTyp: uint8
  RFM_LINE_PRED_dC3V: single
  RFM_LINE_PRED_dC2V: single
  RFM_LINE_PRED_dC1V: single
  RFM_LINE_PRED_bIsLineExist: uint8
  RFM_LINE_PRED_dC0V: single

IDC_L2_GW29_RAW_BUS = Simulink.Bus(HeaderFile="Rte_Type.h")
  TOS_ACCP2_targetExistP2: boolean  % IDC_L2_GW29|1|0|0|1|boolean
  TOS_ACCP2_P2HdgAng: uint16  % IDC_L2_GW29|0.01|-180|-180|180|single
  TOS_ACCP2_ObjDYP2: uint16  % IDC_L2_GW29|0.05|-100|-100|100|single
  TOS_ACCP2_ObjMovgStP2: uint8  % IDC_L2_GW29|1|0|0|5|uint8
  TOS_ACCP2_ObjTypP2: uint8  % IDC_L2_GW29|1|0|0|8|uint8
  TOS_ACCP2_fu_TypP2: uint8  % IDC_L2_GW29|1|0|0|63|uint8
  TOS_ACCP2_P2CutinProb: uint8  % IDC_L2_GW29|0.01|0|0|1|single
  TOS_ACCP2_rangeP2: uint16  % IDC_L2_GW29|0.01|0|0|210|single
  TOS_ACCP2_axAbsGroundP2: uint16  % IDC_L2_GW29|0.05|-21.592|-10.3|7.3|single
  TOS_ACCP2_vxRelP2: uint16  % IDC_L2_GW29|0.05|-110|-120|130|single
  TOS_ACCP2_dxP2: uint16  % IDC_L2_GW29|0.05|0|-80|200|single
  TOS_ACCP2_IDP2: uint8  % IDC_L2_GW29|1|0|0|80|uint8
  TOS_ACCP3_targetExistP3: boolean  % IDC_L2_GW29|1|0|0|1|boolean
  TOS_ACCP3_P3HdgAng: uint16  % IDC_L2_GW29|0.01|-180|-180|180|single
  TOS_ACCP3_ObjTypP3: uint8  % IDC_L2_GW29|1|0|0|8|uint8
  TOS_ACCP3_ObjDYP3: uint16  % IDC_L2_GW29|0.05|-100|-100|100|single
  TOS_ACCP3_fu_TypP3: uint8  % IDC_L2_GW29|1|0|0|63|uint8
  TOS_ACCP3_ObjMovgStP3: uint8  % IDC_L2_GW29|1|0|0|5|uint8
  TOS_ACCP3_P3CutinProb: uint8  % IDC_L2_GW29|0.01|0|0|1|single
  TOS_ACCP3_rangeP3: uint16  % IDC_L2_GW29|0.01|0|0|210|single
  TOS_ACCP3_axAbsGroundP3: uint16  % IDC_L2_GW29|0.05|-10.3|-10.3|7.3|single
  TOS_ACCP3_vxRelP3: uint16  % IDC_L2_GW29|0.05|-120|-120|130|single
  TOS_ACCP3_dxP3: uint16  % IDC_L2_GW29|0.05|-80|-80|200|single
  TOS_ACCP3_IDP3: uint8  % IDC_L2_GW29|1|0|0|80|uint8
  TOS_ACCP0_Obj_Orntn: uint8  % IDC_L2_GW29|1|0|0|10|uint8
  TOS_ACCP0_P0CutInflg: boolean  % IDC_L2_GW29|1|0|0|1|boolean
  TOS_ACCP0_ACCTgtObjVy: uint16  % IDC_L2_GW29|0.125|-64|-64|63.875|single
  TOS_ACCP0_ACCTgtObjExist: uint8  % IDC_L2_GW29|0.015625|0|0|0.98438|single
  TOS_ACCP0_ACCTgtObjCntAlive: uint16  % IDC_L2_GW29|17|0|0|65536|uint32
  TOS_ACCP0_ACCTgtObjObstcl: uint8  % IDC_L2_GW29|0.03125|0|0|0.96875|single
  TOS_ACCP0_ACCTgtObjAy: uint16  % IDC_L2_GW29|0.03125|-16|-16|15.9688|single
  TOS_ACCP0_P0HdgAng: uint16  % IDC_L2_GW29|0.01|-180|-180|180|single
  TOS_ACCP0_ObjTypP0: uint8  % IDC_L2_GW29|1|0|0|8|uint8
  TOS_ACCP0_ObjDYP0: uint16  % IDC_L2_GW29|0.05|-100|-100|100|single
  TOS_ACCP0_fu_TypP0: uint8  % IDC_L2_GW29|1|0|0|63|uint8
  TOS_ACCP0_ObjMovgStP0: uint8  % IDC_L2_GW29|1|0|0|5|uint8
  TOS_ACCP0_targetExistP0: uint8  % IDC_L2_GW29|1|0|0|1|uint8
  TOS_ACCP0_rangeP0: uint16  % IDC_L2_GW29|0.01|0|0|210|single
  TOS_ACCP0_axAbsGroundP0: uint16  % IDC_L2_GW29|0.05|-10.3|-10.3|7.3|single
  TOS_ACCP0_vxRelP0: uint16  % IDC_L2_GW29|0.05|-120|-120|130|single
  TOS_ACCP0_IDP0: uint8  % IDC_L2_GW29|1|0|0|80|uint8
  TOS_ACCP0_dxP0: uint16  % IDC_L2_GW29|0.05|-80|-80|200|single
  RFM_LINE_PRED_eColour: uint8  % IDC_L2_GW29|1|0|0|4|uint8
  RFM_LINE_PRED_dQuality: uint8  % IDC_L2_GW29|0.01|0|0|1|single
  RFM_LINE_PRED_dDisFront: uint16  % IDC_L2_GW29|0.01|0|0|200|single
  RFM_LINE_PRED_dDisStart: uint16  % IDC_L2_GW29|0.01|0|0|200|single
  RFM_LINE_PRED_dLaneWidth: uint8  % IDC_L2_GW29|0.1|0|0|0.7|single
  RFM_LINE_PRED_eLineTyp: uint8  % IDC_L2_GW29|1|0|0|14|uint8
  RFM_LINE_PRED_dC3V: uint32  % IDC_L2_GW29|1e-08|-0.004|-0.004|0.004|single
  RFM_LINE_PRED_dC2V: uint16  % IDC_L2_GW29|5e-06|-0.125|-0.125|0.125|single
  RFM_LINE_PRED_dC1V: uint16  % IDC_L2_GW29|0.0009|-2|-2|2|single
  RFM_LINE_PRED_bIsLineExist: uint8  % IDC_L2_GW29|1|0|0|3|uint8
  RFM_LINE_PRED_dC0V: uint16  % IDC_L2_GW29|0.01|-30|-30|30|single

IDC_L2_GW3_MSG_BUS = Simulink.Bus(HeaderFile="Rte_Type.h")
  AEB_LATCYC_dyFisrtDetn: single
  AEB_LATCYC_dxFisrtDetn: single
  AEB_LATCYC_ObjMeasSts: boolean
  AEB_LATCYC_ObjLifeCycle: uint16
  AEB_LATCYC_ObjExistProb: single
  AEB_LATCYC_ObjIsObstclProb: single
  AEB_LATCYC_dyVari: single
  AEB_LATCYC_dxVari: single
  AEB_LATCYC_ay: single
  AEB_LATCYC_ax: single
  AEB_LATCYC_vy: single
  AEB_LATCYC_vx: single
  AEB_LATCYC_dz: single
  AEB_LATCYC_dy: single
  AEB_LATCYC_ObjMovgOrntn: uint8
  AEB_LATCYC_dx: single
  AEB_LATCYC_ObjMovgSt: uint8
  AEB_LATCYC_ObjYawAng: single
  AEB_LATCYC_ObjHei: single
  AEB_LATCYC_ObjWidth: single
  AEB_LATCYC_ObjTypCamCfmd: boolean
  AEB_LATCYC_ObjLen: single
  AEB_LATCYC_ObjTyp: uint8
  AEB_LATCYC_FusnTyp: uint8
  AEB_LATCYC_ObjID: uint8
  TOS_LCP3_ObjIn_Lane: uint8
  TOS_LCP3_LeftLane_Prob: single
  TOS_LCP3_RightLane_Prob: single
  TOS_LCP3_CurrLane_Prob: single
  TOS_LCP3_Obj_Age: uint16
  TOS_LCP3_Obj_ObstclProb: single
  TOS_LCP3_Obj_ExistProb: single
  TOS_LCP3_Obj_Typ_Prob: single
  TOS_LCP3_Obj_Std_HdgAng: single
  TOS_LCP3_Obj_Std_Width: single
  TOS_LCP3_Obj_Std_Len: single
  TOS_LCP3_Obj_AY: single
  TOS_LCP3_Obj_AX: single
  TOS_LCP3_Obj_Std_VY: single
  TOS_LCP3_Obj_Std_VX: single
  TOS_LCP3_Obj_Std_DY: single
  TOS_LCP3_Obj_Std_DX: single
  TOS_LCP3_Obj_Std_AY: single
  TOS_LCP3_Obj_Std_AX: single
  TOS_LCP3_Obj_VY: single
  TOS_LCP3_Obj_VX: single
  TOS_LCP3_Obj_DY: single
  TOS_LCP3_Obj_DX: single
  TOS_LCP3_Obj_MovgSt: uint8
  TOS_LCP3_Obj_Orntn: uint8
  TOS_LCP3_Obj_YawAng: single
  TOS_LCP3_Obj_HdgAng: single
  TOS_LCP3_Obj_Hei: single
  TOS_LCP3_Obj_Width: single
  TOS_LCP3_Obj_Len: single
  TOS_LCP3_Obj_Typ: uint8
  TOS_LCP3_Obj_Fusn_Typ: uint8
  TOS_LCP3_Obj_ID: uint8

IDC_L2_GW3_RAW_BUS = Simulink.Bus(HeaderFile="Rte_Type.h")
  AEB_LATCYC_dyFisrtDetn: uint16  % IDC_L2_GW3|0.125|-128|-128|127.875|single
  AEB_LATCYC_dxFisrtDetn: uint16  % IDC_L2_GW3|0.125|0|0|254.9375|single
  AEB_LATCYC_ObjMeasSts: boolean  % IDC_L2_GW3|1|0|0|1|boolean
  AEB_LATCYC_ObjLifeCycle: uint16  % IDC_L2_GW3|17|0|0|65535|uint16
  AEB_LATCYC_ObjExistProb: uint8  % IDC_L2_GW3|0.015625|0|0|0.98438|single
  AEB_LATCYC_ObjIsObstclProb: uint8  % IDC_L2_GW3|0.03125|0|0|0.96875|single
  AEB_LATCYC_dyVari: uint8  % IDC_L2_GW3|0.0625|0|0|15.5|single
  AEB_LATCYC_dxVari: uint8  % IDC_L2_GW3|0.0625|0|0|15.5|single
  AEB_LATCYC_ay: uint16  % IDC_L2_GW3|0.03125|-16|-16|15.9688|single
  AEB_LATCYC_ax: uint16  % IDC_L2_GW3|0.03125|-16|-16|15.9688|single
  AEB_LATCYC_vy: uint16  % IDC_L2_GW3|0.125|-64|-64|63.875|single
  AEB_LATCYC_vx: uint16  % IDC_L2_GW3|0.0625|-128|-128|127|single
  AEB_LATCYC_dz: uint16  % IDC_L2_GW3|0.05|-102.4|-102.4|102.3|single
  AEB_LATCYC_dy: uint16  % IDC_L2_GW3|0.125|-128|-128|127.875|single
  AEB_LATCYC_ObjMovgOrntn: uint8  % IDC_L2_GW3|1|0|0|3|uint8
  AEB_LATCYC_dx: uint16  % IDC_L2_GW3|0.0625|0|0|255.9375|single
  AEB_LATCYC_ObjMovgSt: uint8  % IDC_L2_GW3|1|0|0|4|uint8
  AEB_LATCYC_ObjYawAng: uint16  % IDC_L2_GW3|0.01|-180|-180|180|single
  AEB_LATCYC_ObjHei: uint16  % IDC_L2_GW3|0.01|0|0|6|single
  AEB_LATCYC_ObjWidth: uint16  % IDC_L2_GW3|0.01|0|0|5|single
  AEB_LATCYC_ObjTypCamCfmd: boolean  % IDC_L2_GW3|1|0|0|1|boolean
  AEB_LATCYC_ObjLen: uint16  % IDC_L2_GW3|0.05|0|0|20|single
  AEB_LATCYC_ObjTyp: uint8  % IDC_L2_GW3|1|0|0|8|uint8
  AEB_LATCYC_FusnTyp: uint8  % IDC_L2_GW3|1|0|0|63|uint8
  AEB_LATCYC_ObjID: uint8  % IDC_L2_GW3|1|0|0|255|uint8
  TOS_LCP3_ObjIn_Lane: uint8  % IDC_L2_GW3|1|0|0|3|uint8
  TOS_LCP3_LeftLane_Prob: uint8  % IDC_L2_GW3|0.01|0|0|1|single
  TOS_LCP3_RightLane_Prob: uint8  % IDC_L2_GW3|0.01|0|0|1|single
  TOS_LCP3_CurrLane_Prob: uint8  % IDC_L2_GW3|0.01|0|0|1|single
  TOS_LCP3_Obj_Age: uint16  % IDC_L2_GW3|1|0|0|65535|uint16
  TOS_LCP3_Obj_ObstclProb: uint8  % IDC_L2_GW3|0.03125|0|0|1|single
  TOS_LCP3_Obj_ExistProb: uint8  % IDC_L2_GW3|0.01|0|0|1|single
  TOS_LCP3_Obj_Typ_Prob: uint8  % IDC_L2_GW3|0.01|0|0|1|single
  TOS_LCP3_Obj_Std_HdgAng: uint16  % IDC_L2_GW3|0.01|0|0|3.14|single
  TOS_LCP3_Obj_Std_Width: uint8  % IDC_L2_GW3|0.01|0|0|2|single
  TOS_LCP3_Obj_Std_Len: uint8  % IDC_L2_GW3|0.05|0|0|10|single
  TOS_LCP3_Obj_AY: uint16  % IDC_L2_GW3|0.05|-10.3|-10.3|7.3|single
  TOS_LCP3_Obj_AX: uint16  % IDC_L2_GW3|0.05|-10.3|-10.3|7.3|single
  TOS_LCP3_Obj_Std_VY: uint16  % IDC_L2_GW3|0.05|0|0|50|single
  TOS_LCP3_Obj_Std_VX: uint16  % IDC_L2_GW3|0.05|0|0|130|single
  TOS_LCP3_Obj_Std_DY: uint16  % IDC_L2_GW3|0.05|0|0|100|single
  TOS_LCP3_Obj_Std_DX: uint16  % IDC_L2_GW3|0.05|0|0|250|single
  TOS_LCP3_Obj_Std_AY: uint8  % IDC_L2_GW3|0.05|0|0|7.3|single
  TOS_LCP3_Obj_Std_AX: uint8  % IDC_L2_GW3|0.05|0|0|7.3|single
  TOS_LCP3_Obj_VY: uint16  % IDC_L2_GW3|0.05|-50|-50|50|single
  TOS_LCP3_Obj_VX: uint16  % IDC_L2_GW3|0.05|-120|-120|130|single
  TOS_LCP3_Obj_DY: uint16  % IDC_L2_GW3|0.05|-100|-100|100|single
  TOS_LCP3_Obj_DX: uint16  % IDC_L2_GW3|0.05|-80|-80|200|single
  TOS_LCP3_Obj_MovgSt: uint8  % IDC_L2_GW3|1|0|0|5|uint8
  TOS_LCP3_Obj_Orntn: uint8  % IDC_L2_GW3|1|0|0|10|uint8
  TOS_LCP3_Obj_YawAng: uint16  % IDC_L2_GW3|0.01|-180|-180|180|single
  TOS_LCP3_Obj_HdgAng: uint16  % IDC_L2_GW3|0.01|-180|-180|180|single
  TOS_LCP3_Obj_Hei: uint16  % IDC_L2_GW3|0.01|0.01|0.01|2.95|single
  TOS_LCP3_Obj_Width: uint16  % IDC_L2_GW3|0.01|0.04|0.04|2.98|single
  TOS_LCP3_Obj_Len: uint16  % IDC_L2_GW3|0.05|1.2|1.2|21|single
  TOS_LCP3_Obj_Typ: uint8  % IDC_L2_GW3|1|0|0|8|uint8
  TOS_LCP3_Obj_Fusn_Typ: uint8  % IDC_L2_GW3|1|0|0|63|uint8
  TOS_LCP3_Obj_ID: uint8  % IDC_L2_GW3|1|0|0|80|uint8

IDC_L2_GW30_MSG_BUS = Simulink.Bus(HeaderFile="Rte_Type.h")
  VehInLeftmostLane: boolean
  VehInRightmostLane: boolean
  TJADataClct_ConNotStsf: uint32
  ESSDataClct_OverrideESSExit: boolean
  ESSDataClct_DriverSteerESSExit: boolean
  ACCDataClct_ConNotStsf: uint32
  ELK_Con_SteerWheelAngle_ELKExit: boolean
  ELK_Con_SteerWheelSpd_ELKExit: boolean
  LCK_Con_AccPedalRate_LCKExit: boolean
  LCK_Con_BrakePress_LCKExit: boolean
  LCK_Con_SteerAngleSpd_LCKExit: boolean
  LCK_Con_OverRide_LCKExit: boolean
  LCK_Con_SteerWheelAngle_LCKExit: boolean
  LCK_Con_DriverInput_LCKExit: boolean
  LKA_Con_AccPedalRate_LKAExit: boolean
  LKA_Con_BrakePressure_LKAExit: boolean
  LKA_Con_SteerWheelAngle_LKAExit: boolean
  LKA_Con_DriverInput_LKAExit: boolean
  LKA_Con_SteerWheelSpd_LKAExit: boolean
  LKA_Con_OverRide_LKAExit: boolean
  ELK_Con_AccPedalRate_ELKExit: boolean
  ELK_Con_BrakePressure_ELKExit: boolean
  ACCDataClct_OverrideACCExit: boolean
  ACCDataClct_DriverBrakeACCExit: boolean
  ACCDataClct_DriverSteerACCExit: boolean
  LDW_Con_AccPedalRate_LDWExit: boolean
  LDW_Con_BrakePressure_LDWExit: boolean
  LDW_Con_SteerWheelAngle_LDWExit: boolean
  LDW_Con_DriverInput_LDWExit: boolean
  LDW_Con_SteerWheelSpd_LDWExit: boolean
  IntelligentEvaActSts: boolean
  HWADataClct_DriverBrakeHWAExit: boolean
  HWADataClct_OverrideHWAExit: boolean
  HWADataClct_DriverSteerHWAExit: boolean
  HWAAccControlSts: uint8
  LCKIEDist: single
  ELKSts: uint8
  LCKIESts: uint8
  LCKSts: uint8
  LKASts: uint8
  TJASts: uint8
  HWASts: uint8
  JA_CycAEBFuncSts: uint8
  JA_PedAEBFuncSts: uint8
  ACCSts: uint8
  EBAFuncSts: uint8
  FCTBFuncSts: uint8
  JA_PTW_AEBFuncSts: uint8
  CycAEBfullFuncSts: uint8
  PedAEBfullFuncSts: uint8
  CycAEBpartFuncSts: uint8
  AEBfullFuncSts: uint8
  JA_AEBfullFuncSts: uint8
  RFM_ROAD_dCurrLaneWidth: single
  AEBpartFuncSts: uint8
  SteerAngOffset_deg: single
  psiDtOpt: single
  alpSideSlipAng: single
  kapTraj: single
  ayvRefMs2: single
  axvRefMs2: single
  vxvRefMs: single
  RFM_LINEF_RB_eColour: uint8
  RFM_LINEF_RB_dQuality: single
  RFM_LINEF_RB_dDisFront: single
  RFM_LINEF_RB_dDisStart: single
  RFM_LINEF_RB_dLaneWidth: single
  RFM_LINEF_RB_eLineTyp: uint8
  RFM_LINEF_RB_dC3V: single
  RFM_LINEF_RB_dC2V: single
  RFM_LINEF_RB_dC1V: single
  RFM_LINEF_RB_bIsLineExist: uint8
  RFM_LINEF_RB_dC0V: single
  RFM_LINEF_LB_eColour: uint8
  RFM_LINEF_LB_dQuality: single
  RFM_LINEF_LB_dDisFront: single
  RFM_LINEF_LB_dDisStart: single
  RFM_LINEF_LB_dLaneWidth: single
  RFM_LINEF_LB_eLineTyp: uint8
  RFM_LINEF_LB_dC3V: single
  RFM_LINEF_LB_dC2V: single
  RFM_LINEF_LB_dC1V: single
  RFM_LINEF_LB_bIsLineExist: uint8
  RFM_LINEF_LB_dC0V: single

IDC_L2_GW30_RAW_BUS = Simulink.Bus(HeaderFile="Rte_Type.h")
  VehInLeftmostLane: boolean  % IDC_L2_GW30|1|0|0|1|boolean
  VehInRightmostLane: boolean  % IDC_L2_GW30|1|0|0|1|boolean
  TJADataClct_ConNotStsf: uint32  % IDC_L2_GW30|1|0|0|4294967295|uint32
  ESSDataClct_OverrideESSExit: boolean  % IDC_L2_GW30|1|0|0|1|boolean
  ESSDataClct_DriverSteerESSExit: boolean  % IDC_L2_GW30|1|0|0|1|boolean
  ACCDataClct_ConNotStsf: uint32  % IDC_L2_GW30|1|0|0|4294967295|uint32
  ELK_Con_SteerWheelAngle_ELKExit: boolean  % IDC_L2_GW30|1|0|0|1|boolean
  ELK_Con_SteerWheelSpd_ELKExit: boolean  % IDC_L2_GW30|1|0|0|1|boolean
  LCK_Con_AccPedalRate_LCKExit: boolean  % IDC_L2_GW30|1|0|0|1|boolean
  LCK_Con_BrakePress_LCKExit: boolean  % IDC_L2_GW30|1|0|0|1|boolean
  LCK_Con_SteerAngleSpd_LCKExit: boolean  % IDC_L2_GW30|1|0|0|1|boolean
  LCK_Con_OverRide_LCKExit: boolean  % IDC_L2_GW30|1|0|0|1|boolean
  LCK_Con_SteerWheelAngle_LCKExit: boolean  % IDC_L2_GW30|1|0|0|1|boolean
  LCK_Con_DriverInput_LCKExit: boolean  % IDC_L2_GW30|1|0|0|1|boolean
  LKA_Con_AccPedalRate_LKAExit: boolean  % IDC_L2_GW30|1|0|0|1|boolean
  LKA_Con_BrakePressure_LKAExit: boolean  % IDC_L2_GW30|1|0|0|1|boolean
  LKA_Con_SteerWheelAngle_LKAExit: boolean  % IDC_L2_GW30|1|0|0|1|boolean
  LKA_Con_DriverInput_LKAExit: boolean  % IDC_L2_GW30|1|0|0|1|boolean
  LKA_Con_SteerWheelSpd_LKAExit: boolean  % IDC_L2_GW30|1|0|0|1|boolean
  LKA_Con_OverRide_LKAExit: boolean  % IDC_L2_GW30|1|0|0|1|boolean
  ELK_Con_AccPedalRate_ELKExit: boolean  % IDC_L2_GW30|1|0|0|1|boolean
  ELK_Con_BrakePressure_ELKExit: boolean  % IDC_L2_GW30|1|0|0|1|boolean
  ACCDataClct_OverrideACCExit: boolean  % IDC_L2_GW30|1|0|0|1|boolean
  ACCDataClct_DriverBrakeACCExit: boolean  % IDC_L2_GW30|1|0|0|1|boolean
  ACCDataClct_DriverSteerACCExit: boolean  % IDC_L2_GW30|1|0|0|1|boolean
  LDW_Con_AccPedalRate_LDWExit: boolean  % IDC_L2_GW30|1|0|0|1|boolean
  LDW_Con_BrakePressure_LDWExit: boolean  % IDC_L2_GW30|1|0|0|1|boolean
  LDW_Con_SteerWheelAngle_LDWExit: boolean  % IDC_L2_GW30|1|0|0|1|boolean
  LDW_Con_DriverInput_LDWExit: boolean  % IDC_L2_GW30|1|0|0|1|boolean
  LDW_Con_SteerWheelSpd_LDWExit: boolean  % IDC_L2_GW30|1|0|0|1|boolean
  IntelligentEvaActSts: boolean  % IDC_L2_GW30|1|0|0|1|boolean
  HWADataClct_DriverBrakeHWAExit: boolean  % IDC_L2_GW30|1|0|0|1|boolean
  HWADataClct_OverrideHWAExit: boolean  % IDC_L2_GW30|1|0|0|1|boolean
  HWADataClct_DriverSteerHWAExit: boolean  % IDC_L2_GW30|1|0|0|1|boolean
  HWAAccControlSts: uint8  % IDC_L2_GW30|1|0|0|7|uint8
  LCKIEDist: uint16  % IDC_L2_GW30|0.01|-2|-2|2|single
  ELKSts: uint8  % IDC_L2_GW30|1|0|0|9|uint8
  LCKIESts: uint8  % IDC_L2_GW30|1|0|0|7|uint8
  LCKSts: uint8  % IDC_L2_GW30|1|0|0|7|uint8
  LKASts: uint8  % IDC_L2_GW30|1|0|0|7|uint8
  TJASts: uint8  % IDC_L2_GW30|1|0|0|9|uint8
  HWASts: uint8  % IDC_L2_GW30|1|0|0|10|uint8
  JA_CycAEBFuncSts: uint8  % IDC_L2_GW30|1|0|0|4|uint8
  JA_PedAEBFuncSts: uint8  % IDC_L2_GW30|1|0|0|4|uint8
  ACCSts: uint8  % IDC_L2_GW30|1|0|0|9|uint8
  EBAFuncSts: uint8  % IDC_L2_GW30|1|0|0|4|uint8
  FCTBFuncSts: uint8  % IDC_L2_GW30|1|0|0|4|uint8
  JA_PTW_AEBFuncSts: uint8  % IDC_L2_GW30|1|0|0|4|uint8
  CycAEBfullFuncSts: uint8  % IDC_L2_GW30|1|0|0|4|uint8
  PedAEBfullFuncSts: uint8  % IDC_L2_GW30|1|0|0|4|uint8
  CycAEBpartFuncSts: uint8  % IDC_L2_GW30|1|0|0|4|uint8
  AEBfullFuncSts: uint8  % IDC_L2_GW30|1|0|0|4|uint8
  JA_AEBfullFuncSts: uint8  % IDC_L2_GW30|1|0|0|4|uint8
  RFM_ROAD_dCurrLaneWidth: uint8  % IDC_L2_GW30|0.1|1.5|1.5|7.8|single
  AEBpartFuncSts: uint8  % IDC_L2_GW30|1|0|0|4|uint8
  SteerAngOffset_deg: uint16  % IDC_L2_GW30|0.01|-320|-320|335.35|single
  psiDtOpt: uint16  % IDC_L2_GW30|0.0001|-3|-3|3.5535|single
  alpSideSlipAng: uint16  % IDC_L2_GW30|0.001|-30|-30|35.535|single
  kapTraj: uint16  % IDC_L2_GW30|0.0001|-3|-3|3.5535|single
  ayvRefMs2: uint16  % IDC_L2_GW30|0.001|-21.592|-21.592|42.6323|single
  axvRefMs2: uint16  % IDC_L2_GW30|0.001|-21.592|-21.592|42.6323|single
  vxvRefMs: uint16  % IDC_L2_GW30|0.001|0|0|65.535|single
  RFM_LINEF_RB_eColour: uint8  % IDC_L2_GW30|1|0|0|4|uint8
  RFM_LINEF_RB_dQuality: uint8  % IDC_L2_GW30|0.01|0|0|1|single
  RFM_LINEF_RB_dDisFront: uint16  % IDC_L2_GW30|0.01|0|0|200|single
  RFM_LINEF_RB_dDisStart: uint16  % IDC_L2_GW30|0.01|0|0|200|single
  RFM_LINEF_RB_dLaneWidth: uint8  % IDC_L2_GW30|0.1|0|0|0.7|single
  RFM_LINEF_RB_eLineTyp: uint8  % IDC_L2_GW30|1|0|0|14|uint8
  RFM_LINEF_RB_dC3V: uint32  % IDC_L2_GW30|1e-08|-0.004|-0.004|0.004|single
  RFM_LINEF_RB_dC2V: uint16  % IDC_L2_GW30|5e-06|-0.125|-0.125|0.125|single
  RFM_LINEF_RB_dC1V: uint16  % IDC_L2_GW30|0.0009|-2|-2|2|single
  RFM_LINEF_RB_bIsLineExist: uint8  % IDC_L2_GW30|1|0|0|3|uint8
  RFM_LINEF_RB_dC0V: uint16  % IDC_L2_GW30|0.01|-30|-30|30|single
  RFM_LINEF_LB_eColour: uint8  % IDC_L2_GW30|1|0|0|4|uint8
  RFM_LINEF_LB_dQuality: uint8  % IDC_L2_GW30|0.01|0|0|1|single
  RFM_LINEF_LB_dDisFront: uint16  % IDC_L2_GW30|0.01|0|0|200|single
  RFM_LINEF_LB_dDisStart: uint16  % IDC_L2_GW30|0.01|0|0|200|single
  RFM_LINEF_LB_dLaneWidth: uint8  % IDC_L2_GW30|0.1|0|0|0.7|single
  RFM_LINEF_LB_eLineTyp: uint8  % IDC_L2_GW30|1|0|0|14|uint8
  RFM_LINEF_LB_dC3V: uint32  % IDC_L2_GW30|1e-08|-0.004|-0.004|0.004|single
  RFM_LINEF_LB_dC2V: uint16  % IDC_L2_GW30|5e-06|-0.125|-0.125|0.125|single
  RFM_LINEF_LB_dC1V: uint16  % IDC_L2_GW30|0.0009|-2|-2|2|single
  RFM_LINEF_LB_bIsLineExist: uint8  % IDC_L2_GW30|1|0|0|3|uint8
  RFM_LINEF_LB_dC0V: uint16  % IDC_L2_GW30|0.01|-30|-30|30|single

IDC_L2_GW4_MSG_BUS = Simulink.Bus(HeaderFile="Rte_Type.h")
  TOS_LCP4_ObjIn_Lane: uint8
  TOS_LCP4_RightLane_Prob: single
  TOS_LCP4_CurrLane_Prob: single
  TOS_LCP4_LeftLane_Prob: single
  TOS_LCP4_Obj_Age: uint16
  TOS_LCP4_Obj_ObstclProb: single
  TOS_LCP4_Obj_ExistProb: single
  TOS_LCP4_Obj_Typ_Prob: single
  TOS_LCP4_Obj_Std_HdgAng: single
  TOS_LCP4_Obj_Std_Width: single
  TOS_LCP4_Obj_Std_Len: single
  TOS_LCP4_Obj_AY: single
  TOS_LCP4_Obj_AX: single
  TOS_LCP4_Obj_Std_VY: single
  TOS_LCP4_Obj_Std_VX: single
  TOS_LCP4_Obj_Std_DY: single
  TOS_LCP4_Obj_Std_DX: single
  TOS_LCP4_Obj_Std_AY: single
  TOS_LCP4_Obj_Std_AX: single
  TOS_LCP4_Obj_VY: single
  TOS_LCP4_Obj_VX: single
  TOS_LCP4_Obj_DY: single
  TOS_LCP4_Obj_DX: single
  TOS_LCP4_Obj_MovgSt: uint8
  TOS_LCP4_Obj_Orntn: uint8
  TOS_LCP4_Obj_YawAng: single
  TOS_LCP4_Obj_HdgAng: single
  TOS_LCP4_Obj_Hei: single
  TOS_LCP4_Obj_Width: single
  TOS_LCP4_Obj_Len: single
  TOS_LCP4_Obj_Typ: uint8
  TOS_LCP4_Obj_ID: uint8
  TOS_LCP4_Obj_Fusn_Typ: uint8
  AEB_LATPED_dyFisrtDetn: single
  AEB_LATPED_dxFisrtDetn: single
  AEB_LATPED_ObjMeasSts: boolean
  AEB_LATPED_ObjLifeCycle: uint16
  AEB_LATPED_ObjExistProb: single
  AEB_LATPED_ObjIsObstclProb: single
  AEB_LATPED_dyVari: single
  AEB_LATPED_dxVari: single
  AEB_LATPED_ay: single
  AEB_LATPED_ax: single
  AEB_LATPED_vy: single
  AEB_LATPED_vx: single
  AEB_LATPED_dz: single
  AEB_LATPED_dy: single
  AEB_LATPED_ObjMovgOrntn: uint8
  AEB_LATPED_dx: single
  AEB_LATPED_ObjMovgSt: uint8
  AEB_LATPED_ObjYawAng: single
  AEB_LATPED_ObjHei: single
  AEB_LATPED_ObjWidth: single
  AEB_LATPED_ObjTypCamCfmd: boolean
  AEB_LATPED_ObjLen: single
  AEB_LATPED_ObjTyp: uint8
  AEB_LATPED_FusnTyp: uint8
  AEB_LATPED_ObjID: uint8

IDC_L2_GW4_RAW_BUS = Simulink.Bus(HeaderFile="Rte_Type.h")
  TOS_LCP4_ObjIn_Lane: uint8  % IDC_L2_GW4|1|0|0|3|uint8
  TOS_LCP4_RightLane_Prob: uint8  % IDC_L2_GW4|0.01|0|0|1|single
  TOS_LCP4_CurrLane_Prob: uint8  % IDC_L2_GW4|0.01|0|0|1|single
  TOS_LCP4_LeftLane_Prob: uint8  % IDC_L2_GW4|0.01|0|0|1|single
  TOS_LCP4_Obj_Age: uint16  % IDC_L2_GW4|1|0|0|65535|uint16
  TOS_LCP4_Obj_ObstclProb: uint8  % IDC_L2_GW4|0.03125|0|0|1|single
  TOS_LCP4_Obj_ExistProb: uint8  % IDC_L2_GW4|0.01|0|0|1|single
  TOS_LCP4_Obj_Typ_Prob: uint8  % IDC_L2_GW4|0.01|0|0|1|single
  TOS_LCP4_Obj_Std_HdgAng: uint16  % IDC_L2_GW4|0.01|0|0|3.14|single
  TOS_LCP4_Obj_Std_Width: uint8  % IDC_L2_GW4|0.01|0|0|2|single
  TOS_LCP4_Obj_Std_Len: uint8  % IDC_L2_GW4|0.05|0|0|10|single
  TOS_LCP4_Obj_AY: uint16  % IDC_L2_GW4|0.05|-10.3|-10.3|7.3|single
  TOS_LCP4_Obj_AX: uint16  % IDC_L2_GW4|0.05|-10.3|-10.3|7.3|single
  TOS_LCP4_Obj_Std_VY: uint16  % IDC_L2_GW4|0.05|0|0|50|single
  TOS_LCP4_Obj_Std_VX: uint16  % IDC_L2_GW4|0.05|0|0|130|single
  TOS_LCP4_Obj_Std_DY: uint16  % IDC_L2_GW4|0.05|0|0|100|single
  TOS_LCP4_Obj_Std_DX: uint16  % IDC_L2_GW4|0.05|0|0|250|single
  TOS_LCP4_Obj_Std_AY: uint8  % IDC_L2_GW4|0.05|0|0|7.3|single
  TOS_LCP4_Obj_Std_AX: uint8  % IDC_L2_GW4|0.05|0|0|7.3|single
  TOS_LCP4_Obj_VY: uint16  % IDC_L2_GW4|0.05|-50|-50|50|single
  TOS_LCP4_Obj_VX: uint16  % IDC_L2_GW4|0.05|-120|-120|130|single
  TOS_LCP4_Obj_DY: uint16  % IDC_L2_GW4|0.05|-100|-100|100|single
  TOS_LCP4_Obj_DX: uint16  % IDC_L2_GW4|0.05|-80|-80|200|single
  TOS_LCP4_Obj_MovgSt: uint8  % IDC_L2_GW4|1|0|0|5|uint8
  TOS_LCP4_Obj_Orntn: uint8  % IDC_L2_GW4|1|0|0|10|uint8
  TOS_LCP4_Obj_YawAng: uint16  % IDC_L2_GW4|0.01|-180|-180|180|single
  TOS_LCP4_Obj_HdgAng: uint16  % IDC_L2_GW4|0.01|-180|-180|180|single
  TOS_LCP4_Obj_Hei: uint16  % IDC_L2_GW4|0.01|0.01|0.01|2.95|single
  TOS_LCP4_Obj_Width: uint16  % IDC_L2_GW4|0.01|0.04|0.04|2.98|single
  TOS_LCP4_Obj_Len: uint16  % IDC_L2_GW4|0.05|1.2|1.2|21|single
  TOS_LCP4_Obj_Typ: uint8  % IDC_L2_GW4|1|0|0|8|uint8
  TOS_LCP4_Obj_ID: uint8  % IDC_L2_GW4|1|0|0|80|uint8
  TOS_LCP4_Obj_Fusn_Typ: uint8  % IDC_L2_GW4|1|0|0|63|uint8
  AEB_LATPED_dyFisrtDetn: uint16  % IDC_L2_GW4|0.125|-128|-128|127.875|single
  AEB_LATPED_dxFisrtDetn: uint16  % IDC_L2_GW4|0.125|0|0|254.9375|single
  AEB_LATPED_ObjMeasSts: boolean  % IDC_L2_GW4|1|0|0|1|boolean
  AEB_LATPED_ObjLifeCycle: uint16  % IDC_L2_GW4|17|0|0|65535|uint16
  AEB_LATPED_ObjExistProb: uint8  % IDC_L2_GW4|0.015625|0|0|0.98438|single
  AEB_LATPED_ObjIsObstclProb: uint8  % IDC_L2_GW4|0.03125|0|0|0.96875|single
  AEB_LATPED_dyVari: uint8  % IDC_L2_GW4|0.0625|0|0|15.5|single
  AEB_LATPED_dxVari: uint8  % IDC_L2_GW4|0.0625|0|0|15.5|single
  AEB_LATPED_ay: uint16  % IDC_L2_GW4|0.03125|-16|-16|15.9688|single
  AEB_LATPED_ax: uint16  % IDC_L2_GW4|0.03125|-16|-16|15.9688|single
  AEB_LATPED_vy: uint16  % IDC_L2_GW4|0.125|-64|-64|63.875|single
  AEB_LATPED_vx: uint16  % IDC_L2_GW4|0.0625|-128|-128|127|single
  AEB_LATPED_dz: uint16  % IDC_L2_GW4|0.05|-102.4|-102.4|102.3|single
  AEB_LATPED_dy: uint16  % IDC_L2_GW4|0.125|-128|-128|127.875|single
  AEB_LATPED_ObjMovgOrntn: uint8  % IDC_L2_GW4|1|0|0|3|uint8
  AEB_LATPED_dx: uint16  % IDC_L2_GW4|0.0625|0|0|255.9375|single
  AEB_LATPED_ObjMovgSt: uint8  % IDC_L2_GW4|1|0|0|4|uint8
  AEB_LATPED_ObjYawAng: uint16  % IDC_L2_GW4|0.01|-180|-180|180|single
  AEB_LATPED_ObjHei: uint16  % IDC_L2_GW4|0.01|0|0|6|single
  AEB_LATPED_ObjWidth: uint16  % IDC_L2_GW4|0.01|0|0|5|single
  AEB_LATPED_ObjTypCamCfmd: boolean  % IDC_L2_GW4|1|0|0|1|boolean
  AEB_LATPED_ObjLen: uint16  % IDC_L2_GW4|0.05|0|0|20|single
  AEB_LATPED_ObjTyp: uint8  % IDC_L2_GW4|1|0|0|8|uint8
  AEB_LATPED_FusnTyp: uint8  % IDC_L2_GW4|1|0|0|63|uint8
  AEB_LATPED_ObjID: uint8  % IDC_L2_GW4|1|0|0|255|uint8

IDC_L2_GW5_MSG_BUS = Simulink.Bus(HeaderFile="Rte_Type.h")
  AEB_JAPED_dyFisrtDetn: single
  AEB_JAPED_dxFisrtDetn: single
  AEB_JAPED_ObjMeasSts: boolean
  AEB_JAPED_ObjLifeCycle: uint16
  AEB_JAPED_ObjExistProb: single
  AEB_JAPED_ObjIsObstclProb: single
  AEB_JAPED_dyVari: single
  AEB_JAPED_dxVari: single
  AEB_JAPED_ay: single
  AEB_JAPED_ax: single
  AEB_JAPED_vy: single
  AEB_JAPED_vx: single
  AEB_JAPED_dz: single
  AEB_JAPED_dy: single
  AEB_JAPED_ObjMovgOrntn: uint8
  AEB_JAPED_dx: single
  AEB_JAPED_ObjMovgSt: uint8
  AEB_JAPED_ObjYawAng: single
  AEB_JAPED_ObjHei: single
  AEB_JAPED_ObjWidth: single
  AEB_JAPED_ObjTypCamCfmd: boolean
  AEB_JAPED_ObjLen: single
  AEB_JAPED_ObjTyp: uint8
  AEB_JAPED_FusnTyp: uint8
  AEB_JAPED_ObjID: uint8
  TOS_LCP10_ObjIn_Lane: uint8
  TOS_LCP10_LeftLane_Prob: single
  TOS_LCP10_RightLane_Prob: single
  TOS_LCP10_CurrLane_Prob: single
  TOS_LCP10_Obj_Age: uint16
  TOS_LCP10_Obj_ObstclProb: single
  TOS_LCP10_Obj_ExistProb: single
  TOS_LCP10_Obj_Typ_Prob: single
  TOS_LCP10_Obj_Std_HdgAng: single
  TOS_LCP10_Obj_Std_Width: single
  TOS_LCP10_Obj_Std_Len: single
  TOS_LCP10_Obj_AY: single
  TOS_LCP10_Obj_AX: single
  TOS_LCP10_Obj_Std_VY: single
  TOS_LCP10_Obj_Std_VX: single
  TOS_LCP10_Obj_Std_DY: single
  TOS_LCP10_Obj_Std_DX: single
  TOS_LCP10_Obj_Std_AY: single
  TOS_LCP10_Obj_Std_AX: single
  TOS_LCP10_Obj_VY: single
  TOS_LCP10_Obj_VX: single
  TOS_LCP10_Obj_DY: single
  TOS_LCP10_Obj_DX: single
  TOS_LCP10_Obj_MovgSt: uint8
  TOS_LCP10_Obj_Orntn: uint8
  TOS_LCP10_Obj_YawAng: single
  TOS_LCP10_Obj_HdgAng: single
  TOS_LCP10_Obj_Hei: single
  TOS_LCP10_Obj_Width: single
  TOS_LCP10_Obj_Len: single
  TOS_LCP10_Obj_Typ: uint8
  TOS_LCP10_Obj_Fusn_Typ: uint8
  TOS_LCP10_Obj_ID: uint8

IDC_L2_GW5_RAW_BUS = Simulink.Bus(HeaderFile="Rte_Type.h")
  AEB_JAPED_dyFisrtDetn: uint16  % IDC_L2_GW5|0.125|-128|-128|127.875|single
  AEB_JAPED_dxFisrtDetn: uint16  % IDC_L2_GW5|0.125|0|0|254.9375|single
  AEB_JAPED_ObjMeasSts: boolean  % IDC_L2_GW5|1|0|0|1|boolean
  AEB_JAPED_ObjLifeCycle: uint16  % IDC_L2_GW5|17|0|0|65535|uint16
  AEB_JAPED_ObjExistProb: uint8  % IDC_L2_GW5|0.015625|0|0|0.98438|single
  AEB_JAPED_ObjIsObstclProb: uint8  % IDC_L2_GW5|0.03125|0|0|0.96875|single
  AEB_JAPED_dyVari: uint8  % IDC_L2_GW5|0.0625|0|0|15.5|single
  AEB_JAPED_dxVari: uint8  % IDC_L2_GW5|0.0625|0|0|15.5|single
  AEB_JAPED_ay: uint16  % IDC_L2_GW5|0.03125|-16|-16|15.9688|single
  AEB_JAPED_ax: uint16  % IDC_L2_GW5|0.03125|-16|-16|15.9688|single
  AEB_JAPED_vy: uint16  % IDC_L2_GW5|0.125|-64|-64|63.875|single
  AEB_JAPED_vx: uint16  % IDC_L2_GW5|0.0625|-128|-128|127|single
  AEB_JAPED_dz: uint16  % IDC_L2_GW5|0.05|-102.4|-102.4|102.3|single
  AEB_JAPED_dy: uint16  % IDC_L2_GW5|0.125|-128|-128|127.875|single
  AEB_JAPED_ObjMovgOrntn: uint8  % IDC_L2_GW5|1|0|0|3|uint8
  AEB_JAPED_dx: uint16  % IDC_L2_GW5|0.0625|0|0|255.9375|single
  AEB_JAPED_ObjMovgSt: uint8  % IDC_L2_GW5|1|0|0|5|uint8
  AEB_JAPED_ObjYawAng: uint16  % IDC_L2_GW5|0.01|-180|-180|180|single
  AEB_JAPED_ObjHei: uint16  % IDC_L2_GW5|0.01|0|0|6|single
  AEB_JAPED_ObjWidth: uint16  % IDC_L2_GW5|0.01|0|0|5|single
  AEB_JAPED_ObjTypCamCfmd: boolean  % IDC_L2_GW5|1|0|0|1|boolean
  AEB_JAPED_ObjLen: uint16  % IDC_L2_GW5|0.05|0|0|20|single
  AEB_JAPED_ObjTyp: uint8  % IDC_L2_GW5|1|0|0|8|uint8
  AEB_JAPED_FusnTyp: uint8  % IDC_L2_GW5|1|0|0|63|uint8
  AEB_JAPED_ObjID: uint8  % IDC_L2_GW5|1|0|0|255|uint8
  TOS_LCP10_ObjIn_Lane: uint8  % IDC_L2_GW5|1|0|0|3|uint8
  TOS_LCP10_LeftLane_Prob: uint8  % IDC_L2_GW5|0.01|0|0|1|single
  TOS_LCP10_RightLane_Prob: uint8  % IDC_L2_GW5|0.01|0|0|1|single
  TOS_LCP10_CurrLane_Prob: uint8  % IDC_L2_GW5|0.01|0|0|1|single
  TOS_LCP10_Obj_Age: uint16  % IDC_L2_GW5|1|0|0|65535|uint16
  TOS_LCP10_Obj_ObstclProb: uint8  % IDC_L2_GW5|0.03125|0|0|1|single
  TOS_LCP10_Obj_ExistProb: uint8  % IDC_L2_GW5|0.01|0|0|1|single
  TOS_LCP10_Obj_Typ_Prob: uint8  % IDC_L2_GW5|0.01|0|0|1|single
  TOS_LCP10_Obj_Std_HdgAng: uint16  % IDC_L2_GW5|0.01|0|0|3.14|single
  TOS_LCP10_Obj_Std_Width: uint8  % IDC_L2_GW5|0.01|0|0|2|single
  TOS_LCP10_Obj_Std_Len: uint8  % IDC_L2_GW5|0.05|0|0|10|single
  TOS_LCP10_Obj_AY: uint16  % IDC_L2_GW5|0.05|-10.3|-10.3|7.3|single
  TOS_LCP10_Obj_AX: uint16  % IDC_L2_GW5|0.05|-10.3|-10.3|7.3|single
  TOS_LCP10_Obj_Std_VY: uint16  % IDC_L2_GW5|0.05|0|0|50|single
  TOS_LCP10_Obj_Std_VX: uint16  % IDC_L2_GW5|0.05|0|0|130|single
  TOS_LCP10_Obj_Std_DY: uint16  % IDC_L2_GW5|0.05|0|0|100|single
  TOS_LCP10_Obj_Std_DX: uint16  % IDC_L2_GW5|0.05|0|0|250|single
  TOS_LCP10_Obj_Std_AY: uint8  % IDC_L2_GW5|0.05|0|0|7.3|single
  TOS_LCP10_Obj_Std_AX: uint8  % IDC_L2_GW5|0.05|0|0|7.3|single
  TOS_LCP10_Obj_VY: uint16  % IDC_L2_GW5|0.05|-50|-50|50|single
  TOS_LCP10_Obj_VX: uint16  % IDC_L2_GW5|0.05|-120|-120|130|single
  TOS_LCP10_Obj_DY: uint16  % IDC_L2_GW5|0.05|-100|-100|100|single
  TOS_LCP10_Obj_DX: uint16  % IDC_L2_GW5|0.05|-80|-80|200|single
  TOS_LCP10_Obj_MovgSt: uint8  % IDC_L2_GW5|1|0|0|5|uint8
  TOS_LCP10_Obj_Orntn: uint8  % IDC_L2_GW5|1|0|0|10|uint8
  TOS_LCP10_Obj_YawAng: uint16  % IDC_L2_GW5|0.01|-180|-180|180|single
  TOS_LCP10_Obj_HdgAng: uint16  % IDC_L2_GW5|0.01|-180|-180|180|single
  TOS_LCP10_Obj_Hei: uint16  % IDC_L2_GW5|0.01|0.01|0.01|2.95|single
  TOS_LCP10_Obj_Width: uint16  % IDC_L2_GW5|0.01|0.04|0.04|2.98|single
  TOS_LCP10_Obj_Len: uint16  % IDC_L2_GW5|0.05|1.2|1.2|21|single
  TOS_LCP10_Obj_Typ: uint8  % IDC_L2_GW5|1|0|0|8|uint8
  TOS_LCP10_Obj_Fusn_Typ: uint8  % IDC_L2_GW5|1|0|0|63|uint8
  TOS_LCP10_Obj_ID: uint8  % IDC_L2_GW5|1|0|0|80|uint8

IDC_L2_GW6_MSG_BUS = Simulink.Bus(HeaderFile="Rte_Type.h")
  DTC_ERR_01: uint32
  DTC_ERR_02: uint32
  DTC_ERR_03: uint32
  DTC_ERR_04: uint32
  DTC_ERR_05: uint32
  ITC_ERR_01: uint32
  ITC_ERR_02: uint32
  ITC_ERR_03: uint32
  ITC_ERR_04: uint32
  ITC_ERR_05: uint32
  ITC_ERR_06: uint32
  ITC_ERR_07: uint32
  ITC_ERR_08: uint32
  ITC_ERR_09: uint32
  ITC_ERR_10: uint32
  ITC_ERR_11: uint32

IDC_L2_GW6_RAW_BUS = Simulink.Bus(HeaderFile="Rte_Type.h")
  DTC_ERR_01: uint32  % IDC_L2_GW6|1|0|0|4294967295|uint32
  DTC_ERR_02: uint32  % IDC_L2_GW6|1|0|0|4294967295|uint32
  DTC_ERR_03: uint32  % IDC_L2_GW6|1|0|0|4294967295|uint32
  DTC_ERR_04: uint32  % IDC_L2_GW6|1|0|0|4294967295|uint32
  DTC_ERR_05: uint32  % IDC_L2_GW6|1|0|0|4294967295|uint32
  ITC_ERR_01: uint32  % IDC_L2_GW6|1|0|0|4294967295|uint32
  ITC_ERR_02: uint32  % IDC_L2_GW6|1|0|0|4294967295|uint32
  ITC_ERR_03: uint32  % IDC_L2_GW6|1|0|0|4294967295|uint32
  ITC_ERR_04: uint32  % IDC_L2_GW6|1|0|0|4294967295|uint32
  ITC_ERR_05: uint32  % IDC_L2_GW6|1|0|0|4294967295|uint32
  ITC_ERR_06: uint32  % IDC_L2_GW6|1|0|0|4294967295|uint32
  ITC_ERR_07: uint32  % IDC_L2_GW6|1|0|0|4294967295|uint32
  ITC_ERR_08: uint32  % IDC_L2_GW6|1|0|0|4294967295|uint32
  ITC_ERR_09: uint32  % IDC_L2_GW6|1|0|0|4294967295|uint32
  ITC_ERR_10: uint32  % IDC_L2_GW6|1|0|0|4294967295|uint32
  ITC_ERR_11: uint32  % IDC_L2_GW6|1|0|0|4294967295|uint32

IDC_L2_GW7_MSG_BUS = Simulink.Bus(HeaderFile="Rte_Type.h")
  ITC_ERR_12: uint32
  ITC_ERR_13: uint32
  ITC_ERR_14: uint32
  ITC_ERR_15: uint32
  ITC_ERR_16: uint32
  ITC_ERR_17: uint32
  ITC_ERR_18: uint32
  ITC_ERR_19: uint32
  ITC_ERR_20: uint32
  ITC_ERR_21: uint32
  ITC_ERR_22: uint32
  ITC_ERR_23: uint32
  ITC_ERR_24: uint32
  ITC_ERR_25: uint32
  DTC_ERR_06: uint32
  DTC_ERR_07: uint32

IDC_L2_GW7_RAW_BUS = Simulink.Bus(HeaderFile="Rte_Type.h")
  ITC_ERR_12: uint32  % IDC_L2_GW7|1|0|0|4294967295|uint32
  ITC_ERR_13: uint32  % IDC_L2_GW7|1|0|0|4294967295|uint32
  ITC_ERR_14: uint32  % IDC_L2_GW7|1|0|0|4294967295|uint32
  ITC_ERR_15: uint32  % IDC_L2_GW7|1|0|0|4294967295|uint32
  ITC_ERR_16: uint32  % IDC_L2_GW7|1|0|0|4294967295|uint32
  ITC_ERR_17: uint32  % IDC_L2_GW7|1|0|0|4294967295|uint32
  ITC_ERR_18: uint32  % IDC_L2_GW7|1|0|0|4294967295|uint32
  ITC_ERR_19: uint32  % IDC_L2_GW7|1|0|0|4294967295|uint32
  ITC_ERR_20: uint32  % IDC_L2_GW7|1|0|0|4294967295|uint32
  ITC_ERR_21: uint32  % IDC_L2_GW7|1|0|0|4294967295|uint32
  ITC_ERR_22: uint32  % IDC_L2_GW7|1|0|0|4294967295|uint32
  ITC_ERR_23: uint32  % IDC_L2_GW7|1|0|0|4294967295|uint32
  ITC_ERR_24: uint32  % IDC_L2_GW7|1|0|0|4294967295|uint32
  ITC_ERR_25: uint32  % IDC_L2_GW7|1|0|0|4294967295|uint32
  DTC_ERR_06: uint32  % IDC_L2_GW7|1|0|0|4294967295|uint32
  DTC_ERR_07: uint32  % IDC_L2_GW7|1|0|0|4294967295|uint32

IDC_L2_GW8_MSG_BUS = Simulink.Bus(HeaderFile="Rte_Type.h")
  TOS_LCP9_ObjIn_Lane: uint8
  TOS_LCP9_RightLane_Prob: single
  TOS_LCP9_LeftLane_Prob: single
  TOS_LCP9_CurrLane_Prob: single
  TOS_LCP9_Obj_ObstclProb: single
  TOS_LCP9_Obj_Age: uint16
  TOS_LCP9_Obj_ExistProb: single
  TOS_LCP9_Obj_Typ_Prob: single
  TOS_LCP9_Obj_Std_HdgAng: single
  TOS_LCP9_Obj_Std_Width: single
  TOS_LCP9_Obj_Std_Len: single
  TOS_LCP9_Obj_AY: single
  TOS_LCP9_Obj_AX: single
  TOS_LCP9_Obj_Std_VY: single
  TOS_LCP9_Obj_Std_VX: single
  TOS_LCP9_Obj_Std_DY: single
  TOS_LCP9_Obj_Std_DX: single
  TOS_LCP9_Obj_Std_AY: single
  TOS_LCP9_Obj_Std_AX: single
  TOS_LCP9_Obj_VY: single
  TOS_LCP9_Obj_VX: single
  TOS_LCP9_Obj_DY: single
  TOS_LCP9_Obj_DX: single
  TOS_LCP9_Obj_MovgSt: uint8
  TOS_LCP9_Obj_Orntn: uint8
  TOS_LCP9_Obj_YawAng: single
  TOS_LCP9_Obj_HdgAng: single
  TOS_LCP9_Obj_Hei: single
  TOS_LCP9_Obj_Width: single
  TOS_LCP9_Obj_Typ: uint8
  TOS_LCP9_Obj_Len: single
  TOS_LCP9_Obj_ID: uint8
  ACC_RiTgtTyp: uint8
  TOS_LCP9_Obj_Fusn_Typ: uint8
  ACC_RiTgtDx: single
  ACC_RiTgtDy: single
  ACC_LeTgtTyp: uint8
  ACC_LeTargrtDection: uint8
  ACC_RiTargrtDetn: uint8
  ACC_LeTgtDx: single
  ACC_LeTgtDy: single
  ACC_PotentialTgtDetn: uint8
  ACC_PotentialTgtTyp: uint8
  ACC_RlvTgtDx: single
  ACC_RlvTgtTyp: uint8
  ACC_RlvTgtDy: single
  ACC_RlvTgtDetn: uint8
  ACC_EgoStatus: uint8
  ACC_PotentialTgtDx: single
  ACC_PotentialTgtDy: single
  ISL_InterSysInfoDisp: uint8
  CruCha_ModDisp: uint8
  CruChar_InterSysInfoDisp: uint8
  TJA_ACC_SelSts: uint8
  TJA_ICA_ModDisp: uint8
  TJA_ICA_InterSysInfoDisp: uint8
  Longctrl_HazActv: uint8
  ACC_TgtObjBarDisp: uint8
  ACC_TimeGapSet: uint8
  ACC_SpdSetValue: uint8
  ACC_ModDisp: uint8
  ACC_FctSts: uint8
  ACC_ObjDetecte: boolean
  ACC_TakeOverReq: boolean
  ACC_InterSysInfoDisp: uint8
  HWA_LaneChangeReq: uint8
  HWA_LaneChange: uint8
  ADAS_DriverInloop_Monitor: uint8
  HWA_warning: uint8
  HWA_ModDisp: uint8
  HWA_InterSysInfoDisp: uint8
  ISL_Resp: boolean
  ICA_HandsOffResp: boolean
  HWA_Resp: boolean
  ALC_Resp: boolean
  ActualTargetSpeed: uint8
  Longctrl_FuelCutOffPrevn: boolean
  Longctrl_DecelToStopReq: boolean
  Longctrl_ParkShiftReq: uint8
  Longctrl_Decel_ReqValue: single
  Longctrl_EngTrqReqActive: boolean
  Longctrl_VehHldReq: boolean
  Longctrl_DrvOFF_Req: boolean
  Longctrl_ModSts: uint8
  Longctrl_Decel_Req: boolean
  Longctrl_EngTrqReq: single

IDC_L2_GW8_RAW_BUS = Simulink.Bus(HeaderFile="Rte_Type.h")
  TOS_LCP9_ObjIn_Lane: uint8  % IDC_L2_GW8|1|0|0|3|uint8
  TOS_LCP9_RightLane_Prob: uint8  % IDC_L2_GW8|0.01|0|0|1|single
  TOS_LCP9_LeftLane_Prob: uint8  % IDC_L2_GW8|0.01|0|0|1|single
  TOS_LCP9_CurrLane_Prob: uint8  % IDC_L2_GW8|0.01|0|0|1|single
  TOS_LCP9_Obj_ObstclProb: uint8  % IDC_L2_GW8|0.03125|0|0|1|single
  TOS_LCP9_Obj_Age: uint16  % IDC_L2_GW8|1|0|0|65535|uint16
  TOS_LCP9_Obj_ExistProb: uint8  % IDC_L2_GW8|0.01|0|0|1|single
  TOS_LCP9_Obj_Typ_Prob: uint8  % IDC_L2_GW8|0.01|0|0|1|single
  TOS_LCP9_Obj_Std_HdgAng: uint16  % IDC_L2_GW8|0.01|0|0|3.14|single
  TOS_LCP9_Obj_Std_Width: uint8  % IDC_L2_GW8|0.01|0|0|2|single
  TOS_LCP9_Obj_Std_Len: uint8  % IDC_L2_GW8|0.05|0|0|10|single
  TOS_LCP9_Obj_AY: uint16  % IDC_L2_GW8|0.05|-10.3|-10.3|7.3|single
  TOS_LCP9_Obj_AX: uint16  % IDC_L2_GW8|0.05|-10.3|-10.3|7.3|single
  TOS_LCP9_Obj_Std_VY: uint16  % IDC_L2_GW8|0.05|0|0|50|single
  TOS_LCP9_Obj_Std_VX: uint16  % IDC_L2_GW8|0.05|0|0|130|single
  TOS_LCP9_Obj_Std_DY: uint16  % IDC_L2_GW8|0.05|0|0|100|single
  TOS_LCP9_Obj_Std_DX: uint16  % IDC_L2_GW8|0.05|0|0|250|single
  TOS_LCP9_Obj_Std_AY: uint8  % IDC_L2_GW8|0.05|0|0|7.3|single
  TOS_LCP9_Obj_Std_AX: uint8  % IDC_L2_GW8|0.05|0|0|7.3|single
  TOS_LCP9_Obj_VY: uint16  % IDC_L2_GW8|0.05|-50|-50|50|single
  TOS_LCP9_Obj_VX: uint16  % IDC_L2_GW8|0.05|-120|-120|130|single
  TOS_LCP9_Obj_DY: uint16  % IDC_L2_GW8|0.05|-100|-100|100|single
  TOS_LCP9_Obj_DX: uint16  % IDC_L2_GW8|0.05|-80|-80|200|single
  TOS_LCP9_Obj_MovgSt: uint8  % IDC_L2_GW8|1|0|0|5|uint8
  TOS_LCP9_Obj_Orntn: uint8  % IDC_L2_GW8|1|0|0|10|uint8
  TOS_LCP9_Obj_YawAng: uint16  % IDC_L2_GW8|0.01|-180|-180|180|single
  TOS_LCP9_Obj_HdgAng: uint16  % IDC_L2_GW8|0.01|-180|-180|180|single
  TOS_LCP9_Obj_Hei: uint16  % IDC_L2_GW8|0.01|0.01|0.01|2.95|single
  TOS_LCP9_Obj_Width: uint16  % IDC_L2_GW8|0.01|0.04|0.04|2.98|single
  TOS_LCP9_Obj_Typ: uint8  % IDC_L2_GW8|1|0|0|8|uint8
  TOS_LCP9_Obj_Len: uint16  % IDC_L2_GW8|0.05|1.2|1.2|21|single
  TOS_LCP9_Obj_ID: uint8  % IDC_L2_GW8|1|0|0|80|uint8
  ACC_RiTgtTyp: uint8  % IDC_L2_GW8|1|0|0|7|uint8
  TOS_LCP9_Obj_Fusn_Typ: uint8  % IDC_L2_GW8|1|0|0|63|uint8
  ACC_RiTgtDx: uint16  % IDC_L2_GW8|0.5|0|0|150|single
  ACC_RiTgtDy: uint8  % IDC_L2_GW8|0.1|-8|-8|8|single
  ACC_LeTgtTyp: uint8  % IDC_L2_GW8|1|0|0|7|uint8
  ACC_LeTargrtDection: uint8  % IDC_L2_GW8|1|0|0|3|uint8
  ACC_RiTargrtDetn: uint8  % IDC_L2_GW8|1|0|0|3|uint8
  ACC_LeTgtDx: uint16  % IDC_L2_GW8|0.5|0|0|150|single
  ACC_LeTgtDy: uint8  % IDC_L2_GW8|0.1|-8|-8|8|single
  ACC_PotentialTgtDetn: uint8  % IDC_L2_GW8|1|0|0|3|uint8
  ACC_PotentialTgtTyp: uint8  % IDC_L2_GW8|1|0|0|7|uint8
  ACC_RlvTgtDx: uint16  % IDC_L2_GW8|0.5|0|0|150|single
  ACC_RlvTgtTyp: uint8  % IDC_L2_GW8|1|0|0|7|uint8
  ACC_RlvTgtDy: uint8  % IDC_L2_GW8|0.1|-8|-8|8|single
  ACC_RlvTgtDetn: uint8  % IDC_L2_GW8|1|0|0|3|uint8
  ACC_EgoStatus: uint8  % IDC_L2_GW8|1|0|0|3|uint8
  ACC_PotentialTgtDx: uint16  % IDC_L2_GW8|0.5|0|0|150|single
  ACC_PotentialTgtDy: uint8  % IDC_L2_GW8|0.1|-8|-8|8|single
  ISL_InterSysInfoDisp: uint8  % IDC_L2_GW8|1|0|0|3|uint8
  CruCha_ModDisp: uint8  % IDC_L2_GW8|1|0|0|15|uint8
  CruChar_InterSysInfoDisp: uint8  % IDC_L2_GW8|1|0|0|15|uint8
  TJA_ACC_SelSts: uint8  % IDC_L2_GW8|1|0|0|7|uint8
  TJA_ICA_ModDisp: uint8  % IDC_L2_GW8|1|0|0|7|uint8
  TJA_ICA_InterSysInfoDisp: uint8  % IDC_L2_GW8|1|0|0|7|uint8
  Longctrl_HazActv: uint8  % IDC_L2_GW8|1|0|0|3|uint8
  ACC_TgtObjBarDisp: uint8  % IDC_L2_GW8|1|0|0|7|uint8
  ACC_TimeGapSet: uint8  % IDC_L2_GW8|1|0|0|7|uint8
  ACC_SpdSetValue: uint8  % IDC_L2_GW8|1|0|0|255|uint8
  ACC_ModDisp: uint8  % IDC_L2_GW8|1|0|0|31|uint8
  ACC_FctSts: uint8  % IDC_L2_GW8|1|0|0|3|uint8
  ACC_ObjDetecte: boolean  % IDC_L2_GW8|1|0|0|1|boolean
  ACC_TakeOverReq: boolean  % IDC_L2_GW8|1|0|0|1|boolean
  ACC_InterSysInfoDisp: uint8  % IDC_L2_GW8|1|0|0|31|uint8
  HWA_LaneChangeReq: uint8  % IDC_L2_GW8|1|0|0|7|uint8
  HWA_LaneChange: uint8  % IDC_L2_GW8|1|0|0|3|uint8
  ADAS_DriverInloop_Monitor: uint8  % IDC_L2_GW8|1|0|0|7|uint8
  HWA_warning: uint8  % IDC_L2_GW8|1|0|0|3|uint8
  HWA_ModDisp: uint8  % IDC_L2_GW8|1|0|0|15|uint8
  HWA_InterSysInfoDisp: uint8  % IDC_L2_GW8|1|0|0|15|uint8
  ISL_Resp: boolean  % IDC_L2_GW8|1|0|0|1|boolean
  ICA_HandsOffResp: boolean  % IDC_L2_GW8|1|0|0|1|boolean
  HWA_Resp: boolean  % IDC_L2_GW8|1|0|0|1|boolean
  ALC_Resp: boolean  % IDC_L2_GW8|1|0|0|1|boolean
  ActualTargetSpeed: uint8  % IDC_L2_GW8|1|0|0|254|uint8
  Longctrl_FuelCutOffPrevn: boolean  % IDC_L2_GW8|1|0|0|1|boolean
  Longctrl_DecelToStopReq: boolean  % IDC_L2_GW8|1|0|0|1|boolean
  Longctrl_ParkShiftReq: uint8  % IDC_L2_GW8|1|0|0|3|uint8
  Longctrl_Decel_ReqValue: uint8  % IDC_L2_GW8|0.05|-7|-7|5.75|single
  Longctrl_EngTrqReqActive: boolean  % IDC_L2_GW8|1|0|0|1|boolean
  Longctrl_VehHldReq: boolean  % IDC_L2_GW8|1|0|0|1|boolean
  Longctrl_DrvOFF_Req: boolean  % IDC_L2_GW8|1|0|0|1|boolean
  Longctrl_ModSts: uint8  % IDC_L2_GW8|1|0|0|15|uint8
  Longctrl_Decel_Req: boolean  % IDC_L2_GW8|1|0|0|1|boolean
  Longctrl_EngTrqReq: uint16  % IDC_L2_GW8|0.0030518|-100|-100|99.9997|single

IDC_L2_GW9_MSG_BUS = Simulink.Bus(HeaderFile="Rte_Type.h")
  TOS_LCP5_ObjIn_Lane: uint8
  HMA_HibeamReq: uint8
  TOS_LCP5_RightLane_Prob: single
  TOS_LCP5_LeftLane_Prob: single
  TOS_LCP5_CurrLane_Prob: single
  TOS_LCP5_Obj_Age: uint16
  TOS_LCP5_Obj_ObstclProb: single
  TOS_LCP5_Obj_ExistProb: single
  TOS_LCP5_Obj_Typ_Prob: single
  TOS_LCP5_Obj_Std_HdgAng: single
  TOS_LCP5_Obj_Std_Width: single
  TOS_LCP5_Obj_Std_Len: single
  TOS_LCP5_Obj_AY: single
  TOS_LCP5_Obj_AX: single
  TOS_LCP5_Obj_Std_VY: single
  TOS_LCP5_Obj_Std_VX: single
  TOS_LCP5_Obj_Std_DY: single
  TOS_LCP5_Obj_Std_DX: single
  TOS_LCP5_Obj_Std_AY: single
  TOS_LCP5_Obj_Std_AX: single
  TOS_LCP5_Obj_VY: single
  TOS_LCP5_Obj_VX: single
  TOS_LCP5_Obj_DY: single
  TOS_LCP5_Obj_Orntn: uint8
  TOS_LCP5_Obj_DX: single
  TOS_LCP5_Obj_MovgSt: uint8
  TOS_LCP5_Obj_YawAng: single
  TOS_LCP5_Obj_HdgAng: single
  TOS_LCP5_Obj_Hei: single
  TOS_LCP5_Obj_Width: single
  TOS_LCP5_Obj_Len: single
  TOS_LCP5_Obj_ID: uint8
  TOS_LCP5_Obj_Typ: uint8
  TOS_LCP5_Obj_Fusn_Typ: uint8
  TSRSpdLimWarn: boolean
  TSRWarnResp: boolean
  TSR_Snvty: int8
  HMA_Sts: uint8
  TSRTrfcSignVal: uint8
  TSRSts: uint8
  TSRSpdLimSts: uint8
  TSRTrfcSignValCfdc: uint8
  TSRSpdLim: uint8
  TSRSpdLimCfdc: uint8
  TSRSpdLimUnit: uint8
  IFC_NextRiLane_dy: single
  IFC_NextLeLane_dy: single
  IFC_RiLane_dy: single
  IFC_NextLeLaneTyp: uint8
  IFC_NextRiLaneTyp: uint8
  IFC_LeLane_dy: single
  IFC_LeLaneTyp: uint8
  IFC_RiLaneTyp: uint8
  LaneAvailability: uint8
  LSSErrSts: uint8
  ESSintervention: uint8
  IFC_LaneCurve: single
  LSSFuncSts: uint8
  ELKMainState: uint8
  IFCCalibrationSts: uint8
  CameraBlockageSts: boolean
  LDW_LKAWarn: uint8
  LSSIntervention: uint8
  IntelligentEvaResp: boolean
  AESSts: uint8
  ESSSts: uint8
  AESErrSts: boolean
  ESSErrSts: boolean
  IFC_Handsoffwarn: uint8
  LDWResp: boolean
  LKAResp: boolean
  LCKResp: boolean
  ELKResp: boolean
  LDW_LKA_Snvty: uint8
  IFCHUTInterface: boolean
  IFCAngCmdReqProtnValue: uint16
  IFCFuncTrqCmdReqFlag: uint8
  IFCVibrationWarning: uint8
  IFCAngCmdReqValue: single
  IFCTrqOvlCmdReqValue: single
  ObjTTCRi: single
  IFCTrqOvlCmdProtnValue: uint16

IDC_L2_GW9_RAW_BUS = Simulink.Bus(HeaderFile="Rte_Type.h")
  TOS_LCP5_ObjIn_Lane: uint8  % IDC_L2_GW9|1|0|0|3|uint8
  HMA_HibeamReq: uint8  % IDC_L2_GW9|1|0|0|3|uint8
  TOS_LCP5_RightLane_Prob: uint8  % IDC_L2_GW9|0.01|0|0|1|single
  TOS_LCP5_LeftLane_Prob: uint8  % IDC_L2_GW9|0.01|0|0|1|single
  TOS_LCP5_CurrLane_Prob: uint8  % IDC_L2_GW9|0.01|0|0|1|single
  TOS_LCP5_Obj_Age: uint16  % IDC_L2_GW9|1|0|0|65535|uint16
  TOS_LCP5_Obj_ObstclProb: uint8  % IDC_L2_GW9|0.03125|0|0|1|single
  TOS_LCP5_Obj_ExistProb: uint8  % IDC_L2_GW9|0.01|0|0|1|single
  TOS_LCP5_Obj_Typ_Prob: uint8  % IDC_L2_GW9|0.01|0|0|1|single
  TOS_LCP5_Obj_Std_HdgAng: uint16  % IDC_L2_GW9|0.01|0|0|3.14|single
  TOS_LCP5_Obj_Std_Width: uint8  % IDC_L2_GW9|0.01|0|0|2|single
  TOS_LCP5_Obj_Std_Len: uint8  % IDC_L2_GW9|0.05|0|0|10|single
  TOS_LCP5_Obj_AY: uint16  % IDC_L2_GW9|0.05|-10.3|-10.3|7.3|single
  TOS_LCP5_Obj_AX: uint16  % IDC_L2_GW9|0.05|-10.3|-10.3|7.3|single
  TOS_LCP5_Obj_Std_VY: uint16  % IDC_L2_GW9|0.05|0|0|50|single
  TOS_LCP5_Obj_Std_VX: uint16  % IDC_L2_GW9|0.05|0|0|130|single
  TOS_LCP5_Obj_Std_DY: uint16  % IDC_L2_GW9|0.05|0|0|100|single
  TOS_LCP5_Obj_Std_DX: uint16  % IDC_L2_GW9|0.05|0|0|250|single
  TOS_LCP5_Obj_Std_AY: uint8  % IDC_L2_GW9|0.05|0|0|7.3|single
  TOS_LCP5_Obj_Std_AX: uint8  % IDC_L2_GW9|0.05|0|0|7.3|single
  TOS_LCP5_Obj_VY: uint16  % IDC_L2_GW9|0.05|-50|-50|50|single
  TOS_LCP5_Obj_VX: uint16  % IDC_L2_GW9|0.05|-120|-120|130|single
  TOS_LCP5_Obj_DY: uint16  % IDC_L2_GW9|0.05|-100|-100|100|single
  TOS_LCP5_Obj_Orntn: uint8  % IDC_L2_GW9|1|0|0|10|uint8
  TOS_LCP5_Obj_DX: uint16  % IDC_L2_GW9|0.05|-80|-80|200|single
  TOS_LCP5_Obj_MovgSt: uint8  % IDC_L2_GW9|1|0|0|5|uint8
  TOS_LCP5_Obj_YawAng: uint16  % IDC_L2_GW9|0.01|-180|-180|180|single
  TOS_LCP5_Obj_HdgAng: uint16  % IDC_L2_GW9|0.01|-180|-180|180|single
  TOS_LCP5_Obj_Hei: uint16  % IDC_L2_GW9|0.01|0.01|0.01|2.95|single
  TOS_LCP5_Obj_Width: uint16  % IDC_L2_GW9|0.01|0.04|0.04|2.98|single
  TOS_LCP5_Obj_Len: uint16  % IDC_L2_GW9|0.05|1.2|1.2|21|single
  TOS_LCP5_Obj_ID: uint8  % IDC_L2_GW9|1|0|0|80|uint8
  TOS_LCP5_Obj_Typ: uint8  % IDC_L2_GW9|1|0|0|8|uint8
  TOS_LCP5_Obj_Fusn_Typ: uint8  % IDC_L2_GW9|1|0|0|63|uint8
  TSRSpdLimWarn: boolean  % IDC_L2_GW9|1|0|0|1|boolean
  TSRWarnResp: boolean  % IDC_L2_GW9|1|0|0|1|boolean
  TSR_Snvty: uint8  % IDC_L2_GW9|1|-15|-15|15|int8
  HMA_Sts: uint8  % IDC_L2_GW9|1|0|0|7|uint8
  TSRTrfcSignVal: uint8  % IDC_L2_GW9|1|0|0|255|uint8
  TSRSts: uint8  % IDC_L2_GW9|1|0|0|7|uint8
  TSRSpdLimSts: uint8  % IDC_L2_GW9|1|0|0|3|uint8
  TSRTrfcSignValCfdc: uint8  % IDC_L2_GW9|1|0|0|3|uint8
  TSRSpdLim: uint8  % IDC_L2_GW9|1|0|0|63|uint8
  TSRSpdLimCfdc: uint8  % IDC_L2_GW9|1|0|0|3|uint8
  TSRSpdLimUnit: uint8  % IDC_L2_GW9|1|0|0|3|uint8
  IFC_NextRiLane_dy: uint16  % IDC_L2_GW9|0.0039063|-8|-8|7.9922|single
  IFC_NextLeLane_dy: uint16  % IDC_L2_GW9|0.0039063|-8|-8|7.9922|single
  IFC_RiLane_dy: uint16  % IDC_L2_GW9|0.0039063|-8|-8|7.9922|single
  IFC_NextLeLaneTyp: uint8  % IDC_L2_GW9|1|0|0|7|uint8
  IFC_NextRiLaneTyp: uint8  % IDC_L2_GW9|1|0|0|7|uint8
  IFC_LeLane_dy: uint16  % IDC_L2_GW9|0.0039063|-8|-8|7.9922|single
  IFC_LeLaneTyp: uint8  % IDC_L2_GW9|1|0|0|7|uint8
  IFC_RiLaneTyp: uint8  % IDC_L2_GW9|1|0|0|7|uint8
  LaneAvailability: uint8  % IDC_L2_GW9|1|0|0|3|uint8
  LSSErrSts: uint8  % IDC_L2_GW9|1|0|0|7|uint8
  ESSintervention: uint8  % IDC_L2_GW9|1|0|0|3|uint8
  IFC_LaneCurve: uint16  % IDC_L2_GW9|1.5e-05|-0.0307|-0.0307|0.030705|single
  LSSFuncSts: uint8  % IDC_L2_GW9|1|0|0|7|uint8
  ELKMainState: uint8  % IDC_L2_GW9|1|0|0|7|uint8
  IFCCalibrationSts: uint8  % IDC_L2_GW9|1|0|0|3|uint8
  CameraBlockageSts: boolean  % IDC_L2_GW9|1|0|0|1|boolean
  LDW_LKAWarn: uint8  % IDC_L2_GW9|1|0|0|3|uint8
  LSSIntervention: uint8  % IDC_L2_GW9|1|0|0|7|uint8
  IntelligentEvaResp: boolean  % IDC_L2_GW9|1|0|0|1|boolean
  AESSts: uint8  % IDC_L2_GW9|1|0|0|3|uint8
  ESSSts: uint8  % IDC_L2_GW9|1|0|0|3|uint8
  AESErrSts: boolean  % IDC_L2_GW9|1|0|0|1|boolean
  ESSErrSts: boolean  % IDC_L2_GW9|1|0|0|1|boolean
  IFC_Handsoffwarn: uint8  % IDC_L2_GW9|1|0|0|7|uint8
  LDWResp: boolean  % IDC_L2_GW9|1|0|0|1|boolean
  LKAResp: boolean  % IDC_L2_GW9|1|0|0|1|boolean
  LCKResp: boolean  % IDC_L2_GW9|1|0|0|1|boolean
  ELKResp: boolean  % IDC_L2_GW9|1|0|0|1|boolean
  LDW_LKA_Snvty: uint8  % IDC_L2_GW9|1|0|0|3|uint8
  IFCHUTInterface: boolean  % IDC_L2_GW9|1|0|0|1|boolean
  IFCAngCmdReqProtnValue: uint16  % IDC_L2_GW9|1|0|0|16383|uint16
  IFCFuncTrqCmdReqFlag: uint8  % IDC_L2_GW9|1|0|0|7|uint8
  IFCVibrationWarning: uint8  % IDC_L2_GW9|1|0|0|3|uint8
  IFCAngCmdReqValue: uint16  % IDC_L2_GW9|0.1|-780|-780|780|single
  IFCTrqOvlCmdReqValue: uint16  % IDC_L2_GW9|0.01|-10.23|-10.23|10.24|single
  ObjTTCRi: uint8  % IDC_L2_GW9|0.1|0|0|12.7|single
  IFCTrqOvlCmdProtnValue: uint16  % IDC_L2_GW9|1|0|0|16383|uint16