% Simulink data dictionary PubIfDecisionLSM_RTE.sldd

LSM_TJA_ICA_BUS = Simulink.Bus(HeaderFile="Rte_Type.h")
  TJALineValid: boolean  % 目标线有效性
  TJALineC3: single  % TJA_ICA目标线参数C0;曲线方程：y=c0+c1*x+c2*x^2+c3*x^3;
  TJALineC2: single  % TJA_ICA目标线参数C1
  TJALineC1: single  % TJA_ICA目标线参数C2
  TJALineC0: single  % TJA_ICA目标线参数C3
  TJARange: single  % 目标线有效长度，基于车辆坐标系x轴正方向长度（>=0）

LSM_LCK_BUS = Simulink.Bus(HeaderFile="Rte_Type.h")
  LCKLineValid: boolean  % 目标线有效性
  LCKLineC3: single  % LCK；目标线参数C0;曲线方程：y=c0+c1*x+c2*x^2+c3*x^3;
  LCKLineC2: single  % LCK；目标线参数C1
  LCKLineC1: single  % LCK；目标线参数C2
  LCKLineC0: single  % LCK；目标线参数C3
  LCKRange: single  % 目标线有效长度，基于车辆坐标系x轴正方向长度（>=0）

LSM_ESS_BUS = Simulink.Bus(HeaderFile="Rte_Type.h")
  ESSLineValid: boolean  % 目标线是否有效
  ESSLineC3: single  % y = C3*x^3 + C2*x^2 + C1*x + C0
  ESSLineC2: single  % y = C3*x^3 + C2*x^2 + C1*x + C0
  ESSLineC1: single  % y = C3*x^3 + C2*x^2 + C1*x + C0
  ESSLineC0: single  % y = C3*x^3 + C2*x^2 + C1*x + C0
  ESSRange: single  % 目标线有效距离
  ESSLeLineValid: boolean  % 目标线是否有效
  ESSLeLineC3: single  % y = C3*x^3 + C2*x^2 + C1*x + C0
  ESSLeLineC2: single  % y = C3*x^3 + C2*x^2 + C1*x + C0
  ESSLeLineC1: single  % y = C3*x^3 + C2*x^2 + C1*x + C0
  ESSLeLineC0: single  % y = C3*x^3 + C2*x^2 + C1*x + C0
  ESSLeRange: single  % 目标线有效距离
  ESSRiLineValid: boolean  % 目标线是否有效
  ESSRiLineC3: single  % y = C3*x^3 + C2*x^2 + C1*x + C0
  ESSRiLineC2: single  % y = C3*x^3 + C2*x^2 + C1*x + C0
  ESSRiLineC1: single  % y = C3*x^3 + C2*x^2 + C1*x + C0
  ESSRiLineC0: single  % y = C3*x^3 + C2*x^2 + C1*x + C0
  ESSRiRange: single  % 目标线有效距离

LSM_HWA_BUS = Simulink.Bus(HeaderFile="Rte_Type.h")
  HWALineValid: boolean  % 目标线是否有效
  HWALineC3: single  % y = C3*x^3 + C2*x^2 + C1*x + C0
  HWALineC2: single  % y = C3*x^3 + C2*x^2 + C1*x + C0
  HWALineC1: single  % y = C3*x^3 + C2*x^2 + C1*x + C0
  HWALineC0: single  % y = C3*x^3 + C2*x^2 + C1*x + C0
  HWARange: single  % 目标线有效距离
  HWALeLineValid: boolean  % 目标线是否有效
  HWALeLineC3: single  % y = C3*x^3 + C2*x^2 + C1*x + C0
  HWALeLineC2: single  % y = C3*x^3 + C2*x^2 + C1*x + C0
  HWALeLineC1: single  % y = C3*x^3 + C2*x^2 + C1*x + C0
  HWALeLineC0: single  % y = C3*x^3 + C2*x^2 + C1*x + C0
  HWALeRange: single  % 目标线有效距离
  HWARiLineValid: boolean  % 目标线是否有效
  HWARiLineC3: single  % y = C3*x^3 + C2*x^2 + C1*x + C0
  HWARiLineC2: single  % y = C3*x^3 + C2*x^2 + C1*x + C0
  HWARiLineC1: single  % y = C3*x^3 + C2*x^2 + C1*x + C0
  HWARiLineC0: single  % y = C3*x^3 + C2*x^2 + C1*x + C0
  HWARiRange: single  % 目标线有效距离
  SingleLineLost_b: boolean  % 本车道单侧车道线丢失
  DoubleLineLost_b: boolean  % 本车道双侧车道线丢失
  preDyDiff: single
  HeadAngDiff: single
  MLeLane: boolean
  RoadWidth: single
  LeLineCrossing: boolean
  RiLineCrossing: boolean
  MRiLane: uint8
  MrcStopLane: uint8
  LeLineVirtual_b: boolean
  RiLineVirtual_b: boolean
  LeLineLcAvailable: boolean
  RiLineLcAvailable: boolean