% Simulink data dictionary PubIfSensorUNPACK_IF_RTE.sldd

ADCAN_DIAG_BUS = Simulink.Bus()
  RSDS_FD1_ErrSts: uint32
  RSDS_FD2_ErrSts: uint32
  ECM_FD1_ErrSts: uint32
  ECM_FD2_ErrSts: uint32
  ECM_FD3_ErrSts: uint32
  ECM1_ErrSts: uint32
  ECM4_ErrSts: uint32
  ECM9_ErrSts: uint32
  HCU_FD1_ErrSts: uint32
  HCU_PT1_ErrSts: uint32
  DCT_FD1_ErrSts: uint32
  DCT_FD4_ErrSts: uint32
  DCT5_ErrSts: uint32
  ESP_FD2_ErrSts: uint32
  ESP_FD3_ErrSts: uint32
  ESP1_ErrSts: uint32
  ESP2_ErrSts: uint32
  ABS1_ErrSts: uint32
  ABS2_ErrSts: uint32
  ABS3_ErrSts: uint32
  EPS_FD1_ErrSts: uint32
  BCM1_ErrSts: uint32
  BCM3_ErrSts: uint32
  BCM8_ErrSts: uint32
  AC2_ErrSts: uint32
  F_PBOX1_ErrSts: uint32
  R_PBOX1_ErrSts: uint32
  CSA1_ErrSts: uint32
  CSA2_ErrSts: uint32
  ABM1_ErrSts: uint32
  ABM2_ErrSts: uint32
  HAP_FD1_ErrSts: uint32
  IP2_ErrSts: uint32
  HUT_FD1_ErrSts: uint32
  HUT19_ErrSts: uint32
  T_BOX_FD3_ErrSts: uint32
  HC1_ErrSts: uint32
  DMS_FD1_ErrSts: uint32