% Simulink data dictionary PubIfUnpackIF_V411.sldd

VCAN_ABM_MSG_BUS = Simulink.Bus()
  PassSBR: boolean  % ABM1|1|0|0|1|boolean
  DrvSBR: boolean  % ABM1|1|0|0|1|boolean
  VehLgtAccel: single  % ABM2|0.00098|-21.592|-21.592|21.592|single
  VehLatAccel: single  % ABM2|0.00098|-21.592|-21.592|21.592|single
  VehYawRate: single  % ABM2|0.00024|-2.093|-2.093|2.093|single
  VehDynYawRateVld: boolean  % ABM2|1|0|0|1|boolean
  VehLatAccelVld: boolean  % ABM2|1|0|0|1|boolean
  VehLgtAccelVld: boolean  % ABM2|1|0|0|1|boolean

VCAN_AC_MSG_BUS = Simulink.Bus()
  ACAmbTemp: single  % AC2|0.5|-40|-40|86.5|single

VCAN_BCM_MSG_BUS = Simulink.Bus()
  WindshldWiprActvSts: boolean  % BCM1|1|0|0|1|boolean
  RRDoorSts: boolean  % BCM1|1|0|0|1|boolean
  PassengerDoorSts: boolean  % BCM1|1|0|0|1|boolean
  LRDoorSts: boolean  % BCM1|1|0|0|1|boolean
  DrvDoorSts: boolean  % BCM1|1|0|0|1|boolean
  HazardLmpSwtSts: boolean  % BCM3|1|0|0|1|boolean
  PASWorkCmd: boolean  % BCM8|1|0|0|1|boolean
  WiprReq_F_PBOX: uint8  % BCM8|1|0|0|7|uint8
  KL30BRelaySts: boolean  % BCM8|1|0|0|1|boolean

VCAN_CSA_MSG_BUS = Simulink.Bus()
  FrntWiprSwtSts: uint8  % CSA1|1|0|0|7|uint8
  FrntWshrSwtSts: uint8  % CSA1|1|0|0|3|uint8
  LTurnLmpSwtSts: boolean  % CSA1|1|0|0|1|boolean
  RTurnLmpSwtSts: boolean  % CSA1|1|0|0|1|boolean
  FrntFogLmpSwtSts: boolean  % CSA1|1|0|0|1|boolean
  LowBeamSwtSts: boolean  % CSA1|1|0|0|1|boolean
  HiBeamSwtSts: boolean  % CSA1|1|0|0|1|boolean
  AutoLmpSwtSts: boolean  % CSA1|1|0|0|1|boolean
  SteerWheelAngSign: boolean  % CSA2|1|0|0|1|boolean
  SteerWheelAng: single  % CSA2|0.1|0|0|780|single
  SteerWheelSpdSign: boolean  % CSA2|1|0|0|1|boolean
  SteerWheelSpd: single  % CSA2|0.1|0|0|1016|single
  ACC_TimeGap_DecSetSwt: boolean  % CSA2|1|0|0|1|boolean
  ACC_TimeGap_IncSetSwt: boolean  % CSA2|1|0|0|1|boolean
  CC_ACC_CANCEL_OFFSwt: boolean  % CSA2|1|0|0|1|boolean
  CC_ACC_CRUISE_OFFSwt: boolean  % CSA2|1|0|0|1|boolean
  CC_ACCSwtErr: boolean  % CSA2|1|0|0|1|boolean
  CC_ACC_DecSetSpd_SetSwt: boolean  % CSA2|1|0|0|1|boolean
  CC_ACC_IncSetSpd_ResuSwt: boolean  % CSA2|1|0|0|1|boolean
  SAS_Sts: uint8  % CSA2|1|0|0|3|uint8
  Rollingcounter_CSA2: uint8  % CSA2|1|0|0|15|uint8
  HWA_OK_OFFSwt: boolean  % CSA2|1|0|0|1|boolean

VCAN_CR_MSG_BUS = Simulink.Bus()
  FCTA_Warn: boolean  % CR_FD1|1|0|0|1|boolean
  FCTA_B_FuncSts: uint8  % CR_FD1|1|0|0|3|uint8
  CR_FCTB_Resp: boolean  % CR_FD1|1|0|0|1|boolean
  CR_FCTA_Resp: boolean  % CR_FD1|1|0|0|1|boolean
  FCTB_ABA_Req: boolean  % CR_FD1|1|0|0|1|boolean
  FCTB_ABA_Level: uint8  % CR_FD1|1|0|0|3|uint8
  FCTBTrig: boolean  % CR_FD1|1|0|0|1|boolean
  CR_BrkgReq: boolean  % CR_FD1|1|0|0|1|boolean
  CR_BliSts: boolean  % CR_FD1|1|0|0|1|boolean
  CR_ErrSts: boolean  % CR_FD1|1|0|0|1|boolean
  CR_BrkgReqVal: single  % CR_FD1|0.000488|-16|-16|16|single
  FCTA_B_TTC: single  % CR_FD1|0.1|0|0|6.3|single
  FCTB_ABP_Req: boolean  % CR_FD1|1|0|0|1|boolean
  CR_ObjDistY_Le: single  % CR_FD1|0.1|-12.8|-12.8|12.7|single
  CR_ObjID_Le: uint8  % CR_FD1|1|0|0|63|uint8
  CR_ObjDistX_Le: single  % CR_FD1|0.1|-10|-10|92.3|single
  CR_ObjRelVelX_Le: single  % CR_FD1|0.1|-60|-60|42.3|single
  CR_ObjSts_Le: uint8  % CR_FD1|1|0|0|3|uint8
  CR_ObjRelAccelX_Le: single  % CR_FD1|0.03125|-16|-16|15.9688|single
  CR_ObjMotionType_Le: uint8  % CR_FD1|1|0|0|7|uint8
  CR_ObjDistY_Ri: single  % CR_FD1|0.1|-12.8|-12.8|12.7|single
  CR_ObjID_Ri: uint8  % CR_FD1|1|0|0|63|uint8
  CR_ObjDistX_Ri: single  % CR_FD1|0.1|-10|-10|92.3|single
  CR_ObjRelVelX_Ri: single  % CR_FD1|0.1|-60|-60|42.3|single
  CR_ObjSts_Ri: uint8  % CR_FD1|1|0|0|3|uint8
  CR_ObjRelAccelX_Ri: single  % CR_FD1|0.03125|-16|-16|15.9688|single
  CR_ObjMotionType_Ri: uint8  % CR_FD1|1|0|0|7|uint8
  CR_ObjRelAccelY_Ri: single  % CR_FD1|0.03125|-16|-16|15.9688|single
  CR_ObjRelAccelY_Le: single  % CR_FD1|0.03125|-16|-16|15.9688|single
  CR_ObjRelVelY_Ri: single  % CR_FD1|0.1|-6.4|-6.4|6.3|single
  CR_ObjRelVelY_Le: single  % CR_FD1|0.1|-6.4|-6.4|6.3|single
  CR_ObjDistXStd_Le: single  % CR_FD1|0.375|0|0|11.625|single
  CR_ObjRelVelXStd_Le: single  % CR_FD1|0.375|0|0|11.625|single
  CR_ObjDistYStd_Le: single  % CR_FD1|0.375|0|0|11.625|single
  CR_ObjRelVelYStd_Le: single  % CR_FD1|0.375|0|0|11.625|single
  CR_ObjRAccelYStd_Le: single  % CR_FD1|0.375|0|0|11.625|single
  CR_ObjRAccelXStd_Le: single  % CR_FD1|0.375|0|0|11.625|single
  CR_ObjDistYStd_Ri: single  % CR_FD1|0.375|0|0|11.625|single
  CR_ObjDistXStd_Ri: single  % CR_FD1|0.375|0|0|11.625|single
  CR_ObjRelVelXStd_Ri: single  % CR_FD1|0.375|0|0|11.625|single
  CR_ObjRelVelYStd_Ri: single  % CR_FD1|0.375|0|0|11.625|single
  CR_ObjRAccelYStd_Ri: single  % CR_FD1|0.375|0|0|11.625|single
  CR_ObjRAccelXStd_Ri: single  % CR_FD1|0.375|0|0|11.625|single

VCAN_DCT_MSG_BUS = Simulink.Bus()
  TargetGearValid: boolean  % DCT5|1|0|0|1|boolean
  SHIFT_IN_PROGRESS: boolean  % DCT5|1|0|0|1|boolean
  CurrentGearValid: boolean  % DCT5|1|0|0|1|boolean
  TARGET_GEAR: uint8  % DCT5|1|0|0|15|uint8
  ShiftInPrgValid: boolean  % DCT5|1|0|0|1|boolean
  TGS_LEVER: uint8  % DCT5|1|0|0|15|uint8
  CURRENT_GEAR: uint8  % DCT5|1|0|0|15|uint8
  RatAct: single  % DCT_FD1|0.1|0|0|25.5|single
  DrvFaiMsg: uint8  % DCT_FD4|1|0|0|15|uint8

VCAN_DMS_MSG_BUS = Simulink.Bus()
  DistrctnLvlQlty_ACC: uint8  % DMS_FD1|1|0|0|100|uint8
  DrowsnsLvl_ACC: uint8  % DMS_FD1|1|0|0|7|uint8
  DistrctnLvl_ACC: uint8  % DMS_FD1|1|0|0|7|uint8
  HeadPosnX: int16  % DMS_FD1|1|-500|-500|1000|int16
  HeadPosnY: int16  % DMS_FD1|1|-500|-500|500|int16
  HeadPosnZ: int16  % DMS_FD1|1|-500|-500|500|int16
  HeadYawAng: int8  % DMS_FD1|1|-75|-75|75|int8
  HeadPitchAng: int8  % DMS_FD1|1|-25|-25|45|int8
  HeadRollAng: int8  % DMS_FD1|1|-45|-45|45|int8
  HeadDetn: boolean  % DMS_FD1|1|0|0|1|boolean
  DMSSts: uint8  % DMS_FD1|1|0|0|7|uint8
  RobustGazeYawAng: int8  % DMS_FD1|1|-90|-90|90|int8
  RobustGazePitchAng: int8  % DMS_FD1|1|-90|-90|90|int8
  LEyeOpenStsQlty: uint8  % DMS_FD1|1|0|0|100|uint8
  REyeOpenStsQlty: uint8  % DMS_FD1|1|0|0|100|uint8
  REyeOpenSts: uint8  % DMS_FD1|1|0|0|3|uint8
  LEyeOpenSts: uint8  % DMS_FD1|1|0|0|3|uint8

VCAN_DVR_MSG_BUS = Simulink.Bus()
  DVRSts: uint8  % DVR_FD1|1|0|0|15|uint8

VCAN_EPS_MSG_BUS = Simulink.Bus()
  EPS_DSTCtrlSts: uint8  % EPS_FD1|1|0|0|7|uint8
  EPS_FailSts: uint8  % EPS_FD1|1|0|0|3|uint8
  EPS_TrqSnsrSts: boolean  % EPS_FD1|1|0|0|1|boolean
  EPS_SteerMod: uint8  % EPS_FD1|1|0|0|7|uint8
  EPS_DrvInpTrqVal_HighReslolution: single  % EPS_FD1|0.015625|-31.9844|-31.9844|32|single
  EPS_LKATorqOvrlDlvd: single  % EPS_FD1|0.01|-15|-15|15|single
  EPS_LKATrqOvlDlvdSts: uint8  % EPS_FD1|1|0|0|3|uint8
  EPS_DrvInpTrqVal_HighResVld: boolean  % EPS_FD1|1|0|0|1|boolean
  EPS_LKATorqOvrlDlvdVld: boolean  % EPS_FD1|1|0|0|1|boolean
  EPS_SteerWheelAngSign: boolean  % EPS_FD1|1|0|0|1|boolean
  EPS_SteerWheelAng: single  % EPS_FD1|0.1|0|0|780|single
  EPS_SteerWheelSpdSign: boolean  % EPS_FD1|1|0|0|1|boolean
  EPS_SteerWheelSpd: single  % EPS_FD1|0.1|0|0|1016|single
  EPS_AvailStsforHAD: uint8  % EPS_FD1|1|0|0|3|uint8
  EPS_SteerWheelAngVld: boolean  % EPS_FD1|1|0|0|1|boolean
  EPS_HADerror_Reason: uint8  % EPS_FD1|1|0|0|15|uint8
  EPS_HADHndShkRespSt: uint8  % EPS_FD1|1|0|0|7|uint8
  EPS_AngCmdOverRange: boolean  % EPS_FD1|1|0|0|1|boolean

VCAN_ESP_MSG_BUS = Simulink.Bus()
  IsDrvReqFxBrakeDom: boolean  % ESP14|1|0|0|1|boolean
  DrvReqFxBrkDomAvail: uint8  % ESP14|1|0|0|2|uint8
  IsDrvPressBrkPedal: boolean  % ESP14|1|0|0|1|boolean
  DrvPressBrkPedalAvl: uint8  % ESP14|1|0|0|2|uint8
  L12mainVMCavailiable: boolean  % ESP_FD2|1|0|0|1|boolean
  L12VLCADactive: boolean  % ESP_FD2|1|0|0|1|boolean
  ESP_DiagActv: boolean  % ESP_FD2|1|0|0|1|boolean
  BrkDskOvrheatd: boolean  % ESP_FD2|1|0|0|1|boolean
  NoBrkForce: boolean  % ESP_FD2|1|0|0|1|boolean
  VehStandstill: uint8  % ESP_FD2|1|0|0|3|uint8
  AEBIBActv: boolean  % ESP_FD2|1|0|0|1|boolean
  AEBBAActv: boolean  % ESP_FD2|1|0|0|1|boolean
  AEBAvailable: boolean  % ESP_FD2|1|0|0|1|boolean
  ABPAvailable: boolean  % ESP_FD2|1|0|0|1|boolean
  ABPActv: boolean  % ESP_FD2|1|0|0|1|boolean
  ABAavailable: boolean  % ESP_FD2|1|0|0|1|boolean
  ABAactv: boolean  % ESP_FD2|1|0|0|1|boolean
  HDCCtrl: uint8  % ESP_FD2|1|0|0|2|uint8
  CDDActv: boolean  % ESP_FD2|1|0|0|1|boolean
  CDDAvailable: boolean  % ESP_FD2|1|0|0|1|boolean
  AWBAvailable: boolean  % ESP_FD2|1|0|0|1|boolean
  AWBActv: boolean  % ESP_FD2|1|0|0|1|boolean
  AVHSts: uint8  % ESP_FD2|1|0|0|2|uint8
  CDPActv: boolean  % ESP_FD2|1|0|0|1|boolean
  DrivingModDis: uint8  % ESP_FD2|1|0|0|31|uint8
  PTCActv_RA: boolean  % ESP_FD2|1|0|0|1|boolean
  BTCActv_RA: boolean  % ESP_FD2|1|0|0|1|boolean
  ESPFuncOffSts: boolean  % ESP_FD2|1|0|0|1|boolean
  ESPBrkLmpCtrl: boolean  % ESP_FD2|1|0|0|1|boolean
  ESPFailSts: boolean  % ESP_FD2|1|0|0|1|boolean
  ESP_MasterCylBrkPressVld: boolean  % ESP_FD2|1|0|0|1|boolean
  VDCActv: boolean  % ESP_FD2|1|0|0|1|boolean
  MSRActv: boolean  % ESP_FD2|1|0|0|1|boolean
  PTCActv: boolean  % ESP_FD2|1|0|0|1|boolean
  BTCActv: boolean  % ESP_FD2|1|0|0|1|boolean
  ESP_MasterCylBrkPress: single  % ESP_FD2|0.03125|-42.5|-42.5|425|single
  MSRActv_RA: boolean  % ESP_FD2|1|0|0|1|boolean
  VehSpdVld: boolean  % ESP_FD2|1|0|0|1|boolean
  EBDFailSts: boolean  % ESP_FD2|1|0|0|1|boolean
  ABSFailSts: boolean  % ESP_FD2|1|0|0|1|boolean
  VehSpd: single  % ESP_FD2|0.05625|0|0|299.9812|single
  ABSActv: boolean  % ESP_FD2|1|0|0|1|boolean
  FLWheelSpdVld: boolean  % ESP_FD3|1|0|0|1|boolean
  FLWheelDriveDirection: uint8  % ESP_FD3|1|0|0|3|uint8
  FLWheelSpd: single  % ESP_FD3|0.05625|0|0|299.9812|single
  FRWheelSpdVld: boolean  % ESP_FD3|1|0|0|1|boolean
  FRWheelDriveDirection: uint8  % ESP_FD3|1|0|0|3|uint8
  FRWheelSpd: single  % ESP_FD3|0.05625|0|0|299.9812|single
  WssFLEdgesSum: uint8  % ESP_FD3|1|0|0|255|uint8
  WssFREdgesSum: uint8  % ESP_FD3|1|0|0|255|uint8
  WssFREdgesSumVld: boolean  % ESP_FD3|1|0|0|1|boolean
  WssFLEdgesSumVld: boolean  % ESP_FD3|1|0|0|1|boolean
  EPB_SwtPosnVld: boolean  % ESP_FD3|1|0|0|1|boolean
  EPBErrSts: uint8  % ESP_FD3|1|0|0|3|uint8
  EPBSts: uint8  % ESP_FD3|1|0|0|3|uint8
  EPB_SwtPosn: uint8  % ESP_FD3|1|0|0|3|uint8
  ESP_DSTSts: uint8  % ESP_FD3|1|0|0|7|uint8
  RLWheelSpdVld: boolean  % ESP_FD3|1|0|0|1|boolean
  RLWheelDriveDirection: uint8  % ESP_FD3|1|0|0|3|uint8
  RLWheelSpd: single  % ESP_FD3|0.05625|0|0|299.9812|single
  RRWheelSpdVld: boolean  % ESP_FD3|1|0|0|1|boolean
  RRWheelDriveDirection: uint8  % ESP_FD3|1|0|0|3|uint8
  RRWheelSpd: single  % ESP_FD3|0.05625|0|0|299.9812|single
  WssRREdgesSum: uint8  % ESP_FD3|1|0|0|255|uint8
  WssRLEdgesSum: uint8  % ESP_FD3|1|0|0|255|uint8
  WssRREdgesSumVld: boolean  % ESP_FD3|1|0|0|1|boolean
  WssRLEdgesSumVld: boolean  % ESP_FD3|1|0|0|1|boolean
  LSMGearRequest: uint8  % ESP_FD3|1|0|0|2|uint8
  VLC_ESP_State: uint8  % ESP_FD3|1|0|0|3|uint8
  VLC_ESP_FuelCutOffPrevention: boolean  % ESP_FD3|1|0|0|1|boolean
  L3mainVMCavailiable: uint8  % ESP_FD3|1|0|0|3|uint8
  L3VLCADactive: boolean  % ESP_FD3|1|0|0|1|boolean
  ParkPawlRequest: boolean  % ESP_FD3|1|0|0|1|boolean
  VLC_IntTartAccel: single  % ESP_FD3|0.0125|-16|-16|16|single

VCAN_PBOX_MSG_BUS = Simulink.Bus()
  FFogLmpSts_F_Pbox: boolean  % F_PBox1|1|0|0|1|boolean
  LowBeamSts_F_Pbox: boolean  % F_PBox1|1|0|0|1|boolean
  HiBeamSts_F_Pbox: boolean  % F_PBox1|1|0|0|1|boolean
  HoodSts_F_Pbox: boolean  % F_PBox1|1|0|0|1|boolean
  RFogLmpSts_R_Pbox: boolean  % R_PBox1|1|0|0|1|boolean
  RTurnLmpSts_R_Pbox: boolean  % R_PBox1|1|0|0|1|boolean
  LTurnLmpSts_R_Pbox: boolean  % R_PBox1|1|0|0|1|boolean

VCAN_HAP_MSG_BUS = Simulink.Bus()
  TurnLightsCmd: uint8  % HAP_FD1|1|0|0|3|uint8
  APS_WorkSts: uint8  % HAP_FD1|1|0|0|7|uint8
  DVRWorkSts: uint8  % HAP_FD2|1|0|0|3|uint8
  USS_FLCNear_Obj_Pos_X: single  % HAP_FD6|0.1|0|0|6.2|single
  USS_FLCNear_Obj_Confidence: single  % HAP_FD6|0.1|0|0|1|single
  USS_FLCNear_Obj_Pos_Y: single  % HAP_FD6|0.1|-3.1|-3.1|3.1|single
  USS_FLMNear_Obj_Pos_X: single  % HAP_FD6|0.1|0|0|6.2|single
  USS_FLMNear_Obj_Confidence: single  % HAP_FD6|0.1|0|0|1|single
  USS_FLMNear_Obj_Pos_Y: single  % HAP_FD6|0.1|-3.1|-3.1|3.1|single
  USS_FRMNear_Obj_Pos_X: single  % HAP_FD6|0.1|0|0|6.2|single
  USS_FRMNear_Obj_Confidence: single  % HAP_FD6|0.1|0|0|1|single
  USS_FRMNear_Obj_Pos_Y: single  % HAP_FD6|0.1|-3.1|-3.1|3.1|single
  USS_FrontSys_Status: uint8  % HAP_FD6|1|0|0|3|uint8
  USS_FRCNear_Obj_Pos_X: single  % HAP_FD6|0.1|0|0|6.2|single
  USS_FRCNear_Obj_Confidence: single  % HAP_FD6|0.1|0|0|1|single
  USS_FRCNear_Obj_Pos_Y: single  % HAP_FD6|0.1|-3.1|-3.1|3.1|single

VCAN_HC_MSG_BUS = Simulink.Bus()
  ALS_FailSts: boolean  % HC1|1|0|0|1|boolean
  RightHighBeamFailSts: boolean  % HC1|1|0|0|1|boolean
  LeftHighBeamFailSts: boolean  % HC1|1|0|0|1|boolean
  RightLowBeamFailSts: boolean  % HC1|1|0|0|1|boolean
  LeftLowBeamFailSts: boolean  % HC1|1|0|0|1|boolean
  ADBstatus: uint8  % HC1|1|0|0|3|uint8
  HighBeamSts_HC: boolean  % HC1|1|0|0|1|boolean
  HBStatusSegment3: uint8  % HC1|1|0|0|3|uint8
  HBStatusSegment2: uint8  % HC1|1|0|0|3|uint8
  HBStatusSegment1: uint8  % HC1|1|0|0|3|uint8
  HBStatusSegment0: uint8  % HC1|1|0|0|3|uint8
  HBStatusSegment7: uint8  % HC1|1|0|0|3|uint8
  HBStatusSegment6: uint8  % HC1|1|0|0|3|uint8
  HBStatusSegment5: uint8  % HC1|1|0|0|3|uint8
  HBStatusSegment4: uint8  % HC1|1|0|0|3|uint8
  RLHiBeamReq_HC: boolean  % HC1|1|0|0|1|boolean
  LLHiBeamReq_HC: boolean  % HC1|1|0|0|1|boolean

VCAN_HCM_MSG_BUS = Simulink.Bus()
  LHiBeamSts: boolean  % HCM_L1|1|0|0|1|boolean
  LLowBeamSts: boolean  % HCM_L1|1|0|0|1|boolean
  RHiBeamSts: boolean  % HCM_R1|1|0|0|1|boolean
  RLowBeamSts: boolean  % HCM_R1|1|0|0|1|boolean

VCAN_HCU_MSG_BUS = Simulink.Bus()
  HCU_AccelPedalPosn_Diag: single  % HCU_FD1|0.3937|0|0|100.395|single
  HCU_BrkPedalStsValid: boolean  % HCU_FD1|1|0|0|1|boolean
  HCU_AccelPedalPosn_DiagValid: boolean  % HCU_FD1|1|0|0|1|boolean
  HCU_BrkPedalSts: uint8  % HCU_FD1|1|0|0|3|uint8
  ActWheelTrqDmd: int16  % HCU_FD1|5|-6000|-6000|14475|int16
  MaxPsblWheelTrq: int16  % HCU_FD1|20|-6000|-6000|14460|int16
  TotWheelTrq: int16  % HCU_FD1|5|-6000|-6000|14475|int16
  HCU_ACCInterface: boolean  % HCU_FD1|1|0|0|1|boolean
  MinPsblWheelTrq: int16  % HCU_FD1|20|-6000|-6000|14460|int16
  HCU_PowertrainSts: uint8  % HCU_FD1|1|0|0|31|uint8
  ACU_ShiftInProgress: uint8  % HCU_FD1|1|0|0|3|uint8
  HCU_PTDrvMod: uint8  % HCU_FD3|1|0|0|7|uint8
  HCU_DrvMod: uint8  % HCU_FD3|1|0|0|15|uint8
  DrvTrqReqOvld: uint8  % HCU_FD3|1|0|0|3|uint8
  HCU_FltLvl: uint8  % HCU_FD3|1|0|0|2|uint8
  HCU_GearSts: uint8  % HCU_FD3|1|0|0|15|uint8

VCAN_HUT_MSG_BUS = Simulink.Bus()
  ADAS_Meta_MapProvider: uint8  % HUT19|1|0|0|7|uint8
  ADAS_Meta_MsgTyp: uint8  % HUT19|1|0|0|7|uint8
  ADAS_Meta_CountryCode: uint16  % HUT19|1|0|0|1023|uint16
  ADAS_Meta_ProtVer_MinorSub: uint8  % HUT19|1|0|0|7|uint8
  ADAS_Meta_ProtVer_Major: uint8  % HUT19|1|0|0|3|uint8
  ADAS_Meta_CycCnt: uint8  % HUT19|1|0|0|3|uint8
  ADAS_Meta_HwVer: uint16  % HUT19|1|0|0|511|uint16
  ADAS_Meta_DrvSide: boolean  % HUT19|1|0|0|1|boolean
  ADAS_Meta_RegionCode: uint16  % HUT19|1|0|0|32767|uint16
  ADAS_Meta_MapVerYear: uint8  % HUT19|1|0|0|63|uint8
  ADAS_Meta_MapVerQtr: uint8  % HUT19|1|0|0|3|uint8
  ADAS_Meta_ProtVer_Minor: uint8  % HUT19|1|0|0|15|uint8
  ADAS_Meta_SpdUnits: boolean  % HUT19|1|0|0|1|boolean
  ADAS_ProfLong_MsgTyp: uint8  % HUT20|1|0|0|7|uint8
  ADAS_ProfLong_Offset: uint16  % HUT20|1|0|0|8190|uint16
  ADAS_ProfLong_PathIdx: uint8  % HUT20|1|0|0|63|uint8
  ADAS_ProfLong_CycCnt: uint8  % HUT20|1|0|0|3|uint8
  ADAS_ProfLong_Update: boolean  % HUT20|1|0|0|1|boolean
  ADAS_ProfLong_Retr: boolean  % HUT20|1|0|0|1|boolean
  ADAS_ProfLong_CtrlPoint: boolean  % HUT20|1|0|0|1|boolean
  ADAS_ProfLong_ProfTyp: uint8  % HUT20|1|0|0|31|uint8
  ADAS_ProfLong_Value: uint32  % HUT20|1|0|0|4294967295|uint32
  ADAS_ProfShort_MsgTyp: uint8  % HUT21|1|0|0|7|uint8
  ADAS_ProfShort_Offset: uint16  % HUT21|1|0|0|8190|uint16
  ADAS_ProfShort_PathIdx: uint8  % HUT21|1|0|0|63|uint8
  ADAS_ProfShort_CycCnt: uint8  % HUT21|1|0|0|3|uint8
  ADAS_ProfShort_Update: boolean  % HUT21|1|0|0|1|boolean
  ADAS_ProfShort_Retr: boolean  % HUT21|1|0|0|1|boolean
  ADAS_ProfShort_CtrlPoint: boolean  % HUT21|1|0|0|1|boolean
  ADAS_ProfShort_ProfTyp: uint8  % HUT21|1|0|0|31|uint8
  ADAS_ProfShort_AccurClass: uint8  % HUT21|1|0|0|3|uint8
  ADAS_ProfShort_Dist1: uint16  % HUT21|1|0|0|1022|uint16
  ADAS_ProfShort_Value0: uint16  % HUT21|1|0|0|1022|uint16
  ADAS_ProfShort_Value1: uint16  % HUT21|1|0|0|1022|uint16
  ADAS_Seg_MsgTyp: uint8  % HUT22|1|0|0|7|uint8
  ADAS_Seg_Offset: uint16  % HUT22|1|0|0|8190|uint16
  ADAS_Seg_PathIdx: uint8  % HUT22|1|0|0|63|uint8
  ADAS_Seg_CycCnt: uint8  % HUT22|1|0|0|3|uint8
  ADAS_Seg_Update: boolean  % HUT22|1|0|0|1|boolean
  ADAS_Seg_Retr: boolean  % HUT22|1|0|0|1|boolean
  ADAS_Seg_BuildUpArea: uint8  % HUT22|1|0|0|3|uint8
  ADAS_Seg_Brdg: uint8  % HUT22|1|0|0|3|uint8
  ADAS_Seg_Tunnel: uint8  % HUT22|1|0|0|3|uint8
  ADAS_Seg_FuncRoadClass: uint8  % HUT22|1|0|0|7|uint8
  ADAS_Seg_RelProbb: single  % HUT22|3.3333|0|0|100|single
  ADAS_Seg_FormOfWay: uint8  % HUT22|1|0|0|15|uint8
  ADAS_Seg_CmplxInsct: uint8  % HUT22|1|0|0|3|uint8
  ADAS_Seg_PartOfCalcRoute: uint8  % HUT22|1|0|0|3|uint8
  ADAS_Seg_EffSpdLmtTyp: uint8  % HUT22|1|0|0|7|uint8
  ADAS_Seg_EffSpdLmt: uint8  % HUT22|1|0|0|31|uint8
  ADAS_Seg_NumOfLaneDrvDir: uint8  % HUT22|1|0|0|7|uint8
  ADAS_Seg_NumOfLaneOppDir: uint8  % HUT22|1|0|0|3|uint8
  ADAS_Seg_DivideRoad: uint8  % HUT22|1|0|0|3|uint8
  ADAS_Stub_MsgTyp: uint8  % HUT23|1|0|0|7|uint8
  ADAS_Stub_Offset: uint16  % HUT23|1|0|0|8190|uint16
  ADAS_Stub_PathIdx: uint8  % HUT23|1|0|0|63|uint8
  ADAS_Stub_CycCnt: uint8  % HUT23|1|0|0|3|uint8
  ADAS_Stub_Update: boolean  % HUT23|1|0|0|1|boolean
  ADAS_Stub_Retr: boolean  % HUT23|1|0|0|1|boolean
  ADAS_Stub_StubPathIdx: uint8  % HUT23|1|0|0|63|uint8
  ADAS_Stub_FuncRoadClass: uint8  % HUT23|1|0|0|7|uint8
  ADAS_Stub_RelProbb: single  % HUT23|3.3333|0|0|100|single
  ADAS_Stub_FormOfWay: uint8  % HUT23|1|0|0|15|uint8
  ADAS_Stub_CmplxInsct: uint8  % HUT23|1|0|0|3|uint8
  ADAS_Stub_PartOfCalcRoute: uint8  % HUT23|1|0|0|3|uint8
  ADAS_Stub_TurnAngl: single  % HUT23|1.4173|0|0|358.583|single
  ADAS_Stub_NumOfLaneDrvDir: uint8  % HUT23|1|0|0|7|uint8
  ADAS_Stub_NumOfLaneOppDir: uint8  % HUT23|1|0|0|3|uint8
  ADAS_Stub_RtOfWay: uint8  % HUT23|1|0|0|3|uint8
  ADAS_Stub_LastStub: boolean  % HUT23|1|0|0|1|boolean
  Time_Hour: uint8  % HUT34|1|0|0|31|uint8
  TimeMod: boolean  % HUT34|1|0|0|1|boolean
  TimeIndcn: boolean  % HUT34|1|0|0|1|boolean
  Time_Minutes: uint8  % HUT34|1|0|0|63|uint8
  Time_Second: uint8  % HUT34|1|0|0|63|uint8
  Time_Year_Right: uint8  % HUT34|1|0|0|15|uint8
  Time_Year_Left: uint8  % HUT34|1|0|0|15|uint8
  Time_Month: uint8  % HUT34|1|0|0|15|uint8
  Time_Day: uint8  % HUT34|1|0|0|31|uint8
  IFC_SnvtySet: uint8  % HUT_FD1|1|0|0|3|uint8
  FCW_SnvtySet: uint8  % HUT_FD1|1|0|0|3|uint8
  LDWSwtReq: boolean  % HUT_FD1|1|0|0|1|boolean
  ESS_VehSwtReq: boolean  % HUT_FD1|1|0|0|1|boolean
  ESS_PedSwtReq: boolean  % HUT_FD1|1|0|0|1|boolean
  ELKSwtReq: boolean  % HUT_FD1|1|0|0|1|boolean
  LCKSwtReq: boolean  % HUT_FD1|1|0|0|1|boolean
  LKASwtReq: boolean  % HUT_FD1|1|0|0|1|boolean
  AEB_VehSwtReq: boolean  % HUT_FD1|1|0|0|1|boolean
  LSSWarnFormSwtReq: uint8  % HUT_FD1|1|0|0|3|uint8
  TSRWarnSwtReq: boolean  % HUT_FD1|1|0|0|1|boolean
  TSRSwtReq: boolean  % HUT_FD1|1|0|0|1|boolean
  AEB_PedSwtReq: boolean  % HUT_FD1|1|0|0|1|boolean
  LSSSwtReq: boolean  % HUT_FD1|1|0|0|1|boolean
  IntelligentEvaSwtReq: boolean  % HUT_FD1|1|0|0|1|boolean
  TSR_SnvtySet: int8  % HUT_FD1|1|-15|-15|15|int8
  ISLSwtReq: boolean  % HUT_FD1|1|0|0|1|boolean
  ICA_HandsOffSwtReq: boolean  % HUT_FD1|1|0|0|1|boolean
  NavVehToTrafEyeDist: uint16  % HUT_FD1|1|0|0|1023|uint16
  NavSpdLimUnit_HUT: uint8  % HUT_FD1|1|0|0|3|uint8
  NavSpdLimValue: uint8  % HUT_FD1|1|0|0|63|uint8
  HWA_SwtReq: boolean  % HUT_FD1|1|0|0|1|boolean
  NavSpdLimSignSts: uint8  % HUT_FD1|1|0|0|7|uint8
  NavCtryType: uint16  % HUT_FD1|1|0|0|1023|uint16
  NavTSRTrafSign: uint8  % HUT_FD1|1|0|0|255|uint8
  ALC_SwtReq: boolean  % HUT_FD1|1|0|0|1|boolean
  AESSwtReq: boolean  % HUT_FD1|1|0|0|1|boolean
  AEB_JASwtReq: boolean  % HUT_FD1|1|0|0|1|boolean
  HWA_SnvtySet: uint8  % HUT_FD1|1|0|0|3|uint8
  NavSpdLimType: uint8  % HUT_FD1|1|0|0|3|uint8
  NavRoadType: uint8  % HUT_FD1|1|0|0|15|uint8
  ADAS_Posn_MsgTye: uint8  % HUT_FD1|1|0|0|7|uint8
  ADAS_Posn_Offset: uint16  % HUT_FD1|1|0|0|8190|uint16
  ADAS_Posn_Pathldx: uint8  % HUT_FD1|1|0|0|63|uint8
  ADAS_Posn_CycCnt: uint8  % HUT_FD1|1|0|0|3|uint8
  ADAS_Posn_PosProbb: single  % HUT_FD1|3.33|0|0|100|single
  ADAS_Posn_Idx: uint8  % HUT_FD1|1|0|0|3|uint8
  ADAS_Posn_Age: uint16  % HUT_FD1|5|0|0|2545|uint16
  ADAS_Posn_CurLane: uint8  % HUT_FD1|1|0|0|7|uint8
  ADAS_Posn_PosConfdc: uint8  % HUT_FD1|1|0|0|7|uint8
  ADAS_Posn_Spd: single  % HUT_FD1|0.2|-12.8|-12.8|89.2|single
  ADAS_Posn_Rehead: single  % HUT_FD1|1.4173|0|0|358.583|single
  NOH_Act_Req: boolean  % HUT_FD3|1|0|0|1|boolean
  NOH_Swt_Req: boolean  % HUT_FD3|1|0|0|1|boolean

VCAN_IB_MSG_BUS = Simulink.Bus()
  IsDrvReqFxBrakeDom: boolean  % IBooster3|1|0|0|1|boolean
  DrvReqFxBrkDomAvail: uint8  % IBooster3|1|0|0|2|uint8
  IB_BrkPedalAppldVld: uint8  % IBooster_FD2|1|0|0|3|uint8
  IB_BrkPedalAppld: boolean  % IBooster_FD2|1|0|0|1|boolean
  VehStandstill: uint8  % IBooster_FD2|1|0|0|3|uint8
  FLWheelSpdVld: boolean  % IBooster_FD2|1|0|0|1|boolean
  FLWheelDriveDirection: uint8  % IBooster_FD2|1|0|0|3|uint8
  FLWheelSpd: single  % IBooster_FD2|0.05625|0|0|299.9812|single
  FRWheelSpdVld: boolean  % IBooster_FD2|1|0|0|1|boolean
  FRWheelDriveDirection: uint8  % IBooster_FD2|1|0|0|3|uint8
  FRWheelSpd: single  % IBooster_FD2|0.05625|0|0|299.9812|single
  WssFLEdgesSum: uint8  % IBooster_FD2|1|0|0|255|uint8
  WssFREdgesSum: uint8  % IBooster_FD2|1|0|0|255|uint8
  WssFREdgesSumVld: boolean  % IBooster_FD2|1|0|0|1|boolean
  WssFLEdgesSumVld: boolean  % IBooster_FD2|1|0|0|1|boolean
  VehSpdVld: boolean  % IBooster_FD2|1|0|0|1|boolean
  VehSpd: single  % IBooster_FD2|0.05625|0|0|299.9812|single
  L3mainVMCavailiable: uint8  % IBooster_FD2|1|0|0|3|uint8
  L3VLCADactive: boolean  % IBooster_FD2|1|0|0|1|boolean
  VLC_IntTartAccel: single  % IBooster_FD2|0.0125|-16|-16|16|single
  RLWheelSpdVld: boolean  % IBooster_FD2|1|0|0|1|boolean
  RLWheelDriveDirection: uint8  % IBooster_FD2|1|0|0|3|uint8
  RLWheelSpd: single  % IBooster_FD2|0.05625|0|0|299.9812|single
  RRWheelSpdVld: boolean  % IBooster_FD2|1|0|0|1|boolean
  RRWheelDriveDirection: uint8  % IBooster_FD2|1|0|0|3|uint8
  RRWheelSpd: single  % IBooster_FD2|0.05625|0|0|299.9812|single
  WssRREdgesSum: uint8  % IBooster_FD2|1|0|0|255|uint8
  WssRLEdgesSum: uint8  % IBooster_FD2|1|0|0|255|uint8
  WssRREdgesSumVld: boolean  % IBooster_FD2|1|0|0|1|boolean
  WssRLEdgesSumVld: boolean  % IBooster_FD2|1|0|0|1|boolean

VCAN_IP_MSG_BUS = Simulink.Bus()
  IP_VehSpdDisp: single  % IP1|0.5|0|0|255|single
  IP_VelSpdDisp_Mile: uint8  % IP1|1|0|0|255|uint8
  IP_VehTotDistance: single  % IP2|0.1|0|0|999999.9|single
  IP_VehTotDistanceValid: boolean  % IP2|1|0|0|1|boolean
  IP_ACCErr: boolean  % IP2|1|0|0|1|boolean
  IP_Err: boolean  % IP2|1|0|0|1|boolean
  IP_VehSpdUnit: boolean  % IP2|1|0|0|1|boolean

VCAN_LMU_MSG_BUS = Simulink.Bus()
  LMUSysSts: uint8  % LMU1|1|0|0|3|uint8

VCAN_PEPS_MSG_BUS = Simulink.Bus()
  SysPowerModVld: boolean  % PEPS2|1|0|0|1|boolean
  SysPowerMod: uint8  % PEPS2|1|0|0|3|uint8

VCAN_RSDS_MSG_BUS = Simulink.Bus()
  RSDS_ObjRelAccelY_Le: single  % RSDS_FD1|0.03125|-16|-16|15.9688|single
  ObjIDLe: uint8  % RSDS_FD1|1|0|0|63|uint8
  LeTarSts: uint8  % RSDS_FD1|1|0|0|3|uint8
  ObjLgtPosnCurvLe: single  % RSDS_FD1|0.1|-92.3|-92.3|10|single
  ObjLatPosnCurvLe: single  % RSDS_FD1|0.1|-12.8|-12.8|12.7|single
  ObjLgtSpdCurvLe: single  % RSDS_FD1|0.1|-10|-10|92.3|single
  ObjLatSpdCurvLe: single  % RSDS_FD1|0.1|-6.4|-6.4|6.3|single
  ObjTTCLe: single  % RSDS_FD1|0.1|0|0|12.7|single
  ObjStatyLe: boolean  % RSDS_FD1|1|0|0|1|boolean
  ObjWidthLe: single  % RSDS_FD1|0.5|0|0|3.5|single
  ObjLenLe: uint8  % RSDS_FD1|1|0|0|15|uint8
  ObjRinRi: uint8  % RSDS_FD1|1|0|0|15|uint8
  ObjStsLe: uint8  % RSDS_FD1|1|0|0|3|uint8
  ZoneIndLe: uint8  % RSDS_FD1|1|0|0|3|uint8
  ObjStsRi: uint8  % RSDS_FD1|1|0|0|3|uint8
  ZoneIndRi: uint8  % RSDS_FD1|1|0|0|3|uint8
  ObjStatyRi: boolean  % RSDS_FD1|1|0|0|1|boolean
  ObjWidthRi: single  % RSDS_FD1|0.5|0|0|3.5|single
  ObjIDRi: uint8  % RSDS_FD1|1|0|0|63|uint8
  RiTarSts: uint8  % RSDS_FD1|1|0|0|3|uint8
  ObjLgtPosnCurvRi: single  % RSDS_FD1|0.1|-92.3|-92.3|10|single
  ObjLatPosnCurvRi: single  % RSDS_FD1|0.1|-12.8|-12.8|12.7|single
  ObjLgtSpdCurvRi: single  % RSDS_FD1|0.1|-10|-10|92.3|single
  ObjLatSpdCurvRi: single  % RSDS_FD1|0.1|-6.4|-6.4|6.3|single
  ObjTTCRi: single  % RSDS_FD1|0.1|0|0|12.7|single
  RSDS_ObjDistXStd_Le: single  % RSDS_FD1|0.375|0|0|11.625|single
  RSDS_ObjRelVelXStd_Le: single  % RSDS_FD1|0.375|0|0|11.625|single
  RSDS_ObjDistYStd_Le: single  % RSDS_FD1|0.375|0|0|11.625|single
  RSDS_ObjRelVelYStd_Le: single  % RSDS_FD1|0.375|0|0|11.625|single
  RSDS_ObjRAccelYStd_Le: single  % RSDS_FD1|0.375|0|0|11.625|single
  RSDS_ObjRAccelXStd_Le: single  % RSDS_FD1|0.375|0|0|11.625|single
  RSDS_ObjDistYStd_Ri: single  % RSDS_FD1|0.375|0|0|11.625|single
  RSDS_ObjDistXStd_Ri: single  % RSDS_FD1|0.375|0|0|11.625|single
  RSDS_ObjRelVelXStd_Ri: single  % RSDS_FD1|0.375|0|0|11.625|single
  RSDS_ObjRelVelYStd_Ri: single  % RSDS_FD1|0.375|0|0|11.625|single
  RSDS_ObjRAccelYStd_Ri: single  % RSDS_FD1|0.375|0|0|11.625|single
  RSDS_ObjRAccelXStd_Ri: single  % RSDS_FD1|0.375|0|0|11.625|single
  RSDS_ObjRelAccelX_Le: single  % RSDS_FD1|0.03125|-16|-16|15.9688|single
  RSDS_ObjRelAccelX_Ri: single  % RSDS_FD1|0.03125|-16|-16|15.9688|single
  RSDS_ObjRelAccelY_Ri: single  % RSDS_FD1|0.03125|-16|-16|15.9688|single
  RCW_TTC: single  % RSDS_FD2|0.1|0|0|6.3|single

VCAN_TBOX_MSG_BUS = Simulink.Bus()
  T_Box_SysErrSts: uint8  % T_Box_FD3|1|0|0|31|uint8

VCAN_TRAILER_MSG_BUS = Simulink.Bus()
  TrailerSts: boolean  % Trailer1|1|0|0|1|boolean

VCAN_ECM_MSG_BUS = Simulink.Bus()
  NetEngTrq: single  % ECM_FD1|0.0030518|-100|-100|99.9967|single
  DrvEngTrqReq: single  % ECM_FD1|0.0030518|-100|-100|99.9997|single
  DrvEngTrqReqVld: boolean  % ECM_FD1|1|0|0|1|boolean
  HCU_Start_StopSts: uint8  % ECM_FD1|1|0|0|9|uint8
  HCU_PowertrainSts_P0: uint8  % ECM_FD1|1|0|0|15|uint8
  EngTrqMinAct: single  % ECM_FD1|0.0030518|-100|-100|99.9997|single
  EngTrqMaxActSpd: single  % ECM_FD1|0.0030518|-100|-100|99.9997|single
  TrqLoss: single  % ECM_FD1|0.0030518|-100|-100|99.9997|single
  TrqLossVldty: boolean  % ECM_FD1|1|0|0|1|boolean
  BrkPedalSts: uint8  % ECM_FD1|1|0|0|3|uint8
  Start_StopSts: uint8  % ECM_FD1|1|0|0|7|uint8
  EngSpd: single  % ECM_FD1|0.125|0|0|8191.875|single
  EngSpdVldty: uint8  % ECM_FD1|1|0|0|2|uint8
  AccPedalOverride: boolean  % ECM_FD2|1|0|0|1|boolean
  AccelPedlPosnDiagc: single  % ECM_FD2|0.3937|0|0|100.3935|single
  ECMACCInterface: boolean  % ECM_FD2|1|0|0|1|boolean
  ECMRespACC: boolean  % ECM_FD2|1|0|0|1|boolean
  EngFail: uint8  % ECM_FD2|1|0|0|7|uint8
  AccelPedalPosn: single  % ECM_FD2|0.3937|0|0|100.3935|single
  AccelPedalPosnVldty: uint8  % ECM_FD2|1|0|0|2|uint8
  EngState: uint8  % ECM_FD2|1|0|0|3|uint8
  EngState_PHEV: uint8  % ECM_FD2|1|0|0|7|uint8
  MaxEngTrqNorm: uint16  % ECM_FD3|5|0|0|510|uint16
  EngLimpHomeSts: boolean  % ECM_FD3|1|0|0|1|boolean
  EngSpd_ECM1: single, Min=0, Max=8191.875  % ECM1|0.125|0|0|8191.875
  EngSpdVldty_ECM1: uint8, Min=0, Max=2  % ECM1|1|0|0|2

ADCAN_DIAG_UPDATE_BUS = Simulink.Bus()
  ADCAN_BSW_RSDS_FD1_IsUpdated: boolean
  ADCAN_BSW_RSDS_FD2_IsUpdated: boolean
  ADCAN_BSW_ECM_FD1_IsUpdated: boolean
  ADCAN_BSW_ECM_FD2_IsUpdated: boolean
  ADCAN_BSW_ECM_FD3_IsUpdated: boolean
  ADCAN_BSW_ECM1_IsUpdated: boolean
  ADCAN_BSW_HCU_FD1_IsUpdated: boolean
  ADCAN_BSW_DCT_FD1_IsUpdated: boolean
  ADCAN_BSW_DCT_FD4_IsUpdated: boolean
  ADCAN_BSW_DCT5_IsUpdated: boolean
  ADCAN_BSW_ESP_FD2_IsUpdated: boolean
  ADCAN_BSW_ESP_FD3_IsUpdated: boolean
  ADCAN_BSW_EPS_FD1_IsUpdated: boolean
  ADCAN_BSW_BCM1_IsUpdated: boolean
  ADCAN_BSW_BCM3_IsUpdated: boolean
  ADCAN_BSW_BCM8_IsUpdated: boolean
  ADCAN_BSW_AC2_IsUpdated: boolean
  ADCAN_BSW_F_PBox1_IsUpdated: boolean
  ADCAN_BSW_R_PBox_IsUpdated: boolean
  ADCAN_BSW_CSA1_IsUpdated: boolean
  ADCAN_BSW_CSA2_IsUpdated: boolean
  ADCAN_BSW_ABM1_IsUpdated: boolean
  ADCAN_BSW_ABM2_IsUpdated: boolean
  ADCAN_BSW_HAP_FD1_IsUpdated: boolean
  ADCAN_BSW_IP2_IsUpdated: boolean
  ADCAN_BSW_HUT_FD1_IsUpdated: boolean
  ADCAN_BSW_HUT19_IsUpdated: boolean
  ADCAN_BSW_T_Box_FD3_IsUpdated: boolean
  ADCAN_BSW_HC1_IsUpdated: boolean
  ADCAN_BSW_DMS_FD1_IsUpdated: boolean