% Simulink data dictionary enumsss.sldd

ACC_STATE = enum(DefaultValue="ACC_Off", AddClassNameToEnumNames=true)
  ACC_Off = 0
  ACC_Reject = 1
  ACC_Standby = 2
  ACC_ActiveControl = 3
  ACC_BrakeOnly = 4
  ACC_Override = 5
  ACC_StandWait = 6
  ACC_Failure = 7
  ACC_StandActive = 9

ISLActive = enum(DefaultValue="Inactive", StorageType="uint8", AddClassNameToEnumNames=true)
  Inactive = 0
  Active = 1
  ISL_Take_Over_Warning = 2

ISL_InterSysInfoDisp = enum(DefaultValue="No_display", StorageType="uint8", AddClassNameToEnumNames=true)
  No_display = 0
  Speed_Limit_Confirm_Request = 1
  Speed_Limit_Take_Over_Request = 2

STATE = enum(DefaultValue="OFF", StorageType="uint8", AddClassNameToEnumNames=true)
  OFF = 0
  IDLE = 1
  READY = 2
  ACTIVE = 3
  ACTIVE_LEFT = 4
  ACTIVE_RIGHT = 5
  ERROR = 6
  DEFAULT = 7

ELKSTATE = enum(DefaultValue="ELK_OFF", StorageType="uint8", AddClassNameToEnumNames=true)
  ELK_OFF = 0
  ELK_IDLE = 1
  ELK_READY = 2
  ELK_ACTIVE_LEFT = 3
  ELK_ACTIVE_RIGHT = 4
  ELK_ONCOMING_LEFT = 5
  ELK_ONCOMING_RIGHT = 6
  ELK_OVERTAKING_LEFT = 7
  ELK_OVERTAKING_RIGHT = 8
  ELK_ERROR = 9
  ELK_DEFAULT = 10

HWA_STATE = enum(DefaultValue="HWA_Off", StorageType="uint8", AddClassNameToEnumNames=true)
  HWA_Off = 0
  HWA_Idle = 1
  HWA_Ready = 2
  HWA_CCAct = 3
  HWA_Pause = 4
  HWA_LeftTurn = 5
  HWA_RightTurn = 6
  HWA_Error = 7
  HWA_SafeStop = 9
  HWA_SlowRetreat = 10
  HWA_LeftTurnPrepare = 11
  HWA_RightTurnPrepare = 12

LCK_STATE = enum(DefaultValue="LCK_Off", StorageType="uint8", AddClassNameToEnumNames=true)
  LCK_Off = 0
  LCK_Idle = 1
  LCK_Ready = 2
  LCK_Active = 3
  LCK_Error = 7

RFM_TSR_FUSIONSTS_E = enum(AddClassNameToEnumNames=true)
  UNKNOWN = 0  % 融合状态（故障，融合，仅视觉，仅导航）
  FUSION = 1  % 融合状态（故障，融合，仅视觉，仅导航）
  VISION = 2  % 融合状态（故障，融合，仅视觉，仅导航）
  HUT = 3  % 融合状态（故障，融合，仅视觉，仅导航）
  FAILURE = 4  % 融合状态（故障，融合，仅视觉，仅导航）

RFM_NAV_ROADTYPE_E = enum(AddClassNameToEnumNames=true)
  UNKNOWN = 0  % 指示导航检测到的车辆当前行驶位置的行驶类型(HUT)
  EXPRESSWAY = 1  % 指示导航检测到的车辆当前行驶位置的行驶类型(HUT)
  CITY_EXPRESSWAY = 2  % 指示导航检测到的车辆当前行驶位置的行驶类型(HUT)
  NATIONAL_ROAD = 3  % 指示导航检测到的车辆当前行驶位置的行驶类型(HUT)
  PROVINCIAL_ROAD = 4  % 指示导航检测到的车辆当前行驶位置的行驶类型(HUT)
  COUNTRY_ROAD = 5  % 指示导航检测到的车辆当前行驶位置的行驶类型(HUT)
  CITY_OR_VILLAGE_ROAD = 6  % 指示导航检测到的车辆当前行驶位置的行驶类型(HUT)
  RAMP = 7  % 指示导航检测到的车辆当前行驶位置的行驶类型(HUT)
  TUNNEL = 8  % 指示导航检测到的车辆当前行驶位置的行驶类型(HUT)
  SIDE_ROAD = 9  % 指示导航检测到的车辆当前行驶位置的行驶类型(HUT)
  CHANNEL = 10  % 指示导航检测到的车辆当前行驶位置的行驶类型(HUT)
  RESERVED = 0  % 指示导航检测到的车辆当前行驶位置的行驶类型(HUT)

RFM_NAV_SPLTYPE_E = enum(AddClassNameToEnumNames=true)
  UNKNOWN = 0  % 限速类型
  TRAFFIC_SIGN = 1  % 限速类型
  ELECTRONIC_EYE = 2  % 限速类型
  ROAD_DEFAULT = 3  % 限速类型

RFM_NAV_SPLUNIT_E = enum(AddClassNameToEnumNames=true)
  KMH = 0  % 指示当前限速单位
  MPH = 1  % 指示当前限速单位
  UNKNOWN = 2  % 指示当前限速单位
  RESERVED = 3  % 指示当前限速单位

RFM_LANECHANGE_DIR_E = enum(AddClassNameToEnumNames=true)
  INVALID = 0  % 指示是否发生变道以及变道向哪个方向
  LEFT = 1  % 指示是否发生变道以及变道向哪个方向
  RIGHT = 2  % 指示是否发生变道以及变道向哪个方向

RFM_LINE_TYPE_E = enum(AddClassNameToEnumNames=true)
  UNDECIDED = 0  % 车道线线型 （普通、实线、虚线、路牙...）
  SOLID = 1  % 车道线线型 （普通、实线、虚线、路牙...）
  DASHED = 2  % 车道线线型 （普通、实线、虚线、路牙...）
  DOUBLE_SOLID_DASHED = 3  % 车道线线型 （普通、实线、虚线、路牙...）
  DOUBLE_DASHED_SOLID = 4  % 车道线线型 （普通、实线、虚线、路牙...）
  DOUBLE_SOLID_SOLID = 5  % 车道线线型 （普通、实线、虚线、路牙...）
  DOUBLE_DASHED_DASHED = 6  % 车道线线型 （普通、实线、虚线、路牙...）
  BOTTS = 7  % 车道线线型 （普通、实线、虚线、路牙...）
  DECELERATION = 8  % 车道线线型 （普通、实线、虚线、路牙...）
  HOV_LANE = 9  % 车道线线型 （普通、实线、虚线、路牙...）
  ROAD_EDGE = 10  % 车道线线型 （普通、实线、虚线、路牙...）
  ELEVATED_STRUCTURE = 11  % 车道线线型 （普通、实线、虚线、路牙...）
  LCURB = 12  % 车道线线型 （普通、实线、虚线、路牙...）
  CONES_POLES = 13  % 车道线线型 （普通、实线、虚线、路牙...）
  PARKED_CARS = 14  % 车道线线型 （普通、实线、虚线、路牙...）

RFM_LINE_COLOR_E = enum(AddClassNameToEnumNames=true)
  NONE = 0  % 车道线颜色
  YELLOW = 1  % 车道线颜色
  WHITE = 2  % 车道线颜色
  BLUE = 3  % 车道线颜色
  ORANGE = 4  % 车道线颜色

OFM_OBJ_FUSTYPE = enum(DefaultValue="FC_FR", AddClassNameToEnumNames=true)
  FC_FR = 3  % FC代表摄像头；FR代表前雷达；
  FC_FR_CL = 7  % CL代表左角雷达；CR代表右角雷达；
  FC_FR_CR = 11  % BL代表左盲点雷达；BR代表右盲点雷达；
  FC_FR_CL_CR = 15
  FC_FR_BL = 19
  FC_FR_CL_BL = 23
  FC_FR_CR_BL = 27
  FC_FR_CL_CR_BL = 31
  FC_FR_BR = 35
  FC_FR_CL_BR = 39
  FC_FR_CR_BR = 43
  FC_FR_CL_CR_BR = 47
  FC_FR_BL_BR = 51
  FC_FR_CL_BL_BR = 55
  FC_FR_CR_BL_BR = 59
  FC_FR_CL_CR_BL_BR = 63
  INVALID = 0
  FC = 1
  FR = 2
  CL = 4
  FC_CL = 5
  FR_CL = 6
  CR = 8
  FC_CR = 9
  FR_CR = 10
  CL_CR = 12
  FC_CL_CR = 13
  FR_CL_CR = 14
  BL = 16
  FC_BL = 17
  FR_BL = 18
  CL_BL = 20
  FC_CL_BL = 21
  FR_CL_BL = 22
  CR_BL = 24
  FC_CR_BL = 25
  FR_CR_BL = 26
  CL_CR_BL = 28
  FC_CL_CR_BL = 29
  FR_CL_CR_BL = 30
  BR = 32
  FC_BR = 33
  FR_BR = 34
  CL_BR = 36
  FC_CL_BR = 37
  FR_CL_BR = 38
  CR_BR = 40
  FC_CR_BR = 41
  FR_CR_BR = 42
  CL_CR_BR = 44
  FC_CL_CR_BR = 45
  FR_CL_CR_BR = 46
  BL_BR = 48
  FC_BL_BR = 49
  FR_BL_BR = 50
  CL_BL_BR = 52
  FC_CL_BL_BR = 53
  FR_CL_BL_BR = 54
  CR_BL_BR = 56
  FC_CR_BL_BR = 57
  FR_CR_BL_BR = 58
  CL_CR_BL_BR = 60
  FC_CL_CR_BL_BR = 61
  FR_CL_CR_BL_BR = 62

ObjectMovingOrientation_E = enum(DefaultValue="UnknownDir", AddClassNameToEnumNames=true)
  UnknownDir = 0  % 目标运动方向：未知
  SameDir = 1  % 目标运动方向：同向
  OnComingDir = 2  % 目标运动方向：对向
  Crossing = 3  % 目标运动方向：横穿

LM_SpecialRoadType_E = enum(DefaultValue="enum1", AddClassNameToEnumNames=true)
  enum1 = 0

LM_RoadNumChg_E = enum(DefaultValue="NotChange", AddClassNameToEnumNames=true)
  NotChange = 0
  LeftAdd = 1
  RightAdd = 2
  LeftDes = 3
  RightDes = 4

LM_DrivInWLFlag_E = enum(DefaultValue="INVALID", AddClassNameToEnumNames=true)
  INVALID = 0
  EgoCarInLeftLane = 1
  EgoCarInMidLane = 2
  EgoCarInRightLane = 3

ObjectMovingState_E = enum(DefaultValue="invalid", AddClassNameToEnumNames=true)
  invalid = 0  % TOS输出，目标运动状态：未知
  UnknownState = 1  % TOS输出，目标运动状态：未知
  Moving = 2  % TOS输出，目标运动状态：运动的
  Still = 3  % TOS输出，目标运动状态：一直静止
  Stopped = 4  % 运动到停

ObjectMovingState_AEB_E = enum(DefaultValue="UnknownState", AddClassNameToEnumNames=true)
  UnknownState = 0
  Still = 1
  Moving = 2
  Stopped = 3

Std_ReturnType = Simulink.AliasType(BaseType="uint8")
StbM_TimeBaseStatusType = Simulink.AliasType(BaseType="uint8")

TOS_AEB_OBJ_MOVINGSTATE_E = enum(AddClassNameToEnumNames=true)
  UNKNOWN = 0  % 目标的运动状态(静止、运动...)
  STILL = 1  % 目标的运动状态(静止、运动...)
  MOVING = 2  % 目标的运动状态(静止、运动...)
  STOPED = 3  % 目标的运动状态(静止、运动...)

TOS_AEB_OBJ_ORIENTATION_E = enum(AddClassNameToEnumNames=true)
  UNKNOWN = 0  % 目标的运动方向(同向、对向、横穿...)
  SAME_DIR = 1  % 目标的运动方向(同向、对向、横穿...)
  INV_DIR = 2  % 目标的运动方向(同向、对向、横穿...)
  CROSSING = 3  % 目标的运动方向(同向、对向、横穿...)

OFM_OBJ_TYPE_E = enum(DefaultValue="INVALID", AddClassNameToEnumNames=true)
  INVALID = 0  % 目标的类型（行人、小汽车、卡车...）
  UNKNOWN_TYPE = 1  % 目标的类型（行人、小汽车、卡车...）
  CAR = 2  % 目标的类型（行人、小汽车、卡车...）
  TRUCK = 3  % 目标的类型（行人、小汽车、卡车...）
  MOTORBIKE = 4  % 目标的类型（行人、小汽车、卡车...）
  BICYCLE = 5  % 目标的类型（行人、小汽车、卡车...）
  PEDESTRIAN = 6  % 目标的类型（行人、小汽车、卡车...）
  GENERAL_OBJECT = 7  % 目标的类型（行人、小汽车、卡车...）
  ANIMAL = 8  % 目标的类型（行人、小汽车、卡车...）

OFM_OBJ_FUSIONTYPE_E = enum(DefaultValue="INVALID", AddClassNameToEnumNames=true)
  INVALID = 0  % 目标是否是融合,传感器类型，FC代表摄像头；FR代表前雷达；CL代表左角雷达；CR代表右角雷达；BL代表左盲点雷达；BR代表右盲点雷达；
  FC = 1  % 目标是否是融合,传感器类型，FC代表摄像头；FR代表前雷达；CL代表左角雷达；CR代表右角雷达；BL代表左盲点雷达；BR代表右盲点雷达；
  FR = 2  % 目标是否是融合,传感器类型，FC代表摄像头；FR代表前雷达；CL代表左角雷达；CR代表右角雷达；BL代表左盲点雷达；BR代表右盲点雷达；
  FC_FR = 3  % 目标是否是融合,传感器类型，FC代表摄像头；FR代表前雷达；CL代表左角雷达；CR代表右角雷达；BL代表左盲点雷达；BR代表右盲点雷达；
  CL = 4  % 目标是否是融合,传感器类型，FC代表摄像头；FR代表前雷达；CL代表左角雷达；CR代表右角雷达；BL代表左盲点雷达；BR代表右盲点雷达；
  FC_CL = 5  % 目标是否是融合,传感器类型，FC代表摄像头；FR代表前雷达；CL代表左角雷达；CR代表右角雷达；BL代表左盲点雷达；BR代表右盲点雷达；
  FR_CL = 6  % 目标是否是融合,传感器类型，FC代表摄像头；FR代表前雷达；CL代表左角雷达；CR代表右角雷达；BL代表左盲点雷达；BR代表右盲点雷达；
  FC_FR_CL = 7  % 目标是否是融合,传感器类型，FC代表摄像头；FR代表前雷达；CL代表左角雷达；CR代表右角雷达；BL代表左盲点雷达；BR代表右盲点雷达；
  CR = 8  % 目标是否是融合,传感器类型，FC代表摄像头；FR代表前雷达；CL代表左角雷达；CR代表右角雷达；BL代表左盲点雷达；BR代表右盲点雷达；
  FC_CR = 9  % 目标是否是融合,传感器类型，FC代表摄像头；FR代表前雷达；CL代表左角雷达；CR代表右角雷达；BL代表左盲点雷达；BR代表右盲点雷达；
  FR_CR = 10  % 目标是否是融合,传感器类型，FC代表摄像头；FR代表前雷达；CL代表左角雷达；CR代表右角雷达；BL代表左盲点雷达；BR代表右盲点雷达；
  FC_FR_CR = 11  % 目标是否是融合,传感器类型，FC代表摄像头；FR代表前雷达；CL代表左角雷达；CR代表右角雷达；BL代表左盲点雷达；BR代表右盲点雷达；
  CL_CR = 12  % 目标是否是融合,传感器类型，FC代表摄像头；FR代表前雷达；CL代表左角雷达；CR代表右角雷达；BL代表左盲点雷达；BR代表右盲点雷达；
  FC_CL_CR = 13  % 目标是否是融合,传感器类型，FC代表摄像头；FR代表前雷达；CL代表左角雷达；CR代表右角雷达；BL代表左盲点雷达；BR代表右盲点雷达；
  FR_CL_CR = 14  % 目标是否是融合,传感器类型，FC代表摄像头；FR代表前雷达；CL代表左角雷达；CR代表右角雷达；BL代表左盲点雷达；BR代表右盲点雷达；
  FC_FR_CL_CR = 15  % 目标是否是融合,传感器类型，FC代表摄像头；FR代表前雷达；CL代表左角雷达；CR代表右角雷达；BL代表左盲点雷达；BR代表右盲点雷达；
  BL = 16  % 目标是否是融合,传感器类型，FC代表摄像头；FR代表前雷达；CL代表左角雷达；CR代表右角雷达；BL代表左盲点雷达；BR代表右盲点雷达；
  FC_BL = 17  % 目标是否是融合,传感器类型，FC代表摄像头；FR代表前雷达；CL代表左角雷达；CR代表右角雷达；BL代表左盲点雷达；BR代表右盲点雷达；
  FR_BL = 18  % 目标是否是融合,传感器类型，FC代表摄像头；FR代表前雷达；CL代表左角雷达；CR代表右角雷达；BL代表左盲点雷达；BR代表右盲点雷达；
  FC_FR_BL = 19  % 目标是否是融合,传感器类型，FC代表摄像头；FR代表前雷达；CL代表左角雷达；CR代表右角雷达；BL代表左盲点雷达；BR代表右盲点雷达；
  CL_BL = 20  % 目标是否是融合,传感器类型，FC代表摄像头；FR代表前雷达；CL代表左角雷达；CR代表右角雷达；BL代表左盲点雷达；BR代表右盲点雷达；
  FC_CL_BL = 21  % 目标是否是融合,传感器类型，FC代表摄像头；FR代表前雷达；CL代表左角雷达；CR代表右角雷达；BL代表左盲点雷达；BR代表右盲点雷达；
  FR_CL_BL = 22  % 目标是否是融合,传感器类型，FC代表摄像头；FR代表前雷达；CL代表左角雷达；CR代表右角雷达；BL代表左盲点雷达；BR代表右盲点雷达；
  FC_FR_CL_BL = 23  % 目标是否是融合,传感器类型，FC代表摄像头；FR代表前雷达；CL代表左角雷达；CR代表右角雷达；BL代表左盲点雷达；BR代表右盲点雷达；
  CR_BL = 24  % 目标是否是融合,传感器类型，FC代表摄像头；FR代表前雷达；CL代表左角雷达；CR代表右角雷达；BL代表左盲点雷达；BR代表右盲点雷达；
  FC_CR_BL = 25  % 目标是否是融合,传感器类型，FC代表摄像头；FR代表前雷达；CL代表左角雷达；CR代表右角雷达；BL代表左盲点雷达；BR代表右盲点雷达；
  FR_CR_BL = 26  % 目标是否是融合,传感器类型，FC代表摄像头；FR代表前雷达；CL代表左角雷达；CR代表右角雷达；BL代表左盲点雷达；BR代表右盲点雷达；
  FC_FR_CR_BL = 27  % 目标是否是融合,传感器类型，FC代表摄像头；FR代表前雷达；CL代表左角雷达；CR代表右角雷达；BL代表左盲点雷达；BR代表右盲点雷达；
  CL_CR_BL = 28  % 目标是否是融合,传感器类型，FC代表摄像头；FR代表前雷达；CL代表左角雷达；CR代表右角雷达；BL代表左盲点雷达；BR代表右盲点雷达；
  FC_CL_CR_BL = 29  % 目标是否是融合,传感器类型，FC代表摄像头；FR代表前雷达；CL代表左角雷达；CR代表右角雷达；BL代表左盲点雷达；BR代表右盲点雷达；
  FR_CL_CR_BL = 30  % 目标是否是融合,传感器类型，FC代表摄像头；FR代表前雷达；CL代表左角雷达；CR代表右角雷达；BL代表左盲点雷达；BR代表右盲点雷达；
  FC_FR_CL_CR_BL = 31  % 目标是否是融合,传感器类型，FC代表摄像头；FR代表前雷达；CL代表左角雷达；CR代表右角雷达；BL代表左盲点雷达；BR代表右盲点雷达；
  BR = 32  % 目标是否是融合,传感器类型，FC代表摄像头；FR代表前雷达；CL代表左角雷达；CR代表右角雷达；BL代表左盲点雷达；BR代表右盲点雷达；
  FC_BR = 33  % 目标是否是融合,传感器类型，FC代表摄像头；FR代表前雷达；CL代表左角雷达；CR代表右角雷达；BL代表左盲点雷达；BR代表右盲点雷达；
  FR_BR = 34  % 目标是否是融合,传感器类型，FC代表摄像头；FR代表前雷达；CL代表左角雷达；CR代表右角雷达；BL代表左盲点雷达；BR代表右盲点雷达；
  FC_FR_BR = 35  % 目标是否是融合,传感器类型，FC代表摄像头；FR代表前雷达；CL代表左角雷达；CR代表右角雷达；BL代表左盲点雷达；BR代表右盲点雷达；
  CL_BR = 36  % 目标是否是融合,传感器类型，FC代表摄像头；FR代表前雷达；CL代表左角雷达；CR代表右角雷达；BL代表左盲点雷达；BR代表右盲点雷达；
  FC_CL_BR = 37  % 目标是否是融合,传感器类型，FC代表摄像头；FR代表前雷达；CL代表左角雷达；CR代表右角雷达；BL代表左盲点雷达；BR代表右盲点雷达；
  FR_CL_BR = 38  % 目标是否是融合,传感器类型，FC代表摄像头；FR代表前雷达；CL代表左角雷达；CR代表右角雷达；BL代表左盲点雷达；BR代表右盲点雷达；
  FC_FR_CL_BR = 39  % 目标是否是融合,传感器类型，FC代表摄像头；FR代表前雷达；CL代表左角雷达；CR代表右角雷达；BL代表左盲点雷达；BR代表右盲点雷达；
  CR_BR = 40  % 目标是否是融合,传感器类型，FC代表摄像头；FR代表前雷达；CL代表左角雷达；CR代表右角雷达；BL代表左盲点雷达；BR代表右盲点雷达；
  FC_CR_BR = 41  % 目标是否是融合,传感器类型，FC代表摄像头；FR代表前雷达；CL代表左角雷达；CR代表右角雷达；BL代表左盲点雷达；BR代表右盲点雷达；
  FR_CR_BR = 42  % 目标是否是融合,传感器类型，FC代表摄像头；FR代表前雷达；CL代表左角雷达；CR代表右角雷达；BL代表左盲点雷达；BR代表右盲点雷达；
  FC_FR_CR_BR = 43  % 目标是否是融合,传感器类型，FC代表摄像头；FR代表前雷达；CL代表左角雷达；CR代表右角雷达；BL代表左盲点雷达；BR代表右盲点雷达；
  CL_CR_BR = 44  % 目标是否是融合,传感器类型，FC代表摄像头；FR代表前雷达；CL代表左角雷达；CR代表右角雷达；BL代表左盲点雷达；BR代表右盲点雷达；
  FC_CL_CR_BR = 45  % 目标是否是融合,传感器类型，FC代表摄像头；FR代表前雷达；CL代表左角雷达；CR代表右角雷达；BL代表左盲点雷达；BR代表右盲点雷达；
  FR_CL_CR_BR = 46  % 目标是否是融合,传感器类型，FC代表摄像头；FR代表前雷达；CL代表左角雷达；CR代表右角雷达；BL代表左盲点雷达；BR代表右盲点雷达；
  FC_FR_CL_CR_BR = 47  % 目标是否是融合,传感器类型，FC代表摄像头；FR代表前雷达；CL代表左角雷达；CR代表右角雷达；BL代表左盲点雷达；BR代表右盲点雷达；
  BL_BR = 48  % 目标是否是融合,传感器类型，FC代表摄像头；FR代表前雷达；CL代表左角雷达；CR代表右角雷达；BL代表左盲点雷达；BR代表右盲点雷达；
  FC_BL_BR = 49  % 目标是否是融合,传感器类型，FC代表摄像头；FR代表前雷达；CL代表左角雷达；CR代表右角雷达；BL代表左盲点雷达；BR代表右盲点雷达；
  FR_BL_BR = 50  % 目标是否是融合,传感器类型，FC代表摄像头；FR代表前雷达；CL代表左角雷达；CR代表右角雷达；BL代表左盲点雷达；BR代表右盲点雷达；
  FC_FR_BL_BR = 51  % 目标是否是融合,传感器类型，FC代表摄像头；FR代表前雷达；CL代表左角雷达；CR代表右角雷达；BL代表左盲点雷达；BR代表右盲点雷达；
  CL_BL_BR = 52  % 目标是否是融合,传感器类型，FC代表摄像头；FR代表前雷达；CL代表左角雷达；CR代表右角雷达；BL代表左盲点雷达；BR代表右盲点雷达；
  FC_CL_BL_BR = 53  % 目标是否是融合,传感器类型，FC代表摄像头；FR代表前雷达；CL代表左角雷达；CR代表右角雷达；BL代表左盲点雷达；BR代表右盲点雷达；
  FR_CL_BL_BR = 54  % 目标是否是融合,传感器类型，FC代表摄像头；FR代表前雷达；CL代表左角雷达；CR代表右角雷达；BL代表左盲点雷达；BR代表右盲点雷达；
  FC_FR_CL_BL_BR = 55  % 目标是否是融合,传感器类型，FC代表摄像头；FR代表前雷达；CL代表左角雷达；CR代表右角雷达；BL代表左盲点雷达；BR代表右盲点雷达；
  CR_BL_BR = 56  % 目标是否是融合,传感器类型，FC代表摄像头；FR代表前雷达；CL代表左角雷达；CR代表右角雷达；BL代表左盲点雷达；BR代表右盲点雷达；
  FC_CR_BL_BR = 57  % 目标是否是融合,传感器类型，FC代表摄像头；FR代表前雷达；CL代表左角雷达；CR代表右角雷达；BL代表左盲点雷达；BR代表右盲点雷达；
  FR_CR_BL_BR = 58  % 目标是否是融合,传感器类型，FC代表摄像头；FR代表前雷达；CL代表左角雷达；CR代表右角雷达；BL代表左盲点雷达；BR代表右盲点雷达；
  FC_FR_CR_BL_BR = 59  % 目标是否是融合,传感器类型，FC代表摄像头；FR代表前雷达；CL代表左角雷达；CR代表右角雷达；BL代表左盲点雷达；BR代表右盲点雷达；
  CL_CR_BL_BR = 60  % 目标是否是融合,传感器类型，FC代表摄像头；FR代表前雷达；CL代表左角雷达；CR代表右角雷达；BL代表左盲点雷达；BR代表右盲点雷达；
  FC_CL_CR_BL_BR = 61  % 目标是否是融合,传感器类型，FC代表摄像头；FR代表前雷达；CL代表左角雷达；CR代表右角雷达；BL代表左盲点雷达；BR代表右盲点雷达；
  FR_CL_CR_BL_BR = 62  % 目标是否是融合,传感器类型，FC代表摄像头；FR代表前雷达；CL代表左角雷达；CR代表右角雷达；BL代表左盲点雷达；BR代表右盲点雷达；
  FC_FR_CL_CR_BL_BR = 63  % 目标是否是融合,传感器类型，FC代表摄像头；FR代表前雷达；CL代表左角雷达；CR代表右角雷达；BL代表左盲点雷达；BR代表右盲点雷达；

OFM_OBJ_MOVINGSTATE_E = enum(DefaultValue="INVALID", AddClassNameToEnumNames=true)
  INVALID = 0  % 目标的运动状态(静止、运动...)
  UNKNOWN = 1  % 目标的运动状态(静止、运动...)
  MOVING = 2  % 目标的运动状态(静止、运动...)
  STATIONARY = 3  % 目标的运动状态(静止、运动...)
  STOPPED = 4  % 目标的运动状态(静止、运动...)
  MOVING_SLOWLY = 5  % 目标的运动状态(静止、运动...)

OFM_OBJ_ORIENTATION_E = enum(DefaultValue="INVALID", AddClassNameToEnumNames=true)
  INVALID = 0  % 目标的运动方向(同向、对向、横穿...)
  UNKNOWN = 1  % 目标的运动方向(同向、对向、横穿...)
  NORTH_EAST = 2  % 目标的运动方向(同向、对向、横穿...)
  EAST = 3  % 目标的运动方向(同向、对向、横穿...)
  SOUTH_EAST = 4  % 目标的运动方向(同向、对向、横穿...)
  SOUTH = 5  % 目标的运动方向(同向、对向、横穿...)
  SOUTH_WEST = 6  % 目标的运动方向(同向、对向、横穿...)
  WEST = 7  % 目标的运动方向(同向、对向、横穿...)
  NORTH_WEST = 8  % 目标的运动方向(同向、对向、横穿...)
  NORTH = 9  % 目标的运动方向(同向、对向、横穿...)
  CROSS = 16  % 目标的运动方向(同向、对向、横穿...)

VSM_HOD_DrvTrqFilted = Simulink.Signal(StorageClass="ExportedGlobal")

TJA_STATE = enum(DefaultValue="TJA_Off", StorageType="uint8", AddClassNameToEnumNames=true)
  TJA_Off = 0
  TJA_Idle = 1
  TJA_Ready = 2
  TJA_Active = 3
  TJA_Error = 7
  TJA_SafeStop = 9
  TJA_Wait = 6
  TJA_SlowRetreat = 10

DspaceConfig = Simulink.ConfigSet(StartTime="0", StopTime="Inf", Solver="FixedStepAuto", ProdHWDeviceType="Custom Processor->Custom", SystemTargetFile="dsrt.tlc", TargetLang="C")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