% Simulink data dictionary adas_Enum.sldd

TOS_AEB_OBJ_MOVINGSTATE_E = enum(AddClassNameToEnumNames=true)
  UNKNOWN = 0  % 目标的运动状态(静止、运动...)
  STILL = 1  % 目标的运动状态(静止、运动...)
  MOVING = 2  % 目标的运动状态(静止、运动...)
  STOPED = 3  % 目标的运动状态(静止、运动...)

TOS_AEB_OBJ_ORIENTATION_E = enum(AddClassNameToEnumNames=true)
  UNKNOWN = 0  % 目标的运动方向(同向、对向、横穿...)
  SAME_DIR = 1  % 目标的运动方向(同向、对向、横穿...)
  INV_DIR = 2  % 目标的运动方向(同向、对向、横穿...)
  CROSSING = 3  % 目标的运动方向(同向、对向、横穿...)

STATE = enum(DefaultValue="OFF", StorageType="uint8", AddClassNameToEnumNames=true)
  OFF = 0
  IDLE = 1
  READY = 2
  ACTIVE = 3
  ACTIVE_LEFT = 4
  ACTIVE_RIGHT = 5
  ERROR = 6
  DEFAULT = 7

RFM_TSR_FUSIONSTS_E = enum(AddClassNameToEnumNames=true)
  UNKNOWN = 0  % 融合状态（故障，融合，仅视觉，仅导航）
  FUSION = 1  % 融合状态（故障，融合，仅视觉，仅导航）
  VISION = 2  % 融合状态（故障，融合，仅视觉，仅导航）
  HUT = 3  % 融合状态（故障，融合，仅视觉，仅导航）
  FAILURE = 4  % 融合状态（故障，融合，仅视觉，仅导航）

RFM_NAV_ROADTYPE_E = enum(AddClassNameToEnumNames=true)
  UNKNOWN = 0  % 指示导航检测到的车辆当前行驶位置的行驶类型(HUT)
  EXPRESSWAY = 1  % 指示导航检测到的车辆当前行驶位置的行驶类型(HUT)
  CITY_EXPRESSWAY = 2  % 指示导航检测到的车辆当前行驶位置的行驶类型(HUT)
  NATIONAL_ROAD = 3  % 指示导航检测到的车辆当前行驶位置的行驶类型(HUT)
  PROVINCIAL_ROAD = 4  % 指示导航检测到的车辆当前行驶位置的行驶类型(HUT)
  COUNTRY_ROAD = 5  % 指示导航检测到的车辆当前行驶位置的行驶类型(HUT)
  CITY_OR_VILLAGE_ROAD = 6  % 指示导航检测到的车辆当前行驶位置的行驶类型(HUT)
  RAMP = 7  % 指示导航检测到的车辆当前行驶位置的行驶类型(HUT)
  TUNNEL = 8  % 指示导航检测到的车辆当前行驶位置的行驶类型(HUT)
  SIDE_ROAD = 9  % 指示导航检测到的车辆当前行驶位置的行驶类型(HUT)
  CHANNEL = 10  % 指示导航检测到的车辆当前行驶位置的行驶类型(HUT)
  RESERVED = 0  % 指示导航检测到的车辆当前行驶位置的行驶类型(HUT)

RFM_NAV_SPLTYPE_E = enum(AddClassNameToEnumNames=true)
  UNKNOWN = 0  % 限速类型
  TRAFFIC_SIGN = 1  % 限速类型
  ELECTRONIC_EYE = 2  % 限速类型
  ROAD_DEFAULT = 3  % 限速类型

RFM_NAV_SPLUNIT_E = enum(AddClassNameToEnumNames=true)
  KMH = 0  % 指示当前限速单位
  MPH = 1  % 指示当前限速单位
  UNKNOWN = 2  % 指示当前限速单位
  RESERVED = 3  % 指示当前限速单位

RFM_LINE_TYPE_E = enum(AddClassNameToEnumNames=true)
  UNDECIDED = 0  % 车道线线型 （普通、实线、虚线、路牙...）
  SOLID = 1  % 车道线线型 （普通、实线、虚线、路牙...）
  DASHED = 2  % 车道线线型 （普通、实线、虚线、路牙...）
  DOUBLE_SOLID_DASHED = 3  % 车道线线型 （普通、实线、虚线、路牙...）
  DOUBLE_DASHED_SOLID = 4  % 车道线线型 （普通、实线、虚线、路牙...）
  DOUBLE_SOLID_SOLID = 5  % 车道线线型 （普通、实线、虚线、路牙...）
  DOUBLE_DASHED_DASHED = 6  % 车道线线型 （普通、实线、虚线、路牙...）
  BOTTS = 7  % 车道线线型 （普通、实线、虚线、路牙...）
  DECELERATION = 8  % 车道线线型 （普通、实线、虚线、路牙...）
  HOV_LANE = 9  % 车道线线型 （普通、实线、虚线、路牙...）
  ROAD_EDGE = 10  % 车道线线型 （普通、实线、虚线、路牙...）
  ELEVATED_STRUCTURE = 11  % 车道线线型 （普通、实线、虚线、路牙...）
  LCURB = 12  % 车道线线型 （普通、实线、虚线、路牙...）
  CONES_POLES = 13  % 车道线线型 （普通、实线、虚线、路牙...）
  PARKED_CARS = 14  % 车道线线型 （普通、实线、虚线、路牙...）

RFM_LINE_COLOR_E = enum(AddClassNameToEnumNames=true)
  NONE = 0  % 车道线颜色
  YELLOW = 1  % 车道线颜色
  WHITE = 2  % 车道线颜色
  BLUE = 3  % 车道线颜色
  ORANGE = 4  % 车道线颜色

RFM_LANECHANGE_DIR_E = enum(AddClassNameToEnumNames=true)
  INVALID = 0  % 指示是否发生变道以及变道向哪个方向
  LEFT = 1  % 指示是否发生变道以及变道向哪个方向
  RIGHT = 2  % 指示是否发生变道以及变道向哪个方向

LCK_STATE = enum(DefaultValue="LCK_Off", StorageType="uint8", AddClassNameToEnumNames=true)
  LCK_Off = 0
  LCK_Idle = 1
  LCK_Ready = 2
  LCK_Active = 3
  LCK_Error = 7

ISLActive = enum(DefaultValue="Inactive", StorageType="uint8", AddClassNameToEnumNames=true)
  Inactive = 0
  Active = 1
  ISL_Take_Over_Warning = 2

ISL_InterSysInfoDisp = enum(DefaultValue="No_display", StorageType="uint8", AddClassNameToEnumNames=true)
  No_display = 0
  Speed_Limit_Confirm_Request = 1
  Speed_Limit_Take_Over_Request = 2

HWA_STATE = enum(DefaultValue="HWA_Off", StorageType="uint8", AddClassNameToEnumNames=true)
  HWA_Off = 0
  HWA_Idle = 1
  HWA_Ready = 2
  HWA_CCAct = 3
  HWA_Pause = 4
  HWA_LeftTurn = 5
  HWA_RightTurn = 6
  HWA_Error = 7
  HWA_SafeStop = 9
  HWA_SlowRetreat = 10
  HWA_LeftTurnPrepare = 11
  HWA_RightTurnPrepare = 12

ELKSTATE = enum(DefaultValue="ELK_OFF", StorageType="uint8", AddClassNameToEnumNames=true)
  ELK_OFF = 0
  ELK_IDLE = 1
  ELK_READY = 2
  ELK_ACTIVE_LEFT = 3
  ELK_ACTIVE_RIGHT = 4
  ELK_ONCOMING_LEFT = 5
  ELK_ONCOMING_RIGHT = 6
  ELK_OVERTAKING_LEFT = 7
  ELK_OVERTAKING_RIGHT = 8
  ELK_ERROR = 9
  ELK_DEFAULT = 10

ACC_STATE = enum(DefaultValue="ACC_Off", AddClassNameToEnumNames=true)
  ACC_Off = 0
  ACC_Reject = 1
  ACC_Standby = 2
  ACC_ActiveControl = 3
  ACC_BrakeOnly = 4
  ACC_Override = 5
  ACC_StandWait = 6
  ACC_Failure = 7
  ACC_StandActive = 9

TJA_STATE = enum(DefaultValue="TJA_Off", StorageType="uint8", AddClassNameToEnumNames=true)
  TJA_Off = 0
  TJA_Idle = 1
  TJA_Ready = 2
  TJA_Active = 3
  TJA_Error = 7
  TJA_SafeStop = 9
  TJA_Wait = 6
  TJA_SlowRetreat = 10
  TJA_MRC = 11