% Simulink data dictionary LATC.sldd

LCS_Debug_BUS = Simulink.Bus()
  LCS_PID_torqP: single
  LCS_PID_torqD: single
  ErrDt: single
  LCS_ControlAngleError: single
  LCS_TarSteerAngle_deg: single
  LCS_TarSteerAngleEnd: single
  LCS_CurSteerAngle_deg: single

LATC_L3_BUS = Simulink.Bus()
  HWP_AngCmdReqVal: single, Min=-780, Max=780
  HWP_AngCmdReqValVld: boolean, Min=0, Max=1
  HWP_ReqCtrlEPS: boolean, Min=0, Max=1
  HWP_ReqCtrlEPSVld: boolean, Min=0, Max=1
  HWP_WorkReq: uint8, Min=0, Max=7
  HWP_WorkReqVld: boolean, Min=0, Max=1
  HWP_FuncTrqCmdReqFlag: uint8, Min=0, Max=7
  HWP_TrqOvlCmdReqValue: single, Min=-10.23, Max=10.24

LCS_IN_axvRefMs2 = Simulink.Signal(StorageClass="ExportedGlobal")
LCS_IN_ayvRefMs2 = Simulink.Signal(StorageClass="ExportedGlobal")
LCS_IN_kapTraj = Simulink.Signal(StorageClass="ExportedGlobal")
LCS_IN_alpSideSlipAngle = Simulink.Signal(StorageClass="ExportedGlobal")
LCS_IN_psiDtOpt = Simulink.Signal(StorageClass="ExportedGlobal")
LCS_IN_SteerAngOffset_deg = Simulink.Signal(StorageClass="ExportedGlobal")
LCS_IN_EPS_DrvInpTrqVal = Simulink.Signal(StorageClass="ExportedGlobal")
LCS_IN_EPS_LKATorqOvrlDlvd = Simulink.Signal(StorageClass="ExportedGlobal")
LCS_IN_EPS_LKATorqOvrlDlvdVld = Simulink.Signal(StorageClass="ExportedGlobal")
LCS_IN_SteerWheelSpd = Simulink.Signal(StorageClass="ExportedGlobal")
LCS_IN_SteerWheelAng = Simulink.Signal(StorageClass="ExportedGlobal")
LCS_IN_SteerWheelSpdSign = Simulink.Signal(StorageClass="ExportedGlobal")
LCS_IN_SteerWheelAngleSign = Simulink.Signal(StorageClass="ExportedGlobal")
LCS_IN_desLaneA0 = Simulink.Signal(StorageClass="ExportedGlobal")
LCS_IN_desLaneA2 = Simulink.Signal(StorageClass="ExportedGlobal")
LCS_IN_desLaneA3 = Simulink.Signal(StorageClass="ExportedGlobal")
LCS_IN_desLaneA1 = Simulink.Signal(StorageClass="ExportedGlobal")
LCS_IN_SteerAngleSpd_degs = Simulink.Signal(StorageClass="ExportedGlobal")
LCS_IN_CurrentLaneWidth = Simulink.Signal(StorageClass="ExportedGlobal")
LCS_IN_desLaneValid = Simulink.Signal(StorageClass="ExportedGlobal")
LCS_IN_TarDangerLevel = Simulink.Signal(StorageClass="ExportedGlobal")
LCS_IN_CurSteerAngle_deg = Simulink.Signal(StorageClass="ExportedGlobal")
LCS_IN_SteerAngleOffset_deg = Simulink.Signal(StorageClass="ExportedGlobal")
LCS_IN_EPS_LKAAngDlvdSts = Simulink.Signal(StorageClass="ExportedGlobal")
LCS_IN_EPS_LKATrqOvlDlvdSts = Simulink.Signal(StorageClass="ExportedGlobal")
LCS_IN_EPS_FailSts = Simulink.Signal(StorageClass="ExportedGlobal")
LCS_IN_TarDangerlLevel = Simulink.Signal(StorageClass="ExportedGlobal")
LCS_OUT_ReqEPSTrgAngle = Simulink.Signal(StorageClass="ExportedGlobal")
LCS_OUT_EpsTrqReqValue = Simulink.Signal(StorageClass="ExportedGlobal")
LCS_OUT_EpsTrqReqValueVld = Simulink.Signal(StorageClass="ExportedGlobal")
LCS_OUT_AngCmdReqValVld = Simulink.Signal(StorageClass="ExportedGlobal")
P_LCS_CurOffset_VehicleSpd_LimitValue = Simulink.Parameter(7, StorageClass="ExportedGlobal", DataType="single")
P_LCS_CurOffset_SterAngleSpd_LimitValue = Simulink.Parameter(6, StorageClass="ExportedGlobal", DataType="single")
P_LCS_CurentOffset_LimitValue = Simulink.Parameter(0.001, StorageClass="ExportedGlobal", DataType="single")
P_LCS_communicationTest = Simulink.Parameter(1, StorageClass="ExportedGlobal", DataType="boolean")
P_LCS_communicationTest_SteerAngleSlopeTest_Enable = Simulink.Parameter(0, StorageClass="ExportedGlobal", DataType="uint8")
P_LCS_communicationTest_SteerAngleSlopeTest_Slope = Simulink.Parameter(3, StorageClass="ExportedGlobal", DataType="single")
P_LCS_communicationTest_SteerAngleSlopeTest_MinValue = Simulink.Parameter(-780, StorageClass="ExportedGlobal", DataType="single")
P_LCS_communicationTest_SteerAngleSlopeTest_MaxValue = Simulink.Parameter(780, StorageClass="ExportedGlobal", DataType="single")
LCS_Trq_Switch = Simulink.Signal(StorageClass="ExportedGlobal")
P_LCS_Trq_Switch = Simulink.Parameter(0, StorageClass="ExportedGlobal", DataType="uint8")
LCS_Counter = Simulink.Signal(StorageClass="ExportedGlobal", DataType="uint8")
P_LCS_IN_Offset_Test_SW = Simulink.Parameter(0, StorageClass="ExportedGlobal", DataType="uint8")
P_LCS_IN_Offset_Test_Value = Simulink.Parameter(0, StorageClass="ExportedGlobal", DataType="single")
P_LCS_A0_Limit = Simulink.Parameter(0.25, StorageClass="ExportedGlobal", DataType="single")
P_LCS_A1_Limit = Simulink.Parameter(0.002, StorageClass="ExportedGlobal", DataType="single")
LCS_LATC_Effect = Simulink.Signal(StorageClass="ExportedGlobal")
LCS_CurSteerAngle_deg = Simulink.Signal(StorageClass="ExportedGlobal")
LCS_ReqEPSTrgAngle = Simulink.Signal(StorageClass="ExportedGlobal")
P_LCS_ESS_AngleSlope_Limit = Simulink.Parameter(2.9, StorageClass="ExportedGlobal", DataType="single")
LCS_EqA0 = Simulink.Signal(StorageClass="ExportedGlobal")
LCS_Spd_ms = Simulink.Signal(StorageClass="ExportedGlobal")
LCS_DisplaySpd_kph = Simulink.Signal(StorageClass="ExportedGlobal")
LCS_MinDis = Simulink.Signal(StorageClass="ExportedGlobal")
LCS_AbsMinDis = Simulink.Signal(StorageClass="ExportedGlobal")
LCS_AbsDis_BaseLaneWidth = Simulink.Signal(StorageClass="ExportedGlobal")
LCS_TurnCenterPointX = Simulink.Signal(StorageClass="ExportedGlobal")
LCS_TurnCenterPointY = Simulink.Signal(StorageClass="ExportedGlobal")
P_LCS_Trigger_Init = Simulink.Parameter(1, StorageClass="ExportedGlobal")
P_LCS_Turn_StraightLength1 = Simulink.Parameter(20, StorageClass="ExportedGlobal")
P_LCS_Turn_StraightLength2 = Simulink.Parameter(12, StorageClass="ExportedGlobal")
P_LCS_Turn_StraightLength3 = Simulink.Parameter(20, StorageClass="ExportedGlobal")
P_LCS_TurnDirection = Simulink.Parameter(1, StorageClass="ExportedGlobal")
P_LCS_TurnRoadType = Simulink.Parameter(1, StorageClass="ExportedGlobal")
P_LCS_LineVaildSW = Simulink.Parameter(0, StorageClass="ExportedGlobal")
P_LCS_LineVaildSW2 = Simulink.Parameter(0, StorageClass="ExportedGlobal")
LCS_CurrentSteerAngleOffset_deg = Simulink.Signal(StorageClass="ExportedGlobal")
LCS_OffSetUpdate_Flg = Simulink.Signal(StorageClass="ExportedGlobal")
LCS_CurOffsetA2_Enable = Simulink.Signal(StorageClass="ExportedGlobal")
P_LCS_CurOffsetA2_FliterTime = Simulink.Parameter(0.2, StorageClass="ExportedGlobal", DataType="single")
P_LCS_CurOffsetA2_Enable = Simulink.Parameter(0, StorageClass="ExportedGlobal", DataType="boolean")
P_LCS_CurOffset_SterAngleSpd_Enable = Simulink.Parameter(0, StorageClass="ExportedGlobal", DataType="boolean")
P_LCS_A2_CurrentOffsetFliterTime = Simulink.Parameter(repmat(2, 1, 10), StorageClass="ExportedGlobal", DataType="single")
P_LCS_A2_Curve_BP = Simulink.Parameter(single([0 0.0002 0.0003 0.0007 0.0013 0.0025 0.0033 0.005 0.01 0.02]), StorageClass="ExportedGlobal")
P_LCS_CurSteerAngleOffsetLimit_Up = Simulink.Parameter(10, StorageClass="ExportedGlobal", DataType="single")
P_LCS_CurSteerAngleOffsetLimit_Low = Simulink.Parameter(-10, StorageClass="ExportedGlobal", DataType="single")
LCS_SubModel_Number = Simulink.Signal(StorageClass="ExportedGlobal")
Sig = Simulink.Signal()
LCS_SubModel_VERSION = Simulink.Signal(StorageClass="ExportedGlobal")
LCS_communicationTest_IFCTrqOvlCmdReqValue = Simulink.Signal(StorageClass="ExportedGlobal")
LCS_communicationTest_IFCFuncTrqCmdReqFlag = Simulink.Signal(StorageClass="ExportedGlobal")
LCS_communicationTest_IFCAngCmdReqValue = Simulink.Signal(StorageClass="ExportedGlobal")
LCS_communicationTest_IFCFuncAngCmdReqFlag = Simulink.Signal(StorageClass="ExportedGlobal")
LCS_communicationTest_LATC_L3 = Simulink.Signal(StorageClass="ExportedGlobal")
LCS_TurndDeltaX = Simulink.Signal(StorageClass="ExportedGlobal")
LCS_TurndDeltaY = Simulink.Signal(StorageClass="ExportedGlobal")
LCS_LATC_SteerAngleCmd_deg = Simulink.Signal(StorageClass="ExportedGlobal")
LCS_LATC_Feedforward_deg = Simulink.Signal(StorageClass="ExportedGlobal")
LCS_LATC_Feedback_deg = Simulink.Signal(StorageClass="ExportedGlobal")
LCS_LATC_SteerAngleLimit_deg = Simulink.Signal(StorageClass="ExportedGlobal")
LatError_contribution = Simulink.Signal(StorageClass="ExportedGlobal")
LatErrorRate_contribution = Simulink.Signal(StorageClass="ExportedGlobal")
HeadingError_contribution = Simulink.Signal(StorageClass="ExportedGlobal")
HeadingErrorRate_contribution = Simulink.Signal(StorageClass="ExportedGlobal")
LCS_LATC_TarAngle_deg = Simulink.Signal(StorageClass="ExportedGlobal")
P_LCS_LATC_TarAngleFliterWindowSize = Simulink.Parameter(5, StorageClass="ExportedGlobal")
P_LCS_LATC_CurOffsetVehicleSpdLimitValue_degs = Simulink.Parameter(7, StorageClass="ExportedGlobal", DataType="single")
P_LCS_LATC_StateHoldTime_st = Simulink.Parameter(250, StorageClass="ExportedGlobal")
P_LCS_LATC_ELKAngleSlope_ratio = Simulink.Parameter(repmat(1.6, 1, 16), StorageClass="ExportedGlobal")
P_LCS_LATC_ELKMaxLatAcc_ms2 = Simulink.Parameter(repmat(10, 1, 16), StorageClass="ExportedGlobal")
P_LCS_LATC_ESSAngleSlope_ratio = Simulink.Parameter(repmat(1.6, 1, 16), StorageClass="ExportedGlobal")
P_LCS_LATC_ESSMaxLatAcc_ms2 = Simulink.Parameter(repmat(10, 1, 16), StorageClass="ExportedGlobal")
P_LCS_LATC_LCAngleSlope_ratio = Simulink.Parameter(repmat(1.6, 1, 16), StorageClass="ExportedGlobal")
P_LCS_LATC_LCEcoAngleSlope_ratio = Simulink.Parameter(repmat(1.6, 1, 16), StorageClass="ExportedGlobal")
P_LCS_LATC_LCNormalAngleSlope_ratio = Simulink.Parameter(repmat(1.6, 1, 16), StorageClass="ExportedGlobal")
P_LCS_LATC_LCSportAngleSlope_ratio = Simulink.Parameter(repmat(1.6, 1, 16), StorageClass="ExportedGlobal")
P_LCS_LATC_LCKIEMaxLatAcc_ms2 = Simulink.Parameter(repmat(10, 1, 16), StorageClass="ExportedGlobal")
P_LCS_LATC_LCKIEAngleSlope_ratio = Simulink.Parameter([0.4 0.4 0.4 0.4 0.4 0.4 0.4 0.4 0.4 0.5 0.6 0.6 0.6 0.6 0.6 0.6], StorageClass="ExportedGlobal")
P_LCS_LATC_LCKMaxLatAcc_ms2 = Simulink.Parameter(repmat(10, 1, 16), StorageClass="ExportedGlobal")
P_LCS_LATC_LCNormalMaxLatAcc_ms2 = Simulink.Parameter(repmat(10, 1, 16), StorageClass="ExportedGlobal")
P_LCS_LATC_LCCancleMaxLatAcc_ms2 = Simulink.Parameter(repmat(10, 1, 16), StorageClass="ExportedGlobal")
P_LCS_LATC_CurOffsetCurve_TabX_m = Simulink.Parameter(single([0 0.0002 0.0003 0.0007 0.0013 0.0025 0.0033 0.005 0.01 0.02]), StorageClass="ExportedGlobal")
P_LCS_LATC_CurOffsetCurveFliterTime_Tab_s = Simulink.Parameter(repmat(2, 1, 10), StorageClass="ExportedGlobal")
P_LCS_LATC_LKAMaxLatAcc_ms2 = Simulink.Parameter(repmat(10, 1, 16), StorageClass="ExportedGlobal")
P_LCS_LATC_LCEcoMaxLatAcc_ms2 = Simulink.Parameter(repmat(10, 1, 16), StorageClass="ExportedGlobal")
P_LCS_LATC_LCSportMaxLatAcc_ms2 = Simulink.Parameter(repmat(10, 1, 16), StorageClass="ExportedGlobal")
P_LCS_LATC_LCKAngleSlope_ratio = Simulink.Parameter([0.4 0.4 0.4 0.4 0.4 0.4 0.4 0.4 0.4 0.5 0.6 0.6 0.6 0.6 0.6 0.6], StorageClass="ExportedGlobal")
P_LCS_LATC_LKAAngleSlope_ratio = Simulink.Parameter(repmat(1.6, 1, 16), StorageClass="ExportedGlobal")
P_LCS_LATC_StateActiveFlg_TabX_st = Simulink.Parameter([1 2 3 4 5], StorageClass="ExportedGlobal")
P_LCS_LATC_StateActiveHoldTime_TabY_st = Simulink.Parameter([0 0.2 0.4 0.6 0.8 1 1.2 1.4 1.6 1.8 2 4 6 8 10], StorageClass="ExportedGlobal")

P_LCS_LATC_StateActivAngleSlopeLimit_ratio = Simulink.Parameter([0.01 0.01 0.1 0.2 0.4 0.8 1 1.2 1.4 1.6 1.8 2 2 2 2
 0.15 0.15 0.15 0.15 0.15 0.15 0.15 0.15 1.4 1.6 1.8 2 2 2 2
 0.1 0.15 0.2 0.25 0.28 0.8 1 1.2 1.4 1.6 1.8 2 2 2 2
 0.5 0.7 1 1 1 1 1 1.2 1.4 1.6 1.8 2 2 2 2
 1.6 1.6 1.6 1.6 1.6 1.6 1.6 1.6 1.6 1.6 1.6 1.6 2 2 2], StorageClass="ExportedGlobal")

P_LCS_LATC_LCKAngleSlope_Tab_degs = Simulink.Parameter(repmat(0.4, 1, 12), StorageClass="ExportedGlobal")
P_LCS_LATC_VehicleSpd_TabX_Kph = Simulink.Parameter([0 10 20 30 40 60 80 90 100 110 120 140], StorageClass="ExportedGlobal")
P_LCS_LATC_LCKIEAngleSlope_Tab_degs = Simulink.Parameter(repmat(0.4, 1, 12), StorageClass="ExportedGlobal")
P_LCS_LATC_LCNormalAngleSlope_Tab_degs = Simulink.Parameter(repmat(0.5, 1, 12), StorageClass="ExportedGlobal")
P_LCS_LATC_ESSAESAngleSlope_Tab_degs = Simulink.Parameter(repmat(0.4, 1, 12), StorageClass="ExportedGlobal")
P_LCS_LATC_LCAngleSlope_Tab_degs = Simulink.Parameter(repmat(0.8, 1, 12), StorageClass="ExportedGlobal")
P_LCS_LATC_LCEcoAngleSlope_Tab_degs = Simulink.Parameter(repmat(0.4, 1, 12), StorageClass="ExportedGlobal")
P_LCS_LATC_LCSportAngleSlope_Tab_degs = Simulink.Parameter(repmat(1.5, 1, 12), StorageClass="ExportedGlobal")
P_LCS_LATC_LKAAngleSlope_Tab_degs = Simulink.Parameter(repmat(0.4, 1, 12), StorageClass="ExportedGlobal")
P_LCS_LATC_DeltaEps_Tab_s = Simulink.Parameter([0.5 0.5 0.5 0.5 0.5 0.5 0.5 0.5 0.5 0.5 0.4 0.4 0.4 0.4 0.4 0.4], StorageClass="ExportedGlobal")
LCS_LATC_AngleSlopeFlg_st = Simulink.Signal(StorageClass="ExportedGlobal")
LCS_LATC_CurrentSteerAngleOffset_deg = Simulink.Signal(StorageClass="ExportedGlobal")
LCS_LATC_TarAngleFilter_deg = Simulink.Signal(StorageClass="ExportedGlobal")
LCS_LATC_MaxAy_ms2 = Simulink.Signal(StorageClass="ExportedGlobal")
LCS_LATC_StateActAngleSlope_degs = Simulink.Signal(StorageClass="ExportedGlobal")
LCS_LATC_StateAngleSlope_degs = Simulink.Signal(StorageClass="ExportedGlobal")
LCS_LATC_EqA0 = Simulink.Signal(StorageClass="ExportedGlobal")
LCS_LATC_TarSteerAngle = Simulink.Signal(StorageClass="ExportedGlobal")
LCS_LATC_TarSteerAngleFilter = Simulink.Signal(StorageClass="ExportedGlobal")
LCS_LATC_TarSteerAngleEnd = Simulink.Signal(StorageClass="ExportedGlobal")
LCS_LATC_DeltaAngle = Simulink.Signal(StorageClass="ExportedGlobal")
LCS_LATC_ESS_TarAngle2 = Simulink.Signal(StorageClass="ExportedGlobal")
LCS_LATC_ReqEPSTrgAngle = Simulink.Signal(StorageClass="ExportedGlobal")
LCS_LATC_ReqEPSTrgAngle_deg = Simulink.Signal(StorageClass="ExportedGlobal")
LCS_LATC_PreIndex = Simulink.Signal(StorageClass="ExportedGlobal")
LCS_LATC_HoldTime_s = Simulink.Signal(StorageClass="ExportedGlobal")
LCS_LATC_OutTrgSteerAngle = Simulink.Signal(StorageClass="ExportedGlobal")
LCS_LATC_PlanT = Simulink.Signal(StorageClass="ExportedGlobal")
LCS_LATC_PlanLoopNum = Simulink.Signal(StorageClass="ExportedGlobal")
LCS_LATC_PlanLength = Simulink.Signal(StorageClass="ExportedGlobal")
LCS_LATC_PlanAyDt = Simulink.Signal(StorageClass="ExportedGlobal")
LCS_LATC_FinalpreDis = Simulink.Signal(StorageClass="ExportedGlobal")
LCS_LATC_MatrixResult_deg = Simulink.Signal(StorageClass="ExportedGlobal")
LCS_LATC_lat_error = Simulink.Signal(StorageClass="ExportedGlobal")
LCS_LATC_heading_error = Simulink.Signal(StorageClass="ExportedGlobal")
LCS_LATC_lat_error_feedback = Simulink.Signal(StorageClass="ExportedGlobal")
LCS_LATC_lat_error_rate = Simulink.Signal(StorageClass="ExportedGlobal")
LCS_LATC_heading_error_feedback = Simulink.Signal(StorageClass="ExportedGlobal")
LCS_LATC_heading_error_rate = Simulink.Signal(StorageClass="ExportedGlobal")
LCS_LATC_lookahead_Pt_Kappa = Simulink.Signal(StorageClass="ExportedGlobal")
LCS_Predict_x = Simulink.Signal(StorageClass="ExportedGlobal")
LCS_Predict_y = Simulink.Signal(StorageClass="ExportedGlobal")
LCS_Predict_heading = Simulink.Signal(StorageClass="ExportedGlobal")
LCS_Predict_spd = Simulink.Signal(StorageClass="ExportedGlobal")
LCS_Predict_yawrate = Simulink.Signal(StorageClass="ExportedGlobal")
LCS_MatchPtX = Simulink.Signal(StorageClass="ExportedGlobal")
LCS_MatchPtY = Simulink.Signal(StorageClass="ExportedGlobal")
LCS_MatchPtTheta = Simulink.Signal(StorageClass="ExportedGlobal")
LCS_MatchPtCurve = Simulink.Signal(StorageClass="ExportedGlobal")
LCS_ProjectPtX = Simulink.Signal(StorageClass="ExportedGlobal")
LCS_MatchPtS = Simulink.Signal(StorageClass="ExportedGlobal")
LCS_ProjectPtY = Simulink.Signal(StorageClass="ExportedGlobal")
LCS_ProjectPtTheta = Simulink.Signal(StorageClass="ExportedGlobal")
LCS_ProjectPtCurve = Simulink.Signal(StorageClass="ExportedGlobal")
LCS_ProjectPtS = Simulink.Signal(StorageClass="ExportedGlobal")
LCS_LATC_Project_Pt_Kappa = Simulink.Signal(StorageClass="ExportedGlobal")
LCS_LATC_lat_error_lookahead = Simulink.Signal(StorageClass="ExportedGlobal")
LCS_LATC_lat_error_rate_lookahead = Simulink.Signal(StorageClass="ExportedGlobal")
LCS_LATC_heading_error_lookahead = Simulink.Signal(StorageClass="ExportedGlobal")
LCS_LATC_heading_error_rate_lookahead = Simulink.Signal(StorageClass="ExportedGlobal")
LCS_TarTraj_x = Simulink.Signal(StorageClass="ExportedGlobal")
LCS_TarTraj_y = Simulink.Signal(StorageClass="ExportedGlobal")
LCS_TarTraj_theta = Simulink.Signal(StorageClass="ExportedGlobal")
LCS_TarTraj_kappa = Simulink.Signal(StorageClass="ExportedGlobal")
P_LCS_QP_Kappa_max = Simulink.Parameter(0.001, StorageClass="ExportedGlobal")
P_LCS_LATC_Max_Phi = Simulink.Parameter(15, StorageClass="ExportedGlobal")
P_LCS_LATC_Max_y = Simulink.Parameter(0.5, StorageClass="ExportedGlobal")
P_LCS_LATC_U_Max = Simulink.Parameter(90, StorageClass="ExportedGlobal")
P_LCS_LATC_Max_LatAcc = Simulink.Parameter(4, StorageClass="ExportedGlobal")
LCS_LATC_Vy_ms = Simulink.Signal(StorageClass="ExportedGlobal")
LCS_IN_vxvRefMs = Simulink.Signal(StorageClass="ExportedGlobal")
LCS_CurrentSteerAngOffset_deg = Simulink.Signal(StorageClass="ExportedGlobal")
P_LCS_Current_Offset_Test_SW = Simulink.Parameter(0, StorageClass="ExportedGlobal")
P_LCS_Current_Offset_Test_Value = Simulink.Parameter(0, StorageClass="ExportedGlobal")
P_LCS_LATC_SoftConstWeight = Simulink.Parameter(1, StorageClass="ExportedGlobal")
P_LCS_LATC_TarAngleLP_Time = Simulink.Parameter(0.02, StorageClass="ExportedGlobal", DataType="single")
P_LCS_LATC_MPC_SW = Simulink.Parameter(0, StorageClass="ExportedGlobal", DataType="single")
LCS_LATC_lookahead_Pt_Num = Simulink.Signal(StorageClass="ExportedGlobal")
LCS_LATC_lookahead_Distance = Simulink.Signal(StorageClass="ExportedGlobal")
P_LCS_VehicleSpd_TabX_Kph = Simulink.Parameter([0 5 10 15 20 25 30 35 40 60 80 90 100 110 120 140], StorageClass="ExportedGlobal")
P_LCS_Curvature_bp = Simulink.Parameter(single([0 0.0003 0.0005 0.00067 0.001 0.00125 0.002 0.004 0.0056 0.007 0.008 0.01 0.0125 0.017 0.025 0.05]), StorageClass="ExportedGlobal")
P_LCS_LCK_AngleSlope_Limit = Simulink.Parameter(1.4, StorageClass="ExportedGlobal", DataType="single")
LCS_LATC_FinalSteerAngle_cmd = Simulink.Signal(StorageClass="ExportedGlobal")
P_LCS_LATC_PreView_SW = Simulink.Parameter(1, StorageClass="ExportedGlobal", DataType="single")
P_LCS_LATC_Du_Max = Simulink.Parameter(20, StorageClass="ExportedGlobal")
P_LCS_Lookahead_DistanceFac = Simulink.Parameter([1 1 1 1 1 1.2 1.5 1.8 2 2 2 2 2 2 2 2], StorageClass="ExportedGlobal")
P_LCS_Lookahead_Distance = Simulink.Parameter(repmat(7, 1, 16), StorageClass="ExportedGlobal")

P_LCS_LATC_MatrixQ1_st = Simulink.Parameter([0.8 0.8 0.8 0.8 0.8 0.8 0.8 0.8 0.8 0.5 0.2 0.2 0.2 0.2 0.2 0.2
 0.8 0.8 0.8 0.8 0.8 0.8 0.8 0.8 0.8 0.5 0.2 0.2 0.2 0.2 0.2 0.2
 1.2 1.2 1.2 1.2 1.2 1.2 1.2 1.2 1.2 0.6 0.2 0.2 0.2 0.2 0.2 0.2
 1.4 1.4 1.4 1.4 1.4 1.4 1.4 1.4 1.4 0.7 0.3 0.3 0.3 0.3 0.3 0.3
 1.4 1.4 1.4 1.4 1.4 1.4 1.4 1.4 1.4 0.7 0.3 0.3 0.3 0.3 0.3 0.3
 1.4 1.4 1.4 1.4 1.4 1.4 1.4 1.4 1.4 0.7 0.3 0.3 0.3 0.3 0.3 0.3
 2 2 2 2 2 2 2 2 2 2 0.3 0.3 0.3 0.3 0.3 0.3
 2.2 2.2 2.2 2.2 2.2 2.2 2.2 2.2 2.2 2.2 0.3 0.3 0.3 0.3 0.3 0.3
 2.2 2.2 2.2 2.2 2.2 2.2 2.2 2.2 2.2 2.2 0.3 0.3 0.3 0.3 0.3 0.3
 2.2 2.2 2.2 2.2 2.2 2.2 2.2 2.2 2.2 2.2 0.3 0.3 0.3 0.3 0.3 0.3
 2.2 2.2 2.2 2.2 2.2 2.2 2.2 2.2 2.2 2.2 0.3 0.3 0.3 0.3 0.3 0.3
 2.2 2.2 2.2 2.2 2.2 2.2 2.2 2.2 2.2 2.2 0.3 0.3 0.3 0.3 0.3 0.3
 2.2 2.2 2.2 2.2 2.2 2.2 2.2 2.2 2.2 2.2 0.3 0.3 0.3 0.3 0.3 0.3
 2.2 2.2 2.2 2.2 2.2 2.2 2.2 2.2 2.2 2.2 0.3 0.3 0.3 0.3 0.3 0.3
 2.2 2.2 2.2 2.2 2.2 2.2 2.2 2.2 2.2 2.2 0.3 0.3 0.3 0.3 0.3 0.3
 2.2 2.2 2.2 2.2 2.2 2.2 2.2 2.2 2.2 2.2 0.3 0.3 0.3 0.3 0.3 0.3], StorageClass="ExportedGlobal")

P_LCS_LATC_MatrixQ3_st = Simulink.Parameter([20 20 20 20 20 20 20 20 20 15 5 5 5 5 5 5
 20 20 20 20 20 20 20 20 20 15 5 5 5 5 5 5
 20 20 20 20 20 20 20 20 20 15 5 5 5 5 5 5
 20 20 20 20 20 20 20 20 20 15 5 5 5 5 5 5
 20 20 20 20 20 20 20 20 20 15 5 5 5 5 5 5
 15 15 15 15 15 15 15 15 15 15 8 8 8 8 8 8
 15 15 15 15 15 15 15 15 15 15 8 8 8 8 8 8
 15 15 15 15 15 15 15 15 15 15 8 8 8 8 8 8
 15 15 15 15 15 15 15 15 15 15 8 8 8 8 8 8
 15 15 15 15 15 15 15 15 15 15 8 8 8 8 8 8
 15 15 15 15 15 15 15 15 15 15 8 8 8 8 8 8
 15 15 15 15 15 15 15 15 15 15 10 10 10 10 10 10
 15 15 15 15 15 15 15 15 15 15 10 10 10 10 10 10
 13 13 13 13 13 13 13 13 13 13 10 10 10 10 10 10
 13 13 13 13 13 13 13 13 13 13 10 10 10 10 10 10
 13 13 13 13 13 13 13 13 13 13 10 10 10 10 10 10], StorageClass="ExportedGlobal", DataType="single")

P_LCS_LATC_MatrixR_st = Simulink.Parameter([10 10 10 10 10 10 10 10 10 10 10 10 10 10 10 10
 10 10 10 10 10 10 10 10 10 10 10 10 10 10 10 10
 10 10 10 10 10 10 10 10 10 10 10 10 10 10 10 10
 10 10 10 10 10 10 10 10 10 10 9 9 9 9 9 9
 10 10 10 10 10 10 10 10 10 10 9 9 9 9 9 9
 10 10 10 10 10 10 10 10 10 10 8 8 8 8 8 8
 10 10 10 10 10 10 10 10 10 10 8 8 8 8 8 8
 15 15 15 15 15 15 15 15 15 15 7 7 7 7 7 7
 15 15 15 15 15 15 15 15 15 15 7 7 7 7 7 7
 15 15 15 15 15 15 15 15 15 15 7 7 7 7 7 7
 15 15 15 15 15 15 15 15 15 15 7 7 7 7 7 7
 15 15 15 15 15 15 15 15 15 15 7 7 7 7 7 7
 15 15 15 15 15 15 15 15 15 15 7 7 7 7 7 7
 15 15 15 15 15 15 15 15 15 15 7 7 7 7 7 7
 15 15 15 15 15 15 15 15 15 15 7 7 7 7 7 7
 15 15 15 15 15 15 15 15 15 15 7 7 7 7 7 7], StorageClass="ExportedGlobal")

P_LCS_CycleTime = Simulink.Parameter([0.4 0.4 0.4 0.4 0.4 0.4 0.4 0.4 0.4 0.5 0.5 0.5 0.5 0.5 0.5 0.5
 0.4 0.4 0.4 0.4 0.4 0.4 0.4 0.4 0.4 0.5 0.5 0.5 0.5 0.5 0.5 0.5
 0.4 0.4 0.4 0.4 0.4 0.4 0.4 0.4 0.4 0.5 0.5 0.5 0.5 0.5 0.5 0.5
 0.4 0.4 0.4 0.4 0.4 0.4 0.4 0.4 0.4 0.4 0.4 0.4 0.4 0.4 0.4 0.4
 0.4 0.4 0.4 0.4 0.4 0.4 0.4 0.4 0.4 0.4 0.4 0.4 0.4 0.4 0.4 0.4
 0.4 0.4 0.4 0.4 0.4 0.4 0.4 0.4 0.4 0.4 0.4 0.4 0.4 0.4 0.4 0.4
 0.4 0.4 0.4 0.4 0.4 0.4 0.4 0.4 0.4 0.4 0.4 0.4 0.4 0.4 0.4 0.4
 0.4 0.4 0.4 0.4 0.4 0.4 0.4 0.4 0.4 0.4 0.4 0.4 0.4 0.4 0.4 0.4
 0.4 0.4 0.4 0.4 0.4 0.4 0.4 0.4 0.4 0.4 0.4 0.4 0.4 0.4 0.4 0.4
 0.6 0.6 0.6 0.6 0.6 0.6 0.6 0.6 0.6 0.4 0.4 0.4 0.4 0.4 0.4 0.4
 0.6 0.6 0.6 0.6 0.6 0.6 0.6 0.6 0.6 0.4 0.4 0.4 0.4 0.4 0.4 0.4
 0.6 0.6 0.6 0.6 0.6 0.6 0.6 0.6 0.6 0.4 0.4 0.4 0.4 0.4 0.4 0.4
 0.6 0.6 0.6 0.6 0.6 0.6 0.6 0.6 0.6 0.4 0.4 0.4 0.4 0.4 0.4 0.4
 0.6 0.6 0.6 0.6 0.6 0.6 0.6 0.6 0.6 0.4 0.4 0.4 0.4 0.4 0.4 0.4
 0.6 0.6 0.6 0.6 0.6 0.6 0.6 0.6 0.6 0.4 0.4 0.4 0.4 0.4 0.4 0.4
 0.6 0.6 0.6 0.6 0.6 0.6 0.6 0.6 0.6 0.4 0.4 0.4 0.4 0.4 0.4 0.4], StorageClass="ExportedGlobal")

P_LCS_PLAN_VehicleSpd_TabY_Kph = Simulink.Parameter([0 5 10 15 20 25 30 35 40 60 80 90 100 110 120 140], StorageClass="ExportedGlobal")
P_LCS_PLAN_PreDisCurve_TabX_m = Simulink.Parameter(single([0 0.0003 0.0005 0.00067 0.001 0.00125 0.002 0.004 0.0056 0.007 0.008 0.01 0.0125 0.017 0.025 0.05]), StorageClass="ExportedGlobal")
P_LCS_PLAN_CurvePreview_TabX_m = Simulink.Parameter(single([0 0.0003 0.0005 0.00067 0.001 0.00125 0.002 0.004 0.0056 0.007 0.008 0.01 0.0125 0.017 0.025 0.05]), StorageClass="ExportedGlobal")
P_LCS_PLAN_PreCurMinDisFac_ratio = Simulink.Parameter(repmat(1, 1, 16), StorageClass="ExportedGlobal")
P_LCS_PLAN_VehicleSpd_TabX_kph = Simulink.Parameter([0 5 10 15 20 25 30 35 40 60 80 90 100 110 120 140], StorageClass="ExportedGlobal")
P_LCS_PLAN_MinPlanDis_m = Simulink.Parameter(repmat(10, 1, 16), StorageClass="ExportedGlobal")
P_LCS_PLAN_LCKIEAyDtLimit_Tab_ms3 = Simulink.Parameter(repmat(1, 16, 16), StorageClass="SimulinkGlobal")
P_LCS_PLAN_LCNormalAyDtLimit_Tab_ms3 = Simulink.Parameter(repmat(1, 16, 16), StorageClass="ExportedGlobal")
P_LCS_PLAN_LKAAyDtLimit_Tab_ms3 = Simulink.Parameter(repmat(1, 16, 16), StorageClass="ExportedGlobal")
P_LCS_PLAN_ELKAyDtLimit_Tab_ms3 = Simulink.Parameter(repmat(1, 16, 16), StorageClass="ExportedGlobal")
P_LCS_PLAN_ESSAyDtLimit_Tab_ms3 = Simulink.Parameter(repmat(1, 16, 16), StorageClass="ExportedGlobal")
P_LCS_PLAN_LCEcoAyDtLimit_Tab_ms3 = Simulink.Parameter(repmat(1, 16, 16), StorageClass="ExportedGlobal")
P_LCS_PLAN_LCSportAyDtLimit_Tab_ms3 = Simulink.Parameter(repmat(1, 16, 16), StorageClass="ExportedGlobal")
P_LCS_PLAN_LCCancleAyDtLimit_Tab_ms3 = Simulink.Parameter(repmat(1, 16, 16), StorageClass="ExportedGlobal")
LCS_PLAN_AyDtLimit = Simulink.Signal(StorageClass="ExportedGlobal")
LCS_PLAN_PreviewCurve = Simulink.Signal(StorageClass="ExportedGlobal")
P_LCS_PLAN_CurvePreViewFilterTime_s = Simulink.Parameter(0.1, StorageClass="ExportedGlobal")
P_LCS_PLAN_CurvePreView_s = Simulink.Parameter(0.3, StorageClass="ExportedGlobal")
P_LCS_PLAN_StateActiv_AyDtLimit_ms3 = Simulink.Parameter(repmat(0.5, 5, 15), StorageClass="ExportedGlobal")
LCS_NumTraj = Simulink.Signal(StorageClass="ExportedGlobal")
LCS_TrajPt = Simulink.Signal(StorageClass="ExportedGlobal")
P_LCS_PLAN_LCKAyDtLimit_Tab_ms3 = Simulink.Parameter(repmat(1.5, 16, 16), StorageClass="ExportedGlobal")