% Simulink data dictionary LCS_v05.sldd

LCS_Debug_BUS = Simulink.Bus()
  LCS_PID_torqP: single
  LCS_PID_torqD: single
  ErrDt: single
  LCS_ControlAngleError: single
  LCS_TarSteerAngle_deg: single
  LCS_TarSteerAngleEnd: single
  LCS_CurSteerAngle_deg: single

LATC_L3_BUS = Simulink.Bus()
  HWP_AngCmdReqVal: single, Min=-780, Max=780
  HWP_AngCmdReqValVld: boolean, Min=0, Max=1
  HWP_ReqCtrlEPS: boolean, Min=0, Max=1
  HWP_ReqCtrlEPSVld: boolean, Min=0, Max=1
  HWP_WorkReq: uint8, Min=0, Max=7
  HWP_WorkReqVld: boolean, Min=0, Max=1
  HWP_FuncTrqCmdReqFlag: uint8, Min=0, Max=7
  HWP_TrqOvlCmdReqValue: single, Min=-10.23, Max=10.24

P_LCS_DeltaEps_SpdBp = Simulink.Parameter(single([0 5 10 15 20 25 30 35 40 60 80 90 100 110 120 140]), StorageClass="ExportedGlobal")
P_LCS_AngleSlopeNormal = Simulink.Parameter(0.4, StorageClass="ExportedGlobal", DataType="single")
P_LCS_preDis_spd = Simulink.Parameter(single([0 5 10 15 20 25 30 35 40 60 80 90 100 110 120 140]), StorageClass="ExportedGlobal")
P_LCS_LCcancel_detaA0 = Simulink.Parameter(1.5, StorageClass="ExportedGlobal", DataType="single")
P_LCS_SteerAngleOffset_ALG_Switch = Simulink.Parameter(1, StorageClass="ExportedGlobal", DataType="uint8")
P_LCS_SteerAngle_Deviation = Simulink.Parameter(2.2, StorageClass="ExportedGlobal", DataType="single")
P_LCS_AngleFilterTime = Simulink.Parameter(0.1, StorageClass="ExportedGlobal", DataType="single")
LCS_MaxHeadingAngle = Simulink.Signal(StorageClass="ExportedGlobal")
LCS_preDis = Simulink.Signal(StorageClass="ExportedGlobal")
LCS_Q = Simulink.Signal(StorageClass="ExportedGlobal")
LCS_TarSteerAngle_deg = Simulink.Signal(StorageClass="ExportedGlobal")
LCS_TarSteerAngleSlope = Simulink.Signal(StorageClass="ExportedGlobal")
LCS_Counter = Simulink.Signal(StorageClass="ExportedGlobal", DataType="uint8")
LCS_IN_vxvRefMs = Simulink.Signal(StorageClass="ExportedGlobal")
LCS_IN_axvRefMs2 = Simulink.Signal(StorageClass="ExportedGlobal")
LCS_IN_ayvRefMs2 = Simulink.Signal(StorageClass="ExportedGlobal")
LCS_IN_kapTraj = Simulink.Signal(StorageClass="ExportedGlobal")
LCS_IN_alpSideSlipAngle = Simulink.Signal(StorageClass="ExportedGlobal")
LCS_IN_psiDtOpt = Simulink.Signal(StorageClass="ExportedGlobal")
LCS_IN_SteerAngOffset_deg = Simulink.Signal(StorageClass="ExportedGlobal")
LCS_IN_EPS_DrvInpTrqVal = Simulink.Signal(StorageClass="ExportedGlobal")
LCS_IN_EPS_LKATorqOvrlDlvd = Simulink.Signal(StorageClass="ExportedGlobal")
LCS_IN_EPS_LKATorqOvrlDlvdVld = Simulink.Signal(StorageClass="ExportedGlobal")
LCS_IN_SteerWheelSpd = Simulink.Signal(StorageClass="ExportedGlobal")
LCS_IN_SteerWheelAng = Simulink.Signal(StorageClass="ExportedGlobal")
LCS_IN_SteerWheelSpdSign = Simulink.Signal(StorageClass="ExportedGlobal")
LCS_IN_SteerWheelAngleSign = Simulink.Signal(StorageClass="ExportedGlobal")
LCS_MPC_TarAngle1 = Simulink.Signal(StorageClass="ExportedGlobal")
LCS_CurSteerAngleAddOffset_deg = Simulink.Signal(StorageClass="ExportedGlobal")
LCS_SteerAngleSpd_degs = Simulink.Signal(StorageClass="ExportedGlobal")
LCS_DisplaySpd_kph = Simulink.Signal(StorageClass="ExportedGlobal")
LCS_TarSteerAngleEnd = Simulink.Signal(StorageClass="ExportedGlobal")
LCS_TarSteerAngle = Simulink.Signal(StorageClass="ExportedGlobal")
LCS_IN_desLaneA0 = Simulink.Signal(StorageClass="ExportedGlobal")
LCS_IN_desLaneA2 = Simulink.Signal(StorageClass="ExportedGlobal")
LCS_IN_desLaneA3 = Simulink.Signal(StorageClass="ExportedGlobal")
LCS_IN_desLaneA1 = Simulink.Signal(StorageClass="ExportedGlobal")
LCS_Predis_facNormal = Simulink.Signal(StorageClass="ExportedGlobal")
LCS_Predis_BaseDis = Simulink.Signal(StorageClass="ExportedGlobal")
LCS_AngleSlope_LCcancel = Simulink.Signal(StorageClass="ExportedGlobal")
LCS_Predis_facEmerg = Simulink.Signal(StorageClass="ExportedGlobal")
LCS_Predis_facMediu = Simulink.Signal(StorageClass="ExportedGlobal")
LCS_IN_SteerAngleSpd_degs = Simulink.Signal(StorageClass="ExportedGlobal")
LCS_AngCmdReqVal = Simulink.Signal(StorageClass="ExportedGlobal")
LCS_EPSFault = Simulink.Signal(StorageClass="ExportedGlobal")
LCS_RealHoldTime = Simulink.Signal(StorageClass="ExportedGlobal")
LCS_LooKTBHoldTime = Simulink.Signal(StorageClass="ExportedGlobal")
LCS_StateActive_AngleSlope = Simulink.Signal(StorageClass="ExportedGlobal")
LCS_TarSteerAngle_Filter = Simulink.Signal(StorageClass="ExportedGlobal", DataType="single")
LCS_IN_CurrentLaneWidth = Simulink.Signal(StorageClass="ExportedGlobal")
LCS_TarSteerAngleCalc_Num = Simulink.Signal(StorageClass="ExportedGlobal")
LCS_AngleSlope_Flg = Simulink.Signal(StorageClass="ExportedGlobal")
LCS_AngleSlope_Cnt = Simulink.Signal(StorageClass="ExportedGlobal")
LCS_OffSetUpdate_Flg = Simulink.Signal(StorageClass="ExportedGlobal")
LCS_CurrentSteerAngleOffset_deg = Simulink.Signal(StorageClass="ExportedGlobal")
LCS_IN_desLaneValid = Simulink.Signal(StorageClass="ExportedGlobal")
P_LCS_preDis_Nomal = Simulink.Parameter([8 9 10 11 12 13 14 15 17 22 28 31 35 38 42 49], StorageClass="ExportedGlobal", DataType="single")
LCS_LCType = Simulink.Signal(StorageClass="ExportedGlobal")
LCS_IN_TarDangerLevel = Simulink.Signal(StorageClass="ExportedGlobal")
LCS_State_AngleSlope = Simulink.Signal(StorageClass="ExportedGlobal")
LCS_AngleSlope_HoldTime = Simulink.Signal(StorageClass="ExportedGlobal", DataType="LCS_AngleSlope_HoldTime")
LCS_TarDangerLevelProc = Simulink.Signal(StorageClass="ExportedGlobal")
LCS_IsOverRide = Simulink.Signal(StorageClass="ExportedGlobal")
LCS_Torq_OUT = Simulink.Signal(StorageClass="ExportedGlobal")
LCS_DangerLevelisNotESS = Simulink.Signal(StorageClass="ExportedGlobal")
LCS_ESS_TarTorq = Simulink.Signal(StorageClass="ExportedGlobal")
LCS_ESS_TarAngle = Simulink.Signal(StorageClass="ExportedGlobal")
LCS_ControlAngleError = Simulink.Signal(StorageClass="ExportedGlobal")
LCS_TorqFFPID_OUT = Simulink.Signal(StorageClass="ExportedGlobal")
LCS_Torq_PID = Simulink.Signal(StorageClass="ExportedGlobal")
LCS_Torq_FFAdd = Simulink.Signal(StorageClass="ExportedGlobal")
LCS_AngleErrorReversTorq = Simulink.Signal(StorageClass="ExportedGlobal")
LCS_Torq_FF = Simulink.Signal(StorageClass="ExportedGlobal")
LCS_Torq_P = Simulink.Signal(StorageClass="ExportedGlobal")
LCS_Torq_D = Simulink.Signal(StorageClass="ExportedGlobal")
LCS_Torq_I = Simulink.Signal(StorageClass="ExportedGlobal")
LCS_HoldTime = Simulink.Signal(StorageClass="ExportedGlobal")
LCS_EqA0 = Simulink.Signal(StorageClass="ExportedGlobal")
P_LCS_PID_DisableKi_CurveVal = Simulink.Parameter(0.003, StorageClass="ExportedGlobal", DataType="single")
P_LCS_AngleErrorReversTorq_LC_VehSpdVal = Simulink.Parameter([0 0 0 0 0 0 0 0.1 0.05 0.06 0.15 0.2 0.15 0.15 0.4 0.4], StorageClass="ExportedGlobal", DataType="single")
P_LCS_AngleErrorReversTorq_LC_TarAngleFac = Simulink.Parameter(single([0 0.5 0.8 1 1 1 1 1]), StorageClass="ExportedGlobal")
P_LCS_PID_DrvTorqFacVal = Simulink.Parameter([1 1 1 1], StorageClass="ExportedGlobal", DataType="single")
P_LCS_PID_DrvTorqFacBp = Simulink.Parameter([0.7 1 1.5 2], StorageClass="ExportedGlobal", DataType="single")
P_LCS_TarAngleFilterEnable = Simulink.Parameter(true, StorageClass="ExportedGlobal", DataType="boolean")  % TarAngle滤波使能
P_LCS_TestAngleSwitch = Simulink.Parameter(0, StorageClass="ExportedGlobal", DataType="single")
P_LCS_TestTarAngle = Simulink.Parameter(0, StorageClass="ExportedGlobal", DataType="single")
P_LCS_TarAngleFilterFC_spdVal = Simulink.Parameter([0.6 0.6 0.6 1 2 3 3 3], StorageClass="ExportedGlobal", DataType="single")
P_LCS_CurAngleFiltEnable = Simulink.Parameter(true, StorageClass="ExportedGlobal", DataType="boolean")
P_LCS_CurAngleFilterFC = Simulink.Parameter(2, StorageClass="ExportedGlobal", DataType="single")
LCS_SteerAngleFilter_deg = Simulink.Signal(StorageClass="ExportedGlobal")
LCS_SteerAngleSpdFilter_degs = Simulink.Signal(StorageClass="ExportedGlobal")
LCS_SubModel_VERSION = Simulink.Signal(StorageClass="ExportedGlobal")
LCS_SubModel_Number = Simulink.Signal(StorageClass="ExportedGlobal")
LCS_IN_CurSteerAngle_deg = Simulink.Signal(StorageClass="ExportedGlobal")
LCS_LC_NomalPredisFac = Simulink.Signal(StorageClass="ExportedGlobal")
LCS_LC_NomalPredis = Simulink.Signal(StorageClass="ExportedGlobal")
LCS_LC_EcoPredis = Simulink.Signal(StorageClass="ExportedGlobal")
LCS_LC_EcoPredisFac = Simulink.Signal(StorageClass="ExportedGlobal")
LCS_LC_SportPredis = Simulink.Signal(StorageClass="ExportedGlobal")
LCS_LC_SportPredisFac = Simulink.Signal(StorageClass="ExportedGlobal")
LCS_LCKPredis = Simulink.Signal(StorageClass="ExportedGlobal")
LCS_LCKPredisFac = Simulink.Signal(StorageClass="ExportedGlobal")
LCS_finalPredis = Simulink.Signal(StorageClass="ExportedGlobal")
LCS_IN_SteerAngleOffset_deg = Simulink.Signal(StorageClass="ExportedGlobal")
P_LCS_IN_Offset_Test_SW = Simulink.Parameter(0, StorageClass="ExportedGlobal", DataType="uint8")
LCS_LC_ELKPredisFac = Simulink.Signal(StorageClass="ExportedGlobal")
LCS_LC_ELKPredis = Simulink.Signal(StorageClass="ExportedGlobal")
LCS_LC_ESSPredis = Simulink.Signal(StorageClass="ExportedGlobal")
P_LCS_DangerLevel_ManualSW = Simulink.Parameter(0, StorageClass="ExportedGlobal", DataType="uint8")
P_LCS_DangerLevel_ManualValue = Simulink.Parameter(1, StorageClass="ExportedGlobal", DataType="uint8")
LCS_OUT_ReqEPSTrgAngle = Simulink.Signal(StorageClass="ExportedGlobal")
LCS_OUT_EpsTrqReqValue = Simulink.Signal(StorageClass="ExportedGlobal")
LCS_OUT_EpsTrqReqValueVld = Simulink.Signal(StorageClass="ExportedGlobal")
LCS_OUT_AngCmdReqValVld = Simulink.Signal(StorageClass="ExportedGlobal")
P_LCS_IN_Offset_Test_Value = Simulink.Parameter(0, StorageClass="ExportedGlobal", DataType="single")
LCS_CurSteerAngle_deg = Simulink.Signal(StorageClass="ExportedGlobal")
LCS_A2_LatAcc = Simulink.Signal(StorageClass="ExportedGlobal")
P_LCS_R3_Pretime = Simulink.Parameter(0.1, StorageClass="ExportedGlobal", DataType="single")
P_LCS_A2Switch = Simulink.Parameter(1, StorageClass="ExportedGlobal", DataType="uint8")
LCS_Predis_Curve1 = Simulink.Signal(StorageClass="ExportedGlobal")
LCS_Predis_Curve2 = Simulink.Signal(StorageClass="ExportedGlobal")
LCS_Predis_Curve3 = Simulink.Signal(StorageClass="ExportedGlobal")
LCS_Predis_Curve4 = Simulink.Signal(StorageClass="ExportedGlobal")
LCS_Predis_Curve = Simulink.Signal(StorageClass="ExportedGlobal")
LCS_LCK_Fac = Simulink.Signal(StorageClass="ExportedGlobal")
P_LCS_Trq_Switch = Simulink.Parameter(0, StorageClass="ExportedGlobal", DataType="uint8")
LCS_Trq_Switch = Simulink.Signal(StorageClass="ExportedGlobal")
P_LCS_A2_Curve_BP = Simulink.Parameter(single([0 0.0002 0.0003 0.0007 0.0013 0.0025 0.0033 0.005 0.01 0.02]), StorageClass="ExportedGlobal")
LCS_A2_LatAccFac = Simulink.Signal(StorageClass="ExportedGlobal")
LCS_LCK_CurveFac = Simulink.Signal(StorageClass="ExportedGlobal")
P_LCS_A2_Pretime = Simulink.Parameter(0.075, StorageClass="ExportedGlobal", DataType="single")
P_LCS_A2S_FliterTime = Simulink.Parameter(0.5, StorageClass="ExportedGlobal", DataType="single")
LCS_Predis_CurveFac = Simulink.Signal(StorageClass="ExportedGlobal")
LCS_LC_LCPredis = Simulink.Signal(StorageClass="ExportedGlobal")
LCS_LC_LCPredisFac = Simulink.Signal(StorageClass="ExportedGlobal")
LCS_LC_Cancel_Flg = Simulink.Signal(StorageClass="ExportedGlobal")
LCS_ReqEPSTrgAngle = Simulink.Signal(StorageClass="ExportedGlobal")
P_LCS_LatAcc2CurveSW = Simulink.Parameter(0, StorageClass="ExportedGlobal", DataType="uint8")
LCS_CurOffsetA2_Enable = Simulink.Signal(StorageClass="ExportedGlobal")
P_LCS_CurentOffset_LimitValue = Simulink.Parameter(0.001, StorageClass="ExportedGlobal", DataType="single")
P_LCS_CurOffsetA2_FliterTime = Simulink.Parameter(0.2, StorageClass="ExportedGlobal", DataType="single")
P_LCS_CurOffset_SterAngleSpd_LimitValue = Simulink.Parameter(6, StorageClass="ExportedGlobal", DataType="single")
LCS_DeltaAngle = Simulink.Signal(StorageClass="ExportedGlobal")
LCS_ESS_NotActiveFlg = Simulink.Signal(StorageClass="ExportedGlobal")
LCS_ESS_SteerWheelAngleSpdFilter = Simulink.Signal(StorageClass="ExportedGlobal")
LCS_ESS_SteerWheelAngleSpd = Simulink.Signal(StorageClass="ExportedGlobal")
LCS_ESS_TarAngle2 = Simulink.Signal(StorageClass="ExportedGlobal")
LCS_ESS_TarAngleSpdFilter = Simulink.Signal(StorageClass="ExportedGlobal")
LCS_ESS_TarAngleSpd = Simulink.Signal(StorageClass="ExportedGlobal")
P_LCS_ESS_LogicTest_Enable = Simulink.Parameter(1, StorageClass="ExportedGlobal", DataType="boolean")
P_LCS_ESS_SteerAngleFilterTime = Simulink.Parameter(0.2, StorageClass="ExportedGlobal", DataType="single")
P_LCS_ESS_TarAngleFilterTime = Simulink.Parameter(0.2, StorageClass="ExportedGlobal", DataType="single")
LCS_LC_ESSPredisFac = Simulink.Signal(StorageClass="ExportedGlobal")
LCS_LC_AESPredisFac = Simulink.Signal(StorageClass="ExportedGlobal")
LCS_LC_AESPredis = Simulink.Signal()
LCS_ESS_NotActiveFlg1 = Simulink.Signal(StorageClass="ExportedGlobal")
LCS_ESS_NotActiveFlg2 = Simulink.Signal(StorageClass="ExportedGlobal")
LCS_ESS_NotActiveFlg3 = Simulink.Signal(StorageClass="ExportedGlobal")
LCS_ESS_NotActiveDelayFlg = Simulink.Signal(StorageClass="ExportedGlobal")
LCS_ESS_NotActiveFlgOriginal = Simulink.Signal(StorageClass="ExportedGlobal")
LCS_IN_TarDangerlLevel = Simulink.Signal(StorageClass="ExportedGlobal")
LCS_IN_EPS_FailSts = Simulink.Signal(StorageClass="ExportedGlobal")
LCS_IN_EPS_LKAAngDlvdSts = Simulink.Signal(StorageClass="ExportedGlobal")
LCS_IN_EPS_LKATrqOvlDlvdSts = Simulink.Signal(StorageClass="ExportedGlobal")
LCS_EPS_FailSts1 = Simulink.Signal(StorageClass="ExportedGlobal")
LCS_EPS_FailSts2 = Simulink.Signal(StorageClass="ExportedGlobal")
LCS_LC_Complete_PreDisFac = Simulink.Signal(StorageClass="ExportedGlobal")
P_LCS_CurOffsetA2_Enable = Simulink.Parameter(0, StorageClass="ExportedGlobal", DataType="boolean")
LCS_LATC_Effect = Simulink.Signal(StorageClass="ExportedGlobal")
P_LCS_PID_A2_BP = Simulink.Parameter(single([0 0.0002 0.0003 0.0007 0.0013 0.0025 0.0033 0.005 0.01 0.02]), StorageClass="ExportedGlobal")
LCS_PID_TarDangerLevel = Simulink.Signal(StorageClass="ExportedGlobal")
LCS_PID_A2_Curve = Simulink.Signal(StorageClass="ExportedGlobal")
LCS_PID_A0_SW = Simulink.Signal(StorageClass="ExportedGlobal")
LCS_PID_A2_SW = Simulink.Signal(StorageClass="ExportedGlobal")
P_LCS_tarAngleSpdFilterFC = AUTOSAR4.Parameter(2, SwCalibrationAccess="ReadWrite", StorageClass="ExportedGlobal", DataType="single")
P_LCS_TorqueGainFilterTime = AUTOSAR4.Parameter(0.1, SwCalibrationAccess="ReadWrite", StorageClass="ExportedGlobal", DataType="single")

P_LCS_StateActiv_AngleSlope = Simulink.Parameter([0.01 0.01 0.1 0.2 0.4 0.8 1 1.2 1.4 1.6 1.8 2 2 2 2
 0.15 0.15 0.2 0.4 0.6 0.8 1 1.2 1.4 1.6 1.8 2 2 2 2
 0.1 0.15 0.2 0.25 0.28 0.8 1 1.2 1.4 1.6 1.8 2 2 2 2
 0.5 0.7 1 1 1 1 1 1.2 1.4 1.6 1.8 2 2 2 2
 1.6 1.6 1.6 1.6 1.6 1.6 1.6 1.6 1.6 1.6 1.6 1.6 2 2 2
 1.6 1.6 1.6 1.6 1.6 1.6 1.6 1.6 1.6 1.6 1.6 1.6 2 2 2], StorageClass="ExportedGlobal", DataType="single")

P_LCS_StateComplete_AngleSlope = Simulink.Parameter(repmat(0.3, 4, 15), StorageClass="ExportedGlobal", DataType="single")
P_LCS_LC_Complete_PreDisFac = Simulink.Parameter(repmat(1, 4, 15), StorageClass="ExportedGlobal", DataType="single")

P_LCS_AngleSlope_AES_Active = Simulink.Parameter([0.4 0.4 0.4 0.4 0.4 0.4 0.4 0.4 0.4 0.4 0.4 0.4
 0.4 0.4 0.4 0.4 0.4 0.4 0.4 0.4 0.4 0.4 0.4 0.4
 0.4 0.4 0.4 0.4 0.4 0.4 0.4 0.4 0.4 0.4 0.4 0.4
 0.35 0.35 0.35 0.35 0.35 0.35 0.35 0.35 0.35 0.35 0.35 0.35
 0.35 0.35 0.35 0.35 0.35 0.35 0.35 0.35 0.35 0.35 0.35 0.35
 0.35 0.35 0.35 0.35 0.35 0.35 0.35 0.35 0.35 0.35 0.35 0.35
 0.35 0.35 0.35 0.35 0.35 0.35 0.35 0.35 0.35 0.35 0.35 0.35
 0.35 0.35 0.35 0.35 0.35 0.35 0.35 0.35 0.35 0.35 0.35 0.35
 0.35 0.35 0.35 0.35 0.35 0.35 0.35 0.35 0.35 0.35 0.35 0.35
 0.3 0.3 0.3 0.3 0.3 0.3 0.3 0.3 0.3 0.3 0.3 0.3
 0.3 0.3 0.3 0.3 0.3 0.3 0.3 0.3 0.3 0.3 0.3 0.3
 0.3 0.3 0.3 0.3 0.3 0.3 0.3 0.3 0.3 0.3 0.3 0.3
 0.3 0.3 0.3 0.3 0.3 0.3 0.3 0.3 0.3 0.3 0.3 0.3
 0.3 0.3 0.3 0.3 0.3 0.3 0.3 0.3 0.3 0.3 0.3 0.3
 0.3 0.3 0.3 0.3 0.3 0.3 0.3 0.3 0.3 0.3 0.3 0.3
 0.3 0.3 0.3 0.3 0.3 0.3 0.3 0.3 0.3 0.3 0.3 0.3
 0.3 0.3 0.3 0.3 0.3 0.3 0.3 0.3 0.3 0.3 0.3 0.3
 0.3 0.3 0.3 0.3 0.3 0.3 0.3 0.3 0.3 0.3 0.3 0.3
 0.3 0.3 0.3 0.3 0.3 0.3 0.3 0.3 0.3 0.3 0.3 0.3], StorageClass="ExportedGlobal", DataType="single")

P_LCS_A0_Limit = Simulink.Parameter(0.25, StorageClass="ExportedGlobal", DataType="single")
P_LCS_A1_Limit = Simulink.Parameter(0.002, StorageClass="ExportedGlobal", DataType="single")
P_LCS_AngleSlope_LCK_Curve_Fac = Simulink.Parameter([1 1 1 1 1.2 1.4 1.4 1.5 1.5 1.6], StorageClass="ExportedGlobal", DataType="single")
P_LCS_CurSteerAngleOffsetLimit_Up = Simulink.Parameter(10, StorageClass="ExportedGlobal", DataType="single")
P_LCS_CurSteerAngleOffsetLimit_Low = Simulink.Parameter(-10, StorageClass="ExportedGlobal", DataType="single")
P_LCS_A2_CurrentOffsetFliterTime = Simulink.Parameter(repmat(2, 1, 10), StorageClass="ExportedGlobal", DataType="single")
P_LCS_PID_A0_P_Spd_ActiveValue = Simulink.Parameter(60, StorageClass="ExportedGlobal", DataType="single")
P_LCS_PID_A2_P = Simulink.Parameter(repmat(1, 1, 10), StorageClass="ExportedGlobal", DataType="single")
P_LCS_PID_A2_P_A2_LimitValue = Simulink.Parameter(0.005, StorageClass="ExportedGlobal", DataType="single")
P_LCS_ESS_SteerAngleErr = Simulink.Parameter(repmat(30, 1, 16), StorageClass="ExportedGlobal", DataType="single")

P_LCS_preDis_ESS_Fac = Simulink.Parameter([0 0 0 0 0 0 0 0 -0.1 -0.1 -0.1 0 0 0 0 0
 0 0 0 0 0 0 0 0 -0.1 -0.1 -0.1 0 0 0 0 0
 0 0 0 0 0 0 0 0 -0.1 -0.1 -0.1 0 0 0 0 0
 0 0 0 0 0 0 0 0 -0.1 -0.1 -0.1 0 0 0 0 0
 -0.1 -0.1 -0.1 -0.1 -0.1 0.1 0.1 0.1 -0.3 -0.3 -0.3 0 0 0 0 0
 -0.1 -0.1 -0.1 -0.1 -0.1 0.1 0.1 0.1 -0.3 -0.3 -0.3 0 0 0 0 0
 -0.1 -0.1 -0.1 -0.1 -0.1 0.1 0.2 0.2 -0.3 -0.3 -0.3 0 0 0 0 0
 -0.1 -0.1 -0.1 -0.1 -0.1 0.1 0.3 0.3 -0.3 -0.3 -0.3 0 0 0 0 0
 -0.1 -0.1 -0.1 -0.1 -0.1 0.1 0.3 0.3 -0.3 -0.3 -0.3 0 0 0 0 0
 -0.1 -0.1 -0.1 -0.1 -0.1 0.1 0.3 0.3 -0.3 -0.3 -0.3 0 0 0 0 0
 0.1 0.1 0.1 0.1 0.2 0.35 0.4 0.4 -0.3 -0.3 -0.3 0 0 0 0 0
 0.1 0.1 0.1 0.1 0.2 0.35 0.4 0.4 -0.3 -0.3 -0.3 0 0 0 0 0
 0.1 0.1 0.1 0.1 0.2 0.35 0.4 0.4 -0.3 -0.3 -0.3 0 0 0 0 0
 0.2 0.2 0.2 0.2 0.35 0.35 0.4 0.4 -0.3 -0.3 -0.3 0 0 0 0 0
 0.2 0.2 0.2 0.2 0.35 0.35 0.4 0.4 -0.45 -0.45 -0.45 0 0 0 0 0
 0.2 0.2 0.2 0.2 0.35 0.35 0.4 0.4 -0.45 -0.45 -0.45 0 0 0 0 0
 0.2 0.2 0.2 0.2 0.35 0.35 0.4 0.4 -0.45 -0.45 -0.45 0 0 0 0 0
 0.2 0.2 0.2 0.2 0.35 0.35 0.4 0.4 -0.45 -0.45 -0.45 0 0 0 0 0
 0.2 0.2 0.2 0.2 0.35 0.35 0.4 0.4 -0.45 -0.45 -0.45 0 0 0 0 0], StorageClass="ExportedGlobal", DataType="single")

P_LCS_AngleSlope_ESS = Simulink.Parameter([0.4 0.4 0.4 0.4 2 2 2 2 2 2 2 2
 0.4 0.4 0.4 0.4 2 2 2 2 2 2 2 2
 0.4 0.4 0.4 0.4 2 2 2 2 2 2 2 2
 0.35 0.35 0.35 0.35 2 2 2 2 2 2 2 2
 0.35 0.35 0.35 0.35 2 2 2 2 2 2 2 2
 0.35 0.35 0.35 0.35 2 2 2 2 2 2 2 2
 0.35 0.35 0.35 0.35 2 2 2 2 2 2 2 2
 0.35 0.35 0.35 0.35 2 2 2 2 2 2 2 2
 0.35 0.35 0.35 0.35 2 2 2 2 2 2 2 2
 0.3 0.3 0.3 0.3 2 2 2 2 2 2 2 2
 0.3 0.3 0.3 0.3 2 2 2 2 2 2 2 2
 0.3 0.3 0.3 0.3 2 2 2 2 2 2 2 2
 0.3 0.3 0.3 0.3 2 2 2 2 2 2 2 2
 0.3 0.3 0.3 0.3 2 2 2 2 2 2 2 2
 0.3 0.3 0.3 0.3 2 2 2 2 2 2 2 2
 0.3 0.3 0.3 0.3 2 2 2 2 2 2 2 2
 0.3 0.3 0.3 0.3 2 2 2 2 2 2 2 2
 0.3 0.3 0.3 0.3 2 2 2 2 2 2 2 2
 0.3 0.3 0.3 0.3 2 2 2 2 2 2 2 2], StorageClass="ExportedGlobal", DataType="single")

P_LCS_AngleSlope_ESS_Add = Simulink.Parameter([1 1 1 1 1 1 1 1 1 1 1 1
 1 1 1 1 1 1 1 1 1 1 1 1
 1 1 1 1 1 1 1 1 1 1 1 1
 1 1 1 1 1 1 1 1 1 1 1 1
 2 2 2 2 7.5 7.5 7.5 7.5 7.5 7.5 7.5 7.5
 2 2 2 2 7.5 7.5 7.5 7.5 7.5 7.5 7.5 7.5
 2 2 2 2 7.5 7.5 7.5 7.5 7.5 7.5 7.5 7.5
 7 7 7 7 7.5 7.5 7.5 7.5 7.5 7.5 7.5 7.5
 7 7 7 7 7.5 7.5 7.5 7.5 7.5 7.5 7.5 7.5
 7 7 7 7 7.5 7.5 7.5 7.5 7.5 7.5 7.5 7.5
 7 7 7 7 7.5 7.5 7.5 7.5 7.5 7.5 7.5 7.5
 7 7 7 7 7.5 7.5 7.5 7.5 7.5 7.5 7.5 7.5
 7 7 7 7 7.5 7.5 7.5 7.5 7.5 7.5 7.5 7.5
 7 7 7 7 7.5 7.5 7.5 7.5 7.5 7.5 7.5 7.5
 7 7 7 7 7.5 7.5 7.5 7.5 7.5 7.5 7.5 7.5
 7 7 7 7 8 8 8 8 8 8 8 8
 7 7 7 7 8 8 8 8 8 8 8 8
 7 7 7 7 8 8 8 8 8 8 8 8
 7 7 7 7 8 8 8 8 8 8 8 8], StorageClass="ExportedGlobal", DataType="single")

P_LCS_preDis_LCK_Fac = Simulink.Parameter(repmat(0, 19, 16), StorageClass="ExportedGlobal", DataType="single")
P_LCS_preDis_LCK_A2Curve_Fac2 = Simulink.Parameter([1 1 1 0.85 0.75 0.6 0.5 0.3 0.3 0.25], StorageClass="ExportedGlobal", DataType="single")
P_LCS_LCcancel_Delaytime = Simulink.Parameter(200, StorageClass="ExportedGlobal", DataType="single")
P_LCS_LCcancel_A0_LimitValue = Simulink.Parameter(0.8, StorageClass="ExportedGlobal", DataType="single")
P_LCS_LCcancel_A1_LimitValue = Simulink.Parameter(0.5, StorageClass="ExportedGlobal", DataType="single")

P_LCS_preDis_LC_Fac = Simulink.Parameter([0 0 0 0 0 0 0 0 0 0 0 0 0 0 0 0
 0 0 0 0 0 0 0 0 0 -0.5 -0.4 -0.25 -0.2 -0.15 -0.1 -0.1
 0 0 0 0 0 0 0 0 0 -0.55 -0.45 -0.3 -0.25 -0.2 -0.15 -0.15
 0 0 0 0 0 0 0 0 0 -0.6 -0.5 -0.35 -0.3 -0.25 -0.2 -0.2
 -0.1 -0.1 -0.1 -0.1 -0.1 0.1 0.1 0.1 0.1 -0.6 -0.5 -0.35 -0.3 -0.25 -0.2 -0.2
 -0.1 -0.1 -0.1 -0.1 -0.1 0.1 0.1 0.1 0.1 -0.6 -0.5 -0.35 -0.3 -0.25 -0.2 -0.2
 -0.1 -0.1 -0.1 -0.1 -0.1 0.1 0.2 0.2 0.2 -0.6 -0.5 -0.35 -0.3 -0.25 -0.2 -0.2
 -0.1 -0.1 -0.1 -0.1 -0.1 0.1 0.3 0.3 0.3 -0.6 -0.5 -0.35 -0.3 -0.25 -0.2 -0.2
 -0.1 -0.1 -0.1 -0.1 -0.1 0.1 0.3 0.3 0.3 -0.6 -0.5 -0.35 -0.3 -0.25 -0.2 -0.2
 -0.1 -0.1 -0.1 -0.1 -0.1 0.1 0.3 0.3 0.3 -0.6 -0.5 -0.35 -0.3 -0.25 -0.2 -0.2
 0.1 0.1 0.1 0.1 0.2 0.35 0.4 0.4 0.4 -0.6 -0.5 -0.35 -0.3 -0.25 -0.2 -0.2
 0.1 0.1 0.1 0.1 0.2 0.35 0.4 0.4 0.4 -0.6 -0.5 -0.35 -0.3 -0.25 -0.2 -0.2
 0.1 0.1 0.1 0.1 0.2 0.35 0.4 0.4 0.4 -0.6 -0.5 -0.35 -0.3 -0.25 -0.2 -0.2
 0.2 0.2 0.2 0.2 0.35 0.35 0.4 0.4 0.4 -0.6 -0.5 -0.35 -0.3 -0.25 -0.2 -0.2
 0.2 0.2 0.2 0.2 0.35 0.35 0.4 0.4 0.4 -0.6 -0.5 -0.35 -0.3 -0.25 -0.2 -0.2
 0.2 0.2 0.2 0.2 0.35 0.35 0.4 0.4 0.4 -0.6 -0.5 -0.35 -0.3 -0.25 -0.2 -0.2
 0.2 0.2 0.2 0.2 0.35 0.35 0.4 0.4 0.4 -0.6 -0.5 -0.35 -0.3 -0.25 -0.2 -0.2
 0.2 0.2 0.2 0.2 0.35 0.35 0.4 0.4 0.4 -0.6 -0.5 -0.35 -0.3 -0.25 -0.2 -0.2
 0.2 0.2 0.2 0.2 0.35 0.35 0.4 0.4 0.4 -0.6 -0.5 -0.35 -0.3 -0.25 -0.2 -0.2], DataType="single")

P_LCS_AngleSlope_LC_Cancel = Simulink.Parameter([0.4 0.4 0.4 0.4 0.6 0.9 0.7 0.6 0.5 0.5 0.5 0.5
 0.4 0.4 0.4 0.4 0.6 0.9 0.7 0.6 0.5 0.5 0.5 0.5
 0.4 0.4 0.4 0.4 0.6 0.9 0.7 0.6 0.5 0.5 0.5 0.5
 0.4 0.4 0.4 0.4 0.6 0.9 0.7 0.6 0.5 0.5 0.5 0.5
 0.4 0.4 0.4 0.4 0.6 0.9 0.7 0.6 0.5 0.5 0.5 0.5
 0.4 0.4 0.4 0.4 0.6 0.9 0.7 0.6 0.5 0.5 0.5 0.5
 0.4 0.4 0.4 0.4 0.6 0.9 0.7 0.6 0.5 0.5 0.5 0.5
 0.4 0.4 0.4 0.4 0.6 0.9 0.7 0.6 0.5 0.5 0.5 0.5
 0.4 0.4 0.4 0.4 0.6 0.9 0.7 0.6 0.5 0.5 0.5 0.5
 0.4 0.4 0.4 0.4 0.6 0.9 0.7 0.6 0.5 0.5 0.5 0.5
 0.4 0.4 0.4 0.4 0.6 0.9 0.7 0.6 0.5 0.5 0.5 0.5
 0.4 0.4 0.4 0.4 0.6 0.9 0.7 0.6 0.5 0.5 0.5 0.5
 0.4 0.4 0.4 0.4 0.6 0.9 0.7 0.6 0.5 0.5 0.5 0.5
 0.4 0.4 0.4 0.4 0.6 0.9 0.7 0.6 0.5 0.5 0.5 0.5
 0.4 0.4 0.4 0.4 0.6 0.9 0.7 0.6 0.5 0.5 0.5 0.5
 0.4 0.4 0.4 0.4 0.6 0.9 0.7 0.6 0.5 0.5 0.5 0.5
 0.4 0.4 0.4 0.4 0.6 0.9 0.7 0.6 0.5 0.5 0.5 0.5
 0.4 0.4 0.4 0.4 0.6 0.9 0.7 0.6 0.5 0.5 0.5 0.5
 0.4 0.4 0.4 0.4 0.6 0.9 0.7 0.6 0.5 0.5 0.5 0.5], StorageClass="ExportedGlobal", DataType="single")

P_LCS_FF_A0_Speed_Factor = Simulink.Parameter(repmat(1, 1, 16), StorageClass="ExportedGlobal", DataType="single")
P_LCS_FF_A0_Torq = Simulink.Parameter(repmat(0, 1, 16), StorageClass="ExportedGlobal", DataType="single")
P_LCS_PID_A0_BP = Simulink.Parameter([0 0.1 0.2 0.4 0.6 0.8 1 1.2 1.4 1.6 1.8 2 2.4 2.8 3.2 3.5], StorageClass="ExportedGlobal", DataType="single")
P_LCS_PID_A0_FF_SW = Simulink.Parameter(0, StorageClass="ExportedGlobal", DataType="single")
P_LCS_PID_A0_P = Simulink.Parameter(repmat(1, 1, 16), StorageClass="ExportedGlobal", DataType="single")
P_LCS_AngErrReversSign_SourceSW = Simulink.Parameter(1, StorageClass="ExportedGlobal", DataType="single")
P_LCS_CurOffset_VehicleSpd_LimitValue = Simulink.Parameter(7, StorageClass="ExportedGlobal", DataType="single")
P_LCS_EPSNotActiveSpdValue = Simulink.Parameter(3, StorageClass="ExportedGlobal", DataType="single")
P_LCS_CurrentOffset_FliterTime = Simulink.Parameter(0.02, StorageClass="ExportedGlobal", DataType="single")

P_LCS_preDis_ELK_Fac = Simulink.Parameter([0 0 0 0 0 0 0 0 0 0 0 0 0 0 0 0
 0 0 0 0 0 0 0 0 0 -0.5 -0.4 -0.25 -0.2 -0.15 -0.1 -0.1
 0 0 0 0 0 0 0 0 0 -0.55 -0.45 -0.3 -0.25 -0.2 -0.15 -0.15
 0 0 0 0 0 0 0 0 0 -0.6 -0.5 -0.35 -0.3 -0.25 -0.2 -0.2
 -0.1 -0.1 -0.1 -0.1 -0.1 0.1 0.1 0.1 0.1 -0.6 -0.5 -0.35 -0.3 -0.25 -0.2 -0.2
 -0.1 -0.1 -0.1 -0.1 -0.1 0.1 0.1 0.1 0.1 -0.6 -0.5 -0.35 -0.3 -0.25 -0.2 -0.2
 -0.1 -0.1 -0.1 -0.1 -0.1 0.1 0.2 0.2 0.2 -0.6 -0.5 -0.35 -0.3 -0.25 -0.2 -0.2
 -0.1 -0.1 -0.1 -0.1 -0.1 0.1 0.3 0.3 0.3 -0.6 -0.5 -0.35 -0.3 -0.25 -0.2 -0.2
 -0.1 -0.1 -0.1 -0.1 -0.1 0.1 0.3 0.3 0.3 -0.6 -0.5 -0.35 -0.3 -0.25 -0.2 -0.2
 -0.1 -0.1 -0.1 -0.1 -0.1 0.1 0.3 0.3 0.3 -0.6 -0.5 -0.35 -0.3 -0.25 -0.2 -0.2
 0.1 0.1 0.1 0.1 0.2 0.35 0.4 0.4 0.4 -0.6 -0.5 -0.35 -0.3 -0.25 -0.2 -0.2
 0.1 0.1 0.1 0.1 0.2 0.35 0.4 0.4 0.4 -0.6 -0.5 -0.35 -0.3 -0.25 -0.2 -0.2
 0.1 0.1 0.1 0.1 0.2 0.35 0.4 0.4 0.4 -0.6 -0.5 -0.35 -0.3 -0.25 -0.2 -0.2
 0.2 0.2 0.2 0.2 0.35 0.35 0.4 0.4 0.4 -0.6 -0.5 -0.35 -0.3 -0.25 -0.2 -0.2
 0.2 0.2 0.2 0.2 0.35 0.35 0.4 0.4 0.4 -0.6 -0.5 -0.35 -0.3 -0.25 -0.2 -0.2
 0.2 0.2 0.2 0.2 0.35 0.35 0.4 0.4 0.4 -0.6 -0.5 -0.35 -0.3 -0.25 -0.2 -0.2
 0.2 0.2 0.2 0.2 0.35 0.35 0.4 0.4 0.4 -0.6 -0.5 -0.35 -0.3 -0.25 -0.2 -0.2
 0.2 0.2 0.2 0.2 0.35 0.35 0.4 0.4 0.4 -0.6 -0.5 -0.35 -0.3 -0.25 -0.2 -0.2
 0.2 0.2 0.2 0.2 0.35 0.35 0.4 0.4 0.4 -0.6 -0.5 -0.35 -0.3 -0.25 -0.2 -0.2], StorageClass="ExportedGlobal", DataType="single")

P_LCS_AngleSlope_ELK = Simulink.Parameter([0.4 0.4 0.4 0.4 0.6 0.9 0.7 0.6 0.5 0.5 0.5 0.5
 0.4 0.4 0.4 0.4 0.6 0.9 0.7 0.6 0.5 0.5 0.5 0.5
 0.4 0.4 0.4 0.4 0.6 0.9 0.7 0.6 0.5 0.5 0.5 0.5
 0.4 0.4 0.4 0.4 0.6 0.9 0.7 0.6 0.5 0.5 0.5 0.5
 0.4 0.4 0.4 0.4 0.6 0.9 0.7 0.6 0.5 0.5 0.5 0.5
 0.4 0.4 0.4 0.4 0.6 0.9 0.7 0.6 0.5 0.5 0.5 0.5
 0.4 0.4 0.4 0.4 0.6 0.9 0.7 0.6 0.5 0.5 0.5 0.5
 0.4 0.4 0.4 0.4 0.6 0.9 0.7 0.6 0.5 0.5 0.5 0.5
 0.4 0.4 0.4 0.4 0.6 0.9 0.7 0.6 0.5 0.5 0.5 0.5
 0.4 0.4 0.4 0.4 0.6 0.9 0.7 0.6 0.5 0.5 0.5 0.5
 0.4 0.4 0.4 0.4 0.6 0.9 0.7 0.6 0.5 0.5 0.5 0.5
 0.4 0.4 0.4 0.4 0.6 0.9 0.7 0.6 0.5 0.5 0.5 0.5
 0.4 0.4 0.4 0.4 0.6 0.9 0.7 0.6 0.5 0.5 0.5 0.5
 0.4 0.4 0.4 0.4 0.6 0.9 0.7 0.6 0.5 0.5 0.5 0.5
 0.4 0.4 0.4 0.4 0.6 0.9 0.7 0.6 0.5 0.5 0.5 0.5
 0.4 0.4 0.4 0.4 0.6 0.9 0.7 0.6 0.5 0.5 0.5 0.5
 0.4 0.4 0.4 0.4 0.6 0.9 0.7 0.6 0.5 0.5 0.5 0.5
 0.4 0.4 0.4 0.4 0.6 0.9 0.7 0.6 0.5 0.5 0.5 0.5
 0.4 0.4 0.4 0.4 0.6 0.9 0.7 0.6 0.5 0.5 0.5 0.5], StorageClass="ExportedGlobal", DataType="single")

P_LCS_ESS_preDis_Nomal = Simulink.Parameter([8 9 10 10 11 11 11 11 11 12 15 18 22 24 27 33], StorageClass="ExportedGlobal", DataType="single")
P_LCS_PID_AngErrFacVal_P = Simulink.Parameter(repmat(1, 1, 5), StorageClass="ExportedGlobal", DataType="single")
P_LCS_PID_AngErrFacBp_P = Simulink.Parameter([0 2 4 6 12], StorageClass="ExportedGlobal", DataType="single")
P_LCS_preDis_LCK_A2Curve_Fac = Simulink.Parameter([1 0.9 0.7 0.5 0.3], StorageClass="ExportedGlobal", DataType="single")
P_LCS_ESS_AngleSlope_Limit = Simulink.Parameter(2.9, StorageClass="ExportedGlobal", DataType="single")
P_LCS_ESS_Test_SW = Simulink.Parameter(0, StorageClass="ExportedGlobal", DataType="single")
P_LCS_ESSAngleSW2 = Simulink.Parameter(0, StorageClass="ExportedGlobal", DataType="single")

P_LCS_preDis_AES_Fac = Simulink.Parameter([0 0 0 0 0 0 0 0 -0.5 -0.5 -0.4 -0.4 -0.4 -0.4 -0.4 -0.4
 0 0 0 0 0 0 0 0 -0.5 -0.5 -0.4 -0.4 -0.4 -0.4 -0.4 -0.4
 0 0 0 0 0 0 0 0 -0.5 -0.5 -0.4 -0.4 -0.4 -0.4 -0.4 -0.4
 0 0 0 0 0 0 0 0 -0.48 -0.48 -0.38 -0.38 -0.35 -0.35 -0.35 -0.35
 -0.1 -0.1 -0.1 -0.1 -0.1 0.1 0.1 0.1 -0.48 -0.48 -0.38 -0.38 -0.35 -0.35 -0.35 -0.35
 -0.1 -0.1 -0.1 -0.1 -0.1 0.1 0.1 0.1 -0.48 -0.48 -0.38 -0.38 -0.35 -0.35 -0.35 -0.35
 -0.1 -0.1 -0.1 -0.1 -0.1 0.1 0.2 0.2 -0.48 -0.48 -0.38 -0.38 -0.35 -0.35 -0.35 -0.35
 -0.1 -0.1 -0.1 -0.1 -0.1 0.1 0.3 0.3 -0.45 -0.45 -0.35 -0.35 -0.35 -0.35 -0.35 -0.35
 -0.1 -0.1 -0.1 -0.1 -0.1 0.1 0.3 0.3 -0.38 -0.38 -0.35 -0.35 -0.35 -0.35 -0.35 -0.35
 -0.1 -0.1 -0.1 -0.1 -0.1 0.1 0.3 0.3 -0.32 -0.32 -0.32 -0.32 -0.32 -0.32 -0.32 -0.32
 0.1 0.1 0.1 0.1 0.2 0.35 0.4 0.4 -0.3 -0.3 -0.3 -0.3 -0.3 -0.3 -0.3 -0.3
 0.1 0.1 0.1 0.1 0.2 0.35 0.4 0.4 -0.28 -0.28 -0.28 -0.28 -0.28 -0.28 -0.28 -0.28
 0.1 0.1 0.1 0.1 0.2 0.35 0.4 0.4 -0.25 -0.25 -0.25 -0.25 -0.25 -0.25 -0.25 -0.25
 0.2 0.2 0.2 0.2 0.35 0.35 0.4 0.4 -0.23 -0.23 -0.23 -0.23 -0.23 -0.23 -0.23 -0.23
 0.2 0.2 0.2 0.2 0.35 0.35 0.4 0.4 -0.2 -0.2 -0.2 -0.2 -0.2 -0.2 -0.2 -0.2
 0.2 0.2 0.2 0.2 0.35 0.35 0.4 0.4 -0.15 -0.15 -0.15 -0.15 -0.15 -0.15 -0.15 -0.15
 0.2 0.2 0.2 0.2 0.35 0.35 0.4 0.4 -0.1 -0.1 -0.1 -0.1 -0.1 -0.1 -0.1 -0.1
 0.2 0.2 0.2 0.2 0.35 0.35 0.4 0.4 0 0 0 0 0 0 0 0
 0.2 0.2 0.2 0.2 0.35 0.35 0.4 0.4 0 0 0 0 0 0 0 0], StorageClass="ExportedGlobal", DataType="single")

P_LCS_ESSOverrideTime1 = Simulink.Parameter(0.06, StorageClass="ExportedGlobal", DataType="single")
P_LCS_ESSOverrideTime3 = Simulink.Parameter(0.06, StorageClass="ExportedGlobal", DataType="single")
P_LCS_ESSOverrideValue2 = Simulink.Parameter(20, StorageClass="ExportedGlobal", DataType="single")
P_LCS_ESSOverrideValue1 = Simulink.Parameter(20, StorageClass="ExportedGlobal", DataType="single")
P_LCS_ESSOverrideTime2 = Simulink.Parameter(0.06, StorageClass="ExportedGlobal", DataType="single")
P_LCS_ESS_NotActiveFlgDelayTimeSW = Simulink.Parameter(0, StorageClass="ExportedGlobal", DataType="single")
P_LCS_ESS_NotActiveFlgDelayTime = Simulink.Parameter(0, StorageClass="ExportedGlobal", DataType="single")
P_LCS_ESSAngSlope_SW = Simulink.Parameter(0, StorageClass="ExportedGlobal", DataType="single")
P_LCS_FFW_Torq_AngleBp = Simulink.Parameter([-100 -80 -60 -55 -50 -45 -40 -35 -30 -25 -20 -15 -12 -10 -8 -6 -5 -4 -2 0 2 4 5 6 8 10 12 15 20 25 30 35 40 45 50 55 60 80 100], StorageClass="ExportedGlobal", DataType="single")
P_LCS_FFW_Torq_SpdBp = Simulink.Parameter([0 10 30 50 70 90 110 120], StorageClass="ExportedGlobal", DataType="single")
P_LCS_AngleErrorReversTorq_LC_VehSpdBp = Simulink.Parameter([0 5 10 15 20 25 30 35 40 60 70 80 90 100 120 140], StorageClass="ExportedGlobal", DataType="single")
P_LCS_AngleErrorReversTorq_LC_TarAngleBp = Simulink.Parameter([0 2 4 6 8 10 15 20], StorageClass="ExportedGlobal", DataType="single")
P_LCS_TarAngleAddOffset_enable = Simulink.Parameter(0, StorageClass="ExportedGlobal", DataType="single")
P_LCS_TarAngleFilterFC_spdBp = Simulink.Parameter([0 30 50 60 80 100 120 150], StorageClass="ExportedGlobal", DataType="single")
P_LCS_A2_LatAcc_BP = Simulink.Parameter([0 0.5 2 3 4], StorageClass="ExportedGlobal", DataType="single")

P_LCS_preDis_LC_Eco_Fac = Simulink.Parameter([0 0 0 0 0 0 0 0 0 0 0 0 0 0 0 0
 0 0 0 0 0 0 0 0 0 0 0 0 0 0 0 0
 0 0 0 0 0 0 0 0 0 0 0 0 0 0 0 0
 0 0 0 0 0 0 0 0 0 0 0 0 0 0 0 0
 0.25 0.25 0.25 0.25 0.25 0.25 0.25 0.25 0.35 0.35 0.35 0.35 0.35 0.35 0.35 0.35
 0.3 0.3 0.3 0.3 0.3 0.35 0.5 0.55 0.55 0.55 0.55 0.55 0.55 0.55 0.55 0.55
 0.3 0.3 0.3 0.3 0.3 0.4 0.55 0.6 0.65 0.7 0.75 0.75 0.75 0.75 0.75 0.75
 0.3 0.3 0.3 0.3 0.3 0.45 0.6 0.65 0.7 0.75 0.8 0.8 0.8 0.8 0.8 0.8
 0.35 0.35 0.35 0.35 0.35 0.5 0.65 0.7 0.75 0.8 0.85 0.85 0.85 0.85 0.85 0.85
 0.35 0.35 0.35 0.35 0.35 0.55 0.7 0.75 0.8 0.85 0.95 0.95 0.95 0.95 0.95 0.95
 0.45 0.45 0.45 0.45 0.55 0.65 0.7 0.75 0.8 0.85 1 1 1 1 1 1
 0.45 0.45 0.45 0.45 0.55 0.65 0.7 0.75 0.8 0.85 1.05 1.1 1.15 1.15 1.15 1.15
 0.45 0.45 0.45 0.45 0.55 0.65 0.7 0.75 0.8 0.85 1.1 1.15 1.2 1.25 1.3 1.3
 0.55 0.55 0.55 0.55 0.6 0.65 0.7 0.75 0.8 0.85 1.1 1.2 1.25 1.3 1.3 1.3
 0.55 0.55 0.55 0.55 0.6 0.65 0.7 0.75 0.8 0.85 1.1 1.2 1.25 1.3 1.3 1.3
 0.55 0.55 0.55 0.55 0.6 0.65 0.7 0.75 0.8 0.85 1.1 1.2 1.25 1.3 1.3 1.3
 0.55 0.55 0.55 0.55 0.6 0.65 0.7 0.75 0.8 0.85 1.1 1.2 1.25 1.3 1.3 1.3
 0.55 0.55 0.55 0.55 0.6 0.65 0.7 0.75 0.8 0.85 1.1 1.2 1.25 1.3 1.3 1.3
 0.55 0.55 0.55 0.55 0.6 0.65 0.7 0.75 0.8 0.85 1.1 1.2 1.25 1.3 1.3 1.3], StorageClass="ExportedGlobal", DataType="single")

P_LCS_preDis_LC_Nomal_Fac = Simulink.Parameter([0 0 0 0 0 0 0 0 0 0 0 0 0 0 0 0
 0 0 0 0 0 0 0 0 0 0 0 0 0 0 0 0
 0 0 0 0 0 0 0 0 0 0 0 0 0 0 0 0
 0 0 0 0 0 0 0 0 0 0 0 0 0 0 0 0
 -0.1 -0.1 -0.1 -0.1 -0.1 0.1 0.1 0.1 0.1 0.2 0.2 0.2 0.2 0.2 0.2 0.25
 -0.1 -0.1 -0.1 -0.1 -0.1 0.1 0.2 0.2 0.2 0.3 0.4 0.4 0.4 0.4 0.4 0.45
 -0.1 -0.1 -0.1 -0.1 -0.1 0.1 0.2 0.2 0.2 0.3 0.4 0.4 0.4 0.4 0.4 0.45
 -0.1 -0.1 -0.1 -0.1 -0.1 0.1 0.3 0.3 0.3 0.4 0.45 0.45 0.45 0.45 0.45 0.5
 -0.1 -0.1 -0.1 -0.1 -0.1 0.1 0.3 0.3 0.3 0.4 0.5 0.5 0.5 0.5 0.5 0.55
 -0.1 -0.1 -0.1 -0.1 -0.1 0.1 0.3 0.3 0.3 0.4 0.6 0.6 0.6 0.6 0.6 0.65
 0.1 0.1 0.1 0.1 0.2 0.35 0.4 0.4 0.4 0.45 0.65 0.65 0.65 0.65 0.65 0.7
 0.1 0.1 0.1 0.1 0.2 0.35 0.4 0.4 0.4 0.45 0.7 0.75 0.8 0.8 0.8 0.85
 0.1 0.1 0.1 0.1 0.2 0.35 0.4 0.4 0.4 0.45 0.75 0.75 0.85 0.9 0.95 1
 0.2 0.2 0.2 0.2 0.35 0.35 0.4 0.4 0.4 0.45 0.75 0.8 0.85 0.95 0.95 1
 0.2 0.2 0.2 0.2 0.35 0.35 0.4 0.4 0.4 0.45 0.75 0.85 0.9 0.95 0.95 1
 0.2 0.2 0.2 0.2 0.35 0.35 0.4 0.4 0.4 0.45 0.75 0.85 0.9 0.95 0.95 1
 0.2 0.2 0.2 0.2 0.35 0.35 0.4 0.4 0.4 0.45 0.75 0.85 0.9 0.95 0.95 1
 0.2 0.2 0.2 0.2 0.35 0.35 0.4 0.4 0.4 0.45 0.75 0.85 0.9 0.95 0.95 1
 0.2 0.2 0.2 0.2 0.35 0.35 0.4 0.4 0.4 0.45 0.75 0.85 0.9 0.95 0.95 1], StorageClass="ExportedGlobal", DataType="single")

P_LCS_preDis_LC_Sport_Fac = Simulink.Parameter([0 0 0 0 0 0 0 0 0 0 0 0 0 0 0 0
 0 0 0 0 0 0 0 0 0 0 0 0 0 0 0 0
 0 0 0 0 0 0 0 0 0 0 0 0 0 0 0 0
 0 0 0 0 0 0 0 0 0 0 0 0 0 0 0 0
 -0.1 -0.1 -0.1 -0.1 -0.1 0.1 0.1 0.1 0.1 0 0 0 0 0 0 0
 -0.1 -0.1 -0.1 -0.1 -0.1 0.1 0.1 0.1 0.1 0 0 0 0 0 0 0
 -0.1 -0.1 -0.1 -0.1 -0.1 0.1 0.2 0.2 0.2 0 0 0 0 0 0 0
 -0.1 -0.1 -0.1 -0.1 -0.1 0.1 0.3 0.3 0.3 0 0 0 0 0 0 0
 -0.1 -0.1 -0.1 -0.1 -0.1 0.1 0.3 0.3 0.3 0 0.05 0.05 0.05 0.05 0.05 0.05
 -0.1 -0.1 -0.1 -0.1 -0.1 0.1 0.3 0.3 0.3 0 0.1 0.1 0.1 0.1 0.1 0.1
 0.1 0.1 0.1 0.1 0.2 0.35 0.4 0.4 0.4 0.05 0.15 0.15 0.2 0.23 0.25 0.25
 0.1 0.1 0.1 0.1 0.2 0.35 0.4 0.4 0.4 0.05 0.15 0.15 0.2 0.25 0.25 0.25
 0.1 0.1 0.1 0.1 0.2 0.35 0.4 0.4 0.4 0.05 0.15 0.15 0.2 0.25 0.25 0.25
 0.2 0.2 0.2 0.2 0.35 0.35 0.4 0.4 0.4 0.05 0.15 0.15 0.2 0.25 0.25 0.25
 0.2 0.2 0.2 0.2 0.35 0.35 0.4 0.4 0.4 0.1 0.15 0.2 0.2 0.25 0.3 0.35
 0.2 0.2 0.2 0.2 0.35 0.35 0.4 0.4 0.4 0.1 0.2 0.25 0.3 0.35 0.4 0.45
 0.2 0.2 0.2 0.2 0.35 0.35 0.4 0.4 0.4 0.3 0.3 0.35 0.5 0.55 0.6 0.65
 0.2 0.2 0.2 0.2 0.35 0.35 0.4 0.4 0.4 0.5 0.6 0.65 0.8 0.85 0.9 0.95
 0.2 0.2 0.2 0.2 0.35 0.35 0.4 0.4 0.4 0.5 0.6 0.65 0.8 0.85 0.9 0.95], StorageClass="ExportedGlobal", DataType="single")

P_LCS_A0Slope_LCcancel_DisableFilterTime = Simulink.Parameter(0.5, StorageClass="ExportedGlobal", DataType="single")
P_LCS_preDis_TmaxFac = Simulink.Parameter([0.4 0.4 0.4 0.4 0.4 0.4 0.4 0.4 0.4 0.6 0.6 0.7 0.75 0.9 0.9 0.9], StorageClass="ExportedGlobal", DataType="single")
P_LCS_LCK_preDis_Nomal_Add = Simulink.Parameter(repmat(0, 1, 8), StorageClass="ExportedGlobal", DataType="single")
P_LCS_LCK_preDis_TmaxFac = Simulink.Parameter([0.4 0.4 0.4 0.4 0.4 0.4 0.4 0.4 0.4 0.4 0.6 0.7 0.75 0.9 0.9 0.9], StorageClass="ExportedGlobal", DataType="single")
P_LCS_LCK_AngleSlopeNormal_Spd = Simulink.Parameter(repmat(0.4, 1, 16), StorageClass="ExportedGlobal", DataType="single")
P_LCS_LCK2ESS_AngleSlopeLimtCnt_Spd = Simulink.Parameter([50 50 50 50 50 50 0 0 0 0 0 0 0 60 50 50], StorageClass="ExportedGlobal", DataType="single")
P_LCS_LCK2LC_AngleSlopeLimtCnt_Spd = Simulink.Parameter([50 50 20 20 20 20 20 20 30 80 80 70 70 60 50 50], StorageClass="ExportedGlobal", DataType="single")
P_LCS_LCK2ESS_AngleSlope_LimVal = Simulink.Parameter([0.2 1 1 1 1 0.15], StorageClass="ExportedGlobal", DataType="single")
P_LCS_LCK2LC_AngleSlope_LimVal = Simulink.Parameter([0.2 0.2 0.2 0.15 0.15 0.15], StorageClass="ExportedGlobal", DataType="single")
P_LCS_LCType = Simulink.Parameter(1, StorageClass="ExportedGlobal", DataType="single")
P_LCS_ESS_AngleSlopeNormal_Spd = Simulink.Parameter([0.4 0.4 0.4 0.4 0.4 0.4 1.2 1.2 1.2 1.2 1.2 1 1 0.25 0.25 0.25], StorageClass="ExportedGlobal", DataType="single")
P_LCS_ESS_preDis_TmaxFac = Simulink.Parameter([0.4 0.4 0.4 0.4 0.4 0.4 -0.1 -0.1 -0.1 0.1 0.1 0 0 0.9 0.9 0.9], StorageClass="ExportedGlobal", DataType="single")
P_LCS_LC_AngleSlopeNormal_Spd = Simulink.Parameter([0.4 0.4 1 1 0.8 0.5 0.5 0.5 0.5 0.35 0.3 0.3 0.2 0.25 0.25 0.25], StorageClass="ExportedGlobal", DataType="single")
P_LCS_LC_preDis_TmaxFac = Simulink.Parameter([0.4 0.4 0.1 0.1 0.3 0.4 0.4 0.4 0.3 0.4 0.6 0.7 0.75 0.9 0.9 0.9], StorageClass="ExportedGlobal", DataType="single")
P_LCS_LC_preDis_Nomal_Add = Simulink.Parameter([-1 -1 -1 -1 -1 -1 0 0], StorageClass="ExportedGlobal", DataType="single")
P_LCS_LC_preDis_Nomal = Simulink.Parameter([6 6 6 6 8 10 10 13 17 22 28 31 35 38 42 49], StorageClass="ExportedGlobal", DataType="single")
P_LCS_LC_preDis_Nomal_EM = Simulink.Parameter([6 6 6 6 8 10 10 13 12 18 26 31 32 38 42 49], StorageClass="ExportedGlobal", DataType="single")
P_LCS_LC_AngleSlopeNormal_EM_Spd = Simulink.Parameter([0.4 0.4 1 1 0.8 0.5 0.5 0.5 0.8 0.4 0.4 0.45 0.45 0.25 0.25 0.25], StorageClass="ExportedGlobal", DataType="single")
P_LCS_LC_preDis_TmaxFac_EM = Simulink.Parameter([0.4 0.4 0.1 0.1 0.3 0.4 0.4 0.4 0.3 0.4 0.4 0.4 0.4 0.9 0.9 0.9], StorageClass="ExportedGlobal", DataType="single")
P_LCS_LC_preDis_Nomal_EM_Add = Simulink.Parameter(repmat(0, 1, 8), StorageClass="ExportedGlobal", DataType="single")
P_LCS_AngleSlope_Spd_BP = Simulink.Parameter([0 10 20 30 40 60 80 90 100 110 120 140], StorageClass="ExportedGlobal", DataType="single")
P_LCS_AngleSlopeNormal_LCK_8 = Simulink.Parameter(repmat(0.4, 1, 12), StorageClass="ExportedGlobal", DataType="single")
P_LCS_AngleSlopeNormal_LCKIE_9 = Simulink.Parameter(repmat(0.4, 1, 12), StorageClass="ExportedGlobal", DataType="single")
P_LCS_AngleSlopeNormal_LC_10 = Simulink.Parameter(repmat(0.4, 1, 12), StorageClass="ExportedGlobal", DataType="single")
P_LCS_AngleSlopeNormal_LKA_11 = Simulink.Parameter(repmat(0.4, 1, 12), StorageClass="ExportedGlobal", DataType="single")
P_LCS_AngleSlopeNormal_ELK_12 = Simulink.Parameter(repmat(0.4, 1, 12), StorageClass="ExportedGlobal", DataType="single")
P_LCS_AngleSlopeNormal_ESS_13 = Simulink.Parameter(repmat(0.4, 1, 12), StorageClass="ExportedGlobal", DataType="single")
P_LCS_LevelType = Simulink.Parameter(1, StorageClass="ExportedGlobal", DataType="single")
P_LCS_End_Offset_Switch = Simulink.Parameter(1, StorageClass="ExportedGlobal", DataType="single")
P_LCS_AngleSlope_limitCnt_BP = Simulink.Parameter([0 10 20 30 40 50 60 70 80 90 100 110 210 230], StorageClass="ExportedGlobal", DataType="single")
P_LCS_A0_Dis_BP = Simulink.Parameter([0 0.2 0.4 0.6 0.8 1 1.2 1.4 1.6 1.8 2 2.2 2.4 2.6 2.8 3 3.2 3.4 3.6], StorageClass="ExportedGlobal", DataType="single")
P_LCS_AngleSlope_SpdBp = Simulink.Parameter([0 10 20 30 40 60 80 90 100 110 120 140], StorageClass="ExportedGlobal", DataType="single")

P_LCS_AngleSlope_IE2LCK_14 = Simulink.Parameter([0.2 0.2 0.2 0.2 0.2 0.2 0.1 0.1 0.1 0.1 0.1 0.1
 0.2 0.2 0.2 0.2 0.2 0.2 0.2 0.2 0.2 0.2 0.2 0.2
 0.3 0.3 0.3 0.3 0.3 0.3 0.3 0.3 0.3 0.3 0.3 0.3
 0.4 0.4 0.4 0.4 0.4 0.4 0.4 0.4 0.4 0.4 0.4 0.4
 0.4 0.4 0.4 0.4 0.4 0.4 0.4 0.4 0.4 0.4 0.4 0.4
 0.4 0.4 0.4 0.4 0.4 0.4 0.4 0.4 0.4 0.4 0.4 0.4
 0.4 0.4 0.4 0.4 0.4 0.4 0.4 0.4 0.4 0.4 0.4 0.4
 0.4 0.4 0.4 0.4 0.4 0.4 0.4 0.4 0.4 0.4 0.4 0.4
 0.4 0.4 0.4 0.4 0.4 0.4 0.4 0.4 0.4 0.4 0.4 0.4
 0.4 0.4 0.4 0.4 0.4 0.4 0.4 0.4 0.4 0.4 0.4 0.4
 0.4 0.4 0.4 0.4 0.4 0.4 0.4 0.4 0.4 0.4 0.4 0.4
 0.4 0.4 0.4 0.4 0.4 0.4 0.4 0.4 0.4 0.4 0.4 0.4
 0.4 0.4 0.4 0.4 0.4 0.4 0.4 0.4 0.4 0.4 0.4 0.4
 0.4 0.4 0.4 0.4 0.4 0.4 0.4 0.4 0.4 0.4 0.4 0.4
 0.4 0.4 0.4 0.4 0.4 0.4 0.4 0.4 0.4 0.4 0.4 0.4
 0.4 0.4 0.4 0.4 0.4 0.4 0.4 0.4 0.4 0.4 0.4 0.4
 0.4 0.4 0.4 0.4 0.4 0.4 0.4 0.4 0.4 0.4 0.4 0.4
 0.4 0.4 0.4 0.4 0.4 0.4 0.4 0.4 0.4 0.4 0.4 0.4
 0.4 0.4 0.4 0.4 0.4 0.4 0.4 0.4 0.4 0.4 0.4 0.4], StorageClass="ExportedGlobal", DataType="single")

P_LCS_AngleSlope_LKA2LCK_15 = Simulink.Parameter([0.2 0.2 0.2 0.2 0.2 0.2 0.1 0.1 0.1 0.1 0.1 0.1
 0.2 0.2 0.2 0.2 0.2 0.2 0.2 0.2 0.2 0.2 0.2 0.2
 0.3 0.3 0.3 0.3 0.3 0.3 0.3 0.3 0.3 0.3 0.3 0.3
 0.4 0.4 0.4 0.4 0.4 0.4 0.4 0.4 0.4 0.4 0.4 0.4
 0.4 0.4 0.4 0.4 0.4 0.4 0.4 0.4 0.4 0.4 0.4 0.4
 0.4 0.4 0.4 0.4 0.4 0.4 0.4 0.4 0.4 0.4 0.4 0.4
 0.4 0.4 0.4 0.4 0.4 0.4 0.4 0.4 0.4 0.4 0.4 0.4
 0.4 0.4 0.4 0.4 0.4 0.4 0.4 0.4 0.4 0.4 0.4 0.4
 0.4 0.4 0.4 0.4 0.4 0.4 0.4 0.4 0.4 0.4 0.4 0.4
 0.4 0.4 0.4 0.4 0.4 0.4 0.4 0.4 0.4 0.4 0.4 0.4
 0.4 0.4 0.4 0.4 0.4 0.4 0.4 0.4 0.4 0.4 0.4 0.4
 0.4 0.4 0.4 0.4 0.4 0.4 0.4 0.4 0.4 0.4 0.4 0.4
 0.4 0.4 0.4 0.4 0.4 0.4 0.4 0.4 0.4 0.4 0.4 0.4
 0.4 0.4 0.4 0.4 0.4 0.4 0.4 0.4 0.4 0.4 0.4 0.4
 0.4 0.4 0.4 0.4 0.4 0.4 0.4 0.4 0.4 0.4 0.4 0.4
 0.4 0.4 0.4 0.4 0.4 0.4 0.4 0.4 0.4 0.4 0.4 0.4
 0.4 0.4 0.4 0.4 0.4 0.4 0.4 0.4 0.4 0.4 0.4 0.4
 0.4 0.4 0.4 0.4 0.4 0.4 0.4 0.4 0.4 0.4 0.4 0.4
 0.4 0.4 0.4 0.4 0.4 0.4 0.4 0.4 0.4 0.4 0.4 0.4], StorageClass="ExportedGlobal", DataType="single")

P_LCS_AngleSlope_LKA_17 = Simulink.Parameter([0.2 0.2 0.2 0.2 0.2 0.2 0.1 0.1 0.1 0.1 0.1 0.1
 0.2 0.2 0.2 0.2 0.2 0.2 0.2 0.2 0.2 0.2 0.2 0.2
 0.3 0.3 0.3 0.3 0.3 0.3 0.3 0.3 0.3 0.3 0.3 0.3
 0.4 0.4 0.4 0.4 0.4 0.4 0.4 0.4 0.4 0.4 0.4 0.4
 0.4 0.4 0.4 0.4 0.4 0.4 0.4 0.4 0.4 0.4 0.4 0.4
 0.4 0.4 0.4 0.4 0.4 0.4 0.4 0.4 0.4 0.4 0.4 0.4
 0.4 0.4 0.4 0.4 0.4 0.4 0.4 0.4 0.4 0.4 0.4 0.4
 0.4 0.4 0.4 0.4 0.4 0.4 0.4 0.4 0.4 0.4 0.4 0.4
 0.4 0.4 0.4 0.4 0.4 0.4 0.4 0.4 0.4 0.4 0.4 0.4
 0.4 0.4 0.4 0.4 0.4 0.4 0.4 0.4 0.4 0.4 0.4 0.4
 0.4 0.4 0.4 0.4 0.4 0.4 0.4 0.4 0.4 0.4 0.4 0.4
 0.4 0.4 0.4 0.4 0.4 0.4 0.4 0.4 0.4 0.4 0.4 0.4
 0.4 0.4 0.4 0.4 0.4 0.4 0.4 0.4 0.4 0.4 0.4 0.4
 0.4 0.4 0.4 0.4 0.4 0.4 0.4 0.4 0.4 0.4 0.4 0.4
 0.4 0.4 0.4 0.4 0.4 0.4 0.4 0.4 0.4 0.4 0.4 0.4
 0.4 0.4 0.4 0.4 0.4 0.4 0.4 0.4 0.4 0.4 0.4 0.4
 0.4 0.4 0.4 0.4 0.4 0.4 0.4 0.4 0.4 0.4 0.4 0.4
 0.4 0.4 0.4 0.4 0.4 0.4 0.4 0.4 0.4 0.4 0.4 0.4
 0.4 0.4 0.4 0.4 0.4 0.4 0.4 0.4 0.4 0.4 0.4 0.4], StorageClass="ExportedGlobal", DataType="single")

P_LCS_AngleSlope_HoldTime = Simulink.Parameter([0.6 0.6 0.6 0.6 0.6 0.6 0.6 0.6 0.6 0.6 0.6 1
 0.6 0.6 0.6 0.6 0.6 0.6 0.6 0.6 0.6 0.6 0.6 1
 0.6 0.6 0.6 0.6 0.6 0.6 0.6 0.6 0.6 0.6 0.6 1
 0.6 0.6 0.6 0.6 0.6 0.6 0.6 0.6 0.6 0.6 0.6 1
 0.6 0.6 0.6 0.6 0.6 0.6 0.6 0.6 0.6 0.6 0.6 1
 0.6 0.6 0.6 0.6 0.6 0.6 0.6 0.6 0.6 0.6 0.6 1
 0.6 0.6 0.6 0.6 0.6 0.6 0.6 0.6 0.6 0.6 0.6 1], StorageClass="ExportedGlobal", DataType="single")

P_LCS_AngleSlope_IE_2 = Simulink.Parameter([0.2 0.2 0.2 0.2 0.2 0.2 0.1 0.1 0.1 0.1 0.1 0.1
 0.2 0.2 0.2 0.2 0.2 0.2 0.2 0.2 0.2 0.2 0.2 0.2
 0.3 0.3 0.3 0.3 0.3 0.3 0.3 0.3 0.3 0.3 0.3 0.3
 0.4 0.4 0.4 0.4 0.4 0.4 0.4 0.4 0.4 0.4 0.4 0.4
 0.4 0.4 0.4 0.4 0.4 0.4 0.4 0.4 0.4 0.4 0.4 0.4
 0.4 0.4 0.4 0.4 0.4 0.4 0.4 0.4 0.4 0.4 0.4 0.4
 0.4 0.4 0.4 0.4 0.4 0.4 0.4 0.4 0.4 0.4 0.4 0.4
 0.4 0.4 0.4 0.4 0.4 0.4 0.4 0.4 0.4 0.4 0.4 0.4
 0.4 0.4 0.4 0.4 0.4 0.4 0.4 0.4 0.4 0.4 0.4 0.4
 0.4 0.4 0.4 0.4 0.4 0.4 0.4 0.4 0.4 0.4 0.4 0.4
 0.4 0.4 0.4 0.4 0.4 0.4 0.4 0.4 0.4 0.4 0.4 0.4
 0.4 0.4 0.4 0.4 0.4 0.4 0.4 0.4 0.4 0.4 0.4 0.4
 0.4 0.4 0.4 0.4 0.4 0.4 0.4 0.4 0.4 0.4 0.4 0.4
 0.4 0.4 0.4 0.4 0.4 0.4 0.4 0.4 0.4 0.4 0.4 0.4
 0.4 0.4 0.4 0.4 0.4 0.4 0.4 0.4 0.4 0.4 0.4 0.4
 0.4 0.4 0.4 0.4 0.4 0.4 0.4 0.4 0.4 0.4 0.4 0.4
 0.4 0.4 0.4 0.4 0.4 0.4 0.4 0.4 0.4 0.4 0.4 0.4
 0.4 0.4 0.4 0.4 0.4 0.4 0.4 0.4 0.4 0.4 0.4 0.4
 0.4 0.4 0.4 0.4 0.4 0.4 0.4 0.4 0.4 0.4 0.4 0.4], StorageClass="ExportedGlobal", DataType="single")

P_LCS_OffsetCaclc_SpdLow = Simulink.Parameter(20, StorageClass="ExportedGlobal", DataType="single")
P_LCS_OffsetCaclc_SpdUp = Simulink.Parameter(130, StorageClass="ExportedGlobal", DataType="single")
P_LCS_Offset_A2_FliterTime = Simulink.Parameter(2, StorageClass="ExportedGlobal", DataType="single")
P_LCS_Offset_FliterTime = Simulink.Parameter(2, StorageClass="ExportedGlobal", DataType="single")
P_LCS_Offset_Switch = Simulink.Parameter(1, StorageClass="ExportedGlobal", DataType="single")
P_LCS_AngleSlope_LCKIE = Simulink.Parameter(repmat(0.4, 19, 12), StorageClass="ExportedGlobal", DataType="single")
P_LCS_AngleSlope_LCK = Simulink.Parameter(repmat(0.4, 19, 12), StorageClass="ExportedGlobal", DataType="single")

P_LCS_AngleSlope_LC_Nomal = Simulink.Parameter([0.4 0.4 0.4 0.4 0.4 0.4 0.4 0.4 0.4 0.4 0.4 0.4
 0.4 0.4 0.4 0.4 0.4 0.4 0.4 0.4 0.4 0.4 0.4 0.4
 0.4 0.4 0.4 0.4 0.4 0.4 0.4 0.4 0.4 0.4 0.4 0.4
 0.35 0.35 0.35 0.35 0.35 0.35 0.35 0.35 0.35 0.35 0.35 0.35
 0.35 0.35 0.35 0.35 0.35 0.35 0.35 0.35 0.35 0.35 0.35 0.35
 0.35 0.35 0.35 0.35 0.35 0.35 0.35 0.35 0.35 0.35 0.35 0.35
 0.35 0.35 0.35 0.35 0.35 0.35 0.35 0.35 0.35 0.35 0.35 0.35
 0.35 0.35 0.35 0.35 0.35 0.35 0.35 0.35 0.35 0.35 0.35 0.35
 0.35 0.35 0.35 0.35 0.35 0.35 0.35 0.35 0.35 0.35 0.35 0.35
 0.3 0.3 0.3 0.3 0.3 0.3 0.3 0.3 0.3 0.3 0.3 0.3
 0.3 0.3 0.3 0.3 0.3 0.3 0.3 0.3 0.3 0.3 0.3 0.3
 0.3 0.3 0.3 0.3 0.3 0.3 0.3 0.3 0.3 0.3 0.3 0.3
 0.3 0.3 0.3 0.3 0.3 0.3 0.3 0.3 0.3 0.3 0.3 0.3
 0.3 0.3 0.3 0.3 0.3 0.3 0.3 0.3 0.3 0.3 0.3 0.3
 0.3 0.3 0.3 0.3 0.3 0.3 0.3 0.3 0.3 0.3 0.3 0.3
 0.3 0.3 0.3 0.3 0.3 0.3 0.3 0.3 0.3 0.3 0.3 0.3
 0.3 0.3 0.3 0.3 0.3 0.3 0.3 0.3 0.3 0.3 0.3 0.3
 0.3 0.3 0.3 0.3 0.3 0.3 0.3 0.3 0.3 0.3 0.3 0.3
 0.3 0.3 0.3 0.3 0.3 0.3 0.3 0.3 0.3 0.3 0.3 0.3], StorageClass="ExportedGlobal", DataType="single")

P_LCS_AngleSlope_LKA = Simulink.Parameter([0.2 0.2 0.2 0.2 0.2 0.2 0.1 0.1 0.1 0.1 0.1 0.1
 0.2 0.2 0.2 0.2 0.2 0.2 0.2 0.2 0.2 0.2 0.2 0.2
 0.3 0.3 0.3 0.3 0.3 0.3 0.3 0.3 0.3 0.3 0.3 0.3
 0.4 0.4 0.4 0.4 0.4 0.4 0.4 0.4 0.4 0.4 0.4 0.4
 0.4 0.4 0.4 0.4 0.4 0.4 0.4 0.4 0.4 0.4 0.4 0.4
 0.4 0.4 0.4 0.4 0.4 0.4 0.4 0.4 0.4 0.4 0.4 0.4
 0.4 0.4 0.4 0.4 0.4 0.4 0.4 0.4 0.4 0.4 0.4 0.4
 0.4 0.4 0.4 0.4 0.4 0.4 0.4 0.4 0.4 0.4 0.4 0.4
 0.4 0.4 0.4 0.4 0.4 0.4 0.4 0.4 0.4 0.4 0.4 0.4
 0.4 0.4 0.4 0.4 0.4 0.4 0.4 0.4 0.4 0.4 0.4 0.4
 0.4 0.4 0.4 0.4 0.4 0.4 0.4 0.4 0.4 0.4 0.4 0.4
 0.4 0.4 0.4 0.4 0.4 0.4 0.4 0.4 0.4 0.4 0.4 0.4
 0.4 0.4 0.4 0.4 0.4 0.4 0.4 0.4 0.4 0.4 0.4 0.4
 0.4 0.4 0.4 0.4 0.4 0.4 0.4 0.4 0.4 0.4 0.4 0.4
 0.4 0.4 0.4 0.4 0.4 0.4 0.4 0.4 0.4 0.4 0.4 0.4
 0.4 0.4 0.4 0.4 0.4 0.4 0.4 0.4 0.4 0.4 0.4 0.4
 0.4 0.4 0.4 0.4 0.4 0.4 0.4 0.4 0.4 0.4 0.4 0.4
 0.4 0.4 0.4 0.4 0.4 0.4 0.4 0.4 0.4 0.4 0.4 0.4
 0.4 0.4 0.4 0.4 0.4 0.4 0.4 0.4 0.4 0.4 0.4 0.4], StorageClass="ExportedGlobal", DataType="single")

P_LCS_AngleSlope_LC_Eco = Simulink.Parameter([0.4 0.4 0.4 0.4 0.4 0.4 0.4 0.4 0.4 0.4 0.4 0.4
 0.4 0.4 0.4 0.4 0.4 0.4 0.4 0.4 0.4 0.4 0.4 0.4
 0.4 0.4 0.4 0.4 0.4 0.4 0.4 0.4 0.4 0.4 0.4 0.4
 0.35 0.35 0.35 0.35 0.35 0.35 0.35 0.35 0.35 0.35 0.35 0.35
 0.35 0.35 0.35 0.35 0.35 0.35 0.35 0.35 0.35 0.35 0.35 0.35
 0.35 0.35 0.35 0.35 0.35 0.35 0.35 0.35 0.35 0.35 0.35 0.35
 0.35 0.35 0.35 0.35 0.35 0.35 0.35 0.35 0.35 0.35 0.35 0.35
 0.35 0.35 0.35 0.35 0.35 0.35 0.35 0.35 0.35 0.35 0.35 0.35
 0.35 0.35 0.35 0.35 0.35 0.35 0.35 0.35 0.35 0.35 0.35 0.35
 0.3 0.3 0.3 0.3 0.3 0.3 0.3 0.3 0.3 0.3 0.3 0.3
 0.3 0.3 0.3 0.3 0.3 0.3 0.3 0.3 0.3 0.3 0.3 0.3
 0.3 0.3 0.3 0.3 0.3 0.3 0.3 0.3 0.3 0.3 0.3 0.3
 0.3 0.3 0.3 0.3 0.3 0.3 0.3 0.3 0.3 0.3 0.3 0.3
 0.3 0.3 0.3 0.3 0.3 0.3 0.3 0.3 0.3 0.3 0.3 0.3
 0.3 0.3 0.3 0.3 0.3 0.3 0.3 0.3 0.3 0.3 0.3 0.3
 0.3 0.3 0.3 0.3 0.3 0.3 0.3 0.3 0.3 0.3 0.3 0.3
 0.3 0.3 0.3 0.3 0.3 0.3 0.3 0.3 0.3 0.3 0.3 0.3
 0.3 0.3 0.3 0.3 0.3 0.3 0.3 0.3 0.3 0.3 0.3 0.3
 0.3 0.3 0.3 0.3 0.3 0.3 0.3 0.3 0.3 0.3 0.3 0.3], StorageClass="ExportedGlobal", DataType="single")

P_LCS_AngleSlope_LC_Sport = Simulink.Parameter([0.4 0.4 0.4 0.4 0.4 0.4 0.4 0.4 0.4 0.4 0.4 0.4
 0.4 0.4 0.4 0.4 0.4 0.4 0.4 0.4 0.4 0.4 0.4 0.4
 0.4 0.4 0.4 0.4 0.4 0.4 0.4 0.4 0.4 0.4 0.4 0.4
 0.35 0.35 0.35 0.35 0.35 0.35 0.35 0.35 0.35 0.35 0.35 0.35
 0.35 0.35 0.35 0.35 0.35 0.35 0.35 0.35 0.35 0.35 0.35 0.35
 0.35 0.35 0.35 0.35 0.35 0.35 0.35 0.35 0.35 0.35 0.35 0.35
 0.35 0.35 0.35 0.35 0.35 0.35 0.35 0.35 0.35 0.35 0.35 0.35
 0.35 0.35 0.35 0.35 0.35 0.35 0.35 0.35 0.35 0.35 0.35 0.35
 0.35 0.35 0.35 0.35 0.35 0.35 0.35 0.35 0.35 0.35 0.35 0.35
 0.3 0.3 0.3 0.3 0.3 0.3 0.3 0.3 0.3 0.3 0.3 0.3
 0.3 0.3 0.3 0.3 0.3 0.3 0.3 0.3 0.3 0.3 0.3 0.3
 0.3 0.3 0.3 0.3 0.3 0.3 0.3 0.3 0.3 0.3 0.3 0.3
 0.3 0.3 0.3 0.3 0.3 0.3 0.3 0.3 0.3 0.3 0.3 0.3
 0.3 0.3 0.3 0.3 0.3 0.3 0.3 0.3 0.3 0.3 0.3 0.3
 0.3 0.3 0.3 0.3 0.3 0.3 0.3 0.3 0.3 0.3 0.3 0.3
 0.3 0.3 0.3 0.3 0.3 0.3 0.3 0.3 0.3 0.3 0.3 0.3
 0.3 0.3 0.3 0.3 0.3 0.3 0.3 0.3 0.3 0.3 0.3 0.3
 0.3 0.3 0.3 0.3 0.3 0.3 0.3 0.3 0.3 0.3 0.3 0.3
 0.3 0.3 0.3 0.3 0.3 0.3 0.3 0.3 0.3 0.3 0.3 0.3], StorageClass="ExportedGlobal", DataType="single")

P_LCS_DeltaEps_TimeVal = Simulink.Parameter([0.8 0.8 0.8 0.8 0.8 0.8 0.8 0.8 0.8 0.8 0.5 0.5 0.5 0.5 0.5 0.5], StorageClass="ExportedGlobal", DataType="single")
P_LCS_FF_EnableSpd = Simulink.Parameter(5, StorageClass="ExportedGlobal", DataType="single")
P_LCS_communicationTest = Simulink.Parameter(1, StorageClass="ExportedGlobal", DataType="boolean")
LCS_communicationTest_IFCTrqOvlCmdReqValue = Simulink.Signal(StorageClass="ExportedGlobal")
LCS_communicationTest_IFCFuncTrqCmdReqFlag = Simulink.Signal(StorageClass="ExportedGlobal")
LCS_communicationTest_IFCAngCmdReqValue = Simulink.Signal(StorageClass="ExportedGlobal")
LCS_communicationTest_IFCFuncAngCmdReqFlag = Simulink.Signal(StorageClass="ExportedGlobal")
LCS_communicationTest_LATC_L3 = Simulink.Signal(StorageClass="ExportedGlobal")
P_LCS_StateHold_time = Simulink.Parameter(250, StorageClass="ExportedGlobal", DataType="uint16")
P_LCS_CurOffset_SterAngleSpd_Enable = Simulink.Parameter(0, StorageClass="ExportedGlobal", DataType="boolean")
P_LCS_ESSAngleSW = Simulink.Parameter(1, StorageClass="ExportedGlobal", DataType="boolean")
P_LCS_PID_A0_PID_SW = Simulink.Parameter(0, StorageClass="ExportedGlobal", DataType="boolean")
P_LCS_PID_A2_PID_SW = Simulink.Parameter(0, StorageClass="ExportedGlobal", DataType="boolean")
P_LCS_StateCompleteFlg_BP = Simulink.Parameter([7 8 9 10], StorageClass="ExportedGlobal", DataType="uint8")
P_LCS_DesAngle_DelaySample = AUTOSAR4.Parameter(0, SwCalibrationAccess="ReadWrite", StorageClass="ExportedGlobal", DataType="single")
P_LCS_FF_LCRevs_SpdBP = AUTOSAR4.Parameter([0 10 20 30 40 50 60 70 80 90 100 110 120 130], SwCalibrationAccess="ReadWrite", StorageClass="ExportedGlobal", DataType="single")
P_LCS_FF_LCRevs_TimeFacVal = AUTOSAR4.Parameter([0.35 0.2 0.1 0.05], SwCalibrationAccess="ReadWrite", StorageClass="ExportedGlobal", DataType="single")
P_LCS_FF_LCRevs_TimeBP = AUTOSAR4.Parameter([0 0.5 1 1.5], SwCalibrationAccess="ReadWrite", StorageClass="ExportedGlobal", DataType="single")
P_LCS_FF_Param_CurveFac = AUTOSAR4.Parameter([1 1 1.0691 1.1055 1.4424 1.6703 1.8], SwCalibrationAccess="ReadWrite", StorageClass="ExportedGlobal", DataType="single")
P_LCS_FF_Param_CurveBp = AUTOSAR4.Parameter([0 0.003 0.008 0.01 0.05 0.08 0.1], SwCalibrationAccess="ReadWrite", StorageClass="ExportedGlobal", DataType="single")
P_LCS_FFWSwitch = AUTOSAR4.Parameter(0, SwCalibrationAccess="ReadWrite", StorageClass="ExportedGlobal", DataType="single")
P_LCS_FF_TarAngleTorq_Factor = AUTOSAR4.Parameter([-2.35 -2.2937 -2.1785 -2.1305 -2.0729 -1.9866 -1.9098 -1.737 -1.5739 -1.4395 -1.3148 -1.1804 -1.0461 -0.97889 -0.85 -0.78 -0.71017 -0.6334 -0.4 0 0.4 0.50864 0.62 0.7 0.8 0.91 0.97889 1.1 1.2476 1.4299 1.5451 1.7 1.8 1.9194 2 2.0441 2.0921 2.25 2.3], SwCalibrationAccess="ReadWrite", StorageClass="ExportedGlobal", DataType="single")
P_LCS_FF_TarAngleTorq_Bp = AUTOSAR4.Parameter([-100 -80 -60 -55 -50 -45 -40 -35 -30 -25 -20 -15 -12 -10 -8 -6 -5 -4 -2 0 2 4 5 6 8 10 12 15 20 25 30 35 40 45 50 55 60 80 100], SwCalibrationAccess="ReadWrite", StorageClass="ExportedGlobal", DataType="single")
P_LCS_FF_Speed_Factor = AUTOSAR4.Parameter([0.69545 0.6 0.56212 0.56212 0.56515 0.57121 0.57424 0.58333 0.6 0.95 1 1 1 1 1 1], SwCalibrationAccess="ReadWrite", StorageClass="ExportedGlobal", DataType="single")
P_LCS_FF_Speed_Bp = AUTOSAR4.Parameter([0 5 10 15 20 25 30 35 40 60 70 80 90 100 120 140], SwCalibrationAccess="ReadWrite", StorageClass="ExportedGlobal", DataType="single")

P_LCS_FFW_Torq_V71 = AUTOSAR4.Parameter([-2.9 -2.3 -2.6 -2.9 -2.62 -2.9 -2.55 -2.29
 -2.9 -1.96 -2.6 -2.9 -2.62 -2.9 -2.55 -2.29
 -2.9 -1.65 -2.15 -2.9 -2.62 -2.9 -2.55 -2.29
 -2.5 -1.5 -2.1 -2.9 -2.62 -2.9 -2.55 -2.29
 -2.45 -1.45 -2.07 -2.8 -2.62 -2.9 -2.55 -2.29
 -2.35 -1.34 -2 -2.6 -2.62 -2.9 -2.55 -2.29
 -2.31 -1.22 -1.85 -2.45 -2.62 -2.9 -2.55 -2.29
 -2.18 -1.15 -1.75 -2.37 -2.62 -2.9 -2.55 -2.29
 -2.05 -1.04 -1.65 -2 -2.62 -2.9 -2.55 -2.29
 -1.86 -0.92 -1.3 -1.96 -2.61 -2.9 -2.55 -2.29
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 ], SwCalibrationAccess="ReadWrite", StorageClass="ExportedGlobal", DataType="single")

P_LCS_AngleErrorReversTorq_VehSpdBp = AUTOSAR4.Parameter([60 80 90 100 150], SwCalibrationAccess="ReadWrite", StorageClass="ExportedGlobal", DataType="single")
P_LCS_PID_Param_GainSwitch = AUTOSAR4.Parameter(0, SwCalibrationAccess="ReadWrite", StorageClass="ExportedGlobal", DataType="single")
P_LCS_PID_Param_Speed_Factor_P = AUTOSAR4.Parameter([1 0.8 0.8 0.8 0.8 0.8 0.8 0.8 0.8 0.8 0.8 0.8 0.7 0.6 0.6 0.5], SwCalibrationAccess="ReadWrite", StorageClass="ExportedGlobal", DataType="single")  % 更新高速P
P_LCS_PID_Param_Speed_Adapt = AUTOSAR4.Parameter([0 5 10 15 20 25 30 35 40 60 70 80 90 100 120 140], SwCalibrationAccess="ReadWrite", StorageClass="ExportedGlobal", DataType="single")
P_LCS_PID_Param_Speed_Factor_D = AUTOSAR4.Parameter([0.01 0.05 0.1 0.2 0.3 0.4 0.5 0.6 0.8 1 1 1 1 1 1 1], SwCalibrationAccess="ReadWrite", StorageClass="ExportedGlobal", DataType="single")
P_LCS_PID_Param_Speed_Factor_I = AUTOSAR4.Parameter([0.01 0.05 0.1 0.2 0.3 0.4 0.5 0.6 0.8 0.8 0.8 0.8 0.8 0.8 0.8 0.8], SwCalibrationAccess="ReadWrite", StorageClass="ExportedGlobal", DataType="single")
P_LCS_PID_Param_SteerWheelSpd_Factor_P = AUTOSAR4.Parameter([1 1 1 0.98 0.8 0.6 0.4 0.3], SwCalibrationAccess="ReadWrite", StorageClass="ExportedGlobal", DataType="single")
P_LCS_PID_Param_SteerWheelSpd_Adapt = AUTOSAR4.Parameter([0 5 8 10 20 30 40 50], SwCalibrationAccess="ReadWrite", StorageClass="ExportedGlobal", DataType="single")
P_LCS_PID_Param_SteerWheelSpd_Factor_D = AUTOSAR4.Parameter([1 1.5 1.8 2 2.5 2.8 3 4], SwCalibrationAccess="ReadWrite", StorageClass="ExportedGlobal", DataType="single")
P_LCS_PID_Param_SteerWheelAngle_Factor_P = AUTOSAR4.Parameter([1 1 1 0.9 0.8 0.7 0.6 0.58], SwCalibrationAccess="ReadWrite", StorageClass="ExportedGlobal", DataType="single")
P_LCS_PID_Param_SteerWheelAngle_Adapt = AUTOSAR4.Parameter([0 3 6 10 15 20 30 45], SwCalibrationAccess="ReadWrite", StorageClass="ExportedGlobal", DataType="single")
P_LCS_PID_Param_SteerWheelAngle_Factor_D = AUTOSAR4.Parameter([1 1 1 0.6 0.3 0.3 0.2 0.2], SwCalibrationAccess="ReadWrite", StorageClass="ExportedGlobal", DataType="single")
P_LCS_PID_AngErrFacVal = AUTOSAR4.Parameter([1 1 0.8 0.6 0.3], SwCalibrationAccess="ReadWrite", StorageClass="ExportedGlobal", DataType="single")
P_LCS_PID_AngErrFacBp = AUTOSAR4.Parameter([0 2 4 6 12], SwCalibrationAccess="ReadWrite", StorageClass="ExportedGlobal", DataType="single")
P_LCS_PID_Param_CurveFac = AUTOSAR4.Parameter([0 0 0.069091 0.10545 0.44242 0.6703 0.8], SwCalibrationAccess="ReadWrite", StorageClass="ExportedGlobal", DataType="single")
P_LCS_PID_Param_CurveBp = AUTOSAR4.Parameter([0 0.003 0.008 0.01 0.05 0.08 0.1], SwCalibrationAccess="ReadWrite", StorageClass="ExportedGlobal", DataType="single")
P_LCS_OverRideTime_TH_s = AUTOSAR4.Parameter(0.5, SwCalibrationAccess="ReadWrite", StorageClass="ExportedGlobal", DataType="single")
P_LCS_NoOverRideTime_TH_s = AUTOSAR4.Parameter(1, SwCalibrationAccess="ReadWrite", StorageClass="ExportedGlobal", DataType="single")
P_LCS_DetOverRide_DrvTrq_TH = AUTOSAR4.Parameter(1, SwCalibrationAccess="ReadWrite", StorageClass="ExportedGlobal", DataType="single")
P_LCS_DetNoOverRide_DrvTrq_TH = AUTOSAR4.Parameter(0.7, SwCalibrationAccess="ReadWrite", StorageClass="ExportedGlobal", DataType="single")
P_LCS_PreTime_ESS = AUTOSAR4.Parameter(2, SwCalibrationAccess="ReadWrite", StorageClass="ExportedGlobal", DataType="single")
P_LCS_PID_Kp_TarAng_ESS = AUTOSAR4.Parameter(12, SwCalibrationAccess="ReadWrite", StorageClass="ExportedGlobal", DataType="single")
P_LCS_PID_Ki_TarAng_ESS = AUTOSAR4.Parameter(0, SwCalibrationAccess="ReadWrite", StorageClass="ExportedGlobal", DataType="single")
P_LCS_SW = AUTOSAR4.Parameter(1, SwCalibrationAccess="ReadWrite", StorageClass="ExportedGlobal", DataType="boolean")
P_LCS_PreTime_ESS2 = AUTOSAR4.Parameter(1.7, SwCalibrationAccess="ReadWrite", StorageClass="ExportedGlobal", DataType="single")
P_LCS_PID_Kp_TarAng_ESS2 = AUTOSAR4.Parameter(0.5, SwCalibrationAccess="ReadWrite", StorageClass="ExportedGlobal", DataType="single")
P_LCS_PID_Kp_TarTorq_ESS = AUTOSAR4.Parameter(2, SwCalibrationAccess="ReadWrite", StorageClass="ExportedGlobal", DataType="single")
P_LCS_TarTorq_Limit_ESS = AUTOSAR4.Parameter(0.25, SwCalibrationAccess="ReadWrite", StorageClass="ExportedGlobal", DataType="single")
P_LCS_PID_SteerAngSpdLim = AUTOSAR4.Parameter(20, SwCalibrationAccess="ReadWrite", StorageClass="ExportedGlobal", DataType="single")
P_LCS_MaxTorqSlope = AUTOSAR4.Parameter(0.18, SwCalibrationAccess="ReadWrite", StorageClass="ExportedGlobal", DataType="single")
P_LCS_TorqReqMax = AUTOSAR4.Parameter(2.99, SwCalibrationAccess="ReadWrite", StorageClass="ExportedGlobal", DataType="single")
P_LCS_TorqReqMin = AUTOSAR4.Parameter(-2.99, SwCalibrationAccess="ReadWrite", StorageClass="ExportedGlobal", DataType="single")
P_LCS_ESS_MaxTorqSlope = AUTOSAR4.Parameter(1.5, SwCalibrationAccess="ReadWrite", StorageClass="ExportedGlobal", DataType="single")
P_LCS_FF_LCRevs_SpdVal = AUTOSAR4.Parameter([0 0.8 0.8 0.8 0.8 0.8 0.8 0.8 0.8 0.8 0.8 0.8 0.8 0.8], SwCalibrationAccess="ReadWrite", StorageClass="ExportedGlobal", DataType="single")
P_LCS_AngleErrorReversTorq = AUTOSAR4.Parameter(0.06, SwCalibrationAccess="ReadWrite", StorageClass="ExportedGlobal", DataType="single")
P_LCS_AngleErrorReversTorq_VehSpdFac = AUTOSAR4.Parameter([1 1 0.5 0 0], SwCalibrationAccess="ReadWrite", StorageClass="ExportedGlobal", DataType="single")
P_LCS_PID_Param_KiFreaseWhenLC_Enable = AUTOSAR4.Parameter(0, SwCalibrationAccess="ReadWrite", StorageClass="ExportedGlobal", DataType="boolean")
P_LCS_PID_Param_Kp = AUTOSAR4.Parameter(0.15, SwCalibrationAccess="ReadWrite", StorageClass="ExportedGlobal", DataType="single")
P_LCS_PID_Param_Kd = AUTOSAR4.Parameter(0, SwCalibrationAccess="ReadWrite", StorageClass="ExportedGlobal", DataType="single")
P_LCS_PID_Param_KdFilterTime = AUTOSAR4.Parameter(0.5, SwCalibrationAccess="ReadWrite", StorageClass="ExportedGlobal", DataType="single")
P_LCS_PID_Param_Ki = AUTOSAR4.Parameter(0.001, SwCalibrationAccess="ReadWrite", StorageClass="ExportedGlobal", DataType="single")
P_LCS_OverRideDetect_enable = AUTOSAR4.Parameter(true, SwCalibrationAccess="ReadWrite", StorageClass="ExportedGlobal", DataType="boolean")
P_LCS_LCK_preDis_Nomal = Simulink.Parameter([8 9 10 11 12 13 14 15 17 22 28 33 35 36 36 36], StorageClass="ExportedGlobal", DataType="single")
P_LCS_StateActiveFlg_BP = Simulink.Parameter([1 2 3 4 5 6], StorageClass="ExportedGlobal", DataType="uint8")
P_LCS_StateActive_HoldTime_BP = Simulink.Parameter([0 0.2 0.4 0.6 0.8 1 1.2 1.4 1.6 1.8 2 4 6 8 10], StorageClass="ExportedGlobal", DataType="single")