% Simulink data dictionary HWAtest.sldd

LCS_Debug_BUS = Simulink.Bus()
  LCS_PID_torqP: single
  LCS_PID_torqD: single
  ErrDt: single
  LCS_ControlAngleError: single
  LCS_TarSteerAngle_deg: single
  LCS_TarSteerAngleEnd: single
  LCS_CurSteerAngle_deg: single

P_LCS_TestTarAngle = Simulink.Parameter(0, StorageClass="ExportedGlobal", DataType="single")
P_LCS_TestAngleSwitch = Simulink.Parameter(0, StorageClass="ExportedGlobal", DataType="single")
P_LCS_PID_Kp_ErrFacVal = Simulink.Parameter([0 2 5 5 5 5], StorageClass="ExportedGlobal", DataType="single")
P_LCS_PID_Kp_ErrFacBp = Simulink.Parameter([0 2 5 10 15 20], StorageClass="ExportedGlobal", DataType="single")
P_LCS_PID_Kp_SpdFacBp = Simulink.Parameter([0 5 10 15 20 25 30 35 40 60 80 90 100 110 120 140], StorageClass="ExportedGlobal", DataType="single")
P_LCS_PID_Kp_AngFacVal = Simulink.Parameter([1 1 1 1 1 1 0.6 0.5 0.4 0.3 0.2], StorageClass="ExportedGlobal", DataType="single")
P_LCS_PID_Kp_AngFacBp = Simulink.Parameter([0 2 5 10 15 20 30 40 50 60 80], StorageClass="ExportedGlobal", DataType="single")
P_LCS_PID_SteerAngSpdLim = Simulink.Parameter(25, StorageClass="ExportedGlobal", DataType="single")
P_LCS_PID_SteerAngSpdLimFacVal = Simulink.Parameter([1 1 0.5 0.25 0.25], StorageClass="ExportedGlobal", DataType="single")
P_LCS_PID_SteerAngSpdLimFacBp = Simulink.Parameter([0 2 5 10 15], StorageClass="ExportedGlobal", DataType="single")
P_LCS_PID_DrvTorqFacVal = Simulink.Parameter([1 0.5 0.1 0], StorageClass="ExportedGlobal", DataType="single")
P_LCS_PID_tarAngSlopeLPtime = Simulink.Parameter(0.1, StorageClass="ExportedGlobal", DataType="single")
P_LCS_PID_tarAngLimtVal = Simulink.Parameter(repmat(0.2, 1, 11), StorageClass="ExportedGlobal", DataType="single")
P_LCS_PID_tarAngLimtBp = Simulink.Parameter([0 2 5 10 15 20 30 40 50 60 80], StorageClass="ExportedGlobal", DataType="single")
P_LCS_PID_tarAngSlopeLimtBp = Simulink.Parameter([0 2 5 10 15 20], StorageClass="ExportedGlobal", DataType="single")
P_LCS_tDeltaEPS = Simulink.Parameter(0.22, StorageClass="ExportedGlobal", DataType="single")
P_LCS_TarSteerAngleIncFac = Simulink.Parameter(1, StorageClass="ExportedGlobal", DataType="single")
P_LCS_TorqReqMax = Simulink.Parameter(2.9, StorageClass="ExportedGlobal", DataType="single")
P_LCS_TorqReqMin = Simulink.Parameter(-2.9, StorageClass="ExportedGlobal", DataType="single")
P_LCS_MaxHeadingAngle_spd = Simulink.Parameter([0 20 40 60 80 100 120 140 160], StorageClass="ExportedGlobal", DataType="single")
P_LCS_MaxHeadingAngle_val = Simulink.Parameter([10 10 7 3.5 3 2.5 2 2 2], StorageClass="ExportedGlobal", DataType="single")
P_LCS_R2val = Simulink.Parameter([1 2 3.3 4.7 6 7.4 8.67 10 11.4 16.8 22.2 24.9 27.6 30.3 33 38.4], StorageClass="ExportedGlobal", DataType="single")
P_LCS_preDis_spd = Simulink.Parameter([0 5 10 15 20 25 30 35 40 60 80 90 100 110 120 140], StorageClass="ExportedGlobal", DataType="single")
P_LCS_preDis_tmax = Simulink.Parameter([1.5 1.5 1.5 1.5 1.5 1.5 1.5 1.5 1.5 1.5 1.8 1.8 1.8 1.8 1.8 1.8], StorageClass="ExportedGlobal", DataType="single")
P_LCS_StrAngRatio_enable = Simulink.Parameter(0, StorageClass="ExportedGlobal", DataType="uint8")
P_LCS_ApplyTorqSource = Simulink.Parameter(3, StorageClass="ExportedGlobal", DataType="uint8")
P_LCS_PID_aplyTorqLimtBp = Simulink.Parameter(single([0 0.5 1 1.5 2 2.5 3]), StorageClass="ExportedGlobal")
P_LCS_PID_DrvTorqFacBp = Simulink.Parameter([0.7 1 1.5 2], StorageClass="ExportedGlobal", DataType="single")
P_LCS_PID_Kd = Simulink.Parameter(0.01, StorageClass="ExportedGlobal", DataType="single")
P_LCS_PID_Kp = Simulink.Parameter(0.03, StorageClass="ExportedGlobal", DataType="single")
P_LCS_PID_Kp_SpdFacVal = Simulink.Parameter([0.1 0.1 0.3 0.35 0.4 0.5 0.6 0.7 0.8 1 1 1 1 1 1 1], StorageClass="ExportedGlobal", DataType="single")
P_LCS_preDis_tmin = Simulink.Parameter([0.8 0.8 0.8 0.8 0.8 0.8 0.8 0.8 0.8 0.8 0.7 0.7 0.7 0.7 0.7 0.7], StorageClass="ExportedGlobal", DataType="single")
P_LCS_PID_aplyTorqLimtVal = Simulink.Parameter(single([0.2 0.2 0.18 0.18 0.18 0.1 0.1]), StorageClass="ExportedGlobal")
P_LCS_PID_tarAngSlopeLimtVal = Simulink.Parameter([0.2 0.2 0.2 0.18 0.18 0.18], StorageClass="ExportedGlobal", DataType="single")
P_LCS_PID_Ki_TarAng_ESS = Simulink.Parameter(0, StorageClass="ExportedGlobal", DataType="single")
P_LCS_PID_Kp_TarTorq_ESS = Simulink.Parameter(2, StorageClass="ExportedGlobal", DataType="single")
P_LCS_TarTorq_Limit_ESS = Simulink.Parameter(0.25, StorageClass="ExportedGlobal", DataType="single")
P_LCS_PID_Kd_SpdFacBp = Simulink.Parameter([0 5 10 15 20 25 30 35 40 60 80 90 100 110 120 140], StorageClass="ExportedGlobal", DataType="single")
P_LCS_PID_Kd_SpdFacVal = Simulink.Parameter(repmat(1, 1, 16), StorageClass="ExportedGlobal", DataType="single")
P_LCS_PreTime_ESS = Simulink.Parameter(2, StorageClass="ExportedGlobal", DataType="single")
P_LCS_PID_Kp_TarAng_ESS = Simulink.Parameter(12, StorageClass="ExportedGlobal", DataType="single")
P_LCS_PID_Param_Speed_Adapt = ASAP2.Parameter([0 5 10 15 20 25 30 35 40 60 70 80 90 100 120 140], StorageClass="ExportedGlobal")
P_LCS_PID_Param_SteerWheelSpd_Adapt = ASAP2.Parameter([0 5 8 10 20 30 40 50], StorageClass="ExportedGlobal")
P_LCS_PID_Param_SteerWheelAngle_Factor_P = ASAP2.Parameter([1 1 1 0.9 0.8 0.7 0.6 0.58], StorageClass="ExportedGlobal")
P_LCS_PID_Param_SteerWheelAngle_Adapt = ASAP2.Parameter([0 3 6 10 15 20 30 45], StorageClass="ExportedGlobal")
P_LCS_PID_Param_SteerWheelAngle_Factor_D = ASAP2.Parameter([1 1 1 0.6 0.3 0.3 0.2 0.2], StorageClass="ExportedGlobal")
P_LCS_PID_Param_SteerWheelSpd_Factor_D = ASAP2.Parameter([1 1.5 1.8 2 2.5 2.8 3 4], StorageClass="ExportedGlobal")
P_LCS_PID_Param_Kifactor = ASAP2.Parameter(1, StorageClass="ExportedGlobal")
P_LCS_PID_Param_KdFilterTime = ASAP2.Parameter(0.02, StorageClass="ExportedGlobal")
P_LCS_PID_Param_Kd = ASAP2.Parameter(0, StorageClass="ExportedGlobal")
P_LCS_PID_Param_Ki = ASAP2.Parameter(0.001, StorageClass="ExportedGlobal")
P_LCS_PID_Param_Kp = ASAP2.Parameter(0.15, StorageClass="ExportedGlobal")
P_LCS_TorqueGainFilterTime = Simulink.Parameter(0.1, StorageClass="ExportedGlobal")
P_LCS_FF_Speed_Bp = Simulink.Parameter([0 5 10 15 20 25 30 35 40 60 70 80 90 100 120 140], StorageClass="ExportedGlobal")
P_LCS_FF_TarAngleTorq_Bp = Simulink.Parameter([-100 -80 -60 -55 -50 -45 -40 -35 -30 -25 -20 -15 -12 -10 -8 -6 -5 -4 -2 0 2 4 5 6 8 10 12 15 20 25 30 35 40 45 50 55 60 80 100], StorageClass="ExportedGlobal")
P_LCS_FF_TarAngleTorq_Factor = Simulink.Parameter([-2.35 -2.2937 -2.1785 -2.1305 -2.0729 -1.9866 -1.9098 -1.737 -1.5739 -1.4395 -1.3148 -1.1804 -1.0461 -0.97889 -0.85 -0.78 -0.71017 -0.6334 -0.53743 -0.0095969 0.4 0.50864 0.62 0.7 0.8 0.91 0.97889 1.1 1.2476 1.4299 1.5451 1.7 1.8 1.9194 2 2.0441 2.0921 2.25 2.3], StorageClass="ExportedGlobal")
P_LCS_FF_Speed_Factor = Simulink.Parameter([0.69545 0.6 0.56212 0.56212 0.56515 0.57121 0.57424 0.58333 0.6 0.95 1.0045 1.0742 1.1682 1.2591 1.3995 1.4976], StorageClass="ExportedGlobal")
P_LCS_PreTime_ESS2 = Simulink.Parameter(1.7, StorageClass="ExportedGlobal", DataType="single")
P_LCS_SW = Simulink.Parameter(1, StorageClass="ExportedGlobal", DataType="boolean")
P_LCS_PID_Kp_TarAng_ESS2 = Simulink.Parameter(0.5, StorageClass="ExportedGlobal", DataType="single")
P_LCS_PID_AngErrFacVal = Simulink.Parameter([1 1 0.8 0.6 0.3], StorageClass="ExportedGlobal")
P_LCS_PID_AngErrFacBp = Simulink.Parameter([0 2 4 6 12], StorageClass="ExportedGlobal")
P_LCS_MaxTorqSlope = Simulink.Parameter(0.05, StorageClass="ExportedGlobal", DataType="single")
P_LCS_preDis_Far = Simulink.Parameter([12 12 12 12 13 13 16 19 22 33 51 57 64 70 77 90], StorageClass="ExportedGlobal", DataType="single")
P_LCS_preDis_Nomal = Simulink.Parameter([8 9 10 11 12 13 14 15 17 22 28 31 35 38 42 49], StorageClass="ExportedGlobal", DataType="single")

P_LCS_FFW_Torq_V71 = Simulink.Parameter([-2.9 -2.3 -2.6 -2.9 -2.62 -2.9 -2.55 -2.29
 -2.9 -1.96 -2.6 -2.9 -2.62 -2.9 -2.55 -2.29
 -2.9 -1.65 -2.15 -2.9 -2.62 -2.9 -2.55 -2.29
 -2.5 -1.5 -2.1 -2.9 -2.62 -2.9 -2.55 -2.29
 -2.45 -1.45 -2.07 -2.8 -2.62 -2.9 -2.55 -2.29
 -2.35 -1.34 -2 -2.6 -2.62 -2.9 -2.55 -2.29
 -2.31 -1.22 -1.85 -2.45 -2.62 -2.9 -2.55 -2.29
 -2.18 -1.15 -1.75 -2.37 -2.62 -2.9 -2.55 -2.29
 -2.05 -1.04 -1.65 -2 -2.62 -2.9 -2.55 -2.29
 -1.86 -0.92 -1.3 -1.96 -2.61 -2.9 -2.55 -2.29
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 ], StorageClass="ExportedGlobal")

P_LCS_preDis_TmaxFac = Simulink.Parameter(repmat(0.8, 1, 16), StorageClass="ExportedGlobal")
LCS_PID_TorqD = Simulink.Signal(StorageClass="ExportedGlobal")
LCS_PID_TorqGain = Simulink.Signal(StorageClass="ExportedGlobal")
LCS_PID_TorqPD = Simulink.Signal(StorageClass="ExportedGlobal")
LCS_ControlAngleError = Simulink.Signal(StorageClass="ExportedGlobal")
LCS_CurSteerAngle_deg = Simulink.Signal(StorageClass="ExportedGlobal")
LCS_MaxHeadingAngle = Simulink.Signal(StorageClass="ExportedGlobal")
LCS_preDis = Simulink.Signal(StorageClass="ExportedGlobal")
LCS_Q = Simulink.Signal(StorageClass="ExportedGlobal")
LCS_R2 = Simulink.Signal(StorageClass="ExportedGlobal")
LCS_TarSteerAngle_deg = Simulink.Signal(StorageClass="ExportedGlobal")
LCS_TarSteerAngleSlope = Simulink.Signal(StorageClass="ExportedGlobal")
LCS_vDis = Simulink.Signal(StorageClass="ExportedGlobal")
LCS_epsTrqReqFlag = Simulink.Signal(StorageClass="ExportedGlobal")
LCS_epsTrqReqValue = Simulink.Signal(StorageClass="ExportedGlobal")
LCS_Counter = Simulink.Signal(StorageClass="ExportedGlobal", DataType="uint8")
LCS_IN_vxvRefMs = Simulink.Signal(StorageClass="ExportedGlobal")
LCS_IN_axvRefMs2 = Simulink.Signal(StorageClass="ExportedGlobal")
LCS_IN_ayvRefMs2 = Simulink.Signal(StorageClass="ExportedGlobal")
LCS_IN_kapTraj = Simulink.Signal(StorageClass="ExportedGlobal")
LCS_IN_alpSideSlipAngle = Simulink.Signal(StorageClass="ExportedGlobal")
LCS_IN_psiDtOpt = Simulink.Signal(StorageClass="ExportedGlobal")
LCS_IN_SteerAngOffset_deg = Simulink.Signal(StorageClass="ExportedGlobal")
LCS_IN_EPS_DrvInpTrqVal = Simulink.Signal(StorageClass="ExportedGlobal")
LCS_IN_EPS_LKATorqOvrlDlvd = Simulink.Signal(StorageClass="ExportedGlobal")
LCS_IN_EPS_LKATorqOvrlDlvdVld = Simulink.Signal(StorageClass="ExportedGlobal")
LCS_IN_SteerWheelSpd = Simulink.Signal(StorageClass="ExportedGlobal")
LCS_IN_SteerWheelAng = Simulink.Signal(StorageClass="ExportedGlobal")
LCS_IN_SteerWheelSpdSign = Simulink.Signal(StorageClass="ExportedGlobal")
LCS_IN_SteerWheelAngleSign = Simulink.Signal(StorageClass="ExportedGlobal")
LCS_IN_dCurrentLaneWidth = Simulink.Signal(StorageClass="ExportedGlobal")
LCS_EPS_LKATorqOvrlDlvd = Simulink.Signal(StorageClass="ExportedGlobal")
LCS_DangerLevelisNotESS = Simulink.Signal(StorageClass="ExportedGlobal")
LCS_ESS_TarTorq = Simulink.Signal(StorageClass="ExportedGlobal")
LCS_aplyTorqLimt = Simulink.Signal(StorageClass="ExportedGlobal")
LCS_tarAngLimt = Simulink.Signal(StorageClass="ExportedGlobal")
LCS_tarAngSlopeLimt = Simulink.Signal(StorageClass="ExportedGlobal")
ESS_TarAngle = Simulink.Signal(StorageClass="ExportedGlobal")
ESS_TarTorq = Simulink.Signal(StorageClass="ExportedGlobal")
LCS_ESS_TarAngle = Simulink.Signal(StorageClass="ExportedGlobal")
LCS_Torq_P = Simulink.Signal(StorageClass="ExportedGlobal")
LCS_Torq_D = Simulink.Signal(StorageClass="ExportedGlobal")
LCS_Torq_I = Simulink.Signal(StorageClass="ExportedGlobal")
LCS_Torq_FF = Simulink.Signal(StorageClass="ExportedGlobal")
LCS_Torq_PID = Simulink.Signal(StorageClass="ExportedGlobal")
LCS_Torq_OUT = Simulink.Signal(StorageClass="ExportedGlobal")
P_LCS_AngleSlope_SpdBp = Simulink.Parameter([0 30 60 90 120 140], StorageClass="ExportedGlobal")
P_LCS_AngleSlope_LimVal = Simulink.Parameter(repmat(0.2, 1, 6), StorageClass="ExportedGlobal")
P_LCS_AngleSlope_dtAddVal = Simulink.Parameter(repmat(0.1, 1, 6), StorageClass="ExportedGlobal")
P_LCS_AngleSlopeLimtCnt = Simulink.Parameter(50, StorageClass="ExportedGlobal")
P_LCS_TorqSlope_AngleErrorBp = Simulink.Parameter([0 1 3 5 7 9 12 15], StorageClass="ExportedGlobal")
P_LCS_TorqSlope_AngleErrorVal = Simulink.Parameter([0.03 0.05 0.08 0.1 0.12 0.15 0.18 0.18], StorageClass="ExportedGlobal")
P_LCS_AngleSlopeNormal = Simulink.Parameter(0.3, StorageClass="ExportedGlobal", DataType="single")
P_LCS_PID_Param_CurveBp = Simulink.Parameter([0 0.003 0.008 0.01 0.05 0.08 0.1], StorageClass="ExportedGlobal")
P_LCS_PID_Param_CurveFac = Simulink.Parameter([0 0 0.069091 0.10545 0.44242 0.6703 0.8], StorageClass="ExportedGlobal")
P_LCS_DeltaEps_SpdBp = Simulink.Parameter(single([0 5 10 15 20 25 30 35 40 60 80 90 100 110 120 140]), StorageClass="ExportedGlobal")
P_LCS_DeltaEps_TimeVal = Simulink.Parameter(single([0.8 0.8 0.77803 0.75258 0.71864 0.65924 0.5447 0.45773 0.38348 0.2 0.2 0.2 0.20106 0.2 0.2 0.2]), StorageClass="ExportedGlobal")
P_LCS_TorqSlope_TorqErrorBp = Simulink.Parameter([0 0.5 1 1.5 2], StorageClass="ExportedGlobal")
P_LCS_A3FilterTIme = Simulink.Parameter(0.05, StorageClass="ExportedGlobal", DataType="single")
P_LCS_A2FilterTIme = Simulink.Parameter(0.05, StorageClass="ExportedGlobal", DataType="single")
P_LCS_A0Slope_Min = Simulink.Parameter(5, StorageClass="ExportedGlobal", DataType="single")
P_LCS_A0Slope_Nomal = Simulink.Parameter(5, StorageClass="ExportedGlobal", DataType="single")
P_LCS_A1Slope_Min = Simulink.Parameter(0.5, StorageClass="ExportedGlobal", DataType="single")
P_LCS_A1SLope_Normal = Simulink.Parameter(0.5, StorageClass="ExportedGlobal", DataType="single")
P_LCS_AngleSlope_A3Bp = Simulink.Parameter([0 5.0e-5 0.001], StorageClass="ExportedGlobal")
P_LCS_AngleSlope_A3Val = Simulink.Parameter([0.3 0.6 0.8], StorageClass="ExportedGlobal", DataType="single")
P_LCS_PID_Param_SteerWheelSpd_Factor_P = ASAP2.Parameter([1 0.9 0.8 0.74439 0.6 0.5 0.4 0.3], StorageClass="ExportedGlobal")
P_LCS_FFWSwitch = Simulink.Parameter(0, StorageClass="ExportedGlobal")
P_LCS_PID_Param_Speed_Factor_D = ASAP2.Parameter([0.01 0.05 0.1 0.2 0.3 0.4 0.5 0.6 0.8 1 1 1 1 1 1 1], StorageClass="ExportedGlobal")
P_LCS_FF_LCRevs_SpdBP = Simulink.Parameter([0 10 20 30 40 50 60 70 80 90 100 110 120 130], StorageClass="ExportedGlobal")
P_LCS_FF_LCRevs_SpdVal = Simulink.Parameter([0 0.8 0.8 0.8 0.8 0.8 0.8 0.8 0.8 0.8 0.8 0.8 0.8 0.8], StorageClass="ExportedGlobal", DataType="single")
P_LCS_CANDelaySwitch = Simulink.Parameter(0, StorageClass="ExportedGlobal", DataType="uint8")
P_LCS_MinTorqSlope = Simulink.Parameter(0.02, StorageClass="ExportedGlobal", DataType="single")
P_LCS_TorqSlope_TorqErrorVal = Simulink.Parameter(single([0.02 0.05 0.1 0.15 0.18]), StorageClass="ExportedGlobal")
P_LCS_PID_Param_Speed_Factor_P = ASAP2.Parameter([1 0.8 0.8 0.8 0.8 0.8 0.8 0.8 1 1 1 1 1 1 1 1], StorageClass="ExportedGlobal")
LCS_TorqFFPID_OUT = Simulink.Signal(StorageClass="ExportedGlobal")
P_LCS_PIDSwitch = Simulink.Parameter(1, StorageClass="ExportedGlobal")
LCS_PID_torqP = Simulink.Signal(StorageClass="ExportedGlobal")
P_Global_WheelTrack_m = AUTOSAR4.Parameter(1.586, SwCalibrationAccess="ReadWrite", StorageClass="ExportedGlobal", DataType="single", Unit="m")
P_Global_Weight_N = AUTOSAR4.Parameter(20000, SwCalibrationAccess="ReadWrite", StorageClass="ExportedGlobal", DataType="single", Unit="N")
P_Global_VehicleWidthMin_m = AUTOSAR4.Parameter(1.86, SwCalibrationAccess="ReadWrite", StorageClass="ExportedGlobal", DataType="single", Unit="m")
P_Global_VehicleWidthMax_m = AUTOSAR4.Parameter(2.12, SwCalibrationAccess="ReadWrite", StorageClass="ExportedGlobal", DataType="single", Unit="m")
P_Global_Vehicle_Length_m = AUTOSAR4.Parameter(5, SwCalibrationAccess="ReadWrite", StorageClass="ExportedGlobal", DataType="single")
P_Global_TireRadius_m = AUTOSAR4.Parameter(0.358, SwCalibrationAccess="ReadWrite", StorageClass="ExportedGlobal", DataType="single", Unit="m")
P_Global_SteeringAngleRatio = AUTOSAR4.Parameter(17.79, SwCalibrationAccess="ReadWrite", StorageClass="ExportedGlobal", DataType="single")
P_Global_SideSlipAnglefactor = AUTOSAR4.Parameter(0.002, SwCalibrationAccess="ReadWrite", StorageClass="ExportedGlobal", DataType="single")
P_Global_RearAxleToCenter_m = AUTOSAR4.Parameter(1.48, SwCalibrationAccess="ReadWrite", StorageClass="ExportedGlobal", DataType="single", Unit="m")
P_Global_RadarToRearAxleCenterX_m = AUTOSAR4.Parameter(3.72, SwCalibrationAccess="ReadWrite", StorageClass="ExportedGlobal", DataType="single", Unit="m")
P_Global_IFV2Fwheel_Dx = AUTOSAR4.Parameter(0.827, SwCalibrationAccess="ReadWrite", StorageClass="ExportedGlobal", DataType="single")
P_Global_IFV2FrontBumper_m = AUTOSAR4.Parameter(1.7, SwCalibrationAccess="ReadWrite", StorageClass="ExportedGlobal", DataType="single", Unit="m")
P_Global_IFV2CenterAxis_m = AUTOSAR4.Parameter(-0.067, SwCalibrationAccess="ReadWrite", StorageClass="ExportedGlobal", DataType="single", Unit="m")
P_Global_Height_m = AUTOSAR4.Parameter(1.72, SwCalibrationAccess="ReadWrite", StorageClass="ExportedGlobal", DataType="single", Unit="m")
P_Global_FrontAxleToCenter_m = AUTOSAR4.Parameter(1.2, SwCalibrationAccess="ReadWrite", StorageClass="ExportedGlobal", DataType="single", Unit="m")
P_Global_DxvRearBumper_m = AUTOSAR4.Parameter(0.96, SwCalibrationAccess="ReadWrite", StorageClass="ExportedGlobal", DataType="single", Unit="m")
P_Global_DxvFrontBumper_m = AUTOSAR4.Parameter(3.8, SwCalibrationAccess="ReadWrite", StorageClass="ExportedGlobal", DataType="single", Unit="m")
P_Global_CharSpd_ms = AUTOSAR4.Parameter(26, SwCalibrationAccess="ReadWrite", StorageClass="ExportedGlobal", DataType="single", Unit="m/s")
P_Global_WheelBase_m = AUTOSAR4.Parameter(2.68, SwCalibrationAccess="ReadWrite", StorageClass="ExportedGlobal", DataType="single", Unit="m")
P_Global_IFV2RearAxis_m = AUTOSAR4.Parameter(2.1, SwCalibrationAccess="ReadWrite", StorageClass="ExportedGlobal", DataType="single", Unit="m")
LongCtrl_axvClosedLoopControl = Simulink.Signal(StorageClass="ExportedGlobal")
LongCtrl_axvDiff = Simulink.Signal(StorageClass="ExportedGlobal")
LongCtrl_axvModelDiff = Simulink.Signal(StorageClass="ExportedGlobal")
LongCtrl_axvModelRef = Simulink.Signal(StorageClass="ExportedGlobal")
LongCtrl_axvModelResidual = Simulink.Signal(StorageClass="ExportedGlobal")
LongCtrl_axvTracActMean = Simulink.Signal(StorageClass="ExportedGlobal")
LongCtrl_axvTracMin = Simulink.Signal(StorageClass="ExportedGlobal")
LongCtrl_DCEnable = Simulink.Signal(StorageClass="ExportedGlobal")
LongCtrl_ECEnable = Simulink.Signal(StorageClass="ExportedGlobal")
LongCtrl_FF_NetEngTorq = Simulink.Signal(StorageClass="ExportedGlobal")
LongCtrl_FF_NetEngTorqInc = Simulink.Signal(StorageClass="ExportedGlobal")
LongCtrl_FF_NetEngTorqMax = Simulink.Signal(StorageClass="ExportedGlobal", Unit="%")
LongCtrl_Fz = Simulink.Signal(StorageClass="ExportedGlobal")
LongCtrl_OverrideToDC = Simulink.Signal(StorageClass="ExportedGlobal")
LongCtrl_PI_NetEngTorq = Simulink.Signal(StorageClass="ExportedGlobal")
LongCtrl_PI_NetEngTorqInc = Simulink.Signal(StorageClass="ExportedGlobal")
LongCtrl_Sw2DC = Simulink.Signal(StorageClass="ExportedGlobal")
LongCtrl_Sw2DC1 = Simulink.Signal(StorageClass="ExportedGlobal")
LongCtrl_Sw2DC2 = Simulink.Signal(StorageClass="ExportedGlobal")
LongCtrl_Sw2DC3 = Simulink.Signal(StorageClass="ExportedGlobal")
LongCtrl_Sw2DC4 = Simulink.Signal(StorageClass="ExportedGlobal")
LongCtrl_Sw2DC5 = Simulink.Signal(StorageClass="ExportedGlobal")
LongCtrl_Sw2DC6 = Simulink.Signal(StorageClass="ExportedGlobal")
LongCtrl_Sw2DC7 = Simulink.Signal(StorageClass="ExportedGlobal")
LongCtrl_Sw2EC = Simulink.Signal(StorageClass="ExportedGlobal")
LongCtrl_Sw2EC1 = Simulink.Signal(StorageClass="ExportedGlobal")
LongCtrl_Sw2EC2 = Simulink.Signal(StorageClass="ExportedGlobal")
LongCtrl_Sw2EC3 = Simulink.Signal(StorageClass="ExportedGlobal")
LongCtrl_Sw2EC4 = Simulink.Signal(StorageClass="ExportedGlobal")
LongCtrl_Sw2EC5 = Simulink.Signal(StorageClass="ExportedGlobal")
LongCtrl_Tr_Ratio = Simulink.Signal(StorageClass="ExportedGlobal")
LongCtrl_UpdateEnable_axvModeldiff = Simulink.Signal(StorageClass="ExportedGlobal")
LongCtrl_VlcInternalAcc = Simulink.Signal(StorageClass="ExportedGlobal")
LongCtrl_ACC_EngTrqReq = Simulink.Signal(StorageClass="ExportedGlobal")
LongCtrl_ACC_Decel_ReqValue = Simulink.Signal(StorageClass="ExportedGlobal")
LongCtrl_Counter = Simulink.Signal(StorageClass="ExportedGlobal")
LongCtrl_SW_VERSION = Simulink.Signal(StorageClass="ExportedGlobal")
P_LongCtrl_VLCaXCDeadZoneProp_Y = Simulink.Parameter([60 10 0 0 0 10 60], StorageClass="ExportedGlobal", DataType="single")
P_LongCtrl_VLCaXCKiCtrlDevChar_Y = Simulink.Parameter([1 1 0.9 0.85 0.7 0.6 0.7 0.85 0.9 1 1], StorageClass="ExportedGlobal", DataType="single")
P_LongCtrl_VLCaxCtrlDevDeadZoneChar_Y = Simulink.Parameter([0.15 0.15 0.18 0.2 0.2], StorageClass="ExportedGlobal", DataType="single")
P_LongCtrl_VLCaxCtrlDevEC2DCMax = Simulink.Parameter(0.5, StorageClass="ExportedGlobal", DataType="single")
P_LongCtrl_VLCaxCtrlDevFastQuitDCMode = Simulink.Parameter(0.7, StorageClass="ExportedGlobal", DataType="single")
P_LongCtrl_VLCaxCtrlDevThresAddEC2DC = Simulink.Parameter([0.1 0.1 0.15 0.2 0.2], StorageClass="ExportedGlobal", DataType="single")
P_LongCtrl_VLCAxCtrlDevThresAddEC2DC_Y = Simulink.Parameter([0.1 0.1 0.15 0.2 0.2], StorageClass="ExportedGlobal", DataType="single")
P_LongCtrl_VLCaxCtrlDevTresAddDC2EC = Simulink.Parameter([0.15 0.15 0.12 0.1 0.1], StorageClass="ExportedGlobal", DataType="single")
P_LongCtrl_VLCdaxTarEC2DCMax = Simulink.Parameter(-0.2, StorageClass="ExportedGlobal", DataType="single")
P_LongCtrl_VLCdriveOffAxUpLimXAxix = Simulink.Parameter([0 0.5 1 1.5 3], StorageClass="ExportedGlobal", DataType="single")
P_LongCtrl_VLCdriveOffAxUpLimYAxix = Simulink.Parameter([1.1 1.1 1.3 1.8 2], StorageClass="ExportedGlobal", DataType="single")
P_LongCtrl_VLCki = Simulink.Parameter(0.05, StorageClass="ExportedGlobal", DataType="single")
P_LongCtrl_VLCkp = Simulink.Parameter(4, StorageClass="ExportedGlobal", DataType="single")
P_LongCtrl_VLCks = Simulink.Parameter(0.45, StorageClass="ExportedGlobal", DataType="single")
P_LongCtrl_VLCAxTarDtThreEnableI = Simulink.Parameter(0.4, StorageClass="ExportedGlobal", DataType="single", Min=0, Max=5, Unit="m/s^3")
P_LongCtrl_VLCaxvRoadSlopeDC4CharXAxis = Simulink.Parameter([-0.5 -0.3 -0.2 -0.1 0], StorageClass="ExportedGlobal", DataType="single", Min=-4, Max=1, Unit="m/s^2")
P_LongCtrl_VLCaxvRoadSlopeDC4CharYAxis = Simulink.Parameter([0 0.2 0.4 0.8 1], StorageClass="ExportedGlobal", DataType="single", Min=0, Max=1)
P_LongCtrl_VLCAxvTracMinDC1FullFillXAxis = Simulink.Parameter([0 10 15 30], StorageClass="ExportedGlobal", DataType="single", Min=0, Max=60, Unit="m/s")
P_LongCtrl_VLCAxvTracMinDC1FullFillYAxis = Simulink.Parameter([0 0 0 0], StorageClass="ExportedGlobal", DataType="single", Min=-1, Max=1, Unit="m/s^2")
P_LongCtrl_VLCcoefFXAxis = Simulink.Parameter([0 20 40 60 80 100 120 140 160 180], StorageClass="ExportedGlobal", DataType="single", Min=0, Max=250, Unit="km/h")
P_LongCtrl_VLCcoefFYAxis = Simulink.Parameter([0.0111 0.0112 0.0114 0.0117 0.0122 0.0127 0.0136 0.0147 0.0162 0.0183], StorageClass="ExportedGlobal", DataType="single", Min=0, Max=1)
P_LongCtrl_VLCcoefIFadeOut1Calc = Simulink.Parameter(4, StorageClass="ExportedGlobal", DataType="single", Min=1, Max=10)
P_LongCtrl_VLCcoefIFadeOut1Condition = Simulink.Parameter(0.75, StorageClass="ExportedGlobal", DataType="single", Min=0, Max=1)
P_LongCtrl_VLCcoefIFadeOut2Calc = Simulink.Parameter(3, StorageClass="ExportedGlobal", DataType="single", Min=1, Max=10)
P_LongCtrl_VLCcoefIFadeOut2Condition = Simulink.Parameter(0.5, StorageClass="ExportedGlobal", DataType="single", Min=0, Max=1)
P_LongCtrl_VLCcoefIFadeOut3Calc = Simulink.Parameter(2, StorageClass="ExportedGlobal", DataType="single", Min=1, Max=10)
P_LongCtrl_VLCcoefIFadeOut3Condition = Simulink.Parameter(0.25, StorageClass="ExportedGlobal", DataType="single", Min=0, Max=1)
P_LongCtrl_VLCCounterAxvTracMinTimeout = Simulink.Parameter(40, StorageClass="ExportedGlobal", DataType="single", Min=0, Max=100)
P_LongCtrl_VLCCounterDC2ECTorqDelay = Simulink.Parameter(15, StorageClass="ExportedGlobal", DataType="single", Min=0, Max=100)
P_LongCtrl_VLCCounterDrvOff2EC = Simulink.Parameter(2, StorageClass="ExportedGlobal", DataType="single", Min=0, Max=100)
P_LongCtrl_VLCDtAxvRef2UpperBandDC5 = Simulink.Parameter(-0.5, StorageClass="ExportedGlobal", DataType="single", Min=-1, Max=1)
P_LongCtrl_VLCIACompensionNeg = Simulink.Parameter(-0.05, StorageClass="ExportedGlobal", DataType="single", Min=-3, Max=0, Unit="m/s^2")
P_LongCtrl_VLCIACompensionPos = Simulink.Parameter(0.05, StorageClass="ExportedGlobal", DataType="single", Min=0, Max=3, Unit="m/s^2")
P_LongCtrl_VLCTorqDiffThreAxvTracMinTimeout = Simulink.Parameter(4, StorageClass="ExportedGlobal", DataType="single", Min=0, Max=20)
P_LongCtrl_VLCTrTatioMax = Simulink.Parameter(18, StorageClass="ExportedGlobal", DataType="single", Min=10, Max=30)
P_LongCtrl_VLCTrTatioMin = Simulink.Parameter(0.5, StorageClass="ExportedGlobal", DataType="single", Min=0.1, Max=1)
P_LongCtrl_VLCVlcAccThresAxvTracMinTimeout = Simulink.Parameter(0, StorageClass="ExportedGlobal", DataType="single", Min=-5, Max=2, Unit="m/s^2")
P_LongCtrl_VLCaccelMinHoldXAxis = Simulink.Parameter([1 3], StorageClass="ExportedGlobal", DataType="single", Min=0, Max=5, Unit="m/s^2")
P_LongCtrl_VLCaccelMinHoldYAxis = Simulink.Parameter([-2 -4], StorageClass="ExportedGlobal", DataType="single", Min=-6, Max=0, Unit="m/s^2")
P_LongCtrl_VLCjerkHoldXAxis = Simulink.Parameter([1 3], StorageClass="ExportedGlobal", DataType="single", Min=0, Max=4, Unit="m/s^2")
P_LongCtrl_VLCjerkHoldYAxis = Simulink.Parameter([-5 -30], StorageClass="ExportedGlobal", DataType="single", Min=-50, Max=0, Unit="m/s^3")
LCS_CurSteerAngleSpd_degs = Simulink.Signal(StorageClass="ExportedGlobal")
Override = Simulink.Signal(StorageClass="ExportedGlobal")
TargetAngle_deg = Simulink.Signal(StorageClass="ExportedGlobal")